# Grasshopper definition line_model_single_V2.gh (Grasshopper 1.0.8)
# plug-ins: Human

range = Range(Domain=Domain(0, 1), Steps=Slider(4, range=0..10))
graph_mapper = GraphMapper(
    range,
    x0=0,
    x1=1,
    y0=0,
    y1=1,
    container_name="Bezier",
    cpx=[0, 0.6488399506, 0.8717642426, 1],
    cpy=[0.02372187376, 0.08980971575, 0.464922905, 1])

# ----
# Type A: Low Symmetric Module
brep = Brep([<brep referenced from the Rhino model> x67])
unit_y = UnitY(Factor=1)
construct_point = ConstructPoint(XCoordinate="173.174", YCoordinate="52.937", ZCoordinate="24.596")
unit_x = UnitX(Factor=1)
point = Point(Point(163.5542514, 52.93668045, 24.59639862))
plane_normal = PlaneNormal(Origin=construct_point, ZAxis=unit_y)
plane_normal_2 = PlaneNormal(Origin=construct_point, ZAxis=unit_x)
mirror = Mirror(Geometry=brep, Plane=plane_normal_2)  # -> Geometry, Transform
mirror_2 = Mirror(Geometry=[brep, mirror.Geometry], Plane=plane_normal)  # -> Geometry, Transform
merge = Merge(Data1=brep, Data2=mirror.Geometry, Data3=mirror_2.Geometry)

number_slider = Slider(3, range=0..10)
number_slider_2 = Slider(4.81, range=0..10)
number_slider_3 = Slider(2, range=0..10)

point_2 = Point([Point(132.2950958, 60.15161084, 22.17791246), Point(135.8604859, 60.15161084, 22.17791246), Point(134.6579859, 55.34161084, 22.17791246)])  # disabled
point_3 = Point([Point(132.2950958, 45.72161084, 22.17791246), Point(135.8604859, 45.72161084, 22.17791246), Point(134.6579859, 50.53161084, 22.17791246)])  # disabled
panel = Panel(point_2)  # disabled
panel_2 = Panel(point_3)  # disabled
point_4 = Point([Point(135.2146887, 39.58090502, 24.78351239), Point(133.8377993, 39.36141957, 24.78790208)])  # disabled
point_5 = Point([Point(133.8377993, 66.51180211, 24.78790242), Point(135.2146887, 66.29231667, 24.78351269)])  # disabled
panel_3 = Panel(point_4)  # disabled
panel_4 = Panel(point_5)  # disabled

# ----
# Low module supports
point_6 = Point([<point referenced from the Rhino model> x2])

# ----
# create and manipulate graph
brep_2 = Brep(<brep referenced from the Rhino model>)
curve = Curve(<curve referenced from the Rhino model>)
python_3_script = Python3Script(
    boundary=curve,
    roof_brep=brep_2,
    supports=point_6,
    extend_width=number_slider_2,
    extend_div=number_slider_3,
    z_steps=graph_mapper)  # -> out, ridges_tree, all_edges, graph, all_nodes, node_keys; inputs boundary: Curve, roof_brep: Brep, supports: list of Point3d, extend_width: Double, extend_div: Int32, z_steps: list of Double
# ---------- python_3_script: Python ----------
import os
import sys
from compas_rhino import unload_modules
import compas
compas.PRECISION = ".3f"

gh_dir = os.path.dirname(ghenv.Component.OnPingDocument().FilePath)
root_dir = os.path.dirname(gh_dir)
if gh_dir not in sys.path:
    sys.path.append(gh_dir)
if root_dir not in sys.path:
    sys.path.append(root_dir)

import tree_builder_singleWN_v2
import nodegraph_WN
import importlib

importlib.reload(nodegraph_WN)
importlib.reload(tree_builder_singleWN_v2)


from tree_builder_singleWN_v2 import build_tree_graph
from tree_builder_singleWN_v2 import build_level_zero
from compas_rhino.conversions import point_to_compas



# CONSTANTS #
div_x = 4
div_y = 6
num_levels = 4
inset_edge = 1.2
inset_interior = 0.9

# Build the graph (all logic is in tree_builder.py)
ng = build_tree_graph(
    boundary=boundary,
    supports=supports,
    roof_brep=roof_brep,
    div_x=4,
    div_y=6,
    num_levels=4,
    z_steps=[0, 0.105, 0.176, 0.398, 1.0],
    inset_edge=1.2,
    inset_interior=0.9,
    reach_tol=0.05,   
    debug=True
)

# Outputs
all_edges = ng.edge_lines()
graph = ng
all_nodes = ng.node_points()
node_keys = list(ng.nodes())

from collections import Counter
level_counts = Counter()
for n in ng.nodes():
    attrs = ng.node_attributes(n)
    if attrs.get("ntype") == "apex":
        level_counts[attrs.get("level", -1)] += 1
print("Apex nodes per level:", dict(level_counts))

for n in ng.nodes():
    attrs = ng.node_attributes(n)
    if attrs.get("reached") == True and attrs.get("level", -1) > 2:
        pt = ng.node_point(n)
        print("Support node {}: ({:.3f}, {:.3f}, {:.3f})".format(n, pt.x, pt.y, pt.z))

for i, s in enumerate(supports):
    print("Input support {}: ({:.3f}, {:.3f}, {:.3f})".format(i, s.X, s.Y, s.Z))

for n in ng.nodes():
    attrs = ng.node_attributes(n)
    if attrs.get("ntype") == "apex" and attrs.get("level") == 3:
        pt = ng.node_point(n)
        print("Level 3 apex node {}: ({:.3f}, {:.3f}, {:.3f}), sup_id={}".format(
            n, pt.x, pt.y, pt.z, attrs.get("support_id")))

for n in ng.nodes():
    attrs = ng.node_attributes(n)
    if attrs.get("ntype") == "apex" and attrs.get("level") == 2:
        pt = ng.node_point(n)
        print("Level 2 apex {}: X={:.3f}, Y={:.3f}".format(n, pt.x, pt.y))

for n in ng.nodes():
    attrs = ng.node_attributes(n)
    pt = ng.node_point(n)
    if 133 < pt.x < 135.5 and attrs.get("ntype") == "apex":
        print("node {}: level={} X={:.3f} Y={:.3f} Z={:.3f}".format(
            n, attrs.get("level"), pt.x, pt.y, pt.z))

for n in ng.nodes():
    pt = ng.node_point(n)
    if (abs(pt.y - 50.532) < 0.1 or abs(pt.y - 55.342) < 0.1):
        attrs = ng.node_attributes(n)
        print("node {}: level={} X={:.3f} Y={:.3f} Z={:.3f} type={}".format(
            n, attrs.get("level"), pt.x, pt.y, pt.z, attrs.get("ntype")))

for n in ng.nodes():
    attrs = ng.node_attributes(n)
    if attrs.get("ntype") == "apex" and attrs.get("level", -1) >= 1:
        pt = ng.node_point(n)
        print("node {}: level={} X={:.3f} Y={:.3f} Z={:.3f}".format(
            n, attrs.get("level"), pt.x, pt.y, pt.z))
# ---------- end python_3_script ----------
compas_draw = COMPASDraw(cg=python_3_script.all_edges)  # -> rg
#   port cg: The COMPAS geometry or datastructure to be drawn.
#   port rg: The Rhino geometry object.
# ---------- compas_draw: Python ----------
# r: compas>=2.14.1
"""
Draws COMPAS geometry in Grasshopper.
"""

from typing import Any

import Grasshopper

from compas.scene import SceneObject


class CompasToRhinoGeometry(Grasshopper.Kernel.GH_ScriptInstance):
    def RunScript(self, cg):
        if not cg:
            return None

        return SceneObject(item=cg).draw()
# ---------- end compas_draw ----------
compas_draw_2 = COMPASDraw(cg=python_3_script.all_nodes)  # -> rg; same code as compas_draw
python_3_script_2 = Python3Script(graph=python_3_script.graph, roof_brep=brep_2)  # -> out, edges, nodes, idx, node_graph, a, b, c; inputs roof_brep: Brep
# ---------- python_3_script_2: Python ----------
from copy import deepcopy
from compas.geometry import Point
import os
import sys
import Rhino.Geometry as rg

gh_dir = os.path.dirname(ghenv.Component.OnPingDocument().FilePath)
if gh_dir not in sys.path:
    sys.path.insert(0, gh_dir)

import nodegraph_WN
import importlib
importlib.reload(nodegraph_WN)
ng = deepcopy(graph)

# ---- Create beam nodes FIRST (need 137-140 coordinates) ----
sup_x = 134.680

def add_beam_node(ng, support_node, node_a, node_b, sup_x):
    pa = ng.node_attribute(node_a, "point")
    pb = ng.node_attribute(node_b, "point")
    mid_y = (pa.y + pb.y) / 2.0
    mid_z = (pa.z + pb.z) / 2.0
    beam_pt = Point(sup_x, mid_y, mid_z)
    beam_node = ng.get_or_add_point_node(beam_pt, mobility="yz_free")
    ng.add_graph_edge(support_node, beam_node)
    return beam_node

node_146 = add_beam_node(ng, 143, 138, 137, sup_x)
node_147 = add_beam_node(ng, 145, 139, 140, sup_x)

# ---- Delete unwanted nodes (auto-deletes their edges) ----
for node_id in [144, 137, 138, 139, 140]:
    if ng.has_node(node_id):
        ng.delete_node(node_id)

# ---- Perpendicular foot points on boundary edges ----
# 121 → foot on line 11-7 (Y-min boundary)
# 133 → foot on line 108-114 (Y-max boundary)

perp_pairs = [
    [121, 11, 7],
    [133, 108, 114],[129, 81, 64], [131, 97, 78], [123, 41,24], [125, 57, 38]
]
ng.add_segments_perpendicular(perp_pairs)

# ---- Add all new edges ----
new_edges = [
    # beam nodes to level-1
    (node_146, 127), (node_147, 127),
    (node_146, 124), (node_146, 125), (node_146, 123),
    (node_146, 126), (node_146, 128),
    (node_147, 128), (node_147, 126),
    (node_147, 129), (node_147, 130), (node_147, 131),
    # support to level-1
    (143, 121), (143, 125), (143, 123),
    (145, 133), (145, 131), (145, 129),
]
for u, v in new_edges:
    ng.add_graph_edge(u, v)

# ---- Outputs ----
edges = ng.edge_lines_by_group(0) + ng.edge_lines_by_group(1)
nodes = ng.node_points()
idx = list(ng.nodes())
node_graph = ng

a = ng.points_by_mobility("fixed")
b = ng.points_by_mobility("z_free")
c = ng.points_by_mobility("yz_free")
# ---------- end python_3_script_2 ----------

# ----
# High module supports
point_7 = Point([<point referenced from the Rhino model> x2])

brep_3 = Brep(<brep referenced from the Rhino model>)
point_8 = Point([<point referenced from the Rhino model> x2])
control_points = ControlPoints(Curve=curve)  # -> Points, Weights, Knots
curve_2 = Curve(<curve referenced from the Rhino model>)
brep_4 = Brep(<brep referenced from the Rhino model>)
point_9 = Point([<point referenced from the Rhino model> x2])
curve_3 = Curve(<curve referenced from the Rhino model>)
point_list = PointList(Points=point_6, Size=number_slider)
python_3_script_3 = Python3Script(
    boundary=curve_2,
    roof_brep=brep_3,
    supports=point_8,
    extend_width=number_slider_2,
    extend_div=number_slider_3,
    z_steps=graph_mapper)  # -> out, ridges_tree, all_edges, graph, all_nodes, node_keys; inputs boundary: Curve, roof_brep: Brep, supports: list of Point3d, extend_width: Double, extend_div: Int32, z_steps: list of Double
# ---------- python_3_script_3: Python ----------
import os
import sys
from compas_rhino import unload_modules
import compas
compas.PRECISION = ".3f"

gh_dir = os.path.dirname(ghenv.Component.OnPingDocument().FilePath)
sys.path.append(gh_dir)

import tree_builder_singleWN_v2
import nodegraph_WN
import importlib

importlib.reload(nodegraph_WN)
importlib.reload(tree_builder_singleWN_v2)


from tree_builder_singleWN_v2 import build_tree_graph
from tree_builder_singleWN_v2 import build_level_zero
from compas_rhino.conversions import point_to_compas



# CONSTANTS #
div_x = 4
div_y = 6
num_levels = 4
inset_edge = 1.2
inset_interior = 0.9

# Build the graph (all logic is in tree_builder.py)
ng = build_tree_graph(
    boundary=boundary,
    supports=supports,
    roof_brep=roof_brep,
    div_x=4,
    div_y=6,
    num_levels=4,
    z_steps=[0, 0.105, 0.176, 0.398, 1.0],
    inset_edge=1.2,
    inset_interior=0.9,
    reach_tol=0.05,   
    debug=True
)

# Outputs
all_edges = ng.edge_lines()
graph = ng
all_nodes = ng.node_points()
node_keys = list(ng.nodes())

from collections import Counter
level_counts = Counter()
for n in ng.nodes():
    attrs = ng.node_attributes(n)
    if attrs.get("ntype") == "apex":
        level_counts[attrs.get("level", -1)] += 1
print("Apex nodes per level:", dict(level_counts))

for n in ng.nodes():
    attrs = ng.node_attributes(n)
    if attrs.get("reached") == True and attrs.get("level", -1) > 2:
        pt = ng.node_point(n)
        print("Support node {}: ({:.3f}, {:.3f}, {:.3f})".format(n, pt.x, pt.y, pt.z))

for i, s in enumerate(supports):
    print("Input support {}: ({:.3f}, {:.3f}, {:.3f})".format(i, s.X, s.Y, s.Z))

for n in ng.nodes():
    attrs = ng.node_attributes(n)
    if attrs.get("ntype") == "apex" and attrs.get("level") == 3:
        pt = ng.node_point(n)
        print("Level 3 apex node {}: ({:.3f}, {:.3f}, {:.3f}), sup_id={}".format(
            n, pt.x, pt.y, pt.z, attrs.get("support_id")))

for n in ng.nodes():
    attrs = ng.node_attributes(n)
    if attrs.get("ntype") == "apex" and attrs.get("level") == 2:
        pt = ng.node_point(n)
        print("Level 2 apex {}: X={:.3f}, Y={:.3f}".format(n, pt.x, pt.y))

for n in ng.nodes():
    attrs = ng.node_attributes(n)
    pt = ng.node_point(n)
    if 133 < pt.x < 135.5 and attrs.get("ntype") == "apex":
        print("node {}: level={} X={:.3f} Y={:.3f} Z={:.3f}".format(
            n, attrs.get("level"), pt.x, pt.y, pt.z))

for n in ng.nodes():
    pt = ng.node_point(n)
    if (abs(pt.y - 50.532) < 0.1 or abs(pt.y - 55.342) < 0.1):
        attrs = ng.node_attributes(n)
        print("node {}: level={} X={:.3f} Y={:.3f} Z={:.3f} type={}".format(
            n, attrs.get("level"), pt.x, pt.y, pt.z, attrs.get("ntype")))

for n in ng.nodes():
    attrs = ng.node_attributes(n)
    if attrs.get("ntype") == "apex" and attrs.get("level", -1) >= 1:
        pt = ng.node_point(n)
        print("node {}: level={} X={:.3f} Y={:.3f} Z={:.3f}".format(
            n, attrs.get("level"), pt.x, pt.y, pt.z))
# ---------- end python_3_script_3 ----------
python_3_script_4 = Python3Script(
    boundary=curve_3,
    roof_brep=brep_4,
    supports=point_9,
    extend_width=number_slider_2,
    extend_div=number_slider_3,
    z_steps=graph_mapper)  # -> out, ridges_tree, all_edges, graph, all_nodes, node_keys; inputs boundary: Curve, roof_brep: Brep, supports: list of Point3d, extend_width: Double, extend_div: Int32, z_steps: list of Double; same code as python_3_script_3

swatch = ColourSwatch(SwatchColor=RGB(51, 56, 66))
text_tag = TextTag(Location=compas_draw_2, Text=python_3_script.node_keys, Colour=swatch)
dot_display = DotDisplay(Point=compas_draw_2, Colour=swatch, Size=Slider(0.1, range=0..0.1))

custom_preview_lineweights = CustomPreviewLineweights(
    Geometry=compas_draw,
    Shader=ColourSwatch(SwatchColor=RGB(144, 209, 232)),
    Thickness=Slider(4, range=0..10),
    Absolute=False)

control_points_2 = ControlPoints(Curve=curve_3)  # -> Points, Weights, Knots
point_list_2 = PointList(Points=control_points.Points, Size=number_slider)
compas_draw_3 = COMPASDraw(cg=python_3_script_3.all_edges)  # -> rg; same code as compas_draw
compas_draw_4 = COMPASDraw(cg=python_3_script_4.all_edges)  # -> rg; same code as compas_draw
point_list_3 = PointList(Points=control_points_2.Points, Size=number_slider)
python_3_script_5 = Python3Script(graph=python_3_script_3.graph, roof_brep=brep_3)  # -> out, edges, nodes, idx, node_graph, a, b, c; inputs roof_brep: Brep; same code as python_3_script_2
python_3_script_6 = Python3Script(graph=python_3_script_4.graph, roof_brep=brep_4)  # -> out, edges, nodes, idx, node_graph, a, b, c; inputs roof_brep: Brep; same code as python_3_script_2

# ----
# Type A: Low Symmetrical Module
brep_5 = Brep(graft([<brep referenced from the Rhino model> x280]))
point_10 = Point(<point referenced from the Rhino model>)
point_11 = Point([<point referenced from the Rhino model> x13])
vector_2pt = Vector2Pt(PointA=point_10, PointB=point_11, Unitize=False)  # -> Vector, Length

compas_draw_5 = COMPASDraw(cg=python_3_script_5.edges)  # -> rg; same code as compas_draw
compas_draw_6 = COMPASDraw(cg=python_3_script_6.edges)  # -> rg; same code as compas_draw

# ----
# Type B: High Symmetrical Module
point_12 = Point()
point_13 = Point()
brep_6 = Brep(graft([<brep referenced from the Rhino model> x286]))
vector_2pt_2 = Vector2Pt(PointA=point_13, PointB=point_12, Unitize=False)  # -> Vector, Length

move = Move(Geometry=brep_6, Motion=vector_2pt_2.Vector)  # -> Geometry, Transform
move_2 = Move(Geometry=brep_5, Motion=vector_2pt.Vector)  # -> Geometry, Transform
custom_preview = CustomPreview(Geometry=[brep_5, move_2.Geometry], Material=ColourSwatch(SwatchColor=RGB(255, 189, 23)))

# ----
# Preview segments
number_slider_4 = Slider(15, range=0..15)
python_3_script_7 = Python3Script(graph=python_3_script_2.node_graph, segment_id=number_slider_4)  # -> out, primary, secondary, subgraph; inputs segment_id: Int32
# ---------- python_3_script_7: Python ----------
import os, sys, importlib
gh_dir = os.path.dirname(ghenv.Component.OnPingDocument().FilePath)
if gh_dir not in sys.path:
    sys.path.insert(0, gh_dir)

import edge_classifier
importlib.reload(edge_classifier)
from edge_classifier import classify_single_segment

result = classify_single_segment(graph, segment_index = segment_id,parallel_tol=0.9, near_threshold=1.0)

primary = result["primary_lines"]
secondary = result["secondary_lines"]
subgraph = result["subgraph"]
# ---------- end python_3_script_7 ----------
compas_draw_7 = COMPASDraw(cg=python_3_script_7.primary)  # -> rg; same code as compas_draw
compas_draw_8 = COMPASDraw(cg=python_3_script_7.secondary)  # -> rg; same code as compas_draw
custom_preview_lineweights_2 = CustomPreviewLineweights(Geometry=compas_draw_8, Shader=ColourSwatch(SwatchColor=RGB(50, 143, 103)), Thickness="5", Absolute=False)
custom_preview_lineweights_3 = CustomPreviewLineweights(Geometry=compas_draw_7, Shader=ColourSwatch(SwatchColor=RGB(137, 50, 143)), Thickness="20", Absolute=False)

# ----
# Preview nodes
# fixed
# z-free
# yz-free
compas_draw_9 = COMPASDraw(cg=python_3_script_2.edges)  # -> rg; same code as compas_draw
compas_draw_10 = COMPASDraw(cg=python_3_script_2.nodes)  # -> rg; same code as compas_draw
text_tag_2 = TextTag(Location=compas_draw_10, Text=python_3_script_2.idx, Colour=ColourSwatch(SwatchColor=RGB(23, 64, 15)))
compas_draw_11 = COMPASDraw(cg=python_3_script_2.c)  # -> rg; same code as compas_draw
compas_draw_12 = COMPASDraw(cg=python_3_script_2.b)  # -> rg; same code as compas_draw
compas_draw_13 = COMPASDraw(cg=python_3_script_2.a)  # -> rg; same code as compas_draw
dot_display_2 = DotDisplay(Point=compas_draw_11, Colour=ColourSwatch(SwatchColor=RGB(173, 201, 107)), Size=Slider(0.1, range=0..0.1))
dot_display_3 = DotDisplay(Point=compas_draw_12, Colour=ColourSwatch(SwatchColor=RGB(107, 201, 160)), Size=Slider(0.1, range=0..0.1))
dot_display_4 = DotDisplay(Point=compas_draw_13, Colour=ColourSwatch(SwatchColor=RGB(201, 107, 107)), Size=Slider(0.1, range=0..0.1))
