# Grasshopper definition 070526_SL_modulization_v13.gh (Grasshopper 1.0.8)
# plug-ins: treesloth01, Pufferfish, Human

range = Range(Domain=Domain(0, 1), Steps="3")
range_2 = Range(Domain=Domain(0, 1), Steps="3")
range_3 = Range(Domain=Domain(0, 1), Steps="3")
range_4 = Range(Domain=Domain(0, 1), Steps="3")
graph_mapper = GraphMapper(
    range_2,
    x0=0,
    x1=1,
    y0=0,
    y1=1,
    container_name="Bezier",
    cpx=[0, 0.415862143, 0.940971911, 1],
    cpy=[0, 0.0582934618, 0.3582203984, 1])
graph_mapper_2 = GraphMapper(
    range_3,
    x0=0,
    x1=1,
    y0=0,
    y1=1,
    container_name="Bezier",
    cpx=[0, 0.415862143, 0.940971911, 1],
    cpy=[0, 0.0582934618, 0.3582203984, 1])
graph_mapper_3 = GraphMapper(
    range,
    x0=0,
    x1=1,
    y0=0,
    y1=1,
    container_name="Bezier",
    cpx=[0, 0.415862143, 0.940971911, 1],
    cpy=[0, 0.0582934618, 0.3582203984, 1])
graph_mapper_4 = GraphMapper(
    range_4,
    x0=0,
    x1=1,
    y0=0,
    y1=1,
    container_name="Bezier",
    cpx=[0, 0.415862143, 0.8706001639, 1],
    cpy=[0, 0.0582934618, 0.2888201475, 1])

entwine = Entwine(Branch00=graph_mapper_4, Branch01=graph_mapper_2, Branch02=graph_mapper, Branch03=graph_mapper_3, FlattenInputs=True)  # -> simplify(Result)
panel = Panel("modify points")
# half the beam width?
number_slider = Slider(0.02, range=0..0.1)
# grasp_frames, sequence,
# assembly_method
module_id = ValueList({"0", "1", "6": 2, "7": 3}, selected="1")
number_slider_2 = Slider(0, range=0..3)
sequence = Slider(56, range=0..56)
panel_2 = Panel("""0
1
6
7""")
unit_z = UnitZ(Factor="0.1")
colour_swatch = ColourSwatch(SwatchColor=RGB(0, 0, 0))
human_scale = Geometry(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)
working_space_rfl = Geometry([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])
custom_preview = CustomPreview(Geometry=working_space_rfl, Material=ColourSwatch(SwatchColor=RGB(120, 98, 98)))
custom_preview_2 = CustomPreview(Geometry=human_scale, Material=ColourSwatch(SwatchColor=RGB(217, 178, 178)))

brep = Brep([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])

mesh_naked_edges = MeshNakedEdges(Mesh=brep)  # -> Naked, ResultBoolean
area = Area(Geometry=mesh_naked_edges.Naked)  # -> Area, Centroid
panel_3 = Panel(area.Area)
multiplication = Multiplication(A=area.Area, B="470")
panel_4 = Panel(multiplication)

# ----
# create and manipulate graph
point = Point([Point(2.7, 7.810000534, 0), Point(0.3, 1.810000534, 0), Point(2.7, 1.810000534, 0), Point(0.3, 7.810000534, 0)])

point_2 = Point(point)

python_3_script = Python3Script(roof_breps=brep, supports=point_2, z_steps=entwine)  # -> out, ridges_tree, all_edges, graph, all_nodes, node_keys; inputs roof_breps: list of Brep, supports: list of Point3d, z_steps: tree of Double
# ---------- python_3_script: Python ----------
import os
import sys
from compas_rhino import unload_modules
import compas
compas.PRECISION = ".3f"

gh_dir = os.path.dirname(ghenv.Component.OnPingDocument().FilePath)
sys.path.append(gh_dir)

import tree_builder
import nodegraph
import importlib

importlib.reload(nodegraph)
importlib.reload(tree_builder)


from tree_builder import build_tree_graph_from_breps
from Grasshopper import DataTree
from Grasshopper.Kernel.Data import GH_Path

# lines_tree will be our output
lines_tree = DataTree[object]()
z_tree = []
# 1. Iterate using the Branch count
for i in range(z_steps.BranchCount):
    branch = list(z_steps.Branch(i)) 
    z_tree.append(branch)

# CONSTANTS #
div_x = 3
div_y = 3
num_levels = 3

inset_edge = 0.5
inset_interior = 0.5

# Build the graph (all logic is in tree_builder.py)
ng = build_tree_graph_from_breps(
    supports=supports,
    input_breps=roof_breps,
    div_x=div_x if div_x else 8,
    div_y=div_y if div_y else 6,
    num_levels=num_levels if num_levels else 4,
    z_steps=z_tree,
    inset_edge=inset_edge if inset_edge else 0.5,
    inset_interior=inset_interior if inset_interior else 0.4,
    reach_tol=0.05,
    debug=True
)

# Outputs
all_edges = ng.edge_lines()
graph = ng
all_nodes = ng.node_points()
node_keys = list(ng.nodes())
# ---------- end python_3_script ----------
compas_draw = COMPASDraw(cg=python_3_script.all_nodes)  # -> rg
#   port cg: The COMPAS geometry or datastructure to be drawn.
#   port rg: The Rhino geometry object.
# ---------- compas_draw: Python ----------
# r: compas>=2.14.1
"""
Draws COMPAS geometry in Grasshopper.
"""

from typing import Any

import Grasshopper

from compas.scene import SceneObject


class CompasToRhinoGeometry(Grasshopper.Kernel.GH_ScriptInstance):
    def RunScript(self, cg):
        if not cg:
            return None

        return SceneObject(item=cg).draw()
# ---------- end compas_draw ----------
compas_draw_2 = COMPASDraw(cg=python_3_script.all_edges)  # -> rg; same code as compas_draw

# ----
# transform points
brep_2 = Brep(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)
python_3_script_2 = Python3Script(graph=python_3_script.graph, repellors=brep_2)  # -> out, edges, nodes, node_graph; inputs repellors: list of Brep
# ---------- python_3_script_2: Python ----------
import os, sys, importlib
gh_dir = os.path.dirname(ghenv.Component.OnPingDocument().FilePath)
if gh_dir not in sys.path:
    sys.path.insert(0, gh_dir)

### -----------------------------
## IMPORT
### -----------------------------
import nodegraph

importlib.reload(nodegraph)

from copy import deepcopy
from compas.geometry import Vector, Line, Point, centroid_points

ng = deepcopy(graph)



ng, results = ng.move_nodes_from_geometry(
    repellors,               # Mix of anything
    max_distance = 2.0,
    strength = 2,
    falloff = "smooth"
)

# Outputs
node_graph = ng
edges = ng.edge_lines()
nodes = ng.node_points()
moved_pts = [r['new'] for r in results.values()]
# ---------- end python_3_script_2 ----------

# ----
# Classfiy Edges
# op1 rotate
# op2 choose 1 to be primary and shift others
# op3 use design, cut diagonal
python_3_script_3 = Python3Script(graph=python_3_script_2.node_graph)  # -> out, primary_lines, secondary_lines, tertiary_lines, nodes_pts, nodes_idx, chosen_edge_lines, graph_out
# ---------- python_3_script_3: Python ----------
import os, sys, importlib

gh_dir = os.path.dirname(ghenv.Component.OnPingDocument().FilePath)
if gh_dir not in sys.path:
    sys.path.insert(0, gh_dir)

import edge_classifier
importlib.reload(edge_classifier)
from edge_classifier import classify_edges_by_support_direction, create_subgraphs
from compas.geometry import Line

primary_lines, secondary_lines, tertiary_lines, classification_data  = classify_edges_by_support_direction(
    graph,
    return_tertiary=True
)


# output 
graph_out = graph
# ---------- end python_3_script_3 ----------
draw = COMPASDraw(cg=python_3_script_3.primary_lines)  # -> rg; same code as compas_draw
draw_2 = COMPASDraw(cg=python_3_script_3.secondary_lines)  # -> rg; same code as compas_draw
draw_3 = COMPASDraw(cg=python_3_script_3.tertiary_lines)  # -> rg; same code as compas_draw
draw_4 = COMPASDraw(cg=python_3_script_3.nodes_pts)  # -> rg; same code as compas_draw
draw_5 = COMPASDraw(cg=python_3_script_3.chosen_edge_lines)  # -> rg; same code as compas_draw
custom_preview_lineweights = CustomPreviewLineweights(Geometry=draw, Shader=ColourSwatch(SwatchColor=RGB(137, 50, 143)), Thickness="8", Absolute=False)
custom_preview_lineweights_2 = CustomPreviewLineweights(Geometry=draw_2, Shader=ColourSwatch(SwatchColor=RGB(50, 143, 103)), Thickness="6", Absolute=False)
custom_preview_lineweights_3 = CustomPreviewLineweights(Geometry=draw_3, Shader=ColourSwatch(SwatchColor=RGB(218, 157, 103)), Thickness="6", Absolute=False)

swatch = ColourSwatch(SwatchColor=RGB(51, 56, 66))
text_tag = TextTag(Location=draw_4, Text=python_3_script_3.nodes_idx, Colour=swatch)
dot_display = DotDisplay(Point=draw_4, Colour=swatch, Size=Slider(0.1, range=0..0.1))

# ----
# preview graph
number_slider_3 = Slider(0.1, range=-0.5..0.5)
compas_draw_3 = COMPASDraw(cg=python_3_script_2.edges)  # -> rg; same code as compas_draw
compas_draw_4 = COMPASDraw(cg=python_3_script_2.nodes)  # -> rg; same code as compas_draw
dot_display_2 = DotDisplay(Point=compas_draw_4, Colour=ColourSwatch(SwatchColor=RGB(128, 128, 128)), Size=number_slider_3)

custom_preview_lineweights_4 = CustomPreviewLineweights(
    Geometry=compas_draw_3,
    Shader=ColourSwatch(SwatchColor=RGB(144, 209, 232)),
    Thickness=Slider(4, range=0..10),
    Absolute=False)

offset_surface = OffsetSurface(Surface=brep, Distance=Slider(0.06, range=0..0.1), BothSides=0, CreateSolid=True)
ct_beam = CTBeam(centerline=compas_draw_3, width=Slider(0.1, range=0..0.1), height=Slider(0.12, range=0..1))  # -> Beam, Blank; inputs centerline: list, z_vector: list of Vector3d, width: list of Double, height: list of Double, category: list of String, updateRefObj: Boolean
#   port centerline: Referenced curve or line, Guid of curve or line in the active Rhino document.
#   port z_vector: Vector defining the orientation of the cross-section (corresponds to the height dimension). If None, a default will be taken.
#   port width: Width of the cross-section (usually the smaller dimension).
#   port height: Height of the cross-section (usually the larger dimension).
#   port category: Category of a beam.
#   port updateRefObj: (optional) If True, the attributes in the referenced object will be updated/overwritten with the new values given here.
#   port Beam: Beam object(s).
#   port Blank: Shape of the beam's blank.
# ---------- ct_beam: Python ----------
# r: compas_timber==1.0.5
"""Creates a Beam from a LineCurve."""

# flake8: noqa
import Grasshopper
import Rhino
import rhinoscriptsyntax as rs
import System
from compas.scene import Scene
from compas_rhino.conversions import line_to_compas
from compas_rhino.conversions import vector_to_compas

from compas_timber.elements import Beam as CTBeam
from compas_timber.ghpython.rhino_object_name_attributes import update_rhobj_attributes_name
from compas_timber.ghpython.ghcomponent_helpers import list_input_valid_cpython


class Beam_fromCurve(Grasshopper.Kernel.GH_ScriptInstance):
    def RunScript(self,
            centerline: System.Collections.Generic.List[object],
            z_vector: System.Collections.Generic.List[Rhino.Geometry.Vector3d],
            width: System.Collections.Generic.List[float],
            height: System.Collections.Generic.List[float],
            category: System.Collections.Generic.List[str],
            updateRefObj: bool):
        # minimum inputs required
        if not list_input_valid_cpython(ghenv, centerline, "Centerline"):
            return
        if not width:
            length = self._get_centerline_length(centerline)
            width = [length / 20]
        if not height:
            length = self._get_centerline_length(centerline)
            height = [length / 10]

        # reformat unset parameters for consistency
        if not z_vector:
            z_vector = [None]
        if not category:
            category = [None]

        beams = []
        blanks = []
        scene = Scene()

        if centerline and height and width:
            # check list lengths for consistency
            N = len(centerline)
            if len(z_vector) not in (0, 1, N):
                ghenv.Component.AddRuntimeMessage(
                    Grasshopper.Kernel.GH_RuntimeMessageLevel.Error, " In 'ZVector' I need either none, one or the same number of inputs as the Crv parameter."
                )
            if len(width) not in (1, N):
                ghenv.Component.AddRuntimeMessage(Grasshopper.Kernel.GH_RuntimeMessageLevel.Error, " In 'W' I need either one or the same number of inputs as the Crv parameter.")
            if len(height) not in (1, N):
                ghenv.Component.AddRuntimeMessage(Grasshopper.Kernel.GH_RuntimeMessageLevel.Error, " In 'H' I need either one or the same number of inputs as the Crv parameter.")
            if len(category) not in (0, 1, N):
                ghenv.Component.AddRuntimeMessage(
                    Grasshopper.Kernel.GH_RuntimeMessageLevel.Error, " In 'Category' I need either none, one or the same number of inputs as the Crv parameter."
                )

            # duplicate data if None or single value
            if len(z_vector) != N:
                z_vector = [z_vector[0] for _ in range(N)]
            if len(width) != N:
                width = [width[0] for _ in range(N)]
            if len(height) != N:
                height = [height[0] for _ in range(N)]
            if len(category) != N:
                category = [category[0] for _ in range(N)]

            for line, z, w, h, c in zip(centerline, z_vector, width, height, category):
                guid, geometry = self._get_guid_and_geometry(line)
                rhino_line = rs.coerceline(geometry)
                line = line_to_compas(rhino_line)

                z = vector_to_compas(z) if z else None
                beam = CTBeam.from_centerline(centerline=line, width=w, height=h, z_vector=z)
                beam.attributes["rhino_guid"] = str(guid) if guid else None
                beam.attributes["category"] = c
                if updateRefObj and guid:
                    update_rhobj_attributes_name(guid, "width", str(w))
                    update_rhobj_attributes_name(guid, "height", str(h))
                    update_rhobj_attributes_name(guid, "zvector", str(list(beam.frame.zaxis)))
                    update_rhobj_attributes_name(guid, "category", c)

                beams.append(beam)
                scene.add(beam.blank)

        blanks = scene.draw()

        return beams, blanks

    def _get_guid_and_geometry(self, line):
        # internalized curves and GH geometry will not have persistent GUIDs, referenced Rhino objects will
        # type hint on the input has to be 'ghdoc' for this to work
        guid = None
        geometry = line
        rhino_obj = Rhino.RhinoDoc.ActiveDoc.Objects.FindId(line)
        if rhino_obj:
            guid = line
            geometry = rhino_obj.Geometry
        return guid, geometry

    def _get_centerline_length(self, centerline):
        centerline_length = []
        for i in centerline:
            centerline_length.append(rs.CurveLength(i))
        if centerline_length:
            length_average = sum(centerline_length) / len(centerline_length)
        else:
            length_average = 1
        return length_average
# ---------- end ct_beam ----------
volume = Volume(Geometry=ct_beam.Blank)  # -> Volume, Centroid
mass_addition = MassAddition(Input=volume.Volume)  # -> Result, PartialResults
relay = Relay([ct_beam.Blank, offset_surface])
custom_preview_3 = CustomPreview(Geometry=relay, Material=ColourSwatch(SwatchColor=RGB(219, 206, 167)))
panel_5 = Panel(mass_addition.Result)

py3 = Python3Script(ng=python_3_script_3.graph_out, z_shift=number_slider)  # -> out, a, b, c, d, e, f, graph_out, edges, shifted; inputs z_shift: Double
# ---------- py3: Python ----------
import os, sys, importlib
from copy import deepcopy

gh_dir = os.path.dirname(ghenv.Component.OnPingDocument().FilePath)
if gh_dir not in sys.path:
    sys.path.insert(0, gh_dir)

import edge_classifier
import reciprocal
import line_constraints

importlib.reload(edge_classifier)
importlib.reload(reciprocal)
importlib.reload(line_constraints)

graph = deepcopy(ng)

# -----------------------------
# controls
# -----------------------------
sign_primary = +1
sign_secondary = +1
engage_len = 0.11
tol = 0.1
iters = 5


# -----------------------------
# 1) reciprocal primary
# -----------------------------
res_primary = reciprocal.reciprocal_width_from_subgraph(
    graph,
    target_hierarchy="primary",
    engage_len=engage_len,
    tol=tol,
    rotation_sign=sign_primary,
    min_degree=3,
    iterations=iters,
    max_angle=180.0
)
g = res_primary["graph"]

# -----------------------------
# 2) regenerate secondary (level 1 up)
# -----------------------------
line_constraints.snap_to_host(
    g,
    target_hierarchy="secondary",
    move_node_level = 1,
    host_hierarchy="primary",
    z_offset = z_shift,
    write_attribute=True,
    debug=False
)


# -----------------------------
# 3) reciprocal secondary
# -----------------------------
res_secondary = reciprocal.reciprocal_width_from_subgraph(
    g,
    target_hierarchy="secondary",
    engage_len=engage_len,
    tol=tol,
    rotation_sign=sign_secondary,
    min_degree=3,
    iterations=iters,
    max_angle=180.0
)
g = res_secondary["graph"]

# -----------------------------
# 5) regenerate tertiary (level 0 up)
# -----------------------------
line_constraints.snap_to_host(
    g,
    target_hierarchy="tertiary",
    move_node_level=0,
    host_hierarchy="secondary" ,
    z_offset = z_shift,
    write_attribute=True,
    debug=False
)

line_constraints.snap_to_host(
    g,
    target_hierarchy="tertiary",
    move_node_level=0,
    host_hierarchy="primary",
    z_offset = z_shift,
    write_attribute=True,
    debug=False
)

shifted = []
for e in g.edges():
    shifted.append(g.edge_attribute(e, "shifted_line"))

graph_out = g
# ---------- end py3 ----------
draw_6 = COMPASDraw(cg=py3.a)  # -> rg; same code as compas_draw
draw_7 = COMPASDraw(cg=py3.b)  # -> rg; same code as compas_draw
draw_8 = COMPASDraw(cg=py3.d)  # -> rg; same code as compas_draw
draw_9 = COMPASDraw(cg=py3.shifted)  # -> rg; same code as compas_draw
draw_10 = COMPASDraw(cg=py3.c)  # -> rg; same code as compas_draw
draw_11 = COMPASDraw(cg=py3.edges)  # -> rg; same code as compas_draw

# ----
# shifting and add shoes
python_3_script_4 = Python3Script(graph=python_3_script_3.graph_out)  # -> out, graph_out, shoe_lines
# ---------- python_3_script_4: Python ----------
import os, sys, importlib
gh_dir = os.path.dirname(ghenv.Component.OnPingDocument().FilePath)
if gh_dir not in sys.path:
    sys.path.insert(0, gh_dir)


import leaf_solver
importlib.reload(leaf_solver)
from leaf_solver import create_shoes_from_graph
from copy import deepcopy



ng = deepcopy(graph)
result = create_shoes_from_graph(ng, extension_length = 0.20)

shoe_lines = result["shoe_lines"]
graph_out = ng
# ---------- end python_3_script_4 ----------
draw_12 = COMPASDraw(cg=python_3_script_4.shoe_lines)  # -> rg; same code as compas_draw

# ----
# Foundation
python_3_script_5 = Python3Script(graph=py3.graph_out)  # -> out, graph_out, crosecs, cut_planes, sup_lines
# ---------- python_3_script_5: Python ----------
import os, sys, importlib
gh_dir = os.path.dirname(ghenv.Component.OnPingDocument().FilePath)
if gh_dir not in sys.path:
    sys.path.insert(0, gh_dir)


import foundation_solver
importlib.reload(foundation_solver)
from foundation_solver import trim_anchored_beams_and_find_cut_planes
from copy import deepcopy

from compas.geometry import Polygon

############--------Main Code----------#########
ng = deepcopy(graph)
result = trim_anchored_beams_and_find_cut_planes(ng, min_gap=0.01, min_height=0.0)

########--------Output Data---------#########
cro_sec_dict = result["cross_sections"]
crosecs = []
for node, cro_sec_list in cro_sec_dict.items():
    for crosec in cro_sec_list:
        poly = Polygon(crosec)
        crosecs.append(poly)

cut_pln_dict = result["cut_planes"]
cut_planes = []
for node, pln in cut_pln_dict.items():
    cut_planes.append(pln)


sup_lines = []
for edge in graph.get_support_edges():
    if "shifted_line" in graph.edge_attributes(edge):
        ln = graph.edge_attribute(edge, "shifted_line")
    else:
        ln = graph.edge_line(edge)
    sup_lines.append(ln)

#############-----------Print----------##########
# print (result["cross_sections"])
# print ()
# print (result["cut_planes"])
print (result["foundation_heights"])
# ---------- end python_3_script_5 ----------
draw_13 = COMPASDraw(cg=python_3_script_5.crosecs)  # -> rg; same code as compas_draw
draw_14 = COMPASDraw(cg=python_3_script_5.cut_planes)  # -> rg; same code as compas_draw
draw_15 = COMPASDraw(cg=python_3_script_5.sup_lines)  # -> rg; same code as compas_draw

# ----
# lines for compas_timber from graph
py3_2 = Python3Script(graph=py3.graph_out)  # -> out, a, b, c
# ---------- py3_2: Python ----------
from compas.geometry import Line, Point
from copy import deepcopy

ng = deepcopy(graph)

primary_shifted = []
secondary_shifted = []
tertiary_shifted = []

for e in ng.edges():
    h = ng.edge_attribute(e, "hierarchy")      # classification
    ln = ng.edge_attribute(e, "shifted_lines")  # shifted geometry
    if ln is None:
        continue

    if h == "primary":
        primary_shifted.append(ln)
    elif h == "secondary":
        secondary_shifted.append(ln)
    elif h == "tertiary":
        tertiary_shifted.append(ln)

a = primary_shifted
b = secondary_shifted
c = tertiary_shifted
# ---------- end py3_2 ----------
draw_16 = COMPASDraw(cg=py3_2.b)  # -> rg; same code as compas_draw
draw_17 = COMPASDraw(cg=py3_2.a)  # -> rg; same code as compas_draw
draw_18 = COMPASDraw(cg=py3_2.c)  # -> rg; same code as compas_draw

# ---- group: generate TimberModel
python_3_script_6 = Python3Script(
    graph_in=py3.graph_out,
    plate_polylines=mesh_naked_edges.Naked,
    beam_width=Slider(0.12, range=0..0.2),
    beam_height=Slider(0.16, range=0..1),
    plate_thickness=Slider(0.06, range=0..0.1))  # -> out, final_models, module_beams, module_plates, shifted_lines, beam_attributes_text; inputs plate_polylines: tree of Polyline, beam_width: Double, beam_height: Double, plate_thickness: Double
# ---------- python_3_script_6: Python ----------
from compas_timber.model import TimberModel
from compas_timber.elements import Beam, Plate
from compas.tolerance import Tolerance
from compas.geometry import Line, Vector
from compas.geometry import is_point_in_polygon_xy
from compas_rhino.conversions import polyline_to_compas


# ============================================================
# outputs
# ============================================================
final_models = []

module_beams = []
module_plates = []

shifted_lines = []
beam_attributes_text = []
# ============================================================
# helper: flatten GH input
# ============================================================
def flatten_input(data):
    """Flatten normal lists, tuples, and GH DataTrees into a simple Python list."""

    items = []

    if data is None:
        return items

    # GH DataTree
    if hasattr(data, "Branches"):
        for branch in data.Branches:
            for item in branch:
                items.append(item)
        return items

    # Python list or tuple
    if isinstance(data, (list, tuple)):
        for item in data:
            if isinstance(item, (list, tuple)):
                items.extend(flatten_input(item))
            else:
                items.append(item)
        return items

    # single item
    items.append(data)
    return items

# ============================================================
# 1. flatten plate polylines input
# ============================================================
input_polylines = flatten_input(plate_polylines)

# ============================================================
# 2. convert plate polylines
# ============================================================
module_polylines = []
module_polygon_points = []

for poly in input_polylines:
    try:
        compas_poly = polyline_to_compas(poly)
    except:
        continue

    if compas_poly is None:
        continue

    pts = list(compas_poly.points)

    if len(pts) < 3:
        continue

    # remove duplicated last point if closed
    if pts[0] == pts[-1]:
        pts = pts[:-1]

    module_polylines.append(compas_poly)
    module_polygon_points.append(pts)

# ============================================================
# 3. create one TimberModel per plate polyline
# ============================================================
for module_index, compas_poly in enumerate(module_polylines):

    module_model = TimberModel(Tolerance(unit="M", absolute="0.001"))

    plate = Plate.from_outline_thickness(compas_poly,plate_thickness,Vector(0, 0, 1))

    plate.name = "plate"
    plate.attributes["module_index"] = module_index

    module_model.add_element(plate)

    final_models.append(module_model)
    module_beams.append([])
    module_plates.append([plate])

# ============================================================
# 4. sort graph lines into each TimberModel
# ============================================================
if graph_in:
    for edge in graph_in.edges():
        hierarchy = graph_in.edge_attribute(edge, "hierarchy")

        if hierarchy not in ["primary", "secondary", "tertiary"]:
            continue

        line = graph_in.edge_attribute(edge, "shifted_line")

        if not isinstance(line, Line):
            line = graph_in.edge_attribute(edge, "line")

        if line is None:
            continue

        center = line.midpoint

        for module_index, polygon_pts in enumerate(module_polygon_points):
            if is_point_in_polygon_xy(center, polygon_pts):
                beam = Beam.from_centerline(line,width=beam_width,height=beam_height)

                beam.name = hierarchy

                beam.attributes["edge"] = edge
                beam.attributes["module_index"] = module_index

                beam_attributes_text.append(
                    "beam name: {} | module_index: {} | edge: {}".format(
                        beam.name,
                        beam.attributes.get("module_index"),
                        beam.attributes.get("edge")
                    )
                )

                final_models[module_index].add_element(beam)
                module_beams[module_index].append(beam)
                shifted_lines.append(line)

                break
# ---------- end python_3_script_6 ----------

# ----
python_3_script_7 = Python3Script(final_models=python_3_script_6.final_models, module_index=Slider(0, range=0..3), show_all=Toggle(True))  # -> out, geometry, element_colors; inputs final_models: list, module_index: Int32
# ---------- python_3_script_7: Python ----------
from System.Drawing import Color

# ============================================================
# outputs
# ============================================================
geometry = []

beam_geometry = []
plate_geometry = []

element_text = []
element_points = []
element_colors = []

selected_model = None


# ============================================================
# defaults
# ============================================================
if show_all is None:
    show_all = False

if module_index is None:
    module_index = 0


# ============================================================
# colors per module index
# ============================================================
module_colors = [
    Color.FromArgb(230, 80, 80),     # module 0 - red
    Color.FromArgb(80, 160, 230),    # module 1 - blue
    Color.FromArgb(90, 200, 120),    # module 2 - green
    Color.FromArgb(240, 180, 70)     # module 3 - orange
]


# ============================================================
# helper
# ============================================================
def get_module_color(index):
    return module_colors[index % len(module_colors)]


# ============================================================
# choose which modules to show
# ============================================================
module_ids_to_show = []

if final_models:

    if show_all:
        module_ids_to_show = list(range(len(final_models)))

    else:
        if 0 <= module_index < len(final_models):
            module_ids_to_show = [module_index]
            selected_model = final_models[module_index]


# ============================================================
# collect geometry by module index
# ============================================================
for m_id in module_ids_to_show:

    module_model = final_models[m_id]
    module_color = get_module_color(m_id)

    # ------------------------------------------------------------
    # plates
    # ------------------------------------------------------------
    for plate in module_model.plates:

        try:
            geo = plate.geometry

            geometry.append(geo)
            plate_geometry.append(geo)

            # same colour as beams in this module
            element_colors.append(module_color)

            element_text.append("module {} | plate".format(m_id))
            element_points.append(plate.frame.point)

        except Exception as e:
            print("Plate error in module {}: {}".format(m_id, e))

    # ------------------------------------------------------------
    # beams
    # ------------------------------------------------------------
    for beam in module_model.beams:
        try:
            geo = beam.geometry

            geometry.append(geo)
            beam_geometry.append(geo)

            # same colour as plate in this module
            element_colors.append(module_color)

            name = beam.name
            if name is None:
                name = "beam"

            element_text.append(
                "module {} | {} | length = {:.2f} m".format(m_id,name,beam.length))

            element_points.append(beam.centerline.midpoint)

        except Exception as e:
            print("Beam error in module {}: {}".format(m_id, e))
# ---------- end python_3_script_7 ----------
panel_6 = Panel(python_3_script_6.final_models)

# ---- group: TimberModel_preview
split = TextSplit(Text=python_3_script_7.element_colors, Separators=",")  # -> simplify(Result)
draw_19 = COMPASDraw(cg=python_3_script_7.geometry)  # -> rg; same code as compas_draw
item = ListItem(List=split, Index=0, Wrap=True)  # -> Item, Item1, Item2
rgb = ColourRGB(Alpha=Slider(150, range=0..255), Red=item.Item, Green=item.Item1, Blue=item.Item2)  # -> flatten(Colour)
custom_preview_4 = CustomPreview(Geometry=draw_19, Material=rgb)

# ---- group: module height
group = Group(Geometry=draw_19)
bounding_box = BoundingBox(Content=group, Plane=PlaneXY(0, 0, 0))  # -> Box, Box_2
debrep = DeconstructBrep(Brep=bounding_box.Box)  # -> Faces, Edges, Vertices
points = PointList(Points=debrep.Vertices, Size=Slider(1, range=0..1))
item_2 = ListItem(List=debrep.Vertices, Index=0, Wrap=True)  # -> Item, Item1, Item2, Item3, Item4, Item5
ln = Line(StartPoint=item_2.Item, EndPoint=item_2.Item1)
ln_2 = Line(StartPoint=item_2.Item1, EndPoint=item_2.Item2)
ln_3 = Line(StartPoint=item_2.Item1, EndPoint=item_2.Item5)
linear_dimension = LinearDimension(Line=ln, PointA=item_2.Item, PointB=item_2.Item1, Text="{0:0.000}", Size="0.5")
linear_dimension_2 = LinearDimension(Line=ln_2, PointA=item_2.Item1, PointB=item_2.Item2, Text="{0:0.000}", Size="0.5")
linear_dimension_3 = LinearDimension(Line=ln_3, PointA=item_2.Item1, PointB=item_2.Item5, Text="{0:0.000}", Size="0.5")

# ---- group: Nesting
py3_3 = Python3Script(timber_models=python_3_script_6.final_models)  # -> out, nesting_info, blank_geometry, blank_aligned, blank_length, beam_index, beam_guid, timber_15m_count, cross_section; inputs timber_models: list
# ---------- py3_3: Python ----------
from compas_timber.planning import BeamNester, BeamStock
from compas.geometry import Transformation
from ghpythonlib.treehelpers import list_to_tree

models = timber_models

STOCK_LENGTH = 6.5
SPACING = 0.03

STOCK_ROW_SPACING = 1.0
MODEL_COLUMN_SPACING = 20.0

blank_geometry = []
blank_aligned = []
blank_length = []
beam_index = []
beam_guid_output = []
cross_section_output = []
nesting_info = []

timber_15m_count = 0
timber_15m_count_per_model = []


def split_letter(i):
    return chr(ord("a") + i)


for model_i, model in enumerate(models):

    cross_sections = []

    for beam in model.beams:
        section = (beam.width, beam.height)

        if section not in cross_sections and tuple(reversed(section)) not in cross_sections:
            cross_sections.append(section)

    stock_catalog = [
        BeamStock(
            length=STOCK_LENGTH,
            cross_section=section,
            spacing=SPACING,
        )
        for section in cross_sections
    ]

    nester = BeamNester(
        model=model,
        stock_catalog=stock_catalog,
        spacing=SPACING,
        per_group=False,
    )

    result = nester.nest(fast=False)

    nesting_info.append("========== TimberModel {} ==========".format(model_i))

    model_blank_geometry_tree = []
    model_blank_aligned_tree = []
    model_blank_length_tree = []
    model_beam_index_tree = []
    model_beam_guid_tree = []
    model_cross_section_tree = []

    model_timber_count = 0

    # 每個 TimberModel 作為一個水平區塊，沿 X direction 排列
    model_x_offset = model_i * MODEL_COLUMN_SPACING

    # 這個 row counter 讓同一個 TimberModel 內的每條 stock timber 上下排列
    stock_row_i = 0

    for stock_i, stock in enumerate(result.stocks):

        stock_items = []

        for beam_guid_key, data in stock.element_data.items():

            beam = None
            b_index = None

            for i, b in enumerate(model.beams):
                if str(b.guid) == str(beam_guid_key):
                    beam = b
                    b_index = i
                    break

            if beam is None:
                continue

            stock_items.append({
                "beam": beam,
                "beam_index": b_index,
                "length": data.length,
                "data": data,
                "key": data.key,
                "guid": str(beam_guid_key),
                "cross_section": (beam.width, beam.height)
            })

        split_groups = []
        current_group = []
        current_length = 0.0

        for item in stock_items:

            item_length = item["length"]
            required_length = item_length

            if current_group:
                required_length += SPACING

            if current_group and current_length + required_length > STOCK_LENGTH:
                split_groups.append(current_group)
                current_group = [item]
                current_length = item_length
            else:
                current_group.append(item)
                current_length += required_length

        if current_group:
            split_groups.append(current_group)

        stock_blank_geometry_tree = []
        stock_blank_aligned_tree = []
        stock_blank_length_tree = []
        stock_beam_index_tree = []
        stock_beam_guid_tree = []
        stock_cross_section_tree = []

        for split_i, split_group in enumerate(split_groups):

            timber_15m_count += 1
            model_timber_count += 1

            split_name = "BeamStock_{}_{}".format(stock_i, split_letter(split_i))

            split_blank_geometry = []
            split_blank_aligned = []
            split_blank_length = []
            split_beam_index = []
            split_beam_guid = []
            split_cross_section = []

            current_x = 0.0

            # 同一個 TimberModel 內，每一條 stock timber 用不同 Y row
            x_offset = model_x_offset
            y_offset = stock_row_i * STOCK_ROW_SPACING

            for item in split_group:

                beam = item["beam"]
                length = item["length"]
                guid = item["guid"]
                section = item["cross_section"]

                split_blank_geometry.append(beam.blank)
                split_blank_length.append(length)
                split_beam_index.append(item["beam_index"])
                split_beam_guid.append(guid)
                split_cross_section.append(section)

                aligned_blank = beam.blank.copy()

                target_frame = item["data"].frame.copy()

                # X = model horizontal offset + beam position inside stock
                target_frame.point.x = x_offset + current_x + length / 2.0

                # Y = stock row inside same TimberModel
                target_frame.point.y = y_offset

                # force to XY plane
                target_frame.point.z = 0.0

                T = Transformation.from_frame_to_frame(
                    aligned_blank.frame,
                    target_frame
                )

                aligned_blank.transform(T)
                split_blank_aligned.append(aligned_blank)

                current_x += length + SPACING

            total_length = sum(split_blank_length) + max(0, len(split_blank_length) - 1) * SPACING
            waste = STOCK_LENGTH - total_length

            nesting_info.append("{}:".format(split_name))
            nesting_info.append("CrossSection: {}".format(stock.cross_section))
            nesting_info.append("BeamKeys: {}".format([item["key"] for item in split_group]))
            nesting_info.append("BeamGUIDs: {}".format(split_beam_guid))
            nesting_info.append("BeamIndices: {}".format(split_beam_index))
            nesting_info.append("BeamLengths: {}".format(split_blank_length))
            nesting_info.append("TotalLength: {:.3f}".format(total_length))
            nesting_info.append("Waste: {:.3f}".format(waste))
            nesting_info.append("--------")

            stock_blank_geometry_tree.append(split_blank_geometry)
            stock_blank_aligned_tree.append(split_blank_aligned)
            stock_blank_length_tree.append(split_blank_length)
            stock_beam_index_tree.append(split_beam_index)
            stock_beam_guid_tree.append(split_beam_guid)
            stock_cross_section_tree.append(split_cross_section)

            # let every split stock timber using the next Y row
            stock_row_i += 1

        model_blank_geometry_tree.append(stock_blank_geometry_tree)
        model_blank_aligned_tree.append(stock_blank_aligned_tree)
        model_blank_length_tree.append(stock_blank_length_tree)
        model_beam_index_tree.append(stock_beam_index_tree)
        model_beam_guid_tree.append(stock_beam_guid_tree)
        model_cross_section_tree.append(stock_cross_section_tree)

    timber_15m_count_per_model.append(model_timber_count)

    blank_geometry.append(model_blank_geometry_tree)
    blank_aligned.append(model_blank_aligned_tree)
    blank_length.append(model_blank_length_tree)
    beam_index.append(model_beam_index_tree)
    beam_guid_output.append(model_beam_guid_tree)
    cross_section_output.append(model_cross_section_tree)


blank_geometry = list_to_tree(blank_geometry)
blank_aligned = list_to_tree(blank_aligned)
blank_length = list_to_tree(blank_length)
beam_index = list_to_tree(beam_index)
beam_guid = list_to_tree(beam_guid_output)
cross_section = list_to_tree(cross_section_output)

nesting_info.append("Total stock timber count: {}".format(timber_15m_count))
nesting_info.append("Stock timber count per model: {}".format(timber_15m_count_per_model))

nesting_info = "\n".join(nesting_info)
# ---------- end py3_3 ----------
panel_7 = Panel(py3_3.nesting_info)
panel_8 = Panel(py3_3.blank_length)
panel_9 = Panel(py3_3.timber_15m_count)
draw_20 = COMPASDraw(cg=py3_3.blank_geometry)  # -> simplify(rg); same code as compas_draw
draw_21 = COMPASDraw(cg=py3_3.blank_aligned)  # -> simplify(rg); same code as compas_draw
ma = MassAddition(Input=panel_8)  # -> Result, PartialResults
panel_10 = Panel(ma.Result)
sort = SortList(Keys=flatten(panel_8))  # -> Keys, ValuesA
first_last = FirstLast(List=sort.Keys)  # -> FirstValue, LastValue
panel_11 = Panel(first_last.FirstValue)
panel_12 = Panel(first_last.LastValue)

# ----
panel_13 = Panel(python_3_script_6.beam_attributes_text)

# ---- group: Nesting
# index
panel_14 = Panel(py3_3.beam_index)
panel_15 = Panel(py3_3.beam_guid)
area_2 = Area(Geometry=draw_21)  # -> Area, Centroid
tag = TextTag(Location=area_2.Centroid, Text=panel_14, Colour=ColourSwatch(SwatchColor=RGB(63, 72, 115)))

draw_22 = COMPASDraw(cg=py3_3.blank_aligned)  # -> simplify(rg); same code as compas_draw
tstat = TreeStatistics(Tree=draw_22)  # -> Paths, Length, Count
dpath = DeconstructPath(Branch=tstat.Paths)
item_3 = ListItem(List=dpath, Index=0, Wrap=True)
cset = CreateSet(List=flatten(item_3))  # -> Set, Map
mindex = MemberIndex(Set=flatten(item_3), Member=cset.Set)  # -> Index, Count
partition = PartitionList(List=tstat.Length, Size=mindex.Count)
trim = TrimTree(Tree=draw_22, Depth=1)
bang = ExplodeTree(Data=simplify(partition))  # -> Branch0, Branch1, Branch2, Branch3
bang_2 = ExplodeTree(Data=trim)  # -> Branch0, Branch1, Branch2, Branch3
partition_2 = PartitionList(List=bang_2.Branch0, Size=bang.Branch0)
partition_3 = PartitionList(List=bang_2.Branch1, Size=bang.Branch1)
partition_4 = PartitionList(List=bang_2.Branch2, Size=bang.Branch2)
partition_5 = PartitionList(List=bang_2.Branch3, Size=bang.Branch3)
bang_3 = ExplodeTree(Data=partition_2)  # -> Branch0, Branch1, Branch2
bang_4 = ExplodeTree(Data=partition_3)  # -> Branch0, Branch1, Branch2
bang_5 = ExplodeTree(Data=partition_4)  # -> Branch0, Branch1, Branch2
bang_6 = ExplodeTree(Data=partition_5)  # -> Branch0, Branch1, Branch2
geo = Geometry(bang_3.Branch0)

# cutting plane
debrep_2 = DeconstructBrep(Brep=draw_21)  # -> Faces, Edges, Vertices
item_4 = ListItem(List=debrep_2.Faces, Index="1", Wrap=True)
area_3 = Area(Geometry=item_4)  # -> Area, Centroid
scale_nu = ScaleNU(Geometry=item_4, Plane=area_3.Centroid, ScaleX=1, ScaleY=Slider(3, range=0..10), ScaleZ=Slider(6, range=0..10))  # -> Geometry, Transform

# ---- group: Nesting / TimberModel_preview
# beam pieces
cset_2 = CreateSet(List=python_3_script_7.element_colors)  # -> Set, Map
split_2 = TextSplit(Text=cset_2.Set, Separators=",")  # -> simplify(Result)
item_5 = ListItem(List=split_2, Index=0, Wrap=True)  # -> Item, Item1, Item2
trim_2 = TrimTree(Tree=draw_21, Depth="1")
rgb_2 = ColourRGB(Alpha=Slider(60, range=0..255), Red=item_5.Item, Green=item_5.Item1, Blue=item_5.Item2)
custom_preview_5 = CustomPreview(Geometry=trim_2, Material=rgb_2)

# ---- group: Nesting
# cross-section
bbox = BoundingBox(Content=draw_21, Plane=PlaneXY(0, 0, 0), UnionBox=True)  # -> Box, Box_2
debrep_3 = DeconstructBrep(Brep=bbox.Box)  # -> Faces, Edges, Vertices
item_6 = ListItem(List=debrep_3.Faces, Index="3", Wrap=True)
area_4 = Area(Geometry=item_6)  # -> Area, Centroid
trim_3 = TrimTree(Tree=py3_3.cross_section, Depth=Slider(2, range=0..10))
pdecon = Deconstruct(Point=area_4.Centroid)  # -> XComponent, YComponent, ZComponent
dispatch = Dispatch(List=trim_3, DispatchPattern=[True, False])  # -> ListA, ListB
addition = Addition(A=pdecon.XComponent, B=Slider(-2, range=-10..10))
pt = ConstructPoint(XCoordinate=addition, YCoordinate=pdecon.YComponent, ZCoordinate=0)
concat = Concatenate(FragmentA=dispatch.ListA, FragmentB=" x ", FragmentC=dispatch.ListB, FragmentD=" m")
tag_2 = TextTag(Location=pt, Text=concat, Colour=ColourSwatch(SwatchColor=RGB(51, 51, 51)))

trim_4 = TrimTree(Tree=area_4.Centroid, Depth="2")

# cutting line
panel_16 = Panel("2")
trim_5 = TrimTree(Tree=item_4, Depth=panel_16)
area_5 = Area(Geometry=trim_5)  # -> Area, Centroid
Y = UnitY(Factor=1)
line = LineSDL(Start=area_5.Centroid, Direction=Y, Length=Slider(0.5, range=0..10))
midpt = CurveMiddle(Curve=line)
orient = Orient(Geometry=line, Source=midpt, Target=area_5.Centroid)  # -> Geometry, Transform

# 6.5 m timber
panel_17 = Panel("-0.05 to 0.05")
box = DomainBox(Base=trim_4, X="0 to 6.5", Y=panel_17, Z="-0.06 to 0.06")
move = Move(Geometry=box, Motion="{0,0,-1}")  # -> Geometry, Transform

# ---- group: informations
python_3_script_8 = Python3Script(final_models=python_3_script_6.final_models)  # -> out, heavy_beams, long_beams_blank, long_beams_length, long_beams, beam_info_tree, milled_beam_volume, milled_beam_weight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; inputs final_models: list
# ---------- python_3_script_8: Python ----------
# ============================================================
## volume each modules ###
# ============================================================
density = 470

total_beams_volume = []
total_beams_weight = []
total_plate_volume = []
total_plate_weight = []
number_of_beams = []
number_of_plates = []
milled_beam_volume = []
milled_beam_weight = []
plate_area = []

for module_model in final_models:
    total_volume_beam = 0.0
    total_weight_beam = 0.0
    total_volume_plate = 0.0
    total_weight_plate = 0.0

    total_milled_volume_beam = 0.0
    total_milled_weight_beam = 0.0

    total_plate_area = 0.0

    beam_count = 0

    for beam in module_model.beams:
        if not beam.attributes.get("neighbour", False):

            beam_count += 1

            beam_vol = beam.width * beam.height * beam.length
            beam_weight = beam_vol * density

            milled_volume = beam.geometry.volume
            milled_weight = milled_volume * density

    for plate in module_model.plates:
        plate_vol = plate.width * plate.length * plate.thickness
        plate_weight = plate_vol * density
        plate_ar = plate.width * plate.length

    total_beams_volume.append(beam_vol)
    total_beams_weight.append(beam_weight)
    total_plate_volume.append(plate_vol)
    total_plate_weight.append(plate_weight)

    number_of_beams.append(beam_count)
    number_of_plates.append(len(module_model.plates))

    milled_beam_volume.append(milled_volume)
    milled_beam_weight.append(milled_weight)

    plate_area.append(plate_ar)


# ============================================================
## each beam information ###
# ============================================================

from Grasshopper import DataTree
from Grasshopper.Kernel.Data import GH_Path

beam_info_tree = DataTree[object]()
long_beams_length = DataTree[object]()

all_lengths = []
all_weights = []

long_beams = []
long_beams_blank = []
heavy_beams = []

for i, module_model in enumerate(final_models):
    path = GH_Path(i)

    beam_info_tree.Add("module {}".format(i), path)

    for j, beam in enumerate(module_model.beams):
        length = beam.blank.dimensions[0]
        width = beam.blank.dimensions[1]
        height = beam.blank.dimensions[2]

        volume = beam.width * beam.height * beam.length
        weight = volume * density

        milled_volume = beam.geometry.volume
        milled_weight = milled_volume * density

        text = "beam {} | length = {:.3f} m | weight (milled) = {:.3f} kg | cross-section = {:.3f} x {:.3f} m".format(
            j, length, milled_weight, width, height
        )

        beam_info_tree.Add(text, path)

        # ============================================================
        # beams longer than 5 m
        # ============================================================
        if length > 5.0:
            long_beams.append(beam.geometry)
            long_beams_blank.append(beam.blank)

            text_length = "beam {} | length = {:.3f} m".format(j, length)
            long_beams_length.Add(text_length, path)

        # ============================================================
        # beams heavier than 45 kg
        # ============================================================
        if milled_weight > 45.0:
            heavy_beams.append(beam.geometry)
# ---------- end python_3_script_8 ----------

# ----
draw_23 = COMPASDraw(cg=python_3_script_8.long_beams)  # -> rg; same code as compas_draw

# ---- group: beam that are heavier than 45 kg
# overall information
draw_24 = COMPASDraw(cg=python_3_script_8.heavy_beams)  # -> rg; same code as compas_draw
custom_preview_6 = CustomPreview(Geometry=draw_24, Material=ColourSwatch(SwatchColor=RGB(255, 0, 0)))

# ----
custom_preview_7 = CustomPreview(Geometry=draw_23, Material=ColourSwatch(SwatchColor=RGB(0, 0, 150)))
beam_length_5_m = Panel(draw_23)
plate_area_m2 = Panel(python_3_script_8.plate_area)
beam_information = Panel(python_3_script_8.beam_info_tree)
total_beams_volume_m3 = Panel(python_3_script_8.milled_beam_volume)
total_beams_weight_kg = Panel(python_3_script_8.milled_beam_weight)
total_plates_volume_m3 = Panel(python_3_script_8.total_plate_volume)
total_plates_weight_kg = Panel(python_3_script_8.total_plate_weight)
number_of_beams = Panel(python_3_script_8.number_of_beams)
number_of_plates = Panel(python_3_script_8.number_of_plates)
list_length = ListLength(List=draw_24)
panel_18 = Panel(python_3_script_8.long_beams_length)
draw_25 = COMPASDraw(cg=python_3_script_8.long_beams_blank)  # -> rg; same code as compas_draw

# ---- group: add attributes (frames)
python_3_script_9 = Python3Script(final_models=python_3_script_6.final_models, module_id=number_slider_2)  # -> out, geometry, v_beam_faces, rhino_beam_frames, final_models_with_attributes, beam_index_text, beam_index_points; inputs final_models: list, module_id: Int32
# ---------- python_3_script_9: Python ----------
from compas.geometry import Frame, Vector, Rotation, Transformation
import math
from compas_rhino.conversions import plane_to_compas_frame, frame_to_rhino_plane, point_to_rhino

geometry = []

rhino_beam_frames = []
v_beam_faces = []

beam_indices = []
beam_sequence = []
beam_sequence_text = []
beam_sequence_points = []

beam_index_text = []
beam_index_points = []

final_models_with_attributes = final_models

# ============================================================
# Auto sequence based on beam.name, Z, Y, X, then edge connectivity
# ============================================================

name_order = {
    "tertiary": 0,
    "secondary": 1,
    "primary": 2
}

list_seq_auto = []

for module_model in final_models_with_attributes:

    # ------------------------------------------------------------
    # 1. prepare sortable beam data
    # ------------------------------------------------------------
    beam_data = []

    for i, beam in enumerate(module_model.beams):
        pt = beam.centerline.start
        beam_name = beam.name
        name_rank = name_order.get(beam_name, 99)

        edge = beam.attributes.get("edge")

        beam_data.append({
            "index": i,
            "beam": beam,
            "point": pt,
            "name_rank": name_rank,
            "edge": edge,
            "sort_key": (-pt.z, pt.y, pt.x, name_rank, i)
        })

    # sort first using your original rule
    beam_data.sort(key=lambda item: item["sort_key"])

    # ------------------------------------------------------------
    # 2. create unvisited beam list
    # ------------------------------------------------------------
    unvisited = list(beam_data)
    module_auto_sequence = []

    # ------------------------------------------------------------
    # 3. walk through connected edges
    # ------------------------------------------------------------
    while unvisited:

        # start from the highest-priority remaining beam
        current = unvisited.pop(0)
        module_auto_sequence.append(current["index"])

        current_edge = current["edge"]

        if current_edge is None:
            continue

        # choose one end as the current node
        # for edge (3, 7), this starts looking from node 7
        current_node = current_edge[1]

        while True:

            next_beam = None
            next_position = None

            # find the next unvisited beam connected to current_node
            for pos, candidate in enumerate(unvisited):
                candidate_edge = candidate["edge"]

                if candidate_edge is None:
                    continue

                if current_node in candidate_edge:
                    next_beam = candidate
                    next_position = pos
                    break

            # if no connected beam is found, stop this chain
            if next_beam is None:
                break

            # add next connected beam
            unvisited.pop(next_position)
            module_auto_sequence.append(next_beam["index"])

            # update current_node to the other end of the edge
            a, b = next_beam["edge"]

            if a == current_node:
                current_node = b
            else:
                current_node = a

    list_seq_auto.append(module_auto_sequence)

# ============================================================
# 1. Add grasp_frame, beam_index, sequence, and assembly_method to all modules
# ============================================================

for module_index, module_model in enumerate(final_models_with_attributes):
    if module_index < len(list_seq_auto):
        module_sequence = list_seq_auto[module_index]
    else:
        module_sequence = []

    for i, beam in enumerate(module_model.beams):
        beam.attributes["module_index"] = module_index
        beam.attributes["beam_index"] = i

        # ============================================================
        # Assembly method logic
        # ============================================================
        beam.attributes["assembly_method"] = None

        density = 470  # kg/m3

        beam_volume = beam.geometry.volume
        beam_weight = beam_volume * density
        beam_length = beam.blank_length

        beam.attributes["beam_weight"] = beam_weight
        beam.attributes["beam_length"] = beam_length

        # define limits
        robot_weight_limit = 45.0
        human_weight_limit = 5.0
        special_length_limit = 5.0

        # decide assembly method
        if beam_length > special_length_limit:
            assembly_method = "special_case"

        elif beam_weight > robot_weight_limit:
            assembly_method = "crane_lift_human_align_screw"

        elif beam_weight <= human_weight_limit:
            assembly_method = "human_place_human_screw"

        else:
            assembly_method = "robot_place_hold_human_screw"

        beam.attributes["assembly_method"] = assembly_method

        # ============================================================
        # Grasp frame
        # ============================================================

        beam_face = beam.side_as_surface(0)
        pick_up_point = beam_face.point_at(0.5, 0.5)

        beam_frame = beam.frame.copy()
        beam_frame.point = pick_up_point

        beam.attributes["grasp_frame"] = beam_frame

        # ============================================================
        # Sequence
        # ============================================================

        # normal individual sequence
        if i in module_sequence:
            sequence_number = module_sequence.index(i) + 1
            beam.attributes["sequence"] = sequence_number
        else:
            beam.attributes["sequence"] = None

    
# ============================================================
# 2. Visualize selected module
# ============================================================
if 0 <= module_id < len(final_models_with_attributes):
    module_model = final_models_with_attributes[module_id]

    # plates
    for plate in module_model.plates:
        geometry.append(plate.geometry)

    # beams
    for i, beam in enumerate(module_model.beams):
        if not beam.attributes.get("neighbour", False):
            geometry.append(beam.geometry)

            beam_index = beam.attributes.get("beam_index")
            module_index = beam.attributes.get("module_index")
            sequence_number = beam.attributes.get("sequence")

            beam_indices.append(beam_index)
            beam_sequence.append(sequence_number)

            beam_frame = beam.attributes.get("grasp_frame")

            if beam_frame:
                # plane visualization
                rhino_beam_frames.append(frame_to_rhino_plane(beam_frame))

                # face visualization
                beam_face = beam.side_as_surface(0)
                v_beam_faces.append(beam_face.to_mesh())

                # text tag point
                beam_index_points.append(point_to_rhino(beam.centerline.midpoint))

                # text tag content
                beam_index_text.append("index {}".format(beam_index))

                # optional: sequence text
                beam_sequence_points.append(point_to_rhino(beam_frame.point))

                if sequence_number is not None:
                    beam_sequence_text.append(
                        "seq {} | index {}".format(sequence_number, beam_index)
                    )
                else:
                    beam_sequence_text.append(
                        "no seq | index {}".format(beam_index)
                    )

            print(i, assembly_method)
# ---------- end python_3_script_9 ----------
list_length_2 = ListLength(List=python_3_script_9.geometry)
draw_26 = COMPASDraw(cg=python_3_script_9.geometry)  # -> rg; same code as compas_draw
draw_27 = COMPASDraw(cg=python_3_script_9.v_beam_faces)  # -> rg; same code as compas_draw
plane = Plane(python_3_script_9.rhino_beam_frames)
panel_19 = Panel(list_length_2)
custom_preview_8 = CustomPreview(
    Geometry=draw_26,
    Material={diffuse=RGB(221, 160, 221), emission=RGB(66, 48, 66), shine=0.5, specular=RGB(255, 255, 255), transparency=0})
custom_preview_9 = CustomPreview(Geometry=draw_27, Material=ColourSwatch(SwatchColor=RGB(242, 186, 0)))

# ----
list_length_3 = ListLength(List=beam_length_5_m)  # -> flatten(Length)
ma_2 = MassAddition(Input=total_beams_volume_m3)  # -> Result, PartialResults
mass_addition_2 = MassAddition(Input=number_of_beams)  # -> Result, PartialResults
mass_addition_3 = MassAddition(Input=number_of_plates)  # -> Result, PartialResults
deconstruct_brep = DeconstructBrep(Brep=draw_25)  # -> Faces, Edges, Vertices
num_of_beam_45_kg = Panel(list_length)
totalnum_beam_length_5_m = Panel(list_length_3)
multiplication_2 = Multiplication(A=mass_addition_2.Result, B="4")
list_item = ListItem(List=deconstruct_brep.Vertices, Index="0", Wrap=True)
list_item_2 = ListItem(List=deconstruct_brep.Vertices, Index="1", Wrap=True)
panel_20 = Panel(python_3_script_9.final_models_with_attributes)
point_3 = Point(python_3_script_9.beam_index_points)
line_2 = Line(StartPoint=list_item, EndPoint=list_item_2)
number_of_beams_2 = Panel(multiplication_2)
number_of_plates_2 = Panel(mass_addition_3.Result)
linear_dimension_4 = LinearDimension(Line=line_2, PointA=list_item, PointB=list_item_2, Text="{0:0.000}", Size="0.5")
text_tag_2 = TextTag(
    Location=python_3_script_9.beam_index_points,
    Text=python_3_script_9.beam_index_text,
    Colour=ColourSwatch(SwatchColor=RGB(0, 0, 0)))

# ---- group: total_weight_per_module (kg)
panel_m2 = Expression(
    total_beams_weight_kg=total_beams_weight_kg,
    clt_panel_weight_kg=total_plates_weight_kg,
    Expression="total_beams_weight_kg+clt_panel_weight_kg")

# ----
total_weight_per_module_kg = Panel(panel_m2)

# ---- group: Area Density = Weight Per Module / Plate Area (kg/m2)
panel_m2_2 = Expression(total_weight_per_module=panel_m2, plate_area=plate_area_m2, Expression="total_weight_per_module/plate_area")

# ----
mass_addition_4 = MassAddition(Input=total_weight_per_module_kg)  # -> Result, PartialResults
multiplication_3 = Multiplication(A=mass_addition_4.Result, B="4")
total_weight_kg = Panel(multiplication_3)
weight_per_module_plate_area_kg_m2 = Panel(panel_m2_2)

# ---- group: move to RFL per module & visualize
x_axis = Slider(1.21, range=-10..10)
y_axis = Slider(0, range=-10..10)
surface = Surface(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)
plane_2 = Plane(surface)
move_point = MovePoint(geometry=plane_2, factor=x_axis, factor_2=y_axis, factor_3="0")
# visualize
python_3_script_10 = Python3Script(
    final_models=python_3_script_9.final_models_with_attributes,
    module_id=number_slider_2,
    t_frame=move_point,
    sequence=sequence)  # -> out, geometry, grasp_frames, heavy_beams, long_beams, long_beams_blank, v_beam_faces, beam_sequence_points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; inputs final_models: list, module_id: Int32, sequence: Int32
# ---------- python_3_script_10: Python ----------
from compas_timber.model import TimberModel
from compas.geometry import Frame, Vector, Rotation, Transformation
from compas_rhino.conversions import plane_to_compas_frame, frame_to_rhino_plane, point_to_rhino
from System.Drawing import Color

target_f = plane_to_compas_frame(t_frame)

geometry = []
grasp_frames = []
v_beam_faces = []

long_beams = []
long_beams_blank = []
heavy_beams = []

beam_sequence_points = []
beam_sequence_text = []

beam_name_point = []
beam_name_text = []

sequence_geo = []

assembly_method_text = []
assembly_color = []
plate_color = Color.LightGray

if 0 <= module_id < len(final_models):

    module_model = final_models[module_id]

    # ============================================================
    # create source frame from first plate
    # ============================================================
    source_f = None
    T = None

    if len(module_model.plates) > 0:

        plate = module_model.plates[0]

        plate_face = plate.side_as_surface(2)
        plate_midpoint = plate_face.point_at(0.5, 0.5)

        source_f = plate.frame.copy()
        source_f.point = plate_midpoint

        T = Transformation.from_frame_to_frame(source_f, target_f)

    if source_f and T:
        # ============================================================
        # plates geometry
        # ============================================================
        for plate in module_model.plates:

            geo = plate.geometry.copy()
            geo.transform(T)
            geometry.append(geo)
            sequence_geo.append(geo)
            assembly_color.append(plate_color)

        # ============================================================
        # beams geometry
        # ============================================================
        for i, beam in enumerate(module_model.beams):
            geo = beam.geometry.copy()
            geo.transform(T)

            geo_blank = beam.blank.copy()
            geo_blank.transform(T)

            geometry.append(geo)

            # ============================================================
            # beam name point and text
            # ============================================================
            name_point = beam.centerline.midpoint
            name_point.transform(T)

            beam_name_point.append(point_to_rhino(name_point))
            beam_name_text.append(beam.name)


            # ============================================================
            # beam information
            # ============================================================
            beam_index = beam.attributes.get("beam_index")
            sequence_number = beam.attributes.get("sequence")

            length = beam.blank_length

            milled_volume = beam.geometry.volume
            milled_weight = milled_volume * 470

            # ============================================================
            # sequence geometry from slider
            # ============================================================
            if sequence_number is not None and sequence_number <= sequence:

                sequence_geo.append(geo)

                # ========================================================
                # transformed grasp frame
                # ========================================================
                if "grasp_frame" in beam.attributes:

                    grasp_f = beam.attributes["grasp_frame"].copy()
                    grasp_f.transform(T)

                    grasp_frames.append(frame_to_rhino_plane(grasp_f))

                    # face visualization
                    beam_face = beam.side_as_surface(0)
                    beam_face.transform(T)
                    beam_faces = beam_face.to_mesh()
                    v_beam_faces.append(beam_faces)

                    beam_sequence_text.append(
                        "seq {} | index {}".format(sequence_number, beam_index)
                    )
                    
                    assembly_method = beam.attributes.get("assembly_method")
                    assembly_method_text.append(assembly_method)

                    if assembly_method == "special_case":
                        assembly_color.append(Color.Blue)

                    elif assembly_method == "crane_lift_human_align_screw":
                        assembly_color.append(Color.Red)

                    elif assembly_method == "human_place_human_screw":
                        assembly_color.append(Color.Yellow)

                    elif assembly_method == "robot_place_hold_human_screw":
                        assembly_color.append(Color.Green)

                    else:
                        assembly_color.append(Color.White)
                        
                # sequence point
                seq_point = beam.centerline.midpoint
                seq_point.transform(T)
                beam_sequence_points.append(point_to_rhino(seq_point))

            # ============================================================
            # beams longer than 5 m
            # ============================================================
            if length > 5.0:
                long_beams.append(geo)
                long_beams_blank.append(geo_blank)

            # ============================================================
            # beams heavier than 45 kg
            # ============================================================
            if milled_weight > 45.0:
                heavy_beams.append(geo)
# ---------- end python_3_script_10 ----------
list_length_4 = ListLength(List=python_3_script_10.geometry)
plane_3 = Plane(python_3_script_10.grasp_frames)

# ----
list_item_3 = ListItem(List=weight_per_module_plate_area_kg_m2, Index=panel_2, Wrap=True)
panel_21 = Panel(list_item_3)
panel_22 = Panel(list_length_4)
move_2 = Move(Geometry=python_3_script_10.beam_sequence_points, Motion=unit_z)  # -> Geometry, Transform
v_beam_faces = COMPASDraw(cg=python_3_script_10.v_beam_faces)  # -> rg; same code as compas_draw
sequence_geo = COMPASDraw(cg=python_3_script_10.sequence_geo)  # -> rg; same code as compas_draw
geometry = COMPASDraw(cg=python_3_script_10.geometry)  # -> rg; same code as compas_draw
v_beam_faces_2 = CustomPreview(Geometry=v_beam_faces, Material=ColourSwatch(SwatchColor=RGB(255, 247, 0)))
geometry_2 = CustomPreview(
    Geometry=geometry,
    Material={diffuse=RGB(221, 160, 221), emission=RGB(66, 48, 66), shine=0.5, specular=RGB(255, 255, 255), transparency=0})
sequence_geo_2 = CustomPreview(Geometry=sequence_geo, Material=python_3_script_10.assembly_color)
beam_name = TextTag(Location=python_3_script_10.beam_name_point, Text=python_3_script_10.beam_name_text, Colour=colour_swatch)
assembly_method = TextTag(Location=move_2.Geometry, Text=python_3_script_10.assembly_method_text, Colour=colour_swatch)
beam_sequence = TextTag(Location=move_2.Geometry, Text=python_3_script_10.beam_sequence_text, Colour=ColourSwatch(SwatchColor=RGB(0, 0, 0)))
panel_23 = Panel(geometry)
draw_28 = COMPASDraw(cg=python_3_script_10.long_beams)  # -> rg; same code as compas_draw
draw_29 = COMPASDraw(cg=python_3_script_10.long_beams_blank)  # -> rg; same code as compas_draw

# ---- group: module height
group_2 = Group(Geometry=geometry)
bounding_box_2 = BoundingBox(Content=group_2, Plane=PlaneXY(0, 0, 0))  # -> Box, Box_2
box_corners = BoxCorners(Box=bounding_box_2.Box)  # -> CornerA, CornerB, CornerC, CornerD, CornerE, CornerF, CornerG, CornerH
line_3 = Line(StartPoint=box_corners.CornerA, EndPoint=box_corners.CornerE)
linear_dimension_5 = LinearDimension(Line=line_3, PointA=box_corners.CornerA, PointB=box_corners.CornerE, Text="{0:0.000}", Size="0.5")

# ---- group: beam that are longer than 5 m
deconstruct_brep_2 = DeconstructBrep(Brep=draw_29)  # -> Faces, Edges, Vertices
custom_preview_10 = CustomPreview(Geometry=draw_28, Material=ColourSwatch(SwatchColor=RGB(0, 0, 150)))
list_item_4 = ListItem(List=deconstruct_brep_2.Vertices, Index="0", Wrap=True)
list_item_5 = ListItem(List=deconstruct_brep_2.Vertices, Index="1", Wrap=True)
line_4 = Line(StartPoint=list_item_4, EndPoint=list_item_5)
linear_dimension_6 = LinearDimension(Line=line_4, PointA=list_item_4, PointB=list_item_5, Text="{0:0.000}", Size="0.5")

# ---- group: beam that are heavier than 45 kg
draw_30 = COMPASDraw(cg=python_3_script_10.heavy_beams)  # -> rg; same code as compas_draw
list_length_5 = ListLength(List=draw_30)
custom_preview_11 = CustomPreview(Geometry=draw_30, Material=ColourSwatch(SwatchColor=RGB(255, 0, 0)))

# ----
num_of_beam_45_kg_2 = Panel(list_length_5)

# ---- group: Nesting
# pieces amount of 1 6.5m timber
panel_24 = Panel("1")
trim_6 = TrimTree(Tree=draw_21, Depth=panel_24)
bbox_2 = BoundingBox(Content=trim_6, Plane=PlaneXY(0, 0, 0), UnionBox=True)  # -> Box, Box_2
debrep_4 = DeconstructBrep(Brep=bbox_2.Box)  # -> Faces, Edges, Vertices
item_7 = ListItem(List=debrep_4.Faces, Index="1", Wrap=True)
pull = PullPoint(Point=trim_4, Geometry=item_7, ClosestOnly=True)  # -> ClosestPoint, Distance, Index
X = UnitX(Factor=Slider(3, range=-10..10))
move_3 = Move(Geometry=pull.ClosestPoint, Motion=X)  # -> Geometry, Transform

# time for cutting
lng = ListLength(List=py3_3.blank_length)
trim_7 = TrimTree(Tree=lng, Depth="2")
multiplication_4 = Multiplication(A=trim_7, B=Slider(5, range=0..10))
concat_2 = Concatenate(FragmentA=multiplication_4, FragmentB="  mins")
X_2 = UnitX(Factor=Slider(3, range=-10..10))
move_4 = Move(Geometry=move_3.Geometry, Motion=X_2)  # -> Geometry, Transform
tag_3 = TextTag(Location=move_4.Geometry, Text=concat_2, Colour=ColourSwatch(SwatchColor=RGB(51, 51, 51)))

concat_3 = Concatenate(FragmentA=trim_7, FragmentB="  beams")
tag_4 = TextTag(Location=move_3.Geometry, Text=concat_3, Colour=ColourSwatch(SwatchColor=RGB(51, 51, 51)))

# ==== cluster MovePoint
factor = ClusterInput()
factor_2 = ClusterInput()
unit_x = UnitX(Factor=factor)
unit_y = UnitY(Factor=factor_2)
geometry = ClusterInput()
move = Move(Geometry=geometry, Motion=unit_x)  # -> Geometry, Transform
factor_3 = ClusterInput()
move_2 = Move(Geometry=move.Geometry, Motion=unit_y)  # -> Geometry, Transform
unit_z = UnitZ(Factor=factor_3)
move_3 = Move(Geometry=move_2.Geometry, Motion=unit_z)  # -> Geometry, Transform
geometry_2 = ClusterOutput(move_3.Geometry)
