# Grasshopper definition 101_line_model.ghx (Grasshopper 1.0.8)

curve = Curve(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)
curve_2 = Curve([<curve referenced from the Rhino model> x1076])
python_3_script = Python3Script(lines=curve_2)  # -> out, all_lines; inputs lines: list of Line
# ---------- python_3_script: Python ----------
from compas_rhino.conversions import line_to_compas

lines = [line_to_compas(line) for line in lines]

all_lines = []
for i, ln in enumerate(lines):
    ln.name = str(i)
    all_lines.append(ln)
# ---------- end python_3_script ----------
python_3_script_2 = Python3Script(line=curve)  # -> out, all_lines; inputs line: Line
# ---------- python_3_script_2: Python ----------
from compas_rhino.conversions import line_to_compas

line = line_to_compas(line)

all_lines = []

for i in range(5):
    current_line = line.translated([0,0,i*200])
    current_line.name = str(i) # Convert index to string
    all_lines.append(current_line)
# ---------- end python_3_script_2 ----------
compas_draw = COMPASDraw(cg=python_3_script.all_lines)  # -> rg
#   port cg: The COMPAS geometry or datastructure to be drawn.
#   port rg: The Rhino geometry object.
# ---------- compas_draw: Python ----------
# r: compas>=2.14.1
"""
Draws COMPAS geometry in Grasshopper.
"""

from typing import Any

import Grasshopper

from compas.scene import SceneObject


class CompasToRhinoGeometry(Grasshopper.Kernel.GH_ScriptInstance):
    def RunScript(self, cg):
        if not cg:
            return None

        return SceneObject(item=cg).draw()
# ---------- end compas_draw ----------
python_3_script_3 = Python3Script(all_lines=python_3_script.all_lines, save=Button())  # inputs all_lines: list
# ---------- python_3_script_3: Python ----------
import os
from compas.data import json_dump

gh_dir = os.path.dirname(ghenv.Component.OnPingDocument().FilePath)
data_folder = os.path.join(gh_dir, "data")
json_path = os.path.join(data_folder, "out_lines.json")

# Build data with attributes
data = []
for i, line in enumerate(all_lines):
    data.append({
        "line": line,
        "type": line.name
    })

if save:
    with open(json_path, 'w') as path:
        json_dump(data, path, pretty=True)
# ---------- end python_3_script_3 ----------
