# Grasshopper definition Tree_generator_v2(1).gh (Grasshopper 1.0.8)
# plug-ins: Karamba3D, CORE.Toolbox.Grasshopper, MeshEdit Components

number_slider = Slider(0.572, range=0.001..1)
number_slider_2 = Slider(1.516, range=1.001..3)
number_slider_3 = Slider(4.642, range=3.001..5)

number_slider_4 = Slider(0.281, range=0.001..0.7)
number_slider_5 = Slider(0.807, range=0.701..1.5)
number_slider_6 = Slider(2.178, range=1.501..3)

range = Range(Domain=Domain(0, 1), Steps="4")
range_2 = Range(Domain=Domain(0, 1), Steps="4")
graph = GraphMapper(range_2, x0=0, x1=1, y0=0, y1=1, container_name="Bezier", cpx=[0, 0.3527153432, 1, 1], cpy=[0, 0, 0.533995688, 1])
graph_2 = GraphMapper(range, x0=0, x1=1, y0=0, y1=1, container_name="Bezier", cpx=[0, 0.3447926939, 1, 1], cpy=[0, 0, 0.4894599319, 1])
bnd = Bounds(Numbers=graph_2)
bnd_2 = Bounds(Numbers=graph)
pt = Point([Point(173.1600008, 48.10000076, 20.1), Point(173.1600008, 57.72000076, 20.1)])
rec = Rectangle({Plane=PlaneXY(173.1600008, 52.91000076, 24.8), Size=Domain2(u=-4.81..4.81, v=-14.43..14.43)})
pt_2 = Point([Point(163.5400008, 48.10000076, 16.1), Point(163.5400008, 57.72000076, 16.1)])
rec_2 = Rectangle({Plane=PlaneXY(163.5400008, 52.91000076, 24.8), Size=Domain2(u=-4.81..4.81, v=-14.43..14.43)})
merge = Merge(Data1="0", Data2=number_slider, Data3=number_slider_2, Data4=number_slider_3, Data5="8.7")
graph_3 = QuickGraph(merge, SortOrder=0)
remap = RemapNumbers(Value=graph_2, Source=bnd, Target="8.7")  # -> Mapped, Clipped
merge_2 = Merge(Data1="0", Data2=number_slider_4, Data3=number_slider_5, Data4=number_slider_6, Data5="4.7")
graph_4 = QuickGraph(merge_2, SortOrder=0)
remap_2 = RemapNumbers(Value=graph, Source=bnd_2, Target="4.7")  # -> Mapped, Clipped
galapagos = Galapagos(
    fitness=analyse,
    gene=[number_slider, number_slider_2, number_slider_3, number_slider_4, number_slider_5, number_slider_6])
panel = Panel(remap_2.Mapped)
panel_2 = Panel(remap.Mapped)
py3 = Python3Script(boundary=rec_2, div_x="4", div_y="6", height="8.7", height_list=merge)  # -> out, v_list_out, vertices_out, beams_out, lines_out, new_lines, intersections, pln; inputs anchors: list of Point3d, boundary: Polyline, div_x: Int32, div_y: Int32, height: Double, height_list: list of Double
# ---------- py3: Python ----------
#locate class file in the same folder
from compas_rhino import unload_modules
import sys
import os

#get current file path
path = ghenv.Component.OnPingDocument().FilePath
#get parent directory of the parent directory
parentdir = os.path.dirname(path)
#get src folder which contains classes
dire = os.path.join(parentdir,'scripts')
sys.path.append(dire)

unload_modules('Line_model_v2')


##########------------Imports------------###########
from Line_model_v2 import Beam, VertexList
from compas.geometry import Vector, Point, Line, Plane, Frame

from compas_rhino.conversions import point_to_compas, point_to_rhino
from compas_rhino.conversions import line_to_rhino
from compas_rhino.conversions import polygon_to_compas
from compas_rhino.conversions import plane_to_rhino
import math

from Grasshopper import DataTree
from Grasshopper.Kernel.Data import GH_Path

#######------Conversions-------########
# anchors = [point_to_compas(a) for a in anchors]
boundary = polygon_to_compas(boundary)


#########------Main Code------###############
# 1. Create generator
v_list = VertexList()
v_list.compute_diagrid(
    boundary=boundary,
    division_x=div_x,
    division_y=div_y,
    height=height,
    height_list=height_list
)
# print (v_list.pairs)
print (len(v_list))


# 2. Skip certain vertices
skip_list = 83   # or [83]
v_list.skip(skip_list)

# 3. Move certain vertices
# move_list = [61, 66, 71] + [75, 76, 80, 79]
# move_val_z = [0.8] * 3 + [1.2] * 4
# move_vecs = [Vector(0, 0, val_z) for val_z in move_val_z]
# v_list.move(move_list, move_vecs)
v_list.move([75, 79], [Vector(0, -0.9, 0)] * 2)
# # 4. Add new vertices and pairs
# new_start = [29, 54, 70, 79]
# new_end = [53, 69, 78, 82]
# new_pts = []
# for s, e in zip(new_start, new_end):
#     new_pt = Beam(s, e, v_list).mid
#     new_pts.append(new_pt)

# new_pairs = []
# for i in range(len(new_start) - 1):
#     pair = (len(v_list) + i, len(v_list) + (i + 1))
#     new_pairs.append(pair)

# v_list.add_vertices(new_pts)
# v_list.add_pairs(new_pairs)



# 5. Construct beams
beams = []
lines = []
for pair in v_list.pairs:
    beam = Beam(pair[0], pair[1], v_list)
    beams.append(beam)
    lines.append(beam.axis)


# 6. Add new vertices and pairs
from compas.geometry import intersection_segment_plane
origin = Beam(53, 29, v_list).mid
frame = Frame(origin, v_list.dir2)
pln = Plane(origin, frame.yaxis)
intersections = []
for ln in lines:
    pt = intersection_segment_plane(ln, pln)
    if pt is None:
        continue
    pt = Point(pt[0], pt[1], pt[2])
    intersections.append(pt)
pln = plane_to_rhino(pln)

#########----------Output data----------##############
v_list_out = v_list
beams_out = beams
vertices_out = list(v_list)
lines_out = lines

# new_lines = []
# for pair in new_pairs:
#     ln = Beam(pair[0], pair[1], v_list).axis
#     new_lines.append(ln)
# ---------- end py3 ----------
py3_2 = Python3Script(boundary=rec, div_x="4", div_y="6", height="4.7", height_list=merge_2)  # -> out, v_list_out, vertices_out, beams_out, lines_out; inputs anchors: list of Point3d, boundary: Polyline, div_x: Int32, div_y: Int32, height: Double, height_list: list of Double
# ---------- py3_2: Python ----------
#locate class file in the same folder
from compas_rhino import unload_modules
import sys
import os

#get current file path
path = ghenv.Component.OnPingDocument().FilePath
#get parent directory of the parent directory
parentdir = os.path.dirname(path)
#get src folder which contains classes
dire = os.path.join(parentdir,'scripts')
sys.path.append(dire)

unload_modules('Line_model_v2')


##########------------Imports------------###########
from Line_model_v2 import Beam, VertexList
from compas.geometry import Box, Frame, Vector

from compas_rhino.conversions import point_to_compas, point_to_rhino
from compas_rhino.conversions import line_to_rhino
from compas_rhino.conversions import polygon_to_compas

from Grasshopper import DataTree
from Grasshopper.Kernel.Data import GH_Path

#######------Conversions-------########
# anchors = [point_to_compas(a) for a in anchors]
boundary = polygon_to_compas(boundary)


#########------Main Code------###############
v_list = VertexList()
v_list.compute_diagrid(
    boundary=boundary,
    division_x=div_x,
    division_y=div_y,
    height=height,
    height_list=height_list
)
# print (v_list.pairs)
print (len(v_list))

# Move certain vertices
# move_list = [61, 66, 71] + [75, 76, 80, 79]
# move_val_z = [0.8] * 3 + [1.2] * 4
# move_vecs = [Vector(0, 0, val_z) for val_z in move_val_z]
# v_list.move(move_list, move_vecs)


# Skip vertices
skip_list = 83   # or [83]
v_list.skip(skip_list)

# Construct beams
beams = []
lines = []
for pair in v_list.pairs:
    beam = Beam(pair[0], pair[1], v_list)
    beams.append(beam)
    lines.append(beam.axis)


# Output data
v_list_out = v_list
beams_out = beams
vertices_out = list(v_list)
lines_out = lines
# ---------- end py3_2 ----------
draw = COMPASDraw(cg=py3_2.vertices_out)  # -> rg
#   port cg: The COMPAS geometry or datastructure to be drawn.
#   port rg: The Rhino geometry object.
# ---------- draw: Python ----------
# r: compas>=2.14.1
"""
Draws COMPAS geometry in Grasshopper.
"""

from typing import Any

import Grasshopper

from compas.scene import SceneObject


class CompasToRhinoGeometry(Grasshopper.Kernel.GH_ScriptInstance):
    def RunScript(self, cg):
        if not cg:
            return None

        return SceneObject(item=cg).draw()
# ---------- end draw ----------
draw_2 = COMPASDraw(cg=py3_2.lines_out)  # -> rg; same code as draw
draw_3 = COMPASDraw(cg=py3.vertices_out)  # -> rg; same code as draw
draw_4 = COMPASDraw(cg=py3.lines_out)  # -> rg; same code as draw
draw_5 = COMPASDraw(cg=py3.new_lines)  # -> rg; same code as draw
draw_6 = COMPASDraw(cg=py3.intersections)  # -> rg; same code as draw
pln = Plane(py3.pln)
points = PointList(Points=draw, Size=Slider(0.41, range=0..1))
points_2 = PointList(Points=draw_3, Size=Slider(0.41, range=0..1))
crv = Curve([<curve referenced from the Rhino model> x386])
explode = Explode(Curve=crv, Recursive=True)  # -> Segments, Vertices
merge_3 = Merge(Data1=draw_4, Data2=draw_2)
merge_4 = Merge(Data1=draw_3, Data2=draw)
llinter = LineLineIntersectionKaramba3D(IntersectingLines=explode.Segments, LinesToIntersect=explode.Segments, LimitDistance_m=0.005)  # -> InterSecPoints, LineSubSegments
pt_3 = Point(Tree({0;0;0;0}: [Point(161.1350008, 43.29000076, 24.8), Point(159.9325008, 40.88500076, 24.238)], {0;1;0;0}: [Point(158.7300008, 48.10000076, 24.8), Point(159.9325008, 50.50500076, 24.238)], {0;2;0;0}: [Point(158.7300008, 57.72000076, 24.8), Point(159.9325008, 55.31500076, 24.238)], {0;3;0;0}: [Point(158.7300008, 62.53000076, 24.8), Point(159.9325008, 64.93500076, 24.238)], {0;4;0;0}: [Point(158.7300008, 67.34000076, 24.8), Point(159.9325008, 64.93500076, 24.238)], {0;5;0;0}: [Point(161.1350008, 38.48000076, 24.8), Point(162.3375008, 40.88500076, 24.238)]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))
line = Line([Line((161.1350008, 43.29000076, 24.8), (159.9325008, 40.88500076, 24.238)), Line((158.7300008, 48.10000076, 24.8), (159.9325008, 50.50500076, 24.238)), Line((158.7300008, 57.72000076, 24.8), (159.9325008, 55.31500076, 24.238)), Line((158.7300008, 62.53000076, 24.8), (159.9325008, 64.93500076, 24.238)), Line((158.7300008, 67.34000076, 24.8), (159.9325008, 64.93500076, 24.238)), Line((161.1350008, 38.48000076, 24.8), (162.3375008, 40.88500076, 24.238))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])
rdlines = RemoveDuplicateLinesKaramba3D(Line=flatten(llinter.LineSubSegments), LimitDistance=0.005)  # -> OutLine, Info, Indexes
line_2 = Line(rdlines.OutLine)
rdpoints = RemoveDuplicatePointsKaramba3D(Point=llinter.InterSecPoints, LimitDistance=0.005)  # -> OutPoint, Info, Indexes
pt_4 = Point(rdpoints.OutPoint)
crv_2 = Curve([<curve referenced from the Rhino model> x2])
crv_3 = Curve([<curve referenced from the Rhino model> x196])
explode_2 = Explode(Curve=crv_2, Recursive=True)  # -> Segments, Vertices
entwine = Entwine(Branch00=crv_3, FlattenInputs=True)
beam = CTBeam(centerline=entwine, width="0.12", height="0.16")  # -> Beam, Blank; inputs centerline: list, z_vector: list of Vector3d, width: list of Double, height: list of Double, category: list of String, updateRefObj: Boolean
#   port centerline: Referenced curve or line, Guid of curve or line in the active Rhino document.
#   port z_vector: Vector defining the orientation of the cross-section (corresponds to the height dimension). If None, a default will be taken.
#   port width: Width of the cross-section (usually the smaller dimension).
#   port height: Height of the cross-section (usually the larger dimension).
#   port category: Category of a beam.
#   port updateRefObj: (optional) If True, the attributes in the referenced object will be updated/overwritten with the new values given here.
#   port Beam: Beam object(s).
#   port Blank: Shape of the beam's blank.
# ---------- beam: Python ----------
# r: compas_timber>=1.0.2
"""Creates a Beam from a LineCurve."""

# flake8: noqa
import Grasshopper
import Rhino
import rhinoscriptsyntax as rs
import System
from compas.scene import Scene
from compas_rhino.conversions import line_to_compas
from compas_rhino.conversions import vector_to_compas

from compas_timber.elements import Beam as CTBeam
from compas_timber.ghpython.rhino_object_name_attributes import update_rhobj_attributes_name
from compas_timber.ghpython.ghcomponent_helpers import list_input_valid_cpython


class Beam_fromCurve(Grasshopper.Kernel.GH_ScriptInstance):
    def RunScript(self,
            centerline: System.Collections.Generic.List[object],
            z_vector: System.Collections.Generic.List[Rhino.Geometry.Vector3d],
            width: System.Collections.Generic.List[float],
            height: System.Collections.Generic.List[float],
            category: System.Collections.Generic.List[str],
            updateRefObj: bool):
        # minimum inputs required
        if not list_input_valid_cpython(ghenv, centerline, "Centerline"):
            return
        if not width:
            length = self._get_centerline_length(centerline)
            width = [length / 20]
        if not height:
            length = self._get_centerline_length(centerline)
            height = [length / 10]

        # reformat unset parameters for consistency
        if not z_vector:
            z_vector = [None]
        if not category:
            category = [None]

        beams = []
        blanks = []
        scene = Scene()

        if centerline and height and width:
            # check list lengths for consistency
            N = len(centerline)
            if len(z_vector) not in (0, 1, N):
                ghenv.Component.AddRuntimeMessage(
                    Grasshopper.Kernel.GH_RuntimeMessageLevel.Error, " In 'ZVector' I need either none, one or the same number of inputs as the Crv parameter."
                )
            if len(width) not in (1, N):
                ghenv.Component.AddRuntimeMessage(Grasshopper.Kernel.GH_RuntimeMessageLevel.Error, " In 'W' I need either one or the same number of inputs as the Crv parameter.")
            if len(height) not in (1, N):
                ghenv.Component.AddRuntimeMessage(Grasshopper.Kernel.GH_RuntimeMessageLevel.Error, " In 'H' I need either one or the same number of inputs as the Crv parameter.")
            if len(category) not in (0, 1, N):
                ghenv.Component.AddRuntimeMessage(
                    Grasshopper.Kernel.GH_RuntimeMessageLevel.Error, " In 'Category' I need either none, one or the same number of inputs as the Crv parameter."
                )

            # duplicate data if None or single value
            if len(z_vector) != N:
                z_vector = [z_vector[0] for _ in range(N)]
            if len(width) != N:
                width = [width[0] for _ in range(N)]
            if len(height) != N:
                height = [height[0] for _ in range(N)]
            if len(category) != N:
                category = [category[0] for _ in range(N)]

            for line, z, w, h, c in zip(centerline, z_vector, width, height, category):
                guid, geometry = self._get_guid_and_geometry(line)
                rhino_line = rs.coerceline(geometry)
                line = line_to_compas(rhino_line)

                z = vector_to_compas(z) if z else None
                beam = CTBeam.from_centerline(centerline=line, width=w, height=h, z_vector=z)
                beam.attributes["rhino_guid"] = str(guid) if guid else None
                beam.attributes["category"] = c
                if updateRefObj and guid:
                    update_rhobj_attributes_name(guid, "width", str(w))
                    update_rhobj_attributes_name(guid, "height", str(h))
                    update_rhobj_attributes_name(guid, "zvector", str(list(beam.frame.zaxis)))
                    update_rhobj_attributes_name(guid, "category", c)

                beams.append(beam)
                scene.add(beam.blank)

        blanks = scene.draw()

        return beams, blanks

    def _get_guid_and_geometry(self, line):
        # internalized curves and GH geometry will not have persistent GUIDs, referenced Rhino objects will
        # type hint on the input has to be 'ghdoc' for this to work
        guid = None
        geometry = line
        rhino_obj = Rhino.RhinoDoc.ActiveDoc.Objects.FindId(line)
        if rhino_obj:
            guid = line
            geometry = rhino_obj.Geometry
        return guid, geometry

    def _get_centerline_length(self, centerline):
        centerline_length = []
        for i in centerline:
            centerline_length.append(rs.CurveLength(i))
        if centerline_length:
            length_average = sum(centerline_length) / len(centerline_length)
        else:
            length_average = 1
        return length_average
# ---------- end beam ----------
wires = BrepWireframe(Brep=beam.Blank, Density=-1)
preview = CustomPreview(
    Geometry=beam.Blank,
    Material=graft([ColourSwatch(SwatchColor=RGB(74, 145, 57)), ColourSwatch(SwatchColor=RGB(145, 132, 57))]))
preview_2 = CustomPreview(Geometry=wires, Material=ColourSwatch(SwatchColor=RGB(255, 255, 255)))
crv_4 = Curve()
merge_5 = Merge(Data1=line_2)
rdpoints_2 = RemoveDuplicatePointsKaramba3D(Point=pt_4, LimitDistance=0.005)  # -> OutPoint, Info, Indexes
pt_5 = Point([pt_2, pt])
pt_6 = Point(pt_5)
line_3 = Line(merge_5)
pt_7 = Point(rdpoints_2.OutPoint)
sph = Sphere(Base=pt_6, Radius=Slider(0.54, range=0..1))

line_4 = Line()
len = Length(Curve=line_4)
bnd_3 = Bounds(Numbers=len)
dom = ConstructDomain(DomainStart=Slider(0.048, range=0..1), DomainEnd=Slider(0.242, range=0..1))
dedomain = DeconstructDomain(Domain=bnd_3)  # -> Start, End
midpt = CurveMiddle(Curve=line_4)
remap_3 = RemapNumbers(Value=len, Source=bnd_3, Target=dom)  # -> Mapped, Clipped
gradient = Gradient(
    LowerLimit=dedomain.End,
    UpperLimit=dedomain.Start,
    Parameter=len,
    stops=[0: RGB(234, 38, 0), 0.25: RGB(234, 126, 0), 0.5: RGB(254, 244, 84), 0.75: RGB(173, 203, 249), 1: RGB(75, 107, 169)])
yz = YZPlane(Origin=midpt)
tag = TextTag3D(Location=yz, Text=len, Size=Slider(0.067, range=0..1), Justification=7)
line_prev = TTLineweightPreview(Geometry=line_4, StrokeColor=gradient, StrokeWeight=remap_3.Mapped, Absolute=Toggle(True))

rec_3 = Rectangle({Plane=PlaneXY(168.3500008, 52.91000076, 24.8), Size=Domain2(u=-9.62..9.62, v=-14.43..14.43)})
brepsinc = PointInBreps(Brep=sph, Point=pt_7, Strict=False)  # -> Inside, Index
explode_3 = Explode(Curve=rec_3, Recursive=True)  # -> Segments, Vertices
cull = CullPattern(List=pt_7, CullPattern=brepsinc.Inside)

# ----
# C. Set Support
fsim = FindSimilarMember(Data=pt_6, Set=pt_7)  # -> Hit, Index
pt_8 = Point(cull)
xy = XYPlane(Origin=Point(0, 0, 0))
supp = SupportKaramba3D(
    PosInd=pt_8,
    PlaneOfReference=xy,
    Ct_kN_m=Vector(0, 0, 0),
    Cr_kNm_rad=Vector(0, 0, 0),
    menu=[buttons(on, on, on, off, off, off)])
item = ListItem(List=pt_8, Index=0, Wrap=True)

pt_9 = Point(pt_7)

# ----
# B. Create Beams
number_slider_7 = Slider(20, range=0..100)
number_slider_8 = Slider(16, range=0..100)
matselect = MaterialSelectionKaramba3D(menu=[dropdown(1), dropdown(4), dropdown(11)])
crosec = CrossSectionKaramba3D(
    FamilyNameOfCrossSection="DefaultCroSec",
    Material=matselect,
    Height_cm=number_slider_7,
    UpperFlangeWidth_cm=number_slider_8,
    LowerFlangeWidth_cm=number_slider_8,
    mode="Trapezoid")
line_5 = Line(line_3)
lineelem = CreateLinearElementKaramba3D(
    Line=line_5,
    Identifier="N",
    CrossSection=crosec,
    LimitDistance_m=0.005,
    BucklingLengthY_m=-1,
    BucklingLengthZ_m=-1,
    BucklingLengthLT_m=-1,
    Bending=True,
    ToPolylineMaxAngle=0.25,
    ToPolylineTolerance=0.1,
    ToPolylineMaxEdgeLength=0.25,
    New=True,
    Remove=True,
    mode="LineToBeam",
    GuidGeneratorSeed=401302299)  # -> Element, Points, Info

number_slider_9 = Slider(2000, range=0..20000)
number_slider_10 = Slider(2000, range=0..20000)
vec = VectorXYZ(XComponent=number_slider_9, YComponent=number_slider_9, ZComponent=number_slider_9)  # -> Vector, Length
vec_2 = VectorXYZ(XComponent=number_slider_10, YComponent=number_slider_10, ZComponent=number_slider_10)  # -> Vector, Length

# ----
# E. Set Joints
beam_joints = BeamJointsKaramba3D(
    BeamIdentifier="N",
    CtKNMAtStartingNode=Vector(0, 0, 0),
    CrKNmRadAtStartingNode=vec.Vector,
    CtKNMAtEndNode=Vector(0, 0, 0),
    CrKNmRadAtEndNode=vec_2.Vector,
    menu=[buttons(off, off, off, on, on, on), buttons(off, off, off, on, on, on)])

# ----
# F. Optimize Cross Sections
number_slider_11 = Slider(2, range=0..10)
number_slider_12 = Slider(12, range=0..100)
number_slider_13 = Slider(16, range=0..100)
number_slider_14 = Slider(20, range=0..100)
matselect_2 = MaterialSelectionKaramba3D(menu=[dropdown(1), dropdown(4), dropdown(11)])
series = Series(Start=number_slider_12, Step=number_slider_11, Count=10)
series_2 = Series(Start=number_slider_13, Step=Slider(2, range=0..10), Count=10)
series_3 = Series(Start=number_slider_14, Step=Slider(2, range=0..10), Count=10)
panel_3 = Panel(series)
panel_4 = Panel(series_2)
panel_5 = Panel(series_3)
crosec_2 = CrossSectionKaramba3D(
    FamilyNameOfCrossSection="DefaultCroSec",
    Material=matselect_2,
    Height_cm=series,
    UpperFlangeWidth_cm=number_slider_12,
    LowerFlangeWidth_cm=number_slider_12,
    mode="Trapezoid")
crosec_3 = CrossSectionKaramba3D(
    FamilyNameOfCrossSection="DefaultCroSec",
    Material=matselect_2,
    Height_cm=series_2,
    UpperFlangeWidth_cm=number_slider_13,
    LowerFlangeWidth_cm=number_slider_13,
    mode="Trapezoid")
crosec_4 = CrossSectionKaramba3D(
    FamilyNameOfCrossSection="DefaultCroSec",
    Material=matselect_2,
    Height_cm=series_3,
    UpperFlangeWidth_cm=number_slider_14,
    LowerFlangeWidth_cm=number_slider_14,
    mode="Trapezoid")  # disabled
merge_6 = Merge(Data1=crosec_2, Data2=crosec_3, Data3=crosec_4)
crosec_5 = CrossSectionKaramba3D(merge_6)

addition = Addition(A=Slider(6.5, range=0..10), B=4)
Z = UnitZ(Factor=addition)
pt_10 = Point(Point(188.7300008, 83.48000076, 24.8))
move = Move(Geometry=item, Motion=Z)  # -> Geometry, Transform
xz = XZPlane(Origin=pt_10)
panel_6 = Panel("""0.2
0.2
5""")
panel_7 = Panel("""0.2
0.2
5""")

# ----
# D. Set Loads
# * facade load?
# * snow, wind, etc. load?
pt_11 = Point(pt_7)
item_2 = ListItem(List=explode_3.Segments, Index=0, Wrap=True)  # -> Item, Item1, Item2
pdecon = Deconstruct(Point=pt_11)  # -> XComponent, YComponent, ZComponent
pt_12 = Point(pt_7)
crv_cp = CurveClosestPoint(Point=pt_12, Curve=item_2.Item)  # -> Point, Parameter, Distance
sort = SortList(Keys=pdecon.ZComponent, ValuesA=pt_11)  # -> reverse(Keys), reverse(ValuesA)
round = Round(Number=crv_cp.Distance)  # -> Nearest, Floor, Ceiling
similar = Similarity(FirstNumber=round.Nearest, SecondNumber="0", Threshold=0.1)  # -> Similarity, AbsoluteDifference
cull_2 = CullPattern(List=pt_12, CullPattern=similar.Similarity)
Z_2 = UnitZ(Factor="-1.1")
Z_3 = UnitZ(Factor="-9")
loads = LoadsKaramba3D(Vector=Vector(0, 0, -1), LCase="LC0", mode="Gravity")

crv_cp_2 = CurveClosestPoint(Point=pt_9, Curve=item_2.Item2)  # -> Point, Parameter, Distance
item_3 = ListItem(List=sort.Keys, Index=0, Wrap=True)
round_2 = Round(Number=crv_cp_2.Distance)  # -> Nearest, Floor, Ceiling
similar_2 = Similarity(FirstNumber=round_2.Nearest, SecondNumber="0", Threshold=0.1)  # -> Similarity, AbsoluteDifference
cull_3 = CullPattern(List=pt_9, CullPattern=similar_2.Similarity)

similar_3 = Similarity(FirstNumber=sort.Keys, SecondNumber=item_3, Threshold=0.1)  # -> Similarity, AbsoluteDifference
cull_4 = CullPattern(List=sort.ValuesA, CullPattern=similar_3.Similarity)
del = DelaunayMesh(Points=cull_4, Plane=PlaneXY(0, 0, 0))
quad = Quadrangulate(Mesh=del, Angle=0.03490658504, Ratio=0.875)  # -> Mesh, Count
pt_13 = Point([cull_2, cull_3])
loads_2 = LoadsKaramba3D(ForceVector=Z_3, Local=False, PosInd=pt_13, LCase="LC0", mode="Point")
loads_3 = LoadsKaramba3D(Vector=Z_2, Mesh=quad.Mesh, LCase="LC0", mode="MeshLoad -Const.", menu=[buttons(on, off, off), buttons(on, on)])
merge_7 = Merge(Data1=loads, Data2=loads_2, Data3=loads_3)  # -> flatten(Result)
load = LoadKaramba3D(merge_7)

# ----
# A. Create Panels
number_slider_15 = Slider(6, range=0..100)
explode_4 = MeshExplode(Mesh=quad.Mesh, Interpolate=False)  # -> flatten(Faces)
matselect_3 = MaterialSelectionKaramba3D(menu=[dropdown(1), dropdown(4), dropdown(11)])
crosec_6 = CrossSectionKaramba3D(FamilyNameOfCrossSection="DefaultCroSec", Material=matselect_3, Height_cm=number_slider_15, mode="Shell - Const")
surfelem = CreateSurfaceElementKaramba3D(Mesh=explode_4, Identifier="N", CrossSection=crosec_6, LimitDistance_m=0.005, Bending=True, mode="MeshToShell")  # -> Element, Points, Info

merge_8 = Merge(Data1=surfelem.Element, Data2=lineelem.Element)  # -> flatten(Result)
element = ElementKaramba3D(merge_8)
assemble = AssembleModelKaramba3D(Elem=element, Support=supp, Load=load, Joint=beam_joints, LimitDistance_m=0.005)  # -> Model, Info, Mass_kg, CentreOfGravity, LoadCaseNames
opticrosec = OptimizeCrossSectionKaramba3D(
    Model=assemble.Model,
    CrossSections=crosec_5,
    MaximumUtilization=1,
    MaximumDisplacement_cm=-1,
    MaximumVirtualWork_kNcm=0.01,
    NumberOfUtilizationIterations=5,
    NumberOfDisplacementIterations=5,
    NumberOfDisplacementIncrementsPerIteration=2,
    DisplacementTolerance=0.01,
    NumberOfSamplePoints=3,
    ElasticDesign=True,
    GammaM0=1,
    GammaM1=1.1,
    SwayFrame=True)  # -> OptimizedModel, Info, Mass_kg, MaximumDisplacement_cm, ElasticEnergyChange_kNm, MaximumUtilizationViewInsufficientCrossSections, MaximumDisplacementViewLimitCrossSections
panel_8 = Panel(opticrosec.Mass_kg)
analyse = AnalyseKaramba3D(Model=opticrosec.OptimizedModel)  # -> AnalysedModel, MaximumDisplacement_cm, ResultingForce_kN, ChangeOfElasticEnergy_kNm
panel_9 = Panel(analyse.MaximumDisplacement_cm)
modelview = ModelViewKaramba3D(Model=analyse.AnalysedModel)  # -> Model, DeformedMesh, DeformedAxes, DeformedModel, MaximumDeformation
panel_10 = Panel(analyse.MaximumDisplacement_cm)
tag_2 = TextTag3D(Location=xz, Text=panel_9, Size=Slider(1.8, range=0..10), Justification=7)
disassemble = DisassembleModelKaramba3D(Model=modelview.Model)  # -> Model, Point, Beam, Shell, Support, Load, Line, Mesh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
beamview = BeamViewKaramba3D(Model=modelview.Model)  # -> Model, MeshesOfRenderedBeams, DeformedBeamAxes, LegendColours, LegendTags
disassemble_2 = DisassembleElementKaramba3D(Element=disassemble.Beam)  # -> Element, ElementIdentifier, AxisOfElement, CrossSection, Joint, Material, LocalCoordinateSystem, ElementIsActive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
legend = LegendKaramba3D(
    Colors=beamview.LegendColours,
    Tags=beamview.LegendTags,
    Scale=0.8,
    Textsize=30,
    Legend_HasHeader=False,
    Legend_Justification=1,
    Legend_Position=2)
shellview = ShellViewKaramba3D(Model=modelview.Model, IndexOfLayer=0)  # -> Model, MeshesOfRenderedShells, LegendColours, LegendTags
mesh = Mesh(beamview.MeshesOfRenderedBeams)
disassemble_3 = DisassembleCrossSectionKaramba3D(CroSec=disassemble_2.CrossSection)  # -> CrossSection, FamilyNameOfCrossSection, TypeNameOfCrossSection, ElemIdentifiers, Colour, Material, LocalEccentricity_cm, flatten(Heights_cm)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
multiplication = Multiplication(A=disassemble_3.Heights_cm, B=disassemble_3.MaximumWidth_cm)

line_6 = Line()
bnd_4 = Bounds(Numbers=multiplication)
dom_2 = ConstructDomain(DomainStart=Slider(0.048, range=0..1), DomainEnd=Slider(0.242, range=0..1))
dedomain_2 = DeconstructDomain(Domain=bnd_4)  # -> Start, End
midpt_2 = CurveMiddle(Curve=line_6)
remap_4 = RemapNumbers(Value=multiplication, Source=bnd_4, Target=dom_2)  # -> Mapped, Clipped
gradient_2 = Gradient(
    LowerLimit=dedomain_2.End,
    UpperLimit=dedomain_2.Start,
    Parameter=multiplication,
    stops=[0: RGB(234, 38, 0), 0.25: RGB(234, 126, 0), 0.5: RGB(254, 244, 84), 0.75: RGB(173, 203, 249), 1: RGB(75, 107, 169)])
yz_2 = YZPlane(Origin=midpt_2)
tag_3 = TextTag3D(Location=yz_2, Text=multiplication, Size=Slider(0.067, range=0..1), Justification=7)
line_prev_2 = TTLineweightPreview(Geometry=line_6, StrokeColor=gradient_2, StrokeWeight=remap_4.Mapped, Absolute=Toggle(True))

volume = Volume(Geometry=mesh)  # -> Volume, Centroid
deplane = DeconstructPlane(Plane=disassemble_2.LocalCoordinateSystem)  # -> Origin, XAxis, YAxis, ZAxis
ma = MassAddition(Input=volume.Volume)  # -> Result, PartialResults
multiplication_2 = Multiplication(A=disassemble_3.Heights_cm, _001=0.01)
panel_11 = Panel(ma.PartialResults)
cset = CreateSet(List=flatten(disassemble_3.Heights_cm))  # -> Set, Map
multiplication_3 = Multiplication(A=disassemble_3.MaximumWidth_cm, _001=0.01)
cset_2 = CreateSet(List=flatten(disassemble_3.MaximumWidth_cm))  # -> Set, Map
item_4 = ListItem(List=cset.Set, Index=0, Wrap=True)  # -> Item1, Item
beam_2 = CTBeam(centerline=disassemble_2.AxisOfElement, z_vector=deplane.ZAxis, width=multiplication_3, height=multiplication_2)  # -> Beam, Blank; inputs centerline: list, z_vector: list of Vector3d, width: list of Double, height: list of Double, category: list of String, updateRefObj: Boolean; disabled; same code as beam
item_5 = ListItem(List=beam_2.Beam, Index=0, Wrap=True)  # -> Item, Item1
mindex = MemberIndex(Set=disassemble_3.Heights_cm, Member=item_4.Item1)  # -> Index, Count
item_6 = ListItem(List=disassemble_3.MaximumWidth_cm, Index=mindex.Index, Wrap=True)
panel_12 = Panel(item_6)
panel_13 = Panel(cset.Set)
panel_14 = Panel(cset_2.Set)
model = CTModel(Elements=flatten(beam_2.Beam))  # -> Model, Geometry, DebugInfo; inputs Elements: list, Containers: list, JointRules: list, Features: list, MaxDistance: Double, CreateGeometry: Boolean; disabled
#   port Elements: Collection of Beams
#   port Containers: Container elements, such as walls, floors, roofs, etc.
#   port JointRules: Collection of joint rules.
#   port Features: Collection of feature definitions.
#   port MaxDistance: Max Distance Tolerance for topology detection.
#   port CreateGeometry: If True, Beam and joint geometry is created for visualization.
#   port Model: Model object.
#   port Geometry: Geometry of the beams and joints.
#   port DebugInfo: Debug information object in the case of feature or joining errors.
# ---------- model: Python ----------
# r: compas_timber>=1.0.2
"""Creates an Model"""

import Grasshopper
import Rhino
import System
from compas.scene import Scene
from compas.tolerance import TOL
from compas.tolerance import Tolerance

from compas_timber.design import DebugInfomation
from compas_timber.design import JointRuleSolver
from compas_timber.design import WallPopulator
from compas_timber.elements import Beam
from compas_timber.elements import Plate
from compas_timber.errors import FeatureApplicationError
from compas_timber.ghpython import error
from compas_timber.ghpython import warning
from compas_timber.model import TimberModel

# workaround for https://github.com/gramaziokohler/compas_timber/issues/280
TOL.absolute = 1e-6


class ModelComponent(Grasshopper.Kernel.GH_ScriptInstance):
    @property
    def component(self):
        return ghenv.Component  # type: ignore

    def RunScript(self,
            Elements: System.Collections.Generic.List[object],
            Containers: System.Collections.Generic.List[object],
            JointRules: System.Collections.Generic.List[object],
            Features: System.Collections.Generic.List[object],
            MaxDistance: float,
            CreateGeometry: bool):
        # this used to be default behavior in Rhino7.. I think..
        Elements = Elements or []
        Containers = Containers or []
        JointRules = JointRules or []
        Features = Features or []

        if not Elements:
            warning(self.component, "Input parameter Beams failed to collect data")
        if not JointRules:
            warning(self.component, "Input parameter JointRules failed to collect data")
        if not (Elements or Containers):  # shows beams even if no joints are found
            return
        if MaxDistance is None:
            MaxDistance = TOL.ABSOLUTE  # compared to calculted distance, so shouldn't be just 0.0

        tol = self.get_tol()
        Model = TimberModel(tolerance=tol)
        debug_info = DebugInfomation()

        ##### Adding elements #####
        self.add_elements_to_model(Model, Elements, Containers)

        ##### Wall populating #####
        handled_pairs, wall_joints = self.handle_populators(Model, Containers, MaxDistance)

        ##### Handle joinery #####
        # checks elements compatibility and generates Joints
        JointRules = [j for j in JointRules if j is not None]

        solver = JointRuleSolver(JointRules, max_distance=MaxDistance)
        joint_errors, _ = solver.apply_rules_to_model(Model)  # TODO: figure out best way to pass out unjoined_clusters

        for je in joint_errors:
            debug_info.add_joint_error(je)

        # applies extensions and features resulting from joints
        bje = Model.process_joinery()
        if bje:
            debug_info.add_joint_error(bje)

        ##### Handle user features #####
        if Features:
            feature_errors = self.handle_features(Features)
            debug_info.add_feature_error(feature_errors)

        ##### Visualization #####
        Geometry, errors = self.handle_geometry(Model, CreateGeometry)
        for geo_error in errors:
            debug_info.add_feature_error(geo_error)

        ##### Error Handling #####
        if debug_info.has_errors:
            warning(self.component, "Error found during joint creation. See DebugInfo output for details.")

        return Model, Geometry, debug_info

    def get_tol(self):
        units = Rhino.RhinoDoc.ActiveDoc.GetUnitSystemName(True, True, True, True)
        if units == "m":
            return Tolerance(unit="M", absolute=1e-6, relative=1e-6)
        elif units == "mm":
            return Tolerance(unit="MM", absolute=1e-3, relative=1e-3)
        else:
            error(self.component, f"Unsupported unit: {units}")
            return

    def add_elements_to_model(self, model, elements, containers):
        """Adds elements to the model and groups them by slab."""
        elements = [e for e in elements if e is not None]
        for element in elements:
            element.reset()
            model.add_element(element)

        containers = [c for c in containers if c is not None]

        for index, c_def in enumerate(containers):
            slab = c_def.slab
            model.add_group_element(slab, name=slab.name + str(index))

    def handle_populators(self, model, containers, max_distance):
        # Handle wall populators
        model.connect_adjacent_walls()
        config_sets = [c_def.config_set for c_def in containers]
        populators = []
        if any(config_sets):
            populators = WallPopulator.from_model(model, config_sets)

        handled_pairs = []
        wall_joints = []
        for populator, slab in zip(populators, list(model.slabs)):
            elements = populator.create_elements()
            model.add_elements(elements, parent=slab.name)
            joint_definitions = populator.create_joints(elements, max_distance)
            wall_joints.extend(joint_definitions)
            for j_def in joint_definitions:
                element_a, element_b = j_def.elements
                handled_pairs.append({element_a, element_b})

        return handled_pairs, wall_joints

    def handle_features(self, features):
        feature_errors = []
        features = [f for f in features if f is not None]
        for f_def in features:
            if not f_def.elements:
                warning(self.component, "Features defined in model must have elements defined. Features without elements will be ignored")
                continue

            for element in f_def.elements:
                try:
                    element.add_features(f_def.feature_from_element(element))
                except FeatureApplicationError as ex:
                    feature_errors.append(ex)
        return feature_errors

    def handle_geometry(self, Model, CreateGeometry):
        scene = Scene()
        errors = []
        for element in Model.elements():
            if CreateGeometry:
                scene.add(element.geometry)
                if getattr(element, "debug_info", False):
                    errors.append(element.debug_info)
            else:
                if isinstance(element, Beam):
                    scene.add(element.blank)
                elif isinstance(element, Plate):
                    scene.add(element.shape)
                else:
                    scene.add(element.geometry)
        return scene.draw(), errors
# ---------- end model ----------
panel_15 = Panel(disassemble_3.Heights_cm)

# ---- group: Output: Mesh
bakewithboxmap = CTBakeWithBoxMap(model=model.Model, map_size=panel_6, bake=Button())  # inputs map_size: list of Double, bake: Boolean
#   port model: Model object (optional).
#   port map_size: Scaling of the BoxMap in x,y,z directions (list of three positive values) (optional).
#   port bake: Set to True to Bake. Nothing happens if None or False.
# ---------- bakewithboxmap: Python ----------
# r: compas_timber>=1.0.2
# flake8: noqa
import math
import random

import Grasshopper
import System
import Rhino
import rhinoscriptsyntax as rs
from compas_rhino.conversions import frame_to_rhino
from compas_timber.ghpython import item_input_valid_cpython

from Rhino import Render
from Rhino.Geometry import Interval
from Rhino.Geometry import Plane

from Rhino.Geometry import Box, Mesh
from compas_rhino.conversions import box_to_rhino

class BakeBoxMap(Grasshopper.Kernel.GH_ScriptInstance):
    def RunScript(self,
            model,
            map_size: System.Collections.Generic.List[float],
            bake: bool):
        if map_size and len(map_size) != 3:
            ghenv.Component.AddRuntimeMessage(
                Grasshopper.Kernel.GH_RuntimeMessageLevel.Error, "Input parameter MapSize requires exactly three float values (scale factors in x,y,z directions)"
            )
            return

        unit_system = Rhino.RhinoDoc.ActiveDoc.ModelUnitSystem

        if map_size:
            dimx, dimy, dimz = map_size
        else:
            # for the pine 251 material bitmap, rotated
            if unit_system == Rhino.UnitSystem.Meters:
                dimx = 0.2
                dimy = 0.2
                dimz = 1.0
            if unit_system == Rhino.UnitSystem.Centimeters:
                dimx = 20
                dimy = 20
                dimz = 100
            if unit_system == Rhino.UnitSystem.Millimeters:
                dimx = 200
                dimy = 200
                dimz = 1000

        if not item_input_valid_cpython(ghenv, model, "Model"):
            return

        if not bake:
            return

        try:
            frames, meshes = [], []
            for beam in model.beams:
                frame = frame_to_rhino(beam.frame)
                frames.append(frame)

                box = beam.shape
                box = box_to_rhino(box)
                mesh = Mesh.CreateFromBox(box, 1, 1, 1)
                meshes.append(mesh)

            if frames and meshes:
                rs.EnableRedraw(False)

                for mesh, frame in zip(meshes, frames):
                    guid = Rhino.RhinoDoc.ActiveDoc.Objects.Add(mesh)
                    boxmap = self.create_box_map(frame, dimx, dimy, dimz)
                    Rhino.RhinoDoc.ActiveDoc.Objects.ModifyTextureMapping(guid, 1, boxmap)
        finally:
            rs.EnableRedraw(True)

    @staticmethod
    def create_box_map(pln, sx, sy, sz):
        """
        pln: frame of beam box, where x=main axis, y=width, z=height
        sx,sy,sz: box map size in x,y,z direction
        """

        v = pln.YAxis
        w = pln.ZAxis
        pt = pln.Origin

        # random deviation
        a = math.pi * 0.5
        randangle = (random.random() - 0.5) * a
        v.Rotate(randangle, pln.XAxis)

        b = math.pi * 0.01
        randangle = (random.random() - 0.5) * b
        w.Rotate(randangle, pln.XAxis)

        randpos = sx * random.random()
        pt += pln.XAxis * randpos

        # create box mapping
        mappingPln = Plane(pt, w, v)
        dx = Interval(-sx * 0.5, sx * 0.5)
        dy = Interval(-sy * 0.5, sy * 0.5)
        dz = Interval(-sz * 0.5, sz * 0.5)

        BoxMap = Render.TextureMapping.CreateBoxMapping(mappingPln, dx, dy, dz, False)

        return BoxMap
# ---------- end bakewithboxmap ----------

# ----
bakewithboxmap_2 = CTBakeWithBoxMap(model=model.Model, map_size=panel_7, bake=Button())  # inputs map_size: list of Double, bake: Boolean
#   port model: Model object (optional).
#   port map_size: Scaling of the BoxMap in x,y,z directions (list of three positive values) (optional).
#   port bake: Set to True to Bake. Nothing happens if None or False.
# ---------- bakewithboxmap_2: Python ----------
# r: compas_timber>=1.0.2
# flake8: noqa
import math
import random

import Grasshopper
import System
import Rhino
import rhinoscriptsyntax as rs
from compas_rhino.conversions import frame_to_rhino
from compas_timber.ghpython import item_input_valid_cpython

from Rhino import Render
from Rhino.Geometry import Interval
from Rhino.Geometry import Plane


class BakeBoxMap(Grasshopper.Kernel.GH_ScriptInstance):
    def RunScript(self,
            model,
            map_size: System.Collections.Generic.List[float],
            bake: bool):
        if map_size and len(map_size) != 3:
            ghenv.Component.AddRuntimeMessage(
                Grasshopper.Kernel.GH_RuntimeMessageLevel.Error, "Input parameter MapSize requires exactly three float values (scale factors in x,y,z directions)"
            )
            return

        unit_system = Rhino.RhinoDoc.ActiveDoc.ModelUnitSystem

        if map_size:
            dimx, dimy, dimz = map_size
        else:
            # for the pine 251 material bitmap, rotated
            if unit_system == Rhino.UnitSystem.Meters:
                dimx = 0.2
                dimy = 0.2
                dimz = 1.0
            if unit_system == Rhino.UnitSystem.Centimeters:
                dimx = 20
                dimy = 20
                dimz = 100
            if unit_system == Rhino.UnitSystem.Millimeters:
                dimx = 200
                dimy = 200
                dimz = 1000

        if not item_input_valid_cpython(ghenv, model, "Model"):
            return

        if not bake:
            return

        try:
            # frames = [frame_to_rhino(b.frame) for b in model.beams]
            # breps = [beam.geometry.native_brep for beam in model.beams]

            # if frames and breps:
            #     rs.EnableRedraw(False)

            #     for brep, frame in zip(breps, frames):
            #         guid = Rhino.RhinoDoc.ActiveDoc.Objects.Add(brep)
            #         boxmap = self.create_box_map(frame, dimx, dimy, dimz)
            #         Rhino.RhinoDoc.ActiveDoc.Objects.ModifyTextureMapping(guid, 1, boxmap)
            #
            from compas.datastructures import Mesh
            from compas_rhino.conversions import mesh_to_rhino
            import Rhino.Geometry as rg
            frames, meshes = [], []
            for beam in model.beams:
                frame = frame_to_rhino(beam.frame)
                frames.append(frame)
                mesh = Mesh()

                brep = beam.geometry
                ms = brep.to_meshes()
                for m in ms:
                    mesh.join(m)
                rh_mesh = mesh_to_rhino(mesh)
                rh_mesh.Vertices.CombineIdentical(True, True)
                meshes.append(rh_mesh)

            if frames and meshes:
                rs.EnableRedraw(False)

                for mesh, frame in zip(meshes, frames):
                    guid = Rhino.RhinoDoc.ActiveDoc.Objects.Add(mesh)
                    boxmap = self.create_box_map(frame, dimx, dimy, dimz)
                    Rhino.RhinoDoc.ActiveDoc.Objects.ModifyTextureMapping(guid, 1, boxmap)

                

        finally:
            rs.EnableRedraw(True)

    @staticmethod
    def create_box_map(pln, sx, sy, sz):
        """
        pln: frame of beam box, where x=main axis, y=width, z=height
        sx,sy,sz: box map size in x,y,z direction
        """

        v = pln.YAxis
        w = pln.ZAxis
        pt = pln.Origin

        # random deviation
        a = math.pi * 0.5
        randangle = (random.random() - 0.5) * a
        v.Rotate(randangle, pln.XAxis)

        b = math.pi * 0.01
        randangle = (random.random() - 0.5) * b
        w.Rotate(randangle, pln.XAxis)

        randpos = sx * random.random()
        pt += pln.XAxis * randpos

        # create box mapping
        mappingPln = Plane(pt, w, v)
        dx = Interval(-sx * 0.5, sx * 0.5)
        dy = Interval(-sy * 0.5, sy * 0.5)
        dz = Interval(-sz * 0.5, sz * 0.5)

        BoxMap = Render.TextureMapping.CreateBoxMapping(mappingPln, dx, dy, dz, False)

        return BoxMap
# ---------- end bakewithboxmap_2 ----------
bakewithboxmap_3 = CTBakeWithBoxMap(model=model.Model, map_size=panel_6, bake=Button())  # inputs map_size: list of Double, bake: Boolean
#   port model: Model object (optional).
#   port map_size: Scaling of the BoxMap in x,y,z directions (list of three positive values) (optional).
#   port bake: Set to True to Bake. Nothing happens if None or False.
# ---------- bakewithboxmap_3: Python ----------
# r: compas_timber>=1.0.2
# flake8: noqa
import math
import random

import Grasshopper
import System
import Rhino
import rhinoscriptsyntax as rs
from compas_rhino.conversions import frame_to_rhino
from compas_timber.ghpython import item_input_valid_cpython

from Rhino import Render
from Rhino.Geometry import Interval
from Rhino.Geometry import Plane


class BakeBoxMap(Grasshopper.Kernel.GH_ScriptInstance):
    def RunScript(self,
            model,
            map_size: System.Collections.Generic.List[float],
            bake: bool):
        if map_size and len(map_size) != 3:
            ghenv.Component.AddRuntimeMessage(
                Grasshopper.Kernel.GH_RuntimeMessageLevel.Error, "Input parameter MapSize requires exactly three float values (scale factors in x,y,z directions)"
            )
            return

        unit_system = Rhino.RhinoDoc.ActiveDoc.ModelUnitSystem

        if map_size:
            dimx, dimy, dimz = map_size
        else:
            # for the pine 251 material bitmap, rotated
            if unit_system == Rhino.UnitSystem.Meters:
                dimx = 0.2
                dimy = 0.2
                dimz = 1.0
            if unit_system == Rhino.UnitSystem.Centimeters:
                dimx = 20
                dimy = 20
                dimz = 100
            if unit_system == Rhino.UnitSystem.Millimeters:
                dimx = 200
                dimy = 200
                dimz = 1000

        if not item_input_valid_cpython(ghenv, model, "Model"):
            return

        if not bake:
            return

        try:
            frames = [frame_to_rhino(b.frame) for b in model.beams]
            breps = [beam.geometry.native_brep for beam in model.beams]

            if frames and breps:
                rs.EnableRedraw(False)

                for brep, frame in zip(breps, frames):
                    guid = Rhino.RhinoDoc.ActiveDoc.Objects.Add(brep)
                    boxmap = self.create_box_map(frame, dimx, dimy, dimz)
                    Rhino.RhinoDoc.ActiveDoc.Objects.ModifyTextureMapping(guid, 1, boxmap)
        finally:
            rs.EnableRedraw(True)

    @staticmethod
    def create_box_map(pln, sx, sy, sz):
        """
        pln: frame of beam box, where x=main axis, y=width, z=height
        sx,sy,sz: box map size in x,y,z direction
        """

        v = pln.YAxis
        w = pln.ZAxis
        pt = pln.Origin

        # random deviation
        a = math.pi * 0.5
        randangle = (random.random() - 0.5) * a
        v.Rotate(randangle, pln.XAxis)

        b = math.pi * 0.01
        randangle = (random.random() - 0.5) * b
        w.Rotate(randangle, pln.XAxis)

        randpos = sx * random.random()
        pt += pln.XAxis * randpos

        # create box mapping
        mappingPln = Plane(pt, w, v)
        dx = Interval(-sx * 0.5, sx * 0.5)
        dy = Interval(-sy * 0.5, sy * 0.5)
        dz = Interval(-sz * 0.5, sz * 0.5)

        BoxMap = Render.TextureMapping.CreateBoxMapping(mappingPln, dx, dy, dz, False)

        return BoxMap
# ---------- end bakewithboxmap_3 ----------
