# Grasshopper definition Tree_generator_v2.gh (Grasshopper 1.0.8)

range = Range(Domain=Domain(0, 1), Steps="4")
range_2 = Range(Domain=Domain(0, 1), Steps="4")
graph = GraphMapper(range_2, x0=0, x1=1, y0=0, y1=1, container_name="Bezier", cpx=[0, 0.3527153432, 1, 1], cpy=[0, 0, 0.533995688, 1])
graph_2 = GraphMapper(range, x0=0, x1=1, y0=0, y1=1, container_name="Bezier", cpx=[0, 0.3447926939, 1, 1], cpy=[0, 0, 0.6926424503, 1])
bnd = Bounds(Numbers=graph_2)
bnd_2 = Bounds(Numbers=graph)
pt = Point([Point(173.1600008, 48.10000076, 20.1), Point(173.1600008, 57.72000076, 20.1)])
rec = Rectangle({Plane=PlaneXY(173.1600008, 52.91000076, 24.8), Size=Domain2(u=-4.81..4.81, v=-14.43..14.43)})
pt_2 = Point([Point(163.5400008, 48.10000076, 16.1), Point(163.5400008, 57.72000076, 16.1)])
rec_2 = Rectangle({Plane=PlaneXY(163.5400008, 52.91000076, 24.8), Size=Domain2(u=-4.81..4.81, v=-14.43..14.43)})
remap = RemapNumbers(Value=graph_2, Source=bnd, Target="8.7")  # -> Mapped, Clipped
remap_2 = RemapNumbers(Value=graph, Source=bnd_2, Target="4.7")  # -> Mapped, Clipped
panel = Panel(remap_2.Mapped)
panel_2 = Panel(remap.Mapped)
py3 = Python3Script(boundary=rec_2, div_x="4", div_y="6", height="8.7", height_list=remap.Mapped)  # -> out, v_list_out, vertices_out, beams_out, lines_out, new_lines; inputs anchors: list of Point3d, boundary: Polyline, div_x: Int32, div_y: Int32, height: Double, height_list: list of Double
# ---------- py3: Python ----------
#locate class file in the same folder
from compas_rhino import unload_modules
import sys
import os

#get current file path
path = ghenv.Component.OnPingDocument().FilePath
#get parent directory of the parent directory
parentdir = os.path.dirname(path)
#get src folder which contains classes
dire = os.path.join(parentdir,'scripts')
sys.path.append(dire)

unload_modules('Line_model_v2')


##########------------Imports------------###########
from Line_model_v2 import Beam, VertexList
from compas.geometry import Vector, Point, Line

from compas_rhino.conversions import point_to_compas, point_to_rhino
from compas_rhino.conversions import line_to_rhino
from compas_rhino.conversions import polygon_to_compas

from Grasshopper import DataTree
from Grasshopper.Kernel.Data import GH_Path

#######------Conversions-------########
# anchors = [point_to_compas(a) for a in anchors]
boundary = polygon_to_compas(boundary)


#########------Main Code------###############
# 1. Create generator
v_list = VertexList()
v_list.compute_diagrid(
    boundary=boundary,
    division_x=div_x,
    division_y=div_y,
    height=height,
    height_list=height_list
)
# print (v_list.pairs)
print (len(v_list))


# 2. Skip certain vertices
skip_list = 83   # or [83]
v_list.skip(skip_list)

# 3. Move certain vertices
move_list = [61, 66, 71] + [75, 76, 80, 79]
move_val_z = [0.8] * 3 + [1.2] * 4
move_vecs = [Vector(0, 0, val_z) for val_z in move_val_z]
v_list.move(move_list, move_vecs)

# 4. Add new vertices and pairs
new_start = [29, 54, 70, 79]
new_end = [53, 69, 78, 82]
new_pts = []
for s, e in zip(new_start, new_end):
    new_pt = Beam(s, e, v_list).mid
    new_pts.append(new_pt)

new_pairs = []
for i in range(len(new_start) - 1):
    pair = (len(v_list) + i, len(v_list) + (i + 1))
    new_pairs.append(pair)

v_list.add_vertices(new_pts)
v_list.add_pairs(new_pairs)

# 5. Construct beams
beams = []
lines = []
for pair in v_list.pairs:
    beam = Beam(pair[0], pair[1], v_list)
    beams.append(beam)
    lines.append(beam.axis)


#########----------Output data----------##############
v_list_out = v_list
beams_out = beams
vertices_out = list(v_list)
lines_out = lines

new_lines = []
for pair in new_pairs:
    ln = Beam(pair[0], pair[1], v_list).axis
    new_lines.append(ln)
# ---------- end py3 ----------
py3_2 = Python3Script(boundary=rec, div_x="4", div_y="6", height="4.7", height_list=remap_2.Mapped)  # -> out, v_list_out, vertices_out, beams_out, lines_out; inputs anchors: list of Point3d, boundary: Polyline, div_x: Int32, div_y: Int32, height: Double, height_list: list of Double
# ---------- py3_2: Python ----------
#locate class file in the same folder
from compas_rhino import unload_modules
import sys
import os

#get current file path
path = ghenv.Component.OnPingDocument().FilePath
#get parent directory of the parent directory
parentdir = os.path.dirname(path)
#get src folder which contains classes
dire = os.path.join(parentdir,'scripts')
sys.path.append(dire)

unload_modules('Line_model_v2')


##########------------Imports------------###########
from Line_model_v2 import Beam, VertexList
from compas.geometry import Box, Frame, Vector

from compas_rhino.conversions import point_to_compas, point_to_rhino
from compas_rhino.conversions import line_to_rhino
from compas_rhino.conversions import polygon_to_compas

from Grasshopper import DataTree
from Grasshopper.Kernel.Data import GH_Path

#######------Conversions-------########
# anchors = [point_to_compas(a) for a in anchors]
boundary = polygon_to_compas(boundary)


#########------Main Code------###############
v_list = VertexList()
v_list.compute_diagrid(
    boundary=boundary,
    division_x=div_x,
    division_y=div_y,
    height=height,
    height_list=height_list
)
# print (v_list.pairs)
print (len(v_list))

# Move certain vertices
move_list = [61, 66, 71] + [75, 76, 80, 79]
move_val_z = [0.8] * 3 + [1.2] * 4
move_vecs = [Vector(0, 0, val_z) for val_z in move_val_z]
v_list.move(move_list, move_vecs)


# Skip vertices
skip_list = 83   # or [83]
v_list.skip(skip_list)

# Construct beams
beams = []
lines = []
for pair in v_list.pairs:
    beam = Beam(pair[0], pair[1], v_list)
    beams.append(beam)
    lines.append(beam.axis)


# Output data
v_list_out = v_list
beams_out = beams
vertices_out = list(v_list)
lines_out = lines
# ---------- end py3_2 ----------
draw = COMPASDraw(cg=py3_2.vertices_out)  # -> rg
#   port cg: The COMPAS geometry or datastructure to be drawn.
#   port rg: The Rhino geometry object.
# ---------- draw: Python ----------
# r: compas>=2.14.1
"""
Draws COMPAS geometry in Grasshopper.
"""

from typing import Any

import Grasshopper

from compas.scene import SceneObject


class CompasToRhinoGeometry(Grasshopper.Kernel.GH_ScriptInstance):
    def RunScript(self, cg):
        if not cg:
            return None

        return SceneObject(item=cg).draw()
# ---------- end draw ----------
draw_2 = COMPASDraw(cg=py3_2.lines_out)  # -> rg; same code as draw
draw_3 = COMPASDraw(cg=py3.vertices_out)  # -> rg; same code as draw
draw_4 = COMPASDraw(cg=py3.lines_out)  # -> rg; same code as draw
draw_5 = COMPASDraw(cg=py3.new_lines)  # -> rg; same code as draw
points = PointList(Points=draw, Size=Slider(0.41, range=0..1))
points_2 = PointList(Points=draw_3, Size=Slider(0.41, range=0..1))
merge = Merge(Data1=draw_4, Data2=draw_2)
line = Line(merge)
crv = Curve([<curve referenced from the Rhino model> x2])  # disabled
crv_2 = Curve([<curve referenced from the Rhino model> x196])  # disabled
explode = Explode(Curve=crv, Recursive=True)  # -> Segments, Vertices; disabled
python_3_script = Python3Script(all_lines=line, save=Button())  # inputs all_lines: list
# ---------- python_3_script: Python ----------
import os
import json

target_folder = r"C:\Users\Juste\Documents\_GitHub\MAS-2526\llhil-t2-fabrication\design\structure_model\data\Exchange Files\Files_In\_working"
json_path = os.path.join(target_folder, "out_lines.json")
os.makedirs(target_folder, exist_ok=True)

def serialize_compas(obj):
    # Preferred: COMPAS data protocol
    if hasattr(obj, "__jsondump__"):
        try:
            return obj.__jsondump__()
        except Exception:
            pass

    # Fallback: generic Data-like object
    if hasattr(obj, "to_data"):
        try:
            return {
                "dtype": obj.__class__.__module__ + "/" + obj.__class__.__name__,
                "data": obj.to_data()
            }
        except Exception:
            pass

    # Last resort
    return str(obj)

data = []
for line in all_lines:
    data.append({
        "line": serialize_compas(line),
        "type": getattr(line, "name", None)
    })

if save:
    with open(json_path, "w", encoding="utf-8") as f:
        json.dump(data, f, indent=2)
# ---------- end python_3_script ----------
entwine = Entwine(Branch00=crv_2, FlattenInputs=True)  # disabled
panel_3 = Panel("0.12")  # disabled
panel_4 = Panel("0.16")  # disabled
beam = CTBeam(centerline=entwine, width=panel_3, height=panel_4)  # -> Beam, Blank; inputs centerline: list, z_vector: list of Vector3d, width: list of Double, height: list of Double, category: list of String, updateRefObj: Boolean; disabled
#   port centerline: Referenced curve or line, Guid of curve or line in the active Rhino document.
#   port z_vector: Vector defining the orientation of the cross-section (corresponds to the height dimension). If None, a default will be taken.
#   port width: Width of the cross-section (usually the smaller dimension).
#   port height: Height of the cross-section (usually the larger dimension).
#   port category: Category of a beam.
#   port updateRefObj: (optional) If True, the attributes in the referenced object will be updated/overwritten with the new values given here.
#   port Beam: Beam object(s).
#   port Blank: Shape of the beam's blank.
# ---------- beam: Python ----------
# r: compas_timber>=1.0.2
"""Creates a Beam from a LineCurve."""

# flake8: noqa
import Grasshopper
import Rhino
import rhinoscriptsyntax as rs
import System
from compas.scene import Scene
from compas_rhino.conversions import line_to_compas
from compas_rhino.conversions import vector_to_compas

from compas_timber.elements import Beam as CTBeam
from compas_timber.ghpython.rhino_object_name_attributes import update_rhobj_attributes_name
from compas_timber.ghpython.ghcomponent_helpers import list_input_valid_cpython


class Beam_fromCurve(Grasshopper.Kernel.GH_ScriptInstance):
    def RunScript(self,
            centerline: System.Collections.Generic.List[object],
            z_vector: System.Collections.Generic.List[Rhino.Geometry.Vector3d],
            width: System.Collections.Generic.List[float],
            height: System.Collections.Generic.List[float],
            category: System.Collections.Generic.List[str],
            updateRefObj: bool):
        # minimum inputs required
        if not list_input_valid_cpython(ghenv, centerline, "Centerline"):
            return
        if not width:
            length = self._get_centerline_length(centerline)
            width = [length / 20]
        if not height:
            length = self._get_centerline_length(centerline)
            height = [length / 10]

        # reformat unset parameters for consistency
        if not z_vector:
            z_vector = [None]
        if not category:
            category = [None]

        beams = []
        blanks = []
        scene = Scene()

        if centerline and height and width:
            # check list lengths for consistency
            N = len(centerline)
            if len(z_vector) not in (0, 1, N):
                ghenv.Component.AddRuntimeMessage(
                    Grasshopper.Kernel.GH_RuntimeMessageLevel.Error, " In 'ZVector' I need either none, one or the same number of inputs as the Crv parameter."
                )
            if len(width) not in (1, N):
                ghenv.Component.AddRuntimeMessage(Grasshopper.Kernel.GH_RuntimeMessageLevel.Error, " In 'W' I need either one or the same number of inputs as the Crv parameter.")
            if len(height) not in (1, N):
                ghenv.Component.AddRuntimeMessage(Grasshopper.Kernel.GH_RuntimeMessageLevel.Error, " In 'H' I need either one or the same number of inputs as the Crv parameter.")
            if len(category) not in (0, 1, N):
                ghenv.Component.AddRuntimeMessage(
                    Grasshopper.Kernel.GH_RuntimeMessageLevel.Error, " In 'Category' I need either none, one or the same number of inputs as the Crv parameter."
                )

            # duplicate data if None or single value
            if len(z_vector) != N:
                z_vector = [z_vector[0] for _ in range(N)]
            if len(width) != N:
                width = [width[0] for _ in range(N)]
            if len(height) != N:
                height = [height[0] for _ in range(N)]
            if len(category) != N:
                category = [category[0] for _ in range(N)]

            for line, z, w, h, c in zip(centerline, z_vector, width, height, category):
                guid, geometry = self._get_guid_and_geometry(line)
                rhino_line = rs.coerceline(geometry)
                line = line_to_compas(rhino_line)

                z = vector_to_compas(z) if z else None
                beam = CTBeam.from_centerline(centerline=line, width=w, height=h, z_vector=z)
                beam.attributes["rhino_guid"] = str(guid) if guid else None
                beam.attributes["category"] = c
                if updateRefObj and guid:
                    update_rhobj_attributes_name(guid, "width", str(w))
                    update_rhobj_attributes_name(guid, "height", str(h))
                    update_rhobj_attributes_name(guid, "zvector", str(list(beam.frame.zaxis)))
                    update_rhobj_attributes_name(guid, "category", c)

                beams.append(beam)
                scene.add(beam.blank)

        blanks = scene.draw()

        return beams, blanks

    def _get_guid_and_geometry(self, line):
        # internalized curves and GH geometry will not have persistent GUIDs, referenced Rhino objects will
        # type hint on the input has to be 'ghdoc' for this to work
        guid = None
        geometry = line
        rhino_obj = Rhino.RhinoDoc.ActiveDoc.Objects.FindId(line)
        if rhino_obj:
            guid = line
            geometry = rhino_obj.Geometry
        return guid, geometry

    def _get_centerline_length(self, centerline):
        centerline_length = []
        for i in centerline:
            centerline_length.append(rs.CurveLength(i))
        if centerline_length:
            length_average = sum(centerline_length) / len(centerline_length)
        else:
            length_average = 1
        return length_average
# ---------- end beam ----------
swatch = ColourSwatch(SwatchColor=RGB(74, 145, 57))  # disabled
swatch_2 = ColourSwatch(SwatchColor=RGB(145, 132, 57))  # disabled
swatch_3 = ColourSwatch(SwatchColor=RGB(255, 255, 255))  # disabled
wires = BrepWireframe(Brep=beam.Blank, Density=-1)  # disabled
preview = CustomPreview(Geometry=beam.Blank, Material=graft([swatch, swatch_2]))  # disabled
preview_2 = CustomPreview(Geometry=wires, Material=swatch_3)  # disabled
