# Grasshopper definition Tree_generator_v4.1.gh (Grasshopper 1.0.8)
# plug-ins: Karamba3D, CORE.Toolbox.Grasshopper, MeshEdit Components

number_slider = Slider(0.562, range=0.001..1)
number_slider_2 = Slider(1.816, range=1.001..3)
number_slider_3 = Slider(3.915, range=3.001..5)

number_slider_4 = Slider(0.281, range=0.001..0.7)
number_slider_5 = Slider(0.807, range=0.701..1.5)
number_slider_6 = Slider(2.178, range=1.501..3)

range = Range(Domain=Domain(0, 1), Steps="4")  # disabled
graph_mapper = GraphMapper(range, x0=0, x1=1, y0=0, y1=1, container_name="Bezier", cpx=[0, 0.3447926939, 1, 1], cpy=[0, 0, 0.4894599319, 1])  # disabled
bounds = Bounds(Numbers=graph_mapper)  # disabled
remap_numbers = RemapNumbers(Value=graph_mapper, Source=bounds, Target="8.7")  # -> Mapped, Clipped; disabled
panel = Panel(remap_numbers.Mapped)  # disabled

galapagos = Galapagos(
    fitness=analyse,
    gene=[number_slider, number_slider_2, number_slider_3, number_slider_4, number_slider_5, number_slider_6])
merge = Merge(Data1="0", Data2=number_slider, Data3=number_slider_2, Data4=number_slider_3, Data5="8.7")
merge_2 = Merge(Data1="0", Data2=number_slider_4, Data3=number_slider_5, Data4=number_slider_6, Data5="4.7")
quick_graph = QuickGraph(merge, SortOrder=0)
quick_graph_2 = QuickGraph(merge_2, SortOrder=0)
number_slider_7 = Slider(0, range=0..2)
rectangle = Rectangle({Plane=PlaneXY(163.5400008, 52.91000076, 24.8), Size=Domain2(u=-4.81..4.81, v=-14.43..14.43)})
curve = Curve([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])
rectangle_2 = Rectangle({Plane=PlaneXY(173.1600008, 52.91000076, 24.8), Size=Domain2(u=-4.81..4.81, v=-14.43..14.43)})
curve_2 = Curve([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])
python_3_script = Python3Script(boundary=rectangle, div_x="4", div_y="6", height="8.7", height_list=merge, selections=curve, amp=number_slider_7)  # -> out, v_list_out, vertices_out, beams_out, lines_out, intersections, pln, aa, pts_group; inputs anchors: list of Point3d, boundary: Polyline, div_x: Int32, div_y: Int32, height: Double, height_list: list of Double, selections: list of Polyline, amp: Double
# ---------- python_3_script: Python ----------
#locate class file in the same folder
from compas_rhino import unload_modules
import sys
import os

#get current file path
path = ghenv.Component.OnPingDocument().FilePath
#get parent directory of the parent directory
parentdir = os.path.dirname(path)
#get src folder which contains classes
dire = os.path.join(parentdir,'scripts')
sys.path.append(dire)

unload_modules('Line_model_v2')


##########------------Imports------------###########
from Line_model_v2 import Beam, VertexList
from compas.geometry import Vector, Point, Line, Plane, Frame

from compas_rhino.conversions import point_to_compas, point_to_rhino
from compas_rhino.conversions import line_to_rhino
from compas_rhino.conversions import polygon_to_compas
from compas_rhino.conversions import plane_to_rhino
import math

from Grasshopper import DataTree
from Grasshopper.Kernel.Data import GH_Path

#######------Conversions-------########
# anchors = [point_to_compas(a) for a in anchors]
boundary = polygon_to_compas(boundary)


#########------Main Code------###############
# 1. Create generator
v_list = VertexList()
v_list.compute_diagrid(
    boundary=boundary,
    division_x=div_x,
    division_y=div_y,
    height=height,
    height_list=height_list
)
# print (v_list.pairs)
# print (len(v_list))


# 2. Skip certain vertices
skip_list = 83   # or [83]
v_list.skip(skip_list)


# 3. Move certain vertices
from compas.geometry import is_point_in_convex_polygon_xy
from compas_rhino.conversions import polyline_to_compas
from compas_rhino.conversions import polygon_to_rhino
from compas.geometry import Polygon

def remap_number(value, from_min, from_max, to_min=0, to_max=1):
    return to_min + (to_max - to_min) * ((value - from_min) / (from_max - from_min))


polylines = [polyline_to_compas(p) for p in selections]
polygons = [Polygon(list(p)) for p in polylines]
"""
move_indices_L = []
for poly in polygons[:2]:
    for i, p in enumerate(v_list):
        inside = is_point_in_convex_polygon_xy(p, poly)
        if inside:
            move_indices_L.append(i)

move_indices_R = []
for poly in polygons[2:4]:
    for i, p in enumerate(v_list):
        inside = is_point_in_convex_polygon_xy(p, poly)
        if inside:
            move_indices_R.append(i)

to_pln = Plane(v_list[20], Vector(1,0,0))
max_dist = v_list[6].distance_to_plane(to_pln)
vec_list_L = []
for iL in move_indices_L:
    p = v_list[iL]
    dist = p.distance_to_plane(to_pln)
    new_amp = remap_number(amp, 0, max_dist, 0, dist)
    vec_list_L.append(Vector(new_amp, 0, 0))

vec_list_R = []
for iR in move_indices_R:
    p = v_list[iR]
    dist = p.distance_to_plane(to_pln)
    new_amp = remap_number(amp, 0, max_dist, 0, dist)
    vec_list_R.append(Vector(-new_amp, 0, 0))


v_list.move(move_indices_L, vec_list_L)
# v_list.move(move_indices_R, vec_list_R)
aa = [v_list[i] for i in move_indices_L + move_indices_R]
"""

# 3-2. Shorten cantilever
move_indices_T = []
for i, p in enumerate(v_list):
    inside = is_point_in_convex_polygon_xy(p, polygons[4])
    if inside:
        move_indices_T.append(i)

move_indices_B = []
for i, p in enumerate(v_list):
    inside = is_point_in_convex_polygon_xy(p, polygons[5])
    if inside:
        move_indices_B.append(i)

to_pln = Plane(v_list[4], Vector(0,1,0))
max_dist = v_list[6].distance_to_plane(to_pln)
vec_list_T = []
for iT in move_indices_T:
    p = v_list[iT]
    dist = p.distance_to_plane(to_pln)
    new_amp = remap_number(amp, 0, max_dist, 0, dist)
    vec_list_T.append(Vector(0, new_amp, 0))

to_pln = Plane(v_list[2], Vector(0,1,0))
max_dist = v_list[0].distance_to_plane(to_pln)
vec_list_B = []
for iB in move_indices_B:
    p = v_list[iB]
    dist = p.distance_to_plane(to_pln)
    new_amp = remap_number(amp, 0, max_dist, 0, dist)
    vec_list_B.append(Vector(0, -new_amp, 0))

v_list.move(move_indices_T, vec_list_T)
v_list.move(move_indices_B, vec_list_B)



# 4. Group vertices
groups = v_list.group_by_diamond()
pts_group = DataTree[object]()

for i, (root, branches) in enumerate(groups.items()):
    midpts = [v_list[root] + (v_list[b] - v_list[root]) / 2 for b in branches]
    pts_group.AddRange(midpts, GH_Path(i))
    

# Add new vertices and pairs
# pairs_for_mid = [(41, 47), (74, 78), (46, 52), (77, 81)]

# mid_pts = []
# for a, b in pairs_for_mid:
#     mid = v_list[a] + (v_list[b] - v_list[a]) / 2
#     mid_pts.append(mid)

# v_list.add_vertices(mid_pts)

# v_list.add_pairs([(85, 14), (85, 15), (85, 64)])
# v_list.add_pairs([(86, 64), (86, 65), (86, 82)])
# v_list.add_pairs([(87, 19), (87, 20), (87, 68)])
# v_list.add_pairs([(88, 67), (88, 68), (88, 84)])

# 5. Construct beams
beams = []
lines = []
for pair in v_list.pairs:
    beam = Beam(pair[0], pair[1], v_list)
    beams.append(beam)
    lines.append(beam.axis)


# . Add new vertices and pairs
from compas.geometry import intersection_segment_plane
origin = Beam(53, 29, v_list).mid
frame = Frame(origin, v_list.dir2)
pln = Plane(origin, frame.yaxis)
intersections = []
for ln in lines:
    pt = intersection_segment_plane(ln, pln)
    if pt is None:
        continue
    pt = Point(pt[0], pt[1], pt[2])
    intersections.append(pt)
pln = plane_to_rhino(pln)

#########----------Output data----------##############
v_list_out = v_list
beams_out = beams
vertices_out = list(v_list)
lines_out = lines
# ---------- end python_3_script ----------
python_3_script_2 = Python3Script(boundary=rectangle_2, div_x="4", div_y="6", height="4.7", height_list=merge_2, selections=curve_2, amp=number_slider_7)  # -> out, v_list_out, vertices_out, beams_out, lines_out; inputs anchors: list of Point3d, boundary: Polyline, div_x: Int32, div_y: Int32, height: Double, height_list: list of Double, selections: list of Polyline, amp: Double
# ---------- python_3_script_2: Python ----------
#locate class file in the same folder
from compas_rhino import unload_modules
import sys
import os

#get current file path
path = ghenv.Component.OnPingDocument().FilePath
#get parent directory of the parent directory
parentdir = os.path.dirname(path)
#get src folder which contains classes
dire = os.path.join(parentdir,'scripts')
sys.path.append(dire)

unload_modules('Line_model_v2')


##########------------Imports------------###########
from Line_model_v2 import Beam, VertexList
from compas.geometry import Box, Frame, Vector, Plane

from compas_rhino.conversions import point_to_compas, point_to_rhino
from compas_rhino.conversions import line_to_rhino
from compas_rhino.conversions import polygon_to_compas

from Grasshopper import DataTree
from Grasshopper.Kernel.Data import GH_Path

#######------Conversions-------########
# anchors = [point_to_compas(a) for a in anchors]
boundary = polygon_to_compas(boundary)


#########------Main Code------###############
v_list = VertexList()
v_list.compute_diagrid(
    boundary=boundary,
    division_x=div_x,
    division_y=div_y,
    height=height,
    height_list=height_list
)
# print (v_list.pairs)
print (len(v_list))

# 3. Move certain vertices
from compas.geometry import is_point_in_convex_polygon_xy
from compas_rhino.conversions import polyline_to_compas
from compas_rhino.conversions import polygon_to_rhino
from compas.geometry import Polygon

def remap_number(value, from_min, from_max, to_min=0, to_max=1):
    return to_min + (to_max - to_min) * ((value - from_min) / (from_max - from_min))


polylines = [polyline_to_compas(p) for p in selections]
polygons = [Polygon(list(p)) for p in polylines]

# move_indices_L = []
# for poly in polygons[:2]:
#     for i, p in enumerate(v_list):
#         inside = is_point_in_convex_polygon_xy(p, poly)
#         if inside:
#             move_indices_L.append(i)

# move_indices_R = []
# for poly in polygons[2:]:
#     for i, p in enumerate(v_list):
#         inside = is_point_in_convex_polygon_xy(p, poly)
#         if inside:
#             move_indices_R.append(i)

# to_pln = Plane(v_list[20], Vector(1,0,0))
# max_dist = v_list[6].distance_to_plane(to_pln)
# vec_list_L = []
# for iL in move_indices_L:
#     p = v_list[iL]
#     dist = p.distance_to_plane(to_pln)
#     new_amp = remap_number(amp, 0, max_dist, 0, dist)
#     vec_list_L.append(Vector(new_amp, 0, 0))

# vec_list_R = []
# for iR in move_indices_R:
#     p = v_list[iR]
#     dist = p.distance_to_plane(to_pln)
#     new_amp = remap_number(amp, 0, max_dist, 0, dist)
#     vec_list_R.append(Vector(-new_amp, 0, 0))

# 3-2. Shorten cantilever
move_indices_T = []
for i, p in enumerate(v_list):
    inside = is_point_in_convex_polygon_xy(p, polygons[4])
    if inside:
        move_indices_T.append(i)

move_indices_B = []
for i, p in enumerate(v_list):
    inside = is_point_in_convex_polygon_xy(p, polygons[5])
    if inside:
        move_indices_B.append(i)

to_pln = Plane(v_list[4], Vector(0,1,0))
max_dist = v_list[6].distance_to_plane(to_pln)
vec_list_T = []
for iT in move_indices_T:
    p = v_list[iT]
    dist = p.distance_to_plane(to_pln)
    new_amp = remap_number(amp, 0, max_dist, 0, dist)
    vec_list_T.append(Vector(0, new_amp, 0))

to_pln = Plane(v_list[2], Vector(0,1,0))
max_dist = v_list[0].distance_to_plane(to_pln)
vec_list_B = []
for iB in move_indices_B:
    p = v_list[iB]
    dist = p.distance_to_plane(to_pln)
    new_amp = remap_number(amp, 0, max_dist, 0, dist)
    vec_list_B.append(Vector(0, -new_amp, 0))

v_list.move(move_indices_T, vec_list_T)
v_list.move(move_indices_B, vec_list_B)


# Skip vertices
skip_list = 83   # or [83]
v_list.skip(skip_list)

# 4. Add new vertices and pairs
# pairs_for_mid = [(41, 47), (74, 78), (46, 52), (77, 81)]

# mid_pts = []
# for a, b in pairs_for_mid:
#     mid = v_list[a] + (v_list[b] - v_list[a]) / 2
#     mid_pts.append(mid)

# v_list.add_vertices(mid_pts)

# v_list.add_pairs([(85, 14),(85,15),(85,64)])
# v_list.add_pairs([(86, 64),(86,65),(86,82)])
# v_list.add_pairs([(87, 19),(87,20),(87,68)])
# v_list.add_pairs([(88, 67),(88,68),(88,84)])

# Construct beams
beams = []
lines = []
for pair in v_list.pairs:
    beam = Beam(pair[0], pair[1], v_list)
    beams.append(beam)
    lines.append(beam.axis)


# Output data
v_list_out = v_list
beams_out = beams
vertices_out = list(v_list)
lines_out = lines
# ---------- end python_3_script_2 ----------
draw = COMPASDraw(cg=python_3_script.vertices_out)  # -> rg
#   port cg: The COMPAS geometry or datastructure to be drawn.
#   port rg: The Rhino geometry object.
# ---------- draw: Python ----------
# r: compas>=2.14.1
"""
Draws COMPAS geometry in Grasshopper.
"""

from typing import Any

import Grasshopper

from compas.scene import SceneObject


class CompasToRhinoGeometry(Grasshopper.Kernel.GH_ScriptInstance):
    def RunScript(self, cg):
        if not cg:
            return None

        return SceneObject(item=cg).draw()
# ---------- end draw ----------
draw_2 = COMPASDraw(cg=python_3_script.lines_out)  # -> rg; same code as draw
draw_3 = COMPASDraw(cg=python_3_script.intersections)  # -> rg; same code as draw
draw_4 = COMPASDraw(cg=python_3_script.aa)  # -> rg; same code as draw
draw_5 = COMPASDraw(cg=python_3_script.pts_group)  # -> rg; same code as draw
draw_6 = COMPASDraw(cg=python_3_script_2.vertices_out)  # -> rg; same code as draw
draw_7 = COMPASDraw(cg=python_3_script_2.lines_out)  # -> rg; same code as draw
plane = Plane(python_3_script.pln)
polyline = PolyLine(Vertices=draw_5, Closed=invert(False))
number_slider_8 = Slider(0.41, range=0..1)
point_list = PointList(Points=draw, Size=number_slider_8)
point_list_2 = PointList(Points=draw_6, Size=number_slider_8)
merge_3 = Merge(Data1=draw_2, Data2=draw_7)
merge_4 = Merge(Data1=draw, Data2=draw_6)
point = Point(merge_4)

# ---- group: without orthogonal
line = Line(merge_3)

# ---- group: addition elements / v6
curve_3 = Curve([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])

# ---- group: addition elements / v6_2
curve_4 = Curve([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])

# ---- group: addition elements / v7
curve_5 = Curve([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])

# ----
# * 20. 03. 2026
merge_5 = Merge(Data1=line, Data2=curve_5)

# ----
# * 23. 03. 2026
# facade load
# + snow/rain load
panel_2 = Panel("2.458")
panel_3 = Panel("2.906")
panel_4 = Panel("3.002")
panel_5 = Panel("3.202")
panel_6 = Panel("2.987")
panel_7 = Panel("2.988")
panel_8 = Panel("3.351")
panel_9 = Panel("2.965")
panel_10 = Panel("2.897")
panel_11 = Panel("3.127")
panel_12 = Panel("2.931")

# ---- group: v5 (5 legs)
crv = Curve([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])

# ---- group: V0 (Original)
crv_2 = Curve([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])

# ---- group: V0 (Original + Ortho)
crv_3 = Curve([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])

# ---- group: V3 (4 legs)
crv_4 = Curve([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])

# ---- group: V3-2 (6 legs)
crv_5 = Curve([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])

# ---- group: v4 (6 legs)
crv_6 = Curve([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])

# ---- group: v6 (ortho+ additional)
crv_7 = Curve([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])

# ---- group: v6-2 (ortho+ additional)
crv_8 = Curve([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])

# ---- group: v7 (ortho+ additional)
crv_9 = Curve([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])

# ---- group: v1 (offset from edges)
crv_10 = Curve([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])

# ---- group: v2 (changed grid line)
crv_11 = Curve([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])

# ---- group: facade beam
crv_12 = Curve([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])

# ----
panel_14 = Panel("2.957")
panel_15 = Panel("2.9936")
panel_16 = Panel("2.964")
panel_17 = Panel("3.066")

# ---- group: V4_00
crv_13 = Curve([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])

# ---- group: v4_01
crv_14 = Curve([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])

# ---- group: v4_02
crv_15 = Curve([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])

# ---- group: v4_03
crv_16 = Curve([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])

# ---- group: v4_04
crv_17 = Curve([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])

# ----
explode = Explode(Curve=crv_17, Recursive=True)  # -> flatten(Segments), flatten(Vertices)
llinter = LineLineIntersectionKaramba3D(IntersectingLines=explode.Segments, LinesToIntersect=explode.Segments, LimitDistance_m=0.005)  # -> flatten(InterSecPoints), flatten(LineSubSegments)
rdpoints = RemoveDuplicatePointsKaramba3D(Point=llinter.InterSecPoints, LimitDistance=0.005)  # -> OutPoint, Info, Indexes
rdlines = RemoveDuplicateLinesKaramba3D(Line=llinter.LineSubSegments, LimitDistance=0.005)  # -> OutLine, Info, Indexes
line_2 = Line(rdlines.OutLine)
point_2 = Point(rdpoints.OutPoint)

# ---- group: Facade
rectangle_3 = Rectangle({Plane=PlaneXY(168.3500008, 52.91000076, 24.8), Size=Domain2(u=-9.62..9.62, v=-14.43..14.43)})
point_3 = Point(point_2)
explode_2 = Explode(Curve=rectangle_3, Recursive=True)  # -> Segments, Vertices
deconstruct = Deconstruct(Point=point_3)  # -> XComponent, YComponent, ZComponent
list_item = ListItem(List=explode_2.Segments, Index=0, Wrap=True)  # -> Item, Item1, Item2
sort_list = SortList(Keys=deconstruct.ZComponent, ValuesValuesA=point_3)  # -> reverse(Keys), reverse(ValuesValuesA)
curve_6 = Curve([list_item.Item, list_item.Item2])
list_item_2 = ListItem(List=sort_list.Keys, Index=0, Wrap=True)
divide_curve = DivideCurve(Curve=curve_6, Count="8", Kinks=False)  # -> Points, Tangents, Parameters
similarity = Similarity(FirstNumber=sort_list.Keys, SecondNumber=list_item_2, Threshold=0.1)  # -> Similarity, AbsoluteDifference
cull_pattern = CullPattern(List=sort_list.ValuesValuesA, CullPattern=similarity.Similarity)
deconstruct_2 = Deconstruct(Point=cull_pattern)  # -> XComponent, YComponent, ZComponent
sort_list_2 = SortList(Keys=deconstruct_2.YComponent)  # -> Keys, ValuesValuesA
list_item_3 = ListItem(List=sort_list_2.Keys, Index=0, Wrap=True)  # -> Item1, Item
member_index = MemberIndex(Set=deconstruct_2.YComponent, Member=list_item_3.Item)  # -> Index, Count
member_index_2 = MemberIndex(Set=deconstruct_2.YComponent, Member=list_item_3.Item1)  # -> Index, Count
list_item_4 = ListItem(List=cull_pattern, Index=member_index_2.Index, Wrap=True)
list_item_5 = ListItem(List=cull_pattern, Index=member_index.Index, Wrap=True)
point_4 = Point([list_item_5, list_item_4])

# ----
merge_6 = Merge(Data1=divide_curve.Points, Data2=cull_pattern)  # -> flatten(Result)

# ----
# C. Set Support
number_slider_9 = Slider(0.54, range=0..1)
point_5 = Point([Point(163.5400008, 48.10000076, 16.1), Point(163.5400008, 57.72000076, 16.1), Point(173.1600008, 48.10000076, 20.1), Point(173.1600008, 57.72000076, 20.1)])
sphere = Sphere(Base=point_5, Radius=number_slider_9)
point_in_breps = PointInBreps(Brep=sphere, Point=point_2, Strict=False)  # -> Inside, Index
cull_pattern_2 = CullPattern(List=point_2, CullPattern=point_in_breps.Inside)
point_6 = Point(cull_pattern_2)
xy_plane = XYPlane(Origin=Point(0, 0, 0))
supp = SupportKaramba3D(
    PosInd=point_6,
    PlaneOfReference=xy_plane,
    Ct_kN_m=Vector(0, 0, 0),
    Cr_kNm_rad=Vector(0, 0, 0),
    menu=[buttons(on, on, on, off, off, off)])
list_item_6 = ListItem(List=point_6, Index=0, Wrap=True)

rdpoints_2 = RemoveDuplicatePointsKaramba3D(Point=merge_6, LimitDistance=0.005)  # -> OutPoint, Info, Indexes

# ----
# B. Create Beams
number_slider_10 = Slider(20, range=0..100)
number_slider_11 = Slider(16, range=0..100)
matselect = MaterialSelectionKaramba3D(menu=[dropdown(1), dropdown(4), dropdown(11)])
crosec = CrossSectionKaramba3D(
    FamilyNameOfCrossSection="DefaultCroSec",
    Material=matselect,
    Height_cm=number_slider_10,
    UpperFlangeWidth_cm=number_slider_11,
    LowerFlangeWidth_cm=number_slider_11,
    mode="Trapezoid")
line_3 = Line(line_2)
lineelem = CreateLinearElementKaramba3D(
    Line=line_3,
    Identifier="N",
    CrossSection=crosec,
    LimitDistance_m=0.005,
    BucklingLengthY_m=-1,
    BucklingLengthZ_m=-1,
    BucklingLengthLT_m=-1,
    Bending=True,
    ToPolylineMaxAngle=0.25,
    ToPolylineTolerance=0.1,
    ToPolylineMaxEdgeLength=0.25,
    New=True,
    Remove=True,
    mode="LineToBeam",
    GuidGeneratorSeed=401302299)  # -> Element, Points, Info

number_slider_12 = Slider(2000, range=0..20000)
number_slider_13 = Slider(2000, range=0..20000)
vector_xyz = VectorXYZ(XComponent=number_slider_12, YComponent=number_slider_12, ZComponent=number_slider_12)  # -> Vector, Length
vector_xyz_2 = VectorXYZ(XComponent=number_slider_13, YComponent=number_slider_13, ZComponent=number_slider_13)  # -> Vector, Length

# ----
# D. Set Loads
# * facade load?
# * snow, wind, etc. load?
delaunay_mesh = DelaunayMesh(Points=rdpoints_2.OutPoint, Plane=PlaneXY(0, 0, 0))
unit_z = UnitZ(Factor="-9")
unit_z_2 = UnitZ(Factor="-1.1")
quadrangulate = Quadrangulate(Mesh=delaunay_mesh, Angle=0.03490658504, Ratio=0.875)  # -> Mesh, Count
loads = LoadsKaramba3D(Vector=Vector(0, 0, -1), LCase="LC0", mode="Gravity")
loads_2 = LoadsKaramba3D(ForceVector=unit_z, Local=False, PosInd=point_4, LCase="LC0", mode="Point")
loads_3 = LoadsKaramba3D(
    Vector=unit_z_2,
    Mesh=quadrangulate.Mesh,
    LCase="LC0",
    mode="MeshLoad -Const.",
    menu=[buttons(on, off, off), buttons(on, on)])
merge_7 = Merge(Data1=loads, Data2=loads_2, Data3=loads_3)  # -> flatten(Result)
load_karamba3d = LoadKaramba3D(merge_7)

# ----
# A. Create Panels
matselect_2 = MaterialSelectionKaramba3D(menu=[dropdown(1), dropdown(4), dropdown(11)])
crosec_2 = CrossSectionKaramba3D(FamilyNameOfCrossSection="DefaultCroSec", Material=matselect_2, Height_cm=Slider(6, range=0..100), mode="Shell - Const")
mesh_explode = MeshExplode(Mesh=quadrangulate.Mesh, Interpolate=False)  # -> flatten(Faces)
surfelem = CreateSurfaceElementKaramba3D(Mesh=mesh_explode, Identifier="N", CrossSection=crosec_2, LimitDistance_m=0.005, Bending=True, mode="MeshToShell")  # -> Element, Points, Info

# ----
# E. Set Joints
beam_joints = BeamJointsKaramba3D(
    BeamIdentifier="N",
    CtKNMAtStartingNode=Vector(0, 0, 0),
    CrKNmRadAtStartingNode=vector_xyz.Vector,
    CtKNMAtEndNode=Vector(0, 0, 0),
    CrKNmRadAtEndNode=vector_xyz_2.Vector,
    menu=[buttons(off, off, off, on, on, on), buttons(off, off, off, on, on, on)])

merge_8 = Merge(Data1=surfelem.Element, Data2=lineelem.Element)  # -> flatten(Result)

# ----
# F. Optimize Cross Sections
number_slider_14 = Slider(12, range=0..100)
number_slider_15 = Slider(16, range=0..100)
number_slider_16 = Slider(20, range=0..100)
matselect_3 = MaterialSelectionKaramba3D(menu=[dropdown(1), dropdown(4), dropdown(11)])
series = Series(Start=number_slider_14, Step=Slider(2, range=0..10), Count=10)
series_2 = Series(Start=number_slider_15, Step=Slider(2, range=0..10), Count=10)
series_3 = Series(Start=number_slider_16, Step=Slider(2, range=0..10), Count=10)
panel_18 = Panel(series)
panel_19 = Panel(series_2)
panel_20 = Panel(series_3)
crosec_3 = CrossSectionKaramba3D(
    FamilyNameOfCrossSection="DefaultCroSec",
    Material=matselect_3,
    Height_cm=series,
    UpperFlangeWidth_cm=number_slider_14,
    LowerFlangeWidth_cm=number_slider_14,
    mode="Trapezoid")
crosec_4 = CrossSectionKaramba3D(
    FamilyNameOfCrossSection="DefaultCroSec",
    Material=matselect_3,
    Height_cm=series_2,
    UpperFlangeWidth_cm=number_slider_15,
    LowerFlangeWidth_cm=number_slider_15,
    mode="Trapezoid")
crosec_5 = CrossSectionKaramba3D(
    FamilyNameOfCrossSection="DefaultCroSec",
    Material=matselect_3,
    Height_cm=series_3,
    UpperFlangeWidth_cm=number_slider_16,
    LowerFlangeWidth_cm=number_slider_16,
    mode="Trapezoid")
merge_9 = Merge(Data1=crosec_3, Data2=crosec_4, Data3=crosec_5)
cross_section_karamba3d = CrossSectionKaramba3D(merge_9)

element_karamba3d = ElementKaramba3D(merge_8)
addition = Addition(A=Slider(6.5, range=0..10), B=4)
unit_z_3 = UnitZ(Factor=addition)
assemble = AssembleModelKaramba3D(Elem=element_karamba3d, Support=supp, Load=load_karamba3d, Joint=beam_joints, LimitDistance_m=0.005)  # -> Model, Info, Mass_kg, CentreOfGravity, LoadCaseNames
move = Move(Geometry=list_item_6, Motion=unit_z_3)  # -> Geometry, Transform
point_7 = Point(Point(188.7300008, 83.48000076, 24.8))
opticrosec = OptimizeCrossSectionKaramba3D(
    Model=assemble.Model,
    CrossSections=cross_section_karamba3d,
    MaximumUtilization=1,
    MaximumDisplacement_cm=Slider(3, range=0..10),
    MaximumVirtualWork_kNcm=0.01,
    NumberOfUtilizationIterations=5,
    NumberOfDisplacementIterations=5,
    NumberOfDisplacementIncrementsPerIteration=2,
    DisplacementTolerance=0.01,
    NumberOfSamplePoints=3,
    ElasticDesign=True,
    GammaM0=1,
    GammaM1=1.1,
    SwayFrame=True)  # -> OptimizedModel, Info, Mass_kg, MaximumDisplacement_cm, ElasticEnergyChange_kNm, MaximumUtilizationViewInsufficientCrossSections, MaximumDisplacementViewLimitCrossSections
xz_plane = XZPlane(Origin=point_7)
panel_21 = Panel(opticrosec.Mass_kg)
analyse = AnalyseKaramba3D(Model=opticrosec.OptimizedModel)  # -> AnalysedModel, MaximumDisplacement_cm, ResultingForce_kN, ChangeOfElasticEnergy_kNm
panel_22 = Panel(analyse.MaximumDisplacement_cm)
modelview = ModelViewKaramba3D(Model=analyse.AnalysedModel)  # -> Model, DeformedMesh, DeformedAxes, DeformedModel, MaximumDeformation
text_tag_3d = TextTag3D(Location=xz_plane, Text=panel_22, Size=Slider(1.8, range=0..10), Justification=7)
disassemble = DisassembleModelKaramba3D(Model=modelview.Model)  # -> Model, Point, Beam, Shell, Support, Load, Line, Mesh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
disassemble_2 = DisassembleElementKaramba3D(Element=disassemble.Beam)  # -> Element, ElementIdentifier, AxisOfElement, CrossSection, Joint, Material, LocalCoordinateSystem, ElementIsActive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
utilization = UtilizationOfElementsKaramba3D(
    AnalysedModel=analyse.AnalysedModel,
    ElementsIdentifiers=disassemble_2.Element,
    NumberOfSamplePoints=3,
    ElasticDesign=True,
    GammaM0=1,
    GammaM1=1.1,
    SwayFrame=True,
    WithDetails=False,
    mode="Beams")  # -> Model, Utilization, SigMax_kN_cm², SigMin_kN_cm², TauMax_kN_cm², UtilN, UtilVy, UtilVz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
panel_23 = Panel(utilization.UtilN)
beamview = BeamViewKaramba3D(Model=modelview.Model)  # -> Model, MeshesOfRenderedBeams, DeformedBeamAxes, LegendColours, LegendTags
disassemble_3 = DisassembleCrossSectionKaramba3D(CroSec=disassemble_2.CrossSection)  # -> CrossSection, FamilyNameOfCrossSection, TypeNameOfCrossSection, ElemIdentifiers, Colour, Material, LocalEccentricity_cm, flatten(Heights_cm)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
mesh = Mesh(beamview.MeshesOfRenderedBeams)
multiplication = Multiplication(A=disassemble_3.Heights_cm, B=disassemble_3.MaximumWidth_cm)
legend = LegendKaramba3D(
    Colors=beamview.LegendColours,
    Tags=beamview.LegendTags,
    Scale=0.8,
    Textsize=30,
    Legend_HasHeader=False,
    Legend_Justification=1,
    Legend_Position=2)

line_4 = Line()
curve_middle = CurveMiddle(Curve=line_4)
construct_domain = ConstructDomain(DomainStart=Slider(0.048, range=0..1), DomainEnd=Slider(0.242, range=0..1))
bounds_2 = Bounds(Numbers=multiplication)
deconstruct_domain = DeconstructDomain(Domain=bounds_2)  # -> Start, End
yz_plane = YZPlane(Origin=curve_middle)
gradient = Gradient(
    LowerLimit=deconstruct_domain.End,
    UpperLimit=deconstruct_domain.Start,
    Parameter=multiplication,
    stops=[0: RGB(234, 38, 0), 0.25: RGB(234, 126, 0), 0.5: RGB(254, 244, 84), 0.75: RGB(173, 203, 249), 1: RGB(75, 107, 169)])
remap_numbers_2 = RemapNumbers(Value=multiplication, Source=bounds_2, Target=construct_domain)  # -> Mapped, Clipped
text_tag_3d_2 = TextTag3D(Location=yz_plane, Text=multiplication, Size=Slider(0.067, range=0..1), Justification=7)
tt_lineweight_preview = TTLineweightPreview(Geometry=line_4, StrokeColor=gradient, StrokeWeight=remap_numbers_2.Mapped, Absolute=Toggle(True))

volume = Volume(Geometry=mesh)  # -> Volume, Centroid
create_set = CreateSet(List=flatten(disassemble_3.Heights_cm))  # -> Set, Map
deconstruct_plane = DeconstructPlane(Plane=disassemble_2.LocalCoordinateSystem)  # -> Origin, XAxis, YAxis, ZAxis
mass_addition = MassAddition(Input=volume.Volume)  # -> Result, PartialResults
create_set_2 = CreateSet(List=flatten(disassemble_3.MaximumWidth_cm))  # -> Set, Map
multiplication_2 = Multiplication(A=disassemble_3.Heights_cm, _001=0.01)
multiplication_3 = Multiplication(A=disassemble_3.MaximumWidth_cm, _001=0.01)
list_item_7 = ListItem(List=create_set.Set, Index=0, Wrap=True)  # -> Item1, Item
shellview = ShellViewKaramba3D(Model=modelview.Model, IndexOfLayer=0)  # -> Model, MeshesOfRenderedShells, LegendColours, LegendTags
panel_24 = Panel(mass_addition.PartialResults)
member_index_3 = MemberIndex(Set=disassemble_3.Heights_cm, Member=list_item_7.Item1)  # -> Index, Count
list_item_8 = ListItem(List=disassemble_3.MaximumWidth_cm, Index=member_index_3.Index, Wrap=True)
panel_25 = Panel(list_item_8)
panel_26 = Panel(create_set_2.Set)
panel_27 = Panel(create_set.Set)
panel_28 = Panel(disassemble_3.Heights_cm)

# ---- group: Compas_Timber
beam = CTBeam(
    centerline=disassemble_2.AxisOfElement,
    z_vector=deconstruct_plane.ZAxis,
    width=multiplication_3,
    height=multiplication_2)  # -> Beam, Blank; inputs centerline: list, z_vector: list of Vector3d, width: list of Double, height: list of Double, category: list of String, updateRefObj: Boolean; disabled
#   port centerline: Referenced curve or line, Guid of curve or line in the active Rhino document.
#   port z_vector: Vector defining the orientation of the cross-section (corresponds to the height dimension). If None, a default will be taken.
#   port width: Width of the cross-section (usually the smaller dimension).
#   port height: Height of the cross-section (usually the larger dimension).
#   port category: Category of a beam.
#   port updateRefObj: (optional) If True, the attributes in the referenced object will be updated/overwritten with the new values given here.
#   port Beam: Beam object(s).
#   port Blank: Shape of the beam's blank.
# ---------- beam: Python ----------
# r: compas_timber>=1.0.2
"""Creates a Beam from a LineCurve."""

# flake8: noqa
import Grasshopper
import Rhino
import rhinoscriptsyntax as rs
import System
from compas.scene import Scene
from compas_rhino.conversions import line_to_compas
from compas_rhino.conversions import vector_to_compas

from compas_timber.elements import Beam as CTBeam
from compas_timber.ghpython.rhino_object_name_attributes import update_rhobj_attributes_name
from compas_timber.ghpython.ghcomponent_helpers import list_input_valid_cpython


class Beam_fromCurve(Grasshopper.Kernel.GH_ScriptInstance):
    def RunScript(self,
            centerline: System.Collections.Generic.List[object],
            z_vector: System.Collections.Generic.List[Rhino.Geometry.Vector3d],
            width: System.Collections.Generic.List[float],
            height: System.Collections.Generic.List[float],
            category: System.Collections.Generic.List[str],
            updateRefObj: bool):
        # minimum inputs required
        if not list_input_valid_cpython(ghenv, centerline, "Centerline"):
            return
        if not width:
            length = self._get_centerline_length(centerline)
            width = [length / 20]
        if not height:
            length = self._get_centerline_length(centerline)
            height = [length / 10]

        # reformat unset parameters for consistency
        if not z_vector:
            z_vector = [None]
        if not category:
            category = [None]

        beams = []
        blanks = []
        scene = Scene()

        if centerline and height and width:
            # check list lengths for consistency
            N = len(centerline)
            if len(z_vector) not in (0, 1, N):
                ghenv.Component.AddRuntimeMessage(
                    Grasshopper.Kernel.GH_RuntimeMessageLevel.Error, " In 'ZVector' I need either none, one or the same number of inputs as the Crv parameter."
                )
            if len(width) not in (1, N):
                ghenv.Component.AddRuntimeMessage(Grasshopper.Kernel.GH_RuntimeMessageLevel.Error, " In 'W' I need either one or the same number of inputs as the Crv parameter.")
            if len(height) not in (1, N):
                ghenv.Component.AddRuntimeMessage(Grasshopper.Kernel.GH_RuntimeMessageLevel.Error, " In 'H' I need either one or the same number of inputs as the Crv parameter.")
            if len(category) not in (0, 1, N):
                ghenv.Component.AddRuntimeMessage(
                    Grasshopper.Kernel.GH_RuntimeMessageLevel.Error, " In 'Category' I need either none, one or the same number of inputs as the Crv parameter."
                )

            # duplicate data if None or single value
            if len(z_vector) != N:
                z_vector = [z_vector[0] for _ in range(N)]
            if len(width) != N:
                width = [width[0] for _ in range(N)]
            if len(height) != N:
                height = [height[0] for _ in range(N)]
            if len(category) != N:
                category = [category[0] for _ in range(N)]

            for line, z, w, h, c in zip(centerline, z_vector, width, height, category):
                guid, geometry = self._get_guid_and_geometry(line)
                rhino_line = rs.coerceline(geometry)
                line = line_to_compas(rhino_line)

                z = vector_to_compas(z) if z else None
                beam = CTBeam.from_centerline(centerline=line, width=w, height=h, z_vector=z)
                beam.attributes["rhino_guid"] = str(guid) if guid else None
                beam.attributes["category"] = c
                if updateRefObj and guid:
                    update_rhobj_attributes_name(guid, "width", str(w))
                    update_rhobj_attributes_name(guid, "height", str(h))
                    update_rhobj_attributes_name(guid, "zvector", str(list(beam.frame.zaxis)))
                    update_rhobj_attributes_name(guid, "category", c)

                beams.append(beam)
                scene.add(beam.blank)

        blanks = scene.draw()

        return beams, blanks

    def _get_guid_and_geometry(self, line):
        # internalized curves and GH geometry will not have persistent GUIDs, referenced Rhino objects will
        # type hint on the input has to be 'ghdoc' for this to work
        guid = None
        geometry = line
        rhino_obj = Rhino.RhinoDoc.ActiveDoc.Objects.FindId(line)
        if rhino_obj:
            guid = line
            geometry = rhino_obj.Geometry
        return guid, geometry

    def _get_centerline_length(self, centerline):
        centerline_length = []
        for i in centerline:
            centerline_length.append(rs.CurveLength(i))
        if centerline_length:
            length_average = sum(centerline_length) / len(centerline_length)
        else:
            length_average = 1
        return length_average
# ---------- end beam ----------
model = CTModel(Elements=flatten(beam.Beam))  # -> Model, Geometry, DebugInfo; inputs Elements: list, Containers: list, JointRules: list, Features: list, MaxDistance: Double, CreateGeometry: Boolean; disabled
#   port Elements: Collection of Beams
#   port Containers: Container elements, such as walls, floors, roofs, etc.
#   port JointRules: Collection of joint rules.
#   port Features: Collection of feature definitions.
#   port MaxDistance: Max Distance Tolerance for topology detection.
#   port CreateGeometry: If True, Beam and joint geometry is created for visualization.
#   port Model: Model object.
#   port Geometry: Geometry of the beams and joints.
#   port DebugInfo: Debug information object in the case of feature or joining errors.
# ---------- model: Python ----------
# r: compas_timber>=1.0.2
"""Creates an Model"""

import Grasshopper
import Rhino
import System
from compas.scene import Scene
from compas.tolerance import TOL
from compas.tolerance import Tolerance

from compas_timber.design import DebugInfomation
from compas_timber.design import JointRuleSolver
from compas_timber.design import WallPopulator
from compas_timber.elements import Beam
from compas_timber.elements import Plate
from compas_timber.errors import FeatureApplicationError
from compas_timber.ghpython import error
from compas_timber.ghpython import warning
from compas_timber.model import TimberModel

# workaround for https://github.com/gramaziokohler/compas_timber/issues/280
TOL.absolute = 1e-6


class ModelComponent(Grasshopper.Kernel.GH_ScriptInstance):
    @property
    def component(self):
        return ghenv.Component  # type: ignore

    def RunScript(self,
            Elements: System.Collections.Generic.List[object],
            Containers: System.Collections.Generic.List[object],
            JointRules: System.Collections.Generic.List[object],
            Features: System.Collections.Generic.List[object],
            MaxDistance: float,
            CreateGeometry: bool):
        # this used to be default behavior in Rhino7.. I think..
        Elements = Elements or []
        Containers = Containers or []
        JointRules = JointRules or []
        Features = Features or []

        if not Elements:
            warning(self.component, "Input parameter Beams failed to collect data")
        if not JointRules:
            warning(self.component, "Input parameter JointRules failed to collect data")
        if not (Elements or Containers):  # shows beams even if no joints are found
            return
        if MaxDistance is None:
            MaxDistance = TOL.ABSOLUTE  # compared to calculted distance, so shouldn't be just 0.0

        tol = self.get_tol()
        Model = TimberModel(tolerance=tol)
        debug_info = DebugInfomation()

        ##### Adding elements #####
        self.add_elements_to_model(Model, Elements, Containers)

        ##### Wall populating #####
        handled_pairs, wall_joints = self.handle_populators(Model, Containers, MaxDistance)

        ##### Handle joinery #####
        # checks elements compatibility and generates Joints
        JointRules = [j for j in JointRules if j is not None]

        solver = JointRuleSolver(JointRules, max_distance=MaxDistance)
        joint_errors, _ = solver.apply_rules_to_model(Model)  # TODO: figure out best way to pass out unjoined_clusters

        for je in joint_errors:
            debug_info.add_joint_error(je)

        # applies extensions and features resulting from joints
        bje = Model.process_joinery()
        if bje:
            debug_info.add_joint_error(bje)

        ##### Handle user features #####
        if Features:
            feature_errors = self.handle_features(Features)
            debug_info.add_feature_error(feature_errors)

        ##### Visualization #####
        Geometry, errors = self.handle_geometry(Model, CreateGeometry)
        for geo_error in errors:
            debug_info.add_feature_error(geo_error)

        ##### Error Handling #####
        if debug_info.has_errors:
            warning(self.component, "Error found during joint creation. See DebugInfo output for details.")

        return Model, Geometry, debug_info

    def get_tol(self):
        units = Rhino.RhinoDoc.ActiveDoc.GetUnitSystemName(True, True, True, True)
        if units == "m":
            return Tolerance(unit="M", absolute=1e-6, relative=1e-6)
        elif units == "mm":
            return Tolerance(unit="MM", absolute=1e-3, relative=1e-3)
        else:
            error(self.component, f"Unsupported unit: {units}")
            return

    def add_elements_to_model(self, model, elements, containers):
        """Adds elements to the model and groups them by slab."""
        elements = [e for e in elements if e is not None]
        for element in elements:
            element.reset()
            model.add_element(element)

        containers = [c for c in containers if c is not None]

        for index, c_def in enumerate(containers):
            slab = c_def.slab
            model.add_group_element(slab, name=slab.name + str(index))

    def handle_populators(self, model, containers, max_distance):
        # Handle wall populators
        model.connect_adjacent_walls()
        config_sets = [c_def.config_set for c_def in containers]
        populators = []
        if any(config_sets):
            populators = WallPopulator.from_model(model, config_sets)

        handled_pairs = []
        wall_joints = []
        for populator, slab in zip(populators, list(model.slabs)):
            elements = populator.create_elements()
            model.add_elements(elements, parent=slab.name)
            joint_definitions = populator.create_joints(elements, max_distance)
            wall_joints.extend(joint_definitions)
            for j_def in joint_definitions:
                element_a, element_b = j_def.elements
                handled_pairs.append({element_a, element_b})

        return handled_pairs, wall_joints

    def handle_features(self, features):
        feature_errors = []
        features = [f for f in features if f is not None]
        for f_def in features:
            if not f_def.elements:
                warning(self.component, "Features defined in model must have elements defined. Features without elements will be ignored")
                continue

            for element in f_def.elements:
                try:
                    element.add_features(f_def.feature_from_element(element))
                except FeatureApplicationError as ex:
                    feature_errors.append(ex)
        return feature_errors

    def handle_geometry(self, Model, CreateGeometry):
        scene = Scene()
        errors = []
        for element in Model.elements():
            if CreateGeometry:
                scene.add(element.geometry)
                if getattr(element, "debug_info", False):
                    errors.append(element.debug_info)
            else:
                if isinstance(element, Beam):
                    scene.add(element.blank)
                elif isinstance(element, Plate):
                    scene.add(element.shape)
                else:
                    scene.add(element.geometry)
        return scene.draw(), errors
# ---------- end model ----------
panel_29 = Panel("""0.2
0.2
5""")
button = Button()
bakewithboxmap = CTBakeWithBoxMap(model=model.Model, map_size=panel_29, bake=Button())  # inputs map_size: list of Double, bake: Boolean
#   port model: Model object (optional).
#   port map_size: Scaling of the BoxMap in x,y,z directions (list of three positive values) (optional).
#   port bake: Set to True to Bake. Nothing happens if None or False.
# ---------- bakewithboxmap: Python ----------
# r: compas_timber>=1.0.2
# flake8: noqa
import math
import random

import Grasshopper
import System
import Rhino
import rhinoscriptsyntax as rs
from compas_rhino.conversions import frame_to_rhino
from compas_timber.ghpython import item_input_valid_cpython

from Rhino import Render
from Rhino.Geometry import Interval
from Rhino.Geometry import Plane


class BakeBoxMap(Grasshopper.Kernel.GH_ScriptInstance):
    def RunScript(self,
            model,
            map_size: System.Collections.Generic.List[float],
            bake: bool):
        if map_size and len(map_size) != 3:
            ghenv.Component.AddRuntimeMessage(
                Grasshopper.Kernel.GH_RuntimeMessageLevel.Error, "Input parameter MapSize requires exactly three float values (scale factors in x,y,z directions)"
            )
            return

        unit_system = Rhino.RhinoDoc.ActiveDoc.ModelUnitSystem

        if map_size:
            dimx, dimy, dimz = map_size
        else:
            # for the pine 251 material bitmap, rotated
            if unit_system == Rhino.UnitSystem.Meters:
                dimx = 0.2
                dimy = 0.2
                dimz = 1.0
            if unit_system == Rhino.UnitSystem.Centimeters:
                dimx = 20
                dimy = 20
                dimz = 100
            if unit_system == Rhino.UnitSystem.Millimeters:
                dimx = 200
                dimy = 200
                dimz = 1000

        if not item_input_valid_cpython(ghenv, model, "Model"):
            return

        if not bake:
            return

        try:
            frames = [frame_to_rhino(b.frame) for b in model.beams]
            breps = [beam.geometry.native_brep for beam in model.beams]

            if frames and breps:
                rs.EnableRedraw(False)

                for brep, frame in zip(breps, frames):
                    guid = Rhino.RhinoDoc.ActiveDoc.Objects.Add(brep)
                    boxmap = self.create_box_map(frame, dimx, dimy, dimz)
                    Rhino.RhinoDoc.ActiveDoc.Objects.ModifyTextureMapping(guid, 1, boxmap)
        finally:
            rs.EnableRedraw(True)

    @staticmethod
    def create_box_map(pln, sx, sy, sz):
        """
        pln: frame of beam box, where x=main axis, y=width, z=height
        sx,sy,sz: box map size in x,y,z direction
        """

        v = pln.YAxis
        w = pln.ZAxis
        pt = pln.Origin

        # random deviation
        a = math.pi * 0.5
        randangle = (random.random() - 0.5) * a
        v.Rotate(randangle, pln.XAxis)

        b = math.pi * 0.01
        randangle = (random.random() - 0.5) * b
        w.Rotate(randangle, pln.XAxis)

        randpos = sx * random.random()
        pt += pln.XAxis * randpos

        # create box mapping
        mappingPln = Plane(pt, w, v)
        dx = Interval(-sx * 0.5, sx * 0.5)
        dy = Interval(-sy * 0.5, sy * 0.5)
        dz = Interval(-sz * 0.5, sz * 0.5)

        BoxMap = Render.TextureMapping.CreateBoxMapping(mappingPln, dx, dy, dz, False)

        return BoxMap
# ---------- end bakewithboxmap ----------
bakewithboxmap_2 = CTBakeWithBoxMap(model=model.Model, map_size=panel_29, bake=Button())  # inputs map_size: list of Double, bake: Boolean
#   port model: Model object (optional).
#   port map_size: Scaling of the BoxMap in x,y,z directions (list of three positive values) (optional).
#   port bake: Set to True to Bake. Nothing happens if None or False.
# ---------- bakewithboxmap_2: Python ----------
# r: compas_timber>=1.0.2
# flake8: noqa
import math
import random

import Grasshopper
import System
import Rhino
import rhinoscriptsyntax as rs
from compas_rhino.conversions import frame_to_rhino
from compas_timber.ghpython import item_input_valid_cpython

from Rhino import Render
from Rhino.Geometry import Interval
from Rhino.Geometry import Plane


class BakeBoxMap(Grasshopper.Kernel.GH_ScriptInstance):
    def RunScript(self,
            model,
            map_size: System.Collections.Generic.List[float],
            bake: bool):
        if map_size and len(map_size) != 3:
            ghenv.Component.AddRuntimeMessage(
                Grasshopper.Kernel.GH_RuntimeMessageLevel.Error, "Input parameter MapSize requires exactly three float values (scale factors in x,y,z directions)"
            )
            return

        unit_system = Rhino.RhinoDoc.ActiveDoc.ModelUnitSystem

        if map_size:
            dimx, dimy, dimz = map_size
        else:
            # for the pine 251 material bitmap, rotated
            if unit_system == Rhino.UnitSystem.Meters:
                dimx = 0.2
                dimy = 0.2
                dimz = 1.0
            if unit_system == Rhino.UnitSystem.Centimeters:
                dimx = 20
                dimy = 20
                dimz = 100
            if unit_system == Rhino.UnitSystem.Millimeters:
                dimx = 200
                dimy = 200
                dimz = 1000

        if not item_input_valid_cpython(ghenv, model, "Model"):
            return

        if not bake:
            return

        try:
            # frames = [frame_to_rhino(b.frame) for b in model.beams]
            # breps = [beam.geometry.native_brep for beam in model.beams]

            # if frames and breps:
            #     rs.EnableRedraw(False)

            #     for brep, frame in zip(breps, frames):
            #         guid = Rhino.RhinoDoc.ActiveDoc.Objects.Add(brep)
            #         boxmap = self.create_box_map(frame, dimx, dimy, dimz)
            #         Rhino.RhinoDoc.ActiveDoc.Objects.ModifyTextureMapping(guid, 1, boxmap)
            #
            from compas.datastructures import Mesh
            from compas_rhino.conversions import mesh_to_rhino
            import Rhino.Geometry as rg
            frames, meshes = [], []
            for beam in model.beams:
                frame = frame_to_rhino(beam.frame)
                frames.append(frame)
                mesh = Mesh()

                brep = beam.geometry
                ms = brep.to_meshes()
                for m in ms:
                    mesh.join(m)
                rh_mesh = mesh_to_rhino(mesh)
                rh_mesh.Vertices.CombineIdentical(True, True)
                meshes.append(rh_mesh)

            if frames and meshes:
                rs.EnableRedraw(False)

                for mesh, frame in zip(meshes, frames):
                    guid = Rhino.RhinoDoc.ActiveDoc.Objects.Add(mesh)
                    boxmap = self.create_box_map(frame, dimx, dimy, dimz)
                    Rhino.RhinoDoc.ActiveDoc.Objects.ModifyTextureMapping(guid, 1, boxmap)

                

        finally:
            rs.EnableRedraw(True)

    @staticmethod
    def create_box_map(pln, sx, sy, sz):
        """
        pln: frame of beam box, where x=main axis, y=width, z=height
        sx,sy,sz: box map size in x,y,z direction
        """

        v = pln.YAxis
        w = pln.ZAxis
        pt = pln.Origin

        # random deviation
        a = math.pi * 0.5
        randangle = (random.random() - 0.5) * a
        v.Rotate(randangle, pln.XAxis)

        b = math.pi * 0.01
        randangle = (random.random() - 0.5) * b
        w.Rotate(randangle, pln.XAxis)

        randpos = sx * random.random()
        pt += pln.XAxis * randpos

        # create box mapping
        mappingPln = Plane(pt, w, v)
        dx = Interval(-sx * 0.5, sx * 0.5)
        dy = Interval(-sy * 0.5, sy * 0.5)
        dz = Interval(-sz * 0.5, sz * 0.5)

        BoxMap = Render.TextureMapping.CreateBoxMapping(mappingPln, dx, dy, dz, False)

        return BoxMap
# ---------- end bakewithboxmap_2 ----------

# ---- group: Compas_Timber / Output: Mesh
bakewithboxmap_3 = CTBakeWithBoxMap(model=model.Model, map_size=panel_29, bake=button)  # inputs map_size: list of Double, bake: Boolean
#   port model: Model object (optional).
#   port map_size: Scaling of the BoxMap in x,y,z directions (list of three positive values) (optional).
#   port bake: Set to True to Bake. Nothing happens if None or False.
# ---------- bakewithboxmap_3: Python ----------
# r: compas_timber>=1.0.2
# flake8: noqa
import math
import random

import Grasshopper
import System
import Rhino
import rhinoscriptsyntax as rs
from compas_rhino.conversions import frame_to_rhino
from compas_timber.ghpython import item_input_valid_cpython

from Rhino import Render
from Rhino.Geometry import Interval
from Rhino.Geometry import Plane

from Rhino.Geometry import Box, Mesh
from compas_rhino.conversions import box_to_rhino

class BakeBoxMap(Grasshopper.Kernel.GH_ScriptInstance):
    def RunScript(self,
            model,
            map_size: System.Collections.Generic.List[float],
            bake: bool):
        if map_size and len(map_size) != 3:
            ghenv.Component.AddRuntimeMessage(
                Grasshopper.Kernel.GH_RuntimeMessageLevel.Error, "Input parameter MapSize requires exactly three float values (scale factors in x,y,z directions)"
            )
            return

        unit_system = Rhino.RhinoDoc.ActiveDoc.ModelUnitSystem

        if map_size:
            dimx, dimy, dimz = map_size
        else:
            # for the pine 251 material bitmap, rotated
            if unit_system == Rhino.UnitSystem.Meters:
                dimx = 0.2
                dimy = 0.2
                dimz = 1.0
            if unit_system == Rhino.UnitSystem.Centimeters:
                dimx = 20
                dimy = 20
                dimz = 100
            if unit_system == Rhino.UnitSystem.Millimeters:
                dimx = 200
                dimy = 200
                dimz = 1000

        if not item_input_valid_cpython(ghenv, model, "Model"):
            return

        if not bake:
            return

        try:
            frames, meshes = [], []
            for beam in model.beams:
                frame = frame_to_rhino(beam.frame)
                frames.append(frame)

                box = beam.shape
                box = box_to_rhino(box)
                mesh = Mesh.CreateFromBox(box, 1, 1, 1)
                meshes.append(mesh)

            if frames and meshes:
                rs.EnableRedraw(False)

                for mesh, frame in zip(meshes, frames):
                    guid = Rhino.RhinoDoc.ActiveDoc.Objects.Add(mesh)
                    boxmap = self.create_box_map(frame, dimx, dimy, dimz)
                    Rhino.RhinoDoc.ActiveDoc.Objects.ModifyTextureMapping(guid, 1, boxmap)
        finally:
            rs.EnableRedraw(True)

    @staticmethod
    def create_box_map(pln, sx, sy, sz):
        """
        pln: frame of beam box, where x=main axis, y=width, z=height
        sx,sy,sz: box map size in x,y,z direction
        """

        v = pln.YAxis
        w = pln.ZAxis
        pt = pln.Origin

        # random deviation
        a = math.pi * 0.5
        randangle = (random.random() - 0.5) * a
        v.Rotate(randangle, pln.XAxis)

        b = math.pi * 0.01
        randangle = (random.random() - 0.5) * b
        w.Rotate(randangle, pln.XAxis)

        randpos = sx * random.random()
        pt += pln.XAxis * randpos

        # create box mapping
        mappingPln = Plane(pt, w, v)
        dx = Interval(-sx * 0.5, sx * 0.5)
        dy = Interval(-sy * 0.5, sy * 0.5)
        dz = Interval(-sz * 0.5, sz * 0.5)

        BoxMap = Render.TextureMapping.CreateBoxMapping(mappingPln, dx, dy, dz, False)

        return BoxMap
# ---------- end bakewithboxmap_3 ----------
