# Grasshopper definition Tree_generator_v6.ghx (Grasshopper 1.0.8)
# plug-ins: Karamba3D

# ----
# A. Initialize Data
height = Panel("8.7")
height_2 = Panel("4.7")
div_x = Panel("4")
div_y = Panel("6")
rec = Rectangle({Plane=PlaneXY(163.5400008, 52.91000076, 24.8), Size=Domain2(u=-4.81..4.81, v=-14.43..14.43)})
rec_2 = Rectangle({Plane=PlaneXY(173.1600008, 52.91000076, 24.8), Size=Domain2(u=-4.81..4.81, v=-14.43..14.43)})
py3 = Python3Script(boundary=rec, div_x=div_x, div_y=div_y, height=height)  # -> out, v_list_out; inputs boundary: Polyline, div_x: Int32, div_y: Int32, height: Double
# ---------- py3: Python ----------
#locate class file in the same folder
from compas_rhino import unload_modules
import sys
import os

#get current file path
path = ghenv.Component.OnPingDocument().FilePath
#get parent directory of the parent directory
parentdir = os.path.dirname(path)
#get src folder which contains classes
dire = os.path.join(parentdir,'scripts')
sys.path.append(dire)

import Line_model_v3
unload_modules('Line_model_v3')

##########------------Imports------------###########
from Line_model_v3 import VertexList
from compas_rhino.conversions import polyline_to_compas
from compas.geometry import Line

from Grasshopper import DataTree
from Grasshopper.Kernel.Data import GH_Path

#######------Conversions-------########
boundary = polyline_to_compas(boundary)

#########------Main Code------###############
# 1. Create generator
v_list = VertexList(
    boundary=boundary,
    division_x=div_x,
    division_y=div_y,
    height=height
)
v_list.compute_diagrid()

# 2. Skip certain vertices


#########----------Output data----------##############
v_list_out = v_list
# ---------- end py3 ----------
py3_2 = Python3Script(boundary=rec_2, div_x=div_x, div_y=div_y, height=height_2)  # -> out, v_list_out; inputs boundary: Polyline, div_x: Int32, div_y: Int32, height: Double; same code as py3

py3_3 = Python3Script(toggle=Toggle(False))  # -> out, a; inputs toggle: Boolean; disabled
# ---------- py3_3: Python ----------
#locate class file in the same folder
from compas_rhino import unload_modules
import sys
import os

#get current file path
path = ghenv.Component.OnPingDocument().FilePath
#get parent directory of the parent directory
parentdir = os.path.dirname(path)
#get src folder which contains classes
dire = os.path.join(parentdir,'scripts')
sys.path.append(dire)

# import Line_model_v3
unload_modules('Line_model_v3')
# ---------- end py3_3 ----------

# ----
# B. Set Roof
srf = Surface([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])
join = BrepJoin(Breps=srf)  # -> Breps, Closed
py3_4 = Python3Script(v_list=py3.v_list_out, brep=join.Breps)  # -> out, v_list_out, intersects, pts; inputs brep: Brep
# ---------- py3_4: Python ----------
#locate class file in the same folder
from compas_rhino import unload_modules
import sys
import os

#get current file path
path = ghenv.Component.OnPingDocument().FilePath
#get parent directory of the parent directory
parentdir = os.path.dirname(path)
#get src folder which contains classes
dire = os.path.join(parentdir,'scripts')
sys.path.append(dire)

import Line_model_v3
unload_modules('Line_model_v3')

##########------------Imports------------###########
import Rhino.Geometry as rg
from compas_rhino.conversions import point_to_rhino, point_to_compas
from compas.geometry import Line

#######------Conversions-------########
pts_rh = [point_to_rhino(p) for p in v_list.roof_points]
#########------Main Code------###############

intersects = rg.Intersect.Intersection.ProjectPointsToBreps(
    [brep],
    pts_rh,
    rg.Vector3d(0, 0, -1),
    1e-6
)


for idx, inter_p in enumerate(intersects):
    inter_p = point_to_compas(inter_p)
    v_list[idx].z = inter_p.z
    v_list.default_z[idx] = inter_p.z
print (len(intersects))

#########----------Output data----------##############
v_list_out = v_list

pts = v_list.vertices
print (len(pts))
# ---------- end py3_4 ----------
py3_5 = Python3Script(v_list=py3_2.v_list_out, brep=join.Breps)  # -> out, v_list_out, intersects, pts; inputs brep: Brep; same code as py3_4

number_slider = Slider(0.562, range=0.001..1)
number_slider_2 = Slider(1.816, range=1.001..3)
number_slider_3 = Slider(4.081, range=3.001..5)

number_slider_4 = Slider(0.403, range=0.001..0.7)
number_slider_5 = Slider(1.151, range=0.701..1.5)
number_slider_6 = Slider(2.4, range=1.501..3)

# ----
# * Params
panel = Panel("0")
merge = Merge(Data1=panel, Data2=number_slider, Data3=number_slider_2, Data4=number_slider_3, Data5=height)
merge_2 = Merge(Data1=panel, Data2=number_slider_4, Data3=number_slider_5, Data4=number_slider_6, Data5=height_2)
galapagos = Galapagos(gene=[number_slider, number_slider_2, number_slider_3, number_slider_4, number_slider_5, number_slider_6])

# ----
# C. Set height
py3_6 = Python3Script(v_list=py3_4.v_list_out, height_list=merge)  # -> out, v_list_out, a; inputs height_list: list of Double
# ---------- py3_6: Python ----------
#locate class file in the same folder
from compas_rhino import unload_modules
import sys
import os

#get current file path
path = ghenv.Component.OnPingDocument().FilePath
#get parent directory of the parent directory
parentdir = os.path.dirname(path)
#get src folder which contains classes
dire = os.path.join(parentdir,'scripts')
sys.path.append(dire)

import Line_model_v3
unload_modules('Line_model_v3')

##########------------Imports------------###########
from Line_model_v3 import Beam
from compas_rhino.conversions import polyline_to_compas
from compas.geometry import Polygon, Plane, Line


#######------Conversions-------########


#########------Main Code------###############
v_list.reset_default()
v_list.set_default_height(height_list)

#########----------Output data----------##############
v_list_out = v_list
a = list(v_list)
# ---------- end py3_6 ----------
py3_7 = Python3Script(v_list=py3_5.v_list_out, height_list=merge_2)  # -> out, v_list_out, a; inputs height_list: list of Double; same code as py3_6

# ----
# D. Add vertices and pairs
py3_8 = Python3Script(v_list=py3_6.v_list_out)  # -> out, v_list_out
# ---------- py3_8: Python ----------
#locate class file in the same folder
from compas_rhino import unload_modules
import sys
import os

#get current file path
path = ghenv.Component.OnPingDocument().FilePath
#get parent directory of the parent directory
parentdir = os.path.dirname(path)
#get src folder which contains classes
dire = os.path.join(parentdir,'scripts')
sys.path.append(dire)

import Line_model_v3
unload_modules('Line_model_v3')

##########------------Imports------------###########
from Line_model_v3 import Beam
from compas_rhino.conversions import polyline_to_compas
from compas.geometry import Polygon, Plane, Line


#######------Conversions-------########


#########------Main Code------###############


# 4. Add vertex
v1 = Line(start=v_list[74], end=(v_list[78])).midpoint
v2 = Line(start=v_list[74], end=(v_list[75])).midpoint
v3 = Line(start=v_list[75], end=(v_list[79])).midpoint
v4 = Line(start=v_list[79], end=(v_list[78])).midpoint
v5 = Line(start=v_list[76], end=(v_list[80])).midpoint
v6 = Line(start=v_list[81], end=(v_list[80])).midpoint
v7 = Line(start=v_list[77], end=(v_list[81])).midpoint
v8 = Line(start=v_list[77], end=(v_list[76])).midpoint

#---Important--- To avoid adding duplicate points and pairs
v_list.reset_default()

v_list.add_vertices([v1, v2, v3, v4, v5, v6, v7, v8])

v_list.add_pairs([(64, 85), (82, 85), (65, 85)])
v_list.add_pairs([(60, 86), (82, 86), (65, 86)])
v_list.add_pairs([(66, 87), (82, 87), (65, 87)])
v_list.add_pairs([(70, 88), (82, 88), (65, 88)])

v_list.add_pairs([(84, 90), (84, 91), (84, 92), (84, 89)])
v_list.add_pairs([(67, 90), (67, 91), (67, 92), (67, 89)])
v_list.add_pairs([(72, 90), (68, 91), (62, 92), (66, 89)])


v_list.add_pairs([(87, 60), (87, 70), (87, 71), (87, 61), (89, 61), (89, 71), (89, 72), (89, 62)])



#########----------Output data----------##############
v_list_out = v_list
print (len(v_list))
print (len(v_list.pairs))
# ---------- end py3_8 ----------
py3_9 = Python3Script(v_list=py3_7.v_list_out)  # -> out, v_list_out
# ---------- py3_9: Python ----------
#locate class file in the same folder
from compas_rhino import unload_modules
import sys
import os

#get current file path
path = ghenv.Component.OnPingDocument().FilePath
#get parent directory of the parent directory
parentdir = os.path.dirname(path)
#get src folder which contains classes
dire = os.path.join(parentdir,'scripts')
sys.path.append(dire)

import Line_model_v3
unload_modules('Line_model_v3')

##########------------Imports------------###########
from Line_model_v3 import Beam
from compas_rhino.conversions import polyline_to_compas
from compas.geometry import Polygon, Plane, Line


#######------Conversions-------########


#########------Main Code------###############


# 4. Add vertex
v1 = Line(start=v_list[74], end=(v_list[78])).midpoint
v2 = Line(start=v_list[74], end=(v_list[75])).midpoint
v3 = Line(start=v_list[75], end=(v_list[79])).midpoint
v4 = Line(start=v_list[79], end=(v_list[78])).midpoint
v5 = Line(start=v_list[76], end=(v_list[80])).midpoint
v6 = Line(start=v_list[81], end=(v_list[80])).midpoint
v7 = Line(start=v_list[77], end=(v_list[81])).midpoint
v8 = Line(start=v_list[77], end=(v_list[76])).midpoint

v_list.reset_default()
v_list.add_vertices([v1, v2, v3, v4, v5, v6, v7, v8])

v_list.add_pairs([(64, 85), (82, 85), (65, 85)])
v_list.add_pairs([(60, 86), (82, 86), (65, 86)])
v_list.add_pairs([(66, 87), (82, 87), (65, 87)])
v_list.add_pairs([(70, 88), (82, 88), (65, 88)])

v_list.add_pairs([(84, 90), (84, 91), (84, 92), (84, 89)])
v_list.add_pairs([(67, 90), (67, 91), (67, 92), (67, 89)])
v_list.add_pairs([(72, 90), (68, 91), (62, 92), (66, 89)])


v_list.add_pairs([(87, 60), (87, 70), (87, 71), (87, 61), (89, 61), (89, 71), (89, 72), (89, 62)])



#########----------Output data----------##############
v_list_out = v_list
print (len(v_list))
print (len(v_list.pairs))
# ---------- end py3_9 ----------

# ----
# E. Output
py3_10 = Python3Script(v_list=py3_8.v_list_out)  # -> out, v_list_out, port, vertices_out, lines_out, port_2, facade_points, roof_points
# ---------- py3_10: Python ----------
#locate class file in the same folder
from compas_rhino import unload_modules
import sys
import os

#get current file path
path = ghenv.Component.OnPingDocument().FilePath
#get parent directory of the parent directory
parentdir = os.path.dirname(path)
#get src folder which contains classes
dire = os.path.join(parentdir,'scripts')
sys.path.append(dire)

import Line_model_v3
unload_modules('Line_model_v3')


##########------------Imports------------###########
from Line_model_v3 import Beam



#######------Conversions-------########

#########------Main Code------###############

skip_list = [83, 75, 76, 80, 79]
v_list.skip(skip_list)


# Construct beams
beams = []
lines = []
for pair in v_list.pairs:
    beam = Beam(pair[0], pair[1], v_list)
    beams.append(beam)
    lines.append(beam.axis)

#########----------Output data----------##############
v_list_out = v_list

vertices_out = [v_list[idx] for idx in range(len(v_list)) if idx not in v_list.skip_indices]
lines_out = lines

facade_points = v_list.facade_points
roof_points = v_list.roof_points
# ---------- end py3_10 ----------
py3_11 = Python3Script(v_list=py3_9.v_list_out)  # -> out, v_list_out, port, vertices_out, lines_out, port_2, facade_points, roof_points; same code as py3_10

# ----
# * All Points
number_slider_7 = Slider(0.41, range=0..1)
draw = COMPASDraw(cg=py3_10.vertices_out)  # -> rg
#   port cg: The COMPAS geometry or datastructure to be drawn.
#   port rg: The Rhino geometry object.
# ---------- draw: Python ----------
# r: compas>=2.14.1
"""
Draws COMPAS geometry in Grasshopper.
"""

from typing import Any

import Grasshopper

from compas.scene import SceneObject


class CompasToRhinoGeometry(Grasshopper.Kernel.GH_ScriptInstance):
    def RunScript(self, cg):
        if not cg:
            return None

        return SceneObject(item=cg).draw()
# ---------- end draw ----------
draw_2 = COMPASDraw(cg=py3_11.vertices_out)  # -> rg; same code as draw
merge_3 = Merge(Data1=draw, Data2=draw_2)
points = PointList(Points=draw, Size=number_slider_7)
points_2 = PointList(Points=draw_2, Size=number_slider_7)
duppt = RemoveDuplicatePts(Points=merge_3, Tolerance=0.01)
pt = Point(duppt)

# ----
# * Facade points
draw_3 = COMPASDraw(cg=py3_10.facade_points)  # -> rg; same code as draw
draw_4 = COMPASDraw(cg=py3_11.facade_points)  # -> rg; same code as draw
merge_4 = Merge(Data1=draw_3, Data2=draw_4)
rdpoints = RemoveDuplicatePointsKaramba3D(Point=merge_4, LimitDistance=0.005)  # -> OutPoint, Info, Indexes
pt_2 = Point(rdpoints.OutPoint)

# ----
# * Roof points
draw_5 = COMPASDraw(cg=py3_10.roof_points)  # -> rg; same code as draw
draw_6 = COMPASDraw(cg=py3_11.roof_points)  # -> rg; same code as draw
merge_5 = Merge(Data1=draw_5, Data2=draw_6)
rdpoints_2 = RemoveDuplicatePointsKaramba3D(Point=merge_5, LimitDistance=0.005)  # -> OutPoint, Info, Indexes
pt_3 = Point(rdpoints_2.OutPoint)

# ----
# * All Lines
draw_7 = COMPASDraw(cg=py3_10.lines_out)  # -> rg; same code as draw
draw_8 = COMPASDraw(cg=py3_11.lines_out)  # -> rg; same code as draw
merge_6 = Merge(Data1=draw_7, Data2=draw_8)
rdlines = RemoveDuplicateLinesKaramba3D(Line=merge_6, LimitDistance=0.005)  # -> OutLine, Info, Indexes
line = Line(rdlines.OutLine)

# ----
# * To Karamba
line_2 = Line(line)
pt_4 = Point(pt)
pt_5 = Point(pt_2)
pt_6 = Point(pt_3)
