# Grasshopper definition Tree_generator_v9_nadya.gh (Grasshopper 1.0.8)
# plug-ins: Karamba3D, CORE.Toolbox.Grasshopper, MeshEdit Components, Pufferfish, Leopard version 0a1

# ----
# A. Initialize Data
srf = Surface([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])
join = BrepJoin(Breps=srf)  # -> Breps, Closed
div_x = Panel("4")
height = Panel("8.54")
height_2 = Panel("4.54")
div_y = Panel("6")
smesh = SimpleMesh(Brep=join.Breps)
tri = Triangulate(Mesh=smesh)  # -> Mesh, Count
rec = Rectangle({Plane=PlaneXY(163.5400008, 52.91000076, 24.64), Size=Domain2(u=-4.81..4.81, v=-14.43..14.43)})
rec_2 = Rectangle({Plane=PlaneXY(173.1600008, 52.91000076, 24.64), Size=Domain2(u=-4.81..4.81, v=-14.43..14.43)})
py3 = Python3Script(boundary=rec, div_x=div_x, div_y=div_y, height=height, roof_mesh=tri.Mesh)  # -> out, v_list_out; inputs boundary: Polyline, div_x: Int32, div_y: Int32, height: Double, roof_mesh: Mesh
# ---------- py3: Python ----------
#locate class file in the same folder
from compas_rhino import unload_modules
import sys
import os

#get current file path
path = ghenv.Component.OnPingDocument().FilePath
#get parent directory of the parent directory
parentdir = os.path.dirname(path)
#get src folder which contains classes
dire = os.path.join(parentdir,'scripts')
sys.path.append(dire)

unload_modules('Line_model_v5')

##########------------Imports------------###########
from Line_model_v5 import VertexList, BeamList
from compas_rhino.conversions import polyline_to_compas, mesh_to_compas
from compas.geometry import Line


#######------Conversions-------########
boundary = polyline_to_compas(boundary)
mesh = mesh_to_compas(roof_mesh)

#########------Main Code------###############
# 1. Create generator
v_list = VertexList(
    boundary=boundary,
    division_x=div_x,
    division_y=div_y,
    height=height
)
# 2. Compute Default diagrid
v_list.compute_diagrid()

# 3. Assign tilted roof
v_list.set_default_roof(mesh)

#########----------Output data----------##############
v_list_out = v_list

#########---------Print----------------###########
print ("vertex_length:", len(v_list))
print ("pairs_length:", len(v_list.pairs))

print ("level_set:", set(pair.level for pair in v_list.pairs))
print ("cross_section_set:", set(pair.cross_section for pair in v_list.pairs))
print ("categories_set:", set(str(pair.categories) for pair in v_list.pairs))
# ---------- end py3 ----------
py3_2 = Python3Script(boundary=rec_2, div_x=div_x, div_y=div_y, height=height_2, roof_mesh=tri.Mesh)  # -> out, v_list_out; inputs boundary: Polyline, div_x: Int32, div_y: Int32, height: Double, roof_mesh: Mesh
# ---------- py3_2: Python ----------
#locate class file in the same folder
from compas_rhino import unload_modules
import sys
import os

#get current file path
path = ghenv.Component.OnPingDocument().FilePath
#get parent directory of the parent directory
parentdir = os.path.dirname(path)
#get src folder which contains classes
dire = os.path.join(parentdir,'scripts')
sys.path.append(dire)

unload_modules('Line_model_v5')

##########------------Imports------------###########
from Line_model_v5 import VertexList
from compas_rhino.conversions import polyline_to_compas, mesh_to_compas
from compas.geometry import Line


#######------Conversions-------########
boundary = polyline_to_compas(boundary)
mesh = mesh_to_compas(roof_mesh)

#########------Main Code------###############
# 1. Create generator
v_list = VertexList(
    boundary=boundary,
    division_x=div_x,
    division_y=div_y,
    height=height
)
# 2. Compute Default diagrid
v_list.compute_diagrid()

# 3. Assign tilted roof
v_list.set_default_roof(mesh)

#########----------Output data----------##############
v_list_out = v_list

#########---------Print----------------###########
print ("vertex_length:", len(v_list))
print ("pairs_length:", len(v_list.pairs))

print ("level_set:", set(pair.level for pair in v_list.pairs))
print ("cross_section_set:", set(pair.cross_section for pair in v_list.pairs))
print ("categories_set:", set(str(pair.categories) for pair in v_list.pairs))
# ---------- end py3_2 ----------

# ----
# * Params
panel = Panel("0")
merge = Merge(
    Data1=panel,
    Data2=Slider(0.705, range=0.001..1),
    Data3=Slider(2.107, range=1.001..3),
    Data4=Slider(4.42, range=3.001..5),
    Data5=height)
merge_2 = Merge(
    Data1=panel,
    Data2=Slider(0.422, range=0.001..0.7),
    Data3=Slider(1.261, range=0.701..1.5),
    Data4=Slider(2.614, range=1.501..3),
    Data5=height_2)
galapagos = Galapagos()

toggle = BooleanToggle(False)  # disabled
py3_3 = Python3Script(toggle=toggle)  # -> out, a; inputs toggle: Boolean; disabled
# ---------- py3_3: Python ----------
#locate class file in the same folder
from compas_rhino import unload_modules
import sys
import os

#get current file path
path = ghenv.Component.OnPingDocument().FilePath
#get parent directory of the parent directory
parentdir = os.path.dirname(path)
#get src folder which contains classes
dire = os.path.join(parentdir,'scripts')
sys.path.append(dire)

# import Line_model_v3
unload_modules('Line_model_v4')
# ---------- end py3_3 ----------

# ----
# * Using rhino.geometry
py3_4 = Python3Script()  # -> out, v_list_out, intersects, pts; inputs brep: Brep; disabled
# ---------- py3_4: Python ----------
#locate class file in the same folder
from compas_rhino import unload_modules
import sys
import os

#get current file path
path = ghenv.Component.OnPingDocument().FilePath
#get parent directory of the parent directory
parentdir = os.path.dirname(path)
#get src folder which contains classes
dire = os.path.join(parentdir,'scripts')
sys.path.append(dire)

import Line_model_v3
unload_modules('Line_model_v3')

##########------------Imports------------###########
import Rhino.Geometry as rg
from compas_rhino.conversions import point_to_rhino, point_to_compas
from compas.geometry import Line

#######------Conversions-------########
pts_rh = [point_to_rhino(p) for p in v_list.roof_points]
#########------Main Code------###############

intersects = rg.Intersect.Intersection.ProjectPointsToBreps(
    [brep],
    pts_rh,
    rg.Vector3d(0, 0, -1),
    1e-6
)


for idx, inter_p in enumerate(intersects):
    inter_p = point_to_compas(inter_p)
    v_list[idx].z = inter_p.z
    v_list.default_z[idx] = inter_p.z
print (len(intersects))

#########----------Output data----------##############
v_list_out = v_list

pts = v_list.vertices
print (len(pts))
# ---------- end py3_4 ----------

# ----
# B. Set height
py3_5 = Python3Script(v_list=py3.v_list_out, height_list=merge)  # -> out, v_list_out, vertices_out; inputs height_list: list of Double
# ---------- py3_5: Python ----------
#locate class file in the same folder
from compas_rhino import unload_modules
import sys
import os

#get current file path
path = ghenv.Component.OnPingDocument().FilePath
#get parent directory of the parent directory
parentdir = os.path.dirname(path)
#get src folder which contains classes
dire = os.path.join(parentdir,'scripts')
sys.path.append(dire)

unload_modules('Line_model_v5')
##########------------Imports------------###########


#######------Conversions-------########


#########------Main Code------###############
v_list.reset_default()
v_list.set_default_height(height_list)

#########----------Output data----------##############
v_list_out = v_list
vertices_out = [v_list[idx] if idx not in v_list.skip_indices else None for idx in range(len(v_list))]
#########---------Print----------------###########
print ("vertex_length:", len(v_list))
print ("pairs_length:", len(v_list.pairs))

print ("level_set:", set(pair.level for pair in v_list.pairs))
print ("cross_section_set:", set(pair.cross_section for pair in v_list.pairs))
print ("categories_set:", set(str(pair.categories) for pair in v_list.pairs))
# ---------- end py3_5 ----------
py3_6 = Python3Script(v_list=py3_2.v_list_out, height_list=merge_2)  # -> out, v_list_out; inputs height_list: list of Double
# ---------- py3_6: Python ----------
#locate class file in the same folder
from compas_rhino import unload_modules
import sys
import os

#get current file path
path = ghenv.Component.OnPingDocument().FilePath
#get parent directory of the parent directory
parentdir = os.path.dirname(path)
#get src folder which contains classes
dire = os.path.join(parentdir,'scripts')
sys.path.append(dire)

unload_modules('Line_model_v5')
##########------------Imports------------###########


#######------Conversions-------########


#########------Main Code------###############
v_list.reset_default()
v_list.set_default_height(height_list)

#########----------Output data----------##############
v_list_out = v_list

#########---------Print----------------###########
print ("vertex_length:", len(v_list))
print ("pairs_length:", len(v_list.pairs))

print ("level_set:", set(pair.level for pair in v_list.pairs))
print ("cross_section_set:", set(pair.cross_section for pair in v_list.pairs))
print ("categories_set:", set(str(pair.categories) for pair in v_list.pairs))
# ---------- end py3_6 ----------

draw = COMPASDraw()  # -> rg
#   port cg: The COMPAS geometry or datastructure to be drawn.
#   port rg: The Rhino geometry object.
# ---------- draw: Python ----------
# r: compas>=2.14.1
"""
Draws COMPAS geometry in Grasshopper.
"""

from typing import Any

import Grasshopper

from compas.scene import SceneObject


class CompasToRhinoGeometry(Grasshopper.Kernel.GH_ScriptInstance):
    def RunScript(self, cg):
        if not cg:
            return None

        return SceneObject(item=cg).draw()
# ---------- end draw ----------

# ----
# C. Add vertices and pairs
number_slider = Slider(0.1, range=0..1)
toggle_2 = BooleanToggle(True)
py3_7 = Python3Script(v_list=py3_5.v_list_out, compute=toggle_2, t=number_slider)  # -> out, v_list_out, my_planes, vertices_out, new_beams; inputs compute: Boolean, t: Double
# ---------- py3_7: Python ----------
#locate class file in the same folder
from compas_rhino import unload_modules
import sys
import os

#get current file path
path = ghenv.Component.OnPingDocument().FilePath
#get parent directory of the parent directory
parentdir = os.path.dirname(path)
#get src folder which contains classes
dire = os.path.join(parentdir,'scripts')
sys.path.append(dire)

unload_modules('Line_model_v5')
unload_modules('Structs_v2')

##########------------Imports------------###########
from Line_model_v5 import BeamList
from Structs_v2 import Pair, BeamCategory, CrossSection
from compas.geometry import Plane, Line, intersection_segment_plane, Point, Vector
import math


#######------Conversions-------########


#########------Main Code------###############
v_list.reset_default()
v_list.skip(83)


if compute:

    # -------------------------
    # 1. Add vertices (midpoints)
    # -------------------------
    midpoint_pairs = [
        (74, 78), (74, 75), (75, 79), (79, 78),
        (76, 80), (81, 80), (77, 81), (77, 76),
        (41, 47), (46, 52)
    ]

    new_vertices = [
        Line(v_list[a], v_list[b]).midpoint
        for a, b in midpoint_pairs
    ]

    v_list.reset_default()
    v_list.add_vertices(new_vertices)

    # -------------------------
    # 2. Helper to add pairs
    # -------------------------
    def add_pairs(pairs, category):
        for p in pairs:
            p.categories.append(category)
        v_list.add_pairs(pairs)

    # -------------------------
    # 3. Define pair groups
    # -------------------------
    lvl_3_pairs = [
        Pair(87, 82, 3), Pair(86, 82, 3), Pair(85, 82, 3), Pair(88, 82, 3),
        Pair(89, 84, 3), Pair(90, 84, 3), Pair(92, 84, 3), Pair(91, 84, 3)
    ]

    lvl_2_pairs = [
        Pair(62, 92, 2), Pair(66, 89, 2), Pair(72, 90, 2), Pair(68, 91, 2),
        Pair(67, 92, 2), Pair(67, 90, 2), Pair(67, 91, 2), Pair(67, 89, 2),
        Pair(60, 86, 2), Pair(64, 85, 2), Pair(70, 88, 2), Pair(66, 87, 2),
        Pair(65, 86, 2), Pair(65, 88, 2), Pair(65, 85, 2), Pair(65, 87, 2)
    ]

    bracing = [
        Pair(61, 89, 2), Pair(62, 89, 2), Pair(71, 89, 2), Pair(72, 89, 2),
        Pair(61, 87, 2), Pair(71, 87, 2), Pair(60, 87, 2), Pair(70, 87, 2)
    ]

    lvl_1_pairs = [Pair(94, 68, 1), Pair(93, 64, 1)]
    lvl_0_pairs = [Pair(20, 94, 0), Pair(19, 94, 0), Pair(14, 93, 0), Pair(15, 93, 0)]

    # -------------------------
    # 4. Add pairs (batched)
    # -------------------------
    add_pairs(lvl_3_pairs, BeamCategory.SINGLE)
    add_pairs(lvl_2_pairs, BeamCategory.SINGLE)
    add_pairs(bracing, BeamCategory.BRACING)
    add_pairs(lvl_1_pairs, BeamCategory.SINGLE)
    add_pairs(lvl_0_pairs, BeamCategory.SINGLE)

    # -------------------------
    # 5. Skip vertices
    # -------------------------
    v_list.skip([75, 76, 80, 79])

     # -------------------------
    # 6. Intersections (optimized)
    # -------------------------
    z_thresh = v_list[82].z + 4.2

    x_lines = [
        Line(v_list[i], v_list[j])
        for i, j in v_list.pairs
        if v_list[i].z < z_thresh and v_list[j].z < z_thresh
    ]

    u = v_list[5] - v_list[13]
    v = v_list[27] - v_list[33]

    # Precompute lines
    base_lines = [
        Line(v_list[85], v_list[82]),
        Line(v_list[87], v_list[82]),
        Line(v_list[89], v_list[84]),
        Line(v_list[91], v_list[84]),
    ]

    pl_points = [
        base_lines[0].point_at(t),
        base_lines[1].midpoint,
        base_lines[2].midpoint,
        base_lines[3].point_at(t),
    ]

    my_planes = [
        plane
        for pt in pl_points
        for plane in (
            Plane(pt, u).rotated(math.pi/2, axis=[0,0,1], point=pt),
            Plane(pt, v).rotated(-math.pi/2, axis=[0,0,1], point=pt),
        )
    ]

    # Batch intersection results
    new_pts = []
    for ln in x_lines:
        for pl in my_planes:
            b = intersection_segment_plane(ln, pl)
            if b:
                new_pts.append(Point(*b))

    if new_pts:
        v_list.add_vertices(new_pts)

    # -------------------------
    # 7. Cleanup
    # -------------------------
    v_list.skip([100, 113, 103, 102, 106, 111, 109, 107])

    # -------------------------
    # 8. Bracing beams
    # -------------------------
    bracing_pairs = [
        Pair(104, 96, 3), Pair(104, 95, 3), Pair(101, 95, 3),
        Pair(105, 96, 3), Pair(101, 99, 3), Pair(105, 99, 3),
        Pair(114, 97, 3), Pair(114, 98, 3), Pair(112, 97, 3),
        Pair(110, 98, 3), Pair(112, 108, 3), Pair(108, 110, 3)
    ]
    add_pairs(bracing_pairs, BeamCategory.BRACING)

    # -------------------------
    # 9. Delete pairs (batch)
    # -------------------------
    delete_list = [
        (74, 82), (85, 82), (78, 82), (88, 82), (87, 82), (86, 82),
        (89, 84), (90, 84), (81, 84), (91, 84), (77, 84), (92, 84)
    ]
    for p in delete_list:
        v_list.delete_pairs(p)

    # -------------------------
    # 10. Join pairs
    # -------------------------
    join_pairs = [
        Pair(74, 95, 3), Pair(95, 82, 3), Pair(85, 104, 3), Pair(104, 82, 3),
        Pair(78, 96, 3), Pair(96, 82, 3), Pair(88, 105, 3), Pair(105, 82, 3),
        Pair(87, 99, 3), Pair(99, 82, 3), Pair(86, 101, 3), Pair(101, 82, 3),

        Pair(89, 108, 3), Pair(108, 84, 3), Pair(90, 110, 3), Pair(110, 84, 3),
        Pair(81, 98, 3), Pair(98, 84, 3), Pair(91, 114, 3), Pair(114, 84, 3),
        Pair(77, 97, 3), Pair(97, 84, 3), Pair(92, 112, 3), Pair(112, 84, 3),
    ]

    for p in join_pairs:
        p.categories.append(BeamCategory.SPLIT)

    add_pairs(join_pairs, BeamCategory.SINGLE)

    # -------------------------
    # 11. Move points
    # -------------------------
    v_list.move([87, 89, 71, 66, 61, 99, 108], Vector(0, 0, .6))



#########----------Output data----------##############
v_list_out = v_list
vertices_out = [v_list[idx] if idx not in v_list.skip_indices else None for idx in range(len(v_list))]
new_beams = [
    Line(v_list[a], v_list[b])
    for a, b in bracing_pairs
]

#########---------Print----------------###########
print (len(v_list))
print (len(v_list.pairs))

print ("skip_list:", v_list.skip_indices)

for pair in v_list.pairs:
    print(pair)
# ---------- end py3_7 ----------
py3_8 = Python3Script(v_list=py3_6.v_list_out, compute=toggle_2, t=number_slider)  # -> out, v_list_out, my_planes; inputs compute: Boolean, t: Double
# ---------- py3_8: Python ----------
#locate class file in the same folder
from compas_rhino import unload_modules
import sys
import os

#get current file path
path = ghenv.Component.OnPingDocument().FilePath
#get parent directory of the parent directory
parentdir = os.path.dirname(path)
#get src folder which contains classes
dire = os.path.join(parentdir,'scripts')
sys.path.append(dire)

unload_modules('Line_model_v5')
unload_modules('Structs_v2')

##########------------Imports------------###########
from Structs_v2 import Pair, BeamCategory, CrossSection
from compas.geometry import Plane, Line, intersection_segment_plane, Point, Vector
import math


#######------Conversions-------########


#########------Main Code------###############
v_list.reset_default()
v_list.skip(83)


if compute:

    lvls = [0, 1, ]
    # -------------------------
    # 1. Add vertices (midpoints)
    # -------------------------
    midpoint_pairs = [
        (74, 78), (74, 75), (75, 79), (79, 78),
        (76, 80), (81, 80), (77, 81), (77, 76),
        (41, 47), (46, 52)
    ]

    new_vertices = [
        Line(v_list[a], v_list[b]).midpoint
        for a, b in midpoint_pairs
    ]

    v_list.reset_default()
    v_list.add_vertices(new_vertices)

    # print( v_list[87].name)
    # group = {}
    # for lvl in lvls:
    #     for pair in pairs:
    #         group.setdefault(lvl, []).append(pair)


    # -------------------------
    # 2. Helper to add pairs
    # -------------------------
    def add_pairs(pairs, category):
        for p in pairs:
            p.categories.append(category)
        v_list.add_pairs(pairs)

    # -------------------------
    # 3. Define pair groups
    # -------------------------
    lvl_3_pairs = [
        Pair(87, 82, 3), Pair(86, 82, 3), Pair(85, 82, 3), Pair(88, 82, 3),
        Pair(89, 84, 3), Pair(90, 84, 3), Pair(92, 84, 3), Pair(91, 84, 3)
    ]

    lvl_2_pairs = [
        Pair(62, 92, 2), Pair(66, 89, 2), Pair(72, 90, 2), Pair(68, 91, 2),
        Pair(67, 92, 2), Pair(67, 90, 2), Pair(67, 91, 2), Pair(67, 89, 2),
        Pair(60, 86, 2), Pair(64, 85, 2), Pair(70, 88, 2), Pair(66, 87, 2),
        Pair(65, 86, 2), Pair(65, 88, 2), Pair(65, 85, 2), Pair(65, 87, 2)
    ]

    bracing = [
        Pair(61, 89, 2), Pair(62, 89, 2), Pair(71, 89, 2), Pair(72, 89, 2),
        Pair(61, 87, 2), Pair(71, 87, 2), Pair(60, 87, 2), Pair(70, 87, 2)
    ]

    lvl_1_pairs = [Pair(94, 68, 1), Pair(93, 64, 1)]
    lvl_0_pairs = [Pair(20, 94, 0), Pair(19, 94, 0), Pair(14, 93, 0), Pair(15, 93, 0)]

    # -------------------------
    # 4. Add pairs (batched)
    # -------------------------
    add_pairs(lvl_3_pairs, BeamCategory.SINGLE)
    add_pairs(lvl_2_pairs, BeamCategory.SINGLE)
    add_pairs(bracing, BeamCategory.BRACING)
    add_pairs(lvl_1_pairs, BeamCategory.SINGLE)
    add_pairs(lvl_0_pairs, BeamCategory.SINGLE)

    # -------------------------
    # 5. Skip vertices
    # -------------------------
    v_list.skip([75, 76, 80, 79])

    # print(v_list[46].name.split('_')[1])

     # -------------------------
    # 6. Intersections (optimized)
    # -------------------------
    z_thresh = v_list[82].z + 3.2

    x_lines = [
        Line(v_list[i], v_list[j])
        for i, j in v_list.pairs
        if v_list[i].z < z_thresh and v_list[j].z < z_thresh
    ]

    u = v_list[5] - v_list[13]
    v = v_list[27] - v_list[33]

    # Precompute lines
    base_lines = [
        Line(v_list[85], v_list[82]),
        Line(v_list[87], v_list[82]),
        Line(v_list[89], v_list[84]),
        Line(v_list[91], v_list[84]),
    ]

    pl_points = [
        base_lines[0].point_at(t),
        base_lines[1].midpoint,
        base_lines[2].midpoint,
        base_lines[3].point_at(t),
    ]

    my_planes = [
        plane
        for pt in pl_points
        for plane in (
            Plane(pt, u).rotated(math.pi/2, axis=[0,0,1], point=pt),
            Plane(pt, v).rotated(-math.pi/2, axis=[0,0,1], point=pt),
        )
    ]

    # Batch intersection results
    new_pts = []
    for ln in x_lines:
        for pl in my_planes:
            b = intersection_segment_plane(ln, pl)
            if b:
                new_pts.append(Point(*b))

    if new_pts:
        v_list.add_vertices(new_pts)

    # -------------------------
    # 7. Cleanup
    # -------------------------
    v_list.skip([100, 113, 103, 102, 106, 111, 109, 107])

    # -------------------------
    # 8. Bracing beams
    # -------------------------
    bracing_pairs = [
        Pair(104, 96, 3), Pair(104, 95, 3), Pair(101, 95, 3),
        Pair(105, 96, 3), Pair(101, 99, 3), Pair(105, 99, 3),
        Pair(114, 97, 3), Pair(114, 98, 3), Pair(112, 97, 3),
        Pair(110, 98, 3), Pair(112, 108, 3), Pair(108, 110, 3)
    ]
    add_pairs(bracing_pairs, BeamCategory.BRACING)

    # -------------------------
    # 9. Delete pairs (batch)
    # -------------------------
    delete_list = [
        (74, 82), (85, 82), (78, 82), (88, 82), (87, 82), (86, 82),
        (89, 84), (90, 84), (81, 84), (91, 84), (77, 84), (92, 84)
    ]
    for p in delete_list:
        v_list.delete_pairs(p)

    # -------------------------
    # 10. Join pairs
    # -------------------------
    join_pairs = [
        Pair(74, 95, 3), Pair(95, 82, 3), Pair(85, 104, 3), Pair(104, 82, 3),
        Pair(78, 96, 3), Pair(96, 82, 3), Pair(88, 105, 3), Pair(105, 82, 3),
        Pair(87, 99, 3), Pair(99, 82, 3), Pair(86, 101, 3), Pair(101, 82, 3),

        Pair(89, 108, 3), Pair(108, 84, 3), Pair(90, 110, 3), Pair(110, 84, 3),
        Pair(81, 98, 3), Pair(98, 84, 3), Pair(91, 114, 3), Pair(114, 84, 3),
        Pair(77, 97, 3), Pair(97, 84, 3), Pair(92, 112, 3), Pair(112, 84, 3),
    ]

    for p in join_pairs:
        p.categories.append(BeamCategory.SPLIT)

    add_pairs(join_pairs, BeamCategory.SINGLE)

    # -------------------------
    # 11. Move points
    # -------------------------
    v_list.move([87, 89, 71, 66, 61, 99, 108], Vector(0, 0, .6))



#########----------Output data----------##############
v_list_out = v_list

#########---------Print----------------###########
print (len(v_list))
print (len(v_list.pairs))

print ("skip_list:", v_list.skip_indices)

for pair in v_list.pairs:
    print(pair)
# ---------- end py3_8 ----------

py3_9 = Python3Script(v_list=py3_7.v_list_out)  # -> out, lines_out, vertices_out
# ---------- py3_9: Python ----------
#locate class file in the same folder
from compas_rhino import unload_modules
import sys
import os

#get current file path
path = ghenv.Component.OnPingDocument().FilePath
#get parent directory of the parent directory
parentdir = os.path.dirname(path)
#get src folder which contains classes
dire = os.path.join(parentdir,'scripts')
sys.path.append(dire)

unload_modules('Line_model_v5')

##########------------Imports------------###########
from Line_model_v5 import BeamList



#######------Conversions-------########

#########------Main Code------###############

# 1. Construct beams
b_list = BeamList(v_list)
b_list.set_default_beams()
v_list = b_list.v_list

#########----------Output data----------##############
b_list_out = b_list

vertices_out = [v_list[idx] if idx not in v_list.skip_indices else None for idx in range(len(v_list))]
lines_out = b_list.axises
# ---------- end py3_9 ----------
py3_10 = Python3Script(v_list=py3_8.v_list_out)  # -> out, lines_out, vertices_out; same code as py3_9
draw_2 = COMPASDraw(cg=py3_10.lines_out)  # -> rg; same code as draw
draw_3 = COMPASDraw(cg=py3_9.lines_out)  # -> rg; same code as draw
draw_4 = COMPASDraw(cg=py3_7.vertices_out)  # -> rg; same code as draw
points = PointList(Points=draw_4, Size=Slider(0.5, range=0..1))
line_prev = TTLineweightPreview(
    Geometry=draw,
    StrokeColor=ColourSwatch(SwatchColor=RGB(0, 60, 255)),
    StrokeWeight=Slider(10, range=0..10),
    Absolute=False)

# ----
# Util: Valency_map
number_slider_2 = Slider(1, range=0..13)
py3_11 = Python3Script(valency=number_slider_2)  # -> out, line_groups, spheres, message; inputs valency: Int32
# ---------- py3_11: Python ----------
#locate class file in the same folder
from compas_rhino import unload_modules
import sys
import os

#get current file path
path = ghenv.Component.OnPingDocument().FilePath
#get parent directory of the parent directory
parentdir = os.path.dirname(path)
#get src folder which contains classes
dire = os.path.join(parentdir,'scripts')
sys.path.append(dire)

unload_modules('Line_model_v5')

##########------------Imports------------###########
from compas.geometry import Line
from compas_rhino.conversions import line_to_rhino, point_to_rhino
import Rhino.Geometry as rg

from Grasshopper import DataTree
from Grasshopper.Kernel.Data import GH_Path

#######------Conversions-------########


#########------Main Code------###############
topology = v_list.topology
print ('T:', topology)
print()

valency_map = v_list.valency_map
print ('V:', valency_map)
print ()

try:
    groups = v_list.group_by_valency(valency)
    print ('G:', groups)

    spheres = []
    line_groups = DataTree[object]()

    for parent, children in groups.items():
        for c in children:
            line = Line(v_list[parent], v_list[c])
            line = line_to_rhino(line)
            line_groups.Add(line, GH_Path(parent))

        sphere = rg.Sphere(point_to_rhino(v_list[parent]), 0.3)
        spheres.append(sphere)
    message = 'Time to work!'

except ValueError as e:
    error_msg = "Warning: " + str(e)
    message = error_msg



#########----------Output data----------##############


#########---------Print----------------###########
# ---------- end py3_11 ----------
panel_2 = Panel(py3_11.message)
viewer = ParamViewer(py3_11.line_groups)

# ----
# D. Construct beams
py3_12 = Python3Script(v_list=py3_7.v_list_out)  # -> out, b_list_out
# ---------- py3_12: Python ----------
#locate class file in the same folder
from compas_rhino import unload_modules
import sys
import os

#get current file path
path = ghenv.Component.OnPingDocument().FilePath
#get parent directory of the parent directory
parentdir = os.path.dirname(path)
#get src folder which contains classes
dire = os.path.join(parentdir,'scripts')
sys.path.append(dire)

unload_modules('Line_model_v5')

##########------------Imports------------###########
from Line_model_v5 import BeamList



#######------Conversions-------########

#########------Main Code------###############

# 1. Construct beams
b_list = BeamList(v_list)
b_list.set_default_beams()


#########----------Output data----------##############
b_list_out = b_list

#########---------Print----------------###########
print ("beam_length:", len(b_list))
print ("b_pairs_length:", len(b_list.pairs))
print ()
print ("vertex_length:", len(v_list))
print ("pairs_length:", len(v_list.pairs))

print ("level_set:", set(pair.level for pair in v_list.pairs))
print ("cross_section_set:", set(pair.cross_section for pair in v_list.pairs))
print ("categories_set:", set(str(pair.categories) for pair in v_list.pairs))
# ---------- end py3_12 ----------
py3_13 = Python3Script(v_list=py3_8.v_list_out)  # -> out, b_list_out; same code as py3_12

crv = Curve([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])  # disabled
seam2crvcorn = SeamToCurveCorner(Curve=crv)  # -> Adjusted, Point, R; disabled
simplify = SimplifyCurve(Curve=seam2crvcorn.Adjusted)  # -> Curve, Simplified; disabled
brep = Brep()  # disabled
explode = Explode(Curve=simplify.Curve, Recursive=True)  # -> Segments, Vertices; disabled
project = ProjectPoint(Point=explode.Vertices, Direction=Vector(0, 0, -1), Geometry=brep)  # -> Point, Index; disabled
pline = PolyLine(Vertices=project.Point, Closed=False)  # -> flatten(Polyline); disabled
crv_2 = Curve(pline)  # disabled

# ----
# E. Modularize Structure
where_you_double_beams = Panel("""0
2
8
10
13
15
21
23
28
30
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""")
crv_3 = Curve([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])
# F. Preassign Cross Section
toggle_3 = BooleanToggle(True)
py3_14 = Python3Script(b_list=py3_12.b_list_out, polylines=crv_3, double_indices=where_you_double_beams, compute=toggle_3)  # -> out, b_list_out, lines_out, test, doubles_out; inputs polylines: list of Polyline, double_indices: list of Int32, compute: Boolean
# ---------- py3_14: Python ----------
#locate class file in the same folder
from compas_rhino import unload_modules
import sys
import os

#get current file path
path = ghenv.Component.OnPingDocument().FilePath
#get parent directory of the parent directory
parentdir = os.path.dirname(path)
#get src folder which contains classes
dire = os.path.join(parentdir,'scripts')
sys.path.append(dire)

unload_modules('Line_model_v5')
unload_modules('Structs_v2')

##########------------Imports------------###########
from Line_model_v5 import BeamList
from Structs_v2 import Pair, BeamCategory, CrossSection
from compas_rhino.conversions import polyline_to_compas

from Grasshopper import DataTree
from Grasshopper.Kernel.Data import GH_Path


#######------Conversions-------########
polylines = [polyline_to_compas(p) for p in polylines]


#########------Main Code------###############
if compute:
    b_list.double(double_indices)

tol = 1e-3
group_lvl = b_list.group_by_levels(level_list=[2, 1, 1], tol=tol)

print (group_lvl)

indices_top = []
lines_out = DataTree[object]()

for module_idx, beam_indices in group_lvl.items():
    path = GH_Path(module_idx)
    for idx in beam_indices:
        if module_idx == 0:
            indices_top.append(idx)
        lines_out.Add(b_list[idx].axis, path)

# print (indices_top)

# b_list.group_by_module(polylines, tol=tol, optional_indices=indices_top)
g = b_list.group_by_module(polylines, tol=tol)
print (g)

# test = DataTree[object]()
# print (b_list.group)
# for panel_idx, beam_indices in b_list.group.items():
#     path = GH_Path(panel_idx)
#     for b_idx in beam_indices:
#         test.Add(b_list[b_idx].axis, path)



#########----------Output data----------##############
b_list_out = b_list
doubles_out = []
for beam in b_list:
    if beam is None: 
        continue
    if BeamCategory.DOUBLE in beam.categories: 
        doubles_out.append(beam.axis)
    # if failed:
    #     try str(BeamCategory.DOUBLE)


#########---------Print----------------###########
print ("beam_length:", len(b_list))
print ("b_pairs_length:", len(b_list.pairs))
print ("vertex_length:", len(b_list.v_list))
print ()

print ("level_set:", set(pair.level for pair in b_list.pairs))
print ("cross_section_set:", set(pair.cross_section for pair in b_list.pairs))
print ("categories_set:", set(str(pair.categories) for pair in b_list.pairs))
# ---------- end py3_14 ----------
py3_15 = Python3Script(b_list=py3_13.b_list_out, polylines=crv_3, double_indices=where_you_double_beams, compute=toggle_3)  # -> out, b_list_out, lines_out, test; inputs polylines: list of Polyline, double_indices: list of Int32, compute: Boolean
# ---------- py3_15: Python ----------
#locate class file in the same folder
from compas_rhino import unload_modules
import sys
import os

#get current file path
path = ghenv.Component.OnPingDocument().FilePath
#get parent directory of the parent directory
parentdir = os.path.dirname(path)
#get src folder which contains classes
dire = os.path.join(parentdir,'scripts')
sys.path.append(dire)

unload_modules('Line_model_v5')
unload_modules('Structs_v2')

##########------------Imports------------###########
from Line_model_v5 import BeamList
from Structs_v2 import Pair, BeamCategory, CrossSection
from compas_rhino.conversions import polyline_to_compas

from Grasshopper import DataTree
from Grasshopper.Kernel.Data import GH_Path


#######------Conversions-------########
polylines = [polyline_to_compas(p) for p in polylines]


#########------Main Code------###############
if compute:
    # for b in b_list:
    #     if b is not None:
    #         b.cross_section  = CrossSection.L
    #         b.pair.cross_section = CrossSection.L

    b_list.double(double_indices)

tol = 1e-3
group_lvl = b_list.group_by_levels(level_list=[2, 1, 1], tol=tol)

print (group_lvl)

indices_top = []
lines_out = DataTree[object]()

for module_idx, beam_indices in group_lvl.items():
    path = GH_Path(module_idx)
    for idx in beam_indices:
        if module_idx == 0:
            indices_top.append(idx)
        lines_out.Add(b_list[idx].axis, path)

# print (indices_top)

# b_list.group_by_module(polylines, tol=tol, optional_indices=indices_top)
g = b_list.group_by_module(polylines, tol=tol)
print (g)

# test = DataTree[object]()
# print (b_list.group)
# for panel_idx, beam_indices in b_list.group.items():
#     path = GH_Path(panel_idx)
#     for b_idx in beam_indices:
#         test.Add(b_list[b_idx].axis, path)



#########----------Output data----------##############
b_list_out = b_list


#########---------Print----------------###########
print ("beam_length:", len(b_list))
print ("b_pairs_length:", len(b_list.pairs))
print ("vertex_length:", len(b_list.v_list))
print ()

print ("level_set:", set(pair.level for pair in b_list.pairs))
print ("cross_section_set:", set(pair.cross_section for pair in b_list.pairs))
print ("categories_set:", set(str(pair.categories) for pair in b_list.pairs))
# ---------- end py3_15 ----------

# ----
# Util: Modularization
number_slider_3 = Slider(17, range=0..50)
data = Data([py3_14.b_list_out, py3_15.b_list_out])
py3_16 = Python3Script(b_lists=data, module_index=number_slider_3, isolate=Toggle(False), explode=Slider(0, range=0..1))  # -> out, lines_group, panels, panel_indices; inputs b_lists: list, module_index: Int32, isolate: Boolean, explode: Double
# ---------- py3_16: Python ----------
##########------------Imports------------###########
from compas.geometry import Polygon, Plane, Line, Point

from Grasshopper import DataTree
from Grasshopper.Kernel.Data import GH_Path


#######------Conversions-------########

#########-------Helpers-------########
def average_points(points):
    if not points:
        return None
    x = sum(point.x for point in points) / len(points)
    y = sum(point.y for point in points) / len(points)
    z = sum(point.z for point in points) / len(points)

    return Point(x, y, z)

#########------Main Code------###############
ps = b_lists[0].clt_panels

if explode:
    centroids = [average_points(list(p[:-1])) for p in ps]
    center = average_points(centroids)
    vec = [c - center for c in centroids]


lines_group = DataTree[object]()
panels = DataTree[object]()
panel_indices = DataTree[int]()

for b_list in b_lists:
    for panel_idx, beam_indices in b_list.group.items():
        path = GH_Path(panel_idx)

        # print (panel_idx, beam_indices)

        for b_idx in beam_indices:
            beam = b_list[b_idx]
            if beam is None:
                continue
            line = beam.axis

            if isolate and panel_idx == module_index:
                lines_group.Add(line, path)
            elif not isolate:
                if explode:
                    line = line.translated(vec[panel_idx] * explode)
                lines_group.Add(line, path)

#########----------Output data----------##############

for i, panel in enumerate(ps):
    path = GH_Path(i)

    if isolate and i == module_index:
        panels.Add(panel, path)
        panel_indices.Add(i, path)
        break

    elif not isolate:
        if explode:
            panel = panel.translated(vec[i] * explode)
        panels.Add(panel, path)
        panel_indices.Add(i, path)
# ---------- end py3_16 ----------
draw_5 = COMPASDraw(cg=py3_16.lines_group)  # -> rg; same code as draw
draw_6 = COMPASDraw(cg=py3_16.panels)  # -> rg; same code as draw
area = Area(Geometry=draw_6)
viewer_2 = ParamViewer(draw_5)
boundary = BoundarySurfaces(Edges=draw_6)
tag = TextTag(Location=area, Text=py3_16.panel_indices)
line_prev_2 = TTLineweightPreview(Geometry=draw_5, StrokeWeight=Slider(4.6, range=0..10), Absolute=False)

toggle_4 = BooleanToggle(True)  # disabled
py3_17 = Python3Script(b_list=py3_14.b_list_out)  # -> out, b_list_out, port, vertices_out, lines_out, ws, hs, facade_points, roof_points, support_points; disabled
# ---------- py3_17: Python ----------
#locate class file in the same folder
from compas_rhino import unload_modules
import sys
import os

#get current file path
path = ghenv.Component.OnPingDocument().FilePath
#get parent directory of the parent directory
parentdir = os.path.dirname(path)
#get src folder which contains classes
dire = os.path.join(parentdir,'scripts')
sys.path.append(dire)

unload_modules('Line_model_v4')


##########------------Imports------------###########
from Line_model_v4 import BeamList



#######------Conversions-------########

#########------Main Code------###############
v_list = b_list.v_list



#########----------Output data----------##############
b_list_out = b_list


vertices_out = [v_list[idx] if idx not in v_list.skip_indices else None for idx in range(len(v_list))]
lines_out = b_list.axises

ws = [b.width if b is not None else None for b in b_list]
hs = [b.height if b is not None else None for b in b_list]

facade_points = v_list.facade_points
roof_points = v_list.roof_points
support_points = v_list.support_points



#########---------Print----------------###########
print (len(v_list))
# ---------- end py3_17 ----------
panel_3 = Panel("""1. join_beam
2. group by levels""")
py3_18 = Python3Script(b_list=py3_13.b_list_out, compute=toggle_4)  # -> out, b_list_out, lines_out, test; inputs compute: Boolean; disabled
# ---------- py3_18: Python ----------
#locate class file in the same folder
from compas_rhino import unload_modules
import sys
import os

#get current file path
path = ghenv.Component.OnPingDocument().FilePath
#get parent directory of the parent directory
parentdir = os.path.dirname(path)
#get src folder which contains classes
dire = os.path.join(parentdir,'scripts')
sys.path.append(dire)

unload_modules('Line_model_v5')
unload_modules('Structs_v2')

##########------------Imports------------###########
from Structs_v2 import BeamCategory, CrossSection
from compas_rhino.conversions import polyline_to_compas

from Grasshopper import DataTree
from Grasshopper.Kernel.Data import GH_Path


#######------Conversions-------########


#########------Main Code------###############
if compute:
    for beam in b_list:
        if beam is None:
            continue
        
        # Preassign cross section by categories and level
        if BeamCategory.CLT_ATTACHED in beam.categories:
            beam.cross_section = CrossSection.W80H120
            # beam.pair.cross_section = CrossSection.W80H120
            
        elif [BeamCategory.SINGLE] == beam.categories:
            beam.cross_section = CrossSection.W120H240

        elif BeamCategory.DOUBLE in beam.categories:
            if beam.level in [0, 1]:
                beam.cross_section = CrossSection.W80H200
            elif beam.level == 2:
                beam.cross_section = CrossSection.W80H240
            elif beam.level == 3:
                beam.cross_section = CrossSection.W80H280





#########----------Output data----------##############
b_list_out = b_list


#########---------Print----------------###########
print ("beam_length:", len(b_list))
print ("b_pairs_length:", len(b_list.pairs))
print ("vertex_length:", len(b_list.v_list))
print ()

print ("level_set:", set(pair.level for pair in b_list.pairs))
print ("p_cross_section_set:", set(pair.cross_section for pair in b_list.pairs))
print ("b_cross_section_set:", set(beam.cross_section for beam in b_list if beam is not None))
print ("categories_set:", set(str(pair.categories) for pair in b_list.pairs))


for beam in b_list:
    if beam is not None:
        print(beam.pair)
# ---------- end py3_18 ----------
clean = CleanTree(RemoveNulls=True, RemoveInvalid=True, RemoveEmpty=False, Tree=py3_17.lines_out)  # disabled
clean_2 = CleanTree(RemoveNulls=True, RemoveInvalid=True, RemoveEmpty=False, Tree=py3_17.ws)  # disabled
clean_3 = CleanTree(RemoveNulls=True, RemoveInvalid=True, RemoveEmpty=False, Tree=py3_17.hs)  # disabled
multiplication = Multiplication(A=clean_3, _0001=0.001)  # disabled
multiplication_2 = Multiplication(A=clean_2, _0001=0.001)  # disabled
draw_7 = COMPASDraw(cg=clean)  # -> rg; disabled; same code as draw
wires = BrepWireframe(Brep=boundary, Density=-1)
py3_19 = Python3Script(b_list=py3_12.b_list_out, angle=Slider(5, range=0..20), compute=toggle_3)  # -> out, b_list_out, lines_out, test, lines; inputs angle: Double, compute: Boolean
# ---------- py3_19: Python ----------
#locate class file in the same folder
from compas_rhino import unload_modules
import sys
import os

#get current file path
path = ghenv.Component.OnPingDocument().FilePath
#get parent directory of the parent directory
parentdir = os.path.dirname(path)
#get src folder which contains classes
dire = os.path.join(parentdir,'scripts')
sys.path.append(dire)

unload_modules('Line_model_v4')
unload_modules('Structs_v1')

##########------------Imports------------###########
from Line_model_v4 import BeamList
from Structs_v1 import Pair, BeamCategory, CrossSection
from compas_rhino.conversions import polyline_to_compas

from Grasshopper import DataTree
from Grasshopper.Kernel.Data import GH_Path


#######------Conversions-------########


#########------Main Code------###############
if compute:
    pts = b_list.rotate_xy(angle)

    print (pts)


#########----------Output data----------##############
b_list_out = b_list

lines_out = DataTree[object]()
test = DataTree[object]()

for b in b_list:
    if b is None:
        continue


    if BeamCategory.SINGLE in b.categories:
        test.Add(b.axis)
    else:
        lines_out.Add(b.axis)

lines = DataTree[object]()

from compas.geometry import Line
for (start, end) in pts:
    line = Line(start, end)
    lines.Add(line)
#########---------Print----------------###########
# print (len(b_list))
# print (len(b_list.v_list))
# print (len(b_list.v_list.pairs))
# print (len(b_list.axises))

# for b in b_list:
#     if b is None:
#         continue
#     print (b.categories)
# ---------- end py3_19 ----------
beam = CTBeam(centerline=draw_7, width=multiplication_2, height=multiplication)  # -> Beam, Blank; inputs centerline: list, z_vector: list of Vector3d, width: list of Double, height: list of Double, category: list of String, updateRefObj: Boolean; disabled
#   port centerline: Referenced curve or line, Guid of curve or line in the active Rhino document.
#   port z_vector: Vector defining the orientation of the cross-section (corresponds to the height dimension). If None, a default will be taken.
#   port width: Width of the cross-section (usually the smaller dimension).
#   port height: Height of the cross-section (usually the larger dimension).
#   port category: Category of a beam.
#   port updateRefObj: (optional) If True, the attributes in the referenced object will be updated/overwritten with the new values given here.
#   port Beam: Beam object(s).
#   port Blank: Shape of the beam's blank.
# ---------- beam: Python ----------
# r: compas_timber>=1.0.2
"""Creates a Beam from a LineCurve."""

# flake8: noqa
import Grasshopper
import Rhino
import rhinoscriptsyntax as rs
import System
from compas.scene import Scene
from compas_rhino.conversions import line_to_compas
from compas_rhino.conversions import vector_to_compas

from compas_timber.elements import Beam as CTBeam
from compas_timber.ghpython.rhino_object_name_attributes import update_rhobj_attributes_name
from compas_timber.ghpython.ghcomponent_helpers import list_input_valid_cpython


class Beam_fromCurve(Grasshopper.Kernel.GH_ScriptInstance):
    def RunScript(self,
            centerline: System.Collections.Generic.List[object],
            z_vector: System.Collections.Generic.List[Rhino.Geometry.Vector3d],
            width: System.Collections.Generic.List[float],
            height: System.Collections.Generic.List[float],
            category: System.Collections.Generic.List[str],
            updateRefObj: bool):
        # minimum inputs required
        if not list_input_valid_cpython(ghenv, centerline, "Centerline"):
            return
        if not width:
            length = self._get_centerline_length(centerline)
            width = [length / 20]
        if not height:
            length = self._get_centerline_length(centerline)
            height = [length / 10]

        # reformat unset parameters for consistency
        if not z_vector:
            z_vector = [None]
        if not category:
            category = [None]

        beams = []
        blanks = []
        scene = Scene()

        if centerline and height and width:
            # check list lengths for consistency
            N = len(centerline)
            if len(z_vector) not in (0, 1, N):
                ghenv.Component.AddRuntimeMessage(
                    Grasshopper.Kernel.GH_RuntimeMessageLevel.Error, " In 'ZVector' I need either none, one or the same number of inputs as the Crv parameter."
                )
            if len(width) not in (1, N):
                ghenv.Component.AddRuntimeMessage(Grasshopper.Kernel.GH_RuntimeMessageLevel.Error, " In 'W' I need either one or the same number of inputs as the Crv parameter.")
            if len(height) not in (1, N):
                ghenv.Component.AddRuntimeMessage(Grasshopper.Kernel.GH_RuntimeMessageLevel.Error, " In 'H' I need either one or the same number of inputs as the Crv parameter.")
            if len(category) not in (0, 1, N):
                ghenv.Component.AddRuntimeMessage(
                    Grasshopper.Kernel.GH_RuntimeMessageLevel.Error, " In 'Category' I need either none, one or the same number of inputs as the Crv parameter."
                )

            # duplicate data if None or single value
            if len(z_vector) != N:
                z_vector = [z_vector[0] for _ in range(N)]
            if len(width) != N:
                width = [width[0] for _ in range(N)]
            if len(height) != N:
                height = [height[0] for _ in range(N)]
            if len(category) != N:
                category = [category[0] for _ in range(N)]

            for line, z, w, h, c in zip(centerline, z_vector, width, height, category):
                guid, geometry = self._get_guid_and_geometry(line)
                rhino_line = rs.coerceline(geometry)
                line = line_to_compas(rhino_line)

                z = vector_to_compas(z) if z else None
                beam = CTBeam.from_centerline(centerline=line, width=w, height=h, z_vector=z)
                beam.attributes["rhino_guid"] = str(guid) if guid else None
                beam.attributes["category"] = c
                if updateRefObj and guid:
                    update_rhobj_attributes_name(guid, "width", str(w))
                    update_rhobj_attributes_name(guid, "height", str(h))
                    update_rhobj_attributes_name(guid, "zvector", str(list(beam.frame.zaxis)))
                    update_rhobj_attributes_name(guid, "category", c)

                beams.append(beam)
                scene.add(beam.blank)

        blanks = scene.draw()

        return beams, blanks

    def _get_guid_and_geometry(self, line):
        # internalized curves and GH geometry will not have persistent GUIDs, referenced Rhino objects will
        # type hint on the input has to be 'ghdoc' for this to work
        guid = None
        geometry = line
        rhino_obj = Rhino.RhinoDoc.ActiveDoc.Objects.FindId(line)
        if rhino_obj:
            guid = line
            geometry = rhino_obj.Geometry
        return guid, geometry

    def _get_centerline_length(self, centerline):
        centerline_length = []
        for i in centerline:
            centerline_length.append(rs.CurveLength(i))
        if centerline_length:
            length_average = sum(centerline_length) / len(centerline_length)
        else:
            length_average = 1
        return length_average
# ---------- end beam ----------
draw_8 = COMPASDraw(cg=py3_14.test)  # -> rg; same code as draw
draw_9 = COMPASDraw(cg=py3_14.lines_out)  # -> rg; same code as draw
branch = TreeBranch(Tree=draw_9, Path=Slider(1, range=0..3), MaintainPaths=True)
draw_10 = COMPASDraw(cg=py3_19.lines_out)  # -> rg; same code as draw
draw_11 = COMPASDraw(cg=py3_19.test)  # -> rg; same code as draw
draw_12 = COMPASDraw(cg=py3_19.lines)  # -> rg; same code as draw
model = CTModel(Elements=flatten(beam.Beam))  # -> Model, Geometry, DebugInfo; inputs Elements: list, Containers: list, JointRules: list, Features: list, MaxDistance: Double, CreateGeometry: Boolean; disabled
#   port Elements: Collection of Beams
#   port Containers: Container elements, such as walls, floors, roofs, etc.
#   port JointRules: Collection of joint rules.
#   port Features: Collection of feature definitions.
#   port MaxDistance: Max Distance Tolerance for topology detection.
#   port CreateGeometry: If True, Beam and joint geometry is created for visualization.
#   port Model: Model object.
#   port Geometry: Geometry of the beams and joints.
#   port DebugInfo: Debug information object in the case of feature or joining errors.
# ---------- model: Python ----------
# r: compas_timber>=1.0.2
"""Creates an Model"""

import Grasshopper
import Rhino
import System
from compas.scene import Scene
from compas.tolerance import TOL
from compas.tolerance import Tolerance

from compas_timber.design import DebugInfomation
from compas_timber.design import JointRuleSolver
from compas_timber.design import WallPopulator
from compas_timber.elements import Beam
from compas_timber.elements import Plate
from compas_timber.errors import FeatureApplicationError
from compas_timber.ghpython import error
from compas_timber.ghpython import warning
from compas_timber.model import TimberModel

# workaround for https://github.com/gramaziokohler/compas_timber/issues/280
TOL.absolute = 1e-6


class ModelComponent(Grasshopper.Kernel.GH_ScriptInstance):
    @property
    def component(self):
        return ghenv.Component  # type: ignore

    def RunScript(self,
            Elements: System.Collections.Generic.List[object],
            Containers: System.Collections.Generic.List[object],
            JointRules: System.Collections.Generic.List[object],
            Features: System.Collections.Generic.List[object],
            MaxDistance: float,
            CreateGeometry: bool):
        # this used to be default behavior in Rhino7.. I think..
        Elements = Elements or []
        Containers = Containers or []
        JointRules = JointRules or []
        Features = Features or []

        if not Elements:
            warning(self.component, "Input parameter Beams failed to collect data")
        if not JointRules:
            warning(self.component, "Input parameter JointRules failed to collect data")
        if not (Elements or Containers):  # shows beams even if no joints are found
            return
        if MaxDistance is None:
            MaxDistance = TOL.ABSOLUTE  # compared to calculted distance, so shouldn't be just 0.0

        tol = self.get_tol()
        Model = TimberModel(tolerance=tol)
        debug_info = DebugInfomation()

        ##### Adding elements #####
        self.add_elements_to_model(Model, Elements, Containers)

        ##### Wall populating #####
        handled_pairs, wall_joints = self.handle_populators(Model, Containers, MaxDistance)

        ##### Handle joinery #####
        # checks elements compatibility and generates Joints
        JointRules = [j for j in JointRules if j is not None]

        solver = JointRuleSolver(JointRules, max_distance=MaxDistance)
        joint_errors, _ = solver.apply_rules_to_model(Model)  # TODO: figure out best way to pass out unjoined_clusters

        for je in joint_errors:
            debug_info.add_joint_error(je)

        # applies extensions and features resulting from joints
        bje = Model.process_joinery()
        if bje:
            debug_info.add_joint_error(bje)

        ##### Handle user features #####
        if Features:
            feature_errors = self.handle_features(Features)
            debug_info.add_feature_error(feature_errors)

        ##### Visualization #####
        Geometry, errors = self.handle_geometry(Model, CreateGeometry)
        for geo_error in errors:
            debug_info.add_feature_error(geo_error)

        ##### Error Handling #####
        if debug_info.has_errors:
            warning(self.component, "Error found during joint creation. See DebugInfo output for details.")

        return Model, Geometry, debug_info

    def get_tol(self):
        units = Rhino.RhinoDoc.ActiveDoc.GetUnitSystemName(True, True, True, True)
        if units == "m":
            return Tolerance(unit="M", absolute=1e-6, relative=1e-6)
        elif units == "mm":
            return Tolerance(unit="MM", absolute=1e-3, relative=1e-3)
        else:
            error(self.component, f"Unsupported unit: {units}")
            return

    def add_elements_to_model(self, model, elements, containers):
        """Adds elements to the model and groups them by slab."""
        elements = [e for e in elements if e is not None]
        for element in elements:
            element.reset()
            model.add_element(element)

        containers = [c for c in containers if c is not None]

        for index, c_def in enumerate(containers):
            slab = c_def.slab
            model.add_group_element(slab, name=slab.name + str(index))

    def handle_populators(self, model, containers, max_distance):
        # Handle wall populators
        model.connect_adjacent_walls()
        config_sets = [c_def.config_set for c_def in containers]
        populators = []
        if any(config_sets):
            populators = WallPopulator.from_model(model, config_sets)

        handled_pairs = []
        wall_joints = []
        for populator, slab in zip(populators, list(model.slabs)):
            elements = populator.create_elements()
            model.add_elements(elements, parent=slab.name)
            joint_definitions = populator.create_joints(elements, max_distance)
            wall_joints.extend(joint_definitions)
            for j_def in joint_definitions:
                element_a, element_b = j_def.elements
                handled_pairs.append({element_a, element_b})

        return handled_pairs, wall_joints

    def handle_features(self, features):
        feature_errors = []
        features = [f for f in features if f is not None]
        for f_def in features:
            if not f_def.elements:
                warning(self.component, "Features defined in model must have elements defined. Features without elements will be ignored")
                continue

            for element in f_def.elements:
                try:
                    element.add_features(f_def.feature_from_element(element))
                except FeatureApplicationError as ex:
                    feature_errors.append(ex)
        return feature_errors

    def handle_geometry(self, Model, CreateGeometry):
        scene = Scene()
        errors = []
        for element in Model.elements():
            if CreateGeometry:
                scene.add(element.geometry)
                if getattr(element, "debug_info", False):
                    errors.append(element.debug_info)
            else:
                if isinstance(element, Beam):
                    scene.add(element.blank)
                elif isinstance(element, Plate):
                    scene.add(element.shape)
                else:
                    scene.add(element.geometry)
        return scene.draw(), errors
# ---------- end model ----------
panel_4 = Panel("""0.2
0.2
5""")  # disabled

# ----
# F. Output
py3_20 = Python3Script(b_list=py3_14.b_list_out)  # -> out, b_list_out, port, vertices_out, lines_out, port_2, facade_points, roof_points, support_points
# ---------- py3_20: Python ----------
#locate class file in the same folder
from compas_rhino import unload_modules
import sys
import os

#get current file path
path = ghenv.Component.OnPingDocument().FilePath
#get parent directory of the parent directory
parentdir = os.path.dirname(path)
#get src folder which contains classes
dire = os.path.join(parentdir,'scripts')
sys.path.append(dire)

unload_modules('Line_model_v5')


##########------------Imports------------###########
from Line_model_v5 import BeamList



#######------Conversions-------########

#########------Main Code------###############
v_list = b_list.v_list



#########----------Output data----------##############
b_list_out = b_list


vertices_out = [v_list[idx] if idx not in v_list.skip_indices else None for idx in range(len(v_list))]
lines_out = b_list.axises

facade_points = v_list.facade_points
roof_points = v_list.roof_points
support_points = v_list.support_points



#########---------Print----------------###########
print ("beam_length:", len(b_list))
print ("b_pairs_length:", len(b_list.pairs))
print ("vertex_length:", len(b_list.v_list))
print ()

print ("level_set:", set(pair.level for pair in b_list.pairs))
print ("cross_section_set:", set(pair.cross_section for pair in b_list.pairs))
print ("categories_set:", set(str(pair.categories) for pair in b_list.pairs))
# ---------- end py3_20 ----------
py3_21 = Python3Script(b_list=py3_15.b_list_out)  # -> out, b_list_out, port, vertices_out, lines_out, port_2, facade_points, roof_points, support_points; same code as py3_20

# ----
# Util: Read / Write json
button = Button()
data_2 = Data([py3_14.b_list_out, py3_15.b_list_out])
number_slider_4 = Slider(233, range=0..300)
python_3_script = Python3Script(b_lists=data_2, save=button)  # inputs b_lists: list, save: Boolean
# ---------- python_3_script: Python ----------
import os
from compas.data import json_dump
from compas_rhino.conversions import mesh_to_compas

######------Helpers-----#######
def remove_duplicate_points(points, precision=3):
    unique_points = {}
    
    for p in points:
        key = (round(p.x, precision), round(p.y, precision), round(p.z, precision))
        
        if key not in unique_points:
            unique_points[key] = p

    return list(unique_points.values())


#######-------Main Code------##############
facade_pts = [p for b_list in b_lists for p in b_list.v_list.facade_points]
roof_pts = [p for b_list in b_lists for p in b_list.v_list.roof_points]

clt_panels = [p for b_list in b_lists for p in b_list.clt_panels]

facade_pts = remove_duplicate_points(facade_pts)
roof_pts = remove_duplicate_points(roof_pts)

print (len(roof_pts))

data = {
    "b_lists": [],
    "lines": [],
    "types": [],
    "widths": [],
    "heights": [],
    "forces": [],
    "meshes": [],
    "clt_panels": [],
    "support_pts": [],
    "facade_pts": [],
    "roof_pts": []
}

data["facade_pts"] = facade_pts
data["roof_pts"] = roof_pts
data["clt_panels"] = clt_panels

for i, b_list in enumerate(b_lists):
    # data["b_lists"].append(b_list)
    data["support_pts"].extend(b_list.v_list.support_points)

    if i == 0:
        data["meshes"] = b_list.roof
    
    for beam in b_list:
        if beam is None:
            continue
        data["lines"].append(beam.axis)
        data["types"].append(beam.categories)
        data["widths"].append(beam.width)
        data["heights"].append(beam.height)
        data["forces"].append(beam.force)

    

print (data)
########-------Outputs--------#############
gh_dir = os.path.dirname(ghenv.Component.OnPingDocument().FilePath)
data_folder = os.path.join(gh_dir, "data")
json_path = os.path.join(data_folder, "out_lines.json")

if save:
    with open(json_path, 'w') as path:
        json_dump(data, path, pretty=False)
# ---------- end python_3_script ----------
to_structure_model = Python3Script()  # -> out, lines, types, widths, heights, forces, roofs, port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
# ---------- to_structure_model: Python ----------
import os
from compas.data import json_load
from Grasshopper import DataTree
from Grasshopper.Kernel.Data import GH_Path

gh_dir = os.path.dirname(ghenv.Component.OnPingDocument().FilePath)
# design_folder = os.path.dirname(gh_dir)
# json_path = os.path.join(design_folder, "line_model", "data", "out_lines.json")
json_path = os.path.join(gh_dir, "data", "out_lines.json")


lines_data = json_load(json_path)


lines = lines_data.get("lines")

types = DataTree[str]()
for i, ts in enumerate(lines_data.get("types")):
    types.AddRange(ts, GH_Path(i))

widths = lines_data.get("widths")
heights = lines_data.get("heights")
forces = lines_data.get("forces")
roofs = lines_data.get("meshes")

support_pts = lines_data.get("support_pts")
facade_pts = lines_data.get("facade_pts")
roof_pts = lines_data.get("roof_pts")
# ---------- end to_structure_model ----------
branch_2 = TreeBranch(Tree=to_structure_model.types, Path=number_slider_4, MaintainPaths=True)
draw_13 = COMPASDraw(cg=to_structure_model.lines)  # -> rg; same code as draw
item = ListItem(List=draw_13, Index=number_slider_4, Wrap=True)
panel_5 = Panel(branch_2)
viewer_3 = ParamViewer(to_structure_model.lines)
viewer_4 = ParamViewer(to_structure_model.types)
viewer_5 = ParamViewer(to_structure_model.widths)
viewer_6 = ParamViewer(to_structure_model.heights)
viewer_7 = ParamViewer(to_structure_model.forces)
viewer_8 = ParamViewer(to_structure_model.roofs)
viewer_9 = ParamViewer(to_structure_model.support_pts)

button_2 = Button()  # disabled
preview = CustomPreview(
    Geometry=model.Geometry,
    Material={diffuse=RGB(221, 160, 221), emission=RGB(66, 48, 66), shine=0.5, specular=RGB(255, 255, 255), transparency=0})  # disabled
bakewithboxmap = CTBakeWithBoxMap(model=model.Model, map_size=panel_4, bake=button_2)  # inputs map_size: list of Double, bake: Boolean; disabled
#   port model: Model object (optional).
#   port map_size: Scaling of the BoxMap in x,y,z directions (list of three positive values) (optional).
#   port bake: Set to True to Bake. Nothing happens if None or False.
# ---------- bakewithboxmap: Python ----------
# r: compas_timber>=1.0.2
# flake8: noqa
import math
import random

import Grasshopper
import System
import Rhino
import rhinoscriptsyntax as rs
from compas_rhino.conversions import frame_to_rhino
from compas_timber.ghpython import item_input_valid_cpython

from Rhino import Render
from Rhino.Geometry import Interval
from Rhino.Geometry import Plane


class BakeBoxMap(Grasshopper.Kernel.GH_ScriptInstance):
    def RunScript(self,
            model,
            map_size: System.Collections.Generic.List[float],
            bake: bool):
        if map_size and len(map_size) != 3:
            ghenv.Component.AddRuntimeMessage(
                Grasshopper.Kernel.GH_RuntimeMessageLevel.Error, "Input parameter MapSize requires exactly three float values (scale factors in x,y,z directions)"
            )
            return

        unit_system = Rhino.RhinoDoc.ActiveDoc.ModelUnitSystem

        if map_size:
            dimx, dimy, dimz = map_size
        else:
            # for the pine 251 material bitmap, rotated
            if unit_system == Rhino.UnitSystem.Meters:
                dimx = 0.2
                dimy = 0.2
                dimz = 1.0
            if unit_system == Rhino.UnitSystem.Centimeters:
                dimx = 20
                dimy = 20
                dimz = 100
            if unit_system == Rhino.UnitSystem.Millimeters:
                dimx = 200
                dimy = 200
                dimz = 1000

        if not item_input_valid_cpython(ghenv, model, "Model"):
            return

        if not bake:
            return

        try:
            frames = [frame_to_rhino(b.frame) for b in model.beams]
            breps = [beam.geometry.native_brep for beam in model.beams]

            if frames and breps:
                rs.EnableRedraw(False)

                for brep, frame in zip(breps, frames):
                    guid = Rhino.RhinoDoc.ActiveDoc.Objects.Add(brep)
                    boxmap = self.create_box_map(frame, dimx, dimy, dimz)
                    Rhino.RhinoDoc.ActiveDoc.Objects.ModifyTextureMapping(guid, 1, boxmap)
        finally:
            rs.EnableRedraw(True)

    @staticmethod
    def create_box_map(pln, sx, sy, sz):
        """
        pln: frame of beam box, where x=main axis, y=width, z=height
        sx,sy,sz: box map size in x,y,z direction
        """

        v = pln.YAxis
        w = pln.ZAxis
        pt = pln.Origin

        # random deviation
        a = math.pi * 0.5
        randangle = (random.random() - 0.5) * a
        v.Rotate(randangle, pln.XAxis)

        b = math.pi * 0.01
        randangle = (random.random() - 0.5) * b
        w.Rotate(randangle, pln.XAxis)

        randpos = sx * random.random()
        pt += pln.XAxis * randpos

        # create box mapping
        mappingPln = Plane(pt, w, v)
        dx = Interval(-sx * 0.5, sx * 0.5)
        dy = Interval(-sy * 0.5, sy * 0.5)
        dz = Interval(-sz * 0.5, sz * 0.5)

        BoxMap = Render.TextureMapping.CreateBoxMapping(mappingPln, dx, dy, dz, False)

        return BoxMap
# ---------- end bakewithboxmap ----------

# ----
# * Support points
draw_14 = COMPASDraw(cg=py3_20.support_points)  # -> rg; same code as draw
draw_15 = COMPASDraw(cg=py3_21.support_points)  # -> rg; same code as draw
merge_3 = Merge(Data1=draw_14, Data2=draw_15)
rdpoints = RemoveDuplicatePointsKaramba3D(Point=merge_3, LimitDistance=0.005)  # -> OutPoint, Info, Indexes
pt = Point(rdpoints.OutPoint)

# ----
# * Facade points
draw_16 = COMPASDraw(cg=py3_20.facade_points)  # -> rg; same code as draw
draw_17 = COMPASDraw(cg=py3_21.facade_points)  # -> rg; same code as draw
merge_4 = Merge(Data1=draw_16, Data2=draw_17)
rdpoints_2 = RemoveDuplicatePointsKaramba3D(Point=merge_4, LimitDistance=0.005)  # -> OutPoint, Info, Indexes
pt_2 = Point(rdpoints_2.OutPoint)

# ----
# * Roof points
draw_18 = COMPASDraw(cg=py3_20.roof_points)  # -> rg; same code as draw
draw_19 = COMPASDraw(cg=py3_21.roof_points)  # -> rg; same code as draw
merge_5 = Merge(Data1=draw_18, Data2=draw_19)
rdpoints_3 = RemoveDuplicatePointsKaramba3D(Point=merge_5, LimitDistance=0.005)  # -> OutPoint, Info, Indexes
pt_3 = Point(rdpoints_3.OutPoint)

# ----
# * All Lines
draw_20 = COMPASDraw(cg=py3_20.lines_out)  # -> rg; same code as draw
draw_21 = COMPASDraw(cg=py3_21.lines_out)  # -> rg; same code as draw
midpt = CurveMiddle(Curve=draw_20)  # disabled
merge_6 = Merge(Data1=draw_20, Data2=draw_21)
clean_4 = CleanTree(RemoveNulls=True, RemoveInvalid=True, RemoveEmpty=False, Tree=merge_6)
points_2 = PointList(Points=midpt, Size=Slider(0.15, range=0..1))
rdlines = RemoveDuplicateLinesKaramba3D(Line=clean_4, LimitDistance=0.005)  # -> OutLine, Info, Indexes
line = Line(rdlines.OutLine)

line_prev_3 = TTLineweightPreview(
    Geometry=merge_6,
    StrokeColor=ColourSwatch(SwatchColor=RGB(255, 0, 0)),
    StrokeWeight=Slider(5, range=0..10),
    Absolute=False)
to_timber_design = Python3Script()  # -> out, lines, types, widths, heights, forces, roofs, port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; same code as to_structure_model
panel_6 = Panel(to_structure_model.types)
panel_7 = Panel(to_structure_model.widths)
panel_8 = Panel(to_structure_model.heights)
lselgeo = LeopardsSelectGeometry(Geometry=line, lock=True, maintain=False, order=False, selectedobject="332|335|164|165")  # -> Geometry, Path, Index, Order
midpt_2 = CurveMiddle(Curve=lselgeo.Geometry)
panel_9 = Panel("Garden")  # disabled

number_slider_5 = Slider(2000, range=0..20000)
number_slider_6 = Slider(2000, range=0..20000)
vec = VectorXYZ(XComponent=number_slider_5, YComponent=number_slider_5, ZComponent=number_slider_5)  # -> Vector, Length
vec_2 = VectorXYZ(XComponent=number_slider_6, YComponent=number_slider_6, ZComponent=number_slider_6)  # -> Vector, Length

# ----
# F. Optimize Cross Sections
number_slider_7 = Slider(2, range=0..10)
number_slider_8 = Slider(12, range=0..100)
number_slider_9 = Slider(16, range=0..100)
number_slider_10 = Slider(20, range=0..100)
matselect = MaterialSelectionKaramba3D(menu=[dropdown(1), dropdown(4), dropdown(11)])
series = Series(Start=number_slider_8, Step=number_slider_7, Count=10)
series_2 = Series(Start=number_slider_9, Step=Slider(2, range=0..10), Count=10)
series_3 = Series(Start=number_slider_10, Step=Slider(2, range=0..10), Count=10)
panel_10 = Panel(series)
panel_11 = Panel(series_2)
panel_12 = Panel(series_3)
crosec = CrossSectionKaramba3D(
    FamilyNameOfCrossSection="DefaultCroSec",
    Material=matselect,
    Height_cm=series,
    UpperFlangeWidth_cm=number_slider_8,
    LowerFlangeWidth_cm=number_slider_8,
    mode="Trapezoid")
crosec_2 = CrossSectionKaramba3D(
    FamilyNameOfCrossSection="DefaultCroSec",
    Material=matselect,
    Height_cm=series_2,
    UpperFlangeWidth_cm=number_slider_9,
    LowerFlangeWidth_cm=number_slider_9,
    mode="Trapezoid")
crosec_3 = CrossSectionKaramba3D(
    FamilyNameOfCrossSection="DefaultCroSec",
    Material=matselect,
    Height_cm=series_3,
    UpperFlangeWidth_cm=number_slider_10,
    LowerFlangeWidth_cm=number_slider_10,
    mode="Trapezoid")
merge_7 = Merge(Data1=crosec, Data2=crosec_2, Data3=crosec_3)
crosec_4 = CrossSectionKaramba3D(merge_7)

# ----
# * All Points
number_slider_11 = Slider(0.19, range=0..1)
draw_22 = COMPASDraw(cg=py3_20.vertices_out)  # -> rg; same code as draw
draw_23 = COMPASDraw(cg=py3_21.vertices_out)  # -> rg; same code as draw
merge_8 = Merge(Data1=draw_22, Data2=draw_23)
points_3 = PointList(Points=draw_22, Size=number_slider_11)
points_4 = PointList(Points=draw_23, Size=number_slider_11)
clean_5 = CleanTree(RemoveNulls=True, RemoveInvalid=True, RemoveEmpty=False, Tree=merge_8)

item_2 = ListItem(List=draw_22, Index=Slider(72, range=0..100), Wrap=True)
item_3 = ListItem(List=draw_22, Index=Slider(81, range=0..100), Wrap=True)
rdpoints_4 = RemoveDuplicatePointsKaramba3D(Point=clean_5, LimitDistance=0.005)  # -> OutPoint, Info, Indexes

pt_4 = Point(rdpoints_4.OutPoint)

# ----
# * To Karamba
line_2 = Line(line)  # disabled
pt_5 = Point(pt_4)  # disabled
pt_6 = Point(pt_2)  # disabled
pt_7 = Point(pt_3)  # disabled
pt_8 = Point(pt)  # disabled

# ----
# C. Set Support
number_slider_12 = Slider(0.54, range=0..1)
sph = Sphere(Base=pt_8, Radius=number_slider_12)
brepsinc = PointInBreps(Brep=sph, Point=pt_5, Strict=False)  # -> Inside, Index
cull = CullPattern(List=pt_5, CullPattern=brepsinc.Inside)
pt_9 = Point(cull)
xy = XYPlane(Origin=Point(0, 0, 0))
supp = SupportKaramba3D(
    PosInd=pt_9,
    PlaneOfReference=xy,
    Ct_kN_m=Vector(0, 0, 0),
    Cr_kNm_rad=Vector(0, 0, 0),
    menu=[buttons(on, on, on, off, off, off)])
item_4 = ListItem(List=pt_9, Index=0, Wrap=True)

# ----
# B. Create Beams
number_slider_13 = Slider(16, range=0..100)
number_slider_14 = Slider(12, range=0..100)
matselect_2 = MaterialSelectionKaramba3D(menu=[dropdown(1), dropdown(4), dropdown(11)])
line_3 = Line(line_2)
crosec_5 = CrossSectionKaramba3D(
    FamilyNameOfCrossSection="DefaultCroSec",
    Material=matselect_2,
    Height_cm=number_slider_13,
    UpperFlangeWidth_cm=number_slider_14,
    LowerFlangeWidth_cm=number_slider_14,
    mode="Trapezoid")
lineelem = CreateLinearElementKaramba3D(
    Line=line_3,
    Identifier="N",
    CrossSection=crosec_5,
    LimitDistance_m=0.005,
    BucklingLengthY_m=-1,
    BucklingLengthZ_m=-1,
    BucklingLengthLT_m=-1,
    Bending=True,
    ToPolylineMaxAngle=0.25,
    ToPolylineTolerance=0.1,
    ToPolylineMaxEdgeLength=0.25,
    New=True,
    Remove=True,
    mode="LineToBeam",
    GuidGeneratorSeed=-1879238011)  # -> Element, Points, Info

# ----
# E. Set Joints
beam_joints = BeamJointsKaramba3D(
    BeamIdentifier="N",
    CtKNMAtStartingNode=Vector(0, 0, 0),
    CrKNmRadAtStartingNode=vec.Vector,
    CtKNMAtEndNode=Vector(0, 0, 0),
    CrKNmRadAtEndNode=vec_2.Vector,
    menu=[buttons(off, off, off, on, on, on), buttons(off, off, off, on, on, on)])

# ----
# * garden weight
number_slider_15 = Slider(2, range=0..10)

# ----
# D. Set Loads
# * facade load?
# * snow, wind, etc. load?
pt_10 = Point(pt_6)
pt_11 = Point(pt_7)
del = DelaunayMesh(Points=pt_11, Plane=PlaneXY(0, 0, 0))
Z = UnitZ(Factor="-1.1")
panel_13 = Panel("Facade")  # disabled
panel_14 = Panel("Gravity")  # disabled
panel_15 = Panel("Live")  # disabled
loads = LoadsKaramba3D(Vector=Z, Mesh=del, LCase=panel_15, mode="MeshLoad -Const.", menu=[buttons(on, off, off), buttons(on, on)])  # disabled
loads_2 = LoadsKaramba3D(Vector=Vector(0, 0, -1), LCase=panel_14, mode="Gravity")

pdecon = Deconstruct(Point=pt_11)  # -> XComponent, YComponent, ZComponent
roundd = RoundToDecimalPlace(NumberX=pdecon.ZComponent, DecimalPlace=number_slider_15, RoundType=0)  # -> Rounded, Difference
cset = CreateSet(List=roundd.Rounded)  # -> Set, Map
sort = SortList(Keys=cset.Set)  # -> Keys, ValuesA
bnd = Bounds(Numbers=sort.Keys)
remap = RemapNumbers(Value=roundd.Rounded, Source=bnd, Target="0 to 5.5")  # -> Mapped, Clipped
Z_2 = UnitZ(Factor=remap.Mapped)
rev = Reverse(Vector=Z_2)
loads_3 = LoadsKaramba3D(Vectors=rev, Mesh=del, LCase=panel_9, mode="MeshLoad -Variable", menu=[buttons(on, off, off), buttons(on, on)])

panel_16 = Panel(remap.Mapped)

lng = ListLength(List=pt_10)
multiplication_3 = Multiplication(A="9", B="19.24")
division = Division(A=lng, B=2)
division_2 = Division(A=multiplication_3, B=division)
panel_17 = Panel(division_2)
neg = Negative(Value=division_2)

# ----
# A. Create CLT Panels
number_slider_16 = Slider(6, range=0..100)
matselect_3 = MaterialSelectionKaramba3D(menu=[dropdown(1), dropdown(4), dropdown(11)])
crosec_6 = CrossSectionKaramba3D(FamilyNameOfCrossSection="DefaultCroSec", Material=matselect_3, Height_cm=number_slider_16, mode="Shell - Const")
explode_2 = MeshExplode(Mesh=del, Interpolate=False)  # -> flatten(Faces)
surfelem = CreateSurfaceElementKaramba3D(Mesh=explode_2, Identifier="N", CrossSection=crosec_6, LimitDistance_m=0.005, Bending=True, mode="MeshToShell")  # -> Element, Points, Info

Z_3 = UnitZ(Factor=neg)
loads_4 = LoadsKaramba3D(ForceVector=Z_3, Local=False, PosInd=pt_10, LCase=panel_13, mode="Point")
merge_9 = Merge(Data1=loads_2, Data2=loads_4, Data3=loads_3, Data4=loads)  # -> flatten(Result)
load = LoadKaramba3D(merge_9)

merge_10 = Merge(Data1=surfelem.Element, Data2=lineelem.Element)  # -> flatten(Result)
element = ElementKaramba3D(merge_10)
assemble = AssembleModelKaramba3D(Elem=element, Support=supp, Load=load, Joint=beam_joints, LimitDistance_m=0.005)  # -> Model, Info, Mass_kg, CentreOfGravity, LoadCaseNames
opticrosec = OptimizeCrossSectionKaramba3D(
    Model=assemble.Model,
    CrossSections=crosec_4,
    MaximumUtilization=1,
    MaximumDisplacement_cm=Slider(3, range=0..10),
    MaximumVirtualWork_kNcm=0.01,
    NumberOfUtilizationIterations=5,
    NumberOfDisplacementIterations=5,
    NumberOfDisplacementIncrementsPerIteration=2,
    DisplacementTolerance=0.01,
    NumberOfSamplePoints=3,
    ElasticDesign=True,
    GammaM0=1,
    GammaM1=1.1,
    SwayFrame=True)  # -> OptimizedModel, Info, Mass_kg, MaximumDisplacement_cm, ElasticEnergyChange_kNm, MaximumUtilizationViewInsufficientCrossSections, MaximumDisplacementViewLimitCrossSections
panel_18 = Panel(opticrosec.Mass_kg)
analyse = AnalyseKaramba3D(Model=opticrosec.OptimizedModel)  # -> AnalysedModel, MaximumDisplacement_cm, ResultingForce_kN, ChangeOfElasticEnergy_kNm

panel_19 = Panel(analyse.MaximumDisplacement_cm)
pt_12 = Point(Point(182.5668785, 72.48847474, 24.8))
tag_2 = TextTag(Location=pt_12, Text=panel_19)

modelview = ModelViewKaramba3D(Model=analyse.AnalysedModel)  # -> Model, DeformedMesh, DeformedAxes, DeformedModel, MaximumDeformation
model_2 = ModelKaramba3D(modelview.Model)
disassemble = DisassembleModelKaramba3D(Model=model_2)  # -> Model, Point, Beam, Shell, Support, Load, Line, Mesh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
b_forces = BeamForcesKaramba3D(AnalysedModel=model_2, BeamsIdentifiers=disassemble.Beam, Ts=[0, 1])  # -> Model, NormalForce_kN, ShearForceVz_kN, ShearForceVy_kN, TorsionalMomentMt_kNm, BendingMomentMy_kNm, BendingMomentMz_kNm, LoadCaseIndex
beamview = BeamViewKaramba3D(Model=modelview.Model)  # -> Model, MeshesOfRenderedBeams, DeformedBeamAxes, LegendColours, LegendTags
disassemble_2 = DisassembleElementKaramba3D(Element=disassemble.Beam)  # -> Element, ElementIdentifier, AxisOfElement, CrossSection, Joint, Material, LocalCoordinateSystem, ElementIsActive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
panel_20 = Panel(b_forces.NormalForce_kN)
legend = LegendKaramba3D(
    Colors=beamview.LegendColours,
    Tags=beamview.LegendTags,
    Scale=0.8,
    Textsize=30,
    Legend_HasHeader=False,
    Legend_Justification=1,
    Legend_Position=2)
shellview = ShellViewKaramba3D(Model=beamview.Model, IndexOfLayer=0)  # -> Model, MeshesOfRenderedShells, LegendColours, LegendTags
disassemble_3 = DisassembleCrossSectionKaramba3D(CroSec=disassemble_2.CrossSection)  # -> CrossSection, FamilyNameOfCrossSection, TypeNameOfCrossSection, ElemIdentifiers, Colour, Material, LocalEccentricity_cm, flatten(Heights_cm)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
b_forces_2 = BeamForcesKaramba3D(AnalysedModel=model_2, BeamsIdentifiers=disassemble_2.Element, Ts=[0, 1])  # -> Model, NormalForce_kN, ShearForceVz_kN, ShearForceVy_kN, TorsionalMomentMt_kNm, BendingMomentMy_kNm, BendingMomentMz_kNm, LoadCaseIndex
panel_21 = Panel(b_forces_2.NormalForce_kN)

# ----
# Result: Cross Sections
num = Number(disassemble_3.Heights_cm)
num_2 = Number(disassemble_3.MaximumWidth_cm)

sort_2 = SortList(Keys=num, ValuesA=num_2)  # -> Keys, ValuesA

# ----
# * Cross section display
number_slider_17 = Slider(0.048, range=0..1)
line_4 = Line(disassemble_2.AxisOfElement)
addition = Addition(A=sort_2.Keys, B=sort_2.ValuesA)
midpt_3 = CurveMiddle(Curve=line_4)
bnd_2 = Bounds(Numbers=addition)
dedomain = DeconstructDomain(Domain=bnd_2)  # -> Start, End
dom = ConstructDomain(DomainStart=number_slider_17, DomainEnd=Slider(0.242, range=0..1))
remap_2 = RemapNumbers(Value=addition, Source=bnd_2, Target=dom)  # -> Mapped, Clipped
gradient = Gradient(
    LowerLimit=dedomain.End,
    UpperLimit=dedomain.Start,
    Parameter=addition,
    stops=[0: RGB(234, 38, 0), 0.25: RGB(234, 126, 0), 0.5: RGB(254, 244, 84), 0.75: RGB(173, 203, 249), 1: RGB(75, 107, 169)])
concat = Concatenate(FragmentA="h", FragmentB=sort_2.Keys, FragmentC=" w", FragmentD=sort_2.ValuesA)
line_prev_4 = TTLineweightPreview(Geometry=line_4, StrokeColor=gradient, StrokeWeight=remap_2.Mapped, Absolute=Toggle(True))
tag_3 = TextTag(Location=midpt_3, Text=concat)

# ----
# * Cross section result
panel_22 = Panel("h")
concat_2 = Concatenate(FragmentA=panel_22, FragmentB=sort_2.Keys, FragmentC=" w", FragmentD=sort_2.ValuesA)
cset_2 = CreateSet(List=flatten(concat_2))  # -> Set, Map
mindex = MemberIndex(Set=concat_2, Member=cset_2.Set)  # -> Index, Count
concat_3 = Concatenate(FragmentA=cset_2.Set, FragmentB=" ,c:", FragmentC=mindex.Count)
panel_23 = Panel(concat_3)

# ---- group: Compas_Timber
deplane = DeconstructPlane(Plane=disassemble_2.LocalCoordinateSystem)  # -> Origin, XAxis, YAxis, ZAxis; disabled
multiplication_4 = Multiplication(A=disassemble_3.Heights_cm, _001=0.01)  # disabled
multiplication_5 = Multiplication(A=disassemble_3.MaximumWidth_cm, _001=0.01)  # disabled
number_slider_18 = Slider(0.12, range=0..1)  # disabled
beam_2 = CTBeam(width=number_slider_18, height=number_slider_18)  # -> Beam, Blank; inputs centerline: list, z_vector: list of Vector3d, width: list of Double, height: list of Double, category: list of String, updateRefObj: Boolean; disabled; same code as beam
model_3 = CTModel(Elements=flatten(beam_2.Beam))  # -> Model, Geometry, DebugInfo; inputs Elements: list, Containers: list, JointRules: list, Features: list, MaxDistance: Double, CreateGeometry: Boolean; disabled; same code as model
panel_24 = Panel("""0.2
0.2
5""")  # disabled
button_3 = Button()  # disabled
button_4 = Button()  # disabled
button_5 = Button()  # disabled
bakewithboxmap_2 = CTBakeWithBoxMap(model=model_3.Model, map_size=panel_24, bake=button_4)  # inputs map_size: list of Double, bake: Boolean; disabled
#   port model: Model object (optional).
#   port map_size: Scaling of the BoxMap in x,y,z directions (list of three positive values) (optional).
#   port bake: Set to True to Bake. Nothing happens if None or False.
# ---------- bakewithboxmap_2: Python ----------
# r: compas_timber>=1.0.2
# flake8: noqa
import math
import random

import Grasshopper
import System
import Rhino
import rhinoscriptsyntax as rs
from compas_rhino.conversions import frame_to_rhino
from compas_timber.ghpython import item_input_valid_cpython

from Rhino import Render
from Rhino.Geometry import Interval
from Rhino.Geometry import Plane


class BakeBoxMap(Grasshopper.Kernel.GH_ScriptInstance):
    def RunScript(self,
            model,
            map_size: System.Collections.Generic.List[float],
            bake: bool):
        if map_size and len(map_size) != 3:
            ghenv.Component.AddRuntimeMessage(
                Grasshopper.Kernel.GH_RuntimeMessageLevel.Error, "Input parameter MapSize requires exactly three float values (scale factors in x,y,z directions)"
            )
            return

        unit_system = Rhino.RhinoDoc.ActiveDoc.ModelUnitSystem

        if map_size:
            dimx, dimy, dimz = map_size
        else:
            # for the pine 251 material bitmap, rotated
            if unit_system == Rhino.UnitSystem.Meters:
                dimx = 0.2
                dimy = 0.2
                dimz = 1.0
            if unit_system == Rhino.UnitSystem.Centimeters:
                dimx = 20
                dimy = 20
                dimz = 100
            if unit_system == Rhino.UnitSystem.Millimeters:
                dimx = 200
                dimy = 200
                dimz = 1000

        if not item_input_valid_cpython(ghenv, model, "Model"):
            return

        if not bake:
            return

        try:
            # frames = [frame_to_rhino(b.frame) for b in model.beams]
            # breps = [beam.geometry.native_brep for beam in model.beams]

            # if frames and breps:
            #     rs.EnableRedraw(False)

            #     for brep, frame in zip(breps, frames):
            #         guid = Rhino.RhinoDoc.ActiveDoc.Objects.Add(brep)
            #         boxmap = self.create_box_map(frame, dimx, dimy, dimz)
            #         Rhino.RhinoDoc.ActiveDoc.Objects.ModifyTextureMapping(guid, 1, boxmap)
            #
            from compas.datastructures import Mesh
            from compas_rhino.conversions import mesh_to_rhino
            import Rhino.Geometry as rg
            frames, meshes = [], []
            for beam in model.beams:
                frame = frame_to_rhino(beam.frame)
                frames.append(frame)
                mesh = Mesh()

                brep = beam.geometry
                ms = brep.to_meshes()
                for m in ms:
                    mesh.join(m)
                rh_mesh = mesh_to_rhino(mesh)
                rh_mesh.Vertices.CombineIdentical(True, True)
                meshes.append(rh_mesh)

            if frames and meshes:
                rs.EnableRedraw(False)

                for mesh, frame in zip(meshes, frames):
                    guid = Rhino.RhinoDoc.ActiveDoc.Objects.Add(mesh)
                    boxmap = self.create_box_map(frame, dimx, dimy, dimz)
                    Rhino.RhinoDoc.ActiveDoc.Objects.ModifyTextureMapping(guid, 1, boxmap)

                

        finally:
            rs.EnableRedraw(True)

    @staticmethod
    def create_box_map(pln, sx, sy, sz):
        """
        pln: frame of beam box, where x=main axis, y=width, z=height
        sx,sy,sz: box map size in x,y,z direction
        """

        v = pln.YAxis
        w = pln.ZAxis
        pt = pln.Origin

        # random deviation
        a = math.pi * 0.5
        randangle = (random.random() - 0.5) * a
        v.Rotate(randangle, pln.XAxis)

        b = math.pi * 0.01
        randangle = (random.random() - 0.5) * b
        w.Rotate(randangle, pln.XAxis)

        randpos = sx * random.random()
        pt += pln.XAxis * randpos

        # create box mapping
        mappingPln = Plane(pt, w, v)
        dx = Interval(-sx * 0.5, sx * 0.5)
        dy = Interval(-sy * 0.5, sy * 0.5)
        dz = Interval(-sz * 0.5, sz * 0.5)

        BoxMap = Render.TextureMapping.CreateBoxMapping(mappingPln, dx, dy, dz, False)

        return BoxMap
# ---------- end bakewithboxmap_2 ----------
bakewithboxmap_3 = CTBakeWithBoxMap(model=model_3.Model, map_size=panel_24, bake=button_5)  # inputs map_size: list of Double, bake: Boolean; disabled; same code as bakewithboxmap

# ---- group: Compas_Timber / Output: Mesh
bakewithboxmap_4 = CTBakeWithBoxMap(model=model_3.Model, map_size=panel_24, bake=button_3)  # inputs map_size: list of Double, bake: Boolean; disabled
#   port model: Model object (optional).
#   port map_size: Scaling of the BoxMap in x,y,z directions (list of three positive values) (optional).
#   port bake: Set to True to Bake. Nothing happens if None or False.
# ---------- bakewithboxmap_4: Python ----------
# r: compas_timber>=1.0.2
# flake8: noqa
import math
import random

import Grasshopper
import System
import Rhino
import rhinoscriptsyntax as rs
from compas_rhino.conversions import frame_to_rhino
from compas_timber.ghpython import item_input_valid_cpython

from Rhino import Render
from Rhino.Geometry import Interval
from Rhino.Geometry import Plane

from Rhino.Geometry import Box, Mesh
from compas_rhino.conversions import box_to_rhino

class BakeBoxMap(Grasshopper.Kernel.GH_ScriptInstance):
    def RunScript(self,
            model,
            map_size: System.Collections.Generic.List[float],
            bake: bool):
        if map_size and len(map_size) != 3:
            ghenv.Component.AddRuntimeMessage(
                Grasshopper.Kernel.GH_RuntimeMessageLevel.Error, "Input parameter MapSize requires exactly three float values (scale factors in x,y,z directions)"
            )
            return

        unit_system = Rhino.RhinoDoc.ActiveDoc.ModelUnitSystem

        if map_size:
            dimx, dimy, dimz = map_size
        else:
            # for the pine 251 material bitmap, rotated
            if unit_system == Rhino.UnitSystem.Meters:
                dimx = 0.2
                dimy = 0.2
                dimz = 1.0
            if unit_system == Rhino.UnitSystem.Centimeters:
                dimx = 20
                dimy = 20
                dimz = 100
            if unit_system == Rhino.UnitSystem.Millimeters:
                dimx = 200
                dimy = 200
                dimz = 1000

        if not item_input_valid_cpython(ghenv, model, "Model"):
            return

        if not bake:
            return

        try:
            frames, meshes = [], []
            for beam in model.beams:
                frame = frame_to_rhino(beam.frame)
                frames.append(frame)

                box = beam.shape
                box = box_to_rhino(box)
                mesh = Mesh.CreateFromBox(box, 1, 1, 1)
                meshes.append(mesh)

            if frames and meshes:
                rs.EnableRedraw(False)

                for mesh, frame in zip(meshes, frames):
                    guid = Rhino.RhinoDoc.ActiveDoc.Objects.Add(mesh)
                    boxmap = self.create_box_map(frame, dimx, dimy, dimz)
                    Rhino.RhinoDoc.ActiveDoc.Objects.ModifyTextureMapping(guid, 1, boxmap)
        finally:
            rs.EnableRedraw(True)

    @staticmethod
    def create_box_map(pln, sx, sy, sz):
        """
        pln: frame of beam box, where x=main axis, y=width, z=height
        sx,sy,sz: box map size in x,y,z direction
        """

        v = pln.YAxis
        w = pln.ZAxis
        pt = pln.Origin

        # random deviation
        a = math.pi * 0.5
        randangle = (random.random() - 0.5) * a
        v.Rotate(randangle, pln.XAxis)

        b = math.pi * 0.01
        randangle = (random.random() - 0.5) * b
        w.Rotate(randangle, pln.XAxis)

        randpos = sx * random.random()
        pt += pln.XAxis * randpos

        # create box mapping
        mappingPln = Plane(pt, w, v)
        dx = Interval(-sx * 0.5, sx * 0.5)
        dy = Interval(-sy * 0.5, sy * 0.5)
        dz = Interval(-sz * 0.5, sz * 0.5)

        BoxMap = Render.TextureMapping.CreateBoxMapping(mappingPln, dx, dy, dz, False)

        return BoxMap
# ---------- end bakewithboxmap_4 ----------

# ----
intersection_count = Slider(4, range=0..13)
select = BooleanToggle(True)

pt_13 = Point(disassemble.Point)
n_forces = NodeForcesKaramba3D(AnalysedModel=model_2, PosInd=pt_13, PlaneOfReference=PlaneXY(0, 0, 0), Local=False)  # -> Model, Elements, Direction, Forces, Moments, LoadCaseIndex
# Result: Valency
tstat = TreeStatistics(Tree=n_forces.Elements)  # -> Paths, Length, Count
lng_2 = ListLength(List=n_forces.Elements)  # -> flatten(Length)
equals = Equality(FirstNumber=lng_2, SecondNumber=intersection_count)  # -> Equality, Inequality
bool = Boolean(select)
cset_3 = CreateSet(List=lng_2)  # -> Set, Map
sift = SiftPattern(List=tstat.Paths, SiftPattern=equals.Equality)  # -> Output0, Output1
sift_2 = SiftPattern(List=pt_13, SiftPattern=equals.Equality)  # -> Output0, Output1
sort_3 = SortList(Keys=cset_3.Set)  # -> Keys, ValuesA
filter = StreamFilter(Gate=bool, Stream0=tstat.Paths, Stream1=sift.Output1)
filter_2 = StreamFilter(Gate=bool, Stream0=pt_13, Stream1=sift_2.Output1)
bnd_3 = Bounds(Numbers=lng_2)
dedomain_2 = DeconstructDomain(Domain=bnd_3)  # -> Start, End
dom_2 = ConstructDomain(DomainStart=Slider(0.28, range=0..1), DomainEnd=Slider(0.61, range=0..1))
gradient_2 = Gradient(
    LowerLimit=dedomain_2.End,
    UpperLimit=dedomain_2.Start,
    Parameter=lng_2,
    stops=[0: RGB(234, 38, 0), 0.25: RGB(234, 126, 0), 0.5: RGB(254, 244, 84), 0.75: RGB(173, 203, 249), 1: RGB(75, 107, 169)])
remap_3 = RemapNumbers(Value=lng_2, Source=bnd_3, Target=dom_2)  # -> Mapped, Clipped
branch_3 = TreeBranch(Tree=n_forces.Elements, Path=filter, MaintainPaths=True)
msphereex = MeshSphereEx(Base=filter_2, Radius=remap_3.Mapped, Count=Slider(5, range=0..10))
disassemble_4 = DisassembleElementKaramba3D(Element=branch_3)  # -> Element, ElementIdentifier, AxisOfElement, CrossSection, Joint, Material, LocalCoordinateSystem, ElementIsActive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

intersection_chart = Panel(sort_3.Keys)

preview_2 = CustomPreview(Geometry=msphereex, Material=gradient_2)
line_5 = Line(disassemble_4.AxisOfElement)
pt_14 = Point(filter_2)
tag_4 = TextTag(Location=filter_2, Text=lng_2, Colour=ColourSwatch(SwatchColor=RGB(0, 0, 0)))
