# Grasshopper definition Tree_joint_prototype_v4.gh (Grasshopper 1.0.8)
# plug-ins: Karamba3D, CORE.Toolbox.Grasshopper, MeshEdit Components

crv = Curve([<curve referenced from the Rhino model> x256])
crv_2 = Curve([<curve referenced from the Rhino model> x92])
crv_3 = Curve([<curve referenced from the Rhino model> x80])
crv_4 = Curve([<curve referenced from the Rhino model> x368])
crv_5 = Curve([<curve referenced from the Rhino model> x320])
Z = UnitZ(Factor=1)
crv_6 = Curve([<curve referenced from the Rhino model> x4])
crv_7 = Curve([<curve referenced from the Rhino model> x8])
rev = Reverse(Vector=Z)
platefromthickness = CTPlateFromOutlineAndThickness(outline=crv_6, thickness="0.06", category="CLT")  # -> Plate, Geometry; inputs thickness: Double, vector: Vector3d, openings: list, category: String, updateRefObj: Boolean
#   port outline: Referenced polyline, Guid of polyline in the active Rhino document.
#   port thickness: Thickness of the plate material.
#   port vector: Determines direction of the plate extrusion
#   port openings: List of openings in the plate.
#   port category: Category of a beam.
#   port updateRefObj: (optional) If True, the attributes in the referenced object will be updated/overwritten with the new values given here.
#   port Plate: Plate object(s).
#   port Geometry: Shape of the plate.
# ---------- platefromthickness: Python ----------
# r: compas_timber>=1.0.2
"""Creates a Beam from a LineCurve."""

# flake8: noqa
import Grasshopper
import Rhino
import rhinoscriptsyntax as rs
import System
from compas.scene import Scene
from compas_rhino.conversions import polyline_to_compas
from compas_rhino.conversions import vector_to_compas

from compas_timber.elements import Plate as CTPlate
from compas_timber.ghpython.rhino_object_name_attributes import update_rhobj_attributes_name
from compas_timber.ghpython.ghcomponent_helpers import item_input_valid_cpython


class Plate(Grasshopper.Kernel.GH_ScriptInstance):
    def RunScript(self,
            outline,
            thickness: float,
            vector: Rhino.Geometry.Vector3d,
            openings: System.Collections.Generic.List[object],
            category: str,
            updateRefObj: bool):
        # minimum inputs required

        if not item_input_valid_cpython(ghenv, outline, "Outline") or not item_input_valid_cpython(ghenv, thickness, "Thickness"):
            return
        scene = Scene()
        guid, geometry = self._get_guid_and_geometry(outline)
        rhino_polyline = rs.coercecurve(geometry)
        line = polyline_to_compas(rhino_polyline.ToPolyline())
        v = vector_to_compas(vector) if vector else None
        o = []
        if openings:
            for o_outline in openings:
                o_guid, o_geometry = self._get_guid_and_geometry(o_outline)
                o_rhino_polyline = rs.coercecurve(o_geometry)
                o.append(polyline_to_compas(o_rhino_polyline.ToPolyline()))
        plate = CTPlate.from_outline_thickness(line, thickness, vector=v, openings=o)
        plate.attributes["rhino_guid"] = str(guid) if guid else None
        plate.attributes["category"] = category

        if updateRefObj and guid:
            update_rhobj_attributes_name(guid, "outline", str(outline))
            update_rhobj_attributes_name(guid, "thickness", str(thickness))
            update_rhobj_attributes_name(guid, "category", category)

        scene.add(plate.shape)
        geo = scene.draw()
        return plate, geo

    def _get_guid_and_geometry(self, line):  # TODO: move to ghpython_helpers
        # internalized curves and GH geometry will not have persistent GUIDs, referenced Rhino objects will
        # type hint on the input has to be 'ghdoc' for this to work
        guid = None
        geometry = line
        rhino_obj = Rhino.RhinoDoc.ActiveDoc.Objects.FindId(line)

        if rhino_obj:
            guid = line
            geometry = rhino_obj.Geometry
        return guid, geometry
# ---------- end platefromthickness ----------
beam = CTBeam(centerline=crv, width=Slider(0.12, range=0..1), height=Slider(0.16, range=0..1), category="DIAGONAL")  # -> Beam, Blank; inputs centerline: list, z_vector: list of Vector3d, width: list of Double, height: list of Double, category: list of String, updateRefObj: Boolean
#   port centerline: Referenced curve or line, Guid of curve or line in the active Rhino document.
#   port z_vector: Vector defining the orientation of the cross-section (corresponds to the height dimension). If None, a default will be taken.
#   port width: Width of the cross-section (usually the smaller dimension).
#   port height: Height of the cross-section (usually the larger dimension).
#   port category: Category of a beam.
#   port updateRefObj: (optional) If True, the attributes in the referenced object will be updated/overwritten with the new values given here.
#   port Beam: Beam object(s).
#   port Blank: Shape of the beam's blank.
# ---------- beam: Python ----------
# r: compas_timber>=1.0.2
"""Creates a Beam from a LineCurve."""

# flake8: noqa
import Grasshopper
import Rhino
import rhinoscriptsyntax as rs
import System
from compas.scene import Scene
from compas_rhino.conversions import line_to_compas
from compas_rhino.conversions import vector_to_compas

from compas_timber.elements import Beam as CTBeam
from compas_timber.ghpython.rhino_object_name_attributes import update_rhobj_attributes_name
from compas_timber.ghpython.ghcomponent_helpers import list_input_valid_cpython


class Beam_fromCurve(Grasshopper.Kernel.GH_ScriptInstance):
    def RunScript(self,
            centerline: System.Collections.Generic.List[object],
            z_vector: System.Collections.Generic.List[Rhino.Geometry.Vector3d],
            width: System.Collections.Generic.List[float],
            height: System.Collections.Generic.List[float],
            category: System.Collections.Generic.List[str],
            updateRefObj: bool):
        # minimum inputs required
        if not list_input_valid_cpython(ghenv, centerline, "Centerline"):
            return
        if not width:
            length = self._get_centerline_length(centerline)
            width = [length / 20]
        if not height:
            length = self._get_centerline_length(centerline)
            height = [length / 10]

        # reformat unset parameters for consistency
        if not z_vector:
            z_vector = [None]
        if not category:
            category = [None]

        beams = []
        blanks = []
        scene = Scene()

        if centerline and height and width:
            # check list lengths for consistency
            N = len(centerline)
            if len(z_vector) not in (0, 1, N):
                ghenv.Component.AddRuntimeMessage(
                    Grasshopper.Kernel.GH_RuntimeMessageLevel.Error, " In 'ZVector' I need either none, one or the same number of inputs as the Crv parameter."
                )
            if len(width) not in (1, N):
                ghenv.Component.AddRuntimeMessage(Grasshopper.Kernel.GH_RuntimeMessageLevel.Error, " In 'W' I need either one or the same number of inputs as the Crv parameter.")
            if len(height) not in (1, N):
                ghenv.Component.AddRuntimeMessage(Grasshopper.Kernel.GH_RuntimeMessageLevel.Error, " In 'H' I need either one or the same number of inputs as the Crv parameter.")
            if len(category) not in (0, 1, N):
                ghenv.Component.AddRuntimeMessage(
                    Grasshopper.Kernel.GH_RuntimeMessageLevel.Error, " In 'Category' I need either none, one or the same number of inputs as the Crv parameter."
                )

            # duplicate data if None or single value
            if len(z_vector) != N:
                z_vector = [z_vector[0] for _ in range(N)]
            if len(width) != N:
                width = [width[0] for _ in range(N)]
            if len(height) != N:
                height = [height[0] for _ in range(N)]
            if len(category) != N:
                category = [category[0] for _ in range(N)]

            for line, z, w, h, c in zip(centerline, z_vector, width, height, category):
                guid, geometry = self._get_guid_and_geometry(line)
                rhino_line = rs.coerceline(geometry)
                line = line_to_compas(rhino_line)

                z = vector_to_compas(z) if z else None
                beam = CTBeam.from_centerline(centerline=line, width=w, height=h, z_vector=z)
                beam.attributes["rhino_guid"] = str(guid) if guid else None
                beam.attributes["category"] = c
                if updateRefObj and guid:
                    update_rhobj_attributes_name(guid, "width", str(w))
                    update_rhobj_attributes_name(guid, "height", str(h))
                    update_rhobj_attributes_name(guid, "zvector", str(list(beam.frame.zaxis)))
                    update_rhobj_attributes_name(guid, "category", c)

                beams.append(beam)
                scene.add(beam.blank)

        blanks = scene.draw()

        return beams, blanks

    def _get_guid_and_geometry(self, line):
        # internalized curves and GH geometry will not have persistent GUIDs, referenced Rhino objects will
        # type hint on the input has to be 'ghdoc' for this to work
        guid = None
        geometry = line
        rhino_obj = Rhino.RhinoDoc.ActiveDoc.Objects.FindId(line)
        if rhino_obj:
            guid = line
            geometry = rhino_obj.Geometry
        return guid, geometry

    def _get_centerline_length(self, centerline):
        centerline_length = []
        for i in centerline:
            centerline_length.append(rs.CurveLength(i))
        if centerline_length:
            length_average = sum(centerline_length) / len(centerline_length)
        else:
            length_average = 1
        return length_average
# ---------- end beam ----------
beam_2 = CTBeam(centerline=crv_2, width=Slider(0.12, range=0..1), height=Slider(0.16, range=0..1), category="LONG")  # -> Beam, Blank; inputs centerline: list, z_vector: list of Vector3d, width: list of Double, height: list of Double, category: list of String, updateRefObj: Boolean; same code as beam
beam_3 = CTBeam(centerline=crv_3, width=Slider(0.12, range=0..1), height=Slider(0.12, range=0..1), category="SHORT")  # -> Beam, Blank; inputs centerline: list, z_vector: list of Vector3d, width: list of Double, height: list of Double, category: list of String, updateRefObj: Boolean; same code as beam
platefromthickness_2 = CTPlateFromOutlineAndThickness(outline=crv_7, thickness="0.06", category="CLT")  # -> Plate, Geometry; inputs thickness: Double, vector: Vector3d, openings: list, category: String, updateRefObj: Boolean; same code as platefromthickness
beam_4 = CTBeam(centerline=crv_4, width=Slider(0.12, range=0..1), height=Slider(0.16, range=0..1), category="LONG")  # -> Beam, Blank; inputs centerline: list, z_vector: list of Vector3d, width: list of Double, height: list of Double, category: list of String, updateRefObj: Boolean; same code as beam
beam_5 = CTBeam(centerline=crv_5, width=Slider(0.12, range=0..1), height=Slider(0.12, range=0..1), category="SHORT")  # -> Beam, Blank; inputs centerline: list, z_vector: list of Vector3d, width: list of Double, height: list of Double, category: list of String, updateRefObj: Boolean; same code as beam
num = Number("0.02")
num_2 = Number("0.02")
jointsbycategory = CTCategoryJointsRules(main_beam_category="LONG", cross_beam_category="LONG", step_depth=num)  # -> TStepJoint; inputs main_beam_category: String, cross_beam_category: String
#   port main_beam_category: Beam A category.
#   port cross_beam_category: Beam B category.
#   port TStepJoint: A joint rule.
# ---------- jointsbycategory: Python ----------
# r: compas_timber>=1.0.2
"""Defines which Joint type will be applied in the Automatic Joints component for connecting Beams with the given Category attributes. This overrides Topological Joint rules and is overriden by Direct joint rules"""

# flake8: noqa
import inspect
from collections import OrderedDict

import Grasshopper
from System.Windows.Forms import ToolStripMenuItem
from System.Windows.Forms import ToolStripSeparator


from compas_timber.design import CategoryRule
from compas_timber.ghpython import get_createable_joints
from compas_timber.ghpython import item_input_valid_cpython
from compas_timber.ghpython import manage_cpython_dynamic_params
from compas_timber.ghpython import rename_cpython_gh_output
from compas_timber.ghpython import warning
from compas_timber.ghpython import message


class CategoryJointRule(Grasshopper.Kernel.GH_ScriptInstance):
    def __init__(self):
        super(CategoryJointRule, self).__init__()
        self.topo_bools = OrderedDict([("Unknown", False), ("I", False), ("L", False), ("T", False), ("X", False)])

        self.classes = {}
        for cls in get_createable_joints():
            self.classes[cls.__name__] = cls

        if ghenv.Component.Params.Output[0].NickName == "Rule":
            self.joint_type = None
        else:
            parsed_output = ghenv.Component.Params.Output[0].NickName.split("_")
            self.joint_type = self.classes.get(parsed_output[0])
            for key in parsed_output[1:]:
                self.topo_bools[key] = True

    @property
    def component(self):
        return ghenv.Component  # type: ignore

    def RunScript(self, *args):
        if not self.joint_type:
            warning(self.component, "Select joint type from context menu (right click)")
            return None
        else:
            message(self.component, self.joint_type.__name__)
            cat_a, cat_b = args[:2]
            kwargs = {}
            for i, val in enumerate(args[2:]):
                if val is not None:
                    kwargs[self.arg_names()[i + 2]] = val
            if not item_input_valid_cpython(ghenv, cat_a, self.arg_names()[0]) or not item_input_valid_cpython(ghenv, cat_b, self.arg_names()[1]):
                return

            topos = []
            for i, bool in enumerate(self.topo_bools.values()):
                if bool:
                    topos.append(i)

            return CategoryRule(self.joint_type, cat_a, cat_b, topos, **kwargs)

    def arg_names(self):
        names = inspect.getargspec(self.joint_type.__init__)[0][1:]
        for i in range(2):
            names[i] += "_category"
        return [name for name in names if (name != "key") and (name != "frame")] + ["max_distance"]

    def AppendAdditionalMenuItems(self, menu):
        for name in self.classes.keys():
            item = menu.Items.Add(name, None, self.on_item_click)
            if self.joint_type and name == self.joint_type.__name__:
                item.Checked = True

        menu.Items.Add(ToolStripSeparator())
        topo_menu = ToolStripMenuItem("Apply to Topology")
        menu.Items.Add(topo_menu)
        for name, bool in self.topo_bools.items():
            item = ToolStripMenuItem(name, None, self.on_topo_click)
            item.Checked = bool
            topo_menu.DropDownItems.Add(item)

    def output_name(self):
        name = self.joint_type.__name__
        for key, bool in self.topo_bools.items():
            if bool:
                name += "_{}".format(key)
        return name

    def on_topo_click(self, sender, event_info):
        self.topo_bools[str(sender)] = not self.topo_bools[str(sender)]
        rename_cpython_gh_output(self.output_name(), 0, ghenv)
        ghenv.Component.ExpireSolution(True)

    def on_item_click(self, sender, event_info):
        self.joint_type = self.classes[str(sender)]
        rename_cpython_gh_output(self.output_name(), 0, ghenv)
        manage_cpython_dynamic_params(self.arg_names(), ghenv, rename_count=2, permanent_param_count=0)
        ghenv.Component.ExpireSolution(True)
# ---------- end jointsbycategory ----------
jointsbycategory_2 = CTCategoryJointsRules(main_beam_category="SHORT", cross_beam_category="LONG")  # -> TButtJoint; inputs main_beam_category: String, cross_beam_category: String; same code as jointsbycategory
entwine = Entwine(Branch00=platefromthickness.Plate, Branch01=beam_2.Beam, Branch02=beam_3.Beam, FlattenInputs=True)
jointsbycategory_3 = CTCategoryJointsRules(main_beam_category="LONG", cross_beam_category="LONG", step_depth=num_2)  # -> TStepJoint; inputs main_beam_category: String, cross_beam_category: String; same code as jointsbycategory
jointsbycategory_4 = CTCategoryJointsRules(main_beam_category="SHORT", cross_beam_category="LONG")  # -> TButtJoint; inputs main_beam_category: String, cross_beam_category: String; same code as jointsbycategory
jointsbycategory_5 = CTCategoryJointsRules(main_beam_category="DIAGONAL", cross_beam_category="DIAGONAL", step_depth=num_2)  # -> TStepJoint; inputs main_beam_category: String, cross_beam_category: String; same code as jointsbycategory
entwine_2 = Entwine(Branch01=beam_4.Beam, Branch02=beam_5.Beam, Branch03=beam.Beam, FlattenInputs=True)
model = CTModel(Elements=flatten(platefromthickness_2.Plate))  # -> Model, Geometry, DebugInfo; inputs Elements: list, Containers: list, JointRules: list, Features: list, MaxDistance: Double, CreateGeometry: Boolean
#   port Elements: Collection of Beams
#   port Containers: Container elements, such as walls, floors, roofs, etc.
#   port JointRules: Collection of joint rules.
#   port Features: Collection of feature definitions.
#   port MaxDistance: Max Distance Tolerance for topology detection.
#   port CreateGeometry: If True, Beam and joint geometry is created for visualization.
#   port Model: Model object.
#   port Geometry: Geometry of the beams and joints.
#   port DebugInfo: Debug information object in the case of feature or joining errors.
# ---------- model: Python ----------
# r: compas_timber>=1.0.2
"""Creates an Model"""

import Grasshopper
import Rhino
import System
from compas.scene import Scene
from compas.tolerance import TOL
from compas.tolerance import Tolerance

from compas_timber.design import DebugInfomation
from compas_timber.design import JointRuleSolver
from compas_timber.design import WallPopulator
from compas_timber.elements import Beam
from compas_timber.elements import Plate
from compas_timber.errors import FeatureApplicationError
from compas_timber.ghpython import error
from compas_timber.ghpython import warning
from compas_timber.model import TimberModel

# workaround for https://github.com/gramaziokohler/compas_timber/issues/280
TOL.absolute = 1e-6


class ModelComponent(Grasshopper.Kernel.GH_ScriptInstance):
    @property
    def component(self):
        return ghenv.Component  # type: ignore

    def RunScript(self,
            Elements: System.Collections.Generic.List[object],
            Containers: System.Collections.Generic.List[object],
            JointRules: System.Collections.Generic.List[object],
            Features: System.Collections.Generic.List[object],
            MaxDistance: float,
            CreateGeometry: bool):
        # this used to be default behavior in Rhino7.. I think..
        Elements = Elements or []
        Containers = Containers or []
        JointRules = JointRules or []
        Features = Features or []

        if not Elements:
            warning(self.component, "Input parameter Beams failed to collect data")
        if not JointRules:
            warning(self.component, "Input parameter JointRules failed to collect data")
        if not (Elements or Containers):  # shows beams even if no joints are found
            return
        if MaxDistance is None:
            MaxDistance = TOL.ABSOLUTE  # compared to calculted distance, so shouldn't be just 0.0

        tol = self.get_tol()
        Model = TimberModel(tolerance=tol)
        debug_info = DebugInfomation()

        ##### Adding elements #####
        self.add_elements_to_model(Model, Elements, Containers)

        ##### Wall populating #####
        handled_pairs, wall_joints = self.handle_populators(Model, Containers, MaxDistance)

        ##### Handle joinery #####
        # checks elements compatibility and generates Joints
        JointRules = [j for j in JointRules if j is not None]

        solver = JointRuleSolver(JointRules, max_distance=MaxDistance)
        joint_errors, _ = solver.apply_rules_to_model(Model)  # TODO: figure out best way to pass out unjoined_clusters

        for je in joint_errors:
            debug_info.add_joint_error(je)

        # applies extensions and features resulting from joints
        bje = Model.process_joinery()
        if bje:
            debug_info.add_joint_error(bje)

        ##### Handle user features #####
        if Features:
            feature_errors = self.handle_features(Features)
            debug_info.add_feature_error(feature_errors)

        ##### Visualization #####
        Geometry, errors = self.handle_geometry(Model, CreateGeometry)
        for geo_error in errors:
            debug_info.add_feature_error(geo_error)

        ##### Error Handling #####
        if debug_info.has_errors:
            warning(self.component, "Error found during joint creation. See DebugInfo output for details.")

        return Model, Geometry, debug_info

    def get_tol(self):
        units = Rhino.RhinoDoc.ActiveDoc.GetUnitSystemName(True, True, True, True)
        if units == "m":
            return Tolerance(unit="M", absolute=1e-6, relative=1e-6)
        elif units == "mm":
            return Tolerance(unit="MM", absolute=1e-3, relative=1e-3)
        else:
            error(self.component, f"Unsupported unit: {units}")
            return

    def add_elements_to_model(self, model, elements, containers):
        """Adds elements to the model and groups them by slab."""
        elements = [e for e in elements if e is not None]
        for element in elements:
            element.reset()
            model.add_element(element)

        containers = [c for c in containers if c is not None]

        for index, c_def in enumerate(containers):
            slab = c_def.slab
            model.add_group_element(slab, name=slab.name + str(index))

    def handle_populators(self, model, containers, max_distance):
        # Handle wall populators
        model.connect_adjacent_walls()
        config_sets = [c_def.config_set for c_def in containers]
        populators = []
        if any(config_sets):
            populators = WallPopulator.from_model(model, config_sets)

        handled_pairs = []
        wall_joints = []
        for populator, slab in zip(populators, list(model.slabs)):
            elements = populator.create_elements()
            model.add_elements(elements, parent=slab.name)
            joint_definitions = populator.create_joints(elements, max_distance)
            wall_joints.extend(joint_definitions)
            for j_def in joint_definitions:
                element_a, element_b = j_def.elements
                handled_pairs.append({element_a, element_b})

        return handled_pairs, wall_joints

    def handle_features(self, features):
        feature_errors = []
        features = [f for f in features if f is not None]
        for f_def in features:
            if not f_def.elements:
                warning(self.component, "Features defined in model must have elements defined. Features without elements will be ignored")
                continue

            for element in f_def.elements:
                try:
                    element.add_features(f_def.feature_from_element(element))
                except FeatureApplicationError as ex:
                    feature_errors.append(ex)
        return feature_errors

    def handle_geometry(self, Model, CreateGeometry):
        scene = Scene()
        errors = []
        for element in Model.elements():
            if CreateGeometry:
                scene.add(element.geometry)
                if getattr(element, "debug_info", False):
                    errors.append(element.debug_info)
            else:
                if isinstance(element, Beam):
                    scene.add(element.blank)
                elif isinstance(element, Plate):
                    scene.add(element.shape)
                else:
                    scene.add(element.geometry)
        return scene.draw(), errors
# ---------- end model ----------
merge = Merge(Data1=jointsbycategory, Data2=jointsbycategory_2)
model_2 = CTModel(Elements=flatten(entwine), JointRules=flatten(merge), CreateGeometry=Toggle(True))  # -> Model, Geometry, DebugInfo; inputs Elements: list, Containers: list, JointRules: list, Features: list, MaxDistance: Double, CreateGeometry: Boolean; same code as model
merge_2 = Merge(Data1=jointsbycategory_3, Data2=jointsbycategory_4, Data3=jointsbycategory_5)
panel = Panel("""0.2
0.2
 5""")
model_3 = CTModel(Elements=flatten(entwine_2), JointRules=flatten(merge_2), CreateGeometry=Toggle(True))  # -> Model, Geometry, DebugInfo; inputs Elements: list, Containers: list, JointRules: list, Features: list, MaxDistance: Double, CreateGeometry: Boolean; same code as model
bakewplatesithboxmap = CTBakePlatesWithBoxMap(model=model.Model, map_size=panel, swap_uv=Toggle(True), bake=Button())  # inputs map_size: list of Double, swap_uv: Boolean, bake: Boolean
#   port model: Model object (optional).
#   port map_size: Scaling of the BoxMap in x,y,z directions (list of three positive values) (optional).
#   port swap_uv: Rotates the BoxMap 90 degrees (optional).
#   port bake: Set to True to Bake. Nothing happens if None or False.
# ---------- bakewplatesithboxmap: Python ----------
# r: compas_timber>=1.0.2
# flake8: noqa
import math
import random

import Grasshopper
import System
import Rhino
import rhinoscriptsyntax as rs
from compas_rhino.conversions import frame_to_rhino

from compas_timber.ghpython.ghcomponent_helpers import item_input_valid_cpython
from Rhino import Render
from Rhino.Geometry import Interval
from Rhino.Geometry import Plane


class BakePlateMap(Grasshopper.Kernel.GH_ScriptInstance):
    def RunScript(self,
            model,
            map_size: System.Collections.Generic.List[float],
            swap_uv: bool,
            bake: bool):
        if map_size and len(map_size) != 3:
            ghenv.Component.AddRuntimeMessage(
                Grasshopper.Kernel.GH_RuntimeMessageLevel.Error, "Input parameter MapSize requires exactly three float values (scale factors in x,y,z directions)"
            )
            return

        unit_system = Rhino.RhinoDoc.ActiveDoc.ModelUnitSystem

        if map_size:
            dimx, dimy, dimz = map_size
        else:
            # for the pine 251 material bitmap, rotated
            if unit_system == Rhino.UnitSystem.Meters:
                dimx = 1.0
                dimy = 1.0
                dimz = 1.0
            if unit_system == Rhino.UnitSystem.Centimeters:
                dimx = 100
                dimy = 100
                dimz = 100
            if unit_system == Rhino.UnitSystem.Millimeters:
                dimx = 1000
                dimy = 1000
                dimz = 1000

        if not item_input_valid_cpython(ghenv, model, "Model"):
            return

        if not bake:
            return

        try:
            frames = [frame_to_rhino(b.frame) for b in model.plates]
            breps = [beam.geometry.native_brep for beam in model.plates]

            if frames and breps:
                rs.EnableRedraw(False)

                for brep, frame in zip(breps, frames):
                    guid = Rhino.RhinoDoc.ActiveDoc.Objects.Add(brep)
                    boxmap = self.create_box_map(frame, dimx, dimy, dimz, swap_uv)
                    Rhino.RhinoDoc.ActiveDoc.Objects.ModifyTextureMapping(guid, 1, boxmap)
        finally:
            rs.EnableRedraw(True)

    @staticmethod
    def create_box_map(pln, sx, sy, sz, swap_uv):
        """
        pln: frame of beam box, where x=main axis, y=width, z=height
        sx,sy,sz: box map size in x,y,z direction
        """

        v = pln.YAxis
        w = pln.ZAxis
        pt = pln.Origin

        # random deviation
        a = math.pi * 0.5
        randangle = (random.random() - 0.5) * a
        v.Rotate(randangle, pln.XAxis)

        b = math.pi * 0.01
        randangle = (random.random() - 0.5) * b
        w.Rotate(randangle, pln.XAxis)

        randpos = sx * random.random()
        pt += pln.XAxis * randpos

        # create box mapping
        mappingPln = Plane(pt, w, v)
        dx = Interval(-sx * 0.5, sx * 0.5)
        dy = Interval(-sy * 0.5, sy * 0.5)
        dz = Interval(-sz * 0.5, sz * 0.5)
        if swap_uv:
            mappingPln.Rotate(math.radians(90), mappingPln.XAxis)
        BoxMap = Render.TextureMapping.CreateBoxMapping(mappingPln, dx, dy, dz, False)

        return BoxMap
# ---------- end bakewplatesithboxmap ----------
panel_2 = Panel("""0.2
0.2
5""")
unflatten = UnflattenTree(Tree=model_2.Geometry, Guide=entwine)
merge_3 = Merge(
    Data1=ColourSwatch(SwatchColor=RGB(255, 255, 255)),
    Data2=ColourSwatch(SwatchColor=RGB(189, 150, 60)),
    Data3=ColourSwatch(SwatchColor=RGB(75, 196, 156)))  # -> graft(Result)
panel_3 = Panel("""0.2
0.2
5""")
unflatten_2 = UnflattenTree(Tree=model_3.Geometry, Guide=entwine_2)
merge_4 = Merge(
    Data1=ColourSwatch(SwatchColor=RGB(255, 255, 255)),
    Data2=ColourSwatch(SwatchColor=RGB(189, 150, 60)),
    Data3=ColourSwatch(SwatchColor=RGB(75, 196, 156)),
    Data4=ColourSwatch(SwatchColor=RGB(255, 94, 94)))  # -> graft(Result)
bakewplatesithboxmap_2 = CTBakePlatesWithBoxMap(model=model_2.Model, bake=Button())  # inputs map_size: list of Double, swap_uv: Boolean, bake: Boolean; same code as bakewplatesithboxmap
bakewithboxmap = CTBakeWithBoxMap(model=model_2.Model, map_size=panel_2, bake=Button())  # inputs map_size: list of Double, bake: Boolean
#   port model: Model object (optional).
#   port map_size: Scaling of the BoxMap in x,y,z directions (list of three positive values) (optional).
#   port bake: Set to True to Bake. Nothing happens if None or False.
# ---------- bakewithboxmap: Python ----------
# r: compas_timber>=1.0.2
# flake8: noqa
import math
import random

import Grasshopper
import System
import Rhino
import rhinoscriptsyntax as rs
from compas_rhino.conversions import frame_to_rhino
from compas_timber.ghpython import item_input_valid_cpython

from Rhino import Render
from Rhino.Geometry import Interval
from Rhino.Geometry import Plane


class BakeBoxMap(Grasshopper.Kernel.GH_ScriptInstance):
    def RunScript(self,
            model,
            map_size: System.Collections.Generic.List[float],
            bake: bool):
        if map_size and len(map_size) != 3:
            ghenv.Component.AddRuntimeMessage(
                Grasshopper.Kernel.GH_RuntimeMessageLevel.Error, "Input parameter MapSize requires exactly three float values (scale factors in x,y,z directions)"
            )
            return

        unit_system = Rhino.RhinoDoc.ActiveDoc.ModelUnitSystem

        if map_size:
            dimx, dimy, dimz = map_size
        else:
            # for the pine 251 material bitmap, rotated
            if unit_system == Rhino.UnitSystem.Meters:
                dimx = 0.2
                dimy = 0.2
                dimz = 1.0
            if unit_system == Rhino.UnitSystem.Centimeters:
                dimx = 20
                dimy = 20
                dimz = 100
            if unit_system == Rhino.UnitSystem.Millimeters:
                dimx = 200
                dimy = 200
                dimz = 1000

        if not item_input_valid_cpython(ghenv, model, "Model"):
            return

        if not bake:
            return

        try:
            frames = [frame_to_rhino(b.frame) for b in model.beams]
            breps = [beam.geometry.native_brep for beam in model.beams]

            if frames and breps:
                rs.EnableRedraw(False)

                for brep, frame in zip(breps, frames):
                    guid = Rhino.RhinoDoc.ActiveDoc.Objects.Add(brep)
                    boxmap = self.create_box_map(frame, dimx, dimy, dimz)
                    Rhino.RhinoDoc.ActiveDoc.Objects.ModifyTextureMapping(guid, 1, boxmap)
        finally:
            rs.EnableRedraw(True)

    @staticmethod
    def create_box_map(pln, sx, sy, sz):
        """
        pln: frame of beam box, where x=main axis, y=width, z=height
        sx,sy,sz: box map size in x,y,z direction
        """

        v = pln.YAxis
        w = pln.ZAxis
        pt = pln.Origin

        # random deviation
        a = math.pi * 0.5
        randangle = (random.random() - 0.5) * a
        v.Rotate(randangle, pln.XAxis)

        b = math.pi * 0.01
        randangle = (random.random() - 0.5) * b
        w.Rotate(randangle, pln.XAxis)

        randpos = sx * random.random()
        pt += pln.XAxis * randpos

        # create box mapping
        mappingPln = Plane(pt, w, v)
        dx = Interval(-sx * 0.5, sx * 0.5)
        dy = Interval(-sy * 0.5, sy * 0.5)
        dz = Interval(-sz * 0.5, sz * 0.5)

        BoxMap = Render.TextureMapping.CreateBoxMapping(mappingPln, dx, dy, dz, False)

        return BoxMap
# ---------- end bakewithboxmap ----------
wires = BrepWireframe(Brep=unflatten, Density=-1)
bakewithboxmap_2 = CTBakeWithBoxMap(model=model_3.Model, map_size=panel_3, bake=Button())  # inputs map_size: list of Double, bake: Boolean; same code as bakewithboxmap
preview = CustomPreview(Geometry=unflatten, Material=merge_3)
wires_2 = BrepWireframe(Brep=unflatten_2, Density=-1)
preview_2 = CustomPreview(Geometry=wires, Material=ColourSwatch(SwatchColor=RGB(255, 255, 255)))
preview_3 = CustomPreview(Geometry=unflatten_2, Material=merge_4)
preview_4 = CustomPreview(Geometry=wires_2, Material=ColourSwatch(SwatchColor=RGB(255, 255, 255)))
crv_8 = Curve([<curve referenced from the Rhino model> x560])
crv_9 = Curve([<curve referenced from the Rhino model> x256])
merge_5 = Merge(Data1=crv_8, Data2=crv_9)
explode = Explode(Curve=merge_5, Recursive=True)  # -> flatten(Segments), Vertices
llinter = LineLineIntersectionKaramba3D(IntersectingLines=explode.Segments, LinesToIntersect=explode.Segments, LimitDistance_m=0.005)  # -> flatten(InterSecPoints), flatten(LineSubSegments)
rdlines = RemoveDuplicateLinesKaramba3D(Line=llinter.LineSubSegments, LimitDistance=0.005)  # -> OutLine, Info, Indexes
rdpoints = RemoveDuplicatePointsKaramba3D(Point=llinter.InterSecPoints, LimitDistance=0.005)  # -> OutPoint, Info, Indexes
line = Line(rdlines.OutLine)
pt = Point([Point(193.5400008, 93.10000076, 16.1), Point(193.5400008, 102.7200008, 16.1), Point(203.1600008, 102.7200008, 20.1), Point(203.1600008, 93.10000076, 20.1)])
pt_2 = Point(rdpoints.OutPoint)
sph = Sphere(Base=pt, Radius=Slider(0.54, range=0..1))
rec = Rectangle({Plane=PlaneXY(198.3500008, 97.91000076, 24.8), Size=Domain2(u=-9.62..9.62, v=-14.43..14.43)})

line_2 = Line()
len = Length(Curve=line_2)
bnd = Bounds(Numbers=len)
dom = ConstructDomain(DomainStart=Slider(0.048, range=0..1), DomainEnd=Slider(0.242, range=0..1))
dedomain = DeconstructDomain(Domain=bnd)  # -> Start, End
midpt = CurveMiddle(Curve=line_2)
remap = RemapNumbers(Value=len, Source=bnd, Target=dom)  # -> Mapped, Clipped
gradient = Gradient(
    LowerLimit=dedomain.End,
    UpperLimit=dedomain.Start,
    Parameter=len,
    stops=[0: RGB(234, 38, 0), 0.25: RGB(234, 126, 0), 0.5: RGB(254, 244, 84), 0.75: RGB(173, 203, 249), 1: RGB(75, 107, 169)])
yz = YZPlane(Origin=midpt)
tag = TextTag3D(Location=yz, Text=len, Size=Slider(0.067, range=0..1), Justification=7)
line_prev = TTLineweightPreview(Geometry=line_2, StrokeColor=gradient, StrokeWeight=remap.Mapped, Absolute=Toggle(True))

brepsinc = PointInBreps(Brep=sph, Point=pt_2, Strict=False)  # -> Inside, Index
explode_2 = Explode(Curve=rec, Recursive=True)  # -> Segments, Vertices
cull = CullPattern(List=pt_2, CullPattern=brepsinc.Inside)

# ----
# C. Set Support
fsim = FindSimilarMember(Data=pt, Set=pt_2)  # -> Hit, Index
pt_3 = Point(cull)
xy = XYPlane(Origin=Point(0, 0, 0))
supp = SupportKaramba3D(
    PosInd=pt_3,
    PlaneOfReference=xy,
    Ct_kN_m=Vector(0, 0, 0),
    Cr_kNm_rad=Vector(0, 0, 0),
    menu=[buttons(on, on, on, on, on, on)])
item = ListItem(List=pt_3, Index=0, Wrap=True)

pt_4 = Point(pt_2)

# ----
# B. Create Beams
number_slider = Slider(20, range=0..100)
number_slider_2 = Slider(16, range=0..100)
matselect = MaterialSelectionKaramba3D(menu=[dropdown(1), dropdown(4), dropdown(11)])
crosec = CrossSectionKaramba3D(
    FamilyNameOfCrossSection="DefaultCroSec",
    Material=matselect,
    Height_cm=number_slider,
    UpperFlangeWidth_cm=number_slider_2,
    LowerFlangeWidth_cm=number_slider_2,
    mode="Trapezoid")
line_3 = Line(line)
lineelem = CreateLinearElementKaramba3D(
    Line=line_3,
    Identifier="XZ",
    CrossSection=crosec,
    LimitDistance_m=0.005,
    BucklingLengthY_m=-1,
    BucklingLengthZ_m=-1,
    BucklingLengthLT_m=-1,
    Bending=True,
    ToPolylineMaxAngle=0.25,
    ToPolylineTolerance=0.1,
    ToPolylineMaxEdgeLength=0.25,
    New=True,
    Remove=True,
    mode="LineToBeam",
    GuidGeneratorSeed=-2066765909)  # -> Element, Points, Info

number_slider_3 = Slider(2000, range=0..20000)
number_slider_4 = Slider(2000, range=0..20000)
vec = VectorXYZ(XComponent=number_slider_3, YComponent=number_slider_3, ZComponent=number_slider_3)  # -> Vector, Length
vec_2 = VectorXYZ(XComponent=number_slider_4, YComponent=number_slider_4, ZComponent=number_slider_4)  # -> Vector, Length

# ----
# E. Set Joints
beam_joints = BeamJointsKaramba3D(
    BeamIdentifier="XZ",
    CtKNMAtStartingNode=Vector(0, 0, 0),
    CrKNmRadAtStartingNode=vec.Vector,
    CtKNMAtEndNode=Vector(0, 0, 0),
    CrKNmRadAtEndNode=vec_2.Vector,
    menu=[buttons(off, off, off, on, on, on), buttons(off, off, off, on, on, on)])

# ----
# F. Optimize Cross Sections
number_slider_5 = Slider(2, range=0..10)
number_slider_6 = Slider(12, range=0..100)
number_slider_7 = Slider(16, range=0..100)
number_slider_8 = Slider(20, range=0..100)
matselect_2 = MaterialSelectionKaramba3D(menu=[dropdown(1), dropdown(4), dropdown(11)])
series = Series(Start=number_slider_6, Step=number_slider_5, Count=10)
series_2 = Series(Start=number_slider_7, Step=Slider(2, range=0..10), Count=10)
series_3 = Series(Start=number_slider_8, Step=Slider(2, range=0..10), Count=10)
panel_4 = Panel(series)
panel_5 = Panel(series_2)
panel_6 = Panel(series_3)
crosec_2 = CrossSectionKaramba3D(
    FamilyNameOfCrossSection="DefaultCroSec",
    Material=matselect_2,
    Height_cm=series,
    UpperFlangeWidth_cm=number_slider_6,
    LowerFlangeWidth_cm=number_slider_6,
    mode="Trapezoid")
crosec_3 = CrossSectionKaramba3D(
    FamilyNameOfCrossSection="DefaultCroSec",
    Material=matselect_2,
    Height_cm=series_2,
    UpperFlangeWidth_cm=number_slider_7,
    LowerFlangeWidth_cm=number_slider_7,
    mode="Trapezoid")
crosec_4 = CrossSectionKaramba3D(
    FamilyNameOfCrossSection="DefaultCroSec",
    Material=matselect_2,
    Height_cm=series_3,
    UpperFlangeWidth_cm=number_slider_8,
    LowerFlangeWidth_cm=number_slider_8,
    mode="Trapezoid")  # disabled
merge_6 = Merge(Data1=crosec_2, Data2=crosec_3, Data3=crosec_4)
crosec_5 = CrossSectionKaramba3D(merge_6)

addition = Addition(A=Slider(6.5, range=0..10), B=4)
Z_2 = UnitZ(Factor=addition)
pt_5 = Point(Point(188.7300008, 83.48000076, 24.8))
move = Move(Geometry=item, Motion=Z_2)  # -> Geometry, Transform
xz = XZPlane(Origin=pt_5)
panel_7 = Panel("""0.2
0.2
5""")
panel_8 = Panel("""0.2
0.2
5""")

# ----
# D. Set Loads
# * facade load?
# * snow, wind, etc. load?
pt_6 = Point(pt_2)
item_2 = ListItem(List=explode_2.Segments, Index=0, Wrap=True)  # -> Item, Item1, Item2
pdecon = Deconstruct(Point=pt_6)  # -> XComponent, YComponent, ZComponent
pt_7 = Point(pt_2)
crv_cp = CurveClosestPoint(Point=pt_7, Curve=item_2.Item)  # -> Point, Parameter, Distance
sort = SortList(Keys=pdecon.ZComponent, ValuesA=pt_6)  # -> reverse(Keys), reverse(ValuesA)
round = Round(Number=crv_cp.Distance)  # -> Nearest, Floor, Ceiling
similar = Similarity(FirstNumber=round.Nearest, SecondNumber="0", Threshold=0.1)  # -> Similarity, AbsoluteDifference
cull_2 = CullPattern(List=pt_7, CullPattern=similar.Similarity)
Z_3 = UnitZ(Factor="-1.1")
Z_4 = UnitZ(Factor="-9")
loads = LoadsKaramba3D(Vector=Vector(0, 0, -1), LCase="LC0", mode="Gravity")

crv_cp_2 = CurveClosestPoint(Point=pt_4, Curve=item_2.Item2)  # -> Point, Parameter, Distance
item_3 = ListItem(List=sort.Keys, Index=0, Wrap=True)
round_2 = Round(Number=crv_cp_2.Distance)  # -> Nearest, Floor, Ceiling
similar_2 = Similarity(FirstNumber=round_2.Nearest, SecondNumber="0", Threshold=0.1)  # -> Similarity, AbsoluteDifference
cull_3 = CullPattern(List=pt_4, CullPattern=similar_2.Similarity)

similar_3 = Similarity(FirstNumber=sort.Keys, SecondNumber=item_3, Threshold=0.1)  # -> Similarity, AbsoluteDifference
cull_4 = CullPattern(List=sort.ValuesA, CullPattern=similar_3.Similarity)
del = DelaunayMesh(Points=cull_4, Plane=PlaneXY(0, 0, 0))
quad = Quadrangulate(Mesh=del, Angle=0.03490658504, Ratio=0.875)  # -> Mesh, Count
pt_8 = Point([cull_2, cull_3])
loads_2 = LoadsKaramba3D(ForceVector=Z_4, Local=False, PosInd=pt_8, LCase="LC0", mode="Point")
loads_3 = LoadsKaramba3D(Vector=Z_3, Mesh=del, LCase="LC0", mode="MeshLoad -Const.", menu=[buttons(on, off, off), buttons(on, on)])
merge_7 = Merge(Data1=loads, Data2=loads_2, Data3=loads_3)  # -> flatten(Result)
load = LoadKaramba3D(merge_7)

# ----
# A. Create Panels
number_slider_9 = Slider(6, range=0..100)
explode_3 = MeshExplode(Mesh=del, Interpolate=False)  # -> flatten(Faces)
matselect_3 = MaterialSelectionKaramba3D(menu=[dropdown(1), dropdown(4), dropdown(11)])
crosec_6 = CrossSectionKaramba3D(FamilyNameOfCrossSection="DefaultCroSec", Material=matselect_3, Height_cm=number_slider_9, mode="Shell - Const")
surfelem = CreateSurfaceElementKaramba3D(Mesh=explode_3, Identifier="XZ", CrossSection=crosec_6, LimitDistance_m=0.005, Bending=True, mode="MeshToShell")  # -> Element, Points, Info

merge_8 = Merge(Data1=surfelem.Element, Data2=lineelem.Element)
element = ElementKaramba3D(merge_8)
assemble = AssembleModelKaramba3D(Elem=element, Support=supp, Load=load, Joint=beam_joints, LimitDistance_m=0.005)  # -> Model, Info, Mass_kg, CentreOfGravity, LoadCaseNames
opticrosec = OptimizeCrossSectionKaramba3D(
    Model=assemble.Model,
    CrossSections=crosec_5,
    MaximumUtilization=1,
    MaximumDisplacement_cm=-1,
    MaximumVirtualWork_kNcm=0.01,
    NumberOfUtilizationIterations=5,
    NumberOfDisplacementIterations=5,
    NumberOfDisplacementIncrementsPerIteration=2,
    DisplacementTolerance=0.01,
    NumberOfSamplePoints=3,
    ElasticDesign=True,
    GammaM0=1,
    GammaM1=1.1,
    SwayFrame=True)  # -> OptimizedModel, Info, Mass_kg, MaximumDisplacement_cm, ElasticEnergyChange_kNm, MaximumUtilizationViewInsufficientCrossSections, MaximumDisplacementViewLimitCrossSections
panel_9 = Panel(opticrosec.Mass_kg)
analyse = AnalyseKaramba3D(Model=opticrosec.OptimizedModel)  # -> AnalysedModel, MaximumDisplacement_cm, ResultingForce_kN, ChangeOfElasticEnergy_kNm
panel_10 = Panel(analyse.MaximumDisplacement_cm)
modelview = ModelViewKaramba3D(Model=analyse.AnalysedModel)  # -> Model, DeformedMesh, DeformedAxes, DeformedModel, MaximumDeformation
panel_11 = Panel(analyse.MaximumDisplacement_cm)
tag_2 = TextTag3D(Location=xz, Text=panel_10, Size=Slider(1.8, range=0..10), Justification=7)
disassemble = DisassembleModelKaramba3D(Model=modelview.Model)  # -> Model, Point, Beam, Shell, Support, Load, Line, Mesh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
beamview = BeamViewKaramba3D(Model=modelview.Model)  # -> Model, MeshesOfRenderedBeams, DeformedBeamAxes, LegendColours, LegendTags
disassemble_2 = DisassembleElementKaramba3D(Element=disassemble.Beam)  # -> Element, ElementIdentifier, AxisOfElement, CrossSection, Joint, Material, LocalCoordinateSystem, ElementIsActive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
legend = LegendKaramba3D(
    Colors=beamview.LegendColours,
    Tags=beamview.LegendTags,
    Scale=0.8,
    Textsize=30,
    Legend_HasHeader=False,
    Legend_Justification=1,
    Legend_Position=2)
shellview = ShellViewKaramba3D(Model=modelview.Model, IndexOfLayer=0)  # -> Model, MeshesOfRenderedShells, LegendColours, LegendTags
mesh = Mesh(beamview.MeshesOfRenderedBeams)
disassemble_3 = DisassembleCrossSectionKaramba3D(CroSec=disassemble_2.CrossSection)  # -> CrossSection, FamilyNameOfCrossSection, TypeNameOfCrossSection, ElemIdentifiers, Colour, Material, LocalEccentricity_cm, flatten(Heights_cm)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
multiplication = Multiplication(A=disassemble_3.Heights_cm, B=disassemble_3.MaximumWidth_cm)

line_4 = Line()
bnd_2 = Bounds(Numbers=multiplication)
dom_2 = ConstructDomain(DomainStart=Slider(0.048, range=0..1), DomainEnd=Slider(0.242, range=0..1))
dedomain_2 = DeconstructDomain(Domain=bnd_2)  # -> Start, End
midpt_2 = CurveMiddle(Curve=line_4)
remap_2 = RemapNumbers(Value=multiplication, Source=bnd_2, Target=dom_2)  # -> Mapped, Clipped
gradient_2 = Gradient(
    LowerLimit=dedomain_2.End,
    UpperLimit=dedomain_2.Start,
    Parameter=multiplication,
    stops=[0: RGB(234, 38, 0), 0.25: RGB(234, 126, 0), 0.5: RGB(254, 244, 84), 0.75: RGB(173, 203, 249), 1: RGB(75, 107, 169)])
yz_2 = YZPlane(Origin=midpt_2)
tag_3 = TextTag3D(Location=yz_2, Text=multiplication, Size=Slider(0.067, range=0..1), Justification=7)
line_prev_2 = TTLineweightPreview(Geometry=line_4, StrokeColor=gradient_2, StrokeWeight=remap_2.Mapped, Absolute=Toggle(True))

volume = Volume(Geometry=mesh)  # -> Volume, Centroid
deplane = DeconstructPlane(Plane=disassemble_2.LocalCoordinateSystem)  # -> Origin, XAxis, YAxis, ZAxis
ma = MassAddition(Input=volume.Volume)  # -> Result, PartialResults
multiplication_2 = Multiplication(A=disassemble_3.Heights_cm, _001=0.01)
panel_12 = Panel(ma.PartialResults)
multiplication_3 = Multiplication(A=disassemble_3.MaximumWidth_cm, _001=0.01)
cset = CreateSet(List=flatten(disassemble_3.Heights_cm))  # -> Set, Map
cset_2 = CreateSet(List=flatten(disassemble_3.MaximumWidth_cm))  # -> Set, Map
beam_6 = CTBeam(centerline=disassemble_2.AxisOfElement, z_vector=deplane.ZAxis, width=multiplication_3, height=multiplication_2)  # -> Beam, Blank; inputs centerline: list, z_vector: list of Vector3d, width: list of Double, height: list of Double, category: list of String, updateRefObj: Boolean; disabled; same code as beam
panel_13 = Panel(cset.Set)
panel_14 = Panel(cset_2.Set)
item_4 = ListItem(List=beam_6.Beam, Index=0, Wrap=True)  # -> Item, Item1
model_4 = CTModel(Elements=flatten(beam_6.Beam))  # -> Model, Geometry, DebugInfo; inputs Elements: list, Containers: list, JointRules: list, Features: list, MaxDistance: Double, CreateGeometry: Boolean; disabled; same code as model
panel_15 = Panel(disassemble_3.Heights_cm)

# ---- group: Output: Mesh
bakewithboxmap_3 = CTBakeWithBoxMap(model=model_4.Model, map_size=panel_7, bake=Button())  # inputs map_size: list of Double, bake: Boolean
#   port model: Model object (optional).
#   port map_size: Scaling of the BoxMap in x,y,z directions (list of three positive values) (optional).
#   port bake: Set to True to Bake. Nothing happens if None or False.
# ---------- bakewithboxmap_3: Python ----------
# r: compas_timber>=1.0.2
# flake8: noqa
import math
import random

import Grasshopper
import System
import Rhino
import rhinoscriptsyntax as rs
from compas_rhino.conversions import frame_to_rhino
from compas_timber.ghpython import item_input_valid_cpython

from Rhino import Render
from Rhino.Geometry import Interval
from Rhino.Geometry import Plane

from Rhino.Geometry import Box, Mesh
from compas_rhino.conversions import box_to_rhino

class BakeBoxMap(Grasshopper.Kernel.GH_ScriptInstance):
    def RunScript(self,
            model,
            map_size: System.Collections.Generic.List[float],
            bake: bool):
        if map_size and len(map_size) != 3:
            ghenv.Component.AddRuntimeMessage(
                Grasshopper.Kernel.GH_RuntimeMessageLevel.Error, "Input parameter MapSize requires exactly three float values (scale factors in x,y,z directions)"
            )
            return

        unit_system = Rhino.RhinoDoc.ActiveDoc.ModelUnitSystem

        if map_size:
            dimx, dimy, dimz = map_size
        else:
            # for the pine 251 material bitmap, rotated
            if unit_system == Rhino.UnitSystem.Meters:
                dimx = 0.2
                dimy = 0.2
                dimz = 1.0
            if unit_system == Rhino.UnitSystem.Centimeters:
                dimx = 20
                dimy = 20
                dimz = 100
            if unit_system == Rhino.UnitSystem.Millimeters:
                dimx = 200
                dimy = 200
                dimz = 1000

        if not item_input_valid_cpython(ghenv, model, "Model"):
            return

        if not bake:
            return

        try:
            frames, meshes = [], []
            for beam in model.beams:
                frame = frame_to_rhino(beam.frame)
                frames.append(frame)

                box = beam.shape
                box = box_to_rhino(box)
                mesh = Mesh.CreateFromBox(box, 1, 1, 1)
                meshes.append(mesh)

            if frames and meshes:
                rs.EnableRedraw(False)

                for mesh, frame in zip(meshes, frames):
                    guid = Rhino.RhinoDoc.ActiveDoc.Objects.Add(mesh)
                    boxmap = self.create_box_map(frame, dimx, dimy, dimz)
                    Rhino.RhinoDoc.ActiveDoc.Objects.ModifyTextureMapping(guid, 1, boxmap)
        finally:
            rs.EnableRedraw(True)

    @staticmethod
    def create_box_map(pln, sx, sy, sz):
        """
        pln: frame of beam box, where x=main axis, y=width, z=height
        sx,sy,sz: box map size in x,y,z direction
        """

        v = pln.YAxis
        w = pln.ZAxis
        pt = pln.Origin

        # random deviation
        a = math.pi * 0.5
        randangle = (random.random() - 0.5) * a
        v.Rotate(randangle, pln.XAxis)

        b = math.pi * 0.01
        randangle = (random.random() - 0.5) * b
        w.Rotate(randangle, pln.XAxis)

        randpos = sx * random.random()
        pt += pln.XAxis * randpos

        # create box mapping
        mappingPln = Plane(pt, w, v)
        dx = Interval(-sx * 0.5, sx * 0.5)
        dy = Interval(-sy * 0.5, sy * 0.5)
        dz = Interval(-sz * 0.5, sz * 0.5)

        BoxMap = Render.TextureMapping.CreateBoxMapping(mappingPln, dx, dy, dz, False)

        return BoxMap
# ---------- end bakewithboxmap_3 ----------

# ----
bakewithboxmap_4 = CTBakeWithBoxMap(model=model_4.Model, map_size=panel_8, bake=Button())  # inputs map_size: list of Double, bake: Boolean
#   port model: Model object (optional).
#   port map_size: Scaling of the BoxMap in x,y,z directions (list of three positive values) (optional).
#   port bake: Set to True to Bake. Nothing happens if None or False.
# ---------- bakewithboxmap_4: Python ----------
# r: compas_timber>=1.0.2
# flake8: noqa
import math
import random

import Grasshopper
import System
import Rhino
import rhinoscriptsyntax as rs
from compas_rhino.conversions import frame_to_rhino
from compas_timber.ghpython import item_input_valid_cpython

from Rhino import Render
from Rhino.Geometry import Interval
from Rhino.Geometry import Plane


class BakeBoxMap(Grasshopper.Kernel.GH_ScriptInstance):
    def RunScript(self,
            model,
            map_size: System.Collections.Generic.List[float],
            bake: bool):
        if map_size and len(map_size) != 3:
            ghenv.Component.AddRuntimeMessage(
                Grasshopper.Kernel.GH_RuntimeMessageLevel.Error, "Input parameter MapSize requires exactly three float values (scale factors in x,y,z directions)"
            )
            return

        unit_system = Rhino.RhinoDoc.ActiveDoc.ModelUnitSystem

        if map_size:
            dimx, dimy, dimz = map_size
        else:
            # for the pine 251 material bitmap, rotated
            if unit_system == Rhino.UnitSystem.Meters:
                dimx = 0.2
                dimy = 0.2
                dimz = 1.0
            if unit_system == Rhino.UnitSystem.Centimeters:
                dimx = 20
                dimy = 20
                dimz = 100
            if unit_system == Rhino.UnitSystem.Millimeters:
                dimx = 200
                dimy = 200
                dimz = 1000

        if not item_input_valid_cpython(ghenv, model, "Model"):
            return

        if not bake:
            return

        try:
            # frames = [frame_to_rhino(b.frame) for b in model.beams]
            # breps = [beam.geometry.native_brep for beam in model.beams]

            # if frames and breps:
            #     rs.EnableRedraw(False)

            #     for brep, frame in zip(breps, frames):
            #         guid = Rhino.RhinoDoc.ActiveDoc.Objects.Add(brep)
            #         boxmap = self.create_box_map(frame, dimx, dimy, dimz)
            #         Rhino.RhinoDoc.ActiveDoc.Objects.ModifyTextureMapping(guid, 1, boxmap)
            #
            from compas.datastructures import Mesh
            from compas_rhino.conversions import mesh_to_rhino
            import Rhino.Geometry as rg
            frames, meshes = [], []
            for beam in model.beams:
                frame = frame_to_rhino(beam.frame)
                frames.append(frame)
                mesh = Mesh()

                brep = beam.geometry
                ms = brep.to_meshes()
                for m in ms:
                    mesh.join(m)
                rh_mesh = mesh_to_rhino(mesh)
                rh_mesh.Vertices.CombineIdentical(True, True)
                meshes.append(rh_mesh)

            if frames and meshes:
                rs.EnableRedraw(False)

                for mesh, frame in zip(meshes, frames):
                    guid = Rhino.RhinoDoc.ActiveDoc.Objects.Add(mesh)
                    boxmap = self.create_box_map(frame, dimx, dimy, dimz)
                    Rhino.RhinoDoc.ActiveDoc.Objects.ModifyTextureMapping(guid, 1, boxmap)

                

        finally:
            rs.EnableRedraw(True)

    @staticmethod
    def create_box_map(pln, sx, sy, sz):
        """
        pln: frame of beam box, where x=main axis, y=width, z=height
        sx,sy,sz: box map size in x,y,z direction
        """

        v = pln.YAxis
        w = pln.ZAxis
        pt = pln.Origin

        # random deviation
        a = math.pi * 0.5
        randangle = (random.random() - 0.5) * a
        v.Rotate(randangle, pln.XAxis)

        b = math.pi * 0.01
        randangle = (random.random() - 0.5) * b
        w.Rotate(randangle, pln.XAxis)

        randpos = sx * random.random()
        pt += pln.XAxis * randpos

        # create box mapping
        mappingPln = Plane(pt, w, v)
        dx = Interval(-sx * 0.5, sx * 0.5)
        dy = Interval(-sy * 0.5, sy * 0.5)
        dz = Interval(-sz * 0.5, sz * 0.5)

        BoxMap = Render.TextureMapping.CreateBoxMapping(mappingPln, dx, dy, dz, False)

        return BoxMap
# ---------- end bakewithboxmap_4 ----------
bakewithboxmap_5 = CTBakeWithBoxMap(model=model_4.Model, map_size=panel_7, bake=Button())  # inputs map_size: list of Double, bake: Boolean; same code as bakewithboxmap
