# Grasshopper definition dimond_shape_TOP.gh (Grasshopper 1.0.8)

curve = Curve(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)
cluster = Cluster(curve=curve)  # -> i, curve_2
python_3_script = Python3Script(crv1=cluster.i, crv2=cluster.curve_2)  # -> out, networks, mirror; inputs crv1: list of Curve, crv2: list of Curve
# ---------- python_3_script: Python ----------
from compas_rhino.conversions import curve_to_compas
from compas.geometry import NurbsCurve, Line,Point

networks = []

n1 = 4
nr = 3

nx2 = n1 * 2
ny2 = nr * 2

for c1_rhino, c2_rhino in zip(crv1, crv2):
    c1 = curve_to_compas(c1_rhino)
    c2 = curve_to_compas(c2_rhino)

    edge_start = NurbsCurve.from_line(Line(c1.start, c2.start))
    edge_end   = NurbsCurve.from_line(Line(c1.end, c2.end))

    grid2 = []
    for r in range(ny2 + 1):
        v2 = r / float(ny2)
        row_start = edge_start.point_at(v2)
        row_end   = edge_end.point_at(v2)
        rowline = NurbsCurve.from_line(Line(row_start, row_end))
        _, row = rowline.divide_by_count(nx2, True)
        grid2.append(row)


    def diagonal_segments(i, j, direction=1):
        step = min(nx2 - i, ny2 - j) if direction == 1 else min(i, ny2 - j)
        segs = []
        for k in range(step):
            p1 = grid2[j + k][i + direction * k]
            p2 = grid2[j + k + 1][i + direction * (k + 1)]
            segs.append(Line(p1, p2))
        return segs

    for i in range(0,nx2+1,2):
        networks.extend(diagonal_segments(i, 0,  1))   # /
        networks.extend(diagonal_segments(i, 0, -1))   # \

    for j in range(1,ny2):
        networks.extend(diagonal_segments(0,   j,  1))  # /
        networks.extend(diagonal_segments(nx2, j, -1))  # \
    
    mirror=[]
    axis_y = c1.start[1]

    for ln in networks:
        p1 = ln.start
        p2 = ln.end

        mp1 = Point(p1[0] ,2 * axis_y - p1[1], p1[2])
        mp2 = Point(p2[0] ,2 * axis_y - p2[1], p2[2])

        mirror.append(Line(mp1, mp2))
# ---------- end python_3_script ----------
compas_draw = COMPASDraw(cg=[python_3_script.networks, python_3_script.mirror])  # -> rg
#   port cg: The COMPAS geometry or datastructure to be drawn.
#   port rg: The Rhino geometry object.
# ---------- compas_draw: Python ----------
# r: compas>=2.14.1
"""
Draws COMPAS geometry in Grasshopper.
"""

from typing import Any

import Grasshopper

from compas.scene import SceneObject


class CompasToRhinoGeometry(Grasshopper.Kernel.GH_ScriptInstance):
    def RunScript(self, cg):
        if not cg:
            return None

        return SceneObject(item=cg).draw()
# ---------- end compas_draw ----------

# ==== cluster Cluster
curve = ClusterInput()
explode = Explode(Curve=curve, Recursive=True)  # -> Segments, Vertices
cull_pattern = CullPattern(List=explode.Segments, CullPattern=invert([False, True]))
list_item = ListItem(List=cull_pattern, Index=0, Wrap=True)  # -> Item, Item1
i = ClusterOutput(list_item.Item)
flip_curve = FlipCurve(Curve=list_item.Item1)  # -> Curve, Flag
curve_2 = ClusterOutput(flip_curve.Curve)
