# Grasshopper definition nadja_bracing.gh (Grasshopper 1.0.8)

py3 = Python3Script()  # -> out, v_list_out; inputs compute: Boolean
# ---------- py3: Python ----------
#locate class file in the same folder
from compas_rhino import unload_modules
import sys
import os

#get current file path
path = ghenv.Component.OnPingDocument().FilePath
#get parent directory of the parent directory
parentdir = os.path.dirname(path)
#get src folder which contains classes
dire = os.path.join(parentdir,'scripts')
sys.path.append(dire)

import Line_model_v3
unload_modules('Line_model_v3')

##########------------Imports------------###########
from Line_model_v3 import Beam
from compas_rhino.conversions import polyline_to_compas
from compas.geometry import Polygon, Plane, Line, Vector, intersection_segment_plane, Point
import math


#######------Conversions-------########


#########------Main Code------###############

if compute:
    # 4. Add vertex
    v1 = Line(start=v_list[74], end=(v_list[78])).midpoint
    v2 = Line(start=v_list[74], end=(v_list[75])).midpoint
    v3 = Line(start=v_list[75], end=(v_list[79])).midpoint
    v4 = Line(start=v_list[79], end=(v_list[78])).midpoint
    v5 = Line(start=v_list[76], end=(v_list[80])).midpoint
    v6 = Line(start=v_list[81], end=(v_list[80])).midpoint
    v7 = Line(start=v_list[77], end=(v_list[81])).midpoint
    v8 = Line(start=v_list[77], end=(v_list[76])).midpoint
    v9 = Line(start=v_list[64], end=(v_list[14])).midpoint
    v10 = Line(start=v_list[68], end=(v_list[20])).midpoint

    #---Important--- To avoid adding duplicate points and pairs
    v_list.reset_default()

    v_list.add_vertices([v1, v2, v3, v4, v5, v6, v7, v8, v9, v10])

    v_list.add_pairs([(64, 85), (82, 85), (65, 85)])
    v_list.add_pairs([(60, 86), (82, 86), (65, 86)])
    v_list.add_pairs([(66, 87), (82, 87), (65, 87)])
    v_list.add_pairs([(70, 88), (82, 88), (65, 88)])

    # top ortogonal
    v_list.add_pairs([(93, 64), (93, 15), (93, 14)])
    v_list.add_pairs([(94, 20), (94, 68), (94, 19)])

    v_list.add_pairs([(84, 90), (84, 91), (84, 92), (84, 89)])
    v_list.add_pairs([(67, 90), (67, 91), (67, 92), (67, 89)])
    v_list.add_pairs([(72, 90), (68, 91), (62, 92), (66, 89)])


    v_list.add_pairs([(87, 60), (87, 70), (87, 71), (87, 61), (89, 61), (89, 71), (89, 72), (89, 62)])
 
    skip_list = [75, 76, 80, 79]
    v_list.skip(skip_list)

    # intersecting lines 
    x_lines = []
    for v_pair in v_list.pairs:
        if v_list[v_pair[0]].z < v_list[82].z + 4.2 and v_list[v_pair[1]].z < v_list[82].z + 4.2:
            x_line = Line(v_list[v_pair[0]], v_list[v_pair[1]])
            x_lines.append(x_line)
    u = v_list[5] - v_list[13]
    v = v_list[27] - v_list[33]
    # start of the plane pt
    pt_one = Line(v_list[85], v_list[82]).point_at(.1)
    pt_two = Line(v_list[87], v_list[82]).midpoint
    pt_three = Line(v_list[89], v_list[84]).midpoint
    pt_four = Line(v_list[91], v_list[84]).point_at(.1)

    pl_points = [pt_one, pt_two, pt_three, pt_four]

    my_planes = []
    for pt in pl_points:
        plane_u = Plane(pt, u).rotated(math.pi/2, axis=[0,0,1], point=pt)
        plane_v = Plane(pt, v).rotated(-math.pi/2, axis=[0,0,1], point=pt)
        my_planes.append(plane_u)
        my_planes.append(plane_v)
    
    # intersect with beams 
    for ln in x_lines:
        for pl in my_planes:
            b_point = intersection_segment_plane(ln, pl)
            try:
                add_point = Point(b_point[0], b_point[1], b_point[2])
                v_list.add_vertices([add_point])
            except:
                continue
    
    # Bracing
    v_list.add_pairs([(100, 96), (100, 95), (101, 95), (105, 96), (101, 103), (105, 103)])
    v_list.add_pairs([(109, 97), (109, 98), (112, 97), (108, 98), (112, 113), (108, 113)])


#########----------Output data----------##############
v_list_out = v_list
print (len(v_list))
print (len(v_list.pairs))
# ---------- end py3 ----------
py3_2 = Python3Script()  # -> out, v_list_out; inputs compute: Boolean
# ---------- py3_2: Python ----------
#locate class file in the same folder
from compas_rhino import unload_modules
import sys
import os

#get current file path
path = ghenv.Component.OnPingDocument().FilePath
#get parent directory of the parent directory
parentdir = os.path.dirname(path)
#get src folder which contains classes
dire = os.path.join(parentdir,'scripts')
sys.path.append(dire)

import Line_model_v3
unload_modules('Line_model_v3')

##########------------Imports------------###########
from Line_model_v3 import Beam
from compas_rhino.conversions import polyline_to_compas
from compas.geometry import Polygon, Plane, Line, intersection_segment_plane
import math


#######------Conversions-------########


#########------Main Code------###############

if compute:
    # 4. Add vertex
    v1 = Line(start=v_list[74], end=(v_list[78])).midpoint
    v2 = Line(start=v_list[74], end=(v_list[75])).midpoint
    v3 = Line(start=v_list[75], end=(v_list[79])).midpoint
    v4 = Line(start=v_list[79], end=(v_list[78])).midpoint
    v5 = Line(start=v_list[76], end=(v_list[80])).midpoint
    v6 = Line(start=v_list[81], end=(v_list[80])).midpoint
    v7 = Line(start=v_list[77], end=(v_list[81])).midpoint
    v8 = Line(start=v_list[77], end=(v_list[76])).midpoint
    v9 = Line(start=v_list[64], end=(v_list[14])).midpoint
    v10 = Line(start=v_list[68], end=(v_list[20])).midpoint

    #---Important--- To avoid adding duplicate points and pairs
    v_list.reset_default()

    v_list.add_vertices([v1, v2, v3, v4, v5, v6, v7, v8, v9, v10])

    v_list.add_pairs([(64, 85), (82, 85), (65, 85)])
    v_list.add_pairs([(60, 86), (82, 86), (65, 86)])
    v_list.add_pairs([(66, 87), (82, 87), (65, 87)])
    v_list.add_pairs([(70, 88), (82, 88), (65, 88)])

    # top ortogonal
    v_list.add_pairs([(93, 64), (93, 15), (93, 14)])
    v_list.add_pairs([(94, 20), (94, 68), (94, 19)])

    v_list.add_pairs([(84, 90), (84, 91), (84, 92), (84, 89)])
    v_list.add_pairs([(67, 90), (67, 91), (67, 92), (67, 89)])
    v_list.add_pairs([(72, 90), (68, 91), (62, 92), (66, 89)])


    v_list.add_pairs([(87, 60), (87, 70), (87, 71), (87, 61), (89, 61), (89, 71), (89, 72), (89, 62)])
 
    skip_list = [75, 76, 80, 79]
    v_list.skip(skip_list)

    # intersecting lines 
    x_lines = []
    for v_pair in v_list.pairs:
        if v_list[v_pair[0]].z < v_list[82].z + 4.2 and v_list[v_pair[1]].z < v_list[82].z + 4.2:
            x_line = Line(v_list[v_pair[0]], v_list[v_pair[1]])
            x_lines.append(x_line)
    u = v_list[5] - v_list[13]
    v = v_list[27] - v_list[33]
    # start of the plane pt
    pt_one = Line(v_list[85], v_list[82]).point_at(.1)
    pt_two = Line(v_list[87], v_list[82]).midpoint
    pt_three = Line(v_list[89], v_list[84]).midpoint
    pt_four = Line(v_list[91], v_list[84]).point_at(.1)

    pl_points = [pt_one, pt_two, pt_three, pt_four]

    my_planes = []
    for pt in pl_points:
        plane_u = Plane(pt, u).rotated(math.pi/2, axis=[0,0,1], point=pt)
        plane_v = Plane(pt, v).rotated(-math.pi/2, axis=[0,0,1], point=pt)
        my_planes.append(plane_u)
        my_planes.append(plane_v)
    
    # intersect with beams 
    for ln in x_lines:
        for pl in my_planes:
            b_point = intersection_segment_plane(ln, pl)
            try:
                add_point = Point(b_point[0], b_point[1], b_point[2])
                v_list.add_vertices([add_point])
            except:
                continue
    
    # Bracing
    v_list.add_pairs([(100, 96), (100, 95), (101, 95), (105, 96), (101, 103), (105, 103)])
    v_list.add_pairs([(109, 97), (109, 98), (112, 97), (108, 98), (112, 113), (108, 113)])



#########----------Output data----------##############
v_list_out = v_list
print (len(v_list))
print (len(v_list.pairs))
# ---------- end py3_2 ----------
