# Grasshopper definition Script_setup_v1.ghx (Grasshopper 1.0.8)
# plug-ins: Karamba3D

# ----
# * Initialization
height = Panel("8.7")
height_2 = Panel("4.7")
div_x = Panel("4")
div_y = Panel("6")
rec = Rectangle({Plane=PlaneXY(163.5400008, 52.91000076, 24.8), Size=Domain2(u=-4.81..4.81, v=-14.43..14.43)})
rec_2 = Rectangle({Plane=PlaneXY(173.1600008, 52.91000076, 24.8), Size=Domain2(u=-4.81..4.81, v=-14.43..14.43)})

# ----
# * Params
panel = Panel("0")
galapagos = Galapagos()
merge = Merge(
    Data1=panel,
    Data2=Slider(0.562, range=0.001..1),
    Data3=Slider(1.816, range=1.001..3),
    Data4=Slider(3.915, range=3.001..5),
    Data5=height)
merge_2 = Merge(
    Data1=panel,
    Data2=Slider(0.281, range=0.001..0.7),
    Data3=Slider(0.807, range=0.701..1.5),
    Data4=Slider(2.178, range=1.501..3),
    Data5=height_2)

py3 = Python3Script(boundary=rec, div_x=div_x, div_y=div_y, height=height, height_list=merge)  # -> out, v_list_out, vertices_out, beams_out, lines_out, intersections, pln, facade_points, roof_points; inputs boundary: Polyline, div_x: Int32, div_y: Int32, height: Double, height_list: list of Double
# ---------- py3: Python ----------
#locate class file in the same folder
from compas_rhino import unload_modules
import sys
import os

#get current file path
path = ghenv.Component.OnPingDocument().FilePath
#get parent directory of the parent directory
parentdir = os.path.dirname(path)
#get src folder which contains classes
dire = os.path.join(parentdir,'scripts')
sys.path.append(dire)

unload_modules('Line_model_v2')


##########------------Imports------------###########
from Line_model_v2 import Beam, VertexList
from compas.geometry import Vector, Point, Line, Plane, Frame

from compas_rhino.conversions import point_to_compas, point_to_rhino
from compas_rhino.conversions import line_to_rhino
from compas_rhino.conversions import polyline_to_compas
from compas_rhino.conversions import plane_to_rhino
import math

from Grasshopper import DataTree
from Grasshopper.Kernel.Data import GH_Path

#######------Conversions-------########
# anchors = [point_to_compas(a) for a in anchors]
boundary = polyline_to_compas(boundary)

#########------Main Code------###############
# 1. Create generator
v_list = VertexList()
v_list.compute_diagrid(
    boundary=boundary,
    division_x=div_x,
    division_y=div_y,
    height=height,
    height_list=height_list
)
# print (v_list.pairs)
# print (len(v_list))

b = boundary
# 2. Skip certain vertices
skip_list = 83   # or [83]
v_list.skip(skip_list)


# 3. Group and Move certain vertices
from compas.geometry import is_point_in_convex_polygon_xy
from compas_rhino.conversions import polyline_to_compas
from compas.geometry import Polygon

def remap_number(value, from_min, from_max, to_min=0, to_max=1):
    return to_min + (to_max - to_min) * ((value - from_min) / (from_max - from_min))




# 5. Construct beams
beams = []
lines = []
for pair in v_list.pairs:
    beam = Beam(pair[0], pair[1], v_list)
    beams.append(beam)
    lines.append(beam.axis)


# . Add new vertices and pairs
# from compas.geometry import intersection_segment_plane
# origin = Beam(53, 21, v_list).mid
# frame = Frame(origin, v_list.dir2)
# pln = Plane(origin, frame.yaxis)
# intersections = []
# for ln in lines:
#     pt = intersection_segment_plane(ln, pln)
#     if pt is None:
#         continue
#     pt = Point(pt[0], pt[1], pt[2])
#     intersections.append(pt)
# pln = plane_to_rhino(pln)


#########----------Output data----------##############
v_list_out = v_list
beams_out = beams
vertices_out = list(v_list)
lines_out = lines

facade_points = v_list.facade_points
roof_points = v_list.roof_points
# ---------- end py3 ----------
py3_2 = Python3Script(boundary=rec_2, div_x=div_x, div_y=div_y, height=height_2, height_list=merge_2)  # -> out, v_list_out, vertices_out, beams_out, lines_out, intersections, pln, facade_points, roof_points; inputs boundary: Polyline, div_x: Int32, div_y: Int32, height: Double, height_list: list of Double; same code as py3
draw = COMPASDraw(cg=py3.intersections)  # -> rg
#   port cg: The COMPAS geometry or datastructure to be drawn.
#   port rg: The Rhino geometry object.
# ---------- draw: Python ----------
# r: compas>=2.14.1
"""
Draws COMPAS geometry in Grasshopper.
"""

from typing import Any

import Grasshopper

from compas.scene import SceneObject


class CompasToRhinoGeometry(Grasshopper.Kernel.GH_ScriptInstance):
    def RunScript(self, cg):
        if not cg:
            return None

        return SceneObject(item=cg).draw()
# ---------- end draw ----------
pln = Plane(py3.pln)

# ----
# * All Points
number_slider = Slider(0.41, range=0..1)
draw_2 = COMPASDraw(cg=py3.vertices_out)  # -> rg; same code as draw
draw_3 = COMPASDraw(cg=py3_2.vertices_out)  # -> rg; same code as draw
merge_3 = Merge(Data1=draw_2, Data2=draw_3)
points = PointList(Points=draw_2, Size=number_slider)
points_2 = PointList(Points=draw_3, Size=number_slider)
rdpoints = RemoveDuplicatePointsKaramba3D(Point=merge_3, LimitDistance=0.005)  # -> OutPoint, Info, Indexes
pt = Point(rdpoints.OutPoint)

# ----
# * Facade points
draw_4 = COMPASDraw(cg=py3.facade_points)  # -> rg; same code as draw
draw_5 = COMPASDraw(cg=py3_2.facade_points)  # -> rg; same code as draw
merge_4 = Merge(Data1=draw_4, Data2=draw_5)
rdpoints_2 = RemoveDuplicatePointsKaramba3D(Point=merge_4, LimitDistance=0.005)  # -> OutPoint, Info, Indexes
pt_2 = Point(rdpoints_2.OutPoint)

# ----
# * Roof points
draw_6 = COMPASDraw(cg=py3.roof_points)  # -> rg; same code as draw
draw_7 = COMPASDraw(cg=py3_2.roof_points)  # -> rg; same code as draw
merge_5 = Merge(Data1=draw_6, Data2=draw_7)
rdpoints_3 = RemoveDuplicatePointsKaramba3D(Point=merge_5, LimitDistance=0.005)  # -> OutPoint, Info, Indexes
pt_3 = Point(rdpoints_3.OutPoint)

# ----
# * All Lines
draw_8 = COMPASDraw(cg=py3.lines_out)  # -> rg; same code as draw
draw_9 = COMPASDraw(cg=py3_2.lines_out)  # -> rg; same code as draw
merge_6 = Merge(Data1=draw_8, Data2=draw_9)
rdlines = RemoveDuplicateLinesKaramba3D(Line=merge_6, LimitDistance=0.005)  # -> OutLine, Info, Indexes
line = Line(rdlines.OutLine)

# ----
# * To Karamba
line_2 = Line(line)
pt_4 = Point(pt)
pt_5 = Point(pt_2)
pt_6 = Point(pt_3)
