# Grasshopper definition to_timber_design_v1.ghx (Grasshopper 1.0.8)
# plug-ins: Karamba3D, CORE.Toolbox.Grasshopper, Pufferfish, Leopard version 0a1

# ----
# A. Initialize Data
srf = Surface([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])
join = BrepJoin(Breps=srf)  # -> Breps, Closed
div_x = Panel("4")
height = Panel("8.54")
height_2 = Panel("4.54")
div_y = Panel("6")
smesh = SimpleMesh(Brep=join.Breps)
tri = Triangulate(Mesh=smesh)  # -> Mesh, Count
rec = Rectangle({Plane=PlaneXY(163.5400008, 52.91000076, 24.64), Size=Domain2(u=-4.81..4.81, v=-14.43..14.43)})
rec_2 = Rectangle({Plane=PlaneXY(173.1600008, 52.91000076, 24.64), Size=Domain2(u=-4.81..4.81, v=-14.43..14.43)})
py3 = Python3Script(boundary=rec, div_x=div_x, div_y=div_y, height=height, roof_mesh=tri.Mesh)  # -> out, v_list_out; inputs boundary: Polyline, div_x: Int32, div_y: Int32, height: Double, roof_mesh: Mesh
# ---------- py3: Python ----------
#locate class file in the same folder
from compas_rhino import unload_modules
import sys
import os

#get current file path
path = ghenv.Component.OnPingDocument().FilePath
#get parent directory of the parent directory
parentdir = os.path.dirname(path)
#get src folder which contains classes
dire = os.path.join(parentdir,'scripts')
sys.path.append(dire)

unload_modules('Line_model_v4')

##########------------Imports------------###########
from Line_model_v4 import VertexList
from compas_rhino.conversions import polyline_to_compas, mesh_to_compas
from compas.geometry import Line


#######------Conversions-------########
boundary = polyline_to_compas(boundary)
mesh = mesh_to_compas(roof_mesh)

#########------Main Code------###############
# 1. Create generator
v_list = VertexList(
    boundary=boundary,
    division_x=div_x,
    division_y=div_y,
    height=height
)
# 2. Compute Default diagrid
v_list.compute_diagrid()

# 3. Assign tilted roof
v_list.set_default_roof(mesh)

#########----------Output data----------##############
v_list_out = v_list

#########---------Print----------------###########
print (len(v_list))
# ---------- end py3 ----------
py3_2 = Python3Script(boundary=rec_2, div_x=div_x, div_y=div_y, height=height_2, roof_mesh=tri.Mesh)  # -> out, v_list_out; inputs boundary: Polyline, div_x: Int32, div_y: Int32, height: Double, roof_mesh: Mesh; same code as py3

# ----
# * Params
panel = Panel("0")
merge = Merge(
    Data1=panel,
    Data2=Slider(0.705, range=0.001..1),
    Data3=Slider(2.107, range=1.001..3),
    Data4=Slider(4.42, range=3.001..5),
    Data5=height)
merge_2 = Merge(
    Data1=panel,
    Data2=Slider(0.422, range=0.001..0.7),
    Data3=Slider(1.261, range=0.701..1.5),
    Data4=Slider(2.614, range=1.501..3),
    Data5=height_2)
galapagos = Galapagos()

toggle = BooleanToggle(False)  # disabled
py3_3 = Python3Script(toggle=toggle)  # -> out, a; inputs toggle: Boolean; disabled
# ---------- py3_3: Python ----------
#locate class file in the same folder
from compas_rhino import unload_modules
import sys
import os

#get current file path
path = ghenv.Component.OnPingDocument().FilePath
#get parent directory of the parent directory
parentdir = os.path.dirname(path)
#get src folder which contains classes
dire = os.path.join(parentdir,'scripts')
sys.path.append(dire)

# import Line_model_v3
unload_modules('Line_model_v4')
# ---------- end py3_3 ----------

# ----
# * Using rhino.geometry
py3_4 = Python3Script()  # -> out, v_list_out, intersects, pts; inputs brep: Brep; disabled
# ---------- py3_4: Python ----------
#locate class file in the same folder
from compas_rhino import unload_modules
import sys
import os

#get current file path
path = ghenv.Component.OnPingDocument().FilePath
#get parent directory of the parent directory
parentdir = os.path.dirname(path)
#get src folder which contains classes
dire = os.path.join(parentdir,'scripts')
sys.path.append(dire)

import Line_model_v3
unload_modules('Line_model_v3')

##########------------Imports------------###########
import Rhino.Geometry as rg
from compas_rhino.conversions import point_to_rhino, point_to_compas
from compas.geometry import Line

#######------Conversions-------########
pts_rh = [point_to_rhino(p) for p in v_list.roof_points]
#########------Main Code------###############

intersects = rg.Intersect.Intersection.ProjectPointsToBreps(
    [brep],
    pts_rh,
    rg.Vector3d(0, 0, -1),
    1e-6
)


for idx, inter_p in enumerate(intersects):
    inter_p = point_to_compas(inter_p)
    v_list[idx].z = inter_p.z
    v_list.default_z[idx] = inter_p.z
print (len(intersects))

#########----------Output data----------##############
v_list_out = v_list

pts = v_list.vertices
print (len(pts))
# ---------- end py3_4 ----------

# ----
# B. Set height
py3_5 = Python3Script(v_list=py3.v_list_out, height_list=merge)  # -> out, v_list_out; inputs height_list: list of Double
# ---------- py3_5: Python ----------
#locate class file in the same folder
from compas_rhino import unload_modules
import sys
import os

#get current file path
path = ghenv.Component.OnPingDocument().FilePath
#get parent directory of the parent directory
parentdir = os.path.dirname(path)
#get src folder which contains classes
dire = os.path.join(parentdir,'scripts')
sys.path.append(dire)

unload_modules('Line_model_v4')
##########------------Imports------------###########


#######------Conversions-------########


#########------Main Code------###############
v_list.reset_default()
v_list.set_default_height(height_list)

#########----------Output data----------##############
v_list_out = v_list

#########---------Print----------------###########
print (len(v_list))
print (len(v_list.pairs))
# ---------- end py3_5 ----------
py3_6 = Python3Script(v_list=py3_2.v_list_out, height_list=merge_2)  # -> out, v_list_out; inputs height_list: list of Double; same code as py3_5

toggle_2 = BooleanToggle(False)  # disabled

# ----
# C. Add vertices and pairs
number_slider = Slider(0.1, range=0..1)
toggle_3 = BooleanToggle(True)
py3_7 = Python3Script(v_list=py3_5.v_list_out, compute=toggle_3, t=number_slider)  # -> out, v_list_out; inputs compute: Boolean, t: Double
# ---------- py3_7: Python ----------
#locate class file in the same folder
from compas_rhino import unload_modules
import sys
import os

#get current file path
path = ghenv.Component.OnPingDocument().FilePath
#get parent directory of the parent directory
parentdir = os.path.dirname(path)
#get src folder which contains classes
dire = os.path.join(parentdir,'scripts')
sys.path.append(dire)

unload_modules('Line_model_v4')
unload_modules('Structs_v1')

##########------------Imports------------###########
from Structs_v1 import Pair, BeamCategory, CrossSection
from compas.geometry import Plane, Line, intersection_segment_plane, Point
import math


#######------Conversions-------########


#########------Main Code------###############
v_list.reset_default()
v_list.skip(83)


if compute:

    # # Add vertex 
    # vertex_list = [
    #     [v_list[74], (v_list[78])], [v_list[74], (v_list[75])], [v_list[75], (v_list[79])], [v_list[79], (v_list[78])], 
    #     [v_list[76], (v_list[80])], [v_list[81], (v_list[80])], [v_list[77], (v_list[81])], [v_list[77], (v_list[76])],
    #     [v_list[64], (v_list[14])], [v_list[68], (v_list[20])]
    # ]
    # for v in vertex_list:
    #     vn = Line(v[0], v[1]).midpoint
    #     v_list.add_vertices(vn)

    # 4. Add vertex
    v1 = Line(v_list[74], (v_list[78])).midpoint
    v2 = Line(v_list[74], (v_list[75])).midpoint
    v3 = Line(v_list[75], (v_list[79])).midpoint
    v4 = Line(v_list[79], (v_list[78])).midpoint
    v5 = Line(v_list[76], (v_list[80])).midpoint
    v6 = Line(v_list[81], (v_list[80])).midpoint
    v7 = Line(v_list[77], (v_list[81])).midpoint
    v8 = Line(v_list[77], (v_list[76])).midpoint
    v9 = Line(v_list[64], (v_list[14])).midpoint
    v10 = Line(v_list[68], (v_list[20])).midpoint

    #---Important--- To avoid adding duplicate points and pairs
    v_list.reset_default()

    v_list.add_vertices([v1, v2, v3, v4, v5, v6, v7, v8, v9, v10])
    # Add ortogonal
    orthogonal_pairs = [
        Pair(64, 85), Pair(82, 85), Pair(65, 85), Pair(93, 64), Pair(93, 15), Pair(93, 14),
        Pair(60, 86), Pair(82, 86), Pair(65, 86), Pair(66, 87), Pair(82, 87), Pair(65, 87),
        Pair(70, 88), Pair(82, 88), Pair(65, 88), Pair(84, 90), Pair(84, 91), Pair(84, 92), Pair(84, 89),
        Pair(67, 90), Pair(67, 91), Pair(67, 92), Pair(67, 89), Pair(72, 90), Pair(68, 91), Pair(62, 92), Pair(66, 89),
        Pair(94, 20), Pair(94, 68), Pair(94, 19)

    ]
    for pair in orthogonal_pairs:
        v_list.add_pairs(pair)
    # Add bridge 
    bridge_pairs = [
        Pair(87, 60), Pair(87, 70), Pair(87, 71), Pair(87, 61), Pair(89, 61), Pair(89, 71), Pair(89, 72), Pair(89, 62)
    ]
    for pair in bridge_pairs:
        v_list.add_pairs(pair)

    # Delete points
    skip_list = [75, 76, 80, 79]
    v_list.skip(skip_list)


    # Intersecting pts 
    x_lines = []
    for v_pair in v_list.pairs:
        if v_list[v_pair[0]].z < v_list[82].z + 4.2 and v_list[v_pair[1]].z < v_list[82].z + 4.2:
            x_line = Line(v_list[v_pair[0]], v_list[v_pair[1]])
            x_lines.append(x_line)
    u = v_list[5] - v_list[13]
    v = v_list[27] - v_list[33]

    pt_one = Line(v_list[85], v_list[82]).point_at(t)
    pt_two = Line(v_list[87], v_list[82]).midpoint
    pt_three = Line(v_list[89], v_list[84]).midpoint
    pt_four = Line(v_list[91], v_list[84]).point_at(t)

    pl_points = [pt_one, pt_two, pt_three, pt_four]

    my_planes = []
    for pt in pl_points:
        plane_u = Plane(pt, u).rotated(math.pi/2, axis=[0,0,1], point=pt)
        plane_v = Plane(pt, v).rotated(-math.pi/2, axis=[0,0,1], point=pt)
        my_planes.append(plane_u)
        my_planes.append(plane_v)
    
    # intersect with beams 
    for ln in x_lines:
        for pl in my_planes:
            b_point = intersection_segment_plane(ln, pl)
            try:
                add_point = Point(b_point[0], b_point[1], b_point[2])
                v_list.add_vertices([add_point])
            except:
                continue
    # Delete points
    v_list.skip([100, 110, 113, 103, 102, 106, 111, 107])

    # Add bracing beams
    bracing_pairs = [
        Pair(100, 96), Pair(100, 95), Pair(101, 95), Pair(105, 96), Pair(101, 103), Pair(105, 103), 
        Pair(109, 97), Pair(109, 98), Pair(112, 97), Pair(108, 98), Pair(112, 113), Pair(108, 113)
    ]
    for pair in bracing_pairs:
        pair.cross_section = CrossSection.M
        pair.categories.append(BeamCategory.BRACING)
        v_list.add_pairs(pair)


    # Delete pairs
    delete_list = [
        (82, 87), (82, 86), (82, 85), (82, 88), (74, 82), (78, 82), (84, 90), 
        (84, 92), (84, 91), (77, 84), (81, 84), (84, 89)
    ]
    for pair in delete_list:
        v_list.delete_pairs(pair)

    # Joint beams
    join_pairs = [
        Pair(87, 104), Pair(104, 82), Pair(86, 101), Pair(101, 82), Pair(74, 95), Pair(95, 82), Pair(85, 99),
        Pair(99, 82), Pair(78, 96), Pair(96, 82), Pair(88, 105), Pair(105, 82), Pair(89, 114), Pair(114, 84),
        Pair(90, 108), Pair(108, 84), Pair(81, 98), Pair(98, 84), Pair(91, 109), Pair(109, 84), Pair(77, 97),
        Pair(97, 84), Pair(92, 112), Pair(112, 84)
    ]
    for pair in join_pairs:
        # pair.cross_section = curr_pair.cross_section
        pair.categories.append(BeamCategory.SPLIT)
        v_list.add_pairs(pair)
(64, 85)



#########----------Output data----------##############
v_list_out = v_list

#########---------Print----------------###########
print (len(v_list))
print (len(v_list.pairs))

print ("skip_list:", v_list.skip_indices)

for pair in v_list.pairs:
    print(pair)
# ---------- end py3_7 ----------
py3_8 = Python3Script(v_list=py3_6.v_list_out, compute=toggle_3, t=number_slider)  # -> out, v_list_out; inputs compute: Boolean, t: Double
# ---------- py3_8: Python ----------
#locate class file in the same folder
from compas_rhino import unload_modules
import sys
import os

#get current file path
path = ghenv.Component.OnPingDocument().FilePath
#get parent directory of the parent directory
parentdir = os.path.dirname(path)
#get src folder which contains classes
dire = os.path.join(parentdir,'scripts')
sys.path.append(dire)

unload_modules('Line_model_v4')
unload_modules('Structs_v1')

##########------------Imports------------###########
from Structs_v1 import Pair, BeamCategory, CrossSection
from compas.geometry import Plane, Line, intersection_segment_plane, Point
import math


#######------Conversions-------########


#########------Main Code------###############
v_list.reset_default()
v_list.skip(83)


if compute:

    # # Add vertex 
    # vertex_list = [
    #     [v_list[74], (v_list[78])], [v_list[74], (v_list[75])], [v_list[75], (v_list[79])], [v_list[79], (v_list[78])], 
    #     [v_list[76], (v_list[80])], [v_list[81], (v_list[80])], [v_list[77], (v_list[81])], [v_list[77], (v_list[76])],
    #     [v_list[64], (v_list[14])], [v_list[68], (v_list[20])]
    # ]
    # for v in vertex_list:
    #     vn = Line(v[0], v[1]).midpoint
    #     v_list.add_vertices(vn)

    # 4. Add vertex
    v1 = Line(v_list[74], (v_list[78])).midpoint
    v2 = Line(v_list[74], (v_list[75])).midpoint
    v3 = Line(v_list[75], (v_list[79])).midpoint
    v4 = Line(v_list[79], (v_list[78])).midpoint
    v5 = Line(v_list[76], (v_list[80])).midpoint
    v6 = Line(v_list[81], (v_list[80])).midpoint
    v7 = Line(v_list[77], (v_list[81])).midpoint
    v8 = Line(v_list[77], (v_list[76])).midpoint
    v9 = Line(v_list[64], (v_list[14])).midpoint
    v10 = Line(v_list[68], (v_list[20])).midpoint

    #---Important--- To avoid adding duplicate points and pairs
    v_list.reset_default()

    v_list.add_vertices([v1, v2, v3, v4, v5, v6, v7, v8, v9, v10])
    # Add ortogonal
    ortogonal_pairs = [
        Pair(64, 85), Pair(82, 85), Pair(65, 85), Pair(93, 64), Pair(93, 15), Pair(93, 14),
        Pair(60, 86), Pair(82, 86), Pair(65, 86), Pair(66, 87), Pair(82, 87), Pair(65, 87),
        Pair(70, 88), Pair(82, 88), Pair(65, 88), Pair(84, 90), Pair(84, 91), Pair(84, 92), Pair(84, 89),
        Pair(67, 90), Pair(67, 91), Pair(67, 92), Pair(67, 89), Pair(72, 90), Pair(68, 91), Pair(62, 92), Pair(66, 89),
        Pair(94, 20), Pair(94, 68), Pair(94, 19)

    ]
    for pair in ortogonal_pairs:
        v_list.add_pairs(pair)
    # Add bridge 
    bridge_pairs = [
        Pair(87, 60), Pair(87, 70), Pair(87, 71), Pair(87, 61), Pair(89, 61), Pair(89, 71), Pair(89, 72), Pair(89, 62)
    ]
    for pair in bridge_pairs:
        v_list.add_pairs(pair)

    # Delete points
    skip_list = [75, 76, 80, 79]
    v_list.skip(skip_list)


    # Intersecting pts 
    x_lines = []
    for v_pair in v_list.pairs:
        if v_list[v_pair[0]].z < v_list[82].z + 3.2 and v_list[v_pair[1]].z < v_list[82].z + 3.2:
            x_line = Line(v_list[v_pair[0]], v_list[v_pair[1]])
            x_lines.append(x_line)
    u = v_list[5] - v_list[13]
    v = v_list[27] - v_list[33]

    pt_one = Line(v_list[85], v_list[82]).point_at(t)
    pt_two = Line(v_list[87], v_list[82]).midpoint
    pt_three = Line(v_list[89], v_list[84]).midpoint
    pt_four = Line(v_list[91], v_list[84]).point_at(t)

    pl_points = [pt_one, pt_two, pt_three, pt_four]

    my_planes = []
    for pt in pl_points:
        plane_u = Plane(pt, u).rotated(math.pi/2, axis=[0,0,1], point=pt)
        plane_v = Plane(pt, v).rotated(-math.pi/2, axis=[0,0,1], point=pt)
        my_planes.append(plane_u)
        my_planes.append(plane_v)
    
    # intersect with beams 
    for ln in x_lines:
        for pl in my_planes:
            b_point = intersection_segment_plane(ln, pl)
            try:
                add_point = Point(b_point[0], b_point[1], b_point[2])
                v_list.add_vertices([add_point])
            except:
                continue
    # Delete points
    v_list.skip([100, 110, 113, 103, 102, 106, 111, 107])
    # Delete pairs
    delete_list = [
        (82, 87), (82, 86), (82, 85), (82, 88), (74, 82), (78, 82), (84, 90), 
        (84, 92), (84, 91), (77, 84), (81, 84), (84, 89)
    ]
    for pair in delete_list:
        v_list.delete_pairs(pair)
    # Add bracing beams
    bracing_pairs = [
        Pair(100, 96), Pair(100, 95), Pair(101, 95), Pair(105, 96), Pair(101, 103), Pair(105, 103), 
        Pair(109, 97), Pair(109, 98), Pair(112, 97), Pair(108, 98), Pair(112, 113), Pair(108, 113)
    ]
    for pair in bracing_pairs:
        v_list.add_pairs(pair)
        pair.categories.append(BeamCategory.BRACING)
    # Joint beams 
    join_pairs = [
        Pair(87, 104), Pair(104, 82), Pair(86, 101), Pair(101, 82), Pair(74, 95), Pair(95, 82), Pair(85, 99),
        Pair(99, 82), Pair(78, 96), Pair(96, 82), Pair(88, 105), Pair(105, 82), Pair(89, 114), Pair(114, 84),
        Pair(90, 108), Pair(108, 84), Pair(81, 98), Pair(98, 84), Pair(91, 109), Pair(109, 84), Pair(77, 97),
        Pair(97, 84), Pair(92, 112), Pair(112, 84)
    ]
    for pair in join_pairs:
        v_list.add_pairs(pair)
        pair.categories.append(BeamCategory.SPLIT)




#########----------Output data----------##############
v_list_out = v_list

#########---------Print----------------###########
print (len(v_list))
print (len(v_list.pairs))

print ("skip_list:", v_list.skip_indices)

for pair in v_list.pairs:
    print(pair)
# ---------- end py3_8 ----------

py3_9 = Python3Script(v_list=py3_5.v_list_out, compute=toggle_2)  # -> out, v_list_out; inputs compute: Boolean; disabled
# ---------- py3_9: Python ----------
#locate class file in the same folder
from compas_rhino import unload_modules
import sys
import os

#get current file path
path = ghenv.Component.OnPingDocument().FilePath
#get parent directory of the parent directory
parentdir = os.path.dirname(path)
#get src folder which contains classes
dire = os.path.join(parentdir,'scripts')
sys.path.append(dire)

unload_modules('Line_model_v4')
unload_modules('Structs_v1')

##########------------Imports------------###########
from Structs_v1 import Pair, BeamCategory, CrossSection
from compas.geometry import Plane, Line, intersection_segment_plane, Point
import math


#######------Conversions-------########


#########------Main Code------###############
v_list.reset_default()
v_list.skip(83)


if compute:
    # 4. Add vertex
    v1 = Line(start=v_list[74], end=(v_list[78])).midpoint
    v2 = Line(start=v_list[74], end=(v_list[75])).midpoint
    v3 = Line(start=v_list[75], end=(v_list[79])).midpoint
    v4 = Line(start=v_list[79], end=(v_list[78])).midpoint
    v5 = Line(start=v_list[76], end=(v_list[80])).midpoint
    v6 = Line(start=v_list[81], end=(v_list[80])).midpoint
    v7 = Line(start=v_list[77], end=(v_list[81])).midpoint
    v8 = Line(start=v_list[77], end=(v_list[76])).midpoint
    v9 = Line(start=v_list[64], end=(v_list[14])).midpoint
    v10 = Line(start=v_list[68], end=(v_list[20])).midpoint

    #---Important--- To avoid adding duplicate points and pairs
    v_list.reset_default()

    v_list.add_vertices([v1, v2, v3, v4, v5, v6, v7, v8, v9, v10])

    v_list.add_pairs([(64, 85), (82, 85), (65, 85)])
    v_list.add_pairs([(60, 86), (82, 86), (65, 86)])
    v_list.add_pairs([(66, 87), (82, 87), (65, 87)])
    v_list.add_pairs([(70, 88), (82, 88), (65, 88)])

    # top ortogonal
    v_list.add_pairs([(93, 64), (93, 15), (93, 14)])
    v_list.add_pairs([(94, 20), (94, 68), (94, 19)])

    v_list.add_pairs([(84, 90), (84, 91), (84, 92), (84, 89)])
    v_list.add_pairs([(67, 90), (67, 91), (67, 92), (67, 89)])
    v_list.add_pairs([(72, 90), (68, 91), (62, 92), (66, 89)])


    v_list.add_pairs([(87, 60), (87, 70), (87, 71), (87, 61), (89, 61), (89, 71), (89, 72), (89, 62)])
 
    skip_list = [75, 76, 80, 79]
    v_list.skip(skip_list)

    # intersecting lines 
    x_lines = []
    for v_pair in v_list.pairs:
        if v_list[v_pair[0]].z < v_list[82].z + 4.2 and v_list[v_pair[1]].z < v_list[82].z + 4.2:
            x_line = Line(v_list[v_pair[0]], v_list[v_pair[1]])
            x_lines.append(x_line)
    u = v_list[5] - v_list[13]
    v = v_list[27] - v_list[33]
    # start of the plane pt
    pt_one = Line(v_list[85], v_list[82]).point_at(.1)
    pt_two = Line(v_list[87], v_list[82]).midpoint
    pt_three = Line(v_list[89], v_list[84]).midpoint
    pt_four = Line(v_list[91], v_list[84]).point_at(.1)

    pl_points = [pt_one, pt_two, pt_three, pt_four]

    my_planes = []
    for pt in pl_points:
        plane_u = Plane(pt, u).rotated(math.pi/2, axis=[0,0,1], point=pt)
        plane_v = Plane(pt, v).rotated(-math.pi/2, axis=[0,0,1], point=pt)
        my_planes.append(plane_u)
        my_planes.append(plane_v)
    
    # intersect with beams 
    for ln in x_lines:
        for pl in my_planes:
            b_point = intersection_segment_plane(ln, pl)
            try:
                add_point = Point(b_point[0], b_point[1], b_point[2])
                v_list.add_vertices([add_point])
            except:
                continue
    
    # Bracing
    v_list.add_pairs([(100, 96), (100, 95), (101, 95), (105, 96), (101, 103), (105, 103)])
    v_list.add_pairs([(109, 97), (109, 98), (112, 97), (108, 98), (112, 113), (108, 113)])


#########----------Output data----------##############
v_list_out = v_list

#########---------Print----------------###########
print (len(v_list))
print (len(v_list.pairs))

print ("skip_list:", v_list.skip_indices)

for pair in v_list.pairs:
    print(pair)
# ---------- end py3_9 ----------

# ----
# Util: Valency_map
number_slider_2 = Slider(6, range=0..13)
py3_10 = Python3Script(valency=number_slider_2)  # -> out, line_groups, spheres, message; inputs valency: Int32
# ---------- py3_10: Python ----------
#locate class file in the same folder
from compas_rhino import unload_modules
import sys
import os

#get current file path
path = ghenv.Component.OnPingDocument().FilePath
#get parent directory of the parent directory
parentdir = os.path.dirname(path)
#get src folder which contains classes
dire = os.path.join(parentdir,'scripts')
sys.path.append(dire)

unload_modules('Line_model_v4')

##########------------Imports------------###########
from compas.geometry import Line
from compas_rhino.conversions import line_to_rhino, point_to_rhino
import Rhino.Geometry as rg

from Grasshopper import DataTree
from Grasshopper.Kernel.Data import GH_Path

#######------Conversions-------########


#########------Main Code------###############
topology = v_list.topology
print ('T:', topology)
print()

valency_map = v_list.valency_map
print ('V:', valency_map)
print ()

try:
    groups = v_list.group_by_valency(valency)
    print ('G:', groups)

    spheres = []
    line_groups = DataTree[object]()

    for parent, children in groups.items():
        for c in children:
            line = Line(v_list[parent], v_list[c])
            line = line_to_rhino(line)
            line_groups.Add(line, GH_Path(parent))

        sphere = rg.Sphere(point_to_rhino(v_list[parent]), 0.3)
        spheres.append(sphere)
    message = 'Time to work!'

except ValueError as e:
    error_msg = "Warning: " + str(e)
    message = error_msg



#########----------Output data----------##############


#########---------Print----------------###########
# ---------- end py3_10 ----------
panel_2 = Panel(py3_10.message)
viewer = ParamViewer(py3_10.line_groups)

# ----
# D. Construct beams
py3_11 = Python3Script(v_list=py3_7.v_list_out)  # -> out, b_list_out
# ---------- py3_11: Python ----------
#locate class file in the same folder
from compas_rhino import unload_modules
import sys
import os

#get current file path
path = ghenv.Component.OnPingDocument().FilePath
#get parent directory of the parent directory
parentdir = os.path.dirname(path)
#get src folder which contains classes
dire = os.path.join(parentdir,'scripts')
sys.path.append(dire)

unload_modules('Line_model_v4')

##########------------Imports------------###########
from Line_model_v4 import BeamList



#######------Conversions-------########

#########------Main Code------###############

# 1. Construct beams
b_list = BeamList(v_list)
b_list.set_default_beams()


#########----------Output data----------##############
b_list_out = b_list

#########---------Print----------------###########
print (len(b_list))
print (len(b_list.pairs))

print (len(v_list))
print (len(v_list.pairs))

for pair in b_list.pairs:
    print (pair)
# ---------- end py3_11 ----------
py3_12 = Python3Script(v_list=py3_8.v_list_out)  # -> out, b_list_out; same code as py3_11

crv = Curve([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])  # disabled
seam2crvcorn = SeamToCurveCorner(Curve=crv)  # -> Adjusted, Point, R; disabled
simplify = SimplifyCurve(Curve=seam2crvcorn.Adjusted)  # -> Curve, Simplified; disabled
brep = Brep(join.Breps)  # disabled
explode = Explode(Curve=simplify.Curve, Recursive=True)  # -> Segments, Vertices; disabled
project = ProjectPoint(Point=explode.Vertices, Direction=Vector(0, 0, -1), Geometry=brep)  # -> Point, Index; disabled
pline = PolyLine(Vertices=project.Point, Closed=False)  # -> flatten(Polyline); disabled
crv_2 = Curve(pline)  # disabled

# ----
# E. Modularize Structure
where_you_double_beams = Panel("""241
240
235
234
229
228
223
222
201
200
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""")
crv_3 = Curve([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])
toggle_4 = BooleanToggle(True)
py3_13 = Python3Script(b_list=py3_11.b_list_out, polylines=crv_3, double_indices=where_you_double_beams, compute=toggle_4)  # -> out, b_list_out, lines_out; inputs polylines: list of Polyline, double_indices: list of Int32, compute: Boolean
# ---------- py3_13: Python ----------
#locate class file in the same folder
from compas_rhino import unload_modules
import sys
import os

#get current file path
path = ghenv.Component.OnPingDocument().FilePath
#get parent directory of the parent directory
parentdir = os.path.dirname(path)
#get src folder which contains classes
dire = os.path.join(parentdir,'scripts')
sys.path.append(dire)

unload_modules('Line_model_v4')
unload_modules('Structs_v1')

##########------------Imports------------###########
from Line_model_v4 import BeamList
from Structs_v1 import Pair, BeamCategory
from compas_rhino.conversions import polyline_to_compas

from Grasshopper import DataTree
from Grasshopper.Kernel.Data import GH_Path


#######------Conversions-------########
polylines = [polyline_to_compas(p) for p in polylines]


#########------Main Code------###############
if compute:
    b_list.double(double_indices)

### Optimize this by filtering polylines first based on aabb
b_list.group_by_module(polylines, tol=1e-3)



#########----------Output data----------##############
b_list_out = b_list


#########---------Print----------------###########
print (len(b_list))
print (len(b_list.v_list))
print (len(b_list.v_list.pairs))
print (len(b_list.axises))

for b in b_list:
    if b is None:
        continue
    print (b.categories)
# ---------- end py3_13 ----------
py3_14 = Python3Script(b_list=py3_12.b_list_out, polylines=crv_3, double_indices=where_you_double_beams, compute=toggle_4)  # -> out, b_list_out, lines_out; inputs polylines: list of Polyline, double_indices: list of Int32, compute: Boolean
# ---------- py3_14: Python ----------
#locate class file in the same folder
from compas_rhino import unload_modules
import sys
import os

#get current file path
path = ghenv.Component.OnPingDocument().FilePath
#get parent directory of the parent directory
parentdir = os.path.dirname(path)
#get src folder which contains classes
dire = os.path.join(parentdir,'scripts')
sys.path.append(dire)

unload_modules('Line_model_v4')
unload_modules('Structs_v1')

##########------------Imports------------###########
from Line_model_v4 import BeamList
from Structs_v1 import Pair, BeamCategory
from compas_rhino.conversions import polyline_to_compas

from Grasshopper import DataTree
from Grasshopper.Kernel.Data import GH_Path


#######------Conversions-------########
polylines = [polyline_to_compas(p) for p in polylines]


#########------Main Code------###############
if compute:
    b_list.double(double_indices)

### Optimize this by filtering polylines first based on aabb
b_list.group_by_module(polylines, tol=1e-3)



#########----------Output data----------##############
b_list_out = b_list


#########---------Print----------------###########
print (len(b_list))
print (len(b_list.v_list))
print (len(b_list.v_list.pairs))
print (len(b_list.axises))
# ---------- end py3_14 ----------

# ----
# Util: Modularization
number_slider_3 = Slider(2, range=0..50)
data = Data([py3_13.b_list_out, py3_14.b_list_out])
py3_15 = Python3Script(b_lists=data, module_index=number_slider_3, isolate=Toggle(False), explode=Slider(0.36, range=0..1))  # -> out, lines_group, panels, panel_indices; inputs b_lists: list, module_index: Int32, isolate: Boolean, explode: Double
# ---------- py3_15: Python ----------
#locate class file in the same folder
from compas_rhino import unload_modules
import sys
import os

#get current file path
path = ghenv.Component.OnPingDocument().FilePath
#get parent directory of the parent directory
parentdir = os.path.dirname(path)
#get src folder which contains classes
dire = os.path.join(parentdir,'scripts')
sys.path.append(dire)

import Line_model_v3
unload_modules('Line_model_v3')

##########------------Imports------------###########
from Line_model_v3 import Beam, BeamList
from compas.geometry import Polygon, Plane, Line, Point

from Grasshopper import DataTree
from Grasshopper.Kernel.Data import GH_Path


#######------Conversions-------########

#########-------Helpers-------########
def average_points(points):
    if not points:
        return None
    x = sum(point.x for point in points) / len(points)
    y = sum(point.y for point in points) / len(points)
    z = sum(point.z for point in points) / len(points)

    return Point(x, y, z)

#########------Main Code------###############
ps = b_lists[0].clt_panels

if explode:
    centroids = [average_points(list(p[:-1])) for p in ps]
    center = average_points(centroids)
    vec = [c - center for c in centroids]


lines_group = DataTree[object]()
panels = DataTree[object]()
panel_indices = DataTree[int]()

for b_list in b_lists:
    for panel_idx, beam_indices in b_list.group.items():
        path = GH_Path(panel_idx)

        # print (panel_idx, beam_indices)

        for b_idx in beam_indices:
            beam = b_list[b_idx]
            if beam is None:
                continue
            line = beam.axis

            if isolate and panel_idx == module_index:
                lines_group.Add(line, path)
            elif not isolate:
                if explode:
                    line = line.translated(vec[panel_idx] * explode)
                lines_group.Add(line, path)

#########----------Output data----------##############

for i, panel in enumerate(ps):
    path = GH_Path(i)

    if isolate and i == module_index:
        panels.Add(panel, path)
        panel_indices.Add(i, path)
        break

    elif not isolate:
        if explode:
            panel = panel.translated(vec[i] * explode)
        panels.Add(panel, path)
        panel_indices.Add(i, path)
# ---------- end py3_15 ----------
draw = COMPASDraw(cg=py3_15.lines_group)  # -> rg
#   port cg: The COMPAS geometry or datastructure to be drawn.
#   port rg: The Rhino geometry object.
# ---------- draw: Python ----------
# r: compas>=2.14.1
"""
Draws COMPAS geometry in Grasshopper.
"""

from typing import Any

import Grasshopper

from compas.scene import SceneObject


class CompasToRhinoGeometry(Grasshopper.Kernel.GH_ScriptInstance):
    def RunScript(self, cg):
        if not cg:
            return None

        return SceneObject(item=cg).draw()
# ---------- end draw ----------
draw_2 = COMPASDraw(cg=py3_15.panels)  # -> rg; same code as draw
area = Area(Geometry=draw_2)
viewer_2 = ParamViewer(draw)
line_prev = TTLineweightPreview(Geometry=draw, StrokeWeight=Slider(2.9, range=0..10), Absolute=False)
boundary = BoundarySurfaces(Edges=draw_2)
tag = TextTag(Location=area, Text=py3_15.panel_indices)

# ----
# F. Output
py3_16 = Python3Script(b_list=py3_13.b_list_out)  # -> out, b_list_out, port, vertices_out, lines_out, port_2, facade_points, roof_points, support_points
# ---------- py3_16: Python ----------
#locate class file in the same folder
from compas_rhino import unload_modules
import sys
import os

#get current file path
path = ghenv.Component.OnPingDocument().FilePath
#get parent directory of the parent directory
parentdir = os.path.dirname(path)
#get src folder which contains classes
dire = os.path.join(parentdir,'scripts')
sys.path.append(dire)

unload_modules('Line_model_v4')


##########------------Imports------------###########
from Line_model_v4 import BeamList



#######------Conversions-------########

#########------Main Code------###############
v_list = b_list.v_list



#########----------Output data----------##############
b_list_out = b_list


vertices_out = [v_list[idx] if idx not in v_list.skip_indices else None for idx in range(len(v_list))]
lines_out = b_list.axises

facade_points = v_list.facade_points
roof_points = v_list.roof_points
support_points = v_list.support_points



#########---------Print----------------###########
print (len(v_list))
# ---------- end py3_16 ----------
py3_17 = Python3Script(b_list=py3_14.b_list_out)  # -> out, b_list_out, port, vertices_out, lines_out, port_2, facade_points, roof_points, support_points; same code as py3_16

# ----
# Util: Read / Write json
button = Button()  # disabled
data_2 = Data([py3_13.b_list_out, py3_14.b_list_out])  # disabled
number_slider_4 = Slider(233, range=0..300)  # disabled
python_3_script = Python3Script(b_lists=data_2, save=button)  # inputs b_lists: list, save: Boolean; disabled
# ---------- python_3_script: Python ----------
import os
from compas.data import json_dump
from compas_rhino.conversions import mesh_to_compas

######------Helpers-----#######
def remove_duplicate_points(points, precision=3):
    unique_points = {}
    
    for p in points:
        key = (round(p.x, precision), round(p.y, precision), round(p.z, precision))
        
        if key not in unique_points:
            unique_points[key] = p

    return list(unique_points.values())


#######-------Main Code------##############
facade_pts = [p for b_list in b_lists for p in b_list.v_list.facade_points]
roof_pts = [p for b_list in b_lists for p in b_list.v_list.roof_points]

clt_panels = [p for b_list in b_lists for p in b_list.clt_panels]

facade_pts = remove_duplicate_points(facade_pts)
roof_pts = remove_duplicate_points(roof_pts)

print (len(roof_pts))

data = {
    "b_lists": [],
    "lines": [],
    "types": [],
    "widths": [],
    "heights": [],
    "forces": [],
    "meshes": [],
    "clt_panels": [],
    "support_pts": [],
    "facade_pts": [],
    "roof_pts": []
}

data["facade_pts"] = facade_pts
data["roof_pts"] = roof_pts
data["clt_panels"] = clt_panels

for i, b_list in enumerate(b_lists):
    # data["b_lists"].append(b_list)
    data["support_pts"].extend(b_list.v_list.support_points)

    if i == 0:
        data["meshes"] = b_list.roof
    
    for beam in b_list:
        if beam is None:
            continue
        data["lines"].append(beam.axis)
        data["types"].append(beam.categories)
        data["widths"].append(beam.width)
        data["heights"].append(beam.height)
        data["forces"].append(beam.force)

    

print (data)
########-------Outputs--------#############
gh_dir = os.path.dirname(ghenv.Component.OnPingDocument().FilePath)
data_folder = os.path.join(gh_dir, "data")
json_path = os.path.join(data_folder, "out_lines.json")

if save:
    with open(json_path, 'w') as path:
        json_dump(data, path, pretty=False)
# ---------- end python_3_script ----------
to_structure_model = Python3Script()  # -> out, lines, types, widths, heights, forces, roofs, port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; disabled
# ---------- to_structure_model: Python ----------
import os
from compas.data import json_load
from Grasshopper import DataTree
from Grasshopper.Kernel.Data import GH_Path

gh_dir = os.path.dirname(ghenv.Component.OnPingDocument().FilePath)
# design_folder = os.path.dirname(gh_dir)
# json_path = os.path.join(design_folder, "line_model", "data", "out_lines.json")
json_path = os.path.join(gh_dir, "data", "out_lines.json")


lines_data = json_load(json_path)


lines = lines_data.get("lines")

types = DataTree[str]()
for i, ts in enumerate(lines_data.get("types")):
    types.AddRange(ts, GH_Path(i))

widths = lines_data.get("widths")
heights = lines_data.get("heights")
forces = lines_data.get("forces")
roofs = lines_data.get("meshes")

support_pts = lines_data.get("support_pts")
facade_pts = lines_data.get("facade_pts")
roof_pts = lines_data.get("roof_pts")
# ---------- end to_structure_model ----------
branch = TreeBranch(Tree=to_structure_model.types, Path=number_slider_4, MaintainPaths=True)  # disabled
draw_3 = COMPASDraw(cg=to_structure_model.lines)  # -> rg; disabled; same code as draw
item = ListItem(List=draw_3, Index=number_slider_4, Wrap=True)  # disabled
panel_3 = Panel(branch)  # disabled
viewer_3 = ParamViewer(to_structure_model.lines)  # disabled
viewer_4 = ParamViewer(to_structure_model.types)  # disabled
viewer_5 = ParamViewer(to_structure_model.widths)  # disabled
viewer_6 = ParamViewer(to_structure_model.heights)  # disabled
viewer_7 = ParamViewer(to_structure_model.forces)  # disabled
viewer_8 = ParamViewer(to_structure_model.roofs)  # disabled
viewer_9 = ParamViewer(to_structure_model.support_pts)  # disabled

# ----
# * Support points
draw_4 = COMPASDraw(cg=py3_16.support_points)  # -> rg; same code as draw
draw_5 = COMPASDraw(cg=py3_17.support_points)  # -> rg; same code as draw
merge_3 = Merge(Data1=draw_4, Data2=draw_5)
rdpoints = RemoveDuplicatePointsKaramba3D(Point=merge_3, LimitDistance=0.005)  # -> OutPoint, Info, Indexes
pt = Point(rdpoints.OutPoint)

# ----
# * Facade points
draw_6 = COMPASDraw(cg=py3_16.facade_points)  # -> rg; same code as draw
draw_7 = COMPASDraw(cg=py3_17.facade_points)  # -> rg; same code as draw
merge_4 = Merge(Data1=draw_6, Data2=draw_7)
rdpoints_2 = RemoveDuplicatePointsKaramba3D(Point=merge_4, LimitDistance=0.005)  # -> OutPoint, Info, Indexes
pt_2 = Point(rdpoints_2.OutPoint)

# ----
# * Roof points
draw_8 = COMPASDraw(cg=py3_16.roof_points)  # -> rg; same code as draw
draw_9 = COMPASDraw(cg=py3_17.roof_points)  # -> rg; same code as draw
merge_5 = Merge(Data1=draw_8, Data2=draw_9)
rdpoints_3 = RemoveDuplicatePointsKaramba3D(Point=merge_5, LimitDistance=0.005)  # -> OutPoint, Info, Indexes
pt_3 = Point(rdpoints_3.OutPoint)

# ----
# * All Lines
draw_10 = COMPASDraw(cg=py3_16.lines_out)  # -> rg; same code as draw
draw_11 = COMPASDraw(cg=py3_17.lines_out)  # -> rg; same code as draw
midpt = CurveMiddle(Curve=draw_10)  # disabled
merge_6 = Merge(Data1=draw_10, Data2=draw_11)
clean = CleanTree(RemoveNulls=True, RemoveInvalid=True, RemoveEmpty=False, Tree=merge_6)
points = PointList(Points=midpt, Size=Slider(0.14, range=0..1))
rdlines = RemoveDuplicateLinesKaramba3D(Line=clean, LimitDistance=0.005)  # -> OutLine, Info, Indexes
line = Line(rdlines.OutLine)

to_timber_design = Python3Script()  # -> out, lines, types, widths, heights, forces, roofs, port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; disabled; same code as to_structure_model
lselgeo = LeopardsSelectGeometry(Geometry=line, lock=True, maintain=False, order=False, selectedobject="332|335|164|165")  # -> Geometry, Path, Index, Order
midpt_2 = CurveMiddle(Curve=lselgeo.Geometry)

# ----
# * All Points
number_slider_5 = Slider(0.29, range=0..1)
draw_12 = COMPASDraw(cg=py3_16.vertices_out)  # -> rg; same code as draw
draw_13 = COMPASDraw(cg=py3_17.vertices_out)  # -> rg; same code as draw
merge_7 = Merge(Data1=draw_12, Data2=draw_13)
points_2 = PointList(Points=draw_12, Size=number_slider_5)
points_3 = PointList(Points=draw_13, Size=number_slider_5)
clean_2 = CleanTree(RemoveNulls=True, RemoveInvalid=True, RemoveEmpty=False, Tree=merge_7)

rdpoints_4 = RemoveDuplicatePointsKaramba3D(Point=clean_2, LimitDistance=0.005)  # -> OutPoint, Info, Indexes

pt_4 = Point(rdpoints_4.OutPoint)
