# Grasshopper definition v8.3_remove mid part_python_THL.gh (Grasshopper 1.0.8)

# ---- group: NEW UPDATE
# C. Add vertices and pairs
number_slider = Slider(0.1, range=0..1)
toggle = BooleanToggle(True)
py3 = Python3Script(compute=toggle, t=number_slider)  # -> out, v_list_out, my_planes; inputs compute: Boolean, t: Double
# ---------- py3: Python ----------
#locate class file in the same folder
from compas_rhino import unload_modules
import sys
import os

#get current file path
path = ghenv.Component.OnPingDocument().FilePath
#get parent directory of the parent directory
parentdir = os.path.dirname(path)
#get src folder which contains classes
dire = os.path.join(parentdir,'scripts')
sys.path.append(dire)

unload_modules('Line_model_v4')
unload_modules('Structs_v1')

##########------------Imports------------###########
from Structs_v1 import Pair, BeamCategory, CrossSection
from compas.geometry import Plane, Line, intersection_segment_plane, Point, Vector
import math


#######------Conversions-------########


#########------Main Code------###############
v_list.reset_default()
v_list.skip(83)


if compute:

    lvls = [0, 1, ]
    # -------------------------
    # 1. Add vertices (midpoints)
    # -------------------------
    midpoint_pairs = [
        (74, 78), (74, 75), (75, 79), (79, 78),
        (76, 80), (81, 80), (77, 81), (77, 76),
        (41, 47), (46, 52)
    ]

    new_vertices = [
        Line(v_list[a], v_list[b]).midpoint
        for a, b in midpoint_pairs
    ]

    v_list.reset_default()
    v_list.add_vertices(new_vertices)

    # print( v_list[87].name)
    # group = {}
    # for lvl in lvls:
    #     for pair in pairs:
    #         group.setdefault(lvl, []).append(pair)


    # -------------------------
    # 2. Helper to add pairs
    # -------------------------
    def add_pairs(pairs, cross_section, category):
        for p in pairs:
            p.cross_section = cross_section
            p.categories.append(category)
        v_list.add_pairs(pairs)

    # -------------------------
    # 3. Define pair groups
    # -------------------------
    lvl_3_pairs = [
        Pair(87, 82, 3), Pair(86, 82, 3), Pair(85, 82, 3), Pair(88, 82, 3),
        Pair(89, 84, 3), Pair(90, 84, 3), Pair(92, 84, 3), Pair(91, 84, 3)
    ]

    lvl_2_pairs = [
        Pair(62, 92, 2), Pair(66, 89, 2), Pair(72, 90, 2), Pair(68, 91, 2),
        Pair(67, 92, 2), Pair(67, 90, 2), Pair(67, 91, 2), Pair(67, 89, 2),
        Pair(60, 86, 2), Pair(64, 85, 2), Pair(70, 88, 2), Pair(66, 87, 2),
        Pair(65, 86, 2), Pair(65, 88, 2), Pair(65, 85, 2), Pair(65, 87, 2),
        
    ]

    bracing = [
        Pair(61, 89, 2), Pair(62, 89, 2), Pair(71, 89, 2), Pair(72, 89, 2),
        Pair(61, 87, 2), Pair(71, 87, 2), Pair(60, 87, 2), Pair(70, 87, 2)
    ]

    lvl_1_pairs = [Pair(94, 68, 1), Pair(93, 64, 1)]
    lvl_0_pairs = [Pair(20, 94, 0), Pair(19, 94, 0), Pair(14, 93, 0), Pair(15, 93, 0)]

    # -------------------------
    # 4. Add pairs (batched)
    # -------------------------
    add_pairs(lvl_3_pairs, CrossSection.L, BeamCategory.SINGLE)
    add_pairs(lvl_2_pairs, CrossSection.M, BeamCategory.SINGLE)
    add_pairs(bracing, CrossSection.M, BeamCategory.BRACING)
    add_pairs(lvl_1_pairs, CrossSection.S, BeamCategory.SINGLE)
    add_pairs(lvl_0_pairs, CrossSection.XS, BeamCategory.SINGLE)

    # -------------------------
    # 5. Skip vertices
    # -------------------------
    v_list.skip([75, 76, 80, 79])

    # print(v_list[46].name.split('_')[1])

     # -------------------------
    # 6. Intersections (optimized)
    # -------------------------
    z_thresh = v_list[82].z + 4.2

    x_lines = [
        Line(v_list[i], v_list[j])
        for i, j in v_list.pairs
        if v_list[i].z < z_thresh and v_list[j].z < z_thresh
    ]

    u = v_list[5] - v_list[13]
    v = v_list[27] - v_list[33]

    # Precompute lines
    base_lines = [
        Line(v_list[85], v_list[82]),
        Line(v_list[87], v_list[82]),
        Line(v_list[89], v_list[84]),
        Line(v_list[91], v_list[84]),
    ]

    pl_points = [
        base_lines[0].point_at(t),
        base_lines[1].midpoint,
        base_lines[2].midpoint,
        base_lines[3].point_at(t),
    ]

    my_planes = [
        plane
        for pt in pl_points
        for plane in (
            Plane(pt, u).rotated(math.pi/2, axis=[0,0,1], point=pt),
            Plane(pt, v).rotated(-math.pi/2, axis=[0,0,1], point=pt),
        )
    ]

    # Batch intersection results
    new_pts = []
    for ln in x_lines:
        for pl in my_planes:
            b = intersection_segment_plane(ln, pl)
            if b:
                new_pts.append(Point(*b))

    if new_pts:
        v_list.add_vertices(new_pts)

    # -------------------------
    # 7. Cleanup
    # -------------------------
    v_list.skip([100, 113, 103, 102, 106, 111, 109, 107])

    # -------------------------
    # 8. Bracing beams
    # -------------------------
    bracing_pairs = [
        Pair(104, 96, 3), Pair(104, 95, 3), Pair(101, 95, 3),
        Pair(105, 96, 3), Pair(101, 99, 3), Pair(105, 99, 3),
        Pair(114, 97, 3), Pair(114, 98, 3), Pair(112, 97, 3),
        Pair(110, 98, 3), Pair(112, 108, 3), Pair(108, 110, 3)
    ]
    add_pairs(bracing_pairs, CrossSection.M, BeamCategory.BRACING)

    # -------------------------
    # 9. Delete pairs (batch)
    # -------------------------
    delete_list = [
        (74, 82), (85, 82), (78, 82), (88, 82), (87, 82), (86, 82),
        (89, 84), (90, 84), (81, 84), (91, 84), (77, 84), (92, 84)
    ]
    for p in delete_list:
        v_list.delete_pairs(p)

    # -------------------------
    # 10. Join pairs
    # -------------------------
    join_pairs = [
        Pair(74, 95, 3), Pair(95, 82, 3), Pair(85, 104, 3), Pair(104, 82, 3),
        Pair(78, 96, 3), Pair(96, 82, 3), Pair(88, 105, 3), Pair(105, 82, 3),
        Pair(87, 99, 3), Pair(99, 82, 3), Pair(86, 101, 3), Pair(101, 82, 3),

        Pair(89, 108, 3), Pair(108, 84, 3), Pair(90, 110, 3), Pair(110, 84, 3),
        Pair(81, 98, 3), Pair(98, 84, 3), Pair(91, 114, 3), Pair(114, 84, 3),
        Pair(77, 97, 3), Pair(97, 84, 3), Pair(92, 112, 3), Pair(112, 84, 3),
    ]

    for p in join_pairs:
        p.categories.append(BeamCategory.SPLIT)

    add_pairs(join_pairs, CrossSection.L, BeamCategory.SINGLE)

    # -------------------------
    # 11. Move points
    # -------------------------
#    v_list.move([87, 89, 99, 108, 61, 66, 71], Vector(0, 0, .5))


#########----------Output data----------##############
v_list_out = v_list

#########---------Print----------------###########
print (len(v_list))
print (len(v_list.pairs))

print ("skip_list:", v_list.skip_indices)

for pair in v_list.pairs:
    print(pair)
# ---------- end py3 ----------
py3_2 = Python3Script(compute=toggle, t=number_slider)  # -> out, v_list_out, my_planes; inputs compute: Boolean, t: Double
# ---------- py3_2: Python ----------
#locate class file in the same folder
from compas_rhino import unload_modules
import sys
import os

#get current file path
path = ghenv.Component.OnPingDocument().FilePath
#get parent directory of the parent directory
parentdir = os.path.dirname(path)
#get src folder which contains classes
dire = os.path.join(parentdir,'scripts')
sys.path.append(dire)

unload_modules('Line_model_v4')
unload_modules('Structs_v1')

##########------------Imports------------###########
from Structs_v1 import Pair, BeamCategory, CrossSection
from compas.geometry import Plane, Line, intersection_segment_plane, Point, Vector
import math


#######------Conversions-------########


#########------Main Code------###############
v_list.reset_default()
v_list.skip(83)


if compute:

    lvls = [0, 1, ]
    # -------------------------
    # 1. Add vertices (midpoints)
    # -------------------------
    midpoint_pairs = [
        (74, 78), (74, 75), (75, 79), (79, 78),
        (76, 80), (81, 80), (77, 81), (77, 76),
        (41, 47), (46, 52)
    ]

    new_vertices = [
        Line(v_list[a], v_list[b]).midpoint
        for a, b in midpoint_pairs
    ]

    v_list.reset_default()
    v_list.add_vertices(new_vertices)

    # print( v_list[87].name)
    # group = {}
    # for lvl in lvls:
    #     for pair in pairs:
    #         group.setdefault(lvl, []).append(pair)


    # -------------------------
    # 2. Helper to add pairs
    # -------------------------
    def add_pairs(pairs, cross_section, category):
        for p in pairs:
            p.cross_section = cross_section
            p.categories.append(category)
        v_list.add_pairs(pairs)

    # -------------------------
    # 3. Define pair groups
    # -------------------------
    lvl_3_pairs = [
        Pair(87, 82, 3), Pair(86, 82, 3), Pair(85, 82, 3), Pair(88, 82, 3),
        Pair(89, 84, 3), Pair(90, 84, 3), Pair(92, 84, 3), Pair(91, 84, 3)
    ]

    lvl_2_pairs = [
        Pair(62, 92, 2), Pair(66, 89, 2), Pair(72, 90, 2), Pair(68, 91, 2),
        Pair(67, 92, 2), Pair(67, 90, 2), Pair(67, 91, 2), Pair(67, 89, 2),
        Pair(60, 86, 2), Pair(64, 85, 2), Pair(70, 88, 2), Pair(66, 87, 2),
        Pair(65, 86, 2), Pair(65, 88, 2), Pair(65, 85, 2), Pair(65, 87, 2),
        Pair(10,89,2), Pair(10,87,2), Pair(17,89,2), Pair(17,87,2), Pair(24,89,2), Pair(24,87,2)        ###ADDITION BEAMS
    ]

    bracing = [
        Pair(61, 89, 2), Pair(62, 89, 2), Pair(71, 89, 2), Pair(72, 89, 2),
        Pair(61, 87, 2), Pair(71, 87, 2), Pair(60, 87, 2), Pair(70, 87, 2)
    ]

    lvl_1_pairs = [Pair(94, 68, 1), Pair(93, 64, 1)]
    lvl_0_pairs = [Pair(20, 94, 0), Pair(19, 94, 0), Pair(14, 93, 0), Pair(15, 93, 0)]

    # -------------------------
    # 4. Add pairs (batched)
    # -------------------------
    add_pairs(lvl_3_pairs, CrossSection.L, BeamCategory.SINGLE)
    add_pairs(lvl_2_pairs, CrossSection.M, BeamCategory.SINGLE)
    add_pairs(bracing, CrossSection.M, BeamCategory.BRACING)
    add_pairs(lvl_1_pairs, CrossSection.S, BeamCategory.SINGLE)
    add_pairs(lvl_0_pairs, CrossSection.XS, BeamCategory.SINGLE)

    # -------------------------
    # 5. Skip vertices
    # -------------------------
    v_list.skip([75, 76, 80, 79])
    v_list.skip([61,66,71])

    # print(v_list[46].name.split('_')[1])

     # -------------------------
    # 6. Intersections (optimized)
    # -------------------------
    z_thresh = v_list[82].z + 3.2

    x_lines = [
        Line(v_list[i], v_list[j])
        for i, j in v_list.pairs
        if v_list[i].z < z_thresh and v_list[j].z < z_thresh
    ]

    u = v_list[5] - v_list[13]
    v = v_list[27] - v_list[33]

    # Precompute lines
    base_lines = [
        Line(v_list[85], v_list[82]),
        Line(v_list[87], v_list[82]),
        Line(v_list[89], v_list[84]),
        Line(v_list[91], v_list[84]),
    ]

    pl_points = [
        base_lines[0].point_at(t),
        base_lines[1].midpoint,
        base_lines[2].midpoint,
        base_lines[3].point_at(t),
    ]

    my_planes = [
        plane
        for pt in pl_points
        for plane in (
            Plane(pt, u).rotated(math.pi/2, axis=[0,0,1], point=pt),
            Plane(pt, v).rotated(-math.pi/2, axis=[0,0,1], point=pt),
        )
    ]

    # Batch intersection results
    new_pts = []
    for ln in x_lines:
        for pl in my_planes:
            b = intersection_segment_plane(ln, pl)
            if b:
                new_pts.append(Point(*b))

    if new_pts:
        v_list.add_vertices(new_pts)

    # -------------------------
    # 7. Cleanup
    # -------------------------
    v_list.skip([100, 113, 103, 102, 106, 111, 109, 107])

    # -------------------------
    # 8. Bracing beams
    # -------------------------
    bracing_pairs = [
        Pair(104, 96, 3), Pair(104, 95, 3), Pair(101, 95, 3),
        Pair(105, 96, 3), Pair(101, 99, 3), Pair(105, 99, 3),
        Pair(114, 97, 3), Pair(114, 98, 3), Pair(112, 97, 3),
        Pair(110, 98, 3), Pair(112, 108, 3), Pair(108, 110, 3)
    ]
    add_pairs(bracing_pairs, CrossSection.M, BeamCategory.BRACING)

    # -------------------------
    # 9. Delete pairs (batch)
    # -------------------------
    delete_list = [
        (74, 82), (85, 82), (78, 82), (88, 82), (87, 82), (86, 82),
        (89, 84), (90, 84), (81, 84), (91, 84), (77, 84), (92, 84)
    ]
    for p in delete_list:
        v_list.delete_pairs(p)

    # -------------------------
    # 10. Join pairs
    # -------------------------
    join_pairs = [
        Pair(74, 95, 3), Pair(95, 82, 3), Pair(85, 104, 3), Pair(104, 82, 3),
        Pair(78, 96, 3), Pair(96, 82, 3), Pair(88, 105, 3), Pair(105, 82, 3),
        Pair(87, 99, 3), Pair(99, 82, 3), Pair(86, 101, 3), Pair(101, 82, 3),

        Pair(89, 108, 3), Pair(108, 84, 3), Pair(90, 110, 3), Pair(110, 84, 3),
        Pair(81, 98, 3), Pair(98, 84, 3), Pair(91, 114, 3), Pair(114, 84, 3),
        Pair(77, 97, 3), Pair(97, 84, 3), Pair(92, 112, 3), Pair(112, 84, 3),
    ]

    for p in join_pairs:
        p.categories.append(BeamCategory.SPLIT)

    add_pairs(join_pairs, CrossSection.L, BeamCategory.SINGLE)

    # -------------------------
    # 11. Move points
    # -------------------------
    v_list.move([87, 89], Vector(0, 0, 1))
    v_list.move([99, 108], Vector(0, 0, .5))
    v_list.move([70, 65, 60, 62, 67, 72], Vector(0, 0, .5))



#########----------Output data----------##############
v_list_out = v_list

#########---------Print----------------###########
print (len(v_list))
print (len(v_list.pairs))

print ("skip_list:", v_list.skip_indices)

for pair in v_list.pairs:
    print(pair)
# ---------- end py3_2 ----------
