# Grasshopper definition line_model(1).ghx (Grasshopper 1.0.8)
# plug-ins: CORE.Toolbox.Grasshopper, Human

range = Range(Domain=Domain(0, 1), Steps=Slider(4, range=0..10))
graph_mapper = GraphMapper(
    range,
    x0=0,
    x1=1,
    y0=0,
    y1=1,
    container_name="Bezier",
    cpx=[0, 0.6170566082, 0.8717642426, 1],
    cpy=[0, 0.0728777647, 0.464922905, 1])

# ----
# create and manipulate graph
curve = Curve(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)
brep = Brep(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)
point = Point([Point(163.5542514, 48.10027414, 15.94000248), Point(163.5542514, 57.72031214, 15.94000382), Point(173.1742514, 57.7202747, 19.94), Point(173.1742514, 48.1002747, 19.94)])
python_3_script = Python3Script(boundary=curve, roof_brep=brep, supports=point, z_steps=graph_mapper)  # -> out, ridges_tree, all_edges, graph, all_nodes, node_keys, lines_by_group; inputs boundary: Curve, roof_brep: Brep, supports: list of Point3d, z_steps: list of Double
# ---------- python_3_script: Python ----------
import os
import sys
from compas_rhino import unload_modules
import compas
compas.PRECISION = ".3f"

gh_dir = os.path.dirname(ghenv.Component.OnPingDocument().FilePath)
sys.path.append(gh_dir)

import tree_builder
import nodegraph
import importlib

importlib.reload(nodegraph)
importlib.reload(tree_builder)


from tree_builder import build_tree_graph


# CONSTANTS #
div_x = 8
div_y = 6
num_levels = 4

inset_edge = 0.6
inset_interior = .7

# Build the graph (all logic is in tree_builder.py)
ng = build_tree_graph(
    boundary=boundary,
    supports=supports,
    roof_brep=roof_brep,
    div_x=div_x if div_x else 8,
    div_y=div_y if div_y else 6,
    num_levels=num_levels if num_levels else 4,
    z_steps=z_steps,
    inset_edge=inset_edge if inset_edge else 0.5,
    inset_interior=inset_interior if inset_interior else 0.4,
    reach_tol=0.05,
    debug=True
)

# Outputs
all_edges = ng.edge_lines()
graph = ng
all_nodes = ng.node_points()
node_keys = list(ng.nodes())

# Print
first_level = ""
print(first_level)
lines_by_group = ng.edge_lines_by_group(0)
# ---------- end python_3_script ----------
compas_draw = COMPASDraw(cg=python_3_script.all_edges)  # -> rg
#   port cg: The COMPAS geometry or datastructure to be drawn.
#   port rg: The Rhino geometry object.
# ---------- compas_draw: Python ----------
# r: compas>=2.14.1
"""
Draws COMPAS geometry in Grasshopper.
"""

from typing import Any

import Grasshopper

from compas.scene import SceneObject


class CompasToRhinoGeometry(Grasshopper.Kernel.GH_ScriptInstance):
    def RunScript(self, cg):
        if not cg:
            return None

        return SceneObject(item=cg).draw()
# ---------- end compas_draw ----------
compas_draw_2 = COMPASDraw(cg=python_3_script.all_nodes)  # -> rg; same code as compas_draw
python_3_script_2 = Python3Script(graph=python_3_script.graph)  # -> out, edges, nodes, idx, node_graph, a, b, c
# ---------- python_3_script_2: Python ----------
from copy import deepcopy
import os
import sys

gh_dir = os.path.dirname(ghenv.Component.OnPingDocument().FilePath)
if gh_dir not in sys.path:
    sys.path.insert(0, gh_dir)

ng = deepcopy(graph)

# Delete nodes
for node_id in [288, 289]:
    if ng.has_node(node_id):
        ng.delete_node(node_id)

# Add new elements
target_pairs = [
    [286, 274, 275], [290, 278, 279], [287, 277, 276], [291, 280, 281],
    [241, 7, 11], [268, 234, 228], [265, 214, 208], [244, 31, 27],
    [287, 244], [287, 251], [287, 249],
    [291, 268], [291, 263], [291, 261],
    [290, 265], [290, 258], [290, 260],
    [286, 241], [286, 246], [286, 248]
]

ng.add_segments(target_pairs)

edges = ng.edge_lines_by_group(0) + ng.edge_lines_by_group(1)
nodes = ng.node_points()
idx = list(ng.nodes())
node_graph = ng

a = ng.points_by_mobility("fixed")     # supports + inset corners
b = ng.points_by_mobility("z_free")    # apex nodes
c = ng.points_by_mobility("yz_free")  # added via add_segment

attrs_lst = graph.nodes_attributes()

all_keys = set(key for attrs in attrs_lst for key in attrs.keys())
print (all_keys)

attributes_lst = {}
for attrs in attrs_lst:
    for key, value in attrs.items():
        if key in ('x', 'y', 'z', 'point'): continue
        attributes_lst.setdefault(key, set()).add(str(value))

# print (attributes_lst)
# ---------- end python_3_script_2 ----------

swatch = ColourSwatch(SwatchColor=RGB(51, 56, 66))
text_tag = TextTag(Location=compas_draw_2, Text=python_3_script.node_keys, Colour=swatch)
dot_display = DotDisplay(Point=compas_draw_2, Colour=swatch, Size=Slider(0.1, range=0..0.1))

custom_preview_lineweights = CustomPreviewLineweights(
    Geometry=compas_draw,
    Shader=ColourSwatch(SwatchColor=RGB(144, 209, 232)),
    Thickness=Slider(4, range=0..10),
    Absolute=False)

compas_draw_3 = COMPASDraw(cg=python_3_script.lines_by_group)  # -> rg; same code as compas_draw

# ----
# Preview segments
number_slider = Slider(3, range=0..15)
python_3_script_3 = Python3Script(graph=python_3_script_2.node_graph, segment_id=number_slider)  # -> out, primary, secondary, subgraph, dom_vec; inputs segment_id: Int32
# ---------- python_3_script_3: Python ----------
import os, sys, importlib
gh_dir = os.path.dirname(ghenv.Component.OnPingDocument().FilePath)
if gh_dir not in sys.path:
    sys.path.insert(0, gh_dir)

import edge_classifier
import config
importlib.reload(edge_classifier)
importlib.reload(config)
from edge_classifier import classify_single_segment

result = classify_single_segment(graph, segment_index = segment_id,parallel_tol=None, near_threshold=None)

primary = result["primary_lines"]
secondary = result["secondary_lines"]
subgraph = result["subgraph"]
segmet_index = result["segment_index"]


# print(graph.nodes_attributes()[0])

attrs_lst = subgraph.edges_attributes()

all_keys = set(key for attrs in attrs_lst for key in attrs.keys())
print (all_keys)

attributes_lst = {}
for attrs in attrs_lst:
    for key, value in attrs.items():
        if key in ('x', 'y', 'z', 'point'): continue
        attributes_lst.setdefault(key, set()).add(str(value))

print (attributes_lst['parallel_score'])
# ---------- end python_3_script_3 ----------
compas_draw_4 = COMPASDraw(cg=python_3_script_3.secondary)  # -> rg; same code as compas_draw
compas_draw_5 = COMPASDraw(cg=python_3_script_3.primary)  # -> rg; same code as compas_draw
custom_preview_lineweights_2 = CustomPreviewLineweights(Geometry=compas_draw_4, Shader=ColourSwatch(SwatchColor=RGB(50, 143, 103)), Thickness="5", Absolute=False)
custom_preview_lineweights_3 = CustomPreviewLineweights(Geometry=compas_draw_5, Shader=ColourSwatch(SwatchColor=RGB(137, 50, 143)), Thickness="20", Absolute=False)

# ----
# Preview nodes
# fixed
# z-free
# yz-free
compas_draw_6 = COMPASDraw(cg=python_3_script_2.nodes)  # -> rg; same code as compas_draw
compas_draw_7 = COMPASDraw(cg=python_3_script_2.edges)  # -> rg; same code as compas_draw
text_tag_2 = TextTag(Location=compas_draw_6, Text=python_3_script_2.idx, Colour=ColourSwatch(SwatchColor=RGB(23, 64, 15)))
compas_draw_8 = COMPASDraw(cg=python_3_script_2.c)  # -> rg; same code as compas_draw
compas_draw_9 = COMPASDraw(cg=python_3_script_2.b)  # -> rg; same code as compas_draw
compas_draw_10 = COMPASDraw(cg=python_3_script_2.a)  # -> rg; same code as compas_draw
dot_display_2 = DotDisplay(Point=compas_draw_8, Colour=ColourSwatch(SwatchColor=RGB(173, 201, 107)), Size=Slider(0.1, range=0..0.1))
dot_display_3 = DotDisplay(Point=compas_draw_9, Colour=ColourSwatch(SwatchColor=RGB(107, 201, 160)), Size=Slider(0.1, range=0..0.1))
dot_display_4 = DotDisplay(Point=compas_draw_10, Colour=ColourSwatch(SwatchColor=RGB(201, 107, 107)), Size=Slider(0.1, range=0..0.1))

brep_2 = Brep(<brep referenced from the Rhino model>)
python_3_script_4 = Python3Script(graph=python_3_script_2.node_graph, interior_brep=brep_2)  # -> out, edges, moved_points, normals; inputs interior_brep: Brep
# ---------- python_3_script_4: Python ----------
import os, sys, importlib
gh_dir = os.path.dirname(ghenv.Component.OnPingDocument().FilePath)
if gh_dir not in sys.path:
    sys.path.insert(0, gh_dir)

### -----------------------------
## IMPORT
### -----------------------------
import edge_classifier
import transformer
import nodegraph

importlib.reload(edge_classifier)
importlib.reload(transformer)
importlib.reload(nodegraph)

from edge_classifier import classify_single_segment
from transformer import edge_in_brep
from copy import deepcopy
from compas.geometry import Vector, Line, Point, centroid_points

### -----------------------------
## CLASS
### -----------------------------
ng = deepcopy(graph)

### -----------------------------
## OUT
### -----------------------------
intersecting_edges, history, moved_points = edge_in_brep(ng, interior_brep, debug=True)
edges = ng.edge_lines_by_group(0) + ng.edge_lines_by_group(1)


### -----------------------------
## PRINT
### -----------------------------
print(history)
# ---------- end python_3_script_4 ----------
panel = Panel(python_3_script_4.normals)
line_prev = TTLineweightPreview(Geometry=compas_draw_7, StrokeColor=ColourSwatch(SwatchColor=RGB(87, 50, 50)), Absolute=False)
compas_draw_11 = COMPASDraw(cg=python_3_script_3.dom_vec)  # -> rg; same code as compas_draw
compas_draw_12 = COMPASDraw(cg=python_3_script_4.moved_points)  # -> rg; same code as compas_draw
compas_draw_13 = COMPASDraw(cg=python_3_script_4.edges)  # -> rg; same code as compas_draw
end = EndPoints(Curve=compas_draw_11)  # -> Start, End
pt = Point(end.Start)
dot_display_5 = DotDisplay(Point=compas_draw_12, Colour=ColourSwatch(SwatchColor=RGB(255, 255, 255)), Size=Slider(0.2, range=-0.5..0.5))
