# Grasshopper definition line_model_NM.ghx (Grasshopper 1.0.8)
# plug-ins: Pufferfish, Human

range = Range(Domain=Domain(0, 1), Steps="3")
range_2 = Range(Domain=Domain(0, 1), Steps="3")
range_3 = Range(Domain=Domain(0, 1), Steps="3")
range_4 = Range(Domain=Domain(0, 1), Steps="3")
graph_mapper = GraphMapper(
    range,
    x0=0,
    x1=1,
    y0=0,
    y1=1,
    container_name="Bezier",
    cpx=[0, 0.3654789627, 0.6756706834, 1],
    cpy=[0.1923651099, 0.1061905622, 0.1951037645, 1])
graph_mapper_2 = GraphMapper(
    range_2,
    x0=0,
    x1=1,
    y0=0,
    y1=1,
    container_name="Bezier",
    cpx=[0, 0.415862143, 0.940971911, 1],
    cpy=[0, 0.0582934618, 0.3582203984, 1])
graph_mapper_3 = GraphMapper(
    range_3,
    x0=0,
    x1=1,
    y0=0,
    y1=1,
    container_name="Bezier",
    cpx=[0, 0.415862143, 0.940971911, 1],
    cpy=[0, 0.0582934618, 0.3582203984, 1])
graph_mapper_4 = GraphMapper(
    range_4,
    x0=0,
    x1=1,
    y0=0,
    y1=1,
    container_name="Bezier",
    cpx=[0, 0.415862143, 0.940971911, 1],
    cpy=[0, 0.0582934618, 0.3582203984, 1])

number = Number(graph_mapper)
number_2 = Number([Slider(0.13, range=0..1), Slider(0.12, range=0..1), Slider(0.4, range=0..1), Slider(1, range=0..1)])
entwine = Entwine(Branch00=number_2, Branch01=number_2, Branch02=number_2, Branch03=number_2, FlattenInputs=True)  # -> simplify(Result)

# ----
# Overall Height (middle)
number_slider = Slider(3.5, range=0..10)

# ----
# create breps
panel = Panel("4.81")
construct_point = ConstructPoint(XCoordinate="1.50", YCoordinate=panel, ZCoordinate=number_slider)
w = Slider(2.7, range=0..10)
d = Slider(5.9, range=0..10)
ax = Slider(4, range=-10..10)
ay = Slider(-8.5, range=-10..10)
python_3_script = Python3Script(center_pt=construct_point, width=w, depth=d, angle_x=ax, angle_y=ay)  # -> out, breps, center_pts, breps_extended; inputs center_pt: Point3d
# ---------- python_3_script: Python ----------
import Rhino.Geometry as rg
import math

# ── inputs ────────────────────────────────────────────────────────────────────
# width / depth = per-panel size, so total grid = 2*width x 2*depth
try:
    cx = float(center_pt.X)
    cy = float(center_pt.Y)
    cz = float(center_pt.Z)
except Exception:
    cx, cy, cz = 0.0, 0.0, 0.0

ax = float(angle_x)   # ANGLE1
ay = float(angle_y)   # ANGLE2
hw = float(width)     # half-width  = per-panel X size
hd = float(depth)     # half-depth  = per-panel Y size
EW = 2.9 #m    
ED = 6.0 #m

dz_x = hd * math.tan(math.radians(ax))
dz_y = hw * math.tan(math.radians(ay))

# ── 9 points ──────────────────────────────────────────────────────────────────
p0 = rg.Point3d(cx,      cy,      cz)
p1 = rg.Point3d(cx - hw, cy - hd, cz - dz_x - dz_y)
p2 = rg.Point3d(cx,      cy - hd, cz - dz_x)
p3 = rg.Point3d(cx + hw, cy - hd, cz - dz_x - dz_y)
p4 = rg.Point3d(cx - hw, cy,      cz - dz_y)
p6 = rg.Point3d(cx + hw, cy,      cz - dz_y)
p7 = rg.Point3d(cx - hw, cy + hd, cz - dz_x - dz_y)
p8 = rg.Point3d(cx,      cy + hd, cz - dz_x)
p9 = rg.Point3d(cx + hw, cy + hd, cz - dz_x - dz_y)
 
# ── helpers ───────────────────────────────────────────────────────────────────
def make_srf(a, b, c, d):
    poly = rg.Polyline([a, b, c, d, a])
    crv  = poly.ToNurbsCurve()
    res  = rg.Brep.CreatePlanarBreps(crv, 0.001)
    return res[0] if res else None
 
def vec(a, b):
    return rg.Vector3d(b.X - a.X, b.Y - a.Y, b.Z - a.Z)
 
def unitize(v):
    v2 = rg.Vector3d(v)
    v2.Unitize()
    return v2
 
def pt_add(p, v):
    return rg.Point3d(p.X + v.X, p.Y + v.Y, p.Z + v.Z)
 
def dot(a, b):
    return a.X*b.X + a.Y*b.Y + a.Z*b.Z
 
def fit_panel(a, b, c, d, ew, ed):
    v1 = vec(a, b)
    v2 = vec(a, d)

    # try both orientations, use whichever makes v1 the longer edge
    if v2.Length > v1.Length:
        v1, v2 = v2, v1

    normal = rg.Vector3d.CrossProduct(v1, v2)
    normal.Unitize()
    x_ax = unitize(v1)
    y_ax = rg.Vector3d.CrossProduct(normal, x_ax)
    y_ax.Unitize()

    def lproj(p):
        v = vec(a, p)
        return dot(v, x_ax), dot(v, y_ax)

    pb  = lproj(b)
    pd2 = lproj(d)

    flat_w = pb[0] + abs(pd2[0])
    flat_h = abs(pd2[1])

    long_s  = max(ew, ed)
    short_s = min(ew, ed)
    if flat_w >= flat_h:
        tw, th = long_s, short_s
    else:
        tw, th = short_s, long_s

    sx = tw / flat_w
    sy = th / flat_h

    new_b = pt_add(a, x_ax * (pb[0]  * sx))
    new_d = pt_add(a, x_ax * (pd2[0] * sx) + y_ax * (pd2[1] * sy))
    new_c = pt_add(new_b, vec(a, new_d))

    return a, new_b, new_c, new_d
 
# ── 4 panels ──────────────────────────────────────────────────────────────────
panels_pts = [
    (p0, p2, p1, p4),   # FL
    (p0, p2, p3, p6),   # FR — swap b and d vs before
    (p0, p8, p7, p4),   # BL — swap b and d vs before  
    (p0, p8, p9, p6),   # BR
]
 
breps          = []
breps_extended = []
 
for (a, b, c, d) in panels_pts:
    breps.append(make_srf(a, b, c, d))
    fa, fb, fc, fd = fit_panel(a, b, c, d, EW, ED)
    breps_extended.append(make_srf(fa, fb, fc, fd))
 
breps          = [b for b in breps          if b is not None]
breps_extended = [b for b in breps_extended if b is not None]
 
# ── center pts (flat, Z=0) ────────────────────────────────────────────────────
center_pts = [
    rg.Point3d(cx - hw*0.5, cy - hd*0.5, 0.0),
    rg.Point3d(cx + hw*0.5, cy - hd*0.5, 0.0),
    rg.Point3d(cx - hw*0.5, cy + hd*0.5, 0.0),
    rg.Point3d(cx + hw*0.5, cy + hd*0.5, 0.0),
]
# ---------- end python_3_script ----------

orient = Orient(Geometry=python_3_script.breps_extended, Source=python_3_script.breps_extended, Target=PlaneXY(0, 0, 0))  # -> Geometry, Transform
# actual clt?
brep = Brep(python_3_script.breps_extended)
brep_2 = Brep(python_3_script.breps)
bounding_box = BoundingBox(Content=orient.Geometry, Plane=PlaneXY(0, 0, 0))  # -> Box, Box_2
deconstruct_box = DeconstructBox(Box=bounding_box.Box)  # -> Plane, X, Y, Z

# ----
# create and manipulate graph
point = Point(python_3_script.center_pts)
python_3_script_2 = Python3Script(roof_breps=python_3_script.breps, supports=point, CLT_plate=brep, z_steps=entwine)  # -> out, ridges_tree, all_edges, graph, all_nodes, node_keys; inputs roof_breps: list of Brep, supports: list of Point3d, CLT_plate: list of Brep, z_steps: tree of Double
# ---------- python_3_script_2: Python ----------
import os
import sys
from compas_rhino import unload_modules
import compas
compas.PRECISION = ".3f"

gh_dir = os.path.dirname(ghenv.Component.OnPingDocument().FilePath)
sys.path.append(gh_dir)

import tree_builder
import nodegraph
import importlib

importlib.reload(nodegraph)
importlib.reload(tree_builder)


from tree_builder import build_tree_graph_from_breps
from Grasshopper import DataTree
from Grasshopper.Kernel.Data import GH_Path

# lines_tree will be our output
lines_tree = DataTree[object]()
z_tree = []
# 1. Iterate using the Branch count
for i in range(z_steps.BranchCount):
    branch = list(z_steps.Branch(i)) 
    z_tree.append(branch)

# CONSTANTS #
div_x = 3
div_y = 3
num_levels = 3

inset_edge = 0.3
inset_interior = 0.3

# Build the graph (all logic is in tree_builder.py)
ng = build_tree_graph_from_breps(
    supports=supports,
    input_breps=roof_breps,
    clt_breps = CLT_plate,
    div_x=div_x if div_x else 8,
    div_y=div_y if div_y else 6,
    num_levels=num_levels if num_levels else 4,
    z_steps=z_tree,
    inset_edge=inset_edge if inset_edge else 0.5,
    inset_interior=inset_interior if inset_interior else 0.4,
    reach_tol=0.05,
    debug=False
)

# Outputs
all_edges = ng.edge_lines()
graph = ng
all_nodes = ng.node_points()
node_keys = list(ng.nodes())
# ---------- end python_3_script_2 ----------
compas_draw = COMPASDraw(cg=python_3_script_2.all_edges)  # -> rg
#   port cg: The COMPAS geometry or datastructure to be drawn.
#   port rg: The Rhino geometry object.
# ---------- compas_draw: Python ----------
# r: compas>=2.14.1
"""
Draws COMPAS geometry in Grasshopper.
"""

from typing import Any

import Grasshopper

from compas.scene import SceneObject


class CompasToRhinoGeometry(Grasshopper.Kernel.GH_ScriptInstance):
    def RunScript(self, cg):
        if not cg:
            return None

        return SceneObject(item=cg).draw()
# ---------- end compas_draw ----------
compas_draw_2 = COMPASDraw(cg=python_3_script_2.all_nodes)  # -> rg; same code as compas_draw

deconstruct_domain = DeconstructDomain(Domain=deconstruct_box.X)  # -> Start, End
deconstruct_domain_2 = DeconstructDomain(Domain=deconstruct_box.Y)  # -> Start, End
subtraction = Subtraction(A=deconstruct_domain_2.End, B=deconstruct_domain_2.Start)
subtraction_2 = Subtraction(A=deconstruct_domain.End, B=deconstruct_domain.Start)
panel_2 = Panel([subtraction_2, subtraction])

# ----
# transform points
brep_3 = Brep([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])
python_3_script_3 = Python3Script(graph=python_3_script_2.graph, repellors=brep_3)  # -> out, edges, nodes, node_graph; inputs repellors: list of Brep
# ---------- python_3_script_3: Python ----------
import os, sys, importlib
gh_dir = os.path.dirname(ghenv.Component.OnPingDocument().FilePath)
if gh_dir not in sys.path:
    sys.path.insert(0, gh_dir)

### -----------------------------
## IMPORT
### -----------------------------
import nodegraph

importlib.reload(nodegraph)

from copy import deepcopy
from compas.geometry import Vector, Line, Point, centroid_points

ng = deepcopy(graph)



ng, results = ng.move_nodes_from_geometry(
    repellors,               # Mix of anything
    max_distance = 1.0,
    strength = 0.2,
    falloff = "linear"
)

# Outputs
node_graph = ng
edges = ng.edge_lines()
nodes = ng.node_points()
moved_pts = [r['new'] for r in results.values()]
# ---------- end python_3_script_3 ----------

panel_3 = Panel("modify points")
button = Button()  # disabled
py3 = Python3Script(unload=button)  # -> out, a; disabled
# ---------- py3: Python ----------
from compas_rhino import unload_modules
import compas_timber
import nodegraph

if unload:
    unload_modules('nodegraph')
    print("Module Unloaded")
# ---------- end py3 ----------

# ----
# preview graph
number_slider_2 = Slider(0.1, range=-0.5..0.5)
compas_draw_3 = COMPASDraw()  # -> rg; same code as compas_draw
compas_draw_4 = COMPASDraw()  # -> rg; same code as compas_draw
dot_display = DotDisplay(Point=compas_draw_4, Colour=ColourSwatch(SwatchColor=RGB(128, 128, 128)), Size=number_slider_2)

custom_preview_lineweights = CustomPreviewLineweights(
    Geometry=compas_draw_3,
    Shader=ColourSwatch(SwatchColor=RGB(144, 209, 232)),
    Thickness=Slider(4, range=0..10),
    Absolute=False)

number_slider_3 = Slider(0.2, range=0..1)
offset_surface = OffsetSurface(Distance=Slider(0.06, range=0..0.1), BothSides=0, CreateSolid=True)

# ----
# transform points
brep_4 = Brep([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])

# ----
# classify
python_3_script_4 = Python3Script(graph=python_3_script_2.graph)  # -> out, main_primary_lines, primary_lines, secondary_lines, tertiary_lines, graph_out
# ---------- python_3_script_4: Python ----------
import os, sys, importlib
gh_dir = os.path.dirname(ghenv.Component.OnPingDocument().FilePath)
if gh_dir not in sys.path:
    sys.path.insert(0, gh_dir)

import edge_classifier
importlib.reload(edge_classifier)

from edge_classifier import classify_edges_by_support_direction, edges_from_keys
from edge_classifier import assign_edges_dimensions
# Call the function
main_primary_keys, primary_keys, secondary_keys, tertiary_keys = classify_edges_by_support_direction(
    graph,
    parallel_tol=None,
    debug=False,
    seed_plane_tol=1e-3
)

# # Set default beams' dimensions
# assign_edges_dimensions(graph)


# Convert to Line objects for visualization
primary_lines = edges_from_keys(graph, primary_keys)
main_primary_lines = edges_from_keys(graph, main_primary_keys)
secondary_lines = edges_from_keys(graph, secondary_keys)
tertiary_lines = edges_from_keys(graph, tertiary_keys)

# output 
graph_out = graph

# for edge in graph.edges():
#     w = graph.edge_attribute(edge, 'width')
#     h = graph.edge_attribute(edge, 'height')
#     print (w, h)
# ---------- end python_3_script_4 ----------
draw = COMPASDraw(cg=python_3_script_4.primary_lines)  # -> rg; same code as compas_draw
draw_2 = COMPASDraw(cg=python_3_script_4.secondary_lines)  # -> rg; same code as compas_draw
draw_3 = COMPASDraw(cg=python_3_script_4.tertiary_lines)  # -> rg; same code as compas_draw
custom_preview_lineweights_2 = CustomPreviewLineweights(Geometry=draw, Shader=ColourSwatch(SwatchColor=RGB(137, 50, 143)), Thickness="8", Absolute=False)
custom_preview_lineweights_3 = CustomPreviewLineweights(Geometry=draw_2, Shader=ColourSwatch(SwatchColor=RGB(50, 143, 103)), Thickness="6", Absolute=False)
custom_preview_lineweights_4 = CustomPreviewLineweights(Geometry=draw_3, Shader=ColourSwatch(SwatchColor=RGB(218, 157, 103)), Thickness="6", Absolute=False)

python_3_script_5 = Python3Script(graph=python_3_script_4.graph_out, repellors=brep_4, s=Slider(0, range=0..100), offset=Slider(0.4, range=0..1))  # -> out, target_lines, edges, nodes, node_graph, group, new_pts, node_graph_2; inputs repellors: list of Brep, s: Int32, offset: Double
# ---------- python_3_script_5: Python ----------
import os, sys, importlib
gh_dir = os.path.dirname(ghenv.Component.OnPingDocument().FilePath)
if gh_dir not in sys.path:
    sys.path.insert(0, gh_dir)

### -----------------------------
## IMPORT
### -----------------------------
import nodegraph
import reciprocal
import edge_classifier

importlib.reload(nodegraph)
importlib.reload(reciprocal)
importlib.reload(edge_classifier)

from copy import deepcopy
from compas.geometry import Vector, Line, Point, centroid_points, Frame
from edge_classifier import classify_edges_by_support_direction, edges_from_keys
from edge_classifier import assign_edges_dimensions, create_subgraphs
# from nodegraph import move_node
# from reciprocal import find_coplanar_groups

ng = deepcopy(graph)
# ==============================================================================
# Helpers
# ==============================================================================

def _get_pt(subgraph, node):
    """Get point from node."""
    pt = subgraph.node_attribute(node, 'point')
    if pt is None:
        return Point(subgraph.node_attribute(node, 'x'),
                    subgraph.node_attribute(node, 'y'),
                    subgraph.node_attribute(node, 'z') or 0.0)
    return Point(pt.x, pt.y, pt.z) if hasattr(pt, 'x') else Point(*pt)

def _get_line(subgraph, edge):
    """Get line from edge."""
    u, v = edge
    line = subgraph.edge_attribute((u, v), 'line')
    if line and isinstance(line, Line):
        return line
    if line:
        return Line(Point(*line[0]), Point(*line[1]))
    return Line(_get_pt(subgraph, u), _get_pt(subgraph, v))

# ==============================================================================
# Coplanar Groups
# ==============================================================================

def find_coplanar_groups(subgraph, min_degree=2, plane_tol=0.1, debug=True, allowed_edges=None, max_degree=10, engage_len=0.11):
    """
    Find groups of eligible edges that lie on the same plane.
    Returns groups where 2+ edges meet at a joint.
    """
    allowed_keys = None
    if allowed_edges is not None:
        allowed_keys = {tuple(sorted((u, v))) for (u, v) in allowed_edges}

    # Get eligible edges
    if allowed_keys is None:
        edges = [
            (u, v)
            for u, v in subgraph.edges()
            if subgraph.edge_attribute((u, v), 'hierarchy') in ('primary', 'double')
        ]
    else:
        edges = [
            (u, v)
            for u, v in subgraph.edges()
            if tuple(sorted((u, v))) in allowed_keys
        ]
    
    if debug:
        print(f"Total eligible edges: {len(edges)}")
    
    if not edges:
        return []
    
    def edge_midpoint(edge):
        p1, p2 = _get_pt(subgraph, edge[0]), _get_pt(subgraph, edge[1])
        return Point((p1.x + p2.x)/2, (p1.y + p2.y)/2, (p1.z + p2.z)/2)
    
    def edge_direction(edge):
        d = Vector.from_start_end(_get_pt(subgraph, edge[0]), _get_pt(subgraph, edge[1]))
        d.unitize()
        return d
    
    def make_plane_frame(edge):
        """Create a plane frame from edge: origin=midpoint, normal=edge×Z"""
        mid = edge_midpoint(edge)
        d = edge_direction(edge)
        
        # Normal = edge × Z
        normal = d.cross(Vector(0, 0, 1))
        if normal.length < 1e-9:
            normal = d.cross(Vector(1, 0, 0))
        normal.unitize()
        
        # Frame: X=edge dir, Y=normal×edge, Z(local)=normal
        xaxis = d
        yaxis = normal.cross(d)
        yaxis.unitize()
        
        return Frame(mid, xaxis, yaxis), normal
    
    def edge_on_plane(edge, frame, tol):
        """Check if both endpoints of edge lie on the plane"""
        p1, p2 = _get_pt(subgraph, edge[0]), _get_pt(subgraph, edge[1])
        local1 = frame.to_local_coordinates(p1)
        local2 = frame.to_local_coordinates(p2)
        return abs(local1[2]) < tol and abs(local2[2]) < tol
    
    # Group edges by plane
    plane_groups = []
    remaining = list(edges)
    
    while remaining:
        # Pick first edge to define a plane
        seed = remaining.pop(0)
        frame, normal = make_plane_frame(seed)
        
        # Find all edges that lie on this plane
        on_plane = [seed]
        still_remaining = []
        
        for edge in remaining:
            if edge_on_plane(edge, frame, plane_tol):
                on_plane.append(edge)
            else:
                still_remaining.append(edge)
        
        remaining = still_remaining
        plane_groups.append((frame, normal, on_plane))
    
    return plane_groups

# ==============================================================================
# Main
# ==============================================================================

target_edges = []
for edge in ng.edges():
    if graph.edge_attribute(edge, 'group') == 0:
        hie = graph.edge_attribute(edge, 'hierarchy')
        if hie in ('secondary', 'tertiary'):
            target_edges.append(edge)

# --- find coplanar groups ---
groups = find_coplanar_groups(
    ng, min_degree=2, plane_tol=0.1, debug=False,
    allowed_edges=target_edges, max_degree=3, engage_len=.11
)

lines = []
target_lines = []
target_nodes = []

for group in groups:
    if len(group[2]) > 2:
        lines.append([_get_line(ng, edge) for edge in group[2]])
        nodes = []
        for edge in group[2]:
            u, v = edge
            nodes.append(u)
            nodes.append(v)
        target_nodes.append(set(nodes))

group = lines[s]

for line in lines:
    for l in line:
        target_lines.append(l)

# Extract vector
l1 = lines[1][0]
v1 = Vector.from_start_end(l1.start, l1.end)
v1.unitized()
v1_xy = Vector(v1.x, v1.y, 0)

l2 = lines[0][0]
v2 = Vector.from_start_end(l2.start, l2.end)
v2.unitized()
v2_xy = Vector(v2.x, v2.y, 0)

new_pts = []

for node in target_nodes[0]:
    ng, new_pt = ng.move_nodes(node, -v1_xy*offset)
    new_pts.append(new_pt)

for node in target_nodes[1]:
    ng, new_pt = ng.move_nodes(node, -v2_xy*offset)
    new_pts.append(new_pt)

for node in target_nodes[2]:
    ng, new_pt = ng.move_nodes(node, v1_xy*offset)
    new_pts.append(new_pt)

for node in target_nodes[3]:
    ng, new_pt = ng.move_nodes(node, v2_xy*offset)
    new_pts.append(new_pt)

# Outputs
node_graph = ng
edges = ng.edge_lines()
nodes = ng.node_points()
# ---------- end python_3_script_5 ----------

compas_draw_5 = COMPASDraw(cg=python_3_script_5.target_lines)  # -> rg; same code as compas_draw
compas_draw_6 = COMPASDraw(cg=python_3_script_5.group)  # -> rg; same code as compas_draw
compas_draw_7 = COMPASDraw(cg=python_3_script_5.edges)  # -> rg; same code as compas_draw
compas_draw_8 = COMPASDraw(cg=python_3_script_5.new_pts)  # -> rg; same code as compas_draw
custom_preview_lineweights_5 = CustomPreviewLineweights(Geometry=compas_draw_5, Shader=ColourSwatch(SwatchColor=RGB(231, 23, 143)), Thickness="8", Absolute=False)
draw_4 = COMPASDraw(cg=python_3_script_4.main_primary_lines)  # -> rg; same code as compas_draw

custom_preview_lineweights_6 = CustomPreviewLineweights(Geometry=draw_4, Shader=ColourSwatch(SwatchColor=RGB(231, 23, 143)), Thickness="8", Absolute=False)

# ----
# Add shoes
number_slider_4 = Slider(200, range=0..1000)
python_3_script_6 = Python3Script(graph=python_3_script_5.node_graph_2, extension=Slider(0.15, range=0..1))  # -> out, graph_out, shoe_lines; inputs extension: Double
# ---------- python_3_script_6: Python ----------
import os, sys, importlib
gh_dir = os.path.dirname(ghenv.Component.OnPingDocument().FilePath)
if gh_dir not in sys.path:
    sys.path.insert(0, gh_dir)


import leaf_solver
importlib.reload(leaf_solver)
from leaf_solver import create_shoes_from_graph
from copy import deepcopy



ng = deepcopy(graph)
result = create_shoes_from_graph(ng, extension_length = extension)

shoe_lines = result["shoe_lines"]
graph_out = ng


for edge in ng.edges():
    level = ng.edge_attribute(edge, 'level')
    print (level)
# ---------- end python_3_script_6 ----------
draw_5 = COMPASDraw(cg=python_3_script_6.shoe_lines)  # -> rg; same code as compas_draw

# ----
# Set default cross sections
python_3_script_7 = Python3Script(graph=python_3_script_6.graph_out)  # -> out, graph_out
# ---------- python_3_script_7: Python ----------
import os, sys, importlib
gh_dir = os.path.dirname(ghenv.Component.OnPingDocument().FilePath)
if gh_dir not in sys.path:
    sys.path.insert(0, gh_dir)


import edge_classifier
importlib.reload(edge_classifier)
from edge_classifier import assign_edges_dimensions


# Set default beams' dimensions
assign_edges_dimensions(graph, scale="m")


graph_out = graph
# ---------- end python_3_script_7 ----------

# ----
# Shifting - op 2 different joint middle node
number_slider_5 = Slider(0.8, range=0..1)
number_slider_6 = Slider(0.9, range=0..1)
number_slider_7 = Slider(0.05, range=0..0.1)
py3_2 = Python3Script(ng=python_3_script_7.graph_out, z_shift=Slider(0.06, range=0..0.1), t_value=number_slider_5)  # -> out, graph_out, edges, shifted, lines; inputs z_shift: Double, t_value: Double
# ---------- py3_2: Python ----------
import os, sys, importlib
from copy import deepcopy

gh_dir = os.path.dirname(ghenv.Component.OnPingDocument().FilePath)
if gh_dir not in sys.path:
    sys.path.insert(0, gh_dir)

import edge_classifier
import reciprocal
import line_constraints

importlib.reload(edge_classifier)
importlib.reload(reciprocal)
importlib.reload(line_constraints)

graph = deepcopy(ng)

# -----------------------------
# controls
# -----------------------------
sign_primary = +1
sign_secondary = +1
engage_len = 0.00
tol = 0.1
iters = 5




# -----------------------------
# 1) reciprocal primary
# -----------------------------
res_primary = reciprocal.reciprocal_width_from_subgraph(
    graph,
    target_hierarchy="primary",
    engage_len=engage_len,
    tol=tol,
    rotation_sign=sign_primary,
    min_degree=3,
    iterations=iters,
    max_angle=180.0, 
    max_degree = 3
)
g = res_primary["graph"]

# Snap to primary primary

line_constraints.snap_to_host(
    g,
    target_hierarchy="main_primary",
    move_node_level = 0,
    host_hierarchy="primary",
    z_offset = 0.10,
    write_attribute=True,
    debug=False
)

res_main_primary = reciprocal.reciprocal_width_from_subgraph(
    graph,
    target_hierarchy="main_primary",
    engage_len=engage_len,
    tol=tol,
    rotation_sign=sign_primary,
    min_degree=3,
    iterations=iters,
    max_angle=180.0
)
g = res_main_primary["graph"]
# -----------------------------
# 2) regenerate secondary (level 1 up)
# -----------------------------
line_constraints.snap_to_host(
    g,
    target_hierarchy="secondary",
    move_node_level = 1,
    host_hierarchy="primary",
    z_offset = z_shift,
    write_attribute=True,
    debug=False
)

line_constraints.snap_to_host(
    g,
    target_hierarchy="secondary",
    move_node_level = 1,
    host_hierarchy="main_primary",
    z_offset = z_shift,
    write_attribute=True,
    debug=False
)

# -----------------------------
# 3) reciprocal secondary
# -----------------------------
res_secondary = reciprocal.reciprocal_width_from_subgraph(
    g,
    target_hierarchy="secondary",
    engage_len=engage_len,
    tol=tol,
    rotation_sign=sign_secondary,
    min_degree=3,
    iterations=iters,
    max_angle=180.0
)
g = res_secondary["graph"]

# -----------------------------
# 5) regenerate tertiary (level 0 up)
# -----------------------------

lines = []
for e in g.edges():
    h = g.edge_attribute(e, "hierarchy")
    u,v = e
    lu = g.node_attribute(u, "level")
    lv = g.node_attribute(v, "level")
    if h == "tertiary":
        if lu == 1:
            g.edge_attribute(e,"hierarchy", "tertiary_l1" )
    if h == "secondary":
        if lu == 1:
            g.edge_attribute(e,"hierarchy", "secondary_l1" )



line_constraints.snap_to_host(
    g,
    target_hierarchy="tertiary",
    target_level_pair=0,
    move_node_level=0,
    host_hierarchy=("secondary", "secondary_l1") ,
    z_offset = 0.03,
    write_attribute=True,
    debug=False
)

line_constraints.snap_to_host(
    g,
    target_hierarchy="tertiary_l1",
    target_level_pair=0,
    move_node_level=0,
    host_hierarchy="secondary_l1" ,
    z_offset = 0,
    write_attribute=True,
    debug=False
)

line_constraints.snap_to_host(
    g,
    target_hierarchy="tertiary",
    move_node_level=0,
    host_hierarchy="primary",
    z_offset = 0.03,
    write_attribute=True,
    debug=False
)

line_constraints.snap_to_host(
    g,
    target_hierarchy="tertiary",
    move_node_level=0,
    host_hierarchy="main_primary",
    z_offset = 0.03,
    write_attribute=True,
    debug=False
)

line = line_constraints.middle_node_solver(g, debug=True, t_value=t_value)
print(line)

graph_out = g
shifted = []
for e in g.edges():
    shifted.append(g.edge_attribute(e, "shifted_line"))


points = []
for node in g.nodes():
    points.append(g.node_point(node))

edges = g.edge_lines()
# print(*g.edges_attributes())
lines = []

for e in g.edges():
    j = g.edge_attribute(e, "middle_joint")
    ln = g.edge_attribute(e, "shifted_line")
    if j:
        lines.append(ln)
    h = g.edge_attribute(e, "hierarchy")
    u,v = e
    lu = g.node_attribute(u, "level")
    lv = g.node_attribute(v, "level")
    if h == "tertiary_l1":
        if lu == 1:
            g.edge_attribute(e,"hierarchy", "tertiary" )
    if h == "secondary_l1":
        if lu == 1:
            g.edge_attribute(e,"hierarchy", "secondary" )
# ---------- end py3_2 ----------
draw_6 = COMPASDraw(cg=py3_2.edges)  # -> rg; same code as compas_draw
draw_7 = COMPASDraw(cg=py3_2.shifted)  # -> rg; same code as compas_draw
draw_8 = COMPASDraw(cg=py3_2.lines)  # -> rg; same code as compas_draw

# ----
# Shifting op1 - reciprocal middle joint
number_slider_8 = Slider(0.05, range=0..0.1)
py3_3 = Python3Script(ng=python_3_script_7.graph_out, z_shift=number_slider_8)  # -> out, graph_out, edges, shifted; inputs z_shift: Double
# ---------- py3_3: Python ----------
import os, sys, importlib
from copy import deepcopy

gh_dir = os.path.dirname(ghenv.Component.OnPingDocument().FilePath)
if gh_dir not in sys.path:
    sys.path.insert(0, gh_dir)

import edge_classifier
import reciprocal
import line_constraints

importlib.reload(edge_classifier)
importlib.reload(reciprocal)
importlib.reload(line_constraints)

graph = deepcopy(ng)

# -----------------------------
# controls
# -----------------------------
sign_primary = +1
sign_secondary = +1
engage_len = 0.015
tol = 0.1
iters = 5


# -----------------------------
# 1) reciprocal primary
# -----------------------------
res_primary = reciprocal.reciprocal_width_from_subgraph(
    graph,
    target_hierarchy="primary",
    engage_len=engage_len,
    tol=tol,
    rotation_sign=sign_primary,
    min_degree=3,
    iterations=iters,
    max_angle=180.0, 
    max_degree = 4
)
g = res_primary["graph"]

# Snap to primary primary

line_constraints.snap_to_host(
    g,
    target_hierarchy="main_primary",
    move_node_level = 0,
    host_hierarchy="primary",
    z_offset = z_shift,
    snap_8_degree_edges = False,
    write_attribute=True,
    debug=False
)

res_main_primary = reciprocal.reciprocal_width_from_subgraph(
    graph,
    target_hierarchy="main_primary",
    engage_len=engage_len,
    tol=tol,
    rotation_sign=sign_primary,
    min_degree=3,
    iterations=iters,
    max_angle=180.0
)
g = res_main_primary["graph"]
# -----------------------------
# 2) regenerate secondary (level 1 up)
# -----------------------------
line_constraints.snap_to_host(
    g,
    target_hierarchy="secondary",
    move_node_level = 1,
    host_hierarchy="primary",
    z_offset = z_shift,
    write_attribute=True,
    debug=False
)

line_constraints.snap_to_host(
    g,
    target_hierarchy="secondary",
    move_node_level = 1,
    host_hierarchy="main_primary",
    z_offset = z_shift,
    write_attribute=True,
    debug=False
)

# -----------------------------
# 3) reciprocal secondary
# -----------------------------
res_secondary = reciprocal.reciprocal_width_from_subgraph(
    g,
    target_hierarchy="secondary",
    engage_len=engage_len,
    tol=tol,
    rotation_sign=sign_secondary,
    min_degree=3,
    iterations=iters,
    max_angle=180.0
)
g = res_secondary["graph"]

# -----------------------------
# 5) regenerate tertiary (level 0 up)
# -----------------------------
line_constraints.snap_to_host(
    g,
    target_hierarchy="tertiary",
    move_node_level=0,
    host_hierarchy="secondary" ,
    z_offset = z_shift,
    write_attribute=True,
    debug=False
)

line_constraints.snap_to_host(
    g,
    target_hierarchy="tertiary",
    move_node_level=0,
    host_hierarchy="primary",
    z_offset = z_shift,
    write_attribute=True,
    debug=False
)

line_constraints.snap_to_host(
    g,
    target_hierarchy="tertiary",
    move_node_level=0,
    host_hierarchy="main_primary",
    z_offset = z_shift,
    write_attribute=True,
    debug=False
)


graph_out = g
shifted = []
for e in g.edges():
    shifted.append(g.edge_attribute(e, "shifted_line"))
# ---------- end py3_3 ----------
draw_9 = COMPASDraw(cg=py3_3.edges)  # -> rg; same code as compas_draw
draw_10 = COMPASDraw(cg=py3_3.shifted)  # -> rg; same code as compas_draw

# ----
# foundation
python_3_script_8 = Python3Script(graph=py3_2.graph_out)  # -> out, graph_out, crosecs, cut_planes, sup_lines, total_lines
# ---------- python_3_script_8: Python ----------
import os, sys, importlib
gh_dir = os.path.dirname(ghenv.Component.OnPingDocument().FilePath)
if gh_dir not in sys.path:
    sys.path.insert(0, gh_dir)


import foundation_solver
importlib.reload(foundation_solver)
from foundation_solver import trim_anchored_beams_and_find_cut_planes
from copy import deepcopy

from compas.geometry import Polygon

############--------Main Code----------#########
ng = deepcopy(graph)
result = trim_anchored_beams_and_find_cut_planes(ng, min_gap=0.001, min_height=0.01, _step = 0.01)

########--------Output Data---------#########
cro_sec_dict = result["cross_sections"]
crosecs = []
for node, cro_sec_list in cro_sec_dict.items():
    for crosec in cro_sec_list:
        poly = Polygon(crosec)
        crosecs.append(poly)

cut_pln_dict = result["cut_planes"]
cut_planes = []
for node, pln in cut_pln_dict.items():
    cut_planes.append(pln)


sup_lines = []
for edge in ng.get_support_edges():
    if "shifted_line" in graph.edge_attributes(edge):
        ln = ng.edge_attribute(edge, "shifted_line")
    else:
        ln = ng.edge_line(edge)
    sup_lines.append(ln)


total_lines = []
for e in ng.edges():
    total_lines.append(ng.edge_attribute(e, "shifted_line"))


graph_out = ng
#############-----------Print----------##########
# print (result["cross_sections"])
# print ()
# print (result["cut_planes"])
print (result["foundation_heights"])


for node in ng.get_support_nodes():
    print (ng.node_attribute(node, 'cut_plane'))
# ---------- end python_3_script_8 ----------
draw_11 = COMPASDraw(cg=python_3_script_8.crosecs)  # -> rg; same code as compas_draw
draw_12 = COMPASDraw(cg=python_3_script_8.cut_planes)  # -> rg; same code as compas_draw
draw_13 = COMPASDraw(cg=python_3_script_8.total_lines)  # -> rg; same code as compas_draw
draw_14 = COMPASDraw(cg=python_3_script_8.sup_lines)  # -> rg; same code as compas_draw

python_3_script_9 = Python3Script(graph=python_3_script_8.graph_out)  # -> out, lines, colors
# ---------- python_3_script_9: Python ----------
import rhinoscriptsyntax as rs
import scriptcontext as sc
import Rhino.Display as rd
import System.Drawing as sd
from compas.geometry import Line, Point
from copy import deepcopy

ng = deepcopy(graph)

HIERARCHY_COLORS = {
    "primary":      sd.Color.FromArgb(255, 220,  50,  50),
    "main_primary": sd.Color.FromArgb(255, 150,  80, 220),
    "secondary":    sd.Color.FromArgb(255,  50, 150, 220),
    "tertiary":     sd.Color.FromArgb(255,  80, 200, 100),
    "shoe":         sd.Color.FromArgb(255,  20, 150, 100)
}

lines = []
colors = []

for e in ng.edges():
    h  = ng.edge_attribute(e, "hierarchy")
    ln = ng.edge_attribute(e, "shifted_line")

    if ln is None or h not in HIERARCHY_COLORS:
        continue

    lines.append(ln)
    colors.append(HIERARCHY_COLORS[h])
# ---------- end python_3_script_9 ----------
compas_draw_9 = COMPASDraw(cg=python_3_script_9.lines)  # -> rg; same code as compas_draw
custom_preview_lineweights_7 = CustomPreviewLineweights(Geometry=compas_draw_9, Shader=python_3_script_9.colors, Thickness="8", Absolute=False)

py3_4 = Python3Script(graph=python_3_script_8.graph_out)  # -> out, lines, widths, heights
# ---------- py3_4: Python ----------
lines = []
widths = []
heights = []
for edge in graph.edges():
    attrs = graph.edge_attributes(edge)
    if "shifted_line" in attrs:
        ln = graph.edge_attribute(edge, "shifted_line")
    else:
        ln = graph.edge_line(edge)

    lines.append(ln)
    widths.append(graph.edge_attribute(edge, "width"))
    heights.append(graph.edge_attribute(edge, "height"))
# ---------- end py3_4 ----------
draw_15 = COMPASDraw(cg=py3_4.lines)  # -> rg; same code as compas_draw

# ----
# export line model for compas timber
button_2 = Button()
py3_5 = Python3Script(export=button_2, graph=python_3_script_8.graph_out)  # -> out, a; inputs export: Boolean
# ---------- py3_5: Python ----------
from compas.data import json_dump

import os, sys, importlib

gh_dir = os.path.dirname(ghenv.Component.OnPingDocument().FilePath)
if gh_dir not in sys.path:
    sys.path.insert(0, gh_dir)

file_path = os.path.join(gh_dir, "data", "260513_shifted_lines.json")
print(file_path)
if export:
    json_dump(graph, file_path, pretty = True)
# ---------- end py3_5 ----------

beam = CTBeam(centerline=draw_15, width=py3_4.widths, height=py3_4.heights)  # -> Beam, Blank; inputs centerline: list, z_vector: list of Vector3d, width: list of Double, height: list of Double, category: list of String, updateRefObj: Boolean
#   port centerline: Referenced curve or line, Guid of curve or line in the active Rhino document.
#   port z_vector: Vector defining the orientation of the cross-section (corresponds to the height dimension). If None, a default will be taken.
#   port width: Width of the cross-section (usually the smaller dimension).
#   port height: Height of the cross-section (usually the larger dimension).
#   port category: Category of a beam.
#   port updateRefObj: (optional) If True, the attributes in the referenced object will be updated/overwritten with the new values given here.
#   port Beam: Beam object(s).
#   port Blank: Shape of the beam's blank.
# ---------- beam: Python ----------
# env: C:\Users\jfrancisco\Documents\GitHub\timber_design\src
# r: compas_timber>=0.16.2
"""Creates a Beam from a LineCurve."""

# flake8: noqa
import Grasshopper
import Rhino
import rhinoscriptsyntax as rs
import System
from compas.scene import Scene
from compas_rhino.conversions import line_to_compas
from compas_rhino.conversions import vector_to_compas

from compas_timber.elements import Beam as CTBeam
from timber_design.ghpython.ghcomponent_helpers import list_input_valid_cpython


class Beam_fromCurve(Grasshopper.Kernel.GH_ScriptInstance):
    def RunScript(self,
            centerline: System.Collections.Generic.List[object],
            z_vector: System.Collections.Generic.List[Rhino.Geometry.Vector3d],
            width: System.Collections.Generic.List[float],
            height: System.Collections.Generic.List[float],
            category: System.Collections.Generic.List[str],
            updateRefObj: bool):
        # minimum inputs required
        if not list_input_valid_cpython(ghenv, centerline, "Centerline"):
            return
        if not width:
            length = self._get_centerline_length(centerline)
            width = [length / 20]
        if not height:
            length = self._get_centerline_length(centerline)
            height = [length / 10]

        # reformat unset parameters for consistency
        if not z_vector:
            z_vector = [None]
        if not category:
            category = [None]

        beams = []
        blanks = []
        scene = Scene()

        if centerline and height and width:
            # check list lengths for consistency
            N = len(centerline)
            if len(z_vector) not in (0, 1, N):
                ghenv.Component.AddRuntimeMessage(
                    Grasshopper.Kernel.GH_RuntimeMessageLevel.Error, " In 'ZVector' I need either none, one or the same number of inputs as the Crv parameter."
                )
            if len(width) not in (1, N):
                ghenv.Component.AddRuntimeMessage(Grasshopper.Kernel.GH_RuntimeMessageLevel.Error, " In 'W' I need either one or the same number of inputs as the Crv parameter.")
            if len(height) not in (1, N):
                ghenv.Component.AddRuntimeMessage(Grasshopper.Kernel.GH_RuntimeMessageLevel.Error, " In 'H' I need either one or the same number of inputs as the Crv parameter.")
            if len(category) not in (0, 1, N):
                ghenv.Component.AddRuntimeMessage(
                    Grasshopper.Kernel.GH_RuntimeMessageLevel.Error, " In 'Category' I need either none, one or the same number of inputs as the Crv parameter."
                )

            # duplicate data if None or single value
            if len(z_vector) != N:
                z_vector = [z_vector[0] for _ in range(N)]
            if len(width) != N:
                width = [width[0] for _ in range(N)]
            if len(height) != N:
                height = [height[0] for _ in range(N)]
            if len(category) != N:
                category = [category[0] for _ in range(N)]

            for line, z, w, h, c in zip(centerline, z_vector, width, height, category):
                guid, geometry = self._get_guid_and_geometry(line)
                rhino_line = rs.coerceline(geometry)
                line = line_to_compas(rhino_line)

                z = vector_to_compas(z) if z else None
                beam = CTBeam.from_centerline(centerline=line, width=w, height=h, z_vector=z)
                beam.attributes["rhino_guid"] = str(guid) if guid else None
                beam.attributes["category"] = c


                beams.append(beam)
                scene.add(beam.blank)

        blanks = scene.draw()

        return beams, blanks

    def _get_guid_and_geometry(self, line):
        # internalized curves and GH geometry will not have persistent GUIDs, referenced Rhino objects will
        # type hint on the input has to be 'ghdoc' for this to work
        guid = None
        geometry = line
        rhino_obj = Rhino.RhinoDoc.ActiveDoc.Objects.FindId(line)
        if rhino_obj:
            guid = line
            geometry = rhino_obj.Geometry
        return guid, geometry

    def _get_centerline_length(self, centerline):
        centerline_length = []
        for i in centerline:
            centerline_length.append(rs.CurveLength(i))
        if centerline_length:
            length_average = sum(centerline_length) / len(centerline_length)
        else:
            length_average = 1
        return length_average
# ---------- end beam ----------
python_3_script_10 = Python3Script(graph=python_3_script_8.graph_out)  # -> out, graph_out, line_tree
# ---------- python_3_script_10: Python ----------
import os, sys, importlib
gh_dir = os.path.dirname(ghenv.Component.OnPingDocument().FilePath)
if gh_dir not in sys.path:
    sys.path.insert(0, gh_dir)


from copy import deepcopy


ng = deepcopy(graph)








# points = []
# for node in ng.nodes():
#     group = ng.node_attribute(node, 'group')
#     sup_id = ng.node_attribute(node, 'support_id')

#     if group is not None:
#         points.append(ng.node_point(node))
#     print (group, sup_id)


from Grasshopper import DataTree
from Grasshopper.Kernel.Data import GH_Path
    
line_tree = DataTree[object]()

for edge in ng.edges():
    group = ng.edge_attribute(edge, 'group')
    sup_id = ng.edge_attribute(edge, 'nearest_support')

    attrs = ng.edge_attributes(edge)
    print (attrs)
    # print (group, sup_id)
    path = GH_Path(group)
    line_tree.Add(ng.edge_line(edge), path)
# ---------- end python_3_script_10 ----------
volume = Volume(Geometry=beam.Blank)  # -> Volume, Centroid
draw_16 = COMPASDraw(cg=python_3_script_10.line_tree)  # -> rg; same code as compas_draw
branch = TreeBranch(Tree=draw_16, Path=Slider(3, range=0..3), MaintainPaths=True)
custom_preview = CustomPreview(Geometry=beam.Blank, Material=ColourSwatch(SwatchColor=RGB(219, 206, 167)))
mass_addition = MassAddition(Input=volume.Volume)  # -> Result, PartialResults
panel_4 = Panel(mass_addition.Result)
