# Grasshopper definition line_model_classification.ghx (Grasshopper 1.0.8)
# plug-ins: Human

# ----
# * Params
height = Panel("2.0")
height_2 = Panel("9.12")
merge = Merge(
    Data1="0",
    Data2=Slider(0.468, range=0.001..1),
    Data3=Slider(1.574, range=1.001..3),
    Data4=Slider(3.404, range=3.001..5),
    Data5=height)
merge_2 = Merge(
    Data1="0",
    Data2=Slider(0.34, range=0.001..1),
    Data3=Slider(0.8, range=0.701..1.5),
    Data4=Slider(2.196, range=1.501..3),
    Data5=height)
bnd = Bounds(Numbers=merge)
bnd_2 = Bounds(Numbers=merge_2)
remap = RemapNumbers(Value=merge_2, Source=bnd_2, Target=Domain(0, 1))  # -> Mapped, Clipped
remap_2 = RemapNumbers(Value=merge, Source=bnd, Target=Domain(0, 1))  # -> Mapped, Clipped
entwine = Entwine(Branch00=remap.Mapped, Branch01=remap.Mapped, FlattenInputs=True)  # -> simplify(Result)

py3 = Python3Script(l=Slider(5, range=0..10), coeff_h=Slider(0.43, range=0..1))  # -> out, D_heigts; inputs l: Int32, coeff_h: Double
# ---------- py3: Python ----------
import Rhino.Geometry as rg
import math
from ghpythonlib.treehelpers import list_to_tree, tree_to_list


def expo_num(coeff):
    max_heigth = 1
    h_coeficient = []
    for n in range(l):
        y = coeff ** (n*(-1)) # number 2 can be change so the exponential changes
        h_coeficient.append(abs(y - 1))
    heigts = []
    print(h_coeficient)
    for n in h_coeficient:
        param = n/h_coeficient[-1]
        r = max_heigth * param
        h = r - max_heigth
        # heigts.append(round(r, 1))
        heigts.append(r)
    D = heigts
    return D

D_heigts = expo_num(coeff_h)
# ---------- end py3 ----------
panel = Panel(py3.D_heigts)

brep = Brep(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)
point = Point([Point(162.73, 50.18, 20.14375552), Point(162.73, 40.56, 20.15824172), Point(159.73, 40.56, 20.15385067), Point(159.73, 50.18, 20.15385067)])
point_2 = Point(point)
curve = Curve(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)

# ----
# create and manipulate graph
python_3_script = Python3Script(boundary=curve, roof_brep=brep, supports=point_2, z_steps=entwine)  # -> out, ridges_tree, all_edges, graph, all_nodes, node_keys; inputs boundary: Curve, roof_brep: Brep, supports: list of Point3d, z_steps: tree of Double
# ---------- python_3_script: Python ----------
import os
import sys
from compas_rhino import unload_modules
import compas
compas.PRECISION = ".3f"

gh_dir = os.path.dirname(ghenv.Component.OnPingDocument().FilePath)
sys.path.append(gh_dir)

import tree_builder
import nodegraph
import importlib

importlib.reload(nodegraph)
importlib.reload(tree_builder)


from tree_builder import build_tree_graph
from Grasshopper import DataTree
from Grasshopper.Kernel.Data import GH_Path

# lines_tree will be our output
lines_tree = DataTree[object]()
z_tree = []
# 1. Iterate using the Branch count
for i in range(z_steps.BranchCount):
    branch = list(z_steps.Branch(i)) 
    z_tree.append(branch)

print(type(z_tree[1]))

# CONSTANTS #
div_x = 6
div_y = 6
num_levels = 3

inset_edge = 0.5
inset_interior = 0.5

# Build the graph (all logic is in tree_builder.py)
ng = build_tree_graph(
    boundary=boundary,
    supports=supports,
    roof_brep=roof_brep,
    div_x=div_x if div_x else 8,
    div_y=div_y if div_y else 6,
    num_levels=num_levels if num_levels else 4,
    z_steps=z_tree,
    inset_edge=inset_edge if inset_edge else 0.5,
    inset_interior=inset_interior if inset_interior else 0.4,
    reach_tol=0.05,
    debug=True
)

# Outputs
all_edges = ng.edge_lines()
graph = ng
all_nodes = ng.node_points()
node_keys = list(ng.nodes())
# ---------- end python_3_script ----------
compas_draw = COMPASDraw(cg=python_3_script.all_nodes)  # -> rg
#   port cg: The COMPAS geometry or datastructure to be drawn.
#   port rg: The Rhino geometry object.
# ---------- compas_draw: Python ----------
# r: compas>=2.14.1
"""
Draws COMPAS geometry in Grasshopper.
"""

from typing import Any

import Grasshopper

from compas.scene import SceneObject


class CompasToRhinoGeometry(Grasshopper.Kernel.GH_ScriptInstance):
    def RunScript(self, cg):
        if not cg:
            return None

        return SceneObject(item=cg).draw()
# ---------- end compas_draw ----------
compas_draw_2 = COMPASDraw(cg=python_3_script.all_edges)  # -> rg; same code as compas_draw
python_3_script_2 = Python3Script(graph=python_3_script.graph)  # -> out, edges, nodes, idx, node_graph, a, b, c
# ---------- python_3_script_2: Python ----------
from copy import deepcopy
import os
import sys

gh_dir = os.path.dirname(ghenv.Component.OnPingDocument().FilePath)
if gh_dir not in sys.path:
    sys.path.insert(0, gh_dir)

ng = deepcopy(graph)

# Delete nodes
for node_id in [288, 289, 204, 205, 202, 203, *range(188,192)]:
    if ng.has_node(node_id):
        ng.delete_node(node_id)

# # Add new elements
# target_pairs = [
#     [286, 274, 275, True], [287, 276, 277, True], [290, 278, 279, True], [291, 280, 281, True],
#     [286, 270, 271, False], [287, 272, 273, False], [290, 282, 283, False], [291, 284, 285, False],
#     [246, 44, 81, False], [246, 48, 87, False], [248, 54, 91, False], [248, 58, 97, False],
#     [258, 124, 161, False], [258, 128, 167, False], [260, 134, 171, False], [260, 138, 177, False],
#     [249, 64, 101, False], [249, 68, 107, False], [251, 74, 111, False], [251, 78, 117, False],
#     [261, 144, 181, False], [261, 148, 187, False], [263, 154, 191, False], [263, 158, 197, False],
#     [286, 246], [287, 249], [290, 258], [291, 261],
#     [286, 248], [287, 251], [290, 260], [291, 263],
#     [296, 241], [297, 244], [298, 265], [299, 268],
#     [296, 247], [297, 250], [298, 259], [299, 262],
#     [296, 270], [297, 272], [298, 282], [299, 284],
#     [296, 271], [297, 273], [298, 283], [299, 285],
# ]

# ng.add_segments(target_pairs)


edges = ng.edge_lines_by_group(0) + ng.edge_lines_by_group(1)
# nodes = ng.node_points()
# idx = list(ng.nodes())
node_graph = ng

a = ng.points_by_mobility("fixed")     # supports + inset corners
b = ng.points_by_mobility("z_free")    # apex nodes
c = ng.points_by_mobility("yz_free")  # added via add_segment
# ---------- end python_3_script_2 ----------

compas_draw_3 = COMPASDraw(cg=[python_3_script_2.a, python_3_script_2.b, python_3_script_2.c])  # -> rg; same code as compas_draw
compas_draw_4 = COMPASDraw(cg=python_3_script_2.edges)  # -> rg; same code as compas_draw

swatch = ColourSwatch(SwatchColor=RGB(51, 56, 66))
text_tag = TextTag(Location=compas_draw, Text=python_3_script.node_keys, Colour=swatch)
dot_display = DotDisplay(Point=compas_draw_3, Colour=swatch, Size=Slider(0.1, range=0..0.1))

custom_preview_lineweights = CustomPreviewLineweights(
    Geometry=compas_draw_4,
    Shader=ColourSwatch(SwatchColor=RGB(144, 209, 232)),
    Thickness=Slider(4, range=0..10),
    Absolute=False)

length = Length(Curve=compas_draw_4)
sort_list = SortList(Keys=length, ValuesValuesA=length)  # -> Keys, ValuesValuesA
panel_2 = Panel("""6
7""")
draw = COMPASDraw()  # -> rg; same code as compas_draw
custom_preview_lineweights_2 = CustomPreviewLineweights(Geometry=draw, Shader=ColourSwatch(SwatchColor=RGB(78, 207, 222)), Thickness="3", Absolute=False)

# ----
# Classfiy Edges
panel_3 = Panel("""0
1
2
3""")
python_3_script_3 = Python3Script(graph=python_3_script_2.node_graph, sub=Toggle(True), sub_ids=panel_2)  # -> out, primary_lines, secondary_lines, graph_out; inputs sub: Boolean, sub_ids: list of Int32
# ---------- python_3_script_3: Python ----------
import os, sys, importlib

gh_dir = os.path.dirname(ghenv.Component.OnPingDocument().FilePath)
if gh_dir not in sys.path:
    sys.path.insert(0, gh_dir)

import edge_classifier
importlib.reload(edge_classifier)
from edge_classifier import classify_edges_by_support_direction

primary_lines, secondary_lines, data = classify_edges_by_support_direction(graph, debug=True)

# output 
graph_out = graph
# ---------- end python_3_script_3 ----------
draw_2 = COMPASDraw()  # -> rg; same code as compas_draw
draw_3 = COMPASDraw(cg=python_3_script_3.primary_lines)  # -> rg; same code as compas_draw
custom_preview_lineweights_3 = CustomPreviewLineweights(Geometry=draw_2, Shader=ColourSwatch(SwatchColor=RGB(231, 148, 222)), Thickness="3", Absolute=False)
custom_preview_lineweights_4 = CustomPreviewLineweights(Geometry=draw_3, Shader=ColourSwatch(SwatchColor=RGB(137, 50, 143)), Thickness="8", Absolute=False)

draw_4 = COMPASDraw(cg=python_3_script_3.secondary_lines)  # -> rg; same code as compas_draw

custom_preview_lineweights_5 = CustomPreviewLineweights(Geometry=draw_4, Shader=ColourSwatch(SwatchColor=RGB(50, 143, 103)), Thickness="6", Absolute=False)

# ----
# Snap leaf points and create shoes
brep_2 = Brep(brep)
python_3_script_4 = Python3Script(graph=python_3_script_3.graph_out, brep=brep_2)  # -> out, graph_out, leaf_lines, leaf_points, shoe_lines, other_lines; inputs brep: Brep
# ---------- python_3_script_4: Python ----------
import os, sys, importlib
gh_dir = os.path.dirname(ghenv.Component.OnPingDocument().FilePath)
if gh_dir not in sys.path:
    sys.path.insert(0, gh_dir)


import leaf_solver
importlib.reload(leaf_solver)
from leaf_solver import create_shoes_and_shift_leaves
from copy import deepcopy



ng = deepcopy(graph)

result = create_shoes_and_shift_leaves(ng, brep, min_length=0.30, min_angle=15)


########--------Output Data---------#########
leaf_lines = [ng.edge_line(edge) for edge in ng.edges() if ng.is_leaf_edge(edge)]
other_lines = [ng.edge_line(edge) for edge in ng.edges() if not ng.is_leaf_edge(edge)]

leaf_points = result["leaf_points"]
shoe_lines = result["shoe_lines"]

graph_out = ng

#############-----------Print----------##########
group = result["group_dict"]
print (group)
# ---------- end python_3_script_4 ----------
draw_5 = COMPASDraw(cg=python_3_script_4.leaf_lines)  # -> rg; same code as compas_draw
draw_6 = COMPASDraw(cg=python_3_script_4.shoe_lines)  # -> rg; same code as compas_draw
draw_7 = COMPASDraw(cg=python_3_script_4.leaf_points)  # -> rg; same code as compas_draw
draw_8 = COMPASDraw(cg=python_3_script_4.other_lines)  # -> rg; same code as compas_draw

py3_2 = Python3Script(subgraph=python_3_script_4.graph_out, y=Slider(0, range=0..1))  # -> out, a, b, c, d, e, f, h, i; inputs y: Double
# ---------- py3_2: Python ----------
import os
import sys
import importlib

# -----------------------------------------------------------------------------
# Setup
# -----------------------------------------------------------------------------
gh_dir = os.path.dirname(ghenv.Component.OnPingDocument().FilePath)
if gh_dir not in sys.path:
    sys.path.insert(0, gh_dir)

import reciprocal_staged
import line_constraints

importlib.reload(reciprocal_staged)
importlib.reload(line_constraints)

# -----------------------------------------------------------------------------
# 1) Reciprocal stage: orthogonal first
# -----------------------------------------------------------------------------
stage = reciprocal_staged.reciprocal_staged_primary_from_subgraph(subgraph)
g = stage["graph"]

# -----------------------------------------------------------------------------
# 2) Constrain primary diagonals (level 1, specific driving nodes), move up
# -----------------------------------------------------------------------------

diag_dep = line_constraints.regenerate_edges(
    g,
    target_hierarchy="primary",  
    target_categories=("default_diagonal", "moved_diagonal"),
    target_level_pair=None,   
    target_nodes=[246],          
    move_node_level=1,
    host_hierarchy="primary",   
    host_categories="orthogonal",
    host_level_pair=None,
    choose="up",
    prefer_on_segment=True,
    debug=True,
)
print(diag_dep["info"])

line_constraints.commit_generated_lines(
    g,
    hierarchy_filter="primary",
    category_filter=("default_diagonal", "moved_diagonal"),
)

b = diag_dep["generated_lines"]


# -----------------------------------------------------------------------------
# 3) Reciprocal stage: diagonals only
# -----------------------------------------------------------------------------
diag_rec = reciprocal_staged.reciprocal_diagonal_primary_from_subgraph(g)
g = diag_rec["graph"]

# -----------------------------------------------------------------------------
# 4) Secondary: move level-0 endpoint up
# -----------------------------------------------------------------------------

#add shift allong host if node has 4 edges, if none has 6 keep the alignment)

sec_shift = line_constraints.regenerate_edges(
    g,
    target_hierarchy="secondary",
    move_node_level=0,
    host_hierarchy="primary",
    host_categories=("orthogonal", "default_diagonal", "moved_diagonal"),
    host_level_pair=None,
    choose="up",
    shift_along_host=y,
    prefer_on_segment=True,
    debug=True,
)
line_constraints.commit_generated_lines(g, hierarchy_filter="secondary")

print(sec_shift["info"])
# -----------------------------------------------------------------------------
# 5) Tertiary pass A: move level-0 endpoint down
# -----------------------------------------------------------------------------
ter_shift_l0 = line_constraints.regenerate_edges(
    g,
    target_hierarchy="tertiary",
    move_node_level=0,
    host_hierarchy="primary",
    host_categories=("orthogonal", "default_diagonal", "moved_diagonal"),
    host_level_pair=None,
    choose="down",
    prefer_on_segment=True,
    debug=True,
)
line_constraints.commit_generated_lines(g, hierarchy_filter="tertiary")

# -----------------------------------------------------------------------------
# 6) Tertiary pass B: move level-1 endpoint up (keeps previous shift)
# -----------------------------------------------------------------------------
ter_shift_l1 = line_constraints.regenerate_edges(
    g,
    target_hierarchy="tertiary",
    move_node_level=1,
    host_hierarchy="primary",
    host_categories=("orthogonal", "default_diagonal", "moved_diagonal"),
    host_level_pair=None,
    choose="up",
    prefer_on_segment=True,
    debug=True,
)
line_constraints.commit_generated_lines(g, hierarchy_filter="tertiary")

# -------------------------------------------------------------------------
# Quaternary pass A: move level-1 endpoint DOWN
# -------------------------------------------------------------------------
qua_shift_l1 = line_constraints.regenerate_edges(
    g,
    target_hierarchy="quaternary",
    target_categories=None,
    target_level_pair=(1, 2),
    target_nodes=None,
    move_node_level=1,
    host_hierarchy="primary",
    host_categories=("orthogonal", "default_diagonal", "moved_diagonal"),
    host_level_pair=None,
    choose="down",
    prefer_on_segment=True,
    debug=True,
)

line_constraints.commit_generated_lines(g, hierarchy_filter="quaternary")

# -------------------------------------------------------------------------
# Quaternary pass B: move level-2 endpoint UP (keeps pass A result)
# -------------------------------------------------------------------------
qua_shift_l2 = line_constraints.regenerate_edges(
    g,
    target_hierarchy="quaternary",
    target_categories=None,
    target_level_pair=(1, 2),
    target_nodes=None,
    move_node_level=2,
    host_hierarchy="primary",
    host_categories=("orthogonal", "default_diagonal", "moved_diagonal"),
    host_level_pair=None,
    choose="up",
    prefer_on_segment=True,
    debug=True,
)

line_constraints.commit_generated_lines(g, hierarchy_filter="quaternary")

# GH preview outputs


#-------------------------------------------------------------------------
# GH outputs
# -----------------------------------------------------------------------------
a = stage["viz"]["stage_1_shifted_lines"]      # orthogonal reciprocal
               
d = diag_rec["shifted_diagonal_lines"]         # diagonal reciprocal

e = sec_shift["generated_lines"]               # secondary shifted
f = ter_shift_l0["generated_lines"]            # tertiary l0 down
h = ter_shift_l1["generated_lines"]            # tertiary l1 up
i = qua_shift_l2["generated_lines"] # level-2 up


g_out = g
# ---------- end py3_2 ----------
draw_9 = COMPASDraw(cg=py3_2.b)  # -> rg; same code as compas_draw
draw_10 = COMPASDraw(cg=py3_2.a)  # -> rg; same code as compas_draw
draw_11 = COMPASDraw(cg=py3_2.c)  # -> rg; same code as compas_draw
draw_12 = COMPASDraw(cg=py3_2.d)  # -> rg; same code as compas_draw
draw_13 = COMPASDraw(cg=py3_2.e)  # -> rg; same code as compas_draw
draw_14 = COMPASDraw(cg=py3_2.h)  # -> rg; same code as compas_draw
draw_15 = COMPASDraw(cg=py3_2.f)  # -> rg; same code as compas_draw
draw_16 = COMPASDraw(cg=py3_2.i)  # -> rg; same code as compas_draw
