# Grasshopper definition line_model_timber.ghx (Grasshopper 1.0.8)
# plug-ins: Pufferfish, Human

range = Range(Domain=Domain(0, 1), Steps="3")
range_2 = Range(Domain=Domain(0, 1), Steps="3")
range_3 = Range(Domain=Domain(0, 1), Steps="3")
range_4 = Range(Domain=Domain(0, 1), Steps="3")
graph_mapper = GraphMapper(
    range_4,
    x0=0,
    x1=1,
    y0=0,
    y1=1,
    container_name="Bezier",
    cpx=[0, 0.415862143, 0.8706001639, 1],
    cpy=[0, 0.0582934618, 0.2888201475, 1])
graph_mapper_2 = GraphMapper(
    range_3,
    x0=0,
    x1=1,
    y0=0,
    y1=1,
    container_name="Bezier",
    cpx=[0, 0.415862143, 0.940971911, 1],
    cpy=[0, 0.0582934618, 0.3582203984, 1])
graph_mapper_3 = GraphMapper(
    range_2,
    x0=0,
    x1=1,
    y0=0,
    y1=1,
    container_name="Bezier",
    cpx=[0, 0.415862143, 0.940971911, 1],
    cpy=[0, 0.0582934618, 0.3582203984, 1])
graph_mapper_4 = GraphMapper(
    range,
    x0=0,
    x1=1,
    y0=0,
    y1=1,
    container_name="Bezier",
    cpx=[0, 0.415862143, 0.940971911, 1],
    cpy=[0, 0.0582934618, 0.3582203984, 1])

entwine = Entwine(Branch00=graph_mapper, Branch01=graph_mapper_2, Branch02=graph_mapper_3, Branch03=graph_mapper_4, FlattenInputs=True)  # -> simplify(Result)
panel = Panel("modify points")
# half the beam width?
number_slider = Slider(0.04, range=0..0.1)
number_slider_2 = Slider(200, range=0..1000)
number_slider_3 = Slider(120, range=0..1000)
crv = Curve([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])
split = SplitList(List=crv, Index="3")  # -> ListA, ListB
crv_2 = Curve([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])
ctbeam = Python3Script(centerline=split.ListA, width=number_slider_3, height=number_slider_2, category="reciprocal")  # -> out, Beam, Blank; inputs centerline: list, width: list of Double, height: list of Double, category: list of String
# ---------- ctbeam: Python ----------
import Grasshopper
import Rhino

import rhinoscriptsyntax as rs
import System

from compas.scene import Scene
from compas_rhino.conversions import line_to_compas, vector_to_compas

from compas_timber.elements import Beam as CTBeam

class Beam_fromCurve(Grasshopper.Kernel.GH_ScriptInstance):
    def RunScript(self,
            centerline: list[object],
            width: list[float],
            height: list[float],
            category: list[str]):

        if not width:
            length = self._get_centerline_length(centerline)
            width = [length / 20]
        if not height:
            length = self._get_centerline_length(centerline)
            height = [length / 10]

        # reformat unset parameters for consistency
        if not category:
            category = [None]
        
        beams = []
        blanks = []
        scene = Scene()

        if centerline and height and width:
            N = len(centerline)
            if len(width) not in (1,N):
                print ("In 'W' I need either one or the same number of inputs as the Crv parameter.")
            if len(height) not in (1,N):
                print ("In 'H' I need either one or the same number of inputs as the Crv parameter.")
            if len(category) not in (0,1,N):
                print (" In 'Category' I need either none, one or the same number of inputs as the Crv parameter.")
            
            if len(width) != N:
                width = [width[0] for _ in range (N)]
            if len(height) != N:
                height = [height[0] for _ in range(N)]
            if len(category) != N:
                category = [category[0] for _ in range(N)]
            
            for line, w, h, c in zip (centerline, width, height, category):
                guid, geometry = self._get_guid_and_geometry(line)
                rhino_line = rs.coerceline(geometry)
                line = line_to_compas(rhino_line)

                beam = CTBeam.from_centerline(centerline=line, width = w, height = h)
                beam.attributes["category"] = c

                beams.append(beam)
                scene.add(beam.blank)
        
        blanks = scene.draw()

        return beams, blanks
                
    def _get_guid_and_geometry(self, line):
        # internalized curves and GH geometry will not have persistent GUIDs, referenced Rhino objects will
        # type hint on the input has to be 'ghdoc' for this to work
        guid = None
        geometry = line
        rhino_obj = Rhino.RhinoDoc.ActiveDoc.Objects.FindId(line)
        if rhino_obj:
            guid = line
            geometry = rhino_obj.Geometry
        return guid, geometry
    
    def _get_centerline_length(self, centerline):
        centerline_length = []
        for i in centerline:
            centerline_length.append(rs.CurveLength(i))
        if centerline_length:
            length_average = sum(centerline_length) / len(centerline_length)
        else:
            length_average = 1
        return length_average
# ---------- end ctbeam ----------
py3 = Python3Script(unload=Button())
# ---------- py3: Python ----------
from compas_rhino import unload_modules
import compas_timber

if unload:
    unload_modules("compas_timber")
# ---------- end py3 ----------
ctbeam_2 = Python3Script(centerline=split.ListB, width=number_slider_3, height=number_slider_2, category="reciprocal_b")  # -> out, Beam, Blank; inputs centerline: list, width: list of Double, height: list of Double, category: list of String; same code as ctbeam
ctbeam_3 = Python3Script(centerline=crv_2, width=Slider(80, range=0..1000), height=Slider(200, range=0..1000), category="birdsmouth")  # -> out, Beam, Blank; inputs centerline: list, width: list of Double, height: list of Double, category: list of String; same code as ctbeam
multiplication = Multiplication(A=number_slider, B=Slider(1, range=0..1000))
crvprox = CurveProximity(CurveA=crv_2, CurveB=split.ListB)  # -> PointA, PointB, Distance
sort = SortList(Keys=crvprox.Distance, ValuesA=crvprox.Distance)  # -> Keys, ValuesA
item = ListItem(List=reverse(sort.ValuesA), Index=0, Wrap=True)
int = Integer(item)
py3_2 = Python3Script(rest_beams=ctbeam.Beam, cross_beam=ctbeam_2.Beam, main_beams=ctbeam_3.Beam, max_distance=int)  # -> out, a, model; inputs rest_beams: list, main_beams: list, max_distance: Double
# ---------- py3_2: Python ----------
from compas_timber.analyzers import TripletAnalyzer

from compas_timber.connections import JointTopology
from compas_timber.connections import KBirdsmouthJoint
from compas_timber.connections import TMultiStepJoint

from compas_timber.model import TimberModel
from compas.tolerance import Tolerance
from compas.scene import Scene

scene = Scene()
model = TimberModel(unit = "MM", tolerance = Tolerance(unit="MM"))

elements = [cross_beam] + main_beams + rest_beams
for element in elements:
    element.remove_features()
model.add_elements(elements)

for m in model.elements():
    print (m.attributes)

# run first solver for creating pairs
model.connect_adjacent_beams(max_distance)

# #handle non-pair joints (in this case a 3-way connection using TripletAnalyzer)
analyzer = TripletAnalyzer(model, max_distance/2)
clusters = analyzer.find()

for cluster in clusters:
    # promote cluster that matches the topology
    if cluster.topology == JointTopology.TOPO_K:
        # make sure the cross_beam is always first in the new list
        reordered_elements = [e for e in cluster.elements if e.attributes["category"] == "reciprocal_b"]
        # then add the rest of them in a random order
        reordered_elements += [e for e in cluster.elements if e not in reordered_elements]
        kbj = KBirdsmouthJoint.promote_cluster(model, clusters[0], reordered_elements=reordered_elements, mill_depth=40)
2
#handle pair-wise joint connections
for candidate in model.joint_candidates:
    if candidate.is_promoted == False: # skip the joints that make up the clusters and have been already promoted
        if candidate.topology == JointTopology.TOPO_T:
            tmsj = TMultiStepJoint.promote_joint_candidate(model, candidate, step_depth=25)

model.process_joinery()

for beam in model.beams:
    scene.add(beam.geometry)
a = scene.draw()
# ---------- end py3_2 ----------
path = FilePath("/Users/minghip/Desktop/")
displayjointnames = Python3Script(model=py3_2.model)
# ---------- displayjointnames: Python ----------
import Grasshopper
import System

from compas_rhino.conversions import point_to_rhino

from compas_timber.utils import intersection_line_line_param

class ShowJointTypes(Grasshopper.Kernel.GH_ScriptInstance):
    def RunScript(self, model):
        self.pt = []
        self.txt = []

        for joint in model.joints:
            line_a, line_b = joint.elements[0].centerline, joint.elements[1].centerline
            [p1, _], [p2, _] = intersection_line_line_param(line_a, line_b, float("inf"), False, 1e-3)
            p1 = point_to_rhino(p1)
            p2 = point_to_rhino(p2)
            
            self.pt.append((p2 + p1)/2)
            self.txt.append(joint.__class__.__name__)
    
    def DrawViewportWires(self, arg):
        if ghenv.Component.Locked:
            return
        col = System.Drawing.Color.FromArgb(255, 0, 0, 0)
        # https://developer.rhino3d.com/api/RhinoCommon/html/M_Rhino_Display_DisplayPipeline_Draw2dText_5.htm
        for p, t in zip(self.pt, self.txt):
            arg.Display.Draw2dText(t, col, p, True, 25, "Verdana")
# ---------- end displayjointnames ----------
btlx = Python3Script(model=py3_2.model, file_path=path, write=Button())  # -> BTLx
# ---------- btlx: Python ----------
import os
import Grasshopper
import Rhino

from compas_timber.fabrication import BTLxWriter

class WriteBTLx(Grasshopper.Kernel.GH_ScriptInstance):
    def RunScript(self, model, file_path, write):

        output_path = os.path.join(file_path,f"timber_model.btlx")
        btlx = BTLxWriter(output_path)

        if write:
            XML = btlx.write(model, output_path)
        else:
            XML = btlx.model_to_xml(model)
        return XML
# ---------- end btlx ----------
md_slider = MDSlider(SliderMode=0, slider_value=Point(0.5, 0.5, 0.5), x_domain=Domain(0, 1), y_domain=Domain(0, 1), z_domain=Domain(0, 1))
panel_2 = Panel(btlx)
crv_3 = Curve([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])
crv_4 = Curve([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])
path_2 = FilePath("C:\Users\frido\OneDrive\Dokumente\ETH_MAS_Architecture_Digital_Fabrication\Visual_Studio_Code\GitHub_personal\MAS_26_copy\10_T2_Timber\10_05_BTLx\")
srf = Surface(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)
crv_5 = Curve([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])
crv_6 = Curve([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])
srf_2 = Surface(reparameterize(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))
number_slider_4 = Slider(0, range=0..3)
evalsrf = EvaluateSurface(Surface=srf_2, Point=md_slider)  # -> Point, Normal, UDirection, VDirection, Frame
path_3 = FilePath("/Users/minghip/Desktop/")
py3_3 = Python3Script(brep=srf, shoe=crv_5, leaf=crv_3, recipro=crv_4, low_sup=crv_6, path=path_2, b_plane=evalsrf.Frame)  # -> out, a, model, z_vectors, c, b, frames; inputs brep: list of Surface, shoe: list of Curve, leaf: list of Curve, recipro: list of Curve, low_sup: list of Curve, b_plane: Plane
# ---------- py3_3: Python ----------
from compas.scene import Scene
from compas.tolerance import Tolerance, TOL

from compas_timber.model import TimberModel
from compas_timber.elements import Beam

from compas_timber.connections import JointTopology, TMultiStepJoint, TStepJoint,LMiterJoint, TBirdsmouthJoint, XLapJoint

from compas_timber.fabrication import StepShapeType, JackRafterCut

from compas_rhino.conversions import curve_to_compas_line, surface_to_compas, plane_to_compas_frame, plane_to_compas

from compas.geometry import Frame, Plane, Vector, Point, angle_vectors, Line, intersection_segment_plane

from compas_timber.fabrication import BTLxWriter

""" check if planar function """
def is_planar(element_a, element_b):
    frames_a = []
    frames_b = []
    planarity_check = []
    frame_a = element_a.frame
    frame_a.xaxis = Vector(0,0,1)
    frames_a.append(frame_a)

    frame_b = element_b.frame
    frame_b.xaxis = Vector(0, 0, 1)

    planarity = angle_vectors(frame_a.normal, frame_b.normal, deg = True)
    planarity_check.append(planarity)

    is_planar = bool
    if planarity < 0.2 or planarity > 178.2:
        is_planar = True
    else:
        is_planar = False
    return(is_planar)

""" orient Lines, so start is on bottom"""
def orient_lines(centerline):
    if centerline.start.z > centerline.end.z:
        return Line(centerline.end, centerline.start)
    return centerline

""" get brep normalZz_vector """
z_vectors = []
for srf in brep:
    compas_srf = surface_to_compas(srf)          # returns a NurbsSurface or similar
    frame = compas_srf.frame_at(0.5, 0.5) 
    z_vector = frame.normal       # get frame at surface midpoint
    z_vectors.append(z_vector)

#initialise Scene object
scene = Scene()


#initialise compas timber model
model = TimberModel(Tolerance(unit="MM"), absolute = "100")

# beam list
beams = []

#shoes
shoes = [curve_to_compas_line(c) for c in shoe]

for l in shoes:
    beam = Beam.from_centerline(l, width = 120, height = 200, z_vector = z_vectors[0])
    beam.attributes["category"] = "shoe"
    beams.append(beam)
    model.add_element(beam)

leaves = [curve_to_compas_line(c) for c in leaf]
for l in leaves:
    beam = Beam.from_centerline(l, width = 120, height = 240)
    beam.attributes["category"] = "leaf"
    beams.append(beam)
    model.add_element(beam)

reciprocal = [curve_to_compas_line(c) for c in recipro]
for r in reciprocal:
    beam = Beam.from_centerline(r, width = 120, height = 200)
    beam.attributes["category"] = "reciprocal"
    beams.append(beam)
    model.add_element(beam)

birdmiter = [curve_to_compas_line(c) for c in low_sup]
for b in birdmiter:
    beam = Beam.from_centerline(b, width =80, height = 200)
    beam.attributes["category"] = "miterbirdsmouth"
    beams.append(beam)
    model.add_element(beam)

# print categories
for beam in model.beams:
    print(beam.attributes["category"])



model.connect_adjacent_beams(max_distance=100)
for candidate in model.joint_candidates:
    # dictionary = beam.attributes.get["category"]
    beam_a, beam_b = candidate.elements

        # sorting by Z for shoe-step-topology
    a_is_shoe = bool
    b_is_shoe = bool
    ceiling_height = 2640

    a_oriented = orient_lines(candidate.element_a.centerline) # set shoe-direction
    height_a = candidate.location.z
    # height_a = candidate.element_a.centerline.midpoint.z
    print("a", height_a)
    if height_a > ceiling_height:
        a_is_shoe = True
    else:
        a_is_shoe = False

    b_oriented = orient_lines(candidate.element_b.centerline)
    height_b = b_oriented.end.z
    print("b", height_b)
    if height_b > ceiling_height:
        b_is_shoe = True
    else:
        b_is_shoe = False

    if beam_a.attributes["category"] == "leaf" and beam_b.attributes["category"] == "shoe":
        heel_step = TStepJoint.create(model, beam_a, beam_b, step_shape="double", step_depth=40, heel_depth=60)
        # heel_step = TMultiStepJoint.create(model, beam_a, beam_b, step_shape = StepShapeType.HEEL, step_count = 2)
        # print("hello")
    elif candidate.topology == JointTopology.TOPO_X:
        lap_joint = XLapJoint.create(model, beam_a, beam_b)
    
    elif beam_a.attributes["category"] == "miterbirdsmouth" and beam_b.attributes["category"] == "reciprocal":
        birdsmouth = TBirdsmouthJoint.create(model, beam_a, beam_b)
    
    elif candidate.topology == JointTopology.TOPO_L:
        miter = LMiterJoint.create(model, candidate.element_a, candidate.element_b) #candidate.element_a as well as beam_a works!
    
    elif candidate.topology == JointTopology.TOPO_T and is_planar(candidate.element_a, candidate.element_b) == True:
        if a_is_shoe == True:
            heel = TMultiStepJoint.create(model, beam_a, beam_b, step_count = 2, step_shape = StepShapeType.HEEL)
        # elif b_is_shoe == True:
            # heelstep = heel = TMultiStepJoint.create(model, beam_a, beam_b, step_count = 2, step_shape = StepShapeType.HEEL)
        # if a_is_shoe == False:
        #     teeth = TMultiStepJoint.create(model, beam_a, beam_b, step_count = 5) #step_depth = 15
        #     print("hello")
        # elif b_is_shoe == False:
        #     teethstep = TMultiStepJoint.create(model, beam_a, beam_b, step_count = 5)
        else:
            multistep = TMultiStepJoint.create(model, beam_a, beam_b, step_count = 5)
    


#from_plane_and_beam(cls, plane, beam, ref_side_index=3, **kwargs):
frames = []
for b in beams:
    plane_cut = plane_to_compas(b_plane)
    frames.append(plane_cut)
    intersection = intersection_segment_plane(b.centerline, plane_cut, tol=None)
    if intersection is not None:
        jackrafter = JackRafterCut.from_plane_and_beam(plane_cut, b, ref_side_indes =3)
    # print(frame)
    # jackrafter = JackRafterCut.from_plane_and_beam(plane_cut, b, ref_side_indes =5)
        b.add_feature(jackrafter)


# drill_line = line_to_compas(drill_line)
# for i, beam in enumerate(model.beams):
#     if i == 0:
#         drill_feature = Drilling.from_line_and_element(drill_line, beam, diameter=10)
#         beam.add_features(drill_feature)
#         scene.add(beam.geometry)


model.process_joinery()

#visualise geometries
for beam in model.beams:
    scene.add(beam.geometry)

writer = BTLxWriter()
btlx = writer.write(model, file_path=path)

a = scene.draw()
# ---------- end py3_3 ----------
draw = COMPASDraw(cg=py3_3.frames)  # -> rg
#   port cg: The COMPAS geometry or datastructure to be drawn.
#   port rg: The Rhino geometry object.
# ---------- draw: Python ----------
# r: compas>=2.14.1
"""
Draws COMPAS geometry in Grasshopper.
"""

from typing import Any

import Grasshopper

from compas.scene import SceneObject


class CompasToRhinoGeometry(Grasshopper.Kernel.GH_ScriptInstance):
    def RunScript(self, cg):
        if not cg:
            return None

        return SceneObject(item=cg).draw()
# ---------- end draw ----------
draw_2 = COMPASDraw(cg=py3_3.z_vectors)  # -> rg; same code as draw
file_path = FilePath("/Users/minghip/Desktop/timber_model_0.json")
python_3_script = Python3Script(y=file_path)  # -> out, a; inputs y: String
# ---------- python_3_script: Python ----------
from compas.data import json_load
from compas_timber.model import TimberModel

timber_model = json_load(y)
timber_model.process_joinery()
# ---------- end python_3_script ----------

brep = Brep([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])

# ----
# create and manipulate graph
point = Point([Point(2.7, 7.810000534, 0), Point(0.3, 1.810000534, 0), Point(2.7, 1.810000534, 0), Point(0.3, 7.810000534, 0)])

point_2 = Point(point)

python_3_script_2 = Python3Script(roof_breps=brep, supports=point_2, z_steps=entwine)  # -> out, ridges_tree, all_edges, graph, all_nodes, node_keys; inputs roof_breps: list of Brep, supports: list of Point3d, z_steps: tree of Double
# ---------- python_3_script_2: Python ----------
import os
import sys
from compas_rhino import unload_modules
import compas
compas.PRECISION = ".3f"

gh_dir = os.path.dirname(ghenv.Component.OnPingDocument().FilePath)
sys.path.append(gh_dir)

import tree_builder
import nodegraph
import importlib

importlib.reload(nodegraph)
importlib.reload(tree_builder)


from tree_builder import build_tree_graph_from_breps
from Grasshopper import DataTree
from Grasshopper.Kernel.Data import GH_Path

# lines_tree will be our output
lines_tree = DataTree[object]()
z_tree = []
# 1. Iterate using the Branch count
for i in range(z_steps.BranchCount):
    branch = list(z_steps.Branch(i)) 
    z_tree.append(branch)

# CONSTANTS #
div_x = 3
div_y = 3
num_levels = 3

inset_edge = 0.5
inset_interior = 0.5

# Build the graph (all logic is in tree_builder.py)
ng = build_tree_graph_from_breps(
    supports=supports,
    input_breps=roof_breps,
    div_x=div_x if div_x else 8,
    div_y=div_y if div_y else 6,
    num_levels=num_levels if num_levels else 4,
    z_steps=z_tree,
    inset_edge=inset_edge if inset_edge else 0.5,
    inset_interior=inset_interior if inset_interior else 0.4,
    reach_tol=0.05,
    debug=True
)

# Outputs
all_edges = ng.edge_lines()
graph = ng
all_nodes = ng.node_points()
node_keys = list(ng.nodes())
# ---------- end python_3_script_2 ----------
compas_draw = COMPASDraw(cg=python_3_script_2.all_nodes)  # -> rg; same code as draw
compas_draw_2 = COMPASDraw(cg=python_3_script_2.all_edges)  # -> rg; same code as draw

# ----
# transform points
brep_2 = Brep(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)
python_3_script_3 = Python3Script(graph=python_3_script_2.graph, repellors=brep_2)  # -> out, edges, nodes, node_graph; inputs repellors: list of Brep
# ---------- python_3_script_3: Python ----------
import os, sys, importlib
gh_dir = os.path.dirname(ghenv.Component.OnPingDocument().FilePath)
if gh_dir not in sys.path:
    sys.path.insert(0, gh_dir)

### -----------------------------
## IMPORT
### -----------------------------
import nodegraph

importlib.reload(nodegraph)

from copy import deepcopy
from compas.geometry import Vector, Line, Point, centroid_points

ng = deepcopy(graph)



ng, results = ng.move_nodes_from_geometry(
    repellors,               # Mix of anything
    max_distance = 2.0,
    strength = 2,
    falloff = "smooth"
)

# Outputs
node_graph = ng
edges = ng.edge_lines()
nodes = ng.node_points()
moved_pts = [r['new'] for r in results.values()]
# ---------- end python_3_script_3 ----------

# ----
# Classfiy Edges
# op1 rotate
# op2 choose 1 to be primary and shift others
# op3 use design, cut diagonal
python_3_script_4 = Python3Script(graph=python_3_script_3.node_graph)  # -> out, primary_lines, secondary_lines, tertiary_lines, nodes_pts, nodes_idx, chosen_edge_lines, graph_out
# ---------- python_3_script_4: Python ----------
import os, sys, importlib

gh_dir = os.path.dirname(ghenv.Component.OnPingDocument().FilePath)
if gh_dir not in sys.path:
    sys.path.insert(0, gh_dir)

import edge_classifier
importlib.reload(edge_classifier)
from edge_classifier import classify_edges_by_support_direction, create_subgraphs
from compas.geometry import Line

primary_lines, secondary_lines, tertiary_lines, classification_data  = classify_edges_by_support_direction(
    graph,
    return_tertiary=True
)


# output 
graph_out = graph
# ---------- end python_3_script_4 ----------
draw_3 = COMPASDraw(cg=python_3_script_4.primary_lines)  # -> rg; same code as draw
draw_4 = COMPASDraw(cg=python_3_script_4.secondary_lines)  # -> rg; same code as draw
draw_5 = COMPASDraw(cg=python_3_script_4.tertiary_lines)  # -> rg; same code as draw
draw_6 = COMPASDraw(cg=python_3_script_4.nodes_pts)  # -> rg; same code as draw
draw_7 = COMPASDraw(cg=python_3_script_4.chosen_edge_lines)  # -> rg; same code as draw
custom_preview_lineweights = CustomPreviewLineweights(Geometry=draw_3, Shader=ColourSwatch(SwatchColor=RGB(137, 50, 143)), Thickness="8", Absolute=False)
custom_preview_lineweights_2 = CustomPreviewLineweights(Geometry=draw_4, Shader=ColourSwatch(SwatchColor=RGB(50, 143, 103)), Thickness="6", Absolute=False)
custom_preview_lineweights_3 = CustomPreviewLineweights(Geometry=draw_5, Shader=ColourSwatch(SwatchColor=RGB(218, 157, 103)), Thickness="6", Absolute=False)

swatch = ColourSwatch(SwatchColor=RGB(51, 56, 66))
text_tag = TextTag(Location=draw_6, Text=python_3_script_4.nodes_idx, Colour=swatch)
dot_display = DotDisplay(Point=draw_6, Colour=swatch, Size=Slider(0.1, range=0..0.1))

# ----
# preview graph
number_slider_5 = Slider(0.1, range=-0.5..0.5)
compas_draw_3 = COMPASDraw(cg=python_3_script_3.edges)  # -> rg; same code as draw
compas_draw_4 = COMPASDraw(cg=python_3_script_3.nodes)  # -> rg; same code as draw
dot_display_2 = DotDisplay(Point=compas_draw_4, Colour=ColourSwatch(SwatchColor=RGB(128, 128, 128)), Size=number_slider_5)

custom_preview_lineweights_4 = CustomPreviewLineweights(
    Geometry=compas_draw_3,
    Shader=ColourSwatch(SwatchColor=RGB(144, 209, 232)),
    Thickness=Slider(4, range=0..10),
    Absolute=False)

offset_surface = OffsetSurface(Surface=brep, Distance=Slider(0.06, range=0..0.1), BothSides=0, CreateSolid=True)
ct_beam = CTBeam(centerline=compas_draw_3, width=Slider(0.1, range=0..0.1), height=Slider(0.12, range=0..1))  # -> Beam, Blank; inputs centerline: list, z_vector: list of Vector3d, width: list of Double, height: list of Double, category: list of String, updateRefObj: Boolean
#   port centerline: Referenced curve or line, Guid of curve or line in the active Rhino document.
#   port z_vector: Vector defining the orientation of the cross-section (corresponds to the height dimension). If None, a default will be taken.
#   port width: Width of the cross-section (usually the smaller dimension).
#   port height: Height of the cross-section (usually the larger dimension).
#   port category: Category of a beam.
#   port updateRefObj: (optional) If True, the attributes in the referenced object will be updated/overwritten with the new values given here.
#   port Beam: Beam object(s).
#   port Blank: Shape of the beam's blank.
# ---------- ct_beam: Python ----------
# r: compas_timber==1.0.5
"""Creates a Beam from a LineCurve."""

# flake8: noqa
import Grasshopper
import Rhino
import rhinoscriptsyntax as rs
import System
from compas.scene import Scene
from compas_rhino.conversions import line_to_compas
from compas_rhino.conversions import vector_to_compas

from compas_timber.elements import Beam as CTBeam
from compas_timber.ghpython.rhino_object_name_attributes import update_rhobj_attributes_name
from compas_timber.ghpython.ghcomponent_helpers import list_input_valid_cpython


class Beam_fromCurve(Grasshopper.Kernel.GH_ScriptInstance):
    def RunScript(self,
            centerline: System.Collections.Generic.List[object],
            z_vector: System.Collections.Generic.List[Rhino.Geometry.Vector3d],
            width: System.Collections.Generic.List[float],
            height: System.Collections.Generic.List[float],
            category: System.Collections.Generic.List[str],
            updateRefObj: bool):
        # minimum inputs required
        if not list_input_valid_cpython(ghenv, centerline, "Centerline"):
            return
        if not width:
            length = self._get_centerline_length(centerline)
            width = [length / 20]
        if not height:
            length = self._get_centerline_length(centerline)
            height = [length / 10]

        # reformat unset parameters for consistency
        if not z_vector:
            z_vector = [None]
        if not category:
            category = [None]

        beams = []
        blanks = []
        scene = Scene()

        if centerline and height and width:
            # check list lengths for consistency
            N = len(centerline)
            if len(z_vector) not in (0, 1, N):
                ghenv.Component.AddRuntimeMessage(
                    Grasshopper.Kernel.GH_RuntimeMessageLevel.Error, " In 'ZVector' I need either none, one or the same number of inputs as the Crv parameter."
                )
            if len(width) not in (1, N):
                ghenv.Component.AddRuntimeMessage(Grasshopper.Kernel.GH_RuntimeMessageLevel.Error, " In 'W' I need either one or the same number of inputs as the Crv parameter.")
            if len(height) not in (1, N):
                ghenv.Component.AddRuntimeMessage(Grasshopper.Kernel.GH_RuntimeMessageLevel.Error, " In 'H' I need either one or the same number of inputs as the Crv parameter.")
            if len(category) not in (0, 1, N):
                ghenv.Component.AddRuntimeMessage(
                    Grasshopper.Kernel.GH_RuntimeMessageLevel.Error, " In 'Category' I need either none, one or the same number of inputs as the Crv parameter."
                )

            # duplicate data if None or single value
            if len(z_vector) != N:
                z_vector = [z_vector[0] for _ in range(N)]
            if len(width) != N:
                width = [width[0] for _ in range(N)]
            if len(height) != N:
                height = [height[0] for _ in range(N)]
            if len(category) != N:
                category = [category[0] for _ in range(N)]

            for line, z, w, h, c in zip(centerline, z_vector, width, height, category):
                guid, geometry = self._get_guid_and_geometry(line)
                rhino_line = rs.coerceline(geometry)
                line = line_to_compas(rhino_line)

                z = vector_to_compas(z) if z else None
                beam = CTBeam.from_centerline(centerline=line, width=w, height=h, z_vector=z)
                beam.attributes["rhino_guid"] = str(guid) if guid else None
                beam.attributes["category"] = c
                if updateRefObj and guid:
                    update_rhobj_attributes_name(guid, "width", str(w))
                    update_rhobj_attributes_name(guid, "height", str(h))
                    update_rhobj_attributes_name(guid, "zvector", str(list(beam.frame.zaxis)))
                    update_rhobj_attributes_name(guid, "category", c)

                beams.append(beam)
                scene.add(beam.blank)

        blanks = scene.draw()

        return beams, blanks

    def _get_guid_and_geometry(self, line):
        # internalized curves and GH geometry will not have persistent GUIDs, referenced Rhino objects will
        # type hint on the input has to be 'ghdoc' for this to work
        guid = None
        geometry = line
        rhino_obj = Rhino.RhinoDoc.ActiveDoc.Objects.FindId(line)
        if rhino_obj:
            guid = line
            geometry = rhino_obj.Geometry
        return guid, geometry

    def _get_centerline_length(self, centerline):
        centerline_length = []
        for i in centerline:
            centerline_length.append(rs.CurveLength(i))
        if centerline_length:
            length_average = sum(centerline_length) / len(centerline_length)
        else:
            length_average = 1
        return length_average
# ---------- end ct_beam ----------
volume = Volume(Geometry=ct_beam.Blank)  # -> Volume, Centroid
relay = Relay([ct_beam.Blank, offset_surface])
mass_addition = MassAddition(Input=volume.Volume)  # -> Result, PartialResults
custom_preview = CustomPreview(Geometry=relay, Material=ColourSwatch(SwatchColor=RGB(219, 206, 167)))
panel_3 = Panel(mass_addition.Result)

py3_4 = Python3Script(ng=python_3_script_4.graph_out, z_shift=number_slider)  # -> out, a, b, c, d, e, f, graph_out, edges, shifted; inputs z_shift: Double
# ---------- py3_4: Python ----------
import os, sys, importlib
from copy import deepcopy

gh_dir = os.path.dirname(ghenv.Component.OnPingDocument().FilePath)
if gh_dir not in sys.path:
    sys.path.insert(0, gh_dir)

import edge_classifier
import reciprocal
import line_constraints

importlib.reload(edge_classifier)
importlib.reload(reciprocal)
importlib.reload(line_constraints)

graph = deepcopy(ng)

# -----------------------------
# controls
# -----------------------------
sign_primary = +1
sign_secondary = +1
engage_len = 0.11
tol = 0.1
iters = 5


# -----------------------------
# 1) reciprocal primary
# -----------------------------
res_primary = reciprocal.reciprocal_width_from_subgraph(
    graph,
    target_hierarchy="primary",
    engage_len=engage_len,
    tol=tol,
    rotation_sign=sign_primary,
    min_degree=3,
    iterations=iters,
    max_angle=180.0
)
g = res_primary["graph"]

# -----------------------------
# 2) regenerate secondary (level 1 up)
# -----------------------------
line_constraints.snap_to_host(
    g,
    target_hierarchy="secondary",
    move_node_level = 1,
    host_hierarchy="primary",
    z_offset = z_shift,
    write_attribute=True,
    debug=False
)


# -----------------------------
# 3) reciprocal secondary
# -----------------------------
res_secondary = reciprocal.reciprocal_width_from_subgraph(
    g,
    target_hierarchy="secondary",
    engage_len=engage_len,
    tol=tol,
    rotation_sign=sign_secondary,
    min_degree=30,
    iterations=iters,
    max_angle=180.0
)
g = res_secondary["graph"]

# -----------------------------
# 5) regenerate tertiary (level 0 up)
# -----------------------------
line_constraints.snap_to_host(
    g,
    target_hierarchy="tertiary",
    move_node_level=0,
    host_hierarchy="secondary" ,
    z_offset = z_shift,
    write_attribute=True,
    debug=False
)

line_constraints.snap_to_host(
    g,
    target_hierarchy="tertiary",
    move_node_level=0,
    host_hierarchy="primary",
    z_offset = z_shift,
    write_attribute=True,
    debug=False
)

shifted = []
for e in g.edges():
    shifted.append(g.edge_attribute(e, "shifted_line"))

graph_out = g
# ---------- end py3_4 ----------
draw_8 = COMPASDraw(cg=py3_4.a)  # -> rg; same code as draw
draw_9 = COMPASDraw(cg=py3_4.b)  # -> rg; same code as draw
draw_10 = COMPASDraw(cg=py3_4.d)  # -> rg; same code as draw
draw_11 = COMPASDraw(cg=py3_4.shifted)  # -> rg; same code as draw
draw_12 = COMPASDraw(cg=py3_4.c)  # -> rg; same code as draw
draw_13 = COMPASDraw(cg=py3_4.edges)  # -> rg; same code as draw

# ----
# shifting and add shoes
python_3_script_5 = Python3Script(graph=python_3_script_4.graph_out)  # -> out, graph_out, shoe_lines
# ---------- python_3_script_5: Python ----------
import os, sys, importlib
gh_dir = os.path.dirname(ghenv.Component.OnPingDocument().FilePath)
if gh_dir not in sys.path:
    sys.path.insert(0, gh_dir)


import leaf_solver
importlib.reload(leaf_solver)
from leaf_solver import create_shoes_from_graph
from copy import deepcopy



ng = deepcopy(graph)
result = create_shoes_from_graph(ng, extension_length = 0.20)

shoe_lines = result["shoe_lines"]
graph_out = ng
# ---------- end python_3_script_5 ----------
draw_14 = COMPASDraw(cg=python_3_script_5.shoe_lines)  # -> rg; same code as draw

# ----
# Foundation
python_3_script_6 = Python3Script(graph=py3_4.graph_out)  # -> out, graph_out, crosecs, cut_planes, sup_lines
# ---------- python_3_script_6: Python ----------
import os, sys, importlib
gh_dir = os.path.dirname(ghenv.Component.OnPingDocument().FilePath)
if gh_dir not in sys.path:
    sys.path.insert(0, gh_dir)


import foundation_solver
importlib.reload(foundation_solver)
from foundation_solver import trim_anchored_beams_and_find_cut_planes
from copy import deepcopy

from compas.geometry import Polygon

############--------Main Code----------#########
ng = deepcopy(graph)
result = trim_anchored_beams_and_find_cut_planes(ng, min_gap=0.01, min_height=0.0)

########--------Output Data---------#########
cro_sec_dict = result["cross_sections"]
crosecs = []
for node, cro_sec_list in cro_sec_dict.items():
    for crosec in cro_sec_list:
        poly = Polygon(crosec)
        crosecs.append(poly)

cut_pln_dict = result["cut_planes"]
cut_planes = []
for node, pln in cut_pln_dict.items():
    cut_planes.append(pln)


sup_lines = []
for edge in graph.get_support_edges():
    if "shifted_line" in graph.edge_attributes(edge):
        ln = graph.edge_attribute(edge, "shifted_line")
    else:
        ln = graph.edge_line(edge)
    sup_lines.append(ln)

#############-----------Print----------##########
# print (result["cross_sections"])
# print ()
# print (result["cut_planes"])
print (result["foundation_heights"])
# ---------- end python_3_script_6 ----------
draw_15 = COMPASDraw(cg=python_3_script_6.cut_planes)  # -> rg; same code as draw
draw_16 = COMPASDraw(cg=python_3_script_6.sup_lines)  # -> rg; same code as draw
draw_17 = COMPASDraw(cg=python_3_script_6.crosecs)  # -> rg; same code as draw

# ----
# lines for compas_timber from graph
py3_5 = Python3Script(graph=py3_4.graph_out)  # -> out, a, b, c, models
# ---------- py3_5: Python ----------
from compas.geometry import Line, Point
from copy import deepcopy

ng = deepcopy(graph)

primary_shifted = []
secondary_shifted = []
tertiary_shifted = []

for e in ng.edges():
    group = ng.edge_attribute(e, "group")
    print(group)
    h = ng.edge_attribute(e, "hierarchy")      # classification
    l = ng.edge_attribute(e, "level")
    # print (l)
    ln = ng.edge_attribute(e, "shifted_line")  # shifted geometry
    if ln is None:
        continue

    if h == "primary" and l != 0:
        print (l)
        primary_shifted.append(ln)
    elif h == "secondary":
        secondary_shifted.append(ln)
    elif h == "tertiary":
        tertiary_shifted.append(ln)

a = primary_shifted
b = secondary_shifted
c = tertiary_shifted
# ---------- end py3_5 ----------
draw_18 = COMPASDraw(cg=py3_5.b)  # -> rg; same code as draw
draw_19 = COMPASDraw(cg=py3_5.a)  # -> rg; same code as draw
draw_20 = COMPASDraw(cg=py3_5.c)  # -> rg; same code as draw

deconstruct_brep = DeconstructBrep(Brep=brep)  # -> Faces, Edges, Vertices
join_curves = JoinCurves(Curves=deconstruct_brep.Edges, Preserve=False)  # -> flatten(Curves)
curve = Curve(join_curves)
offset = OffsetCurve(Curve=curve, Distance=Slider(0, range=0..1), Corners=1)
unit_z = UnitZ(Factor="0.05")

# ---- group: boxes
python_3_script_7 = Python3Script(x=flatten(curve), y=flatten(offset))  # -> out, boxes, x_sorted, y_sorted, c_pts; inputs x: list of Curve, y: list of Curve
# ---------- python_3_script_7: Python ----------
from compas.geometry import bounding_box, Box
from compas_rhino.conversions import curve_to_compas_polyline

def curve_xy_key(curve):
    c = curve_to_compas_polyline(curve)
    pts = c.points
    bb = bounding_box(pts)

    # center of bounding box
    cx = (bb[0][0] + bb[6][0]) * 0.5
    cy = (bb[0][1] + bb[6][1]) * 0.5

    # return (cx, cy)
    return (round(cy, 3), cx)

# sort first
x_sorted = sorted(x, key=curve_xy_key)
y_sorted = sorted(y, key=curve_xy_key)

boxes = []
for curve in y_sorted:
    c = curve_to_compas_polyline(curve)
    points = c.points
    a = Box.from_bounding_box(bounding_box(points))
    a.zsize = 20.0
    boxes.append(a)

c_pts = [b.frame.point for b in boxes]
print(boxes)
# ---------- end python_3_script_7 ----------

# ----
move = Move(Geometry=python_3_script_7.x_sorted, Motion=unit_z)  # -> Geometry, Transform
draw_21 = COMPASDraw(cg=python_3_script_7.c_pts)  # -> rg; same code as draw
point_list = PointList(Points=draw_21, Size=Slider(1, range=0..10))

timber_model = Python3Script(
    shoes=draw_14,
    line_graph=py3_4.graph_out,
    boxes=python_3_script_7.boxes,
    clt_plates=move.Geometry,
    max_distance=multiplication,
    footing_plane=python_3_script_6.cut_planes)  # -> out, a, b, c, d, e, processed_models, base_model; inputs shoes: list of Line, boxes: list, clt_plates: list of Polyline, max_distance: Double
# ---------- timber_model: Python ----------
from compas.scene import Scene
from compas_rhino.conversions import line_to_compas, polyline_to_compas, plane_to_compas
from compas.tolerance import Tolerance, TOL

from compas_timber.model import TimberModel
from compas_timber.elements import Beam, Plate
from compas_timber.analyzers import TripletAnalyzer

from compas_timber.connections import JointTopology
from compas_timber.connections import TMultiStepJoint
from compas_timber.connections import TStepJoint
from compas_timber.connections import LMiterJoint
from compas_timber.connections import TBirdsmouthJoint
from compas_timber.connections import XLapJoint
from compas_timber.connections import KBirdsmouthJoint

from compas_timber.fabrication import JackRafterCut

from compas.geometry import Frame, Vector, Point, angle_vectors, centroid_points, Line, intersection_segment_plane

#initialise scene object
scene = Scene()

# #initialise base compas timber model
# base_model = TimberModel(Tolerance(unit="MM", absolute="0.001"))

# ============================================================
# Helper: make polygon point order consistent with world Z+
# ============================================================
def oriented_polyline_to_world_z_plus(compas_poly):
    pts = list(compas_poly.points)

    if len(pts) < 3:
        return compas_poly, Vector(0, 0, 1)

    # remove duplicate last point if closed
    if pts[0] == pts[-1]:
        pts = pts[:-1]

    if len(pts) < 3:
        return compas_poly, Vector(0, 0, 1)

    p0 = pts[0]
    p1 = pts[1]
    p2 = pts[2]

    frame = Frame.from_points(p0, p1, p2)
    local_z = frame.zaxis
    world_z = Vector(0, 0, 1)

    # if normal points downward, reverse point order
    if local_z.dot(world_z) < 0:
        pts.reverse()

        # close it again if original was closed
        pts.append(pts[0])

        compas_poly = type(compas_poly)(pts)

        p0 = compas_poly.points[0]
        p1 = compas_poly.points[1]
        p2 = compas_poly.points[2]

        frame = Frame.from_points(p0, p1, p2)
        local_z = frame.zaxis

    return compas_poly, local_z

# ============================================================
# Create CLT Plates
# ============================================================

plates = []
models = []

# for c in clt_plates:
#     compas_poly = polyline_to_compas(c)
#     if compas_poly is None:
#         continue
#     center = centroid_points(compas_poly.points)    
#     for b in boxes:
#         model = TimberModel(Tolerance(unit="MM", absolute="0.001"))
#         if b.contains_point(center):
#             compas_poly, local_z = oriented_polyline_to_world_z_plus(compas_poly)

#             plate = Plate.from_outline_thickness(
#                 compas_poly,
#                 thickness=0.1,
#                 vector=local_z
#             )

#             plates.append(plate)
#             model.add_element(plate)
#             base_model.add_element(plate)
#             models.append(model)

# ============================================================
# Input Beams
# ============================================================

beams = []
cutting_frames = []
for plane in footing_plane:
    cutting_frames.append(plane)

#convert rhino curves into compas lines
"""to be replaced with graph input"""

from copy import deepcopy

ng = deepcopy(line_graph)

for edge in ng.edges():
    h = ng.edge_attribute(edge,"hierarchy") #primary, secondary, tertiary
    l = ng.edge_attribute(edge,"level") #0,1,2... top to bottom 
    g = ng.edge_attribute(edge, "group") #quadrant 0,1,2,3 clockwise

    """set width and height based on attributes"""

    if h == "primary" and l != 0:
        ln_width = 0.100
        ln_height = 0.160
    elif h == "primary" or h == "secondary":
        ln_width = 0.100
        ln_height = 0.120
    elif h == "tertiary":
        ln_width = 0.100
        ln_height = 0.120

    ln = ng.edge_attribute(edge, "shifted_line")
    
    if ln is None:
        continue
    
    # for b, m in zip (boxes, models):
    #     if b.contains_point(ln.start) or b.contains_point(ln.end):
    #         ln.name = h
    #         beam = Beam.from_centerline(ln,width=ln_width, height=ln_height)
    #         beam.name = ln.name
    #         beams.append(beam)
    #         m.add_element(beam)
    #         base_model.add_element(beam)
    #         break



#temporary add shoe
for shoe in shoes:
    shoe_line = line_to_compas(shoe)
    for b, m in zip (boxes, models):
        if b.contains_point(shoe_line.start) or b.contains_point(shoe_line.end):
            beam = Beam.from_centerline(shoe_line, width=0.1, height=0.1)
            beam.name = "shoe"
            beams.append(beam)
            m.add_element(beam)
            base_model.add_element(beam)

# ============================================================
# Process Jointery
# ============================================================

#planarity check
def is_planar(element_a, element_b):
    frames_a = []
    frames_b = []
    planarity_check = []
    frame_a = element_a.frame
    frame_a.xaxis = Vector(0,0,1)
    frames_a.append(frame_a)

    frame_b = element_b.frame
    frame_b.xaxis = Vector(0, 0, 1)

    planarity = angle_vectors(frame_a.normal, frame_b.normal, deg = True)
    planarity_check.append(planarity)

    is_planar = bool
    if planarity < 0.2 or planarity > 178.2:
        is_planar = True
    else:
        is_planar = False
    return(is_planar)

distances = []

#reset beams and features
for model in models:
    for beam in model.beams:
        beam.remove_features()

    #compute line network
    base_model.connect_adjacent_beams(max_distance)
    model.connect_adjacent_beams(max_distance)

    for c in model.joint_candidates:
        distances.append(c.distance)

    # #handle non-pair joints (in this case a 3-way connection using TripletAnalyzer)
    # analyzer = TripletAnalyzer(model, max(distances)/2)
    # clusters = analyzer.find()

    # for cluster in clusters:
    #     if cluster.topology == JointTopology.TOPO_K:
    #         reordered_elements = [e for e in cluster.elements if h == "primary"]
    #         print (len(reordered_elements))
    #         reordered_elements += [e for e in cluster.elements if e not in reordered_elements]
    #         kbj = KBirdsmouthJoint.promote_cluster(model, cluster[0], reordered_elements=reordered_elements, mill_depth=.040)

    #debugging tools
    candidates_a = []
    candidates_b = []
    frames_a = []
    frames_b = []
    planarity_check = []

    #set joint conditions
    for candidate in model.joint_candidates:
        if candidate.is_promoted == False:
            #check for mid_point = above certain z_height
            a_is_shoe = bool
            b_is_shoe = bool
            ceiling_height = 3.9

            height_a = candidate.element_a.centerline.midpoint.z
            if height_a > ceiling_height:
                a_is_shoe = True
            else:
                a_is_shoe = False
                
            height_b = candidate.element_b.centerline.midpoint.z
            if height_b > ceiling_height:
                b_is_shoe = True
            else:
                b_is_shoe = False

            #joints based on topology, planarity and z height
            if candidate.topology == JointTopology.TOPO_T and is_planar(candidate.element_a, candidate.element_b) == True:
                if b_is_shoe == True:
                    t_step_joint = TMultiStepJoint.create(model, candidate.element_a, candidate.element_b, step_count=2)
                
                else:
                    if angle_vectors(candidate.element_a.centerline.direction, candidate.element_b.centerline.direction, deg=True) < 50:
                        step_shape = "heel"
                    else:
                        step_shape = "step"
                    
                    print (candidate.element_a.centerline.name)
                    t_step_joint = TMultiStepJoint.create(model, candidate.element_a, candidate.element_b, step_shape=step_shape, step_depth=.02, riser_angle=90)
            
            elif candidate.topology == JointTopology.TOPO_T and is_planar(candidate.element_a, candidate.element_b) == False:
                t_bm_joint = TBirdsmouthJoint.create(model, candidate.element_a, candidate.element_b)
                # t_np_step_joint = TMultiStepJoint.create(model, candidate.element_a, candidate.element_b, do_refine_cut=True, step_depth = 0.02, riser_angle=90)
            elif candidate.topology==JointTopology.TOPO_L:
                mp = Frame.worldYZ
                # miter_plane = ??
                l_miter_joint = LMiterJoint.create(model, candidate.element_a, candidate.element_b, cutoff = False)

            elif candidate.topology == JointTopology.TOPO_X:
                x_lap_joint = XLapJoint.create(model, candidate.element_a, candidate.element_b)

            else:
                continue
    
    # #add features to beams
    # for beam in model.beams:
    #     if beam.name == "primary":
    #         for plane in cutting_frames:
    #             intersection = intersection_segment_plane(b.centerline, plane, tol=None)
    #             if intersection is not None:
    #                 jackrafter = JackRafterCut.from_plane_and_beam(plane, b, ref_side_indes =3)
    #         # jackrafter = JackRafterCut.from_plane_and_beam(plane_cut, b, ref_side_indes =5)
    #             b.add_feature(jackrafter)


    # drill_line = line_to_compas(drill_line)
    # for i, beam in enumerate(model.beams):
    #     if i == 0:
    #         drill_feature = Drilling.from_line_and_element(drill_line, beam, diameter=10)
    #         beam.add_features(drill_feature)
    #         scene.add(beam.geometry)

    #process joints in compas timber model
    model.process_joinery()

processed_models = []

for m in models:
    processed_models.append(m)

    #visualise geometries
    for beam in (m.beams):
        scene.add(beam.geometry)
    
    for plate in (m.plates):
        scene.add(plate.geometry)
    print ("ADDED")

a = scene.draw()
# ---------- end timber_model ----------
panel_4 = Panel(timber_model.base_model)
panel_5 = Panel(timber_model.processed_models)
compas_draw_5 = COMPASDraw(cg=timber_model.b)  # -> rg; same code as draw
compas_draw_6 = COMPASDraw(cg=timber_model.d)  # -> rg; same code as draw
compas_draw_7 = COMPASDraw(cg=timber_model.c)  # -> rg; same code as draw
compas_draw_8 = COMPASDraw(cg=timber_model.e)  # -> rg; same code as draw
list_item = ListItem(List=timber_model.processed_models, Index=0, Wrap=True)
geometry = Geometry(timber_model.a)
displayjointnames_2 = Python3Script(model=list_item)  # same code as displayjointnames
item_2 = ListItem(List=timber_model.processed_models, Index="0", Wrap=True)
panel_6 = Panel(item_2)

# ---- group: json_dump of n modules
py3_6 = Python3Script(x=item_2, save=Button(), file_path=path_3)  # -> out, a; inputs x: list
# ---------- py3_6: Python ----------
import os
from compas.data import json_dump

if save:
    for i, m in enumerate(x):
        """Serialize models to .JSON"""
        output_path = os.path.join(file_path, f"timber_model_{i}.json")
        m.to_json(output_path, pretty=True)
        print(f"Model written to {output_path}")
# ---------- end py3_6 ----------

# ---- group: visualize modules based on index
py3_7 = Python3Script(x=item_2, y=number_slider_4)  # -> out, a; inputs x: list, y: Int32
# ---------- py3_7: Python ----------
from compas.scene import Scene
from compas_rhino.conversions import line_to_compas
from compas.tolerance import Tolerance, TOL

from compas_timber.model import TimberModel
from compas_timber.elements import Beam, Plate

from compas_timber.connections import JointTopology
from compas_timber.connections import TMultiStepJoint
from compas_timber.connections import TStepJoint
from compas_timber.connections import LMiterJoint
from compas_timber.connections import TBirdsmouthJoint
from compas_timber.connections import XLapJoint

from compas_rhino.conversions import line_to_compas, polyline_to_compas

from compas.geometry import Frame, Vector, Point, angle_vectors, centroid_points

from statistics import mean


scene = Scene()
# for m in x:
# model = x[y]
for beam in (x[y].beams):
    if not beam.attributes["neighbour"]:
        scene.add(beam.geometry)

for plate in (x[y].plates):
    scene.add(plate.geometry)
a = scene.draw()
# ---------- end py3_7 ----------

# ---- group: visualize neighbour beams based on module index
py3_8 = Python3Script(x=item_2, y=number_slider_4)  # -> out, a; inputs x: list, y: Int32
# ---------- py3_8: Python ----------
from compas.scene import Scene
from compas_rhino.conversions import line_to_compas
from compas.tolerance import Tolerance, TOL

from compas_timber.model import TimberModel
from compas_timber.elements import Beam, Plate

from compas_timber.connections import JointTopology
from compas_timber.connections import TMultiStepJoint
from compas_timber.connections import TStepJoint
from compas_timber.connections import LMiterJoint
from compas_timber.connections import TBirdsmouthJoint
from compas_timber.connections import XLapJoint

from compas_rhino.conversions import line_to_compas, polyline_to_compas

from compas.geometry import Frame, Vector, Point, angle_vectors, centroid_points

from statistics import mean


scene = Scene()
# for m in x:
# model = x[y]
for beam in (x[y].beams):
    if beam.attributes["neighbour"]:
        scene.add(beam.geometry)
a = scene.draw()
# ---------- end py3_8 ----------
