# Grasshopper definition line_model_v3_nadya.gh (Grasshopper 1.0.8)
# plug-ins: Human

py3 = Python3Script(x=Button())  # -> out, a
# ---------- py3: Python ----------
from compas_rhino import unload_modules

if x:
    unload_modules(("compas_timber", "timber_design", "compas_model"))
# ---------- end py3 ----------

range = Range(Domain=Domain(0, 1), Steps=Slider(4, range=0..10))
graph = GraphMapper(
    range,
    x0=0,
    x1=1,
    y0=0,
    y1=1,
    container_name="Bezier",
    cpx=[0, 0.2812580168, 0.9951813221, 1],
    cpy=[0, 0, 0.1881061196, 1])

curve = Curve(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)
brep = Brep(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)
point = Point([Point(163.5542514, 48.10027414, 15.94000248), Point(163.5542514, 57.72031214, 15.94000382), Point(173.1742514, 57.7202747, 19.94), Point(173.1742514, 48.1002747, 19.94)])

py3_2 = Python3Script(l=Slider(5, range=0..10), coeff_h=Slider(0.43, range=0..1))  # -> out, D_heigts; inputs l: Int32, coeff_h: Double
# ---------- py3_2: Python ----------
import Rhino.Geometry as rg
import math
from ghpythonlib.treehelpers import list_to_tree, tree_to_list


def expo_num(coeff):
    max_heigth = 1
    h_coeficient = []
    for n in range(l):
        y = coeff ** (n*(-1)) # number 2 can be change so the exponential changes
        h_coeficient.append(abs(y - 1))
    heigts = []
    print(h_coeficient)
    for n in h_coeficient:
        param = n/h_coeficient[-1]
        r = max_heigth * param
        h = r - max_heigth
        # heigts.append(round(r, 1))
        heigts.append(r)
    D = heigts
    return D

D_heigts = expo_num(coeff_h)
# ---------- end py3_2 ----------
panel = Panel(py3_2.D_heigts)
panel_2 = Panel(graph)
crv = Curve(<curve referenced from the Rhino model>)

curve_2 = Curve(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)
brep_2 = Brep(<brep referenced from the Rhino model>)
point_2 = Point([Point(163.54, 57.72, 15.455), Point(163.54, 48.1, 15.455), Point(173.16, 48.1, 19.455), Point(173.16, 57.72, 19.455)])

# ----
# create and manipulate graph
python_3_script = Python3Script(boundary=curve_2, roof_brep=brep_2, supports=point_2, z_steps=py3_2.D_heigts)  # -> out, ridges_tree, all_edges, graph, all_nodes, node_keys; inputs boundary: Curve, roof_brep: Brep, supports: list of Point3d, z_steps: list of Double
# ---------- python_3_script: Python ----------
import os
import sys
from compas_rhino import unload_modules
import compas
compas.PRECISION = ".3f"

gh_dir = os.path.dirname(ghenv.Component.OnPingDocument().FilePath)
sys.path.append(gh_dir)

import tree_builder
import nodegraph
import importlib

importlib.reload(nodegraph)
importlib.reload(tree_builder)


from tree_builder import build_tree_graph


# CONSTANTS #
div_x = 8
div_y = 6
num_levels = 4

inset_edge = 0.8
inset_interior = 0.7

# Build the graph (all logic is in tree_builder.py)
ng = build_tree_graph(
    boundary=boundary,
    supports=supports,
    roof_brep=roof_brep,
    div_x=div_x if div_x else 8,
    div_y=div_y if div_y else 6,
    num_levels=num_levels if num_levels else 4,
    z_steps=z_steps,
    inset_edge=inset_edge if inset_edge else 0.5,
    inset_interior=inset_interior if inset_interior else 0.4,
    reach_tol=0.05,
    debug=True
)

# Outputs
all_edges = ng.edge_lines()
graph = ng
all_nodes = ng.node_points()
node_keys = list(ng.nodes())
# ---------- end python_3_script ----------
compas_draw = COMPASDraw(cg=python_3_script.all_edges)  # -> rg
#   port cg: The COMPAS geometry or datastructure to be drawn.
#   port rg: The Rhino geometry object.
# ---------- compas_draw: Python ----------
# r: compas>=2.14.1
"""
Draws COMPAS geometry in Grasshopper.
"""

from typing import Any

import Grasshopper

from compas.scene import SceneObject


class CompasToRhinoGeometry(Grasshopper.Kernel.GH_ScriptInstance):
    def RunScript(self, cg):
        if not cg:
            return None

        return SceneObject(item=cg).draw()
# ---------- end compas_draw ----------
compas_draw_2 = COMPASDraw(cg=python_3_script.all_nodes)  # -> rg; same code as compas_draw
python_3_script_2 = Python3Script(graph=python_3_script.graph)  # -> out, edges, nodes, idx, node_graph, a, b, c
# ---------- python_3_script_2: Python ----------
from copy import deepcopy
import os
import sys

gh_dir = os.path.dirname(ghenv.Component.OnPingDocument().FilePath)
if gh_dir not in sys.path:
    sys.path.insert(0, gh_dir)

ng = deepcopy(graph)

# Delete nodes
for node_id in [288, 289]:
    if ng.has_node(node_id):
        ng.delete_node(node_id)

# Add new elements
target_pairs = [
    [286, 274, 275, True], [287, 276, 277, True], [290, 278, 279, True], [291, 280, 281, True],
    [286, 270, 271, False], [287, 272, 273, False], [290, 282, 283, False], [291, 284, 285, False],
    [246, 44, 81, False], [246, 48, 87, False], [248, 54, 91, False], [248, 58, 97, False],
    [258, 124, 161, False], [258, 128, 167, False], [260, 134, 171, False], [260, 138, 177, False],
    [249, 64, 101, False], [249, 68, 107, False], [251, 74, 111, False], [251, 78, 117, False],
    [261, 144, 181, False], [261, 148, 187, False], [263, 154, 191, False], [263, 158, 197, False],
    [286, 246], [287, 249], [290, 258], [291, 261],
    [286, 248], [287, 251], [290, 260], [291, 263],
    [296, 241], [297, 244], [298, 265], [299, 268],
    [296, 247], [297, 250], [298, 259], [299, 262],
    [296, 270], [297, 272], [298, 282], [299, 284],
    [296, 271], [297, 273], [298, 283], [299, 285],
]

ng.add_segments(target_pairs)


edges = ng.edge_lines_by_group(0) + ng.edge_lines_by_group(1)
nodes = ng.node_points()
idx = list(ng.nodes())
node_graph = ng

a = ng.points_by_mobility("fixed")     # supports + inset corners
b = ng.points_by_mobility("z_free")    # apex nodes
c = ng.points_by_mobility("yz_free")  # added via add_segment
# ---------- end python_3_script_2 ----------

swatch = ColourSwatch(SwatchColor=RGB(51, 56, 66))
text_tag = TextTag(Location=compas_draw_2, Text=python_3_script.node_keys, Colour=swatch)
dot_display = DotDisplay(Point=compas_draw_2, Colour=swatch, Size=Slider(0.1, range=0..0.1))

custom_preview_lineweights = CustomPreviewLineweights(
    Geometry=compas_draw,
    Shader=ColourSwatch(SwatchColor=RGB(144, 209, 232)),
    Thickness=Slider(4, range=0..10),
    Absolute=False)

# ----
# Transform points
number_slider = Slider(3, range=0..10)
brep_3 = Brep(<brep referenced from the Rhino model>)
brep_4 = Brep(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)
python_3_script_3 = Python3Script(graph=python_3_script_2.node_graph, interior_brep=brep_4, move=Toggle(True), sub_iterations=number_slider)  # -> out, edges, nodes, idx, node_graph, a, b, c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; inputs interior_brep: Brep, sub_iterations: Int32
# ---------- python_3_script_3: Python ----------
import os, sys, importlib
gh_dir = os.path.dirname(ghenv.Component.OnPingDocument().FilePath)
if gh_dir not in sys.path:
    sys.path.insert(0, gh_dir)

### -----------------------------
## IMPORT
### -----------------------------
import edge_classifier
import transformer
import nodegraph

importlib.reload(edge_classifier)
importlib.reload(transformer)
importlib.reload(nodegraph)

from edge_classifier import classify_single_segment
from transformer import edge_in_brep
from copy import deepcopy
from compas.geometry import Vector, Line, Point, centroid_points

### -----------------------------
## INITIALIZATION
### -----------------------------
ng = deepcopy(graph)

### -----------------------------
## EXECUTION
### -----------------------------
if move:
    intersecting_edges, is_clear, moved_points, pt = edge_in_brep(ng, interior_brep, sub_iterations=sub_iterations, debug=True)

target_pairs = [[298, 290], [296, 286], [297, 287], [299, 291]]
movement_data = [[graph.node_attribute(pair[0], "point"), ng.edge_line(pair).vector, pair[0]] for pair in target_pairs]
# move = [ng.node_attribute(data[2], "point", data[0] + data[1]/3) for data in movement_data]

move = []
for data in movement_data:
    key = data[2]
    moved_pt = data[0] + data[1]/3
    move.append(ng.node_attribute(key, "point", moved_pt))
    ng.node_attributes(key, names=["x", "y", "z"], values=[moved_pt.x, moved_pt.y, moved_pt.z])



### -----------------------------
## OUTPUTS
### -----------------------------
edges = ng.edge_lines_by_group(0) + ng.edge_lines_by_group(1)
nodes = ng.node_points()
idx = list(ng.nodes())
node_graph = ng

a = ng.points_by_mobility("fixed")     # supports + inset corners
b = ng.points_by_mobility("z_free")    # apex nodes
c = ng.points_by_mobility("yz_free")  # added via add_segment

original_pt = [ng.node_attribute(key, 'original_point') for key in ng.nodes()]

### -----------------------------
## PRINT
### -----------------------------
# print(is_clear)
print(*ng.node_attributes(286))
# print(original_pt)
# ---------- end python_3_script_3 ----------

panel_3 = Panel("""0
1""")
panel_4 = Panel("""0
1""")
python_3_script_4 = Python3Script(graph=python_3_script_3.node_graph, sub=Toggle(True), sub_ids=panel_3)  # -> out, primary, secondary, tertiary, special, leaves, result, new_ng, nodes; inputs sub: Boolean, sub_ids: list of Int32
# ---------- python_3_script_4: Python ----------
import os, sys, importlib
gh_dir = os.path.dirname(ghenv.Component.OnPingDocument().FilePath)
if gh_dir not in sys.path:
    sys.path.insert(0, gh_dir)

import edge_classifier_v2
importlib.reload(edge_classifier_v2)
from edge_classifier_v2 import combine_graphs, classify_edges_by_Michael

from Grasshopper import DataTree
from Grasshopper.Kernel.Data import GH_Path


subs = classify_edges_by_Michael(graph, seg_x=8, seg_y=2)

primary = DataTree[object]()
secondary = DataTree[object]()
tertiary = DataTree[object]()
special = DataTree[object]()
leaves = DataTree[object]()

for i, sub in enumerate(subs):
    path = GH_Path(i)

    sg = sub["graph"]
    for node in sg.nodes():
        attrs_n = sg.node_attributes(node)
        # print (attrs_n)
    
    for edge in sg.edges():
        attrs_e = sg.edge_attributes(edge)
        # print (attrs_e)
        
        hie = "hierarchy"
        if hie not in attrs_e:
            continue
        
        if sub and i not in sub_ids:
            continue
        
        if attrs_e[hie] == "primary":
            primary.Add(sg.edge_line(edge), path)
        elif attrs_e[hie] == "secondary":
            secondary.Add(sg.edge_line(edge), path)
        elif attrs_e[hie] == "tertiary":
            tertiary.Add(sg.edge_line(edge), path)
        elif attrs_e[hie] == "special":
            special.Add(sg.edge_line(edge), path)

for edge in graph.edges():
    attrs_e = graph.edge_attributes(edge)
    if attrs_e["etype"] == "apex_inset":
        leaves.Add(graph.edge_line(edge))

sgs = [sub["graph"] for sub in subs[0:2]]
new_ng = combine_graphs(sgs)

nodes = new_ng.node_points()
print(*new_ng.edges_attributes())
# ---------- end python_3_script_4 ----------
python_3_script_5 = Python3Script(graph=python_3_script_3.node_graph, sub=Toggle(True), sub_ids=panel_4)  # -> out, primary, secondary, tertiary, special, new_ng; inputs sub: Boolean, sub_ids: list of Int32
# ---------- python_3_script_5: Python ----------
import os, sys, importlib
gh_dir = os.path.dirname(ghenv.Component.OnPingDocument().FilePath)
if gh_dir not in sys.path:
    sys.path.insert(0, gh_dir)

import edge_classifier_v2
importlib.reload(edge_classifier_v2)
from edge_classifier_v2 import combine_graphs, classify_edges_by_Michael

from Grasshopper import DataTree
from Grasshopper.Kernel.Data import GH_Path


subgraphs = classify_edges_by_Michael(graph, seg_x=8, seg_y=2)

primary = DataTree[object]()
secondary = DataTree[object]()
tertiary = DataTree[object]()
special = DataTree[object]()

for i, sg in enumerate(subgraphs):
    path = GH_Path(i)

    for node in sg.nodes():
        attrs_n = sg.node_attributes(node)
        # print (attrs_n)
    
    for edge in sg.edges():
        attrs_e = sg.edge_attributes(edge)
        # print (attrs_e)
        
        hie = "hierarchy"
        if hie not in attrs_e:
            continue
        
        if sub and i not in sub_ids:
            continue

        if attrs_e[hie] == "primary":
            primary.Add(sg.edge_line(edge), path)
        elif attrs_e[hie] == "secondary":
            secondary.Add(sg.edge_line(edge), path)
        elif attrs_e[hie] == "tertiary":
            tertiary.Add(sg.edge_line(edge), path)
        elif attrs_e[hie] == "special":
            special.Add(sg.edge_line(edge), path)
    


sgs = []
for i in sub_ids:
    sgs.append(subgraphs[i])

new_ng = combine_graphs(sgs)
# ---------- end python_3_script_5 ----------
compas_draw_3 = COMPASDraw(cg=python_3_script_2.edges)  # -> rg; same code as compas_draw
number_slider_2 = Slider(1, range=0..15)  # disabled

compas_draw_4 = COMPASDraw(cg=python_3_script_3.moved_points)  # -> rg; same code as compas_draw
dot_display_2 = DotDisplay(Point=compas_draw_4, Colour=ColourSwatch(SwatchColor=RGB(255, 255, 255)), Size=Slider(0.2, range=-0.5..0.5))

draw = COMPASDraw(cg=python_3_script_4.primary)  # -> rg; same code as compas_draw
draw_2 = COMPASDraw(cg=python_3_script_4.secondary)  # -> rg; same code as compas_draw
draw_3 = COMPASDraw(cg=python_3_script_4.tertiary)  # -> rg; same code as compas_draw
draw_4 = COMPASDraw(cg=python_3_script_4.special)  # -> rg; same code as compas_draw
draw_5 = COMPASDraw(cg=python_3_script_4.result)  # -> rg; same code as compas_draw
draw_6 = COMPASDraw(cg=python_3_script_4.leaves)  # -> rg; same code as compas_draw
brep_5 = Brep([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])  # disabled
brep_6 = Brep([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])
compas_draw_5 = COMPASDraw(cg=python_3_script_3.original_pt)  # -> rg; same code as compas_draw
brep_7 = Brep()
python_3_script_6 = Python3Script(graph=python_3_script_4.new_ng, segment_id=number_slider_2)  # -> out, primary, secondary, double, node_graph, nodes, idx; inputs segment_id: Int32; disabled
# ---------- python_3_script_6: Python ----------
import os, sys, importlib
gh_dir = os.path.dirname(ghenv.Component.OnPingDocument().FilePath)
if gh_dir not in sys.path:
    sys.path.insert(0, gh_dir)

import edge_classifier
import config
import reciprocal

importlib.reload(config)
importlib.reload(edge_classifier)
importlib.reload(reciprocal)

from edge_classifier import create_subgraphs,classify_subgraph_edges,classify_edges_by_support_direction
from reciprocal import reciprocal_from_subgraph, reciprocal_width_from_subgraph

from compas.geometry import Line

# classify_edges_by_support_direction(graph, parallel_tol=0.9)
# subgraphs = create_subgraphs(graph, seg_x=8, seg_y=2) # could change double divisions here
# sup_pts = graph.get_support_points()

# # Then fetch any segment on demand
# def get_segment(idx):
#     sg_data = subgraphs[idx % len(subgraphs)]
#     return classify_subgraph_edges(sg_data, sup_pts, near_threshold=1.0, parallel_tol=0.9)

# # Use it
# primary, secondary, double, near_sup, subgraph = get_segment(segment_id)
# print(graph[1])
result = reciprocal_width_from_subgraph(graph, engage_len=.11, debug = True)
print(result)
primary = result["shifted_lines"]
secondary = result["secondary_lines"]

node_graph = graph

nodes = node_graph.node_points()
idx = list(node_graph.nodes())
# ---------- end python_3_script_6 ----------
python_3_script_7 = Python3Script(graph=python_3_script_4.new_ng, floor=brep_5)  # -> out, edges, nodes, idx, anchors_pt, anchor_joint, node_graph; inputs floor: list of Brep; disabled
# ---------- python_3_script_7: Python ----------
import os, sys, importlib
gh_dir = os.path.dirname(ghenv.Component.OnPingDocument().FilePath)
if gh_dir not in sys.path:
    sys.path.insert(0, gh_dir)

### -----------------------------
## IMPORT
### -----------------------------
import edge_classifier
import transformer
import nodegraph
import anchor

importlib.reload(edge_classifier)
importlib.reload(transformer)
importlib.reload(nodegraph)
importlib.reload(anchor)

from edge_classifier import classify_single_segment
from transformer import edge_in_brep
from copy import deepcopy
from compas.geometry import Vector, Line, Point, centroid_points
from anchor import create_anchor_joint

### -----------------------------
## INITIALIZATION
### -----------------------------
ng = deepcopy(graph)

### -----------------------------
## EXECUTION
### -----------------------------
anchor_joint, anchors_pt = create_anchor_joint(ng)


### -----------------------------
## OUTPUTS
### -----------------------------


### -----------------------------
## PRINT
### -----------------------------
# print(anchor_joint)
# print(*ng.node_attributes(286))
print(anchor_joint)
# ---------- end python_3_script_7 ----------
python_3_script_8 = Python3Script(graph=python_3_script_4.new_ng, floor=brep_6)  # -> out, edges, nodes, idx, lines_tree; inputs floor: list of Brep
# ---------- python_3_script_8: Python ----------
import os, sys, importlib
gh_dir = os.path.dirname(ghenv.Component.OnPingDocument().FilePath)
if gh_dir not in sys.path:
    sys.path.insert(0, gh_dir)

### -----------------------------
## IMPORT
### -----------------------------
import edge_classifier
import transformer
import nodegraph
import shifting_solver

importlib.reload(edge_classifier)
importlib.reload(transformer)
importlib.reload(nodegraph)
importlib.reload(shifting_solver)

from edge_classifier import classify_single_segment
from transformer import edge_in_brep
from copy import deepcopy
from compas.geometry import Vector, Line, Point, centroid_points
from shifting_solver import shift_from_subgraph


from Grasshopper import DataTree
from Grasshopper.Kernel.Data import GH_Path
### -----------------------------
## INITIALIZATION
### -----------------------------
ng = deepcopy(graph)

### -----------------------------
## EXECUTION
### -----------------------------
result, lines = shift_from_subgraph(ng)

lines_tree = DataTree[object]()
for i, lst in enumerate(lines):
    path = GH_Path(i)
    # lines_tree.AddRange(lst, path)
    for ln in lst:
        lines_tree.Add(ln, path)

### -----------------------------
## OUTPUTS
### -----------------------------


### -----------------------------
## PRINT
### -----------------------------
# print(anchor_joint)
# print(*ng.node_attributes(286))
print(lines)
# ---------- end python_3_script_8 ----------
python_3_script_9 = Python3Script(graph=python_3_script_5.new_ng, brep=brep_7)  # -> out, graph, leaf_lines, result, new_points; inputs brep: Brep
# ---------- python_3_script_9: Python ----------
import os, sys, importlib
gh_dir = os.path.dirname(ghenv.Component.OnPingDocument().FilePath)
if gh_dir not in sys.path:
    sys.path.insert(0, gh_dir)


import leaf_solver
importlib.reload(leaf_solver)
from leaf_solver import compute_leaf_and_shoe
from copy import deepcopy



ng = deepcopy(graph)

result = compute_leaf_and_shoe(ng, brep, min_angle=20)
print (result)
new_points = result["meet_pts"]

########--------Output Data---------#########
leaf_lines = [ng.edge_line(edge) for edge in ng.edges() if ng.is_leaf_edge(edge)]
#############-----------Print----------##########
# print (len(list(graph.edges())))
# print (len(leaf_edges))
# ---------- end python_3_script_9 ----------
custom_preview_lineweights_2 = CustomPreviewLineweights(Geometry=draw, Shader=ColourSwatch(SwatchColor=RGB(137, 50, 143)), Thickness="8", Absolute=False)
custom_preview_lineweights_3 = CustomPreviewLineweights(Geometry=draw_2, Shader=ColourSwatch(SwatchColor=RGB(50, 143, 103)), Thickness="6", Absolute=False)
custom_preview_lineweights_4 = CustomPreviewLineweights(Geometry=draw_3, Shader=ColourSwatch(SwatchColor=RGB(189, 172, 66)), Thickness="3", Absolute=False)
custom_preview_lineweights_5 = CustomPreviewLineweights(Geometry=draw_4, Shader=ColourSwatch(SwatchColor=RGB(78, 207, 222)), Thickness="3", Absolute=False)
compas_draw_6 = COMPASDraw(cg=python_3_script_8.lines_tree)  # -> rg; same code as compas_draw
compas_draw_7 = COMPASDraw(cg=python_3_script_6.primary)  # -> rg; disabled; same code as compas_draw
compas_draw_8 = COMPASDraw(cg=python_3_script_6.secondary)  # -> rg; disabled; same code as compas_draw
compas_draw_9 = COMPASDraw(cg=python_3_script_6.double)  # -> rg; disabled; same code as compas_draw
compas_draw_10 = COMPASDraw(cg=python_3_script_6.nodes)  # -> rg; disabled; same code as compas_draw
draw_7 = COMPASDraw(cg=python_3_script_9.leaf_lines)  # -> rg; same code as compas_draw
compas_draw_11 = COMPASDraw(cg=python_3_script_7.anchors_pt)  # -> rg; disabled; same code as compas_draw
compas_draw_12 = COMPASDraw(cg=python_3_script_7.anchor_joint)  # -> rg; disabled; same code as compas_draw
draw_8 = COMPASDraw(cg=python_3_script_9.new_points)  # -> rg; same code as compas_draw

# ----
# Preview segments
number_slider_3 = Slider(1, range=0..15)
python_3_script_10 = Python3Script(graph=python_3_script_3.node_graph, segment_id=number_slider_3)  # -> out, primary, secondary, subgraph; inputs segment_id: Int32; disabled
# ---------- python_3_script_10: Python ----------
import os, sys, importlib
gh_dir = os.path.dirname(ghenv.Component.OnPingDocument().FilePath)
if gh_dir not in sys.path:
    sys.path.insert(0, gh_dir)

import edge_classifier
importlib.reload(edge_classifier)
from edge_classifier import classify_single_segment

result = classify_single_segment(graph, segment_index = segment_id,parallel_tol=0.999, near_threshold=1.0)

primary = result["primary_lines"]
secondary = result["secondary_lines"]
subgraph = result["subgraph"]
# ---------- end python_3_script_10 ----------
compas_draw_13 = COMPASDraw(cg=python_3_script_10.secondary)  # -> rg; same code as compas_draw
compas_draw_14 = COMPASDraw(cg=python_3_script_10.primary)  # -> rg; same code as compas_draw
custom_preview_lineweights_6 = CustomPreviewLineweights(Geometry=compas_draw_13, Shader=ColourSwatch(SwatchColor=RGB(50, 143, 103)), Thickness="5", Absolute=False)
custom_preview_lineweights_7 = CustomPreviewLineweights(Geometry=compas_draw_14, Shader=ColourSwatch(SwatchColor=RGB(137, 50, 143)), Thickness="20", Absolute=False)

# ----
# Preview nodes
# fixed
# z-free
# yz-free
compas_draw_15 = COMPASDraw(cg=python_3_script_3.edges)  # -> rg; same code as compas_draw
compas_draw_16 = COMPASDraw(cg=python_3_script_3.nodes)  # -> rg; same code as compas_draw
swatch_2 = ColourSwatch(SwatchColor=RGB(23, 64, 15))
text_tag_2 = TextTag(Location=compas_draw_16, Text=python_3_script_3.idx, Colour=swatch_2)
compas_draw_17 = COMPASDraw(cg=python_3_script_3.c)  # -> rg; same code as compas_draw
compas_draw_18 = COMPASDraw(cg=python_3_script_3.b)  # -> rg; same code as compas_draw
compas_draw_19 = COMPASDraw(cg=python_3_script_3.a)  # -> rg; same code as compas_draw
dot_display_3 = DotDisplay(Point=compas_draw_17, Colour=ColourSwatch(SwatchColor=RGB(173, 201, 107)), Size=Slider(0.1, range=0..0.1))
dot_display_4 = DotDisplay(Point=compas_draw_18, Colour=ColourSwatch(SwatchColor=RGB(107, 201, 160)), Size=Slider(0.1, range=0..0.1))
dot_display_5 = DotDisplay(Point=compas_draw_19, Colour=ColourSwatch(SwatchColor=RGB(201, 107, 107)), Size=Slider(0.1, range=0..0.1))

text_tag_3 = TextTag(Location=compas_draw_10, Text=python_3_script_6.idx, Colour=swatch_2)  # disabled
py3_3 = Python3Script(x=python_3_script_6.primary)  # -> out, geom; inputs x: list; disabled
# ---------- py3_3: Python ----------
import compas
from compas.scene import Scene
from compas_timber.model import TimberModel
from compas_timber.elements import Beam
from compas_timber.connections import TStepJoint
# from compas_timber.connections import TopologyRules
from compas_timber.connections.solver import ConnectionSolver
from compas_timber.connections import ConnectionSolver
from compas.tolerance import TOL, Tolerance


model = TimberModel(Tolerance(unit='MM'))

for l in x:
    b = Beam.from_centerline(l, 0.14, 0.24)
    model.add_element(b)

rules = []
# rules.append(TopologyRules(JointTopology.TOPO_T, TStepJoint))

solver = ConnectionSolver()
pairs = solver.find_intersecting_pairs(model.beams, max_distance=0.03)
for pair in pairs:
    topo = solver.find_topology(*pair, max_distance=0.03)
    if topo.topology == 3:
        TStepJoint.create(model, topo.beam_a, topo.beam_b)

model.process_joinery()

scene = Scene()
for b in model.beams:
    scene.add(b.geometry)
geom = scene.draw()
# ---------- end py3_3 ----------
python_3_script_11 = Python3Script(graph=python_3_script_4.new_ng)  # -> out, graph, leaf_lines, other_lines, shoe_lines; disabled
# ---------- python_3_script_11: Python ----------
import os, sys, importlib
gh_dir = os.path.dirname(ghenv.Component.OnPingDocument().FilePath)
if gh_dir not in sys.path:
    sys.path.insert(0, gh_dir)


from compas.geometry import Line


# 1. Get leaf edges
leaf_edges = graph.leaf_edges()

# 2. Get nodes with valency not 1
nodes = list(set([x for edge in leaf_edges for x in edge]))
parent_nodes = []
for n in nodes:
    if graph.degree(n) != 1:
        parent_nodes.append(n)

# 3. Create a dict of leaf clusters
leaves_group = {}
for pn in parent_nodes:
    for le in leaf_edges:
        if pn in le:
            leaves_group.setdefault(pn, []).append(le)

# 4. Partition edges by there colinearity
# For now using hierarchy to find pairs
shoe_pairs = {}
for pn, edges in leaves_group.items():
    pair = {}
    for edge in edges:
        hie = graph.edge_attribute(edge, "hierarchy")
        if hie == "primary":
            pair.setdefault("primary", []).append(edge)
        if hie == "secondary":
            pair.setdefault("secondary", []).append(edge)

    for two in pair.values():
        shoe_pairs.setdefault(pn, []).append(two)

shoe_lines = []
for lst in shoe_pairs.values():
    for two in lst:
        print (two)
        p1 = graph.node_point(two[0][1])
        p2 = graph.node_point(two[1][1])
        shoe_lines.append(Line(p1, p2))
print (shoe_pairs)


########--------Output Data---------#########
leaf_lines = [graph.edge_line(e) for e in leaf_edges]
other_lines = [graph.edge_line(e) for e in graph.edges() if not graph.is_leaf_edge(e)]

#############-----------Print----------##########
# print (len(list(graph.edges())))
# print (len(leaf_edges))
# ---------- end python_3_script_11 ----------
draw_9 = COMPASDraw(cg=python_3_script_11.other_lines)  # -> rg; disabled; same code as compas_draw
draw_10 = COMPASDraw(cg=python_3_script_11.leaf_lines)  # -> rg; disabled; same code as compas_draw
draw_11 = COMPASDraw(cg=python_3_script_11.shoe_lines)  # -> rg; disabled; same code as compas_draw
debrep = DeconstructBrep(Brep=brep_2)  # -> Faces, Edges, Vertices; disabled

python_3_script_12 = Python3Script(graph=python_3_script_11.graph)  # -> out, graph, leaf_lines; disabled
# ---------- python_3_script_12: Python ----------
import os, sys, importlib
gh_dir = os.path.dirname(ghenv.Component.OnPingDocument().FilePath)
if gh_dir not in sys.path:
    sys.path.insert(0, gh_dir)



# 1. Create subgraph for clustering shoes
leaf_edges = graph.leaf_edges()
nodes = [x for edge in leaf_edges for x in edge]
subgraph = graph.extract_subgraph(nodes)

# 2. Delete edges which are not leaf edges in subgraph
to_del = []
for edge in subgraph.edges():
    if not subgraph.is_leaf_edge(edge):
        to_del.append(edge)

for edge in to_del:
    subgraph.delete_edge(edge)

# 3. Cluster edges by valency == 4
for node in subgraph.nodes():
    valency = subgraph.degree(node)
    print (valency)

# 4. Group edges by coplanarity


########--------Output Data---------#########
leaf_lines = subgraph.edge_lines()

#############-----------Print----------##########
print (len(nodes))
print (len(leaf_edges))
print (subgraph)
# ---------- end python_3_script_12 ----------
number_slider_4 = Slider(1.522, range=0..6.283)  # disabled
draw_12 = COMPASDraw(cg=python_3_script_12.leaf_lines)  # -> rg; disabled; same code as compas_draw
brep_8 = Brep(debrep.Faces)  # disabled
number_slider_5 = Slider(0.279, range=0..1)  # disabled
crv_2 = Curve(draw_12)  # disabled
eval = EvaluateLength(Curve=crv_2, Length=number_slider_5, Normalized=True)  # -> Point, Tangent, Parameter; disabled
clt_lines = Python3Script(curves=crv_2, surface=brep_8, RAD=number_slider_4)  # -> out, new_lines, new_intersection_pt, new_c, z_line, projected_line, compas_lines; inputs curves: list of Curve, surface: Brep; disabled
# ---------- clt_lines: Python ----------
import Rhino.Geometry as rg
from compas.geometry import Point, Line, Vector
from compas.geometry import cross_vectors
from compas.geometry import Rotation
from compas.geometry import intersection_line_line
from compas_rhino.conversions import line_to_compas, curve_to_compas_line
import math

"""orient lines"""
def orient_lines(line):
    if line.start.z < line.end.z:
        return Line(line.end, line.start)
    return line


""" surface projection """
def project_to_brep(pt, brep):
    """Project a point vertically (Z) onto a Rhino brep."""
    if brep is None:
        return pt
    origin = rg.Point3d(pt.x, pt.y, pt.z)
    ray = rg.Ray3d(origin, rg.Vector3d.ZAxis)
    hits = rg.Intersect.Intersection.RayShoot(ray, [brep], 1)
    if hits:
        return Point(hits[0].X, hits[0].Y, hits[0].Z)
    # Try downward if upward missed
    ray = rg.Ray3d(origin, -rg.Vector3d.ZAxis)
    hits = rg.Intersect.Intersection.RayShoot(ray, [brep], 1)
    if hits:
        return Point(hits[0].X, hits[0].Y, hits[0].Z)
    return pt

def check_min_angle(line1, line2, min_angle):
    """Check if the angle is larger than or equal to the given minimum angle."""
    angle = line1.vector.angle(line2.vector)
    return angle >= math.radians(min_angle)


new_lines = []

for line in curves:
    rg_line = curve_to_compas_line(line)
    oriented = orient_lines(rg_line)
    
    start_proj = project_to_brep(oriented.start, surface)
    end_proj   = project_to_brep(oriented.end, surface)
    
    projected_line = Line(start_proj, end_proj)


    if check_min_angle(oriented, projected_line, 20):
        new_lines.append(rg_line)
        continue

    z_line = Line(oriented.end, end_proj)
    
    alpha = projected_line.vector.angle(z_line.vector)
    gamma = math.radians(160) - alpha

    axis = cross_vectors(z_line.vector, oriented.vector)
    R    = Rotation.from_axis_and_angle(axis, -gamma, z_line.start)

    rotated_line  = z_line.transformed(R)
    intersection  = intersection_line_line(rotated_line, projected_line)
    if intersection[0] is not None:
        new_lines.append(Line(oriented.end, Point(*intersection[0])))
    else:
        print("no intersection found")
        
    

    print(math.degrees(alpha), gamma)
# ---------- end clt_lines ----------
number_slider_6 = Slider(0.16, range=0..1)  # disabled
draw_13 = COMPASDraw(cg=clt_lines.new_lines)  # -> rg; disabled; same code as compas_draw
draw_14 = COMPASDraw(cg=clt_lines.new_intersection_pt)  # -> rg; disabled; same code as compas_draw
draw_15 = COMPASDraw(cg=clt_lines.new_c)  # -> rg; disabled; same code as compas_draw
draw_16 = COMPASDraw(cg=clt_lines.z_line)  # -> rg; disabled; same code as compas_draw
draw_17 = COMPASDraw(cg=clt_lines.projected_line)  # -> rg; disabled; same code as compas_draw
draw_18 = COMPASDraw(cg=clt_lines.compas_lines)  # -> rg; disabled; same code as compas_draw
eval_2 = EvaluateLength(Curve=draw_13, Length=number_slider_6, Normalized=True)  # -> Point, Tangent, Parameter; disabled
number_slider_7 = Slider(0.198, range=-0.5..10)  # disabled
number_slider_8 = Slider(0.2, range=0..1)  # disabled
number_slider_9 = Slider(0.2, range=0..1)  # disabled
number_slider_10 = Slider(0.8, range=0..1)  # disabled
number_slider_11 = Slider(0.14, range=0..1)  # disabled
number_slider_12 = Slider(0.2, range=0..1)  # disabled
vdis = VectorDisplay(Anchor=draw_14, Vector=draw_17)  # disabled
beam = CTBeam(centerline=draw_13, width=number_slider_11, height=number_slider_12)  # -> Beam, Blank; inputs centerline: list, z_vector: list of Vector3d, width: list of Double, height: list of Double, category: list of String, updateRefObj: Boolean; disabled
#   port centerline: Referenced curve or line, Guid of curve or line in the active Rhino document.
#   port z_vector: Vector defining the orientation of the cross-section (corresponds to the height dimension). If None, a default will be taken.
#   port width: Width of the cross-section (usually the smaller dimension).
#   port height: Height of the cross-section (usually the larger dimension).
#   port category: Category of a beam.
#   port updateRefObj: (optional) If True, the attributes in the referenced object will be updated/overwritten with the new values given here.
#   port Beam: Beam object(s).
#   port Blank: Shape of the beam's blank.
# ---------- beam: Python ----------
# env: C:\Users\frido\OneDrive\Dokumente\ETH_MAS_Architecture_Digital_Fabrication\Visual_Studio_Code\MAS-2526\timber_design\src
# r: compas_timber>=0.16.2
"""Creates a Beam from a LineCurve."""

# flake8: noqa
import Grasshopper
import Rhino
import rhinoscriptsyntax as rs
import System
from compas.scene import Scene
from compas_rhino.conversions import line_to_compas
from compas_rhino.conversions import vector_to_compas

from compas_timber.elements import Beam as CTBeam
from timber_design.ghpython.ghcomponent_helpers import list_input_valid_cpython


class Beam_fromCurve(Grasshopper.Kernel.GH_ScriptInstance):
    def RunScript(self,
            centerline: System.Collections.Generic.List[object],
            z_vector: System.Collections.Generic.List[Rhino.Geometry.Vector3d],
            width: System.Collections.Generic.List[float],
            height: System.Collections.Generic.List[float],
            category: System.Collections.Generic.List[str],
            updateRefObj: bool):
        # minimum inputs required
        if not list_input_valid_cpython(ghenv, centerline, "Centerline"):
            return
        if not width:
            length = self._get_centerline_length(centerline)
            width = [length / 20]
        if not height:
            length = self._get_centerline_length(centerline)
            height = [length / 10]

        # reformat unset parameters for consistency
        if not z_vector:
            z_vector = [None]
        if not category:
            category = [None]

        beams = []
        blanks = []
        scene = Scene()

        if centerline and height and width:
            # check list lengths for consistency
            N = len(centerline)
            if len(z_vector) not in (0, 1, N):
                ghenv.Component.AddRuntimeMessage(
                    Grasshopper.Kernel.GH_RuntimeMessageLevel.Error, " In 'ZVector' I need either none, one or the same number of inputs as the Crv parameter."
                )
            if len(width) not in (1, N):
                ghenv.Component.AddRuntimeMessage(Grasshopper.Kernel.GH_RuntimeMessageLevel.Error, " In 'W' I need either one or the same number of inputs as the Crv parameter.")
            if len(height) not in (1, N):
                ghenv.Component.AddRuntimeMessage(Grasshopper.Kernel.GH_RuntimeMessageLevel.Error, " In 'H' I need either one or the same number of inputs as the Crv parameter.")
            if len(category) not in (0, 1, N):
                ghenv.Component.AddRuntimeMessage(
                    Grasshopper.Kernel.GH_RuntimeMessageLevel.Error, " In 'Category' I need either none, one or the same number of inputs as the Crv parameter."
                )

            # duplicate data if None or single value
            if len(z_vector) != N:
                z_vector = [z_vector[0] for _ in range(N)]
            if len(width) != N:
                width = [width[0] for _ in range(N)]
            if len(height) != N:
                height = [height[0] for _ in range(N)]
            if len(category) != N:
                category = [category[0] for _ in range(N)]

            for line, z, w, h, c in zip(centerline, z_vector, width, height, category):
                guid, geometry = self._get_guid_and_geometry(line)
                rhino_line = rs.coerceline(geometry)
                line = line_to_compas(rhino_line)

                z = vector_to_compas(z) if z else None
                beam = CTBeam.from_centerline(centerline=line, width=w, height=h, z_vector=z)
                beam.attributes["rhino_guid"] = str(guid) if guid else None
                beam.attributes["category"] = c


                beams.append(beam)
                scene.add(beam.blank)

        blanks = scene.draw()

        return beams, blanks

    def _get_guid_and_geometry(self, line):
        # internalized curves and GH geometry will not have persistent GUIDs, referenced Rhino objects will
        # type hint on the input has to be 'ghdoc' for this to work
        guid = None
        geometry = line
        rhino_obj = Rhino.RhinoDoc.ActiveDoc.Objects.FindId(line)
        if rhino_obj:
            guid = line
            geometry = rhino_obj.Geometry
        return guid, geometry

    def _get_centerline_length(self, centerline):
        centerline_length = []
        for i in centerline:
            centerline_length.append(rs.CurveLength(i))
        if centerline_length:
            length_average = sum(centerline_length) / len(centerline_length)
        else:
            length_average = 1
        return length_average
# ---------- end beam ----------
py3_4 = Python3Script(
    centerlines=draw_13,
    brep=brep_8,
    dist=number_slider_7,
    bwidth=number_slider_8,
    bdepth=number_slider_9,
    steel=number_slider_10)  # -> out, shifted_pt, board, oriented_boards, projected_lines, old_pts, new_shift_pts; inputs centerlines: list of Line, brep: Brep, dist: Double, bwidth: Double, bdepth: Double, steel: Double; disabled
# ---------- py3_4: Python ----------
import os
import sys


from compas.geometry import Box, Point, Line, Vector, Box, Frame, Plane

from compas.geometry import angle_vectors, cross_vectors, intersection_line_plane
from compas.geometry import Rotation, Transformation, Translation
from compas_rhino.conversions import line_to_compas, curve_to_compas_line
import math


import Rhino.Geometry as rg

from compas_rhino import unload_modules

# gh_dir = os.path.dirname(ghenv.Component.OnPingDocument().FilePath)
# sys.path.append(gh_dir)

# import tree_builder

""" surface projection """
def project_to_brep(pt, brep):
    """Project a point vertically (Z) onto a Rhino brep."""
    if brep is None:
        return pt
    origin = rg.Point3d(pt.x, pt.y, pt.z)
    ray = rg.Ray3d(origin, rg.Vector3d.ZAxis)
    hits = rg.Intersect.Intersection.RayShoot(ray, [brep], 1)
    if hits:
        return Point(hits[0].X, hits[0].Y, hits[0].Z)
    # Try downward if upward missed
    ray = rg.Ray3d(origin, -rg.Vector3d.ZAxis)
    hits = rg.Intersect.Intersection.RayShoot(ray, [brep], 1)
    if hits:
        return Point(hits[0].X, hits[0].Y, hits[0].Z)
    return pt

""" orient Lines, so start is on bottom"""
def orient_lines(line):
    if line.start.z > line.end.z:
        return Line(line.end, line.start)
    return line

""" get Z Vector for Frame """
def _calculate_z_vector_from_centerline(centerline_vector):
    c = Vector(0,0,1)
    angle = angle_vectors(c, centerline_vector)
    if angle < 0.001 or angle > math.pi - 0.001: 
        c = Vector(1,0,0)
    return c




oriented = []
shifted_pt = []
board = []
projected_lines = []
oriented_boards = []

old_pts = []
new_shift_pts = []

for centerline in centerlines:
    ocmpln = orient_lines(line_to_compas(centerline))
    distvec = ocmpln.vector.unitized()
    shiftpt = ocmpln.end.translate(distvec*dist)
    z_axis = _calculate_z_vector_from_centerline(distvec)
    # plane0 = Plane(ocmpln.end, Vector(0,0,1))
    # intersectpt = intersection_line_plane(oriented, plane0)
    xy_frame = Frame(ocmpln.end,  z_axis, distvec)
    # xy_frame = Frame(oriented.start,  z_axis, distvec)
    plate = Box(steel, bdepth, bwidth, xy_frame)
    oriented.append(ocmpln)
    shifted_pt.append(shiftpt)
    board.append(plate)

    pt_start = ocmpln.start
    pt_end = ocmpln.end
    roof_startpt = project_to_brep(pt_start, brep)
    roof_endpt = project_to_brep(pt_end, brep)
    proj_l = Line(roof_startpt, roof_endpt)
    proj_vec = proj_l.vector
    or_frame = Frame(ocmpln.end, proj_vec, distvec)
    or_box = Box(steel, bdepth, bwidth, or_frame)
    oriented_boards.append(or_box)
    lines =  proj_l

    T = Translation.from_vector(-ocmpln.vector.unitized() * bdepth * 0.5 / math.sin(math.radians(30)))
    new_shift_pt = ocmpln.end.transformed(T)
    new_shift_pts.append(new_shift_pt)
    # old_pt = ocmpln.end
    old_pts.append(ocmpln.end)
    projected_lines.append(proj_l)




"""? what should I do in case of list of breps? --> python# normalize brep input — works for single or multiple surfaces
breps = list(brep) if hasattr(brep, '__iter__') else [brep] --> pythondef project_to_brep(point, breps):
    # breps should already be a list of GeometryBase
    ray = rg.Ray3d(point, rg.Vector3d(0, 0, 1))
    hits = rg.Intersect.Intersection.RayShoot(ray, breps, 1)
    ..."""
# ---------- end py3_4 ----------
draw_19 = COMPASDraw(cg=py3_4.oriented_boards)  # -> rg; disabled; same code as compas_draw
draw_20 = COMPASDraw(cg=py3_4.projected_lines)  # -> rg; disabled; same code as compas_draw
draw_21 = COMPASDraw(cg=py3_4.new_shift_pts)  # -> rg; disabled; same code as compas_draw
draw_22 = COMPASDraw(cg=py3_4.old_pts)  # -> rg; disabled; same code as compas_draw
dist = Distance(PointA=draw_22, PointB=draw_21)  # disabled
cset = CreateSet(List=dist)  # -> Set, Map; disabled
panel_5 = Panel(cset.Set)  # disabled

crv_3 = Curve(draw_6)  # disabled
srf = Surface(debrep.Faces)  # disabled
number_slider_13 = Slider(1.522, range=0..6.283)  # disabled
claude = Python3Script(curves=crv_3, surface=srf, RAD=number_slider_13)  # -> out, new_lines, new_intersection_pt, new_c, z_line, projected_line, compas_lines; inputs curves: list of Curve, surface: Surface; disabled
# ---------- claude: Python ----------
import Rhino.Geometry as rg
from compas.geometry import Point, Line, Vector
from compas.geometry import cross_vectors
from compas.geometry import Rotation
from compas.geometry import intersection_line_line
from compas_rhino.conversions import line_to_compas, curve_to_compas_line
import math

"""orient lines"""
def orient_lines(line):
    if line.start.z < line.end.z:
        return Line(line.end, line.start)
    return line


""" surface projection """
def project_to_brep(pt, brep):
    """Project a point vertically (Z) onto a Rhino brep."""
    if brep is None:
        return pt
    origin = rg.Point3d(pt.x, pt.y, pt.z)
    ray = rg.Ray3d(origin, rg.Vector3d.ZAxis)
    hits = rg.Intersect.Intersection.RayShoot(ray, [brep], 1)
    if hits:
        return Point(hits[0].X, hits[0].Y, hits[0].Z)
    # Try downward if upward missed
    ray = rg.Ray3d(origin, -rg.Vector3d.ZAxis)
    hits = rg.Intersect.Intersection.RayShoot(ray, [brep], 1)
    if hits:
        return Point(hits[0].X, hits[0].Y, hits[0].Z)
    return pt


new_lines = []

new_lines = []

for line in curves:
    oriented = orient_lines(curve_to_compas_line(line))
    
    start_proj = project_to_brep(oriented.start, surface)
    end_proj   = project_to_brep(oriented.end, surface)
    
    projected_line = Line(start_proj, end_proj)
    z_line         = Line(oriented.end, end_proj)
    
    alpha = projected_line.vector.angle(z_line.vector)
    gamma = math.radians(160) - alpha
    
    axis = cross_vectors(z_line.vector, oriented.vector)
    R    = Rotation.from_axis_and_angle(axis, -gamma, z_line.start)
    
    rotated_line  = z_line.transformed(R)
    intersection  = intersection_line_line(rotated_line, projected_line)
    if intersection[0] is not None:
        new_lines.append(Line(oriented.end, Point(*intersection[0])))
    else:
        print("no intersection found")
        
    

    print(alpha, gamma)
# ---------- end claude ----------
draw_23 = COMPASDraw(cg=claude.new_lines)  # -> rg; disabled; same code as compas_draw
draw_24 = COMPASDraw(cg=claude.new_intersection_pt)  # -> rg; disabled; same code as compas_draw
draw_25 = COMPASDraw(cg=claude.new_c)  # -> rg; disabled; same code as compas_draw
draw_26 = COMPASDraw(cg=claude.z_line)  # -> rg; disabled; same code as compas_draw
draw_27 = COMPASDraw(cg=claude.projected_line)  # -> rg; disabled; same code as compas_draw
draw_28 = COMPASDraw(cg=claude.compas_lines)  # -> rg; disabled; same code as compas_draw
vdis_2 = VectorDisplay(Anchor=draw_24, Vector=draw_27)  # disabled
number_slider_14 = Slider(0.2, range=0..1)  # disabled
number_slider_15 = Slider(0.14, range=0..1)  # disabled
number_slider_16 = Slider(0.2, range=0..1)  # disabled
number_slider_17 = Slider(0.5, range=0..2)  # disabled
number_slider_18 = Slider(0.198, range=-0.5..10)  # disabled
number_slider_19 = Slider(0.2, range=0..1)  # disabled
beam_2 = CTBeam(centerline=draw_23, width=number_slider_15, height=number_slider_14)  # -> Beam, Blank; inputs centerline: list, z_vector: list of Vector3d, width: list of Double, height: list of Double, category: list of String, updateRefObj: Boolean; disabled; same code as beam
py3_5 = Python3Script(
    centerlines=draw_23,
    brep=srf,
    dist=number_slider_18,
    bwidth=number_slider_16,
    bdepth=number_slider_19,
    steel=number_slider_17)  # -> out, shifted_pt, board, oriented_boards, projected_lines, plate, lines, pt_end, proj_vec; inputs centerlines: list of Line, brep: Surface, dist: Double, bwidth: Double, bdepth: Double, steel: Double; disabled
# ---------- py3_5: Python ----------
import os
import sys


from compas.geometry import Box, Line, Vector, Box, Frame, angle_vectors

from compas.geometry import Box, Line, Vector, Frame, angle_vectors, Point, Rotation, Plane, intersection_line_plane
from compas_rhino.conversions import line_to_compas, curve_to_compas_line
import math

import Rhino.Geometry as rg

from compas_rhino import unload_modules

# gh_dir = os.path.dirname(ghenv.Component.OnPingDocument().FilePath)
# sys.path.append(gh_dir)

# import tree_builder

""" surface projection """
def project_to_brep(pt, brep):
    """Project a point vertically (Z) onto a Rhino brep."""
    if brep is None:
        return pt
    origin = rg.Point3d(pt.x, pt.y, pt.z)
    ray = rg.Ray3d(origin, rg.Vector3d.ZAxis)
    hits = rg.Intersect.Intersection.RayShoot(ray, [brep], 1)
    if hits:
        return Point(hits[0].X, hits[0].Y, hits[0].Z)
    # Try downward if upward missed
    ray = rg.Ray3d(origin, -rg.Vector3d.ZAxis)
    hits = rg.Intersect.Intersection.RayShoot(ray, [brep], 1)
    if hits:
        return Point(hits[0].X, hits[0].Y, hits[0].Z)
    return pt

""" orient Lines, so start is on bottom"""
def orient_lines(line):
    if line.start.z > line.end.z:
        return Line(line.end, line.start)
    return line

""" get Z Vector for Frame """
def _calculate_z_vector_from_centerline(centerline_vector):
    c = Vector(0,0,1)
    angle = angle_vectors(c, centerline_vector)
    if angle < 0.001 or angle > math.pi - 0.001: 
        c = Vector(1,0,0)
    return c




oriented = []
shifted_pt = []
board = []
projected_lines = []
oriented_boards = []
lines = []

for centerline in centerlines:
    ocmpln = orient_lines(line_to_compas(centerline))
    distvec = ocmpln.vector.unitized()
    shiftpt = ocmpln.end.translate(distvec*dist)
    z_axis = _calculate_z_vector_from_centerline(distvec)
    # plane0 = Plane(ocmpln.end, Vector(0,0,1))
    # intersectpt = intersection_line_plane(oriented, plane0)
    xy_frame = Frame(ocmpln.end,  z_axis, distvec)
    # xy_frame = Frame(oriented.start,  z_axis, distvec)
    plate = Box(steel, bdepth, bwidth, xy_frame)
    oriented.append(ocmpln)
    shifted_pt.append(shiftpt)
    board.append(plate)

    pt_start = ocmpln.start
    pt_end = ocmpln.end
    roof_startpt = project_to_brep(pt_start, brep)
    roof_endpt = project_to_brep(pt_end, brep)
    proj_l = Line(roof_startpt, roof_endpt)
    proj_vec = proj_l.vector
    or_frame = Frame(ocmpln.end, proj_vec, distvec)
    or_box = Box(steel, bdepth, bwidth, or_frame)
    oriented_boards.append(or_box)

    projected_lines.append(proj_l)
    line = Line(pt_end + proj_vec.unitized()*steel/2, pt_end - proj_vec.unitized()*steel)
    lines.append(line)




"""? what should I do in case of list of breps? --> python# normalize brep input — works for single or multiple surfaces
breps = list(brep) if hasattr(brep, '__iter__') else [brep] --> pythondef project_to_brep(point, breps):
    # breps should already be a list of GeometryBase
    ray = rg.Ray3d(point, rg.Vector3d(0, 0, 1))
    hits = rg.Intersect.Intersection.RayShoot(ray, breps, 1)
    ..."""
# ---------- end py3_5 ----------
draw_29 = COMPASDraw(cg=py3_5.oriented_boards)  # -> rg; disabled; same code as compas_draw
draw_30 = COMPASDraw(cg=py3_5.lines)  # -> rg; disabled; same code as compas_draw
py3_6 = Python3Script(crv_one=flatten(draw_23), crv_two=flatten(draw_30))  # -> out, a, btlx; inputs crv_one: list of Line, crv_two: list of Line; disabled
# ---------- py3_6: Python ----------
from compas_timber.elements import Beam
from compas_timber.model import TimberModel
from compas_timber.connections import TMultiStepJoint
from compas_timber.connections import TButtJoint
from compas_timber.connections import LLapJoint
from compas_timber.connections import JointTopology
from compas_timber.fabrication import BTLxWriter
from compas_rhino.conversions import line_to_compas
from compas.geometry import dot_vectors
from compas.geometry import angle_vectors
from compas.scene import Scene
from compas.tolerance import Tolerance

scene = Scene()

curves_one = [line_to_compas(c) for c in crv_one]
curves_two = [line_to_compas(c) for c in crv_two if c is not None]
model = TimberModel(Tolerance(unit="MM"))

beams = []
for i, curve in enumerate(curves_one):
    beam = Beam.from_centerline(curve, width=.160, height=.200)
    beam.attributes["category"] = "main_load"
    beams.append(beam)
    # scene.add(beam.geometry)
    model.add_element(beam)

for i, curve in enumerate(curves_two):
    beam = Beam.from_centerline(curve, width=.160, height=.200)
    beam.attributes["category"] = "secondary"
    beams.append(beam)
    # scene.add(beam.geometry)
    model.add_element(beam)

for beam in model.beams:
    print(beam.attributes["category"])

model.connect_adjacent_beams()

for candidate in model.joint_candidates:
    # if candidate.element_a.guid == model.beams[1].guid and candidate.element_b.guid == model.beams[2].guid:
    #     LLapJoint.create(model, candidate.element_a, candidate.element_b, cut_plane_bias=0.5)
    if candidate.element_a.attributes["category"] == "main_load" and candidate.element_b.attributes["category"] == "secondary":
        TMultiStepJoint.create(model, candidate.element_a, candidate.element_b)
    # elif candidate.topology == JointTopology.TOPO_T:
    #     if angle_vectors(candidate.element_a.centerline.direction, candidate.element_b.centerline.direction, deg=True) < 50:
    #         step_shape = "heel"
    #     else:
    #         step_shape = "step"
    #     t_step_joint = TMultiStepJoint.create(
    #     model,
    #     candidate.element_a,
    #     candidate.element_b,
    #     step_shape=step_shape,
    #     step_depth=.020,
    #     riser_angle=.090
    #     )
    # elif candidate.topology == JointTopology.TOPO_L:
    #     LLapJoint.create(model, candidate.element_a, candidate.element_b, cut_plane_bias=0.5)
print(len(model.joints))
model.process_joinery()

writer = BTLxWriter()
# btlx = writer.write(model, file_path=path)

for beam in model.beams:
    scene.add(beam.geometry)
a = scene.draw()
# ---------- end py3_6 ----------
