# Grasshopper definition line_model_v4.ghx (Grasshopper 1.0.8)
# plug-ins: Human

py3 = Python3Script(l=Slider(5, range=0..10), coeff_h=Slider(0.43, range=0..1))  # -> out, D_heigts; inputs l: Int32, coeff_h: Double
# ---------- py3: Python ----------
import Rhino.Geometry as rg
import math
from ghpythonlib.treehelpers import list_to_tree, tree_to_list


def expo_num(coeff):
    max_heigth = 1
    h_coeficient = []
    for n in range(l):
        y = coeff ** (n*(-1)) # number 2 can be change so the exponential changes
        h_coeficient.append(abs(y - 1))
    heigts = []
    print(h_coeficient)
    for n in h_coeficient:
        param = n/h_coeficient[-1]
        r = max_heigth * param
        h = r - max_heigth
        # heigts.append(round(r, 1))
        heigts.append(r)
    D = heigts
    return D

D_heigts = expo_num(coeff_h)
# ---------- end py3 ----------
panel = Panel(py3.D_heigts)

curve = Curve(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)
brep = Brep(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)
point = Point([Point(163.54, 57.72, 15.455), Point(163.54, 48.1, 15.455), Point(173.16, 48.1, 19.455), Point(173.16, 57.72, 19.455)])

# ----
# create and manipulate graph
python_3_script = Python3Script(boundary=curve, roof_brep=brep, supports=point, z_steps=py3.D_heigts)  # -> out, ridges_tree, all_edges, graph, all_nodes, node_keys; inputs boundary: Curve, roof_brep: Brep, supports: list of Point3d, z_steps: list of Double
# ---------- python_3_script: Python ----------
import os
import sys
from compas_rhino import unload_modules
import compas
compas.PRECISION = ".3f"

gh_dir = os.path.dirname(ghenv.Component.OnPingDocument().FilePath)
sys.path.append(gh_dir)

import tree_builder
import nodegraph
import importlib

importlib.reload(nodegraph)
importlib.reload(tree_builder)


from tree_builder import build_tree_graph


# CONSTANTS #
div_x = 8
div_y = 6
num_levels = 4

inset_edge = 0.5
inset_interior = 0.5

# Build the graph (all logic is in tree_builder.py)
ng = build_tree_graph(
    boundary=boundary,
    supports=supports,
    roof_brep=roof_brep,
    div_x=div_x if div_x else 8,
    div_y=div_y if div_y else 6,
    num_levels=num_levels if num_levels else 4,
    z_steps=z_steps,
    inset_edge=inset_edge if inset_edge else 0.5,
    inset_interior=inset_interior if inset_interior else 0.4,
    reach_tol=0.05,
    debug=True
)

# Outputs
all_edges = ng.edge_lines()
graph = ng
all_nodes = ng.node_points()
node_keys = list(ng.nodes())
# ---------- end python_3_script ----------
compas_draw = COMPASDraw(cg=python_3_script.all_edges)  # -> rg
#   port cg: The COMPAS geometry or datastructure to be drawn.
#   port rg: The Rhino geometry object.
# ---------- compas_draw: Python ----------
# r: compas>=2.14.1
"""
Draws COMPAS geometry in Grasshopper.
"""

from typing import Any

import Grasshopper

from compas.scene import SceneObject


class CompasToRhinoGeometry(Grasshopper.Kernel.GH_ScriptInstance):
    def RunScript(self, cg):
        if not cg:
            return None

        return SceneObject(item=cg).draw()
# ---------- end compas_draw ----------
compas_draw_2 = COMPASDraw(cg=python_3_script.all_nodes)  # -> rg; same code as compas_draw
python_3_script_2 = Python3Script(graph=python_3_script.graph)  # -> out, edges, nodes, idx, node_graph, a, b, c
# ---------- python_3_script_2: Python ----------
from copy import deepcopy
import os
import sys

gh_dir = os.path.dirname(ghenv.Component.OnPingDocument().FilePath)
if gh_dir not in sys.path:
    sys.path.insert(0, gh_dir)

ng = deepcopy(graph)

# Delete nodes
for node_id in [288, 289]:
    if ng.has_node(node_id):
        ng.delete_node(node_id)

# Add new elements
target_pairs = [
    [286, 274, 275, True], [287, 276, 277, True], [290, 278, 279, True], [291, 280, 281, True],
    [286, 270, 271, False], [287, 272, 273, False], [290, 282, 283, False], [291, 284, 285, False],
    [246, 44, 81, False], [246, 48, 87, False], [248, 54, 91, False], [248, 58, 97, False],
    [258, 124, 161, False], [258, 128, 167, False], [260, 134, 171, False], [260, 138, 177, False],
    [249, 64, 101, False], [249, 68, 107, False], [251, 74, 111, False], [251, 78, 117, False],
    [261, 144, 181, False], [261, 148, 187, False], [263, 154, 191, False], [263, 158, 197, False],
    [286, 246], [287, 249], [290, 258], [291, 261],
    [286, 248], [287, 251], [290, 260], [291, 263],
    [296, 241], [297, 244], [298, 265], [299, 268],
    [296, 247], [297, 250], [298, 259], [299, 262],
    [296, 270], [297, 272], [298, 282], [299, 284],
    [296, 271], [297, 273], [298, 283], [299, 285],
]

ng.add_segments(target_pairs)


edges = ng.edge_lines_by_group(0) + ng.edge_lines_by_group(1)
nodes = ng.node_points()
idx = list(ng.nodes())
node_graph = ng

a = ng.points_by_mobility("fixed")     # supports + inset corners
b = ng.points_by_mobility("z_free")    # apex nodes
c = ng.points_by_mobility("yz_free")  # added via add_segment
# ---------- end python_3_script_2 ----------

custom_preview_lineweights = CustomPreviewLineweights(
    Geometry=compas_draw,
    Shader=ColourSwatch(SwatchColor=RGB(144, 209, 232)),
    Thickness=Slider(4, range=0..10),
    Absolute=False)

swatch = ColourSwatch(SwatchColor=RGB(51, 56, 66))
text_tag = TextTag(Location=compas_draw_2, Text=python_3_script.node_keys, Colour=swatch)
dot_display = DotDisplay(Point=compas_draw_2, Colour=swatch, Size=Slider(0.1, range=0..0.1))

# ----
# Transform points
number_slider = Slider(5, range=0..10)
brep_2 = Brep(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)
python_3_script_3 = Python3Script(graph=python_3_script_2.node_graph, interior_brep=brep_2, move=Toggle(True), sub_iterations=number_slider)  # -> out, edges, edges0, nodes, idx, node_graph, a, b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; inputs interior_brep: Brep, sub_iterations: Int32
# ---------- python_3_script_3: Python ----------
import os, sys, importlib
gh_dir = os.path.dirname(ghenv.Component.OnPingDocument().FilePath)
if gh_dir not in sys.path:
    sys.path.insert(0, gh_dir)

### -----------------------------
## IMPORT
### -----------------------------
import edge_classifier
import transformer
import nodegraph

importlib.reload(edge_classifier)
importlib.reload(transformer)
importlib.reload(nodegraph)

from edge_classifier import classify_single_segment
from transformer import edge_in_brep
from copy import deepcopy
from compas.geometry import Vector, Line, Point, centroid_points

### -----------------------------
## INITIALIZATION
### -----------------------------
ng = deepcopy(graph)

### -----------------------------
## EXECUTION
### -----------------------------
if move:
    intersecting_edges, is_clear, moved_points, pt = edge_in_brep(ng, interior_brep, sub_iterations=sub_iterations, debug=True)

target_pairs = [[298, 290], [296, 286], [297, 287], [299, 291]]
movement_data = [[graph.node_attribute(pair[0], "point"), ng.edge_line(pair).vector, pair[0]] for pair in target_pairs]
# move = [ng.node_attribute(data[2], "point", data[0] + data[1]/3) for data in movement_data]

move = []
for data in movement_data:
    key = data[2]
    moved_pt = data[0] + data[1]/3
    move.append(ng.node_attribute(key, "point", moved_pt))
    ng.node_attributes(key, names=["x", "y", "z"], values=[moved_pt.x, moved_pt.y, moved_pt.z])



### -----------------------------
## OUTPUTS
### -----------------------------
edges = ng.edge_lines_by_group(0) + ng.edge_lines_by_group(1)
edges0 = ng.edge_lines_by_group(1)
nodes = ng.node_points()
idx = list(ng.nodes())
node_graph = ng

a = ng.points_by_mobility("fixed")     # supports + inset corners
b = ng.points_by_mobility("z_free")    # apex nodes
c = ng.points_by_mobility("yz_free")  # added via add_segment

### -----------------------------
## PRINT
### -----------------------------
# print(is_clear)
# ---------- end python_3_script_3 ----------

compas_draw_3 = COMPASDraw(cg=python_3_script_2.edges)  # -> rg; same code as compas_draw

compas_draw_4 = COMPASDraw(cg=python_3_script_3.moved_points)  # -> rg; same code as compas_draw
dot_display_2 = DotDisplay(Point=compas_draw_4, Colour=ColourSwatch(SwatchColor=RGB(255, 255, 255)), Size=Slider(0.2, range=-0.5..0.5))

compas_draw_5 = COMPASDraw(cg=python_3_script_3.nodes)  # -> rg; same code as compas_draw
draw = COMPASDraw(cg=python_3_script_3.edges0)  # -> rg; same code as compas_draw

# ----
# Classfiy Edges
toggle = BooleanToggle(True)
panel_2 = Panel("""0
1""")
python_3_script_4 = Python3Script(graph=python_3_script_3.node_graph, sub=toggle, sub_ids=panel_2)  # -> out, primary, secondary, tertiary, special, graph_out, a; inputs sub: Boolean, sub_ids: list of Int32
# ---------- python_3_script_4: Python ----------
import os, sys, importlib
gh_dir = os.path.dirname(ghenv.Component.OnPingDocument().FilePath)
if gh_dir not in sys.path:
    sys.path.insert(0, gh_dir)

import edge_classifier_v2
importlib.reload(edge_classifier_v2)
from edge_classifier_v2 import combine_graphs, classify_edges_by_Michael

from Grasshopper import DataTree
from Grasshopper.Kernel.Data import GH_Path


subgraphs = classify_edges_by_Michael(graph, seg_x=8, seg_y=2)

primary = DataTree[object]()
secondary = DataTree[object]()
tertiary = DataTree[object]()
special = DataTree[object]()

for i, sg in enumerate(subgraphs):
    path = GH_Path(i)

    for node in sg.nodes():
        attrs_n = sg.node_attributes(node)
        # print (attrs_n)
    
    for edge in sg.edges():
        attrs_e = sg.edge_attributes(edge)
        # print (attrs_e)
        
        hie = "hierarchy"
        if hie not in attrs_e:
            continue
        
        if sub and i not in sub_ids:
            continue

        if attrs_e[hie] == "primary":
            primary.Add(sg.edge_line(edge), path)
        elif attrs_e[hie] == "secondary":
            secondary.Add(sg.edge_line(edge), path)
        elif attrs_e[hie] == "tertiary":
            tertiary.Add(sg.edge_line(edge), path)
        elif attrs_e[hie] == "special":
            special.Add(sg.edge_line(edge), path)
    

sgs = []
if not sub:
    sub_ids = list(range(len(subgraphs)))
    
for i in sub_ids:
    sgs.append(subgraphs[i])
graph_out = combine_graphs(sgs)
# ---------- end python_3_script_4 ----------
draw_2 = COMPASDraw(cg=python_3_script_4.primary)  # -> rg; same code as compas_draw
draw_3 = COMPASDraw(cg=python_3_script_4.secondary)  # -> rg; same code as compas_draw
draw_4 = COMPASDraw(cg=python_3_script_4.tertiary)  # -> rg; same code as compas_draw
draw_5 = COMPASDraw(cg=python_3_script_4.special)  # -> rg; same code as compas_draw
custom_preview_lineweights_2 = CustomPreviewLineweights(Geometry=draw_4, Shader=ColourSwatch(SwatchColor=RGB(189, 172, 66)), Thickness="3", Absolute=False)
custom_preview_lineweights_3 = CustomPreviewLineweights(Geometry=draw_2, Shader=ColourSwatch(SwatchColor=RGB(137, 50, 143)), Thickness="8", Absolute=False)
custom_preview_lineweights_4 = CustomPreviewLineweights(Geometry=draw_3, Shader=ColourSwatch(SwatchColor=RGB(50, 143, 103)), Thickness="6", Absolute=False)
custom_preview_lineweights_5 = CustomPreviewLineweights(Geometry=draw_5, Shader=ColourSwatch(SwatchColor=RGB(78, 207, 222)), Thickness="3", Absolute=False)

tag = TextTag(Location=compas_draw_5, Text=python_3_script_3.idx)

# ----
# Snap leaf points and create shoes
brep_3 = Brep(brep)
python_3_script_5 = Python3Script(graph=python_3_script_4.graph_out, brep=brep_3)  # -> out, graph_out, leaf_lines, leaf_points, shoe_lines, other_lines; inputs brep: Brep
# ---------- python_3_script_5: Python ----------
import os, sys, importlib
gh_dir = os.path.dirname(ghenv.Component.OnPingDocument().FilePath)
if gh_dir not in sys.path:
    sys.path.insert(0, gh_dir)


import leaf_solver
importlib.reload(leaf_solver)
from leaf_solver import create_shoes_and_shift_leaves
from copy import deepcopy



ng = deepcopy(graph)

result = create_shoes_and_shift_leaves(ng, brep, min_length=0.30, min_angle=15)


########--------Output Data---------#########
leaf_lines = [ng.edge_line(edge) for edge in ng.edges() if ng.is_leaf_edge(edge)]
other_lines = [ng.edge_line(edge) for edge in ng.edges() if not ng.is_leaf_edge(edge)]

leaf_points = result["leaf_points"]
shoe_lines = result["shoe_lines"]

graph_out = ng

#############-----------Print----------##########
group = result["group_dict"]
print (group)
# ---------- end python_3_script_5 ----------
draw_6 = COMPASDraw(cg=python_3_script_5.shoe_lines)  # -> rg; same code as compas_draw
draw_7 = COMPASDraw(cg=python_3_script_5.other_lines)  # -> rg; same code as compas_draw
draw_8 = COMPASDraw(cg=python_3_script_5.leaf_points)  # -> rg; same code as compas_draw
draw_9 = COMPASDraw(cg=python_3_script_5.leaf_lines)  # -> rg; same code as compas_draw

# ----
# Run reciprocal
python_3_script_6 = Python3Script(graph=python_3_script_5.graph_out)  # -> out, primary, secondary, double, subgraph
# ---------- python_3_script_6: Python ----------
import os, sys, importlib
gh_dir = os.path.dirname(ghenv.Component.OnPingDocument().FilePath)
if gh_dir not in sys.path:
    sys.path.insert(0, gh_dir)

import edge_classifier
import config
import reciprocal

importlib.reload(config)
importlib.reload(edge_classifier)
importlib.reload(reciprocal)

from edge_classifier import create_subgraphs,classify_subgraph_edges,classify_edges_by_support_direction
from reciprocal import reciprocal_from_subgraph, reciprocal_width_from_subgraph

from compas.geometry import Line

# classify_edges_by_support_direction(graph, parallel_tol=0.9)
# subgraphs = create_subgraphs(graph, seg_x=8, seg_y=2) # could change double divisions here
# sup_pts = graph.get_support_points()

# # Then fetch any segment on demand
# def get_segment(idx):
#     sg_data = subgraphs[idx % len(subgraphs)]
#     return classify_subgraph_edges(sg_data, sup_pts, near_threshold=1.0, parallel_tol=0.9)

# # Use it
# primary, secondary, double, near_sup, subgraph = get_segment(segment_id)
# print(graph[1])
result = reciprocal_width_from_subgraph(graph, engage_len=.11, debug = True)
print(result)
primary = result["shifted_lines"]
secondary = result["secondary_lines"]
# ---------- end python_3_script_6 ----------
compas_draw_6 = COMPASDraw(cg=python_3_script_6.secondary)  # -> rg; same code as compas_draw
compas_draw_7 = COMPASDraw(cg=python_3_script_6.double)  # -> rg; same code as compas_draw
compas_draw_8 = COMPASDraw(cg=python_3_script_6.primary)  # -> rg; same code as compas_draw
py3_2 = Python3Script(x=python_3_script_6.primary)  # -> out, geom; inputs x: list; disabled
# ---------- py3_2: Python ----------
import compas
from compas.scene import Scene
from compas_timber.model import TimberModel
from compas_timber.elements import Beam
from compas_timber.connections import TStepJoint
# from compas_timber.connections import TopologyRules
from compas_timber.connections.solver import ConnectionSolver
from compas_timber.connections import ConnectionSolver
from compas.tolerance import TOL, Tolerance


model = TimberModel(Tolerance(unit='MM'))

for l in x:
    b = Beam.from_centerline(l, 0.14, 0.24)
    model.add_element(b)

rules = []
# rules.append(TopologyRules(JointTopology.TOPO_T, TStepJoint))

solver = ConnectionSolver()
pairs = solver.find_intersecting_pairs(model.beams)
for pair in pairs:
    topo = solver.find_topology(*pair)
    if topo.topology == 3:
        TStepJoint.create(model, topo.beam_a, topo.beam_b)

model.process_joinery()

scene = Scene()
for b in model.beams:
    scene.add(b.geometry)
geom = scene.draw()
# ---------- end py3_2 ----------

py3_3 = Python3Script(subgraph=python_3_script_5.graph_out)  # -> out, a, b, c, d, e
# ---------- py3_3: Python ----------
import os, sys, importlib
gh_dir = os.path.dirname(ghenv.Component.OnPingDocument().FilePath)
if gh_dir not in sys.path:
    sys.path.insert(0, gh_dir)


import reciprocal_staged
import shifting_solver

importlib.reload(reciprocal_staged)
importlib.reload(shifting_solver)

stage_result = reciprocal_staged.reciprocal_staged_primary_from_subgraph(subgraph)
g = stage_result["graph"]   # this should be a NodeGraph, not None

shift_result = shifting_solver.shift_level0_secondary_to_primary(g)

a = stage_result["viz"]["stage_1_shifted_lines"]
b = stage_result["viz"]["stage_2_shifted_lines"]
c = shift_result["shifted_secondary_lines"]
d = shift_result["untouched_secondary_lines"]
e = shift_result["all_primary_lines"]
# ---------- end py3_3 ----------
py3_4 = Python3Script(subgraph=python_3_script_5.graph_out)  # -> out, a, b, c, d, e
# ---------- py3_4: Python ----------
import os, sys, importlib
gh_dir = os.path.dirname(ghenv.Component.OnPingDocument().FilePath)
if gh_dir not in sys.path:
    sys.path.insert(0, gh_dir)


import importlib
import reciprocal_staged
import line_constraints


importlib.reload(reciprocal_staged)
importlib.reload(line_constraints)

stage = reciprocal_staged.reciprocal_staged_primary_from_subgraph(subgraph)
g = stage["graph"]

sec = line_constraints.regenerate_level0_secondary_from_primary_t(g, t=0.2)

a = stage["viz"]["primary_shifted_lines"]        # shifted primaries
b = sec["generated_secondary_lines"]             # new level-0 secondary lines from primaries
c = sec["untouched_secondary_lines"]             # secondary lines not resolved by rule
# ---------- end py3_4 ----------
py3_5 = Python3Script(subgraph=python_3_script_5.graph_out)  # -> out, a, b, c, d, e, f, s1
# ---------- py3_5: Python ----------
import os, sys, importlib
gh_dir = os.path.dirname(ghenv.Component.OnPingDocument().FilePath)
if gh_dir not in sys.path:
    sys.path.insert(0, gh_dir)


import importlib
import reciprocal_staged
import line_constraints


importlib.reload(reciprocal_staged)
importlib.reload(line_constraints)

stage = reciprocal_staged.reciprocal_staged_primary_from_subgraph(subgraph)  # orthogonal-first setup
g = stage["graph"]

# Option 2
diag_dep = line_constraints.regenerate_primary_diagonals_from_orthogonal_nodes(
    g, t=0.1, level=1, apply_all_in_level=True, required_diagonal_count=2,
    required_orthogonal_count=3
)
print(diag_dep["processed_nodes"])

# 3) promote generated diagonal geometry -> line (so reciprocal reads it)
for e in g.edges():
    if g.edge_attribute(e, "hierarchy") == "primary" and g.edge_attribute(e, "e_category") in ("default_diagonal", "moved_diagonal"):
        gl = g.edge_attribute(e, "generated_line")
        if gl is not None:
            g.edge_attribute(e, "line", gl)
            g.edge_attribute(e, "shifted_lines", gl)

# 4) reciprocal only on diagonals
diag_rec = reciprocal_staged.reciprocal_diagonal_primary_from_subgraph(g)
sec = line_constraints.regenerate_level0_secondary_from_primary_t(g, t=0.2)
print(sec["untouched_secondary_lines"])
# visualize
a = stage["viz"]["stage_1_shifted_lines"]         # orthogonal reciprocal result
b = diag_dep["generated_diagonal_lines"]          # diagonals linked to orthogonals
c = diag_dep["host_orthogonal_lines"]
d = diag_rec["shifted_diagonal_lines"] 

e = sec["generated_secondary_lines"]             # new level-0 secondary lines from primaries
f = sec["untouched_secondary_lines"] 



processed = diag_dep["processed_nodes"]
for n in processed:
    pt = g.node_attribute(n, "point")
    lvl = g.node_attribute(n, "level")
    print("node:", n, "level:", lvl, "z:", round(pt.z, 3))


for n in g.nodes():
    egs = list(g.node_edges(n))
    has_ortho = any(
        g.edge_attribute(e, "hierarchy") == "primary" and
        g.edge_attribute(e, "e_category") == "orthogonal"
        for e in egs
    )
    has_diag = any(
        g.edge_attribute(e, "hierarchy") == "primary" and
        g.edge_attribute(e, "e_category") in ("default_diagonal", "moved_diagonal")
        for e in egs
    )
    if has_ortho and has_diag:
        lvl = g.node_attribute(n, "level")
        pt = g.node_attribute(n, "point")
        print("candidate node:", n, "level:", lvl, "z:", round(pt.z, 3))


sec_l1 = line_constraints.get_secondary_lines_by_level(g, level=1, use_generated=True)
s1 = sec_l1["lines"]

sec0 = line_constraints.regenerate_level0_secondary_from_primary_t(g, t=0.8)
print(sec0["info"])
# ---------- end py3_5 ----------
py3_6 = Python3Script(subgraph=python_3_script_5.graph_out)  # -> out, a, b, c, d, out_sec0, t_gen, t_un, s_gen
# ---------- py3_6: Python ----------
import os
import sys
import importlib

# make local GH folder importable
gh_dir = os.path.dirname(ghenv.Component.OnPingDocument().FilePath)
if gh_dir not in sys.path:
    sys.path.insert(0, gh_dir)

import reciprocal_staged
import line_constraints

importlib.reload(reciprocal_staged)
importlib.reload(line_constraints)

# 1) staged reciprocal (orthogonal first)
stage = reciprocal_staged.reciprocal_staged_primary_from_subgraph(subgraph)
g = stage["graph"]

# 2) constrain primary diagonals from orthogonal at level 1
diag_dep = line_constraints.regenerate_primary_diagonals_from_orthogonal_nodes(
    g,
    t=0.1,
    level=1,
    apply_all_in_level=True,
    required_diagonal_count=2,
    required_orthogonal_count=3,
)
#print("processed_nodes:", diag_dep["processed_nodes"])

# 3) commit constrained diagonals into active line geometry
line_constraints.commit_generated_lines(
    g,
    hierarchy_filter="primary",
    category_filter=("default_diagonal", "moved_diagonal"),
)

# 4) reciprocal only on diagonals
diag_rec = reciprocal_staged.reciprocal_diagonal_primary_from_subgraph(g)
g = diag_rec["graph"]

# 5) constrain level-0 secondary from primary
sec0 = line_constraints.regenerate_level0_secondary_from_primary_t(g, t=0.2)
#print("sec0 info:", sec0["info"])


# outputs for GH preview
a = stage["viz"]["stage_1_shifted_lines"]      # orthogonal reciprocal
b = diag_dep["generated_diagonal_lines"]       # constrained diagonals
c = diag_dep["host_orthogonal_lines"]          # host orthogonal lines
d = diag_rec["shifted_diagonal_lines"]         # diagonal reciprocal
out_sec0 = sec0["generated_secondary_lines"]   # use this as GH output

ter_dep = line_constraints.regenerate_tertiary_01_from_neighbor_hosts(
    g,
    t_level0=0.25,
    t_level1=0.25,
    host_hierarchy="primary",
    host_categories=("orthogonal", "default_diagonal", "moved_diagonal"),
    host_level0_pair=(0,1),
    host_level1_pair=(1,2),
    host_idx_level0=0,
    host_idx_level1=1,
    debug=True,
)

print(ter_dep["host_debug"])


line_constraints.commit_generated_lines(g, hierarchy_filter="tertiary")


t_gen = ter_dep["generated_lines"]
t_un = ter_dep["untouched_lines"]
#print(ter_dep["info"])


sp = line_constraints.regenerate_special_from_host_pair(
    g,
    t_start=0.15,
    t_end=0.15,
    host_hierarchy="primary",
    host_categories=("orthogonal", "default_diagonal", "moved_diagonal"),
    host_pair=(2, 3),
)

# optional commit
line_constraints.commit_generated_lines(g, hierarchy_filter="special")

# visualize
s_gen = sp["generated_lines"]
print(sp["info"])


from collections import Counter

special_edges = [edge for edge in g.edges() if g.edge_attribute(edge, "hierarchy") == "special"]

print("special count:", len(special_edges))

pairs = []
for edge in special_edges:
    u, v = edge
    lu = g.node_attribute(u, "level")
    lv = g.node_attribute(v, "level")
    pu = g.node_attribute(u, "point")
    pv = g.node_attribute(v, "point")
    pairs.append(tuple(sorted((lu, lv))))

    has_gen = g.edge_attribute(edge, "generated_line") is not None
    has_shift = g.edge_attribute(edge, "shifted_lines") is not None
    has_line = g.edge_attribute(edge, "line") is not None
    cat = g.edge_attribute(edge, "e_category")

    print(
        "edge:", edge,
        "| levels:", (lu, lv),
        "| category:", cat,
        "| gen/shift/line:", (has_gen, has_shift, has_line),
        "| u_pt:", (round(pu.x, 3), round(pu.y, 3), round(pu.z, 3)),
        "| v_pt:", (round(pv.x, 3), round(pv.y, 3), round(pv.z, 3)),
    )

print("special level pairs:", Counter(pairs))
# ---------- end py3_6 ----------
py3_7 = Python3Script(subgraph=python_3_script_5.graph_out)  # -> out, a, b, c, d, e, f
# ---------- py3_7: Python ----------
import os
import sys
import importlib
from collections import Counter

# -----------------------------------------------------------------------------
# Setup
# -----------------------------------------------------------------------------
gh_dir = os.path.dirname(ghenv.Component.OnPingDocument().FilePath)
if gh_dir not in sys.path:
    sys.path.insert(0, gh_dir)

import reciprocal_staged
import line_constraints

importlib.reload(reciprocal_staged)
importlib.reload(line_constraints)

DEBUG = False

# -----------------------------------------------------------------------------
# 1) Reciprocal stage: orthogonal first
# -----------------------------------------------------------------------------
stage = reciprocal_staged.reciprocal_staged_primary_from_subgraph(subgraph)
g = stage["graph"]

# -----------------------------------------------------------------------------
# 2) Constrain primary diagonals from orthogonal (level 1)
# -----------------------------------------------------------------------------
diag_dep = line_constraints.regenerate_primary_diagonals_from_orthogonal_nodes(
    g,
    t=0.1,
    level=1,
    apply_all_in_level=True,
    required_diagonal_count=2,
    required_orthogonal_count=3,
)

line_constraints.commit_generated_lines(
    g,
    hierarchy_filter="primary",
    category_filter=("default_diagonal", "moved_diagonal"),
)

# -----------------------------------------------------------------------------
# 3) Reciprocal stage: diagonals only
# -----------------------------------------------------------------------------
diag_rec = reciprocal_staged.reciprocal_diagonal_primary_from_subgraph(g)
g = diag_rec["graph"]

# -----------------------------------------------------------------------------
# 4) Constrain secondary (level 0)
# -----------------------------------------------------------------------------
sec0 = line_constraints.regenerate_level0_secondary_from_primary_t(g, t=0.2)

# -----------------------------------------------------------------------------
# 5) Constrain tertiary (0-1) from host pairs
# -----------------------------------------------------------------------------
ter_dep = line_constraints.regenerate_tertiary_01_from_neighbor_hosts(
    g,
    t_level0=0.25,
    t_level1=0.25,
    host_hierarchy="primary",
    host_categories=("orthogonal", "default_diagonal", "moved_diagonal"),
    host_level0_pair=(0, 1),
    host_level1_pair=(1, 2),
    host_idx_level0=0,
    host_idx_level1=1,
    debug=DEBUG,
)
line_constraints.commit_generated_lines(g, hierarchy_filter="tertiary")

# -----------------------------------------------------------------------------
# 6) Constrain special
# -----------------------------------------------------------------------------
sp = line_constraints.regenerate_special_from_host_pair(
    g,
    t_start=0.15,
    t_end=0.15,
    host_hierarchy="primary",
    host_categories=("orthogonal", "default_diagonal", "moved_diagonal"),
    host_pair=(2, 3),
)
line_constraints.commit_generated_lines(g, hierarchy_filter="special")

# -----------------------------------------------------------------------------
# GH outputs
# -----------------------------------------------------------------------------
a = stage["viz"]["stage_1_shifted_lines"]      # orthogonal reciprocal
b = diag_dep["generated_diagonal_lines"]       # constrained diagonals
c = diag_dep["host_orthogonal_lines"]          # host orthogonals
d = diag_rec["shifted_diagonal_lines"]         # diagonal reciprocal
e = sec0["generated_secondary_lines"]          # constrained secondary level 0
f = ter_dep["generated_lines"]                 # constrained tertiary
g_out = g                                      # final graph

# -----------------------------------------------------------------------------
# Optional debug
# -----------------------------------------------------------------------------
if DEBUG:
    print("tertiary host debug:")
    print(ter_dep["host_debug"])
    print("special info:", sp["info"])

    special_edges = [edge for edge in g.edges() if g.edge_attribute(edge, "hierarchy") == "special"]
    print("special count:", len(special_edges))

    pairs = []
    for edge in special_edges:
        u, v = edge
        lu = g.node_attribute(u, "level")
        lv = g.node_attribute(v, "level")
        pairs.append(tuple(sorted((lu, lv))))
        print("edge:", edge, "| levels:", (lu, lv), "| category:", g.edge_attribute(edge, "e_category"))

    print("special level pairs:", Counter(pairs))
# ---------- end py3_7 ----------
draw_10 = COMPASDraw(cg=py3_7.b)  # -> rg; same code as compas_draw
draw_11 = COMPASDraw(cg=py3_7.c)  # -> rg; same code as compas_draw
draw_12 = COMPASDraw(cg=py3_3.c)  # -> rg; same code as compas_draw
draw_13 = COMPASDraw(cg=py3_3.e)  # -> rg; same code as compas_draw
draw_14 = COMPASDraw(cg=py3_3.a)  # -> rg; same code as compas_draw
draw_15 = COMPASDraw(cg=py3_3.b)  # -> rg; same code as compas_draw
draw_16 = COMPASDraw(cg=py3_3.d)  # -> rg; same code as compas_draw
draw_17 = COMPASDraw(cg=py3_4.e)  # -> rg; same code as compas_draw
draw_18 = COMPASDraw(cg=py3_4.d)  # -> rg; same code as compas_draw
draw_19 = COMPASDraw(cg=py3_4.c)  # -> rg; same code as compas_draw
draw_20 = COMPASDraw(cg=py3_5.d)  # -> rg; same code as compas_draw
draw_21 = COMPASDraw(cg=py3_4.b)  # -> rg; same code as compas_draw
draw_22 = COMPASDraw(cg=py3_5.f)  # -> rg; same code as compas_draw
draw_23 = COMPASDraw(cg=py3_4.a)  # -> rg; same code as compas_draw
draw_24 = COMPASDraw(cg=py3_5.a)  # -> rg; same code as compas_draw
py3_8 = Python3Script()  # -> out, a; unedited script template
draw_25 = COMPASDraw(cg=py3_6.a)  # -> rg; same code as compas_draw
draw_26 = COMPASDraw(cg=py3_7.a)  # -> rg; same code as compas_draw
draw_27 = COMPASDraw(cg=py3_7.d)  # -> rg; same code as compas_draw
draw_28 = COMPASDraw(cg=py3_7.e)  # -> rg; same code as compas_draw
draw_29 = COMPASDraw(cg=py3_7.f)  # -> rg; same code as compas_draw
draw_30 = COMPASDraw(cg=py3_6.s_gen)  # -> rg; same code as compas_draw
draw_31 = COMPASDraw(cg=py3_6.d)  # -> rg; same code as compas_draw
draw_32 = COMPASDraw(cg=py3_5.e)  # -> rg; same code as compas_draw
draw_33 = COMPASDraw(cg=py3_5.b)  # -> rg; same code as compas_draw
draw_34 = COMPASDraw(cg=py3_5.c)  # -> rg; same code as compas_draw
draw_35 = COMPASDraw(cg=py3_6.out_sec0)  # -> rg; same code as compas_draw
draw_36 = COMPASDraw(cg=py3_6.t_un)  # -> rg; same code as compas_draw
draw_37 = COMPASDraw(cg=py3_6.t_gen)  # -> rg; same code as compas_draw
