# Grasshopper definition line_model_v5.gh (Grasshopper 1.0.8)
# plug-ins: Human

py3 = Python3Script(l=Slider(5, range=0..10), coeff_h=Slider(0.43, range=0..1))  # -> out, D_heigts; inputs l: Int32, coeff_h: Double
# ---------- py3: Python ----------
import Rhino.Geometry as rg
import math
from ghpythonlib.treehelpers import list_to_tree, tree_to_list


def expo_num(coeff):
    max_heigth = 1
    h_coeficient = []
    for n in range(l):
        y = coeff ** (n*(-1)) # number 2 can be change so the exponential changes
        h_coeficient.append(abs(y - 1))
    heigts = []
    print(h_coeficient)
    for n in h_coeficient:
        param = n/h_coeficient[-1]
        r = max_heigth * param
        h = r - max_heigth
        # heigts.append(round(r, 1))
        heigts.append(r)
    D = heigts
    return D

D_heigts = expo_num(coeff_h)
# ---------- end py3 ----------
panel = Panel(py3.D_heigts)

# ----
# * Params
height = Panel("5.12")
height_2 = Panel("9.12")
merge = Merge(
    Data1="0",
    Data2=Slider(0.705, range=0.001..1),
    Data3=Slider(1.574, range=1.001..3),
    Data4=Slider(3.404, range=3.001..5),
    Data5=height_2)
merge_2 = Merge(
    Data1="0",
    Data2=Slider(0.917, range=0.001..1),
    Data3=Slider(1.013, range=0.701..1.5),
    Data4=Slider(2.277, range=1.501..3),
    Data5=height)
bnd = Bounds(Numbers=merge)
bnd_2 = Bounds(Numbers=merge_2)
remap = RemapNumbers(Value=merge, Source=bnd, Target=Domain(0, 1))  # -> Mapped, Clipped
remap_2 = RemapNumbers(Value=merge_2, Source=bnd_2, Target=Domain(0, 1))  # -> Mapped, Clipped
entwine = Entwine(Branch00=remap.Mapped, Branch01=remap_2.Mapped, FlattenInputs=True)  # -> simplify(Result)

py3_2 = Python3Script(l=Slider(5, range=0..10), coeff_h=Slider(0.43, range=0..1))  # -> out, D_heigts; inputs l: Int32, coeff_h: Double; same code as py3
panel_2 = Panel(py3_2.D_heigts)

curve = Curve(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)
brep = Brep(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)
point = Point([Point(163.54, 57.72, 15.455), Point(163.54, 48.1, 15.455), Point(173.16, 48.1, 19.455), Point(173.16, 57.72, 19.455)])

# ----
# * 120mm of CLT thickness &
# 80mm of half of the shoe thickness
panel_3 = Panel("{0, 0, -0.2}")
move = Move(Geometry=brep, Motion=panel_3)  # -> Geometry, Transform

# ----
# create and manipulate graph
python_3_script = Python3Script(boundary=curve, roof_brep=move.Geometry, supports=point, z_steps=py3.D_heigts)  # -> out, ridges_tree, all_edges, graph, all_nodes, node_keys; inputs boundary: Curve, roof_brep: Brep, supports: list of Point3d, z_steps: list of Double
# ---------- python_3_script: Python ----------
import os
import sys
from compas_rhino import unload_modules
import compas
compas.PRECISION = ".3f"

gh_dir = os.path.dirname(ghenv.Component.OnPingDocument().FilePath)
sys.path.append(gh_dir)

import tree_builder
import nodegraph
import importlib

importlib.reload(nodegraph)
importlib.reload(tree_builder)


from tree_builder import build_tree_graph


# CONSTANTS #
div_x = 8
div_y = 6
num_levels = 4

inset_edge = 0.5
inset_interior = 0.5

# Build the graph (all logic is in tree_builder.py)
ng = build_tree_graph(
    boundary=boundary,
    supports=supports,
    roof_brep=roof_brep,
    div_x=div_x if div_x else 8,
    div_y=div_y if div_y else 6,
    num_levels=num_levels if num_levels else 4,
    z_steps=z_steps,
    inset_edge=inset_edge if inset_edge else 0.5,
    inset_interior=inset_interior if inset_interior else 0.4,
    reach_tol=0.05,
    debug=True
)

# Outputs
all_edges = ng.edge_lines()
graph = ng
all_nodes = ng.node_points()
node_keys = list(ng.nodes())
# ---------- end python_3_script ----------
compas_draw = COMPASDraw(cg=python_3_script.all_edges)  # -> rg
#   port cg: The COMPAS geometry or datastructure to be drawn.
#   port rg: The Rhino geometry object.
# ---------- compas_draw: Python ----------
# r: compas>=2.14.1
"""
Draws COMPAS geometry in Grasshopper.
"""

from typing import Any

import Grasshopper

from compas.scene import SceneObject


class CompasToRhinoGeometry(Grasshopper.Kernel.GH_ScriptInstance):
    def RunScript(self, cg):
        if not cg:
            return None

        return SceneObject(item=cg).draw()
# ---------- end compas_draw ----------
compas_draw_2 = COMPASDraw(cg=python_3_script.all_nodes)  # -> rg; same code as compas_draw
python_3_script_2 = Python3Script(graph=python_3_script.graph)  # -> out, edges, nodes, idx, node_graph, a, b, c
# ---------- python_3_script_2: Python ----------
from copy import deepcopy
import os
import sys

gh_dir = os.path.dirname(ghenv.Component.OnPingDocument().FilePath)
if gh_dir not in sys.path:
    sys.path.insert(0, gh_dir)

ng = deepcopy(graph)

# Delete nodes
for node_id in [288, 289]:
    if ng.has_node(node_id):
        ng.delete_node(node_id)

# Add new elements
target_pairs = [
    [286, 274, 275, True], [287, 276, 277, True], [290, 278, 279, True], [291, 280, 281, True],
    [286, 270, 271, False], [287, 272, 273, False], [290, 282, 283, False], [291, 284, 285, False],
    [246, 44, 81, False], [246, 48, 87, False], [248, 54, 91, False], [248, 58, 97, False],
    [258, 124, 161, False], [258, 128, 167, False], [260, 134, 171, False], [260, 138, 177, False],
    [249, 64, 101, False], [249, 68, 107, False], [251, 74, 111, False], [251, 78, 117, False],
    [261, 144, 181, False], [261, 148, 187, False], [263, 154, 191, False], [263, 158, 197, False],
    [286, 246], [287, 249], [290, 258], [291, 261],
    [286, 248], [287, 251], [290, 260], [291, 263],
    [296, 241], [297, 244], [298, 265], [299, 268],
    [296, 247], [297, 250], [298, 259], [299, 262],
    [296, 270], [297, 272], [298, 282], [299, 284],
    [296, 271], [297, 273], [298, 283], [299, 285],
]

ng.add_segments(target_pairs)


edges = ng.edge_lines_by_group(0) + ng.edge_lines_by_group(1)
nodes = ng.node_points()
idx = list(ng.nodes())
node_graph = ng

a = ng.points_by_mobility("fixed")     # supports + inset corners
b = ng.points_by_mobility("z_free")    # apex nodes
c = ng.points_by_mobility("yz_free")  # added via add_segment
# ---------- end python_3_script_2 ----------

custom_preview_lineweights = CustomPreviewLineweights(
    Geometry=compas_draw,
    Shader=ColourSwatch(SwatchColor=RGB(144, 209, 232)),
    Thickness=Slider(4, range=0..10),
    Absolute=False)

swatch = ColourSwatch(SwatchColor=RGB(51, 56, 66))
text_tag = TextTag(Location=compas_draw_2, Text=python_3_script.node_keys, Colour=swatch)
dot_display = DotDisplay(Point=compas_draw_2, Colour=swatch, Size=Slider(0.1, range=0..0.1))

curve_2 = Curve(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)
brep_2 = Brep(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)
point_2 = Point([Point(163.54, 57.72, 15.455), Point(163.54, 48.1, 15.455), Point(173.16, 48.1, 19.455), Point(173.16, 57.72, 19.455)])

# ----
# * 120mm of CLT thickness &
# 80mm of half of the shoe thickness
panel_4 = Panel("{0, 0, -0.2}")
move_2 = Move(Geometry=brep_2, Motion=panel_4)  # -> Geometry, Transform

# ----
# create and manipulate graph
python_3_script_3 = Python3Script(boundary=curve_2, roof_brep=move_2.Geometry, supports=point_2, z_steps=entwine)  # -> out, ridges_tree, all_edges, graph, all_nodes, node_keys; inputs boundary: Curve, roof_brep: Brep, supports: list of Point3d, z_steps: tree of Double
# ---------- python_3_script_3: Python ----------
import os
import sys
from compas_rhino import unload_modules
import compas
compas.PRECISION = ".3f"

gh_dir = os.path.dirname(ghenv.Component.OnPingDocument().FilePath)
sys.path.append(gh_dir)

import tree_builder
import nodegraph
import importlib

importlib.reload(nodegraph)
importlib.reload(tree_builder)


from tree_builder import build_tree_graph
from Grasshopper import DataTree
from Grasshopper.Kernel.Data import GH_Path

# lines_tree will be our output
lines_tree = DataTree[object]()
z_tree = []
# 1. Iterate using the Branch count
for i in range(z_steps.BranchCount):
    branch = list(z_steps.Branch(i)) 
    z_tree.append(branch)

print(type(z_tree[1]))

# CONSTANTS #
div_x = 8
div_y = 6
num_levels = 4

inset_edge = 0.5
inset_interior = 0.5

# Build the graph (all logic is in tree_builder.py)
ng = build_tree_graph(
    boundary=boundary,
    supports=supports,
    roof_brep=roof_brep,
    div_x=div_x if div_x else 8,
    div_y=div_y if div_y else 6,
    num_levels=num_levels if num_levels else 4,
    z_steps=z_tree,
    inset_edge=inset_edge if inset_edge else 0.5,
    inset_interior=inset_interior if inset_interior else 0.4,
    reach_tol=0.05,
    debug=True
)

# Outputs
all_edges = ng.edge_lines()
graph = ng
all_nodes = ng.node_points()
node_keys = list(ng.nodes())
# ---------- end python_3_script_3 ----------
compas_draw_3 = COMPASDraw(cg=python_3_script_3.all_edges)  # -> rg; same code as compas_draw
compas_draw_4 = COMPASDraw(cg=python_3_script_3.all_nodes)  # -> rg; same code as compas_draw
python_3_script_4 = Python3Script(graph=python_3_script_3.graph)  # -> out, edges, nodes, idx, node_graph, a, b, c; same code as python_3_script_2

custom_preview_lineweights_2 = CustomPreviewLineweights(
    Geometry=compas_draw_3,
    Shader=ColourSwatch(SwatchColor=RGB(144, 209, 232)),
    Thickness=Slider(4, range=0..10),
    Absolute=False)

swatch_2 = ColourSwatch(SwatchColor=RGB(51, 56, 66))
text_tag_2 = TextTag(Location=compas_draw_4, Text=python_3_script_3.node_keys, Colour=swatch_2)
dot_display_2 = DotDisplay(Point=compas_draw_4, Colour=swatch_2, Size=Slider(0.1, range=0..0.1))

# ----
# Transform points
number_slider = Slider(5, range=0..10)
brep_3 = Brep(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)
python_3_script_5 = Python3Script(graph=python_3_script_2.node_graph, interior_brep=brep_3, move=Toggle(True), sub_iterations=number_slider)  # -> out, edges, nodes, idx, node_graph, a, b, c, port, moved_points; inputs interior_brep: Brep, sub_iterations: Int32
# ---------- python_3_script_5: Python ----------
import os, sys, importlib
gh_dir = os.path.dirname(ghenv.Component.OnPingDocument().FilePath)
if gh_dir not in sys.path:
    sys.path.insert(0, gh_dir)

### -----------------------------
## IMPORT
### -----------------------------
import edge_classifier
import transformer
import nodegraph

importlib.reload(edge_classifier)
importlib.reload(transformer)
importlib.reload(nodegraph)

from edge_classifier import classify_single_segment
from transformer import edge_in_brep
from copy import deepcopy
from compas.geometry import Vector, Line, Point, centroid_points

### -----------------------------
## INITIALIZATION
### -----------------------------
ng = deepcopy(graph)

### -----------------------------
## EXECUTION
### -----------------------------
if move:
    intersecting_edges, is_clear, moved_points, pt = edge_in_brep(ng, interior_brep, sub_iterations=sub_iterations, debug=True)

target_pairs = [[298, 290], [296, 286], [297, 287], [299, 291]]
movement_data = [[graph.node_attribute(pair[0], "point"), ng.edge_line(pair).vector, pair[0]] for pair in target_pairs]
# move = [ng.node_attribute(data[2], "point", data[0] + data[1]/3) for data in movement_data]

move = []
for data in movement_data:
    key = data[2]
    moved_pt = data[0] + data[1]/3
    move.append(ng.node_attribute(key, "point", moved_pt))
    ng.node_attributes(key, names=["x", "y", "z"], values=[moved_pt.x, moved_pt.y, moved_pt.z])



### -----------------------------
## OUTPUTS
### -----------------------------
edges = ng.edge_lines_by_group(0) + ng.edge_lines_by_group(1)
nodes = ng.node_points()
idx = list(ng.nodes())
node_graph = ng

a = ng.points_by_mobility("fixed")     # supports + inset corners
b = ng.points_by_mobility("z_free")    # apex nodes
c = ng.points_by_mobility("yz_free")  # added via add_segment

### -----------------------------
## PRINT
### -----------------------------
# print(is_clear)
# ---------- end python_3_script_5 ----------

compas_draw_5 = COMPASDraw(cg=python_3_script_2.edges)  # -> rg; same code as compas_draw

compas_draw_6 = COMPASDraw(cg=python_3_script_5.moved_points)  # -> rg; same code as compas_draw
dot_display_3 = DotDisplay(Point=compas_draw_6, Colour=ColourSwatch(SwatchColor=RGB(255, 255, 255)), Size=Slider(0.2, range=-0.5..0.5))

# ----
# Transform points
number_slider_2 = Slider(1, range=0..10)
brep_4 = Brep(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)
python_3_script_6 = Python3Script(graph=python_3_script_4.node_graph, interior_brep=brep_4, move=Toggle(True), sub_iterations=number_slider_2)  # -> out, edges, nodes, idx, node_graph, a, b, c, port, moved_points; inputs interior_brep: Brep, sub_iterations: Int32; same code as python_3_script_5

compas_draw_7 = COMPASDraw(cg=python_3_script_4.edges)  # -> rg; same code as compas_draw

compas_draw_8 = COMPASDraw(cg=python_3_script_6.moved_points)  # -> rg; same code as compas_draw
dot_display_4 = DotDisplay(Point=compas_draw_8, Colour=ColourSwatch(SwatchColor=RGB(255, 255, 255)), Size=Slider(0.2, range=-0.5..0.5))

compas_draw_9 = COMPASDraw(cg=python_3_script_5.nodes)  # -> rg; same code as compas_draw
panel_5 = Panel("""0
1""")

# ----
# Classfiy Edges
toggle = BooleanToggle(True)
panel_6 = Panel("""0
1
2
3""")
python_3_script_7 = Python3Script(graph=python_3_script_6.node_graph, sub=toggle, sub_ids=panel_5)  # -> out, primary_orth, diag_00, diag_01, diag_11, diag_12, secondary, tertiary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; inputs sub: Boolean, sub_ids: list of Int32
# ---------- python_3_script_7: Python ----------
import os, sys, importlib
gh_dir = os.path.dirname(ghenv.Component.OnPingDocument().FilePath)
if gh_dir not in sys.path:
    sys.path.insert(0, gh_dir)

import edge_classifier_v4
importlib.reload(edge_classifier_v4)
from edge_classifier_v4 import combine_graphs, classify_edges

from Grasshopper import DataTree
from Grasshopper.Kernel.Data import GH_Path

# Classify subgraphs
subgraphs = classify_edges(graph, seg_x=8, seg_y=2)

# Output trees
from Grasshopper import DataTree
from Grasshopper.Kernel.Data import GH_Path

primary_orth = DataTree[object]()
secondary = DataTree[object]()
tertiary = DataTree[object]()
quaternary = DataTree[object]()
ignored = DataTree[object]()


diag_trees = {}

for i, sg in enumerate(subgraphs):
    path = GH_Path(i)

    for edge in sg.edges():
        attrs_e = sg.edge_attributes(edge)
        hie = attrs_e.get("hierarchy")
        if not hie:
            continue

        if sub and i not in sub_ids:
            continue

        line = sg.edge_line(edge)

        if hie == "primary_orthogonal":
            primary_orth.Add(line, path)

        elif hie.startswith("primary_diagonal_"):
            if hie not in diag_trees:
                diag_trees[hie] = DataTree[object]()
            diag_trees[hie].Add(line, path)

        elif hie == "secondary":
            secondary.Add(line, path)
        elif hie == "tertiary":
            tertiary.Add(line, path)
        elif hie == "quaternary":
            quaternary.Add(line, path)
        elif hie == "ignored":
            ignored.Add(line, path)

diag_00 = diag_trees.get("primary_diagonal_0_0", DataTree[object]())
diag_01 = diag_trees.get("primary_diagonal_0_1", DataTree[object]())
diag_11 = diag_trees.get("primary_diagonal_1_1", DataTree[object]())
diag_12 = diag_trees.get("primary_diagonal_1_2", DataTree[object]())

# Subgraph selection + combined output graph
sgs = []
if not sub:
    sub_ids = list(range(len(subgraphs)))

for i in sub_ids:
    sgs.append(subgraphs[i])

graph_out = combine_graphs(sgs)
# ---------- end python_3_script_7 ----------
draw = COMPASDraw(cg=python_3_script_7.quaternary)  # -> rg; same code as compas_draw
draw_2 = COMPASDraw(cg=python_3_script_7.secondary)  # -> rg; same code as compas_draw
draw_3 = COMPASDraw(cg=python_3_script_7.tertiary)  # -> rg; same code as compas_draw
draw_4 = COMPASDraw(cg=python_3_script_7.primary_orth)  # -> rg; same code as compas_draw
custom_preview_lineweights_3 = CustomPreviewLineweights(Geometry=draw, Shader=ColourSwatch(SwatchColor=RGB(231, 148, 222)), Thickness="3", Absolute=False)
custom_preview_lineweights_4 = CustomPreviewLineweights(Geometry=draw_4, Shader=ColourSwatch(SwatchColor=RGB(137, 50, 143)), Thickness="8", Absolute=False)
custom_preview_lineweights_5 = CustomPreviewLineweights(Geometry=draw_2, Shader=ColourSwatch(SwatchColor=RGB(50, 143, 103)), Thickness="6", Absolute=False)
custom_preview_lineweights_6 = CustomPreviewLineweights(Geometry=draw_3, Shader=ColourSwatch(SwatchColor=RGB(189, 172, 66)), Thickness="3", Absolute=False)

tag = TextTag(Location=compas_draw_9, Text=python_3_script_5.idx)
draw_5 = COMPASDraw(cg=python_3_script_7.ignored)  # -> rg; same code as compas_draw
draw_6 = COMPASDraw(cg=python_3_script_7.diag_00)  # -> rg; same code as compas_draw
draw_7 = COMPASDraw(cg=python_3_script_7.diag_01)  # -> rg; same code as compas_draw
draw_8 = COMPASDraw(cg=python_3_script_7.diag_12)  # -> rg; same code as compas_draw
draw_9 = COMPASDraw(cg=python_3_script_7.diag_11)  # -> rg; same code as compas_draw
custom_preview_lineweights_7 = CustomPreviewLineweights(Geometry=draw_5, Shader=ColourSwatch(SwatchColor=RGB(78, 207, 222)), Thickness="3", Absolute=False)

# ----
# Snap leaf points and create shoes
brep_5 = Brep(move.Geometry)
python_3_script_8 = Python3Script(graph=python_3_script_7.graph_out, brep=brep_5)  # -> out, graph_out, leaf_lines, leaf_points, shoe_lines, other_lines; inputs brep: Brep
# ---------- python_3_script_8: Python ----------
import os, sys, importlib
gh_dir = os.path.dirname(ghenv.Component.OnPingDocument().FilePath)
if gh_dir not in sys.path:
    sys.path.insert(0, gh_dir)


import leaf_solver
importlib.reload(leaf_solver)
from leaf_solver import create_shoes_and_shift_leaves
from copy import deepcopy



ng = deepcopy(graph)

result = create_shoes_and_shift_leaves(ng, brep, min_length=0.30, min_angle=20)


########--------Output Data---------#########
leaf_lines = [ng.edge_line(edge) for edge in ng.edges() if ng.is_leaf_edge(edge)]
other_lines = [ng.edge_line(edge) for edge in ng.edges() if not ng.is_leaf_edge(edge)]

leaf_points = result["leaf_points"]
shoe_lines = result["shoe_lines"]

graph_out = ng

#############-----------Print----------##########
group = result["group_dict"]
print (group)
# ---------- end python_3_script_8 ----------
draw_10 = COMPASDraw(cg=python_3_script_8.leaf_lines)  # -> rg; same code as compas_draw
draw_11 = COMPASDraw(cg=python_3_script_8.shoe_lines)  # -> rg; same code as compas_draw
draw_12 = COMPASDraw(cg=python_3_script_8.leaf_points)  # -> rg; same code as compas_draw
draw_13 = COMPASDraw(cg=python_3_script_8.other_lines)  # -> rg; same code as compas_draw

# ----
# Run reciprocal
python_3_script_9 = Python3Script(graph=python_3_script_8.graph_out)  # -> out, primary, secondary, double, subgraph; disabled
# ---------- python_3_script_9: Python ----------
import os, sys, importlib
gh_dir = os.path.dirname(ghenv.Component.OnPingDocument().FilePath)
if gh_dir not in sys.path:
    sys.path.insert(0, gh_dir)

import edge_classifier
import config
import reciprocal

importlib.reload(config)
importlib.reload(edge_classifier)
importlib.reload(reciprocal)

from edge_classifier import create_subgraphs,classify_subgraph_edges,classify_edges_by_support_direction
from reciprocal import reciprocal_from_subgraph, reciprocal_width_from_subgraph

from compas.geometry import Line

# classify_edges_by_support_direction(graph, parallel_tol=0.9)
# subgraphs = create_subgraphs(graph, seg_x=8, seg_y=2) # could change double divisions here
# sup_pts = graph.get_support_points()

# # Then fetch any segment on demand
# def get_segment(idx):
#     sg_data = subgraphs[idx % len(subgraphs)]
#     return classify_subgraph_edges(sg_data, sup_pts, near_threshold=1.0, parallel_tol=0.9)

# # Use it
# primary, secondary, double, near_sup, subgraph = get_segment(segment_id)
# print(graph[1])
result = reciprocal_width_from_subgraph(graph, engage_len=.11, debug = True)
print(result)
primary = result["shifted_lines"]
secondary = result["secondary_lines"]
# ---------- end python_3_script_9 ----------
compas_draw_10 = COMPASDraw(cg=python_3_script_9.primary)  # -> rg; disabled; same code as compas_draw
compas_draw_11 = COMPASDraw(cg=python_3_script_9.secondary)  # -> rg; disabled; same code as compas_draw
compas_draw_12 = COMPASDraw(cg=python_3_script_9.double)  # -> rg; disabled; same code as compas_draw
py3_3 = Python3Script(x=python_3_script_9.primary)  # -> out, geom; inputs x: list; disabled
# ---------- py3_3: Python ----------
import compas
from compas.scene import Scene
from compas_timber.model import TimberModel
from compas_timber.elements import Beam
from compas_timber.connections import TStepJoint
# from compas_timber.connections import TopologyRules
from compas_timber.connections.solver import ConnectionSolver
from compas_timber.connections import ConnectionSolver
from compas.tolerance import TOL, Tolerance


model = TimberModel(Tolerance(unit='MM'))

for l in x:
    b = Beam.from_centerline(l, 0.14, 0.24)
    model.add_element(b)

rules = []
# rules.append(TopologyRules(JointTopology.TOPO_T, TStepJoint))

solver = ConnectionSolver()
pairs = solver.find_intersecting_pairs(model.beams)
for pair in pairs:
    topo = solver.find_topology(*pair)
    if topo.topology == 3:
        TStepJoint.create(model, topo.beam_a, topo.beam_b)

model.process_joinery()

scene = Scene()
for b in model.beams:
    scene.add(b.geometry)
geom = scene.draw()
# ---------- end py3_3 ----------

py3_4 = Python3Script(subgraph=python_3_script_8.graph_out)  # -> out, a, b, c, d, e, f, h, i
# ---------- py3_4: Python ----------
import os
import sys
import importlib

# -----------------------------------------------------------------------------
# Setup
# -----------------------------------------------------------------------------
gh_dir = os.path.dirname(ghenv.Component.OnPingDocument().FilePath)
if gh_dir not in sys.path:
    sys.path.insert(0, gh_dir)

import reciprocal_staged
import line_constraints

importlib.reload(reciprocal_staged)
importlib.reload(line_constraints)

# -----------------------------------------------------------------------------
# 1) Reciprocal stage: orthogonal first
# -----------------------------------------------------------------------------
stage = reciprocal_staged.reciprocal_staged_primary_from_subgraph(subgraph)
g = stage["graph"]

# -----------------------------------------------------------------------------
# 2) Constrain primary diagonals (level 1, specific driving nodes), move up
# -----------------------------------------------------------------------------

diag_dep = line_constraints.regenerate_edges_move_one_node_vertical(
    g,
    target_hierarchy="primary",  
    target_categories=("default_diagonal", "moved_diagonal"),
    target_level_pair=None,   
    target_nodes=[246],          
    move_node_level=1,
    host_hierarchy="primary",   
    host_categories="orthogonal",
    host_level_pair=None,
    choose="up",
    prefer_on_segment=True,
    debug=True,
)
print(diag_dep["info"])

line_constraints.commit_generated_lines(
    g,
    hierarchy_filter="primary",
    category_filter=("default_diagonal", "moved_diagonal"),
)

b = diag_dep["generated_lines"]

# -----------------------------------------------------------------------------
# 2.1) Constrain primary diagonals (level 1, specific driving nodes), move up
# -----------------------------------------------------------------------------


# -----------------------------------------------------------------------------
# 3) Reciprocal stage: diagonals only
# -----------------------------------------------------------------------------
diag_rec = reciprocal_staged.reciprocal_diagonal_primary_from_subgraph(g)
g = diag_rec["graph"]

# -----------------------------------------------------------------------------
# 4) Secondary: move level-0 endpoint up
# -----------------------------------------------------------------------------
sec_shift = line_constraints.regenerate_edges_move_one_node_vertical(
    g,
    target_hierarchy="secondary",
    move_node_level=0,
    host_hierarchy="primary",
    host_categories=("orthogonal", "default_diagonal", "moved_diagonal"),
    host_level_pair=None,
    choose="up",
    prefer_on_segment=True,
    debug=True,
)
line_constraints.commit_generated_lines(g, hierarchy_filter="secondary")

# -----------------------------------------------------------------------------
# 5) Tertiary pass A: move level-0 endpoint down
# -----------------------------------------------------------------------------
ter_shift_l0 = line_constraints.regenerate_edges_move_one_node_vertical(
    g,
    target_hierarchy="tertiary",
    move_node_level=0,
    host_hierarchy="primary",
    host_categories=("orthogonal", "default_diagonal", "moved_diagonal"),
    host_level_pair=None,
    choose="down",
    prefer_on_segment=True,
    debug=True,
)
line_constraints.commit_generated_lines(g, hierarchy_filter="tertiary")

# -----------------------------------------------------------------------------
# 6) Tertiary pass B: move level-1 endpoint up (keeps previous shift)
# -----------------------------------------------------------------------------
ter_shift_l1 = line_constraints.regenerate_edges_move_one_node_vertical(
    g,
    target_hierarchy="tertiary",
    move_node_level=1,
    host_hierarchy="primary",
    host_categories=("orthogonal", "default_diagonal", "moved_diagonal"),
    host_level_pair=None,
    choose="up",
    prefer_on_segment=True,
    debug=True,
)
line_constraints.commit_generated_lines(g, hierarchy_filter="tertiary")

# -------------------------------------------------------------------------
# Quaternary pass A: move level-1 endpoint DOWN
# -------------------------------------------------------------------------
qua_shift_l1 = line_constraints.regenerate_edges_move_one_node_vertical(
    g,
    target_hierarchy="quaternary",
    target_categories=None,
    target_level_pair=(1, 2),
    target_nodes=None,
    move_node_level=1,
    host_hierarchy="primary",
    host_categories=("orthogonal", "default_diagonal", "moved_diagonal"),
    host_level_pair=None,
    choose="down",
    prefer_on_segment=True,
    debug=True,
)

line_constraints.commit_generated_lines(g, hierarchy_filter="quaternary")

# -------------------------------------------------------------------------
# Quaternary pass B: move level-2 endpoint UP (keeps pass A result)
# -------------------------------------------------------------------------
qua_shift_l2 = line_constraints.regenerate_edges_move_one_node_vertical(
    g,
    target_hierarchy="quaternary",
    target_categories=None,
    target_level_pair=(1, 2),
    target_nodes=None,
    move_node_level=2,
    host_hierarchy="primary",
    host_categories=("orthogonal", "default_diagonal", "moved_diagonal"),
    host_level_pair=None,
    choose="up",
    prefer_on_segment=True,
    debug=True,
)

line_constraints.commit_generated_lines(g, hierarchy_filter="quaternary")

# GH preview outputs


#-------------------------------------------------------------------------
# GH outputs
# -----------------------------------------------------------------------------
a = stage["viz"]["stage_1_shifted_lines"]      # orthogonal reciprocal
               
d = diag_rec["shifted_diagonal_lines"]         # diagonal reciprocal

e = sec_shift["generated_lines"]               # secondary shifted
f = ter_shift_l0["generated_lines"]            # tertiary l0 down
h = ter_shift_l1["generated_lines"]            # tertiary l1 up
i = qua_shift_l2["generated_lines"] # level-2 up


g_out = g
# ---------- end py3_4 ----------
py3_5 = Python3Script(subgraph=python_3_script_8.graph_out)  # -> out, a, b, c, d, e, f, h, i
# ---------- py3_5: Python ----------
import os
import sys
import importlib

# -----------------------------------------------------------------------------
# Setup
# -----------------------------------------------------------------------------
gh_dir = os.path.dirname(ghenv.Component.OnPingDocument().FilePath)
if gh_dir not in sys.path:
    sys.path.insert(0, gh_dir)

import reciprocal_staged
import line_constraints

importlib.reload(reciprocal_staged)
importlib.reload(line_constraints)

# -----------------------------------------------------------------------------
# 1) Reciprocal stage: orthogonal first
# -----------------------------------------------------------------------------
stage = reciprocal_staged.reciprocal_staged_primary_from_subgraph(subgraph)
g = stage["graph"]

# -----------------------------------------------------------------------------
# 2) Constrain primary diagonals (level 1, specific driving nodes), move up
# -----------------------------------------------------------------------------

diag_dep = line_constraints.regenerate_edges_move_one_node_vertical(
    g,
    target_hierarchy="primary",  
    target_categories=("default_diagonal", "moved_diagonal"),
    target_level_pair=None,   
    target_nodes=[246],          
    move_node_level=1,
    host_hierarchy="primary",   
    host_categories="orthogonal",
    host_level_pair=None,
    choose="up",
    prefer_on_segment=True,
    debug=True,
)
print(diag_dep["info"])

line_constraints.commit_generated_lines(
    g,
    hierarchy_filter="primary",
    category_filter=("default_diagonal", "moved_diagonal"),
)

b = diag_dep["generated_lines"]

# -----------------------------------------------------------------------------
# 2.1) Constrain primary diagonals (level 1, specific driving nodes), move up
# -----------------------------------------------------------------------------

diag_dep1 = line_constraints.regenerate_edges_move_one_node_vertical(
    g,
    target_hierarchy="primary",
    target_categories=("default_diagonal", "moved_diagonal"),
    target_level_pair=(1, 2),        
    target_nodes=[247],             
    move_node_level=1,
    host_hierarchy="primary",
    host_categories=("default_diagonal", "moved_diagonal"), 
    host_level_pair=(0, 1),          
    choose="up",
    prefer_on_segment=False,
    debug=True,
)


c = diag_dep1["generated_lines"]

# -----------------------------------------------------------------------------
# 3) Reciprocal stage: diagonals only
# -----------------------------------------------------------------------------
diag_rec = reciprocal_staged.reciprocal_diagonal_primary_from_subgraph(g)
g = diag_rec["graph"]

# -----------------------------------------------------------------------------
# 4) Secondary: move level-0 endpoint up
# -----------------------------------------------------------------------------
sec_shift = line_constraints.regenerate_edges_move_one_node_vertical(
    g,
    target_hierarchy="secondary",
    move_node_level=0,
    host_hierarchy="primary",
    host_categories=("orthogonal", "default_diagonal", "moved_diagonal"),
    host_level_pair=None,
    choose="up",
    prefer_on_segment=True,
    debug=True,
)
line_constraints.commit_generated_lines(g, hierarchy_filter="secondary")

# -----------------------------------------------------------------------------
# 5) Tertiary pass A: move level-0 endpoint down
# -----------------------------------------------------------------------------
ter_shift_l0 = line_constraints.regenerate_edges_move_one_node_vertical(
    g,
    target_hierarchy="tertiary",
    move_node_level=0,
    host_hierarchy="primary",
    host_categories=("orthogonal", "default_diagonal", "moved_diagonal"),
    host_level_pair=None,
    choose="down",
    prefer_on_segment=True,
    debug=True,
)
line_constraints.commit_generated_lines(g, hierarchy_filter="tertiary")

# -----------------------------------------------------------------------------
# 6) Tertiary pass B: move level-1 endpoint up (keeps previous shift)
# -----------------------------------------------------------------------------
ter_shift_l1 = line_constraints.regenerate_edges_move_one_node_vertical(
    g,
    target_hierarchy="tertiary",
    move_node_level=1,
    host_hierarchy="primary",
    host_categories=("orthogonal", "default_diagonal", "moved_diagonal"),
    host_level_pair=None,
    choose="up",
    prefer_on_segment=True,
    debug=True,
)
line_constraints.commit_generated_lines(g, hierarchy_filter="tertiary")

# -------------------------------------------------------------------------
# Quaternary pass A: move level-1 endpoint DOWN
# -------------------------------------------------------------------------
qua_shift_l1 = line_constraints.regenerate_edges_move_one_node_vertical(
    g,
    target_hierarchy="quaternary",
    target_categories=None,
    target_level_pair=(1, 2),
    target_nodes=None,
    move_node_level=1,
    host_hierarchy="primary",
    host_categories=("orthogonal", "default_diagonal", "moved_diagonal"),
    host_level_pair=None,
    choose="down",
    prefer_on_segment=True,
    debug=True,
)

line_constraints.commit_generated_lines(g, hierarchy_filter="quaternary")

# -------------------------------------------------------------------------
# Quaternary pass B: move level-2 endpoint UP (keeps pass A result)
# -------------------------------------------------------------------------
qua_shift_l2 = line_constraints.regenerate_edges_move_one_node_vertical(
    g,
    target_hierarchy="quaternary",
    target_categories=None,
    target_level_pair=(1, 2),
    target_nodes=None,
    move_node_level=2,
    host_hierarchy="primary",
    host_categories=("orthogonal", "default_diagonal", "moved_diagonal"),
    host_level_pair=None,
    choose="up",
    prefer_on_segment=True,
    debug=True,
)

line_constraints.commit_generated_lines(g, hierarchy_filter="quaternary")

# GH preview outputs


#-------------------------------------------------------------------------
# GH outputs
# -----------------------------------------------------------------------------
a = stage["viz"]["stage_1_shifted_lines"]      # orthogonal reciprocal
               
d = diag_rec["shifted_diagonal_lines"]         # diagonal reciprocal

e = sec_shift["generated_lines"]               # secondary shifted
f = ter_shift_l0["generated_lines"]            # tertiary l0 down
h = ter_shift_l1["generated_lines"]            # tertiary l1 up
i = qua_shift_l2["generated_lines"] # level-2 up


g_out = g
# ---------- end py3_5 ----------
draw_14 = COMPASDraw(cg=py3_4.b)  # -> rg; same code as compas_draw
draw_15 = COMPASDraw(cg=py3_5.b)  # -> rg; same code as compas_draw
draw_16 = COMPASDraw(cg=py3_4.c)  # -> rg; same code as compas_draw
draw_17 = COMPASDraw(cg=py3_4.f)  # -> rg; same code as compas_draw
draw_18 = COMPASDraw(cg=py3_5.c)  # -> rg; same code as compas_draw
draw_19 = COMPASDraw(cg=py3_5.f)  # -> rg; same code as compas_draw
# fix node that moved
# reciprocal if angle too short
draw_20 = COMPASDraw(cg=py3_4.a)  # -> rg; same code as compas_draw
draw_21 = COMPASDraw(cg=py3_4.d)  # -> rg; same code as compas_draw
draw_22 = COMPASDraw(cg=py3_5.a)  # -> rg; same code as compas_draw
draw_23 = COMPASDraw(cg=py3_4.h)  # -> rg; same code as compas_draw
draw_24 = COMPASDraw(cg=py3_4.e)  # -> rg; same code as compas_draw
draw_25 = COMPASDraw(cg=py3_4.i)  # -> rg; same code as compas_draw
draw_26 = COMPASDraw(cg=py3_5.d)  # -> rg; same code as compas_draw
draw_27 = COMPASDraw(cg=py3_5.h)  # -> rg; same code as compas_draw
draw_28 = COMPASDraw(cg=py3_5.e)  # -> rg; same code as compas_draw
draw_29 = COMPASDraw(cg=py3_5.i)  # -> rg; same code as compas_draw
