# Grasshopper definition line_model_v8.ghx (Grasshopper 1.0.8)
# plug-ins: RhinoCodePluginGH, Human

height = Panel("9.12")
height_2 = Panel("5.12")

# ---- group: CLT Brep
brep = Brep(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)

# ----
merge = Merge(
    Data1="0",
    Data2=Slider(0.53, range=0.001..1),
    Data3=Slider(1.528, range=1.001..3),
    Data4=Slider(2.8, range=2.001..5),
    Data5=height)
merge_2 = Merge(
    Data1="0",
    Data2=Slider(0.9, range=0.001..1),
    Data3=Slider(0.85, range=0.701..1.5),
    Data4=Slider(1.88, range=1.501..3),
    Data5=height_2)
move = Move(Geometry=brep, Motion="{0, 0, -0.2}")  # -> Geometry, Transform
bnd = Bounds(Numbers=merge_2)
bnd_2 = Bounds(Numbers=merge)
remap = RemapNumbers(Value=merge, Source=bnd_2, Target=Domain(0, 1))  # -> Mapped, Clipped
remap_2 = RemapNumbers(Value=merge_2, Source=bnd, Target=Domain(0, 1))  # -> Mapped, Clipped
entwine = Entwine(Branch00=remap.Mapped, Branch01=remap_2.Mapped, FlattenInputs=True)  # -> simplify(Result)
point = Point([Point(163.54, 57.72, 15.455), Point(163.54, 48.1, 15.455), Point(173.16, 48.1, 19.455), Point(173.16, 57.72, 19.455)])
curve = Curve(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)
create_graph = Python3Script(boundary=curve, roof_brep=move.Geometry, supports=point, z_steps=entwine)  # -> out, ridges_tree, all_edges, graph, all_nodes, node_keys; inputs boundary: Curve, roof_brep: Brep, supports: list of Point3d, z_steps: tree of Double
# ---------- create_graph: Python ----------
import os
import sys
from compas_rhino import unload_modules
import compas
compas.PRECISION = ".3f"

gh_dir = os.path.dirname(ghenv.Component.OnPingDocument().FilePath)
sys.path.append(gh_dir)

import tree_builder
import nodegraph
import importlib

importlib.reload(nodegraph)
importlib.reload(tree_builder)


from tree_builder import build_tree_graph
from Grasshopper import DataTree
from Grasshopper.Kernel.Data import GH_Path

# lines_tree will be our output
lines_tree = DataTree[object]()
z_tree = []
# 1. Iterate using the Branch count
for i in range(z_steps.BranchCount):
    branch = list(z_steps.Branch(i)) 
    z_tree.append(branch)

print(type(z_tree[1]))

# CONSTANTS #
div_x = 8
div_y = 6
num_levels = 4

inset_edge = 0.5
inset_interior = 0.5

# Build the graph (all logic is in tree_builder.py)
ng = build_tree_graph(
    boundary=boundary,
    supports=supports,
    roof_brep=roof_brep,
    div_x=div_x if div_x else 8,
    div_y=div_y if div_y else 6,
    num_levels=num_levels if num_levels else 4,
    z_steps=z_tree,
    inset_edge=inset_edge if inset_edge else 0.5,
    inset_interior=inset_interior if inset_interior else 0.4,
    reach_tol=0.05,
    debug=True
)

# Outputs
all_edges = ng.edge_lines()
graph = ng
all_nodes = ng.node_points()
node_keys = list(ng.nodes())
# ---------- end create_graph ----------
compas_draw = COMPASDraw(cg=create_graph.all_edges)  # -> rg
#   port cg: The COMPAS geometry or datastructure to be drawn.
#   port rg: The Rhino geometry object.
# ---------- compas_draw: Python ----------
# r: compas>=2.14.1
"""
Draws COMPAS geometry in Grasshopper.
"""

from typing import Any

import Grasshopper

from compas.scene import SceneObject


class CompasToRhinoGeometry(Grasshopper.Kernel.GH_ScriptInstance):
    def RunScript(self, cg):
        if not cg:
            return None

        return SceneObject(item=cg).draw()
# ---------- end compas_draw ----------

# ---- group: Visualise Edges
custom_preview_lineweights = CustomPreviewLineweights(
    Geometry=compas_draw,
    Shader=ColourSwatch(SwatchColor=RGB(144, 209, 232)),
    Thickness=Slider(4, range=0..10),
    Absolute=False)

# ----
compas_draw_2 = COMPASDraw(cg=create_graph.all_nodes)  # -> rg; same code as compas_draw

# ---- group: Visualise Nodes
swatch = ColourSwatch(SwatchColor=RGB(51, 56, 66))
text_tag = TextTag(Location=compas_draw_2, Text=create_graph.node_keys, Colour=swatch)
dot_display = DotDisplay(Point=compas_draw_2, Colour=swatch, Size=Slider(0.1, range=0..0.1))

# ----
add_orthogonal_edges = Python3Script(graph=create_graph.graph)  # -> out, edges, nodes, idx, node_graph, a, b, c
# ---------- add_orthogonal_edges: Python ----------
from copy import deepcopy
import os
import sys

gh_dir = os.path.dirname(ghenv.Component.OnPingDocument().FilePath)
if gh_dir not in sys.path:
    sys.path.insert(0, gh_dir)

ng = deepcopy(graph)

# Delete nodes
for node_id in [288, 289]:
    if ng.has_node(node_id):
        ng.delete_node(node_id)

# Add new elements
target_pairs = [
    [286, 274, 275, True], [287, 276, 277, True], [290, 278, 279, True], [291, 280, 281, True],
    [286, 270, 271, False], [287, 272, 273, False], [290, 282, 283, False], [291, 284, 285, False],
    [246, 44, 81, False], [246, 48, 87, False], [248, 54, 91, False], [248, 58, 97, False],
    [258, 124, 161, False], [258, 128, 167, False], [260, 134, 171, False], [260, 138, 177, False],
    [249, 64, 101, False], [249, 68, 107, False], [251, 74, 111, False], [251, 78, 117, False],
    [261, 144, 181, False], [261, 148, 187, False], [263, 154, 191, False], [263, 158, 197, False],
    [286, 246], [287, 249], [290, 258], [291, 261],
    [286, 248], [287, 251], [290, 260], [291, 263],
    [296, 241], [297, 244], [298, 265], [299, 268],
    [296, 247], [297, 250], [298, 259], [299, 262],
    [296, 270], [297, 272], [298, 282], [299, 284],
    [296, 271], [297, 273], [298, 283], [299, 285],
]

ng.add_segments(target_pairs)


edges = ng.edge_lines_by_group(0) + ng.edge_lines_by_group(1)
nodes = ng.node_points()
idx = list(ng.nodes())
node_graph = ng

a = ng.points_by_mobility("fixed")     # supports + inset corners
b = ng.points_by_mobility("z_free")    # apex nodes
c = ng.points_by_mobility("yz_free")  # added via add_segment
# ---------- end add_orthogonal_edges ----------
compas_draw_3 = COMPASDraw(cg=add_orthogonal_edges.edges)  # -> rg; same code as compas_draw
brep_2 = Brep(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)
adjust_points = Python3Script(graph=add_orthogonal_edges.node_graph, interior_brep=brep_2, move=Toggle(True), sub_iterations=Slider(1, range=0..10))  # -> out, edges, node_keys, nodes, idx, node_graph, moved_points; inputs interior_brep: Brep, sub_iterations: Int32
# ---------- adjust_points: Python ----------
import os, sys, importlib
gh_dir = os.path.dirname(ghenv.Component.OnPingDocument().FilePath)
if gh_dir not in sys.path:
    sys.path.insert(0, gh_dir)

### -----------------------------
## IMPORT
### -----------------------------
import edge_classifier_v5
import transformer
import nodegraph

importlib.reload(edge_classifier_v5)
importlib.reload(transformer)
importlib.reload(nodegraph)

from edge_classifier_v5 import classify_single_segment
from transformer import edge_in_brep
from copy import deepcopy
from compas.geometry import Vector, Line, Point, centroid_points

### -----------------------------
## INITIALIZATION
### -----------------------------
ng = deepcopy(graph)

### -----------------------------
## EXECUTION
### -----------------------------
if move:
    intersecting_edges, is_clear, moved_points, pt = edge_in_brep(ng, interior_brep, sub_iterations=sub_iterations, debug=True)

target_pairs = [[298, 290], [296, 286], [297, 287], [299, 291]]
movement_data = [[graph.node_attribute(pair[0], "point"), ng.edge_line(pair).vector, pair[0]] for pair in target_pairs]
move = [ng.node_attribute(data[2], "point", data[0] + data[1]/3) for data in movement_data]

move = []
for data in movement_data:
    key = data[2]
    moved_pt = data[0] + data[1]/3
    move.append(ng.node_attribute(key, "point", moved_pt))
    ng.node_attributes(key, names=["x", "y", "z"], values=[moved_pt.x, moved_pt.y, moved_pt.z])



### -----------------------------
## OUTPUTS
### -----------------------------
edges = ng.edge_lines_by_group(0) + ng.edge_lines_by_group(1)
nodes = ng.node_points()
idx = list(ng.nodes())
node_graph = ng
node_keys = list(ng.nodes())

a = ng.points_by_mobility("fixed")     # supports + inset corners
b = ng.points_by_mobility("z_free")    # apex nodes
c = ng.points_by_mobility("yz_free")  # added via add_segment

### -----------------------------
## PRINT
### -----------------------------
# print(is_clear)
# ---------- end adjust_points ----------
compas_draw_4 = COMPASDraw(cg=adjust_points.edges)  # -> rg; same code as compas_draw

# ---- group: Visualise Edges
custom_preview_lineweights_2 = CustomPreviewLineweights(
    Geometry=compas_draw_4,
    Shader=ColourSwatch(SwatchColor=RGB(144, 209, 232)),
    Thickness=Slider(4, range=0..10),
    Absolute=False)

# ----
compas_draw_5 = COMPASDraw(cg=adjust_points.nodes)  # -> rg; same code as compas_draw

# ---- group: Visualise Nodes
swatch_2 = ColourSwatch(SwatchColor=RGB(51, 56, 66))
text_tag_2 = TextTag(Location=compas_draw_5, Text=adjust_points.node_keys, Colour=swatch_2)
dot_display_2 = DotDisplay(Point=compas_draw_5, Colour=swatch_2, Size=Slider(0.1, range=0..0.1))

# ----
compas_draw_6 = COMPASDraw(cg=adjust_points.moved_points)  # -> rg; same code as compas_draw
panel = Panel("""0
1""")
panel_2 = Panel("""0
1
2
3
4
5
6
7
8
9
10
11
12
13
14
15""")
classify_edges = Python3Script(graph=adjust_points.node_graph, sub=Toggle(True), sub_ids=panel_2)  # -> out, primary_orth, diag_00, diag_01, diag_11, diag_12, secondary, tertiary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; inputs sub: Boolean, sub_ids: list of Int32
# ---------- classify_edges: Python ----------
import os, sys, importlib
gh_dir = os.path.dirname(ghenv.Component.OnPingDocument().FilePath)
if gh_dir not in sys.path:
    sys.path.insert(0, gh_dir)

import edge_classifier_v5
importlib.reload(edge_classifier_v5)
from edge_classifier_v5 import combine_graphs, classify_edges, combine_subgraphs_by_count

from Grasshopper import DataTree
from Grasshopper.Kernel.Data import GH_Path

# Classify subgraphs
subgraphs = classify_edges(graph, seg_x=8, seg_y=2)

# Output trees
from Grasshopper import DataTree
from Grasshopper.Kernel.Data import GH_Path

primary_orth = DataTree[object]()
secondary = DataTree[object]()
tertiary = DataTree[object]()
quaternary = DataTree[object]()
ignored = DataTree[object]()


diag_trees = {}

for i, sg in enumerate(subgraphs):
    path = GH_Path(i)

    for edge in sg.edges():
        attrs_e = sg.edge_attributes(edge)
        hie = attrs_e.get("hierarchy")
        if not hie:
            continue

        if sub and i not in sub_ids:
            continue

        line = sg.edge_line(edge)

        if hie == "primary_orthogonal":
            primary_orth.Add(line, path)

        elif hie.startswith("primary_diagonal_"):
            if hie not in diag_trees:
                diag_trees[hie] = DataTree[object]()
            diag_trees[hie].Add(line, path)

        elif hie == "secondary":
            secondary.Add(line, path)
        elif hie == "tertiary":
            tertiary.Add(line, path)
        elif hie == "quaternary":
            quaternary.Add(line, path)
        elif hie == "ignored":
            ignored.Add(line, path)

diag_00 = diag_trees.get("primary_diagonal_0_0", DataTree[object]())
diag_01 = diag_trees.get("primary_diagonal_0_1", DataTree[object]())
diag_11 = diag_trees.get("primary_diagonal_1_1", DataTree[object]())
diag_12 = diag_trees.get("primary_diagonal_1_2", DataTree[object]())

if not sub:
    sub_ids = list(range(len(subgraphs)))

paired_subgraphs, paired_ids = combine_subgraphs_by_count(
    subgraphs,
    group_size=2,
    selected_ids=sub_ids
)

graph_out = combine_graphs([subgraphs[i] for i in sub_ids])
# ---------- end classify_edges ----------
draw = COMPASDraw(cg=classify_edges.primary_orth)  # -> rg; same code as compas_draw
draw_2 = COMPASDraw(cg=classify_edges.diag_01)  # -> rg; same code as compas_draw
draw_3 = COMPASDraw(cg=classify_edges.diag_12)  # -> rg; same code as compas_draw
draw_4 = COMPASDraw(cg=classify_edges.tertiary)  # -> rg; same code as compas_draw
draw_5 = COMPASDraw(cg=classify_edges.ignored)  # -> rg; same code as compas_draw
draw_6 = COMPASDraw(cg=classify_edges.diag_00)  # -> rg; same code as compas_draw
draw_7 = COMPASDraw(cg=classify_edges.diag_11)  # -> rg; same code as compas_draw
draw_8 = COMPASDraw(cg=classify_edges.secondary)  # -> rg; same code as compas_draw
draw_9 = COMPASDraw(cg=classify_edges.quaternary)  # -> rg; same code as compas_draw
custom_preview_lineweights_3 = CustomPreviewLineweights(Geometry=draw, Shader=ColourSwatch(SwatchColor=RGB(137, 50, 143)), Thickness="8", Absolute=False)
custom_preview_lineweights_4 = CustomPreviewLineweights(Geometry=draw_8, Shader=ColourSwatch(SwatchColor=RGB(50, 143, 103)), Thickness="6", Absolute=False)
custom_preview_lineweights_5 = CustomPreviewLineweights(Geometry=draw_4, Shader=ColourSwatch(SwatchColor=RGB(189, 172, 66)), Thickness="3", Absolute=False)
custom_preview_lineweights_6 = CustomPreviewLineweights(Geometry=draw_9, Shader=ColourSwatch(SwatchColor=RGB(231, 148, 222)), Thickness="3", Absolute=False)
custom_preview_lineweights_7 = CustomPreviewLineweights(Geometry=draw_5, Shader=ColourSwatch(SwatchColor=RGB(78, 207, 222)), Thickness="3", Absolute=False)
data = Data(classify_edges.graph_out)
brep_3 = Brep(move.Geometry)
shift_shoes = Python3Script(graph=data, brep=brep_3)  # -> out, graph_out, leaf_lines, leaf_points, shoe_lines, other_lines; inputs brep: Brep
# ---------- shift_shoes: Python ----------
import os, sys, importlib
gh_dir = os.path.dirname(ghenv.Component.OnPingDocument().FilePath)
if gh_dir not in sys.path:
    sys.path.insert(0, gh_dir)


import leaf_solver
importlib.reload(leaf_solver)
from leaf_solver import create_shoes_and_shift_leaves
from copy import deepcopy



ng = deepcopy(graph)

result = create_shoes_and_shift_leaves(ng, brep, min_length=0.30, min_angle=20)


########--------Output Data---------#########
leaf_lines = [ng.edge_line(edge) for edge in ng.edges() if ng.is_leaf_edge(edge)]
other_lines = [ng.edge_line(edge) for edge in ng.edges() if not ng.is_leaf_edge(edge)]

leaf_points = result["leaf_points"]
shoe_lines = result["shoe_lines"]

graph_out = ng

#############-----------Print----------##########
group = result["group_dict"]
print (group)
# ---------- end shift_shoes ----------
draw_10 = COMPASDraw(cg=shift_shoes.leaf_lines)  # -> rg; same code as compas_draw
draw_11 = COMPASDraw(cg=shift_shoes.shoe_lines)  # -> rg; same code as compas_draw
draw_12 = COMPASDraw(cg=shift_shoes.leaf_points)  # -> rg; same code as compas_draw
draw_13 = COMPASDraw(cg=shift_shoes.other_lines)  # -> rg; same code as compas_draw
panel_3 = Panel("""0
1
2
3
4
5
6
7
8
9
10
11
12
13
14
15""")
panel_4 = Panel("""0
1
2
3
4
5
6
7
8
9
10
11
12
13
14
15""")
data_2 = Data(shift_shoes.graph_out)
data_3 = Data(shift_shoes.graph_out)
data_4 = Data(shift_shoes.graph_out)
reciprocal = Python3Script(graph=data_4)  # -> out, primary, secondary, double, subgraph; disabled
# ---------- reciprocal: Python ----------
import os, sys, importlib
gh_dir = os.path.dirname(ghenv.Component.OnPingDocument().FilePath)
if gh_dir not in sys.path:
    sys.path.insert(0, gh_dir)

import edge_classifier
import config
import reciprocal

importlib.reload(config)
importlib.reload(edge_classifier)
importlib.reload(reciprocal)

from edge_classifier import create_subgraphs,classify_subgraph_edges,classify_edges_by_support_direction
from reciprocal import reciprocal_from_subgraph, reciprocal_width_from_subgraph

from compas.geometry import Line

# classify_edges_by_support_direction(graph, parallel_tol=0.9)
# subgraphs = create_subgraphs(graph, seg_x=8, seg_y=2) # could change double divisions here
# sup_pts = graph.get_support_points()

# # Then fetch any segment on demand
# def get_segment(idx):
#     sg_data = subgraphs[idx % len(subgraphs)]
#     return classify_subgraph_edges(sg_data, sup_pts, near_threshold=1.0, parallel_tol=0.9)

# # Use it
# primary, secondary, double, near_sup, subgraph = get_segment(segment_id)
# print(graph[1])
result = reciprocal_width_from_subgraph(graph, engage_len=.11, debug = True)
print(result)
primary = result["shifted_lines"]
secondary = result["secondary_lines"]
# ---------- end reciprocal ----------
shift_primary = Python3Script(graph=classify_edges.graph_out, sub_ids=panel_3, y=Slider(0, range=0..1))  # -> out, a, b, c, d, e, f, h, i; inputs sub_ids: list of Int32, y: Double
# ---------- shift_primary: Python ----------
import os
import sys
import importlib

# -----------------------------------------------------------------------------
# Setup
# -----------------------------------------------------------------------------
gh_dir = os.path.dirname(ghenv.Component.OnPingDocument().FilePath)
if gh_dir not in sys.path:
    sys.path.insert(0, gh_dir)

import reciprocal_staged
import line_constraints
import edge_classifier_v5

importlib.reload(reciprocal_staged)
importlib.reload(line_constraints)
importlib.reload(edge_classifier_v5)

from edge_classifier_v5 import classify_edges

# -----------------------------------------------------------------------------
# 1) Reciprocal stage: orthogonal first
# -----------------------------------------------------------------------------
subgraphs = classify_edges(graph, seg_x=8, seg_y=2)

processed_graphs = []
stages = []
diag_deps = []

for i, sg in enumerate(subgraphs):
    if sub and i not in sub_ids:
        continue

    print("Processing subgraph", i)

    stage = reciprocal_staged.reciprocal_staged_primary_from_subgraph(sg)
    g = stage["graph"]

# -----------------------------------------------------------------------------
# 2) Constrain primary diagonals (level 1, specific driving nodes), move up
# -----------------------------------------------------------------------------

diag_dep = line_constraints.regenerate_edges(
    g,
    target_hierarchy="primary",  
    target_categories=("default_diagonal", "moved_diagonal"),
    target_level_pair=None,   
    target_nodes=[258,260,246,248,249,251,261,263],          
    move_node_level=1,
    host_hierarchy="primary",   
    host_categories="orthogonal",
    host_level_pair=None,
    choose="up",
    prefer_on_segment=True,
    debug=True,
)
print(diag_dep["info"])

line_constraints.commit_generated_lines(
    g,
    hierarchy_filter="primary",
    category_filter=("default_diagonal", "moved_diagonal"),
)

b = diag_dep["generated_lines"]


# -----------------------------------------------------------------------------
# 3) Reciprocal stage: diagonals only
# -----------------------------------------------------------------------------
diag_rec = reciprocal_staged.reciprocal_diagonal_primary_from_subgraph(g)
g = diag_rec["graph"]

# -----------------------------------------------------------------------------
# 4) Secondary: move level-0 endpoint up
# -----------------------------------------------------------------------------

#add shift allong host if node has 4 edges, if none has 6 keep the alignment)

sec_shift = line_constraints.regenerate_edges(
    g,
    target_hierarchy="secondary",
    move_node_level=0,
    host_hierarchy="primary",
    host_categories=("orthogonal", "default_diagonal", "moved_diagonal"),
    host_level_pair=None,
    choose="up",
    shift_along_host=y,
    prefer_on_segment=True,
    debug=True,
)
line_constraints.commit_generated_lines(g, hierarchy_filter="secondary")

print(sec_shift["info"])
# -----------------------------------------------------------------------------
# 5) Tertiary pass A: move level-0 endpoint down
# -----------------------------------------------------------------------------
ter_shift_l0 = line_constraints.regenerate_edges(
    g,
    target_hierarchy="tertiary",
    move_node_level=0,
    host_hierarchy="primary",
    host_categories=("orthogonal", "default_diagonal", "moved_diagonal"),
    host_level_pair=None,
    choose="down",
    prefer_on_segment=True,
    debug=True,
)
line_constraints.commit_generated_lines(g, hierarchy_filter="tertiary")

# -----------------------------------------------------------------------------
# 6) Tertiary pass B: move level-1 endpoint up (keeps previous shift)
# -----------------------------------------------------------------------------
ter_shift_l1 = line_constraints.regenerate_edges(
    g,
    target_hierarchy="tertiary",
    move_node_level=1,
    host_hierarchy="primary",
    host_categories=("orthogonal", "default_diagonal", "moved_diagonal"),
    host_level_pair=None,
    choose="up",
    prefer_on_segment=True,
    debug=True,
)
line_constraints.commit_generated_lines(g, hierarchy_filter="tertiary")

# -------------------------------------------------------------------------
# Quaternary pass A: move level-1 endpoint DOWN
# -------------------------------------------------------------------------
qua_shift_l1 = line_constraints.regenerate_edges(
    g,
    target_hierarchy="quaternary",
    target_categories=None,
    target_level_pair=(1, 2),
    target_nodes=None,
    move_node_level=1,
    host_hierarchy="primary",
    host_categories=("orthogonal", "default_diagonal", "moved_diagonal"),
    host_level_pair=None,
    choose="down",
    prefer_on_segment=True,
    debug=True,
)

line_constraints.commit_generated_lines(g, hierarchy_filter="quaternary")

# -------------------------------------------------------------------------
# Quaternary pass B: move level-2 endpoint UP (keeps pass A result)
# -------------------------------------------------------------------------
qua_shift_l2 = line_constraints.regenerate_edges(
    g,
    target_hierarchy="quaternary",
    target_categories=None,
    target_level_pair=(1, 2),
    target_nodes=None,
    move_node_level=2,
    host_hierarchy="primary",
    host_categories=("orthogonal", "default_diagonal", "moved_diagonal"),
    host_level_pair=None,
    choose="up",
    prefer_on_segment=True,
    debug=True,
)

line_constraints.commit_generated_lines(g, hierarchy_filter="quaternary")

# GH preview outputs


#-------------------------------------------------------------------------
# GH outputs
# -----------------------------------------------------------------------------
a = stage["viz"]["stage_1_shifted_lines"]      # orthogonal reciprocal
               
d = diag_rec["shifted_diagonal_lines"]         # diagonal reciprocal

e = sec_shift["generated_lines"]               # secondary shifted
f = ter_shift_l0["generated_lines"]            # tertiary l0 down
h = ter_shift_l1["generated_lines"]            # tertiary l1 up
i = qua_shift_l2["generated_lines"] # level-2 up


g_out = g
# ---------- end shift_primary ----------
shift_primary_2 = Python3Script(graph=classify_edges.graph_out, sub_ids=panel_4, y=Slider(0, range=0..1))  # -> out, a, b, c, d, e, f, h, i; inputs sub_ids: list of Int32, y: Double
# ---------- shift_primary_2: Python ----------
import os
import sys
import importlib

# -----------------------------------------------------------------------------
# Setup
# -----------------------------------------------------------------------------
gh_dir = os.path.dirname(ghenv.Component.OnPingDocument().FilePath)
if gh_dir not in sys.path:
    sys.path.insert(0, gh_dir)

import reciprocal_v5
import line_constraints
import edge_classifier_v5

importlib.reload(reciprocal_v5)
importlib.reload(line_constraints)
importlib.reload(edge_classifier_v5)

from edge_classifier_v5 import classify_edges, combine_graphs

import reciprocal_v5
importlib.reload(reciprocal_v5)


# -----------------------------------------------------------------------------
# Helpers: reciprocal per subgraph
# -----------------------------------------------------------------------------
subgraphs = classify_edges(graph, seg_x=8, seg_y=2)

processed_graphs = []
orthogonal_lines = []

for i, sg in enumerate(subgraphs):
    print("Orthogonal reciprocal: subgraph", i)

    result = reciprocal_v5.reciprocal_width_from_subgraph(
        sg,
        active_hierarchies="primary_orthogonal",
        active_categories="orthogonal",
        engage_len=0.11,
        tol=0.1,
        rotation_sign=+1,
        min_degree=2,
        iterations=10,
        debug=True,
    )

    processed_graphs.append(result["graph"])
    orthogonal_lines.extend(result["shifted_lines"])

g = combine_graphs(processed_graphs)
a = orthogonal_lines
# -----------------------------------------------------------------------------
# 2) Constrain primary diagonals on the whole graph
# -----------------------------------------------------------------------------
diag_dep = line_constraints.regenerate_edges(
    g,
    target_hierarchy="primary",
    target_categories=("default_diagonal", "moved_diagonal"),
    target_level_pair=None,
    target_nodes=[258, 260, 246, 248, 249, 251, 261, 263],
    move_node_level=1,
    host_hierarchy="primary",
    host_categories="orthogonal",
    host_level_pair=None,
    choose="up",
    prefer_on_segment=True,
    debug=True,
)
print(diag_dep["info"])

line_constraints.commit_generated_lines(
    g,
    hierarchy_filter="primary",
    category_filter=("default_diagonal", "moved_diagonal"),
)

b = diag_dep["generated_lines"]


# -----------------------------------------------------------------------------
# 3) Diagonal reciprocal stage: per subgraph again
# -----------------------------------------------------------------------------
processed_graphs = []
diagonal_lines = []

for i, sg in enumerate(subgraphs):
    print("Diagonal reciprocal: subgraph", i)

    result = reciprocal_v5.reciprocal_width_from_subgraph(
        sg,
        active_hierarchies="primary_diagonal",
        active_categories=("default_diagonal", "moved_diagonal"),
        engage_len=0.11,
        tol=0.1,
        rotation_sign=+1,
        min_degree=2,
        iterations=10,
        debug=True,
    )

    processed_graphs.append(result["graph"])
    diagonal_lines.extend(result["shifted_lines"])

g = combine_graphs(processed_graphs)
d = diagonal_lines

# -----------------------------------------------------------------------------
# 4) Secondary: move level-0 endpoint up
# -----------------------------------------------------------------------------
sec_shift = line_constraints.regenerate_edges(
    g,
    target_hierarchy="secondary",
    move_node_level=0,
    host_hierarchy="primary",
    host_categories=("orthogonal", "default_diagonal", "moved_diagonal"),
    host_level_pair=None,
    choose="up",
    shift_along_host=y,
    prefer_on_segment=True,
    debug=True,
)
line_constraints.commit_generated_lines(g, hierarchy_filter="secondary")
print(sec_shift["info"])


# -----------------------------------------------------------------------------
# 5) Tertiary pass A: move level-0 endpoint down
# -----------------------------------------------------------------------------
ter_shift_l0 = line_constraints.regenerate_edges(
    g,
    target_hierarchy="tertiary",
    move_node_level=0,
    host_hierarchy="primary",
    host_categories=("orthogonal", "default_diagonal", "moved_diagonal"),
    host_level_pair=None,
    choose="down",
    prefer_on_segment=True,
    debug=True,
)
line_constraints.commit_generated_lines(g, hierarchy_filter="tertiary")


# -----------------------------------------------------------------------------
# 6) Tertiary pass B: move level-1 endpoint up
# -----------------------------------------------------------------------------
ter_shift_l1 = line_constraints.regenerate_edges(
    g,
    target_hierarchy="tertiary",
    move_node_level=1,
    host_hierarchy="primary",
    host_categories=("orthogonal", "default_diagonal", "moved_diagonal"),
    host_level_pair=None,
    choose="up",
    prefer_on_segment=True,
    debug=True,
)
line_constraints.commit_generated_lines(g, hierarchy_filter="tertiary")


# -----------------------------------------------------------------------------
# 7) Quaternary pass A: move level-1 endpoint down
# -----------------------------------------------------------------------------
qua_shift_l1 = line_constraints.regenerate_edges(
    g,
    target_hierarchy="quaternary",
    target_categories=None,
    target_level_pair=(1, 2),
    target_nodes=None,
    move_node_level=1,
    host_hierarchy="primary",
    host_categories=("orthogonal", "default_diagonal", "moved_diagonal"),
    host_level_pair=None,
    choose="down",
    prefer_on_segment=True,
    debug=True,
)
line_constraints.commit_generated_lines(g, hierarchy_filter="quaternary")


# -----------------------------------------------------------------------------
# 8) Quaternary pass B: move level-2 endpoint up
# -----------------------------------------------------------------------------
qua_shift_l2 = line_constraints.regenerate_edges(
    g,
    target_hierarchy="quaternary",
    target_categories=None,
    target_level_pair=(1, 2),
    target_nodes=None,
    move_node_level=2,
    host_hierarchy="primary",
    host_categories=("orthogonal", "default_diagonal", "moved_diagonal"),
    host_level_pair=None,
    choose="up",
    prefer_on_segment=True,
    debug=True,
)
line_constraints.commit_generated_lines(g, hierarchy_filter="quaternary")


# -----------------------------------------------------------------------------
# GH outputs
# -----------------------------------------------------------------------------
e = sec_shift["generated_lines"]
f = ter_shift_l0["generated_lines"]
h = ter_shift_l1["generated_lines"]
i = qua_shift_l2["generated_lines"]

g_out = g
# ---------- end shift_primary_2 ----------
compas_draw_7 = COMPASDraw(cg=reciprocal.primary)  # -> rg; disabled; same code as compas_draw
compas_draw_8 = COMPASDraw(cg=reciprocal.double)  # -> rg; disabled; same code as compas_draw
draw_14 = COMPASDraw(cg=shift_primary.b)  # -> rg; same code as compas_draw
draw_15 = COMPASDraw(cg=shift_primary.f)  # -> rg; same code as compas_draw
draw_16 = COMPASDraw(cg=shift_primary.i)  # -> rg; same code as compas_draw
draw_17 = COMPASDraw(cg=shift_primary_2.b)  # -> rg; same code as compas_draw
draw_18 = COMPASDraw(cg=shift_primary_2.f)  # -> rg; same code as compas_draw
draw_19 = COMPASDraw(cg=shift_primary_2.i)  # -> rg; same code as compas_draw
draw_20 = COMPASDraw(cg=shift_primary.d)  # -> rg; same code as compas_draw
draw_21 = COMPASDraw(cg=shift_primary.e)  # -> rg; same code as compas_draw
compas_draw_9 = COMPASDraw(cg=reciprocal.secondary)  # -> rg; disabled; same code as compas_draw
draw_22 = COMPASDraw(cg=shift_primary.a)  # -> rg; same code as compas_draw
draw_23 = COMPASDraw(cg=shift_primary.h)  # -> rg; same code as compas_draw
draw_24 = COMPASDraw(cg=shift_primary_2.a)  # -> rg; same code as compas_draw
draw_25 = COMPASDraw(cg=shift_primary_2.e)  # -> rg; same code as compas_draw
draw_26 = COMPASDraw(cg=shift_primary_2.h)  # -> rg; same code as compas_draw
draw_27 = COMPASDraw(cg=shift_primary_2.d)  # -> rg; same code as compas_draw
custom_preview_lineweights_8 = CustomPreviewLineweights(Geometry=draw, Shader=ColourSwatch(SwatchColor=RGB(137, 50, 143)), Thickness="8", Absolute=False)
custom_preview_lineweights_9 = CustomPreviewLineweights(Geometry=draw_8, Shader=ColourSwatch(SwatchColor=RGB(50, 143, 103)), Thickness="6", Absolute=False)
custom_preview_lineweights_10 = CustomPreviewLineweights(Geometry=draw_4, Shader=ColourSwatch(SwatchColor=RGB(189, 172, 66)), Thickness="3", Absolute=False)
custom_preview_lineweights_11 = CustomPreviewLineweights(Geometry=draw_9, Shader=ColourSwatch(SwatchColor=RGB(231, 148, 222)), Thickness="3", Absolute=False)
custom_preview_lineweights_12 = CustomPreviewLineweights(Geometry=draw_5, Shader=ColourSwatch(SwatchColor=RGB(78, 207, 222)), Thickness="3", Absolute=False)
