# Grasshopper definition 120526_inputtimbermodel_nesting.gh (Grasshopper 1.0.8)
# plug-ins: treesloth01

# TimberModel
py3 = Python3Script()  # -> out, timber_model
# ---------- py3: Python ----------
from compas.data import json_load
import os, sys, importlib

gh_dir = os.path.dirname(ghenv.Component.OnPingDocument().FilePath)
gh_par = os.path.dirname(gh_dir)
file_path = os.path.join(gh_par, "timber_design","data", "12_05_timber_model_v3_0.json")
print(file_path)

timber_model = json_load(file_path)
timber_model.process_joinery()
# ---------- end py3 ----------
py3_2 = Python3Script(timber_model=py3.timber_model)  # -> out, a, b; inputs timber_model: list
# ---------- py3_2: Python ----------
from compas.scene import Scene
from compas.geometry import Frame, Vector, Point, Transformation, Rotation
from compas_rhino.conversions import plane_to_compas_frame

from copy import deepcopy
import math

module = timber_model

module_model = module[0]

at_frame = Frame(
    point=Point(x=5.96989, y=10.56825, z=0.36166),
    xaxis=Vector(x=0.000, y=1.000, z=0.000),
    yaxis=Vector(x=1.000, y=-0.000, z=0.000)
)

at_T = Transformation.from_frame(at_frame)


scene = Scene()

plate = module_model.plates[0]

home_T = plate.transformation_to_local()


for plate in module_model.plates:
    plate.transform(at_T * home_T)
    scene.add(plate.geometry)

for beam in module_model.beams:
    beam.transform(at_T * home_T)

    scene.add(beam.geometry)


a = scene.draw()
b = module_model
# ---------- end py3_2 ----------

python_3_script = Python3Script(final_models=py3_2.b, module_index=Slider(0, range=0..3), show_all=Toggle(True))  # -> out, geometry, element_colors; inputs final_models: list, module_index: Int32
# ---------- python_3_script: Python ----------
from System.Drawing import Color

# ============================================================
# outputs
# ============================================================
geometry = []

beam_geometry = []
plate_geometry = []

element_text = []
element_points = []
element_colors = []

selected_model = None


# ============================================================
# defaults
# ============================================================
if show_all is None:
    show_all = False

if module_index is None:
    module_index = 0


# ============================================================
# colors per module index
# ============================================================
module_colors = [
    Color.FromArgb(230, 80, 80),     # module 0 - red
    Color.FromArgb(80, 160, 230),    # module 1 - blue
    Color.FromArgb(90, 200, 120),    # module 2 - green
    Color.FromArgb(240, 180, 70)     # module 3 - orange
]


# ============================================================
# helper
# ============================================================
def get_module_color(index):
    return module_colors[index % len(module_colors)]


# ============================================================
# choose which modules to show
# ============================================================
module_ids_to_show = []

if final_models:

    if show_all:
        module_ids_to_show = list(range(len(final_models)))

    else:
        if 0 <= module_index < len(final_models):
            module_ids_to_show = [module_index]
            selected_model = final_models[module_index]


# ============================================================
# collect geometry by module index
# ============================================================
for m_id in module_ids_to_show:

    module_model = final_models[m_id]
    module_color = get_module_color(m_id)

    # ------------------------------------------------------------
    # plates
    # ------------------------------------------------------------
    for plate in module_model.plates:

        try:
            geo = plate.geometry

            geometry.append(geo)
            plate_geometry.append(geo)

            # same colour as beams in this module
            element_colors.append(module_color)

            element_text.append("module {} | plate".format(m_id))
            element_points.append(plate.frame.point)

        except Exception as e:
            print("Plate error in module {}: {}".format(m_id, e))

    # ------------------------------------------------------------
    # beams
    # ------------------------------------------------------------
    for beam in module_model.beams:
        try:
            geo = beam.geometry

            geometry.append(geo)
            beam_geometry.append(geo)

            # same colour as plate in this module
            element_colors.append(module_color)

            name = beam.name
            if name is None:
                name = "beam"

            element_text.append(
                "module {} | {} | length = {:.2f} m".format(m_id,name,beam.length))

            element_points.append(beam.centerline.midpoint)

        except Exception as e:
            print("Beam error in module {}: {}".format(m_id, e))
# ---------- end python_3_script ----------
draw = COMPASDraw(cg=python_3_script.geometry)  # -> rg
#   port cg: The COMPAS geometry or datastructure to be drawn.
#   port rg: The Rhino geometry object.
# ---------- draw: Python ----------
# r: compas>=2.14.1
"""
Draws COMPAS geometry in Grasshopper.
"""

from typing import Any

import Grasshopper

from compas.scene import SceneObject


class CompasToRhinoGeometry(Grasshopper.Kernel.GH_ScriptInstance):
    def RunScript(self, cg):
        if not cg:
            return None

        return SceneObject(item=cg).draw()
# ---------- end draw ----------
custom_preview = CustomPreview(Geometry=draw, Material=python_3_script.element_colors)

# ---- group: module height
group = Group(Geometry=py3_2.a)
bounding_box = BoundingBox(Content=group, Plane=PlaneXY(0, 0, 0))  # -> Box, Box_2
box_corners = BoxCorners(Box=bounding_box.Box)  # -> CornerA, CornerB, CornerC, CornerD, CornerE, CornerF, CornerG, CornerH
line = Line(StartPoint=box_corners.CornerB, EndPoint=box_corners.CornerF)
line_2 = Line(StartPoint=box_corners.CornerA, EndPoint=box_corners.CornerB)
line_3 = Line(StartPoint=box_corners.CornerA, EndPoint=box_corners.CornerD)
linear_dimension = LinearDimension(Line=line, PointA=box_corners.CornerA, PointB=box_corners.CornerE, Text="{0:0.000}", Size="0.5")
linear_dimension_2 = LinearDimension(Line=line_2, PointA=box_corners.CornerA, PointB=box_corners.CornerB, Text="{0:0.000}", Size="0.5")
linear_dimension_3 = LinearDimension(Line=line_3, PointA=box_corners.CornerA, PointB=box_corners.CornerD, Text="{0:0.000}", Size="0.5")

# ----
panel = Panel(py3_2.b)

# ---- group: Nesting
py3_3 = Python3Script(timber_models=py3_2.b)  # -> out, nesting_info, blank_geometry, blank_aligned, blank_length, beam_index, beam_guid, timber_650_count, cross_section; inputs timber_models: list
# ---------- py3_3: Python ----------
from compas_timber.planning import BeamNester, BeamStock
from compas.geometry import Transformation
from ghpythonlib.treehelpers import list_to_tree

models = timber_models

STOCK_LENGTH = 6.5
SPACING = 0.03

STOCK_ROW_SPACING = 1.0
MODEL_COLUMN_SPACING = 20.0

blank_geometry = []
blank_aligned = []
blank_length = []
beam_index = []
beam_guid_output = []
cross_section_output = []
nesting_info = []

timber_650_count = 0
timber_650_count_per_model = []


def split_letter(i):
    return chr(ord("a") + i)


for model_i, model in enumerate(models):

    cross_sections = []

    for beam in model.beams:
        section = (beam.width, beam.height)

        if section not in cross_sections and tuple(reversed(section)) not in cross_sections:
            cross_sections.append(section)

    stock_catalog = [
        BeamStock(
            length=STOCK_LENGTH,
            cross_section=section,
            spacing=SPACING,
        )
        for section in cross_sections
    ]

    nester = BeamNester(
        model=model,
        stock_catalog=stock_catalog,
        spacing=SPACING,
        per_group=False,
    )

    result = nester.nest(fast=False)

    nesting_info.append("========== TimberModel {} ==========".format(model_i))

    model_blank_geometry_tree = []
    model_blank_aligned_tree = []
    model_blank_length_tree = []
    model_beam_index_tree = []
    model_beam_guid_tree = []
    model_cross_section_tree = []

    model_timber_count = 0

    # 每個 TimberModel 作為一個水平區塊，沿 X direction 排列
    model_x_offset = model_i * MODEL_COLUMN_SPACING

    # 這個 row counter 讓同一個 TimberModel 內的每條 stock timber 上下排列
    stock_row_i = 0

    for stock_i, stock in enumerate(result.stocks):

        stock_items = []

        for beam_guid_key, data in stock.element_data.items():

            beam = None
            b_index = None

            for i, b in enumerate(model.beams):
                if str(b.guid) == str(beam_guid_key):
                    beam = b
                    b_index = i
                    break

            if beam is None:
                continue

            stock_items.append({
                "beam": beam,
                "beam_index": b_index,
                "length": data.length,
                "data": data,
                "key": data.key,
                "guid": str(beam_guid_key),
                "cross_section": (beam.width, beam.height)
            })

        split_groups = []
        current_group = []
        current_length = 0.0

        for item in stock_items:

            item_length = item["length"]
            required_length = item_length

            if current_group:
                required_length += SPACING

            if current_group and current_length + required_length > STOCK_LENGTH:
                split_groups.append(current_group)
                current_group = [item]
                current_length = item_length
            else:
                current_group.append(item)
                current_length += required_length

        if current_group:
            split_groups.append(current_group)

        stock_blank_geometry_tree = []
        stock_blank_aligned_tree = []
        stock_blank_length_tree = []
        stock_beam_index_tree = []
        stock_beam_guid_tree = []
        stock_cross_section_tree = []

        for split_i, split_group in enumerate(split_groups):

            timber_650_count += 1
            model_timber_count += 1

            split_name = "BeamStock_{}_{}".format(stock_i, split_letter(split_i))

            split_blank_geometry = []
            split_blank_aligned = []
            split_blank_length = []
            split_beam_index = []
            split_beam_guid = []
            split_cross_section = []

            current_x = 0.0

            # 同一個 TimberModel 內，每一條 stock timber 用不同 Y row
            x_offset = model_x_offset
            y_offset = stock_row_i * STOCK_ROW_SPACING

            for item in split_group:

                beam = item["beam"]
                length = item["length"]
                guid = item["guid"]
                section = item["cross_section"]

                split_blank_geometry.append(beam.blank)
                split_blank_length.append(length)
                split_beam_index.append(item["beam_index"])
                split_beam_guid.append(guid)
                split_cross_section.append(section)

                aligned_blank = beam.blank.copy()

                target_frame = item["data"].frame.copy()

                # X = model horizontal offset + beam position inside stock
                target_frame.point.x = x_offset + current_x + length / 2.0

                # Y = stock row inside same TimberModel
                target_frame.point.y = y_offset

                # force to XY plane
                target_frame.point.z = 0.0

                T = Transformation.from_frame_to_frame(
                    aligned_blank.frame,
                    target_frame
                )

                aligned_blank.transform(T)
                split_blank_aligned.append(aligned_blank)

                current_x += length + SPACING

            total_length = sum(split_blank_length) + max(0, len(split_blank_length) - 1) * SPACING
            waste = STOCK_LENGTH - total_length

            nesting_info.append("{}:".format(split_name))
            nesting_info.append("CrossSection: {}".format(stock.cross_section))
            nesting_info.append("BeamKeys: {}".format([item["key"] for item in split_group]))
            nesting_info.append("BeamGUIDs: {}".format(split_beam_guid))
            nesting_info.append("BeamIndices: {}".format(split_beam_index))
            nesting_info.append("BeamLengths: {}".format(split_blank_length))
            nesting_info.append("TotalLength: {:.3f}".format(total_length))
            nesting_info.append("Waste: {:.3f}".format(waste))
            nesting_info.append("--------")

            stock_blank_geometry_tree.append(split_blank_geometry)
            stock_blank_aligned_tree.append(split_blank_aligned)
            stock_blank_length_tree.append(split_blank_length)
            stock_beam_index_tree.append(split_beam_index)
            stock_beam_guid_tree.append(split_beam_guid)
            stock_cross_section_tree.append(split_cross_section)

            # let every split stock timber using the next Y row
            stock_row_i += 1

        model_blank_geometry_tree.append(stock_blank_geometry_tree)
        model_blank_aligned_tree.append(stock_blank_aligned_tree)
        model_blank_length_tree.append(stock_blank_length_tree)
        model_beam_index_tree.append(stock_beam_index_tree)
        model_beam_guid_tree.append(stock_beam_guid_tree)
        model_cross_section_tree.append(stock_cross_section_tree)

    timber_650_count_per_model.append(model_timber_count)

    blank_geometry.append(model_blank_geometry_tree)
    blank_aligned.append(model_blank_aligned_tree)
    blank_length.append(model_blank_length_tree)
    beam_index.append(model_beam_index_tree)
    beam_guid_output.append(model_beam_guid_tree)
    cross_section_output.append(model_cross_section_tree)


blank_geometry = list_to_tree(blank_geometry)
blank_aligned = list_to_tree(blank_aligned)
blank_length = list_to_tree(blank_length)
beam_index = list_to_tree(beam_index)
beam_guid = list_to_tree(beam_guid_output)
cross_section = list_to_tree(cross_section_output)

nesting_info.append("Total stock timber count: {}".format(timber_650_count))
nesting_info.append("Stock timber count per model: {}".format(timber_650_count_per_model))

nesting_info = "\n".join(nesting_info)
# ---------- end py3_3 ----------
panel_2 = Panel(py3_3.nesting_info)
panel_3 = Panel(py3_3.blank_length)
panel_4 = Panel(py3_3.timber_650_count)
draw_2 = COMPASDraw(cg=py3_3.blank_geometry)  # -> simplify(rg); same code as draw
draw_3 = COMPASDraw(cg=py3_3.blank_aligned)  # -> simplify(rg); same code as draw
ma = MassAddition(Input=panel_3)  # -> Result, PartialResults
panel_5 = Panel(ma.Result)
sort = SortList(Keys=flatten(panel_3))  # -> Keys, ValuesA
first_last = FirstLast(List=sort.Keys)  # -> FirstValue, LastValue
panel_6 = Panel(first_last.FirstValue)
panel_7 = Panel(first_last.LastValue)

draw_4 = COMPASDraw(cg=py3_3.blank_aligned)  # -> simplify(rg); same code as draw
tstat = TreeStatistics(Tree=draw_4)  # -> Paths, Length, Count
dpath = DeconstructPath(Branch=tstat.Paths)
item = ListItem(List=dpath, Index=0, Wrap=True)
cset = CreateSet(List=flatten(item))  # -> Set, Map
mindex = MemberIndex(Set=flatten(item), Member=cset.Set)  # -> Index, Count
partition = PartitionList(List=tstat.Length, Size=mindex.Count)
trim = TrimTree(Tree=draw_4, Depth=1)
bang = ExplodeTree(Data=simplify(partition))  # -> Branch0, Branch1, Branch2, Branch3
bang_2 = ExplodeTree(Data=trim)  # -> Branch0, Branch1, Branch2, Branch3
partition_2 = PartitionList(List=bang_2.Branch0, Size=bang.Branch0)
partition_3 = PartitionList(List=bang_2.Branch1, Size=bang.Branch1)
partition_4 = PartitionList(List=bang_2.Branch2, Size=bang.Branch2)
partition_5 = PartitionList(List=bang_2.Branch3, Size=bang.Branch3)
bang_3 = ExplodeTree(Data=partition_2)  # -> Branch0, Branch1, Branch2
bang_4 = ExplodeTree(Data=partition_3)  # -> Branch0, Branch1, Branch2
bang_5 = ExplodeTree(Data=partition_4)  # -> Branch0, Branch1, Branch2
bang_6 = ExplodeTree(Data=partition_5)  # -> Branch0, Branch1, Branch2
geo = Geometry(bang_3.Branch0)

# index
panel_8 = Panel(py3_3.beam_index)
panel_9 = Panel(py3_3.beam_guid)
area = Area(Geometry=draw_3)  # -> Area, Centroid
tag = TextTag(Location=area.Centroid, Text=panel_8, Colour=ColourSwatch(SwatchColor=RGB(63, 72, 115)))

# cutting plane
debrep = DeconstructBrep(Brep=draw_3)  # -> Faces, Edges, Vertices
item_2 = ListItem(List=debrep.Faces, Index="1", Wrap=True)
area_2 = Area(Geometry=item_2)  # -> Area, Centroid
scale_nu = ScaleNU(Geometry=item_2, Plane=area_2.Centroid, ScaleX=1, ScaleY=Slider(3, range=0..10), ScaleZ=Slider(6, range=0..10))  # -> Geometry, Transform

# ---- group: Nesting / TimberModel_preview
# beam pieces
cset_2 = CreateSet(List=python_3_script.element_colors)  # -> Set, Map
split = TextSplit(Text=cset_2.Set, Separators=",")  # -> simplify(Result)
item_3 = ListItem(List=split, Index=0, Wrap=True)  # -> Item, Item1, Item2
trim_2 = TrimTree(Tree=draw_3, Depth="1")
rgb = ColourRGB(Alpha=Slider(60, range=0..255), Red=item_3.Item, Green=item_3.Item1, Blue=item_3.Item2)
custom_preview_2 = CustomPreview(Geometry=draw_3, Material=rgb)

# ---- group: Nesting
# cross-section
bbox = BoundingBox(Content=draw_3, Plane=PlaneXY(0, 0, 0), UnionBox=True)  # -> Box, Box_2
debrep_2 = DeconstructBrep(Brep=bbox.Box)  # -> Faces, Edges, Vertices
item_4 = ListItem(List=debrep_2.Faces, Index="3", Wrap=True)
area_3 = Area(Geometry=item_4)  # -> Area, Centroid
trim_3 = TrimTree(Tree=py3_3.cross_section, Depth=Slider(2, range=0..10))
pdecon = Deconstruct(Point=area_3.Centroid)  # -> XComponent, YComponent, ZComponent
dispatch = Dispatch(List=trim_3, DispatchPattern=[True, False])  # -> ListA, ListB
addition = Addition(A=pdecon.XComponent, B=Slider(-2, range=-10..10))
pt = ConstructPoint(XCoordinate=addition, YCoordinate=pdecon.YComponent, ZCoordinate=0)
concat = Concatenate(FragmentA=dispatch.ListA, FragmentB=" x ", FragmentC=dispatch.ListB, FragmentD=" m")
tag_2 = TextTag(Location=pt, Text=concat, Colour=ColourSwatch(SwatchColor=RGB(51, 51, 51)))

# cutting line
panel_10 = Panel("1")
trim_4 = TrimTree(Tree=item_2, Depth=panel_10)
area_4 = Area(Geometry=trim_4)  # -> Area, Centroid
Y = UnitY(Factor=1)
line_4 = LineSDL(Start=area_4.Centroid, Direction=Y, Length=Slider(0.5, range=0..10))
midpt = CurveMiddle(Curve=line_4)
orient = Orient(Geometry=line_4, Source=midpt, Target=area_4.Centroid)  # -> Geometry, Transform

panel_11 = Panel("2")
trim_5 = TrimTree(Tree=area_3.Centroid, Depth=panel_10)

# 6.5 m timber
panel_12 = Panel("-0.05 to 0.05")
box = DomainBox(Base=trim_5, X="0 to 6.5", Y=panel_12, Z="-0.06 to 0.06")
move = Move(Geometry=box, Motion="{0,0,-1}")  # -> Geometry, Transform

# pieces amount of 1 6.5m timber
panel_13 = Panel("1")
trim_6 = TrimTree(Tree=draw_3, Depth=panel_13)
bbox_2 = BoundingBox(Content=draw_3, Plane=PlaneXY(0, 0, 0), UnionBox=True)  # -> Box, Box_2
debrep_3 = DeconstructBrep(Brep=bbox_2.Box)  # -> Faces, Edges, Vertices
item_5 = ListItem(List=debrep_3.Faces, Index="1", Wrap=True)
pull = PullPoint(Point=trim_5, Geometry=item_5, ClosestOnly=True)  # -> ClosestPoint, Distance, Index
X = UnitX(Factor=Slider(3, range=-10..10))
move_2 = Move(Geometry=pull.ClosestPoint, Motion=X)  # -> Geometry, Transform

# time for cutting
lng = ListLength(List=py3_3.blank_length)
trim_7 = TrimTree(Tree=lng, Depth="2")
multiplication = Multiplication(A=trim_7, B=Slider(5, range=0..10))
concat_2 = Concatenate(FragmentA=multiplication, FragmentB="  mins")
X_2 = UnitX(Factor=Slider(3, range=-10..10))
move_3 = Move(Geometry=move_2.Geometry, Motion=X_2)  # -> Geometry, Transform
tag_3 = TextTag(Location=move_3.Geometry, Text=concat_2, Colour=ColourSwatch(SwatchColor=RGB(51, 51, 51)))

concat_3 = Concatenate(FragmentA=trim_7, FragmentB="  beams")
tag_4 = TextTag(Location=move_2.Geometry, Text=concat_3, Colour=ColourSwatch(SwatchColor=RGB(51, 51, 51)))
