# Grasshopper definition 130526_inputtimbermodel_nesting.gh (Grasshopper 1.0.8)
# plug-ins: treesloth01, Human

py3 = Python3Script()  # -> out, line_model
# ---------- py3: Python ----------
from compas.data import json_load

import os, sys, importlib

gh_dir = os.path.dirname(ghenv.Component.OnPingDocument().FilePath)
gh_par = os.path.dirname(gh_dir)
file_path = os.path.join(gh_par, "line_model","data", "260513_shifted_lines.json")

print(file_path)

line_model = json_load(file_path)
# ---------- end py3 ----------

# ---- group: Graph Attributes
sort_graph_attributes = Python3Script(graph=py3.line_model)  # -> out, main_primary, primary, secondary, tertiary, shoes, plates, cut_planes, models
# ---------- sort_graph_attributes: Python ----------
import os, sys, importlib

gh_dir = os.path.dirname(ghenv.Component.OnPingDocument().FilePath)
if gh_dir not in sys.path:
    sys.path.insert(0, gh_dir)

import timber_helpers
importlib.reload(timber_helpers)

from timber_helpers import orient_polyline_to_world_z

from compas.geometry import Line, Point, Transformation, Translation, Vector
from compas.scene import Scene
from copy import deepcopy

from compas_timber.model import TimberModel
from compas_timber.elements import Beam, Plate
from compas.tolerance import Tolerance

#initialise scene object
scene = Scene()

# ============================================================
# Call attributes from graph
# ============================================================

from copy import deepcopy
ng = deepcopy(graph)

main_primary = []
primary = []
secondary = []
tertiary = []
shoes = []
models = []

cut_planes = []
plates = []

groups = [ng.edge_attribute(e,"group") for e in ng.edges()]

#call node attributes from support nodes (planes and polylines)
for node in ng.nodes():
    #cutting plane for footing
    if ng.node_attribute(node, "cut_plane") is not None:
        cut_plane = ng.node_attribute(node, "cut_plane")
        group = ng.node_attribute(node, "group")
        cut_plane.normal = cut_plane.normal * -1
        cut_planes.insert(group, cut_plane)

for node in ng.nodes():
    #outline for clt
    if ng.node_attribute(node, "clt_plate") is not None:
        outline = ng.node_attribute(node, "clt_plate")
        group = ng.node_attribute(node, "group")
        sorted_outline, local_z = orient_polyline_to_world_z(outline)
        vec = local_z.normal
        vec.unitize()
        if vec.z < 0:
            vec = -vec
        
        plate = Plate.from_outline_thickness(
            sorted_outline,
            thickness = 0.1,
            vector = Vector.Zaxis()
    )
        
        T = Translation.from_vector(Vector.Zaxis() * 0.02)
        plate.transform(T)
        plates.insert(group, plate)
    
#call edge attributes from all edges(lines and attributes)
for e in ng.edges():
    ln = ng.edge_attribute(e, "shifted_line")
    h = ng.edge_attribute(e, "hierarchy")

for group, number in enumerate (range(max(groups)+1)):  #iterate through all models
    model = TimberModel(Tolerance(unit="MM", absolute="0.001"))
    beams = []

    clt_plate = plates[group]                           # clt plate
    clt_plate_frame = clt_plate.frame

    for e in ng.edges():
        #extract attributes
        h = ng.edge_attribute(e, "hierarchy")           # classification
        l = ng.edge_attribute(e, "level")               # level
        g = ng.edge_attribute(e, "group")               # group
        ln_width = ng.edge_attribute(e, "height")       # width
        ln_height = ng.edge_attribute(e, "height")       # height

        if group == g:                                  # iterate through groups
            ln = ng.edge_attribute(e, "shifted_line")   # shifted geometry

            if h == "main_primary":                     # visualise lines via .gh outputs
                main_primary.append(ln)
                print(ln_height)
            elif h == "primary":
                primary.append(ln)
            elif h == "secondary":
                secondary.append(ln)
            elif h == "tertiary":
                tertiary.append(ln)
            elif h == "shoe":
                shoes.append(ln)
            if ln is None:
                continue

            #initiate beam element
            if h == "shoe":                             # align shoe to clt frame
                beam = Beam.from_centerline(
                centerline = ln,
                # width = ln_width,
                width = 0.12,
                height = ln_height,
                # z_vector = clt_plate_frame.normal
                )

            else:                                       # default beams aligned to world Z
                beam = Beam.from_centerline(
                centerline = ln,
                # width = ln_width,
                width = 0.1,
                height = ln_height
                )                

            #assign attributes to beam
            beam.attributes["hierarchy"] = h
            beam.attributes["edge"] = e
            beam.attributes["group"] = g
            beam.attributes["level"] = l
            beams.append(beam)

    for beam in beams:                                  # add all elements to model
        model.add_element(beam)
    model.add_element(clt_plate)
    models.append(model)

plates = [plate.geometry for plate in plates]
# ---------- end sort_graph_attributes ----------

# ----
panel = Panel(sort_graph_attributes.models)
py3_2 = Python3Script(unload=Button())
# ---------- py3_2: Python ----------
from compas_rhino import unload_modules
import compas_timber

if unload:
    unload_modules("compas_timber")
# ---------- end py3_2 ----------
draw = COMPASDraw(cg=sort_graph_attributes.main_primary)  # -> rg
#   port cg: The COMPAS geometry or datastructure to be drawn.
#   port rg: The Rhino geometry object.
# ---------- draw: Python ----------
# r: compas>=2.14.1
"""
Draws COMPAS geometry in Grasshopper.
"""

from typing import Any

import Grasshopper

from compas.scene import SceneObject


class CompasToRhinoGeometry(Grasshopper.Kernel.GH_ScriptInstance):
    def RunScript(self, cg):
        if not cg:
            return None

        return SceneObject(item=cg).draw()
# ---------- end draw ----------
draw_2 = COMPASDraw(cg=sort_graph_attributes.secondary)  # -> rg; same code as draw
draw_3 = COMPASDraw(cg=sort_graph_attributes.shoes)  # -> rg; same code as draw
draw_4 = COMPASDraw(cg=sort_graph_attributes.primary)  # -> rg; same code as draw
draw_5 = COMPASDraw(cg=sort_graph_attributes.tertiary)  # -> rg; same code as draw
draw_6 = COMPASDraw(cg=sort_graph_attributes.plates)  # -> rg; same code as draw

# ---- group: Visualise
entwine = Entwine(Branch00=draw, Branch01=draw_4, Branch02=draw_2, Branch03=draw_5, Branch04=draw_3, FlattenInputs=True)
merge = Merge(Data1="main_primary", Data2="primary", Data3="secondary", Data4="tertiary", Data5="shoes")
merge_2 = Merge(
    Data1=ColourSwatch(SwatchColor=RGB(255, 0, 0)),
    Data2=ColourSwatch(SwatchColor=RGB(149, 0, 255)),
    Data3=ColourSwatch(SwatchColor=RGB(0, 183, 255)),
    Data4=ColourSwatch(SwatchColor=RGB(41, 189, 0)),
    Data5=ColourSwatch(SwatchColor=RGB(255, 119, 0)))
midpt = CurveMiddle(Curve=entwine)
previewlw = CustomPreviewLineweights(Geometry=entwine, Shader=graft(merge_2), Thickness="2", Absolute=False)
tag = TextTag(Location=midpt, Text=graft(merge), Colour=graft(merge_2))

# ----
timber_model = Python3Script(models=sort_graph_attributes.models, model_count=Slider(1, range=1..4))  # -> out, timber_models; inputs models: list, model_count: Int32
# ---------- timber_model: Python ----------
import os, sys, importlib

gh_dir = os.path.dirname(ghenv.Component.OnPingDocument().FilePath)
if gh_dir not in sys.path:
    sys.path.insert(0, gh_dir)

import timber_helpers
importlib.reload(timber_helpers)

from timber_helpers import is_planar, orient_polyline_to_world_z

from collections import Counter

from compas.scene import Scene
from compas_rhino.conversions import line_to_compas, polyline_to_compas, plane_to_compas
from compas.tolerance import Tolerance, TOL
from compas.geometry import Frame, Vector, Point, angle_vectors, centroid_points, Line, intersection_segment_plane

from compas_timber.model import TimberModel
from compas_timber.elements import Beam, Plate
from compas_timber.analyzers import TripletAnalyzer
from compas_timber.connections import JointTopology, TMultiStepJoint, TStepJoint, LMiterJoint, TBirdsmouthJoint, XLapJoint, KBirdsmouthJoint, TButtJoint


#initialise scene object
scene = Scene()

# ============================================================
# Process Jointery
# ============================================================

#models = models[0:model_count]

distances = []
max_distance = 0.065
timber_models = []

#reset beams and features
for i, model in enumerate (models):
    model = model.copy()
    for beam in model.beams:
        beam.reset_computed_properties()

    #compute line network
    model.connect_adjacent_beams(max_distance)

    max_offset = max(candidate.distance for candidate in model.joint_candidates)

    for c in model.joint_candidates:
        distances.append(c.distance)

    #handle non-pair joints (in this case a 3-way connection using TripletAnalyzer)
    analyzer = TripletAnalyzer(model, max_offset/2)
    clusters = analyzer.find()

    for cluster in clusters:
        if cluster.topology == JointTopology.TOPO_K:
            #keep track of the amount of elements per type
            counts = Counter(e.attributes["hierarchy"] for e in cluster.elements)
            if counts["secondary"] == 2 and counts["tertiary"] == 1: #skip this joint
                continue

            #define the order of the elements to be passed to the joint
            order = {"main_primary": 0, "primary": 1, "secondary": 2}
            if counts["main_primary"] == 2 and counts["primary"] == 1:
                order = {"primary": 0, "main_primary": 1, "secondary": 2} #override the order just for this condition
            reordered_elements =  sorted(cluster.elements, key=lambda e: order.get(e.attributes["hierarchy"], 99))
            
            if len(reordered_elements) != 3:
                raise ValueError(f"Something went wrong with the analyzer. There should be always 3 elements, got: {len(reordered_elements)}")
            
            #promote cluster
            kbj = KBirdsmouthJoint.promote_cluster(model, cluster, reordered_elements=reordered_elements, mill_depth=0.01)

    #handle all pair joints
    for candidate in model.joint_candidates:
        beam_a, beam_b = candidate.elements             #parallel check with beam.attributes
        if candidate.is_promoted == False:              #all joints that are not k-topology

            """CLT shoe to Top Beam"""
            if candidate.topology == JointTopology.TOPO_T and is_planar(candidate.element_a, candidate.element_b) == False:
                if beam_b.name == 'shoe':
                    # t_butt_joint = TButtJoint.create(model, candidate.element_a, candidate.element_b)
                    t_step_joint = TMultiStepJoint.create(model, candidate.element_a, candidate.element_b,
                    step_count=2
                    )

                """T - Multi Step Joint"""
            elif candidate.topology == JointTopology.TOPO_T and is_planar(candidate.element_a, candidate.element_b) == True:
                if angle_vectors(candidate.element_a.centerline.direction, candidate.element_b.centerline.direction, 
                deg=True) < 50:
                    step_shape = "heel"
                else:
                    step_shape = "step"
                # t_butt_joint = TButtJoint.create(model, candidate.element_a, candidate.element_b)
                t_step_joint = TMultiStepJoint.create(model, candidate.element_a, candidate.element_b, 
                step_shape = step_shape,
                step_depth = .020, 
                riser_angle = 90
                )

                """T - Non-Planar Step Joint"""
            elif candidate.topology == JointTopology.TOPO_T and is_planar(candidate.element_a, candidate.element_b) == False:
                t_butt_joint = TButtJoint.create(model, candidate.element_a, candidate.element_b)
                # t_np_step_joint = TMultiStepJoint.create(model, candidate.element_a, candidate.element_b, 
                # do_refine_cut=True,
                # step_depth = .020,
                # riser_angle = 90
                # )

                """L Mitre Joint"""
            elif candidate.topology==JointTopology.TOPO_L:
                l_miter_joint = LMiterJoint.create(model, candidate.element_a, candidate.element_b, 
                cutoff = False
                )

                """X Lap Joint"""
            elif candidate.topology == JointTopology.TOPO_X:
                x_lap_joint = XLapJoint.create(model, candidate.element_a, candidate.element_b
                )

            else:
                continue

    timber_models.append(model)
# ---------- end timber_model ----------
panel_2 = Panel(timber_model.timber_models)
showjointtypes = CTShowJointTypes()  # disabled
#   port model: Model object.
# ---------- showjointtypes: Python ----------
"""Shows the names of the defined Joints."""
# env: C:\Users\kapso\OneDrive\Documents\GitHub\timber_design\src
# r: compas_timber>=0.16.2
# flake8: noqa
import Grasshopper
import System
from compas_rhino.conversions import point_to_rhino

from compas_timber.utils import intersection_line_line_param
from timber_design.ghpython.ghcomponent_helpers import item_input_valid_cpython


class ShowJointTypes(Grasshopper.Kernel.GH_ScriptInstance):
    def RunScript(self, model):
        self.pt = []
        self.txt = []

        if not item_input_valid_cpython(ghenv, model, "model"):
            return

        for joint in model.joints:
            line_a, line_b = joint.elements[0].centerline, joint.elements[1].centerline
            [p1, _], [p2, _] = intersection_line_line_param(line_a, line_b, float("inf"), False, 1e-3)
            p1 = point_to_rhino(p1)
            p2 = point_to_rhino(p2)

            self.pt.append((p2 + p1) / 2)
            self.txt.append(joint.__class__.__name__)

    def DrawViewportWires(self, arg):
        if ghenv.Component.Locked:
            return
        col = System.Drawing.Color.FromArgb(255, 0, 0, 0)
        # https://developer.rhino3d.com/api/RhinoCommon/html/M_Rhino_Display_DisplayPipeline_Draw2dText_5.htm
        for p, t in zip(self.pt, self.txt):
            arg.Display.Draw2dText(t, col, p, True, 12, "Verdana")
# ---------- end showjointtypes ----------
displayjointnames = Python3Script(model=timber_model.timber_models)
# ---------- displayjointnames: Python ----------
import Grasshopper
import System

from compas_rhino.conversions import point_to_rhino

from compas_timber.utils import intersection_line_line_param

class ShowJointTypes(Grasshopper.Kernel.GH_ScriptInstance):
    def RunScript(self, model):
        self.pt = []
        self.txt = []

        for joint in model.joints:
            line_a, line_b = joint.elements[0].centerline, joint.elements[1].centerline
            [p1, _], [p2, _] = intersection_line_line_param(line_a, line_b, float("inf"), False, 1e-3)
            p1 = point_to_rhino(p1)
            p2 = point_to_rhino(p2)
            
            self.pt.append((p2 + p1)/2)
            self.txt.append(joint.__class__.__name__)
    
    def DrawViewportWires(self, arg):
        if ghenv.Component.Locked:
            return
        col = System.Drawing.Color.FromArgb(255, 0, 0, 0)
        # https://developer.rhino3d.com/api/RhinoCommon/html/M_Rhino_Display_DisplayPipeline_Draw2dText_5.htm
        for p, t in zip(self.pt, self.txt):
            arg.Display.Draw2dText(t, col, p, True, 15, "Verdana")
# ---------- end displayjointnames ----------
process_joinery = Python3Script(
    timber_models=timber_model.timber_models,
    cut_planes=sort_graph_attributes.cut_planes,
    process=Toggle(True),
    vizualize=Toggle(True))  # -> out, timber_models, geo, debug_info; inputs timber_models: list, cut_planes: list, process: Boolean, vizualize: Boolean
# ---------- process_joinery: Python ----------
# from timber_design.workflow import DebugInfomation
# debug_info = DebugInfomation()

from compas.scene import Scene

from compas_timber.model import TimberModel
from compas_timber.elements import Beam, Plate
from compas_timber.fabrication import JackRafterCut

from compas.geometry import intersection_segment_plane

scene = Scene()

max_level = [beam.attributes["level"] for beam in timber_models[0].beams]

if process:
    for i, model in enumerate (timber_models):
        model.process_joinery()

        for beam in model.beams:
            beam.reset_computed_properties()

            if beam.attributes["hierarchy"] == "primary" or beam.attributes["hierarchy"] == "main_primary" and beam.attributes["level"] == max(max_level):
                    cutting_plane = cut_planes[i]
                    intersection = intersection_segment_plane(beam.centerline, cutting_plane, tol=None)
                    if intersection is not None:
                        jackrafter = JackRafterCut.from_plane_and_beam(cutting_plane, beam)
                        beam.add_feature(jackrafter)
                        # btlxprocessing, is joinery = False (to allow joints to be serialised)

        # drill_line = line_to_compas(drill_line)
        # for i, beam in enumerate(model.beams):
        #     if i == 0:
        #         drill_feature = Drilling.from_line_and_element(drill_line, beam, diameter=10)
        #         beam.add_features(drill_feature)
        #         scene.add(beam.geometry)

    # bje = model.process_joinery()
#     if bje:
#         debug_info.add_joint_error(bje)

if vizualize:
    for model in timber_models:
        for beam in model.beams:
            scene.add(beam.geometry)
            # if beam.debug_info:
            #     for error in beam.debug_info:
            #         debug_info.add_feature_error(error)
        for plate in model.plates:
            scene.add(plate.geometry)

geo = scene.draw()
# ---------- end process_joinery ----------
panel_3 = Panel(process_joinery.timber_models)
geometry = Geometry(process_joinery.geo)
featureerrors = CTShowFeatureErrors(debug_info=process_joinery.debug_info, i=Slider(0, range=0..100))  # -> Info, Geometry; disabled
#   port debug_info: DebugInformation object containing feature errors.
#   port i: Index of the feature error to show. This index wraps around the number of errors.
#   port Info: Information about the selected feature error.
#   port Geometry: Geometry related to the selected feature error.
# ---------- featureerrors: Python ----------
"""Shows information useful for debugging feature application errors."""
# env: C:\Users\kapso\OneDrive\Documents\GitHub\timber_design\src
# r: compas_timber>=0.16.2
# flake8: noqa
import Grasshopper

from compas.scene import SceneObject
from timber_design.ghpython.ghcomponent_helpers import item_input_valid_cpython


class ShowFeatureErrors(Grasshopper.Kernel.GH_ScriptInstance):
    def RunScript(self, debug_info, i):
        if not item_input_valid_cpython(ghenv, i, "i"):
            i = 0
        if not item_input_valid_cpython(ghenv, debug_info, "DebugInfo"):
            return
        if not debug_info.feature_errors:
            ghenv.Component.AddRuntimeMessage(Grasshopper.Kernel.GH_RuntimeMessageLevel.Warning, "No feature errors found in input parameter 'DebugInfo'")
            return
        feature_errors = debug_info.feature_errors
        i = int(i) % len(feature_errors)
        error = feature_errors[i]

        geometries = [error.feature_geometry, error.element_geometry]
        geometries = flatten(geometries)
        geo_objs = [SceneObject(item=geo) for geo in geometries]
        output = []
        for obj in geo_objs:
            output.extend(obj.draw())

        return error.message, output


def flatten(lst):
    if not lst:
        return lst
    if isinstance(lst[0], list):
        return flatten(lst[0]) + flatten(lst[1:])
    return lst[:1] + flatten(lst[1:])
# ---------- end featureerrors ----------
preview = CustomPreview(Geometry=geometry, Material=ColourSwatch(SwatchColor=RGBA(156, 115, 115, 147)))

# ---- group: Nesting
py3_3 = Python3Script(timber_models=process_joinery.timber_models)  # -> out, simplify(blank_geo), simplify(blank_aligned), simplify(width_height), simplify(stock_count), simplify(beam_count), simplify(beam_index), simplify(beam_guid)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; inputs timber_models: list
# ---------- py3_3: Python ----------
from compas_timber.planning import BeamNester, BeamStock
from compas.geometry import Transformation
from ghpythonlib.treehelpers import list_to_tree

models = timber_models

STOCK_LENGTH = 6.5
SPACING = 0.03

STOCK_ROW_SPACING = 1.0
MODEL_COLUMN_SPACING = 20.0

blank_geo = []
blank_aligned = []
width_height_output = []
beam_count_output = []
beam_index_output = []
beam_key_output = []
blank_length_output = []

stock_count_info = []
nesting_info = []

stock_total_count = 0
stock_count_per_model = []


def format_section(section):
    return "{:.2f} x {:.2f} m".format(section[0], section[1])


for model_i, model in enumerate(models):

    beam_lookup = {
        str(b.guid): (i, b)
        for i, b in enumerate(model.beams)
    }

    cross_sections = []

    for beam in model.beams:
        section = tuple(sorted((beam.width, beam.height)))

        if section not in cross_sections:
            cross_sections.append(section)

    stock_catalog = [
        BeamStock(
            length=STOCK_LENGTH,
            cross_section=section,
            spacing=SPACING,
        )
        for section in cross_sections
    ]

    nester = BeamNester(
        model=model,
        stock_catalog=stock_catalog,
        spacing=SPACING,
        per_group=False,
    )

    result = nester.nest(fast=False)

    nesting_info.append("========== TimberModel {} ==========".format(model_i))
    stock_count_info.append("========== TimberModel {} ==========".format(model_i))

    model_blank_geo_tree = []
    model_blank_aligned_tree = []
    model_width_height_tree = []
    model_beam_count_tree = []
    model_beam_index_tree = []
    model_beam_key_tree = []
    model_blank_length_tree = []

    model_stock_count = 0
    section_count = {}

    model_x_offset = model_i * MODEL_COLUMN_SPACING
    stock_row_i = 0

    for stock_i, stock in enumerate(result.stocks):

        stock_items = []

        for beam_guid_key, data in stock.element_data.items():

            if str(beam_guid_key) not in beam_lookup:
                continue

            b_index, beam = beam_lookup[str(beam_guid_key)]

            stock_items.append({
                "beam": beam,
                "beam_index": b_index,
                "length": data.length,
                "data": data,
                "key": data.key,
                "section": (beam.width, beam.height)
            })

        split_groups = []
        current_group = []
        current_length = 0.0

        for item in stock_items:

            item_length = item["length"]
            required_length = item_length

            if current_group:
                required_length += SPACING

            if current_group and current_length + required_length > STOCK_LENGTH:
                split_groups.append(current_group)
                current_group = [item]
                current_length = item_length
            else:
                current_group.append(item)
                current_length += required_length

        if current_group:
            split_groups.append(current_group)

        stock_blank_geo_tree = []
        stock_blank_aligned_tree = []
        stock_width_height_tree = []
        stock_beam_count_tree = []
        stock_beam_index_tree = []
        stock_beam_key_tree = []
        stock_blank_length_tree = []

        for split_i, split_group in enumerate(split_groups):

            stock_total_count += 1
            model_stock_count += 1

            section_key = format_section(stock.cross_section)

            if section_key not in section_count:
                section_count[section_key] = 0
            section_count[section_key] += 1

            split_name = "BeamStock_{}_{}".format(stock_i, split_i)

            split_blank_geo = []
            split_blank_aligned = []
            split_width_height = []
            split_beam_count = []
            split_beam_index = []
            split_beam_key = []
            split_blank_length = []

            current_x = 0.0

            x_offset = model_x_offset
            y_offset = stock_row_i * STOCK_ROW_SPACING

            for item in split_group:

                beam = item["beam"]
                length = item["length"]
                key = item["key"]
                section = item["section"]

                split_blank_geo.append(beam.blank)
                split_blank_length.append(length)
                split_beam_index.append(item["beam_index"])
                split_beam_key.append(key)
                split_width_height.append(format_section(section))

                aligned_blank = beam.blank.copy()

                target_frame = item["data"].frame.copy()
                target_frame.point.x = x_offset + current_x + length / 2.0
                target_frame.point.y = y_offset
                target_frame.point.z = 0.0

                T = Transformation.from_frame_to_frame(
                    aligned_blank.frame,
                    target_frame
                )

                aligned_blank.transform(T)
                split_blank_aligned.append(aligned_blank)

                current_x += length + SPACING

            total_length = sum(split_blank_length) + max(0, len(split_blank_length) - 1) * SPACING
            waste = STOCK_LENGTH - total_length
            beam_count_in_stock = len(split_group)

            split_beam_count.append(beam_count_in_stock)

            nesting_info.append("{}:".format(split_name))
            nesting_info.append("CrossSection: {}".format(section_key))
            nesting_info.append("BeamCount: {}".format(beam_count_in_stock))
            nesting_info.append("BeamKeys: {}".format(split_beam_key))
            nesting_info.append("BeamIndices: {}".format(split_beam_index))
            nesting_info.append("BeamLengths: {}".format(split_blank_length))
            nesting_info.append("TotalLength: {:.3f}".format(total_length))
            nesting_info.append("Waste: {:.3f}".format(waste))
            nesting_info.append("--------")

            stock_blank_geo_tree.append(split_blank_geo)
            stock_blank_aligned_tree.append(split_blank_aligned)
            stock_width_height_tree.append(split_width_height)
            stock_beam_count_tree.append(split_beam_count)
            stock_beam_index_tree.append(split_beam_index)
            stock_beam_key_tree.append(split_beam_key)
            stock_blank_length_tree.append(split_blank_length)

            stock_row_i += 1

        model_blank_geo_tree.append(stock_blank_geo_tree)
        model_blank_aligned_tree.append(stock_blank_aligned_tree)
        model_width_height_tree.append(stock_width_height_tree)
        model_beam_count_tree.append(stock_beam_count_tree)
        model_beam_index_tree.append(stock_beam_index_tree)
        model_beam_key_tree.append(stock_beam_key_tree)
        model_blank_length_tree.append(stock_blank_length_tree)

    # Add plate blanks to blank_geo only
    plate_blanks = []

    if hasattr(model, "plates"):
        for plate in model.plates:
            if hasattr(plate, "blank"):
                plate_blanks.append(plate.blank)
            else:
                plate_blanks.append(plate)

    if plate_blanks:
        model_blank_geo_tree.append([plate_blanks])

    stock_count_per_model.append(model_stock_count)

    for section_key, count in section_count.items():
        stock_count_info.append("{}: {}".format(section_key, count))

    stock_count_info.append("Total: {}".format(model_stock_count))
    stock_count_info.append("--------")

    blank_geo.append(model_blank_geo_tree)
    blank_aligned.append(model_blank_aligned_tree)
    width_height_output.append(model_width_height_tree)
    beam_count_output.append(model_beam_count_tree)
    beam_index_output.append(model_beam_index_tree)
    beam_key_output.append(model_beam_key_tree)
    blank_length_output.append(model_blank_length_tree)


blank_geo = list_to_tree(blank_geo)
blank_aligned = list_to_tree(blank_aligned)
width_height = list_to_tree(width_height_output)
beam_count = list_to_tree(beam_count_output)
beam_index = list_to_tree(beam_index_output)
beam_key = list_to_tree(beam_key_output)
blank_length = list_to_tree(blank_length_output)

stock_count_info.append("Global total stock count: {}".format(stock_total_count))
stock_count_info.append("Stock count per model: {}".format(stock_count_per_model))

stock_count = "\n".join(stock_count_info)

nesting_info.append("Global total stock count: {}".format(stock_total_count))
nesting_info.append("Stock count per model: {}".format(stock_count_per_model))

nesting_info = "\n".join(nesting_info)
# ---------- end py3_3 ----------
nesting_info = Panel(py3_3.nesting_info)
blank_geo = COMPASDraw(cg=py3_3.blank_geo)  # -> simplify(rg); same code as draw
blank_aligned = COMPASDraw(cg=py3_3.blank_aligned)  # -> simplify(rg); same code as draw

# ----
py3_4 = Python3Script(models=process_joinery.timber_models, save=Button())  # inputs models: list
# ---------- py3_4: Python ----------
import os, sys, importlib
from compas.data import json_dump

gh_dir = os.path.dirname(ghenv.Component.OnPingDocument().FilePath)
gh_par = os.path.dirname(gh_dir)
file_path = os.path.join(gh_par, "timber_design","data")

if save:
    for i, m in enumerate(models):
        """Serialize models to .JSON"""
        output_path = os.path.join(file_path, f"1205_timber_model_{i}.json")
        m.to_json(output_path, pretty=True)
        print(f"Model written to {output_path}")
# ---------- end py3_4 ----------

# ---- group: Nesting
# shortest, longest beam
blank_length = Panel(py3_3.blank_length)
ma = MassAddition(Input=blank_length)  # -> Result, PartialResults
panel_4 = Panel(ma.Result)
sort = SortList(Keys=flatten(blank_length))  # -> Keys, ValuesA
first_last = FirstLast(List=sort.Keys)  # -> FirstValue, LastValue
panel_5 = Panel(first_last.FirstValue)
panel_6 = Panel(first_last.LastValue)

# cross-section
width_height = Panel(py3_3.width_height)
stock_count = Panel(py3_3.stock_count)
bbox = BoundingBox(Content=blank_aligned, Plane=PlaneXY(0, 0, 0), UnionBox=True)  # -> Box, Box_2
debrep = DeconstructBrep(Brep=bbox.Box)  # -> Faces, Edges, Vertices
item = ListItem(List=debrep.Faces, Index="3", Wrap=True)
area = Area(Geometry=item)  # -> Area, simplify(Centroid)
X = UnitX(Factor=Slider(-3, range=-10..10))
move = Move(Geometry=area.Centroid, Motion=X)  # -> Geometry, Transform
item_2 = ListItem(List=width_height, Index=0, Wrap=True)
tag_2 = TextTag(Location=move.Geometry, Text=item_2, Colour=ColourSwatch(SwatchColor=RGB(51, 51, 51)))

# beam count in 6.5m timber
beam_count = Panel(py3_3.beam_count)
X_2 = UnitX(Factor=Slider(11, range=-10..20))
move_2 = Move(Geometry=move.Geometry, Motion=X_2)  # -> Geometry, Transform
concat = Concatenate(FragmentA=beam_count, FragmentB="  beams")
tag_3 = TextTag(Location=move_2.Geometry, Text=concat, Colour=ColourSwatch(SwatchColor=RGB(51, 51, 51)))

# index
beam_index = Panel(py3_3.beam_index)
beam_key = Panel(py3_3.beam_key)
area_2 = Area(Geometry=blank_aligned)  # -> Area, Centroid
tag_4 = TextTag(Location=area_2.Centroid, Text=beam_index, Colour=ColourSwatch(SwatchColor=RGB(63, 72, 115)))

# cutting line
debrep_2 = DeconstructBrep(Brep=blank_aligned)  # -> Faces, Edges, Vertices
item_3 = ListItem(List=debrep_2.Faces, Index="1", Wrap=True)
area_3 = Area(Geometry=item_3)  # -> Area, Centroid
Y = UnitY(Factor=1)
line = LineSDL(Start=area_3.Centroid, Direction=Y, Length=Slider(0.5, range=0..10))
midpt_2 = CurveMiddle(Curve=line)
orient = Orient(Geometry=line, Source=midpt_2, Target=area_3.Centroid)  # -> Geometry, Transform

# 6.5 m timber
panel_7 = Panel("-0.05 to 0.05")
box = DomainBox(Base=area.Centroid, X="0 to 6.5", Y=panel_7, Z="-0.06 to 0.06")
move_3 = Move(Geometry=box, Motion="{0,0,-1}")  # -> Geometry, Transform

# blank_length
area_4 = Area(Geometry=blank_aligned)  # -> Area, Centroid
concat_2 = Concatenate(FragmentA=blank_length, FragmentB="  m")
tag_5 = TextTag(Location=area_4.Centroid, Text=concat_2, Colour=ColourSwatch(SwatchColor=RGB(51, 51, 51)))
