# Grasshopper definition 260514_sequence.ghx (Grasshopper 1.0.8)
# plug-ins: Human

# TimberModel
panel = Panel("2")
py3 = Python3Script(name=panel)  # -> out, timber_model; inputs name: Int32
# ---------- py3: Python ----------
from compas.data import json_load
import os, sys, importlib

gh_dir = os.path.dirname(ghenv.Component.OnPingDocument().FilePath)
gh_par = os.path.dirname(gh_dir)
file_path = os.path.join(gh_par, "timber_design","data", f"260514_v2_timber_model_{name}.json")
print(file_path)

timber_model = json_load(file_path)
timber_model.process_joinery()
# ---------- end py3 ----------
pt = Point(Point(14.01828384, 9.600147889, 0.2339343578))
py3_2 = Python3Script(timber_model=py3.timber_model, pt=pt)  # -> out, a, b, planes, at_frame, joint_locations, plate_frame; inputs pt: Point3d
# ---------- py3_2: Python ----------
from compas.scene import Scene
from compas.geometry import Frame, Vector, Point, Transformation, Rotation, Frame, Plane
from compas_rhino.conversions import plane_to_compas_frame, point_to_compas

from copy import deepcopy
import math

to_frame = Frame.worldXY()
at_frame = Frame(
    point= point_to_compas(pt),
    xaxis=Vector(x=0.000, y=1.000, z=0.000),
    yaxis=Vector(x=1.000, y=-0.000, z=0.000)
)


model = timber_model

scene = Scene()


at_T = Transformation.from_frame(at_frame)

plate = model.plates[0]
from_frame = plate.attributes['negative_frame']

O = Transformation.from_frame_to_frame(from_frame, to_frame)
at_T = Transformation.from_frame(at_frame)
T = at_T * O

for plate in model.plates:
    plate.transform(T)
    scene.add(plate.geometry)

c = []
for beam in model.beams:
    beam.transform(T)
    c.append(beam.centerline)
    scene.add(beam.geometry)

joint_locations = []
for joint in model.joints:
    #joint.transformed(at_T * home_T)
    joint.location.transform(T)
    pt = joint.location
    joint_locations.append(pt)
    # joint_locations.append(joint.location)


a = scene.draw()
b = model
# ---------- end py3_2 ----------
geo = Geometry(py3_2.a)
draw = COMPASDraw(cg=py3_2.planes)  # -> rg
#   port cg: The COMPAS geometry or datastructure to be drawn.
#   port rg: The Rhino geometry object.
# ---------- draw: Python ----------
# r: compas>=2.14.1
"""
Draws COMPAS geometry in Grasshopper.
"""

from typing import Any

import Grasshopper

from compas.scene import SceneObject


class CompasToRhinoGeometry(Grasshopper.Kernel.GH_ScriptInstance):
    def RunScript(self, cg):
        if not cg:
            return None

        return SceneObject(item=cg).draw()
# ---------- end draw ----------
draw_2 = COMPASDraw(cg=py3_2.at_frame)  # -> rg; same code as draw
draw_3 = COMPASDraw(cg=py3_2.plate_frame)  # -> rg; same code as draw
# to do:
# vizualize robot versus human with colors
# add feature for drilling to robot beams
# add picking frame to beam atributes
# calculate insersion vector - for now use z vector of picking frame
# add support for hangguing beams (do we mill?)
# to compas_timber joints:
# change orientation middle node
# manual vs robot
# op1 manually level 1 terciary
# and very small elements
# middle note do 2 by 2
number_slider = Slider(39, range=0..100)
working_space_rfl = Geometry([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])
human_scale = Geometry(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)
python_3_script = Python3Script(final_models=py3.timber_model)  # -> out, beams_a, beams_b, level_1_joint, level_1_beam, sorted_points, joint_tags, sorting_data, final_module
# ---------- python_3_script: Python ----------
from compas_timber.fabrication import Lap



joints_list = list(final_models.joints)
sorted_joints = sorted(joints_list, key=lambda j: (j.location.x, j.location.y, j.location.z))
sorted_points = [joint.location for joint in sorted_joints]

joint_rank = {joint: idx for idx, joint in enumerate(sorted_joints)}


unvisited = {(i, beam): beam for i, beam in enumerate(final_models.beams)}
sorting_data = []

for joint in sorted_joints:
    for (i, beam) in list(unvisited):
        if beam not in joint.elements:
            continue

        level = beam.attributes.get("level")

        if level == 0:
            hierarchy_rank = {"shoe": 0, "tertiary": 2, "secondary": 4, "primary": 4, "main_primary": 4}
        elif level == 1:
            hierarchy_rank = {"shoe": 0, "tertiary": 4, "secondary": 2, "primary": 3, "main_primary": 3}
        else: 
            hierarchy_rank = {"shoe": 0, "tertiary": 2, "secondary": 2, "primary": 4, "main_primary": 4}

        hierarchy = beam.attributes.get("hierarchy", "")
        shoe_priority = 0 if hierarchy == "shoe" else 1
        if beam.attributes.get("has_middle_joint") and level == 1:
            mid_priority = 1 
        else: 
            mid_priority = 0

        joint_idx = joint_rank[joint]
        hierarchy_idx = hierarchy_rank.get(hierarchy)
        mid_point = beam.centerline.midpoint

        sorting_data.append((
                            shoe_priority,
                            level,
                            mid_priority,
                            hierarchy_idx,
                            joint_idx,
                            mid_point.z,
                            i,
                            beam,
                            joint,
                        ))
        

for i,data in enumerate(sorting_data):
    print(data[0], data[1],data[2], data[3])
sorting_data.sort()
for i,data in enumerate(sorting_data):
    print("sorted", data[0], data[1],data[2],data[3])



beams = final_models.beams
sorted_beams = []
for x, (*_, i, beam, joint) in enumerate(sorting_data):
    if (i, beam) in unvisited:
        beams[i].attributes["seq_idx"] = x
        sorted_beams.append(beam.geometry)
        #print(i, joint.name, joint.location)
        del unvisited[(i, beam)]


    
final_module = final_models
# ---------- end python_3_script ----------
custom_preview = CustomPreview(Geometry=working_space_rfl, Material=ColourSwatch(SwatchColor=RGBA(120, 98, 98, 216)))
custom_preview_2 = CustomPreview(Geometry=human_scale, Material=ColourSwatch(SwatchColor=RGB(217, 178, 178)))
draw_4 = COMPASDraw(cg=python_3_script.sorted_points)  # -> rg; same code as draw

# ----
# Preview
python_3_script_2 = Python3Script(model=py3.timber_model, sorting_data=python_3_script.sorting_data, step=number_slider)  # -> out, geometry_to_show, colors_to_show, plate, midpoints_to_show, texts_to_show; inputs sorting_data: list, step: Int32
# ---------- python_3_script_2: Python ----------
import rhinoscriptsyntax as rs
import scriptcontext as sc
import Rhino.Display as rd
import System.Drawing as sd

from compas.scene import Scene
from compas.geometry import Line, Point
from copy import deepcopy


alpha = 180

COLORS = {
    "primary":      sd.Color.FromArgb(alpha, 220,  50,  50),
    "main_primary": sd.Color.FromArgb(alpha, 150,  80, 220),
    "secondary":    sd.Color.FromArgb(alpha,  50, 150, 220),
    "tertiary":     sd.Color.FromArgb(alpha,  80, 200, 100),
    "shoe":         sd.Color.FromArgb(alpha,  20, 150, 100),
    "plate":        sd.Color.FromArgb(alpha, 100, 100, 100)
}

geometry = []
colors = []


sorted_geometry = []
sorted_colors = []
sorted_midpoints = []
sorted_texts = []
seen = set()


for plate in model.plates:
    geometry.append(plate.geometry)
    colors.append(COLORS["plate"])

for beam in model.beams:
    hie = beam.attributes.get("hierarchy", "secondary")
    geometry.append(beam.geometry)
    colors.append(COLORS.get(hie, COLORS["secondary"]))

for data in sorting_data:
    *_, i, _, joint = data

    if i in seen:
        continue

    if 0 <= i < len(model.beams):
        beam = model.beams[i]

        sorted_geometry.append(beam.geometry)
        sorted_colors.append(
            COLORS.get(
                beam.attributes.get("hierarchy", "secondary"),
                COLORS["secondary"]
            )
        )

        # midpoint per beam
        sorted_midpoints.append(beam.centerline.midpoint)

        # first 4 values from sorting_data as text
        sorted_texts.append(" | ".join(str(value) for value in data[:4]))

        seen.add(i)


step = max(0, min(step, len(sorted_geometry)))

geometry_to_show = sorted_geometry[:step]
colors_to_show = sorted_colors[:step]
plate = geometry[0]
midpoints_to_show = sorted_midpoints[:step]
texts_to_show = sorted_texts[:step]
# ---------- end python_3_script_2 ----------
compas_draw = COMPASDraw(cg=python_3_script_2.geometry_to_show)  # -> rg; same code as draw
wires = BrepWireframe(Brep=compas_draw, Density=-1)
preview = CustomPreview(Geometry=compas_draw, Material=python_3_script_2.colors_to_show)
previewlw = CustomPreviewLineweights(Geometry=wires, Shader=ColourSwatch(SwatchColor=RGB(255, 255, 255)), Absolute=False)

compas_draw_2 = COMPASDraw(cg=python_3_script_2.midpoints_to_show)  # -> rg; same code as draw
compas_draw_3 = COMPASDraw(cg=python_3_script_2.plate)  # -> rg; same code as draw
tag = TextTag(Location=compas_draw_2, Text=python_3_script_2.texts_to_show)
