# Grasshopper definition 260515_sequence.ghx (Grasshopper 1.0.8)
# plug-ins: Human

# ----
# Load json file
toggle = BooleanToggle(True)
# TimberModel
py3 = Python3Script(load=toggle)  # -> out, timber_models; inputs load: Boolean
# ---------- py3: Python ----------
from compas.data import json_load
import os, sys, importlib

from copy import deepcopy

gh_dir = os.path.dirname(ghenv.Component.OnPingDocument().FilePath)
gh_par = os.path.dirname(gh_dir)
file_path = os.path.join(gh_par, "timber_design", "data", "260515_v1_timber_models.json")
print(file_path)

if load:
    results = json_load(file_path)
    results = deepcopy(results)

    for data in results:
        model = data['model']
        attrs = data['attributes']
        print (model.attributes.keys())

        model.attributes = attrs
        print (model.attributes.keys())

    timber_models = [data['model'] for data in results]
# ---------- end py3 ----------

# ----
# Orient to station
number_slider = Slider(0, range=0..3)
list = ValueList({"Zero": 0, "One": 1, "Two": 2, "Three": 2² - 1}, selected=["Zero", "One", "Two", "Three"])
item = ListItem(List=py3.timber_models, Index=number_slider, Wrap=True)
pt = Point(Point(14.01828384, 9.600147889, 0.2339343578))
py3_2 = Python3Script(models=item, target_pt=pt, orient=Toggle(True))  # -> out, models, geo_tree, frame_tree; inputs models: list, target_pt: Point3d, orient: Boolean
# ---------- py3_2: Python ----------
import os, sys, importlib

gh_dir = os.path.dirname(ghenv.Component.OnPingDocument().FilePath)

parent = os.path.dirname(gh_dir)
src_dir = os.path.join(parent, "src")
if src_dir not in sys.path:
    sys.path.insert(0, src_dir)

from Grasshopper import DataTree
from Grasshopper.Kernel.Data import GH_Path


from compas.geometry import Transformation, Frame
from copy import deepcopy

models = deepcopy(models)

#
geo_tree = DataTree[object]()
frame_tree = DataTree[object]()

# Robot station location
to_frame = Frame(list(target_pt), [1, 0, 0], [0, 1, 0])

for model in models:
    g = model.attributes['group']
    path = GH_Path(g)
    
    # Get ONE clt plate for each module
    plate = model.attributes['clt_plate']

    # Get special frame for nesting
    from_frame = plate.attributes['negative_frame']
    O = Transformation.from_frame_to_frame(from_frame, to_frame)
    
    frame_tree.Add(from_frame, path)

    
    for plate in model.plates:
        geo = plate.geometry
        if orient:
            geo.transform(O)
        geo_tree.Add(geo, path)

    for beam in model.beams:
        geo = beam.geometry
        if orient:
            geo.transform(O)
        geo_tree.Add(geo, path)
# ---------- end py3_2 ----------
draw = COMPASDraw(cg=py3_2.geo_tree)  # -> rg
#   port cg: The COMPAS geometry or datastructure to be drawn.
#   port rg: The Rhino geometry object.
# ---------- draw: Python ----------
# r: compas>=2.14.1
"""
Draws COMPAS geometry in Grasshopper.
"""

from typing import Any

import Grasshopper

from compas.scene import SceneObject


class CompasToRhinoGeometry(Grasshopper.Kernel.GH_ScriptInstance):
    def RunScript(self, cg):
        if not cg:
            return None

        return SceneObject(item=cg).draw()
# ---------- end draw ----------
draw_2 = COMPASDraw(cg=py3_2.frame_tree)  # -> rg; same code as draw

# ----
# Process joinery
# (seems cannot orient elements only),
# maybe we can create timber model that is oriented already
toggle_2 = BooleanToggle(False)
py3_3 = Python3Script(models=py3_2.models, process=toggle_2)  # -> out, models; inputs models: list, process: Boolean
# ---------- py3_3: Python ----------
import os, sys, importlib

gh_dir = os.path.dirname(ghenv.Component.OnPingDocument().FilePath)

parent = os.path.dirname(gh_dir)              # go up one level
src_dir = os.path.join(parent, "src")         # go into src folder
if src_dir not in sys.path:
    sys.path.insert(0, src_dir)


import timber_config
importlib.reload(timber_config)

import timber_model
importlib.reload(timber_model)
from timber_model import apply_processings

from copy import deepcopy

models = deepcopy(models)

#
if process:
    for model in models:
        apply_processings(model)
# ---------- end py3_3 ----------

# ----
# Preview
number_slider_2 = Slider(154, range=0..255)  # disabled
python_3_script = Python3Script(models=py3_3.models, alpha=number_slider_2)  # -> out, geos, colors, cut_planes; inputs models: list, alpha: Int32; disabled
# ---------- python_3_script: Python ----------
import rhinoscriptsyntax as rs
import scriptcontext as sc
import Rhino.Display as rd
import System.Drawing as sd

from compas.scene import Scene
from compas.geometry import Line, Point
from copy import deepcopy


COLORS = {
    "primary":      sd.Color.FromArgb(alpha, 220,  50,  50),
    "main_primary": sd.Color.FromArgb(alpha, 150,  80, 220),
    "secondary":    sd.Color.FromArgb(alpha,  50, 150, 220),
    "tertiary":     sd.Color.FromArgb(alpha,  80, 200, 100),
    "shoe":         sd.Color.FromArgb(alpha,  20, 150, 100),
    "plate":        sd.Color.FromArgb(alpha, 100, 100, 100)
}


geos = []
colors = []
cut_planes = []

for model in models:
    for plate in model.plates:
        geos.append(plate.geometry)
        colors.append(COLORS['plate'])

    for beam in model.beams:
        hie = beam.attributes.get('hierarchy')

        geos.append(beam.geometry)
        colors.append(COLORS[hie])

    cut_planes.append(model.attributes['cut_plane'])
# ---------- end python_3_script ----------
compas_draw = COMPASDraw(cg=python_3_script.geos)  # -> rg; disabled; same code as draw
compas_draw_2 = COMPASDraw(cg=python_3_script.cut_planes)  # -> rg; disabled; same code as draw
preview = CustomPreview(Geometry=compas_draw, Material=python_3_script.colors)  # disabled
swatch = ColourSwatch(SwatchColor=RGB(255, 255, 255))  # disabled
wires = BrepWireframe(Brep=compas_draw, Density=-1)  # disabled
previewlw = CustomPreviewLineweights(Geometry=wires, Shader=swatch, Absolute=False)  # disabled

volume = Volume(Geometry=draw)
points = PointList(Points=volume, Size=Slider(0.23, range=0..1))
# to compas_timber joints:
# change orientation middle node
# manual vs robot
# op1 manually level 1 terciary
# and very small elements
# middle note do 2 by 2
number_slider_3 = Slider(0, range=0..100)
# to do:
# vizualize robot versus human with colors
# add feature for drilling to robot beams
# add picking frame to beam atributes
# calculate insersion vector - for now use z vector of picking frame
# add support for hangguing beams (do we mill?)
data = Data(py3_2.models)
python_3_script_2 = Python3Script(final_models=data)  # -> out, beams_a, beams_b, level_1_joint, level_1_beam, sorted_points, joint_tags, sorting_data, final_module
# ---------- python_3_script_2: Python ----------
from compas_timber.fabrication import Lap



joints_list = list(final_models.joints)
sorted_joints = sorted(joints_list, key=lambda j: (j.location.x, j.location.y, j.location.z))
sorted_points = [joint.location for joint in sorted_joints]

joint_rank = {joint: idx for idx, joint in enumerate(sorted_joints)}


unvisited = {(i, beam): beam for i, beam in enumerate(final_models.beams)}
sorting_data = []

for joint in sorted_joints:
    for (i, beam) in list(unvisited):
        if beam not in joint.elements:
            continue

        level = beam.attributes.get("level")

        if level == 0:
            hierarchy_rank = {"shoe": 0, "tertiary": 2, "secondary": 4, "primary": 4, "main_primary": 4}
        elif level == 1:
            hierarchy_rank = {"shoe": 0, "tertiary": 4, "secondary": 2, "primary": 3, "main_primary": 3}
        else: 
            hierarchy_rank = {"shoe": 0, "tertiary": 2, "secondary": 2, "primary": 4, "main_primary": 4}

        hierarchy = beam.attributes.get("hierarchy", "")
        shoe_priority = 0 if hierarchy == "shoe" else 1
        if beam.attributes.get("has_middle_joint") and level == 1:
            mid_priority = 1 
        else: 
            mid_priority = 0

        joint_idx = joint_rank[joint]
        hierarchy_idx = hierarchy_rank.get(hierarchy)
        mid_point = beam.centerline.midpoint

        sorting_data.append((
                            shoe_priority,
                            level,
                            mid_priority,
                            hierarchy_idx,
                            joint_idx,
                            mid_point.z,
                            i,
                            beam,
                            joint,
                        ))
        

for i,data in enumerate(sorting_data):
    print(data[0], data[1],data[2], data[3])
sorting_data.sort()
for i,data in enumerate(sorting_data):
    print("sorted", data[0], data[1],data[2],data[3])



beams = final_models.beams
sorted_beams = []
for x, (*_, i, beam, joint) in enumerate(sorting_data):
    if (i, beam) in unvisited:
        beams[i].attributes["seq_idx"] = x
        sorted_beams.append(beam.geometry)
        #print(i, joint.name, joint.location)
        del unvisited[(i, beam)]


    
final_module = final_models
# ---------- end python_3_script_2 ----------
human_scale = Geometry(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)
working_space_rfl = Geometry([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])
custom_preview = CustomPreview(Geometry=working_space_rfl, Material=ColourSwatch(SwatchColor=RGBA(120, 98, 98, 216)))
custom_preview_2 = CustomPreview(Geometry=human_scale, Material=ColourSwatch(SwatchColor=RGB(217, 178, 178)))
draw_3 = COMPASDraw(cg=python_3_script_2.sorted_points)  # -> rg; same code as draw

# ----
# Preview
python_3_script_3 = Python3Script(model=data, sorting_data=python_3_script_2.sorting_data, step=number_slider_3)  # -> out, geometry_to_show, colors_to_show, plate, midpoints_to_show, texts_to_show; inputs sorting_data: list, step: Int32
# ---------- python_3_script_3: Python ----------
import rhinoscriptsyntax as rs
import scriptcontext as sc
import Rhino.Display as rd
import System.Drawing as sd

from compas.scene import Scene
from compas.geometry import Line, Point
from copy import deepcopy


alpha = 180

COLORS = {
    "primary":      sd.Color.FromArgb(alpha, 220,  50,  50),
    "main_primary": sd.Color.FromArgb(alpha, 150,  80, 220),
    "secondary":    sd.Color.FromArgb(alpha,  50, 150, 220),
    "tertiary":     sd.Color.FromArgb(alpha,  80, 200, 100),
    "shoe":         sd.Color.FromArgb(alpha,  20, 150, 100),
    "plate":        sd.Color.FromArgb(alpha, 100, 100, 100)
}

geometry = []
colors = []


sorted_geometry = []
sorted_colors = []
sorted_midpoints = []
sorted_texts = []
seen = set()


for plate in model.plates:
    geometry.append(plate.geometry)
    colors.append(COLORS["plate"])

for beam in model.beams:
    hie = beam.attributes.get("hierarchy", "secondary")
    geometry.append(beam.geometry)
    colors.append(COLORS.get(hie, COLORS["secondary"]))

for data in sorting_data:
    *_, i, _, joint = data

    if i in seen:
        continue

    if 0 <= i < len(model.beams):
        beam = model.beams[i]

        sorted_geometry.append(beam.geometry)
        sorted_colors.append(
            COLORS.get(
                beam.attributes.get("hierarchy", "secondary"),
                COLORS["secondary"]
            )
        )

        # midpoint per beam
        sorted_midpoints.append(beam.centerline.midpoint)

        # first 4 values from sorting_data as text
        sorted_texts.append(" | ".join(str(value) for value in data[:4]))

        seen.add(i)


step = max(0, min(step, len(sorted_geometry)))

geometry_to_show = sorted_geometry[:step]
colors_to_show = sorted_colors[:step]
plate = geometry[0]
midpoints_to_show = sorted_midpoints[:step]
texts_to_show = sorted_texts[:step]
# ---------- end python_3_script_3 ----------
compas_draw_3 = COMPASDraw(cg=python_3_script_3.geometry_to_show)  # -> rg; same code as draw
wires_2 = BrepWireframe(Brep=compas_draw_3, Density=-1)
preview_2 = CustomPreview(Geometry=compas_draw_3, Material=python_3_script_3.colors_to_show)
previewlw_2 = CustomPreviewLineweights(Geometry=wires_2, Shader=ColourSwatch(SwatchColor=RGB(255, 255, 255)), Absolute=False)

compas_draw_4 = COMPASDraw(cg=python_3_script_3.midpoints_to_show)  # -> rg; same code as draw
compas_draw_5 = COMPASDraw(cg=python_3_script_3.plate)  # -> rg; same code as draw
tag = TextTag(Location=compas_draw_4, Text=python_3_script_3.texts_to_show)
