# Grasshopper definition 260520_SL_timbermodel_sequence_.gh (Grasshopper 1.0.8)
# plug-ins: Heteroptera, Human

# ----
# TimberModel
# Load json file
toggle = BooleanToggle(True)
py3 = Python3Script(load=toggle)  # -> out, timber_models; inputs load: Boolean
# ---------- py3: Python ----------
from compas.data import json_load
import os, sys, importlib

from copy import deepcopy

gh_dir = os.path.dirname(ghenv.Component.OnPingDocument().FilePath)
gh_par = os.path.dirname(gh_dir)
file_path = os.path.join(gh_par, "timber_design", "data", "260518_v1_timber_models.json")
print(file_path)

if load:
    results = json_load(file_path)
    results = deepcopy(results)

    for data in results:
        model = data['model']
        attrs = data['attributes']
        print (model.attributes.keys())

        model.attributes = attrs
        print (model.attributes.keys())

    timber_models = [data['model'] for data in results]
# ---------- end py3 ----------

list = ValueList({"Zero": 0, "One": 1, "Two": 2, "Three": 2² - 1}, selected=["Zero", "One", "Two", "Three"])
item = ListItem(List=py3.timber_models, Index=Slider(1, range=0..3), Wrap=True)

# ----
# Process joinery
# (seems cannot orient elements only),
# maybe we can create timber model that is oriented already
toggle_2 = BooleanToggle(True)
py3_2 = Python3Script(models=item, process=toggle_2)  # -> out, models; inputs models: list, process: Boolean
# ---------- py3_2: Python ----------
import os, sys, importlib

gh_dir = os.path.dirname(ghenv.Component.OnPingDocument().FilePath)

parent = os.path.dirname(gh_dir)              # go up one level
src_dir = os.path.join(parent, "src")         # go into src folder
if src_dir not in sys.path:
    sys.path.insert(0, src_dir)


import timber_config
importlib.reload(timber_config)

import timber_model
importlib.reload(timber_model)
from timber_model import apply_processings

from copy import deepcopy

models = deepcopy(models)

#
if process:
    for model in models:
        apply_processings(model)
# ---------- end py3_2 ----------

# ----
# Orient to station
toggle_3 = BooleanToggle(True)
pt = Point(Point(14.01828384, 9.600147889, 0.2339343578))
py3_3 = Python3Script(models=py3_2.models, target_pt=pt, orient=toggle_3)  # -> out, models, geo, geo_tree, frame_tree; inputs models: list, target_pt: Point3d, orient: Boolean
# ---------- py3_3: Python ----------
from Grasshopper import DataTree
from Grasshopper.Kernel.Data import GH_Path

geo_tree = DataTree[object]()

for model_i, model in enumerate(models):

    g = model.attributes.get("group", model_i)
    path = GH_Path(g)

    for plate in model.plates:
        geo_tree.Add(plate.geometry, path)

    for beam in model.beams:
        geo_tree.Add(beam.geometry, path)

geo = geo_tree
# ---------- end py3_3 ----------
draw = COMPASDraw(cg=py3_3.geo_tree)  # -> rg
#   port cg: The COMPAS geometry or datastructure to be drawn.
#   port rg: The Rhino geometry object.
# ---------- draw: Python ----------
# r: compas>=2.14.1
"""
Draws COMPAS geometry in Grasshopper.
"""

from typing import Any

import Grasshopper

from compas.scene import SceneObject


class CompasToRhinoGeometry(Grasshopper.Kernel.GH_ScriptInstance):
    def RunScript(self, cg):
        if not cg:
            return None

        return SceneObject(item=cg).draw()
# ---------- end draw ----------
# manual vs robot
# op1 manually level 1 terciary
# and very small elements
# middle note do 2 by 2
draw_2 = COMPASDraw(cg=py3_3.frame_tree)  # -> rg; same code as draw
draw_3 = COMPASDraw(cg=py3_3.geo)  # -> rg; same code as draw

# ----
# Orient to station
toggle_4 = BooleanToggle(True)
pt_2 = Point(Point(14.01828384, 9.600147889, 0.2339343578))
py3_4 = Python3Script(models=py3_2.models, target_pt=pt_2, orient=toggle_4)  # -> out, models, geo_tree, frame_tree; inputs models: list, target_pt: Point3d, orient: Boolean; disabled
# ---------- py3_4: Python ----------
import os, sys, importlib

gh_dir = os.path.dirname(ghenv.Component.OnPingDocument().FilePath)

parent = os.path.dirname(gh_dir)
src_dir = os.path.join(parent, "src")
if src_dir not in sys.path:
    sys.path.insert(0, src_dir)

from Grasshopper import DataTree
from Grasshopper.Kernel.Data import GH_Path


from compas.geometry import Transformation, Frame
from copy import deepcopy

# models = deepcopy(models)

#
geo_tree = DataTree[object]()
frame_tree = DataTree[object]()

# Robot station location
to_frame = Frame(list(target_pt), [1, 0, 0], [0, 1, 0])

for model in models:
    g = model.attributes['group']
    path = GH_Path(g)
    
    # Get ONE clt plate for each module
    plate = model.attributes['clt_plate']

    # Get special frame for nesting
    from_frame = plate.attributes['negative_frame']
    O = Transformation.from_frame_to_frame(from_frame, to_frame)
    
    frame_tree.Add(from_frame, path)

    
    for plate in model.plates:
        geo = plate.geometry
        if orient:
            geo.transform(O)
            plate.transform(O)
        geo_tree.Add(geo, path)

    for beam in model.beams:
        geo = beam.geometry
        if orient:
            beam.transform(O)
            geo.transform(O)
        geo_tree.Add(geo, path)
# ---------- end py3_4 ----------
draw_4 = COMPASDraw(cg=py3_4.geo_tree)  # -> rg; same code as draw
draw_5 = COMPASDraw(cg=py3_4.frame_tree)  # -> rg; same code as draw

bang = ExplodeTree(Data=draw_3)  # -> Branch0, Branch1, Branch2, Branch3
geo = Geometry(bang.Branch0)

# ---- group: STEP
number_slider = Slider(100, range=0..100)  # disabled

# ----
data = Data(py3_3.models)
python_3_script = Python3Script(final_models=data)  # -> out, geo_plate, geo_main_primary, geo_primary, geo_secondary, geo_tertiary, geo_shoe, geo_other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
# ---------- python_3_script: Python ----------
from compas_rhino.conversions import point_to_rhino

# ============================================================
# 1. Prepare outputs for GH visualization
# ============================================================

geo_plate = []

geo_main_primary = []
geo_primary = []
geo_secondary = []
geo_tertiary = []
geo_shoe = []
geo_other = []

joint_location = []
joint_tag = []


# ============================================================
# 2. Extract plates
# ============================================================

for plate in final_models.plates:
    geo_plate.append(plate.geometry)


# ============================================================
# 3. Extract beams by hierarchy
# ============================================================

for beam in final_models.beams:

    hierarchy = beam.attributes.get("hierarchy", "")

    if hierarchy == "main_primary":
        geo_main_primary.append(beam.geometry)

    elif hierarchy == "primary":
        geo_primary.append(beam.geometry)

    elif hierarchy == "secondary":
        geo_secondary.append(beam.geometry)

    elif hierarchy == "tertiary":
        geo_tertiary.append(beam.geometry)

    elif hierarchy == "shoe":
        geo_shoe.append(beam.geometry)

    else:
        geo_other.append(beam.geometry)


# ============================================================
# 4. Extract joint information
# ============================================================

for joint in final_models.joints:

    # --------------------------------------------------------
    # joint location
    # --------------------------------------------------------

    joint_location.append(point_to_rhino(joint.location))

    # --------------------------------------------------------
    # joint type / class name
    # --------------------------------------------------------

    joint_type = joint.__class__.__name__

    # optional joint name
    joint_name = getattr(joint, "name", "")

    if joint_name:
        tag = "{} : {}".format(joint_type, joint_name)
    else:
        tag = joint_type

    joint_tag.append(tag)


# ============================================================
# 5. Output final model
# ============================================================

final_model = final_models
# ---------- end python_3_script ----------
# THINGS TO DO: - insersion vector for recripocal
# - insersion vector for level 0 : easier with z
# - middle joint, lap easier from the outside than inside
data_2 = Data(py3_3.models)  # disabled
draw_6 = COMPASDraw(cg=python_3_script.geo_plate)  # -> rg; same code as draw
draw_7 = COMPASDraw(cg=python_3_script.geo_main_primary)  # -> rg; same code as draw
draw_8 = COMPASDraw(cg=python_3_script.geo_primary)  # -> rg; same code as draw
draw_9 = COMPASDraw(cg=python_3_script.geo_secondary)  # -> rg; same code as draw
draw_10 = COMPASDraw(cg=python_3_script.geo_tertiary)  # -> rg; same code as draw
draw_11 = COMPASDraw(cg=python_3_script.geo_shoe)  # -> rg; same code as draw
# to compas_timber joints:
# change orientation middle node
# to do:
# DONE vizualize robot versus human with colors
# add feature for drilling to robot beams
# DONE add picking frame to beam atributes
# DONE calculate insersion vector - for now use z vector of picking frame
# KINDA DONE add support for hangguing beams (do we mill?)
draw_12 = COMPASDraw(cg=python_3_script.geo_other)  # -> rg; same code as draw
python_3_script_2 = Python3Script(final_models=data_2)  # -> out, beams_a, beams_b, level_1_joint, level_1_beam, sorted_points, joint_tags, sorting_data, final_model; disabled
# ---------- python_3_script_2: Python ----------
from compas_timber.fabrication import Lap



joints_list = list(final_models.joints)
sorted_joints = sorted(joints_list, key=lambda j: (j.location.x, j.location.y, j.location.z))
sorted_points = [joint.location for joint in sorted_joints]

joint_rank = {joint: idx for idx, joint in enumerate(sorted_joints)}


unvisited = {(i, beam): beam for i, beam in enumerate(final_models.beams)}
sorting_data = []

for joint in sorted_joints:
    for (i, beam) in list(unvisited):
        if beam not in joint.elements:
            continue

        level = beam.attributes.get("level")
        edge = beam.attributes.get("edge")
        edge_a = edge[0]
        # print(edge_a)


        if level == 0:
            hierarchy_rank = {"shoe": 0, "tertiary": 2, "secondary": 4, "primary": 4, "main_primary": 4}
            start_priority = beam.centerline.start.z

        elif level == 1:
            hierarchy_rank = {"shoe": 0, "tertiary": 4, "secondary": 2, "primary": 3, "main_primary": 3}
            start_priority = 9999
        else: 
            hierarchy_rank = {"shoe": 0, "tertiary": 2, "secondary": 2, "primary": 4, "main_primary": 4}
            start_priority = 9999

        hierarchy = beam.attributes.get("hierarchy", "")
        shoe_priority = 0 if hierarchy == "shoe" else 1
        if beam.attributes.get("has_middle_joint") and level == 1:
            mid_priority = 1 
        else: 
            mid_priority = 0

        print(start_priority)
        
        joint_idx = joint_rank[joint]
        hierarchy_idx = hierarchy_rank.get(hierarchy)
        mid_point = beam.centerline.midpoint
   

        sorting_data.append((
                            shoe_priority,
                            level,
                            mid_priority,
                            hierarchy_idx,
                            edge_a,
                            start_priority,
                            mid_point.z,
                            joint_idx,
                            i,
                            beam,
                            joint,
                        ))
        

for i,data in enumerate(sorting_data):
    print(data[0], data[1],data[2], data[3])
sorting_data.sort()
for i,data in enumerate(sorting_data):
    print("sorted", data[0], data[1],data[2],data[3])



beams = final_models.beams
sorted_beams = []
# for x, (*_, i, beam, joint) in enumerate(sorting_data):
#     if (i, beam) in unvisited:
#         beams[i].attributes["sequence_id"] = x
#         sorted_beams.append(beam.geometry)
#         #print(i, joint.name, joint.location)
#         del unvisited[(i, beam)]

local_seq_idx = 0

for data in sorting_data:
    *_, i, beam, joint = data

    if (i, beam) in unvisited:
        beams[i].attributes["sequence_id"] = local_seq_idx

        sorted_beams.append(beam.geometry)

        local_seq_idx += 1

        del unvisited[(i, beam)]


    
final_model = final_models
# ---------- end python_3_script_2 ----------
human_scale = Geometry(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)
working_space_rfl = Geometry([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])
tag = TextTag(Location=python_3_script.joint_location, Text=python_3_script.joint_tag)
custom_preview = CustomPreview(Geometry=working_space_rfl, Material=ColourSwatch(SwatchColor=RGBA(120, 98, 98, 216)))
custom_preview_2 = CustomPreview(Geometry=human_scale, Material=ColourSwatch(SwatchColor=RGB(217, 178, 178)))
draw_13 = COMPASDraw(cg=python_3_script_2.sorted_points)  # -> rg; disabled; same code as draw
draw_14 = COMPASDraw()  # -> rg; disabled; same code as draw

# ---- group: sequence preview with hierarchy colors
# Preview
python_3_script_3 = Python3Script(model=data_2, sorting_data=python_3_script_2.sorting_data, step=number_slider)  # -> out, geometry_to_show, colors_to_show, plate, midpoints_to_show, texts_to_show; inputs sorting_data: list, step: Int32; disabled
# ---------- python_3_script_3: Python ----------
import rhinoscriptsyntax as rs
import scriptcontext as sc
import Rhino.Display as rd
import System.Drawing as sd

from compas.scene import Scene
from compas.geometry import Line, Point
from copy import deepcopy


alpha = 180

COLORS = {
    "primary":      sd.Color.FromArgb(alpha, 220,  50,  50),
    "main_primary": sd.Color.FromArgb(alpha, 150,  80, 220),
    "secondary":    sd.Color.FromArgb(alpha,  50, 150, 220),
    "tertiary":     sd.Color.FromArgb(alpha,  80, 200, 100),
    "shoe":         sd.Color.FromArgb(alpha,  20, 150, 100),
    "plate":        sd.Color.FromArgb(alpha, 100, 100, 100)
}

geometry = []
colors = []


sorted_geometry = []
sorted_colors = []
sorted_midpoints = []
sorted_texts = []
seen = set()


for plate in model.plates:
    geometry.append(plate.geometry)
    colors.append(COLORS["plate"])

for beam in model.beams:
    hie = beam.attributes.get("hierarchy", "secondary")
    geometry.append(beam.geometry)
    colors.append(COLORS.get(hie, COLORS["secondary"]))

for data in sorting_data:
    *_, i, _, joint = data

    if i in seen:
        continue

    if 0 <= i < len(model.beams):
        beam = model.beams[i]

        sorted_geometry.append(beam.geometry)
        sorted_colors.append(
            COLORS.get(
                beam.attributes.get("hierarchy", "secondary"),
                COLORS["secondary"]
            )
        )

        # midpoint per beam
        sorted_midpoints.append(beam.centerline.midpoint)

        # first 4 values from sorting_data as text
        sorted_texts.append(" | ".join(str(value) for value in data[:4]))

        seen.add(i)


step = max(0, min(step, len(sorted_geometry)))

geometry_to_show = sorted_geometry[:step]
colors_to_show = sorted_colors[:step]
plate = geometry[0]
midpoints_to_show = sorted_midpoints[:step]
texts_to_show = sorted_texts[:step]
# ---------- end python_3_script_3 ----------
compas_draw = COMPASDraw(cg=python_3_script_3.geometry_to_show)  # -> rg; disabled; same code as draw
swatch = ColourSwatch(SwatchColor=RGB(255, 255, 255))  # disabled
wires = BrepWireframe(Brep=compas_draw, Density=-1)  # disabled
preview = CustomPreview(Geometry=compas_draw, Material=python_3_script_3.colors_to_show)  # disabled
previewlw = CustomPreviewLineweights(Geometry=wires, Shader=swatch, Absolute=False)  # disabled

# ----
compas_draw_2 = COMPASDraw(cg=python_3_script_3.plate)  # -> rg; disabled; same code as draw
compas_draw_3 = COMPASDraw(cg=python_3_script_3.plate)  # -> rg; disabled; same code as draw
compas_draw_4 = COMPASDraw(cg=python_3_script_3.midpoints_to_show)  # -> rg; disabled; same code as draw

# ---- group: sequence preview from seq_idx attributes & assembly_method
# sequence preview from seq_idx attributes
# & assembly_method
# make NEW BEAMS as support
python_3_script_4 = Python3Script(model=python_3_script_2.final_model, step=number_slider)  # -> out, geometry_to_show, colors_to_show, final_model, end_points, support_beams; inputs step: Int32; disabled
# ---------- python_3_script_4: Python ----------
import rhinoscriptsyntax as rs
import scriptcontext as sc
import Rhino.Display as rd
import System.Drawing as sd

from compas.scene import Scene
from compas.geometry import Line, Point
from copy import deepcopy
from compas_timber.elements import Beam

# manual vs robot
# op1 manually level 1 tertiary
# and very small elements
# middle note do 2 by 2

alpha = 180

COLORS = {  
    "human":        sd.Color.FromArgb(alpha, 220, 50, 50),
    "robot":        sd.Color.FromArgb(alpha, 80, 200, 100),
    "plate":        sd.Color.FromArgb(alpha, 100, 100, 100)
}

geometry = []
colors = []

geometry_to_show = []
colors_to_show = []
assembly_methods = []

# ------------------------------------------------------------
# plates
# ------------------------------------------------------------
for plate in model.plates:
    geometry.append(plate.geometry)
    colors.append(COLORS["plate"])

    geometry_to_show.append(plate.geometry)
    colors_to_show.append(COLORS["plate"])
    assembly_methods.append("plate")


# ------------------------------------------------------------
# assign assembly method to beams
# ------------------------------------------------------------
for beam in model.beams:
    seq_idx = beam.attributes.get("sequence_id")
    level = beam.attributes.get("level")
    hierarchy = beam.attributes.get("hierarchy")

    assembly_method = None
    
    if level == 0:
        if hierarchy == "shoe":
            assembly_method = "robot"
        else:
            assembly_method = "human"

    if level == 1:
        if hierarchy == "tertiary":
            assembly_method = "human"
        else:
            assembly_method = "robot"

    if assembly_method is None:
        assembly_method = "robot"

    beam.attributes["assembly_method"] = assembly_method

    beam_volume = beam.geometry.volume
    beam.attributes["volume"] = beam_volume

    beam_weight = beam_volume * 470
    beam.attributes["weight"] = beam_weight

    beam_width = beam.width
    beam_height = beam.height

    beam.attributes["crosssection"] = beam_width, "x", beam_height

    beam.attributes["blanklength"] = beam.blank_length

    geometry.append(beam.geometry)
    colors.append(COLORS[assembly_method])
    assembly_methods.append(assembly_method)


# ------------------------------------------------------------
# sort beams by seq_idx
# ------------------------------------------------------------
sorted_beams = sorted(model.beams, key=lambda beam: beam.attributes.get("sequence_id", 999999))

sorted_geometry = []
sorted_colors = []

for beam in sorted_beams:
    assembly_method = beam.attributes.get("assembly_method", "human")

    sorted_geometry.append(beam.geometry)
    sorted_colors.append(COLORS[assembly_method])


# ------------------------------------------------------------
# slider control
# ------------------------------------------------------------
step = int(step)
step = max(0, min(step, len(sorted_geometry)))


for beam_geo, beam_color in zip(sorted_geometry[:step], sorted_colors[:step]):
    geometry_to_show.append(beam_geo)
    colors_to_show.append(beam_color)



end_points = []
support_beam_line = []
support_beams = []
for i, beam in enumerate(sorted_beams[:step]):
    level = beam.attributes.get("level")
    hierarchy = beam.attributes.get("hierarchy")
    if 42 <= i <= 45:
        end_point = beam.centerline.end
        start_point = beam.centerline.start
        
        p_end_point = end_point.copy()
        p_end_point.z = start_point.z

        end_points.append(p_end_point)

        support_beam_cl = Line(end_point, p_end_point)
        support_beam_line.append(support_beam_cl)
    if 54 <= i <= 57:
        end_point = beam.centerline.end
        start_point = beam.centerline.point_at(0.1)
        # start_point = beam.centerline.start
        
        p_start_point = start_point.copy()
        p_start_point.z = end_point.z

        end_points.append(p_start_point)

        support_beam_cl = Line(start_point, p_start_point)
        support_beam_line.append(support_beam_cl)
    # elif level == 1 and hierarchy == "tertiary":
 

for line in support_beam_line:
    support_beam = Beam.from_centerline(line, 0.1,0.1)
    support_beams.append(support_beam.geometry)



final_model = model
# ---------- end python_3_script_4 ----------

# ----
tag_2 = TextTag(Location=compas_draw_4, Text=python_3_script_3.texts_to_show)  # disabled
swatch_2 = ColourSwatch(SwatchColor=RGBA(0, 0, 0, 159))  # disabled
preview_2 = CustomPreview(Geometry=compas_draw_2, Material=swatch_2)  # disabled
compas_draw_5 = COMPASDraw(cg=python_3_script_4.support_beams)  # -> rg; disabled; same code as draw
compas_draw_6 = COMPASDraw(cg=python_3_script_4.end_points)  # -> rg; disabled; same code as draw
panel = Panel(python_3_script_4.final_model)  # disabled
compas_draw_7 = COMPASDraw(cg=python_3_script_4.geometry_to_show)  # -> rg; disabled; same code as draw
preview_3 = CustomPreview(Geometry=compas_draw_7, Material=python_3_script_4.colors_to_show)  # disabled
wires_2 = BrepWireframe(Brep=compas_draw_7, Density=-1)  # disabled
panel_3 = Panel("0.2")  # disabled
swatch_3 = ColourSwatch(SwatchColor=RGBA(255, 255, 60, 143))  # disabled
dot_display = DotDisplay(Point=compas_draw_6, Colour=RGB(0, 0, 0), Size=panel_3)  # disabled
swatch_4 = ColourSwatch(SwatchColor=RGB(255, 255, 255))  # disabled
preview_4 = CustomPreview(Geometry=compas_draw_5, Material=swatch_3)  # disabled
previewlw_2 = CustomPreviewLineweights(Geometry=wires_2, Shader=swatch_4, Absolute=False)  # disabled

# ---- group: add grasp_frame and i_vec as beam attributes
# add grasp_frame and
# insersion vector
# as beam attributes
python_3_script_5 = Python3Script(model=python_3_script_4.final_model)  # -> out, grasp_planes, beam_faces, i_vectors, final_model, a, selected_joints, tag_points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; disabled
# ---------- python_3_script_5: Python ----------
from compas.geometry import Frame, Vector, Point, Line, Rotation
from compas_rhino.conversions import frame_to_rhino_plane, vector_to_rhino, plane_to_rhino, point_to_rhino
from compas_timber.connections import TMultiStepJoint
from compas_timber.elements import CutFeature
import math
grasp_planes = []
beam_faces = []
i_vectors = []

    
final_model = model


a = []
selected_beams = []
selected_joints = []

seen_beams = set()

for joint in final_model.joints:
    if isinstance(joint, TMultiStepJoint):
        for beam in joint.elements:
            beam_length = beam.attributes.get("blanklength")
            has_middle_joint = beam.attributes.get("has_middle_joint")

            if beam_length > 1.6 and has_middle_joint == False:

                if beam in seen_beams:
                    continue

                seen_beams.add(beam)

                a.append(beam.geometry)
                selected_beams.append(beam)
                selected_joints.append(joint)

# ------------------------------------------------------------
# Settings for grouping similar cuts
# ------------------------------------------------------------
point_tolerance = 1
seen_cut_keys = set()

tag_points = []
tag_texts = []
dc_plane = []
dc_vector = []
bm_plane = []
bm_vector = []
new_i_vec = []

insertion_vectors_by_beam = {}

for i, beam in enumerate(selected_beams):
    lowest_feature_by_type = {}

    features = beam.features

    for j, feature in enumerate(features):
        feature_type = type(feature).__name__

        if feature_type not in ["DoubleCut", "BirdsMouth"]:
            continue

        planes = feature.planes_from_params_and_beam(beam)

        world_down = Vector(0, 0, -1)

        sorted_planes = sorted(
                                planes,
                                key=lambda plane: plane.normal.unitized().dot(world_down),
                                reverse=True
                            )

        if feature_type == "DoubleCut":
            selected_plane = sorted_planes[1]   # choose the other plane

        elif feature_type == "BirdsMouth":
            selected_plane = sorted_planes[0]   # keep current correct one

        selected_point = selected_plane.point

        if feature_type not in lowest_feature_by_type:
            lowest_feature_by_type[feature_type] = (feature, selected_plane, selected_point)
        else:
            current_lowest_point = lowest_feature_by_type[feature_type][2]

            if selected_point.z < current_lowest_point.z:
                lowest_feature_by_type[feature_type] = (feature, selected_plane, selected_point)

    dc_vec = None
    bm_vec = None

    for feature_type, data in lowest_feature_by_type.items():
        feature, selected_plane, selected_point = data

        tag_points.append(point_to_rhino(selected_point))
        tag_texts.append(feature_type)

        if feature_type == "DoubleCut":
            dc_plane.append(plane_to_rhino(selected_plane))
            dc_vec = -selected_plane.normal.copy()
   
            dc_vector.append(vector_to_rhino(dc_vec))

        elif feature_type == "BirdsMouth":
            bm_plane.append(plane_to_rhino(selected_plane))
            bm_vec = selected_plane.normal.copy()

            bm_vector.append(vector_to_rhino(bm_vec))

    if dc_vec and bm_vec:
        dc_vec_u = dc_vec.unitized()
        bm_vec_u = bm_vec.unitized()

        i_vec_lb = (dc_vec_u + bm_vec_u).unitized()

        insertion_vectors_by_beam[beam] = i_vec_lb
        new_i_vec.append(vector_to_rhino(i_vec_lb))

        # print("selected beam", i, "i_vec_lb =", i_vec_lb)


for i, beam in enumerate(final_model.beams):
    # ============================================================
    # Grasp frame
    # ============================================================
    beam_face = beam.side_as_surface(0)
    pick_up_point = beam_face.point_at(0.5, 0.5)
    beam_frame = beam.frame.copy()
    beam_frame.point = pick_up_point

    level = beam.attributes.get("level")
    hierarchy = beam.attributes.get("hierarchy")

    print(i_vec_lb)
    if level == 0 and hierarchy != "shoe":
        insersion_vec = -Vector.Zaxis()
    elif beam in insertion_vectors_by_beam:
        insersion_vec = insertion_vectors_by_beam[beam]
    else:
        insersion_vec = beam_frame.zaxis

    beam.attributes["grasp_frame"] = beam_frame
    beam.attributes["insertion_vector"] = insersion_vec

    grasp_frame = beam.attributes.get("grasp_frame")
    i_vec = beam.attributes.get("insertion_vector")


    grasp_plane = frame_to_rhino_plane(grasp_frame)
    grasp_planes.append(grasp_plane)
    beam_face_mesh = beam_face.to_mesh()
    beam_faces.append(beam_face_mesh)
    i_vector = vector_to_rhino(i_vec)
    i_vectors.append(i_vector)
# ---------- end python_3_script_5 ----------

# ----
vector = Vector(python_3_script_5.bm_vector)  # disabled
plane = Plane(python_3_script_5.bm_plane)  # disabled
vector_2 = Vector(python_3_script_5.dc_vector)  # disabled
plane_2 = Plane(python_3_script_5.dc_plane)  # disabled
compas_draw_8 = COMPASDraw(cg=python_3_script_5.beam_faces)  # -> rg; disabled; same code as draw
plane_3 = Plane(python_3_script_5.grasp_planes)  # disabled
vector_display = VectorDisplay(Anchor=python_3_script_5.bm_plane, Vector=vector)  # disabled
vector_display_2 = VectorDisplay(Anchor=python_3_script_5.dc_plane, Vector=vector_2)  # disabled
text_tag = TextTag(Location=python_3_script_5.tag_points, Text=python_3_script_5.tag_texts)  # disabled
area = Area(Geometry=compas_draw_8)  # -> Area, Centroid; disabled
colour_swatch = ColourSwatch(SwatchColor=RGB(108, 75, 185))  # disabled
panel_4 = Panel("5")  # disabled
vector_3 = Vector(python_3_script_5.i_vectors)  # disabled
compas_draw_9 = COMPASDraw(cg=python_3_script_5.a)  # -> rg; disabled; same code as draw
# new insersion vector!
vector_display_ex = VectorDisplayEx(Point=area.Centroid, Vector=vector_3, Colour=colour_swatch, Width=panel_4)  # disabled
center = Center(Geometry=compas_draw_9)  # -> Center, Dimension; disabled
custom_preview_3 = CustomPreview(
    Geometry=compas_draw_9,
    Material={diffuse=RGB(221, 160, 221), emission=RGB(66, 48, 66), shine=0.5, specular=RGB(255, 255, 255), transparency=0})  # disabled

vector_4 = Vector(python_3_script_5.new_i_vec)  # disabled
vector_display_3 = VectorDisplay(Anchor=center.Center, Vector=vector_4)  # disabled

number_slider_2 = Slider(1, range=1..10)  # disabled
button = Button()  # disabled
py3_5 = Python3Script(models=python_3_script_5.final_model, version=number_slider_2, save=button)  # inputs models: list, version: Int32; disabled
# ---------- py3_5: Python ----------
import os, sys, importlib
from datetime import date

from compas.data import json_dump

gh_dir = os.path.dirname(ghenv.Component.OnPingDocument().FilePath)
gh_par = os.path.dirname(gh_dir)
file_path = os.path.join(gh_par, "modularization", "data")

# print(file_path)
today = date.today().strftime("%y%m%d")
# print(today)



if save:
    serializable = []
    for m in models:
        serializable.append({
            "attributes": dict(m.attributes),
            "model": m
        })
        
    output_path = os.path.join(file_path, f"{today}_v{version}_timber_models.json")
    dump = json_dump(serializable, output_path, pretty=True)
    print(f"Model written to {output_path}")


# serializable = []
# for m in models:
#     serializable.append({
#         "attributes": dict(m.attributes),
#         "model": m
#     })
# print (serializable)
# ---------- end py3_5 ----------
# TimberModel with all attributes
python_3_script_6 = Python3Script(model=python_3_script_5.final_model)  # -> out, a; disabled
# ---------- python_3_script_6: Python ----------
a = []

for i, beam in enumerate(model.beams):
    text = "Beam {}: {}".format(i, beam.attributes)
    a.append(text)
# ---------- end python_3_script_6 ----------
panel_5 = Panel(python_3_script_6.a)  # disabled
