# Grasshopper definition 260526_add_gripper_feature.ghx (Grasshopper 1.0.8)
# plug-ins: Human, Increment

panel = Panel("""T2_2026
Consoles / Gripper Positioner""")

# ----
# Load json file
toggle = BooleanToggle(True)
py3 = Python3Script(load=toggle)  # -> out, timber_models, a; inputs load: Boolean
# ---------- py3: Python ----------
from compas.data import json_load
import os, sys, importlib

from copy import deepcopy



gh_dir = os.path.dirname(ghenv.Component.OnPingDocument().FilePath)
gh_par = os.path.dirname(gh_dir)

file_path = os.path.join(gh_par,"modularization", "data", "260526_v2_timber_models.json")
print(file_path)

if load:
    results = json_load(file_path)
    results = deepcopy(results)

    for data in results:
        model = data['model']
        attrs = data['attributes']
        print (model.attributes.keys())

        model.attributes = attrs
        print (model.attributes.keys())

    timber_models = [data['model'] for data in results]
# ---------- end py3 ----------

py3_2 = Python3Script(unload=Button())  # -> out; inputs unload: Boolean
# ---------- py3_2: Python ----------
from compas_rhino import unload_modules
import compas_timber

if unload:
    unload_modules('compas_timber')
    print("Module Unloaded")
# ---------- end py3_2 ----------
check = Python3Script()  # -> out, a
# ---------- check: Python ----------
import compas
import compas_timber

print(compas.__version__)
print(compas_timber.__version__)
print(compas_timber.__file__)
# ---------- end check ----------
panel_2 = Panel(check.out)
number_slider = Slider(0, range=0..100)
gripper_separation = Slider(1.3, range=0..10)
side_index = Slider(0, range=0..3)

# ----
# Process joinery
# (seems cannot orient elements only),
# maybe we can create timber model that is oriented already
toggle_2 = BooleanToggle(True)
py3_3 = Python3Script(models=py3.timber_models, process=toggle_2)  # -> out, model; inputs process: Boolean
# ---------- py3_3: Python ----------
import os, sys, importlib

gh_dir = os.path.dirname(ghenv.Component.OnPingDocument().FilePath)

parent = os.path.dirname(gh_dir)              # go up one level
src_dir = os.path.join(parent, "src")         # go into src folder
if src_dir not in sys.path:
    sys.path.insert(0, src_dir)

print(src_dir)


import timber_config
importlib.reload(timber_config)

import timber_model
importlib.reload(timber_model)
from timber_model import apply_processings

from copy import deepcopy

model = deepcopy(models)

#
if process:
    apply_processings(model)
# ---------- end py3_3 ----------

nest_spacing = Slider(0.032, range=0..0.1)
increment = Increment(BeginningNumber=0, StepSize=1, currentValue=0, increment=1, oldStart=0)  # -> Output, Item; disabled
individual = BooleanToggle(True)
json = Button()
btlx = Button()
increment_2 = Increment(BeginningNumber=0, StepSize=1, currentValue=1, increment=1, oldStart=0)  # -> Output, Item
positioner = Python3Script(model=py3.timber_models, index=increment_2.Output, spacing=nest_spacing, individual=individual, write=json)  # -> out, nesting_result, summary, geometry, blank, consoles_positions, gripper_positions; inputs index: Int32, exclude: list of Int32, path: String, write: Boolean
# ---------- positioner: Python ----------
from compas.data import json_dumps, json_loads
from compas_timber.planning import BeamStock
from compas_timber.planning import BeamNester
from compas_timber.planning import set_gripper_positions
from compas_timber.fabrication import Lap
from compas.data import json_dump
from compas.scene import Scene
from compas.geometry import Transformation, Frame, Vector, Translation
from ghpythonlib.treehelpers import list_to_tree
from compas_rhino.conversions import polyhedron_to_rhino
import os

debug_scene = Scene()
geo_scene = Scene()
blank_scene = Scene()
gripper_positions = []


def get_cross_sections_from_model(model):
    cross_sections = []

    for beam in model.beams:
        section = tuple(sorted((beam.width, beam.height)))

        if section not in cross_sections:
            cross_sections.append(section)

    return cross_sections


stock_catalog = [
    BeamStock(5.0, section)
    for section in get_cross_sections_from_model(model)
]

if individual:
    spacing = 100
else:
    spacing = spacing

nester = BeamNester(model, stock_catalog, spacing, per_group=True)
nesting_result = nester.nest(fast=False, consoles=True, optimize=True, exclude_groups=exclude)
# total_material_volume = nesting_result.total_material_volume
stock_report = nesting_result.total_stock_pieces
print(stock_report)

summary_lines = []

for stock_i, stock in enumerate(nesting_result.stocks):

    summary_lines.append("BeamStock_{}:".format(stock_i))
    summary_lines.append(
        "Dimensions(mm): {:.0f}x{:.0f}x{:.0f}".format(
            stock.cross_section[0] * 1000,
            stock.cross_section[1] * 1000,
            stock.length * 1000
        )
    )

    beam_keys = []
    beam_levels = []
    beam_lengths = []

    for guid, data in stock.element_data.items():

        element = model.element_by_guid(str(guid))

        key = data.get("key")
        length = data.get("length")
        level = element.attributes.get("level", "No level")

        beam_keys.append(key)
        beam_lengths.append(round(length * 1000, 1))
        beam_levels.append(level)

    summary_lines.append("BeamKeys: {}".format(beam_keys))
    summary_lines.append("BeamLevels: {}".format(beam_levels))
    summary_lines.append("BeamLengths(mm): {}".format(beam_lengths))
    summary_lines.append("Waste(mm): {:.1f}".format(stock.length * 1000 - sum(beam_lengths)))
    summary_lines.append("Spacing(mm): {:.1f}".format(float(stock.spacing) * 1000))
    summary_lines.append("Groups: {}".format(list(stock.groups)))
    summary_lines.append("--------")

summary = "\n".join(summary_lines)

debug_volumes = []
for i, stock in enumerate(nesting_result.stocks):
    if i == index:
        consoles_positions = stock.consoles_positions

        for guid, data in stock.element_data.items():

            element = model.element_by_guid(str(guid))

            key = data.get("key")
            frame = data.get("frame")

            att = element.attributes
            level = att.get("level", "No level")

            if element.attributes["gripper_position"] != None:
                gripper_local = float(element.attributes["gripper_position"])
            else:
                gripper_local = None
            blank_ext = element._resolve_blank_extensions()
            value = blank_ext[0]

            frame = Frame(frame.point + (value, 0, 0), Vector.Xaxis(), -Vector.Zaxis())
            offset_transformation = Translation.from_vector(Vector.Zaxis() * element.height / 2.0)

            cnc_transformation = (
                Transformation.from_frame(frame)
                * offset_transformation
            )

            geo = element.elementgeometry.transformed(cnc_transformation)
            geo_scene.add(geo)

            local_blank = element.blank.transformed(element.transformation_to_local())
            local_blank.transform(Transformation.from_frame(frame))
            local_blank.translate(Vector.Yaxis() * element.height / 2.0)
            blank_scene.add(local_blank)

            if gripper_local:
                if blank_ext:
                    gripper_positions.append(frame.point.x + gripper_local - value)
                else:
                    gripper_positions.append(frame.point.x + gripper_local)
            else:
                gripper_positions.append("Assembly by hand")

            print(blank_ext)

def get_file_name(file_path):
    file_path_components = file_path.split('/')
    file_name_and_extension = file_path_components[-1].rsplit('.', 1)
    return file_name_and_extension[0]

if write:
    dir_path = get_file_name(path)
    json_dump(model, fp=dir_path+"_fabrication.json", pretty=True)

geometry = geo_scene.draw()
blank = blank_scene.draw()
debug_volumes = list_to_tree(debug_volumes)
# ---------- end positioner ----------
writebtlx = CTWriteBTLx(nesting_result=positioner.nesting_result, write=btlx)  # -> BTLx; inputs write: Boolean
#   port model: Model object.
#   port path: Filepath for new BTLx.
#   port write: Write to file.
#   port BTLx: Pretty BTLx string
# ---------- writebtlx: Python ----------
from compas_timber.fabrication import BTLxWriter
from compas.tolerance import TOL

model.tolerance.unit = "M"

def get_file_name(file_path):
    file_path_components = file_path.split('/')
    file_name_and_extension = file_path_components[-1].rsplit('.', 1)
    return file_name_and_extension[0]


dir_path = get_file_name(path)
writer = BTLxWriter(project_name="T2_fabrication")

if write:
    XML = writer.write(model, dir_path+"_fabrication.btlx", nesting_result=nesting_result)
# ---------- end writebtlx ----------
py3_4 = Python3Script(model=py3_3.model)  # -> out, geo, frames, a
# ---------- py3_4: Python ----------
geo = []
frames = []
for beam in model.beams:
    level = beam.attributes.get("level")
    frames.append(beam.attributes.get("grasp_frame"))

    geo.append(beam.geometry)
# ---------- end py3_4 ----------
addition = Addition(A=positioner.gripper_positions, B=Slider(0, range=-2..2.001))
draw = COMPASDraw(cg=py3_4.frames)  # -> rg
#   port cg: The COMPAS geometry or datastructure to be drawn.
#   port rg: The Rhino geometry object.
# ---------- draw: Python ----------
# r: compas>=2.14.1
"""
Draws COMPAS geometry in Grasshopper.
"""

from typing import Any

import Grasshopper

from compas.scene import SceneObject


class CompasToRhinoGeometry(Grasshopper.Kernel.GH_ScriptInstance):
    def RunScript(self, cg):
        if not cg:
            return None

        return SceneObject(item=cg).draw()
# ---------- end draw ----------
draw_2 = COMPASDraw(cg=py3_4.geo)  # -> rg; same code as draw
consoles_positions = Panel(positioner.consoles_positions)
gripper_positions = Panel(addition)

# ---- group: sequence preview with hierarchy colors
# Preview
python_3_script = Python3Script(model=py3_3.model, step=Slider(62, range=0..100))  # -> out, geometry_to_show, colors_to_show, plate, midpoints_to_show, texts_to_show; inputs step: Int32
# ---------- python_3_script: Python ----------
import rhinoscriptsyntax as rs
import scriptcontext as sc
import Rhino.Display as rd
import System.Drawing as sd

from compas.scene import Scene
from compas.geometry import Line, Point
from copy import deepcopy


alpha = 180

COLORS = {
    "primary":      sd.Color.FromArgb(alpha, 220,  50,  50),
    "main_primary": sd.Color.FromArgb(alpha, 150,  80, 220),
    "secondary":    sd.Color.FromArgb(alpha,  50, 150, 220),
    "tertiary":     sd.Color.FromArgb(alpha,  80, 200, 100),
    "shoe":         sd.Color.FromArgb(alpha,  20, 150, 100),
    "plate":        sd.Color.FromArgb(alpha, 100, 100, 100)
}

geometry = []
colors = []


sorted_geometry = []
sorted_colors = []
sorted_midpoints = []
sorted_texts = []
seen = set()


for plate in model.plates:
    geometry.append(plate.geometry)
    colors.append(COLORS["plate"])

sorting_data = []

for beam in model.beams:
    sorting_data.append(beam.attributes.get("sequence_id"))
    hie = beam.attributes.get("hierarchy", "secondary")
    geometry.append(beam.geometry)
    colors.append(COLORS.get(hie, COLORS["secondary"]))

beams = model.beams

sorted_beams = sorted(beams, key = lambda j: beam.attributes.get("sequence_id"))

for beam in sorted_beams:

    sorted_geometry.append(beam.geometry)
    sorted_colors.append(
        COLORS.get(
            beam.attributes.get("hierarchy", "secondary"),
            COLORS["secondary"]
        )
    )


step = max(0, min(step, len(sorted_geometry)))

geometry_to_show = sorted_geometry[:step]
colors_to_show = sorted_colors[:step]
plate = geometry[0]
midpoints_to_show = sorted_midpoints[:step]
texts_to_show = sorted_texts[:step]
# ---------- end python_3_script ----------
compas_draw = COMPASDraw(cg=python_3_script.geometry_to_show)  # -> rg; same code as draw
wires = BrepWireframe(Brep=compas_draw, Density=-1)
preview = CustomPreview(Geometry=compas_draw, Material=python_3_script.colors_to_show)
previewlw = CustomPreviewLineweights(Geometry=wires, Shader=ColourSwatch(SwatchColor=RGB(255, 255, 255)), Absolute=False)

# ----
gripper = Gripper(F=graft(addition), A=gripper_separation)
beam = Beam(G=positioner.geometry, geo=positioner.blank, A=side_index)
consoles = Consoles(F=positioner.consoles_positions)
compas_draw_2 = COMPASDraw(cg=python_3_script.plate)  # -> rg; same code as draw
compas_draw_3 = COMPASDraw(cg=python_3_script.plate)  # -> rg; same code as draw
compas_draw_4 = COMPASDraw(cg=python_3_script.midpoints_to_show)  # -> rg; same code as draw
summary = Panel(positioner.summary)
tag = TextTag(Location=compas_draw_4, Text=python_3_script.texts_to_show)
preview_2 = CustomPreview(Geometry=compas_draw_2, Material=ColourSwatch(SwatchColor=RGBA(0, 0, 0, 159)))
py3_5 = Python3Script(version=Slider(1, range=1..10), save=Button())  # inputs models: list, version: Int32
# ---------- py3_5: Python ----------
import os, sys, importlib
from datetime import date

from compas.data import json_dump

gh_dir = os.path.dirname(ghenv.Component.OnPingDocument().FilePath)
gh_par = os.path.dirname(gh_dir)
file_path = os.path.join(gh_par, "modularization", "data")

# print(file_path)
today = date.today().strftime("%y%m%d")
# print(today)



if save:
    serializable = []
    for m in models:
        serializable.append({
            "attributes": dict(m.attributes),
            "model": m
        })
        
    output_path = os.path.join(file_path, f"{today}_v{version}_timber_models.json")
    dump = json_dump(serializable, output_path, pretty=True)
    print(f"Model written to {output_path}")


# serializable = []
# for m in models:
#     serializable.append({
#         "attributes": dict(m.attributes),
#         "model": m
#     })
# print (serializable)
# ---------- end py3_5 ----------

# ==== cluster Consoles
xz = XZPlane(Origin=Point(0, 0, 0))
pt = ConstructPoint(XCoordinate=0, YCoordinate=0, ZCoordinate=0)
pt_2 = ConstructPoint(
    XCoordinate=Slider(120, range=0..1000),
    YCoordinate=Slider(2500, range=0..10000),
    ZCoordinate=expr("-x", Slider(140, range=0..1000)))
division = Division(A=pt_2, B=1000)
box = Box2Pt(PointA=pt, PointB=division, Plane=PlaneXY(0, 0, 0))
division_2 = Division(A=Slider(70, range=0..100), B=1000)
F = ClusterInput()
Z = UnitZ(Factor=expr("-x", division_2))
X = UnitX(Factor=F)
lng = ListLength(List=X)
series = Series(Start=Slider(0.3, range=0..1), Step=Slider(0.2, range=0..1), Count=lng)
move = Move(Geometry=box, Motion=Z)  # -> Geometry, Transform
move_2 = Move(Geometry=move.Geometry, Motion=X)  # -> Geometry, Transform
geo = Geometry(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)
aligndim = AlignedDimension(Plane=xz, PointA=pt, PointB=X, Offset=expr("-x", series), Text="{0:0.00}", Size=Slider(0.1, range=0..0.1))
preview = CustomPreview(Geometry=[move_2.Geometry, geo], Material=ColourSwatch(SwatchColor=RGBA(0, 0, 0, 119)))

# ==== cluster Beam
X = UnitX(Factor=1)
A = ClusterInput()
subtraction = Subtraction(A=A, B=3)
geo = ClusterInput()
neg = Negative(Value=subtraction)
multiplication = Multiplication(A=90, B=neg)
geo_2 = Geometry(geo)
area = Area(Geometry=geo_2)  # -> Area, Centroid
line = LineSDL(Start=area.Centroid, Direction=X, Length=1)
rot3d = Rotate3D(Geometry=geo_2, Angle=degrees(multiplication), Center=area.Centroid, Axis=line)  # -> Geometry, Transform
debox = DeconstructBox(Box=rot3d.Geometry)  # -> Plane, X, Y, Z
division = Division(A="70", B=1000)
Z = UnitZ(Factor=division)
dedomain = DeconstructDomain(Domain=debox.Z)  # -> Start, End
move = Move(Geometry=rot3d.Geometry, Motion=Z)  # -> Geometry, Transform
subtraction_2 = Subtraction(A=dedomain.End, B=dedomain.Start)
division_2 = Division(A="280", B=1000)
merge = Merge(Data1=graft(rot3d.Geometry), Data2=graft(move.Geometry))
equalst = EqualityWithinTolerance(FirstNumber=subtraction_2, SecondNumber=division_2, Tolerance=0.001)  # -> Equality, Inequality
panel = Panel(equalst.Equality)
graft = GraftTree(Tree=equalst.Equality, IncludeEmptyLists=True, IncludeNullItems=True)
item = ListItem(List=merge, Index=graft, Wrap=True)
edges = BrepEdges(Brep=item)  # -> Naked, Interior, NonManifold
previewlw = CustomPreviewLineweights(Geometry=edges.Interior, Shader=ColourSwatch(SwatchColor=RGB(255, 71, 71)), Absolute=False)
division_3 = Division(A="70", B=1000)
Z_2 = UnitZ(Factor=division_3)
G = ClusterInput()
transform = Transform(Geometry=G, Transform=rot3d.Transform)
move_2 = Move(Geometry=transform, Motion=Z_2)  # -> Geometry, Transform
merge_2 = Merge(Data1=graft(transform), Data2=graft(move_2.Geometry))
item_2 = ListItem(List=merge_2, Index=graft, Wrap=True)
edges_2 = BrepEdges(Brep=item_2)  # -> Naked, Interior, NonManifold
preview = CustomPreview(Geometry=item_2, Material=ColourSwatch(SwatchColor=RGBA(255, 171, 97, 119)))
previewlw_2 = CustomPreviewLineweights(Geometry=edges_2.Interior, Shader=ColourSwatch(SwatchColor=RGB(0, 0, 0)), Absolute=False)

# ==== cluster Gripper
medium = Geometry([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])
G = ClusterInput()
long = Geometry([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])
filter = StreamFilter(Gate=G, Stream0=medium, Stream1=long, Stream2=long)
A = ClusterInput()
F = ClusterInput()
division = Division(A=Slider(60, range=0..100), B=1000)
division_2 = Division(A=Slider(225, range=0..1000), B=1000)
Z = UnitZ(Factor=division_2)
X = UnitX(Factor=F)
move = Move(Geometry=filter, Motion=Z)  # -> Geometry, Transform
number_slider = Slider(2, range=0..10)
move_2 = Move(Geometry=move.Geometry, Motion=X)  # -> Geometry, Transform
Y = UnitY(Factor=division)
smaller = SmallerThan(FirstNumber=A, SecondNumber=number_slider)  # -> SmallerThan, OrEqualTo
panel = Panel("""33
34
35
36
45
46
47""")
panel_2 = Panel("""25
26
27
28
29
30""")
panel_3 = Panel("""81
82
83
84
85
86""")
move_3 = Move(Geometry=move_2.Geometry, Motion=Y)  # -> Geometry, Transform
filter_2 = StreamFilter(Gate=smaller.OrEqualTo, Stream0=number_slider, Stream1=A)
subtraction = Subtraction(A=number_slider, B=filter_2)
item = ListItem(List=move_3.Geometry, Index=panel_2, Wrap=True)
item_2 = ListItem(List=move_3.Geometry, Index=panel_3, Wrap=True)
item_3 = ListItem(List=move_3.Geometry, Index=36, Wrap=True)
item_4 = ListItem(List=move_3.Geometry, Index=panel, Wrap=True)
cull_i = CullIndex(List=move_3.Geometry, Indices=[panel_3, panel_2, panel], Wrap=True)
division_3 = Division(A=subtraction, B=2)
explode = ExplodeObject(Object=item_3, Recursive=False)
multiplication = Multiplication(A=A, B=Slider(0.5, range=0..1))
X_2 = UnitX(Factor=division_3)
move_4 = Move(Geometry=item_2, Motion=expr("-x", X_2))  # -> Geometry, Transform
move_5 = Move(Geometry=item, Motion=X_2)  # -> Geometry, Transform
area = Area(Geometry=explode)  # -> Area, Centroid
scale_nu = ScaleNU(Geometry=item_3, Plane=area.Centroid, ScaleX=multiplication, ScaleY=1, ScaleZ=1)  # -> Geometry, Transform
filter_3 = StreamFilter(
    Gate=G,
    Stream0=move_3.Geometry,
    Stream1=move_3.Geometry,
    Stream2=[cull_i, move_4.Geometry, move_5.Geometry, scale_nu.Geometry])
preview = CustomPreview(Geometry=filter_3, Material=ColourSwatch(SwatchColor=RGBA(0, 0, 0, 119)))
