# Grasshopper definition 260527_add_gripper_feature.gh (Grasshopper 1.0.8)
# plug-ins: Human

# ----
# Load json file
toggle = BooleanToggle(True)
py3 = Python3Script(load=toggle)  # -> out, timber_models, a; inputs load: Boolean
# ---------- py3: Python ----------
from compas.data import json_load
import os, sys, importlib

from copy import deepcopy



gh_dir = os.path.dirname(ghenv.Component.OnPingDocument().FilePath)
gh_par = os.path.dirname(gh_dir)

file_path = os.path.join(gh_par,"modularization", "data", "260527_v1_timber_models.json")
print(file_path)

if load:
    results = json_load(file_path)
    results = deepcopy(results)

    for data in results:
        model = data['model']
        attrs = data['attributes']
        print (model.attributes.keys())

        model.attributes = attrs
        print (model.attributes.keys())

    timber_models = [data['model'] for data in results]
# ---------- end py3 ----------

panel = Panel("""T2_2026
Consoles / Gripper Positioner""")
py3_2 = Python3Script(unload=Button())  # -> out; inputs unload: Boolean
# ---------- py3_2: Python ----------
from compas_rhino import unload_modules
import compas_timber

if unload:
    unload_modules('compas_timber')
    print("Module Unloaded")
# ---------- end py3_2 ----------
check = Python3Script()  # -> out, a
# ---------- check: Python ----------
import compas
import compas_timber

print(compas.__version__)
print(compas_timber.__version__)
print(compas_timber.__file__)
# ---------- end check ----------
panel_2 = Panel(check.out)

# ----
# Process joinery
# (seems cannot orient elements only),
# maybe we can create timber model that is oriented already
toggle_2 = BooleanToggle(True)
py3_3 = Python3Script(models=py3.timber_models, process=toggle_2)  # -> out, model; inputs process: Boolean
# ---------- py3_3: Python ----------
import os, sys, importlib

gh_dir = os.path.dirname(ghenv.Component.OnPingDocument().FilePath)

parent = os.path.dirname(gh_dir)              # go up one level
src_dir = os.path.join(parent, "src")         # go into src folder
if src_dir not in sys.path:
    sys.path.insert(0, src_dir)

print(src_dir)


import timber_config
importlib.reload(timber_config)

import timber_model
importlib.reload(timber_model)
from timber_model import apply_processings

from copy import deepcopy

model = deepcopy(models)

#
if process:
    apply_processings(model)
# ---------- end py3_3 ----------

py3_4 = Python3Script(model=py3_3.model)  # -> out, geo, frames, out_model
# ---------- py3_4: Python ----------
from compas.geometry import Line, Plane, Frame
from compas.geometry import intersection_segment_plane
from compas.geometry import angle_vectors
from compas.geometry import dot_vectors
from compas.tolerance import TOL
from compas_timber.fabrication import Drilling

from compas.geometry import Transformation

GRIPPER_SEPARATION = 0.8
DRILL_DEPTH = 0.04
DRILL_DIAMETER = 0.0205

BIG_GRIPPER = 0.8
SMALL_GRIPPER = 0.5

mod = model


def get_default_ref_side_index(plane, beam):
        """Get the default reference side index for the given cutting plane and beam.
        This method checks if the cutting plane intersects with the reference sides of the beam
        and returns the index of the reference side with the smallest angle to the plane's normal.

        # NOTE: Consider moving all connection-agnostic utilities (including this one) to a shared location for reuse in fabrication and other modules.

        Parameters
        ----------
        plane : :class:`~compas.geometry.Plane` or :class:`~compas.geometry.Frame`
            The cutting plane.
        beam : :class:`~compas_timber.elements.Beam`
            The beam that is cut by this instance.

        Returns
        -------
        int
            The default ref_side_index for the given cutting plane and beam.

        """
        angles = {}
        max = 100000
        key = 0
        for i, ref_side in enumerate(beam.ref_sides[:4]):
            width, _ = beam.get_dimensions_relative_to_side(i)
            y_seg = Line.from_point_and_vector(ref_side.point, ref_side.yaxis * width)
            # check if the plane intersects with the reference side and the angle between their normals is positive
            dot = dot_vectors(plane.normal, ref_side.normal)
            if dot<max:
                max=dot
                key=i
        return key

geo = []
frames = []
for beam in mod.beams:
    level = beam.attributes.get("level")
    grasp = beam.attributes.get("grasp_frame")
    T = beam.transformation_to_local()
    gc = grasp.copy()
    ref_side = get_default_ref_side_index(Plane.from_frame(grasp), beam)
    T = Transformation.from_change_of_basis(Frame.worldXY(), beam.ref_sides[ref_side])
    print(gc.transformed(T))
    w,h=beam.get_dimensions_relative_to_side(ref_side)
    if beam.attributes["assembly_method"]=="robot":
        frames.append(grasp)
        if beam.blank_length >= 1.0:
            drilling = Drilling(
                start_x=gc.transformed(T).point.x + BIG_GRIPPER/2,
                start_y=gc.transformed(T).point.y,
                depth_limited=True,
                depth=DRILL_DEPTH,
                diameter=DRILL_DIAMETER,
                ref_side_index=ref_side,
                is_joinery=False,
            )
            beam.add_feature(drilling)
            drilling = Drilling(
                start_x=gc.transformed(T).point.x - BIG_GRIPPER/2,
                start_y=gc.transformed(T).point.y,
                depth_limited=True,
                depth=DRILL_DEPTH,
                diameter=DRILL_DIAMETER,
                ref_side_index=ref_side,
                is_joinery=False,
            )
            beam.add_feature(drilling)
            drilling = Drilling(
                start_x=gc.transformed(T).point.x - (BIG_GRIPPER/2 - 0.20),
                start_y=gc.transformed(T).point.y,
                depth_limited=True,
                depth=DRILL_DEPTH,
                diameter=DRILL_DIAMETER,
                ref_side_index=ref_side,
                is_joinery=False,
            )
            beam.add_feature(drilling)

        elif beam.blank_length >= 0.6:
            drilling = Drilling(
                start_x=gc.transformed(T).point.x + SMALL_GRIPPER/2,
                start_y=gc.transformed(T).point.y,
                depth_limited=True,
                depth=DRILL_DEPTH,
                diameter=DRILL_DIAMETER,
                ref_side_index=ref_side,
                is_joinery=False,
            )
            beam.add_feature(drilling)
            drilling = Drilling(
                start_x=gc.transformed(T).point.x - SMALL_GRIPPER/2,
                start_y=gc.transformed(T).point.y,
                depth_limited=True,
                depth=DRILL_DEPTH,
                diameter=DRILL_DIAMETER,
                ref_side_index=ref_side,
                is_joinery=False,
            )
            beam.add_feature(drilling)
            drilling = Drilling(
                start_x=gc.transformed(T).point.x - (SMALL_GRIPPER/2 - 0.05),
                start_y=gc.transformed(T).point.y,
                depth_limited=True,
                depth=DRILL_DEPTH,
                diameter=DRILL_DIAMETER,
                ref_side_index=ref_side,
                is_joinery=False,
            )
            beam.add_feature(drilling)


    try:
        if level==0:
            geo.append(beam.geometry)
    except Exception as e:
        pass

out_model = mod
# ---------- end py3_4 ----------
draw = COMPASDraw(cg=py3_4.frames)  # -> rg
#   port cg: The COMPAS geometry or datastructure to be drawn.
#   port rg: The Rhino geometry object.
# ---------- draw: Python ----------
# r: compas>=2.14.1
"""
Draws COMPAS geometry in Grasshopper.
"""

from typing import Any

import Grasshopper

from compas.scene import SceneObject


class CompasToRhinoGeometry(Grasshopper.Kernel.GH_ScriptInstance):
    def RunScript(self, cg):
        if not cg:
            return None

        return SceneObject(item=cg).draw()
# ---------- end draw ----------
panel_3 = Panel(py3_4.frames)

# ---- group: sequence preview with hierarchy colors
# Preview
python_3_script = Python3Script(model=py3_4.out_model, step=Slider(100, range=0..100))  # -> out, geometry_to_show, colors_to_show, plate, midpoints_to_show, texts_to_show; inputs step: Int32
# ---------- python_3_script: Python ----------
import rhinoscriptsyntax as rs
import scriptcontext as sc
import Rhino.Display as rd
import System.Drawing as sd

from compas.scene import Scene
from compas.geometry import Line, Point
from copy import deepcopy


alpha = 180

COLORS = {
    "primary":      sd.Color.FromArgb(alpha, 220,  50,  50),
    "main_primary": sd.Color.FromArgb(alpha, 150,  80, 220),
    "secondary":    sd.Color.FromArgb(alpha,  50, 150, 220),
    "tertiary":     sd.Color.FromArgb(alpha,  80, 200, 100),
    "shoe":         sd.Color.FromArgb(alpha,  20, 150, 100),
    "plate":        sd.Color.FromArgb(alpha, 100, 100, 100)
}

geometry = []
colors = []


sorted_geometry = []
sorted_colors = []
sorted_midpoints = []
sorted_texts = []
seen = set()


for plate in model.plates:
    geometry.append(plate.geometry)
    colors.append(COLORS["plate"])

sorting_data = []

for beam in model.beams:
    sorting_data.append(beam.attributes.get("sequence_id"))
    hie = beam.attributes.get("hierarchy", "secondary")
    geometry.append(beam.geometry)
    colors.append(COLORS.get(hie, COLORS["secondary"]))

beams = model.beams

sorted_beams = sorted(beams, key = lambda j: beam.attributes.get("sequence_id"))

for beam in sorted_beams:

    sorted_geometry.append(beam.geometry)
    sorted_colors.append(
        COLORS.get(
            beam.attributes.get("hierarchy", "secondary"),
            COLORS["secondary"]
        )
    )


step = max(0, min(step, len(sorted_geometry)))

geometry_to_show = sorted_geometry[:step]
colors_to_show = sorted_colors[:step]
plate = geometry[0]
midpoints_to_show = sorted_midpoints[:step]
texts_to_show = sorted_texts[:step]
# ---------- end python_3_script ----------
compas_draw = COMPASDraw(cg=python_3_script.geometry_to_show)  # -> rg; same code as draw
wires = BrepWireframe(Brep=compas_draw, Density=-1)
preview = CustomPreview(Geometry=compas_draw, Material=python_3_script.colors_to_show)
previewlw = CustomPreviewLineweights(Geometry=wires, Shader=ColourSwatch(SwatchColor=RGB(255, 255, 255)), Absolute=False)

# ---- group: for milling checking
# green for robot
# red for human
python_3_script_2 = Python3Script(model=py3_4.out_model)  # -> out, geometry, plate, colors, beam_name, dimension, length, robot, assembly_order
# ---------- python_3_script_2: Python ----------
import rhinoscriptsyntax as rs
import scriptcontext as sc
import Rhino.Display as rd
import System.Drawing as sd


alpha = 180

COLORS = {
    "robot": sd.Color.FromArgb(alpha, 0, 200, 100),
    "human": sd.Color.FromArgb(alpha, 220, 50, 50),
    "plate": sd.Color.FromArgb(alpha, 100, 100, 100),
    "default": sd.Color.FromArgb(alpha, 148, 148, 255)
}


# ==========================================================
# Outputs containers
# ==========================================================

geometry = []
colors = []

beam_name = []
dimension = []
length = []
robot = []
assembly_order = []


# ==========================================================
# Plates
# ==========================================================

for plate in model.plates:
    geometry.append(plate.geometry)
    colors.append(COLORS["plate"])


# ==========================================================
# Level 0 beams only
# ==========================================================

for beam in model.beams:

    level = beam.attributes.get("level")

    if level == 0:

        geometry.append(beam.geometry)

        assembly_method = beam.attributes.get("assembly_method")

        if assembly_method == "robot":
            colors.append(COLORS["robot"])
            robot.append(True)

        elif assembly_method == "human":
            colors.append(COLORS["human"])
            robot.append(False)

        else:
            colors.append(COLORS["default"])
            robot.append(None)

        beam_name.append(beam.name)

        assembly_order.append(
            beam.attributes.get("sequence_id")
        )

        dimension.append(
            "{:.0f} x {:.0f} mm".format(
                beam.width * 1000,
                beam.height * 1000
            )
        )

        length.append(
            round(beam.length * 1000, 1)
        )


# ==========================================================
# GH Outputs
# ==========================================================

plate = geometry[0] if geometry else None
# ---------- end python_3_script_2 ----------
compas_draw_2 = COMPASDraw(cg=python_3_script_2.geometry)  # -> rg; same code as draw
compas_draw_3 = COMPASDraw()  # -> rg; same code as draw
wires_2 = BrepWireframe(Brep=compas_draw_2, Density=-1)
preview_2 = CustomPreview(Geometry=compas_draw_2, Material=python_3_script_2.colors)
previewlw_2 = CustomPreviewLineweights(Geometry=wires_2, Shader=ColourSwatch(SwatchColor=RGB(255, 255, 255)), Absolute=False)

# ----
python_3_script_3 = Python3Script(model=py3_4.out_model)  # -> out, geometry, blank, consoles_position, gripper_position
# ---------- python_3_script_3: Python ----------
from compas_timber.planning import BeamStock
from compas_timber.planning import BeamNester
from compas_timber.planning import set_gripper_positions

from compas.geometry import Point
from compas.geometry import Vector
from compas.geometry import Translation

from ghpythonlib.treehelpers import list_to_tree


# ==========================================================
# Settings
# ==========================================================

STOCK_LENGTH = 5.0
SPACING = 0.03
ONLY_LEVEL_0 = True


# ==========================================================
# Helpers
# ==========================================================

def get_cross_sections_from_model(model):
    cross_sections = []

    for beam in model.beams:
        section = tuple(sorted((beam.width, beam.height)))

        if section not in cross_sections:
            cross_sections.append(section)

    return cross_sections


def get_vertices_from_geometry(geometry):
    if hasattr(geometry, "to_vertices_and_faces"):
        vertices, faces = geometry.to_vertices_and_faces()
        return [Point(*xyz) for xyz in vertices]

    if hasattr(geometry, "vertices"):
        return list(geometry.vertices)

    raise ValueError("Cannot extract vertices from geometry: {}".format(type(geometry)))


def get_blank_left_upper_corner(local_blank):
    """
    找出 blank 在 local coordinate 裡的左上角。

    定義：
    left  = minimum X
    upper = maximum Z
    side  = minimum Y

    所以這裡使用：
    x = min X
    y = min Y
    z = max Z

    如果你想用另一側的左上角，可以把 min_y 改成 max_y。
    """

    vertices = get_vertices_from_geometry(local_blank)

    min_x = min(pt.x for pt in vertices)
    min_y = min(pt.y for pt in vertices)
    max_z = max(pt.z for pt in vertices)

    return Point(min_x, min_y, max_z)


def align_beam_by_own_blank_corner(beam):
    """
    每一根 beam 使用自己的 blank 左上角對齊 World 0,0,0。

    回傳：
    aligned_geo
    aligned_blank
    T_align
    corner
    """

    # 1. 取得加工後 geometry
    if hasattr(beam, "elementgeometry"):
        beam_geo = beam.elementgeometry
    else:
        beam_geo = beam.geometry

    # 2. 轉到這根 beam 自己的 local coordinate
    T_local = beam.transformation_to_local()

    local_geo = beam_geo.transformed(T_local)
    local_blank = beam.blank.transformed(T_local)

    # 3. 找這根 beam 自己 blank 的左上角
    corner = get_blank_left_upper_corner(local_blank)

    # 4. 每根 beam 各自建立不同的平移 transformation
    T_align = Translation.from_vector(
        Vector(
            -corner.x,
            -corner.y,
            -corner.z
        )
    )

    # 5. 各自套用不同 transformation
    aligned_geo = local_geo.transformed(T_align)
    aligned_blank = local_blank.transformed(T_align)

    return aligned_geo, aligned_blank, T_align, corner


# ==========================================================
# Step 1: calculate gripper positions
# ==========================================================

set_gripper_positions(model)


# ==========================================================
# Step 2: calculate console positions from nesting
# ==========================================================

stock_catalog = [
    BeamStock(STOCK_LENGTH, section)
    for section in get_cross_sections_from_model(model)
]

nester = BeamNester(
    model,
    stock_catalog,
    SPACING,
    per_group=True
)

nesting_result = nester.nest(
    fast=False,
    consoles=True,
    optimize=True
)


# ==========================================================
# Step 3: build beam guid -> local console positions map
# ==========================================================

beam_console_x_map = {}

for stock in nesting_result.stocks:

    stock_console_positions = stock.consoles_positions or []

    for guid, data in stock.element_data.items():

        frame = data.get("frame")
        beam = model.element_by_guid(str(guid))

        if frame is None or beam is None:
            continue

        beam_start_x = frame.point.x
        beam_end_x = beam_start_x + beam.blank_length

        local_console_xs = []

        for console_x in stock_console_positions:

            if beam_start_x <= console_x <= beam_end_x:
                local_x = console_x - beam_start_x
                local_console_xs.append(local_x)

        beam_console_x_map[str(guid)] = local_console_xs


# ==========================================================
# Outputs as nested lists
# one branch = one beam
# ==========================================================

geometry_data = []
blank_data = []
consoles_position_data = []
gripper_position_data = []


# ==========================================================
# Step 4: align every beam independently
# ==========================================================

for beam in model.beams:

    level = beam.attributes.get("level")

    if ONLY_LEVEL_0 and level != 0:
        continue

    aligned_geo, aligned_blank, T_align, corner = align_beam_by_own_blank_corner(beam)

    geometry_data.append([aligned_geo])
    blank_data.append([aligned_blank])

    # ------------------------------------------------------
    # Console positions
    # ------------------------------------------------------

    console_points = []

    local_console_xs = beam_console_x_map.get(str(beam.guid), [])

    for local_x in local_console_xs:

        p = Point(local_x, 0, 0)
        p.transform(T_align)
        console_points.append(p)

    consoles_position_data.append(console_points)

    # ------------------------------------------------------
    # Gripper position
    # ------------------------------------------------------

    gp = beam.attributes.get("gripper_position", None)

    if gp is not None:
        p = Point(float(gp), 0, 0)
        p.transform(T_align)
        gripper_position_data.append([p])
    else:
        gripper_position_data.append([])


# ==========================================================
# GH Outputs
# ==========================================================

geometry = list_to_tree(geometry_data)
blank = list_to_tree(blank_data)
consoles_position = list_to_tree(consoles_position_data)
gripper_position = list_to_tree(gripper_position_data)
# ---------- end python_3_script_3 ----------
compas_draw_4 = COMPASDraw(cg=python_3_script.plate)  # -> rg; same code as draw
compas_draw_5 = COMPASDraw(cg=python_3_script.midpoints_to_show)  # -> rg; same code as draw
compas_draw_6 = COMPASDraw(cg=python_3_script.plate)  # -> rg; same code as draw

compas_draw_7 = COMPASDraw(cg=python_3_script_2.plate)  # -> rg; same code as draw
preview_3 = CustomPreview(Geometry=compas_draw_7, Material=ColourSwatch(SwatchColor=RGBA(0, 0, 0, 159)))
beam_name = Panel(python_3_script_2.beam_name)
dimension = Panel(python_3_script_2.dimension)
length = Panel(python_3_script_2.length)
robot = Panel(python_3_script_2.robot)
assembly_order = Panel(python_3_script_2.assembly_order)

draw_2 = COMPASDraw(cg=python_3_script_3.geometry)  # -> rg; same code as draw
draw_3 = COMPASDraw(cg=python_3_script_3.blank)  # -> rg; same code as draw
panel_4 = Panel(python_3_script_3.consoles_position)
viewer = ParamViewer(python_3_script_3.consoles_position)
tag = TextTag(Location=compas_draw_5, Text=python_3_script.texts_to_show)
preview_4 = CustomPreview(Geometry=compas_draw_4, Material=ColourSwatch(SwatchColor=RGBA(0, 0, 0, 159)))

py3_5 = Python3Script(models=py3_4.out_model, version=Slider(2, range=1..10), save=Button())  # inputs models: list, version: Int32
# ---------- py3_5: Python ----------
import os, sys, importlib
from datetime import date

from compas.data import json_dump

gh_dir = os.path.dirname(ghenv.Component.OnPingDocument().FilePath)
gh_par = os.path.dirname(gh_dir)
file_path = os.path.join(gh_par, "modularization", "data")

# print(file_path)
today = date.today().strftime("%y%m%d")
# print(today)



if save:
    serializable = []
    for m in models:
        serializable.append({
            "attributes": dict(m.attributes),
            "model": m
        })
        
    output_path = os.path.join(file_path, f"{today}_v{version}_fabrication_model.json")
    dump = json_dump(serializable, output_path, pretty=True)
    print(f"Model written to {output_path}")


# serializable = []
# for m in models:
#     serializable.append({
#         "attributes": dict(m.attributes),
#         "model": m
#     })
# print (serializable)
# ---------- end py3_5 ----------
