# Grasshopper definition 260601_add_gripper_feature_v2_clean.gh (Grasshopper 1.0.8)
# plug-ins: Heteroptera, Human, Increment

# ----
# TimberModel
# Load json file
toggle = BooleanToggle(True)
py3 = Python3Script(load=toggle)  # -> out, timber_models, file_path; inputs load: Boolean
# ---------- py3: Python ----------
from compas.data import json_load
import os, sys, importlib

from copy import deepcopy

gh_dir = os.path.dirname(ghenv.Component.OnPingDocument().FilePath)
gh_par = os.path.dirname(gh_dir)
# file_path = os.path.join(gh_par, "modularization", "data", "260526_v2_timber_models.json")

file_path = os.path.join(gh_par, "timber_design", "data", "260601_v1_timber_models.json")
print(file_path)

if load:
    results = json_load(file_path)
    results = deepcopy(results)

    for data in results:
        model = data['model']
        attrs = data['attributes']
        print (model.attributes.keys())

        model.attributes = attrs
        print (model.attributes.keys())

    timber_models = [data['model'] for data in results]
# ---------- end py3 ----------

list = ValueList({"Zero": 0, "One": 1, "Two": 2, "Three": 2² - 1}, selected="Zero")
item = ListItem(List=py3.timber_models, Index=list, Wrap=True)

# ----
# Process joinery
# (seems cannot orient elements only),
# maybe we can create timber model that is oriented already
toggle_2 = BooleanToggle(True)
py3_2 = Python3Script(model=item, process=toggle_2)  # -> out, model; inputs process: Boolean
# ---------- py3_2: Python ----------
import os, sys, importlib

gh_dir = os.path.dirname(ghenv.Component.OnPingDocument().FilePath)

parent = os.path.dirname(gh_dir)              # go up one level
src_dir = os.path.join(parent, "src")         # go into src folder
if src_dir not in sys.path:
    sys.path.insert(0, src_dir)


import timber_config
importlib.reload(timber_config)

import timber_model
importlib.reload(timber_model)
from timber_model import apply_processings

from copy import deepcopy

model = deepcopy(model)


if process:
    apply_processings(model)
# ---------- end py3_2 ----------

# ---- group: sequence preview from seq_idx attributes & assembly_method
# sequence preview from seq_idx attributes
# & assembly_method
python_3_script = Python3Script(model=py3_2.model)  # -> out, tag_point, tag_text, geometry_to_show, colors_to_show, final_model
# ---------- python_3_script: Python ----------
import rhinoscriptsyntax as rs
import scriptcontext as sc
import Rhino.Display as rd
import System.Drawing as sd

from compas.scene import Scene
from compas.geometry import Line, Point
from copy import deepcopy
from compas_timber.elements import Beam

# manual vs robot
# op1 manually level 1 tertiary
# and very small elements
# middle note do 2 by 2

alpha = 120

COLORS = {  
    # "human":        sd.Color.FromArgb(alpha, 220, 50, 50),
    # "robot":        sd.Color.FromArgb(alpha, 80, 200, 100),
    "human":        sd.Color.FromArgb(alpha, 50, 150, 220),
    "robot":        sd.Color.FromArgb(alpha, 20, 150, 100),
    "plate":        sd.Color.FromArgb(alpha, 100, 100, 100)
}

geometry = []
colors = []

geometry_to_show = []
colors_to_show = []
assembly_methods = []

# ------------------------------------------------------------
# plates
# ------------------------------------------------------------
for plate in model.plates:
    geometry.append(plate.geometry)
    colors.append(COLORS["plate"])

    geometry_to_show.append(plate.geometry)
    colors_to_show.append(COLORS["plate"])
    assembly_methods.append("plate")


# ------------------------------------------------------------
# assign assembly method to beams
# ------------------------------------------------------------
for beam in model.beams:
    seq_idx = beam.attributes.get("sequence_id")
    level = beam.attributes.get("level")
    hierarchy = beam.attributes.get("hierarchy")
    direction_id = beam.attributes.get("direction_id")

    assembly_method = None
    
    if level == 0:
        if hierarchy == "shoe" and direction_id == "B":
            assembly_method = "human"
        elif hierarchy == "shoe" and direction_id == "A":
            assembly_method = "robot"
        else:
            assembly_method = "human"
    elif level == 1:
        if hierarchy == "tertiary":
            assembly_method = "human"
        else:
            assembly_method = "robot"

    if assembly_method is None:
        assembly_method = "robot"

    beam.attributes["assembly_method"] = assembly_method

    beam_volume = beam.geometry.volume
    beam.attributes["volume"] = beam_volume

    beam_weight = beam_volume * 470
    beam.attributes["weight"] = beam_weight

    beam_width = beam.width
    beam_height = beam.height

    beam.attributes["crosssection"] = beam_width, "x", beam_height

    beam.attributes["blanklength"] = beam.blank_length

    geometry_to_show.append(beam.geometry)
    colors.append(COLORS[assembly_method])
    assembly_methods.append(assembly_method)

final_model = model
# ---------- end python_3_script ----------

# ----
draw = COMPASDraw(cg=python_3_script.tag_point)  # -> rg
#   port cg: The COMPAS geometry or datastructure to be drawn.
#   port rg: The Rhino geometry object.
# ---------- draw: Python ----------
# r: compas>=2.14.1
"""
Draws COMPAS geometry in Grasshopper.
"""

from typing import Any

import Grasshopper

from compas.scene import SceneObject


class CompasToRhinoGeometry(Grasshopper.Kernel.GH_ScriptInstance):
    def RunScript(self, cg):
        if not cg:
            return None

        return SceneObject(item=cg).draw()
# ---------- end draw ----------
text_tag = TextTag(Location=draw, Text=python_3_script.tag_text, Colour=ColourSwatch(SwatchColor=RGB(0, 0, 14)))
panel = Panel(python_3_script.final_model)
compas_draw = COMPASDraw(cg=python_3_script.geometry_to_show)  # -> rg; same code as draw
preview = CustomPreview(Geometry=compas_draw, Material=python_3_script.colors_to_show)
wires = BrepWireframe(Brep=compas_draw, Density=-1)
previewlw = CustomPreviewLineweights(Geometry=wires, Shader=ColourSwatch(SwatchColor=RGB(255, 255, 255)), Absolute=False)

# ---- group: add grasp_frame and i_vec as beam attributes
# add grasp_frame and
# insersion vector
# as beam attributes
python_3_script_2 = Python3Script(model=python_3_script.final_model)  # -> out, grasp_planes, beam_faces, i_vectors, final_model, a, tag_points, tag_texts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
# ---------- python_3_script_2: Python ----------
from compas.geometry import Frame, Vector, Point, Line, Rotation
from compas_rhino.conversions import frame_to_rhino_plane, vector_to_rhino, plane_to_rhino, point_to_rhino
from compas_timber.connections import TMultiStepJoint
from compas_timber.elements import CutFeature
import math

grasp_planes = []
beam_faces = []
i_vectors = []

final_model = model

a = []
selected_beams = []
selected_joints = []

seen_beams = set()

for joint in final_model.joints:
    if isinstance(joint, TMultiStepJoint):
        for beam in joint.elements:
            beam_length = beam.attributes.get("blanklength")
            has_middle_joint = beam.attributes.get("has_middle_joint")

            if beam_length > 1.6 and has_middle_joint == False:

                if beam in seen_beams:
                    continue

                seen_beams.add(beam)

                a.append(beam.geometry)
                selected_beams.append(beam)
                selected_joints.append(joint)

# ------------------------------------------------------------
# Settings for grouping similar cuts
# ------------------------------------------------------------
point_tolerance = 1
seen_cut_keys = set()

tag_points = []
tag_texts = []
dc_plane = []
dc_vector = []
bm_plane = []
bm_vector = []
new_i_vec = []

insertion_vectors_by_beam = {}

for i, beam in enumerate(selected_beams):
    lowest_feature_by_type = {}

    features = beam.features

    for j, feature in enumerate(features):
        feature_type = type(feature).__name__

        if feature_type not in ["DoubleCut", "BirdsMouth"]:
            continue

        planes = feature.planes_from_params_and_beam(beam)

        world_down = Vector(0, 0, -1)

        sorted_planes = sorted(
                                planes,
                                key=lambda plane: plane.normal.unitized().dot(world_down),
                                reverse=True
                            )

        level = beam.attributes.get("level")
        if feature_type == "DoubleCut":
            if level == 1:
                selected_plane = sorted_planes[1]
            elif level == 2:
                selected_plane = sorted_planes[0]

        elif feature_type == "BirdsMouth":
            selected_plane = sorted_planes[0]

        selected_point = selected_plane.point

        if feature_type not in lowest_feature_by_type:
            lowest_feature_by_type[feature_type] = (feature, selected_plane, selected_point)
        else:
            current_lowest_point = lowest_feature_by_type[feature_type][2]

            if selected_point.z < current_lowest_point.z:
                lowest_feature_by_type[feature_type] = (feature, selected_plane, selected_point)

    dc_vec = None
    bm_vec = None

    for feature_type, data in lowest_feature_by_type.items():
        feature, selected_plane, selected_point = data

        tag_points.append(point_to_rhino(selected_point))
        tag_texts.append(feature_type)

        if feature_type == "DoubleCut":
            dc_plane.append(plane_to_rhino(selected_plane))
            dc_vec = -selected_plane.normal.copy()
   
            dc_vector.append(vector_to_rhino(dc_vec))

        elif feature_type == "BirdsMouth":
            bm_plane.append(plane_to_rhino(selected_plane))
            bm_vec = selected_plane.normal.copy()

            bm_vector.append(vector_to_rhino(bm_vec))

    if dc_vec and bm_vec:
        dc_vec_u = dc_vec.unitized()
        bm_vec_u = bm_vec.unitized()

        i_vec_lb = (dc_vec_u + bm_vec_u).unitized()

        insertion_vectors_by_beam[beam] = i_vec_lb
        new_i_vec.append(vector_to_rhino(i_vec_lb))


for i, beam in enumerate(final_model.beams):
    # ============================================================
    # Grasp frame
    # ============================================================
    beam_face = beam.side_as_surface(0)
    pick_up_point = beam_face.point_at(0.5, 0.5)
    beam_frame = beam.frame.copy()
    beam_frame.point = pick_up_point

    level = beam.attributes.get("level")
    hierarchy = beam.attributes.get("hierarchy")
    has_middle_joint = beam.attributes.get("has_middle_joint")
    # print(i_vec_lb)
    if level == 0 and hierarchy != "shoe":
        insersion_vec = -Vector.Zaxis()
    elif beam in insertion_vectors_by_beam:
        insersion_vec = insertion_vectors_by_beam[beam]
    elif level == 1 and has_middle_joint:
        insersion_vec = -Vector.Zaxis()
    else:
        insersion_vec = beam_frame.zaxis

    beam.attributes["grasp_frame"] = beam_frame
    beam.attributes["insertion_vector"] = insersion_vec

    grasp_frame = beam.attributes.get("grasp_frame")
    i_vec = beam.attributes.get("insertion_vector")


    grasp_plane = frame_to_rhino_plane(grasp_frame)
    grasp_planes.append(grasp_plane)
    beam_face_mesh = beam_face.to_mesh()
    beam_faces.append(beam_face_mesh)
    i_vector = vector_to_rhino(i_vec)
    i_vectors.append(i_vector)
# ---------- end python_3_script_2 ----------

# ----
compas_draw_2 = COMPASDraw(cg=python_3_script_2.beam_faces)  # -> rg; same code as draw
plane = Plane(python_3_script_2.bm_plane)
vector = Vector(python_3_script_2.dc_vector)
vector_2 = Vector(python_3_script_2.bm_vector)
# 50 & 80 cm the size of GRIPPER
plane_2 = Plane(python_3_script_2.grasp_planes)
plane_3 = Plane(python_3_script_2.dc_plane)
vector_display = VectorDisplay(Anchor=python_3_script_2.bm_plane, Vector=vector_2)
vector_display_2 = VectorDisplay(Anchor=python_3_script_2.dc_plane, Vector=vector)
text_tag_2 = TextTag(Location=python_3_script_2.tag_points, Text=python_3_script_2.tag_texts)
area = Area(Geometry=compas_draw_2)  # -> Area, Centroid
vector_3 = Vector(python_3_script_2.i_vectors)
compas_draw_3 = COMPASDraw(cg=python_3_script_2.a)  # -> rg; same code as draw

btlx = Button()
writebtlx = CTWriteBTLx(model=python_3_script_2.final_model, path=py3.file_path, write=btlx)  # -> BTLx; inputs write: Boolean
#   port model: Model object.
#   port path: Filepath for new BTLx.
#   port write: Write to file.
#   port BTLx: Pretty BTLx string
# ---------- writebtlx: Python ----------
from compas_timber.fabrication import BTLxWriter
from compas.tolerance import TOL

model.tolerance.unit = "M"

def get_file_name(file_path):
    file_path_components = file_path.split('/')
    file_name_and_extension = file_path_components[-1].rsplit('.', 1)
    return file_name_and_extension[0]


dir_path = get_file_name(path)
writer = BTLxWriter(project_name="T2_fabrication")

if write:
    XML = writer.write(model, dir_path+"_fabrication.btlx")
# ---------- end writebtlx ----------

# ----
# new insersion vector!
vector_display_ex = VectorDisplayEx(Point=area.Centroid, Vector=vector_3, Colour=ColourSwatch(SwatchColor=RGB(108, 75, 185)), Width="5")
center = Center(Geometry=compas_draw_3)  # -> Center, Dimension

# ---- group: Gripper holes
py3_3 = Python3Script(model=python_3_script_2.final_model)  # -> out, geo, frames, out_model
# ---------- py3_3: Python ----------
from compas.geometry import Line, Plane, Frame
from compas.geometry import intersection_segment_plane
from compas.geometry import angle_vectors
from compas.geometry import dot_vectors
from compas.tolerance import TOL
from compas_timber.fabrication import Drilling

from compas.geometry import Transformation

GRIPPER_SEPARATION = 0.8
DRILL_DEPTH_1 = 0.04
DRILL_DEPTH_2 = 0.01

DRILL_DIAMETER = 0.0205

BIG_GRIPPER = 0.8
SMALL_GRIPPER = 0.5

mod = model


def get_default_ref_side_index(plane, beam):
        """Get the default reference side index for the given cutting plane and beam.
        This method checks if the cutting plane intersects with the reference sides of the beam
        and returns the index of the reference side with the smallest angle to the plane's normal.

        # NOTE: Consider moving all connection-agnostic utilities (including this one) to a shared location for reuse in fabrication and other modules.

        Parameters
        ----------
        plane : :class:`~compas.geometry.Plane` or :class:`~compas.geometry.Frame`
            The cutting plane.
        beam : :class:`~compas_timber.elements.Beam`
            The beam that is cut by this instance.

        Returns
        -------
        int
            The default ref_side_index for the given cutting plane and beam.

        """
        angles = {}
        max = 100000
        key = 0
        for i, ref_side in enumerate(beam.ref_sides[:4]):
            width, _ = beam.get_dimensions_relative_to_side(i)
            y_seg = Line.from_point_and_vector(ref_side.point, ref_side.yaxis * width)
            # check if the plane intersects with the reference side and the angle between their normals is positive
            dot = dot_vectors(plane.normal, ref_side.normal)
            if dot<max:
                max=dot
                key=i
        return key

geo = []
frames = []
for beam in mod.beams:
    level = beam.attributes.get("level")
    hierarchy = beam.attributes.get("hierarchy")
    grasp = beam.attributes.get("grasp_frame")
    T = beam.transformation_to_local()
    gc = grasp.copy()
    ref_side = get_default_ref_side_index(Plane.from_frame(grasp), beam)
    T = Transformation.from_change_of_basis(Frame.worldXY(), beam.ref_sides[ref_side])
    print(gc.transformed(T))
    w,h=beam.get_dimensions_relative_to_side(ref_side)
    if beam.attributes["assembly_method"]=="robot":
        frames.append(grasp)
        if beam.blank_length >= 1.0:
            drilling = Drilling(
                start_x=gc.transformed(T).point.x + BIG_GRIPPER/2,
                start_y=gc.transformed(T).point.y,
                depth_limited=True,
                depth=DRILL_DEPTH_1,
                diameter=DRILL_DIAMETER,
                ref_side_index=ref_side,
                is_joinery=False,
            )
            beam.add_feature(drilling)
            drilling = Drilling(
                start_x=gc.transformed(T).point.x - BIG_GRIPPER/2,
                start_y=gc.transformed(T).point.y,
                depth_limited=True,
                depth=DRILL_DEPTH_1,
                diameter=DRILL_DIAMETER,
                ref_side_index=ref_side,
                is_joinery=False,
            )
            beam.add_feature(drilling)
            drilling = Drilling(
                start_x=gc.transformed(T).point.x - (BIG_GRIPPER/2 - 0.20),
                start_y=gc.transformed(T).point.y,
                depth_limited=True,
                depth=DRILL_DEPTH_2,
                diameter=DRILL_DIAMETER,
                ref_side_index=ref_side,
                is_joinery=False,
            )
            beam.add_feature(drilling)

        elif beam.blank_length >= 0.6:
            drilling = Drilling(
                start_x=gc.transformed(T).point.x + SMALL_GRIPPER/2,
                start_y=gc.transformed(T).point.y,
                depth_limited=True,
                depth=DRILL_DEPTH_1,
                diameter=DRILL_DIAMETER,
                ref_side_index=ref_side,
                is_joinery=False,
            )
            beam.add_feature(drilling)
            drilling = Drilling(
                start_x=gc.transformed(T).point.x - SMALL_GRIPPER/2,
                start_y=gc.transformed(T).point.y,
                depth_limited=True,
                depth=DRILL_DEPTH_1,
                diameter=DRILL_DIAMETER,
                ref_side_index=ref_side,
                is_joinery=False,
            )
            beam.add_feature(drilling)
            drilling = Drilling(
                start_x=gc.transformed(T).point.x - (SMALL_GRIPPER/2 - 0.05),
                start_y=gc.transformed(T).point.y,
                depth_limited=True,
                depth=DRILL_DEPTH_2,
                diameter=DRILL_DIAMETER,
                ref_side_index=ref_side,
                is_joinery=False,
            )
            beam.add_feature(drilling)


    try:
        if level==0:
        # if level==0 and hierarchy == "shoe":
            geo.append(beam.geometry)
    except Exception as e:
        pass

out_model = mod
# ---------- end py3_3 ----------
draw_2 = COMPASDraw(cg=py3_3.frames)  # -> rg; same code as draw
item_2 = ListItem(List=draw_2, Index=0, Wrap=True)  # -> Item, Item1, Item2
draw_3 = COMPASDraw(cg=py3_3.geo)  # -> rg; same code as draw
panel_2 = Panel(py3_3.frames)
pl = ConstructPlane(Origin=item_2.Item, XAxis=item_2.Item1, YAxis=item_2.Item2)
preview_2 = CustomPreview(
    Geometry=draw_3,
    Material={diffuse=RGB(221, 160, 221), emission=RGB(66, 48, 66), shine=0.5, specular=RGB(255, 255, 255), transparency=0})

individual = BooleanToggle(True)
increment = Increment(BeginningNumber=0, StepSize=1, currentValue=9, increment=1, oldStart=0)  # -> Output, Item
merge = Merge(
    Data1=Slider(0, range=-2.5..2.5),
    Data2=Slider(0, range=-2.5..2.5),
    Data3=Slider(0, range=-2.5..2.5),
    Data4=Slider(0, range=-2.5..2.5))
positioner = Python3Script(model=py3_3.out_model, index=increment.Output, individual=individual)  # -> out, name, summary, geometry, blank, consoles_positions, full_consoles, gripper_positions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; inputs index: Int32, exclude: list of Int32
# ---------- positioner: Python ----------
from compas_timber.planning import BeamStock
from compas_timber.planning import BeamNester

from compas.scene import Scene
from compas.geometry import Transformation
from compas.geometry import Frame
from compas.geometry import Vector
from compas.geometry import Translation

from ghpythonlib.treehelpers import list_to_tree


# ==========================================================
# Helpers
# ==========================================================

def get_bbox_length_from_vertices(vertices):
    xs = []
    ys = []
    zs = []

    for v in vertices:
        if isinstance(v, (list, tuple)):
            x, y, z = v[0], v[1], v[2]
        elif hasattr(v, "point"):
            x, y, z = v.point.x, v.point.y, v.point.z
        else:
            x, y, z = v.x, v.y, v.z

        xs.append(x)
        ys.append(y)
        zs.append(z)

    x_length = max(xs) - min(xs)
    y_length = max(ys) - min(ys)
    z_length = max(zs) - min(zs)

    return max(x_length, y_length, z_length)


def get_cnc_transformation(element, data):
    frame_original = data.get("frame")

    blank_ext = element._resolve_blank_extensions()
    value = blank_ext[0]

    frame = Frame(
        frame_original.point + (value, 0, 0),
        Vector.Xaxis(),
        -Vector.Zaxis()
    )

    offset_transformation = Translation.from_vector(
        Vector.Zaxis() * element.height / 2.0
    )

    cnc_transformation = (
        Transformation.from_frame(frame)
        * offset_transformation
    )

    return cnc_transformation, frame


# ==========================================================
# Scene
# ==========================================================

debug_scene = Scene()
geo_scene = Scene()
blank_scene = Scene()


# ==========================================================
# Stock catalog
# ==========================================================

stock_catalog = [
    BeamStock(5, (0.10, 0.10)),
    BeamStock(5, (0.10, 0.14)),
    BeamStock(5, (0.10, 0.12)),
]


# ==========================================================
# Spacing
# ==========================================================

if individual:
    spacing_value = 100
else:
    spacing_value = spacing


# ==========================================================
# Exclude fallback
# ==========================================================

try:
    exclude_value = exclude
except:
    exclude_value = []


# ==========================================================
# Nesting
# ==========================================================

nester = BeamNester(
    model,
    stock_catalog,
    spacing_value,
    per_group=True
)

nesting_result = nester.nest(
    fast=False,
    consoles=True,
    optimize=True,
    exclude_groups=exclude_value
)


# ==========================================================
# Collect level 0 beams + nesting data only
# ==========================================================

beam_data = []

for stock_i, stock in enumerate(nesting_result.stocks):

    for guid, data in stock.element_data.items():

        element = model.element_by_guid(str(guid))

        if element is None:
            continue

        level = element.attributes.get("level")
        hierarchy = element.attributes.get("hierarchy")

        if level != 0:
            continue
        
        # if level == 0 and hierarchy == "shoe":

        sequence_id = element.attributes.get(
            "sequence_id",
            999999
        )

        beam_data.append({
            "sequence_id": sequence_id,
            "level": level,
            "stock_index": stock_i,
            "stock": stock,
            "element": element,
            "data": data,
            "consoles_positions": stock.consoles_positions or []
        })


# ==========================================================
# Sort level 0 beams by sequence_id
# ==========================================================

beam_data = sorted(
    beam_data,
    key=lambda x: x["sequence_id"]
)


# ==========================================================
# Full consoles positions
# one branch = one level 0 beam, sorted by sequence_id
# ==========================================================

full_consoles_data = []

for item in beam_data:

    element = item["element"]
    data = item["data"]
    frame = data.get("frame")

    beam_start_x = frame.point.x
    beam_end_x = beam_start_x + element.blank_length

    local_consoles = []

    for p in item["consoles_positions"]:

        if beam_start_x <= p <= beam_end_x:
            local_consoles.append(
                round(p - beam_start_x, 2)
            )

    full_consoles_data.append(local_consoles)

full_consoles = list_to_tree(full_consoles_data)


# ==========================================================
# BBox length list
# one value = one level 0 beam, sorted by sequence_id
# ==========================================================

length_list = []

for item in beam_data:

    element = item["element"]
    data = item["data"]

    cnc_transformation, frame = get_cnc_transformation(element, data)

    geo_for_length = element.elementgeometry.transformed(
        cnc_transformation
    )

    bbox_len = round(
        get_bbox_length_from_vertices(geo_for_length.vertices)*1000,
        3
    )

    length_list.append(bbox_len)


# ==========================================================
# Summary, level 0 only, sorted by sequence_id
# ==========================================================

summary_lines = []

for item, local_consoles, bbox_len in zip(
    beam_data,
    full_consoles_data,
    length_list
):

    element = item["element"]
    stock = item["stock"]
    data = item["data"]

    summary_lines.append(
        "SequenceID: {}".format(item["sequence_id"])
    )

    summary_lines.append(
        "BeamName: {}".format(element.name)
    )

    summary_lines.append(
        "StockIndex: {}".format(item["stock_index"])
    )

    summary_lines.append(
        "Dimensions(mm): {:.0f}x{:.0f}x{:.0f}".format(
            stock.cross_section[0] * 1000,
            stock.cross_section[1] * 1000,
            stock.length * 1000
        )
    )

    summary_lines.append(
        "BeamLength(mm): {:.1f}".format(
            data.get("length", 0) * 1000
        )
    )

    summary_lines.append(
        "BBoxLength(m): {:.4f}".format(bbox_len)
    )

    summary_lines.append(
        "Level: {}".format(item["level"])
    )

    summary_lines.append(
        "Consoles(m): {}".format(local_consoles)
    )

    summary_lines.append(
        "Group: {}".format(list(stock.groups))
    )

    summary_lines.append("--------")

summary = "\n".join(summary_lines)


# ==========================================================
# Select one level 0 beam by sorted index
# index = order in level 0 beam_data, not stock index
# ==========================================================

debug_volumes = []

name = None
selected_sequence_id = None
selected_stock_index = None
consoles_positions = []
bbox_length = None

if 0 <= index < len(beam_data):

    item = beam_data[index]

    element = item["element"]
    data = item["data"]

    selected_sequence_id = item["sequence_id"]
    selected_stock_index = item["stock_index"]

    name = element.name

    consoles_positions = full_consoles_data[index]
    bbox_length = length_list[index]

    cnc_transformation, frame = get_cnc_transformation(element, data)

    # ======================================================
    # Geometry
    # ======================================================

    geo = element.elementgeometry.transformed(
        cnc_transformation
    )

    geo_scene.add(geo)

    # ======================================================
    # Blank
    # ======================================================

    local_blank = element.blank.transformed(
        element.transformation_to_local()
    )

    local_blank.transform(
        Transformation.from_frame(frame)
    )

    local_blank.translate(
        Vector.Yaxis() * element.height / 2.0
    )

    blank_scene.add(local_blank)


# ==========================================================
# GH Outputs
# ==========================================================

geometry = geo_scene.draw()
blank = blank_scene.draw()
debug_volumes = list_to_tree(debug_volumes)
# ---------- end positioner ----------
addition = Addition(A=positioner.consoles_positions, B=merge)
panel_3 = Panel(positioner.name)
tag = TextTag(Location="{0,0,0.4}", Text=positioner.name, Colour=ColourSwatch(SwatchColor=RGB(0, 0, 0)))
panel_4 = Panel(positioner.summary)
beam = Beam(G=positioner.geometry, geo=positioner.blank, A=Slider(0, range=0..3))
consoles = Consoles(F=addition)
full_consoles = Panel(positioner.full_consoles)
bbox_length = Panel(positioner.bbox_length)
length_list = Panel(positioner.length_list)
bake = BakeGeometry(Bake=Toggle(False), Geometry=beam, DeleteOldBakes=False, PreserveTrees=False)

bbox = BoundingBox(Content=positioner.geometry, Plane=PlaneXY(0, 0, 0))  # -> Box, Box_2
debrep = DeconstructBrep(Brep=bbox.Box)  # -> Faces, Edges, Vertices
len = Length(Curve=debrep.Edges)
sort = SortList(Keys=len, ValuesA=debrep.Edges)  # -> Keys, ValuesA
item_3 = ListItem(List=reverse(sort.ValuesA), Index=0, Wrap=True)
Z = UnitZ(Factor=Slider(0.25, range=0..1))
move = Move(Geometry=item_3, Motion=Z)  # -> Geometry, Transform
linedim = LineDimension(Line=move.Geometry, Text="{0:0.000}", Size=0.15)

# ----
custom_preview = CustomPreview(
    Geometry=compas_draw_3,
    Material={diffuse=RGB(221, 160, 221), emission=RGB(66, 48, 66), shine=0.5, specular=RGB(255, 255, 255), transparency=0})

vector_4 = Vector(python_3_script_2.new_i_vec)
vector_display_3 = VectorDisplay(Anchor=center.Center, Vector=vector_4)

# ---- group: Gripper holes / for milling checking
# green for robot
# red for human
number_slider = Slider(0, range=0..2)
python_3_script_3 = Python3Script(model=py3_3.out_model, l=number_slider)  # -> out, geometry, plate, colors, beam_name, dimension, blank_length, geo_length, robot, assembly_order
# ---------- python_3_script_3: Python ----------
import rhinoscriptsyntax as rs
import scriptcontext as sc
import Rhino.Display as rd
import System.Drawing as sd


alpha = 180

COLORS = {
    "robot": sd.Color.FromArgb(alpha, 0, 200, 100),
    "human": sd.Color.FromArgb(alpha, 220, 50, 50),
    "plate": sd.Color.FromArgb(alpha, 100, 100, 100),
    "default": sd.Color.FromArgb(alpha, 148, 148, 255)
}


# ==========================================================
# Outputs containers
# ==========================================================

geometry = []
colors = []

beam_name = []
dimension = []
blank_length = []
geo_length = []
robot = []
assembly_order = []


# ==========================================================
# Plates
# ==========================================================

for plate in model.plates:
    geometry.append(plate.geometry)
    colors.append(COLORS["plate"])


# ==========================================================
# Collect beam data first
# ==========================================================

beam_data = []

for beam in model.beams:

    level = beam.attributes.get("level")
    hierarchy = beam.attributes.get("hierarchy")

    # if level == l:
    # if level == l and hierarchy == "shoe":

    assembly_method = beam.attributes.get("assembly_method")

    # --------------------------------------------------
    # Color
    # --------------------------------------------------

    if assembly_method == "robot":
        color = COLORS["robot"]
        robot_value = True

    elif assembly_method == "human":
        color = COLORS["human"]
        robot_value = False

    else:
        color = COLORS["default"]
        robot_value = None

    # --------------------------------------------------
    # Sequence
    # --------------------------------------------------

    seq = beam.attributes.get("sequence_id")

    if seq is None:
        seq = 999999

    # --------------------------------------------------
    # Store everything together
    # --------------------------------------------------

    beam_data.append({

        "sequence_id": seq,

        "geometry": beam.geometry,

        "color": color,

        "beam_name": beam.name,

        "dimension":
            "{:.0f} x {:.0f} mm".format(
                beam.width * 1000,
                beam.height * 1000
            ),

        "geo_length":
            round(beam.length * 1000, 1),

        "blank_length":
            round(beam.blank_length * 1000, 1),

        "robot": robot_value
    })


# ==========================================================
# Sort by assembly order
# ==========================================================

beam_data = sorted(
    beam_data,
    key=lambda x: x["sequence_id"]
)


# ==========================================================
# Rebuild outputs
# ==========================================================

for data in beam_data:

    geometry.append(data["geometry"])

    colors.append(data["color"])

    beam_name.append(data["beam_name"])

    dimension.append(data["dimension"])

    geo_length.append(data["geo_length"])

    blank_length.append(data["blank_length"])

    robot.append(data["robot"])

    assembly_order.append(data["sequence_id"])


# ==========================================================
# GH Outputs
# ==========================================================

plate = geometry[0] if geometry else None
# ---------- end python_3_script_3 ----------
compas_draw_4 = COMPASDraw(cg=python_3_script_3.geometry)  # -> rg; same code as draw
compas_draw_5 = COMPASDraw()  # -> rg; same code as draw
wires_2 = BrepWireframe(Brep=compas_draw_4, Density=-1)
preview_3 = CustomPreview(Geometry=compas_draw_4, Material=python_3_script_3.colors)
previewlw_2 = CustomPreviewLineweights(Geometry=wires_2, Shader=ColourSwatch(SwatchColor=RGB(255, 255, 255)), Absolute=False)

# ----
len_2 = Length(Curve=item_3)
gripper_separation = Slider(1.3, range=0..10)
division = Division(A=len_2, B="2")
list_2 = ValueList({"Medium": 0, "Large": 1, "Custom": 2}, selected="Medium")
X = UnitX(Factor=division)
gripper = Gripper(G=list_2, F=graft(X), A=gripper_separation)

# ---- group: Gripper holes
compas_draw_6 = COMPASDraw(cg=python_3_script_3.plate)  # -> rg; same code as draw
preview_4 = CustomPreview(Geometry=compas_draw_6, Material=ColourSwatch(SwatchColor=RGBA(0, 0, 0, 159)))
beam_name = Panel(python_3_script_3.beam_name)
dimension = Panel(python_3_script_3.dimension)
blank_length = Panel(python_3_script_3.blank_length)
geo_length = Panel(python_3_script_3.geo_length)
robot = Panel(python_3_script_3.robot)
assembly_order = Panel(python_3_script_3.assembly_order)

split = TextSplit(Text=python_3_script_3.dimension, Separators="mm")
item_4 = ListItem(List=split, Index=0, Wrap=True)
flatten = FlattenTree(Tree=item_4, Path="{0}")
panel_5 = Panel(flatten)

# ----
# TimberModel with all attributes
python_3_script_4 = Python3Script(model=python_3_script_2.final_model)  # -> out, weight
# ---------- python_3_script_4: Python ----------
hierarchy = []
edge = []
group = []
level = []
reached = []
has_middle_joint = []
direction_id = []
cyclic_sign = []
sequence_id = []
assembly_method = []
volume = []
weight = []
crosssection = []
blanklength = []
grasp_frame = []
insertion_vector = []

for i, beam in enumerate(model.beams):
    attrs = beam.attributes

    hierarchy.append(attrs.get("hierarchy"))
    edge.append(attrs.get("edge"))
    group.append(attrs.get("group"))
    level.append(attrs.get("level"))
    reached.append(attrs.get("reached"))
    has_middle_joint.append(attrs.get("has_middle_joint"))
    direction_id.append(attrs.get("direction_id"))
    cyclic_sign.append(attrs.get("cyclic_sign"))
    sequence_id.append(attrs.get("sequence_id"))
    assembly_method.append(attrs.get("assembly_method"))
    volume.append(attrs.get("volume"))
    weight.append(attrs.get("weight"))
    crosssection.append(attrs.get("crosssection"))
    blanklength.append(attrs.get("blanklength"))
    grasp_frame.append(attrs.get("grasp_frame"))
    insertion_vector.append(attrs.get("insertion_vector"))

print(beam.attributes)
# ---------- end python_3_script_4 ----------

# ---- group: Gripper holes
debrep_2 = DeconstructBrep(Brep=compas_draw_4)  # -> Faces, Edges, Vertices
item_5 = ListItem(List=debrep_2.Vertices, Index=0, Wrap=True)  # -> flatten(Item)
cull_i = CullIndex(List=item_5, Indices=0, Wrap=True)
tag_2 = TextTag(Location=cull_i, Text=python_3_script_3.beam_name, Colour=ColourSwatch(SwatchColor=RGB(0, 0, 0)))

# ----
panel_6 = Panel(python_3_script_4.weight)

# ---- group: Gripper holes
py3_4 = Python3Script(models=py3_3.out_model, version=Slider(1, range=1..10), save=Button())  # inputs models: list, version: Int32
# ---------- py3_4: Python ----------
import os, sys, importlib
from datetime import date

from compas.data import json_dump

gh_dir = os.path.dirname(ghenv.Component.OnPingDocument().FilePath)
gh_par = os.path.dirname(gh_dir)
file_path = os.path.join(gh_par, "modularization", "data")

# print(file_path)
today = date.today().strftime("%y%m%d")
# print(today)



if save:
    serializable = []
    for m in models:
        serializable.append({
            "attributes": dict(m.attributes),
            "model": m
        })
        
    output_path = os.path.join(file_path, f"{today}_v{version}_fabrication_model_0.json")
    dump = json_dump(serializable, output_path, pretty=True)
    print(f"Model written to {output_path}")


# serializable = []
# for m in models:
#     serializable.append({
#         "attributes": dict(m.attributes),
#         "model": m
#     })
# print (serializable)
# ---------- end py3_4 ----------

# ==== cluster Consoles
xz = XZPlane(Origin=Point(0, 0, 0))
pt = ConstructPoint(XCoordinate=0, YCoordinate=0, ZCoordinate=0)
pt_2 = ConstructPoint(
    XCoordinate=Slider(120, range=0..1000),
    YCoordinate=Slider(2500, range=0..10000),
    ZCoordinate=expr("-x", Slider(140, range=0..1000)))
division = Division(A=pt_2, B=1000)
box = Box2Pt(PointA=pt, PointB=division, Plane=PlaneXY(0, 0, 0))
division_2 = Division(A=Slider(70, range=0..100), B=1000)
F = ClusterInput()
Z = UnitZ(Factor=expr("-x", division_2))
X = UnitX(Factor=F)
lng = ListLength(List=X)
series = Series(Start=Slider(0.3, range=0..1), Step=Slider(0.2, range=0..1), Count=lng)
move = Move(Geometry=box, Motion=Z)  # -> Geometry, Transform
move_2 = Move(Geometry=move.Geometry, Motion=X)  # -> Geometry, Transform
geo = Geometry(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)
aligndim = AlignedDimension(Plane=xz, PointA=pt, PointB=X, Offset=expr("-x", series), Text="{0:0.00}", Size=Slider(0.1, range=0..0.1))
preview = CustomPreview(Geometry=[move_2.Geometry, geo], Material=ColourSwatch(SwatchColor=RGBA(0, 0, 0, 119)))

# ==== cluster Beam
X = UnitX(Factor=1)
A = ClusterInput()
subtraction = Subtraction(A=A, B=3)
geo = ClusterInput()
neg = Negative(Value=subtraction)
multiplication = Multiplication(A=90, B=neg)
geo_2 = Geometry(geo)
area = Area(Geometry=geo_2)  # -> Area, Centroid
line = LineSDL(Start=area.Centroid, Direction=X, Length=1)
rot3d = Rotate3D(Geometry=geo_2, Angle=degrees(multiplication), Center=area.Centroid, Axis=line)  # -> Geometry, Transform
debox = DeconstructBox(Box=rot3d.Geometry)  # -> Plane, X, Y, Z
division = Division(A="70", B=1000)
Z = UnitZ(Factor=division)
dedomain = DeconstructDomain(Domain=debox.Z)  # -> Start, End
move = Move(Geometry=rot3d.Geometry, Motion=Z)  # -> Geometry, Transform
subtraction_2 = Subtraction(A=dedomain.End, B=dedomain.Start)
division_2 = Division(A="280", B=1000)
merge = Merge(Data1=graft(rot3d.Geometry), Data2=graft(move.Geometry))
equalst = EqualityWithinTolerance(FirstNumber=subtraction_2, SecondNumber=division_2, Tolerance=0.001)  # -> Equality, Inequality
panel = Panel(equalst.Equality)
graft = GraftTree(Tree=equalst.Equality, IncludeEmptyLists=True, IncludeNullItems=True)
item = ListItem(List=merge, Index=graft, Wrap=True)
edges = BrepEdges(Brep=item)  # -> Naked, Interior, NonManifold
previewlw = CustomPreviewLineweights(Geometry=edges.Interior, Shader=ColourSwatch(SwatchColor=RGB(255, 71, 71)), Absolute=False)
division_3 = Division(A="70", B=1000)
Z_2 = UnitZ(Factor=division_3)
G = ClusterInput()
transform = Transform(Geometry=G, Transform=rot3d.Transform)
move_2 = Move(Geometry=transform, Motion=Z_2)  # -> Geometry, Transform
merge_2 = Merge(Data1=graft(transform), Data2=graft(move_2.Geometry))
item_2 = ListItem(List=merge_2, Index=graft, Wrap=True)
edges_2 = BrepEdges(Brep=item_2)  # -> Naked, Interior, NonManifold
brep = Brep()
brep_2 = ClusterOutput(brep)
preview = CustomPreview(Geometry=item_2, Material=ColourSwatch(SwatchColor=RGBA(255, 171, 97, 119)))
previewlw_2 = CustomPreviewLineweights(Geometry=edges_2.Interior, Shader=ColourSwatch(SwatchColor=RGB(0, 0, 0)), Absolute=False)

# ==== cluster Gripper
medium = Geometry([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])
G = ClusterInput()
long = Geometry([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])
filter = StreamFilter(Gate=G, Stream0=medium, Stream1=long, Stream2=long)
A = ClusterInput()
F = ClusterInput()
division = Division(A=Slider(60, range=0..100), B=1000)
division_2 = Division(A=Slider(225, range=0..1000), B=1000)
Z = UnitZ(Factor=division_2)
X = UnitX(Factor=F)
move = Move(Geometry=filter, Motion=Z)  # -> Geometry, Transform
number_slider = Slider(2, range=0..10)
move_2 = Move(Geometry=move.Geometry, Motion=X)  # -> Geometry, Transform
Y = UnitY(Factor=division)
smaller = SmallerThan(FirstNumber=A, SecondNumber=number_slider)  # -> SmallerThan, OrEqualTo
panel = Panel("""33
34
35
36
45
46
47""")
panel_2 = Panel("""25
26
27
28
29
30""")
panel_3 = Panel("""81
82
83
84
85
86""")
move_3 = Move(Geometry=move_2.Geometry, Motion=Y)  # -> Geometry, Transform
filter_2 = StreamFilter(Gate=smaller.OrEqualTo, Stream0=number_slider, Stream1=A)
subtraction = Subtraction(A=number_slider, B=filter_2)
item = ListItem(List=move_3.Geometry, Index=panel_2, Wrap=True)
item_2 = ListItem(List=move_3.Geometry, Index=panel_3, Wrap=True)
item_3 = ListItem(List=move_3.Geometry, Index=36, Wrap=True)
item_4 = ListItem(List=move_3.Geometry, Index=panel, Wrap=True)
cull_i = CullIndex(List=move_3.Geometry, Indices=[panel_3, panel_2, panel], Wrap=True)
division_3 = Division(A=subtraction, B=2)
explode = ExplodeObject(Object=item_3, Recursive=False)
multiplication = Multiplication(A=A, B=Slider(0.5, range=0..1))
X_2 = UnitX(Factor=division_3)
move_4 = Move(Geometry=item_2, Motion=expr("-x", X_2))  # -> Geometry, Transform
move_5 = Move(Geometry=item, Motion=X_2)  # -> Geometry, Transform
area = Area(Geometry=explode)  # -> Area, Centroid
scale_nu = ScaleNU(Geometry=item_3, Plane=area.Centroid, ScaleX=multiplication, ScaleY=1, ScaleZ=1)  # -> Geometry, Transform
filter_3 = StreamFilter(
    Gate=G,
    Stream0=move_3.Geometry,
    Stream1=move_3.Geometry,
    Stream2=[cull_i, move_4.Geometry, move_5.Geometry, scale_nu.Geometry])
preview = CustomPreview(Geometry=filter_3, Material=ColourSwatch(SwatchColor=RGBA(0, 0, 0, 119)))
