# Grasshopper definition 260602_nesting.gh (Grasshopper 1.0.8)
# plug-ins: treesloth01

# ----
# Load json file
toggle = BooleanToggle(True)
py3 = Python3Script(load=toggle)  # -> out, timber_models, file_path; inputs load: Boolean
# ---------- py3: Python ----------
from compas.data import json_load
import os, sys, importlib

from copy import deepcopy



gh_dir = os.path.dirname(ghenv.Component.OnPingDocument().FilePath)
gh_par = os.path.dirname(gh_dir)

file_path = os.path.join(gh_par,"modularization", "data", "260601_v1_timber_models.json")
print(file_path)

if load:
    results = json_load(file_path)
    results = deepcopy(results)

    for data in results:
        model = data['model']
        attrs = data['attributes']
        print (model.attributes.keys())

        model.attributes = attrs
        print (model.attributes.keys())

    timber_models = [data['model'] for data in results]
# ---------- end py3 ----------

path = FilePath("C:\Users\user\github\MAS-2526\10_Timber Rooftop\llhil-t2-fabrication\design\timber_design\data\260526_v1_timber_models.json")
py3_2 = Python3Script(x=path, mod=Slider(0, range=0..3))  # -> out, model, models
# ---------- py3_2: Python ----------
from compas.data import json_load

data = json_load(x)

model = None
models = []

# ==========================================================
# Process all models
# ==========================================================

for i, item in enumerate(data):

    current_model = item.get("model") or item.get("model ")

    if current_model is None:
        print("No model found at index:", i)
        continue

    print("Processing model:", i)

    current_model.process_joinery()

    # collect all processed models
    models.append(current_model)

    # store selected model
    if i == mod:
        model = current_model

# ==========================================================
# Fallback if mod is invalid
# ==========================================================

if model is None:
    print("Warning: mod index not found:", mod)
# ---------- end py3_2 ----------
panel = Panel(path)

# ----
# Load json file
toggle_2 = BooleanToggle(True)
py3_3 = Python3Script(load=toggle_2)  # -> out, timber_models; inputs load: Boolean
# ---------- py3_3: Python ----------
from compas.data import json_load
import os, sys, importlib

from copy import deepcopy

gh_dir = os.path.dirname(ghenv.Component.OnPingDocument().FilePath)
gh_par = os.path.dirname(gh_dir)
file_path = os.path.join(gh_par, "timber_design", "data", "260601_v1_timber_models.json")
print(file_path)

if load:
    results = json_load(file_path)
    results = deepcopy(results)
    
    for data in results:
        model = data['model']
        attrs = data['attributes']
        print (model.attributes.keys())

        model.attributes = attrs
        print (model.attributes.keys())

    timber_models = [data['model'] for data in results]
# ---------- end py3_3 ----------

# ---- group: Nesting
py3_4 = Python3Script(timber_models=py3_3.timber_models)  # -> out, simplify(blank_geo), simplify(blank_aligned), simplify(width_height), simplify(stock_count), simplify(beam_count), simplify(beam_index), simplify(beam_key)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; inputs timber_models: list
# ---------- py3_4: Python ----------
from compas_timber.planning import BeamNester, BeamStock
from compas.geometry import Transformation
from ghpythonlib.treehelpers import list_to_tree

models = timber_models

STOCK_LENGTH = 6.5
SPACING = 0.03

STOCK_ROW_SPACING = 1.0
MODEL_COLUMN_SPACING = 20.0

blank_geo = []
blank_aligned = []
width_height_output = []
beam_count_output = []
beam_index_output = []
beam_key_output = []
beam_name_output = []
blank_length_output = []

stock_count_info = []
nesting_info = []

stock_total_count = 0
stock_count_per_model = []


def format_section(section):
    return "{:.2f} x {:.2f} m".format(section[0], section[1])


for model_i, model in enumerate(models):

    beam_lookup = {
        str(b.guid): (i, b)
        for i, b in enumerate(model.beams)
    }

    cross_sections = []

    for beam in model.beams:
        section = tuple(sorted((beam.width, beam.height)))

        if section not in cross_sections:
            cross_sections.append(section)

    stock_catalog = [
        BeamStock(
            length=STOCK_LENGTH,
            cross_section=section,
            spacing=SPACING,
        )
        for section in cross_sections
    ]

    nester = BeamNester(
        model=model,
        stock_catalog=stock_catalog,
        spacing=SPACING,
        per_group=False,
    )

    result = nester.nest(fast=False)

    nesting_info.append("========== TimberModel {} ==========".format(model_i))
    stock_count_info.append("========== TimberModel {} ==========".format(model_i))

    model_blank_geo_tree = []
    model_blank_aligned_tree = []
    model_width_height_tree = []
    model_beam_count_tree = []
    model_beam_index_tree = []
    model_beam_key_tree = []
    model_beam_name_tree = []
    model_blank_length_tree = []

    model_stock_count = 0
    section_count = {}

    model_x_offset = model_i * MODEL_COLUMN_SPACING
    stock_row_i = 0

    for stock_i, stock in enumerate(result.stocks):

        stock_items = []

        for beam_guid_key, data in stock.element_data.items():

            if str(beam_guid_key) not in beam_lookup:
                continue

            b_index, beam = beam_lookup[str(beam_guid_key)]

            stock_items.append({
                "beam": beam,
                "beam_name": beam.name,
                "beam_index": b_index,
                "length": data["length"],
                "data": data,
                "key": data["key"],
                "section": (beam.width, beam.height)
            })

        split_groups = []
        current_group = []
        current_length = 0.0

        for item in stock_items:

            item_length = item["length"]
            required_length = item_length

            if current_group:
                required_length += SPACING

            if current_group and current_length + required_length > STOCK_LENGTH:
                split_groups.append(current_group)
                current_group = [item]
                current_length = item_length
            else:
                current_group.append(item)
                current_length += required_length

        if current_group:
            split_groups.append(current_group)

        stock_blank_geo_tree = []
        stock_blank_aligned_tree = []
        stock_width_height_tree = []
        stock_beam_count_tree = []
        stock_beam_index_tree = []
        stock_beam_key_tree = []
        stock_beam_name_tree = []
        stock_blank_length_tree = []

        for split_i, split_group in enumerate(split_groups):

            stock_total_count += 1
            model_stock_count += 1

            section_key = format_section(stock.cross_section)

            if section_key not in section_count:
                section_count[section_key] = 0
            section_count[section_key] += 1

            split_name = "BeamStock_{}_{}".format(stock_i, split_i)

            split_blank_geo = []
            split_blank_aligned = []
            split_width_height = []
            split_beam_count = []
            split_beam_index = []
            split_beam_key = []
            split_beam_name = []
            split_blank_length = []

            current_x = 0.0

            x_offset = model_x_offset
            y_offset = stock_row_i * STOCK_ROW_SPACING

            for item in split_group:

                beam = item["beam"]
                length = round(item["length"],2)
                key = item["key"]
                beam_name_value = item["beam_name"]
                section = item["section"]

                split_blank_geo.append(beam.blank)
                split_blank_length.append(length)
                split_beam_index.append(item["beam_index"])
                split_beam_key.append(key)
                split_beam_name.append(beam_name_value)
                split_width_height.append(format_section(section))

                aligned_blank = beam.blank.copy()

                target_frame = item["data"]["frame"].copy()
                target_frame.point.x = x_offset + current_x + length / 2.0
                target_frame.point.y = y_offset
                target_frame.point.z = 0.0

                T = Transformation.from_frame_to_frame(
                    aligned_blank.frame,
                    target_frame
                )

                aligned_blank.transform(T)
                split_blank_aligned.append(aligned_blank)

                current_x += length + SPACING

            total_length = sum(split_blank_length) + max(0, len(split_blank_length) - 1) * SPACING
            waste = STOCK_LENGTH - total_length
            beam_count_in_stock = len(split_group)

            split_beam_count.append(beam_count_in_stock)

            nesting_info.append("{}:".format(split_name))
            nesting_info.append("CrossSection: {}".format(section_key))
            nesting_info.append("BeamCount: {}".format(beam_count_in_stock))
            nesting_info.append("BeamNames: {}".format(split_beam_name))
            nesting_info.append("BeamKeys: {}".format(split_beam_key))
            nesting_info.append("BeamIndices: {}".format(split_beam_index))
            nesting_info.append("BeamLengths: {}".format(split_blank_length))
            nesting_info.append("TotalLength: {:.3f}".format(total_length))
            nesting_info.append("Waste: {:.3f}".format(waste))
            nesting_info.append("--------")

            stock_blank_geo_tree.append(split_blank_geo)
            stock_blank_aligned_tree.append(split_blank_aligned)
            stock_width_height_tree.append(split_width_height)
            stock_beam_count_tree.append(split_beam_count)
            stock_beam_index_tree.append(split_beam_index)
            stock_beam_key_tree.append(split_beam_key)
            stock_beam_name_tree.append(split_beam_name)
            stock_blank_length_tree.append(split_blank_length)

            stock_row_i += 1

        model_blank_geo_tree.append(stock_blank_geo_tree)
        model_blank_aligned_tree.append(stock_blank_aligned_tree)
        model_width_height_tree.append(stock_width_height_tree)
        model_beam_count_tree.append(stock_beam_count_tree)
        model_beam_index_tree.append(stock_beam_index_tree)
        model_beam_key_tree.append(stock_beam_key_tree)
        model_beam_name_tree.append(stock_beam_name_tree)
        model_blank_length_tree.append(stock_blank_length_tree)

    plate_blanks = []

    if hasattr(model, "plates"):
        for plate in model.plates:
            if hasattr(plate, "blank"):
                plate_blanks.append(plate.blank)
            else:
                plate_blanks.append(plate)

    if plate_blanks:
        model_blank_geo_tree.append([plate_blanks])

    stock_count_per_model.append(model_stock_count)

    for section_key, count in section_count.items():
        stock_count_info.append("{}: {}".format(section_key, count))

    stock_count_info.append("Total: {}".format(model_stock_count))
    stock_count_info.append("--------")

    blank_geo.append(model_blank_geo_tree)
    blank_aligned.append(model_blank_aligned_tree)
    width_height_output.append(model_width_height_tree)
    beam_count_output.append(model_beam_count_tree)
    beam_index_output.append(model_beam_index_tree)
    beam_key_output.append(model_beam_key_tree)
    beam_name_output.append(model_beam_name_tree)
    blank_length_output.append(model_blank_length_tree)


blank_geo = list_to_tree(blank_geo)
blank_aligned = list_to_tree(blank_aligned)
width_height = list_to_tree(width_height_output)
beam_count = list_to_tree(beam_count_output)
beam_index = list_to_tree(beam_index_output)
beam_key = list_to_tree(beam_key_output)
beam_name = list_to_tree(beam_name_output)
blank_length = list_to_tree(blank_length_output)

stock_count_info.append("Global total stock count: {}".format(stock_total_count))
stock_count_info.append("Stock count per model: {}".format(stock_count_per_model))

stock_count = "\n".join(stock_count_info)

nesting_info.append("Global total stock count: {}".format(stock_total_count))
nesting_info.append("Stock count per model: {}".format(stock_count_per_model))

nesting_info = "\n".join(nesting_info)
# ---------- end py3_4 ----------
nesting_info = Panel(py3_4.nesting_info)
blank_geo = COMPASDraw(cg=py3_4.blank_geo)  # -> simplify(rg)
#   port cg: The COMPAS geometry or datastructure to be drawn.
#   port rg: The Rhino geometry object.
# ---------- blank_geo: Python ----------
# r: compas>=2.14.1
"""
Draws COMPAS geometry in Grasshopper.
"""

from typing import Any

import Grasshopper

from compas.scene import SceneObject


class CompasToRhinoGeometry(Grasshopper.Kernel.GH_ScriptInstance):
    def RunScript(self, cg):
        if not cg:
            return None

        return SceneObject(item=cg).draw()
# ---------- end blank_geo ----------
blank_aligned = COMPASDraw(cg=py3_4.blank_aligned)  # -> simplify(rg); same code as blank_geo

# shortest, longest beam
blank_length = Panel(py3_4.blank_length)
ma = MassAddition(Input=blank_length)  # -> Result, PartialResults
panel_2 = Panel(ma.Result)
beam_name = Panel(py3_4.beam_name)
sort = SortList(Keys=flatten(blank_length))  # -> Keys, ValuesA
first_last = FirstLast(List=sort.Keys)  # -> FirstValue, LastValue
panel_3 = Panel(first_last.FirstValue)
panel_4 = Panel(first_last.LastValue)

# cross-section
width_height = Panel(py3_4.width_height)
stock_count = Panel(py3_4.stock_count)
bbox = BoundingBox(Content=blank_aligned, Plane=PlaneXY(0, 0, 0), UnionBox=True)  # -> Box, Box_2
debrep = DeconstructBrep(Brep=bbox.Box)  # -> Faces, Edges, Vertices
item = ListItem(List=debrep.Faces, Index="3", Wrap=True)
area = Area(Geometry=item)  # -> Area, simplify(Centroid)
X = UnitX(Factor=Slider(-2, range=-10..10))
move = Move(Geometry=area.Centroid, Motion=X)  # -> Geometry, Transform
item_2 = ListItem(List=width_height, Index=0, Wrap=True)
tag = TextTag(Location=move.Geometry, Text=item_2, Colour=ColourSwatch(SwatchColor=RGB(51, 51, 51)))

# beam count in 6.5m timber
beam_count = Panel(py3_4.beam_count)
X_2 = UnitX(Factor=Slider(11, range=-10..20))
move_2 = Move(Geometry=move.Geometry, Motion=X_2)  # -> Geometry, Transform
concat = Concatenate(FragmentA=beam_count, FragmentB="  beams")
tag_2 = TextTag(Location=move_2.Geometry, Text=concat, Colour=ColourSwatch(SwatchColor=RGB(51, 51, 51)))

# ----
volume = Volume(Geometry=blank_aligned)  # -> Volume, Centroid
ma_2 = MassAddition(Input=flatten(volume.Volume))  # -> Result, PartialResults
panel_5 = Panel(ma_2.Result)

# ---- group: Nesting
# cutting line
debrep_2 = DeconstructBrep(Brep=blank_aligned)  # -> Faces, Edges, Vertices
item_3 = ListItem(List=debrep_2.Faces, Index="1", Wrap=True)
area_2 = Area(Geometry=item_3)  # -> Area, Centroid
Y = UnitY(Factor=1)
line = LineSDL(Start=area_2.Centroid, Direction=Y, Length=Slider(0.5, range=0..10))
midpt = CurveMiddle(Curve=line)
orient = Orient(Geometry=line, Source=midpt, Target=area_2.Centroid)  # -> Geometry, Transform

# 6.5 m timber
panel_6 = Panel("-0.05 to 0.05")
box = DomainBox(Base=area.Centroid, X="0 to 6.5", Y=panel_6, Z="-0.06 to 0.06")
move_3 = Move(Geometry=box, Motion="{0,0,-1}")  # -> Geometry, Transform

# ----
neg = Negative(Value=Slider(0.2, range=0..1))
Y_2 = UnitY(Factor=Slider(0.2, range=0..1))
Y_3 = UnitY(Factor=neg)

# ---- group: Nesting
# index
beam_index = Panel(py3_4.beam_index)
beam_key = Panel(py3_4.beam_key)
area_3 = Area(Geometry=blank_aligned)  # -> Area, Centroid

# ----
move_4 = Move(Geometry=area_3.Centroid, Motion=Y_2)  # -> Geometry, Transform

# ---- group: Nesting (continued)
tag_3 = TextTag(Location=move_4.Geometry, Text=beam_name, Colour=ColourSwatch(SwatchColor=RGB(0, 17, 102)))

# blank_length
area_4 = Area(Geometry=blank_aligned)  # -> Area, Centroid
concat_2 = Concatenate(FragmentA=blank_length, FragmentB="  m")

# ----
move_5 = Move(Geometry=area_4.Centroid, Motion=Y_3)  # -> Geometry, Transform

# ---- group: Nesting (continued)
tag_4 = TextTag(Location=move_5.Geometry, Text=concat_2, Colour=ColourSwatch(SwatchColor=RGB(51, 51, 51)))
