# Grasshopper definition 260604_timbermodel_sequence_.ghx (Grasshopper 1.0.8)
# plug-ins: Heteroptera, Human, LunchBox

# ----
# TimberModel
# Load json file
toggle = BooleanToggle(True)
py3 = Python3Script(load=toggle)  # -> out, timber_models; inputs load: Boolean
# ---------- py3: Python ----------
from compas.data import json_load
import os, sys, importlib

from copy import deepcopy

gh_dir = os.path.dirname(ghenv.Component.OnPingDocument().FilePath)
gh_par = os.path.dirname(gh_dir)
# file_path = os.path.join(gh_par, "modularization", "data", "260602_v1_sequenced_timber_model.json")

file_path = os.path.join(gh_par, "timber_design", "data", "260602_v1_timber_models.json")
print(file_path)

if load:
    results = json_load(file_path)
    results = deepcopy(results)

    for data in results:
        model = data['model']
        attrs = data['attributes']
        print (model.attributes.keys())

        model.attributes = attrs
        print (model.attributes.keys())

    timber_models = [data['model'] for data in results]
# ---------- end py3 ----------

list = ValueList({"Zero": 0, "One": 1, "Two": 2, "Three": 2² - 1}, selected="Zero")
item = ListItem(List=py3.timber_models, Index=list, Wrap=True)

# ----
# Process joinery
# (seems cannot orient elements only),
# maybe we can create timber model that is oriented already
toggle_2 = BooleanToggle(True)
py3_2 = Python3Script(model=item, process=toggle_2)  # -> out, model; inputs process: Boolean
# ---------- py3_2: Python ----------
import os, sys, importlib

gh_dir = os.path.dirname(ghenv.Component.OnPingDocument().FilePath)

parent = os.path.dirname(gh_dir)              # go up one level
src_dir = os.path.join(parent, "src")         # go into src folder
if src_dir not in sys.path:
    sys.path.insert(0, src_dir)


import timber_config
importlib.reload(timber_config)

import timber_model
importlib.reload(timber_model)
from timber_model import apply_processings

from copy import deepcopy

model = deepcopy(model)


if process:
    apply_processings(model)
# ---------- end py3_2 ----------

origin_pt = ConstructPoint(XCoordinate="13.821", YCoordinate="8.081", ZCoordinate="0.215")
x_pt = ConstructPoint(XCoordinate="16.201", YCoordinate="8.111", ZCoordinate="0.229")
y_pt = ConstructPoint(XCoordinate="13.776", YCoordinate="9.110", ZCoordinate="0.215")

# ----
# Orient to station
toggle_3 = BooleanToggle(True)
pt = Point(Point(14.01828384, 9.600147889, 0.2339343578))
py3_3 = Python3Script(model=py3_2.model, target_pt=pt, orient=toggle_3)  # -> out, model, geo_tree, frame_tree, from_fr, to_fr; inputs target_pt: Point3d, orient: Boolean
# ---------- py3_3: Python ----------
import os, sys, importlib

gh_dir = os.path.dirname(ghenv.Component.OnPingDocument().FilePath)

parent = os.path.dirname(gh_dir)
src_dir = os.path.join(parent, "src")
if src_dir not in sys.path:
    sys.path.insert(0, src_dir)

from Grasshopper import DataTree
from Grasshopper.Kernel.Data import GH_Path


from compas.geometry import Transformation, Frame, Point, Vector
from copy import deepcopy

geo_tree = DataTree[object]()
frame_tree = DataTree[object]()

# Robot station location
to_fr = []
to_frame = Frame(list(target_pt), [1, 0, 0], [0, 1, 0])
to_fr.append(to_frame)


g = model.attributes['group']
path = GH_Path(g)

# Get ONE clt plate for each module
plate = model.attributes['clt_plate']

# Get special frame for nesting
from_fr = []
from_frame = plate.attributes['negative_frame']
from_fr.append(from_frame)

O = Transformation.from_frame_to_frame(from_frame, to_frame)


frame_tree.Add(from_frame, path)
cut_plane =  model.attributes['cut_plane']

if orient:
    cut_plane.transform(O)

for plate in model.plates:
    geo = plate.geometry
    if orient:
        geo.transform(O)
        plate.transform(O)
        plate.frame.transform(O)
        geo_tree.Add(geo, path)


for beam in model.beams:
    geo = beam.geometry
    if orient:
        beam.transform(O)
        beam.frame.transform(O)
        geo.transform(O)
    geo_tree.Add(geo, path)

for joint in model.joints:
    if orient:
        joint.location.transform(O)

model.attributes['clt_plate'] = plate
# ---------- end py3_3 ----------
draw = COMPASDraw(cg=py3_3.geo_tree)  # -> rg
#   port cg: The COMPAS geometry or datastructure to be drawn.
#   port rg: The Rhino geometry object.
# ---------- draw: Python ----------
# r: compas>=2.14.1
"""
Draws COMPAS geometry in Grasshopper.
"""

from typing import Any

import Grasshopper

from compas.scene import SceneObject


class CompasToRhinoGeometry(Grasshopper.Kernel.GH_ScriptInstance):
    def RunScript(self, cg):
        if not cg:
            return None

        return SceneObject(item=cg).draw()
# ---------- end draw ----------
draw_2 = COMPASDraw(cg=py3_3.frame_tree)  # -> rg; same code as draw

human_scale = Geometry(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)
working_space_rfl = Geometry([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])
rectangle_3pt = Rectangle3Pt(PointA=origin_pt, PointB=x_pt, PointC=y_pt)  # -> Rectangle, Length
for_json = Python3Script(model=py3_2.model, target_pt=pt, orient=toggle_3)  # -> out, model, geo_tree, frame_tree, from_fr, to_fr; inputs target_pt: Point3d, orient: Boolean; disabled
# ---------- for_json: Python ----------
import os, sys, importlib

gh_dir = os.path.dirname(ghenv.Component.OnPingDocument().FilePath)

parent = os.path.dirname(gh_dir)
src_dir = os.path.join(parent, "src")
if src_dir not in sys.path:
    sys.path.insert(0, src_dir)

from Grasshopper import DataTree
from Grasshopper.Kernel.Data import GH_Path


from compas.geometry import Transformation, Frame, Point, Vector
from copy import deepcopy

import compas_timber

geo_tree = DataTree[object]()
frame_tree = DataTree[object]()

# Robot station location
# to_frame = Frame(list(target_pt), [1, 0, 0], [0, 1, 0])

origin_pt = Point(13.821, 8.081, 0.215)
x_pt      = Point(16.201, 8.111, 0.229)
y_pt      = Point(13.776, 9.110, 0.215)

xaxis = Vector.from_start_end(origin_pt, x_pt)
yaxis = Vector.from_start_end(origin_pt, y_pt)

to_fr = []
to_frame = Frame(origin_pt, xaxis, yaxis)
# print(to_frame.zaxis)

to_fr.append(to_frame)


g = model.attributes['group']
path = GH_Path(g)

# Get ONE clt plate for each module
plate = model.attributes['clt_plate']

plate_outline = plate.outline_a
plate_pt_origin = plate_outline.points[0]


# Get special frame for nesting
from_fr = []
# from_frame = plate.attributes['negative_frame']
from_frame = deepcopy(plate.attributes['negative_frame'])
from_frame.point = plate_pt_origin
from_fr.append(from_frame)

O = Transformation.from_frame_to_frame(from_frame, to_frame)


frame_tree.Add(from_frame, path)
# cut_plane = model.attributes['cut_plane']
cut_plane = deepcopy(model.attributes['cut_plane'])


if orient:
    cut_plane.transform(O)

for plate in model.plates:
    geo = plate.geometry
    if orient:
        geo.transform(O)
        plate.transform(O)
        plate.frame.transform(O)
        geo_tree.Add(geo, path)


for beam in model.beams:
    geo = beam.geometry
    if orient:
        beam.centerline.transform(O)
        beam.transform(O)
        beam.frame.transform(O)
        geo.transform(O)
    geo_tree.Add(geo, path)


for joint in model.joints:
    if orient:
        joint.location.transform(O)
        if joint.name == "KBirdsmouthJoint":
            joint.miter_plane.transform(O)
        if joint.name == "LMiterJoint":
            joint.miter_plane.transform(O)


model.attributes['clt_plate'] = plate
model.attributes['cut_plane'] = cut_plane

model.tolerance.absolute = 0.0001
# ---------- end for_json ----------
custom_preview = CustomPreview(Geometry=human_scale, Material=ColourSwatch(SwatchColor=RGB(217, 178, 178)))
custom_preview_2 = CustomPreview(Geometry=working_space_rfl, Material=ColourSwatch(SwatchColor=RGBA(120, 98, 98, 216)))
draw_3 = COMPASDraw(cg=py3_3.from_fr)  # -> rg; same code as draw
draw_4 = COMPASDraw(cg=py3_3.to_fr)  # -> rg; same code as draw
for_visualization = Python3Script(model=py3_2.model, target_pt=pt, orient=toggle_3)  # -> out, model, geo_tree, frame_tree, from_fr, to_fr; inputs target_pt: Point3d, orient: Boolean; disabled
# ---------- for_visualization: Python ----------
import os, sys, importlib

gh_dir = os.path.dirname(ghenv.Component.OnPingDocument().FilePath)

parent = os.path.dirname(gh_dir)
src_dir = os.path.join(parent, "src")
if src_dir not in sys.path:
    sys.path.insert(0, src_dir)

from Grasshopper import DataTree
from Grasshopper.Kernel.Data import GH_Path


from compas.geometry import Transformation, Frame, Point, Vector
from copy import deepcopy

geo_tree = DataTree[object]()
frame_tree = DataTree[object]()

# Robot station location
to_fr = []
to_frame = Frame(list(target_pt), [1, 0, 0], [0, 1, 0])
to_fr.append(to_frame)


g = model.attributes['group']
path = GH_Path(g)

# Get ONE clt plate for each module
plate = model.attributes['clt_plate']

# Get special frame for nesting
from_fr = []
from_frame = plate.attributes['negative_frame']
from_fr.append(from_frame)

O = Transformation.from_frame_to_frame(from_frame, to_frame)


frame_tree.Add(from_frame, path)
cut_plane =  model.attributes['cut_plane']

if orient:
    cut_plane.transform(O)

for plate in model.plates:
    geo = plate.geometry
    if orient:
        geo.transform(O)
        plate.transform(O)
        plate.frame.transform(O)
        geo_tree.Add(geo, path)


for beam in model.beams:
    geo = beam.geometry
    if orient:
        beam.transform(O)
        beam.frame.transform(O)
        geo.transform(O)
    geo_tree.Add(geo, path)

for joint in model.joints:
    if orient:
        joint.location.transform(O)

model.attributes['clt_plate'] = plate
model.attributes['cut_plane'] = cut_plane
# ---------- end for_visualization ----------
geometry = Geometry(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)
wires = BrepWireframe(Brep=geometry, Density=-1)
# manual vs robot
# op1 manually level 1 terciary
# and very small elements
# middle note do 2 by 2
colour_swatch = ColourSwatch(SwatchColor=RGBA(140, 125, 98, 216))
# to compas_timber joints:
# change orientation middle node
custom_preview_3 = CustomPreview(Geometry=geometry, Material=colour_swatch)
previewlw = CustomPreviewLineweights(Geometry=wires, Shader=ColourSwatch(SwatchColor=RGB(0, 0, 0)), Absolute=False)

# ---- group: STEP
# option 1: small middle first by hand
# option 2: big middle by robot + small middle by hand
# 
# level 1: blue-blue-purple-green
# 
# blue-red-green
# 
# blue-purple-green
# 
# red-green
number_slider = Slider(78, range=0..100)

# ----
data = Data(py3_3.model)

# ---- group: copy paste option 1 or option 2
python_3_script = Python3Script(final_models=data)  # -> out, tag_point, tag_text, sorted_points, sorting_data, final_model
# ---------- python_3_script: Python ----------
import math

joints_list = list(final_models.joints)
sorted_joints = sorted(joints_list, key=lambda j: (j.location.x, j.location.y, j.location.z))
# sorted_points = [joint.location for joint in sorted_joints]

joint_rank = {joint: idx for idx, joint in enumerate(sorted_joints)}

unvisited = {(i, beam): beam for i, beam in enumerate(final_models.beams)}
sorting_data = []

for joint in sorted_joints:
    for (i, beam) in list(unvisited):
        if beam not in joint.elements:
            continue

        level = beam.attributes.get("level")
        edge = beam.attributes.get("edge")
        edge_a = edge[0]
        has_middle_joint = beam.attributes.get("has_middle_joint")
        hierarchy = beam.attributes.get("hierarchy")

        if level == 0:
            hierarchy_rank = {"shoe": 0, "tertiary": 2, "secondary": 4, "primary": 4, "main_primary": 4}
            start_priority = beam.centerline.start.z
        elif level == 1:
            hierarchy_rank = {"shoe": 0, "tertiary": 4, "secondary": 2, "primary": 3, "main_primary": 3}
            start_priority = 9999
        else: 
            hierarchy_rank = {"shoe": 0, "tertiary": 2, "secondary": 2, "primary": 4, "main_primary": 4}
            start_priority = 9999
        
        shoe_priority = 0 if hierarchy == "shoe" else 1

        if has_middle_joint and level == 0:
            mid_priority = 1 
        elif has_middle_joint and level == 1:
            mid_priority = 1 
        else: 
            mid_priority = 0

        joint_idx = joint_rank[joint]
        hierarchy_idx = hierarchy_rank.get(hierarchy)
        mid_point = beam.centerline.midpoint
   
        sorting_data.append((
                            shoe_priority,
                            level,
                            mid_priority,
                            hierarchy_idx,
                            edge_a,
                            start_priority,
                            -mid_point.z,
                            joint_idx,
                            i,
                            beam,
                            joint,
                        ))
sorting_data.sort()

pattern = [
    ("secondary", "B"),
    ("secondary", "A"),
    ("main_primary", "A"),
    ("tertiary", "B"),

    ("secondary", "B"),
    ("primary", "B"),
    ("tertiary", "A"),

    ("secondary", "A"),
    ("main_primary", "A"),
    ("tertiary", "B"),

    ("primary", "B"),
    ("tertiary", "A"),
]

# remove duplicate beam entries first
seen = set()
unique_data = []

for data in sorting_data:
    *_, i, beam, joint = data

    if (i, beam) not in seen:
        unique_data.append(data)
        seen.add((i, beam))

sorting_data = unique_data

shoe_data = [data for data in sorting_data if data[-2].attributes.get("hierarchy") == "shoe"]
non_shoe_data = [data for data in sorting_data if data[-2].attributes.get("hierarchy") != "shoe"]

shoe_A = [data for data in shoe_data if data[-2].attributes.get("direction_id") == "A"]
shoe_B = [data for data in shoe_data if data[-2].attributes.get("direction_id") == "B"]

ordered_shoe = []

while shoe_A or shoe_B:
    if shoe_A:
        ordered_shoe.append(shoe_A.pop(0))
    if shoe_B:
        ordered_shoe.append(shoe_B.pop(0))

sorting_data = ordered_shoe + non_shoe_data

# separate levels
level_0 = [data for data in sorting_data
    if data[1] == 0 and data[-2].attributes.get("has_middle_joint") == False]
level_0_middle = [data for data in sorting_data
    if data[1] == 0 and data[-2].attributes.get("has_middle_joint") == True]
level_1_middle = [data for data in sorting_data
    if data[1] == 1 and data[-2].attributes.get("has_middle_joint") == True]
level_1 = [data for data in sorting_data
    if data[1] == 1 and data[-2].attributes.get("has_middle_joint") == False]
level_2 = [data for data in sorting_data if data[1] == 2]
others = [data for data in sorting_data if data[1] not in [0, 1, 2]]

# center point of level 1 joints
cx = sum(data[-1].location.x for data in level_1) / len(level_1)
cy = sum(data[-1].location.y for data in level_1) / len(level_1)

ordered_level_1 = []
remaining = list(level_1)

pattern_idx = 0
anchor_angle = None

while remaining:
    moved = False
    wanted_hierarchy, wanted_direction = pattern[pattern_idx % len(pattern)]
    matching = []

    for data in remaining:
        *_, i, beam, joint = data

        hierarchy = beam.attributes.get("hierarchy")
        direction_id = beam.attributes.get("direction_id")

        if hierarchy != wanted_hierarchy:
            continue
        if wanted_direction is not None and direction_id != wanted_direction:
            continue

        angle = math.atan2(joint.location.y - cy, joint.location.x - cx)
        matching.append((angle, data))

    if matching:
        if wanted_hierarchy in ["primary", "tertiary"] and anchor_angle is not None:
            matching.sort(key=lambda x: min(abs(x[0] - anchor_angle), 2 * math.pi - abs(x[0] - anchor_angle)))

        selected_angle, selected_data = matching[0]

        ordered_level_1.append(selected_data)
        remaining.remove(selected_data)

        if wanted_hierarchy == "secondary":
            anchor_angle = selected_angle

        moved = True

    pattern_idx += 1

ordered_level_1.extend(remaining)
ordered_middle = []

remaining_level_1_middle = list(level_1_middle)
remaining_level_0_middle = list(level_0_middle)

# ------------------------------------------------------------
# Order level 1 middle beams clockwise
# ------------------------------------------------------------
cx_middle = sum(data[-2].centerline.midpoint.x for data in remaining_level_1_middle) / len(remaining_level_1_middle)
cy_middle = sum(data[-2].centerline.midpoint.y for data in remaining_level_1_middle) / len(remaining_level_1_middle)

start_data = sorted(remaining_level_1_middle,
    key=lambda data: (data[-2].centerline.midpoint.x, data[-2].centerline.midpoint.y))[0]

start_pt = start_data[-2].centerline.midpoint
start_angle = math.atan2(start_pt.y - cy_middle, start_pt.x - cx_middle)

clockwise_ordered = []

for data in remaining_level_1_middle:
    pt = data[-2].centerline.midpoint
    angle = math.atan2(pt.y - cy_middle, pt.x - cx_middle)
    clockwise_distance = (start_angle - angle) % (2 * math.pi)
    clockwise_ordered.append((clockwise_distance, data))
clockwise_ordered.sort(key=lambda x: x[0])

remaining_level_1_middle = [data for _, data in clockwise_ordered]

# ------------------------------------------------------------
# Pair each clockwise level 1 middle beam with nearest level 0 middle beam
# ------------------------------------------------------------
while remaining_level_1_middle:
    level_1_data = remaining_level_1_middle.pop(0)

    ordered_middle.append(level_1_data)

    if remaining_level_0_middle:
        nearest_level_0 = min(
            remaining_level_0_middle,
            key=lambda data: (
                (level_1_data[-2].centerline.midpoint.x - data[-2].centerline.midpoint.x) ** 2 +
                (level_1_data[-2].centerline.midpoint.y - data[-2].centerline.midpoint.y) ** 2))

        ordered_middle.append(nearest_level_0)
        remaining_level_0_middle.remove(nearest_level_0)

# if there are leftover level 0 middle beams, add them after
ordered_middle.extend(remaining_level_0_middle)
sorting_data = level_0 + ordered_level_1 + ordered_middle + level_2 + others

beams = final_models.beams
sorted_beams = []

tag_point = []
tag_text = []

local_seq_idx = 0

for data in sorting_data:
    *_, i, beam, joint = data

    if (i, beam) in unvisited:
        beams[i].attributes["sequence_id"] = local_seq_idx
        sorted_beams.append(beam.geometry)
        local_seq_idx += 1

        tag_point.append(beam.centerline.point_at(0.3))
        tag_text.append(beam.name)
        # tag_text.append(str(beam.attributes.get("sequence_id")))


        del unvisited[(i, beam)]

final_model = final_models
# ---------- end python_3_script ----------

# ---- group: option 1: small middle first by hand
# to do:
# DONE vizualize robot versus human with colors
# add feature for drilling to robot beams
# DONE add picking frame to beam atributes
# DONE calculate insersion vector - for now use z vector of picking frame
# KINDA DONE add support for hangguing beams (do we mill?)
python_3_script_2 = Python3Script(final_models=data)  # -> out, tag_point, tag_text, sorted_points, sorting_data, final_model; disabled
# ---------- python_3_script_2: Python ----------
import math

joints_list = list(final_models.joints)
sorted_joints = sorted(joints_list, key=lambda j: (j.location.x, j.location.y, j.location.z))
sorted_points = [joint.location for joint in sorted_joints]

joint_rank = {joint: idx for idx, joint in enumerate(sorted_joints)}

unvisited = {(i, beam): beam for i, beam in enumerate(final_models.beams)}
sorting_data = []

for joint in sorted_joints:
    for (i, beam) in list(unvisited):
        if beam not in joint.elements:
            continue

        level = beam.attributes.get("level")
        edge = beam.attributes.get("edge")
        edge_a = edge[0]

        has_middle_joint = beam.attributes.get("has_middle_joint")

        if level == 0:
            hierarchy_rank = {"shoe": 0, "tertiary": 2, "secondary": 4, "primary": 4, "main_primary": 4}
            start_priority = beam.centerline.start.z
        elif level == 1:
            hierarchy_rank = {"shoe": 0, "tertiary": 4, "secondary": 2, "primary": 3, "main_primary": 3}
            start_priority = 9999
        else: 
            hierarchy_rank = {"shoe": 0, "tertiary": 2, "secondary": 2, "primary": 4, "main_primary": 4}
            start_priority = 9999

        hierarchy = beam.attributes.get("hierarchy", "")
        shoe_priority = 0 if hierarchy == "shoe" else 1

        if has_middle_joint and level == 0:
            mid_priority = 1 
        elif has_middle_joint and level == 1:
            mid_priority = 1 
        else: 
            mid_priority = 0

        
        joint_idx = joint_rank[joint]
        hierarchy_idx = hierarchy_rank.get(hierarchy)
        mid_point = beam.centerline.midpoint
   
        sorting_data.append((
                            shoe_priority,
                            level,
                            mid_priority,
                            hierarchy_idx,
                            edge_a,
                            start_priority,
                            mid_point.z,
                            joint_idx,
                            i,
                            beam,
                            joint,
                        ))
        
sorting_data.sort()

pattern = [
    ("secondary", "B"),
    ("secondary", "A"),
    ("main_primary", "A"),
    ("tertiary", "B"),

    ("secondary", "B"),
    ("primary", "B"),
    ("tertiary", "A"),

    ("secondary", "A"),
    ("main_primary", "A"),
    ("tertiary", "B"),

    ("primary", "B"),
    ("tertiary", "A"),
]

# remove duplicate beam entries first
seen = set()
unique_data = []

for data in sorting_data:
    *_, i, beam, joint = data

    if (i, beam) not in seen:
        unique_data.append(data)
        seen.add((i, beam))

sorting_data = unique_data

# separate levels
level_0 = [data for data in sorting_data if data[1] == 0]

level_1 = [
    data for data in sorting_data
    if data[1] == 1 and data[-2].attributes.get("has_middle_joint") == False]

level_1_middle = [
    data for data in sorting_data
    if data[1] == 1 and data[-2].attributes.get("has_middle_joint") == True]

level_2 = [data for data in sorting_data if data[1] == 2]
others = [data for data in sorting_data if data[1] not in [0, 1, 2]]

# center point of level 1 joints
cx = sum(data[-1].location.x for data in level_1) / len(level_1)
cy = sum(data[-1].location.y for data in level_1) / len(level_1)

ordered_level_1 = []
remaining = list(level_1)

pattern_idx = 0
anchor_angle = None

while remaining:
    moved = False

    wanted_hierarchy, wanted_direction = pattern[pattern_idx % len(pattern)]
    matching = []

    for data in remaining:
        *_, i, beam, joint = data

        hierarchy = beam.attributes.get("hierarchy")
        direction_id = beam.attributes.get("direction_id")

        if hierarchy != wanted_hierarchy:
            continue
        if wanted_direction is not None and direction_id != wanted_direction:
            continue

        angle = math.atan2(joint.location.y - cy, joint.location.x - cx)
        matching.append((angle, data))

    if matching:
        if wanted_hierarchy in ["primary", "tertiary"] and anchor_angle is not None:
            matching.sort(key=lambda x: min(abs(x[0] - anchor_angle), 2 * math.pi - abs(x[0] - anchor_angle)))

        selected_angle, selected_data = matching[0]

        ordered_level_1.append(selected_data)
        remaining.remove(selected_data)

        if wanted_hierarchy == "secondary":
            anchor_angle = selected_angle

        moved = True

    pattern_idx += 1

ordered_level_1.extend(remaining)
sorting_data = level_0 + ordered_level_1 + level_1_middle + level_2 + others

beams = final_models.beams
sorted_beams = []

tag_point = []
tag_text = []

local_seq_idx = 0

for data in sorting_data:
    *_, i, beam, joint = data

    if (i, beam) in unvisited:
        beams[i].attributes["sequence_id"] = local_seq_idx
        sorted_beams.append(beam.geometry)
        local_seq_idx += 1

        tag_point.append(beam.centerline.midpoint)
        tag_text.append(str(beam.attributes.get("direction_id")))

        del unvisited[(i, beam)]

final_model = final_models
# ---------- end python_3_script_2 ----------

# ----
draw_5 = COMPASDraw(cg=python_3_script.tag_point)  # -> rg; same code as draw
draw_6 = COMPASDraw(cg=python_3_script.sorted_points)  # -> rg; same code as draw
text_tag = TextTag(Location=draw_5, Text=python_3_script.tag_text)

# ---- group: option 2: big middle by robot + small middle by hand
python_3_script_3 = Python3Script(final_models=data)  # -> out, tag_point, tag_text, sorted_points, sorting_data, final_model; disabled
# ---------- python_3_script_3: Python ----------
import math

joints_list = list(final_models.joints)
sorted_joints = sorted(joints_list, key=lambda j: (j.location.x, j.location.y, j.location.z))
sorted_points = [joint.location for joint in sorted_joints]

joint_rank = {joint: idx for idx, joint in enumerate(sorted_joints)}

unvisited = {(i, beam): beam for i, beam in enumerate(final_models.beams)}
sorting_data = []

for joint in sorted_joints:
    for (i, beam) in list(unvisited):
        if beam not in joint.elements:
            continue

        level = beam.attributes.get("level")
        edge = beam.attributes.get("edge")
        edge_a = edge[0]

        has_middle_joint = beam.attributes.get("has_middle_joint")

        if level == 0:
            hierarchy_rank = {"shoe": 0, "tertiary": 2, "secondary": 4, "primary": 4, "main_primary": 4}
            start_priority = beam.centerline.start.z
        elif level == 1:
            hierarchy_rank = {"shoe": 0, "tertiary": 4, "secondary": 2, "primary": 3, "main_primary": 3}
            start_priority = 9999
        else: 
            hierarchy_rank = {"shoe": 0, "tertiary": 2, "secondary": 2, "primary": 4, "main_primary": 4}
            start_priority = 9999

        hierarchy = beam.attributes.get("hierarchy", "")
        shoe_priority = 0 if hierarchy == "shoe" else 1

        if has_middle_joint and level == 0:
            mid_priority = 1 
        elif has_middle_joint and level == 1:
            mid_priority = 1 
        else: 
            mid_priority = 0

        
        joint_idx = joint_rank[joint]
        hierarchy_idx = hierarchy_rank.get(hierarchy)
        mid_point = beam.centerline.midpoint
   
        sorting_data.append((
                            shoe_priority,
                            level,
                            mid_priority,
                            hierarchy_idx,
                            edge_a,
                            start_priority,
                            mid_point.z,
                            joint_idx,
                            i,
                            beam,
                            joint,
                        ))
        
sorting_data.sort()

pattern = [
    ("secondary", "B"),
    ("secondary", "A"),
    ("main_primary", "A"),
    ("tertiary", "B"),

    ("secondary", "B"),
    ("primary", "B"),
    ("tertiary", "A"),

    ("secondary", "A"),
    ("main_primary", "A"),
    ("tertiary", "B"),

    ("primary", "B"),
    ("tertiary", "A"),
]

# remove duplicate beam entries first
seen = set()
unique_data = []

for data in sorting_data:
    *_, i, beam, joint = data

    if (i, beam) not in seen:
        unique_data.append(data)
        seen.add((i, beam))

sorting_data = unique_data

# separate levels
level_0 = [data for data in sorting_data
    if data[1] == 0 and data[-2].attributes.get("has_middle_joint") == False]
level_0_middle = [data for data in sorting_data
    if data[1] == 0 and data[-2].attributes.get("has_middle_joint") == True]
level_1_middle = [data for data in sorting_data
    if data[1] == 1 and data[-2].attributes.get("has_middle_joint") == True]
level_1 = [data for data in sorting_data
    if data[1] == 1 and data[-2].attributes.get("has_middle_joint") == False]
level_2 = [data for data in sorting_data if data[1] == 2]
others = [data for data in sorting_data if data[1] not in [0, 1, 2]]

# center point of level 1 joints
cx = sum(data[-1].location.x for data in level_1) / len(level_1)
cy = sum(data[-1].location.y for data in level_1) / len(level_1)

ordered_level_1 = []
remaining = list(level_1)

pattern_idx = 0
anchor_angle = None

while remaining:
    moved = False
    wanted_hierarchy, wanted_direction = pattern[pattern_idx % len(pattern)]
    matching = []

    for data in remaining:
        *_, i, beam, joint = data

        hierarchy = beam.attributes.get("hierarchy")
        direction_id = beam.attributes.get("direction_id")

        if hierarchy != wanted_hierarchy:
            continue
        if wanted_direction is not None and direction_id != wanted_direction:
            continue

        angle = math.atan2(joint.location.y - cy, joint.location.x - cx)
        matching.append((angle, data))

    if matching:
        if wanted_hierarchy in ["primary", "tertiary"] and anchor_angle is not None:
            matching.sort(key=lambda x: min(abs(x[0] - anchor_angle), 2 * math.pi - abs(x[0] - anchor_angle)))

        selected_angle, selected_data = matching[0]

        ordered_level_1.append(selected_data)
        remaining.remove(selected_data)

        if wanted_hierarchy == "secondary":
            anchor_angle = selected_angle

        moved = True

    pattern_idx += 1

ordered_level_1.extend(remaining)
ordered_middle = []

remaining_level_1_middle = list(level_1_middle)
remaining_level_0_middle = list(level_0_middle)

# ------------------------------------------------------------
# Order level 1 middle beams clockwise
# ------------------------------------------------------------
cx_middle = sum(data[-2].centerline.midpoint.x for data in remaining_level_1_middle) / len(remaining_level_1_middle)
cy_middle = sum(data[-2].centerline.midpoint.y for data in remaining_level_1_middle) / len(remaining_level_1_middle)

start_data = sorted(
    remaining_level_1_middle,
    key=lambda data: (data[-2].centerline.midpoint.x, data[-2].centerline.midpoint.y))[0]

start_pt = start_data[-2].centerline.midpoint
start_angle = math.atan2(start_pt.y - cy_middle, start_pt.x - cx_middle)

clockwise_ordered = []

for data in remaining_level_1_middle:
    pt = data[-2].centerline.midpoint
    angle = math.atan2(pt.y - cy_middle, pt.x - cx_middle)
    clockwise_distance = (start_angle - angle) % (2 * math.pi)
    clockwise_ordered.append((clockwise_distance, data))
clockwise_ordered.sort(key=lambda x: x[0])

remaining_level_1_middle = [data for _, data in clockwise_ordered]

# ------------------------------------------------------------
# Pair each clockwise level 1 middle beam with nearest level 0 middle beam
# ------------------------------------------------------------
while remaining_level_1_middle:
    level_1_data = remaining_level_1_middle.pop(0)

    ordered_middle.append(level_1_data)

    if remaining_level_0_middle:
        nearest_level_0 = min(
            remaining_level_0_middle,
            key=lambda data: (
                (level_1_data[-2].centerline.midpoint.x - data[-2].centerline.midpoint.x) ** 2 +
                (level_1_data[-2].centerline.midpoint.y - data[-2].centerline.midpoint.y) ** 2))

        ordered_middle.append(nearest_level_0)
        remaining_level_0_middle.remove(nearest_level_0)

# if there are leftover level 0 middle beams, add them after
ordered_middle.extend(remaining_level_0_middle)
sorting_data = level_0 + ordered_level_1 + ordered_middle + level_2 + others

beams = final_models.beams
sorted_beams = []

tag_point = []
tag_text = []

local_seq_idx = 0

for data in sorting_data:
    *_, i, beam, joint = data

    if (i, beam) in unvisited:
        beams[i].attributes["sequence_id"] = local_seq_idx
        sorted_beams.append(beam.geometry)
        local_seq_idx += 1

        tag_point.append(beam.centerline.midpoint)
        tag_text.append(str(beam.attributes.get("direction_id")))

        del unvisited[(i, beam)]

final_model = final_models
# ---------- end python_3_script_3 ----------

# ---- group: sequence preview with hierarchy colors
# Preview
python_3_script_4 = Python3Script(model=data, sorting_data=python_3_script.sorting_data, step=number_slider)  # -> out, geometry_to_show, colors_to_show, plate, midpoints_to_show, texts_to_show; inputs sorting_data: list, step: Int32
# ---------- python_3_script_4: Python ----------
import rhinoscriptsyntax as rs
import scriptcontext as sc
import Rhino.Display as rd
import System.Drawing as sd

from compas.scene import Scene
from compas.geometry import Line, Point
from copy import deepcopy


alpha = 180

COLORS = {
    "primary":      sd.Color.FromArgb(alpha, 220,  50,  50),
    "main_primary": sd.Color.FromArgb(alpha, 150,  80, 220),
    "secondary":    sd.Color.FromArgb(alpha,  50, 150, 220),
    "tertiary":     sd.Color.FromArgb(alpha,  80, 200, 100),
    "shoe":         sd.Color.FromArgb(alpha,  20, 150, 100),
    "plate":        sd.Color.FromArgb(alpha, 100, 100, 100)
}

# COLORS = {
#     "level_0_shoe": sd.Color.FromArgb(alpha, 220,  50,  50),
#     "level_0_rest": sd.Color.FromArgb(alpha, 255, 150,  50),
#     1:              sd.Color.FromArgb(alpha, 150,  80, 220),
#     2:              sd.Color.FromArgb(alpha,  50, 150, 220),
#     "plate":        sd.Color.FromArgb(alpha, 100, 100, 100)
# }

# def get_level_color_key(beam):
#     level = beam.attributes.get("level")
#     hierarchy = beam.attributes.get("hierarchy")

#     if level == 0 and hierarchy == "shoe":
#         return "level_0_shoe"
#     elif level == 0:
#         return "level_0_rest"
#     else:
#         return level

# COLORS = {
#     "level_0_middle": sd.Color.FromArgb(alpha, 220,  50,  50),
#     "level_1_middle": sd.Color.FromArgb(alpha, 255, 150,  50),
#     "other"         : sd.Color.FromArgb(10, 150,  80, 220),
#     "plate"         : sd.Color.FromArgb(alpha, 100, 100, 100)
# }

# def get_level_color_key(beam):
#     level = beam.attributes.get("level")
#     has_middle_joint = beam.attributes.get("has_middle_joint")

#     if level == 0 and has_middle_joint == True:
#         return "level_0_middle"
#     elif level == 1 and has_middle_joint == True:
#         return "level_1_middle"
#     else:
#         return "other"

geometry = []
colors = []


sorted_geometry = []
sorted_colors = []
sorted_midpoints = []
sorted_texts = []
seen = set()


for plate in model.plates:
    geometry.append(plate.geometry)
    colors.append(COLORS["plate"])

for beam in model.beams:
    hie = beam.attributes.get("hierarchy", "secondary")
    geometry.append(beam.geometry)
    colors.append(COLORS.get(hie, COLORS["secondary"]))
    
    # color_key = get_level_color_key(beam)
    # geometry.append(beam.geometry)
    # colors.append(COLORS.get(color_key, COLORS["level_0_rest"]))
    # colors.append(COLORS.get(color_key, COLORS["other"]))

for data in sorting_data:
    *_, i, _, joint = data

    if i in seen:
        continue

    if 0 <= i < len(model.beams):
        beam = model.beams[i]

        sorted_geometry.append(beam.geometry)
        sorted_colors.append(
            COLORS.get(
                beam.attributes.get("hierarchy", "secondary"),
                COLORS["secondary"]
            )
        )
        # color_key = get_level_color_key(beam)
        # sorted_colors.append(COLORS.get(color_key, COLORS["level_0_rest"]))
        # sorted_colors.append(COLORS.get(color_key, COLORS["other"]))


        # midpoint per beam
        sorted_midpoints.append(beam.centerline.midpoint)

        # first 4 values from sorting_data as text
        sorted_texts.append(" | ".join(str(value) for value in data[:4]))

        seen.add(i)


step = max(0, min(step, len(sorted_geometry)))

geometry_to_show = sorted_geometry[:step]
colors_to_show = sorted_colors[:step]
plate = geometry[0]
midpoints_to_show = sorted_midpoints[:step]
texts_to_show = sorted_texts[:step]
# ---------- end python_3_script_4 ----------
compas_draw = COMPASDraw(cg=python_3_script_4.geometry_to_show)  # -> rg; same code as draw
wires_2 = BrepWireframe(Brep=compas_draw, Density=-1)
preview = CustomPreview(Geometry=compas_draw, Material=python_3_script_4.colors_to_show)
previewlw_2 = CustomPreviewLineweights(Geometry=wires_2, Shader=ColourSwatch(SwatchColor=RGB(255, 255, 255)), Absolute=False)

# ---- group: sequence preview from seq_idx attributes & assembly_method
# sequence preview from seq_idx attributes
# & assembly_method
python_3_script_5 = Python3Script(model=python_3_script.final_model, step=number_slider)  # -> out, tag_point, tag_text, geometry_to_show, colors_to_show, final_model, end_points, support_beams; inputs step: Int32
# ---------- python_3_script_5: Python ----------
import rhinoscriptsyntax as rs
import scriptcontext as sc
import Rhino.Display as rd
import System.Drawing as sd

from compas.scene import Scene
from compas.geometry import Line, Point
from copy import deepcopy
from compas_timber.elements import Beam

# manual vs robot
# op1 manually level 1 tertiary
# and very small elements
# middle note do 2 by 2

alpha = 180

COLORS = {  
    # "human":        sd.Color.FromArgb(alpha, 220, 50, 50),
    # "robot":        sd.Color.FromArgb(alpha, 80, 200, 100),
    "human":        sd.Color.FromArgb(alpha, 220, 50, 50),
    "robot":        sd.Color.FromArgb(alpha, 20, 150, 100),
    "plate":        sd.Color.FromArgb(alpha, 100, 100, 100)
}

geometry = []
colors = []

geometry_to_show = []
colors_to_show = []
assembly_methods = []

# ------------------------------------------------------------
# plates
# ------------------------------------------------------------
for plate in model.plates:
    plate_T = plate.transformation_to_local()
    geometry.append(plate.geometry)
    colors.append(COLORS["plate"])

    geometry_to_show.append(plate.geometry)
    colors_to_show.append(COLORS["plate"])
    assembly_methods.append("plate")


# ------------------------------------------------------------
# assign assembly method to beams
# ------------------------------------------------------------

for beam in model.beams:
    beam.attributes["plate_T"] = plate_T
    seq_idx = beam.attributes.get("sequence_id")
    level = beam.attributes.get("level")
    hierarchy = beam.attributes.get("hierarchy")
    direction_id = beam.attributes.get("direction_id")

    assembly_method = None
    
    if level == 0:
        if hierarchy == "shoe" and direction_id == "B":
            assembly_method = "human"
        elif hierarchy == "shoe" and direction_id == "A":
            assembly_method = "robot"
        else:
            assembly_method = "human"
    elif level == 1:
        if hierarchy == "tertiary":
            assembly_method = "human"
        else:
            assembly_method = "robot"

    if assembly_method is None:
        assembly_method = "robot"

    beam.attributes["assembly_method"] = assembly_method

    beam_volume = beam.geometry.volume
    beam.attributes["volume"] = beam_volume

    beam_weight = beam_volume * 470
    beam.attributes["weight"] = beam_weight

    beam_width = beam.width
    beam_height = beam.height

    beam.attributes["crosssection"] = beam_width, "x", beam_height

    beam.attributes["blanklength"] = beam.blank_length

    geometry.append(beam.geometry)
    colors.append(COLORS[assembly_method])
    assembly_methods.append(assembly_method)


# ------------------------------------------------------------
# sort beams by seq_idx
# ------------------------------------------------------------
sorted_beams = sorted(model.beams, key=lambda beam: beam.attributes.get("sequence_id", 999999))

sorted_geometry = []
sorted_colors = []

for beam in sorted_beams:
    assembly_method = beam.attributes.get("assembly_method", "human")

    sorted_geometry.append(beam.geometry)
    sorted_colors.append(COLORS[assembly_method])


# ------------------------------------------------------------
# slider control
# ------------------------------------------------------------
step = int(step)
step = max(0, min(step, len(sorted_geometry)))

tag_point = []
tag_text = []

for beam, beam_geo, beam_color in zip(sorted_beams[:step], sorted_geometry[:step], sorted_colors[:step]):
    geometry_to_show.append(beam_geo)
    colors_to_show.append(beam_color)
    # tag_point.append(beam.centerline.point_at(0.2))
    # tag_text.append(beam.name)
    # tag_text.append(f"direction_id : {beam.attributes.get('direction_id')}")
    # tag_text.append("{} {}".format(
    #     beam.attributes.get("hierarchy"),
    #     beam.attributes.get("direction_id")
    # ))

    if beam.attributes.get("sequence_id") >= 50:
        tag_point.append(beam.centerline.point_at(0.5))
        tag_text.append(
            f"{beam.attributes.get('hierarchy')} {beam.attributes.get('direction_id')}"
        )

end_points = []
support_beam_line = []
support_beams = []
for i, beam in enumerate(sorted_beams[:step]):
    level = beam.attributes.get("level")
    hierarchy = beam.attributes.get("hierarchy")
    if 42 <= i <= 45:
        end_point = beam.centerline.end
        start_point = beam.centerline.start
        
        p_end_point = end_point.copy()
        p_end_point.z = start_point.z

        end_points.append(p_end_point)

        support_beam_cl = Line(end_point, p_end_point)
        support_beam_line.append(support_beam_cl)
    if 54 <= i <= 57:
        end_point = beam.centerline.end
        start_point = beam.centerline.point_at(0.1)
        # start_point = beam.centerline.start
        
        p_start_point = start_point.copy()
        p_start_point.z = end_point.z

        end_points.append(p_start_point)

        support_beam_cl = Line(start_point, p_start_point)
        support_beam_line.append(support_beam_cl)
    # elif level == 1 and hierarchy == "tertiary":
 

for line in support_beam_line:
    support_beam = Beam.from_centerline(line, 0.1,0.1)
    support_beams.append(support_beam.geometry)



final_model = model
# ---------- end python_3_script_5 ----------

# ----
python_3_script_6 = Python3Script(model=python_3_script.final_model, step=number_slider)  # -> out, tag_point, tag_text, geometry_to_show, colors_to_show, final_model, end_points, support_beams; inputs step: Int32
# ---------- python_3_script_6: Python ----------
import rhinoscriptsyntax as rs
import scriptcontext as sc
import Rhino.Display as rd
import System.Drawing as sd

from compas.scene import Scene
from compas.geometry import Line, Point
from copy import deepcopy
from compas_timber.elements import Beam


# ------------------------------------------------------------
# colors
# ------------------------------------------------------------
alpha = 180

COLORS = {
    "human":         sd.Color.FromArgb(alpha, 220, 50, 50),
    "robot":         sd.Color.FromArgb(alpha, 20, 150, 100),
    "plate":         sd.Color.FromArgb(alpha, 100, 100, 100),

    # grey for early beams, different from plate grey
    "inactive_beam": sd.Color.FromArgb(alpha, 180, 180, 180)
}


# ------------------------------------------------------------
# output lists
# ------------------------------------------------------------
geometry_to_show = []
colors_to_show = []
assembly_methods = []


# ------------------------------------------------------------
# step
# ------------------------------------------------------------
step = int(step)


# ------------------------------------------------------------
# plates always shown
# ------------------------------------------------------------
for plate in model.plates:
    plate_T = plate.transformation_to_local()

    geometry_to_show.append(plate.geometry)
    colors_to_show.append(COLORS["plate"])
    assembly_methods.append("plate")


# ------------------------------------------------------------
# sort beams by sequence_id
# ------------------------------------------------------------
sorted_beams = sorted(
    model.beams,
    key=lambda beam: beam.attributes.get("sequence_id", 999999)
)


# limit step so it does not exceed beam count
step = max(0, min(step, len(sorted_beams)))


# ------------------------------------------------------------
# assign assembly method and beam information
# ------------------------------------------------------------
for beam in sorted_beams:

    beam.attributes["plate_T"] = plate_T

    seq_idx = beam.attributes.get("sequence_id")
    level = beam.attributes.get("level")
    hierarchy = beam.attributes.get("hierarchy")
    direction_id = beam.attributes.get("direction_id")

    assembly_method = None

    if level == 0:
        if hierarchy == "shoe" and direction_id == "B":
            assembly_method = "human"
        elif hierarchy == "shoe" and direction_id == "A":
            assembly_method = "robot"
        else:
            assembly_method = "human"

    elif level == 1:
        if hierarchy == "tertiary":
            assembly_method = "human"
        else:
            assembly_method = "robot"

    if assembly_method is None:
        assembly_method = "robot"

    beam.attributes["assembly_method"] = assembly_method

    beam_volume = beam.geometry.volume
    beam.attributes["volume"] = beam_volume

    beam_weight = beam_volume * 470
    beam.attributes["weight"] = beam_weight

    beam_width = beam.width
    beam_height = beam.height
    beam.attributes["crosssection"] = beam_width, "x", beam_height

    beam.attributes["blanklength"] = beam.blank_length


# ------------------------------------------------------------
# show beams according to slider step
# ------------------------------------------------------------
for i, beam in enumerate(sorted_beams[:step]):

    assembly_method = beam.attributes.get("assembly_method")

    # # beams 0 to 50 stay grey
    # if i <= 69:
    #     display_color = COLORS["inactive_beam"]

    # # beams 51 and above use human / robot color
    # else:
    #     display_color = COLORS[assembly_method]
    display_color = COLORS[assembly_method]
    geometry_to_show.append(beam.geometry)
    colors_to_show.append(display_color)
    assembly_methods.append(assembly_method)
# ---------- end python_3_script_6 ----------
compas_draw_2 = COMPASDraw(cg=python_3_script_4.plate)  # -> rg; same code as draw
compas_draw_3 = COMPASDraw(cg=python_3_script_4.plate)  # -> rg; same code as draw
compas_draw_4 = COMPASDraw(cg=python_3_script_4.midpoints_to_show)  # -> rg; same code as draw
draw_7 = COMPASDraw(cg=python_3_script_5.tag_point)  # -> rg; same code as draw
tag = TextTag(Location=compas_draw_4, Text=python_3_script_4.texts_to_show)
text_tag_2 = TextTag(Location=draw_7, Text=python_3_script_5.tag_text, Colour=ColourSwatch(SwatchColor=RGB(0, 0, 14)))
# make NEW BEAMS as support
compas_draw_5 = COMPASDraw(cg=python_3_script_5.support_beams)  # -> rg; same code as draw
compas_draw_6 = COMPASDraw(cg=python_3_script_5.end_points)  # -> rg; same code as draw
panel = Panel(python_3_script_5.final_model)
compas_draw_7 = COMPASDraw(cg=python_3_script_5.geometry_to_show)  # -> rg; same code as draw
preview_2 = CustomPreview(Geometry=compas_draw_2, Material=ColourSwatch(SwatchColor=RGBA(0, 0, 0, 159)))
preview_3 = CustomPreview(Geometry=compas_draw_7, Material=python_3_script_5.colors_to_show)
wires_3 = BrepWireframe(Brep=compas_draw_7, Density=-1)
dot_display = DotDisplay(Point=compas_draw_6, Colour=RGB(0, 0, 0), Size="0.2")
preview_4 = CustomPreview(Geometry=compas_draw_5, Material=ColourSwatch(SwatchColor=RGBA(255, 255, 60, 143)))
previewlw_3 = CustomPreviewLineweights(Geometry=wires_3, Shader=ColourSwatch(SwatchColor=RGB(255, 255, 255)), Absolute=False)
object_bake = ObjectBake(
    BakeToggle=Button(),
    GeometryObjects=compas_draw_7,
    Layer="GH_Bake",
    ObjectName="GH_Obj",
    ObjectColor=RGB(255, 255, 255),
    LayerColor=RGB(255, 255, 255))
python_3_script_7 = Python3Script(model=python_3_script_5.final_model)  # -> out, grasp_planes, beam_faces, i_vectors, final_model, a, tag_points, tag_texts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
# ---------- python_3_script_7: Python ----------
from compas.geometry import Frame, Vector, Point, Line, Rotation
from compas_rhino.conversions import frame_to_rhino_plane, vector_to_rhino, plane_to_rhino, point_to_rhino
from compas_timber.connections import TMultiStepJoint
from compas_timber.elements import CutFeature
import math


import System.Drawing as sd

# ------------------------------------------------------------
# Colors for insertion vector display
# ------------------------------------------------------------
alpha = 180

RED  = sd.Color.FromArgb(alpha, 220, 50, 50)
GREY = sd.Color.FromArgb(alpha, 160, 160, 160)
PLATE = sd.Color.FromArgb(100, 160, 160, 160)

colors = []
geo = []
sel_vec = []
b_face = []

grasp_planes = []
beam_faces = []
i_vectors = []

final_model = model

a = []
selected_beams = []
selected_joints = []

seen_beams = set()

for joint in final_model.joints:
    if isinstance(joint, TMultiStepJoint):
        for beam in joint.elements:
            beam_length = beam.attributes.get("blanklength")
            has_middle_joint = beam.attributes.get("has_middle_joint")

            if beam_length > 1.6 and has_middle_joint == False:

                if beam in seen_beams:
                    continue

                seen_beams.add(beam)

                a.append(beam.geometry)
                selected_beams.append(beam)
                selected_joints.append(joint)

# ------------------------------------------------------------
# Settings for grouping similar cuts
# ------------------------------------------------------------
point_tolerance = 1
seen_cut_keys = set()

tag_points = []
tag_texts = []
dc_plane = []
dc_vector = []
bm_plane = []
bm_vector = []
new_i_vec = []

insertion_vectors_by_beam = {}

for i, beam in enumerate(selected_beams):
    lowest_feature_by_type = {}

    features = beam.features

    for j, feature in enumerate(features):
        feature_type = type(feature).__name__

        if feature_type not in ["DoubleCut", "BirdsMouth"]:
            continue

        planes = feature.planes_from_params_and_beam(beam)

        world_down = Vector(0, 0, -1)

        sorted_planes = sorted(
                                planes,
                                key=lambda plane: plane.normal.unitized().dot(world_down),
                                reverse=True
                            )

        level = beam.attributes.get("level")
        if feature_type == "DoubleCut":
            if level == 1:
                selected_plane = sorted_planes[1]
            elif level == 2:
                selected_plane = sorted_planes[0]

        elif feature_type == "BirdsMouth":
            selected_plane = sorted_planes[0]

        selected_point = selected_plane.point

        if feature_type not in lowest_feature_by_type:
            lowest_feature_by_type[feature_type] = (feature, selected_plane, selected_point)
        else:
            current_lowest_point = lowest_feature_by_type[feature_type][2]

            if selected_point.z < current_lowest_point.z:
                lowest_feature_by_type[feature_type] = (feature, selected_plane, selected_point)

    dc_vec = None
    bm_vec = None

    for feature_type, data in lowest_feature_by_type.items():
        feature, selected_plane, selected_point = data

        tag_points.append(point_to_rhino(selected_point))
        tag_texts.append(feature_type)

        if feature_type == "DoubleCut":
            dc_plane.append(plane_to_rhino(selected_plane))
            dc_vec = -selected_plane.normal.copy()
   
            dc_vector.append(vector_to_rhino(dc_vec))

        elif feature_type == "BirdsMouth":
            bm_plane.append(plane_to_rhino(selected_plane))
            bm_vec = selected_plane.normal.copy()

            bm_vector.append(vector_to_rhino(bm_vec))

    if dc_vec and bm_vec:
        dc_vec_u = dc_vec.unitized()
        bm_vec_u = bm_vec.unitized()

        i_vec_lb = (dc_vec_u + bm_vec_u).unitized()

        insertion_vectors_by_beam[beam] = i_vec_lb
        new_i_vec.append(vector_to_rhino(i_vec_lb))
    

for i, beam in enumerate(final_model.beams):
    # ============================================================
    # Grasp frame
    # ============================================================
    beam_face = beam.side_as_surface(0)
    pick_up_point = beam_face.point_at(0.5, 0.5)

    beam_frame = beam.frame.copy()
    beam_frame.point = pick_up_point

    level = beam.attributes.get("level")
    hierarchy = beam.attributes.get("hierarchy")
    has_middle_joint = beam.attributes.get("has_middle_joint")

    # ============================================================
    # Insertion vector logic + color logic
    # ============================================================
    if level == 0:
        insersion_vec = -Vector.Zaxis()
        color_to_show = GREY
        geo.append(beam.geometry)
        

    elif beam in insertion_vectors_by_beam:
        insersion_vec = insertion_vectors_by_beam[beam]
        color_to_show = RED
        geo.append(beam.geometry)
        sel_vec.append(vector_to_rhino(insersion_vec))
        b_face.append(beam.side_as_surface(0).point_at(0.5, 0.5))
        

    elif level == 1 and has_middle_joint:
        insersion_vec = -Vector.Zaxis()
        color_to_show = GREY
        geo.append(beam.geometry)
        

    else:
        insersion_vec = beam_frame.zaxis
        color_to_show = GREY
        geo.append(beam.geometry)
       

    # ============================================================
    # Save attributes
    # ============================================================
    beam.attributes["grasp_frame"] = beam_frame
    beam.attributes["insertion_vector"] = insersion_vec

    # ============================================================
    # Grasshopper outputs
    # ============================================================
    grasp_plane = frame_to_rhino_plane(beam_frame)
    grasp_planes.append(grasp_plane)

    beam_face_mesh = beam_face.to_mesh()
    beam_faces.append(beam_face_mesh)

    i_vector = vector_to_rhino(insersion_vec)
    i_vectors.append(i_vector)

    colors.append(color_to_show)

for plate in model.plates:
    geo.append(plate.geometry)
    color_to_show = PLATE
    colors.append(color_to_show)
# ---------- end python_3_script_7 ----------
# THINGS TO DO: - insersion vector for recripocal
# - insersion vector for level 0 : easier with z
# - middle joint, lap easier from the outside than inside
python_3_script_8 = Python3Script(model=python_3_script_5.final_model)  # -> out, grasp_planes, beam_faces, i_vectors, final_model, a, tag_points, tag_texts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
# ---------- python_3_script_8: Python ----------
from compas.geometry import Frame, Vector, Point, Line, Rotation
from compas_rhino.conversions import frame_to_rhino_plane, vector_to_rhino, plane_to_rhino, point_to_rhino
from compas_timber.connections import TMultiStepJoint
from compas_timber.elements import CutFeature
import math

grasp_planes = []
beam_faces = []
i_vectors = []

final_model = model

a = []
selected_beams = []
selected_joints = []

seen_beams = set()

for joint in final_model.joints:
    if isinstance(joint, TMultiStepJoint):
        for beam in joint.elements:
            beam_length = beam.attributes.get("blanklength")
            has_middle_joint = beam.attributes.get("has_middle_joint")

            if beam_length > 1.6 and has_middle_joint == False:

                if beam in seen_beams:
                    continue

                seen_beams.add(beam)

                a.append(beam.geometry)
                selected_beams.append(beam)
                selected_joints.append(joint)

# ------------------------------------------------------------
# Settings for grouping similar cuts
# ------------------------------------------------------------
point_tolerance = 1
seen_cut_keys = set()

tag_points = []
tag_texts = []
dc_plane = []
dc_vector = []
bm_plane = []
bm_vector = []
new_i_vec = []

insertion_vectors_by_beam = {}

for i, beam in enumerate(selected_beams):
    lowest_feature_by_type = {}

    features = beam.features

    for j, feature in enumerate(features):
        feature_type = type(feature).__name__

        if feature_type not in ["DoubleCut", "BirdsMouth"]:
            continue

        planes = feature.planes_from_params_and_beam(beam)

        world_down = Vector(0, 0, -1)

        sorted_planes = sorted(
                                planes,
                                key=lambda plane: plane.normal.unitized().dot(world_down),
                                reverse=True
                            )

        level = beam.attributes.get("level")
        if feature_type == "DoubleCut":
            if level == 1:
                selected_plane = sorted_planes[1]
            elif level == 2:
                selected_plane = sorted_planes[0]

        elif feature_type == "BirdsMouth":
            selected_plane = sorted_planes[0]

        selected_point = selected_plane.point

        if feature_type not in lowest_feature_by_type:
            lowest_feature_by_type[feature_type] = (feature, selected_plane, selected_point)
        else:
            current_lowest_point = lowest_feature_by_type[feature_type][2]

            if selected_point.z < current_lowest_point.z:
                lowest_feature_by_type[feature_type] = (feature, selected_plane, selected_point)

    dc_vec = None
    bm_vec = None

    for feature_type, data in lowest_feature_by_type.items():
        feature, selected_plane, selected_point = data

        tag_points.append(point_to_rhino(selected_point))
        tag_texts.append(feature_type)

        if feature_type == "DoubleCut":
            dc_plane.append(plane_to_rhino(selected_plane))
            dc_vec = -selected_plane.normal.copy()
   
            dc_vector.append(vector_to_rhino(dc_vec))

        elif feature_type == "BirdsMouth":
            bm_plane.append(plane_to_rhino(selected_plane))
            bm_vec = selected_plane.normal.copy()

            bm_vector.append(vector_to_rhino(bm_vec))

    if dc_vec and bm_vec:
        dc_vec_u = dc_vec.unitized()
        bm_vec_u = bm_vec.unitized()

        i_vec_lb = (dc_vec_u + bm_vec_u).unitized()

        insertion_vectors_by_beam[beam] = i_vec_lb
        new_i_vec.append(vector_to_rhino(i_vec_lb))


for i, beam in enumerate(final_model.beams):
    # ============================================================
    # Grasp frame
    # ============================================================
    beam_face = beam.side_as_surface(0)
    pick_up_point = beam_face.point_at(0.5, 0.5)
    beam_frame = beam.frame.copy()
    beam_frame.point = pick_up_point

    level = beam.attributes.get("level")
    hierarchy = beam.attributes.get("hierarchy")
    has_middle_joint = beam.attributes.get("has_middle_joint")
    # print(i_vec_lb)
    if level == 0:
        insersion_vec = -Vector.Zaxis()
    elif beam in insertion_vectors_by_beam:
        insersion_vec = insertion_vectors_by_beam[beam]
    elif level == 1 and has_middle_joint:
        insersion_vec = -Vector.Zaxis()
    else:
        insersion_vec = beam_frame.zaxis
        # insersion_vec = beam_frame.zaxis.flipped

    beam.attributes["grasp_frame"] = beam_frame
    beam.attributes["insertion_vector"] = insersion_vec

    grasp_frame = beam.attributes.get("grasp_frame")
    i_vec = beam.attributes.get("insertion_vector")

    print(i_vec)

    grasp_plane = frame_to_rhino_plane(grasp_frame)
    grasp_planes.append(grasp_plane)
    beam_face_mesh = beam_face.to_mesh()
    beam_faces.append(beam_face_mesh)
    i_vector = vector_to_rhino(i_vec)
    i_vectors.append(i_vector)
# ---------- end python_3_script_8 ----------

# ---- group: add grasp_frame and i_vec as beam attributes
# 50 & 80 cm the size of GRIPPER
# add grasp_frame and
# insersion vector
# as beam attributes
python_3_script_9 = Python3Script(model=python_3_script_5.final_model)  # -> out, grasp_planes, beam_faces, i_vectors, final_model, a, tag_points, tag_texts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
# ---------- python_3_script_9: Python ----------
from compas.geometry import Frame, Vector, Point, Line, Rotation
from compas_rhino.conversions import frame_to_rhino_plane, vector_to_rhino, plane_to_rhino, point_to_rhino
from compas_timber.connections import TMultiStepJoint
from compas_timber.elements import CutFeature
import math
import System.Drawing as sd


# ------------------------------------------------------------
# Colors
# ------------------------------------------------------------
alpha = 180

RED  = sd.Color.FromArgb(alpha, 220, 50, 50)
GREY = sd.Color.FromArgb(alpha, 160, 160, 160)
PLATE = sd.Color.FromArgb(100, 160, 160, 160)


# ------------------------------------------------------------
# Outputs
# ------------------------------------------------------------
colors = []
geo = []

# Detailed outputs for ONLY ONE selected beam
b = []
b_plane = []
b_face = []

dc_plane = []
dc_vector = []

bm_plane = []
bm_vector = []

new_i_vec = []

tag_points = []
tag_texts = []

grasp_planes = []
beam_faces = []
i_vectors = []

insertion_vectors_by_beam = {}

final_model = model


# ------------------------------------------------------------
# Collect candidate beams
# ------------------------------------------------------------
selected_beams = []
selected_joints = []
seen_beams = set()

for joint in final_model.joints:
    if isinstance(joint, TMultiStepJoint):
        for beam in joint.elements:
            beam_length = beam.attributes.get("blanklength")
            has_middle_joint = beam.attributes.get("has_middle_joint")

            if beam_length > 1.6 and has_middle_joint == False:

                if beam in seen_beams:
                    continue

                seen_beams.add(beam)

                selected_beams.append(beam)
                selected_joints.append(joint)


# ------------------------------------------------------------
# Choose ONE beam using slider
# selected_index should be a Grasshopper integer slider
# ------------------------------------------------------------
selected_index = 7
selected_index = int(selected_index)

if len(selected_beams) > 0:
    selected_index = max(0, min(selected_index, len(selected_beams) - 1))
    selected_beam = selected_beams[selected_index]
else:
    selected_beam = None


# ------------------------------------------------------------
# Calculate planes/vectors ONLY for the selected beam
# ------------------------------------------------------------
if selected_beam:

    beam = selected_beam
    lowest_feature_by_type = {}

    features = beam.features
    world_down = Vector(0, 0, -1)

    for j, feature in enumerate(features):
        feature_type = type(feature).__name__

        if feature_type not in ["DoubleCut", "BirdsMouth"]:
            continue

        planes = feature.planes_from_params_and_beam(beam)

        sorted_planes = sorted(
            planes,
            key=lambda plane: plane.normal.unitized().dot(world_down),
            reverse=True
        )

        level = beam.attributes.get("level")

        selected_plane = None

        if feature_type == "DoubleCut":
            if level == 1 and len(sorted_planes) > 1:
                selected_plane = sorted_planes[1]
            elif level == 2:
                selected_plane = sorted_planes[0]

        elif feature_type == "BirdsMouth":
            selected_plane = sorted_planes[0]

        if not selected_plane:
            continue

        selected_point = selected_plane.point

        if feature_type not in lowest_feature_by_type:
            lowest_feature_by_type[feature_type] = (feature, selected_plane, selected_point)
        else:
            current_lowest_point = lowest_feature_by_type[feature_type][2]

            if selected_point.z < current_lowest_point.z:
                lowest_feature_by_type[feature_type] = (feature, selected_plane, selected_point)


    dc_vec = None
    bm_vec = None

    for feature_type, data in lowest_feature_by_type.items():
        feature, selected_plane, selected_point = data

        tag_points.append(point_to_rhino(selected_point))
        tag_texts.append(feature_type)

        if feature_type == "DoubleCut":
            dc_plane.append(plane_to_rhino(selected_plane))

            dc_vec = -selected_plane.normal.copy()
            dc_vector.append(vector_to_rhino(dc_vec))

        elif feature_type == "BirdsMouth":
            bm_plane.append(plane_to_rhino(selected_plane))

            bm_vec = selected_plane.normal.copy()
            bm_vector.append(vector_to_rhino(bm_vec))


    # ------------------------------------------------------------
    # Combine DoubleCut vector + BirdsMouth vector
    # ------------------------------------------------------------
    if dc_vec and bm_vec:
        dc_vec_u = dc_vec.unitized()
        bm_vec_u = bm_vec.unitized()

        i_vec_lb = (dc_vec_u + bm_vec_u).unitized()

        insertion_vectors_by_beam[beam] = i_vec_lb
        new_i_vec.append(vector_to_rhino(i_vec_lb))

    mid_points = []

    # midpoint between BirdsMouth plane and DoubleCut plane
    if len(dc_plane) > 0 and len(bm_plane) > 0:
        dc_origin = dc_plane[-1].Origin
        bm_origin = bm_plane[-1].Origin

        mid_pt = (dc_origin + bm_origin) / 2
        mid_points.append(mid_pt)


# ------------------------------------------------------------
# Display all beams:
# selected beam = RED
# all others = GREY
# ------------------------------------------------------------
for beam in final_model.beams:

    # ============================================================
    # Grasp frame
    # ============================================================
    beam_face = beam.side_as_surface(0)
    pick_up_point = beam_face.point_at(0.5, 0.5)

    beam_frame = beam.frame.copy()
    beam_frame.point = pick_up_point

    level = beam.attributes.get("level")
    hierarchy = beam.attributes.get("hierarchy")
    has_middle_joint = beam.attributes.get("has_middle_joint")

    # ============================================================
    # Insertion vector logic
    # ============================================================
    if level == 0:
        insersion_vec = -Vector.Zaxis()

    elif beam in insertion_vectors_by_beam:
        insersion_vec = insertion_vectors_by_beam[beam]

    elif level == 1 and has_middle_joint:
        insersion_vec = -Vector.Zaxis()

    else:
        insersion_vec = beam_frame.zaxis


    # ============================================================
    # Color logic
    # ONLY selected beam is red
    # everything else is grey
    # ============================================================
    if beam == selected_beam:
        color_to_show = RED

        # Detailed outputs for selected beam only
        b.append(beam.geometry)
        b_plane.append(frame_to_rhino_plane(beam_frame))
        b_face.append(beam.side_as_surface(0).point_at(0.5, 0.5))

    else:
        color_to_show = GREY


    # ============================================================
    # Save attributes
    # ============================================================
    beam.attributes["grasp_frame"] = beam_frame
    beam.attributes["insertion_vector"] = insersion_vec


    # ============================================================
    # General display outputs
    # ============================================================
    geo.append(beam.geometry)
    colors.append(color_to_show)

    grasp_planes.append(frame_to_rhino_plane(beam_frame))
    beam_faces.append(beam_face.to_mesh())
    i_vectors.append(vector_to_rhino(insersion_vec))


# ------------------------------------------------------------
# Add plates
# ------------------------------------------------------------
for plate in model.plates:
    geo.append(plate.geometry)
    colors.append(PLATE)
# ---------- end python_3_script_9 ----------

# ----
compas_draw_8 = COMPASDraw(cg=python_3_script_9.mid_points)  # -> rg; same code as draw
point = Point(python_3_script_9.mid_points)
# name beam
# MXX-YY
# module number - beam key
# need 2 timber modules
# mirror = different
# 2 modules x 2
compas_draw_9 = COMPASDraw(cg=python_3_script_9.geo)  # -> rg; same code as draw
compas_draw_10 = COMPASDraw(cg=python_3_script_9.beam_faces)  # -> rg; same code as draw
plane = Plane(python_3_script_9.bm_plane)
vector = Vector(python_3_script_9.dc_vector)
vector_2 = Vector(python_3_script_9.bm_vector)
plane_2 = Plane(python_3_script_9.grasp_planes)
plane_3 = Plane(python_3_script_9.dc_plane)
vector_display = VectorDisplay(Anchor=python_3_script_9.bm_plane, Vector=vector_2)
vector_display_2 = VectorDisplay(Anchor=python_3_script_9.dc_plane, Vector=vector)
text_tag_3 = TextTag(Location=python_3_script_9.tag_points, Text=python_3_script_9.tag_texts, Colour=ColourSwatch(SwatchColor=RGB(0, 0, 185)))
area = Area(Geometry=compas_draw_10)  # -> Area, Centroid
colour_swatch_2 = ColourSwatch(SwatchColor=RGB(0, 0, 185))
custom_preview_4 = CustomPreview(Geometry=compas_draw_9, Material=python_3_script_9.colors)
vector_3 = Vector(python_3_script_9.i_vectors)
vector_display_ex = VectorDisplayEx(Point=point, Vector=python_3_script_9.new_i_vec, Colour=colour_swatch_2, Width="3")
compas_draw_11 = COMPASDraw(cg=python_3_script_9.a)  # -> rg; same code as draw
compas_draw_12 = COMPASDraw(cg=python_3_script_9.b_face)  # -> rg; same code as draw
vector_4 = Vector(python_3_script_9.sel_vec)
# new insersion vector!
vector_display_ex_2 = VectorDisplayEx(Point=area.Centroid, Vector=vector_3, Colour=colour_swatch_2, Width="3")
center = Center(Geometry=compas_draw_11)  # -> Center, Dimension
vector_display_ex_3 = VectorDisplayEx(Point=compas_draw_12, Vector=vector_4, Colour=colour_swatch_2, Width="3")
custom_preview_5 = CustomPreview(
    Geometry=compas_draw_11,
    Material={diffuse=RGB(221, 160, 221), emission=RGB(66, 48, 66), shine=0.5, specular=RGB(255, 255, 255), transparency=0})

vector_5 = Vector(python_3_script_9.new_i_vec)
vector_display_3 = VectorDisplay(Anchor=center.Center, Vector=vector_5)

py3_4 = Python3Script(model=python_3_script_9.final_model)  # -> out, geo, frames, out_model; disabled
# ---------- py3_4: Python ----------
from compas.geometry import Line, Plane, Frame
from compas.geometry import intersection_segment_plane
from compas.geometry import angle_vectors
from compas.geometry import dot_vectors
from compas.tolerance import TOL
from compas_timber.fabrication import Drilling

from compas.geometry import Transformation

GRIPPER_SEPARATION = 0.8
DRILL_DEPTH = 0.04
DRILL_DIAMETER = 0.0205

BIG_GRIPPER = 0.8
SMALL_GRIPPER = 0.5

mod = model


def get_default_ref_side_index(plane, beam):
        """Get the default reference side index for the given cutting plane and beam.
        This method checks if the cutting plane intersects with the reference sides of the beam
        and returns the index of the reference side with the smallest angle to the plane's normal.

        # NOTE: Consider moving all connection-agnostic utilities (including this one) to a shared location for reuse in fabrication and other modules.

        Parameters
        ----------
        plane : :class:`~compas.geometry.Plane` or :class:`~compas.geometry.Frame`
            The cutting plane.
        beam : :class:`~compas_timber.elements.Beam`
            The beam that is cut by this instance.

        Returns
        -------
        int
            The default ref_side_index for the given cutting plane and beam.

        """
        angles = {}
        max = 100000
        key = 0
        for i, ref_side in enumerate(beam.ref_sides[:4]):
            width, _ = beam.get_dimensions_relative_to_side(i)
            y_seg = Line.from_point_and_vector(ref_side.point, ref_side.yaxis * width)
            # check if the plane intersects with the reference side and the angle between their normals is positive
            dot = dot_vectors(plane.normal, ref_side.normal)
            if dot<max:
                max=dot
                key=i
        return key

geo = []
frames = []
for beam in mod.beams:
    level = beam.attributes.get("level")
    grasp = beam.attributes.get("grasp_frame")
    T = beam.transformation_to_local()
    gc = grasp.copy()
    ref_side = get_default_ref_side_index(Plane.from_frame(grasp), beam)
    T = Transformation.from_change_of_basis(Frame.worldXY(), beam.ref_sides[ref_side])
    print(gc.transformed(T))
    w,h=beam.get_dimensions_relative_to_side(ref_side)
    if beam.attributes["assembly_method"]=="robot":
        frames.append(grasp)
        if beam.blank_length >= 1.0:
            drilling = Drilling(
                start_x=gc.transformed(T).point.x + BIG_GRIPPER/2,
                start_y=gc.transformed(T).point.y,
                depth_limited=True,
                depth=DRILL_DEPTH,
                diameter=DRILL_DIAMETER,
                ref_side_index=ref_side,
                is_joinery=False,
            )
            beam.add_feature(drilling)
            drilling = Drilling(
                start_x=gc.transformed(T).point.x - BIG_GRIPPER/2,
                start_y=gc.transformed(T).point.y,
                depth_limited=True,
                depth=DRILL_DEPTH,
                diameter=DRILL_DIAMETER,
                ref_side_index=ref_side,
                is_joinery=False,
            )
            beam.add_feature(drilling)
            drilling = Drilling(
                start_x=gc.transformed(T).point.x - (BIG_GRIPPER/2 - 0.20),
                start_y=gc.transformed(T).point.y,
                depth_limited=True,
                depth=DRILL_DEPTH,
                diameter=DRILL_DIAMETER,
                ref_side_index=ref_side,
                is_joinery=False,
            )
            beam.add_feature(drilling)

        elif beam.blank_length >= 0.6:
            drilling = Drilling(
                start_x=gc.transformed(T).point.x + SMALL_GRIPPER/2,
                start_y=gc.transformed(T).point.y,
                depth_limited=True,
                depth=DRILL_DEPTH,
                diameter=DRILL_DIAMETER,
                ref_side_index=ref_side,
                is_joinery=False,
            )
            beam.add_feature(drilling)
            drilling = Drilling(
                start_x=gc.transformed(T).point.x - SMALL_GRIPPER/2,
                start_y=gc.transformed(T).point.y,
                depth_limited=True,
                depth=DRILL_DEPTH,
                diameter=DRILL_DIAMETER,
                ref_side_index=ref_side,
                is_joinery=False,
            )
            beam.add_feature(drilling)
            drilling = Drilling(
                start_x=gc.transformed(T).point.x - (SMALL_GRIPPER/2 - 0.05),
                start_y=gc.transformed(T).point.y,
                depth_limited=True,
                depth=DRILL_DEPTH,
                diameter=DRILL_DIAMETER,
                ref_side_index=ref_side,
                is_joinery=False,
            )
            beam.add_feature(drilling)


    try:
        # if level==0:
        geo.append(beam.geometry)
    except Exception as e:
        pass

out_model = mod
# ---------- end py3_4 ----------
draw_8 = COMPASDraw(cg=py3_4.geo)  # -> rg; same code as draw
draw_9 = COMPASDraw(cg=py3_4.frames)  # -> rg; same code as draw
py3_5 = Python3Script(models=python_3_script_9.final_model, version=Slider(2, range=1..10), save=Button())  # inputs models: list, version: Int32
# ---------- py3_5: Python ----------
import os, sys, importlib
from datetime import date

from compas.data import json_dump

gh_dir = os.path.dirname(ghenv.Component.OnPingDocument().FilePath)
gh_par = os.path.dirname(gh_dir)
file_path = os.path.join(gh_par, "modularization", "data")

# print(file_path)
today = date.today().strftime("%y%m%d")
# print(today)



if save:
    serializable = []
    for m in models:
        serializable.append({
            "attributes": dict(m.attributes),
            "model": m
        })
        
    output_path = os.path.join(file_path, f"{today}_v{version}_sequenced_timber_model.json")
    dump = json_dump(serializable, output_path, pretty=True)
    print(f"Model written to {output_path}")
# ---------- end py3_5 ----------
panel_3 = Panel(py3_4.frames)
preview_5 = CustomPreview(
    Geometry=draw_8,
    Material={diffuse=RGB(221, 160, 221), emission=RGB(66, 48, 66), shine=0.5, specular=RGB(255, 255, 255), transparency=0})
# TimberModel with all attributes
python_3_script_10 = Python3Script(model=python_3_script_9.final_model)  # -> out, weight
# ---------- python_3_script_10: Python ----------
hierarchy = []
edge = []
group = []
level = []
reached = []
has_middle_joint = []
direction_id = []
cyclic_sign = []
sequence_id = []
assembly_method = []
volume = []
weight = []
crosssection = []
blanklength = []
grasp_frame = []
insertion_vector = []

for i, beam in enumerate(model.beams):
    attrs = beam.attributes

    hierarchy.append(attrs.get("hierarchy"))
    edge.append(attrs.get("edge"))
    group.append(attrs.get("group"))
    level.append(attrs.get("level"))
    reached.append(attrs.get("reached"))
    has_middle_joint.append(attrs.get("has_middle_joint"))
    direction_id.append(attrs.get("direction_id"))
    cyclic_sign.append(attrs.get("cyclic_sign"))
    sequence_id.append(attrs.get("sequence_id"))
    assembly_method.append(attrs.get("assembly_method"))
    volume.append(attrs.get("volume"))
    weight.append(attrs.get("weight"))
    crosssection.append(attrs.get("crosssection"))
    blanklength.append(attrs.get("blanklength"))
    grasp_frame.append(attrs.get("grasp_frame"))
    insertion_vector.append(attrs.get("insertion_vector"))

print(beam.attributes)

# for plate in model.plates:
#     print(plate.length, plate.width, plate.height)
#     print(plate.length*plate.width*plate.height*470)
# ---------- end python_3_script_10 ----------
panel_4 = Panel(python_3_script_10.weight)
mass_addition = MassAddition(Input=panel_4)  # -> Result, PartialResults
panel_5 = Panel(mass_addition.Result)

number_slider_2 = Slider(4, range=1..10)  # disabled
button = Button()  # disabled
py3_6 = Python3Script(models=py3_4.out_model, version=number_slider_2, save=button)  # inputs models: list, version: Int32; disabled
# ---------- py3_6: Python ----------
import os, sys, importlib
from datetime import date

from compas.data import json_dump

gh_dir = os.path.dirname(ghenv.Component.OnPingDocument().FilePath)
gh_par = os.path.dirname(gh_dir)
file_path = os.path.join(gh_par, "modularization", "data")

# print(file_path)
today = date.today().strftime("%y%m%d")
# print(today)



if save:
    serializable = []
    for m in models:
        serializable.append({
            "attributes": dict(m.attributes),
            "model": m
        })
        
    output_path = os.path.join(file_path, f"{today}_v{version}_fabrication_model.json")
    dump = json_dump(serializable, output_path, pretty=True)
    print(f"Model written to {output_path}")


# serializable = []
# for m in models:
#     serializable.append({
#         "attributes": dict(m.attributes),
#         "model": m
#     })
# print (serializable)
# ---------- end py3_6 ----------
