# Grasshopper definition 260618_add_features.ghx (Grasshopper 1.0.8)
# plug-ins: Heteroptera, treesloth01, Human, Increment

panel = Panel("""T2_2026
Consoles""")

# ----
# Load json file
toggle = BooleanToggle(True)
py3 = Python3Script(load=toggle)  # -> out, timber_models, maps; inputs load: Boolean
# ---------- py3: Python ----------
from compas.data import json_load, json_dumps
import os, sys, importlib

from copy import deepcopy



gh_dir = os.path.dirname(ghenv.Component.OnPingDocument().FilePath)
gh_par = os.path.dirname(gh_dir)

file_path = os.path.join(gh_par,"timber_design", "data", "260618_v1_timber_models.json")
other_file_path = os.path.join(gh_par,"structure_model", "data", "joint_to_screwmap.json")
# print(file_path)

if load:
    results = json_load(file_path)
    results = deepcopy(results)

    for data in results:
        model = data['model']
        attrs = data['attributes']
        # print (model.attributes.keys())

        model.attributes = attrs
        # print (model.attributes.keys())

    timber_models = [data['model'] for data in results]
    maps = json_load(other_file_path)
    print (len(maps))
    maps = json_dumps({str(k): v for k, v in maps.items()})
    # maps = [json_dumps({str(k): v for k, v in m.items()}) for m in maps]
    print (maps)
    map_list = []
    for model in timber_models:
        g = model.attributes["group"]
# ---------- end py3 ----------

python_3_script = Python3Script(models=py3.timber_models, mapped=py3.maps)  # -> out, pts, labels, log, lines; inputs models: list, mapped: String
# ---------- python_3_script: Python ----------
import clr
clr.AddReference("RhinoCommon")
import Rhino.Geometry as rg

from compas.data import json_loads

pts    = []
lines  = []
labels = []
log    = []

total     = 0
unmatched = 0

mapped = json_loads(mapped)

for model in models:
    g = model.attributes["group"]

    for joint in model.joints:
        loc   = joint.location
        pt    = rg.Point3d(loc.x, loc.y, loc.z)
        key   = str(getattr(joint, "key", joint.guid))
        count = mapped.get(str(joint.guid), -1)

        pts.append(pt)
        labels.append(count)

        if count == -1:
            unmatched += 1
        total += 1

    [lines.append(b.centerline) for b in model.beams]

log.append("OK — {} joints, {} unmatched.".format(total, unmatched))
# ---------- end python_3_script ----------
compas_draw = COMPASDraw(cg=python_3_script.lines)  # -> rg
#   port cg: The COMPAS geometry or datastructure to be drawn.
#   port rg: The Rhino geometry object.
# ---------- compas_draw: Python ----------
# r: compas>=2.14.1
"""
Draws COMPAS geometry in Grasshopper.
"""

from typing import Any

import Grasshopper

from compas.scene import SceneObject


class CompasToRhinoGeometry(Grasshopper.Kernel.GH_ScriptInstance):
    def RunScript(self, cg):
        if not cg:
            return None

        return SceneObject(item=cg).draw()
# ---------- end compas_draw ----------
dot_display = DotDisplay(Point=python_3_script.pts, Colour=ColourSwatch(SwatchColor=RGB(255, 255, 255)), Size=Slider(0.1, range=0..1))
text_tag = TextTag(Location=python_3_script.pts, Text=python_3_script.labels)

py3_2 = Python3Script(unload=Button())  # -> out; inputs unload: Boolean
# ---------- py3_2: Python ----------
from compas_rhino import unload_modules
import compas_timber

if unload:
    unload_modules('compas_timber')
    print("Module Unloaded")
# ---------- end py3_2 ----------
check = Python3Script()  # -> out, a
# ---------- check: Python ----------
import compas
import compas_timber

print(compas.__version__)
print(compas_timber.__version__)
print(compas_timber.__file__)
# ---------- end check ----------
panel_2 = Panel(check.out)

# ----
# Process joinery
list = ValueList({"Zero": 0, "One": 1, "Two": 2, "Three": 2² - 1}, selected=["Zero", "Two"])
item = ListItem(List=py3.timber_models, Index=list, Wrap=True)
py3_3 = Python3Script(models=item, process=Toggle(True))  # -> out, models; inputs models: list, process: Boolean
# ---------- py3_3: Python ----------
import os, sys, importlib

gh_dir = os.path.dirname(ghenv.Component.OnPingDocument().FilePath)

parent = os.path.dirname(gh_dir)              # go up one level
src_dir = os.path.join(parent, "src")         # go into src folder
if src_dir not in sys.path:
    sys.path.insert(0, src_dir)

print (gh_dir)
print (parent)
print (src_dir)

import timber_config
importlib.reload(timber_config)

import timber_model
importlib.reload(timber_model)
from timber_model import apply_processings

from copy import deepcopy

models = deepcopy(models)


#
if process:
    for model in models:
        apply_processings(model)
# ---------- end py3_3 ----------

py3_4 = Python3Script(models=py3_3.models, mapped=py3.maps)  # -> out, locations, txts, port, geos, entry_point_tree, screw_line_tree, screw_length_tree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; inputs models: list, mapped: String
# ---------- py3_4: Python ----------
import os, sys, importlib
gh_dir = os.path.dirname(ghenv.Component.OnPingDocument().FilePath)

parent = os.path.dirname(gh_dir)
src_dir = os.path.join(parent, "src")
if src_dir not in sys.path:
    sys.path.insert(0, src_dir)

import screw
import screw_planning_5
import screw_spec_2
import joint_wrappers_5

importlib.reload(screw)
importlib.reload(screw_planning_5)
importlib.reload(screw_spec_2)
importlib.reload(joint_wrappers_5)

from screw_planning_5 import apply_screws
from screw_spec_2 import ScrewSpecification
from joint_wrappers_5 import TMSJ

from Grasshopper import DataTree
from Grasshopper.Kernel.Data import GH_Path
from compas.data import json_loads

# from copy import deepcopy
# models = deepcopy(models)

locations = []
txts = DataTree[object]()

entry_point_tree = DataTree[object]()
screw_line_tree = DataTree[object]()
screw_length_tree = DataTree[object]()
entry_faces = DataTree[object]()
exit_faces = DataTree[object]()
interfaces = DataTree[object]()

rejected_points = DataTree[object]()
geos = DataTree[object]()

mapped = json_loads(mapped)

for model in models:
    g = model.attributes["group"]
    results = apply_screws(
        model,
        spec_model="WT-plus-6.5",
        screw_map=mapped,
        screw_angle=40,
        add_features=True,
        drill_target="main",
        depth_limited=True,
        with_data=True,
        debug=True
    )

    for i, (key, result) in enumerate(results["joint_data"].items()):
        path = GH_Path(g, i)

        screws = result["screws"]

        entry_points = [s.entry for s in screws]
        screw_lines = [s.line for s in screws]
        screw_lengths = [s.length for s in screws]

        entry_face = result["entry_face"]
        exit_face = result["exit_face"]
        interface = result["interface"]

        entry_point_tree.AddRange(entry_points, path)
        screw_line_tree.AddRange(screw_lines, path)
        screw_length_tree.AddRange(screw_lengths, path)        
        entry_faces.Add(entry_face, path)
        exit_faces.Add(exit_face, path)
        interfaces.Add(interface, path)

        for screw in screws:
            if screw.reject_reason:
                rejected_points.Add(screw.entry, path)
                txts.Add(screw.reject_reason.name, path)
                print (screw.reject_reason.name)
    for beam in model.beams:
        geos.Add(beam.geometry)

    # Debug for screw capacity
    warnings = results["capacity_warnings"]
    for item in warnings:
        print (item)
        location = item['joint'].location
        locations.append(location)
# ---------- end py3_4 ----------
draw = COMPASDraw(cg=py3_4.rejected_points)  # -> rg; same code as compas_draw
text_tag_2 = TextTag(Location=draw, Text=py3_4.txts)
draw_2 = COMPASDraw(cg=py3_4.entry_point_tree)  # -> rg; same code as compas_draw
dots = DotDisplay(Point=draw, Colour=RGB(255, 144, 0), Size=0.03)
draw_3 = COMPASDraw(cg=py3_4.screw_line_tree)  # -> rg; same code as compas_draw
draw_4 = COMPASDraw(cg=py3_4.geos)  # -> rg; same code as compas_draw
draw_5 = COMPASDraw(cg=py3_4.locations)  # -> rg; same code as compas_draw
draw_6 = COMPASDraw(cg=py3_4.interfaces)  # -> rg; same code as compas_draw
draw_7 = COMPASDraw(cg=py3_4.exit_faces)  # -> rg; same code as compas_draw
draw_8 = COMPASDraw(cg=py3_4.entry_faces)  # -> rg; same code as compas_draw
disc = Discontinuity(Curve=draw_8, Level=1)  # -> Points, Parameters
sph = Sphere(Base=draw_5, Radius=0.1)
points = PointList(Points=disc.Points, Size=Slider(0.021, range=0..0.1))
lng = ListLength(List=flatten(draw_2))
lng_2 = ListLength(List=flatten(draw_3))
end = EndPoints(Curve=draw_3)  # -> Start, End
panel_3 = Panel(lng)
panel_4 = Panel(lng_2)

# ----
# Orient to station
toggle_2 = BooleanToggle(True)
pt = Point(Point(14.01828384, 9.600147889, 0.2339343578))
py3_5 = Python3Script(model=py3_4.models, target_pt=pt, orient=toggle_2)  # -> out, model, geo_tree, frame_tree; inputs target_pt: Point3d, orient: Boolean; disabled
# ---------- py3_5: Python ----------
import os, sys
from copy import deepcopy

from Grasshopper import DataTree
from Grasshopper.Kernel.Data import GH_Path
from compas.geometry import Transformation, Frame
from compas_timber.connections import LMiterJoint
# ------------------------------------------------------------
# outputs
# ------------------------------------------------------------
geo_tree = DataTree[object]()
frame_tree = DataTree[object]()

# avoid transforming original model repeatedly in GH
model_out = model

# ------------------------------------------------------------
# path
# ------------------------------------------------------------
g = model_out.attributes.get("group", 0)
path = GH_Path(g)

# ------------------------------------------------------------
# orient transform
# ------------------------------------------------------------
if orient:
    to_frame = Frame(list(target_pt), [1, 0, 0], [0, 1, 0])

    clt_plate = model_out.attributes.get("clt_plate")
    from_frame = clt_plate.attributes.get("negative_frame")

    O = Transformation.from_frame_to_frame(from_frame, to_frame)

    frame_tree.Add(from_frame, path)

    cut_plane = model_out.attributes.get("cut_plane")
    if cut_plane:
        cut_plane.transform(O)
        model_out.attributes["cut_plane"] = cut_plane

    for plate in model_out.plates:
        plate.transform(O)

    for beam in model_out.beams:
        beam.transform(O)

    for joint in model_out.joints:
        if hasattr(joint, "location") and joint.location:
            joint.location.transform(O)
        if isinstance(joint, LMiterJoint):
            if joint.miter_plane:
                joint.miter_plane.transform(O)
# ------------------------------------------------------------
# output geometry
# ------------------------------------------------------------
for plate in model_out.plates:
    geo_tree.Add(plate.geometry, path)

for beam in model_out.beams:
    geo_tree.Add(beam.geometry, path)

# ------------------------------------------------------------
# GH outputs
# ------------------------------------------------------------
geo = geo_tree
frames = frame_tree
model = model_out
# ---------- end py3_5 ----------
draw_9 = COMPASDraw(cg=py3_5.frame_tree)  # -> rg; same code as compas_draw
# manual vs robot
# op1 manually level 1 terciary
# and very small elements
# middle note do 2 by 2
# to compas_timber joints:
# change orientation middle node
draw_10 = COMPASDraw(cg=py3_5.geo_tree)  # -> rg; same code as compas_draw

# ---- group: STEP
# option 1: small middle first by hand
# option 2: big middle by robot + small middle by hand
# 
# level 1: blue-blue-purple-green
# 
# blue-red-green
# 
# blue-purple-green
# 
# red-green
number_slider = Slider(100, range=0..100)

# ----
data = Data(py3_5.model)

# ---- group: copy paste option 1 or option 2
python_3_script_2 = Python3Script(final_models=data)  # -> out, tag_point, tag_text, sorted_points, sorting_data, final_model
# ---------- python_3_script_2: Python ----------
import math

joints_list = list(final_models.joints)
sorted_joints = sorted(joints_list, key=lambda j: (j.location.x, j.location.y, j.location.z))
sorted_points = [joint.location for joint in sorted_joints]

joint_rank = {joint: idx for idx, joint in enumerate(sorted_joints)}

unvisited = {(i, beam): beam for i, beam in enumerate(final_models.beams)}
sorting_data = []

for joint in sorted_joints:
    for (i, beam) in list(unvisited):
        if beam not in joint.elements:
            continue

        level = beam.attributes.get("level")
        edge = beam.attributes.get("edge")
        edge_a = edge[0]
        has_middle_joint = beam.attributes.get("has_middle_joint")
        hierarchy = beam.attributes.get("hierarchy")

        if level == 0:
            hierarchy_rank = {"shoe": 0, "tertiary": 2, "secondary": 4, "primary": 4, "main_primary": 4}
            start_priority = beam.centerline.start.z
        elif level == 1:
            hierarchy_rank = {"shoe": 0, "tertiary": 4, "secondary": 2, "primary": 3, "main_primary": 3}
            start_priority = 9999
        else: 
            hierarchy_rank = {"shoe": 0, "tertiary": 2, "secondary": 2, "primary": 4, "main_primary": 4}
            start_priority = 9999
        
        shoe_priority = 0 if hierarchy == "shoe" else 1

        if has_middle_joint and level == 0:
            mid_priority = 1 
        elif has_middle_joint and level == 1:
            mid_priority = 1 
        else: 
            mid_priority = 0

        joint_idx = joint_rank[joint]
        hierarchy_idx = hierarchy_rank.get(hierarchy)
        mid_point = beam.centerline.midpoint
   
        sorting_data.append((
                            shoe_priority,
                            level,
                            mid_priority,
                            hierarchy_idx,
                            edge_a,
                            start_priority,
                            mid_point.z,
                            joint_idx,
                            i,
                            beam,
                            joint,
                        ))
sorting_data.sort()

pattern = [
    ("secondary", "B"),
    ("secondary", "A"),
    ("main_primary", "A"),
    ("tertiary", "B"),

    ("secondary", "B"),
    ("primary", "B"),
    ("tertiary", "A"),

    ("secondary", "A"),
    ("main_primary", "A"),
    ("tertiary", "B"),

    ("primary", "B"),
    ("tertiary", "A"),
]

# remove duplicate beam entries first
seen = set()
unique_data = []

for data in sorting_data:
    *_, i, beam, joint = data

    if (i, beam) not in seen:
        unique_data.append(data)
        seen.add((i, beam))

sorting_data = unique_data

shoe_data = [data for data in sorting_data if data[-2].attributes.get("hierarchy") == "shoe"]
non_shoe_data = [data for data in sorting_data if data[-2].attributes.get("hierarchy") != "shoe"]

shoe_A = [data for data in shoe_data if data[-2].attributes.get("direction_id") == "A"]
shoe_B = [data for data in shoe_data if data[-2].attributes.get("direction_id") == "B"]

ordered_shoe = []

while shoe_A or shoe_B:
    if shoe_A:
        ordered_shoe.append(shoe_A.pop(0))
    if shoe_B:
        ordered_shoe.append(shoe_B.pop(0))

sorting_data = ordered_shoe + non_shoe_data

# separate levels
level_0 = [data for data in sorting_data
    if data[1] == 0 and data[-2].attributes.get("has_middle_joint") == False]
level_0_middle = [data for data in sorting_data
    if data[1] == 0 and data[-2].attributes.get("has_middle_joint") == True]
level_1_middle = [data for data in sorting_data
    if data[1] == 1 and data[-2].attributes.get("has_middle_joint") == True]
level_1 = [data for data in sorting_data
    if data[1] == 1 and data[-2].attributes.get("has_middle_joint") == False]
level_2 = [data for data in sorting_data if data[1] == 2]
others = [data for data in sorting_data if data[1] not in [0, 1, 2]]

# center point of level 1 joints
cx = sum(data[-1].location.x for data in level_1) / len(level_1)
cy = sum(data[-1].location.y for data in level_1) / len(level_1)

ordered_level_1 = []
remaining = list(level_1)

pattern_idx = 0
anchor_angle = None

while remaining:
    moved = False
    wanted_hierarchy, wanted_direction = pattern[pattern_idx % len(pattern)]
    matching = []

    for data in remaining:
        *_, i, beam, joint = data

        hierarchy = beam.attributes.get("hierarchy")
        direction_id = beam.attributes.get("direction_id")

        if hierarchy != wanted_hierarchy:
            continue
        if wanted_direction is not None and direction_id != wanted_direction:
            continue

        angle = math.atan2(joint.location.y - cy, joint.location.x - cx)
        matching.append((angle, data))

    if matching:
        if wanted_hierarchy in ["primary", "tertiary"] and anchor_angle is not None:
            matching.sort(key=lambda x: min(abs(x[0] - anchor_angle), 2 * math.pi - abs(x[0] - anchor_angle)))

        selected_angle, selected_data = matching[0]

        ordered_level_1.append(selected_data)
        remaining.remove(selected_data)

        if wanted_hierarchy == "secondary":
            anchor_angle = selected_angle

        moved = True

    pattern_idx += 1

ordered_level_1.extend(remaining)
ordered_middle = []

remaining_level_1_middle = list(level_1_middle)
remaining_level_0_middle = list(level_0_middle)

# ------------------------------------------------------------
# Order level 1 middle beams clockwise
# ------------------------------------------------------------
cx_middle = sum(data[-2].centerline.midpoint.x for data in remaining_level_1_middle) / len(remaining_level_1_middle)
cy_middle = sum(data[-2].centerline.midpoint.y for data in remaining_level_1_middle) / len(remaining_level_1_middle)

start_data = sorted(remaining_level_1_middle,
    key=lambda data: (data[-2].centerline.midpoint.x, data[-2].centerline.midpoint.y))[0]

start_pt = start_data[-2].centerline.midpoint
start_angle = math.atan2(start_pt.y - cy_middle, start_pt.x - cx_middle)

clockwise_ordered = []

for data in remaining_level_1_middle:
    pt = data[-2].centerline.midpoint
    angle = math.atan2(pt.y - cy_middle, pt.x - cx_middle)
    clockwise_distance = (start_angle - angle) % (2 * math.pi)
    clockwise_ordered.append((clockwise_distance, data))
clockwise_ordered.sort(key=lambda x: x[0])

remaining_level_1_middle = [data for _, data in clockwise_ordered]

# ------------------------------------------------------------
# Pair each clockwise level 1 middle beam with nearest level 0 middle beam
# ------------------------------------------------------------
while remaining_level_1_middle:
    level_1_data = remaining_level_1_middle.pop(0)

    ordered_middle.append(level_1_data)

    if remaining_level_0_middle:
        nearest_level_0 = min(
            remaining_level_0_middle,
            key=lambda data: (
                (level_1_data[-2].centerline.midpoint.x - data[-2].centerline.midpoint.x) ** 2 +
                (level_1_data[-2].centerline.midpoint.y - data[-2].centerline.midpoint.y) ** 2))

        ordered_middle.append(nearest_level_0)
        remaining_level_0_middle.remove(nearest_level_0)

# if there are leftover level 0 middle beams, add them after
ordered_middle.extend(remaining_level_0_middle)
sorting_data = level_0 + ordered_level_1 + ordered_middle + level_2 + others

beams = final_models.beams
sorted_beams = []

tag_point = []
tag_text = []

local_seq_idx = 0

for data in sorting_data:
    *_, i, beam, joint = data

    if (i, beam) in unvisited:
        beams[i].attributes["sequence_id"] = local_seq_idx
        sorted_beams.append(beam.geometry)
        local_seq_idx += 1

        tag_point.append(beam.centerline.midpoint)
        tag_text.append(str(beam.attributes.get("direction_id")))

        del unvisited[(i, beam)]

final_model = final_models
# ---------- end python_3_script_2 ----------

# ---- group: option 1: small middle first by hand
# to do:
# DONE vizualize robot versus human with colors
# add feature for drilling to robot beams
# DONE add picking frame to beam atributes
# DONE calculate insersion vector - for now use z vector of picking frame
# KINDA DONE add support for hangguing beams (do we mill?)
python_3_script_3 = Python3Script(final_models=data)  # -> out, tag_point, tag_text, sorted_points, sorting_data, final_model
# ---------- python_3_script_3: Python ----------
import math

joints_list = list(final_models.joints)
sorted_joints = sorted(joints_list, key=lambda j: (j.location.x, j.location.y, j.location.z))
sorted_points = [joint.location for joint in sorted_joints]

joint_rank = {joint: idx for idx, joint in enumerate(sorted_joints)}

unvisited = {(i, beam): beam for i, beam in enumerate(final_models.beams)}
sorting_data = []

for joint in sorted_joints:
    for (i, beam) in list(unvisited):
        if beam not in joint.elements:
            continue

        level = beam.attributes.get("level")
        edge = beam.attributes.get("edge")
        edge_a = edge[0]

        has_middle_joint = beam.attributes.get("has_middle_joint")

        if level == 0:
            hierarchy_rank = {"shoe": 0, "tertiary": 2, "secondary": 4, "primary": 4, "main_primary": 4}
            start_priority = beam.centerline.start.z
        elif level == 1:
            hierarchy_rank = {"shoe": 0, "tertiary": 4, "secondary": 2, "primary": 3, "main_primary": 3}
            start_priority = 9999
        else: 
            hierarchy_rank = {"shoe": 0, "tertiary": 2, "secondary": 2, "primary": 4, "main_primary": 4}
            start_priority = 9999

        hierarchy = beam.attributes.get("hierarchy", "")
        shoe_priority = 0 if hierarchy == "shoe" else 1

        if has_middle_joint and level == 0:
            mid_priority = 1 
        elif has_middle_joint and level == 1:
            mid_priority = 1 
        else: 
            mid_priority = 0

        
        joint_idx = joint_rank[joint]
        hierarchy_idx = hierarchy_rank.get(hierarchy)
        mid_point = beam.centerline.midpoint
   
        sorting_data.append((
                            shoe_priority,
                            level,
                            mid_priority,
                            hierarchy_idx,
                            edge_a,
                            start_priority,
                            mid_point.z,
                            joint_idx,
                            i,
                            beam,
                            joint,
                        ))
        
sorting_data.sort()

pattern = [
    ("secondary", "B"),
    ("secondary", "A"),
    ("main_primary", "A"),
    ("tertiary", "B"),

    ("secondary", "B"),
    ("primary", "B"),
    ("tertiary", "A"),

    ("secondary", "A"),
    ("main_primary", "A"),
    ("tertiary", "B"),

    ("primary", "B"),
    ("tertiary", "A"),
]

# remove duplicate beam entries first
seen = set()
unique_data = []

for data in sorting_data:
    *_, i, beam, joint = data

    if (i, beam) not in seen:
        unique_data.append(data)
        seen.add((i, beam))

sorting_data = unique_data

# separate levels
level_0 = [data for data in sorting_data if data[1] == 0]

level_1 = [
    data for data in sorting_data
    if data[1] == 1 and data[-2].attributes.get("has_middle_joint") == False]

level_1_middle = [
    data for data in sorting_data
    if data[1] == 1 and data[-2].attributes.get("has_middle_joint") == True]

level_2 = [data for data in sorting_data if data[1] == 2]
others = [data for data in sorting_data if data[1] not in [0, 1, 2]]

# center point of level 1 joints
cx = sum(data[-1].location.x for data in level_1) / len(level_1)
cy = sum(data[-1].location.y for data in level_1) / len(level_1)

ordered_level_1 = []
remaining = list(level_1)

pattern_idx = 0
anchor_angle = None

while remaining:
    moved = False

    wanted_hierarchy, wanted_direction = pattern[pattern_idx % len(pattern)]
    matching = []

    for data in remaining:
        *_, i, beam, joint = data

        hierarchy = beam.attributes.get("hierarchy")
        direction_id = beam.attributes.get("direction_id")

        if hierarchy != wanted_hierarchy:
            continue
        if wanted_direction is not None and direction_id != wanted_direction:
            continue

        angle = math.atan2(joint.location.y - cy, joint.location.x - cx)
        matching.append((angle, data))

    if matching:
        if wanted_hierarchy in ["primary", "tertiary"] and anchor_angle is not None:
            matching.sort(key=lambda x: min(abs(x[0] - anchor_angle), 2 * math.pi - abs(x[0] - anchor_angle)))

        selected_angle, selected_data = matching[0]

        ordered_level_1.append(selected_data)
        remaining.remove(selected_data)

        if wanted_hierarchy == "secondary":
            anchor_angle = selected_angle

        moved = True

    pattern_idx += 1

ordered_level_1.extend(remaining)
sorting_data = level_0 + ordered_level_1 + level_1_middle + level_2 + others

beams = final_models.beams
sorted_beams = []

tag_point = []
tag_text = []

local_seq_idx = 0

for data in sorting_data:
    *_, i, beam, joint = data

    if (i, beam) in unvisited:
        beams[i].attributes["sequence_id"] = local_seq_idx
        sorted_beams.append(beam.geometry)
        local_seq_idx += 1

        tag_point.append(beam.centerline.midpoint)
        tag_text.append(str(beam.attributes.get("direction_id")))

        del unvisited[(i, beam)]

final_model = final_models
# ---------- end python_3_script_3 ----------

# ----
working_space_rfl = Geometry([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])
human_scale = Geometry(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)
custom_preview = CustomPreview(Geometry=working_space_rfl, Material=ColourSwatch(SwatchColor=RGBA(120, 98, 98, 216)))
custom_preview_2 = CustomPreview(Geometry=human_scale, Material=ColourSwatch(SwatchColor=RGB(217, 178, 178)))
draw_11 = COMPASDraw(cg=python_3_script_2.tag_point)  # -> rg; same code as compas_draw
draw_12 = COMPASDraw()  # -> rg; same code as compas_draw
draw_13 = COMPASDraw(cg=python_3_script_2.sorted_points)  # -> rg; same code as compas_draw
text_tag_3 = TextTag(Location=draw_11, Text=python_3_script_2.tag_text)

# ---- group: option 2: big middle by robot + small middle by hand
python_3_script_4 = Python3Script(final_models=data)  # -> out, tag_point, tag_text, sorted_points, sorting_data, final_model
# ---------- python_3_script_4: Python ----------
import math

joints_list = list(final_models.joints)
sorted_joints = sorted(joints_list, key=lambda j: (j.location.x, j.location.y, j.location.z))
sorted_points = [joint.location for joint in sorted_joints]

joint_rank = {joint: idx for idx, joint in enumerate(sorted_joints)}

unvisited = {(i, beam): beam for i, beam in enumerate(final_models.beams)}
sorting_data = []

for joint in sorted_joints:
    for (i, beam) in list(unvisited):
        if beam not in joint.elements:
            continue

        level = beam.attributes.get("level")
        edge = beam.attributes.get("edge")
        edge_a = edge[0]

        has_middle_joint = beam.attributes.get("has_middle_joint")

        if level == 0:
            hierarchy_rank = {"shoe": 0, "tertiary": 2, "secondary": 4, "primary": 4, "main_primary": 4}
            start_priority = beam.centerline.start.z
        elif level == 1:
            hierarchy_rank = {"shoe": 0, "tertiary": 4, "secondary": 2, "primary": 3, "main_primary": 3}
            start_priority = 9999
        else: 
            hierarchy_rank = {"shoe": 0, "tertiary": 2, "secondary": 2, "primary": 4, "main_primary": 4}
            start_priority = 9999

        hierarchy = beam.attributes.get("hierarchy", "")
        shoe_priority = 0 if hierarchy == "shoe" else 1

        if has_middle_joint and level == 0:
            mid_priority = 1 
        elif has_middle_joint and level == 1:
            mid_priority = 1 
        else: 
            mid_priority = 0

        
        joint_idx = joint_rank[joint]
        hierarchy_idx = hierarchy_rank.get(hierarchy)
        mid_point = beam.centerline.midpoint
   
        sorting_data.append((
                            shoe_priority,
                            level,
                            mid_priority,
                            hierarchy_idx,
                            edge_a,
                            start_priority,
                            mid_point.z,
                            joint_idx,
                            i,
                            beam,
                            joint,
                        ))
        
sorting_data.sort()

pattern = [
    ("secondary", "B"),
    ("secondary", "A"),
    ("main_primary", "A"),
    ("tertiary", "B"),

    ("secondary", "B"),
    ("primary", "B"),
    ("tertiary", "A"),

    ("secondary", "A"),
    ("main_primary", "A"),
    ("tertiary", "B"),

    ("primary", "B"),
    ("tertiary", "A"),
]

# remove duplicate beam entries first
seen = set()
unique_data = []

for data in sorting_data:
    *_, i, beam, joint = data

    if (i, beam) not in seen:
        unique_data.append(data)
        seen.add((i, beam))

sorting_data = unique_data

# separate levels
level_0 = [data for data in sorting_data
    if data[1] == 0 and data[-2].attributes.get("has_middle_joint") == False]
level_0_middle = [data for data in sorting_data
    if data[1] == 0 and data[-2].attributes.get("has_middle_joint") == True]
level_1_middle = [data for data in sorting_data
    if data[1] == 1 and data[-2].attributes.get("has_middle_joint") == True]
level_1 = [data for data in sorting_data
    if data[1] == 1 and data[-2].attributes.get("has_middle_joint") == False]
level_2 = [data for data in sorting_data if data[1] == 2]
others = [data for data in sorting_data if data[1] not in [0, 1, 2]]

# center point of level 1 joints
cx = sum(data[-1].location.x for data in level_1) / len(level_1)
cy = sum(data[-1].location.y for data in level_1) / len(level_1)

ordered_level_1 = []
remaining = list(level_1)

pattern_idx = 0
anchor_angle = None

while remaining:
    moved = False
    wanted_hierarchy, wanted_direction = pattern[pattern_idx % len(pattern)]
    matching = []

    for data in remaining:
        *_, i, beam, joint = data

        hierarchy = beam.attributes.get("hierarchy")
        direction_id = beam.attributes.get("direction_id")

        if hierarchy != wanted_hierarchy:
            continue
        if wanted_direction is not None and direction_id != wanted_direction:
            continue

        angle = math.atan2(joint.location.y - cy, joint.location.x - cx)
        matching.append((angle, data))

    if matching:
        if wanted_hierarchy in ["primary", "tertiary"] and anchor_angle is not None:
            matching.sort(key=lambda x: min(abs(x[0] - anchor_angle), 2 * math.pi - abs(x[0] - anchor_angle)))

        selected_angle, selected_data = matching[0]

        ordered_level_1.append(selected_data)
        remaining.remove(selected_data)

        if wanted_hierarchy == "secondary":
            anchor_angle = selected_angle

        moved = True

    pattern_idx += 1

ordered_level_1.extend(remaining)
ordered_middle = []

remaining_level_1_middle = list(level_1_middle)
remaining_level_0_middle = list(level_0_middle)

# ------------------------------------------------------------
# Order level 1 middle beams clockwise
# ------------------------------------------------------------
cx_middle = sum(data[-2].centerline.midpoint.x for data in remaining_level_1_middle) / len(remaining_level_1_middle)
cy_middle = sum(data[-2].centerline.midpoint.y for data in remaining_level_1_middle) / len(remaining_level_1_middle)

start_data = sorted(
    remaining_level_1_middle,
    key=lambda data: (data[-2].centerline.midpoint.x, data[-2].centerline.midpoint.y))[0]

start_pt = start_data[-2].centerline.midpoint
start_angle = math.atan2(start_pt.y - cy_middle, start_pt.x - cx_middle)

clockwise_ordered = []

for data in remaining_level_1_middle:
    pt = data[-2].centerline.midpoint
    angle = math.atan2(pt.y - cy_middle, pt.x - cx_middle)
    clockwise_distance = (start_angle - angle) % (2 * math.pi)
    clockwise_ordered.append((clockwise_distance, data))
clockwise_ordered.sort(key=lambda x: x[0])

remaining_level_1_middle = [data for _, data in clockwise_ordered]

# ------------------------------------------------------------
# Pair each clockwise level 1 middle beam with nearest level 0 middle beam
# ------------------------------------------------------------
while remaining_level_1_middle:
    level_1_data = remaining_level_1_middle.pop(0)

    ordered_middle.append(level_1_data)

    if remaining_level_0_middle:
        nearest_level_0 = min(
            remaining_level_0_middle,
            key=lambda data: (
                (level_1_data[-2].centerline.midpoint.x - data[-2].centerline.midpoint.x) ** 2 +
                (level_1_data[-2].centerline.midpoint.y - data[-2].centerline.midpoint.y) ** 2))

        ordered_middle.append(nearest_level_0)
        remaining_level_0_middle.remove(nearest_level_0)

# if there are leftover level 0 middle beams, add them after
ordered_middle.extend(remaining_level_0_middle)
sorting_data = level_0 + ordered_level_1 + ordered_middle + level_2 + others

beams = final_models.beams
sorted_beams = []

tag_point = []
tag_text = []

local_seq_idx = 0

for data in sorting_data:
    *_, i, beam, joint = data

    if (i, beam) in unvisited:
        beams[i].attributes["sequence_id"] = local_seq_idx
        sorted_beams.append(beam.geometry)
        local_seq_idx += 1

        tag_point.append(beam.centerline.midpoint)
        tag_text.append(str(beam.attributes.get("direction_id")))

        del unvisited[(i, beam)]

final_model = final_models
# ---------- end python_3_script_4 ----------

# ---- group: sequence preview with hierarchy colors
# Preview
python_3_script_5 = Python3Script(model=data, sorting_data=python_3_script_2.sorting_data, step=number_slider)  # -> out, geometry_to_show, colors_to_show, plate, midpoints_to_show, texts_to_show; inputs sorting_data: list, step: Int32
# ---------- python_3_script_5: Python ----------
import rhinoscriptsyntax as rs
import scriptcontext as sc
import Rhino.Display as rd
import System.Drawing as sd

from compas.scene import Scene
from compas.geometry import Line, Point
from copy import deepcopy


alpha = 180

COLORS = {
    "primary":      sd.Color.FromArgb(alpha, 220,  50,  50),
    "main_primary": sd.Color.FromArgb(alpha, 150,  80, 220),
    "secondary":    sd.Color.FromArgb(alpha,  50, 150, 220),
    "tertiary":     sd.Color.FromArgb(alpha,  80, 200, 100),
    "shoe":         sd.Color.FromArgb(alpha,  20, 150, 100),
    "plate":        sd.Color.FromArgb(alpha, 100, 100, 100)
}

geometry = []
colors = []


sorted_geometry = []
sorted_colors = []
sorted_midpoints = []
sorted_texts = []
seen = set()


for plate in model.plates:
    geometry.append(plate.geometry)
    colors.append(COLORS["plate"])

for beam in model.beams:
    hie = beam.attributes.get("hierarchy", "secondary")
    geometry.append(beam.geometry)
    colors.append(COLORS.get(hie, COLORS["secondary"]))

for data in sorting_data:
    *_, i, _, joint = data

    if i in seen:
        continue

    if 0 <= i < len(model.beams):
        beam = model.beams[i]

        sorted_geometry.append(beam.geometry)
        sorted_colors.append(
            COLORS.get(
                beam.attributes.get("hierarchy", "secondary"),
                COLORS["secondary"]
            )
        )

        # midpoint per beam
        sorted_midpoints.append(beam.centerline.midpoint)

        # first 4 values from sorting_data as text
        sorted_texts.append(" | ".join(str(value) for value in data[:4]))

        seen.add(i)


step = max(0, min(step, len(sorted_geometry)))

geometry_to_show = sorted_geometry[:step]
colors_to_show = sorted_colors[:step]
plate = geometry[0]
midpoints_to_show = sorted_midpoints[:step]
texts_to_show = sorted_texts[:step]
# ---------- end python_3_script_5 ----------
compas_draw_2 = COMPASDraw(cg=python_3_script_5.geometry_to_show)  # -> rg; same code as compas_draw

# ---- group: sequence preview from seq_idx attributes & assembly_method
# sequence preview from seq_idx attributes
# & assembly_method
# make NEW BEAMS as support
python_3_script_6 = Python3Script(model=python_3_script_2.final_model, step=number_slider)  # -> out, geometry_to_show, colors_to_show, final_model, end_points, support_beams; inputs step: Int32
# ---------- python_3_script_6: Python ----------
import rhinoscriptsyntax as rs
import scriptcontext as sc
import Rhino.Display as rd
import System.Drawing as sd

from compas.scene import Scene
from compas.geometry import Line, Point
from copy import deepcopy
from compas_timber.elements import Beam

# manual vs robot
# op1 manually level 1 tertiary
# and very small elements
# middle note do 2 by 2

alpha = 180

COLORS = {  
    "human":        sd.Color.FromArgb(alpha, 220, 50, 50),
    "robot":        sd.Color.FromArgb(alpha, 80, 200, 100),
    "plate":        sd.Color.FromArgb(alpha, 100, 100, 100)
}

geometry = []
colors = []

geometry_to_show = []
colors_to_show = []
assembly_methods = []

# ------------------------------------------------------------
# plates
# ------------------------------------------------------------
for plate in model.plates:
    geometry.append(plate.geometry)
    colors.append(COLORS["plate"])

    geometry_to_show.append(plate.geometry)
    colors_to_show.append(COLORS["plate"])
    assembly_methods.append("plate")


# ------------------------------------------------------------
# assign assembly method to beams
# ------------------------------------------------------------
for beam in model.beams:
    seq_idx = beam.attributes.get("sequence_id")
    level = beam.attributes.get("level")
    hierarchy = beam.attributes.get("hierarchy")
    direction_id = beam.attributes.get("direction_id")

    assembly_method = None
    
    if level == 0:
        if hierarchy == "shoe" and direction_id == "B":
            assembly_method = "human"
        elif hierarchy == "shoe" and direction_id == "A":
            assembly_method = "robot"
        else:
            assembly_method = "human"
    elif level == 1:
        if hierarchy == "tertiary":
            assembly_method = "human"
        else:
            assembly_method = "robot"

    if assembly_method is None:
        assembly_method = "robot"

    beam.attributes["assembly_method"] = assembly_method

    beam_volume = beam.geometry.volume
    beam.attributes["volume"] = beam_volume

    beam_weight = beam_volume * 470
    beam.attributes["weight"] = beam_weight

    beam_width = beam.width
    beam_height = beam.height

    beam.attributes["crosssection"] = beam_width, "x", beam_height

    beam.attributes["blanklength"] = beam.blank_length

    geometry.append(beam.geometry)
    colors.append(COLORS[assembly_method])
    assembly_methods.append(assembly_method)


# ------------------------------------------------------------
# sort beams by seq_idx
# ------------------------------------------------------------
sorted_beams = sorted(model.beams, key=lambda beam: beam.attributes.get("sequence_id", 999999))

sorted_geometry = []
sorted_colors = []

for beam in sorted_beams:
    assembly_method = beam.attributes.get("assembly_method", "human")

    sorted_geometry.append(beam.geometry)
    sorted_colors.append(COLORS[assembly_method])


# ------------------------------------------------------------
# slider control
# ------------------------------------------------------------
step = int(step)
step = max(0, min(step, len(sorted_geometry)))


for beam_geo, beam_color in zip(sorted_geometry[:step], sorted_colors[:step]):
    geometry_to_show.append(beam_geo)
    colors_to_show.append(beam_color)



end_points = []
support_beam_line = []
support_beams = []
for i, beam in enumerate(sorted_beams[:step]):
    level = beam.attributes.get("level")
    hierarchy = beam.attributes.get("hierarchy")
    if 42 <= i <= 45:
        end_point = beam.centerline.end
        start_point = beam.centerline.start
        
        p_end_point = end_point.copy()
        p_end_point.z = start_point.z

        end_points.append(p_end_point)

        support_beam_cl = Line(end_point, p_end_point)
        support_beam_line.append(support_beam_cl)
    if 54 <= i <= 57:
        end_point = beam.centerline.end
        start_point = beam.centerline.point_at(0.1)
        # start_point = beam.centerline.start
        
        p_start_point = start_point.copy()
        p_start_point.z = end_point.z

        end_points.append(p_start_point)

        support_beam_cl = Line(start_point, p_start_point)
        support_beam_line.append(support_beam_cl)
    # elif level == 1 and hierarchy == "tertiary":
 

for line in support_beam_line:
    support_beam = Beam.from_centerline(line, 0.1,0.1)
    support_beams.append(support_beam.geometry)



final_model = model
# ---------- end python_3_script_6 ----------

# ----
compas_draw_3 = COMPASDraw(cg=python_3_script_5.plate)  # -> rg; same code as compas_draw
compas_draw_4 = COMPASDraw(cg=python_3_script_5.plate)  # -> rg; same code as compas_draw
compas_draw_5 = COMPASDraw(cg=python_3_script_5.midpoints_to_show)  # -> rg; same code as compas_draw

# ---- group: sequence preview with hierarchy colors
wires = BrepWireframe(Brep=compas_draw_2, Density=-1)
preview = CustomPreview(Geometry=compas_draw_2, Material=python_3_script_5.colors_to_show)
previewlw = CustomPreviewLineweights(Geometry=wires, Shader=ColourSwatch(SwatchColor=RGB(255, 255, 255)), Absolute=False)

# ----
tag = TextTag(Location=compas_draw_5, Text=python_3_script_5.texts_to_show)
compas_draw_6 = COMPASDraw(cg=python_3_script_6.support_beams)  # -> rg; same code as compas_draw
compas_draw_7 = COMPASDraw(cg=python_3_script_6.end_points)  # -> rg; same code as compas_draw
panel_5 = Panel(python_3_script_6.final_model)
compas_draw_8 = COMPASDraw(cg=python_3_script_6.geometry_to_show)  # -> rg; same code as compas_draw
preview_2 = CustomPreview(Geometry=compas_draw_3, Material=ColourSwatch(SwatchColor=RGBA(0, 0, 0, 159)))
preview_3 = CustomPreview(Geometry=compas_draw_8, Material=python_3_script_6.colors_to_show)
wires_2 = BrepWireframe(Brep=compas_draw_8, Density=-1)
dot_display_2 = DotDisplay(Point=compas_draw_7, Colour=RGB(0, 0, 0), Size="0.2")
preview_4 = CustomPreview(Geometry=compas_draw_6, Material=ColourSwatch(SwatchColor=RGBA(255, 255, 60, 143)))
previewlw_2 = CustomPreviewLineweights(Geometry=wires_2, Shader=ColourSwatch(SwatchColor=RGB(255, 255, 255)), Absolute=False)

# ---- group: add grasp_frame and i_vec as beam attributes
# add grasp_frame and
# insersion vector
# as beam attributes
# THINGS TO DO: - insersion vector for recripocal
# - insersion vector for level 0 : easier with z
# - middle joint, lap easier from the outside than inside
python_3_script_7 = Python3Script(model=python_3_script_6.final_model)  # -> out, grasp_planes, beam_faces, i_vectors, final_model, a, tag_points, tag_texts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
# ---------- python_3_script_7: Python ----------
from compas.geometry import Frame, Vector, Point, Line, Rotation
from compas_rhino.conversions import frame_to_rhino_plane, vector_to_rhino, plane_to_rhino, point_to_rhino
from compas_timber.connections import TMultiStepJoint
from compas_timber.elements import CutFeature
import math

grasp_planes = []
beam_faces = []
i_vectors = []

final_model = model

a = []
selected_beams = []
selected_joints = []

seen_beams = set()

for joint in final_model.joints:
    if isinstance(joint, TMultiStepJoint):
        for beam in joint.elements:
            beam_length = beam.attributes.get("blanklength")
            has_middle_joint = beam.attributes.get("has_middle_joint")

            if beam_length > 1.6 and has_middle_joint == False:

                if beam in seen_beams:
                    continue

                seen_beams.add(beam)

                a.append(beam.geometry)
                selected_beams.append(beam)
                selected_joints.append(joint)

# ------------------------------------------------------------
# Settings for grouping similar cuts
# ------------------------------------------------------------
point_tolerance = 1
seen_cut_keys = set()

tag_points = []
tag_texts = []
dc_plane = []
dc_vector = []
bm_plane = []
bm_vector = []
new_i_vec = []

insertion_vectors_by_beam = {}

for i, beam in enumerate(selected_beams):
    lowest_feature_by_type = {}

    features = beam.features

    for j, feature in enumerate(features):
        feature_type = type(feature).__name__

        if feature_type not in ["DoubleCut", "BirdsMouth"]:
            continue

        planes = feature.planes_from_params_and_beam(beam)

        world_down = Vector(0, 0, -1)

        sorted_planes = sorted(
                                planes,
                                key=lambda plane: plane.normal.unitized().dot(world_down),
                                reverse=True
                            )

        level = beam.attributes.get("level")
        if feature_type == "DoubleCut":
            if level == 1:
                selected_plane = sorted_planes[1]
            elif level == 2:
                selected_plane = sorted_planes[0]

        elif feature_type == "BirdsMouth":
            selected_plane = sorted_planes[0]

        selected_point = selected_plane.point

        if feature_type not in lowest_feature_by_type:
            lowest_feature_by_type[feature_type] = (feature, selected_plane, selected_point)
        else:
            current_lowest_point = lowest_feature_by_type[feature_type][2]

            if selected_point.z < current_lowest_point.z:
                lowest_feature_by_type[feature_type] = (feature, selected_plane, selected_point)

    dc_vec = None
    bm_vec = None

    for feature_type, data in lowest_feature_by_type.items():
        feature, selected_plane, selected_point = data

        tag_points.append(point_to_rhino(selected_point))
        tag_texts.append(feature_type)

        if feature_type == "DoubleCut":
            dc_plane.append(plane_to_rhino(selected_plane))
            dc_vec = -selected_plane.normal.copy()
   
            dc_vector.append(vector_to_rhino(dc_vec))

        elif feature_type == "BirdsMouth":
            bm_plane.append(plane_to_rhino(selected_plane))
            bm_vec = selected_plane.normal.copy()

            bm_vector.append(vector_to_rhino(bm_vec))

    if dc_vec and bm_vec:
        dc_vec_u = dc_vec.unitized()
        bm_vec_u = bm_vec.unitized()

        i_vec_lb = (dc_vec_u + bm_vec_u).unitized()

        insertion_vectors_by_beam[beam] = i_vec_lb
        new_i_vec.append(vector_to_rhino(i_vec_lb))


for i, beam in enumerate(final_model.beams):
    # ============================================================
    # Grasp frame
    # ============================================================
    beam_face = beam.side_as_surface(0)
    pick_up_point = beam_face.point_at(0.5, 0.5)
    beam_frame = beam.frame.copy()
    beam_frame.point = pick_up_point

    level = beam.attributes.get("level")
    hierarchy = beam.attributes.get("hierarchy")
    has_middle_joint = beam.attributes.get("has_middle_joint")
    # print(i_vec_lb)
    if level == 0 and hierarchy != "shoe":
        insersion_vec = -Vector.Zaxis()
    elif beam in insertion_vectors_by_beam:
        insersion_vec = insertion_vectors_by_beam[beam]
    elif level == 1 and has_middle_joint:
        insersion_vec = -Vector.Zaxis()
    else:
        insersion_vec = beam_frame.zaxis

    beam.attributes["grasp_frame"] = beam_frame
    beam.attributes["insertion_vector"] = insersion_vec

    grasp_frame = beam.attributes.get("grasp_frame")
    i_vec = beam.attributes.get("insertion_vector")


    grasp_plane = frame_to_rhino_plane(grasp_frame)
    grasp_planes.append(grasp_plane)
    beam_face_mesh = beam_face.to_mesh()
    beam_faces.append(beam_face_mesh)
    i_vector = vector_to_rhino(i_vec)
    i_vectors.append(i_vector)
# ---------- end python_3_script_7 ----------

# ----
compas_draw_9 = COMPASDraw(cg=python_3_script_7.beam_faces)  # -> rg; same code as compas_draw
plane = Plane(python_3_script_7.bm_plane)
vector = Vector(python_3_script_7.dc_vector)
# name beam
# MXX-YY
# module number - beam key
# need 2 timber modules
# mirror = different
# 2 modules x 2
vector_2 = Vector(python_3_script_7.bm_vector)
# 50 & 80 cm the size of GRIPPER
plane_2 = Plane(python_3_script_7.grasp_planes)
plane_3 = Plane(python_3_script_7.dc_plane)
vector_display = VectorDisplay(Anchor=python_3_script_7.bm_plane, Vector=vector_2)
vector_display_2 = VectorDisplay(Anchor=python_3_script_7.dc_plane, Vector=vector)
text_tag_4 = TextTag(Location=python_3_script_7.tag_points, Text=python_3_script_7.tag_texts)
area = Area(Geometry=compas_draw_9)  # -> Area, Centroid
vector_3 = Vector(python_3_script_7.i_vectors)
compas_draw_10 = COMPASDraw(cg=python_3_script_7.a)  # -> rg; same code as compas_draw
# new insersion vector!
vector_display_ex = VectorDisplayEx(Point=area.Centroid, Vector=vector_3, Colour=ColourSwatch(SwatchColor=RGB(108, 75, 185)), Width="5")
center = Center(Geometry=compas_draw_10)  # -> Center, Dimension
custom_preview_3 = CustomPreview(
    Geometry=compas_draw_10,
    Material={diffuse=RGB(221, 160, 221), emission=RGB(66, 48, 66), shine=0.5, specular=RGB(255, 255, 255), transparency=0})

vector_4 = Vector(python_3_script_7.new_i_vec)
vector_display_3 = VectorDisplay(Anchor=center.Center, Vector=vector_4)

number_slider_2 = Slider(62, range=0..100)
increment = Increment(BeginningNumber=0, StepSize=1, currentValue=0, increment=1, oldStart=0)  # -> Output, Item

# ---- group: Gripper holes
py3_6 = Python3Script(model=python_3_script_7.final_model)  # -> out, geo, frames, out_model
# ---------- py3_6: Python ----------
from compas.geometry import Line, Plane, Frame
from compas.geometry import intersection_segment_plane
from compas.geometry import angle_vectors
from compas.geometry import dot_vectors
from compas.tolerance import TOL
from compas_timber.fabrication import Drilling

from compas.geometry import Transformation

GRIPPER_SEPARATION = 0.8
DRILL_DEPTH_1 = 0.04
DRILL_DEPTH_2 = 0.01

DRILL_DIAMETER = 0.0205

BIG_GRIPPER = 0.8
SMALL_GRIPPER = 0.5

mod = model


def get_default_ref_side_index(plane, beam):
        """Get the default reference side index for the given cutting plane and beam.
        This method checks if the cutting plane intersects with the reference sides of the beam
        and returns the index of the reference side with the smallest angle to the plane's normal.

        # NOTE: Consider moving all connection-agnostic utilities (including this one) to a shared location for reuse in fabrication and other modules.

        Parameters
        ----------
        plane : :class:`~compas.geometry.Plane` or :class:`~compas.geometry.Frame`
            The cutting plane.
        beam : :class:`~compas_timber.elements.Beam`
            The beam that is cut by this instance.

        Returns
        -------
        int
            The default ref_side_index for the given cutting plane and beam.

        """
        angles = {}
        max = 100000
        key = 0
        for i, ref_side in enumerate(beam.ref_sides[:4]):
            width, _ = beam.get_dimensions_relative_to_side(i)
            y_seg = Line.from_point_and_vector(ref_side.point, ref_side.yaxis * width)
            # check if the plane intersects with the reference side and the angle between their normals is positive
            dot = dot_vectors(plane.normal, ref_side.normal)
            if dot<max:
                max=dot
                key=i
        return key

geo = []
frames = []
for beam in mod.beams:
    level = beam.attributes.get("level")
    hierarchy = beam.attributes.get("hierarchy")
    grasp = beam.attributes.get("grasp_frame")
    T = beam.transformation_to_local()
    gc = grasp.copy()
    ref_side = get_default_ref_side_index(Plane.from_frame(grasp), beam)
    T = Transformation.from_change_of_basis(Frame.worldXY(), beam.ref_sides[ref_side])
    print(gc.transformed(T))
    w,h=beam.get_dimensions_relative_to_side(ref_side)
    if beam.attributes["assembly_method"]=="robot":
        frames.append(grasp)
        if beam.blank_length >= 1.0:
            drilling = Drilling(
                start_x=gc.transformed(T).point.x + BIG_GRIPPER/2,
                start_y=gc.transformed(T).point.y,
                depth_limited=True,
                depth=DRILL_DEPTH_1,
                diameter=DRILL_DIAMETER,
                ref_side_index=ref_side,
                is_joinery=False,
            )
            beam.add_feature(drilling)
            drilling = Drilling(
                start_x=gc.transformed(T).point.x - BIG_GRIPPER/2,
                start_y=gc.transformed(T).point.y,
                depth_limited=True,
                depth=DRILL_DEPTH_1,
                diameter=DRILL_DIAMETER,
                ref_side_index=ref_side,
                is_joinery=False,
            )
            beam.add_feature(drilling)
            drilling = Drilling(
                start_x=gc.transformed(T).point.x - (BIG_GRIPPER/2 - 0.20),
                start_y=gc.transformed(T).point.y,
                depth_limited=True,
                depth=DRILL_DEPTH_2,
                diameter=DRILL_DIAMETER,
                ref_side_index=ref_side,
                is_joinery=False,
            )
            beam.add_feature(drilling)

        elif beam.blank_length >= 0.6:
            drilling = Drilling(
                start_x=gc.transformed(T).point.x + SMALL_GRIPPER/2,
                start_y=gc.transformed(T).point.y,
                depth_limited=True,
                depth=DRILL_DEPTH_1,
                diameter=DRILL_DIAMETER,
                ref_side_index=ref_side,
                is_joinery=False,
            )
            beam.add_feature(drilling)
            drilling = Drilling(
                start_x=gc.transformed(T).point.x - SMALL_GRIPPER/2,
                start_y=gc.transformed(T).point.y,
                depth_limited=True,
                depth=DRILL_DEPTH_1,
                diameter=DRILL_DIAMETER,
                ref_side_index=ref_side,
                is_joinery=False,
            )
            beam.add_feature(drilling)
            drilling = Drilling(
                start_x=gc.transformed(T).point.x - (SMALL_GRIPPER/2 - 0.05),
                start_y=gc.transformed(T).point.y,
                depth_limited=True,
                depth=DRILL_DEPTH_2,
                diameter=DRILL_DIAMETER,
                ref_side_index=ref_side,
                is_joinery=False,
            )
            beam.add_feature(drilling)


    try:
        if level==0:
        # if level==0 and hierarchy == "shoe":
            geo.append(beam.geometry)
    except Exception as e:
        pass

out_model = mod
# ---------- end py3_6 ----------
draw_14 = COMPASDraw(cg=py3_6.frames)  # -> rg; same code as compas_draw
item_2 = ListItem(List=draw_14, Index=0, Wrap=True)  # -> Item, Item1, Item2
draw_15 = COMPASDraw(cg=py3_6.geo)  # -> rg; same code as compas_draw
panel_7 = Panel(py3_6.frames)
pl = ConstructPlane(Origin=item_2.Item, XAxis=item_2.Item1, YAxis=item_2.Item2)
preview_5 = CustomPreview(
    Geometry=draw_15,
    Material={diffuse=RGB(221, 160, 221), emission=RGB(66, 48, 66), shine=0.5, specular=RGB(255, 255, 255), transparency=0})

number_slider_3 = Slider(0, range=-2.5..2.5)
number_slider_4 = Slider(0, range=-2.5..2.5)
individual = BooleanToggle(True)
merge = Merge(Data1=Slider(0, range=-2.5..2.5), Data2=Slider(0, range=-2.5..2.5))
positioner = Python3Script(model=py3_6.out_model, individual=individual)  # -> out, name, summary, geometry, blank, consoles_positions, full_consoles, gripper_positions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; inputs index: Int32, exclude: list of Int32
# ---------- positioner: Python ----------
from compas_timber.planning import BeamStock
from compas_timber.planning import BeamNester

from compas.scene import Scene
from compas.geometry import Transformation
from compas.geometry import Frame
from compas.geometry import Vector
from compas.geometry import Translation

from ghpythonlib.treehelpers import list_to_tree


# ==========================================================
# Helpers
# ==========================================================

def get_bbox_length_from_vertices(vertices):
    xs = []
    ys = []
    zs = []

    for v in vertices:
        if isinstance(v, (list, tuple)):
            x, y, z = v[0], v[1], v[2]
        elif hasattr(v, "point"):
            x, y, z = v.point.x, v.point.y, v.point.z
        else:
            x, y, z = v.x, v.y, v.z

        xs.append(x)
        ys.append(y)
        zs.append(z)

    x_length = max(xs) - min(xs)
    y_length = max(ys) - min(ys)
    z_length = max(zs) - min(zs)

    return max(x_length, y_length, z_length)


def get_cnc_transformation(element, data):
    frame_original = data.get("frame")

    blank_ext = element._resolve_blank_extensions()
    value = blank_ext[0]

    frame = Frame(
        frame_original.point + (value, 0, 0),
        Vector.Xaxis(),
        -Vector.Zaxis()
    )

    offset_transformation = Translation.from_vector(
        Vector.Zaxis() * element.height / 2.0
    )

    cnc_transformation = (
        Transformation.from_frame(frame)
        * offset_transformation
    )

    return cnc_transformation, frame


# ==========================================================
# Scene
# ==========================================================

debug_scene = Scene()
geo_scene = Scene()
blank_scene = Scene()


# ==========================================================
# Stock catalog
# ==========================================================

stock_catalog = [
    BeamStock(5, (0.10, 0.10)),
    BeamStock(5, (0.10, 0.14)),
    BeamStock(5, (0.10, 0.12)),
]


# ==========================================================
# Spacing
# ==========================================================

if individual:
    spacing_value = 100
else:
    spacing_value = spacing


# ==========================================================
# Exclude fallback
# ==========================================================

try:
    exclude_value = exclude
except:
    exclude_value = []


# ==========================================================
# Nesting
# ==========================================================

nester = BeamNester(
    model,
    stock_catalog,
    spacing_value,
    per_group=True
)

nesting_result = nester.nest(
    fast=False,
    consoles=True,
    optimize=True,
    exclude_groups=exclude_value
)


# ==========================================================
# Collect level 0 beams + nesting data only
# ==========================================================

beam_data = []

for stock_i, stock in enumerate(nesting_result.stocks):

    for guid, data in stock.element_data.items():

        element = model.element_by_guid(str(guid))

        if element is None:
            continue

        level = element.attributes.get("level")
        hierarchy = element.attributes.get("hierarchy")

        # if level != 0:
        #     continue
        
        # if level == 0 and hierarchy == "shoe":

        sequence_id = element.attributes.get(
            "sequence_id",
            999999
        )

        beam_data.append({
            "sequence_id": sequence_id,
            "level": level,
            "stock_index": stock_i,
            "stock": stock,
            "element": element,
            "data": data,
            "consoles_positions": stock.consoles_positions or []
        })


# ==========================================================
# Sort level 0 beams by sequence_id
# ==========================================================

beam_data = sorted(
    beam_data,
    key=lambda x: x["sequence_id"]
)


# ==========================================================
# Full consoles positions
# one branch = one level 0 beam, sorted by sequence_id
# ==========================================================

full_consoles_data = []

for item in beam_data:

    element = item["element"]
    data = item["data"]
    frame = data.get("frame")

    beam_start_x = frame.point.x
    beam_end_x = beam_start_x + element.blank_length

    local_consoles = []

    for p in item["consoles_positions"]:

        if beam_start_x <= p <= beam_end_x:
            local_consoles.append(
                round(p - beam_start_x, 2)
            )

    full_consoles_data.append(local_consoles)

full_consoles = list_to_tree(full_consoles_data)


# ==========================================================
# BBox length list
# one value = one level 0 beam, sorted by sequence_id
# ==========================================================

length_list = []

for item in beam_data:

    element = item["element"]
    data = item["data"]

    cnc_transformation, frame = get_cnc_transformation(element, data)

    geo_for_length = element.elementgeometry.transformed(
        cnc_transformation
    )

    bbox_len = round(
        get_bbox_length_from_vertices(geo_for_length.vertices)*1000,
        3
    )

    length_list.append(bbox_len)


# ==========================================================
# Summary, level 0 only, sorted by sequence_id
# ==========================================================

summary_lines = []

for item, local_consoles, bbox_len in zip(
    beam_data,
    full_consoles_data,
    length_list
):

    element = item["element"]
    stock = item["stock"]
    data = item["data"]

    summary_lines.append(
        "SequenceID: {}".format(item["sequence_id"])
    )

    summary_lines.append(
        "BeamName: {}".format(element.name)
    )

    summary_lines.append(
        "StockIndex: {}".format(item["stock_index"])
    )

    summary_lines.append(
        "Dimensions(mm): {:.0f}x{:.0f}x{:.0f}".format(
            stock.cross_section[0] * 1000,
            stock.cross_section[1] * 1000,
            stock.length * 1000
        )
    )

    summary_lines.append(
        "BeamLength(mm): {:.1f}".format(
            data.get("length", 0) * 1000
        )
    )

    summary_lines.append(
        "BBoxLength(m): {:.4f}".format(bbox_len)
    )

    summary_lines.append(
        "Level: {}".format(item["level"])
    )

    summary_lines.append(
        "Consoles(m): {}".format(local_consoles)
    )

    summary_lines.append(
        "Group: {}".format(list(stock.groups))
    )

    summary_lines.append("--------")

summary = "\n".join(summary_lines)


# ==========================================================
# Select one level 0 beam by sorted index
# index = order in level 0 beam_data, not stock index
# ==========================================================

debug_volumes = []

name = None
selected_sequence_id = None
selected_stock_index = None
consoles_positions = []
bbox_length = None

if 0 <= index < len(beam_data):

    item = beam_data[index]

    element = item["element"]
    data = item["data"]

    selected_sequence_id = item["sequence_id"]
    selected_stock_index = item["stock_index"]

    name = element.name

    consoles_positions = full_consoles_data[index]
    bbox_length = length_list[index]

    cnc_transformation, frame = get_cnc_transformation(element, data)

    # ======================================================
    # Geometry
    # ======================================================

    geo = element.elementgeometry.transformed(
        cnc_transformation
    )

    geo_scene.add(geo)

    # ======================================================
    # Blank
    # ======================================================

    local_blank = element.blank.transformed(
        element.transformation_to_local()
    )

    local_blank.transform(
        Transformation.from_frame(frame)
    )

    local_blank.translate(
        Vector.Yaxis() * element.height / 2.0
    )

    blank_scene.add(local_blank)


# ==========================================================
# GH Outputs
# ==========================================================

geometry = geo_scene.draw()
blank = blank_scene.draw()
debug_volumes = list_to_tree(debug_volumes)
# ---------- end positioner ----------
addition = Addition(A=positioner.consoles_positions, B=merge)
panel_8 = Panel(positioner.name)
tag_2 = TextTag(Location="{0,0,0.3}", Text=positioner.name, Colour=ColourSwatch(SwatchColor=RGB(0, 0, 0)))
panel_9 = Panel(positioner.summary)
beam = Beam(G=positioner.geometry, geo=positioner.blank, A=Slider(0, range=0..3))
full_consoles = Panel(positioner.full_consoles)
consoles = Consoles(F=addition)
bbox_length = Panel(positioner.bbox_length)
length_list = Panel(positioner.length_list)
bake = BakeGeometry(Bake=Toggle(True), Geometry=beam, DeleteOldBakes=False, PreserveTrees=False)

# ----
number_slider_5 = Slider(1, range=1..10)  # disabled

# ---- group: Gripper holes / for milling checking
# green for robot
# red for human
number_slider_6 = Slider(0, range=0..2)
python_3_script_8 = Python3Script(model=py3_6.out_model, l=number_slider_6)  # -> out, geometry, centerlines, plate, colors, beam_name, dimension, blank_length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
# ---------- python_3_script_8: Python ----------
import rhinoscriptsyntax as rs
import scriptcontext as sc
import Rhino.Display as rd
import System.Drawing as sd


alpha = 180

COLORS = {
    "robot": sd.Color.FromArgb(alpha, 0, 200, 100),
    "human": sd.Color.FromArgb(alpha, 220, 50, 50),
    "plate": sd.Color.FromArgb(alpha, 100, 100, 100),
    "default": sd.Color.FromArgb(alpha, 148, 148, 255)
}


# ==========================================================
# Outputs containers
# ==========================================================

geometry = []
centerlines = []
colors = []

beam_name = []
dimension = []
blank_length = []
geo_length = []
robot = []
assembly_order = []


# ==========================================================
# Plates
# ==========================================================

for plate in model.plates:
    geometry.append(plate.geometry)
    colors.append(COLORS["plate"])


# ==========================================================
# Collect beam data first
# ==========================================================

beam_data = []

for beam in model.beams:

    level = beam.attributes.get("level")
    hierarchy = beam.attributes.get("hierarchy")

    # if level == l:
    # if level == l and hierarchy == "shoe":

    assembly_method = beam.attributes.get("assembly_method")

    centerline = beam.centerline

    # --------------------------------------------------
    # Color
    # --------------------------------------------------

    if assembly_method == "robot":
        color = COLORS["robot"]
        robot_value = True

    elif assembly_method == "human":
        color = COLORS["human"]
        robot_value = False

    else:
        color = COLORS["default"]
        robot_value = None

    # --------------------------------------------------
    # Sequence
    # --------------------------------------------------

    seq = beam.attributes.get("sequence_id")

    if seq is None:
        seq = 999999

    # --------------------------------------------------
    # Store everything together
    # --------------------------------------------------

    beam_data.append({

        "sequence_id": seq,

        "geometry": beam.geometry,

        "color": color,

        "beam_name": beam.name,

        "dimension":
            "{:.0f} x {:.0f} mm".format(
                beam.width * 1000,
                beam.height * 1000
            ),

        "geo_length":
            round(beam.length * 1000, 1),

        "blank_length":
            round(beam.blank_length * 1000, 1),

        "robot": robot_value,

        "centerline": centerline
    })


# ==========================================================
# Sort by assembly order
# ==========================================================

beam_data = sorted(
    beam_data,
    key=lambda x: x["sequence_id"]
)


# ==========================================================
# Rebuild outputs
# ==========================================================

for data in beam_data:

    centerlines.append(data["centerline"])
    geometry.append(data["geometry"])

    colors.append(data["color"])

    beam_name.append(data["beam_name"])

    dimension.append(data["dimension"])

    geo_length.append(data["geo_length"])

    blank_length.append(data["blank_length"])

    robot.append(data["robot"])

    assembly_order.append(data["sequence_id"])


# ==========================================================
# GH Outputs
# ==========================================================

plate = geometry[0] if geometry else None
# ---------- end python_3_script_8 ----------
compas_draw_11 = COMPASDraw(cg=python_3_script_8.geometry)  # -> rg; same code as compas_draw
compas_draw_12 = COMPASDraw()  # -> rg; same code as compas_draw
wires_3 = BrepWireframe(Brep=compas_draw_11, Density=-1)
preview_6 = CustomPreview(Geometry=compas_draw_11, Material=python_3_script_8.colors)
previewlw_3 = CustomPreviewLineweights(Geometry=wires_3, Shader=ColourSwatch(SwatchColor=RGB(255, 255, 255)), Absolute=False)

# ----
button = Button()  # disabled
panel_10 = Panel("""1839.88
1972.172
1961.4
1412.534
2234.59
2159.433
1351.086
2019.701
1245.861
1291.996
1602.38
1540.315
1481.994
1542.804""")
panel_11 = Panel("""2052.091
1871.95
2208.395
2357.569
2370.399
2540.039""")
Z = UnitZ(Factor=Slider(0.2, range=0..1))
sort = SortList(Keys=panel_11)  # -> Keys, ValuesA
sort_2 = SortList(Keys=length_list)  # -> Keys, ValuesA
sort_3 = SortList(Keys=panel_10)  # -> Keys, ValuesA
py3_7 = Python3Script(models=python_3_script_7.final_model, version=number_slider_5, save=button)  # inputs models: list, version: Int32; disabled
# ---------- py3_7: Python ----------
import os, sys, importlib
from datetime import date

from compas.data import json_dump

gh_dir = os.path.dirname(ghenv.Component.OnPingDocument().FilePath)
gh_par = os.path.dirname(gh_dir)
file_path = os.path.join(gh_par, "modularization", "data")

# print(file_path)
today = date.today().strftime("%y%m%d")
# print(today)



if save:
    serializable = []
    for m in models:
        serializable.append({
            "attributes": dict(m.attributes),
            "model": m
        })
        
    output_path = os.path.join(file_path, f"{today}_v{version}_sequenced_timber_model.json")
    dump = json_dump(serializable, output_path, pretty=True)
    print(f"Model written to {output_path}")
# ---------- end py3_7 ----------
first_last = FirstLast(List=sort.Keys)  # -> FirstValue, LastValue
first_last_2 = FirstLast(List=sort_2.Keys)  # -> FirstValue, LastValue
first_last_3 = FirstLast(List=sort_3.Keys)  # -> FirstValue, LastValue
panel_12 = Panel(first_last_3.FirstValue)
panel_13 = Panel(first_last_3.LastValue)
panel_14 = Panel(first_last.FirstValue)
panel_15 = Panel(first_last.LastValue)
panel_16 = Panel(first_last_2.FirstValue)
panel_17 = Panel(first_last_2.LastValue)

# ---- group: Gripper holes
compas_draw_13 = COMPASDraw(cg=python_3_script_8.plate)  # -> rg; same code as compas_draw
preview_7 = CustomPreview(Geometry=compas_draw_13, Material=ColourSwatch(SwatchColor=RGBA(0, 0, 0, 159)))
beam_name = Panel(python_3_script_8.beam_name)
dimension = Panel(python_3_script_8.dimension)
blank_length = Panel(python_3_script_8.blank_length)
geo_length = Panel(python_3_script_8.geo_length)
robot = Panel(python_3_script_8.robot)
assembly_order = Panel(python_3_script_8.assembly_order)

# ----
# TimberModel with all attributes
python_3_script_9 = Python3Script(model=python_3_script_7.final_model)  # -> out, weight
# ---------- python_3_script_9: Python ----------
hierarchy = []
edge = []
group = []
level = []
reached = []
has_middle_joint = []
direction_id = []
cyclic_sign = []
sequence_id = []
assembly_method = []
volume = []
weight = []
crosssection = []
blanklength = []
grasp_frame = []
insertion_vector = []

for i, beam in enumerate(model.beams):
    attrs = beam.attributes

    hierarchy.append(attrs.get("hierarchy"))
    edge.append(attrs.get("edge"))
    group.append(attrs.get("group"))
    level.append(attrs.get("level"))
    reached.append(attrs.get("reached"))
    has_middle_joint.append(attrs.get("has_middle_joint"))
    direction_id.append(attrs.get("direction_id"))
    cyclic_sign.append(attrs.get("cyclic_sign"))
    sequence_id.append(attrs.get("sequence_id"))
    assembly_method.append(attrs.get("assembly_method"))
    volume.append(attrs.get("volume"))
    weight.append(attrs.get("weight"))
    crosssection.append(attrs.get("crosssection"))
    blanklength.append(attrs.get("blanklength"))
    grasp_frame.append(attrs.get("grasp_frame"))
    insertion_vector.append(attrs.get("insertion_vector"))

print(hierarchy)
# ---------- end python_3_script_9 ----------
compas_draw_14 = COMPASDraw(cg=python_3_script_8.centerlines)  # -> rg; same code as compas_draw
midpt = CurveMiddle(Curve=compas_draw_14)

# ---- group: Gripper holes
split = TextSplit(Text=python_3_script_8.dimension, Separators="mm")
item_3 = ListItem(List=split, Index=0, Wrap=True)
flatten = FlattenTree(Tree=item_3, Path="{0}")
panel_18 = Panel(flatten)

debrep = DeconstructBrep(Brep=compas_draw_11)  # -> Faces, Edges, Vertices
item_4 = ListItem(List=debrep.Vertices, Index=0, Wrap=True)  # -> flatten(Item)
cull_i = CullIndex(List=item_4, Indices=0, Wrap=True)
tag_3 = TextTag(Location=midpt, Text=python_3_script_8.beam_name, Colour=ColourSwatch(SwatchColor=RGB(0, 0, 0)))

# ----
panel_19 = Panel(python_3_script_9.weight)

# ---- group: Gripper holes
py3_8 = Python3Script(models=py3_6.out_model, version=Slider(1, range=1..10), save=Button())  # inputs models: list, version: Int32
# ---------- py3_8: Python ----------
import os, sys, importlib
from datetime import date

from compas.data import json_dump, json_load

gh_dir = os.path.dirname(ghenv.Component.OnPingDocument().FilePath)
gh_par = os.path.dirname(gh_dir)
file_path = os.path.join(gh_par, "modularization", "data")

# print(file_path)
today = date.today().strftime("%y%m%d")
# print(today)



if save:
    serializable = []
    for m in models:
        serializable.append({
            "attributes": dict(m.attributes),
            "model": m
        })
        
    output_path = os.path.join(file_path, f"{today}_v{version}_fabrication_model_2.json")
    dump = json_dump(serializable, output_path, pretty=True)
    print(f"Model written to {output_path}")




# serializable = []
# for m in models:
#     serializable.append({
#         "attributes": dict(m.attributes),
#         "model": m
#     })
# print (serializable)
# ---------- end py3_8 ----------

# ----
py3_9 = Python3Script(x=py3_6.out_model)  # -> out, a, b
# ---------- py3_9: Python ----------
from compas.data import json_loads, json_dumps
from compas.scene import Scene

scene = Scene()

a = json_loads(json_dumps(x))
a.process_joinery()

for beam in a.beams:
    scene.add(beam.geometry)

b = scene.draw()
# ---------- end py3_9 ----------
geo = Geometry(py3_9.b)

# ---- group: Gripper holes
bbox = BoundingBox(Content=positioner.geometry, Plane=PlaneXY(0, 0, 0))  # -> Box, Box_2
debrep_2 = DeconstructBrep(Brep=bbox.Box)  # -> Faces, Edges, Vertices
len = Length(Curve=debrep_2.Edges)
sort_4 = SortList(Keys=len, ValuesA=debrep_2.Edges)  # -> Keys, ValuesA
item_5 = ListItem(List=reverse(sort_4.ValuesA), Index=0, Wrap=True)

# ----
move = Move(Geometry=item_5, Motion=Z)  # -> Geometry, Transform

# ---- group: Gripper holes (continued)
linedim = LineDimension(Line=move.Geometry, Text="{0:0.000}", Size=0.1)

# ==== cluster Consoles
xz = XZPlane(Origin=Point(0, 0, 0))
pt = ConstructPoint(XCoordinate=0, YCoordinate=0, ZCoordinate=0)
pt_2 = ConstructPoint(
    XCoordinate=Slider(120, range=0..1000),
    YCoordinate=Slider(2500, range=0..10000),
    ZCoordinate=expr("-x", Slider(140, range=0..1000)))
division = Division(A=pt_2, B=1000)
box = Box2Pt(PointA=pt, PointB=division, Plane=PlaneXY(0, 0, 0))
division_2 = Division(A=Slider(70, range=0..100), B=1000)
F = ClusterInput()
Z = UnitZ(Factor=expr("-x", division_2))
X = UnitX(Factor=F)
lng = ListLength(List=X)
series = Series(Start=Slider(0.3, range=0..1), Step=Slider(0.2, range=0..1), Count=lng)
move = Move(Geometry=box, Motion=Z)  # -> Geometry, Transform
move_2 = Move(Geometry=move.Geometry, Motion=X)  # -> Geometry, Transform
geo = Geometry(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)
aligndim = AlignedDimension(Plane=xz, PointA=pt, PointB=X, Offset=expr("-x", series), Text="{0:0.00}", Size=Slider(0.1, range=0..0.1))
preview = CustomPreview(Geometry=[move_2.Geometry, geo], Material=ColourSwatch(SwatchColor=RGBA(0, 0, 0, 119)))

# ==== cluster Beam
X = UnitX(Factor=1)
A = ClusterInput()
subtraction = Subtraction(A=A, B=3)
geo = ClusterInput()
neg = Negative(Value=subtraction)
multiplication = Multiplication(A=90, B=neg)
geo_2 = Geometry(geo)
area = Area(Geometry=geo_2)  # -> Area, Centroid
line = LineSDL(Start=area.Centroid, Direction=X, Length=1)
rot3d = Rotate3D(Geometry=geo_2, Angle=degrees(multiplication), Center=area.Centroid, Axis=line)  # -> Geometry, Transform
debox = DeconstructBox(Box=rot3d.Geometry)  # -> Plane, X, Y, Z
division = Division(A="70", B=1000)
Z = UnitZ(Factor=division)
dedomain = DeconstructDomain(Domain=debox.Z)  # -> Start, End
move = Move(Geometry=rot3d.Geometry, Motion=Z)  # -> Geometry, Transform
subtraction_2 = Subtraction(A=dedomain.End, B=dedomain.Start)
division_2 = Division(A="280", B=1000)
merge = Merge(Data1=graft(rot3d.Geometry), Data2=graft(move.Geometry))
equalst = EqualityWithinTolerance(FirstNumber=subtraction_2, SecondNumber=division_2, Tolerance=0.001)  # -> Equality, Inequality
panel = Panel(equalst.Equality)
graft = GraftTree(Tree=equalst.Equality, IncludeEmptyLists=True, IncludeNullItems=True)
item = ListItem(List=merge, Index=graft, Wrap=True)
edges = BrepEdges(Brep=item)  # -> Naked, Interior, NonManifold
previewlw = CustomPreviewLineweights(Geometry=edges.Interior, Shader=ColourSwatch(SwatchColor=RGB(255, 71, 71)), Absolute=False)
division_3 = Division(A="70", B=1000)
Z_2 = UnitZ(Factor=division_3)
G = ClusterInput()
transform = Transform(Geometry=G, Transform=rot3d.Transform)
move_2 = Move(Geometry=transform, Motion=Z_2)  # -> Geometry, Transform
merge_2 = Merge(Data1=graft(transform), Data2=graft(move_2.Geometry))
item_2 = ListItem(List=merge_2, Index=graft, Wrap=True)
edges_2 = BrepEdges(Brep=item_2)  # -> Naked, Interior, NonManifold
brep = Brep(item_2)
brep_2 = ClusterOutput(brep)
preview = CustomPreview(Geometry=item_2, Material=ColourSwatch(SwatchColor=RGBA(255, 171, 97, 119)))
previewlw_2 = CustomPreviewLineweights(Geometry=edges_2.Interior, Shader=ColourSwatch(SwatchColor=RGB(0, 0, 0)), Absolute=False)
