# Grasshopper definition 290426_cutting_blanks.ghx (Grasshopper 1.0.8)

# ---- group: secondary
curve = Curve([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])
curve_2 = Curve([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])
curve_3 = Curve([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])
curve_4 = Curve([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])

# ---- group: primary
curve_5 = Curve([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])
curve_6 = Curve([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])
curve_7 = Curve([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])
curve_8 = Curve(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)
curve_9 = Curve([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])

# ---- group: shoe
curve_10 = Curve([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])

# ---- group: compas_timber
python_3_script = Python3Script(
    p_1=curve_8,
    p_2=curve_5,
    p_3=curve_7,
    p_4=curve_6,
    p_5=curve_9,
    s_1=curve_3,
    s_2=curve,
    s_3=curve_4,
    s_4=curve_2,
    s_5=curve_10)  # -> out, a, b, c, d, e, model_ex; inputs p_1: list of Line, p_2: list of Line, p_3: list of Line, p_4: list of Line, p_5: list of Line, s_1: list of Line, s_2: list of Line, s_3: list of Line, s_4: list of Line, s_5: list of Line
# ---------- python_3_script: Python ----------
from compas.scene import Scene
from compas_rhino.conversions import line_to_compas
from compas.tolerance import Tolerance, TOL

from compas_timber.model import TimberModel
from compas_timber.elements import Beam

from compas_timber.connections import JointTopology
from compas_timber.connections import TMultiStepJoint
from compas_timber.connections import TStepJoint
from compas_timber.connections import LMiterJoint
from compas_timber.connections import TBirdsmouthJoint
from compas_timber.connections import XLapJoint

from compas.geometry import Frame, Vector, Point, angle_vectors


#initialise compas timber model
model = TimberModel(Tolerance(unit="MM", absolute="0.001"))

#beam list
beams = []

#convert rhino curves into compas lines
"primary lines"
p_1 = [line_to_compas(c) for c in p_1]
p_2 = [line_to_compas(c) for c in p_2]
p_3 = [line_to_compas(c) for c in p_3]
p_4 = [line_to_compas(c) for c in p_4]
p_5 = [line_to_compas(c) for c in p_5]

"secondary lines"
s_1 = [line_to_compas(c) for c in s_1]
s_2 = [line_to_compas(c) for c in s_2]
s_3 = [line_to_compas(c) for c in s_3]
s_4 = [line_to_compas(c) for c in s_4]

"tertiary (shoe) lines"
s_5 = [line_to_compas(c) for c in s_5]

#assign beam names and width
"primary lines"
for l in p_1:
    l.name = "primary_1"
    beam = Beam.from_centerline(l, width=.120, height=.160)
    beam.name = "primary"
    beams.append(beam)
    model.add_element(beam)

for l in p_2:
    l.name = "primary_2"
    beam = Beam.from_centerline(l, width=.120, height=.180)
    beam.name = "primary"
    beams.append(beam)
    model.add_element(beam)

for l in p_3:
    l.name = "primary_3"
    beam = Beam.from_centerline(l, width=.140, height=.180)
    beam.name = "primary"
    beams.append(beam)
    model.add_element(beam)

for l in p_4:
    l.name = "primary_4"
    beam = Beam.from_centerline(l, width=.140, height=.200)
    beam.name = "primary"
    beams.append(beam)
    model.add_element(beam)

for l in p_5:
    l.name = "primary_5"
    beam = Beam.from_centerline(l, width=.140, height=.240)
    beam.name = "primary"
    beams.append(beam)
    model.add_element(beam)

"Secondary lines"
for l in s_1:
    l.name = "secondary_1"
    beam = Beam.from_centerline(l, width=.120, height=.160)
    beam.name = "secondary"
    beams.append(beam)
    model.add_element(beam)

for l in s_2:
    l.name = "secondary_2"
    beam = Beam.from_centerline(l, width=.120, height=.180)
    beam.name = "secondary"
    beams.append(beam)
    model.add_element(beam)

for l in s_3:
    l.name = "secondary_3"
    beam = Beam.from_centerline(l, width=.140, height=.180)
    beam.name = "secondary"
    beams.append(beam)
    model.add_element(beam)

for l in s_4:
    l.name = "secondary_4"
    beam = Beam.from_centerline(l, width=.140, height=.200)
    beam.name = "secondary"
    beams.append(beam)
    model.add_element(beam)

"tertiary lines"
for l in s_5:
    l.name = "tertiary"
    beam = Beam.from_centerline(l, width=.120, height=.120)
    beam.name = "tertiary"
    beams.append(beam)
    model.add_element(beam)

#reset beams and features
for beam in model.beams:
    beam.remove_features()

#compute line network
model.connect_adjacent_beams()

#debugging tools
candidates_a = []
candidates_b = []
frames_a = []
frames_b = []
planarity_check = []

#set joint conditions
for candidate in model.joint_candidates:
    
    #check for frames
    frame_a = candidate.element_a.frame
    frame_a.xaxis = Vector(0,0,1)
    frames_a.append (frame_a)

    frame_b = candidate.element_b.frame
    frame_b.xaxis = Vector(0,0,1)
    frames_b.append (frame_b)

    #visualise candidates for debug
    candidates_a.append(Beam.from_centerline(candidate.element_a.centerline, width = .1, height = .1))
    candidates_b.append(Beam.from_centerline(candidate.element_b.centerline, width = .1, height = .1))

    #planarity check between candidate a and candidate b
    planarity = (angle_vectors(frame_a.normal, frame_b.normal, deg=True))
    planarity_check.append(planarity)
    
    is_planar = bool
    if planarity < 0.2 or planarity > 179.8:
        is_planar = True
    else:
        is_planar = False
    print (is_planar)

    #check for mid_point = above certain z_height
    a_is_shoe = bool
    b_is_shoe = bool
    ceiling_height = 24.48

    height_a = candidate.element_a.centerline.midpoint.z
    if height_a > ceiling_height:
        a_is_shoe = True
    else:
        a_is_shoe = False
        
    height_b = candidate.element_b.centerline.midpoint.z
    if height_b > ceiling_height:
        b_is_shoe = True
    else:
        b_is_shoe = False

    #joints based on topology, planarity and z height
    if candidate.topology == JointTopology.TOPO_T and is_planar == True:
        if b_is_shoe == True:
            t_step_joint = TMultiStepJoint.create(model, candidate.element_a, candidate.element_b, step_count=2)
        
        else:
            if angle_vectors(candidate.element_a.centerline.direction, candidate.element_b.centerline.direction, deg=True) < 50:
                step_shape = "heel"
            else:
                step_shape = "step"
            
            print (candidate.element_a.centerline.name)
            t_step_joint = TMultiStepJoint.create(model, candidate.element_a, candidate.element_b, step_shape=step_shape, step_depth=.02, riser_angle=90)
    
    elif candidate.topology == JointTopology.TOPO_T and is_planar == False:
        t_bm_joint = TBirdsmouthJoint.create(model, candidate.element_a, candidate.element_b)

    elif candidate.topology==JointTopology.TOPO_L:
        l_miter_joint = LMiterJoint.create(model, candidate.element_a, candidate.element_b, cutoff = False)

    elif candidate.topology == JointTopology.TOPO_X:
        x_lap_joint = XLapJoint.create(model, candidate.element_a, candidate.element_b)

    else:
        print ("some joints were not created!")
        continue

#process joints in compas timber model
model.process_joinery()
a = []
for beam in model.beams:
    a.append(beam.geometry)

b = frames_a[0]
c = candidates_a[0].geometry
d = frames_b[0]
e = candidates_b[0].geometry
model_ex = model
print (planarity_check[1])
# ---------- end python_3_script ----------

# ----
panel = Panel(python_3_script.out)
# cut = JackRafterCut.from_plane_and_beam(butt_plane, self.main_beam, name="Roughing_Cut")
py3 = Python3Script(model_timber=python_3_script.model_ex, offset=Slider(0.03, range=0..0.1), idx=Slider(57, range=0..100))  # -> out, blank, geometry, planes, cuts, b; inputs idx: Int32
# ---------- py3: Python ----------
from compas.scene import Scene
from compas.geometry import Line, Plane, Rotation, intersection_plane_plane_plane

from compas_rhino.conversions import plane_to_rhino
from compas_timber.fabrication import JackRafterCut
import math

model = model_timber
#model_timber.process_joinery()


scene = Scene()

blank_geometries = []      
beam_geometries = []       
beam_cut_planes = []       
beam_cut_lines = []        

for beam in model.beams:
    T_local = beam.transformation_to_local()
    R = Rotation.from_axis_and_angle([1, 0, 0], math.radians(90))

    blank = beam.blank
    b = blank.transformed(T_local)
    b.transform(R)

    geo = beam.geometry
    g = geo.transformed(T_local)
    g.transform(R)

    blank_geometries.append(b)
    beam_geometries.append(g)

    cut_planes_this_beam = []
    cut_lines_this_beam = []

    for feature in beam.features:
        if isinstance(feature, JackRafterCut) and feature.name == "Roughing_Cut":
            cut_plane = feature.plane_from_params_and_beam(beam)
            side_plane = beam.side_as_surface(feature.ref_side_index).to_plane()
            front_plane = Plane.from_frame(beam.front_side(feature.ref_side_index))
            back_plane = Plane.from_frame(beam.back_side(feature.ref_side_index))

            sp = intersection_plane_plane_plane(cut_plane, side_plane, front_plane)
            ep = intersection_plane_plane_plane(cut_plane, side_plane, back_plane)
            cut_line = Line(sp, ep)

            # transform to beam local coordinates
            cut_plane.transform(T_local)
            cut_line.transform(T_local)

            # rotate to machining orientation
            cut_plane.transform(R)
            cut_line.transform(R)

            # optional start-side offset
            vector = cut_plane.normal
            vector.unitize
            if feature.orientation == "start":
                cut_plane.translate(vector*offset)
                cut_line.translate(vector*offset)
            
            if feature.orientation == "end":
                cut_plane.translate(vector*offset)
                cut_line.translate(vector*offset)

            cut_planes_this_beam.append(plane_to_rhino(cut_plane))
            cut_lines_this_beam.append(cut_line)
            scene.add(cut_line)

    beam_cut_planes.append(cut_planes_this_beam)
    beam_cut_lines.append(cut_lines_this_beam)

b = scene.draw()

# GH outputs:
blank = blank_geometries[idx]
geometry = beam_geometries[idx]
planes = beam_cut_planes[idx]
cuts = beam_cut_lines[idx]
# ---------- end py3 ----------
compas_draw = COMPASDraw(cg=python_3_script.b)  # -> rg
#   port cg: The COMPAS geometry or datastructure to be drawn.
#   port rg: The Rhino geometry object.
# ---------- compas_draw: Python ----------
# r: compas>=2.14.1
"""
Draws COMPAS geometry in Grasshopper.
"""

from typing import Any

import Grasshopper

from compas.scene import SceneObject


class CompasToRhinoGeometry(Grasshopper.Kernel.GH_ScriptInstance):
    def RunScript(self, cg):
        if not cg:
            return None

        return SceneObject(item=cg).draw()
# ---------- end compas_draw ----------
compas_draw_2 = COMPASDraw(cg=python_3_script.c)  # -> rg; same code as compas_draw
compas_draw_3 = COMPASDraw(cg=python_3_script.d)  # -> rg; same code as compas_draw
compas_draw_4 = COMPASDraw(cg=python_3_script.e)  # -> rg; same code as compas_draw
draw = COMPASDraw(cg=py3.blank)  # -> rg; same code as compas_draw
draw_2 = COMPASDraw(cg=py3.cuts)  # -> rg; same code as compas_draw
draw_3 = COMPASDraw(cg=py3.geometry)  # -> rg; same code as compas_draw
geometry = Geometry(python_3_script.a)
pln = Plane(py3.planes)
geo = Geometry(py3.b)
draw_4 = COMPASDraw(cg=python_3_script.a)  # -> rg; same code as compas_draw
