# Grasshopper definition 260601_timbermodel_sequence.ghx (Grasshopper 1.0.8)
# plug-ins: Heteroptera, Human

# ----
# TimberModel
# Load json file
toggle = BooleanToggle(True)
py3 = Python3Script(load=toggle)  # -> out, timber_models; inputs load: Boolean
# ---------- py3: Python ----------
from compas.data import json_load
import os, sys, importlib

from copy import deepcopy

gh_dir = os.path.dirname(ghenv.Component.OnPingDocument().FilePath)
gh_par = os.path.dirname(gh_dir)
# file_path = os.path.join(gh_par, "modularization", "data", "260526_v2_timber_models.json")

file_path = os.path.join(gh_par, "timber_design", "data", "260527_v1_timber_models.json")
print(file_path)

if load:
    results = json_load(file_path)
    results = deepcopy(results)

    for data in results:
        model = data['model']
        attrs = data['attributes']
        print (model.attributes.keys())

        model.attributes = attrs
        print (model.attributes.keys())

    timber_models = [data['model'] for data in results]
# ---------- end py3 ----------

list = ValueList({"Zero": 0, "One": 1, "Two": 2, "Three": 2² - 1}, selected="Zero")
item = ListItem(List=py3.timber_models, Index=list, Wrap=True)

# ----
# Process joinery
# (seems cannot orient elements only),
# maybe we can create timber model that is oriented already
toggle_2 = BooleanToggle(False)
py3_2 = Python3Script(model=item, process=toggle_2)  # -> out, model; inputs process: Boolean
# ---------- py3_2: Python ----------
import os, sys, importlib

gh_dir = os.path.dirname(ghenv.Component.OnPingDocument().FilePath)

parent = os.path.dirname(gh_dir)              # go up one level
src_dir = os.path.join(parent, "src")         # go into src folder
if src_dir not in sys.path:
    sys.path.insert(0, src_dir)


import timber_config
importlib.reload(timber_config)

import timber_model
importlib.reload(timber_model)
from timber_model import apply_processings

from copy import deepcopy

model = deepcopy(model)


if process:
    apply_processings(model)
# ---------- end py3_2 ----------

# ---- group: sequence preview from seq_idx attributes & assembly_method
# sequence preview from seq_idx attributes
# & assembly_method
python_3_script = Python3Script(model=py3_2.model)  # -> out, tag_point, tag_text, geometry_to_show, colors_to_show, final_model
# ---------- python_3_script: Python ----------
import rhinoscriptsyntax as rs
import scriptcontext as sc
import Rhino.Display as rd
import System.Drawing as sd

from compas.scene import Scene
from compas.geometry import Line, Point
from copy import deepcopy
from compas_timber.elements import Beam

# manual vs robot
# op1 manually level 1 tertiary
# and very small elements
# middle note do 2 by 2

alpha = 120

COLORS = {  
    # "human":        sd.Color.FromArgb(alpha, 220, 50, 50),
    # "robot":        sd.Color.FromArgb(alpha, 80, 200, 100),
    "human":        sd.Color.FromArgb(alpha, 50, 150, 220),
    "robot":        sd.Color.FromArgb(alpha, 20, 150, 100),
    "plate":        sd.Color.FromArgb(alpha, 100, 100, 100)
}

geometry = []
colors = []

geometry_to_show = []
colors_to_show = []
assembly_methods = []

# ------------------------------------------------------------
# plates
# ------------------------------------------------------------
for plate in model.plates:
    geometry.append(plate.geometry)
    colors.append(COLORS["plate"])

    geometry_to_show.append(plate.geometry)
    colors_to_show.append(COLORS["plate"])
    assembly_methods.append("plate")


# ------------------------------------------------------------
# assign assembly method to beams
# ------------------------------------------------------------
for beam in model.beams:
    seq_idx = beam.attributes.get("sequence_id")
    level = beam.attributes.get("level")
    hierarchy = beam.attributes.get("hierarchy")
    direction_id = beam.attributes.get("direction_id")

    assembly_method = None
    
    if level == 0:
        if hierarchy == "shoe" and direction_id == "B":
            assembly_method = "human"
        elif hierarchy == "shoe" and direction_id == "A":
            assembly_method = "robot"
        else:
            assembly_method = "human"
    elif level == 1:
        if hierarchy == "tertiary":
            assembly_method = "human"
        else:
            assembly_method = "robot"

    if assembly_method is None:
        assembly_method = "robot"

    beam.attributes["assembly_method"] = assembly_method

    beam_volume = beam.geometry.volume
    beam.attributes["volume"] = beam_volume

    beam_weight = beam_volume * 470
    beam.attributes["weight"] = beam_weight

    beam_width = beam.width
    beam_height = beam.height

    beam.attributes["crosssection"] = beam_width, "x", beam_height

    beam.attributes["blanklength"] = beam.blank_length

    geometry_to_show.append(beam.geometry)
    colors.append(COLORS[assembly_method])
    assembly_methods.append(assembly_method)

final_model = model
# ---------- end python_3_script ----------

# ----
draw = COMPASDraw(cg=python_3_script.tag_point)  # -> rg
#   port cg: The COMPAS geometry or datastructure to be drawn.
#   port rg: The Rhino geometry object.
# ---------- draw: Python ----------
# r: compas>=2.14.1
"""
Draws COMPAS geometry in Grasshopper.
"""

from typing import Any

import Grasshopper

from compas.scene import SceneObject


class CompasToRhinoGeometry(Grasshopper.Kernel.GH_ScriptInstance):
    def RunScript(self, cg):
        if not cg:
            return None

        return SceneObject(item=cg).draw()
# ---------- end draw ----------
text_tag = TextTag(Location=draw, Text=python_3_script.tag_text, Colour=ColourSwatch(SwatchColor=RGB(0, 0, 14)))
panel = Panel(python_3_script.final_model)
compas_draw = COMPASDraw(cg=python_3_script.geometry_to_show)  # -> rg; same code as draw
preview = CustomPreview(Geometry=compas_draw, Material=python_3_script.colors_to_show)
wires = BrepWireframe(Brep=compas_draw, Density=-1)
previewlw = CustomPreviewLineweights(Geometry=wires, Shader=ColourSwatch(SwatchColor=RGB(255, 255, 255)), Absolute=False)

# ---- group: add grasp_frame and i_vec as beam attributes
# add grasp_frame and
# insersion vector
# as beam attributes
python_3_script_2 = Python3Script(model=python_3_script.final_model)  # -> out, grasp_planes, beam_faces, i_vectors, final_model, a, tag_points, tag_texts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
# ---------- python_3_script_2: Python ----------
from compas.geometry import Frame, Vector, Point, Line, Rotation
from compas_rhino.conversions import frame_to_rhino_plane, vector_to_rhino, plane_to_rhino, point_to_rhino
from compas_timber.connections import TMultiStepJoint
from compas_timber.elements import CutFeature
import math

grasp_planes = []
beam_faces = []
i_vectors = []

final_model = model

a = []
selected_beams = []
selected_joints = []

seen_beams = set()

for joint in final_model.joints:
    if isinstance(joint, TMultiStepJoint):
        for beam in joint.elements:
            beam_length = beam.attributes.get("blanklength")
            has_middle_joint = beam.attributes.get("has_middle_joint")

            if beam_length > 1.6 and has_middle_joint == False:

                if beam in seen_beams:
                    continue

                seen_beams.add(beam)

                a.append(beam.geometry)
                selected_beams.append(beam)
                selected_joints.append(joint)

# ------------------------------------------------------------
# Settings for grouping similar cuts
# ------------------------------------------------------------
point_tolerance = 1
seen_cut_keys = set()

tag_points = []
tag_texts = []
dc_plane = []
dc_vector = []
bm_plane = []
bm_vector = []
new_i_vec = []

insertion_vectors_by_beam = {}

for i, beam in enumerate(selected_beams):
    lowest_feature_by_type = {}

    features = beam.features

    for j, feature in enumerate(features):
        feature_type = type(feature).__name__

        if feature_type not in ["DoubleCut", "BirdsMouth"]:
            continue

        planes = feature.planes_from_params_and_beam(beam)

        world_down = Vector(0, 0, -1)

        sorted_planes = sorted(
                                planes,
                                key=lambda plane: plane.normal.unitized().dot(world_down),
                                reverse=True
                            )

        level = beam.attributes.get("level")
        if feature_type == "DoubleCut":
            if level == 1:
                selected_plane = sorted_planes[1]
            elif level == 2:
                selected_plane = sorted_planes[0]

        elif feature_type == "BirdsMouth":
            selected_plane = sorted_planes[0]

        selected_point = selected_plane.point

        if feature_type not in lowest_feature_by_type:
            lowest_feature_by_type[feature_type] = (feature, selected_plane, selected_point)
        else:
            current_lowest_point = lowest_feature_by_type[feature_type][2]

            if selected_point.z < current_lowest_point.z:
                lowest_feature_by_type[feature_type] = (feature, selected_plane, selected_point)

    dc_vec = None
    bm_vec = None

    for feature_type, data in lowest_feature_by_type.items():
        feature, selected_plane, selected_point = data

        tag_points.append(point_to_rhino(selected_point))
        tag_texts.append(feature_type)

        if feature_type == "DoubleCut":
            dc_plane.append(plane_to_rhino(selected_plane))
            dc_vec = -selected_plane.normal.copy()
   
            dc_vector.append(vector_to_rhino(dc_vec))

        elif feature_type == "BirdsMouth":
            bm_plane.append(plane_to_rhino(selected_plane))
            bm_vec = selected_plane.normal.copy()

            bm_vector.append(vector_to_rhino(bm_vec))

    if dc_vec and bm_vec:
        dc_vec_u = dc_vec.unitized()
        bm_vec_u = bm_vec.unitized()

        i_vec_lb = (dc_vec_u + bm_vec_u).unitized()

        insertion_vectors_by_beam[beam] = i_vec_lb
        new_i_vec.append(vector_to_rhino(i_vec_lb))


for i, beam in enumerate(final_model.beams):
    # ============================================================
    # Grasp frame
    # ============================================================
    beam_face = beam.side_as_surface(0)
    pick_up_point = beam_face.point_at(0.5, 0.5)
    beam_frame = beam.frame.copy()
    beam_frame.point = pick_up_point

    level = beam.attributes.get("level")
    hierarchy = beam.attributes.get("hierarchy")
    has_middle_joint = beam.attributes.get("has_middle_joint")
    # print(i_vec_lb)
    if level == 0 and hierarchy != "shoe":
        insersion_vec = -Vector.Zaxis()
    elif beam in insertion_vectors_by_beam:
        insersion_vec = insertion_vectors_by_beam[beam]
    elif level == 1 and has_middle_joint:
        insersion_vec = -Vector.Zaxis()
    else:
        insersion_vec = beam_frame.zaxis

    beam.attributes["grasp_frame"] = beam_frame
    beam.attributes["insertion_vector"] = insersion_vec

    grasp_frame = beam.attributes.get("grasp_frame")
    i_vec = beam.attributes.get("insertion_vector")


    grasp_plane = frame_to_rhino_plane(grasp_frame)
    grasp_planes.append(grasp_plane)
    beam_face_mesh = beam_face.to_mesh()
    beam_faces.append(beam_face_mesh)
    i_vector = vector_to_rhino(i_vec)
    i_vectors.append(i_vector)
# ---------- end python_3_script_2 ----------

# ----
compas_draw_2 = COMPASDraw(cg=python_3_script_2.beam_faces)  # -> rg; same code as draw
plane = Plane(python_3_script_2.bm_plane)
vector = Vector(python_3_script_2.dc_vector)
vector_2 = Vector(python_3_script_2.bm_vector)
# 50 & 80 cm the size of GRIPPER
plane_2 = Plane(python_3_script_2.grasp_planes)
plane_3 = Plane(python_3_script_2.dc_plane)
vector_display = VectorDisplay(Anchor=python_3_script_2.bm_plane, Vector=vector_2)
vector_display_2 = VectorDisplay(Anchor=python_3_script_2.dc_plane, Vector=vector)
text_tag_2 = TextTag(Location=python_3_script_2.tag_points, Text=python_3_script_2.tag_texts)
area = Area(Geometry=compas_draw_2)  # -> Area, Centroid
vector_3 = Vector(python_3_script_2.i_vectors)
compas_draw_3 = COMPASDraw(cg=python_3_script_2.a)  # -> rg; same code as draw
# new insersion vector!
vector_display_ex = VectorDisplayEx(Point=area.Centroid, Vector=vector_3, Colour=ColourSwatch(SwatchColor=RGB(108, 75, 185)), Width="5")
center = Center(Geometry=compas_draw_3)  # -> Center, Dimension
custom_preview = CustomPreview(
    Geometry=compas_draw_3,
    Material={diffuse=RGB(221, 160, 221), emission=RGB(66, 48, 66), shine=0.5, specular=RGB(255, 255, 255), transparency=0})

vector_4 = Vector(python_3_script_2.new_i_vec)
vector_display_3 = VectorDisplay(Anchor=center.Center, Vector=vector_4)

# ----
# TimberModel with all attributes
python_3_script_3 = Python3Script(model=python_3_script_2.final_model)  # -> out, weight
# ---------- python_3_script_3: Python ----------
hierarchy = []
edge = []
group = []
level = []
reached = []
has_middle_joint = []
direction_id = []
cyclic_sign = []
sequence_id = []
assembly_method = []
volume = []
weight = []
crosssection = []
blanklength = []
grasp_frame = []
insertion_vector = []

for i, beam in enumerate(model.beams):
    attrs = beam.attributes

    hierarchy.append(attrs.get("hierarchy"))
    edge.append(attrs.get("edge"))
    group.append(attrs.get("group"))
    level.append(attrs.get("level"))
    reached.append(attrs.get("reached"))
    has_middle_joint.append(attrs.get("has_middle_joint"))
    direction_id.append(attrs.get("direction_id"))
    cyclic_sign.append(attrs.get("cyclic_sign"))
    sequence_id.append(attrs.get("sequence_id"))
    assembly_method.append(attrs.get("assembly_method"))
    volume.append(attrs.get("volume"))
    weight.append(attrs.get("weight"))
    crosssection.append(attrs.get("crosssection"))
    blanklength.append(attrs.get("blanklength"))
    grasp_frame.append(attrs.get("grasp_frame"))
    insertion_vector.append(attrs.get("insertion_vector"))

print(beam.attributes)
# ---------- end python_3_script_3 ----------
panel_2 = Panel(python_3_script_3.weight)
py3_3 = Python3Script(model=python_3_script_2.final_model)  # -> out, geo, frames, out_model; disabled
# ---------- py3_3: Python ----------
from compas.geometry import Line, Plane, Frame
from compas.geometry import intersection_segment_plane
from compas.geometry import angle_vectors
from compas.geometry import dot_vectors
from compas.tolerance import TOL
from compas_timber.fabrication import Drilling

from compas.geometry import Transformation

GRIPPER_SEPARATION = 0.8
DRILL_DEPTH = 0.04
DRILL_DIAMETER = 0.0205

BIG_GRIPPER = 0.8
SMALL_GRIPPER = 0.5

mod = model


def get_default_ref_side_index(plane, beam):
        """Get the default reference side index for the given cutting plane and beam.
        This method checks if the cutting plane intersects with the reference sides of the beam
        and returns the index of the reference side with the smallest angle to the plane's normal.

        # NOTE: Consider moving all connection-agnostic utilities (including this one) to a shared location for reuse in fabrication and other modules.

        Parameters
        ----------
        plane : :class:`~compas.geometry.Plane` or :class:`~compas.geometry.Frame`
            The cutting plane.
        beam : :class:`~compas_timber.elements.Beam`
            The beam that is cut by this instance.

        Returns
        -------
        int
            The default ref_side_index for the given cutting plane and beam.

        """
        angles = {}
        max = 100000
        key = 0
        for i, ref_side in enumerate(beam.ref_sides[:4]):
            width, _ = beam.get_dimensions_relative_to_side(i)
            y_seg = Line.from_point_and_vector(ref_side.point, ref_side.yaxis * width)
            # check if the plane intersects with the reference side and the angle between their normals is positive
            dot = dot_vectors(plane.normal, ref_side.normal)
            if dot<max:
                max=dot
                key=i
        return key

geo = []
frames = []
for beam in mod.beams:
    level = beam.attributes.get("level")
    grasp = beam.attributes.get("grasp_frame")
    T = beam.transformation_to_local()
    gc = grasp.copy()
    ref_side = get_default_ref_side_index(Plane.from_frame(grasp), beam)
    T = Transformation.from_change_of_basis(Frame.worldXY(), beam.ref_sides[ref_side])
    print(gc.transformed(T))
    w,h=beam.get_dimensions_relative_to_side(ref_side)
    if beam.attributes["assembly_method"]=="robot":
        frames.append(grasp)
        if beam.blank_length >= 1.0:
            drilling = Drilling(
                start_x=gc.transformed(T).point.x + BIG_GRIPPER/2,
                start_y=gc.transformed(T).point.y,
                depth_limited=True,
                depth=DRILL_DEPTH,
                diameter=DRILL_DIAMETER,
                ref_side_index=ref_side,
                is_joinery=False,
            )
            beam.add_feature(drilling)
            drilling = Drilling(
                start_x=gc.transformed(T).point.x - BIG_GRIPPER/2,
                start_y=gc.transformed(T).point.y,
                depth_limited=True,
                depth=DRILL_DEPTH,
                diameter=DRILL_DIAMETER,
                ref_side_index=ref_side,
                is_joinery=False,
            )
            beam.add_feature(drilling)
            drilling = Drilling(
                start_x=gc.transformed(T).point.x - (BIG_GRIPPER/2 - 0.20),
                start_y=gc.transformed(T).point.y,
                depth_limited=True,
                depth=DRILL_DEPTH,
                diameter=DRILL_DIAMETER,
                ref_side_index=ref_side,
                is_joinery=False,
            )
            beam.add_feature(drilling)

        elif beam.blank_length >= 0.6:
            drilling = Drilling(
                start_x=gc.transformed(T).point.x + SMALL_GRIPPER/2,
                start_y=gc.transformed(T).point.y,
                depth_limited=True,
                depth=DRILL_DEPTH,
                diameter=DRILL_DIAMETER,
                ref_side_index=ref_side,
                is_joinery=False,
            )
            beam.add_feature(drilling)
            drilling = Drilling(
                start_x=gc.transformed(T).point.x - SMALL_GRIPPER/2,
                start_y=gc.transformed(T).point.y,
                depth_limited=True,
                depth=DRILL_DEPTH,
                diameter=DRILL_DIAMETER,
                ref_side_index=ref_side,
                is_joinery=False,
            )
            beam.add_feature(drilling)
            drilling = Drilling(
                start_x=gc.transformed(T).point.x - (SMALL_GRIPPER/2 - 0.05),
                start_y=gc.transformed(T).point.y,
                depth_limited=True,
                depth=DRILL_DEPTH,
                diameter=DRILL_DIAMETER,
                ref_side_index=ref_side,
                is_joinery=False,
            )
            beam.add_feature(drilling)


    try:
        # if level==0:
        geo.append(beam.geometry)
    except Exception as e:
        pass

out_model = mod
# ---------- end py3_3 ----------
draw_2 = COMPASDraw(cg=py3_3.geo)  # -> rg; same code as draw
draw_3 = COMPASDraw(cg=py3_3.frames)  # -> rg; same code as draw
panel_3 = Panel(py3_3.frames)
preview_2 = CustomPreview(
    Geometry=draw_2,
    Material={diffuse=RGB(221, 160, 221), emission=RGB(66, 48, 66), shine=0.5, specular=RGB(255, 255, 255), transparency=0})

number_slider = Slider(4, range=1..10)  # disabled
button = Button()  # disabled
py3_4 = Python3Script(models=py3_3.out_model, version=number_slider, save=button)  # inputs models: list, version: Int32; disabled
# ---------- py3_4: Python ----------
import os, sys, importlib
from datetime import date

from compas.data import json_dump

gh_dir = os.path.dirname(ghenv.Component.OnPingDocument().FilePath)
gh_par = os.path.dirname(gh_dir)
file_path = os.path.join(gh_par, "modularization", "data")

# print(file_path)
today = date.today().strftime("%y%m%d")
# print(today)



if save:
    serializable = []
    for m in models:
        serializable.append({
            "attributes": dict(m.attributes),
            "model": m
        })
        
    output_path = os.path.join(file_path, f"{today}_v{version}_fabrication_model.json")
    dump = json_dump(serializable, output_path, pretty=True)
    print(f"Model written to {output_path}")


# serializable = []
# for m in models:
#     serializable.append({
#         "attributes": dict(m.attributes),
#         "model": m
#     })
# print (serializable)
# ---------- end py3_4 ----------
