# Grasshopper definition assembly_sequence.ghx (Grasshopper 1.0.8)
# plug-ins: Human

# ----
# Load timer_model.json file
toggle = BooleanToggle(True)
py3 = Python3Script(load=toggle)  # -> out, timber_models; inputs load: Boolean
# ---------- py3: Python ----------
from compas.data import json_load
import os, sys, importlib

from copy import deepcopy

gh_dir = os.path.dirname(ghenv.Component.OnPingDocument().FilePath)
gh_par = os.path.dirname(gh_dir)
file_path = os.path.join(gh_par, "timber_design", "data", "260527_v3_timber_models.json")
print(file_path)

if load:
    results = json_load(file_path)
    results = deepcopy(results)

    for data in results:
        model = data['model']
        attrs = data['attributes']
        print (model.attributes.keys())

        model.attributes = attrs
        print (model.attributes.keys())

    timber_models = [data['model'] for data in results]
# ---------- end py3 ----------

human_scale = Geometry(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)
working_space_rfl = Geometry([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])
custom_preview = CustomPreview(Geometry=human_scale, Material=ColourSwatch(SwatchColor=RGB(217, 178, 178)))
custom_preview_2 = CustomPreview(Geometry=working_space_rfl, Material=ColourSwatch(SwatchColor=RGBA(120, 98, 98, 216)))
number_slider = Slider(2, range=0..3)
list = ValueList({"Zero": 0, "One": 1, "Two": 2, "Three": 2² - 1}, selected="Zero")
item = ListItem(List=py3.timber_models, Index=list, Wrap=True)

# ----
# Process joinery
# (seems cannot orient elements only),
# maybe we can create timber model that is oriented already
toggle_2 = BooleanToggle(True)
py3_2 = Python3Script(models=item, process=toggle_2)  # -> out, models; inputs models: list, process: Boolean
# ---------- py3_2: Python ----------
import os, sys, importlib

gh_dir = os.path.dirname(ghenv.Component.OnPingDocument().FilePath)

parent = os.path.dirname(gh_dir)              # go up one level
src_dir = os.path.join(parent, "src")         # go into src folder
if src_dir not in sys.path:
    sys.path.insert(0, src_dir)


import timber_config
importlib.reload(timber_config)

import timber_model
importlib.reload(timber_model)
from timber_model import apply_processings

from copy import deepcopy

models = deepcopy(models)


if process:
    for model in models:
        apply_processings(model)
# ---------- end py3_2 ----------

# ----
# Orient to station
toggle_3 = BooleanToggle(True)
pt = Point(Point(14.01828384, 9.600147889, 0.2339343578))
py3_3 = Python3Script(models=py3_2.models, target_pt=pt, orient=toggle_3)  # -> out, models, pts; inputs models: list, target_pt: Point3d, orient: Boolean
# ---------- py3_3: Python ----------
import os, sys, importlib
from copy import deepcopy

gh_dir = os.path.dirname(ghenv.Component.OnPingDocument().FilePath)
if gh_dir not in sys.path:
    sys.path.insert(0, gh_dir)

### -----------------------------
## IMPORT
### -----------------------------
import assembly_sequence
import assembly_config
import assembly_sequence_oop

importlib.reload(assembly_sequence)
importlib.reload(assembly_config)
importlib.reload(assembly_sequence_oop)

from assembly_sequence import sort_beams_by_joint_location, sort_beams_by_attributes, visualize_sorted_beams
from assembly_sequence_oop import AssemblySolver
from compas.geometry import Transformation, Frame
from copy import deepcopy
from Grasshopper import DataTree
from Grasshopper.Kernel.Data import GH_Path

# models = deepcopy(models)

### -----------------------------
## MAIN API
### -----------------------------

# 1. Initialize pipeline with the target station frame parameter
pipeline = AssemblySolver(*models)

# Robot station location
if orient:
    to_frame = Frame(list(target_pt), [1, 0, 0], [0, 1, 0])
    pipeline.orient_to_station(to_frame)
else:
    to_frame = None
# ---------- end py3_3 ----------

showjointtypes = CTShowJointTypes(model=py3_3.models)
#   port model: Model object.
# ---------- showjointtypes: Python ----------
"""Shows the names of the defined Joints."""
# env: C:\Users\nadja\Documents\GITHUB\timber_design\src
# r: compas_timber>=0.16.2
# flake8: noqa
import Grasshopper
import System
from compas_rhino.conversions import point_to_rhino

from compas_timber.utils import intersection_line_line_param
from timber_design.ghpython.ghcomponent_helpers import item_input_valid_cpython


class ShowJointTypes(Grasshopper.Kernel.GH_ScriptInstance):
    def RunScript(self, model):
        self.pt = []
        self.txt = []

        if not item_input_valid_cpython(ghenv, model, "model"):
            return

        for joint in model.joints:
            line_a, line_b = joint.elements[0].centerline, joint.elements[1].centerline
            [p1, _], [p2, _] = intersection_line_line_param(line_a, line_b, float("inf"), False, 1e-3)
            p1 = point_to_rhino(p1)
            p2 = point_to_rhino(p2)

            self.pt.append((p2 + p1) / 2)
            self.txt.append(joint.__class__.__name__)

    def DrawViewportWires(self, arg):
        if ghenv.Component.Locked:
            return
        col = System.Drawing.Color.FromArgb(255, 0, 0, 0)
        # https://developer.rhino3d.com/api/RhinoCommon/html/M_Rhino_Display_DisplayPipeline_Draw2dText_5.htm
        for p, t in zip(self.pt, self.txt):
            arg.Display.Draw2dText(t, col, p, True, 12, "Verdana")
# ---------- end showjointtypes ----------
draw = COMPASDraw(cg=py3_3.pts)  # -> flatten(rg)
#   port cg: The COMPAS geometry or datastructure to be drawn.
#   port rg: The Rhino geometry object.
# ---------- draw: Python ----------
# r: compas>=2.14.1
"""
Draws COMPAS geometry in Grasshopper.
"""

from typing import Any

import Grasshopper

from compas.scene import SceneObject


class CompasToRhinoGeometry(Grasshopper.Kernel.GH_ScriptInstance):
    def RunScript(self, cg):
        if not cg:
            return None

        return SceneObject(item=cg).draw()
# ---------- end draw ----------
python_3_script = Python3Script(models=py3_3.models, step=Slider(71, range=0..100))  # -> out, flatten(geometry), colors, insertion_vectors, grasp_frames, target_beam, models; inputs step: Int32
# ---------- python_3_script: Python ----------
import os, sys, importlib
from copy import deepcopy

gh_dir = os.path.dirname(ghenv.Component.OnPingDocument().FilePath)
if gh_dir not in sys.path:
    sys.path.insert(0, gh_dir)

### -----------------------------
## IMPORT
### -----------------------------
import assembly_sequence
import assembly_config
import assembly_sequence_oop

importlib.reload(assembly_sequence)
importlib.reload(assembly_config)
importlib.reload(assembly_sequence_oop)

from assembly_sequence import sort_beams_by_joint_location, sort_beams_by_attributes, visualize_sorted_beams
from assembly_sequence_oop import AssemblySolver
from compas.geometry import Transformation, Frame, Vector
from copy import deepcopy
from Grasshopper import DataTree
from Grasshopper.Kernel.Data import GH_Path

# models = deepcopy(models)

### -----------------------------
## MAIN API
### -----------------------------

# 1. Initialize pipeline with the target station frame parameter
pipeline = AssemblySolver(models)

# 2. Fire the lifecycle runner
sorted_beams, grasp_frames = pipeline.run_pipeline()

# 3. Stream outputs to the canvas pins
sorted_points = [beam.frame.point for beam in sorted_beams]

### -----------------------------
## OUTPUT DATA
### -----------------------------
models = models
geometry = DataTree[object]()
colors = DataTree[object]()

for i, beam in enumerate(sorted_beams[:step]):
    path = GH_Path(i)
    geometry.Add(beam.geometry, path)
    colors.Add(beam.attributes["color"])

for plate in models.plates:
    geometry.Add(plate.geometry)
    colors.Add(plate.attributes["color"])

models = models

insertion_vectors = []
for beam in sorted_beams:
    if beam.attributes["assembly_method"] == "robot":
        vec = beam.attributes['insertion_plane']
        # print(type(vec))
        # xaxis = vec.cross(vec)
        # yaxis = xaxis.cross(vec)
        # pt = beam.centerline.midpoint
        # vec_location = Frame(pt)
        # print(vec_location)
        insertion_vectors.append(beam.attributes['insertion_plane'])
s = "M0L1_55"
target_beam = [beam.geometry for beam in models.beams if beam.name == "M0L1_58"]
### -----------------------------
## PRINT
### -----------------------------
# print(atrr_rank)
# for beam in models.beams:
#     print(beam.attributes.keys())
# print(sorted_beams)
# ---------- end python_3_script ----------
compas_draw = COMPASDraw(cg=python_3_script.target_beam)  # -> rg; same code as draw
compas_draw_2 = COMPASDraw(cg=python_3_script.geometry)  # -> rg; same code as draw
compas_draw_3 = COMPASDraw(cg=python_3_script.insertion_vectors)  # -> simplify(rg); same code as draw
compas_draw_4 = COMPASDraw(cg=python_3_script.grasp_frames)  # -> rg; same code as draw
wires = BrepWireframe(Brep=compas_draw_2, Density=-1)
preview = CustomPreview(Geometry=compas_draw_2, Material=python_3_script.colors)
previewlw = CustomPreviewLineweights(Geometry=wires, Shader=ColourSwatch(SwatchColor=RGB(0, 0, 0)), Absolute=False)

# ----
# Preview Plane
cluster = Cluster(L=compas_draw_3)

# ----
# Orient to station
toggle_4 = BooleanToggle(False)
pt_2 = Point(Point(14.01828384, 9.600147889, 0.2339343578))
py3_4 = Python3Script(models=py3_2.models, target_pt=pt_2, orient=toggle_4)  # -> out, models, pts; inputs models: list, target_pt: Point3d, orient: Boolean
# ---------- py3_4: Python ----------
import os, sys, importlib
from copy import deepcopy

gh_dir = os.path.dirname(ghenv.Component.OnPingDocument().FilePath)
if gh_dir not in sys.path:
    sys.path.insert(0, gh_dir)

### -----------------------------
## IMPORT
### -----------------------------
import assembly_sequence

importlib.reload(assembly_sequence)

from assembly_sequence import orient_to_station, sort_beams_by_joint_location

from Grasshopper import DataTree
from Grasshopper.Kernel.Data import GH_Path
from compas.geometry import Transformation, Frame
from copy import deepcopy

# models = deepcopy(models)


# Robot station location
to_frame = Frame(list(target_pt), [1, 0, 0], [0, 1, 0])

### -----------------------------
## MAIN API
### -----------------------------

if orient:
    for model in models:
        print(model.attributes)
        orient_to_station(model, to_frame)

    _, _, pts = sort_beams_by_joint_location(model)
# ---------- end py3_4 ----------

# ----
# Preview
number_slider_2 = Slider(255, range=0..255)
python_3_script_2 = Python3Script(models=py3_4.models, alpha=number_slider_2)  # -> out, geos, colors, cut_planes, models; inputs models: list, alpha: Int32
# ---------- python_3_script_2: Python ----------
import rhinoscriptsyntax as rs
import scriptcontext as sc
import Rhino.Display as rd
import System.Drawing as sd

from compas.scene import Scene
from compas.geometry import Line, Point
from copy import deepcopy


COLORS = {
    "primary":      sd.Color.FromArgb(alpha, 220,  50,  50),
    "main_primary": sd.Color.FromArgb(alpha, 150,  80, 220),
    "secondary":    sd.Color.FromArgb(alpha,  50, 150, 220),
    "tertiary":     sd.Color.FromArgb(alpha,  80, 200, 100),
    "shoe":         sd.Color.FromArgb(alpha,  20, 150, 100),
    "plate":        sd.Color.FromArgb(alpha, 100, 100, 100)
}


geos = []
colors = []
cut_planes = []

for model in models:
    for plate in model.plates:
        pass
        geos.append(plate.geometry)
        colors.append(COLORS['plate'])

    for beam in model.beams:
        # if beam.attributes['hierarchy'] != 'shoe':
        #     continue
        hie = beam.attributes.get('hierarchy')

        geos.append(beam.geometry)
        colors.append(COLORS[hie])

    cut_planes.append(model.attributes['cut_plane'])
# ---------- end python_3_script_2 ----------
compas_draw_5 = COMPASDraw(cg=python_3_script_2.geos)  # -> rg; same code as draw
# THINGS TO DO: - insersion vector for recripocal
# - insersion vector for level 0 : easier with z
# - middle joint, lap easier from the outside than inside
compas_draw_6 = COMPASDraw(cg=python_3_script_2.cut_planes)  # -> rg; same code as draw
preview_2 = CustomPreview(Geometry=compas_draw_5, Material=python_3_script_2.colors)
wires_2 = BrepWireframe(Brep=compas_draw_5, Density=-1)
previewlw_2 = CustomPreviewLineweights(Geometry=wires_2, Shader=ColourSwatch(SwatchColor=RGB(0, 0, 0)), Absolute=False)

draw_2 = COMPASDraw(cg=py3_4.pts)  # -> flatten(rg); same code as draw
showjointtypes_2 = CTShowJointTypes(model=py3_4.models)  # same code as showjointtypes

# ----
# Assembly Sequence
number_slider_3 = Slider(100, range=0..100)
python_3_script_3 = Python3Script(models=py3_4.models, step=number_slider_3)  # -> out, geometry, colors, a_dir, all_bemas; inputs step: Int32
# ---------- python_3_script_3: Python ----------
import os, sys, importlib
from copy import deepcopy

gh_dir = os.path.dirname(ghenv.Component.OnPingDocument().FilePath)
if gh_dir not in sys.path:
    sys.path.insert(0, gh_dir)

### -----------------------------
## IMPORT
### -----------------------------
import assembly_sequence
import assembly_config

importlib.reload(assembly_sequence)
importlib.reload(assembly_config)

from assembly_sequence import sort_beams_by_joint_location, sort_beams_by_attributes, visualize_sorted_beams
from copy import deepcopy
from Grasshopper import DataTree
from Grasshopper.Kernel.Data import GH_Path

# models = deepcopy(models)

### -----------------------------
## MAIN API
### -----------------------------

# Sort geometry
sorted_joints = sort_beams_by_joint_location(models)
atrr_rank = sort_beams_by_attributes(models)

# Visualize geometry with colors himan/robot assembly
geometry, colors = visualize_sorted_beams(models, step=step)


### -----------------------------
## OUTPUT DATA
### -----------------------------

# beams_tree = DataTree[object]()
# for i, beams in enumerate(atrr_rank):
#     path = GH_Path(i)
#     beams_tree.Add(beams.geometry, path)


### -----------------------------
## PRINT
### -----------------------------
print(atrr_rank)
# print(beams_tree)
# print(beams_tree)



# from copy import deepcopy

# models = deepcopy(models)

# from compas_timber.fabrication import Lap



# joints_list = list(models.joints)
# sorted_joints = sorted(joints_list, key=lambda j: (j.location.x, j.location.y, j.location.z))
# sorted_points = [joint.location for joint in sorted_joints]

# joint_rank = {joint: idx for idx, joint in enumerate(sorted_joints)}


# unvisited = {(i, beam): beam for i, beam in enumerate(models.beams)}
# sorting_data = []

# for joint in sorted_joints:
#     for (i, beam) in list(unvisited):
#         if beam not in joint.elements:
#             continue

#         level = beam.attributes.get("level")
#         edge = beam.attributes.get("edge")
#         edge_a = edge[0]
#         # print(edge_a)


#         if level == 0:
#             hierarchy_rank = {"shoe": 0, "tertiary": 2, "secondary": 4, "primary": 4, "main_primary": 4}
#             start_priority = beam.centerline.start.z

#         elif level == 1:
#             hierarchy_rank = {"shoe": 0, "tertiary": 4, "secondary": 2, "primary": 3, "main_primary": 3}
#             start_priority = 9999
#         else: 
#             hierarchy_rank = {"shoe": 0, "tertiary": 2, "secondary": 2, "primary": 4, "main_primary": 4}
#             start_priority = 9999

#         hierarchy = beam.attributes.get("hierarchy", "")
#         shoe_priority = 0 if hierarchy == "shoe" else 1
#         if beam.attributes.get("has_middle_joint") and level == 1:
#             mid_priority = 1 
#         else: 
#             mid_priority = 0

#         print(start_priority)
        
#         joint_idx = joint_rank[joint]
#         hierarchy_idx = hierarchy_rank.get(hierarchy)
#         mid_point = beam.centerline.midpoint
   

#         sorting_data.append((
#                             shoe_priority,
#                             level,
#                             mid_priority,
#                             hierarchy_idx,
#                             edge_a,
#                             start_priority,
#                             mid_point.z,
#                             joint_idx,
#                             i,
#                             beam,
#                             joint,
#                         ))
        

# for i,data in enumerate(sorting_data):
#     print(data[0], data[1],data[2], data[3])
# sorting_data.sort()
# for i,data in enumerate(sorting_data):
#     print("sorted", data[0], data[1],data[2],data[3])



# beams = models.beams
# sorted_beams = []
# # for x, (*_, i, beam, joint) in enumerate(sorting_data):
# #     if (i, beam) in unvisited:
# #         beams[i].attributes["sequence_id"] = x
# #         sorted_beams.append(beam.geometry)
# #         #print(i, joint.name, joint.location)
# #         del unvisited[(i, beam)]

# local_seq_idx = 0

# for data in sorting_data:
#     *_, i, beam, joint = data

#     if (i, beam) in unvisited:
#         beams[i].attributes["sequence_id"] = local_seq_idx

#         sorted_beams.append(beam.geometry)

#         local_seq_idx += 1

#         del unvisited[(i, beam)]


    
# final_model = models
# ---------- end python_3_script_3 ----------
draw_3 = COMPASDraw(cg=python_3_script_3.a_dir)  # -> rg; same code as draw
draw_4 = COMPASDraw(cg=python_3_script_3.all_bemas)  # -> flatten(rg); same code as draw

python_3_script_4 = Python3Script(models=py3_4.models, step=number_slider_3)  # -> out, geometry, colors, a_dir, all_bemas, models; inputs step: Int32
# ---------- python_3_script_4: Python ----------
import os, sys, importlib
from copy import deepcopy

gh_dir = os.path.dirname(ghenv.Component.OnPingDocument().FilePath)
if gh_dir not in sys.path:
    sys.path.insert(0, gh_dir)

### -----------------------------
## IMPORT
### -----------------------------
import assembly_sequence
import assembly_config

importlib.reload(assembly_sequence)
importlib.reload(assembly_config)

from assembly_sequence import sort_beams_by_joint_location, sort_beams_by_attributes, visualize_sorted_beams
from copy import deepcopy
from Grasshopper import DataTree
from Grasshopper.Kernel.Data import GH_Path

# models = deepcopy(models)

### -----------------------------
## MAIN API
### -----------------------------

# Sort geometry
sorted_joints = sort_beams_by_joint_location(models)
atrr_rank = sort_beams_by_attributes(models)

# Visualize geometry with colors himan/robot assembly
geometry, colors = visualize_sorted_beams(models, step=step)


### -----------------------------
## OUTPUT DATA
### -----------------------------

models = models
# beams_tree = DataTree[object]()
# for i, beams in enumerate(atrr_rank):
#     path = GH_Path(i)
#     beams_tree.Add(beams.geometry, path)


### -----------------------------
## PRINT
### -----------------------------
# print(atrr_rank)
for beam in models.beams:
    print(beam.attributes.keys())
# print(beams_tree)
# print(beams_tree)



# from copy import deepcopy

# models = deepcopy(models)

# from compas_timber.fabrication import Lap



# joints_list = list(models.joints)
# sorted_joints = sorted(joints_list, key=lambda j: (j.location.x, j.location.y, j.location.z))
# sorted_points = [joint.location for joint in sorted_joints]

# joint_rank = {joint: idx for idx, joint in enumerate(sorted_joints)}


# unvisited = {(i, beam): beam for i, beam in enumerate(models.beams)}
# sorting_data = []

# for joint in sorted_joints:
#     for (i, beam) in list(unvisited):
#         if beam not in joint.elements:
#             continue

#         level = beam.attributes.get("level")
#         edge = beam.attributes.get("edge")
#         edge_a = edge[0]
#         # print(edge_a)


#         if level == 0:
#             hierarchy_rank = {"shoe": 0, "tertiary": 2, "secondary": 4, "primary": 4, "main_primary": 4}
#             start_priority = beam.centerline.start.z

#         elif level == 1:
#             hierarchy_rank = {"shoe": 0, "tertiary": 4, "secondary": 2, "primary": 3, "main_primary": 3}
#             start_priority = 9999
#         else: 
#             hierarchy_rank = {"shoe": 0, "tertiary": 2, "secondary": 2, "primary": 4, "main_primary": 4}
#             start_priority = 9999

#         hierarchy = beam.attributes.get("hierarchy", "")
#         shoe_priority = 0 if hierarchy == "shoe" else 1
#         if beam.attributes.get("has_middle_joint") and level == 1:
#             mid_priority = 1 
#         else: 
#             mid_priority = 0

#         print(start_priority)
        
#         joint_idx = joint_rank[joint]
#         hierarchy_idx = hierarchy_rank.get(hierarchy)
#         mid_point = beam.centerline.midpoint
   

#         sorting_data.append((
#                             shoe_priority,
#                             level,
#                             mid_priority,
#                             hierarchy_idx,
#                             edge_a,
#                             start_priority,
#                             mid_point.z,
#                             joint_idx,
#                             i,
#                             beam,
#                             joint,
#                         ))
        

# for i,data in enumerate(sorting_data):
#     print(data[0], data[1],data[2], data[3])
# sorting_data.sort()
# for i,data in enumerate(sorting_data):
#     print("sorted", data[0], data[1],data[2],data[3])



# beams = models.beams
# sorted_beams = []
# # for x, (*_, i, beam, joint) in enumerate(sorting_data):
# #     if (i, beam) in unvisited:
# #         beams[i].attributes["sequence_id"] = x
# #         sorted_beams.append(beam.geometry)
# #         #print(i, joint.name, joint.location)
# #         del unvisited[(i, beam)]

# local_seq_idx = 0

# for data in sorting_data:
#     *_, i, beam, joint = data

#     if (i, beam) in unvisited:
#         beams[i].attributes["sequence_id"] = local_seq_idx

#         sorted_beams.append(beam.geometry)

#         local_seq_idx += 1

#         del unvisited[(i, beam)]


    
# final_model = models
# ---------- end python_3_script_4 ----------
wires_3 = BrepWireframe(Brep=draw_4, Density=-1)
preview_3 = CustomPreview(
    Geometry=draw_4,
    Material={diffuse=RGB(221, 160, 221), emission=RGB(66, 48, 66), shine=0.5, specular=RGB(255, 255, 255), transparency=0})
item_2 = ListItem(List=draw_4, Index=Slider(24, range=0..100), Wrap=True)
compas_draw_7 = COMPASDraw(cg=python_3_script_3.geometry)  # -> rg; same code as draw
wires_4 = BrepWireframe(Brep=compas_draw_7, Density=-1)
preview_4 = CustomPreview(Geometry=compas_draw_7, Material=python_3_script_3.colors)
previewlw_3 = CustomPreviewLineweights(Geometry=wires_3, Shader=ColourSwatch(SwatchColor=RGB(0, 0, 0)), Absolute=False)
previewlw_4 = CustomPreviewLineweights(Geometry=wires_4, Shader=ColourSwatch(SwatchColor=RGB(255, 255, 255)), Absolute=False)
python_3_script_5 = Python3Script(models=python_3_script_4.models, step=number_slider_3)  # -> out, geometry, joint_location, joint_name, joint_features_planes, beam_insertion_vec, beam_center, insertion_planes, grasp_frame, models; inputs step: Int32
# ---------- python_3_script_5: Python ----------
import os, sys, importlib
from copy import deepcopy

gh_dir = os.path.dirname(ghenv.Component.OnPingDocument().FilePath)
if gh_dir not in sys.path:
    sys.path.insert(0, gh_dir)

### -----------------------------
## IMPORT
### -----------------------------
import assembly_sequence
import assembly_config

importlib.reload(assembly_sequence)
importlib.reload(assembly_config)

from assembly_sequence import beam_insertion_plane, beam_grasp_frame
from copy import deepcopy
from Grasshopper import DataTree
from Grasshopper.Kernel.Data import GH_Path

# models = deepcopy(models)

### -----------------------------
## MAIN API
### -----------------------------
beams_by_robot, main_data, insertion_plane, model = beam_insertion_plane(models, debug=True)
model, grasp_frame = beam_grasp_frame(model)

### -----------------------------
## OUTPUT DATA
### -----------------------------
geometry = [beam.geometry for beam in beams_by_robot]
geo_midpoint = [beam.centerline.midpoint for beam in beams_by_robot]

joint_location = DataTree[object]()
joint_features_planes = DataTree[object]()
joint_name = DataTree[object]()

for i, joints_list in enumerate(main_data.values()):
    path = GH_Path(i)  # Path {0} will represent Beam 1
    
    # This loops TWICE for Beam 1 (once for Joint A, once for Joint B)
    for s, joint_data in enumerate(joints_list):
        # path = GH_Path(s)
        
        # Now we pull data safely from ONE joint at a time
        j_loc    = joint_data[0] # Single point location
        j_name   = joint_data[1] # "TMultiStepJoint"
        j_feats  = joint_data[2] # List of fabrication features
        j_planes = joint_data[3] # Nested list of planes
        
        # Send them to your Grasshopper Data Trees
        joint_location.Add(j_loc, path)
        joint_name.Add(j_name, path)
        planes_by_joint = [p for all_planes in j_planes for p in all_planes]
        joint_features_planes.Add(j_planes, path)
        # print(j_planes)
        # # Flatten and add features
        # for feat in j_feats:
        #     joint_features.Add(feat, path)
            
        # Flatten and add the nested planes
        # for plane_sublist in j_planes:
            
        #     for p in plane_sublist:
                
        #         joint_features_planes.Add(s, path)
insertion_planes = DataTree[object]()
for i, p in enumerate(insertion_plane.values()):
    path = GH_Path(i)
    insertion_planes.Add(p, path)

beam_insertion_vec = [beam.attributes["insertion_vector"] for beam in beams_by_robot]
beam_center = [beam.centerline.midpoint for beam in beams_by_robot]

### -----------------------------
## PRINT
### -----------------------------
# print(*data.values())
for beam in model.beams:
    print(beam.attributes.keys())
# print(all_features)
# print(all_features_planes)
# ---------- end python_3_script_5 ----------
item_3 = ListItem(List=python_3_script_5.joint_features_planes, Index=0, Wrap=True)  # -> Item, Item1
draw_5 = COMPASDraw(cg=python_3_script_5.grasp_frame)  # -> rg; same code as draw
draw_6 = COMPASDraw(cg=python_3_script_5.geometry)  # -> rg; same code as draw
draw_7 = COMPASDraw(cg=python_3_script_5.joint_location)  # -> rg; same code as draw
draw_8 = COMPASDraw(cg=python_3_script_5.beam_insertion_vec)  # -> rg; same code as draw
draw_9 = COMPASDraw(cg=python_3_script_5.insertion_planes)  # -> rg; same code as draw
draw_10 = COMPASDraw(cg=python_3_script_5.beam_center)  # -> rg; same code as draw
draw_11 = COMPASDraw(cg=item_3.Item)  # -> rg; same code as draw
draw_12 = COMPASDraw(cg=item_3.Item1)  # -> rg; same code as draw
tag = TextTag(Location=draw_7, Text=python_3_script_5.joint_name)
item_4 = ListItem(List=draw_11, Index=0, Wrap=True)  # -> flatten(Item)
item_5 = ListItem(List=draw_12, Index=0, Wrap=True)  # -> flatten(Item)
item_6 = ListItem(List=draw_8, Index=0, Wrap=True)  # -> flatten(Item)
end = EndPoints(Curve=item_5)  # -> Start, End
end_2 = EndPoints(Curve=item_6)  # -> Start, End
end_3 = EndPoints(Curve=item_4)  # -> Start, End
amp = Amplitude(Vector=item_4, Amplitude=0.2)
amp_2 = Amplitude(Vector=item_5, Amplitude=0.2)
amp_3 = Amplitude(Vector=item_6, Amplitude=0.2)
vdisex = VectorDisplayEx(Point=end_3.Start, Vector=flatten(amp), Colour=RGB(0, 0, 0), Width=2)
vdisex_2 = VectorDisplayEx(Point=end.Start, Vector=flatten(amp_2), Colour=RGB(0, 0, 0), Width=2)
vdisex_3 = VectorDisplayEx(Point=draw_10, Vector=flatten(amp_3), Colour=ColourSwatch(SwatchColor=RGB(0, 166, 255)), Width=2)

# ==== cluster Cluster
L = ClusterInput()
item = ListItem(List=L, Index=0, Wrap=True)
end = EndPoints(Curve=item)  # -> Start, End
amp = Amplitude(Vector=item, Amplitude=0.5)
vdisex = VectorDisplayEx(Point=end.Start, Vector=amp, Colour=ColourSwatch(SwatchColor=RGB(0, 255, 238)), Width="5")
