# Grasshopper definition inputgraph_modularization_v2.gh (Grasshopper 1.0.8)

# import graph (line model)
py3 = Python3Script()  # -> out, line_model
# ---------- py3: Python ----------
from compas.data import json_load

import os, sys, importlib

gh_dir = os.path.dirname(ghenv.Component.OnPingDocument().FilePath)
gh_par = os.path.dirname(gh_dir)
file_path = os.path.join(gh_par, "line_model","data", "0806_shifted_lines.json")
print(file_path)

line_model = json_load(file_path)
# ---------- end py3 ----------
panel = Panel(py3.line_model)

# ----
# lines for compas_timber from graph
py3_2 = Python3Script(graph=py3.line_model)  # -> out, a, b, c, d
# ---------- py3_2: Python ----------
from compas.geometry import Line, Point
from copy import deepcopy

ng = deepcopy(graph)

primary_shifted = []
main_primary_shifted = []
secondary_shifted = []
tertiary_shifted = []

for e in ng.edges():
    h = ng.edge_attribute(e, "hierarchy")      # classification
    ln = ng.edge_attribute(e, "shifted_line")  # shifted geometry
    if ln is None:
        continue

    if h == "primary":
        primary_shifted.append(ln)
    elif h == "main_primary":
        primary_shifted.append(ln)
    elif h == "secondary":
        secondary_shifted.append(ln)
    elif h == "tertiary":
        tertiary_shifted.append(ln)

a = primary_shifted
b = secondary_shifted
c = tertiary_shifted
# ---------- end py3_2 ----------
draw = COMPASDraw(cg=py3_2.b)  # -> rg
#   port cg: The COMPAS geometry or datastructure to be drawn.
#   port rg: The Rhino geometry object.
# ---------- draw: Python ----------
# r: compas>=2.14.1
"""
Draws COMPAS geometry in Grasshopper.
"""

from typing import Any

import Grasshopper

from compas.scene import SceneObject


class CompasToRhinoGeometry(Grasshopper.Kernel.GH_ScriptInstance):
    def RunScript(self, cg):
        if not cg:
            return None

        return SceneObject(item=cg).draw()
# ---------- end draw ----------
draw_2 = COMPASDraw(cg=py3_2.a)  # -> rg; same code as draw
draw_3 = COMPASDraw(cg=py3_2.c)  # -> rg; same code as draw

draw_4 = COMPASDraw(cg=py3_2.d)  # -> rg; same code as draw

# ---- group: generate TimberModel
python_3_script = Python3Script(
    graph_in=py3.line_model,
    beam_width=Slider(0.1, range=0..0.1),
    beam_height=Slider(0.12, range=0..1),
    plate_thickness=Slider(0.06, range=0..0.1))  # -> out, final_models, module_beams, module_plates, shifted_lines, beam_attributes_text; inputs plate_polylines: tree of Polyline, beam_width: Double, beam_height: Double, plate_thickness: Double
# ---------- python_3_script: Python ----------
from compas_timber.model import TimberModel
from compas_timber.elements import Beam, Plate
from compas.tolerance import Tolerance
from compas.geometry import Line, Vector, Polyline, Point
from compas.geometry import is_point_in_polygon_xy
from compas_rhino.conversions import polyline_to_compas

# ============================================================
# outputs
# ============================================================
final_models = []

module_beams = []
module_plates = []

shifted_lines = []
beam_attributes_text = []
plate_attributes_text = []

# ============================================================
# helper: flatten GH input
# ============================================================
def flatten_input(data):
    """Flatten normal lists, tuples, and GH DataTrees into a simple Python list."""
    items = []

    if data is None:
        return items

    # GH DataTree
    if hasattr(data, "Branches"):
        for branch in data.Branches:
            for item in branch:
                items.append(item)
        return items

    # Python list or tuple
    if isinstance(data, (list, tuple)):
        for item in data:
            if isinstance(item, (list, tuple)):
                items.extend(flatten_input(item))
            else:
                items.append(item)
        return items

    # single item
    items.append(data)
    return items


# ============================================================
# helper: convert clt_plate data to COMPAS Polyline
# ============================================================
def clt_plate_to_polyline(clt_plate):
    """
    Convert clt_plate from graph/json into COMPAS Polyline.
    Works for:
    - already-deserialized COMPAS Polyline
    - raw JSON dictionary with ["data"]["points"]
    - Rhino polyline
    """

    if clt_plate is None:
        return None

    # already COMPAS Polyline
    if hasattr(clt_plate, "points"):
        return clt_plate

    # raw JSON dictionary
    if isinstance(clt_plate, dict):
        data = clt_plate.get("data", {})
        points = data.get("points", None)

        if points:
            return Polyline(points)

    # Rhino polyline fallback
    try:
        return polyline_to_compas(clt_plate)
    except:
        return None


# ============================================================
# helper: convert shifted_line data to COMPAS Line
# ============================================================
def shifted_line_to_line(shifted_line):
    """
    Convert shifted_line from graph/json into COMPAS Line.
    Works for:
    - already-deserialized COMPAS Line
    - raw JSON dictionary with ["data"]["start"] and ["data"]["end"]
    """

    if shifted_line is None:
        return None

    # already COMPAS Line
    if isinstance(shifted_line, Line):
        return shifted_line

    # raw JSON dictionary
    if isinstance(shifted_line, dict):
        data = shifted_line.get("data", {})
        start = data.get("start", None)
        end = data.get("end", None)

        if start and end:
            return Line(Point(*start), Point(*end))

    return None


# ============================================================
# 1. extract CLT plates from graph nodes
# ============================================================
module_polylines = []
module_polygon_points = []
module_plate_nodes = []

if graph_in:
    for node in graph_in.nodes():
        clt_plate = graph_in.node_attribute(node, "clt_plate")

        if clt_plate is None:
            continue

        compas_poly = clt_plate_to_polyline(clt_plate)

        if compas_poly is None:
            continue

        pts = list(compas_poly.points)

        if len(pts) < 3:
            continue

        # remove duplicated last point if closed
        if pts[0] == pts[-1]:
            pts = pts[:-1]

        module_polylines.append(compas_poly)
        module_polygon_points.append(pts)
        module_plate_nodes.append(node)


# ============================================================
# 2. create one TimberModel per CLT plate polyline
# ============================================================
for module_index, compas_poly in enumerate(module_polylines):

    module_model = TimberModel(Tolerance(unit="M", absolute="0.001"))

    plate = Plate.from_outline_thickness(compas_poly,plate_thickness,Vector(0, 0, 1))

    plate.name = "clt_plate"

    plate.attributes["module_index"] = module_index
    plate.attributes["node"] = module_plate_nodes[module_index]

    module_model.add_element(plate)

    final_models.append(module_model)
    module_beams.append([])
    module_plates.append([plate])

    plate_attributes_text.append(
        "plate name: {} | module_index: {} | node: {}".format(
            plate.name,
            plate.attributes.get("module_index"),
            plate.attributes.get("node")
        )
    )


# ============================================================
# 3. sort beam graph lines into each TimberModel
# ============================================================
if graph_in:
    for edge in graph_in.edges():

        hierarchy = graph_in.edge_attribute(edge, "hierarchy")

        if hierarchy not in ["shoe", "primary", "main_primary", "secondary", "tertiary"]:
            continue

        line = graph_in.edge_attribute(edge, "shifted_line")
        line = shifted_line_to_line(line)

        if line is None:
            line = graph_in.edge_attribute(edge, "line")
            line = shifted_line_to_line(line)

        if line is None:
            continue

        center = line.midpoint

        for module_index, polygon_pts in enumerate(module_polygon_points):

            if is_point_in_polygon_xy(center, polygon_pts):

                edge_width = graph_in.edge_attribute(edge, "width")
                edge_height = graph_in.edge_attribute(edge, "height")

                if edge_width is None:
                    edge_width = beam_width

                if edge_height is None:
                    edge_height = beam_height

                beam = Beam.from_centerline(line,width=edge_width,height=edge_height)

                beam.name = hierarchy

                beam.attributes["edge"] = edge
                beam.attributes["module_index"] = module_index
                beam.attributes["hierarchy"] = hierarchy
                beam.attributes["width"] = edge_width
                beam.attributes["height"] = edge_height

                final_models[module_index].add_element(beam)
                module_beams[module_index].append(beam)
                shifted_lines.append(line)

                beam_attributes_text.append(
                    "beam name: {} | module_index: {} | edge: {} | width: {} | height: {}".format(
                        beam.name,
                        beam.attributes.get("module_index"),
                        beam.attributes.get("edge"),
                        beam.attributes.get("width"),
                        beam.attributes.get("height")
                    )
                )

                break
# ---------- end python_3_script ----------

# ----
python_3_script_2 = Python3Script(final_models=python_3_script.final_models, module_index=Slider(0, range=0..3), show_all=Toggle(False))  # -> out, geometry, element_colors; inputs final_models: list, module_index: Int32
# ---------- python_3_script_2: Python ----------
from System.Drawing import Color

# ============================================================
# outputs
# ============================================================
geometry = []

beam_geometry = []
plate_geometry = []

element_text = []
element_points = []
element_colors = []

selected_model = None


# ============================================================
# defaults
# ============================================================
if show_all is None:
    show_all = False

if module_index is None:
    module_index = 0


# ============================================================
# colors per module index
# ============================================================
module_colors = [
    Color.FromArgb(230, 80, 80),     # module 0 - red
    Color.FromArgb(80, 160, 230),    # module 1 - blue
    Color.FromArgb(90, 200, 120),    # module 2 - green
    Color.FromArgb(240, 180, 70)     # module 3 - orange
]


# ============================================================
# helper
# ============================================================
def get_module_color(index):
    return module_colors[index % len(module_colors)]


# ============================================================
# choose which modules to show
# ============================================================
module_ids_to_show = []

if final_models:

    if show_all:
        module_ids_to_show = list(range(len(final_models)))

    else:
        if 0 <= module_index < len(final_models):
            module_ids_to_show = [module_index]
            selected_model = final_models[module_index]


# ============================================================
# collect geometry by module index
# ============================================================
for m_id in module_ids_to_show:

    module_model = final_models[m_id]
    module_color = get_module_color(m_id)

    # ------------------------------------------------------------
    # plates
    # ------------------------------------------------------------
    for plate in module_model.plates:

        try:
            geo = plate.geometry

            geometry.append(geo)
            plate_geometry.append(geo)

            # same colour as beams in this module
            element_colors.append(module_color)

            element_text.append("module {} | plate".format(m_id))
            element_points.append(plate.frame.point)

        except Exception as e:
            print("Plate error in module {}: {}".format(m_id, e))

    # ------------------------------------------------------------
    # beams
    # ------------------------------------------------------------
    for beam in module_model.beams:
        try:
            geo = beam.geometry

            geometry.append(geo)
            beam_geometry.append(geo)

            # same colour as plate in this module
            element_colors.append(module_color)

            name = beam.name
            if name is None:
                name = "beam"

            element_text.append(
                "module {} | {} | length = {:.2f} m".format(m_id,name,beam.length))

            element_points.append(beam.centerline.midpoint)

        except Exception as e:
            print("Beam error in module {}: {}".format(m_id, e))
# ---------- end python_3_script_2 ----------
# TimberModel
panel_2 = Panel(python_3_script.final_models)
draw_5 = COMPASDraw(cg=python_3_script_2.geometry)  # -> rg; same code as draw
# CLT 2.4 or 3 m
# length 10 or 12 m
custom_preview = CustomPreview(Geometry=draw_5, Material=python_3_script_2.element_colors)

# ---- group: module height
group = Group(Geometry=draw_5)
bounding_box = BoundingBox(Content=group, Plane=PlaneXY(0, 0, 0))  # -> Box, Box_2
box_corners = BoxCorners(Box=bounding_box.Box)  # -> CornerA, CornerB, CornerC, CornerD, CornerE, CornerF, CornerG, CornerH
line = Line(StartPoint=box_corners.CornerB, EndPoint=box_corners.CornerF)
line_2 = Line(StartPoint=box_corners.CornerA, EndPoint=box_corners.CornerB)
line_3 = Line(StartPoint=box_corners.CornerA, EndPoint=box_corners.CornerD)
linear_dimension = LinearDimension(Line=line, PointA=box_corners.CornerA, PointB=box_corners.CornerE, Text="{0:0.000}", Size="0.5")
linear_dimension_2 = LinearDimension(Line=line_2, PointA=box_corners.CornerA, PointB=box_corners.CornerB, Text="{0:0.000}", Size="0.5")
linear_dimension_3 = LinearDimension(Line=line_3, PointA=box_corners.CornerA, PointB=box_corners.CornerD, Text="{0:0.000}", Size="0.5")

# ----
panel_3 = Panel(python_3_script.beam_attributes_text)

# ---- group: informations
python_3_script_3 = Python3Script(final_models=python_3_script.final_models)  # -> out, heavy_beams, long_beams_blank, long_beams_length, long_beams, beam_info_tree, total_beams_volume, total_beams_weight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; inputs final_models: list
# ---------- python_3_script_3: Python ----------
# ============================================================
## volume each modules ###
# ============================================================
density = 470

total_beams_volume = []
total_beams_weight = []
number_of_beams = []

total_plate_volume = []
total_plate_weight = []
number_of_plates = []
plate_area = []

for module_model in final_models:
    total_volume_beam = 0.0
    total_weight_beam = 0.0
    
    total_volume_plate = 0.0
    total_weight_plate = 0.0
    total_plate_area = 0.0

    beam_count = 0
    beams_vol = 0.0

    for beam in module_model.beams:
        
        if not beam.attributes.get("neighbour", False):

            beam_count += 1

            beam_vol = beam.geometry.volume
            beams_vol += beam_vol
            beam_weight = beam_vol * density

    for plate in module_model.plates:
        plate_vol = plate.geometry.volume
        plate_weight = plate_vol * density
        plate_ar = plate.width * plate.length

    total_beams_volume.append(beams_vol)
    total_beams_weight.append(beam_weight)

    total_plate_volume.append(plate_vol)
    total_plate_weight.append(plate_weight)

    number_of_beams.append(beam_count)
    number_of_plates.append(len(module_model.plates))

    plate_area.append(plate_ar)


# ============================================================
## each beam information ###
# ============================================================

from Grasshopper import DataTree
from Grasshopper.Kernel.Data import GH_Path

beam_info_tree = DataTree[object]()
long_beams_length = DataTree[object]()

all_lengths = []
all_weights = []

long_beams = []
long_beams_blank = []
heavy_beams = []

for i, module_model in enumerate(final_models):
    path = GH_Path(i)

    beam_info_tree.Add("module {}".format(i), path)

    for j, beam in enumerate(module_model.beams):
        length = beam.blank.dimensions[0]
        width = beam.blank.dimensions[1]
        height = beam.blank.dimensions[2]

        all_lengths.append(length)

        volume = beam.width * beam.height * beam.length
        weight = volume * density

        milled_volume = beam.geometry.volume
        milled_weight = milled_volume * density

        text = "beam {} | length = {:.3f} m | weight (milled) = {:.3f} kg | cross-section = {:.3f} x {:.3f} m".format(
            j, length, milled_weight, width, height
        )

        beam_info_tree.Add(text, path)

        # ============================================================
        # beams longer than 5 m
        # ============================================================
        if length > 5.0:
            long_beams.append(beam.geometry)
            long_beams_blank.append(beam.blank)

            text_length = "beam {} | length = {:.3f} m".format(j, length)
            long_beams_length.Add(text_length, path)

        # ============================================================
        # beams heavier than 45 kg
        # ============================================================
        if milled_weight > 45.0:
            heavy_beams.append(beam.geometry)
# ---------- end python_3_script_3 ----------

# ----
bounds = Bounds(Numbers=python_3_script_3.all_lengths)
draw_6 = COMPASDraw(cg=python_3_script_3.long_beams)  # -> rg; same code as draw

# ---- group: beam that are heavier than 45 kg
# overall information
draw_7 = COMPASDraw(cg=python_3_script_3.heavy_beams)  # -> rg; same code as draw
custom_preview_2 = CustomPreview(Geometry=draw_7, Material=ColourSwatch(SwatchColor=RGB(255, 0, 0)))

# ----
deconstruct_domain² = DeconstructDomain²(Domain=bounds)  # -> UComponent, VComponent
average = Average(Input=python_3_script_3.all_lengths)
custom_preview_3 = CustomPreview(Geometry=draw_6, Material=ColourSwatch(SwatchColor=RGB(0, 0, 150)))
# grasp_frames, sequence,
# assembly_method
number_slider = Slider(0, range=0..3)
beam_length_5_m = Panel(draw_6)
min_max_length = Panel(deconstruct_domain².UComponent)
beam_information = Panel(python_3_script_3.beam_info_tree)
total_beams_volume_m3 = Panel(python_3_script_3.total_beams_volume)
total_beams_weight_kg = Panel(python_3_script_3.total_beams_weight)
total_plates_volume_m3 = Panel(python_3_script_3.total_plate_volume)
total_plates_weight_kg = Panel(python_3_script_3.total_plate_weight)
number_of_beams = Panel(python_3_script_3.number_of_beams)
number_of_plates = Panel(python_3_script_3.number_of_plates)
plate_area_m2 = Panel(python_3_script_3.plate_area)
beam_length_m = Panel(python_3_script_3.all_lengths)
average_length = Panel(average)
list_length = ListLength(List=draw_7)
panel_4 = Panel(python_3_script_3.long_beams_length)
draw_8 = COMPASDraw(cg=python_3_script_3.long_beams_blank)  # -> rg; same code as draw

# ---- group: add attributes (frames)
python_3_script_4 = Python3Script(final_models=python_3_script.final_models, module_id=number_slider)  # -> out, geometry, v_beam_faces, rhino_beam_frames, final_models_with_attributes, beam_index_text, beam_index_points; inputs final_models: list, module_id: Int32
# ---------- python_3_script_4: Python ----------
from compas.geometry import Frame, Vector, Rotation, Transformation
import math
from compas_rhino.conversions import plane_to_compas_frame, frame_to_rhino_plane, point_to_rhino

geometry = []

rhino_beam_frames = []
v_beam_faces = []

beam_indices = []
beam_sequence = []
beam_sequence_text = []
beam_sequence_points = []

beam_index_text = []
beam_index_points = []

final_models_with_attributes = final_models

# ============================================================
# Auto sequence based on beam.name, Z, Y, X, then edge connectivity
# ============================================================
name_order = {
    "shoe": 0,
    "tertiary": 1,
    "secondary": 2,
    "main_primary" : 3,
    "primary": 4}

list_seq_auto = []

for module_model in final_models_with_attributes:
    # ------------------------------------------------------------
    # 1. prepare sortable beam data
    # ------------------------------------------------------------
    beam_data = []
    for i, beam in enumerate(module_model.beams):
        pt = beam.centerline.start
        name_rank = name_order[beam.name]

        edge = beam.attributes.get("edge")

        beam_data.append({
            "index": i,
            "beam": beam,
            "point": pt,
            "name_rank": name_rank,
            "edge": edge,
            "sort_key": (-pt.z, pt.y, pt.x, name_rank, i)
        })

    # sort first using your original rule
    beam_data.sort(key=lambda item: item["sort_key"])

    # ------------------------------------------------------------
    # 2. create unvisited beam list
    # ------------------------------------------------------------
    unvisited = list(beam_data)
    module_auto_sequence = []

    # ------------------------------------------------------------
    # 3. walk through connected edges
    # ------------------------------------------------------------
    while unvisited:
        # start from the highest-priority remaining beam
        current = unvisited.pop(0)
        module_auto_sequence.append(current["index"])

        current_edge = current["edge"]

        if current_edge is None:
            continue

        # choose one end as the current node
        # for edge (3, 7), this starts looking from node 7
        current_node = current_edge[1]

        while True:
            next_beam = None
            next_position = None

            # find the next unvisited beam connected to current_node
            for pos, candidate in enumerate(unvisited):
                candidate_edge = candidate["edge"]

                if candidate_edge is None:
                    continue

                if current_node in candidate_edge:
                    next_beam = candidate
                    next_position = pos
                    break

            # if no connected beam is found, stop this chain
            if next_beam is None:
                break

            # add next connected beam
            unvisited.pop(next_position)
            module_auto_sequence.append(next_beam["index"])

            # update current_node to the other end of the edge
            a, b = next_beam["edge"]
            if a == current_node:
                current_node = b
            else:
                current_node = a

    list_seq_auto.append(module_auto_sequence)

# ============================================================
# 1. Add grasp_frame, beam_index, sequence, and assembly_method to all modules
# ============================================================
for module_index, module_model in enumerate(final_models_with_attributes):
    if module_index < len(list_seq_auto):
        module_sequence = list_seq_auto[module_index]
    else:
        module_sequence = []

    for i, beam in enumerate(module_model.beams):
        beam.attributes["module_index"] = module_index
        beam.attributes["beam_index"] = i

        # ============================================================
        # Assembly method logic
        # ============================================================
        beam.attributes["assembly_method"] = None

        density = 470  # kg/m3

        beam_volume = beam.geometry.volume
        beam_weight = beam_volume * density
        beam_length = beam.blank_length

        beam.attributes["beam_weight"] = beam_weight
        beam.attributes["beam_length"] = beam_length

        # define limits
        robot_weight_limit = 45.0
        human_weight_limit = 10.0
        special_length_limit = 5.0

        # decide assembly method
        if beam_length > special_length_limit:
            assembly_method = "special_case"
        elif beam_weight > robot_weight_limit:
            assembly_method = "crane_lift_human_align_screw"
        elif beam_weight <= human_weight_limit:
            assembly_method = "human_place_human_screw"
        else:
            assembly_method = "robot_place_hold_human_screw"
        beam.attributes["assembly_method"] = assembly_method

        # ============================================================
        # Grasp frame
        # ============================================================
        beam_face = beam.side_as_surface(0)
        pick_up_point = beam_face.point_at(0.5, 0.5)

        beam_frame = beam.frame.copy()
        beam_frame.point = pick_up_point

        beam.attributes["grasp_frame"] = beam_frame

        # ============================================================
        # Sequence
        # ============================================================
        # normal individual sequence
        if i in module_sequence:
            sequence_number = module_sequence.index(i) + 1
            beam.attributes["sequence"] = sequence_number
        else:
            beam.attributes["sequence"] = None

# ============================================================
# 2. Visualize selected module
# ============================================================
if 0 <= module_id < len(final_models_with_attributes):
    module_model = final_models_with_attributes[module_id]

    # plates
    for plate in module_model.plates:
        geometry.append(plate.geometry)

    # beams
    for i, beam in enumerate(module_model.beams):
        if not beam.attributes.get("neighbour", False):
            geometry.append(beam.geometry)

            beam_index = beam.attributes.get("beam_index")
            module_index = beam.attributes.get("module_index")
            sequence_number = beam.attributes.get("sequence")

            beam_indices.append(beam_index)
            beam_sequence.append(sequence_number)

            beam_frame = beam.attributes.get("grasp_frame")

            if beam_frame:
                # plane visualization
                rhino_beam_frames.append(frame_to_rhino_plane(beam_frame))

                # face visualization
                beam_face = beam.side_as_surface(0)
                v_beam_faces.append(beam_face.to_mesh())

                # text tag point
                beam_index_points.append(point_to_rhino(beam.centerline.midpoint))

                # text tag content
                beam_index_text.append("index {}".format(beam_index))

                # optional: sequence text
                beam_sequence_points.append(point_to_rhino(beam_frame.point))

                if sequence_number is not None:
                    beam_sequence_text.append("seq {} | index {}".format(sequence_number, beam_index))
                else:
                    beam_sequence_text.append("no seq | index {}".format(beam_index))
# ---------- end python_3_script_4 ----------
list_length_2 = ListLength(List=python_3_script_4.geometry)
draw_9 = COMPASDraw(cg=python_3_script_4.geometry)  # -> rg; same code as draw
draw_10 = COMPASDraw(cg=python_3_script_4.v_beam_faces)  # -> rg; same code as draw
plane = Plane(python_3_script_4.rhino_beam_frames)
panel_5 = Panel(list_length_2)
custom_preview_4 = CustomPreview(
    Geometry=draw_9,
    Material={diffuse=RGB(221, 160, 221), emission=RGB(66, 48, 66), shine=0.5, specular=RGB(255, 255, 255), transparency=0})
custom_preview_5 = CustomPreview(Geometry=draw_10, Material=ColourSwatch(SwatchColor=RGB(242, 186, 0)))

# ----
list_length_3 = ListLength(List=beam_length_5_m)  # -> flatten(Length)
mass_addition = MassAddition(Input=total_beams_volume_m3)  # -> Result, PartialResults
mass_addition_2 = MassAddition(Input=total_beams_weight_kg)  # -> Result, PartialResults
mass_addition_3 = MassAddition(Input=number_of_beams)  # -> Result, PartialResults
mass_addition_4 = MassAddition(Input=number_of_plates)  # -> Result, PartialResults
mass_addition_5 = MassAddition(Input=beam_length_m)  # -> Result, PartialResults
deconstruct_brep = DeconstructBrep(Brep=draw_8)  # -> Faces, Edges, Vertices
num_of_beam_45_kg = Panel(list_length)
totalnum_beam_length_5_m = Panel(list_length_3)
total_beam_length_m = Panel(mass_addition_5.Result)
list_item = ListItem(List=deconstruct_brep.Vertices, Index="0", Wrap=True)
list_item_2 = ListItem(List=deconstruct_brep.Vertices, Index="1", Wrap=True)
panel_6 = Panel(python_3_script_4.final_models_with_attributes)
point = Point(python_3_script_4.beam_index_points)
total_beams_volume_m3_2 = Panel(mass_addition.Result)
number_of_beams_2 = Panel(mass_addition_3.Result)
number_of_plates_2 = Panel(mass_addition_4.Result)
total_beams_volume_m3_3 = Panel(mass_addition_2.Result)
line_4 = Line(StartPoint=list_item, EndPoint=list_item_2)
multiplication = Multiplication(A=total_beam_length_m, B="0.1", C="0.12")
linear_dimension_4 = LinearDimension(Line=line_4, PointA=list_item, PointB=list_item_2, Text="{0:0.000}", Size="0.5")
text_tag = TextTag(
    Location=python_3_script_4.beam_index_points,
    Text=python_3_script_4.beam_index_text,
    Colour=ColourSwatch(SwatchColor=RGB(0, 0, 0)))

# ---- group: total_weight_per_module (kg)
panel_m2 = Expression(
    total_beams_weight_kg=total_beams_weight_kg,
    clt_panel_weight_kg=total_plates_weight_kg,
    Expression="total_beams_weight_kg+clt_panel_weight_kg")

# ----
total_beam_volume_m3 = Panel(multiplication)
multiplication_2 = Multiplication(A=total_beam_volume_m3, B="470")
total_beam_weight_kg = Panel(multiplication_2)
total_weight_per_module_kg = Panel(panel_m2)

# ---- group: Area Density = Weight Per Module / Plate Area (kg/m2)
panel_m2_2 = Expression(total_weight_per_module=total_beam_weight_kg, plate_area=plate_area_m2, Expression="total_weight_per_module/plate_area")

# ----
mass_addition_6 = MassAddition(Input=total_weight_per_module_kg)  # -> Result, PartialResults
sequence = Slider(74, range=0..74)
multiplication_3 = Multiplication(A=mass_addition_6.Result, B="4")
total_weight_kg = Panel(multiplication_3)
weight_per_module_plate_area_kg_m2 = Panel(panel_m2_2)
radians = Radians(Degrees="90")
panel_7 = Panel("""0
1
6
7""")
list_item_3 = ListItem(List=weight_per_module_plate_area_kg_m2, Index=panel_7, Wrap=True)
panel_8 = Panel(list_item_3)
unit_z = UnitZ(Factor="0.1")
colour_swatch = ColourSwatch(SwatchColor=RGB(0, 0, 0))
human_scale = Geometry(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)
working_space_rfl = Geometry([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])

# ---- group: move to RFL per module & visualize
x_axis = Slider(1.21, range=-10..10)
y_axis = Slider(0, range=-10..10)
surface = Surface(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)
plane_2 = Plane(surface)
move_point = MovePoint(geometry=plane_2, factor=x_axis, factor_2=y_axis, factor_3="0")

# ----
rotate = Rotate(Geometry=move_point, Angle=radians, Plane=move_point)  # -> Geometry, Transform

# ---- group: move to RFL per module & visualize (continued)
# visualize
python_3_script_5 = Python3Script(
    final_models=python_3_script_4.final_models_with_attributes,
    module_id=number_slider,
    t_frame=rotate.Geometry,
    sequence=sequence)  # -> out, geometry, grasp_frames, heavy_beams, long_beams, long_beams_blank, v_beam_faces, beam_sequence_points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; inputs final_models: list, module_id: Int32, sequence: Int32
# ---------- python_3_script_5: Python ----------
from compas_timber.model import TimberModel
from compas.geometry import Frame, Vector, Rotation, Transformation
from compas_rhino.conversions import plane_to_compas_frame, frame_to_rhino_plane, point_to_rhino
from System.Drawing import Color

target_f = plane_to_compas_frame(t_frame)

geometry = []
grasp_frames = []
v_beam_faces = []

long_beams = []
long_beams_blank = []
heavy_beams = []

beam_sequence_points = []
beam_sequence_text = []

beam_name_point = []
beam_name_text = []

sequence_geo = []

assembly_method_text = []
assembly_color = []
plate_color = Color.LightGray

# ============================================================
# edge node visualization outputs
# ============================================================
edge_node_points = []
edge_node_text = []


if 0 <= module_id < len(final_models):

    module_model = final_models[module_id]

    # ============================================================
    # create source frame from first plate
    # ============================================================
    source_f = None
    T = None

    if len(module_model.plates) > 0:

        plate = module_model.plates[0]

        plate_face = plate.side_as_surface(2)
        plate_midpoint = plate_face.point_at(0.5, 0.5)

        source_f = plate.frame.copy()
        source_f.point = plate_midpoint

        T = Transformation.from_frame_to_frame(source_f, target_f)

    if source_f and T:
        # ============================================================
        # collect unique edge node points
        # ============================================================

        node_points_by_id = {}

        # ============================================================
        # plates geometry
        # ============================================================
        for plate in module_model.plates:
            geo = plate.geometry.copy()
            geo.transform(T)

            geometry.append(geo)
            sequence_geo.append(geo)
            assembly_color.append(plate_color)

        # ============================================================
        # beams geometry
        # ============================================================
        for i, beam in enumerate(module_model.beams):
            geo = beam.geometry.copy()
            geo.transform(T)

            geo_blank = beam.blank.copy()
            geo_blank.transform(T)

            geometry.append(geo)

            # ========================================================
            # beam name point and text
            # ========================================================
            name_point = beam.centerline.midpoint.copy()
            name_point.transform(T)

            beam_name_point.append(point_to_rhino(name_point))
            beam_name_text.append(beam.name)

            # ========================================================
            # edge node point and text
            # ========================================================
            edge = beam.attributes.get("edge")

            if edge is not None and len(edge) == 2:

                node_a = edge[0]
                node_b = edge[1]

                pt_a = beam.centerline.start.copy()
                pt_b = beam.centerline.end.copy()

                pt_a.transform(T)
                pt_b.transform(T)

                if node_a not in node_points_by_id:
                    node_points_by_id[node_a] = pt_a

                if node_b not in node_points_by_id:
                    node_points_by_id[node_b] = pt_b

            # ========================================================
            # beam information
            # ========================================================
            beam_index = beam.attributes.get("beam_index")
            sequence_number = beam.attributes.get("sequence")

            length = beam.blank_length

            milled_volume = beam.geometry.volume
            milled_weight = milled_volume * 470

            # ========================================================
            # sequence geometry from slider
            # ========================================================
            if sequence_number is not None and sequence_number <= sequence:
                sequence_geo.append(geo)

                # ====================================================
                # transformed grasp frame
                # ====================================================
                if "grasp_frame" in beam.attributes:

                    grasp_f = beam.attributes["grasp_frame"].copy()
                    grasp_f.transform(T)

                    grasp_frames.append(frame_to_rhino_plane(grasp_f))

                    # face visualization
                    beam_face = beam.side_as_surface(0)
                    beam_face.transform(T)

                    beam_faces = beam_face.to_mesh()
                    v_beam_faces.append(beam_faces)

                    beam_sequence_text.append(
                        "seq {} | index {}".format(sequence_number, beam_index)
                    )

                    assembly_method = beam.attributes.get("assembly_method")
                    assembly_method_text.append(assembly_method)

                    if assembly_method == "special_case":
                        assembly_color.append(Color.Blue)

                    elif assembly_method == "crane_lift_human_align_screw":
                        assembly_color.append(Color.Red)

                    elif assembly_method == "human_place_human_screw":
                        assembly_color.append(Color.Yellow)

                    elif assembly_method == "robot_place_hold_human_screw":
                        assembly_color.append(Color.Green)

                    else:
                        assembly_color.append(Color.White)

                # sequence point
                seq_point = beam.centerline.midpoint.copy()
                seq_point.transform(T)

                beam_sequence_points.append(point_to_rhino(seq_point))

            # ========================================================
            # beams longer than 5 m
            # ========================================================
            if length > 5.0:
                long_beams.append(geo)
                long_beams_blank.append(geo_blank)

            # ========================================================
            # beams heavier than 45 kg
            # ========================================================
            if milled_weight > 45.0:
                heavy_beams.append(geo)

        # ============================================================
        # convert collected edge nodes to Grasshopper text outputs
        # ============================================================
        for node_id, node_pt in node_points_by_id.items():

            edge_node_points.append(point_to_rhino(node_pt))
            edge_node_text.append("{}".format(node_id))
# ---------- end python_3_script_5 ----------
list_length_4 = ListLength(List=python_3_script_5.geometry)
plane_3 = Plane(python_3_script_5.grasp_frames)

# ----
panel_9 = Panel(list_length_4)
move = Move(Geometry=python_3_script_5.beam_sequence_points, Motion=unit_z)  # -> Geometry, Transform
geometry = COMPASDraw(cg=python_3_script_5.geometry)  # -> rg; same code as draw
v_beam_faces = COMPASDraw(cg=python_3_script_5.v_beam_faces)  # -> rg; same code as draw
sequence_geo = COMPASDraw(cg=python_3_script_5.sequence_geo)  # -> rg; same code as draw
geometry_2 = CustomPreview(Geometry=geometry, Material=ColourSwatch(SwatchColor=RGB(196, 163, 112)))
v_beam_faces_2 = CustomPreview(Geometry=v_beam_faces, Material=ColourSwatch(SwatchColor=RGB(255, 247, 0)))
beam_name = TextTag(Location=python_3_script_5.beam_name_point, Text=python_3_script_5.beam_name_text, Colour=colour_swatch)
assembly_method = TextTag(Location=move.Geometry, Text=python_3_script_5.assembly_method_text, Colour=colour_swatch)
beam_sequence = TextTag(Location=move.Geometry, Text=python_3_script_5.beam_sequence_text, Colour=ColourSwatch(SwatchColor=RGB(0, 0, 0)))
draw_11 = COMPASDraw(cg=python_3_script_5.long_beams)  # -> rg; same code as draw
draw_12 = COMPASDraw(cg=python_3_script_5.long_beams_blank)  # -> rg; same code as draw
panel_10 = Panel(geometry)

sequence_geo_2 = CustomPreview(Geometry=sequence_geo, Material=python_3_script_5.assembly_color)
node = TextTag(
    Location=python_3_script_5.edge_node_points,
    Text=python_3_script_5.edge_node_text,
    Colour=ColourSwatch(SwatchColor=RGB(0, 0, 0)))
dot_display = DotDisplay(Point=python_3_script_5.edge_node_points, Colour=ColourSwatch(SwatchColor=RGB(240, 151, 151)), Size="0.1")
custom_preview_6 = CustomPreview(Geometry=working_space_rfl, Material=ColourSwatch(SwatchColor=RGBA(120, 98, 98, 216)))
custom_preview_7 = CustomPreview(Geometry=human_scale, Material=ColourSwatch(SwatchColor=RGB(217, 178, 178)))

# ---- group: module height
group_2 = Group(Geometry=geometry)
bounding_box_2 = BoundingBox(Content=group_2, Plane=PlaneXY(0, 0, 0))  # -> Box, Box_2
box_corners_2 = BoxCorners(Box=bounding_box_2.Box)  # -> CornerA, CornerB, CornerC, CornerD, CornerE, CornerF, CornerG, CornerH
line_5 = Line(StartPoint=box_corners_2.CornerA, EndPoint=box_corners_2.CornerE)
linear_dimension_5 = LinearDimension(Line=line_5, PointA=box_corners_2.CornerA, PointB=box_corners_2.CornerE, Text="{0:0.000}", Size="0.5")

# ---- group: beam that are longer than 5 m
deconstruct_brep_2 = DeconstructBrep(Brep=draw_12)  # -> Faces, Edges, Vertices
# biggest and smallest
# ATTRIBUTED : DRILL
# 
# 1. which beam is robot
# 2. grasp_frame + metal size
# 3. location of the hole
panel_11 = Panel("1")
custom_preview_8 = CustomPreview(Geometry=draw_11, Material=ColourSwatch(SwatchColor=RGB(0, 0, 150)))
list_item_4 = ListItem(List=deconstruct_brep_2.Vertices, Index="0", Wrap=True)
list_item_5 = ListItem(List=deconstruct_brep_2.Vertices, Index=panel_11, Wrap=True)
line_6 = Line(StartPoint=list_item_4, EndPoint=list_item_5)
linear_dimension_6 = LinearDimension(Line=line_6, PointA=list_item_4, PointB=list_item_5, Text="{0:0.000}", Size="0.5")

# ---- group: beam that are heavier than 45 kg
draw_13 = COMPASDraw(cg=python_3_script_5.heavy_beams)  # -> rg; same code as draw
list_length_5 = ListLength(List=draw_13)
custom_preview_9 = CustomPreview(Geometry=draw_13, Material=ColourSwatch(SwatchColor=RGB(255, 0, 0)))

# ----
num_of_beam_45_kg_2 = Panel(list_length_5)

# ==== cluster MovePoint
factor = ClusterInput()
factor_2 = ClusterInput()
unit_x = UnitX(Factor=factor)
unit_y = UnitY(Factor=factor_2)
geometry = ClusterInput()
move = Move(Geometry=geometry, Motion=unit_x)  # -> Geometry, Transform
factor_3 = ClusterInput()
move_2 = Move(Geometry=move.Geometry, Motion=unit_y)  # -> Geometry, Transform
unit_z = UnitZ(Factor=factor_3)
move_3 = Move(Geometry=move_2.Geometry, Motion=unit_z)  # -> Geometry, Transform
geometry_2 = ClusterOutput(move_3.Geometry)
