# Grasshopper definition inputtimbermodel_newsequence2.ghx (Grasshopper 1.0.8)
# plug-ins: Heteroptera

# TimberModel
py3 = Python3Script()  # -> out, timber_model
# ---------- py3: Python ----------
from compas.data import json_load
import os, sys, importlib

gh_dir = os.path.dirname(ghenv.Component.OnPingDocument().FilePath)
gh_par = os.path.dirname(gh_dir)
file_path = os.path.join(gh_par, "timber_design","data", "1205_timber_model_1.json")
print(file_path)

timber_model = json_load(file_path)
timber_model.process_joinery()
# ---------- end py3 ----------
py3_2 = Python3Script(timber_model=py3.timber_model)  # -> out, a, b, c, joint_locations
# ---------- py3_2: Python ----------
from compas.scene import Scene
from compas.geometry import Frame, Vector, Point, Transformation, Rotation
from compas_rhino.conversions import plane_to_compas_frame

from copy import deepcopy
import math

module = timber_model
module_model = module

scene = Scene()

at_frame = Frame(
    point=Point(x=5.96989, y=10.56825, z=0.36166),
    xaxis=Vector(x=0.000, y=1.000, z=0.000),
    yaxis=Vector(x=1.000, y=-0.000, z=0.000)
)

at_T = Transformation.from_frame(at_frame)

plate = module_model.plates[0]
home_T = plate.transformation_to_local()

T = at_T * home_T

for plate in module_model.plates:
    plate.transform(T)
    scene.add(plate.geometry)

c = []
for beam in module_model.beams:
    beam.transform(T)
    c.append(beam.centerline)
    scene.add(beam.geometry)

joint_locations = []
for joint in module_model.joints:
    # joint.transformed(at_T * home_T)
    joint.location.transform(T)
    pt = joint.location
    joint_locations.append(pt)
    # joint_locations.append(joint.location)


a = scene.draw()
b = module_model
# ---------- end py3_2 ----------

# ---- group: module height
group = Group(Geometry=py3_2.a)  # disabled
bounding_box = BoundingBox(Content=group, Plane=PlaneXY(0, 0, 0))  # -> Box, Box_2; disabled
box_corners = BoxCorners(Box=bounding_box.Box)  # -> CornerA, CornerB, CornerC, CornerD, CornerE, CornerF, CornerG, CornerH; disabled
line = Line(StartPoint=box_corners.CornerB, EndPoint=box_corners.CornerF)  # disabled
line_2 = Line(StartPoint=box_corners.CornerA, EndPoint=box_corners.CornerB)  # disabled
line_3 = Line(StartPoint=box_corners.CornerA, EndPoint=box_corners.CornerD)  # disabled
panel = Panel("0.5")  # disabled
panel_2 = Panel("0.5")  # disabled
panel_3 = Panel("0.5")  # disabled
linear_dimension = LinearDimension(Line=line, PointA=box_corners.CornerA, PointB=box_corners.CornerE, Text="{0:0.000}", Size=panel)  # disabled
linear_dimension_2 = LinearDimension(Line=line_2, PointA=box_corners.CornerA, PointB=box_corners.CornerB, Text="{0:0.000}", Size=panel_2)  # disabled
linear_dimension_3 = LinearDimension(Line=line_3, PointA=box_corners.CornerA, PointB=box_corners.CornerD, Text="{0:0.000}", Size=panel_3)  # disabled

# ----
compas_draw = COMPASDraw(cg=py3_2.c)  # -> rg
#   port cg: The COMPAS geometry or datastructure to be drawn.
#   port rg: The Rhino geometry object.
# ---------- compas_draw: Python ----------
# r: compas>=2.14.1
"""
Draws COMPAS geometry in Grasshopper.
"""

from typing import Any

import Grasshopper

from compas.scene import SceneObject


class CompasToRhinoGeometry(Grasshopper.Kernel.GH_ScriptInstance):
    def RunScript(self, cg):
        if not cg:
            return None

        return SceneObject(item=cg).draw()
# ---------- end compas_draw ----------
panel_4 = Panel(py3_2.b)

# ---- group: informations
python_3_script = Python3Script(final_models=py3_2.b)  # -> out, heavy_beams, long_beams_blank, long_beams_length, long_beams, beam_info_tree, total_beams_volume, total_beams_weight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; inputs final_models: list; disabled
# ---------- python_3_script: Python ----------
# ============================================================
## volume each modules ###
# ============================================================
density = 470

total_beams_volume = []
total_beams_weight = []
number_of_beams = []

total_plate_volume = []
total_plate_weight = []
number_of_plates = []
plate_area = []

for module_model in final_models:
    total_volume_beam = 0.0
    total_weight_beam = 0.0
    
    total_volume_plate = 0.0
    total_weight_plate = 0.0
    total_plate_area = 0.0

    beam_count = 0.0
    beams_vol = 0.0

    plate_vol = 0.0
    plate_weight = 0.0
    plate_ar = 0.0

    for beam in module_model.beams:
        
        if not beam.attributes.get("neighbour", False):

            beam_count += 1

            beam_vol = beam.geometry.volume
            beams_vol += beam_vol
            beam_weight = beam_vol * density

    for plate in module_model.plates:
        plate_vol = plate.geometry.volume
        plate_weight = plate_vol * density
        plate_ar = plate.width * plate.length

    total_beams_volume.append(beams_vol)
    total_beams_weight.append(beam_weight)

    total_plate_volume.append(plate_vol)
    total_plate_weight.append(plate_weight)

    number_of_beams.append(beam_count)
    number_of_plates.append(len(module_model.plates))

    plate_area.append(plate_ar)


# ============================================================
## each beam information ###
# ============================================================

from Grasshopper import DataTree
from Grasshopper.Kernel.Data import GH_Path

beam_info_tree = DataTree[object]()
long_beams_length = DataTree[object]()

all_lengths = []
all_weights = []

long_beams = []
long_beams_blank = []
heavy_beams = []

for i, module_model in enumerate(final_models):
    path = GH_Path(i)

    beam_info_tree.Add("module {}".format(i), path)

    for j, beam in enumerate(module_model.beams):
        length = beam.blank.dimensions[0]
        width = beam.blank.dimensions[1]
        height = beam.blank.dimensions[2]

        all_lengths.append(length)

        volume = beam.width * beam.height * beam.length
        weight = volume * density

        milled_volume = beam.geometry.volume
        milled_weight = milled_volume * density

        text = "beam {} | length = {:.3f} m | weight (milled) = {:.3f} kg | cross-section = {:.3f} x {:.3f} m".format(
            j, length, milled_weight, width, height
        )

        beam_info_tree.Add(text, path)

        # ============================================================
        # beams longer than 5 m
        # ============================================================
        if length > 5.0:
            long_beams.append(beam.geometry)
            long_beams_blank.append(beam.blank)

            text_length = "beam {} | length = {:.3f} m".format(j, length)
            long_beams_length.Add(text_length, path)

        # ============================================================
        # beams heavier than 45 kg
        # ============================================================
        if milled_weight > 45.0:
            heavy_beams.append(beam.geometry)
# ---------- end python_3_script ----------

# ----
bounds = Bounds(Numbers=python_3_script.all_lengths)  # disabled
python_3_script_2 = Python3Script(final_models=py3_2.b)  # -> out, geometry, grasp_frames, v_beam_faces, final_models_with_attributes, beams_a, beams_b, sequence_idx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; inputs final_models: list
# ---------- python_3_script_2: Python ----------
from compas.geometry import Frame, Vector, Rotation, Transformation
import math
from compas_rhino.conversions import plane_to_compas_frame, frame_to_rhino_plane, point_to_rhino
#from compas_timber.connections import Lap
from compas_timber.fabrication import Lap
from compas_timber.connections import joint, Joint

geometry = []

grasp_frames = []
v_beam_faces = []

beam_indices = []
beam_sequence = []
beam_sequence_text = []
beam_sequence_points = []

beam_index_text = []
beam_index_points = []

sorting_points = []

final_models_with_attributes = final_models

list_seq_auto = []

beams_a = []
beams_b = []
# ------------------------------------------------------------
# helper: connected walking inside one beam group
# ------------------------------------------------------------
def connected_walk(group_data):
    unvisited = list(group_data)
    module_auto_sequence = []

    while unvisited:
        # start from the highest-priority remaining beam
        current = unvisited.pop(0)
        module_auto_sequence.append(current["index"])

        current_edge = current["edge"]

        if current_edge is None:
            continue

        a, b = current_edge

        if current["low_node_side"] == 0:
            current_node = b

        else:
            current_node = a

        while True:
            next_beam = None
            next_position = None

            connected_candidates = []

            for pos, candidate in enumerate(unvisited):
                candidate_edge = candidate["edge"]

                if candidate_edge is None:
                    continue

                if current_node in candidate_edge:
                    connected_candidates.append((pos, candidate))

            if connected_candidates:
                connected_candidates.sort(key=lambda item: item[1]["sort_key"])

                next_position, next_beam = connected_candidates[0]

            if next_beam is None:
                break

            unvisited.pop(next_position)
            module_auto_sequence.append(next_beam["index"])

            a, b = next_beam["edge"]

            if a == current_node:
                current_node = b
            else:
                current_node = a

            current = next_beam

    return module_auto_sequence

sequence_idx = []
level_0 = []
level_11 = []
beam = []
for module_model in final_models_with_attributes:
    # 1. prepare sortable beam data
    beam_data = []

    # for i, joint in enumerate(module_model.Joint):
    #     print(beam.joint.location)

    for i, beam in enumerate(module_model.beams):
        # if i == 36:
            # print(beam.features)
            # print(beam.attributes)
            # beam.append(beam.geometry)
        edge = beam.attributes.get("edge")
        level = beam.attributes.get("level")
        modul = beam.attributes.get("level")
        
        box = beam.geometry
        ptlist = [pt.point for pt in box.points]
        rank = None
        if level == 0:
            level_0.append(beam.geometry)

            # print(i, beam.features)
            for feature in beam.features:
                if isinstance(feature, Lap) and feature.name == "Lap_A":
                    sequence_idx.append(i)
                    rank = 0
                    beams_a.append(beam.geometry)
                if isinstance(feature, Lap) and feature.name == "Lap_B":
                    #sequence_idx.append(i)
                    rank = 1
                    beams_b.append(beam.geometry)

            # level 0 uses lower Z point
            z_pt = min(ptlist, key=lambda p: (-p.z, p.y, p.x))
        elif level ==  1:
            level_11.append(beam.geometry)
        elif level == 1 or level == 2:
            # level 1 and 2 use higher Z point
            z_pt = min(ptlist, key=lambda p: (-p.z, p.y, p.x))

        else:
            # fallback if level is missing / unexpected
            z_pt = max(ptlist, key=lambda p: (-p.z, p.y, p.x))

        # print(i, z_pt)
        beam.attributes["sorting_points"] = z_pt

        side, closest_endpoint = beam.endpoint_closest_to_point(z_pt)

        if side == "start":
            low_node_side = 0
        else:
            low_node_side = 1

        #shoe_rank = 0 if beam.name == "shoe" else 1

        beam_data.append({
            "index": i,
            "beam": beam,
            "point": z_pt,
            "edge": edge,
            "level": level,
            "rank": rank,
            "low_node_side": low_node_side,

            # Z-axis sorting first, then Y/X as fallback
            "sort_key": (-z_pt.z, z_pt.y, z_pt.x, i)
        })

    module_auto_sequence = []

    # 2. level 0 shoe beams first
    level_0_shoe = [item for item in beam_data if item["level"] == 0 and item["rank"] == 0]
    level_0_shoe2 = [item for item in beam_data if item["level"] == 0 and item["rank"] == 1]
    level_0_shoe.sort(key=lambda item: item["sort_key"])
    level_0_shoe2.sort(key=lambda item: item["sort_key"])
    module_auto_sequence.extend(connected_walk(level_0_shoe))
    module_auto_sequence.extend(connected_walk(level_0_shoe2))
    # 3. level 0 normal beams
    level_0_normal = [item for item in beam_data if item["level"] == 0]

    level_0_normal.sort(key=lambda item: item["sort_key"])
    module_auto_sequence.extend(connected_walk(level_0_normal))

    # 4. level 1 beams
    level_1 = [item for item in beam_data if item["level"] == 1]

    level_1.sort(key=lambda item: item["sort_key"])
    module_auto_sequence.extend(connected_walk(level_1))

    # 5. level 2 beams
    level_2 = [item for item in beam_data if item["level"] == 2]

    level_2.sort(key=lambda item: item["sort_key"])
    module_auto_sequence.extend(connected_walk(level_2))

    list_seq_auto.append(module_auto_sequence)

print(module_auto_sequence)
sequence_beams = []
for i in sequence_idx:
    sequence_beams.append(module_model.beams[i].geometry)
    # print(sequence_number)
    #         beam.attributes["sequence"] = sequence_number
    #         if sequence_number == 22:
    #             print(beam.features)
# ============================================================
# 1. Add grasp_frame, beam_index, sequence, and assembly_method to all modules
# ============================================================
for module_index, module_model in enumerate(final_models_with_attributes):
    if module_index < len(list_seq_auto):
        module_sequence = list_seq_auto[module_index]
    else:
        module_sequence = []

        # ============================================================
        # Sequence
        # ============================================================
        # normal individual sequence
        if i in module_sequence:
            sequence_number = module_sequence.index(i) + 1
            print(sequence_number)
            beam.attributes["sequence"] = sequence_number
            if sequence_number == 1:
                print(beam.features)
        else:
            beam.attributes["sequence"] = None
# ---------- end python_3_script_2 ----------
number_slider = Slider(31, range=0..100)
number_slider_2 = Slider(31, range=0..100)
colour_swatch = ColourSwatch(SwatchColor=RGB(0, 0, 150))  # disabled
draw = COMPASDraw(cg=python_3_script.long_beams)  # -> rg; disabled; same code as compas_draw
compas_draw_2 = COMPASDraw(cg=py3_2.joint_locations)  # -> rg; same code as compas_draw

# ---- group: beam that are heavier than 45 kg
# overall information
draw_2 = COMPASDraw(cg=python_3_script.heavy_beams)  # -> rg; disabled; same code as compas_draw
colour_swatch_2 = ColourSwatch(SwatchColor=RGB(255, 0, 0))  # disabled
custom_preview = CustomPreview(Geometry=draw_2, Material=colour_swatch_2)  # disabled

# ----
deconstruct_domain² = DeconstructDomain²(Domain=bounds)  # -> UComponent, VComponent; disabled
average = Average(Input=python_3_script.all_lengths)  # disabled
compas_draw_3 = COMPASDraw(cg=py3_2.joint_locations)  # -> rg; same code as compas_draw
python_3_script_3 = Python3Script(final_models=py3.timber_model)  # -> out, beams_a, beams_b, level_1_joint, level_1_beam, sorted_points, joint_tags, sorting_data
# ---------- python_3_script_3: Python ----------
from compas_timber.fabrication import Lap



joints_list = list(final_models.joints)
sorted_joints = sorted(joints_list, key=lambda j: (j.location.x, j.location.y, j.location.z))
sorted_points = [joint.location for joint in sorted_joints]

joint_rank = {joint: idx for idx, joint in enumerate(sorted_joints)}

level_ranks = {0:2 , 1:1, 2:0}

unvisited = {(i, beam): beam for i, beam in enumerate(final_models.beams)}
sorting_data = []

for joint in sorted_joints:
    for (i, beam) in list(unvisited):
        if beam not in joint.elements:
            continue

        level = beam.attributes.get("level")
        
        if level == 0:
            hierarchy_rank = {"shoe": 5, "tertiary": 2, "secondary": 0, "primary": 0, "main_primary": 0}
        elif level == 1:
            hierarchy_rank = {"shoe": 5, "tertiary": 2, "secondary": 2, "primary": 0, "main_primary": 0}
        else: 
            hierarchy_rank = {"shoe": 5, "tertiary": 2, "secondary": 2, "primary": 0, "main_primary": 0}

        hierarchy = beam.attributes.get("hierarchy", "")
        shoe_priority = 0 if hierarchy == "shoe" else 1
        joint_idx = joint_rank[joint]
        level_rank = level_ranks.get(level)

        hierarchy_idx = hierarchy_rank.get(hierarchy)

        sorting_data.append((
                            level_rank,
                            hierarchy_idx,
                            joint_idx,
                            joint.location.x,
                            joint.location.y,
                            joint.location.z,
                            i,
                            beam,
                            joint,
                        ))
        

for i,data in enumerate(sorting_data):
    print(data[0], data[1],data[2], data[3])
sorting_data.sort()
for i,data in enumerate(sorting_data):
    print("sorted", data[0], data[1],data[2],data[3])

sorted_beams = []
for *_, i, beam, joint in sorting_data:
    if (i, beam) in unvisited:
        sorted_beams.append(beam.geometry)
        #print(i, joint.name, joint.location)
        del unvisited[(i, beam)]
# ---------- end python_3_script_3 ----------
custom_preview_2 = CustomPreview(Geometry=draw, Material=colour_swatch)  # disabled
python_3_script_4 = Python3Script(final_models=py3_2.b)  # -> out, beams_a, beams_b, level_1_joint, level_1_beam, sorted_points, joint_tags, sorting_data
# ---------- python_3_script_4: Python ----------
from compas_timber.fabrication import Lap



joints_list = list(final_models.joints)
sorted_joints = sorted(joints_list, key=lambda j: (j.location.x, j.location.y, j.location.z))
sorted_points = [joint.location for joint in sorted_joints]

joint_rank = {joint: idx for idx, joint in enumerate(sorted_joints)}


unvisited = {(i, beam): beam for i, beam in enumerate(final_models.beams)}
sorting_data = []

for joint in sorted_joints:
    for (i, beam) in list(unvisited):
        if beam not in joint.elements:
            continue

        level = beam.attributes.get("level")

        if level == 0:
            hierarchy_rank = {"shoe": 0, "tertiary": 2, "secondary": 4, "primary": 4, "main_primary": 4}
        elif level == 1:
            hierarchy_rank = {"shoe": 0, "tertiary": 2, "secondary": 2, "primary": 4, "main_primary": 4}
        else: 
            hierarchy_rank = {"shoe": 0, "tertiary": 2, "secondary": 2, "primary": 4, "main_primary": 4}

        hierarchy = beam.attributes.get("hierarchy", "")
        shoe_priority = 0 if hierarchy == "shoe" else 1
        joint_idx = joint_rank[joint]
        hierarchy_idx = hierarchy_rank.get(hierarchy)

        sorting_data.append((
                            shoe_priority,
                            level,
                            hierarchy_idx,
                            joint_idx,
                            joint.location.x,
                            joint.location.y,
                            joint.location.z,
                            i,
                            beam,
                            joint,
                        ))
        

for i,data in enumerate(sorting_data):
    print(data[0], data[1],data[2], data[3])
sorting_data.sort()
for i,data in enumerate(sorting_data):
    print("sorted", data[0], data[1],data[2],data[3])

sorted_beams = []
for *_, i, beam, joint in sorting_data:
    if (i, beam) in unvisited:
        sorted_beams.append(beam.geometry)
        #print(i, joint.name, joint.location)
        del unvisited[(i, beam)]
# ---------- end python_3_script_4 ----------
beam_length_5_m = Panel(draw)  # disabled

# ---- group: add attributes
# grasp_frames, sequence,
# assembly_method
python_3_script_5 = Python3Script(final_models=py3_2.b)  # -> out, geometry, grasp_frames, v_beam_faces, final_models_with_attributes, beams_a, beams_b, sequence_idx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
# ---------- python_3_script_5: Python ----------
from compas.geometry import Frame, Vector, Rotation, Transformation
import math
from compas_rhino.conversions import plane_to_compas_frame, frame_to_rhino_plane, point_to_rhino
#from compas_timber.connections import Lap
from compas_timber.fabrication import Lap
from compas_timber.connections import joint, Joint, XLapJoint

geometry = []

grasp_frames = []
v_beam_faces = []

beam_indices = []
beam_sequence = []
beam_sequence_text = []
beam_sequence_points = []

beam_index_text = []
beam_index_points = []

sorting_points = []

final_models_with_attributes = final_models

list_seq_auto = []

beams_a = []
beams_b = []
# ------------------------------------------------------------
# helper: connected walking inside one beam group
# ------------------------------------------------------------
def connected_walk(group_data):
    unvisited = list(group_data)
    module_auto_sequence = []

    while unvisited:
        # start from the highest-priority remaining beam
        current = unvisited.pop(0)
        current_beam = current.get("beam")
        print(current_beam)
        module_auto_sequence.append(current["index"])

        current_edge = current["edge"]

        if current_edge is None:
            continue

        a, b = current_edge

        if current["low_node_side"] == 0:
            current_node = a

        else:
            current_node = b

        while True:
            next_beam = None
            next_position = None

            connected_candidates = []

            for pos, candidate in enumerate(unvisited):
                candidate_edge = candidate["edge"]

                if candidate_edge is None:
                    continue

                if current_node in candidate_edge:
                    connected_candidates.append((pos, candidate))

            if connected_candidates:
                connected_candidates.sort(key=lambda item: item[1]["sort_key"])

                next_position, next_beam = connected_candidates[0]

            if next_beam is None:
                break

            unvisited.pop(next_position)
            module_auto_sequence.append(next_beam["index"])

            a, b = next_beam["edge"]

            if a == current_node:
                current_node = b
            else:
                current_node = a

            current = next_beam

    return module_auto_sequence

def build_endpoint_map(model, precision=3): 
    endpoint_map = {}

    for beam in model.beams:
        pts = [beam.centerline.start, beam.centerline.end]

        for pt in pts:
            gkey = f"{pt.x:.{precision}f},{pt.y:.{precision}f},{pt.z:.{precision}f}"

            if gkey not in endpoint_map:
                endpoint_map[gkey] = []

            if beam not in endpoint_map[gkey]:
                endpoint_map[gkey].append(beam)

    return endpoint_map

def get_neighbors_from_map(target_beam, conn_map, precision=3):
    neighbors = set()
    pts = [target_beam.centerline.start, target_beam.centerline.end]

    for pt in pts:
        gkey = f"{pt.x:.{precision}f},{pt.y:.{precision}f},{pt.z:.{precision}f}"

        # Get all beams at this location, default to empty list if none found
        beams_at_node = conn_map.get(gkey, [])

        for beam in beams_at_node:
            if beam != target_beam:
                neighbors.add(beam)

    return list(neighbors)

# conn_map = build_endpoint_map(final_models_with_attributes[0])



joint_locations = []
level_1_joint = []
level_1_beam = []
beams_a = []
beams_b = []

# for module_model in final_models_with_attributes:
#     for i, joint in enumerate(module_model.joints):
#         joint_locations.append(joint.location)
#         # print(joint_locations)

#         for i, beam in enumerate(module_model.beams):
#             level = beam.attributes.get("level")
#             if level == 1:
#                 print(i, joint_locations)
#                 level_1_joint.append(joint.locations)


from compas_timber.fabrication import Lap

unvisited = []
sorting_data = []

for i, beam in enumerate(final_models.beams):
    level = beam.attributes.get("level")
    if level == 0:
        unvisited.append((i, beam))


for joint in final_models.joints:
    for pos in range(len(unvisited) - 1, -1, -1):
        i, beam = unvisited[pos]
        if beam in joint.elements:
            # XLapJoint first
            if joint.name == "XLapJoint":
                for feature in beam.features:
                    if isinstance(feature, Lap) and feature.name == "Lap_A":
                        sorting_data.append((0, i, beam, joint, "Lap_A"))
                    elif isinstance(feature, Lap) and feature.name == "Lap_B":
                        sorting_data.append((1, i, beam, joint, "Lap_B"))
            # TMultiStepJoint after
            elif joint.name == "TMultiStepJoint":
                sorting_data.append((2, i, beam, joint, None))


# sort by first item only: 0, then 1, then 2
sorting_data.sort(key=lambda item: (item[0], item[3].location.x, item[3].location.z))



# test output
sorted_beams = []

for rank, i, beam, joint, lap_name in sorting_data:
    if (i, beam) in unvisited:
        sorted_beams.append(beam.geometry)
        print(i, rank, joint.name, lap_name, joint.location)
        unvisited.remove((i, beam))
# for joint in final_models.joints:
#     for i, beam in enumerate(final_models.beams):
#         level = beam.attributes.get("level")

#         if level == 0 and beam in joint.elements:
#             if joint.name == "XLapJoint":
#                 # print(i, joint.location, joint.name)
#                 # level_1_joint.append(joint.location)
#                 # level_1_beam.append(beam.geometry)
#                 for feature in beam.features:
#                     if isinstance(feature, Lap) and feature.name == "Lap_A":
#                         rank = 0
#                         beams_a.append(beam.geometry)
#                     if isinstance(feature, Lap) and feature.name == "Lap_B":
#                         rank = 1
#                         beams_b.append(beam.geometry)
#             elif joint.name == "TMultiStepJoint":
#                 print(i, joint.location, joint.name)
#                 level_1_joint.append(joint.location)
#                 level_1_beam.append(beam.geometry)
            # else:    
            #     print(i, joint.location, joint.name)
            
        
joint_points = []
joint_tags = []

for i, joint in enumerate(final_models.joints):
    pt = joint.location

    joint_points.append(pt)
    joint_tags.append("{} | {}".format(i, joint.name))


# sequence_idx = []
# level_0 = []
# level_11 = []
# beam = []
# for module_model in final_models_with_attributes:
#     # 1. prepare sortable beam data
#     beam_data = []

#     # for i, joint in enumerate(module_model.Joint):
#     #     print(beam.joint.location)

#     for i, beam in enumerate(module_model.beams):
#         # if i == 36:
#             # print(beam.features)
#             # print(beam.attributes)
#             # beam.append(beam.geometry)
#         edge = beam.attributes.get("edge")
#         level = beam.attributes.get("level")
#         modul = beam.attributes.get("level")
        
#         box = beam.geometry
#         ptlist = [pt.point for pt in box.points]
#         rank = None
#         if level == 0:
#             level_0.append(beam.geometry)

#             # print(i, beam.features)
#             for feature in beam.features:
#                 if isinstance(feature, Lap) and feature.name == "Lap_A":
#                     sequence_idx.append(i)
#                     rank = 0
#                     beams_a.append(beam.geometry)
#                 if isinstance(feature, Lap) and feature.name == "Lap_B":
#                     #sequence_idx.append(i)
#                     rank = 1
#                     beams_b.append(beam.geometry)

#             # level 0 uses lower Z point
#             z_pt = min(ptlist, key=lambda p: (-p.z, p.y, p.x))
#         elif level ==  1:
#             level_11.append(beam.geometry)
#         elif level == 1 or level == 2:
#             # level 1 and 2 use higher Z point
#             z_pt = min(ptlist, key=lambda p: (-p.z, p.y, p.x))

#         else:
#             # fallback if level is missing / unexpected
#             z_pt = max(ptlist, key=lambda p: (-p.z, p.y, p.x))

#         # print(i, z_pt)
#         beam.attributes["sorting_points"] = z_pt

#         side, closest_endpoint = beam.endpoint_closest_to_point(z_pt)

#         if side == "start":
#             low_node_side = 0
#         else:
#             low_node_side = 1

#         #shoe_rank = 0 if beam.name == "shoe" else 1

#         beam_data.append({
#             "index": i,
#             "beam": beam,
#             "point": z_pt,
#             "edge": edge,
#             "level": level,
#             "rank": rank,
#             "low_node_side": low_node_side,

#             # Z-axis sorting first, then Y/X as fallback
#             "sort_key": (-z_pt.z, z_pt.y, z_pt.x, i)
#         })

#     module_auto_sequence = []

#     # 2. level 0 shoe beams first
#     level_0_shoe = [item for item in beam_data if item["level"] == 0 and item["rank"] == 0]
#     level_0_shoe2 = [item for item in beam_data if item["level"] == 0 and item["rank"] == 1]
#     level_0_shoe.sort(key=lambda item: item["sort_key"])
#     level_0_shoe2.sort(key=lambda item: item["sort_key"])
#     module_auto_sequence.extend(connected_walk(level_0_shoe))
#     module_auto_sequence.extend(connected_walk(level_0_shoe2))
#     # 3. level 0 normal beams
#     level_0_normal = [item for item in beam_data if item["level"] == 0]

#     level_0_normal.sort(key=lambda item: item["sort_key"])
#     module_auto_sequence.extend(connected_walk(level_0_normal))

#     # 4. level 1 beams
#     level_1 = [item for item in beam_data if item["level"] == 1]

#     level_1.sort(key=lambda item: item["sort_key"])
#     module_auto_sequence.extend(connected_walk(level_1))

#     # 5. level 2 beams
#     level_2 = [item for item in beam_data if item["level"] == 2]

#     level_2.sort(key=lambda item: item["sort_key"])
#     module_auto_sequence.extend(connected_walk(level_2))

#     list_seq_auto.append(module_auto_sequence)

# # print(module_auto_sequence)
# sequence_beams = []
# for i in sequence_idx:
#     sequence_beams.append(module_model.beams[i].geometry)
#     # print(sequence_number)
#     #         beam.attributes["sequence"] = sequence_number
#     #         if sequence_number == 22:
#     #             print(beam.features)
# # ============================================================
# # 1. Add grasp_frame, beam_index, sequence, and assembly_method to all modules
# # ============================================================
# for module_index, module_model in enumerate(final_models_with_attributes):
#     if module_index < len(list_seq_auto):
#         module_sequence = list_seq_auto[module_index]
#     else:
#         module_sequence = []

#         # ============================================================
#         # Sequence
#         # ============================================================
#         # normal individual sequence
#         # if i in module_sequence:
#         #     sequence_number = module_sequence.index(i) + 1
#         #     # print(sequence_number)
#         #     beam.attributes["sequence"] = sequence_number
#         #     if sequence_number == 1:
#         #         # print(beam.features)
#         # # else:
#         # #     beam.attributes["sequence"] = None
# ---------- end python_3_script_5 ----------

# ----
panel_5 = Panel(python_3_script.long_beams_length)  # disabled
beam_information = Panel(python_3_script.beam_info_tree)  # disabled
total_beams_volume_m3 = Panel(python_3_script.total_beams_volume)  # disabled
total_beams_weight_kg = Panel(python_3_script.total_beams_weight)  # disabled
total_plates_volume_m3 = Panel(python_3_script.total_plate_volume)  # disabled
total_plates_weight_kg = Panel(python_3_script.total_plate_weight)  # disabled
number_of_beams = Panel(python_3_script.number_of_beams)  # disabled
number_of_plates = Panel(python_3_script.number_of_plates)  # disabled
plate_area_m2 = Panel(python_3_script.plate_area)  # disabled
beam_length_m = Panel(python_3_script.all_lengths)  # disabled
min_max_length = Panel(deconstruct_domain².UComponent)  # disabled
average_length = Panel(average)  # disabled
python_3_script_6 = Python3Script(final_models=py3_2.b)  # -> out, geometry, grasp_frames, v_beam_faces, final_models_with_attributes, beams_a, beams_b, sequence_idx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; inputs final_models: list
# ---------- python_3_script_6: Python ----------
from compas.geometry import Frame, Vector, Rotation, Transformation
import math
from compas_rhino.conversions import plane_to_compas_frame, frame_to_rhino_plane, point_to_rhino
#from compas_timber.connections import Lap
from compas_timber.fabrication import Lap

geometry = []

grasp_frames = []
v_beam_faces = []

beam_indices = []
beam_sequence = []
beam_sequence_text = []
beam_sequence_points = []

beam_index_text = []
beam_index_points = []

sorting_points = []

final_models_with_attributes = final_models

list_seq_auto = []

beams_a = []
beams_b = []
# ------------------------------------------------------------
# helper: connected walking inside one beam group
# ------------------------------------------------------------
def connected_walk(group_data):
    unvisited = list(group_data)
    module_auto_sequence = []

    while unvisited:
        # start from the highest-priority remaining beam
        current = unvisited.pop(0)
        module_auto_sequence.append(current["index"])

        current_edge = current["edge"]

        if current_edge is None:
            continue

        a, b = current_edge

        if current["low_node_side"] == 0:
            current_node = b
        else:
            current_node = a

        while True:
            next_beam = None
            next_position = None

            connected_candidates = []

            for pos, candidate in enumerate(unvisited):
                candidate_edge = candidate["edge"]

                if candidate_edge is None:
                    continue

                if current_node in candidate_edge:
                    connected_candidates.append((pos, candidate))

            if connected_candidates:
                connected_candidates.sort(key=lambda item: item[1]["sort_key"])

                next_position, next_beam = connected_candidates[0]

            if next_beam is None:
                break

            unvisited.pop(next_position)
            module_auto_sequence.append(next_beam["index"])

            a, b = next_beam["edge"]

            if a == current_node:
                current_node = b
            else:
                current_node = a

            current = next_beam

    return module_auto_sequence

sequence_idx = []
level_0 = []
level_11 = []
for module_model in final_models_with_attributes:
    # 1. prepare sortable beam data
    beam_data = []

    for i, beam in enumerate(module_model.beams):
        # print(i, beam.attributes)
        edge = beam.attributes.get("edge")
        level = beam.attributes.get("level")

        box = beam.geometry
        ptlist = [pt.point for pt in box.points]
        rank = None
        if level == 0:
            level_0.append(beam.geometry)
            for feature in beam.features:
                if isinstance(feature, Lap) and feature.name == "Lap_A":
                    sequence_idx.append(i)
                    rank = 0
                    beams_a.append(beam.geometry)
                if isinstance(feature, Lap) and feature.name == "Lap_B":
                    #sequence_idx.append(i)
                    rank = 1
                    beams_b.append(beam.geometry)

            # level 0 uses lower Z point
            z_pt = max(ptlist, key=lambda p: (-p.z, p.y, p.x))
        elif level ==  1:
            level_11.append(beam.geometry)
        elif level == 1 or level == 2:
            # level 1 and 2 use higher Z point
            z_pt = min(ptlist, key=lambda p: (-p.z, p.y, p.x))

        else:
            # fallback if level is missing / unexpected
            z_pt = max(ptlist, key=lambda p: (-p.z, p.y, p.x))

        # print(i, z_pt)
        beam.attributes["sorting_points"] = z_pt

        side, closest_endpoint = beam.endpoint_closest_to_point(z_pt)

        if side == "start":
            low_node_side = 0
        else:
            low_node_side = 1

        #shoe_rank = 0 if beam.name == "shoe" else 1

        beam_data.append({
            "index": i,
            "beam": beam,
            "point": z_pt,
            "edge": edge,
            "level": level,
            "rank": rank,
            "low_node_side": low_node_side,

            # Z-axis sorting first, then Y/X as fallback
            "sort_key": (-z_pt.z, z_pt.y, z_pt.x, i)
        })

    module_auto_sequence = []

    # 2. level 0 shoe beams first
    level_0_shoe = [item for item in beam_data if item["level"] == 0 and item["rank"] == 0]
    level_0_shoe2 = [item for item in beam_data if item["level"] == 0 and item["rank"] == 1]
    level_0_shoe.sort(key=lambda item: item["sort_key"])
    level_0_shoe2.sort(key=lambda item: item["sort_key"])
    module_auto_sequence.extend(connected_walk(level_0_shoe))
    module_auto_sequence.extend(connected_walk(level_0_shoe2))
    # 3. level 0 normal beams
    level_0_normal = [item for item in beam_data if item["level"] == 0]

    level_0_normal.sort(key=lambda item: item["sort_key"])
    module_auto_sequence.extend(connected_walk(level_0_normal))

    # 4. level 1 beams
    level_1 = [item for item in beam_data if item["level"] == 1]

    level_1.sort(key=lambda item: item["sort_key"])
    module_auto_sequence.extend(connected_walk(level_1))

    # 5. level 2 beams
    level_2 = [item for item in beam_data if item["level"] == 2]

    level_2.sort(key=lambda item: item["sort_key"])
    module_auto_sequence.extend(connected_walk(level_2))

    list_seq_auto.append(module_auto_sequence)

sequence_beams = []
for i in sequence_idx:
    sequence_beams.append(module_model.beams[i].geometry)
# ============================================================
# 1. Add grasp_frame, beam_index, sequence, and assembly_method to all modules
# ============================================================
for module_index, module_model in enumerate(final_models_with_attributes):
    if module_index < len(list_seq_auto):
        module_sequence = list_seq_auto[module_index]
    else:
        module_sequence = []

    for i, beam in enumerate(module_model.beams):
        beam.attributes["module_index"] = module_index
        beam.attributes["beam_index"] = i

        # ============================================================
        # Assembly method logic
        # ============================================================
        beam.attributes["assembly_method"] = None

        density = 470  # kg/m3

        beam_volume = beam.geometry.volume
        beam_weight = beam_volume * density
        beam_length = beam.blank_length

        # define limits
        robot_weight_limit = 45.0
        human_weight_limit = 5.0
        special_length_limit = 5.0

        # decide assembly method
        if beam_length > special_length_limit:
            assembly_method = "special_case"
        elif beam_weight > robot_weight_limit:
            assembly_method = "crane_lift_human_align_screw"
        elif beam_weight <= human_weight_limit:
            assembly_method = "human_place_human_screw"
        else:
            assembly_method = "robot_place_hold_human_screw"
        beam.attributes["assembly_method"] = assembly_method

        # ============================================================
        # Grasp frame
        # ============================================================
        beam_face = beam.side_as_surface(0)
        pick_up_point = beam_face.point_at(0.5, 0.5)

        beam_frame = beam.frame.copy()
        beam_frame.point = pick_up_point

        beam.attributes["grasp_frame"] = beam_frame

        # ============================================================
        # Sequence
        # ============================================================
        # normal individual sequence
        if i in module_sequence:
            sequence_number = module_sequence.index(i) + 1
            beam.attributes["sequence"] = sequence_number
        else:
            beam.attributes["sequence"] = None

# ============================================================
# 2. Visualize selected module
# ============================================================
# plates
for plate in module_model.plates:
    geometry.append(plate.geometry)

# beams
for i, beam in enumerate(module_model.beams):
    geometry.append(beam.geometry)

    beam_index = beam.attributes.get("beam_index")
    module_index = beam.attributes.get("module_index")
    sequence_number = beam.attributes.get("sequence")
    level = beam.attributes.get("level")

    beam_indices.append(beam_index)
    beam_sequence.append(sequence_number)

    beam_frame = beam.attributes.get("grasp_frame")

    if beam_frame:
        # plane visualization
        grasp_frames.append(frame_to_rhino_plane(beam_frame))

        # face visualization
        beam_face = beam.side_as_surface(0)
        v_beam_faces.append(beam_face.to_mesh())

        # text tag point
        beam_index_points.append(point_to_rhino(beam.centerline.midpoint))

        # text tag content
        # beam_index_text.append("index {}".format(beam_index))
        beam_index_text.append("level {}".format(level))

        # optional: sequence text
        beam_sequence_points.append(point_to_rhino(beam_frame.point))

        if sequence_number is not None:
            beam_sequence_text.append("seq {} | index {}".format(sequence_number, beam_index))
        else:
            beam_sequence_text.append("no seq | index {}".format(beam_index))
# ---------- end python_3_script_6 ----------
list_length = ListLength(List=draw_2)  # disabled
compas_draw_4 = COMPASDraw(cg=python_3_script_3.sorting_data)  # -> rg; same code as compas_draw
draw_3 = COMPASDraw(cg=python_3_script.long_beams_blank)  # -> rg; disabled; same code as compas_draw
compas_draw_5 = COMPASDraw(cg=python_3_script_3.level_1_joint)  # -> rg; same code as compas_draw
compas_draw_6 = COMPASDraw(cg=python_3_script_3.level_1_beam)  # -> rg; same code as compas_draw
python_3_script_7 = Python3Script(step=number_slider, sorting_data=python_3_script_3.sorting_data, final_models=py3_2.b)  # -> out, geometry_to_show; inputs step: Int32, sorting_data: list
# ---------- python_3_script_7: Python ----------
geometry = []

step = int(step)

# ------------------------------------------------------------
# slider 0 = show only plates
# ------------------------------------------------------------
for plate in final_models.plates:
    geometry.append(plate.geometry)

# ------------------------------------------------------------
# slider 1 = plates + sorted_beams[0]
# slider 2 = plates + sorted_beams[0] + sorted_beams[1]
# etc.
# ------------------------------------------------------------
model_beams = final_models.beams

sorted_beams = []
seen = set()

for *_, i, _, joint in sorting_data:
    if i in seen:
        continue

    if 0 <= i < len(model_beams):
        beam = model_beams[i]
        sorted_beams.append(beam.geometry)
        seen.add(i)

sorted_beams.reverse()
geometry.extend(sorted_beams)

if step < 0:
    step = 0
if step > len(geometry):
    step = len(geometry)
geometry_to_show = geometry[:step]
# ---------- end python_3_script_7 ----------
compas_draw_7 = COMPASDraw(cg=python_3_script_4.sorting_data)  # -> rg; same code as compas_draw
list_length_2 = ListLength(List=beam_length_5_m)  # -> flatten(Length); disabled
compas_draw_8 = COMPASDraw(cg=python_3_script_4.level_1_joint)  # -> rg; same code as compas_draw
compas_draw_9 = COMPASDraw(cg=python_3_script_4.level_1_beam)  # -> rg; same code as compas_draw
python_3_script_8 = Python3Script(step=number_slider_2, sorting_data=python_3_script_4.sorting_data, final_models=py3_2.b)  # -> out, geometry_to_show; inputs step: Int32, sorting_data: list; same code as python_3_script_7
compas_draw_10 = COMPASDraw(cg=python_3_script_3.sorted_points)  # -> rg; same code as compas_draw
mass_addition = MassAddition(Input=beam_length_m)  # -> Result, PartialResults; disabled
deconstruct_brep = DeconstructBrep(Brep=draw_3)  # -> Faces, Edges, Vertices; disabled
number_slider_3 = Slider(1, range=0..10)
num_of_beam_45_kg = Panel(list_length)  # disabled
compas_draw_11 = COMPASDraw(cg=python_3_script_4.sorted_points)  # -> rg; same code as compas_draw
panel_6 = Panel(python_3_script_7.geometry_to_show)
addition = Addition(A=total_beams_volume_m3, B=total_plates_volume_m3)  # disabled
totalnum_beam_length_5_m = Panel(list_length_2)  # disabled
panel_7 = Panel(python_3_script_8.geometry_to_show)
panel_8 = Panel("0")  # disabled
panel_9 = Panel("1")  # disabled
compas_draw_12 = COMPASDraw(cg=python_3_script_7.geometry_to_show)  # -> rg; same code as compas_draw
panel_10 = Panel(addition)  # disabled
total_beam_length_m = Panel(mass_addition.Result)  # disabled
list_item = ListItem(List=deconstruct_brep.Vertices, Index=panel_8, Wrap=True)  # disabled
list_item_2 = ListItem(List=deconstruct_brep.Vertices, Index=panel_9, Wrap=True)  # disabled
item = ListItem(List=compas_draw_12, Index=number_slider, Wrap=True)
compas_draw_13 = COMPASDraw(cg=python_3_script_8.geometry_to_show)  # -> rg; same code as compas_draw
text_tag = TextTag(Location=compas_draw_10)
panel_11 = Panel(python_3_script_5.sequence_idx)
item_2 = ListItem(List=compas_draw_13, Index=number_slider_2, Wrap=True)
compas_draw_14 = COMPASDraw(cg=python_3_script_5.level_0)  # -> rg; same code as compas_draw
compas_draw_15 = COMPASDraw(cg=python_3_script_5.level_11)  # -> rg; same code as compas_draw
compas_draw_16 = COMPASDraw(cg=python_3_script_5.geometry)  # -> rg; same code as compas_draw
compas_draw_17 = COMPASDraw(cg=python_3_script_5.beams_a)  # -> rg; same code as compas_draw
compas_draw_18 = COMPASDraw(cg=python_3_script_5.beams_b)  # -> rg; same code as compas_draw
text_tag_2 = TextTag(Location=compas_draw_11)
line_4 = Line(StartPoint=list_item, EndPoint=list_item_2)  # disabled
custom_preview_3 = CustomPreview(
    Geometry=item,
    Material={diffuse=RGB(221, 160, 221), emission=RGB(66, 48, 66), shine=0.5, specular=RGB(255, 255, 255), transparency=0})
panel_12 = Panel("0.12")  # disabled
panel_13 = Panel("0.1")  # disabled
compas_draw_19 = COMPASDraw(cg=python_3_script_5.sequence_beams)  # -> rg; same code as compas_draw
center = Center(Geometry=compas_draw_19)  # -> Center, Dimension
points = PointList(Points=center.Center, Size=Slider(0.5, range=0..1))
custom_preview_4 = CustomPreview(
    Geometry=item_2,
    Material={diffuse=RGB(221, 160, 221), emission=RGB(66, 48, 66), shine=0.5, specular=RGB(255, 255, 255), transparency=0})
panel_14 = Panel("0.5")  # disabled
sequence = Slider(16, range=0..104)
multiplication = Multiplication(A=total_beam_length_m, B=panel_13, C=panel_12)  # disabled
v_beam_faces = COMPASDraw(cg=python_3_script_5.v_beam_faces)  # -> rg; same code as compas_draw
plane = Plane(python_3_script_5.grasp_frames)
item_3 = ListItem(List=compas_draw_19, Index=Slider(0, range=0..100), Wrap=True)
linear_dimension_4 = LinearDimension(Line=line_4, PointA=list_item, PointB=list_item_2, Text="{0:0.000}", Size=panel_14)  # disabled
compas_draw_20 = COMPASDraw(cg=item_3)  # -> rg; same code as compas_draw
geo = Geometry(item_3)

# ---- group: total_weight_per_module (kg)
panel_m2 = Expression(
    total_beams_weight_kg=total_beams_weight_kg,
    clt_panel_weight_kg=total_plates_weight_kg,
    Expression="total_beams_weight_kg+clt_panel_weight_kg")  # disabled

# ----
total_beam_volume_m3 = Panel(multiplication)  # disabled
v_beam_faces_2 = CustomPreview(Geometry=v_beam_faces, Material=ColourSwatch(SwatchColor=RGB(255, 247, 0)))
panel_15 = Panel("470")  # disabled
multiplication_2 = Multiplication(A=total_beam_volume_m3, B=panel_15)  # disabled
total_beam_weight_kg = Panel(multiplication_2)  # disabled
total_weight_per_module_kg = Panel(panel_m2)  # disabled

# ---- group: Area Density = Weight Per Module / Plate Area (kg/m2)
panel_m2_2 = Expression(total_weight_per_module=total_beam_weight_kg, plate_area=plate_area_m2, Expression="total_weight_per_module/plate_area")  # disabled

# ---- group: move to RFL per module & visualize
# visualize
python_3_script_9 = Python3Script(final_models=python_3_script_5.final_models_with_attributes, sequence=sequence)  # -> out, geometry, grasp_frames, heavy_beams, long_beams, long_beams_blank, sequence_geo, assembly_color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; inputs final_models: list, sequence: Int32
# ---------- python_3_script_9: Python ----------
from compas_timber.model import TimberModel
from compas.geometry import Frame, Vector, Rotation, Transformation
from compas_rhino.conversions import plane_to_compas_frame, frame_to_rhino_plane, point_to_rhino
from System.Drawing import Color

geometry = []
grasp_frames = []

long_beams = []
long_beams_blank = []
heavy_beams = []

beam_name_point = []
beam_name_text = []

sequence_geo = []

assembly_method_text = []
assembly_color = []
plate_color = Color.LightGray

# ============================================================
# edge node visualization outputs
# ============================================================
edge_node_points = []
edge_node_text = []

sorting_points = []

module_model = final_models[0]

# ============================================================
# collect unique edge node points
# ============================================================
node_points_by_id = {}

# ============================================================
# plates geometry
# ============================================================
for plate in module_model.plates:

    geo = plate.geometry
    geometry.append(geo)
    # sequence_geo.append(geo)
    assembly_color.append(plate_color)

# ============================================================
# beams geometry
# ============================================================
for i, beam in enumerate(module_model.beams):
    geo = beam.geometry
    geo_blank = beam.blank
    geometry.append(geo)

    # ========================================================
    # beam name point and text
    # ========================================================
    name_point = beam.centerline.midpoint
    beam_name_point.append(point_to_rhino(name_point))
    beam_name_text.append(beam.name)

    # ========================================================
    # edge node point and text
    # ========================================================
    edge = beam.attributes.get("edge")

    if edge is not None and len(edge) == 2:

        node_a = edge[0]
        node_b = edge[1]

        pt_a = beam.centerline.start
        pt_b = beam.centerline.end

        if node_a not in node_points_by_id:
            node_points_by_id[node_a] = pt_a

        if node_b not in node_points_by_id:
            node_points_by_id[node_b] = pt_b

    # ========================================================
    # beam information
    # ========================================================
    beam_index = beam.attributes.get("beam_index")
    sequence_number = beam.attributes.get("sequence")

    length = beam.blank_length

    milled_volume = beam.geometry.volume
    milled_weight = milled_volume * 470

    # ========================================================
    # sequence geometry from slider
    # ========================================================
    if sequence_number is not None and sequence_number <= sequence:
        sequence_geo.append(geo)

        grasp_frame = beam.attributes.get("grasp_frame")
        # ====================================================
        # transformed grasp frame
        # ====================================================
        if "grasp_frame" in beam.attributes:
            grasp_frames.append(frame_to_rhino_plane(grasp_frame))

            assembly_method = beam.attributes.get("assembly_method")
            assembly_method_text.append(assembly_method)

            # if assembly_method == "special_case":
            #     assembly_color.append(Color.Blue)

            # elif assembly_method == "crane_lift_human_align_screw":
            #     assembly_color.append(Color.Red)

            # elif assembly_method == "human_place_human_screw":
            #     assembly_color.append(Color.Yellow)

            # elif assembly_method == "robot_place_hold_human_screw":
            #     assembly_color.append(Color.Green)

            # else:
            #     assembly_color.append(Color.White)

            assembly_method = beam.attributes.get("level")
            if assembly_method == 1:
                assembly_color.append(Color.Blue)

            elif assembly_method == 2:
                assembly_color.append(Color.Red)

            elif assembly_method == 0:
                assembly_color.append(Color.Green)

            else:
                assembly_color.append(Color.White)

            sorting_point = beam.attributes.get("sorting_points")

            if sorting_point is not None:
                sorting_points.append(point_to_rhino(sorting_point))

    # ========================================================
    # beams longer than 5 m
    # ========================================================
    if length > 5.0:
        long_beams.append(geo)
        long_beams_blank.append(geo_blank)

    # ========================================================
    # beams heavier than 45 kg
    # ========================================================
    if milled_weight > 45.0:
        heavy_beams.append(geo)

# ============================================================
# convert collected edge nodes to Grasshopper text outputs
# ============================================================
for node_id, node_pt in node_points_by_id.items():
    edge_node_points.append(point_to_rhino(node_pt))
    edge_node_text.append("{}".format(node_id))
# ---------- end python_3_script_9 ----------

# ----
plane_2 = Plane(python_3_script_9.grasp_frames)
list_length_3 = ListLength(List=python_3_script_9.geometry)
panel_16 = Panel(list_length_3)
weight_per_module_plate_area_kg_m2 = Panel(panel_m2_2)  # disabled
colour_swatch_3 = ColourSwatch(SwatchColor=RGB(0, 0, 0))
draw_4 = COMPASDraw(cg=python_3_script_9.long_beams)  # -> rg; same code as compas_draw
draw_5 = COMPASDraw(cg=python_3_script_9.long_beams_blank)  # -> rg; same code as compas_draw
geometry = COMPASDraw(cg=python_3_script_9.geometry)  # -> rg; same code as compas_draw
sequence_geo = COMPASDraw(cg=python_3_script_9.sequence_geo)  # -> rg; same code as compas_draw
point = Point(python_3_script_9.sorting_points)
geometry_2 = CustomPreview(Geometry=geometry, Material=ColourSwatch(SwatchColor=RGB(196, 163, 112)))
sequence_geo_2 = CustomPreview(Geometry=sequence_geo, Material=python_3_script_9.assembly_color)
sequence_geo_3 = CustomPreview(Geometry=sequence_geo, Material=ColourSwatch(SwatchColor=RGB(196, 163, 112)))
geometry_3 = CustomPreview(Geometry=point, Material=ColourSwatch(SwatchColor=RGB(0, 0, 0)))
beam_name = TextTag(Location=python_3_script_9.beam_name_point, Text=python_3_script_9.beam_name_text, Colour=colour_swatch_3)
assembly_method = TextTag(Location=python_3_script_9.beam_name_point, Text=python_3_script_9.assembly_method_text, Colour=colour_swatch_3)
node = TextTag(
    Location=python_3_script_9.edge_node_points,
    Text=python_3_script_9.edge_node_text,
    Colour=ColourSwatch(SwatchColor=RGB(0, 0, 0)))
dot_display = DotDisplay(Point=python_3_script_9.edge_node_points, Colour=ColourSwatch(SwatchColor=RGB(240, 151, 151)), Size="0.1")

# ---- group: module height
group_2 = Group(Geometry=python_3_script_9.geometry)
bounding_box_2 = BoundingBox(Content=group_2, Plane=PlaneXY(0, 0, 0))  # -> Box, Box_2
box_corners_2 = BoxCorners(Box=bounding_box_2.Box)  # -> CornerA, CornerB, CornerC, CornerD, CornerE, CornerF, CornerG, CornerH
line_5 = Line(StartPoint=box_corners_2.CornerA, EndPoint=box_corners_2.CornerE)
linear_dimension_5 = LinearDimension(Line=line_5, PointA=box_corners_2.CornerA, PointB=box_corners_2.CornerE, Text="{0:0.000}", Size="0.5")

# ----
working_space_rfl = Geometry([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])

# ---- group: beam that are longer than 5 m
deconstruct_brep_2 = DeconstructBrep(Brep=draw_5)  # -> Faces, Edges, Vertices
custom_preview_5 = CustomPreview(Geometry=draw_4, Material=ColourSwatch(SwatchColor=RGB(0, 0, 150)))
list_item_3 = ListItem(List=deconstruct_brep_2.Vertices, Index="0", Wrap=True)
list_item_4 = ListItem(List=deconstruct_brep_2.Vertices, Index="1", Wrap=True)
line_6 = Line(StartPoint=list_item_3, EndPoint=list_item_4)
# biggest and smallest
# ATTRIBUTED : DRILL
# 
# 1. which beam is robot
# 2. grasp_frame + metal thingy that attatched to the beam size
# 3. location of the hole
panel_17 = Panel("0.5")
linear_dimension_6 = LinearDimension(Line=line_6, PointA=list_item_3, PointB=list_item_4, Text="{0:0.000}", Size=panel_17)

# ---- group: beam that are heavier than 45 kg
draw_6 = COMPASDraw(cg=python_3_script_9.heavy_beams)  # -> rg; same code as compas_draw
list_length_4 = ListLength(List=draw_6)
custom_preview_6 = CustomPreview(Geometry=draw_6, Material=ColourSwatch(SwatchColor=RGB(255, 0, 0)))

# ----
human_scale = Geometry(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)
custom_preview_7 = CustomPreview(Geometry=working_space_rfl, Material=ColourSwatch(SwatchColor=RGBA(120, 98, 98, 216)))
custom_preview_8 = CustomPreview(Geometry=human_scale, Material=ColourSwatch(SwatchColor=RGB(217, 178, 178)))
num_of_beam_45_kg_2 = Panel(list_length_4)
