# Grasshopper definition line_model_edit.ghx (Grasshopper 1.0.8)
# plug-ins: Pufferfish, Human

range = Range(Domain=Domain(0, 1), Steps="3")
range_2 = Range(Domain=Domain(0, 1), Steps="3")
range_3 = Range(Domain=Domain(0, 1), Steps="3")
range_4 = Range(Domain=Domain(0, 1), Steps="3")
graph_mapper = GraphMapper(
    range_2,
    x0=0,
    x1=1,
    y0=0,
    y1=1,
    container_name="Bezier",
    cpx=[0, 0.415862143, 0.940971911, 1],
    cpy=[0, 0.0582934618, 0.3582203984, 1])
graph_mapper_2 = GraphMapper(
    range_3,
    x0=0,
    x1=1,
    y0=0,
    y1=1,
    container_name="Bezier",
    cpx=[0, 0.415862143, 0.940971911, 1],
    cpy=[0, 0.0582934618, 0.3582203984, 1])
graph_mapper_3 = GraphMapper(
    range,
    x0=0,
    x1=1,
    y0=0,
    y1=1,
    container_name="Bezier",
    cpx=[0, 0.415862143, 0.940971911, 1],
    cpy=[0, 0.0582934618, 0.3582203984, 1])
graph_mapper_4 = GraphMapper(
    range_4,
    x0=0,
    x1=1,
    y0=0,
    y1=1,
    container_name="Bezier",
    cpx=[0, 0.415862143, 0.8706001639, 1],
    cpy=[0, 0.0582934618, 0.2888201475, 1])

entwine = Entwine(Branch00=graph_mapper_4, Branch01=graph_mapper_2, Branch02=graph_mapper, Branch03=graph_mapper_3, FlattenInputs=True)  # -> simplify(Result)
panel = Panel("modify points")
number_slider = Slider(0, range=0..3)
# grasp_frames, sequence,
# assembly_method
module_id = ValueList({"0", "1", "6": 2, "7": 3}, selected="1")
sequence = Slider(56, range=0..56)
panel_2 = Panel("""0
1
6
7""")
unit_z = UnitZ(Factor="0.1")
colour_swatch = ColourSwatch(SwatchColor=RGB(0, 0, 0))
human_scale = Geometry(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)
working_space_rfl = Geometry([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])
custom_preview = CustomPreview(Geometry=working_space_rfl, Material=ColourSwatch(SwatchColor=RGB(120, 98, 98)))
custom_preview_2 = CustomPreview(Geometry=human_scale, Material=ColourSwatch(SwatchColor=RGB(217, 178, 178)))

brep = Brep([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])

mesh_naked_edges = MeshNakedEdges(Mesh=brep)  # -> Naked, ResultBoolean
area = Area(Geometry=mesh_naked_edges.Naked)  # -> Area, Centroid
panel_3 = Panel(area.Area)
multiplication = Multiplication(A=area.Area, B="470")
panel_4 = Panel(multiplication)

# ----
# create and manipulate graph
point = Point([Point(2.7, 7.810000534, 0), Point(0.3, 1.810000534, 0), Point(2.7, 1.810000534, 0), Point(0.3, 7.810000534, 0)])

point_2 = Point(point)

python_3_script = Python3Script(roof_breps=brep, supports=point_2, z_steps=entwine)  # -> out, ridges_tree, all_edges, graph, all_nodes, node_keys; inputs roof_breps: list of Brep, supports: list of Point3d, z_steps: tree of Double
# ---------- python_3_script: Python ----------
import os
import sys
from compas_rhino import unload_modules
import compas
compas.PRECISION = ".3f"

gh_dir = os.path.dirname(ghenv.Component.OnPingDocument().FilePath)
sys.path.append(gh_dir)

import tree_builder
import nodegraph
import importlib

importlib.reload(nodegraph)
importlib.reload(tree_builder)


from tree_builder import build_tree_graph_from_breps
from Grasshopper import DataTree
from Grasshopper.Kernel.Data import GH_Path

# lines_tree will be our output
lines_tree = DataTree[object]()
z_tree = []
# 1. Iterate using the Branch count
for i in range(z_steps.BranchCount):
    branch = list(z_steps.Branch(i)) 
    z_tree.append(branch)

# CONSTANTS #
div_x = 3
div_y = 3
num_levels = 3

inset_edge = 0.5
inset_interior = 0.5

# Build the graph (all logic is in tree_builder.py)
ng = build_tree_graph_from_breps(
    supports=supports,
    input_breps=roof_breps,
    div_x=div_x if div_x else 8,
    div_y=div_y if div_y else 6,
    num_levels=num_levels if num_levels else 4,
    z_steps=z_tree,
    inset_edge=inset_edge if inset_edge else 0.5,
    inset_interior=inset_interior if inset_interior else 0.4,
    reach_tol=0.05,
    debug=True
)

# Outputs
all_edges = ng.edge_lines()
graph = ng
all_nodes = ng.node_points()
node_keys = list(ng.nodes())
# ---------- end python_3_script ----------
compas_draw = COMPASDraw(cg=python_3_script.all_nodes)  # -> rg
#   port cg: The COMPAS geometry or datastructure to be drawn.
#   port rg: The Rhino geometry object.
# ---------- compas_draw: Python ----------
# r: compas>=2.14.1
"""
Draws COMPAS geometry in Grasshopper.
"""

from typing import Any

import Grasshopper

from compas.scene import SceneObject


class CompasToRhinoGeometry(Grasshopper.Kernel.GH_ScriptInstance):
    def RunScript(self, cg):
        if not cg:
            return None

        return SceneObject(item=cg).draw()
# ---------- end compas_draw ----------
compas_draw_2 = COMPASDraw(cg=python_3_script.all_edges)  # -> rg; same code as compas_draw

# ----
# transform points
brep_2 = Brep(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)
python_3_script_2 = Python3Script(graph=python_3_script.graph, repellors=brep_2)  # -> out, edges, nodes, node_graph; inputs repellors: list of Brep
# ---------- python_3_script_2: Python ----------
import os, sys, importlib
gh_dir = os.path.dirname(ghenv.Component.OnPingDocument().FilePath)
if gh_dir not in sys.path:
    sys.path.insert(0, gh_dir)

### -----------------------------
## IMPORT
### -----------------------------
import nodegraph

importlib.reload(nodegraph)

from copy import deepcopy
from compas.geometry import Vector, Line, Point, centroid_points

ng = deepcopy(graph)



ng, results = ng.move_nodes_from_geometry(
    repellors,               # Mix of anything
    max_distance = 2.0,
    strength = 2,
    falloff = "smooth"
)

# Outputs
node_graph = ng
edges = ng.edge_lines()
nodes = ng.node_points()
moved_pts = [r['new'] for r in results.values()]
# ---------- end python_3_script_2 ----------

# ----
# classify edges
python_3_script_3 = Python3Script(graph=python_3_script_2.node_graph)  # -> out, primary_lines, secondary_lines, graph_out
# ---------- python_3_script_3: Python ----------
import os, sys, importlib

gh_dir = os.path.dirname(ghenv.Component.OnPingDocument().FilePath)
if gh_dir not in sys.path:
    sys.path.insert(0, gh_dir)

import edge_classifier
importlib.reload(edge_classifier)
from edge_classifier import classify_edges_by_support_direction

primary_lines, secondary_lines, data = classify_edges_by_support_direction(graph, debug=True)

# output 
graph_out = graph
# ---------- end python_3_script_3 ----------

# ----
# preview graph
number_slider_2 = Slider(0.1, range=-0.5..0.5)
compas_draw_3 = COMPASDraw(cg=python_3_script_2.edges)  # -> rg; same code as compas_draw
compas_draw_4 = COMPASDraw(cg=python_3_script_2.nodes)  # -> rg; same code as compas_draw
dot_display = DotDisplay(Point=compas_draw_4, Colour=ColourSwatch(SwatchColor=RGB(128, 128, 128)), Size=number_slider_2)

custom_preview_lineweights = CustomPreviewLineweights(
    Geometry=compas_draw_3,
    Shader=ColourSwatch(SwatchColor=RGB(144, 209, 232)),
    Thickness=Slider(4, range=0..10),
    Absolute=False)

# ----
# shifting and add shoes
py3 = Python3Script(graph=python_3_script_3.graph_out)  # -> out, nodegraph, a
# ---------- py3: Python ----------
import os, sys, importlib

gh_dir = os.path.dirname(ghenv.Component.OnPingDocument().FilePath)
if gh_dir not in sys.path:
    sys.path.insert(0, gh_dir)

import edge_classifier
import reciprocal
import line_constraints

importlib.reload(edge_classifier)
importlib.reload(reciprocal)
importlib.reload(line_constraints)

# 1) classify
primary_lines, secondary_lines, data = edge_classifier.classify_edges_by_support_direction(graph, debug=True)

# 2) build explicit primary edge list from classification data
primary_edges = [d["edge"] for d in data if d.get("type") in ("primary", "double")]

# 3) reciprocal only those edges
res_ortho = reciprocal.reciprocal_width_from_subgraph(
    graph,                      # or your subgraph if that's what you want to modify
    target_edges=primary_edges, # key change
    engage_len=0.11,
    tol=0.1,
    rotation_sign=-1,
    min_degree=3,
    iterations=5,
    debug=True,
)

nodegraph = res_ortho["graph"]
a = res_ortho["shifted_lines"]
# ---------- end py3 ----------
draw = COMPASDraw(cg=py3.a)  # -> rg; same code as compas_draw
python_3_script_4 = Python3Script(graph=py3.nodegraph)  # -> out, graph_out, shoe_lines
# ---------- python_3_script_4: Python ----------
import os, sys, importlib
gh_dir = os.path.dirname(ghenv.Component.OnPingDocument().FilePath)
if gh_dir not in sys.path:
    sys.path.insert(0, gh_dir)


import leaf_solver
importlib.reload(leaf_solver)
from leaf_solver import create_shoes_from_graph
from copy import deepcopy



ng = deepcopy(graph)
result = create_shoes_from_graph(ng, extension_length = 0.20)

shoe_lines = result["shoe_lines"]
graph_out = ng
# ---------- end python_3_script_4 ----------
draw_2 = COMPASDraw(cg=python_3_script_4.shoe_lines)  # -> rg; same code as compas_draw

offset_surface = OffsetSurface(Surface=brep, Distance=Slider(0.06, range=0..0.1), BothSides=0, CreateSolid=True)
ct_beam = CTBeam(centerline=compas_draw_3, width=Slider(0.1, range=0..0.1), height=Slider(0.12, range=0..1))  # -> Beam, Blank; inputs centerline: list, z_vector: list of Vector3d, width: list of Double, height: list of Double, category: list of String, updateRefObj: Boolean
#   port centerline: Referenced curve or line, Guid of curve or line in the active Rhino document.
#   port z_vector: Vector defining the orientation of the cross-section (corresponds to the height dimension). If None, a default will be taken.
#   port width: Width of the cross-section (usually the smaller dimension).
#   port height: Height of the cross-section (usually the larger dimension).
#   port category: Category of a beam.
#   port updateRefObj: (optional) If True, the attributes in the referenced object will be updated/overwritten with the new values given here.
#   port Beam: Beam object(s).
#   port Blank: Shape of the beam's blank.
# ---------- ct_beam: Python ----------
# env: E:\ETH_DFAB\UPDATED_github\timber_design\src
# r: compas_timber>=0.16.2
"""Creates a Beam from a LineCurve."""

# flake8: noqa
import Grasshopper
import Rhino
import rhinoscriptsyntax as rs
import System
from compas.scene import Scene
from compas_rhino.conversions import line_to_compas
from compas_rhino.conversions import vector_to_compas

from compas_timber.elements import Beam as CTBeam
from timber_design.ghpython.ghcomponent_helpers import list_input_valid_cpython


class Beam_fromCurve(Grasshopper.Kernel.GH_ScriptInstance):
    def RunScript(self,
            centerline: System.Collections.Generic.List[object],
            z_vector: System.Collections.Generic.List[Rhino.Geometry.Vector3d],
            width: System.Collections.Generic.List[float],
            height: System.Collections.Generic.List[float],
            category: System.Collections.Generic.List[str],
            updateRefObj: bool):
        # minimum inputs required
        if not list_input_valid_cpython(ghenv, centerline, "Centerline"):
            return
        if not width:
            length = self._get_centerline_length(centerline)
            width = [length / 20]
        if not height:
            length = self._get_centerline_length(centerline)
            height = [length / 10]

        # reformat unset parameters for consistency
        if not z_vector:
            z_vector = [None]
        if not category:
            category = [None]

        beams = []
        blanks = []
        scene = Scene()

        if centerline and height and width:
            # check list lengths for consistency
            N = len(centerline)
            if len(z_vector) not in (0, 1, N):
                ghenv.Component.AddRuntimeMessage(
                    Grasshopper.Kernel.GH_RuntimeMessageLevel.Error, " In 'ZVector' I need either none, one or the same number of inputs as the Crv parameter."
                )
            if len(width) not in (1, N):
                ghenv.Component.AddRuntimeMessage(Grasshopper.Kernel.GH_RuntimeMessageLevel.Error, " In 'W' I need either one or the same number of inputs as the Crv parameter.")
            if len(height) not in (1, N):
                ghenv.Component.AddRuntimeMessage(Grasshopper.Kernel.GH_RuntimeMessageLevel.Error, " In 'H' I need either one or the same number of inputs as the Crv parameter.")
            if len(category) not in (0, 1, N):
                ghenv.Component.AddRuntimeMessage(
                    Grasshopper.Kernel.GH_RuntimeMessageLevel.Error, " In 'Category' I need either none, one or the same number of inputs as the Crv parameter."
                )

            # duplicate data if None or single value
            if len(z_vector) != N:
                z_vector = [z_vector[0] for _ in range(N)]
            if len(width) != N:
                width = [width[0] for _ in range(N)]
            if len(height) != N:
                height = [height[0] for _ in range(N)]
            if len(category) != N:
                category = [category[0] for _ in range(N)]

            for line, z, w, h, c in zip(centerline, z_vector, width, height, category):
                guid, geometry = self._get_guid_and_geometry(line)
                rhino_line = rs.coerceline(geometry)
                line = line_to_compas(rhino_line)

                z = vector_to_compas(z) if z else None
                beam = CTBeam.from_centerline(centerline=line, width=w, height=h, z_vector=z)
                beam.attributes["rhino_guid"] = str(guid) if guid else None
                beam.attributes["category"] = c


                beams.append(beam)
                scene.add(beam.blank)

        blanks = scene.draw()

        return beams, blanks

    def _get_guid_and_geometry(self, line):
        # internalized curves and GH geometry will not have persistent GUIDs, referenced Rhino objects will
        # type hint on the input has to be 'ghdoc' for this to work
        guid = None
        geometry = line
        rhino_obj = Rhino.RhinoDoc.ActiveDoc.Objects.FindId(line)
        if rhino_obj:
            guid = line
            geometry = rhino_obj.Geometry
        return guid, geometry

    def _get_centerline_length(self, centerline):
        centerline_length = []
        for i in centerline:
            centerline_length.append(rs.CurveLength(i))
        if centerline_length:
            length_average = sum(centerline_length) / len(centerline_length)
        else:
            length_average = 1
        return length_average
# ---------- end ct_beam ----------
volume = Volume(Geometry=ct_beam.Blank)  # -> Volume, Centroid
mass_addition = MassAddition(Input=volume.Volume)  # -> Result, PartialResults
relay = Relay([ct_beam.Blank, offset_surface])
custom_preview_3 = CustomPreview(Geometry=relay, Material=ColourSwatch(SwatchColor=RGB(219, 206, 167)))
panel_5 = Panel(mass_addition.Result)

# ----
# Classfiy Edges
# op1 rotate
# op2 choose 1 to be primary and shift others
# op3 use design, cut diagonal
python_3_script_5 = Python3Script(graph=python_3_script_4.graph_out)  # -> out, primary_lines, secondary_lines, tertiary_lines, nodes_pts, nodes_idx, chosen_edge_lines, graph_out
# ---------- python_3_script_5: Python ----------
import os, sys, importlib

gh_dir = os.path.dirname(ghenv.Component.OnPingDocument().FilePath)
if gh_dir not in sys.path:
    sys.path.insert(0, gh_dir)

import edge_classifier
importlib.reload(edge_classifier)
from edge_classifier import classify_edges_by_support_direction, create_subgraphs
from compas.geometry import Line

primary_lines, secondary_lines, tertiary_lines, data, node_edge_report = classify_edges_by_support_direction(
    graph,
    return_tertiary=True,
    return_node_edge_report=True
)
edge_to_idx = {}
for i, (u, v) in enumerate(graph.edges()):
    edge_to_idx[frozenset((u, v))] = i

# outputs debug
nodes_pts = []       # points
nodes_idx = []       # node ids 
chosen_edge_lines = []  # choosen edge as Line


for r in node_edge_report:
    n = r["node"]
    e = r["seed_edge"]  

    # node point + node id
    p = graph.node_attribute(n, "point")
    nodes_pts.append(p)
    nodes_idx.append(n)

    # chosen edge as line + edge idx
    u, v = e
    pu = graph.node_attribute(u, "point")
    pv = graph.node_attribute(v, "point")
    chosen_edge_lines.append(Line(pu, pv) if (pu and pv) else None)

# output 
graph_out = graph
# ---------- end python_3_script_5 ----------
draw_3 = COMPASDraw(cg=python_3_script_5.primary_lines)  # -> rg; same code as compas_draw
draw_4 = COMPASDraw(cg=python_3_script_5.secondary_lines)  # -> rg; same code as compas_draw
draw_5 = COMPASDraw(cg=python_3_script_5.tertiary_lines)  # -> rg; same code as compas_draw
draw_6 = COMPASDraw(cg=python_3_script_5.nodes_pts)  # -> rg; same code as compas_draw
draw_7 = COMPASDraw(cg=python_3_script_5.chosen_edge_lines)  # -> rg; same code as compas_draw
custom_preview_lineweights_2 = CustomPreviewLineweights(Geometry=draw_3, Shader=ColourSwatch(SwatchColor=RGB(137, 50, 143)), Thickness="8", Absolute=False)
custom_preview_lineweights_3 = CustomPreviewLineweights(Geometry=draw_4, Shader=ColourSwatch(SwatchColor=RGB(50, 143, 103)), Thickness="6", Absolute=False)
custom_preview_lineweights_4 = CustomPreviewLineweights(Geometry=draw_5, Shader=ColourSwatch(SwatchColor=RGB(218, 157, 103)), Thickness="6", Absolute=False)

draw_8 = COMPASDraw(cg=python_3_script_3.secondary_lines)  # -> rg; same code as compas_draw
draw_9 = COMPASDraw(cg=python_3_script_3.primary_lines)  # -> rg; same code as compas_draw
custom_preview_lineweights_5 = CustomPreviewLineweights(Geometry=draw_9, Shader=ColourSwatch(SwatchColor=RGB(137, 50, 143)), Thickness="8", Absolute=False)
custom_preview_lineweights_6 = CustomPreviewLineweights(Geometry=draw_8, Shader=ColourSwatch(SwatchColor=RGB(50, 143, 103)), Thickness="6", Absolute=False)

swatch = ColourSwatch(SwatchColor=RGB(51, 56, 66))
text_tag = TextTag(Location=draw_6, Text=python_3_script_5.nodes_idx, Colour=swatch)
dot_display_2 = DotDisplay(Point=draw_6, Colour=swatch, Size=Slider(0.1, range=0..0.1))

py3_2 = Python3Script(graph=python_3_script_5.graph_out)  # -> out, a, b, c, d, e, f, h, edges, g
# ---------- py3_2: Python ----------
import os, sys, importlib

gh_dir = os.path.dirname(ghenv.Component.OnPingDocument().FilePath)
if gh_dir not in sys.path:
    sys.path.insert(0, gh_dir)

import edge_classifier
import reciprocal
import line_constraints

from compas.geometry import Line, Point

importlib.reload(edge_classifier)
importlib.reload(reciprocal)
importlib.reload(line_constraints)

# -----------------------------
# controls
# -----------------------------
sign_primary = -1
sign_secondary = -1
engage_len = 0.11
tol = 0.1
iters = 5

# -----------------------------
# helpers
# -----------------------------
def _dist(p, q):
    return ((p.x - q.x)**2 + (p.y - q.y)**2 + (p.z - q.z)**2) ** 0.5

def _edge_line(g, e):
    # prefer shifted, then committed line, then fallback from node points
    ln = g.edge_attribute(e, "shifted_lines")
    if isinstance(ln, Line):
        return ln
    ln = g.edge_attribute(e, "line")
    if isinstance(ln, Line):
        return ln
    if ln:
        return Line(Point(*ln[0]), Point(*ln[1]))
    u, v = e
    pu = g.node_attribute(u, "point")
    pv = g.node_attribute(v, "point")
    return Line(pu, pv) if pu and pv else None

def sync_node_points_from_edges(g, edges):
    """
    Sync node 'point' from current edge geometry (line/shifted_lines).
    Uses best endpoint-node matching per edge, then averages per node.
    """
    acc = {}  # node -> [Point,...]

    for e in edges:
        u, v = e
        ln = _edge_line(g, e)
        if ln is None:
            continue

        pu = g.node_attribute(u, "point")
        pv = g.node_attribute(v, "point")
        if pu is None or pv is None:
            continue

        # choose endpoint mapping that best matches current node positions
        s, t = ln.start, ln.end
        score_uv = _dist(s, pu) + _dist(t, pv)
        score_vu = _dist(t, pu) + _dist(s, pv)

        if score_uv <= score_vu:
            mu, mv = s, t
        else:
            mu, mv = t, s

        acc.setdefault(u, []).append(mu)
        acc.setdefault(v, []).append(mv)

    for n, pts in acc.items():
        if not pts:
            continue
        x = sum(p.x for p in pts) / len(pts)
        y = sum(p.y for p in pts) / len(pts)
        z = sum(p.z for p in pts) / len(pts)
        g.node_attribute(n, "point", Point(x, y, z))

def edges_by_hierarchy(g, h):
    return [e for e in g.edges() if g.edge_attribute(e, "hierarchy") == h]

# -----------------------------
# 1) classify
# -----------------------------
primary_lines, secondary_lines, tertiary_lines, data = edge_classifier.classify_edges_by_support_direction(
    graph,
    debug=False,
    return_tertiary=True
)

for d0 in data:
    e0 = d0["edge"]
    t0 = d0.get("type")
    if t0 in ("primary", "secondary", "tertiary", "double"):
        graph.edge_attribute(e0, "hierarchy", "primary" if t0 == "double" else t0)

# -----------------------------
# 2) reciprocal primary
# -----------------------------
primary_edges = [d0["edge"] for d0 in data if d0.get("type") in ("primary", "double")]

res_primary = reciprocal.reciprocal_width_from_subgraph(
    graph,
    target_edges=primary_edges,
    engage_len=engage_len,
    tol=tol,
    rotation_sign=sign_primary,
    min_degree=3,
    iterations=iters,
    debug=False,
    straight_angle_threshold_deg=180.0
)
g = res_primary["graph"]

# -----------------------------
# 3) regenerate secondary + tertiary (level 1 up)
# -----------------------------
secon_1 = line_constraints.regenerate_edges(
    g,
    target_hierarchy="secondary",
    move_node_level=1,
    host_hierarchy="primary",
    choose="up",
    write_attribute=True,
    debug=False
)
line_constraints.commit_generated_lines(g, hierarchy_filter="secondary", clear_generated=True)

ters_1 = line_constraints.regenerate_edges(
    g,
    target_hierarchy="tertiary",
    move_node_level=1,
    host_hierarchy="primary",
    choose="up",
    write_attribute=True,
    debug=False
)
line_constraints.commit_generated_lines(g, hierarchy_filter="tertiary", clear_generated=True)

# IMPORTANT: sync node points from updated secondary geometry before secondary reciprocal
secondary_edges = edges_by_hierarchy(g, "secondary")
sync_node_points_from_edges(g, secondary_edges)

# -----------------------------
# 4) reciprocal secondary
# -----------------------------
res_secondary = reciprocal.reciprocal_width_from_subgraph(
    g,
    target_edges=secondary_edges,
    engage_len=engage_len,
    tol=tol,
    rotation_sign=sign_secondary,
    min_degree=3,
    iterations=iters,
    debug=False,
    straight_angle_threshold_deg=180.0
)
g = res_secondary["graph"]

# optional: keep nodes consistent after secondary reciprocal too
sync_node_points_from_edges(g, secondary_edges)

# -----------------------------
# 5) regenerate tertiary (level 0 up)
# -----------------------------
ters_0 = line_constraints.regenerate_edges(
    g,
    target_hierarchy="tertiary",
    move_node_level=0,
    host_hierarchy="secondary",
    choose="up",
    write_attribute=True,
    debug=False
)
line_constraints.commit_generated_lines(g, hierarchy_filter="tertiary", clear_generated=True)
ters_2 = line_constraints.regenerate_edges(
    g,
    target_hierarchy="tertiary",
    move_node_level=0,
    host_hierarchy="primary",
    choose="up",
    write_attribute=True,
    debug=False
)
line_constraints.commit_generated_lines(g, hierarchy_filter="tertiary", clear_generated=True)

# outputs
graph_out = g
edges = g.edge_lines()
a = res_primary["shifted_lines"]
b = res_secondary["shifted_lines"]
c = ters_0["generated_lines"]
d = ters_1["generated_lines"]
e = secon_1["generated_lines"]
f = ters_2["generated_lines"]
# ---------- end py3_2 ----------
draw_10 = COMPASDraw(cg=py3_2.f)  # -> rg; same code as compas_draw
draw_11 = COMPASDraw(cg=py3_2.a)  # -> rg; same code as compas_draw
draw_12 = COMPASDraw(cg=py3_2.b)  # -> rg; same code as compas_draw
draw_13 = COMPASDraw(cg=py3_2.c)  # -> rg; same code as compas_draw
draw_14 = COMPASDraw(cg=py3_2.d)  # -> rg; same code as compas_draw
draw_15 = COMPASDraw(cg=py3_2.e)  # -> rg; same code as compas_draw
draw_16 = COMPASDraw(cg=py3_2.edges)  # -> rg; same code as compas_draw

# ---- group: generate TimberModel
python_3_script_6 = Python3Script(
    graph_in=py3_2.g,
    plate_polylines=mesh_naked_edges.Naked,
    beam_width=Slider(0.1, range=0..0.1),
    beam_height=Slider(0.12, range=0..1),
    plate_thickness=Slider(0.06, range=0..0.1))  # -> out, final_models, module_beams, module_plates, shifted_lines, beam_attributes_text; inputs plate_polylines: tree of Polyline, beam_width: Double, beam_height: Double, plate_thickness: Double
# ---------- python_3_script_6: Python ----------
from compas_timber.model import TimberModel
from compas_timber.elements import Beam, Plate
from compas.tolerance import Tolerance
from compas.geometry import Line, Vector
from compas.geometry import is_point_in_polygon_xy
from compas_rhino.conversions import polyline_to_compas


# ============================================================
# outputs
# ============================================================
final_models = []

module_beams = []
module_plates = []

shifted_lines = []
beam_attributes_text = []
# ============================================================
# helper: flatten GH input
# ============================================================
def flatten_input(data):
    """Flatten normal lists, tuples, and GH DataTrees into a simple Python list."""

    items = []

    if data is None:
        return items

    # GH DataTree
    if hasattr(data, "Branches"):
        for branch in data.Branches:
            for item in branch:
                items.append(item)
        return items

    # Python list or tuple
    if isinstance(data, (list, tuple)):
        for item in data:
            if isinstance(item, (list, tuple)):
                items.extend(flatten_input(item))
            else:
                items.append(item)
        return items

    # single item
    items.append(data)
    return items

# ============================================================
# 1. flatten plate polylines input
# ============================================================
input_polylines = flatten_input(plate_polylines)

# ============================================================
# 2. convert plate polylines
# ============================================================
module_polylines = []
module_polygon_points = []

for poly in input_polylines:
    try:
        compas_poly = polyline_to_compas(poly)
    except:
        continue

    if compas_poly is None:
        continue

    pts = list(compas_poly.points)

    if len(pts) < 3:
        continue

    # remove duplicated last point if closed
    if pts[0] == pts[-1]:
        pts = pts[:-1]

    module_polylines.append(compas_poly)
    module_polygon_points.append(pts)

# ============================================================
# 3. create one TimberModel per plate polyline
# ============================================================
for module_index, compas_poly in enumerate(module_polylines):

    module_model = TimberModel(Tolerance(unit="M", absolute="0.001"))

    plate = Plate.from_outline_thickness(compas_poly,plate_thickness,Vector(0, 0, 1))

    plate.name = "plate"
    plate.attributes["module_index"] = module_index

    module_model.add_element(plate)

    final_models.append(module_model)
    module_beams.append([])
    module_plates.append([plate])

# ============================================================
# 4. sort graph lines into each TimberModel
# ============================================================
if graph_in:
    for edge in graph_in.edges():
        hierarchy = graph_in.edge_attribute(edge, "hierarchy")

        if hierarchy not in ["primary", "secondary", "tertiary"]:
            continue

        line = graph_in.edge_attribute(edge, "shifted_lines")

        if not isinstance(line, Line):
            line = graph_in.edge_attribute(edge, "line")

        if line is None:
            continue

        center = line.midpoint

        for module_index, polygon_pts in enumerate(module_polygon_points):
            if is_point_in_polygon_xy(center, polygon_pts):
                beam = Beam.from_centerline(line,width=beam_width,height=beam_height)

                beam.name = hierarchy

                beam.attributes["edge"] = edge
                beam.attributes["module_index"] = module_index

                beam_attributes_text.append(
                    "beam name: {} | module_index: {} | edge: {}".format(
                        beam.name,
                        beam.attributes.get("module_index"),
                        beam.attributes.get("edge")
                    )
                )

                final_models[module_index].add_element(beam)
                module_beams[module_index].append(beam)
                shifted_lines.append(line)

                break
# ---------- end python_3_script_6 ----------

# ----
python_3_script_7 = Python3Script(final_models=python_3_script_6.final_models, module_index=Slider(0, range=0..3), show_all=Toggle(False))  # -> out, geometry, element_colors; inputs final_models: list, module_index: Int32
# ---------- python_3_script_7: Python ----------
from System.Drawing import Color

# ============================================================
# outputs
# ============================================================
geometry = []

beam_geometry = []
plate_geometry = []

element_text = []
element_points = []
element_colors = []

selected_model = None


# ============================================================
# defaults
# ============================================================
if show_all is None:
    show_all = False

if module_index is None:
    module_index = 0


# ============================================================
# colors per module index
# ============================================================
module_colors = [
    Color.FromArgb(230, 80, 80),     # module 0 - red
    Color.FromArgb(80, 160, 230),    # module 1 - blue
    Color.FromArgb(90, 200, 120),    # module 2 - green
    Color.FromArgb(240, 180, 70)     # module 3 - orange
]


# ============================================================
# helper
# ============================================================
def get_module_color(index):
    return module_colors[index % len(module_colors)]


# ============================================================
# choose which modules to show
# ============================================================
module_ids_to_show = []

if final_models:

    if show_all:
        module_ids_to_show = list(range(len(final_models)))

    else:
        if 0 <= module_index < len(final_models):
            module_ids_to_show = [module_index]
            selected_model = final_models[module_index]


# ============================================================
# collect geometry by module index
# ============================================================
for m_id in module_ids_to_show:

    module_model = final_models[m_id]
    module_color = get_module_color(m_id)

    # ------------------------------------------------------------
    # plates
    # ------------------------------------------------------------
    for plate in module_model.plates:

        try:
            geo = plate.geometry

            geometry.append(geo)
            plate_geometry.append(geo)

            # same colour as beams in this module
            element_colors.append(module_color)

            element_text.append("module {} | plate".format(m_id))
            element_points.append(plate.frame.point)

        except Exception as e:
            print("Plate error in module {}: {}".format(m_id, e))

    # ------------------------------------------------------------
    # beams
    # ------------------------------------------------------------
    for beam in module_model.beams:
        try:
            geo = beam.geometry

            geometry.append(geo)
            beam_geometry.append(geo)

            # same colour as plate in this module
            element_colors.append(module_color)

            name = beam.name
            if name is None:
                name = "beam"

            element_text.append(
                "module {} | {} | length = {:.2f} m".format(m_id,name,beam.length))

            element_points.append(beam.centerline.midpoint)

        except Exception as e:
            print("Beam error in module {}: {}".format(m_id, e))
# ---------- end python_3_script_7 ----------
panel_6 = Panel(python_3_script_6.final_models)
draw_17 = COMPASDraw(cg=python_3_script_7.geometry)  # -> rg; same code as compas_draw
line = Line([draw_11, draw_12, draw_13, draw_10, draw_2])
custom_preview_4 = CustomPreview(Geometry=draw_17, Material=python_3_script_7.element_colors)
beam = CTBeam(centerline=line, width=Slider(0.1, range=0..0.1), height=Slider(0.12, range=0..1))  # -> Beam, Blank; inputs centerline: list, z_vector: list of Vector3d, width: list of Double, height: list of Double, category: list of String, updateRefObj: Boolean
#   port centerline: Referenced curve or line, Guid of curve or line in the active Rhino document.
#   port z_vector: Vector defining the orientation of the cross-section (corresponds to the height dimension). If None, a default will be taken.
#   port width: Width of the cross-section (usually the smaller dimension).
#   port height: Height of the cross-section (usually the larger dimension).
#   port category: Category of a beam.
#   port updateRefObj: (optional) If True, the attributes in the referenced object will be updated/overwritten with the new values given here.
#   port Beam: Beam object(s).
#   port Blank: Shape of the beam's blank.
# ---------- beam: Python ----------
# env: C:\Users\jfrancisco\Documents\GitHub\timber_design\src
# r: compas_timber>=0.16.2
"""Creates a Beam from a LineCurve."""

# flake8: noqa
import Grasshopper
import Rhino
import rhinoscriptsyntax as rs
import System
from compas.scene import Scene
from compas_rhino.conversions import line_to_compas
from compas_rhino.conversions import vector_to_compas

from compas_timber.elements import Beam as CTBeam
from timber_design.ghpython.ghcomponent_helpers import list_input_valid_cpython


class Beam_fromCurve(Grasshopper.Kernel.GH_ScriptInstance):
    def RunScript(self,
            centerline: System.Collections.Generic.List[object],
            z_vector: System.Collections.Generic.List[Rhino.Geometry.Vector3d],
            width: System.Collections.Generic.List[float],
            height: System.Collections.Generic.List[float],
            category: System.Collections.Generic.List[str],
            updateRefObj: bool):
        # minimum inputs required
        if not list_input_valid_cpython(ghenv, centerline, "Centerline"):
            return
        if not width:
            length = self._get_centerline_length(centerline)
            width = [length / 20]
        if not height:
            length = self._get_centerline_length(centerline)
            height = [length / 10]

        # reformat unset parameters for consistency
        if not z_vector:
            z_vector = [None]
        if not category:
            category = [None]

        beams = []
        blanks = []
        scene = Scene()

        if centerline and height and width:
            # check list lengths for consistency
            N = len(centerline)
            if len(z_vector) not in (0, 1, N):
                ghenv.Component.AddRuntimeMessage(
                    Grasshopper.Kernel.GH_RuntimeMessageLevel.Error, " In 'ZVector' I need either none, one or the same number of inputs as the Crv parameter."
                )
            if len(width) not in (1, N):
                ghenv.Component.AddRuntimeMessage(Grasshopper.Kernel.GH_RuntimeMessageLevel.Error, " In 'W' I need either one or the same number of inputs as the Crv parameter.")
            if len(height) not in (1, N):
                ghenv.Component.AddRuntimeMessage(Grasshopper.Kernel.GH_RuntimeMessageLevel.Error, " In 'H' I need either one or the same number of inputs as the Crv parameter.")
            if len(category) not in (0, 1, N):
                ghenv.Component.AddRuntimeMessage(
                    Grasshopper.Kernel.GH_RuntimeMessageLevel.Error, " In 'Category' I need either none, one or the same number of inputs as the Crv parameter."
                )

            # duplicate data if None or single value
            if len(z_vector) != N:
                z_vector = [z_vector[0] for _ in range(N)]
            if len(width) != N:
                width = [width[0] for _ in range(N)]
            if len(height) != N:
                height = [height[0] for _ in range(N)]
            if len(category) != N:
                category = [category[0] for _ in range(N)]

            for line, z, w, h, c in zip(centerline, z_vector, width, height, category):
                guid, geometry = self._get_guid_and_geometry(line)
                rhino_line = rs.coerceline(geometry)
                line = line_to_compas(rhino_line)

                z = vector_to_compas(z) if z else None
                beam = CTBeam.from_centerline(centerline=line, width=w, height=h, z_vector=z)
                beam.attributes["rhino_guid"] = str(guid) if guid else None
                beam.attributes["category"] = c


                beams.append(beam)
                scene.add(beam.blank)

        blanks = scene.draw()

        return beams, blanks

    def _get_guid_and_geometry(self, line):
        # internalized curves and GH geometry will not have persistent GUIDs, referenced Rhino objects will
        # type hint on the input has to be 'ghdoc' for this to work
        guid = None
        geometry = line
        rhino_obj = Rhino.RhinoDoc.ActiveDoc.Objects.FindId(line)
        if rhino_obj:
            guid = line
            geometry = rhino_obj.Geometry
        return guid, geometry

    def _get_centerline_length(self, centerline):
        centerline_length = []
        for i in centerline:
            centerline_length.append(rs.CurveLength(i))
        if centerline_length:
            length_average = sum(centerline_length) / len(centerline_length)
        else:
            length_average = 1
        return length_average
# ---------- end beam ----------
panel_7 = Panel(python_3_script_6.beam_attributes_text)

# ---- group: module height
group = Group(Geometry=draw_17)
bounding_box = BoundingBox(Content=group, Plane=PlaneXY(0, 0, 0))  # -> Box, Box_2
box_corners = BoxCorners(Box=bounding_box.Box)  # -> CornerA, CornerB, CornerC, CornerD, CornerE, CornerF, CornerG, CornerH
line_2 = Line(StartPoint=box_corners.CornerB, EndPoint=box_corners.CornerF)
line_3 = Line(StartPoint=box_corners.CornerA, EndPoint=box_corners.CornerB)
line_4 = Line(StartPoint=box_corners.CornerA, EndPoint=box_corners.CornerD)
linear_dimension = LinearDimension(Line=line_2, PointA=box_corners.CornerA, PointB=box_corners.CornerE, Text="{0:0.000}", Size="0.5")
linear_dimension_2 = LinearDimension(Line=line_3, PointA=box_corners.CornerA, PointB=box_corners.CornerB, Text="{0:0.000}", Size="0.5")
linear_dimension_3 = LinearDimension(Line=line_4, PointA=box_corners.CornerA, PointB=box_corners.CornerD, Text="{0:0.000}", Size="0.5")

# ---- group: informations
python_3_script_8 = Python3Script(final_models=python_3_script_6.final_models)  # -> out, heavy_beams, long_beams_blank, long_beams_length, long_beams, beam_info_tree, milled_beam_volume, milled_beam_weight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; inputs final_models: list
# ---------- python_3_script_8: Python ----------
# ============================================================
## volume each modules ###
# ============================================================
density = 470

total_beams_volume = []
total_beams_weight = []
total_plate_volume = []
total_plate_weight = []
number_of_beams = []
number_of_plates = []
milled_beam_volume = []
milled_beam_weight = []
plate_area = []

for module_model in final_models:
    total_volume_beam = 0.0
    total_weight_beam = 0.0
    total_volume_plate = 0.0
    total_weight_plate = 0.0

    total_milled_volume_beam = 0.0
    total_milled_weight_beam = 0.0

    total_plate_area = 0.0

    beam_count = 0

    for beam in module_model.beams:
        if not beam.attributes.get("neighbour", False):

            beam_count += 1

            beam_vol = beam.width * beam.height * beam.length
            beam_weight = beam_vol * density

            milled_volume = beam.geometry.volume
            milled_weight = milled_volume * density

    for plate in module_model.plates:
        plate_vol = plate.width * plate.length * plate.thickness
        plate_weight = plate_vol * density
        plate_ar = plate.width * plate.length

    total_beams_volume.append(beam_vol)
    total_beams_weight.append(beam_weight)
    total_plate_volume.append(plate_vol)
    total_plate_weight.append(plate_weight)

    number_of_beams.append(beam_count)
    number_of_plates.append(len(module_model.plates))

    milled_beam_volume.append(milled_volume)
    milled_beam_weight.append(milled_weight)

    plate_area.append(plate_ar)


# ============================================================
## each beam information ###
# ============================================================

from Grasshopper import DataTree
from Grasshopper.Kernel.Data import GH_Path

beam_info_tree = DataTree[object]()
long_beams_length = DataTree[object]()

all_lengths = []
all_weights = []

long_beams = []
long_beams_blank = []
heavy_beams = []

for i, module_model in enumerate(final_models):
    path = GH_Path(i)

    beam_info_tree.Add("module {}".format(i), path)

    for j, beam in enumerate(module_model.beams):
        length = beam.blank.dimensions[0]
        width = beam.blank.dimensions[1]
        height = beam.blank.dimensions[2]

        volume = beam.width * beam.height * beam.length
        weight = volume * density

        milled_volume = beam.geometry.volume
        milled_weight = milled_volume * density

        text = "beam {} | length = {:.3f} m | weight (milled) = {:.3f} kg | cross-section = {:.3f} x {:.3f} m".format(
            j, length, milled_weight, width, height
        )

        beam_info_tree.Add(text, path)

        # ============================================================
        # beams longer than 5 m
        # ============================================================
        if length > 5.0:
            long_beams.append(beam.geometry)
            long_beams_blank.append(beam.blank)

            text_length = "beam {} | length = {:.3f} m".format(j, length)
            long_beams_length.Add(text_length, path)

        # ============================================================
        # beams heavier than 45 kg
        # ============================================================
        if milled_weight > 45.0:
            heavy_beams.append(beam.geometry)
# ---------- end python_3_script_8 ----------

# ----
draw_18 = COMPASDraw(cg=python_3_script_8.long_beams)  # -> rg; same code as compas_draw

# ---- group: beam that are heavier than 45 kg
# overall information
draw_19 = COMPASDraw(cg=python_3_script_8.heavy_beams)  # -> rg; same code as compas_draw
custom_preview_5 = CustomPreview(Geometry=draw_19, Material=ColourSwatch(SwatchColor=RGB(255, 0, 0)))

# ----
custom_preview_6 = CustomPreview(Geometry=draw_18, Material=ColourSwatch(SwatchColor=RGB(0, 0, 150)))
beam_length_5_m = Panel(draw_18)
plate_area_m2 = Panel(python_3_script_8.plate_area)
beam_information = Panel(python_3_script_8.beam_info_tree)
total_beams_volume_m3 = Panel(python_3_script_8.milled_beam_volume)
total_beams_weight_kg = Panel(python_3_script_8.milled_beam_weight)
total_plates_volume_m3 = Panel(python_3_script_8.total_plate_volume)
total_plates_weight_kg = Panel(python_3_script_8.total_plate_weight)
number_of_beams = Panel(python_3_script_8.number_of_beams)
number_of_plates = Panel(python_3_script_8.number_of_plates)
list_length = ListLength(List=draw_19)
panel_8 = Panel(python_3_script_8.long_beams_length)
draw_20 = COMPASDraw(cg=python_3_script_8.long_beams_blank)  # -> rg; same code as compas_draw

# ---- group: add attributes (frames)
python_3_script_9 = Python3Script(final_models=python_3_script_6.final_models, module_id=number_slider)  # -> out, geometry, v_beam_faces, rhino_beam_frames, final_models_with_attributes, beam_index_text, beam_index_points; inputs final_models: list, module_id: Int32
# ---------- python_3_script_9: Python ----------
from compas.geometry import Frame, Vector, Rotation, Transformation
import math
from compas_rhino.conversions import plane_to_compas_frame, frame_to_rhino_plane, point_to_rhino

geometry = []

rhino_beam_frames = []
v_beam_faces = []

beam_indices = []
beam_sequence = []
beam_sequence_text = []
beam_sequence_points = []

beam_index_text = []
beam_index_points = []

final_models_with_attributes = final_models

# ============================================================
# Auto sequence based on beam.name, Z, Y, X, then edge connectivity
# ============================================================

name_order = {
    "tertiary": 0,
    "secondary": 1,
    "primary": 2
}

list_seq_auto = []

for module_model in final_models_with_attributes:

    # ------------------------------------------------------------
    # 1. prepare sortable beam data
    # ------------------------------------------------------------
    beam_data = []

    for i, beam in enumerate(module_model.beams):
        pt = beam.centerline.start
        beam_name = beam.name
        name_rank = name_order.get(beam_name, 99)

        edge = beam.attributes.get("edge")

        beam_data.append({
            "index": i,
            "beam": beam,
            "point": pt,
            "name_rank": name_rank,
            "edge": edge,
            "sort_key": (-pt.z, pt.y, pt.x, name_rank, i)
        })

    # sort first using your original rule
    beam_data.sort(key=lambda item: item["sort_key"])

    # ------------------------------------------------------------
    # 2. create unvisited beam list
    # ------------------------------------------------------------
    unvisited = list(beam_data)
    module_auto_sequence = []

    # ------------------------------------------------------------
    # 3. walk through connected edges
    # ------------------------------------------------------------
    while unvisited:

        # start from the highest-priority remaining beam
        current = unvisited.pop(0)
        module_auto_sequence.append(current["index"])

        current_edge = current["edge"]

        if current_edge is None:
            continue

        # choose one end as the current node
        # for edge (3, 7), this starts looking from node 7
        current_node = current_edge[1]

        while True:

            next_beam = None
            next_position = None

            # find the next unvisited beam connected to current_node
            for pos, candidate in enumerate(unvisited):
                candidate_edge = candidate["edge"]

                if candidate_edge is None:
                    continue

                if current_node in candidate_edge:
                    next_beam = candidate
                    next_position = pos
                    break

            # if no connected beam is found, stop this chain
            if next_beam is None:
                break

            # add next connected beam
            unvisited.pop(next_position)
            module_auto_sequence.append(next_beam["index"])

            # update current_node to the other end of the edge
            a, b = next_beam["edge"]

            if a == current_node:
                current_node = b
            else:
                current_node = a

    list_seq_auto.append(module_auto_sequence)

# ============================================================
# 1. Add grasp_frame, beam_index, sequence, and assembly_method to all modules
# ============================================================

for module_index, module_model in enumerate(final_models_with_attributes):
    if module_index < len(list_seq_auto):
        module_sequence = list_seq_auto[module_index]
    else:
        module_sequence = []

    for i, beam in enumerate(module_model.beams):
        beam.attributes["module_index"] = module_index
        beam.attributes["beam_index"] = i

        # ============================================================
        # Assembly method logic
        # ============================================================
        beam.attributes["assembly_method"] = None

        density = 470  # kg/m3

        beam_volume = beam.geometry.volume
        beam_weight = beam_volume * density
        beam_length = beam.blank_length

        beam.attributes["beam_weight"] = beam_weight
        beam.attributes["beam_length"] = beam_length

        # define limits
        robot_weight_limit = 45.0
        human_weight_limit = 5.0
        special_length_limit = 5.0

        # decide assembly method
        if beam_length > special_length_limit:
            assembly_method = "special_case"

        elif beam_weight > robot_weight_limit:
            assembly_method = "crane_lift_human_align_screw"

        elif beam_weight <= human_weight_limit:
            assembly_method = "human_place_human_screw"

        else:
            assembly_method = "robot_place_hold_human_screw"

        beam.attributes["assembly_method"] = assembly_method

        # ============================================================
        # Grasp frame
        # ============================================================

        beam_face = beam.side_as_surface(0)
        pick_up_point = beam_face.point_at(0.5, 0.5)

        beam_frame = beam.frame.copy()
        beam_frame.point = pick_up_point

        beam.attributes["grasp_frame"] = beam_frame

        # ============================================================
        # Sequence
        # ============================================================

        # normal individual sequence
        if i in module_sequence:
            sequence_number = module_sequence.index(i) + 1
            beam.attributes["sequence"] = sequence_number
        else:
            beam.attributes["sequence"] = None

    
# ============================================================
# 2. Visualize selected module
# ============================================================
if 0 <= module_id < len(final_models_with_attributes):
    module_model = final_models_with_attributes[module_id]

    # plates
    for plate in module_model.plates:
        geometry.append(plate.geometry)

    # beams
    for i, beam in enumerate(module_model.beams):
        if not beam.attributes.get("neighbour", False):
            geometry.append(beam.geometry)

            beam_index = beam.attributes.get("beam_index")
            module_index = beam.attributes.get("module_index")
            sequence_number = beam.attributes.get("sequence")

            beam_indices.append(beam_index)
            beam_sequence.append(sequence_number)

            beam_frame = beam.attributes.get("grasp_frame")

            if beam_frame:
                # plane visualization
                rhino_beam_frames.append(frame_to_rhino_plane(beam_frame))

                # face visualization
                beam_face = beam.side_as_surface(0)
                v_beam_faces.append(beam_face.to_mesh())

                # text tag point
                beam_index_points.append(point_to_rhino(beam.centerline.midpoint))

                # text tag content
                beam_index_text.append("index {}".format(beam_index))

                # optional: sequence text
                beam_sequence_points.append(point_to_rhino(beam_frame.point))

                if sequence_number is not None:
                    beam_sequence_text.append(
                        "seq {} | index {}".format(sequence_number, beam_index)
                    )
                else:
                    beam_sequence_text.append(
                        "no seq | index {}".format(beam_index)
                    )

            print(i, assembly_method)
# ---------- end python_3_script_9 ----------
list_length_2 = ListLength(List=python_3_script_9.geometry)
draw_21 = COMPASDraw(cg=python_3_script_9.geometry)  # -> rg; same code as compas_draw
draw_22 = COMPASDraw(cg=python_3_script_9.v_beam_faces)  # -> rg; same code as compas_draw
plane = Plane(python_3_script_9.rhino_beam_frames)
panel_9 = Panel(list_length_2)
custom_preview_7 = CustomPreview(
    Geometry=draw_21,
    Material={diffuse=RGB(221, 160, 221), emission=RGB(66, 48, 66), shine=0.5, specular=RGB(255, 255, 255), transparency=0})
custom_preview_8 = CustomPreview(Geometry=draw_22, Material=ColourSwatch(SwatchColor=RGB(242, 186, 0)))

# ----
list_length_3 = ListLength(List=beam_length_5_m)  # -> flatten(Length)
mass_addition_2 = MassAddition(Input=number_of_beams)  # -> Result, PartialResults
mass_addition_3 = MassAddition(Input=number_of_plates)  # -> Result, PartialResults
deconstruct_brep = DeconstructBrep(Brep=draw_20)  # -> Faces, Edges, Vertices
num_of_beam_45_kg = Panel(list_length)
totalnum_beam_length_5_m = Panel(list_length_3)
multiplication_2 = Multiplication(A=mass_addition_2.Result, B="4")
list_item = ListItem(List=deconstruct_brep.Vertices, Index="0", Wrap=True)
list_item_2 = ListItem(List=deconstruct_brep.Vertices, Index="1", Wrap=True)
panel_10 = Panel(python_3_script_9.final_models_with_attributes)
point_3 = Point(python_3_script_9.beam_index_points)
number_of_beams_2 = Panel(multiplication_2)
number_of_plates_2 = Panel(mass_addition_3.Result)
line_5 = Line(StartPoint=list_item, EndPoint=list_item_2)
linear_dimension_4 = LinearDimension(Line=line_5, PointA=list_item, PointB=list_item_2, Text="{0:0.000}", Size="0.5")
text_tag_2 = TextTag(
    Location=python_3_script_9.beam_index_points,
    Text=python_3_script_9.beam_index_text,
    Colour=ColourSwatch(SwatchColor=RGB(0, 0, 0)))

# ---- group: total_weight_per_module (kg)
panel_m2 = Expression(
    total_beams_weight_kg=total_beams_weight_kg,
    clt_panel_weight_kg=total_plates_weight_kg,
    Expression="total_beams_weight_kg+clt_panel_weight_kg")

# ----
total_weight_per_module_kg = Panel(panel_m2)

# ---- group: Area Density = Weight Per Module / Plate Area (kg/m2)
panel_m2_2 = Expression(total_weight_per_module=panel_m2, plate_area=plate_area_m2, Expression="total_weight_per_module/plate_area")

# ----
mass_addition_4 = MassAddition(Input=total_weight_per_module_kg)  # -> Result, PartialResults
multiplication_3 = Multiplication(A=mass_addition_4.Result, B="4")
total_weight_kg = Panel(multiplication_3)
weight_per_module_plate_area_kg_m2 = Panel(panel_m2_2)

# ---- group: move to RFL per module & visualize
x_axis = Slider(1.21, range=-10..10)
y_axis = Slider(0, range=-10..10)
surface = Surface(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)
plane_2 = Plane(surface)
move_point = MovePoint(geometry=plane_2, factor=x_axis, factor_2=y_axis, factor_3="0")
# visualize
python_3_script_10 = Python3Script(
    final_models=python_3_script_9.final_models_with_attributes,
    module_id=number_slider,
    t_frame=move_point,
    sequence=sequence)  # -> out, geometry, grasp_frames, heavy_beams, long_beams, long_beams_blank, v_beam_faces, beam_sequence_points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; inputs final_models: list, module_id: Int32, sequence: Int32
# ---------- python_3_script_10: Python ----------
from compas_timber.model import TimberModel
from compas.geometry import Frame, Vector, Rotation, Transformation
from compas_rhino.conversions import plane_to_compas_frame, frame_to_rhino_plane, point_to_rhino
from System.Drawing import Color

target_f = plane_to_compas_frame(t_frame)

geometry = []
grasp_frames = []
v_beam_faces = []

long_beams = []
long_beams_blank = []
heavy_beams = []

beam_sequence_points = []
beam_sequence_text = []

beam_name_point = []
beam_name_text = []

sequence_geo = []

assembly_method_text = []
assembly_color = []
plate_color = Color.LightGray

if 0 <= module_id < len(final_models):

    module_model = final_models[module_id]

    # ============================================================
    # create source frame from first plate
    # ============================================================
    source_f = None
    T = None

    if len(module_model.plates) > 0:

        plate = module_model.plates[0]

        plate_face = plate.side_as_surface(2)
        plate_midpoint = plate_face.point_at(0.5, 0.5)

        source_f = plate.frame.copy()
        source_f.point = plate_midpoint

        T = Transformation.from_frame_to_frame(source_f, target_f)

    if source_f and T:
        # ============================================================
        # plates geometry
        # ============================================================
        for plate in module_model.plates:

            geo = plate.geometry.copy()
            geo.transform(T)
            geometry.append(geo)
            sequence_geo.append(geo)
            assembly_color.append(plate_color)

        # ============================================================
        # beams geometry
        # ============================================================
        for i, beam in enumerate(module_model.beams):
            geo = beam.geometry.copy()
            geo.transform(T)

            geo_blank = beam.blank.copy()
            geo_blank.transform(T)

            geometry.append(geo)

            # ============================================================
            # beam name point and text
            # ============================================================
            name_point = beam.centerline.midpoint
            name_point.transform(T)

            beam_name_point.append(point_to_rhino(name_point))
            beam_name_text.append(beam.name)


            # ============================================================
            # beam information
            # ============================================================
            beam_index = beam.attributes.get("beam_index")
            sequence_number = beam.attributes.get("sequence")

            length = beam.blank_length

            milled_volume = beam.geometry.volume
            milled_weight = milled_volume * 470

            # ============================================================
            # sequence geometry from slider
            # ============================================================
            if sequence_number is not None and sequence_number <= sequence:

                sequence_geo.append(geo)

                # ========================================================
                # transformed grasp frame
                # ========================================================
                if "grasp_frame" in beam.attributes:

                    grasp_f = beam.attributes["grasp_frame"].copy()
                    grasp_f.transform(T)

                    grasp_frames.append(frame_to_rhino_plane(grasp_f))

                    # face visualization
                    beam_face = beam.side_as_surface(0)
                    beam_face.transform(T)
                    beam_faces = beam_face.to_mesh()
                    v_beam_faces.append(beam_faces)

                    beam_sequence_text.append(
                        "seq {} | index {}".format(sequence_number, beam_index)
                    )
                    
                    assembly_method = beam.attributes.get("assembly_method")
                    assembly_method_text.append(assembly_method)

                    if assembly_method == "special_case":
                        assembly_color.append(Color.Blue)

                    elif assembly_method == "crane_lift_human_align_screw":
                        assembly_color.append(Color.Red)

                    elif assembly_method == "human_place_human_screw":
                        assembly_color.append(Color.Yellow)

                    elif assembly_method == "robot_place_hold_human_screw":
                        assembly_color.append(Color.Green)

                    else:
                        assembly_color.append(Color.White)
                        
                # sequence point
                seq_point = beam.centerline.midpoint
                seq_point.transform(T)
                beam_sequence_points.append(point_to_rhino(seq_point))

            # ============================================================
            # beams longer than 5 m
            # ============================================================
            if length > 5.0:
                long_beams.append(geo)
                long_beams_blank.append(geo_blank)

            # ============================================================
            # beams heavier than 45 kg
            # ============================================================
            if milled_weight > 45.0:
                heavy_beams.append(geo)
# ---------- end python_3_script_10 ----------
list_length_4 = ListLength(List=python_3_script_10.geometry)
plane_3 = Plane(python_3_script_10.grasp_frames)

# ----
list_item_3 = ListItem(List=weight_per_module_plate_area_kg_m2, Index=panel_2, Wrap=True)
panel_11 = Panel(list_item_3)
panel_12 = Panel(list_length_4)
move = Move(Geometry=python_3_script_10.beam_sequence_points, Motion=unit_z)  # -> Geometry, Transform
v_beam_faces = COMPASDraw(cg=python_3_script_10.v_beam_faces)  # -> rg; same code as compas_draw
sequence_geo = COMPASDraw(cg=python_3_script_10.sequence_geo)  # -> rg; same code as compas_draw
geometry = COMPASDraw(cg=python_3_script_10.geometry)  # -> rg; same code as compas_draw
v_beam_faces_2 = CustomPreview(Geometry=v_beam_faces, Material=ColourSwatch(SwatchColor=RGB(255, 247, 0)))
geometry_2 = CustomPreview(
    Geometry=geometry,
    Material={diffuse=RGB(221, 160, 221), emission=RGB(66, 48, 66), shine=0.5, specular=RGB(255, 255, 255), transparency=0})
sequence_geo_2 = CustomPreview(Geometry=sequence_geo, Material=python_3_script_10.assembly_color)
beam_name = TextTag(Location=python_3_script_10.beam_name_point, Text=python_3_script_10.beam_name_text, Colour=colour_swatch)
assembly_method = TextTag(Location=move.Geometry, Text=python_3_script_10.assembly_method_text, Colour=colour_swatch)
beam_sequence = TextTag(Location=move.Geometry, Text=python_3_script_10.beam_sequence_text, Colour=ColourSwatch(SwatchColor=RGB(0, 0, 0)))
panel_13 = Panel(geometry)
draw_23 = COMPASDraw(cg=python_3_script_10.long_beams)  # -> rg; same code as compas_draw
draw_24 = COMPASDraw(cg=python_3_script_10.long_beams_blank)  # -> rg; same code as compas_draw

# ---- group: module height
group_2 = Group(Geometry=geometry)
bounding_box_2 = BoundingBox(Content=group_2, Plane=PlaneXY(0, 0, 0))  # -> Box, Box_2
box_corners_2 = BoxCorners(Box=bounding_box_2.Box)  # -> CornerA, CornerB, CornerC, CornerD, CornerE, CornerF, CornerG, CornerH
line_6 = Line(StartPoint=box_corners_2.CornerA, EndPoint=box_corners_2.CornerE)
linear_dimension_5 = LinearDimension(Line=line_6, PointA=box_corners_2.CornerA, PointB=box_corners_2.CornerE, Text="{0:0.000}", Size="0.5")

# ---- group: beam that are longer than 5 m
deconstruct_brep_2 = DeconstructBrep(Brep=draw_24)  # -> Faces, Edges, Vertices
custom_preview_9 = CustomPreview(Geometry=draw_23, Material=ColourSwatch(SwatchColor=RGB(0, 0, 150)))
list_item_4 = ListItem(List=deconstruct_brep_2.Vertices, Index="0", Wrap=True)
list_item_5 = ListItem(List=deconstruct_brep_2.Vertices, Index="1", Wrap=True)
line_7 = Line(StartPoint=list_item_4, EndPoint=list_item_5)
linear_dimension_6 = LinearDimension(Line=line_7, PointA=list_item_4, PointB=list_item_5, Text="{0:0.000}", Size="0.5")

# ---- group: beam that are heavier than 45 kg
draw_25 = COMPASDraw(cg=python_3_script_10.heavy_beams)  # -> rg; same code as compas_draw
list_length_5 = ListLength(List=draw_25)
custom_preview_10 = CustomPreview(Geometry=draw_25, Material=ColourSwatch(SwatchColor=RGB(255, 0, 0)))

# ----
num_of_beam_45_kg_2 = Panel(list_length_5)

# ==== cluster MovePoint
factor = ClusterInput()
factor_2 = ClusterInput()
unit_x = UnitX(Factor=factor)
unit_y = UnitY(Factor=factor_2)
geometry = ClusterInput()
move = Move(Geometry=geometry, Motion=unit_x)  # -> Geometry, Transform
factor_3 = ClusterInput()
move_2 = Move(Geometry=move.Geometry, Motion=unit_y)  # -> Geometry, Transform
unit_z = UnitZ(Factor=factor_3)
move_3 = Move(Geometry=move_2.Geometry, Motion=unit_z)  # -> Geometry, Transform
geometry_2 = ClusterOutput(move_3.Geometry)
