# Grasshopper definition modulization_rs_15042026.gh (Grasshopper 1.0.8)

# ---- group: input
line = Line([Line((159.9247373, 40.91188554, 23.75605153), (159.2588936, 39.57964905, 24.62354285)), Line((159.9247373, 40.91188554, 23.75605153), (160.590581, 39.57964905, 24.62354289)), Line((159.9247373, 40.91188554, 23.75605153), (160.7247451, 42.5101797, 24.5649313)), Line((159.9247373, 40.91188554, 23.75605153), (159.2588936, 42.24195882, 24.57029569)), Line((162.3297373, 40.91188554, 23.75605153), (161.6638936, 39.57964905, 24.62354291)), Line((162.3297373, 40.91188554, 23.75605153), (162.995581, 39.57964905, 24.62354295))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])
compas_timber = Python3Script(lines=line, width=Slider(0.08, range=0..1), height=Slider(0.24, range=0..1))  # -> out, geo, num_beams, biggest, smallest, model; inputs lines: list of Line, width: Double, height: Double
# ---------- compas_timber: Python ----------
from compas_timber.model import TimberModel
from compas_timber.elements import Beam
from compas_timber.connections import ConnectionSolver
from compas_timber.connections import JointTopology
from compas.geometry import Vector
import random
from compas_rhino.conversions import line_to_compas

# function to create beam
def create_beam(line, width, height, category, z_vector=None):
    beam = Beam.from_centerline(centerline=line, width=float(width), height=float(height))
    beam.attributes["category"] = category
    return beam

# save beams as a list
beams = [] 
for i,line in enumerate(lines):
    line = line_to_compas(line)
    height = random.choice([0.2,0.24,0.28])
    if height == 0.2:
        line.name = 'small'
    elif height == 0.24:
        line.name = 'medium'
    else:
        line.name = 'big'
    beam = create_beam(line, width, height, line.name)
    beams.append(beam)


# add beams to model
model = TimberModel()
[model.add_element(beam) for beam in beams]


# create a joint
from compas_timber.connections import XLapJoint, JointCandidate, TDovetailJoint, LFrenchRidgeLapJoint, TButtJoint, LMiterJoint, TStepJoint

def get_joint_type(topo, beam_a, beam_b):
    if topo == JointTopology.TOPO_T:
        return TButtJoint
    elif topo == JointTopology.TOPO_L:
        return JointCandidate
    elif topo == JointTopology.TOPO_X:
        return JointCandidate
    # elif topo == JointTopology.Topo_I:
    #     return JointCandidate
    

# find neighboring beams
solver = ConnectionSolver()
beam_pairs = solver.find_intersecting_pairs(list(model.beams), rtree=True)

for beam_a, beam_b in beam_pairs:
    # find topology and reorder beams according to roles if needed based on found topology
    result = solver.find_topology(beam_a, beam_b)
    #print(result)
    topo = result.topology
    beam_a = result.beam_a
    beam_b = result.beam_b

    # join beams accorgind to topology to connection type mapping
    joint_cls = get_joint_type(topo, beam_a, beam_b)
    if joint_cls is not None:
        joint_cls.create(model, beam_a, beam_b)
        
    
model.process_joinery()


# draw geometry
geo = [beam.geometry for beam in model.beams]
num_beams = len(beams)

beams_size = []

for i,beam in enumerate(beams):
    size = beam.length
    beams_size.append((size,i))

biggest = max(beams_size)
smallest = min(beams_size)
# ---------- end compas_timber ----------
panel = Panel(compas_timber.geo)
draw = COMPASDraw(cg=compas_timber.geo)  # -> rg
#   port cg: The COMPAS geometry or datastructure to be drawn.
#   port rg: The Rhino geometry object.
# ---------- draw: Python ----------
# r: compas>=2.14.1
"""
Draws COMPAS geometry in Grasshopper.
"""

from typing import Any

import Grasshopper

from compas.scene import SceneObject


class CompasToRhinoGeometry(Grasshopper.Kernel.GH_ScriptInstance):
    def RunScript(self, cg):
        if not cg:
            return None

        return SceneObject(item=cg).draw()
# ---------- end draw ----------

# ---- group: boxes / 8x2 modules tilted
surface = Surface([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])

# ---- group: boxes
curve = Curve(surface)
py3 = Python3Script(x=flatten(curve))  # -> out, boxes, x_sorted; inputs x: list of Curve
# ---------- py3: Python ----------
from compas.geometry import bounding_box, Box
from compas_rhino.conversions import curve_to_compas_polyline

def curve_xy_key(curve):
    c = curve_to_compas_polyline(curve)
    pts = c.points
    bb = bounding_box(pts)

    # center of bounding box
    cx = (bb[0][0] + bb[6][0]) * 0.5
    cy = (bb[0][1] + bb[6][1]) * 0.5

    # return (cx, cy)
    return (round(cy, 3), cx)

# sort first
x_sorted = sorted(x, key=curve_xy_key)

boxes = []
for curve in x_sorted:
    c = curve_to_compas_polyline(curve)
    points = c.points
    a = Box.from_bounding_box(bounding_box(points))
    a.zsize = 20.0
    boxes.append(a)

print(boxes)
# ---------- end py3 ----------

# ----
draw_2 = COMPASDraw(cg=py3.boxes)  # -> rg; same code as draw
area = Area(Geometry=draw_2)  # -> Area, Centroid
point_list = PointList(Points=area.Centroid, Size=Slider(1, range=0..10))

# ---- group: seperate into modules
py3_2 = Python3Script(timber_module=compas_timber.model, boxes=py3.boxes, box_curves=py3.x_sorted)  # -> out, total_modules, colored_geo, colors, module_rectangles, module_colors; inputs boxes: list, box_curves: list of Curve
# ---------- py3_2: Python ----------
from compas_timber.model import TimberModel
from compas_timber.elements import Beam
from compas.geometry import Box, Frame
import System.Drawing as sd
from compas_rhino.conversions import curve_to_compas_polyline


model = timber_module

# ============================================================
### seperate into modules ###
# ============================================================

total_modules = []

for box in boxes:
    module = []
    for beam in model.beams:
        if box.contains_point(beam.midpoint):
            module.append(beam)
    total_modules.append(module)
# print(total_modules[0])



# ============================================================
## color each modules ###
# ============================================================

def adjust_color(color, factor):
    r = min(255, max(0, int(color.R * factor)))
    g = min(255, max(0, int(color.G * factor)))
    b = min(255, max(0, int(color.B * factor)))
    return sd.Color.FromArgb(r, g, b)

def make_color(i):
    groups = [
        [0, 1],
        [2, 3],
        [4, 5],
        [6, 7],
        [8, 9],
        [10, 11],
        [12, 13],
        [14, 15],
    ]

    base_colors_list = [
        sd.Color.FromArgb(214, 92, 92),    # red
        sd.Color.FromArgb(101, 166, 91),   # green
        sd.Color.FromArgb(78, 150, 222),   # blue
        sd.Color.FromArgb(166, 110, 201),  # purple
        sd.Color.FromArgb(230, 145, 56),   # orange
        sd.Color.FromArgb(69, 170, 150),   # teal
        sd.Color.FromArgb(196, 168, 54),   # olive gold
        sd.Color.FromArgb(209, 109, 176),  # pink
    ]

    for group_id, group in enumerate(groups):
        if i in group:
            base = base_colors_list[group_id]
            idx = group.index(i)
            n = len(group)

            if n == 1:
                factor = 1.0
            else:
                factor = 0.7 + (0.6 * idx / float(n - 1))
                # factor = 0.5 + (1.2 * idx / float(n - 1))

            return adjust_color(base, factor)

    return sd.Color.FromArgb(200, 200, 200)

colored_geo = []
colors = []

for i, module in enumerate(total_modules):
    col = make_color(i)

    for beam in module:
        colored_geo.append(beam.geometry)
        colors.append(col)


h = 0.06
module_rectangles = []
module_colors = []

for i, crv in enumerate(box_curves):
    c = make_color(i)
    poly = curve_to_compas_polyline(crv)

    module_rectangles.append(poly)
    module_colors.append(c)


# ============================================================
## volume each modules ###
# ============================================================

module_total_volumes = []
module_total_weights = []

for module in total_modules:
    total_volume = 0.0
    total_weight = 0.0

    for beam in module:
        vol = beam.width * beam.height * beam.length
        total_volume += vol
        total_weight += vol * 470

    module_total_volumes.append(total_volume)
    module_total_weights.append(total_weight)
# ---------- end py3_2 ----------

# ----
panel_2 = Panel(py3_2.total_modules)

# ---- group: visualize
clt_plates_thickness = Panel("0.08")
draw_3 = COMPASDraw(cg=py3_2.colored_geo)  # -> rg; same code as draw
draw_4 = COMPASDraw(cg=py3_2.module_rectangles)  # -> rg; same code as draw
unit_z = UnitZ(Factor=clt_plates_thickness)
surface_2 = Surface(draw_4)
extrude = Extrude(Base=surface_2, Direction=unit_z)
custom_preview = CustomPreview(Geometry=draw_3, Material=py3_2.colors)
custom_preview_2 = CustomPreview(Geometry=extrude, Material=py3_2.module_colors)

# ---- group: to calculate 1 CLT plates (kg)
area_2 = Area(Geometry=surface_2)  # -> Area, Centroid
density = Panel("470")
panel_m2 = Expression(panel_m2=area_2.Area, clt_thickness=clt_plates_thickness, density=density, Expression="panel_m2*clt_thickness*density")

# ---- group: informations
python_3_script = Python3Script(total_modules=py3_2.total_modules)  # -> out, total_beams_volume, total_beams_weight, number_of_beams, module_heights, bbox_lines; inputs total_modules: list
# ---------- python_3_script: Python ----------
# ============================================================
## volume each modules ###
# ============================================================

total_beams_volume = []
total_beams_weight = []
number_of_beams = []
for module in total_modules:
    total_volume = 0.0
    total_weight = 0.0

    for beam in module:
        vol = beam.width * beam.height * beam.length
        total_volume += vol
        total_weight += vol * 470

    total_beams_volume.append(total_volume)
    total_beams_weight.append(total_weight)
    number_of_beams.append(len(module))


from compas.geometry import bounding_box

# ============================================================
## height each modules ###
# ============================================================

module_heights = []
module_bboxes = []


for module in total_modules:
    pts = []

    for beam in module:
        pts.append(beam.centerline.start)
        pts.append(beam.centerline.end)

    if not pts:
        module_heights.append(0.0)
        module_bboxes.append(None)
        continue

    bbox = bounding_box(pts)   # returns 8 corner points
    z_values = [p[2] for p in bbox]
    height = max(z_values) - min(z_values)

    module_heights.append(height)
    module_bboxes.append(bbox)


from compas.geometry import Line

bbox_lines = []

for bbox in module_bboxes:
    if not bbox:
        bbox_lines.append([])
        continue

    p0, p1, p2, p3, p4, p5, p6, p7 = bbox

    lines = [
        Line(p0, p1), Line(p1, p2), Line(p2, p3), Line(p3, p0),  # bottom
        Line(p4, p5), Line(p5, p6), Line(p6, p7), Line(p7, p4),  # top
        Line(p0, p4), Line(p1, p5), Line(p2, p6), Line(p3, p7)   # verticals
    ]

    bbox_lines.extend(lines)
# ---------- end python_3_script ----------

# ----
draw_5 = COMPASDraw(cg=python_3_script.bbox_lines)  # -> rg; same code as draw
# workflow
# input = receive compas timber model from Joint group
# from compas timber model extract beams information
# 
# group in modules as before
# plan sequence
# outputs: modules + information
# sequence inside module
total_beams_volume_m3 = Panel(python_3_script.total_beams_volume)
total_beams_weight_kg = Panel(python_3_script.total_beams_weight)
number_of_beams = Panel(python_3_script.number_of_beams)
module_heights_m = Panel(python_3_script.module_heights)
mass_addition = MassAddition(Input=total_beams_volume_m3)  # -> Result, PartialResults
mass_addition_2 = MassAddition(Input=total_beams_weight_kg)  # -> Result, PartialResults
mass_addition_3 = MassAddition(Input=number_of_beams)  # -> Result, PartialResults
total_beams_volume_m3_2 = Panel(mass_addition.Result)
total_beams_weight_kg_2 = Panel(mass_addition_2.Result)
number_of_beams_2 = Panel(mass_addition_3.Result)

# ---- group: total_weight_per_module (kg)
panel_m2_2 = Expression(
    total_beams_weight_kg=total_beams_weight_kg,
    clt_panel_weight_kg=panel_m2,
    Expression="total_beams_weight_kg+clt_panel_weight_kg")

# ----
total_weight_per_module_kg = Panel(panel_m2_2)

# ---- group: Area Density = Weight Per Module / Plate Area (kg/m2)
panel_m2_3 = Expression(total_weight_per_module=panel_m2_2, plate_area=area_2.Area, Expression="total_weight_per_module/plate_area")

# ----
mass_addition_4 = MassAddition(Input=total_weight_per_module_kg)  # -> Result, PartialResults
total_weight_kg = Panel(mass_addition_4.Result)
weight_per_module_plate_area_kg_m2 = Panel(panel_m2_3)
