# Grasshopper definition modulization_rs_22042026.gh (Grasshopper 1.0.8)
# plug-ins: Heteroptera

# ---- group: boxes
curve = Curve([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])
python_3_script = Python3Script(x=flatten(curve))  # -> out, boxes, x_sorted; inputs x: list of Curve
# ---------- python_3_script: Python ----------
from compas.geometry import bounding_box, Box
from compas_rhino.conversions import curve_to_compas_polyline

def curve_xy_key(curve):
    c = curve_to_compas_polyline(curve)
    pts = c.points
    bb = bounding_box(pts)

    # center of bounding box
    cx = (bb[0][0] + bb[6][0]) * 0.5
    cy = (bb[0][1] + bb[6][1]) * 0.5

    # return (cx, cy)
    return (round(cy, 3), cx)

# sort first
x_sorted = sorted(x, key=curve_xy_key)

boxes = []
for curve in x_sorted:
    c = curve_to_compas_polyline(curve)
    points = c.points
    a = Box.from_bounding_box(bounding_box(points))
    a.zsize = 20.0
    boxes.append(a)

print(boxes)
# ---------- end python_3_script ----------

# ----
draw = COMPASDraw(cg=python_3_script.boxes)  # -> rg
#   port cg: The COMPAS geometry or datastructure to be drawn.
#   port rg: The Rhino geometry object.
# ---------- draw: Python ----------
# r: compas>=2.14.1
"""
Draws COMPAS geometry in Grasshopper.
"""

from typing import Any

import Grasshopper

from compas.scene import SceneObject


class CompasToRhinoGeometry(Grasshopper.Kernel.GH_ScriptInstance):
    def RunScript(self, cg):
        if not cg:
            return None

        return SceneObject(item=cg).draw()
# ---------- end draw ----------

# ---- group: Michael 21042026
_120_x_180 = Curve([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])
_120_x_160 = Curve([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])
_140_x_180 = Curve([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])
_140_x_200 = Curve([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])
_140_x_240 = Curve([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])

# ----
compas_timber = Python3Script(
    line_1=_120_x_160,
    line_2=_120_x_180,
    line_3=_140_x_180,
    line_4=_140_x_200,
    line_5=_140_x_240,
    clt_plates=python_3_script.x_sorted)  # -> out, num_beams, biggest, smallest, model, a; inputs line_1: list of Line, line_2: list of Line, line_3: list of Line, line_4: list of Line, line_5: list of Line, clt_plates: list of Polyline
# ---------- compas_timber: Python ----------
import Rhino.Geometry as rg
from compas_timber.model import TimberModel
from compas_timber.elements import Beam, Plate
from compas_timber.connections import ConnectionSolver
from compas_timber.connections import JointTopology
from compas.geometry import Vector, Frame
from compas_rhino.conversions import line_to_compas, polyline_to_compas
from compas.scene import Scene

scene = Scene()

# ============================================================
# Helper: reorder Rhino line by Z
# lower Z point -> start
# higher Z point -> end
# ============================================================
def reorder_line_by_z(rh_obj):
    if rh_obj is None:
        return None

    if isinstance(rh_obj, rg.Line):
        p0 = rh_obj.From
        p1 = rh_obj.To
        if p0.Z <= p1.Z:
            return rh_obj
        else:
            return rg.Line(p1, p0)

    if isinstance(rh_obj, rg.LineCurve):
        line = rh_obj.Line
        p0 = line.From
        p1 = line.To
        if p0.Z <= p1.Z:
            return line
        else:
            return rg.Line(p1, p0)

    return rh_obj

# ============================================================
# Helper: create beam
# ============================================================
def create_beam(line, width, height, category, z_vector=None):
    beam = Beam.from_centerline(centerline=line, width=float(width), height=float(height))
    beam.attributes["category"] = category
    return beam



# ============================================================
# Helper: add beams from input lines
# category auto-generated from width and height
# ============================================================
def add_beams_from_lines(lines, width, height, beams):
    category = "{}x{}".format(int(width * 1000), int(height * 1000))

    if not lines:
        return

    for l in lines:
        rh_line = reorder_line_by_z(l)
        if rh_line is None:
            continue

        compas_line = line_to_compas(rh_line)
        if compas_line is None:
            continue

        beam = create_beam(compas_line, width, height, category)
        beams.append(beam)


# ============================================================
# Save beams as a list
# ============================================================
beam_inputs = [
    (line_1, 0.12, 0.16),
    (line_2, 0.12, 0.18),
    (line_3, 0.14, 0.18),
    (line_4, 0.14, 0.20),
    (line_5, 0.14, 0.24),
]

beams = []

for lines, width, height in beam_inputs:
    add_beams_from_lines(lines, width, height, beams)

# ============================================================
# Create CLT Plates
# ============================================================

plates = []

for c in clt_plates:
    compas_poly = polyline_to_compas(c)

    p0 = compas_poly.points[0]
    p1 = compas_poly.points[1]
    p2 = compas_poly.points[2]

    frame = Frame.from_points(p0, p1, p2)
    local_z = frame.zaxis

    # print(local_z)


    # plate = Plate.from_outline_thickness(compas_poly, thickness=0.12, vector=Vector(0, 0, 1))
    plate = Plate.from_outline_thickness(compas_poly, thickness=0.12, vector=local_z)

    plates.append(plate)

# ============================================================
# Add beams to model
# ============================================================
model = TimberModel()
[model.add_element(beam) for beam in beams]
[model.add_element(plate) for plate in plates]


# ============================================================
# Create joint
# ============================================================
from compas_timber.connections import (
    XLapJoint,
    JointCandidate,
    TDovetailJoint,
    LFrenchRidgeLapJoint,
    TButtJoint,
    LMiterJoint,
    TStepJoint
)

def get_joint_type(topo, beam_a, beam_b):
    if topo == JointTopology.TOPO_T:
        return TButtJoint
    elif topo == JointTopology.TOPO_L:
        return JointCandidate
    elif topo == JointTopology.TOPO_X:
        return JointCandidate
    # elif topo == JointTopology.Topo_I:
    #     return JointCandidate


# ============================================================
# Find neighboring beams
# ============================================================
solver = ConnectionSolver()
beam_pairs = solver.find_intersecting_pairs(list(model.beams), rtree=True)

for beam_a, beam_b in beam_pairs:
    result = solver.find_topology(beam_a, beam_b)
    topo = result.topology
    beam_a = result.beam_a
    beam_b = result.beam_b

    joint_cls = get_joint_type(topo, beam_a, beam_b)
    if joint_cls is not None:
        joint_cls.create(model, beam_a, beam_b)

model.process_joinery()


# ============================================================
# Draw geometry
# ============================================================
num_beams = len(beams)

beams_size = []

for i, beam in enumerate(beams):
    size = beam.length
    beams_size.append((size, i))

biggest = max(beams_size)
smallest = min(beams_size)

for beam in model.beams:
    scene.add(beam.geometry)

for plate in model.plates:
    scene.add(plate.geometry)

a = scene.draw()
# ---------- end compas_timber ----------
panel = Panel(compas_timber.model)

# ---- group: seperate into modules
python_3_script_2 = Python3Script(timber_module=compas_timber.model, boxes=python_3_script.boxes, box_curves=python_3_script.x_sorted)  # -> out, total_modules, colored_geo, colors, module_rectangles, module_colors; inputs boxes: list, box_curves: list of Polyline
# ---------- python_3_script_2: Python ----------
from compas_timber.model import TimberModel
from compas_timber.elements import Beam
from compas.geometry import Box, Frame, Translation
import System.Drawing as sd
from compas_rhino.conversions import polyline_to_compas


model = timber_module

# ============================================================
### seperate into modules ###
# ============================================================

total_modules = []

for box in boxes:
    total_modules.append({"beams": [], "plates": []})

for beam in model.beams:
    for i, box in enumerate(boxes):
        if box.contains_point(beam.centerline.midpoint):
            total_modules[i]["beams"].append(beam)
            break

for plate in model.plates:
    point = plate.frame.point.copy()

    move_vec = plate.frame.xaxis * (plate.length / 2.0) + plate.frame.yaxis * (plate.width / 2.0)
    T = Translation.from_vector(move_vec)
    point.transform(T)

    for i, box in enumerate(boxes):
        if box.contains_point(point):
            total_modules[i]["plates"].append(plate)
            break



# ============================================================
## color each modules ###
# ============================================================

def adjust_color(color, factor):
    r = min(255, max(0, int(color.R * factor)))
    g = min(255, max(0, int(color.G * factor)))
    b = min(255, max(0, int(color.B * factor)))
    return sd.Color.FromArgb(r, g, b)

def make_color(i):
    groups = [
        [0, 1],
        [2, 3],
        [4, 5],
        [6, 7],
        [8, 9],
        [10, 11],
        [12, 13],
        [14, 15],
    ]

    base_colors_list = [
        sd.Color.FromArgb(214, 92, 92),    # red
        sd.Color.FromArgb(101, 166, 91),   # green
        sd.Color.FromArgb(78, 150, 222),   # blue
        sd.Color.FromArgb(166, 110, 201),  # purple
        sd.Color.FromArgb(230, 145, 56),   # orange
        sd.Color.FromArgb(69, 170, 150),   # teal
        sd.Color.FromArgb(196, 168, 54),   # olive gold
        sd.Color.FromArgb(209, 109, 176),  # pink
    ]

    for group_id, group in enumerate(groups):
        if i in group:
            base = base_colors_list[group_id]
            idx = group.index(i)
            n = len(group)

            if n == 1:
                factor = 1.0
            else:
                factor = 0.7 + (0.6 * idx / float(n - 1))
                # factor = 0.5 + (1.2 * idx / float(n - 1))

            return adjust_color(base, factor)

    return sd.Color.FromArgb(200, 200, 200)

colored_geo = []
colors = []

for i, module in enumerate(total_modules):
    col = make_color(i)

    for beam in module["beams"]:
        colored_geo.append(beam.geometry)
        colors.append(col)

    for plate in module["plates"]:
        colored_geo.append(plate.geometry)
        colors.append(col)

module_colors = []
module_rectangles = []

for i, crv in enumerate(box_curves):
    c = make_color(i)
    poly = polyline_to_compas(crv)
    module_rectangles.append(poly)
    module_colors.append(c)
# ---------- end python_3_script_2 ----------

# ----
module_id = Slider(15, range=0..15)
draw_2 = COMPASDraw(cg=python_3_script_2.colored_geo)  # -> rg; same code as draw
custom_preview = CustomPreview(Geometry=draw_2, Material=python_3_script_2.colors)
python_3_script_3 = Python3Script(total_modules=python_3_script_2.total_modules, colors=python_3_script_2.module_colors, module_id=module_id)  # -> out, selected_geo, selected_colors, joint_points; inputs total_modules: list, colors: list, module_id: Int32
# ---------- python_3_script_3: Python ----------
from compas.geometry import Point, centroid_points

selected_module = {"beams": [], "plates": []}
color_module = None

if 0 <= module_id < len(total_modules):
    selected_module = total_modules[module_id]
    color_module = colors[module_id]

selected_geo = []
selected_colors = []

for beam in selected_module["beams"]:
    selected_geo.append(beam.geometry)
    selected_colors.append(color_module)

for plate in selected_module["plates"]:
    selected_geo.append(plate.geometry)
    selected_colors.append(color_module)


def point_key(pt, tol=1e-6):
    return (round(pt.x / tol), round(pt.y / tol), round(pt.z / tol))


joint_points = []
point_map = {}

# collect endpoints from beams only
for beam in selected_module["beams"]:
    if not hasattr(beam, "centerline"):
        continue

    pts = [beam.centerline.start, beam.centerline.end]

    for pt in pts:
        k = point_key(pt)

        if k not in point_map:
            point_map[k] = [pt]
        else:
            point_map[k].append(pt)

# keep only shared points (real joints)
for pts in point_map.values():
    if len(pts) > 1:
        c = centroid_points(pts)
        joint_points.append(Point(c[0], c[1], c[2]))
# ---------- end python_3_script_3 ----------
explode_dist = Slider(0, range=0..5)
draw_3 = COMPASDraw(cg=python_3_script_2.module_rectangles)  # -> rg; same code as draw
explode_dist_2 = Slider(0, range=0..5)  # disabled
draw_4 = COMPASDraw(cg=python_3_script_3.joint_points)  # -> rg; same code as draw
draw_5 = COMPASDraw(cg=python_3_script_3.selected_geo)  # -> rg; same code as draw
list_length = ListLength(List=python_3_script_3.selected_geo)
panel_2 = Panel(list_length)
custom_preview_2 = CustomPreview(Geometry=draw_5, Material=python_3_script_3.selected_colors)

# ---- group: EXPLODE!
python_3_script_4 = Python3Script(explode_dist=explode_dist_2)  # -> out, exploded_geo, plates; inputs total_modules: list, module_rectangles: list, explode_dist: Double; disabled
# ---------- python_3_script_4: Python ----------
from compas.geometry import Point, Vector, Translation, centroid_points

# ============================================================
# helper: get center of a module rectangle
# ============================================================

def poly_center_xy(poly):
    pts = list(poly.points)

    # remove duplicate last point if closed
    if len(pts) > 1 and pts[0] == pts[-1]:
        pts = pts[:-1]

    c = centroid_points(pts)
    return Point(c[0], c[1], 0.0)


# ============================================================
# overall center from all module rectangle centers
# ============================================================

module_centers = [poly_center_xy(poly) for poly in module_rectangles]
c = centroid_points(module_centers)
overall_center = Point(c[0], c[1], 0.0)


# ============================================================
# explode modules
# ============================================================

exploded_geo = []
exploded_rectangles = []

module_vectors = []
module_centers_out = []

plates = []
max_dx = max([abs(p.x - overall_center.x) for p in module_centers] + [1e-6])

for i, module in enumerate(total_modules):
    rect = module_rectangles[i]

    module_center = module_centers[i]
    module_centers_out.append(module_center)

    dx = module_center.x - overall_center.x
    dy = module_center.y - overall_center.y

    sy = 1 if dy > 0 else (-1 if dy < 0 else 0)

    vec = Vector(
        (dx / max_dx) * explode_dist * 1.5,
        sy * explode_dist * 0.3,
        0.0
    )
    module_vectors.append(vec)

    T = Translation.from_vector(vec)

    moved_rect = rect.transformed(T)
    exploded_rectangles.append(moved_rect)

    for beam in module["beams"]:
        moved_geo = beam.geometry.transformed(T)
        exploded_geo.append(moved_geo)

    for plate in module["plates"]:
        moved_geo_p = plate.geometry.transformed(T)
        exploded_geo.append(moved_geo_p)
        plates.append(moved_geo_p)
# ---------- end python_3_script_4 ----------

python_3_script_5 = Python3Script(
    total_modules=python_3_script_2.total_modules,
    module_rectangles=python_3_script_2.module_rectangles,
    explode_dist=explode_dist,
    flip_to_world=Toggle(False))  # -> out, exploded_geo, plates; inputs total_modules: list, module_rectangles: list, explode_dist: Double
# ---------- python_3_script_5: Python ----------
from compas.geometry import Point, Vector, Frame, Translation, Rotation, centroid_points

# ============================================================
# helper: get center of a module rectangle
# ============================================================

def poly_center_xy(poly):
    pts = list(poly.points)

    # remove duplicate last point if closed
    if len(pts) > 1 and pts[0] == pts[-1]:
        pts = pts[:-1]

    c = centroid_points(pts)
    return Point(c[0], c[1], c[2])


# ============================================================
# helper: get local frame from module rectangle
# force zaxis to point toward World Z+
# ============================================================

def poly_frame(poly):
    pts = list(poly.points)

    # remove duplicate last point if closed
    if len(pts) > 1 and pts[0] == pts[-1]:
        pts = pts[:-1]

    if len(pts) < 3:
        return Frame.worldXY()

    frame = Frame.from_points(pts[0], pts[1], pts[2])

    world_z = Vector(0, 0, 1)

    # if local z points downward, flip the frame
    if frame.zaxis.dot(world_z) > 0:
        frame = Frame(frame.point, frame.xaxis, -frame.yaxis)

    return frame


# ============================================================
# helper: rotate module plane to World XY about module center
# ============================================================

def module_flip_transform(rect, center):
    local_frame = poly_frame(rect)

    local_z = local_frame.zaxis
    world_z = Vector(0, 0, 1)

    dot_val = local_z.dot(world_z)

    # already aligned
    if abs(dot_val - 1.0) < 1e-6:
        return None

    axis = local_z.cross(world_z)

    # if axis is too small, choose local xaxis
    if axis.length < 1e-6:
        axis = local_frame.xaxis

    axis.unitize()

    angle = local_z.angle(world_z)

    R = Rotation.from_axis_and_angle(axis, angle, point=center)
    return R


# ============================================================
# overall center from all module rectangle centers
# ============================================================

module_centers = [poly_center_xy(poly) for poly in module_rectangles]
c = centroid_points(module_centers)
overall_center = Point(c[0], c[1], c[2])


# ============================================================
# explode modules
# ============================================================

exploded_geo = []
exploded_rectangles = []

module_vectors = []
module_centers_out = []

plates = []
max_dx = max([abs(p.x - overall_center.x) for p in module_centers] + [1e-6])

for i, module in enumerate(total_modules):
    rect = module_rectangles[i]

    module_center = module_centers[i]
    module_centers_out.append(module_center)

    dx = module_center.x - overall_center.x
    dy = module_center.y - overall_center.y

    sy = 1 if dy > 0 else (-1 if dy < 0 else 0)

    vec = Vector(
        (dx / max_dx) * explode_dist * 1.5,
        sy * explode_dist * 0.3,
        0.0
    )
    module_vectors.append(vec)

    T = Translation.from_vector(vec)

    moved_rect = rect.transformed(T)
    moved_center = module_center.transformed(T)

    if flip_to_world:
        R = module_flip_transform(moved_rect, moved_center)
        if R:
            moved_rect = moved_rect.transformed(R)

    exploded_rectangles.append(moved_rect)

    for beam in module["beams"]:
        moved_geo = beam.geometry.transformed(T)

        if flip_to_world and R:
            moved_geo = moved_geo.transformed(R)

        exploded_geo.append(moved_geo)

    for plate in module["plates"]:
        moved_geo_p = plate.geometry.transformed(T)

        if flip_to_world and R:
            moved_geo_p = moved_geo_p.transformed(R)

        exploded_geo.append(moved_geo_p)
        plates.append(moved_geo_p)
# ---------- end python_3_script_5 ----------

# ----
dot_display = DotDisplay(Point=draw_4, Colour=RGB(0, 0, 0), Size="0.1")
draw_6 = COMPASDraw(cg=python_3_script_4.plates)  # -> rg; disabled; same code as draw
draw_7 = COMPASDraw(cg=python_3_script_5.plates)  # -> rg; same code as draw
python_3_script_6 = Python3Script(exploded_geo=python_3_script_5.exploded_geo)  # -> out, a; inputs exploded_geo: list
# ---------- python_3_script_6: Python ----------
import Rhino.Geometry as rg
from compas.geometry import Box, Frame, Point, Vector


# ============================================================
# helper: convert Rhino bounding box to compas Box
# ============================================================

def rhino_bbox_to_compas_box(rbbox):
    min_pt = rbbox.Min
    max_pt = rbbox.Max

    cx = 0.5 * (min_pt.X + max_pt.X)
    cy = 0.5 * (min_pt.Y + max_pt.Y)
    cz = 0.5 * (min_pt.Z + max_pt.Z)

    xsize = max_pt.X - min_pt.X
    ysize = max_pt.Y - min_pt.Y
    zsize = max_pt.Z - min_pt.Z

    frame = Frame(Point(cx, cy, cz), Vector(1, 0, 0), Vector(0, 1, 0))
    return Box(xsize, ysize, zsize, frame=frame)


# ============================================================
# helper: get Rhino brep from compas_rhino RhinoBrep
# ============================================================

def get_native_rhino_brep(geo):
    # try common attributes used by wrappers
    if hasattr(geo, "_brep"):
        return geo._brep

    if hasattr(geo, "native_brep"):
        return geo.native_brep

    if hasattr(geo, "geometry"):
        return geo.geometry

    if hasattr(geo, "_geometry"):
        return geo._geometry

    return None


# ============================================================
# create bounding boxes
# ============================================================

bounding_boxes = []
failed = []

for i, geo in enumerate(exploded_geo):
    try:
        rb = get_native_rhino_brep(geo)

        print("item", i, "type =", type(geo), "native =", type(rb))

        if rb is None:
            failed.append((i, type(geo), "no native brep"))
            continue

        bbox = rb.GetBoundingBox(True)
        box = rhino_bbox_to_compas_box(bbox)
        bounding_boxes.append(box)

    except Exception as e:
        failed.append((i, type(geo), repr(e)))

print("num bounding boxes =", len(bounding_boxes))
print("failed =", failed[:10])

a = bounding_boxes
b = failed
# ---------- end python_3_script_6 ----------

# ---- group: module_index_visualize
# workflow
# input = receive compas timber model from Joint group
# from compas timber model extract beams information
# 
# group in modules as before
# plan sequence
# outputs: modules + information
# sequence inside module
center = Center(Geometry=draw_7)  # -> Center, Dimension
unit_z = UnitZ(Factor="1")
move = Move(Geometry=center.Center, Motion=unit_z)  # -> Geometry, Transform
dot_display_2 = DotDisplay(Point=move.Geometry, Colour=ColourSwatch(SwatchColor=RGBA(255, 207, 121, 44)), Size="1")
point_list = PointList(Points=move.Geometry, Size=Slider(1, range=0..10))

# ----
draw_8 = COMPASDraw(cg=python_3_script_6.a)  # -> rg; same code as draw

# ---- group: visualize explode
draw_9 = COMPASDraw(cg=python_3_script_5.exploded_geo)  # -> rg; same code as draw
custom_preview_3 = CustomPreview(Geometry=draw_9, Material=python_3_script_2.colors)

# ---- group: informations
python_3_script_7 = Python3Script(total_modules=python_3_script_2.total_modules)  # -> out, long_beams, beam_statistics, beam_info_tree, total_beams_volume, total_beams_weight, total_plate_volume, total_plate_weight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; inputs total_modules: list
# ---------- python_3_script_7: Python ----------
# ============================================================
## volume each modules ###
# ============================================================

total_beams_volume = []
total_beams_weight = []
total_plate_volume = []
total_plate_weight = []
number_of_beams = []
number_of_plates = []

for module in total_modules:
    total_volume_beam = 0.0
    total_weight_beam = 0.0
    total_volume_plate = 0.0
    total_weight_plate = 0.0

    for beam in module["beams"]:
        beam_vol = beam.width * beam.height * beam.length
        total_volume_beam += beam_vol
        total_weight_beam += beam_vol * 470

    for plate in module["plates"]:
        plate_vol = plate.width * plate.length * plate.thickness
        total_volume_plate += plate_vol
        total_weight_plate += plate_vol * 470

    total_beams_volume.append(total_volume_beam)
    total_beams_weight.append(total_weight_beam)
    total_plate_volume.append(total_volume_plate)
    total_plate_weight.append(total_weight_plate)
    number_of_beams.append(len(module["beams"]))
    number_of_plates.append(len(module["plates"]))


# ============================================================
## each beam information ###
# ============================================================

from Grasshopper import DataTree
from Grasshopper.Kernel.Data import GH_Path

beam_info_tree = DataTree[object]()
beam_statistics = []

all_lengths = []
all_weights = []

min_length = None
max_length = None
min_weight = None
max_weight = None

min_length_loc = None
max_length_loc = None
min_weight_loc = None
max_weight_loc = None

# new outputs for beams longer than 5 m
long_beams = []

for i, module in enumerate(total_modules):
    path = GH_Path(i)

    beam_info_tree.Add("module {}".format(i), path)

    for j, beam in enumerate(module["beams"]):
        length = beam.length
        volume = beam.width * beam.height * beam.length
        weight = volume * 470

        text = "beam {} | length = {:.3f} m | volume = {:.3f} m3 | weight = {:.3f} kg".format(
            j, length, volume, weight
        )
        beam_info_tree.Add(text, path)

        all_lengths.append(length)
        all_weights.append(weight)

        # ============================================================
        # beams longer than 5 m
        # ============================================================
        if length > 5.0:
            long_beams.append(beam.geometry)

        if min_length is None or length < min_length:
            min_length = length
            min_length_loc = (i + 1, j + 1)

        if max_length is None or length > max_length:
            max_length = length
            max_length_loc = (i + 1, j + 1)

        if min_weight is None or weight < min_weight:
            min_weight = weight
            min_weight_loc = (i + 1, j + 1)

        if max_weight is None or weight > max_weight:
            max_weight = weight
            max_weight_loc = (i + 1, j + 1)

if all_lengths:
    avg_length = sum(all_lengths) / len(all_lengths)
    avg_weight = sum(all_weights) / len(all_weights)

    beam_statistics.append("overall beam statistics")
    beam_statistics.append(
        "min length = {:.3f} m | module {} | beam {}".format(
            min_length, min_length_loc[0], min_length_loc[1]
        )
    )
    beam_statistics.append(
        "max length = {:.3f} m | module {} | beam {}".format(
            max_length, max_length_loc[0], max_length_loc[1]
        )
    )
    beam_statistics.append(
        "avg length = {:.3f} m".format(avg_length)
    )
    beam_statistics.append(
        "min weight = {:.3f} kg | module {} | beam {}".format(
            min_weight, min_weight_loc[0], min_weight_loc[1]
        )
    )
    beam_statistics.append(
        "max weight = {:.3f} kg | module {} | beam {}".format(
            max_weight, max_weight_loc[0], max_weight_loc[1]
        )
    )
    beam_statistics.append(
        "avg weight = {:.3f} kg".format(avg_weight)
    )


# ============================================================
## each plate information ###
# ============================================================

plate_info_tree = DataTree[object]()
plate_statistics = []

all_plate_lengths = []
all_plate_weights = []

min_plate_length = None
max_plate_length = None
min_plate_weight = None
max_plate_weight = None

min_plate_length_loc = None
max_plate_length_loc = None
min_plate_weight_loc = None
max_plate_weight_loc = None

for i, module in enumerate(total_modules):
    path = GH_Path(i)

    plate_info_tree.Add("module {}".format(i), path)

    for j, plate in enumerate(module["plates"]):
        length = plate.length
        volume = plate.width * plate.length * plate.thickness
        weight = volume * 470

        text = "plate {} | length = {:.3f} m | volume = {:.3f} m3 | weight = {:.3f} kg".format(
            j, length, volume, weight
        )
        plate_info_tree.Add(text, path)

        all_plate_lengths.append(length)
        all_plate_weights.append(weight)

        if min_plate_length is None or length < min_plate_length:
            min_plate_length = length
            min_plate_length_loc = (i + 1, j + 1)

        if max_plate_length is None or length > max_plate_length:
            max_plate_length = length
            max_plate_length_loc = (i + 1, j + 1)

        if min_plate_weight is None or weight < min_plate_weight:
            min_plate_weight = weight
            min_plate_weight_loc = (i + 1, j + 1)

        if max_plate_weight is None or weight > max_plate_weight:
            max_plate_weight = weight
            max_plate_weight_loc = (i + 1, j + 1)

if all_plate_lengths:
    avg_plate_length = sum(all_plate_lengths) / len(all_plate_lengths)
    avg_plate_weight = sum(all_plate_weights) / len(all_plate_weights)

    plate_statistics.append("overall plate statistics")
    plate_statistics.append(
        "min length = {:.3f} m | module {} | plate {}".format(
            min_plate_length, min_plate_length_loc[0], min_plate_length_loc[1]
        )
    )
    plate_statistics.append(
        "max length = {:.3f} m | module {} | plate {}".format(
            max_plate_length, max_plate_length_loc[0], max_plate_length_loc[1]
        )
    )
    plate_statistics.append(
        "avg length = {:.3f} m".format(avg_plate_length)
    )
    plate_statistics.append(
        "min weight = {:.3f} kg | module {} | plate {}".format(
            min_plate_weight, min_plate_weight_loc[0], min_plate_weight_loc[1]
        )
    )
    plate_statistics.append(
        "max weight = {:.3f} kg | module {} | plate {}".format(
            max_plate_weight, max_plate_weight_loc[0], max_plate_weight_loc[1]
        )
    )
    plate_statistics.append(
        "avg weight = {:.3f} kg".format(avg_plate_weight)
    )


# ============================================================
## height each modules ###
# ============================================================

from compas.geometry import bounding_box
from compas.geometry import Line

module_heights = []
module_bboxes = []

for module in total_modules:
    pts = []

    for beam in module["beams"]:
        if hasattr(beam, "centerline"):
            pts.append(beam.centerline.start)
            pts.append(beam.centerline.end)

    for plate in module["plates"]:
        if hasattr(plate, "frame"):
            pts.append(plate.frame.point)

    if not pts:
        module_heights.append(0.0)
        module_bboxes.append(None)
        continue

    bbox = bounding_box(pts)
    z_values = [p[2] for p in bbox]
    height = max(z_values) - min(z_values)

    module_heights.append(height)
    module_bboxes.append(bbox)


bbox_lines = []

for bbox in module_bboxes:
    if not bbox:
        continue

    p0, p1, p2, p3, p4, p5, p6, p7 = bbox

    lines = [
        Line(p0, p1), Line(p1, p2), Line(p2, p3), Line(p3, p0),
        Line(p4, p5), Line(p5, p6), Line(p6, p7), Line(p7, p4),
        Line(p0, p4), Line(p1, p5), Line(p2, p6), Line(p3, p7)
    ]

    bbox_lines.extend(lines)
# ---------- end python_3_script_7 ----------

# ----
draw_10 = COMPASDraw(cg=python_3_script_7.bbox_lines)  # -> rg; same code as draw
draw_11 = COMPASDraw(cg=python_3_script_7.long_beams)  # -> rg; same code as draw
custom_preview_4 = CustomPreview(Geometry=draw_11, Material=ColourSwatch(SwatchColor=RGB(150, 119, 87)))
beam_statistics = Panel(python_3_script_7.beam_statistics)
beam_information = Panel(python_3_script_7.beam_info_tree)
total_beams_volume_m3 = Panel(python_3_script_7.total_beams_volume)
total_beams_weight_kg = Panel(python_3_script_7.total_beams_weight)
total_plates_volume_m3 = Panel(python_3_script_7.total_plate_volume)
total_plates_weight_kg = Panel(python_3_script_7.total_plate_weight)
number_of_beams = Panel(python_3_script_7.number_of_beams)
number_of_plates = Panel(python_3_script_7.number_of_plates)
module_heights_m = Panel(python_3_script_7.module_heights)

# ---- group: beam that are longer than 5 m
cluster = Cluster(brep=draw_11)  # -> length_3, start, relay, end
beam_length_5_m = Panel(cluster.length_3)
linear_dimension = LinearDimension(Line=cluster.relay, PointA=cluster.start, PointB=cluster.end, Text="{0:0.000}", Size="0.5")

# ----
mass_addition = MassAddition(Input=total_beams_volume_m3)  # -> Result, PartialResults
mass_addition_2 = MassAddition(Input=total_beams_weight_kg)  # -> Result, PartialResults
mass_addition_3 = MassAddition(Input=total_plates_volume_m3)  # -> Result, PartialResults
mass_addition_4 = MassAddition(Input=total_plates_weight_kg)  # -> Result, PartialResults
mass_addition_5 = MassAddition(Input=number_of_beams)  # -> Result, PartialResults
mass_addition_6 = MassAddition(Input=number_of_plates)  # -> Result, PartialResults
list_length_2 = ListLength(List=beam_length_5_m)  # -> flatten(Length)
total_beams_volume_m3_2 = Panel(mass_addition.Result)
total_beams_weight_kg_2 = Panel(mass_addition_2.Result)
total_beams_volume_m3_3 = Panel(mass_addition_3.Result)
total_plates_weight_kg_2 = Panel(mass_addition_4.Result)
number_of_beams_2 = Panel(mass_addition_5.Result)
number_of_plates_2 = Panel(mass_addition_6.Result)
mass_addition_7 = MassAddition(Input=list_length_2)  # -> Result, PartialResults
total_beams_volume_m3_4 = Panel(mass_addition_7.Result)

# ---- group: total_weight_per_module (kg)
panel_m2 = Expression(
    total_beams_weight_kg=total_beams_weight_kg,
    clt_panel_weight_kg=total_plates_weight_kg,
    Expression="total_beams_weight_kg+clt_panel_weight_kg")

# ----
area = Area(Geometry=draw_3)  # -> Area, Centroid
total_weight_per_module_kg = Panel(panel_m2)

# ---- group: Area Density = Weight Per Module / Plate Area (kg/m2)
panel_m2_2 = Expression(total_weight_per_module=panel_m2, plate_area=area.Area, Expression="total_weight_per_module/plate_area")

# ----
mass_addition_8 = MassAddition(Input=total_weight_per_module_kg)  # -> Result, PartialResults
total_weight_kg = Panel(mass_addition_8.Result)
weight_per_module_plate_area_kg_m2 = Panel(panel_m2_2)

# ==== cluster Cluster
brep = ClusterInput()
deconstruct_brep = DeconstructBrep(Brep=brep)  # -> Faces, Edges, Vertices
length = Length(Curve=deconstruct_brep.Edges)
sort_list = SortList(Keys=length, ValuesValuesA=deconstruct_brep.Edges)  # -> Keys, ValuesValuesA
list_item = ListItem(List=reverse(sort_list.ValuesValuesA), Index=0, Wrap=True)
length_2 = Length(Curve=list_item)
length_3 = ClusterOutput(length_2)
end_points = EndPoints(Curve=list_item)  # -> Start, End
relay = ClusterOutput(list_item)
start = ClusterOutput(end_points.Start)
end = ClusterOutput(end_points.End)
