# Grasshopper definition modulization_rs_28042026_2.gh (Grasshopper 1.0.8)
# plug-ins: Heteroptera

# ---- group: boxes
curve = Curve([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])
python_3_script = Python3Script(x=flatten(curve))  # -> out, boxes, x_sorted; inputs x: list of Curve
# ---------- python_3_script: Python ----------
from compas.geometry import bounding_box, Box
from compas_rhino.conversions import curve_to_compas_polyline

def curve_xy_key(curve):
    c = curve_to_compas_polyline(curve)
    pts = c.points
    bb = bounding_box(pts)

    # center of bounding box
    cx = (bb[0][0] + bb[6][0]) * 0.5
    cy = (bb[0][1] + bb[6][1]) * 0.5

    # return (cx, cy)
    return (round(cy, 3), cx)

# sort first
x_sorted = sorted(x, key=curve_xy_key)

boxes = []
for curve in x_sorted:
    c = curve_to_compas_polyline(curve)
    points = c.points
    a = Box.from_bounding_box(bounding_box(points))
    a.zsize = 20.0
    boxes.append(a)

print(boxes)
# ---------- end python_3_script ----------

# ----
unit_z = UnitZ(Factor="0.06")
move = Move(Geometry=python_3_script.x_sorted, Motion=unit_z)  # -> Geometry, Transform
draw = COMPASDraw(cg=python_3_script.boxes)  # -> rg
#   port cg: The COMPAS geometry or datastructure to be drawn.
#   port rg: The Rhino geometry object.
# ---------- draw: Python ----------
# r: compas>=2.14.1
"""
Draws COMPAS geometry in Grasshopper.
"""

from typing import Any

import Grasshopper

from compas.scene import SceneObject


class CompasToRhinoGeometry(Grasshopper.Kernel.GH_ScriptInstance):
    def RunScript(self, cg):
        if not cg:
            return None

        return SceneObject(item=cg).draw()
# ---------- end draw ----------

# ---- group: secondary
curve_2 = Curve([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])
curve_3 = Curve([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])
curve_4 = Curve([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])
curve_5 = Curve([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])

# ---- group: primary
curve_6 = Curve([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])
curve_7 = Curve([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])
curve_8 = Curve([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])
curve_9 = Curve(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)
curve_10 = Curve([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])

# ---- group: shoe
curve_11 = Curve([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])

# ---- group: compas_timber
python_3_script_2 = Python3Script(
    p_1=curve_9,
    p_2=curve_6,
    p_3=curve_8,
    p_4=curve_7,
    p_5=curve_10,
    s_1=curve_4,
    s_2=curve_2,
    s_3=curve_5,
    s_4=curve_3,
    s_5=curve_11,
    clt_plates=move.Geometry)  # -> out, a, b, c, d, e, model; inputs p_1: list of Line, p_2: list of Line, p_3: list of Line, p_4: list of Line, p_5: list of Line, s_1: list of Line, s_2: list of Line, s_3: list of Line, s_4: list of Line, s_5: list of Line, clt_plates: list of Polyline
# ---------- python_3_script_2: Python ----------
from compas.scene import Scene
from compas_rhino.conversions import line_to_compas
from compas.tolerance import Tolerance, TOL

from compas_timber.model import TimberModel
from compas_timber.elements import Beam, Plate

from compas_timber.connections import JointTopology
from compas_timber.connections import TMultiStepJoint
from compas_timber.connections import TStepJoint
from compas_timber.connections import LMiterJoint
from compas_timber.connections import TBirdsmouthJoint
from compas_timber.connections import XLapJoint

from compas_rhino.conversions import line_to_compas, polyline_to_compas

from compas.geometry import Frame, Vector, Point, angle_vectors

#initialise scene object
scene = Scene()

#initialise compas timber model
model = TimberModel(Tolerance(unit="MM", absolute="0.001"))

# ============================================================
# Helper: make polygon point order consistent with world Z+
# ============================================================
def oriented_polyline_to_world_z_plus(compas_poly):
    pts = list(compas_poly.points)

    if len(pts) < 3:
        return compas_poly, Vector(0, 0, 1)

    # remove duplicate last point if closed
    if pts[0] == pts[-1]:
        pts = pts[:-1]

    if len(pts) < 3:
        return compas_poly, Vector(0, 0, 1)

    p0 = pts[0]
    p1 = pts[1]
    p2 = pts[2]

    frame = Frame.from_points(p0, p1, p2)
    local_z = frame.zaxis
    world_z = Vector(0, 0, 1)

    # if normal points downward, reverse point order
    if local_z.dot(world_z) < 0:
        pts.reverse()

        # close it again if original was closed
        pts.append(pts[0])

        compas_poly = type(compas_poly)(pts)

        p0 = compas_poly.points[0]
        p1 = compas_poly.points[1]
        p2 = compas_poly.points[2]

        frame = Frame.from_points(p0, p1, p2)
        local_z = frame.zaxis

    return compas_poly, local_z

# ============================================================
# Create CLT Plates
# ============================================================
plates = []

for c in clt_plates:
    compas_poly = polyline_to_compas(c)
    if compas_poly is None:
        continue

    compas_poly, local_z = oriented_polyline_to_world_z_plus(compas_poly)

    plate = Plate.from_outline_thickness(
        compas_poly,
        thickness=0.12,
        vector=local_z
    )

    plates.append(plate)
    model.add_element(plate) 


#beam list
beams = []

#convert rhino curves into compas lines
"primary lines"
p_1 = [line_to_compas(c) for c in p_1]
p_2 = [line_to_compas(c) for c in p_2]
p_3 = [line_to_compas(c) for c in p_3]
p_4 = [line_to_compas(c) for c in p_4]
p_5 = [line_to_compas(c) for c in p_5]

"secondary lines"
s_1 = [line_to_compas(c) for c in s_1]
s_2 = [line_to_compas(c) for c in s_2]
s_3 = [line_to_compas(c) for c in s_3]
s_4 = [line_to_compas(c) for c in s_4]

"tertiary (shoe) lines"
s_5 = [line_to_compas(c) for c in s_5]

#assign beam names and width
"primary lines"
for l in p_1:
    l.name = "primary_1"
    beam = Beam.from_centerline(l, width=.120, height=.160)
    beam.name = "primary"
    beams.append(beam)
    model.add_element(beam)

for l in p_2:
    l.name = "primary_2"
    beam = Beam.from_centerline(l, width=.120, height=.180)
    beam.name = "primary"
    beams.append(beam)
    model.add_element(beam)

for l in p_3:
    l.name = "primary_3"
    beam = Beam.from_centerline(l, width=.140, height=.180)
    beam.name = "primary"
    beams.append(beam)
    model.add_element(beam)

for l in p_4:
    l.name = "primary_4"
    beam = Beam.from_centerline(l, width=.140, height=.200)
    beam.name = "primary"
    beams.append(beam)
    model.add_element(beam)

for l in p_5:
    l.name = "primary_5"
    beam = Beam.from_centerline(l, width=.140, height=.240)
    beam.name = "primary"
    beams.append(beam)
    model.add_element(beam)

"Secondary lines"
for l in s_1:
    l.name = "secondary_1"
    beam = Beam.from_centerline(l, width=.120, height=.160)
    beam.name = "secondary"
    beams.append(beam)
    model.add_element(beam)

for l in s_2:
    l.name = "secondary_2"
    beam = Beam.from_centerline(l, width=.120, height=.180)
    beam.name = "secondary"
    beams.append(beam)
    model.add_element(beam)

for l in s_3:
    l.name = "secondary_3"
    beam = Beam.from_centerline(l, width=.140, height=.180)
    beam.name = "secondary"
    beams.append(beam)
    model.add_element(beam)

for l in s_4:
    l.name = "secondary_4"
    beam = Beam.from_centerline(l, width=.140, height=.200)
    beam.name = "secondary"
    beams.append(beam)
    model.add_element(beam)

"tertiary lines"
for l in s_5:
    l.name = "tertiary"
    beam = Beam.from_centerline(l, width=.120, height=.120)
    beam.name = "tertiary"
    beams.append(beam)
    model.add_element(beam)

#reset beams and features
for beam in model.beams:
    beam.remove_features()

#compute line network
model.connect_adjacent_beams()

#debugging tools
candidates_a = []
candidates_b = []
frames_a = []
frames_b = []
planarity_check = []

#set joint conditions
for candidate in model.joint_candidates:
    
    #check for frames
    frame_a = candidate.element_a.frame
    frame_a.xaxis = Vector(0,0,1)
    frames_a.append (frame_a)

    frame_b = candidate.element_b.frame
    frame_b.xaxis = Vector(0,0,1)
    frames_b.append (frame_b)

    #visualise candidates for debug
    candidates_a.append(Beam.from_centerline(candidate.element_a.centerline, width = .1, height = .1))
    candidates_b.append(Beam.from_centerline(candidate.element_b.centerline, width = .1, height = .1))

    #planarity check between candidate a and candidate b
    planarity = (angle_vectors(frame_a.normal, frame_b.normal, deg=True))
    planarity_check.append(planarity)
    
    is_planar = bool
    if planarity < 0.2 or planarity > 179.8:
        is_planar = True
    else:
        is_planar = False
    # print (is_planar)

    #check for mid_point = above certain z_height
    a_is_shoe = bool
    b_is_shoe = bool
    ceiling_height = 24.48

    height_a = candidate.element_a.centerline.midpoint.z
    if height_a > ceiling_height:
        a_is_shoe = True
    else:
        a_is_shoe = False
        
    height_b = candidate.element_b.centerline.midpoint.z
    if height_b > ceiling_height:
        b_is_shoe = True
    else:
        b_is_shoe = False

    #joints based on topology, planarity and z height
    if candidate.topology == JointTopology.TOPO_T and is_planar == True:
        if b_is_shoe == True:
            t_step_joint = TMultiStepJoint.create(model, candidate.element_a, candidate.element_b, step_count=2)
        
        else:
            if angle_vectors(candidate.element_a.centerline.direction, candidate.element_b.centerline.direction, deg=True) < 50:
                step_shape = "heel"
            else:
                step_shape = "step"
            
            # print (candidate.element_a.centerline.name)
            t_step_joint = TMultiStepJoint.create(model, candidate.element_a, candidate.element_b, step_shape=step_shape, step_depth=.02, riser_angle=90)
    
    elif candidate.topology == JointTopology.TOPO_T and is_planar == False:
        t_bm_joint = TBirdsmouthJoint.create(model, candidate.element_a, candidate.element_b)

    elif candidate.topology==JointTopology.TOPO_L:
        l_miter_joint = LMiterJoint.create(model, candidate.element_a, candidate.element_b, cutoff = False)

    elif candidate.topology == JointTopology.TOPO_X:
        x_lap_joint = XLapJoint.create(model, candidate.element_a, candidate.element_b)

    else:
        # print ("some joints were not created!")
        continue

#process joints in compas timber model
model.process_joinery()

#visualise geometries
for beam in (model.beams):
    scene.add(beam.geometry)

for plate in (model.plates):
    scene.add(plate.geometry)

a = scene.draw()
b = frames_a[0]
c = candidates_a[0].geometry
d = frames_b[0]
e = candidates_b[0].geometry

# print (planarity_check[1])

print(model)
# ---------- end python_3_script_2 ----------

# ----
geometry = Geometry(python_3_script_2.a)
compas_draw = COMPASDraw(cg=python_3_script_2.b)  # -> rg; same code as draw
compas_draw_2 = COMPASDraw(cg=python_3_script_2.c)  # -> rg; same code as draw
compas_draw_3 = COMPASDraw(cg=python_3_script_2.d)  # -> rg; same code as draw
compas_draw_4 = COMPASDraw(cg=python_3_script_2.e)  # -> rg; same code as draw
panel = Panel(python_3_script_2.model)
panel_2 = Panel(python_3_script_2.a)

# ---- group: seperate into modules
python_3_script_3 = Python3Script(timber_module=python_3_script_2.model, boxes=python_3_script.boxes, box_curves=move.Geometry)  # -> out, total_modules, colored_geo, colors, module_rectangles, module_colors; inputs boxes: list, box_curves: list of Polyline
# ---------- python_3_script_3: Python ----------
from compas_timber.model import TimberModel
from compas_timber.elements import Beam
from compas.geometry import Box, Frame, Translation
import System.Drawing as sd
from compas_rhino.conversions import polyline_to_compas


model = timber_module

# ============================================================
### separate into modules as TimberModel ###
# ============================================================

total_modules = []

for i in range(len(boxes)):
    total_modules.append(TimberModel())

scaled_boxes = []

for i, box in enumerate(boxes):
    if i == 1:
        new_box = Box(
            xsize=box.xsize * 1.1,
            ysize=box.ysize * 1.1,
            zsize=box.zsize,
            frame=box.frame
        )
        scaled_boxes.append(new_box)
    else:
        scaled_boxes.append(box)

boxes = scaled_boxes


def add_to_timbermodel(timber_model, element):
    if hasattr(timber_model, "add_element"):
        timber_model.add_element(element)
    else:
        timber_model.add(element)


for beam in model.beams:
    for i, box in enumerate(boxes):
        if box.contains_point(beam.centerline.midpoint):
            add_to_timbermodel(total_modules[i], beam)
            break


for plate in model.plates:
    point = plate.frame.point.copy()

    move_vec = plate.frame.xaxis * (plate.length / 2.0) + plate.frame.yaxis * (plate.width / 2.0)
    T = Translation.from_vector(move_vec)
    point.transform(T)

    for i, box in enumerate(boxes):
        if box.contains_point(point):
            add_to_timbermodel(total_modules[i], plate)
            break


# ============================================================
## color each modules ###
# ============================================================

def adjust_color(color, factor):
    r = min(255, max(0, int(color.R * factor)))
    g = min(255, max(0, int(color.G * factor)))
    b = min(255, max(0, int(color.B * factor)))
    return sd.Color.FromArgb(r, g, b)


def make_color(i):
    groups = [
        [0, 1],
        [2, 3],
        [4, 5],
        [6, 7],
        [8, 9],
        [10, 11],
        [12, 13],
        [14, 15],
    ]

    base_colors_list = [
        sd.Color.FromArgb(214, 92, 92),
        sd.Color.FromArgb(101, 166, 91),
        sd.Color.FromArgb(78, 150, 222),
        sd.Color.FromArgb(166, 110, 201),
        sd.Color.FromArgb(230, 145, 56),
        sd.Color.FromArgb(69, 170, 150),
        sd.Color.FromArgb(196, 168, 54),
        sd.Color.FromArgb(209, 109, 176),
    ]

    for group_id, group in enumerate(groups):
        if i in group:
            base = base_colors_list[group_id]
            idx = group.index(i)
            n = len(group)

            if n == 1:
                factor = 1.0
            else:
                factor = 0.7 + (0.6 * idx / float(n - 1))

            return adjust_color(base, factor)

    return sd.Color.FromArgb(200, 200, 200)


colored_geo = []
colors = []

for i, module_model in enumerate(total_modules):
    col = make_color(i)

    for beam in module_model.beams:
        colored_geo.append(beam.geometry)
        colors.append(col)

    for plate in module_model.plates:
        colored_geo.append(plate.geometry)
        colors.append(col)


module_colors = []
module_rectangles = []

for i, crv in enumerate(box_curves):
    c = make_color(i)
    poly = polyline_to_compas(crv)
    module_rectangles.append(poly)
    module_colors.append(c)
# ---------- end python_3_script_3 ----------

# ----
panel_3 = Panel(python_3_script_3.total_modules)
explode_dist = Slider(0, range=0..5)
draw_2 = COMPASDraw(cg=python_3_script_3.module_rectangles)  # -> rg; same code as draw
working_space_rfl = Geometry([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])
x_axis = Slider(8.73, range=0..30)
y_axis = Slider(-1.26, range=-30..10)

# ---- group: EXPLODE!
python_3_script_4 = Python3Script(
    total_modules=python_3_script_3.total_modules,
    module_rectangles=python_3_script_3.module_rectangles,
    explode_dist=explode_dist,
    flip_to_world=Toggle(False))  # -> out, exploded_geo, plates; inputs total_modules: list, module_rectangles: list, explode_dist: Double
# ---------- python_3_script_4: Python ----------
from compas.geometry import Point, Vector, Frame, Translation, Rotation, centroid_points


# ============================================================
# helper: clean polygon points
# ============================================================

def poly_points(poly):
    pts = list(poly.points)
    if len(pts) > 1 and pts[0] == pts[-1]:
        pts = pts[:-1]
    return pts


# ============================================================
# helper: center of module rectangle
# ============================================================

def poly_center(poly):
    pts = poly_points(poly)
    c = centroid_points(pts)
    return Point(*c)


# ============================================================
# helper: local frame from module rectangle
# force zaxis toward World Z+
# ============================================================

def poly_frame(poly):
    pts = poly_points(poly)

    if len(pts) < 3:
        return Frame.worldXY()

    frame = Frame.from_points(pts[0], pts[1], pts[2])

    if frame.zaxis.dot(Vector(0, 0, 1)) < 0:
        frame = Frame(frame.point, frame.xaxis, -frame.yaxis)

    return frame


# ============================================================
# helper: rotation to align module zaxis with World Z+
# ============================================================

def module_flip_transform(rect, center):
    frame = poly_frame(rect)
    local_z = frame.zaxis
    world_z = Vector(0, 0, 1)

    axis = local_z.cross(world_z)

    if axis.length < 1e-6:
        if local_z.dot(world_z) > 0:
            return None
        axis = frame.xaxis

    axis.unitize()
    angle = local_z.angle(world_z)

    return Rotation.from_axis_and_angle(axis, angle, point=center)


# ============================================================
# overall center from all module rectangle centers
# ============================================================

module_centers = [poly_center(rect) for rect in module_rectangles]
overall_center = Point(*centroid_points(module_centers))


# ============================================================
# explode modules
# ============================================================

exploded_geo = []
exploded_rectangles = []
module_vectors = []
module_centers_out = []
plates = []

max_dx = max([abs(pt.x - overall_center.x) for pt in module_centers] + [1e-6])

for i, module_model in enumerate(total_modules):
    rect = module_rectangles[i]
    center = module_centers[i]

    module_centers_out.append(center)

    dx = center.x - overall_center.x
    dy = center.y - overall_center.y
    sy = 1 if dy > 0 else (-1 if dy < 0 else 0)

    vec = Vector(
        (dx / max_dx) * explode_dist * 1.5,
        sy * explode_dist * 0.3,
        0.0
    )

    module_vectors.append(vec)

    T = Translation.from_vector(vec)

    moved_rect = rect.transformed(T)
    moved_center = center.transformed(T)

    R = module_flip_transform(moved_rect, moved_center) if flip_to_world else None

    if R:
        moved_rect = moved_rect.transformed(R)

    exploded_rectangles.append(moved_rect)

    # ============================================================
    # beams from TimberModel
    # ============================================================

    for beam in module_model.beams:
        geo = beam.geometry.transformed(T)

        if R:
            geo = geo.transformed(R)

        exploded_geo.append(geo)

    # ============================================================
    # plates from TimberModel
    # ============================================================

    for plate in module_model.plates:
        geo = plate.geometry.transformed(T)

        if R:
            geo = geo.transformed(R)

        exploded_geo.append(geo)
        plates.append(geo)
# ---------- end python_3_script_4 ----------

# ----
custom_preview = CustomPreview(
    Geometry=working_space_rfl,
    Material={diffuse=RGB(221, 160, 221), emission=RGB(66, 48, 66), shine=0.5, specular=RGB(255, 255, 255), transparency=0})
surface = Surface(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)
plane = Plane(surface)
move_point = MovePoint(geometry=plane, number_x=x_axis, factor=y_axis, factor_2="0.12")

# ---- group: individual modules to sort
module_id = Slider(0, range=0..15)
python_3_script_5 = Python3Script(
    module_rectangles=python_3_script_3.module_rectangles,
    total_modules=python_3_script_3.total_modules,
    colors=python_3_script_3.module_colors,
    module_id=module_id,
    t_frame=move_point)  # -> out, selected_geo, selected_colors, heavy_beams, long_beams, long_beams_blank, module_frame, module_timbermodel, module_beams, module_beam_geometries; inputs module_rectangles: list, total_modules: list, colors: list, module_id: Int32
# ---------- python_3_script_5: Python ----------
from compas_timber.model import TimberModel
from compas.geometry import Frame, Vector, Rotation, Transformation
import math
from compas_rhino.conversions import plane_to_compas_frame

selected_geo = []
selected_colors = []

beam_start_points = []
beam_order = []

heavy_beams = []
long_beams = []
long_beams_blank = []
module_frame = []

module_timbermodel = TimberModel()

# new outputs
module_beams = []
module_beam_geometries = []

if 0 <= module_id < len(total_modules):

    module_model = total_modules[module_id]
    col = colors[module_id]

    target_f = plane_to_compas_frame(t_frame)

    transforms = []

    # ============================================================
    # create module frame from first plate
    # ============================================================

    if len(module_model.plates) > 0:

        f = module_model.plates[0].frame.copy()
        center_pt = f.point.copy()

        if f.zaxis.dot(Vector(0, 0, 1)) < 0:
            f = Frame(f.point, f.xaxis, -f.yaxis)

        local_z = f.zaxis
        world_z = Vector(0, 0, 1)

        axis = local_z.cross(world_z)

        if axis.length > 1e-6:
            axis.unitize()
            angle = local_z.angle(world_z)
            transforms.append(
                Rotation.from_axis_and_angle(axis, angle, point=center_pt)
            )

        transforms.append(
            Rotation.from_axis_and_angle(Vector(0, 1, 0), math.pi, point=center_pt)
        )

        transforms.append(
            Rotation.from_axis_and_angle(
                Vector(0, 0, 1),
                math.radians(-90),
                point=center_pt
            )
        )

        latest_f = f.copy()

        for T in transforms:
            latest_f.transform(T)

        FrameMove = Transformation.from_frame_to_frame(latest_f, target_f)
        transforms.append(FrameMove)

        latest_f.transform(FrameMove)
        module_frame.append(latest_f)

    # ============================================================
    # transform helper
    # ============================================================

    def transform_item(item):
        item = item.copy()
        for T in transforms:
            item.transform(T)
        return item

    # ============================================================
    # transformed timbermodel
    # ============================================================

    for plate in module_model.plates:
        transformed_plate = transform_item(plate)
        module_timbermodel.add_element(transformed_plate)

    for beam in module_model.beams:
        transformed_beam = transform_item(beam)
        transformed_geo = transform_item(beam.geometry)

        module_timbermodel.add_element(transformed_beam)

        module_beams.append(transformed_beam)
        module_beam_geometries.append(transformed_geo)

    # ============================================================
    # plates: always visible
    # ============================================================

    for plate in module_model.plates:
        geo = transform_item(plate.geometry)
        selected_geo.append(geo)
        selected_colors.append(col)

    # ============================================================
    # beams
    # ============================================================

    beam_start_points = []
    beam_order = []

    for i, beam in enumerate(module_model.beams):

        geo = transform_item(beam.geometry)

        # heavy beams
        milled_weight = beam.geometry.volume * 470
        if milled_weight > 45.0:
            heavy_beams.append(geo)

        # long beams
        length = beam.blank.dimensions[0]
        if length > 5.0:
            long_beams.append(geo)
            long_beams_blank.append(transform_item(beam.blank))

        # start point
        start_pt = transform_item(beam.centerline.start)

        beam_start_points.append(start_pt)
        beam_order.append(i)

        # show beam directly (no sorting)
        selected_geo.append(geo)
        selected_colors.append(col)
# ---------- end python_3_script_5 ----------
list_length = ListLength(List=python_3_script_5.selected_geo)
draw_3 = COMPASDraw(cg=python_3_script_5.selected_geo)  # -> rg; same code as draw
panel_4 = Panel(list_length)
custom_preview_2 = CustomPreview(Geometry=draw_3, Material=python_3_script_5.selected_colors)
group = Group(Geometry=draw_3)
bounding_box = BoundingBox(Content=group, Plane=PlaneXY(0, 0, 0))  # -> Box, Box_2
box_corners = BoxCorners(Box=bounding_box.Box)  # -> CornerA, CornerB, CornerC, CornerD, CornerE, CornerF, CornerG, CornerH
line = Line(StartPoint=box_corners.CornerA, EndPoint=box_corners.CornerE)
linear_dimension = LinearDimension(Line=line, PointA=box_corners.CornerA, PointB=box_corners.CornerE, Text="{0:0.000}", Size="0.5")

# ----
draw_4 = COMPASDraw(cg=python_3_script_4.plates)  # -> rg; same code as draw
x_axis_2 = Slider(1.81, range=0..30)
y_axis_2 = Slider(0, range=-30..10)
surface_2 = Surface(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)
plane_2 = Plane(surface_2)

# ---- group: module_index_visualize
# workflow
# input = receive compas timber model from Joint group
# from compas timber model extract beams information
# 
# group in modules as before
# plan sequence
# outputs: modules + information
# sequence inside module
center = Center(Geometry=draw_4)  # -> Center, Dimension
unit_z_2 = UnitZ(Factor="-5")
move_2 = Move(Geometry=center.Center, Motion=unit_z_2)  # -> Geometry, Transform
dot_display = DotDisplay(Point=move_2.Geometry, Colour=ColourSwatch(SwatchColor=RGBA(255, 207, 121, 44)), Size="1")
point_list = PointList(Points=move_2.Geometry, Size=Slider(1, range=0..10))

# ----
beam_id = Slider(19, range=0..46)
cluster = Cluster(geometry=plane_2, origin=plane_2, number_x=x_axis_2, factor_2=y_axis_2, factor="0.12")

# ---- group: visualize explode
draw_5 = COMPASDraw(cg=python_3_script_4.exploded_geo)  # -> rg; same code as draw
custom_preview_3 = CustomPreview(Geometry=draw_5, Material=python_3_script_3.colors)

# ----
python_3_script_6 = Python3Script(
    module_timbermodel=python_3_script_5.module_timbermodel,
    module_beams=python_3_script_5.module_beams,
    module_beam_geometries=python_3_script_5.module_beam_geometries,
    beam_id=beam_id,
    target_frame=cluster)  # -> out, beam_count, selected_beam_geo, rhino_beam_frame, pick_up_face, center_beam, v_beam_face; inputs module_beams: list, module_beam_geometries: list, beam_id: Int32
# ---------- python_3_script_6: Python ----------
from compas_timber.elements import Beam
from compas.geometry import Transformation
from compas.datastructures import Mesh
from compas_rhino.conversions import plane_to_compas_frame, frame_to_rhino_plane

selected_beam = None
selected_beam_geo = None

beam_frame = None
beam_backside_frame = None

moved_beam = None
moved_beam_frame = None
moved_beam_blank = None
moved_pick_up_face = None

all_beams = []
all_beam_geometries = []

beam_count = 0

# ============================================================
# collect beams from Code 1 output
# ============================================================

all_beams = list(module_beams)
all_beam_geometries = list(module_beam_geometries)

beam_count = len(all_beams)

# for beam in 
# ============================================================
# select beam
# ============================================================

if 0 <= beam_id < beam_count:

    beam = all_beams[beam_id]

    selected_beam = beam

    # IMPORTANT:
    # use stored transformed beam.geometry from Code 1
    # this keeps the joint / cut shape visible
    selected_beam_geo = all_beam_geometries[beam_id]


    beam_face = beam.side_as_surface(0)
    pick_up_point = beam_face.point_at(0.5,0.5)

    v_beam_face = beam_face.to_mesh()

    beam_frame = beam.frame
    beam_frame.point = pick_up_point
    rhino_beam_frame = frame_to_rhino_plane(beam_frame)
# ---------- end python_3_script_6 ----------
draw_6 = COMPASDraw(cg=python_3_script_5.module_frame)  # -> rg; same code as draw
beam_count = Panel(python_3_script_6.beam_count)
plane_3 = Plane(python_3_script_6.rhino_beam_frame)
draw_7 = COMPASDraw(cg=python_3_script_6.v_beam_face)  # -> rg; same code as draw
draw_8 = COMPASDraw(cg=python_3_script_6.pick_up_face)  # -> rg; same code as draw
python_3_script_7 = Python3Script()  # -> out, beam_count, selected_beam_geo, beam_frame, pick_up_face; inputs module_beams: list, module_beam_geometries: list, beam_id: Int32
# ---------- python_3_script_7: Python ----------
from compas_timber.elements import Beam
from compas.geometry import Transformation
from compas_rhino.conversions import plane_to_compas_frame, frame_to_rhino_plane

selected_beam = None
selected_beam_geo = None

beam_frame = None
beam_backside_frame = None
pick_up_face = None

moved_beam = None
moved_beam_frame = None
moved_beam_blank = None
moved_pick_up_face = None

all_beams = []
all_beam_geometries = []

beam_count = 0

# ============================================================
# collect beams from Code 1 output
# ============================================================

all_beams = list(module_beams)
all_beam_geometries = list(module_beam_geometries)

beam_count = len(all_beams)

# ============================================================
# select beam
# ============================================================

if 0 <= beam_id < beam_count:

    beam = all_beams[beam_id]

    selected_beam = beam

    # IMPORTANT:
    # use stored transformed beam.geometry from Code 1
    # this keeps the joint / cut shape visible
    selected_beam_geo = all_beam_geometries[beam_id]

    beam_frame = frame_to_rhino_plane(beam.frame)

    # ========================================================
    # pickup face / pickup geometry
    # ========================================================
    # Do NOT use beam.side_as_surface()
    # because it only gives the original rectangular side.
    # Use selected_beam_geo because it already contains the cuts / joints.

    pick_up_face = selected_beam_geo

    # ========================================================
    # move beam
    # ========================================================

    ref_side_index = 0

    if 0 <= ref_side_index <= 3:

        beam_backside_frame = beam.back_side(ref_side_index)

        target_f = plane_to_compas_frame(target_frame)

        T = Transformation.from_frame_to_frame(
            beam_backside_frame,
            target_f
        )

        moved = beam.copy()
        moved.transform(T)

        moved_beam = selected_beam_geo.copy()
        moved_beam.transform(T)

        moved_pick_up_face = pick_up_face.copy()
        moved_pick_up_face.transform(T)

        moved_beam_blank = moved.blank
        moved_beam_frame = frame_to_rhino_plane(moved.frame)
# ---------- end python_3_script_7 ----------

# ---- group: informations
python_3_script_8 = Python3Script(total_modules=python_3_script_3.total_modules)  # -> out, heavy_beams, long_beams_blank, long_beams_length, long_beams, beam_info_tree, milled_beam_volume, milled_beam_weight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; inputs total_modules: list
# ---------- python_3_script_8: Python ----------
# ============================================================
## volume each modules ###
# ============================================================

total_beams_volume = []
total_beams_weight = []
total_plate_volume = []
total_plate_weight = []
number_of_beams = []
number_of_plates = []
milled_beam_volume = []
milled_beam_weight = []

for module_model in total_modules:
    total_volume_beam = 0.0
    total_weight_beam = 0.0
    total_volume_plate = 0.0
    total_weight_plate = 0.0

    total_milled_volume_beam = 0.0
    total_milled_weight_beam = 0.0

    for beam in module_model.beams:
        beam_vol = beam.width * beam.height * beam.length
        total_volume_beam += beam_vol
        total_weight_beam += beam_vol * 470

        milled_volume = beam.geometry.volume
        total_milled_volume_beam += milled_volume
        total_milled_weight_beam += milled_volume * 470

    for plate in module_model.plates:
        plate_vol = plate.width * plate.length * plate.thickness
        total_volume_plate += plate_vol
        total_weight_plate += plate_vol * 470

    total_beams_volume.append(total_volume_beam)
    total_beams_weight.append(total_weight_beam)
    total_plate_volume.append(total_volume_plate)
    total_plate_weight.append(total_weight_plate)

    number_of_beams.append(len(module_model.beams))
    number_of_plates.append(len(module_model.plates))

    milled_beam_volume.append(total_milled_volume_beam)
    milled_beam_weight.append(total_milled_weight_beam)


# ============================================================
## each beam information ###
# ============================================================

from Grasshopper import DataTree
from Grasshopper.Kernel.Data import GH_Path

beam_info_tree = DataTree[object]()
long_beams_length = DataTree[object]()

all_lengths = []
all_weights = []

long_beams = []
long_beams_blank = []
heavy_beams = []

for i, module_model in enumerate(total_modules):
    path = GH_Path(i)

    beam_info_tree.Add("module {}".format(i), path)

    for j, beam in enumerate(module_model.beams):
        length = beam.blank.dimensions[0]
        width = beam.blank.dimensions[1]
        height = beam.blank.dimensions[2]

        volume = beam.width * beam.height * beam.length
        weight = volume * 470

        milled_volume = beam.geometry.volume
        milled_weight = milled_volume * 470

        text = "beam {} | length = {:.3f} m | weight (milled) = {:.3f} kg | cross-section = {:.3f} x {:.3f} m".format(
            j, length, milled_weight, width, height
        )

        beam_info_tree.Add(text, path)

        # ============================================================
        # beams longer than 5 m
        # ============================================================
        if length > 5.0:
            long_beams.append(beam.geometry)
            long_beams_blank.append(beam.blank)

            text_length = "beam {} | length = {:.3f} m".format(j, length)
            long_beams_length.Add(text_length, path)

        # ============================================================
        # beams heavier than 45 kg
        # ============================================================
        if milled_weight > 45.0:
            heavy_beams.append(beam.geometry)


# ============================================================
## height each modules ###
# ============================================================

from compas.geometry import bounding_box
from compas.geometry import Line

module_heights = []
module_bboxes = []

for module_model in total_modules:
    pts = []

    for beam in module_model.beams:
        if hasattr(beam, "centerline"):
            pts.append(beam.centerline.start)
            pts.append(beam.centerline.end)

    for plate in module_model.plates:
        if hasattr(plate, "frame"):
            pts.append(plate.frame.point)

    if not pts:
        module_heights.append(0.0)
        module_bboxes.append(None)
        continue

    bbox = bounding_box(pts)
    z_values = [p[2] for p in bbox]
    height = max(z_values) - min(z_values)

    module_heights.append(height)
    module_bboxes.append(bbox)


bbox_lines = []

for bbox in module_bboxes:
    if not bbox:
        continue

    p0, p1, p2, p3, p4, p5, p6, p7 = bbox

    lines = [
        Line(p0, p1), Line(p1, p2), Line(p2, p3), Line(p3, p0),
        Line(p4, p5), Line(p5, p6), Line(p6, p7), Line(p7, p4),
        Line(p0, p4), Line(p1, p5), Line(p2, p6), Line(p3, p7)
    ]

    bbox_lines.extend(lines)
# ---------- end python_3_script_8 ----------

# ---- group: beam that are heavier than 45 kg
draw_9 = COMPASDraw(cg=python_3_script_5.heavy_beams)  # -> rg; same code as draw
custom_preview_4 = CustomPreview(Geometry=draw_9, Material=ColourSwatch(SwatchColor=RGB(255, 0, 0)))

# ----
draw_10 = COMPASDraw(cg=python_3_script_6.selected_beam_geo)  # -> rg; same code as draw
list_length_2 = ListLength(List=draw_9)
custom_preview_5 = CustomPreview(Geometry=draw_7, Material=ColourSwatch(SwatchColor=RGB(242, 186, 0)))
draw_11 = COMPASDraw(cg=python_3_script_8.bbox_lines)  # -> rg; same code as draw
num_of_beam_45_kg = Panel(list_length_2)
custom_preview_6 = CustomPreview(Geometry=draw_10, Material=ColourSwatch(SwatchColor=RGB(0, 0, 150)))
draw_12 = COMPASDraw(cg=python_3_script_8.long_beams)  # -> rg; same code as draw

# ---- group: beam that are heavier than 45 kg
draw_13 = COMPASDraw(cg=python_3_script_8.heavy_beams)  # -> rg; same code as draw
custom_preview_7 = CustomPreview(Geometry=draw_13, Material=ColourSwatch(SwatchColor=RGB(255, 0, 0)))

# ----
custom_preview_8 = CustomPreview(Geometry=draw_12, Material=ColourSwatch(SwatchColor=RGB(0, 0, 150)))
draw_14 = COMPASDraw(cg=python_3_script_5.long_beams)  # -> rg; same code as draw
draw_15 = COMPASDraw(cg=python_3_script_5.long_beams_blank)  # -> rg; same code as draw
beam_length_5_m = Panel(draw_12)
beam_information = Panel(python_3_script_8.beam_info_tree)
total_beams_volume_m3 = Panel(python_3_script_8.milled_beam_volume)
total_beams_weight_kg = Panel(python_3_script_8.milled_beam_weight)
total_plates_volume_m3 = Panel(python_3_script_8.total_plate_volume)
total_plates_weight_kg = Panel(python_3_script_8.total_plate_weight)
number_of_beams = Panel(python_3_script_8.number_of_beams)
number_of_plates = Panel(python_3_script_8.number_of_plates)
module_heights_m = Panel(python_3_script_8.module_heights)

# ---- group: beam that are longer than 5 m
deconstruct_brep = DeconstructBrep(Brep=draw_15)  # -> Faces, Edges, Vertices
custom_preview_9 = CustomPreview(Geometry=draw_14, Material=ColourSwatch(SwatchColor=RGB(0, 0, 150)))
list_item = ListItem(List=deconstruct_brep.Vertices, Index="0", Wrap=True)
list_item_2 = ListItem(List=deconstruct_brep.Vertices, Index="1", Wrap=True)
line_2 = Line(StartPoint=list_item, EndPoint=list_item_2)
linear_dimension_2 = LinearDimension(Line=line_2, PointA=list_item, PointB=list_item_2, Text="{0:0.000}", Size="0.5")

# ----
list_length_3 = ListLength(List=draw_13)
panel_5 = Panel(python_3_script_8.long_beams_length)
draw_16 = COMPASDraw(cg=python_3_script_8.long_beams_blank)  # -> rg; same code as draw
list_length_4 = ListLength(List=beam_length_5_m)  # -> flatten(Length)
panel_6 = Panel("""0
1
6
7""")
panel_7 = Panel("""0
1
6
7""")
panel_8 = Panel("""0
1
6
7""")
panel_9 = Panel("""0
1
6
7""")
panel_10 = Panel("""0
1
6
7""")
panel_11 = Panel("""0
1
6
7""")
mass_addition = MassAddition(Input=number_of_plates)  # -> Result, PartialResults
deconstruct_brep_2 = DeconstructBrep(Brep=draw_16)  # -> Faces, Edges, Vertices
num_of_beam_45_kg_2 = Panel(list_length_3)
list_item_3 = ListItem(List=total_beams_volume_m3, Index=panel_6, Wrap=True)
list_item_4 = ListItem(List=total_beams_weight_kg, Index=panel_7, Wrap=True)
list_item_5 = ListItem(List=total_plates_volume_m3, Index=panel_8, Wrap=True)
list_item_6 = ListItem(List=total_plates_weight_kg, Index=panel_9, Wrap=True)
list_item_7 = ListItem(List=number_of_beams, Index=panel_10, Wrap=True)
list_item_8 = ListItem(List=module_heights_m, Index=panel_11, Wrap=True)
totalnum_beam_length_5_m = Panel(list_length_4)
panel_12 = Panel(list_item_3)
panel_13 = Panel(list_item_4)
panel_14 = Panel(list_item_5)
panel_15 = Panel(list_item_6)
panel_16 = Panel(list_item_7)
panel_17 = Panel(list_item_8)
number_of_plates_2 = Panel(mass_addition.Result)
list_item_9 = ListItem(List=deconstruct_brep_2.Vertices, Index="0", Wrap=True)
list_item_10 = ListItem(List=deconstruct_brep_2.Vertices, Index="1", Wrap=True)
panel_18 = Panel("""0
1
6
7""")
line_3 = Line(StartPoint=list_item_9, EndPoint=list_item_10)
mass_addition_2 = MassAddition(Input=panel_16)  # -> Result, PartialResults
tree_branch = TreeBranch(Tree=beam_information, Path=panel_18, MaintainPaths=True)
linear_dimension_3 = LinearDimension(Line=line_3, PointA=list_item_9, PointB=list_item_10, Text="{0:0.000}", Size="0.5")
beam_information_2 = Panel(tree_branch)
multiplication = Multiplication(A=mass_addition_2.Result, B="4")

# ---- group: total_weight_per_module (kg)
panel_m2 = Expression(total_beams_weight_kg=panel_13, clt_panel_weight_kg=panel_15, Expression="total_beams_weight_kg+clt_panel_weight_kg")

# ----
number_of_beams_2 = Panel(multiplication)
area = Area(Geometry=draw_2)  # -> Area, Centroid
total_weight_per_module_kg = Panel(panel_m2)

# ---- group: Area Density = Weight Per Module / Plate Area (kg/m2)
panel_m2_2 = Expression(total_weight_per_module=panel_m2, plate_area=area.Area, Expression="total_weight_per_module/plate_area")

# ----
mass_addition_3 = MassAddition(Input=total_weight_per_module_kg)  # -> Result, PartialResults
multiplication_2 = Multiplication(A=mass_addition_3.Result, B="4")
total_weight_kg = Panel(multiplication_2)
weight_per_module_plate_area_kg_m2 = Panel(panel_m2_2)
panel_19 = Panel("""0
1
6
7""")
list_item_11 = ListItem(List=weight_per_module_plate_area_kg_m2, Index=panel_19, Wrap=True)
panel_20 = Panel(list_item_11)

# ==== cluster MovePoint
number_x = ClusterInput()
factor = ClusterInput()
x_minus_one = XMinusOne(NumberX=number_x)
unit_x = UnitX(Factor=x_minus_one)
unit_y = UnitY(Factor=factor)
geometry = ClusterInput()
move = Move(Geometry=geometry, Motion=unit_x)  # -> Geometry, Transform
factor_2 = ClusterInput()
move_2 = Move(Geometry=move.Geometry, Motion=unit_y)  # -> Geometry, Transform
unit_z = UnitZ(Factor=factor_2)
move_3 = Move(Geometry=move_2.Geometry, Motion=unit_z)  # -> Geometry, Transform
geometry_2 = ClusterOutput(move_3.Geometry)

# ==== cluster Cluster
geometry = ClusterInput()
origin = ClusterInput()
factor = ClusterInput()
number_x = ClusterInput()
factor_2 = ClusterInput()
xy_plane = XYPlane(Origin=origin)
rotate = Rotate(Geometry=geometry, Angle=1.570796327, Plane=xy_plane)  # -> Geometry, Transform
x_minus_one = XMinusOne(NumberX=number_x)
unit_x = UnitX(Factor=x_minus_one)
unit_y = UnitY(Factor=factor_2)
move = Move(Geometry=rotate.Geometry, Motion=unit_x)  # -> Geometry, Transform
move_2 = Move(Geometry=move.Geometry, Motion=unit_y)  # -> Geometry, Transform
unit_z = UnitZ(Factor=factor)
move_3 = Move(Geometry=move_2.Geometry, Motion=unit_z)  # -> Geometry, Transform
geometry_2 = ClusterOutput(move_3.Geometry)
