# Grasshopper definition modulization_rs_29042026_update.gh (Grasshopper 1.0.8)

# ---- group: boxes
curve = Curve([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])
offset = OffsetCurve(Curve=curve, Distance=Slider(0.2, range=0..1), Corners=1)
python_3_script = Python3Script(x=flatten(curve), y=flatten(offset))  # -> out, boxes, x_sorted, y_sorted; inputs x: list of Curve, y: list of Curve
# ---------- python_3_script: Python ----------
from compas.geometry import bounding_box, Box
from compas_rhino.conversions import curve_to_compas_polyline

def curve_xy_key(curve):
    c = curve_to_compas_polyline(curve)
    pts = c.points
    bb = bounding_box(pts)

    # center of bounding box
    cx = (bb[0][0] + bb[6][0]) * 0.5
    cy = (bb[0][1] + bb[6][1]) * 0.5

    # return (cx, cy)
    return (round(cy, 3), cx)

# sort first
x_sorted = sorted(x, key=curve_xy_key)
y_sorted = sorted(y, key=curve_xy_key)

boxes = []
for curve in y_sorted:
    c = curve_to_compas_polyline(curve)
    points = c.points
    a = Box.from_bounding_box(bounding_box(points))
    a.zsize = 20.0
    boxes.append(a)

print(boxes)
# ---------- end python_3_script ----------

# ----
unit_z = UnitZ(Factor="0.06")

# ---- group: secondary
# input TimberModel
curve_2 = Curve([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])
curve_3 = Curve([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])
curve_4 = Curve([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])
curve_5 = Curve([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])

# ----
draw = COMPASDraw(cg=python_3_script.boxes)  # -> rg
#   port cg: The COMPAS geometry or datastructure to be drawn.
#   port rg: The Rhino geometry object.
# ---------- draw: Python ----------
# r: compas>=2.14.1
"""
Draws COMPAS geometry in Grasshopper.
"""

from typing import Any

import Grasshopper

from compas.scene import SceneObject


class CompasToRhinoGeometry(Grasshopper.Kernel.GH_ScriptInstance):
    def RunScript(self, cg):
        if not cg:
            return None

        return SceneObject(item=cg).draw()
# ---------- end draw ----------
move = Move(Geometry=python_3_script.x_sorted, Motion=unit_z)  # -> Geometry, Transform

# ---- group: primary
curve_6 = Curve([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])
curve_7 = Curve([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])
curve_8 = Curve(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)
curve_9 = Curve([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])
curve_10 = Curve([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])

# ---- group: shoe
curve_11 = Curve([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])

# ---- group: compas_timber
python_3_script_2 = Python3Script(
    p_1=curve_8,
    p_2=curve_7,
    p_3=curve_10,
    p_4=curve_6,
    p_5=curve_9,
    s_1=curve_4,
    s_2=curve_2,
    s_3=curve_5,
    s_4=curve_3,
    s_5=curve_11,
    clt_plates=move.Geometry,
    boxes=python_3_script.boxes)  # -> out, a, final_models, base_model; inputs p_1: list of Line, p_2: list of Line, p_3: list of Line, p_4: list of Line, p_5: list of Line, s_1: list of Line, s_2: list of Line, s_3: list of Line, s_4: list of Line, s_5: list of Line, clt_plates: list of Polyline, boxes: list
# ---------- python_3_script_2: Python ----------
from compas.scene import Scene
from compas_rhino.conversions import line_to_compas
from compas.tolerance import Tolerance, TOL

from compas_timber.model import TimberModel
from compas_timber.elements import Beam, Plate

from compas_timber.connections import JointTopology
from compas_timber.connections import TMultiStepJoint
from compas_timber.connections import TStepJoint
from compas_timber.connections import LMiterJoint
from compas_timber.connections import TBirdsmouthJoint
from compas_timber.connections import XLapJoint

from compas_rhino.conversions import line_to_compas, polyline_to_compas

from compas.geometry import Frame, Vector, Point, angle_vectors, centroid_points

from statistics import mean

#initialise scene object
scene = Scene()

#initialise compas timber model
base_model = TimberModel(Tolerance(unit="MM", absolute="0.001"))

# ============================================================
# Helper: make polygon point order consistent with world Z+
# ============================================================
def oriented_polyline_to_world_z_plus(compas_poly):
    pts = list(compas_poly.points)

    if len(pts) < 3:
        return compas_poly, Vector(0, 0, 1)

    # remove duplicate last point if closed
    if pts[0] == pts[-1]:
        pts = pts[:-1]

    if len(pts) < 3:
        return compas_poly, Vector(0, 0, 1)

    p0 = pts[0]
    p1 = pts[1]
    p2 = pts[2]

    frame = Frame.from_points(p0, p1, p2)
    local_z = frame.zaxis
    world_z = Vector(0, 0, 1)

    # if normal points downward, reverse point order
    if local_z.dot(world_z) < 0:
        pts.reverse()

        # close it again if original was closed
        pts.append(pts[0])

        compas_poly = type(compas_poly)(pts)

        p0 = compas_poly.points[0]
        p1 = compas_poly.points[1]
        p2 = compas_poly.points[2]

        frame = Frame.from_points(p0, p1, p2)
        local_z = frame.zaxis

    return compas_poly, local_z

# ============================================================
# Create CLT Plates
# ============================================================
plates = []
models = []

for c in clt_plates:
    compas_poly = polyline_to_compas(c)
    if compas_poly is None:
        continue
    center = centroid_points(compas_poly.points)    
    for b in boxes:
        model = TimberModel(Tolerance(unit="MM", absolute="0.001"))
        if b.contains_point(center):
            compas_poly, local_z = oriented_polyline_to_world_z_plus(compas_poly)

            plate = Plate.from_outline_thickness(
                compas_poly,
                thickness=0.12,
                vector=local_z
            )

            plates.append(plate)
            model.add_element(plate)
            base_model.add_element(plate)
            models.append(model)


#beam list
beams = []

#convert rhino curves into compas lines
"primary lines"
p_1 = [line_to_compas(c) for c in p_1]
p_2 = [line_to_compas(c) for c in p_2]
p_3 = [line_to_compas(c) for c in p_3]
p_4 = [line_to_compas(c) for c in p_4]
p_5 = [line_to_compas(c) for c in p_5]

"secondary lines"
s_1 = [line_to_compas(c) for c in s_1]
s_2 = [line_to_compas(c) for c in s_2]
s_3 = [line_to_compas(c) for c in s_3]
s_4 = [line_to_compas(c) for c in s_4]

"tertiary (shoe) lines"
s_5 = [line_to_compas(c) for c in s_5]

#assign beam names and width
"primary lines"
for l in p_1:
    for b, m in zip(boxes, models):
        if b.contains_point(l.start) or b.contains_point(l.end):
            l.name = "primary_1"
            beam = Beam.from_centerline(l, width=.120, height=.160)
            beam.name = "primary"
            if b.contains_point(l.midpoint):
                beam.attributes["neighbour"] = False
            else:
                beam.attributes["neighbour"] = True
            beams.append(beam)
            m.add_element(beam)
            base_model.add_element(beam)

for l in p_2:
    for b, m in zip(boxes, models):
        if b.contains_point(l.start) or b.contains_point(l.end):
            l.name = "primary_2"
            beam = Beam.from_centerline(l, width=.120, height=.180)
            beam.name = "primary"
            if b.contains_point(l.midpoint):
                beam.attributes["neighbour"] = False
            else:
                beam.attributes["neighbour"] = True
            beams.append(beam)
            m.add_element(beam)
            base_model.add_element(beam)

for l in p_3:
    for b, m in zip(boxes, models):
        if b.contains_point(l.start) or b.contains_point(l.end):
            l.name = "primary_3"
            beam = Beam.from_centerline(l, width=.140, height=.180)
            beam.name = "primary"
            if b.contains_point(l.midpoint):
                beam.attributes["neighbour"] = False
            else:
                beam.attributes["neighbour"] = True
            beams.append(beam)
            m.add_element(beam)
            base_model.add_element(beam)

for l in p_4:
    for b, m in zip(boxes, models):
        if b.contains_point(l.start) or b.contains_point(l.end):
            l.name = "primary_4"
            beam = Beam.from_centerline(l, width=.140, height=.200)
            beam.name = "primary"
            if b.contains_point(l.midpoint):
                beam.attributes["neighbour"] = False
            else:
                beam.attributes["neighbour"] = True
            beams.append(beam)
            m.add_element(beam)
            base_model.add_element(beam)

for l in p_5:
    for b, m in zip(boxes, models):
        if b.contains_point(l.start) or b.contains_point(l.end):
            l.name = "primary_5"
            beam = Beam.from_centerline(l, width=.140, height=.240)
            beam.name = "primary"
            if b.contains_point(l.midpoint):
                beam.attributes["neighbour"] = False
            else:
                beam.attributes["neighbour"] = True
            beams.append(beam)
            m.add_element(beam)
            base_model.add_element(beam)

"Secondary lines"
for l in s_1:
    for b, m in zip(boxes, models):
        if b.contains_point(l.start) or b.contains_point(l.end):
            l.name = "secondary_1"
            beam = Beam.from_centerline(l, width=.120, height=.160)
            beam.name = "secondary"
            if b.contains_point(l.midpoint):
                beam.attributes["neighbour"] = False
            else:
                beam.attributes["neighbour"] = True
            beams.append(beam)
            m.add_element(beam)
            base_model.add_element(beam)

for l in s_2:
    for b, m in zip(boxes, models):
        if b.contains_point(l.start) or b.contains_point(l.end):
            l.name = "secondary_2"
            beam = Beam.from_centerline(l, width=.120, height=.180)
            beam.name = "secondary"
            if b.contains_point(l.midpoint):
                beam.attributes["neighbour"] = False
            else:
                beam.attributes["neighbour"] = True
            beams.append(beam)
            m.add_element(beam)
            base_model.add_element(beam)

for l in s_3:
    for b, m in zip(boxes, models):
        if b.contains_point(l.start) or b.contains_point(l.end):
            l.name = "secondary_3"
            beam = Beam.from_centerline(l, width=.140, height=.180)
            beam.name = "secondary"
            if b.contains_point(l.midpoint):
                beam.attributes["neighbour"] = False
            else:
                beam.attributes["neighbour"] = True
            beams.append(beam)
            m.add_element(beam)
            base_model.add_element(beam)

for l in s_4:
    for b, m in zip(boxes, models):
        if b.contains_point(l.start) or b.contains_point(l.end):
            l.name = "secondary_4"
            beam = Beam.from_centerline(l, width=.140, height=.200)
            beam.name = "secondary"
            if b.contains_point(l.midpoint):
                beam.attributes["neighbour"] = False
            else:
                beam.attributes["neighbour"] = True
            beams.append(beam)
            m.add_element(beam)
            base_model.add_element(beam)

"tertiary lines"
for l in s_5:
    for b, m in zip(boxes, models):
        if b.contains_point(l.start) or b.contains_point(l.end):
            l.name = "tertiary"
            beam = Beam.from_centerline(l, width=.120, height=.120)
            beam.name = "tertiary"
            if b.contains_point(l.midpoint):
                beam.attributes["neighbour"] = False
            else:
                beam.attributes["neighbour"] = True
            beams.append(beam)
            m.add_element(beam)
            base_model.add_element(beam)

#reset beams and features
for model in models:
    for beam in model.beams:
        beam.remove_features()

    #compute line network
    base_model.connect_adjacent_beams()
    model.connect_adjacent_beams()

    #debugging tools
    candidates_a = []
    candidates_b = []
    frames_a = []
    frames_b = []
    planarity_check = []

    #set joint conditions
    for candidate in model.joint_candidates:
        
        #check for frames
        frame_a = candidate.element_a.frame
        frame_a.xaxis = Vector(0,0,1)
        frames_a.append (frame_a)

        frame_b = candidate.element_b.frame
        frame_b.xaxis = Vector(0,0,1)
        frames_b.append (frame_b)

        #visualise candidates for debug
        candidates_a.append(Beam.from_centerline(candidate.element_a.centerline, width = .1, height = .1))
        candidates_b.append(Beam.from_centerline(candidate.element_b.centerline, width = .1, height = .1))

        #planarity check between candidate a and candidate b
        planarity = (angle_vectors(frame_a.normal, frame_b.normal, deg=True))
        planarity_check.append(planarity)
        
        is_planar = bool
        if planarity < 0.2 or planarity > 179.8:
            is_planar = True
        else:
            is_planar = False
        # print (is_planar)

        #check for mid_point = above certain z_height
        a_is_shoe = bool
        b_is_shoe = bool
        ceiling_height = 24.48

        height_a = candidate.element_a.centerline.midpoint.z
        if height_a > ceiling_height:
            a_is_shoe = True
        else:
            a_is_shoe = False
            
        height_b = candidate.element_b.centerline.midpoint.z
        if height_b > ceiling_height:
            b_is_shoe = True
        else:
            b_is_shoe = False

        #joints based on topology, planarity and z height
        if candidate.topology == JointTopology.TOPO_T and is_planar == True:
            if b_is_shoe == True:
                t_step_joint = TMultiStepJoint.create(model, candidate.element_a, candidate.element_b, step_count=2)
            
            else:
                if angle_vectors(candidate.element_a.centerline.direction, candidate.element_b.centerline.direction, deg=True) < 50:
                    step_shape = "heel"
                else:
                    step_shape = "step"
                
                # print (candidate.element_a.centerline.name)
                t_step_joint = TMultiStepJoint.create(model, candidate.element_a, candidate.element_b, step_shape=step_shape, step_depth=.02, riser_angle=90)
        
        elif candidate.topology == JointTopology.TOPO_T and is_planar == False:
            t_bm_joint = TBirdsmouthJoint.create(model, candidate.element_a, candidate.element_b)

        elif candidate.topology==JointTopology.TOPO_L:
            l_miter_joint = LMiterJoint.create(model, candidate.element_a, candidate.element_b, cutoff = False)

        elif candidate.topology == JointTopology.TOPO_X:
            x_lap_joint = XLapJoint.create(model, candidate.element_a, candidate.element_b)

        else:
            # print ("some joints were not created!")
            continue

    #process joints in compas timber model
    model.process_joinery()

final_models = []

for m in models:
    final_models.append(m)

    #visualise geometries
    for beam in (m.beams):
        scene.add(beam.geometry)

    for plate in (m.plates):
        scene.add(plate.geometry)
    print("ADDED")

a = scene.draw()
# ---------- end python_3_script_2 ----------

# ----
panel = Panel(python_3_script_2.base_model)
geometry = Geometry(python_3_script_2.a)
number_slider = Slider(3, range=0..3)
panel_2 = Panel("""0
1
6
7""")
panel_3 = Panel(python_3_script_2.final_models)
item = ListItem(List=python_3_script_2.final_models, Index=panel_2, Wrap=True)

# ---- group: json_dump of 4 modules
py3 = Python3Script(x=item, y=Button())  # -> out, a; inputs x: list
# ---------- py3: Python ----------
from compas.data import json_dump

if y:
    for i, m in enumerate(x):
        fp = rf"E:\ETH_DFAB\SEM 2\week 10\new\t2_tm_{i}.json"
        
        json_dump(m, fp, pretty=True)
# ---------- end py3 ----------

# ----
panel_4 = Panel(item)

# ---- group: visualize modules based on index
py3_2 = Python3Script(x=item, y=number_slider)  # -> out, a; inputs x: list, y: Int32
# ---------- py3_2: Python ----------
from compas.scene import Scene
from compas_rhino.conversions import line_to_compas
from compas.tolerance import Tolerance, TOL

from compas_timber.model import TimberModel
from compas_timber.elements import Beam, Plate

from compas_timber.connections import JointTopology
from compas_timber.connections import TMultiStepJoint
from compas_timber.connections import TStepJoint
from compas_timber.connections import LMiterJoint
from compas_timber.connections import TBirdsmouthJoint
from compas_timber.connections import XLapJoint

from compas_rhino.conversions import line_to_compas, polyline_to_compas

from compas.geometry import Frame, Vector, Point, angle_vectors, centroid_points

from statistics import mean


scene = Scene()
# for m in x:
# model = x[y]
for beam in (x[y].beams):
    if not beam.attributes["neighbour"]:
        scene.add(beam.geometry)

for plate in (x[y].plates):
    scene.add(plate.geometry)
a = scene.draw()
# ---------- end py3_2 ----------

# ---- group: visualize neighbour beams based on module index
py3_3 = Python3Script(x=item, y=number_slider)  # -> out, a; inputs x: list, y: Int32
# ---------- py3_3: Python ----------
from compas.scene import Scene
from compas_rhino.conversions import line_to_compas
from compas.tolerance import Tolerance, TOL

from compas_timber.model import TimberModel
from compas_timber.elements import Beam, Plate

from compas_timber.connections import JointTopology
from compas_timber.connections import TMultiStepJoint
from compas_timber.connections import TStepJoint
from compas_timber.connections import LMiterJoint
from compas_timber.connections import TBirdsmouthJoint
from compas_timber.connections import XLapJoint

from compas_rhino.conversions import line_to_compas, polyline_to_compas

from compas.geometry import Frame, Vector, Point, angle_vectors, centroid_points

from statistics import mean


scene = Scene()
# for m in x:
# model = x[y]
for beam in (x[y].beams):
    if beam.attributes["neighbour"]:
        scene.add(beam.geometry)
a = scene.draw()
# ---------- end py3_3 ----------

# ---- group: informations
python_3_script_3 = Python3Script(final_models=item)  # -> out, heavy_beams, long_beams_blank, long_beams_length, long_beams, beam_info_tree, milled_beam_volume, milled_beam_weight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; inputs final_models: list
# ---------- python_3_script_3: Python ----------
# ============================================================
## volume each modules ###
# ============================================================

total_beams_volume = []
total_beams_weight = []
total_plate_volume = []
total_plate_weight = []
number_of_beams = []
number_of_plates = []
milled_beam_volume = []
milled_beam_weight = []
plate_area = []

for module_model in final_models:
    total_volume_beam = 0.0
    total_weight_beam = 0.0
    total_volume_plate = 0.0
    total_weight_plate = 0.0

    total_milled_volume_beam = 0.0
    total_milled_weight_beam = 0.0

    for beam in module_model.beams:
        beam_vol = beam.width * beam.height * beam.length
        total_volume_beam += beam_vol
        total_weight_beam += beam_vol * 470

        milled_volume = beam.geometry.volume
        total_milled_volume_beam += milled_volume
        total_milled_weight_beam += milled_volume * 470

    for plate in module_model.plates:
        plate_vol = plate.width * plate.length * plate.thickness
        total_volume_plate += plate_vol
        total_weight_plate += plate_vol * 470
        plate_ar = plate.width * plate.length

    total_beams_volume.append(total_volume_beam)
    total_beams_weight.append(total_weight_beam)
    total_plate_volume.append(total_volume_plate)
    total_plate_weight.append(total_weight_plate)

    number_of_beams.append(len(module_model.beams))
    number_of_plates.append(len(module_model.plates))

    milled_beam_volume.append(total_milled_volume_beam)
    milled_beam_weight.append(total_milled_weight_beam)

    plate_area.append(plate_ar)


# ============================================================
## each beam information ###
# ============================================================

from Grasshopper import DataTree
from Grasshopper.Kernel.Data import GH_Path

beam_info_tree = DataTree[object]()
long_beams_length = DataTree[object]()

all_lengths = []
all_weights = []

long_beams = []
long_beams_blank = []
heavy_beams = []

for i, module_model in enumerate(final_models):
    path = GH_Path(i)

    beam_info_tree.Add("module {}".format(i), path)

    for j, beam in enumerate(module_model.beams):
        length = beam.blank.dimensions[0]
        width = beam.blank.dimensions[1]
        height = beam.blank.dimensions[2]

        volume = beam.width * beam.height * beam.length
        weight = volume * 470

        milled_volume = beam.geometry.volume
        milled_weight = milled_volume * 470

        text = "beam {} | length = {:.3f} m | weight (milled) = {:.3f} kg | cross-section = {:.3f} x {:.3f} m".format(
            j, length, milled_weight, width, height
        )

        beam_info_tree.Add(text, path)

        # ============================================================
        # beams longer than 5 m
        # ============================================================
        if length > 5.0:
            long_beams.append(beam.geometry)
            long_beams_blank.append(beam.blank)

            text_length = "beam {} | length = {:.3f} m".format(j, length)
            long_beams_length.Add(text_length, path)

        # ============================================================
        # beams heavier than 45 kg
        # ============================================================
        if milled_weight > 45.0:
            heavy_beams.append(beam.geometry)
# ---------- end python_3_script_3 ----------

# ---- group: add attributes (frames)
module_id = Slider(2, range=0..3)
# what to do foooooor sequence hihi: 1.create a tag to see the name of each beam (extract the beam.name)
# 
# 2.compare to the sequence
# 
# 
# 
# sort by:
# height
# shoe, primary, secondary
# node
# grasp_frames
python_3_script_4 = Python3Script(final_models=item, module_id=module_id)  # -> out, geometry, v_beam_faces, rhino_beam_frames, final_models_with_attributes; inputs final_models: list, module_id: Int32
# ---------- python_3_script_4: Python ----------
from compas.geometry import Frame, Vector, Rotation, Transformation
import math
from compas_rhino.conversions import plane_to_compas_frame, frame_to_rhino_plane

geometry = []

rhino_beam_frames = []
v_beam_faces = []

heavy_beams = []

final_models_with_attributes = final_models

for module_model in final_models_with_attributes:
    for beam in module_model.beams:
        if not beam.attributes.get("neighbour", False):
            beam_face = beam.side_as_surface(0)
            pick_up_point = beam_face.point_at(0.5, 0.5)

            beam_frame = beam.frame.copy()
            beam_frame.point = pick_up_point

            beam.attributes["grasp_frame"] = beam_frame


if 0 <= module_id < len(final_models_with_attributes):
    module_model = final_models_with_attributes[module_id]
    for plate in module_model.plates:
        geometry.append(plate.geometry)

    for i, beam in enumerate(module_model.beams):
        if not beam.attributes.get("neighbour", False):
            geometry.append(beam.geometry)
            beam_frame = beam.attributes.get("grasp_frame")
            if beam_frame:
                rhino_beam_frames.append(frame_to_rhino_plane(beam_frame))
                beam_face = beam.side_as_surface(0)
                v_beam_faces.append(beam_face.to_mesh())

            length = beam.blank.dimensions[0]
            width = beam.blank.dimensions[1]
            height = beam.blank.dimensions[2]

            volume = beam.width * beam.height * beam.length
            weight = volume * 470

            milled_volume = beam.geometry.volume
            milled_weight = milled_volume * 470
# ---------- end python_3_script_4 ----------
draw_2 = COMPASDraw(cg=python_3_script_4.v_beam_faces)  # -> rg; same code as draw
list_length = ListLength(List=python_3_script_4.geometry)
draw_3 = COMPASDraw(cg=python_3_script_4.geometry)  # -> rg; same code as draw
plane = Plane(python_3_script_4.rhino_beam_frames)
panel_5 = Panel(list_length)
custom_preview = CustomPreview(Geometry=draw_2, Material=ColourSwatch(SwatchColor=RGB(242, 186, 0)))
custom_preview_2 = CustomPreview(
    Geometry=draw_3,
    Material={diffuse=RGB(221, 160, 221), emission=RGB(66, 48, 66), shine=0.5, specular=RGB(255, 255, 255), transparency=0})

# ----
draw_4 = COMPASDraw(cg=python_3_script_3.long_beams)  # -> rg; same code as draw

# ---- group: beam that are heavier than 45 kg
# overall information
draw_5 = COMPASDraw(cg=python_3_script_3.heavy_beams)  # -> rg; same code as draw
custom_preview_3 = CustomPreview(Geometry=draw_5, Material=ColourSwatch(SwatchColor=RGB(255, 0, 0)))

# ----
custom_preview_4 = CustomPreview(Geometry=draw_4, Material=ColourSwatch(SwatchColor=RGB(0, 0, 150)))
beam_length_5_m = Panel(draw_4)
plate_area_m2 = Panel(python_3_script_3.plate_area)
beam_information = Panel(python_3_script_3.beam_info_tree)
total_beams_volume_m3 = Panel(python_3_script_3.milled_beam_volume)
total_beams_weight_kg = Panel(python_3_script_3.milled_beam_weight)
total_plates_volume_m3 = Panel(python_3_script_3.total_plate_volume)
total_plates_weight_kg = Panel(python_3_script_3.total_plate_weight)
number_of_beams = Panel(python_3_script_3.number_of_beams)
number_of_plates = Panel(python_3_script_3.number_of_plates)
list_length_2 = ListLength(List=draw_5)
panel_6 = Panel(python_3_script_4.final_models_with_attributes)
panel_7 = Panel(python_3_script_3.long_beams_length)
draw_6 = COMPASDraw(cg=python_3_script_3.long_beams_blank)  # -> rg; same code as draw
list_length_3 = ListLength(List=beam_length_5_m)  # -> flatten(Length)
mass_addition = MassAddition(Input=number_of_beams)  # -> Result, PartialResults
mass_addition_2 = MassAddition(Input=number_of_plates)  # -> Result, PartialResults
deconstruct_brep = DeconstructBrep(Brep=draw_6)  # -> Faces, Edges, Vertices
num_of_beam_45_kg = Panel(list_length_2)
totalnum_beam_length_5_m = Panel(list_length_3)
multiplication = Multiplication(A=mass_addition.Result, B="4")
list_item = ListItem(List=deconstruct_brep.Vertices, Index="0", Wrap=True)
list_item_2 = ListItem(List=deconstruct_brep.Vertices, Index="1", Wrap=True)
number_of_beams_2 = Panel(multiplication)
number_of_plates_2 = Panel(mass_addition_2.Result)
line = Line(StartPoint=list_item, EndPoint=list_item_2)
linear_dimension = LinearDimension(Line=line, PointA=list_item, PointB=list_item_2, Text="{0:0.000}", Size="0.5")

# ---- group: total_weight_per_module (kg)
panel_m2 = Expression(
    total_beams_weight_kg=total_beams_weight_kg,
    clt_panel_weight_kg=total_plates_volume_m3,
    Expression="total_beams_weight_kg+clt_panel_weight_kg")

# ----
total_weight_per_module_kg = Panel(panel_m2)

# ---- group: Area Density = Weight Per Module / Plate Area (kg/m2)
panel_m2_2 = Expression(total_weight_per_module=panel_m2, plate_area=plate_area_m2, Expression="total_weight_per_module/plate_area")

# ----
mass_addition_3 = MassAddition(Input=total_weight_per_module_kg)  # -> Result, PartialResults
multiplication_2 = Multiplication(A=mass_addition_3.Result, B="4")
total_weight_kg = Panel(multiplication_2)
weight_per_module_plate_area_kg_m2 = Panel(panel_m2_2)
panel_8 = Panel("""0
1
6
7""")
list_item_3 = ListItem(List=weight_per_module_plate_area_kg_m2, Index=panel_8, Wrap=True)
panel_9 = Panel(list_item_3)

# ---- group: move to RFL per module & visualize
x_axis = Slider(0.42, range=-10..10)
y_axis = Slider(0, range=-10..10)
surface = Surface(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)
plane_2 = Plane(surface)
module_id_2 = Slider(3, range=0..3)
move_point = MovePoint(geometry=plane_2, factor=x_axis, factor_2=y_axis, factor_3="0")
# visualize
python_3_script_5 = Python3Script(final_models=python_3_script_4.final_models_with_attributes, module_id=module_id_2, t_frame=move_point)  # -> out, geometry, grasp_frames; inputs final_models: list, module_id: Int32
# ---------- python_3_script_5: Python ----------
from compas_timber.model import TimberModel
from compas.geometry import Frame, Vector, Rotation, Transformation
from compas_rhino.conversions import plane_to_compas_frame, frame_to_rhino_plane

target_f = plane_to_compas_frame(t_frame)

geometry = []
grasp_frames = []

if 0 <= module_id < len(final_models):

    module_model = final_models[module_id]

    # ============================================================
    # create source frame from first plate
    # ============================================================

    source_f = None

    if len(module_model.plates) > 0:

        plate = module_model.plates[0]

        plate_face = plate.side_as_surface(2)
        plate_midpoint = plate_face.point_at(0.5, 0.5)

        source_f = plate.frame.copy()
        source_f.point = plate_midpoint

        T = Transformation.from_frame_to_frame(source_f, target_f)

    if source_f:

        # ============================================================
        # plates geometry
        # ============================================================

        for plate in module_model.plates:

            geo = plate.geometry.copy()
            geo.transform(T)
            geometry.append(geo)

        # ============================================================
        # beams geometry
        # ============================================================

        for i, beam in enumerate(module_model.beams):
            if not beam.attributes["neighbour"]:
                geo = beam.geometry.copy()
                geo.transform(T)
                geometry.append(geo)

                if "grasp_frame" in beam.attributes:
                    grasp_f = beam.attributes["grasp_frame"].copy()
                    grasp_f.transform(T)

                    grasp_frames.append(frame_to_rhino_plane(grasp_f))
# ---------- end python_3_script_5 ----------
list_length_4 = ListLength(List=python_3_script_5.geometry)
draw_7 = COMPASDraw(cg=python_3_script_5.geometry)  # -> rg; same code as draw
plane_3 = Plane(python_3_script_5.grasp_frames)

# ---- group: beam that are heavier than 45 kg
draw_8 = COMPASDraw()  # -> rg; same code as draw
custom_preview_5 = CustomPreview(Geometry=draw_8, Material=ColourSwatch(SwatchColor=RGB(255, 0, 0)))

# ----
list_length_5 = ListLength(List=draw_8)
num_of_beam_45_kg_2 = Panel(list_length_5)
custom_preview_6 = CustomPreview(
    Geometry=draw_7,
    Material={diffuse=RGB(221, 160, 221), emission=RGB(66, 48, 66), shine=0.5, specular=RGB(255, 255, 255), transparency=0})
panel_10 = Panel(list_length_4)
group = Group(Geometry=draw_7)
working_space_rfl = Geometry([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])
draw_9 = COMPASDraw()  # -> rg; same code as draw
draw_10 = COMPASDraw()  # -> rg; same code as draw
bounding_box = BoundingBox(Content=group, Plane=PlaneXY(0, 0, 0))  # -> Box, Box_2
custom_preview_7 = CustomPreview(Geometry=working_space_rfl, Material=ColourSwatch(SwatchColor=RGB(120, 98, 98)))

# ---- group: beam that are longer than 5 m
deconstruct_brep_2 = DeconstructBrep(Brep=draw_10)  # -> Faces, Edges, Vertices
custom_preview_8 = CustomPreview(Geometry=draw_9, Material=ColourSwatch(SwatchColor=RGB(0, 0, 150)))
list_item_4 = ListItem(List=deconstruct_brep_2.Vertices, Index="0", Wrap=True)
list_item_5 = ListItem(List=deconstruct_brep_2.Vertices, Index="1", Wrap=True)
line_2 = Line(StartPoint=list_item_4, EndPoint=list_item_5)
linear_dimension_2 = LinearDimension(Line=line_2, PointA=list_item_4, PointB=list_item_5, Text="{0:0.000}", Size="0.5")

# ----
box_corners = BoxCorners(Box=bounding_box.Box)  # -> CornerA, CornerB, CornerC, CornerD, CornerE, CornerF, CornerG, CornerH
line_3 = Line(StartPoint=box_corners.CornerA, EndPoint=box_corners.CornerE)
linear_dimension_3 = LinearDimension(Line=line_3, PointA=box_corners.CornerA, PointB=box_corners.CornerE, Text="{0:0.000}", Size="0.5")

# ==== cluster MovePoint
factor = ClusterInput()
factor_2 = ClusterInput()
unit_x = UnitX(Factor=factor)
unit_y = UnitY(Factor=factor_2)
geometry = ClusterInput()
move = Move(Geometry=geometry, Motion=unit_x)  # -> Geometry, Transform
factor_3 = ClusterInput()
move_2 = Move(Geometry=move.Geometry, Motion=unit_y)  # -> Geometry, Transform
unit_z = UnitZ(Factor=factor_3)
move_3 = Move(Geometry=move_2.Geometry, Motion=unit_z)  # -> Geometry, Transform
geometry_2 = ClusterOutput(move_3.Geometry)
