# Grasshopper definition modulization_test.gh (Grasshopper 1.0.8)
# plug-ins: Heteroptera, Pufferfish, Human

line = Line([Line((159.9247373, 40.91188554, 23.75605153), (159.2588936, 39.57964905, 24.62354285)), Line((159.9247373, 40.91188554, 23.75605153), (160.590581, 39.57964905, 24.62354289)), Line((159.9247373, 40.91188554, 23.75605153), (160.7247451, 42.5101797, 24.5649313)), Line((159.9247373, 40.91188554, 23.75605153), (159.2588936, 42.24195882, 24.57029569)), Line((162.3297373, 40.91188554, 23.75605153), (161.6638936, 39.57964905, 24.62354291)), Line((162.3297373, 40.91188554, 23.75605153), (162.995581, 39.57964905, 24.62354295))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])
# workflow
# input = receive compas timber model from Joint group
# from compas timber model extract beams information
# 
# group in modules as before
# plan sequence
# outputs: modules + information
# sequence inside module
compas_timber = Python3Script(lines=line, width=Slider(0.08, range=0..1), height=Slider(0.24, range=0..1))  # -> out, geo, num_beams, biggest, smallest, model; inputs lines: list of Line, width: Double, height: Double
# ---------- compas_timber: Python ----------
from compas_timber.model import TimberModel
from compas_timber.elements import Beam
from compas_timber.connections import ConnectionSolver
from compas_timber.connections import JointTopology
from compas.geometry import Vector
import random
from compas_rhino.conversions import line_to_compas

# function to create beam
def create_beam(line, width, height, category, z_vector=None):
    beam = Beam.from_centerline(centerline=line, width=float(width), height=float(height))
    beam.attributes["category"] = category
    return beam

# save beams as a list
beams = [] 
for i,line in enumerate(lines):
    line = line_to_compas(line)
    height = random.choice([0.2,0.24,0.28])
    if height == 0.2:
        line.name = 'small'
    elif height == 0.24:
        line.name = 'medium'
    else:
        line.name = 'big'
    beam = create_beam(line, width, height, line.name)
    beams.append(beam)


# add beams to model
model = TimberModel()
[model.add_element(beam) for beam in beams]


# create a joint
from compas_timber.connections import XLapJoint, JointCandidate, TDovetailJoint, LFrenchRidgeLapJoint, TButtJoint, LMiterJoint, TStepJoint

def get_joint_type(topo, beam_a, beam_b):
    if topo == JointTopology.TOPO_T:
        return TButtJoint
    elif topo == JointTopology.TOPO_L:
        return JointCandidate
    elif topo == JointTopology.TOPO_X:
        return JointCandidate
    # elif topo == JointTopology.Topo_I:
    #     return JointCandidate
    

# find neighboring beams
solver = ConnectionSolver()
beam_pairs = solver.find_intersecting_pairs(list(model.beams), rtree=True)

for beam_a, beam_b in beam_pairs:
    # find topology and reorder beams according to roles if needed based on found topology
    result = solver.find_topology(beam_a, beam_b)
    #print(result)
    topo = result.topology
    beam_a = result.beam_a
    beam_b = result.beam_b

    # join beams accorgind to topology to connection type mapping
    joint_cls = get_joint_type(topo, beam_a, beam_b)
    if joint_cls is not None:
        joint_cls.create(model, beam_a, beam_b)
        
    
model.process_joinery()


# draw geometry
geo = [beam.geometry for beam in model.beams]
num_beams = len(beams)

beams_size = []

for i,beam in enumerate(beams):
    size = beam.length
    beams_size.append((size,i))

biggest = max(beams_size)
smallest = min(beams_size)
# ---------- end compas_timber ----------
panel = Panel(compas_timber.geo)
draw = COMPASDraw(cg=compas_timber.geo)  # -> rg
#   port cg: The COMPAS geometry or datastructure to be drawn.
#   port rg: The Rhino geometry object.
# ---------- draw: Python ----------
# r: compas>=2.14.1
"""
Draws COMPAS geometry in Grasshopper.
"""

from typing import Any

import Grasshopper

from compas.scene import SceneObject


class CompasToRhinoGeometry(Grasshopper.Kernel.GH_ScriptInstance):
    def RunScript(self, cg):
        if not cg:
            return None

        return SceneObject(item=cg).draw()
# ---------- end draw ----------
point = Point([Point(163.5542514, 48.10027414, 15.94000248), Point(163.5542514, 57.72031214, 15.94000382), Point(173.1742514, 57.7202747, 19.94), Point(173.1742514, 48.1002747, 19.94)])
curve = Curve(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)

# ---- group: tilted overall
brep = Brep(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)

# ----
brep_2 = Brep(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)

# ---- group: modularization_lines
curve_2 = Curve([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])

# ---- group: 8x2 modules tilted
surface = Surface([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])

# ----
# COLUMN!
curve_3 = Curve([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])
ct_beam = CTBeam(centerline=curve_3, width="0.14", height="0.32")  # -> Beam, Blank; inputs centerline: list, z_vector: list of Vector3d, width: list of Double, height: list of Double, category: list of String, updateRefObj: Boolean
#   port centerline: Referenced curve or line, Guid of curve or line in the active Rhino document.
#   port z_vector: Vector defining the orientation of the cross-section (corresponds to the height dimension). If None, a default will be taken.
#   port width: Width of the cross-section (usually the smaller dimension).
#   port height: Height of the cross-section (usually the larger dimension).
#   port category: Category of a beam.
#   port updateRefObj: (optional) If True, the attributes in the referenced object will be updated/overwritten with the new values given here.
#   port Beam: Beam object(s).
#   port Blank: Shape of the beam's blank.
# ---------- ct_beam: Python ----------
# r: compas_timber==1.0.5
"""Creates a Beam from a LineCurve."""

# flake8: noqa
import Grasshopper
import Rhino
import rhinoscriptsyntax as rs
import System
from compas.scene import Scene
from compas_rhino.conversions import line_to_compas
from compas_rhino.conversions import vector_to_compas

from compas_timber.elements import Beam as CTBeam
from compas_timber.ghpython.rhino_object_name_attributes import update_rhobj_attributes_name
from compas_timber.ghpython.ghcomponent_helpers import list_input_valid_cpython


class Beam_fromCurve(Grasshopper.Kernel.GH_ScriptInstance):
    def RunScript(self,
            centerline: System.Collections.Generic.List[object],
            z_vector: System.Collections.Generic.List[Rhino.Geometry.Vector3d],
            width: System.Collections.Generic.List[float],
            height: System.Collections.Generic.List[float],
            category: System.Collections.Generic.List[str],
            updateRefObj: bool):
        # minimum inputs required
        if not list_input_valid_cpython(ghenv, centerline, "Centerline"):
            return
        if not width:
            length = self._get_centerline_length(centerline)
            width = [length / 20]
        if not height:
            length = self._get_centerline_length(centerline)
            height = [length / 10]

        # reformat unset parameters for consistency
        if not z_vector:
            z_vector = [None]
        if not category:
            category = [None]

        beams = []
        blanks = []
        scene = Scene()

        if centerline and height and width:
            # check list lengths for consistency
            N = len(centerline)
            if len(z_vector) not in (0, 1, N):
                ghenv.Component.AddRuntimeMessage(
                    Grasshopper.Kernel.GH_RuntimeMessageLevel.Error, " In 'ZVector' I need either none, one or the same number of inputs as the Crv parameter."
                )
            if len(width) not in (1, N):
                ghenv.Component.AddRuntimeMessage(Grasshopper.Kernel.GH_RuntimeMessageLevel.Error, " In 'W' I need either one or the same number of inputs as the Crv parameter.")
            if len(height) not in (1, N):
                ghenv.Component.AddRuntimeMessage(Grasshopper.Kernel.GH_RuntimeMessageLevel.Error, " In 'H' I need either one or the same number of inputs as the Crv parameter.")
            if len(category) not in (0, 1, N):
                ghenv.Component.AddRuntimeMessage(
                    Grasshopper.Kernel.GH_RuntimeMessageLevel.Error, " In 'Category' I need either none, one or the same number of inputs as the Crv parameter."
                )

            # duplicate data if None or single value
            if len(z_vector) != N:
                z_vector = [z_vector[0] for _ in range(N)]
            if len(width) != N:
                width = [width[0] for _ in range(N)]
            if len(height) != N:
                height = [height[0] for _ in range(N)]
            if len(category) != N:
                category = [category[0] for _ in range(N)]

            for line, z, w, h, c in zip(centerline, z_vector, width, height, category):
                guid, geometry = self._get_guid_and_geometry(line)
                rhino_line = rs.coerceline(geometry)
                line = line_to_compas(rhino_line)

                z = vector_to_compas(z) if z else None
                beam = CTBeam.from_centerline(centerline=line, width=w, height=h, z_vector=z)
                beam.attributes["rhino_guid"] = str(guid) if guid else None
                beam.attributes["category"] = c
                if updateRefObj and guid:
                    update_rhobj_attributes_name(guid, "width", str(w))
                    update_rhobj_attributes_name(guid, "height", str(h))
                    update_rhobj_attributes_name(guid, "zvector", str(list(beam.frame.zaxis)))
                    update_rhobj_attributes_name(guid, "category", c)

                beams.append(beam)
                scene.add(beam.blank)

        blanks = scene.draw()

        return beams, blanks

    def _get_guid_and_geometry(self, line):
        # internalized curves and GH geometry will not have persistent GUIDs, referenced Rhino objects will
        # type hint on the input has to be 'ghdoc' for this to work
        guid = None
        geometry = line
        rhino_obj = Rhino.RhinoDoc.ActiveDoc.Objects.FindId(line)
        if rhino_obj:
            guid = line
            geometry = rhino_obj.Geometry
        return guid, geometry

    def _get_centerline_length(self, centerline):
        centerline_length = []
        for i in centerline:
            centerline_length.append(rs.CurveLength(i))
        if centerline_length:
            length_average = sum(centerline_length) / len(centerline_length)
        else:
            length_average = 1
        return length_average
# ---------- end ct_beam ----------
custom_preview = CustomPreview(Geometry=ct_beam.Blank, Material=ColourSwatch(SwatchColor=RGB(63, 27, 255)))

# ---- group: overall_lines
line_2 = Line([Line((159.9247373, 40.91188554, 24.04388912), (159.2588936, 39.57964905, 24.62354285)), Line((159.9247373, 40.91188554, 24.04388912), (160.590581, 39.57964905, 24.62354289)), Line((159.9247373, 40.91188554, 24.04388912), (160.7247451, 42.5101797, 24.5649313)), Line((159.9247373, 40.91188554, 24.04388912), (159.2588936, 42.24195882, 24.57029569)), Line((162.3297373, 40.91188554, 24.04388912), (161.6638936, 39.57964905, 24.62354291)), Line((162.3297373, 40.91188554, 24.04388912), (162.995581, 39.57964905, 24.62354295))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])

# ----
boundary = BoundarySurfaces(Edges=curve)
py3 = Python3Script(import=Button())  # -> out, a; inputs import: Boolean
# ---------- py3: Python ----------
import os
from compas.data import json_load
from compas_timber.model import TimberModel
from compas_timber.elements import Beam

gh_dir = os.path.dirname(ghenv.Component.OnPingDocument().FilePath)
design_folder = os.path.dirname(gh_dir)
json_path = os.path.join(design_folder, "line_model", "data", "timber_module.json")

timber_model = json_load(json_path)
# ---------- end py3 ----------
mesh_uv = MeshSurface(Surface=boundary, UCount=5, VCount=5, Overhang=True, Equalize=False)

# ---- group: extract edges from surface
mesh_naked_edges = MeshNakedEdges(Mesh=surface)  # -> Naked, ResultBoolean
curve_4 = Curve(mesh_naked_edges.Naked)

# ----
# module surfaces
explode = Explode(Curve=curve_2, Recursive=True)  # -> flatten(Segments), Vertices
end_points = EndPoints(Curve=explode.Segments)  # -> Start, End

# ---- group: generate_bounding_boxes
cell_z = Panel("4.4")
python_3_script = Python3Script(module_surface=flatten(curve_4), cell_z=cell_z, sort_mode="ZYX")  # -> out, boxes, base_curves; inputs module_surface: list of Curve, cell_z: Double
# ---------- python_3_script: Python ----------
import Rhino
import Rhino.Geometry as rg
import scriptcontext as sc

# ============================================================
# Helper: sorting mode
# ============================================================
def get_sort_key(ix, iy, iz, mode="XYZ"):
    mode = (mode or "XYZ").upper()

    if mode == "XYZ":
        return (ix, iy, iz)
    elif mode == "XZY":
        return (ix, iz, iy)
    elif mode == "YXZ":
        return (iy, ix, iz)
    elif mode == "YZX":
        return (iy, iz, ix)
    elif mode == "ZXY":
        return (iz, ix, iy)
    elif mode == "ZYX":
        return (iz, iy, ix)

    return (ix, iy, iz)


# ============================================================
# Helper: convert GUID -> Rhino geometry if needed
# ============================================================
def get_rhino_geo(g):
    if g is None:
        return None

    if isinstance(g, (rg.GeometryBase, rg.Polyline)):
        return g

    if hasattr(g, "GetBoundingBox"):
        return g

    try:
        obj = sc.doc.Objects.Find(g)
        if obj:
            return obj.Geometry
    except:
        pass

    return None


# ============================================================
# Helper: make planar closed curve near original location
# ============================================================
def make_planar_closed_curve(geo, tol=0.01):
    if geo is None:
        return None

    pts = []

    if isinstance(geo, rg.PolylineCurve):
        ok, pl = geo.TryGetPolyline()
        if not ok:
            return None
        pts = [p for p in pl]

    elif isinstance(geo, rg.Polyline):
        pts = [p for p in geo]

    elif isinstance(geo, rg.Curve):
        if not geo.IsClosed:
            return None

        sample_count = 80
        t0 = geo.Domain.T0
        t1 = geo.Domain.T1

        for i in range(sample_count + 1):
            t = t0 + (t1 - t0) * float(i) / float(sample_count)
            pts.append(geo.PointAt(t))

    else:
        return None

    if len(pts) < 4:
        return None

    if pts[0].DistanceTo(pts[-1]) > tol:
        pts.append(pts[0])

    rc, plane = rg.Plane.FitPlaneToPoints(pts)
    if rc != rg.PlaneFitResult.Success:
        return None

    proj_pts = []
    for p in pts:
        success, u, v = plane.ClosestParameter(p)
        if not success:
            return None
        proj_pts.append(plane.PointAt(u, v))

    if proj_pts[0].DistanceTo(proj_pts[-1]) > tol:
        proj_pts.append(proj_pts[0])

    pln_poly = rg.Polyline(proj_pts)
    if not pln_poly.IsClosed:
        return None

    crv = rg.PolylineCurve(pln_poly)

    if not crv.IsClosed:
        return None

    if not crv.IsPlanar():
        return None

    return crv


# ============================================================
# Default sort mode
# ============================================================
if 'sort_mode' not in globals() or sort_mode is None:
    sort_mode = "XYZ"


# ============================================================
# Outputs
# ============================================================
boxes = []
base_curves = []
group_ids = []
group_info = []


# ============================================================
# Main
# ============================================================
if module_surface is not None and cell_z is not None:

    temp_data = []

    for i, srf in enumerate(module_surface):
        geo = get_rhino_geo(srf)

        if geo is None:
            continue

        curve = None

        if isinstance(geo, (rg.PolylineCurve, rg.Polyline, rg.Curve)):
            curve = make_planar_closed_curve(geo)
            if curve is None:
                continue
        else:
            continue

        vec = rg.Vector3d(0, 0, cell_z)

        srf_ex = rg.Surface.CreateExtrusion(curve, vec)
        if srf_ex is None:
            continue

        brep = srf_ex.ToBrep()
        if brep is None:
            continue

        cap = brep.CapPlanarHoles(sc.doc.ModelAbsoluteTolerance)
        if cap is None:
            continue

        # use bounding box center as sorting point
        bb = cap.GetBoundingBox(True)
        center = bb.Center

        sx = center.X
        sy = center.Y
        sz = center.Z

        temp_data.append((get_sort_key(sx, sy, sz, sort_mode), i, cap, curve, center))

    # sort based on selected mode
    temp_data.sort(key=lambda x: x[0])

    # rebuild outputs in sorted order
    for new_i, item in enumerate(temp_data):
        old_sort_key, old_id, cap, curve, center = item

        boxes.append(cap)
        base_curves.append(curve)
        group_ids.append(new_i)
        group_info.append(
            "Group {} | Original Module {} | Center ({:.2f}, {:.2f}, {:.2f})".format(
                new_i, old_id, center.X, center.Y, center.Z
            )
        )
# ---------- end python_3_script ----------
geometry = Geometry(python_3_script.boxes)
curve_5 = Curve(python_3_script.base_curves)

# ----
py3_2 = Python3Script(x=flatten(curve_4))  # -> out, boxes; inputs x: list of Curve
# ---------- py3_2: Python ----------
from compas.geometry import bounding_box, Box
from compas_rhino.conversions import curve_to_compas_polyline

boxes = []
for curve in x:
    c = curve_to_compas_polyline(curve)
    points = c.points
    a = Box.from_bounding_box(bounding_box(points))
    a.zsize = 20.0
    boxes.append(a)

print (boxes)
# ---------- end py3_2 ----------
py3_3 = Python3Script(timber_module=compas_timber.model, boxes=py3_2.boxes)  # -> out, total_modules; inputs boxes: list
# ---------- py3_3: Python ----------
from compas_timber.model import TimberModel
from compas_timber.elements import Beam
from compas.geometry import Box

model = timber_module

def weight_calculation(w,h,l, density=470):
    return w*h*l*density

num_of_beams = len([*model.beams])
print(num_of_beams)

beams = []
total_weight = 0
for i, beam in enumerate(model.beams):
    weight = weight_calculation(beam.width, beam.height, beam.length)
    total_weight += weight

print(total_weight)
    #if i == 0:
        #print(beam)
        #print(beam.centerline)
        #print(beam.length)
        #print(beam.width)
        #print(beam.height)

total_modules = []
for box in boxes:
    module = []
    for beam in model.beams:
        if box.contains_point(beam.midpoint):
            module.append(beam)
    total_modules.append(module)

print(total_modules[0])
# ---------- end py3_3 ----------
line_3 = Line(StartPoint=end_points.Start, EndPoint=end_points.End)
data = Data()
draw_2 = COMPASDraw(cg=py3_2.boxes)  # -> rg; same code as draw

# ---- group: reorder beams + extract start points
sorting_points_and_line = Python3Script(beams_cl=line_3)  # -> out, lines, pts; inputs beams_cl: list of GeometryBase
# ---------- sorting_points_and_line: Python ----------
import Rhino
import Rhino.Geometry as rg
import scriptcontext as sc

# ============================================================
# Helper: convert GUID -> Rhino geometry if needed
# ============================================================
def get_rhino_geo(g):
    if g is None:
        return None

    if hasattr(g, "GetBoundingBox"):
        return g

    try:
        obj = sc.doc.Objects.Find(g)
        if obj:
            return obj.Geometry
    except:
        pass

    return None


# ============================================================
# Helper: return line/curve with start point at lower Z
# ============================================================
def get_ordered_line(g):
    geo = get_rhino_geo(g)
    if geo is None:
        return None

    try:
        zaxis = rg.Vector3d.ZAxis

        if isinstance(geo, rg.Line):
            vec = geo.To - geo.From
            dot = rg.Vector3d.Multiply(vec, zaxis)

            if dot < 0:
                return rg.Line(geo.To, geo.From)
            else:
                return rg.Line(geo.From, geo.To)

        if isinstance(geo, rg.Curve):
            p0 = geo.PointAtStart
            p1 = geo.PointAtEnd
            vec = p1 - p0
            dot = rg.Vector3d.Multiply(vec, zaxis)

            dup = geo.DuplicateCurve()
            if dot < 0:
                dup.Reverse()

            return dup

    except:
        pass

    return geo


# ============================================================
# Helper: get grouping point
# ============================================================
def get_group_point(g):
    if g is None:
        return None

    try:
        if isinstance(g, rg.Line):
            # return g.From
            # return g.To
            return g.PointAt(0.5)

        if isinstance(g, rg.Curve):
            # return g.PointAtStart
            # return g.PointAtEnd
            return g.PointAtNormalizedLength(0.5)


        bb = g.GetBoundingBox(True)
        return bb.Min

    except:
        return None


# ============================================================
# Helper: remove duplicate lines
# ============================================================
def remove_duplicate_lines(lines, pts, tol=0.001):

    unique_lines = []
    unique_pts = []
    seen = set()

    for ln, pt in zip(lines, pts):

        if isinstance(ln, rg.Line):
            p0 = ln.From
            p1 = ln.To
        elif isinstance(ln, rg.Curve):
            p0 = ln.PointAtStart
            p1 = ln.PointAtEnd
        else:
            continue

        key = (
            round(p0.X/tol), round(p0.Y/tol), round(p0.Z/tol),
            round(p1.X/tol), round(p1.Y/tol), round(p1.Z/tol)
        )

        if key not in seen:
            seen.add(key)
            unique_lines.append(ln)
            unique_pts.append(pt)

    return unique_lines, unique_pts


# ============================================================
# Main
# ============================================================
ordered_lines = []
group_points = []

if beams_cl:
    for b in beams_cl:

        geo = get_ordered_line(b)
        if geo is None:
            continue

        pt = get_group_point(geo)
        if pt is None:
            continue

        ordered_lines.append(geo)
        group_points.append(pt)


# ------------------------------------------------------------
# remove duplicates
# ------------------------------------------------------------
clean_lines, clean_pts = remove_duplicate_lines(ordered_lines, group_points)


lines = clean_lines
pts = clean_pts
# ---------- end sorting_points_and_line ----------

# ----
center = Center(Geometry=draw_2)  # -> Center, Dimension
point_list = PointList(Points=center.Center, Size=Slider(3, range=0..10))
tol = Panel("0.0")

# ---- group: group beams into bounding boxes
python_3_script_2 = Python3Script(
    lines=sorting_points_and_line.lines,
    pts=sorting_points_and_line.pts,
    boxes=draw_2,
    base_curves=python_3_script.base_curves,
    tol=tol)  # -> out, group_lengths, sorted_lines, line_colors, sorted_base, base_colors, beam_pts, group_info, group_combined; inputs lines: list of GeometryBase, pts: list of Point3d, boxes: list of GeometryBase, base_curves: list, tol: Double
# ---------- python_3_script_2: Python ----------
import Rhino
import Rhino.Geometry as rg
import scriptcontext as sc
import System.Drawing as sd

# ============================================================
# Helper: convert GUID -> Rhino geometry if needed
# ============================================================
def get_rhino_geo(g):
    if g is None:
        return None

    if hasattr(g, "GetBoundingBox"):
        return g

    try:
        obj = sc.doc.Objects.Find(g)
        if obj:
            return obj.Geometry
    except:
        pass

    return None


# ============================================================
# Helper: return line/curve with start point at lower Z
# ============================================================
def get_ordered_line(g):
    geo = get_rhino_geo(g)
    if geo is None:
        return None

    try:
        zaxis = rg.Vector3d.ZAxis

        if isinstance(geo, rg.Line):
            vec = geo.To - geo.From
            dot = rg.Vector3d.Multiply(vec, zaxis)

            return rg.Line(geo.To, geo.From) if dot < 0 else rg.Line(geo.From, geo.To)

        if isinstance(geo, rg.Curve):
            p0 = geo.PointAtStart
            p1 = geo.PointAtEnd
            vec = p1 - p0
            dot = rg.Vector3d.Multiply(vec, zaxis)

            dup = geo.DuplicateCurve()
            if dot < 0:
                dup.Reverse()

            return dup

    except:
        pass

    return geo


# ============================================================
# Helper: color palette
# ============================================================
def adjust_color(color, factor):
    r = min(255, max(0, int(color.R * factor)))
    g = min(255, max(0, int(color.G * factor)))
    b = min(255, max(0, int(color.B * factor)))
    return sd.Color.FromArgb(r, g, b)


def make_color(i):
    groups = [
        [0, 1, 4, 5],
        [2, 3, 6, 7],
        [32, 33, 36, 37],
        [34, 35, 38, 39],
        [8, 12, 16, 17, 24, 28],
        [9, 13, 18, 19, 25, 29],
        [10, 14, 20, 21, 26, 30],
        [11, 15, 22, 23, 27, 31],
    ]

    base_colors_list = [
        sd.Color.FromArgb(214, 92, 92),    # red
        sd.Color.FromArgb(101, 166, 91),   # green
        sd.Color.FromArgb(78, 150, 222),   # blue
        sd.Color.FromArgb(166, 110, 201),  # purple
        sd.Color.FromArgb(230, 145, 56),   # orange
        sd.Color.FromArgb(69, 170, 150),   # teal
        sd.Color.FromArgb(196, 168, 54),   # olive gold
        sd.Color.FromArgb(209, 109, 176),  # pink
    ]

    for group_id, group in enumerate(groups):
        if i in group:
            base = base_colors_list[group_id]
            idx = group.index(i)
            n = len(group)

            if n == 1:
                factor = 1.0
            else:
                # factor = 0.7 + (0.6 * idx / float(n - 1))
                factor = 0.5 + (1.2 * idx / float(n - 1))

            return adjust_color(base, factor)

    return sd.Color.FromArgb(200, 200, 200)


# ============================================================
# Helper: get centerline length
# ============================================================
def get_line_length(g):
    if g is None:
        return 0.0

    try:
        if isinstance(g, rg.Line):
            return g.Length
        if isinstance(g, rg.Curve):
            return g.GetLength()
    except:
        pass

    return 0.0


# ============================================================
# Helper: get center from base curve or box
# ============================================================
def get_group_center(i, boxes, base_curves):
    try:
        if base_curves is not None and i < len(base_curves):
            base_geo = get_rhino_geo(base_curves[i])
            if base_geo is not None:
                bb = base_geo.GetBoundingBox(True)
                return bb.Center
    except:
        pass

    try:
        if boxes is not None and i < len(boxes):
            box_geo = get_rhino_geo(boxes[i])
            if box_geo is not None:
                bb = box_geo.GetBoundingBox(True)
                return bb.Center
    except:
        pass

    return None


# ============================================================
# Helper: XY projection
# ============================================================
def to_xy_point(pt):
    return rg.Point3d(pt.X, pt.Y, 0.0)


def get_xy_curve(g):
    geo = get_rhino_geo(g)
    if geo is None:
        return None

    try:
        if isinstance(geo, rg.Curve):
            dup = geo.DuplicateCurve()
            dup.Transform(rg.Transform.PlanarProjection(rg.Plane.WorldXY))
            return dup
    except:
        pass

    return None


def is_point_in_curve_xy(pt, crv, tol):
    try:
        pt_xy = to_xy_point(pt)
        contain = crv.Contains(pt_xy, rg.Plane.WorldXY, tol)
        return contain == rg.PointContainment.Inside or contain == rg.PointContainment.Coincident
    except:
        return False


def point_to_curve_distance_xy(pt, crv):
    try:
        pt_xy = to_xy_point(pt)
        ok, t = crv.ClosestPoint(pt_xy)
        if not ok:
            return None
        cp = crv.PointAt(t)
        return pt_xy.DistanceTo(cp)
    except:
        return None


# ============================================================
# Default tolerance
# ============================================================
if 'tol' not in globals() or tol is None:
    tol = 0.01


# ============================================================
# Outputs
# ============================================================
sorted_lines = []
line_colors = []
sorted_base = []
base_colors = []
beam_pts = []

group_combined = []
group_info = []

beam_lengths = []
group_lengths = []
total_length = 0.0


# ============================================================
# Main
# ============================================================
if lines and pts and boxes:

    # collect valid data
    valid_data = []
    for i in range(min(len(lines), len(pts))):
        geo = get_ordered_line(lines[i])
        pt = pts[i]
        if geo and pt:
            valid_data.append((geo, pt))

    # init groups
    group_dict = {i: [] for i in range(len(boxes))}

    # precompute base curves + centers
    group_base_xy = {}
    group_centers = {}

    for i in range(len(boxes)):
        group_base_xy[i] = get_xy_curve(base_curves[i]) if base_curves and i < len(base_curves) else None
        group_centers[i] = get_group_center(i, boxes, base_curves)

    # assign groups
    for geo, pt in valid_data:
        hit_groups = []

        for i in range(len(boxes)):
            crv = group_base_xy[i]
            if crv and is_point_in_curve_xy(pt, crv, tol):
                hit_groups.append(i)

        if hit_groups:
            best_i = None
            best_d = None

            for i in hit_groups:
                d = point_to_curve_distance_xy(pt, group_base_xy[i])
                if d is None:
                    continue
                if best_d is None or d < best_d:
                    best_d = d
                    best_i = i

            chosen = best_i if best_i is not None else hit_groups[0]

        else:
            distances = []

            for i in range(len(boxes)):
                crv = group_base_xy[i]
                if crv:
                    d = point_to_curve_distance_xy(pt, crv)
                    if d is not None:
                        distances.append((d, i))

            if not distances:
                continue

            distances.sort(key=lambda x: x[0])
            chosen = distances[0][1]

        group_dict[chosen].append((geo, pt))

    # colors + stats
    color_dict = {}

    for i in range(len(boxes)):
        color_dict[i] = make_color(i)

        group_items = group_dict[i]
        group_total = sum(get_line_length(g) for g, _ in group_items)

        group_lengths.append(group_total)
        total_length += group_total

        group_info.append(
            "Group {} | Num of Beams: {} | Total Beam Length: {:.2f} m".format(
                i, len(group_items), group_total
            )
        )

    # outputs
    for i in range(len(boxes)):
        for geo, pt in group_dict[i]:
            sorted_lines.append(geo)
            line_colors.append(color_dict[i])
            beam_pts.append(pt)
            beam_lengths.append(get_line_length(geo))

    for i in range(len(boxes)):
        combined = [geo for geo, _ in group_dict[i]]

        if base_curves and i < len(base_curves):
            base_geo = get_rhino_geo(base_curves[i])
            sorted_base.append(base_geo)
            base_colors.append(color_dict[i])
            if base_geo:
                combined.append(base_geo)
        else:
            sorted_base.append(None)
            base_colors.append(color_dict[i])

        group_combined.append(combined)
# ---------- end python_3_script_2 ----------

# ----
point_2 = Point(python_3_script_2.beam_pts)
# extrude pannel up? confirm with Fridolin
list = ValueList({"60": 0.06, "120": 0.12, "240": 0.24}, selected="60")

# ---- group: extrude CLT Plates
clt_plates_thickness = Panel("-0.06")
surface_2 = Surface(python_3_script_2.sorted_base)
unit_z = UnitZ(Factor=list)
extrude = Extrude(Base=surface_2, Direction=unit_z)

# ----
panel_2 = Panel(python_3_script_2.group_info)
mass_addition = MassAddition(Input=python_3_script_2.group_lengths)  # -> Result, PartialResults
total_length_m = Panel(mass_addition.Result)
custom_preview_lineweights = CustomPreviewLineweights(
    Geometry=python_3_script_2.sorted_lines,
    Shader=python_3_script_2.line_colors,
    Thickness=Slider(5, range=0..10),
    Absolute=False)
ct_beam_2 = CTBeam(centerline=python_3_script_2.sorted_lines, width="0.14", height="0.32")  # -> Beam, Blank; inputs centerline: list, z_vector: list of Vector3d, width: list of Double, height: list of Double, category: list of String, updateRefObj: Boolean; same code as ct_beam

# ---- group: TO SHOW COLORED MODULES!
custom_preview_2 = CustomPreview(Geometry=ct_beam_2.Blank, Material=python_3_script_2.line_colors)
custom_preview_3 = CustomPreview(Geometry=extrude, Material=python_3_script_2.base_colors)

# ---- group: total_beam_volume
panel_m2 = Expression(
    total_beam_length_m=python_3_script_2.group_lengths,
    beam_width_m="0.14",
    beam_height_m="0.32",
    Expression="total_beam_length_m*beam_width_m*beam_height_m")

# ----
total_beams_volume_m3 = Panel(panel_m2)

# ---- group: total_beam_weight_per_module
# Weight = density×volume
# (Using a typical density of 470 kg/m³)
weight_per_m2 = Panel("470")
panel_m2_2 = Expression(total_beams_volume_m3=panel_m2, density=weight_per_m2, Expression="total_beams_volume_m3*density")

# ---- group: to calculate 1 CLT plates (kg)
# Weight per square meter
# 
# 
# Weight = density×thickness
# (Using a typical density of 470 kg/m³)
# 
# 
# 
# 470 × 0.06 = 28.2 kg/m2
# 
# 
# Result: 27-30 kg/m2 for 60 mm CLT panel
area = Area(Geometry=surface_2)  # -> Area, Centroid
weight_per_m2_2 = Panel("28.2")
panel_m2_3 = Expression(panel_m2=area.Area, weight_per_m2=weight_per_m2_2, Expression="panel_m2*weight_per_m2")

# ----
mass_addition_2 = MassAddition(Input=total_beams_volume_m3)  # -> Result, PartialResults
total_beams_volume_m3_2 = Panel(mass_addition_2.Result)
rfl_max_limit_m = Panel("4.4")

# ---- group: total_weight_per_module (kg)
# overall information
panel_m2_4 = Expression(total_beams_weight_kg=panel_m2_2, clt_panel_weight_kg=panel_m2_3, Expression="total_beams_weight_kg+clt_panel_weight_kg")

# ----
total_beams_weight_kg = Panel(panel_m2_2)
clt_panel_weight_kg = Panel(panel_m2_3)
mass_addition_3 = MassAddition(Input=total_beams_weight_kg)  # -> Result, PartialResults

# ---- group: Area Density Weight Per Module / Plate Area (kg/m2)
panel_m2_5 = Expression(total_weight_per_module=panel_m2_4, plate_area=area.Area, Expression="total_weight_per_module/plate_area")

# ----
total_beams_weight_kg_2 = Panel(mass_addition_3.Result)
total_weight_per_module_kg = Panel(panel_m2_4)

mass_addition_4 = MassAddition(Input=panel_m2_4)  # -> Result, PartialResults

weight_per_module_plate_area_kg_m2 = Panel(panel_m2_5)
total_prototype_weight_kg = Panel(mass_addition_4.Result)

list_length = ListLength(List=python_3_script_2.group_combined)
series = Series(Start=0, Step=1, Count=list_length)
list_item = ListItem(List=python_3_script_2.group_combined, Index=series, Wrap=True)

# ---- group: seperate lines and rects
python_3_script_3 = Python3Script(group_in=list_item)  # -> out, lines_out, rect_out, total_length
# ---------- python_3_script_3: Python ----------
import Rhino.Geometry as rg

# Inputs:
# group_in

lines_out = []
rect_out = None
total_length = 0.0

if group_in is not None:

    for g in group_in:

        if g is None:
            continue

        # detect rectangle curve
        if isinstance(g, rg.Curve):
            try:
                if g.IsClosed:
                    rect_out = g
                else:
                    lines_out.append(g)
                    total_length += g.GetLength()
            except:
                lines_out.append(g)
                try:
                    total_length += g.GetLength()
                except:
                    pass

        elif isinstance(g, rg.Line):
            lines_out.append(g)
            total_length += g.Length

        else:
            # fallback: try treat as curve-like geometry
            try:
                if hasattr(g, "IsClosed") and g.IsClosed:
                    rect_out = g
                else:
                    lines_out.append(g)
                    if hasattr(g, "GetLength"):
                        total_length += g.GetLength()
            except:
                pass
# ---------- end python_3_script_3 ----------

# ---- group: extrude CLT Plates
clt_plates_thickness_2 = Panel("-0.06")
unit_z_2 = UnitZ(Factor=clt_plates_thickness_2)
surface_3 = Surface(python_3_script_3.rect_out)
extrude_2 = Extrude(Base=surface_3, Direction=unit_z_2)

# ---- group: visualize beams
ct_beam_3 = CTBeam(centerline=python_3_script_3.lines_out, width="0.15", height="0.3")  # -> Beam, Blank; inputs centerline: list, z_vector: list of Vector3d, width: list of Double, height: list of Double, category: list of String, updateRefObj: Boolean; same code as ct_beam

# ----
match_tree = MatchTree(Tree=graft(extrude_2), Guide=ct_beam_3.Blank)
merge = Merge(Data1=ct_beam_3.Blank, Data2=match_tree)
group = Group(Geometry=merge)
bounding_box = BoundingBox(Content=group, Plane=PlaneXY(0, 0, 0))  # -> Box, Box_2
deconstruct_box = DeconstructBox(Box=bounding_box.Box)  # -> Plane, X, Y, Z
deconstruct_domain = DeconstructDomain(Domain=deconstruct_box.Z)  # -> Start, End
subtraction = Subtraction(A=deconstruct_domain.End, B=deconstruct_domain.Start)  # -> flatten(Result)

module_z_height = Panel(subtraction)
maximum = Maximum(A=subtraction, B=rfl_max_limit_m)
how_many_modules_that_exceed_the_limit = Panel(maximum)
