# Grasshopper definition 201_analyse_model.ghx (Grasshopper 1.0.8)

python_3_script = Python3Script()  # -> out, lines, types
# ---------- python_3_script: Python ----------
import os
from compas.data import json_load

gh_dir = os.path.dirname(ghenv.Component.OnPingDocument().FilePath)
design_folder = os.path.dirname(gh_dir)
json_path = os.path.join(design_folder, "line_model", "data", "out_lines.json")

lines_data = json_load(json_path)

lines = [item["line"] for item in lines_data]
types = [item["type"] for item in lines_data]
# ---------- end python_3_script ----------
panel = Panel(python_3_script.lines)
panel_2 = Panel(python_3_script.types)
# to Karamba components
compas_draw = COMPASDraw(cg=python_3_script.lines)  # -> rg
#   port cg: The COMPAS geometry or datastructure to be drawn.
#   port rg: The Rhino geometry object.
# ---------- compas_draw: Python ----------
# r: compas>=2.14.1
"""
Draws COMPAS geometry in Grasshopper.
"""

from typing import Any

import Grasshopper

from compas.scene import SceneObject


class CompasToRhinoGeometry(Grasshopper.Kernel.GH_ScriptInstance):
    def RunScript(self, cg):
        if not cg:
            return None

        return SceneObject(item=cg).draw()
# ---------- end compas_draw ----------
