# Grasshopper definition analyse+export.gh (Grasshopper 1.0.8)
# plug-ins: Karamba3D, GrasshopperRfem6WsPlugin, MeshEdit Components, LunchBox

# ----
# 1. Load JSON
python_3_script = Python3Script()  # -> out, lines, types, widths, heights, roof, edge_beams
# ---------- python_3_script: Python ----------
import os
from compas.data import json_load

gh_dir = os.path.dirname(ghenv.Component.OnPingDocument().FilePath)
design_folder = os.path.dirname(gh_dir)
json_path = os.path.join(design_folder, "line_model", "data", "out_lines.json")

lines_data = json_load(json_path)

lines = [item["line"] for item in lines_data]
types = [item["type"] for item in lines_data]
edge_beams = [l for l,t in zip(lines, types) if t=="edge"]
try:
    widths = [item["width"] for item in lines_data]
    heights = [item["height"] for item in lines_data]
    roof = [item["mesh"] for item in lines_data]
except Exception as e:
    widths = [12.0 for item in lines_data]
    heights = [24.0 for item in lines_data]
    print("Error:", e)
# ---------- end python_3_script ----------
panel = Panel(python_3_script.out)
compas_draw = COMPASDraw(cg=python_3_script.lines)  # -> rg
#   port cg: The COMPAS geometry or datastructure to be drawn.
#   port rg: The Rhino geometry object.
# ---------- compas_draw: Python ----------
# r: compas>=2.14.1
"""
Draws COMPAS geometry in Grasshopper.
"""

from typing import Any

import Grasshopper

from compas.scene import SceneObject


class CompasToRhinoGeometry(Grasshopper.Kernel.GH_ScriptInstance):
    def RunScript(self, cg):
        if not cg:
            return None

        return SceneObject(item=cg).draw()
# ---------- end compas_draw ----------
all_lines = Line(compas_draw)

facade_load_edge_beams = Line(python_3_script.edge_beams)
snow_load_mesh = Line(python_3_script.roof)

cross_h = Number(python_3_script.heights)
cross_w = Number(python_3_script.widths)

height = Number(cross_h)
width = Number(cross_w)

# ----
# B. Create Beams
line = Line(all_lines)
material_selection_karamba3d = MatSelect(menu=[dropdown(1), dropdown(4), dropdown(11)])
cross_section_karamba3d = CroSec(
    FamilyNameOfCrossSection="DefaultCroSec",
    Material=material_selection_karamba3d,
    Height_cm=height,
    UpperFlangeWidth_cm=width,
    LowerFlangeWidth_cm=width,
    mode="Trapezoid")
create_linear_element_karamba3d = LineElem(
    Line=line,
    Identifier="N",
    CrossSection=cross_section_karamba3d,
    LimitDistance_m=0.005,
    BucklingLengthY_m=-1,
    BucklingLengthZ_m=-1,
    BucklingLengthLT_m=-1,
    Bending=True,
    ToPolylineMaxAngle=0.25,
    ToPolylineTolerance=0.1,
    ToPolylineMaxEdgeLength=0.25,
    New=True,
    Remove=True,
    mode="LineToBeam",
    GuidGeneratorSeed=525822330)  # -> Element, Points, Info

# ----
# A. Create CLT Panels
mesh = Mesh(snow_load_mesh)
material_selection_karamba3d_2 = MatSelect(menu=[dropdown(1), dropdown(5), dropdown(8)])
cross_section_karamba3d_2 = CroSec(
    FamilyNameOfCrossSection="DefaultCroSec",
    Material=material_selection_karamba3d_2,
    Height_cm=Slider(6, range=0..100),
    mode="Shell - Const")
mesh_explode = MeshExplode(Mesh=mesh, Interpolate=False)  # -> flatten(Faces)
create_surface_element_karamba3d = SurfElem(Mesh=mesh_explode, CrossSection=cross_section_karamba3d_2, LimitDistance_m=0.005, Bending=True, mode="MeshToShell")  # -> Element, Points, Info

# ----
# C. Set Support
point = Point([Point(163.5400008, 48.10000076, 16.1), Point(163.5400008, 57.72000076, 16.1), Point(173.1600008, 48.10000076, 20.1), Point(173.1600008, 57.72000076, 20.1)])
xy_plane = XYPlane(Origin=Point(0, 0, 0))
support_karamba3d = Supp(
    PosInd=point,
    PlaneOfReference=xy_plane,
    Ct_kN_m=Vector(0, 0, 0),
    Cr_kNm_rad=Vector(0, 0, 0),
    menu=[buttons(on, on, on, off, off, off)])

number_slider = Slider(10000, range=0..20000)
number_slider_2 = Slider(10000, range=0..20000)
vector_xyz = VectorXYZ(XComponent=number_slider, YComponent=number_slider, ZComponent=number_slider)  # -> Vector, Length
vector_xyz_2 = VectorXYZ(XComponent=number_slider_2, YComponent=number_slider_2, ZComponent=number_slider_2)  # -> Vector, Length

# ----
# 2. Check Karamba3d model
list = ValueList({"DL_T", "DL_FD", "LL", "WL_X", "WL_Y", "SL"}, selected="DL_FD")

# ----
# D. Set Loads
curve = Curve(facade_load_edge_beams)
mesh_2 = Mesh(snow_load_mesh)
explode = Explode(Curve=curve, Recursive=True)  # -> Segments, Vertices
quadrangulate = Quadrangulate(Mesh=mesh_2, Angle=0.03490658504, Ratio=0.875)  # -> Mesh, Count
list_2 = ValueList({"DL_T", "DL_FD", "LL", "WL_X", "WL_Y", "SL"}, selected="DL_T")
list_3 = ValueList({"DL_T": -0.5, "DL_FD": -9, "LL": -1.5, "WL_X": -1.1, "WL_Y": -1.1, "SL": -1.1}, selected="DL_FD")
list_4 = ValueList({"DL_T": -0.5, "DL_FD": -9, "LL": -1.5, "WL_X": -1.1, "WL_Y": -1.1, "SL": -1.1}, selected="SL")
loads_karamba3d = Loads(Vector=Vector(0, 0, -1), LCase=list_2, mode="Gravity")
Z = UnitZ(Factor=list_3)
Z_2 = UnitZ(Factor=list_4)
list_5 = ValueList({"DL_T", "DL_FD", "LL", "WL_X", "WL_Y", "SL"}, selected="SL")
loads_karamba3d_2 = Loads(
    Vector=Z_2,
    Mesh=quadrangulate.Mesh,
    LCase=list_5,
    mode="MeshLoad -Const.",
    menu=[buttons(on, off, off), buttons(on, on)])
loads_karamba3d_3 = Loads(ForceVector=Z, Local=False, PosInd=explode.Vertices, LCase=list, mode="Point")
merge = Merge(Data1=loads_karamba3d, Data2=loads_karamba3d_3, Data3=loads_karamba3d_2)  # -> flatten(Result)
load_karamba3d = LoadKaramba3D(merge)

# ----
# E. Set Joints
beam_joints_karamba3d = BeamJoints(
    CtKNMAtStartingNode=Vector(0, 0, 0),
    CrKNmRadAtStartingNode=vector_xyz.Vector,
    CtKNMAtEndNode=Vector(0, 0, 0),
    CrKNmRadAtEndNode=vector_xyz_2.Vector,
    menu=[buttons(off, off, off, on, on, on), buttons(off, off, off, on, on, on)])

# ----
# E. Analyse Model
merge_2 = Merge(Data1=create_surface_element_karamba3d.Element, Data2=create_linear_element_karamba3d.Element)
element_karamba3d = ElementKaramba3D(merge_2)
assemble_model_karamba3d = Assemble(
    Elem=element_karamba3d,
    Support=support_karamba3d,
    Load=load_karamba3d,
    Joint=beam_joints_karamba3d,
    LimitDistance_m=0.005)  # -> Model, Info, Mass_kg, CentreOfGravity, LoadCaseNames
analyse_karamba3d = Analyse(Model=assemble_model_karamba3d.Model)  # -> AnalysedModel, MaximumDisplacement_cm, ResultingForce_kN, ChangeOfElasticEnergy_kNm
panel_2 = Panel(analyse_karamba3d.MaximumDisplacement_cm)

model_view_karamba3d = ModelView(Model=analyse_karamba3d.AnalysedModel)  # -> Model, DeformedMesh, DeformedAxes, DeformedModel, MaximumDeformation
beam_view_karamba3d = BeamView(Model=model_view_karamba3d.Model)  # -> Model, MeshesOfRenderedBeams, DeformedBeamAxes, LegendColours, LegendTags

# ----
# 3. Disassemble Karamba and export RFEM model
model_karamba3d = ModelKaramba3D(beam_view_karamba3d.Model)
disassemble_model_karamba3d = Disassemble(Model=model_karamba3d)  # -> Model, Point, Beam, Shell, Support, Load, Line, Mesh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

# ----
# B. Plate element
disassemble_element_karamba3d = Disassemble(Element=disassemble_model_karamba3d.Shell)  # -> Element, ElementIdentifier, AxisOfElement, CrossSection, Joint, Material, LocalCoordinateSystem, ElementIsActive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
mesh_join = MeshJoin(Meshes=disassemble_element_karamba3d.AxisOfElement)
mesh_to_nurbs = MeshToNurbs(Mesh=mesh_join)  # -> QuadrangularSurfaces, TriangularSurfaces
brep_join = BrepJoin(Breps=mesh_to_nurbs.TriangularSurfaces)  # -> Breps, Closed

# ----
# A. Supports
disassemble_support_karamba3d = DS(Support=disassemble_model_karamba3d.Support)  # -> NodeIndex, PlaneOfReference, Ct_kN_m, Cr_kNm_rad, Dofs
list_item = ListItem(List=disassemble_model_karamba3d.Point, Index=disassemble_support_karamba3d.NodeIndex, Wrap=True)
support = Point(list_item)

# ----
# D. Loads
list_6 = ValueList({"GEOMETRICALLY_LINEAR": 0, "LARGE_DEFORMATIONS": 1, "SECOND_ORDER_P_DELTA": 2}, selected="GEOMETRICALLY_LINEAR")
load_case_classification_component = LoadCaseClassificationComponent(ActionIndex=0, DesignIndex=0, StandardIndex=0, menu=[dropdown(0), dropdown(0), dropdown(0)])  # -> ActionCategory, DesignSituationType
static_analysis_settings = StaticAnalysisSettings(StaticAnalysisSettingNo="1", AnalysisType=list_6, ExceptionalHandling=Toggle(False), mode="Assemble")
load_case = LoadCase(
    LoadCaseNo="1",
    LoadCaseName="Self Weigth",
    StaticAnalysisSettings=static_analysis_settings,
    ActionCategory=load_case_classification_component.ActionCategory,
    SelfWeightActive=Toggle(True),
    mode="Assemble")

support_2 = Point(support)
py3 = Python3Script(L=support_2, S="1")  # -> No; inputs L: list, S: Int32
# ---------- py3: Python ----------
if not S:
    S = 1



No = list(range(S, len(L) + S))
# ---------- end py3 ----------

# ---- group: Plates
list_7 = ValueList({"C24 | SIA 265:2021", "GL24h | SIA 265:2021", "S235 | SIA 263:2013", "Schilliger | Schilliger"}, selected="GL24h | SIA 265:2021")
material = Material(MaterialNo="2", MaterialName=list_7, UserDefinedMaterial=Toggle(True), mode="Assemble")

srf = Surface(brep_join.Breps)
py3_2 = Python3Script(L=srf, S="1")  # -> No; inputs L: list, S: Int32; same code as py3
plate_thickness = Panel(".06")
thickness = Thickness(ThicknessNo="1", MaterialNo=material, ThicknessD=plate_thickness, mode="Assemble")
surface = Surface(GHSurface=srf, SurfaceNo=py3_2, ThicknessNo=thickness, mode="Assemble")

# ----
list_8 = ValueList({"C24 | SIA 265:2021", "GL24h | SIA 265:2021", "S235 | SIA 263:2013", "Schilliger | Schilliger"}, selected="C24 | SIA 265:2021")
material_2 = Material(MaterialNo="1", MaterialName=list_8, UserDefinedMaterial=Toggle(True), mode="Assemble")

# ---- group: Supports
nodal_support = NodalSupport(
    GHNode=support_2,
    SupportNo=py3,
    TranslationalSpringX="0",
    TranslationalSpringY="0",
    TranslationalSpringZ="inf",
    mode="Assemble")

# ----
list_9 = ValueList({"SECTION_DISTRIBUTION_TYPE_CURVED": 0, "SECTION_DISTRIBUTION_TYPE_FISH_BEAM_LINEAR": 1, "SECTION_DISTRIBUTION_TYPE_FISH_BEAM_PARABOLIC": 2, "SECTION_DISTRIBUTION_TYPE_LINEAR": 3, "SECTION_DISTRIBUTION_TYPE_NONE": 4, "SECTION_DISTRIBUTION_TYPE_OFFSET_AT_BOTH_SIDES": 5, "SECTION_DISTRIBUTION_TYPE_OFFSET_AT_END_OF_MEMBER": 6, "SECTION_DISTRIBUTION_TYPE_OFFSET_AT_START_OF_MEMBER": 7, "SECTION_DISTRIBUTION_TYPE_PITCHED_CAMBERED_BEAM_WITH_CONSTANT_HEIGHT": 8, "SECTION_DISTRIBUTION_TYPE_PITCHED_CAMBERED_BEAM_WITH_VARIABLE_HEIGHT": 9, "SECTION_DISTRIBUTION_TYPE_SADDLE": 10, "SECTION_DISTRIBUTION_TYPE_TAPERED_AND_OFFSET_AT_BOTH_SIDES": 11, "SECTION_DISTRIBUTION_TYPE_TAPERED_AND_OFFSET_AT_END_OF_MEMBER": 12, "SECTION_DISTRIBUTION_TYPE_TAPERED_AND_OFFSET_AT_START_OF_MEMBER": 13, "SECTION_DISTRIBUTION_TYPE_TAPERED_AT_BOTH_SIDES": 14, "SECTION_DISTRIBUTION_TYPE_TAPERED_AT_END_OF_MEMBER": 15, "SECTION_DISTRIBUTION_TYPE_TAPERED_AT_START_OF_MEMBER": 16, "SECTION_DISTRIBUTION_TYPE_UNIFORM": 17}, selected="SECTION_DISTRIBUTION_TYPE_UNIFORM")
list_10 = ValueList({"TYPE_ANCHOR": 0, "TYPE_BEAM": 1, "TYPE_BUCKLING": 2, "TYPE_CABLE": 3, "TYPE_CABLE_ON_PULLEYS": 4, "TYPE_COMPRESSION": 5, "TYPE_COUPLING_HINGE_HINGE": 6, "TYPE_COUPLING_HINGE_RIGID": 7, "TYPE_COUPLING_RIGID_HINGE": 8, "TYPE_COUPLING_RIGID_RIGID": 9, "TYPE_DAMPER": 10, "TYPE_DEEP_BEAM": 11, "TYPE_DEFINABLE_STIFFNESS": 12, "TYPE_DESIGN_STRIP": 13, "TYPE_JOIST": 14, "TYPE_LOAD_TRANSFER": 15, "TYPE_PILE": 16, "TYPE_RESULT_BEAM": 17, "TYPE_RESULT_LINE": 18, "TYPE_RIB": 19, "TYPE_RIGID": 20, "TYPE_SHEAR_WALL": 21, "TYPE_SPRING": 22, "TYPE_SURFACE_MODEL": 23, "TYPE_TENDON_CABLE": 24, "TYPE_TENDON_REBAR": 25, "TYPE_TENSION": 26, "TYPE_TRUSS": 27, "TYPE_TRUSS_ONLY_N": 28}, selected="TYPE_BEAM")

# ---- group: Gelenkbedingungen
member_hinge = MemberHinge(mode="Assemble")
member_hinge_2 = MemberHinge(mode="Assemble")

# ----
# C. Beams + Cross-sections
disassemble_element_karamba3d_2 = Disassemble(Element=disassemble_model_karamba3d.Beam)  # -> Element, ElementIdentifier, AxisOfElement, CrossSection, Joint, Material, LocalCoordinateSystem, ElementIsActive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
disassemble_cross_section_karamba3d = Disassemble(CroSec=disassemble_element_karamba3d_2.CrossSection)  # -> CrossSection, FamilyNameOfCrossSection, TypeNameOfCrossSection, ElemIdentifiers, Colour, Material, LocalEccentricity_cm, Heights_cm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
height_2 = Number(disassemble_cross_section_karamba3d.Heights_cm)
width_2 = Number(disassemble_cross_section_karamba3d.MaximumWidth_cm)
match_text = MatchText(Text=disassemble_cross_section_karamba3d.Material, RegEx="Timber", Case=True)
list_item_2 = ListItem(List=height_2, Index=0, Wrap=True)  # -> flatten(Item)
centerlines = Line(disassemble_element_karamba3d_2.AxisOfElement)
dispatch = Dispatch(List=list_item_2, DispatchPattern=match_text)  # -> ListA, ListB
dispatch_2 = Dispatch(List=width_2, DispatchPattern=match_text)  # -> ListA, ListB
dispatch_3 = Dispatch(List=centerlines, DispatchPattern=match_text)  # -> ListA, ListB
timberbeams = Curve(dispatch_3.ListA)
width_3 = Number(dispatch.ListA)
height_3 = Number(dispatch_2.ListA)
python_3_script_2 = Python3Script(beams=timberbeams, w=height_3, h=width_3)  # -> out, sorted_sections, a, b; inputs beams: list of Line, w: list of Int32, h: list of Int32
# ---------- python_3_script_2: Python ----------
import rhinoscriptsyntax as rs
import Rhino.Geometry as rg

def process_rhino_beams(curve_objects, widths_cm, heights_cm):
    """
    Groups actual Rhino curve geometry by unique cross-section dimensions.
    """
    groups = {}
    
    # 1. Group the actual Curve objects
    for crv, w_cm, h_cm in zip(curve_objects, widths_cm, heights_cm):
        # Format the Section Name (m)
        w_m, h_m = w_cm / 100.0, h_cm / 100.0
        section_name = "R_M1 {:.2f}/{:.2f}".format(w_m, h_m)
        
        if section_name not in groups:
            groups[section_name] = []
        
        # Store the actual Rhino Geometry Object
        groups[section_name].append(crv)

    # 2. Flatten into synchronous lists
    flat_curves = []
    flat_ids = []
    mapping_summary = []
    sections = []

    # Sort keys to ensure consistent ID assignment (201, 202...)
    sorted_sections = sorted(groups.keys())

    for i, section in enumerate(sorted_sections):
        current_id = 201 + i
        mapping_summary.append("ID: {} -> {}".format(current_id, section))
        
        for crv in groups[section]:
            flat_curves.append(crv)
            flat_ids.append(current_id)
            
    return flat_curves, flat_ids, sorted_sections

# --- Rhino/Grasshopper Execution ---
# Ensure your input 'curves' is set to "List Access" and "Curve" type hint
# if curves and w and h:
output_curves, output_ids, sorted_sections = process_rhino_beams(beams, w, h)


# Assign to GH Output parameters
a = output_curves
b = output_ids
# ---------- end python_3_script_2 ----------
create_set = CreateSet(List=python_3_script_2.b)  # -> Set, Map
panel_3 = Panel(python_3_script_2.sorted_sections)
cross_section = CrossSection(SectionNo=create_set.Set, SectionName=panel_3, MaterialNo=material_2, mode="Assemble")
crv = Curve(python_3_script_2.a)
long = LongestList(ListA=crv, ListB=cross_section, PaddingMode=2)  # -> ListA, ListB

py3_3 = Python3Script(L=crv, S="50000")  # -> No; inputs L: list, S: Int32; same code as py3

member = Member(
    GHLine=long.ListA,
    MemberNo=py3_3,
    SectionDistribution=list_9,
    SectionStart=python_3_script_2.b,
    MemberType=list_10,
    HingeStart=member_hinge_2,
    HingeEnd=member_hinge,
    mode="Assemble")

members_cross_sections = Data(flatten([cross_section, member]))
load_cases_materials = Data(flatten([load_case, material_2, static_analysis_settings]))
plates = Data(flatten([surface, thickness, material]))
supports = Data(nodal_support)

# ----
# E. Export to RFEM
toggle = BooleanToggle(True)
überschreiben = BooleanToggle(True)
list_11 = ValueList({"None": 0, "Microns": 1, "Millimeters": 2, "Centimeters": 3, "Meters": 4, "Kilometers": 5, "Microinches": 6, "Mils": 7, "Inches": 8, "Feet": 9, "Miles": 10, "CustomUnits": 11, "Angstroms": 12, "Nanometers": 13, "Decimeters": 14, "Dekameters": 15, "Hectometers": 16, "Megameters": 17, "Gigameters": 18, "Yards": 19, "PrinterPoints": 20, "PrinterPicas": 21, "NauticalMiles": 22, "AstronomicalUnits": 23, "LightYears": 24, "Parsecs": 25, "Unset": 26}, selected="Meters")
rfem_export = RFEM6ExportComponent(
    Run=Button(),
    Input=flatten([load_cases_materials, members_cross_sections, supports, plates]),
    Units=list_11,
    FlipZAxis=Toggle(True),
    UtilizeNodes=Toggle(True),
    Overwrite=überschreiben,
    ReadLog=toggle)  # -> RFEMData, Log, SuccessfulExport
panel_4 = Panel(rfem_export.SuccessfulExport)
rec = DataRecorder(rfem_export.Log, DataLimit=-10, RecordData=True)
panel_5 = Panel(rec)
