# Grasshopper definition base_plates.ghx (Grasshopper 1.0.8)
# plug-ins: Human, LadybugGrasshopper

# ----
# GEOMETRY
number_slider = Slider(0.368, range=0..1)
number_slider_2 = Slider(0.08, range=0..0.5)
list = ValueList({"parallel_to_ground", "Perpendicular_to_grain"}, selected="Perpendicular_to_grain")
falsestart = LBFalseStartToggle(False)
falsestart_2 = LBFalseStartToggle(True)
py3 = Python3Script(
    target_cluster_index=Slider(4, range=1..4),
    baseplate_top_z=number_slider,
    webplate_hole_rows=Slider(3, range=1..3),
    include_stiffeners=falsestart,
    enabled=falsestart_2,
    bottom_face_mode=list)  # -> out, payload, preview_breps, footing_debug; inputs webplate_hole_rows: Int32
# ---------- py3: Python ----------
"""
Grasshopper Py3 wrapper: base_plate_geometry

GH Inputs expected:
- payload_override
- line_model_path
- plate_length
- plate_width
- plate_thickness
- bottom_face_mode
- include_hierarchies
- target_support_nodes_only
- support_z_tolerance
- deduplicate_support_nodes
- support_node_merge_tolerance
- target_member_index (deprecated alias for target_cluster_index)
- target_cluster_index
- geometry_kind
- baseplate_top_z
- base_plate_brep
- base_diameter
- min_hole_edge_spacing
- heel_fillet_radius
- timber_bottom_gap
- min_timber_gap
- webplate_thickness
- webplate_hole_diameter
- webplate_hole_pitch
- webplate_hole_transverse_spacing
- webplate_hole_rows
- webplate_hole_pattern
- webplate_hole_stagger_offset
- stiffener_pair_axis_shift
- stiffener_pair_from_point
- stiffener_pair_to_point
- include_stiffeners
- sizing_recommendations
- calc_payload
- enabled

GH Outputs:
- out
- payload  (opaque payload token; keep downstream inputs on Item Access)
- members
- base_plates
- preview_breps
- footing_debug
"""

import importlib.util
import os
import sys
import traceback

try:
    import scriptcontext as sc  # type: ignore
except Exception:
    sc = None

try:
    import Rhino  # type: ignore
except Exception:
    Rhino = None

try:
    from Grasshopper.Kernel.Types import GH_ObjectWrapper  # type: ignore
except Exception:
    GH_ObjectWrapper = None

ROOT = r"C:\Users\Juste\Documents\_GitHub\MAS-2526\10_llhil-t2-fabrication\design\structure_model\Base_Plates"
DEFAULT_PLATE_LENGTH = 0.8
DEFAULT_PLATE_WIDTH = 0.8
DEFAULT_PLATE_THICKNESS = 0.02
DEFAULT_BASEPLATE_TOP_Z = 0.3658
RUN_TAG = "BPG_WRAPPER_SYNC_2026_05_18_HOLE_MODE_AND_END_DISTANCE"

# Diagnostic: print resolved path
print("[GH Wrapper] RUN_TAG:", RUN_TAG)
print("[GH Wrapper] ROOT:", ROOT)
HELPER_PATH = os.path.join(ROOT, "py", "base_plate_geometry.py")
print("[GH Wrapper] HELPER_PATH:", HELPER_PATH)
print("[GH Wrapper] HELPER_EXISTS:", os.path.exists(HELPER_PATH))



def _load_helper():
    module_name = "base_plate_geometry"
    print("[GH Wrapper] HELPER_LOAD_START")
    sys.modules.pop(module_name, None)
    spec = importlib.util.spec_from_file_location(module_name, HELPER_PATH)
    if spec is None or spec.loader is None:
        raise ImportError("Could not load {0}".format(HELPER_PATH))
    module = importlib.util.module_from_spec(spec)
    # Required for dataclasses/type resolution during module execution in GH Py3.
    sys.modules[module_name] = module
    try:
        spec.loader.exec_module(module)
    except Exception as e:
        print("[GH Wrapper] Error importing base_plate_geometry.py:", e)
        import traceback
        print(traceback.format_exc())
        raise
    print("[GH Wrapper] HELPER_LOADED: True")
    return module


def _unit_system_from_name(units_name):
    if Rhino is None:
        return None
    text = str(units_name or "").strip().lower()
    if text in ("m", "meter", "meters", "metre", "metres"):
        return Rhino.UnitSystem.Meters
    if text in ("mm", "millimeter", "millimeters", "millimetre", "millimetres"):
        return Rhino.UnitSystem.Millimeters
    return None


def _payload_to_doc_scale(payload_units):
    if Rhino is None:
        return 1.0
    try:
        doc = Rhino.RhinoDoc.ActiveDoc
        if doc is None:
            return 1.0
        source_units = _unit_system_from_name(payload_units)
        if source_units is None:
            return 1.0
        return float(Rhino.RhinoMath.UnitScale(source_units, doc.ModelUnitSystem))
    except Exception:
        return 1.0


def _scale_breps_copy(breps, scale_factor):
    if Rhino is None:
        return [b for b in (breps or []) if b is not None]
    if abs(scale_factor - 1.0) <= 1e-12:
        return [b for b in (breps or []) if b is not None]

    scaled = []
    transformed_count = 0
    passthrough_count = 0
    try:
        xform = Rhino.Geometry.Transform.Scale(Rhino.Geometry.Plane.WorldXY, scale_factor)
    except Exception:
        return [b for b in (breps or []) if b is not None]

    for geom in (breps or []):
        if geom is None:
            continue
        try:
            dup = None

            # Prefer geometry-preserving duplicate when available.
            duplicate = getattr(geom, "Duplicate", None)
            if callable(duplicate):
                dup = duplicate()

            # Fall back to Brep duplication path.
            if dup is None:
                duplicate_brep = getattr(geom, "DuplicateBrep", None)
                if callable(duplicate_brep):
                    dup = duplicate_brep()

            # Last resort: convert to Brep if possible.
            if dup is None:
                to_brep = getattr(geom, "ToBrep", None)
                if callable(to_brep):
                    try:
                        dup = to_brep(False)
                    except TypeError:
                        dup = to_brep()

            if dup is None:
                passthrough_count += 1
                scaled.append(geom)
                continue

            if not dup.Transform(xform):
                passthrough_count += 1
                scaled.append(geom)
                continue

            transformed_count += 1
            scaled.append(dup)
        except Exception:
            passthrough_count += 1
            scaled.append(geom)

    print(
        "[GH Wrapper] footing scale transform: transformed={0}, passthrough={1}".format(
            transformed_count,
            passthrough_count,
        )
    )
    return scaled


def _coerce_geometry_list(items):
    """Return only Rhino geometry objects, converting to Brep when possible."""
    coerced = []
    for item in (items or []):
        if item is None:
            continue
        geom = item
        if Rhino is not None:
            try:
                if isinstance(geom, Rhino.Geometry.GeometryBase):
                    coerced.append(geom)
                    continue
            except Exception:
                pass
        try:
            duplicate = getattr(item, "Duplicate", None)
            if callable(duplicate):
                geom = duplicate()
        except Exception:
            geom = item
        if Rhino is not None:
            try:
                if isinstance(geom, Rhino.Geometry.GeometryBase):
                    coerced.append(geom)
                    continue
            except Exception:
                pass
        try:
            to_brep = getattr(item, "ToBrep", None)
            if callable(to_brep):
                try:
                    brep = to_brep(False)
                except TypeError:
                    brep = to_brep()
                if brep is not None:
                    coerced.append(brep)
                    continue
        except Exception:
            pass
    return coerced


def _to_python_data(value):
    if isinstance(value, dict):
        return {key: _to_python_data(item) for key, item in value.items()}
    try:
        keys = list(value.Keys)
    except Exception:
        keys = None
    if keys is not None:
        return {
            _to_python_data(key): _to_python_data(value[key])
            for key in keys
        }
    if isinstance(value, (list, tuple)):
        return [_to_python_data(item) for item in value]
    return value


def _component_key():
    try:
        return str(ghenv.Component.InstanceGuid)  # type: ignore[name-defined]
    except Exception:
        return "standalone"


def _store_payload_reference(kind, value):
    if GH_ObjectWrapper is not None:
        print("[GH Wrapper] payload output mode=gh_object_wrapper kind={0}".format(kind))
        return GH_ObjectWrapper(value)
    if sc is None:
        return value
    token = "BPG_PAYLOAD::{0}::{1}".format(kind, _component_key())
    sc.sticky[token] = value
    print("[GH Wrapper] payload output mode=reference_token kind={0}".format(kind))
    return token


def _unwrap_payload(value):
    normalized = value
    while True:
        wrapped_value = getattr(normalized, "Value", None)
        if wrapped_value is not None and wrapped_value is not normalized:
            normalized = wrapped_value
            continue
        branches = getattr(normalized, "Branches", None)
        if branches is not None:
            normalized = _to_python_data(branches)
            continue
        normalized = _to_python_data(normalized)
        if isinstance(normalized, str) and sc is not None and normalized in sc.sticky:
            normalized = sc.sticky[normalized]
            continue
        if isinstance(normalized, (list, tuple)) and len(normalized) == 1:
            normalized = normalized[0]
            continue
        return normalized


def _coerce_webplate_hole_rows(value):
    """Accept both the intended 1/2 integer control and a GH bool toggle."""
    if isinstance(value, bool):
        return 2 if value else 1
    text = str(value).strip().lower()
    if text == "true":
        return 2
    if text == "false":
        return 1
    try:
        numeric = int(value)
    except Exception:
        return None
    if numeric in (1, 2):
        return numeric
    if numeric == 0:
        return 1
    return 2 if numeric > 1 else 1


def _coerce_webplate_hole_pattern(value):
    try:
        numeric = float(value)
        text = str(int(numeric)) if numeric.is_integer() else str(value).strip().lower()
    except Exception:
        text = str(value).strip().lower()
    text = text.replace(" ", "_")
    aliases = {
        "1": "single_row_centerline",
        "single": "single_row_centerline",
        "single_row": "single_row_centerline",
        "single_row_centerline": "single_row_centerline",
        "2": "double_row",
        "double": "double_row",
        "double_row": "double_row",
        "rectangular": "double_row",
        "3": "staggered_double_row",
        "stagger": "staggered_double_row",
        "staggered": "staggered_double_row",
        "staggered_double_row": "staggered_double_row",
    }
    return aliases.get(text)


print("[GH Wrapper] BODY_READY")


try:
    helper = _load_helper()
    try:
        print(
            "[GH Wrapper] helper capabilities: rg_available={0}, base_footing_run_callable={1}".format(
                bool(getattr(helper, "rg", None) is not None),
                callable(getattr(helper, "base_footing_run", None)),
            )
        )
    except Exception:
        pass

    if "enabled" in globals() and enabled is False:
        print("[GH Wrapper] Branch: disabled")
        out = "Base plate geometry disabled."
        payload = {}
        members = []
        base_plates = []
        preview_breps = []
        footing_debug = []
    else:
        print("[GH Wrapper] Branch: active")
        kwargs = {}
        if "payload_override" in globals() and payload_override:
            payload_candidate = _unwrap_payload(payload_override)
            payload = payload_candidate if isinstance(payload_candidate, dict) else payload_override
        else:
            kwargs = {
                "plate_length": DEFAULT_PLATE_LENGTH,
                "plate_width": DEFAULT_PLATE_WIDTH,
                "plate_thickness": DEFAULT_PLATE_THICKNESS,
                "bottom_face_mode": "Perpendicular_to_grain",
                "target_support_nodes_only": True,
                "deduplicate_support_nodes": True,
                "geometry_kind": "footing",
                "baseplate_top_z": DEFAULT_BASEPLATE_TOP_Z,
            }
            if "line_model_path" in globals() and line_model_path:
                from pathlib import Path
                kwargs["line_model_path"] = Path(str(line_model_path))
            else:
                # Fallback for GH context: use absolute path to repo's line_model data
                from pathlib import Path
                data_dir = Path(r"C:\Users\Juste\Documents\_GitHub\MAS-2526\10_llhil-t2-fabrication\design\line_model\data")
                # Prefer the latest explicit line-model export before legacy variants.
                for candidate in ["260516_v1_line_model.json", "0806_shifted_lines.json", "shifted_lines.json", "meters_shifted_lines.json"]:
                    candidate_path = data_dir / candidate
                    if candidate_path.exists():
                        kwargs["line_model_path"] = candidate_path
                        break
            if "plate_length" in globals() and plate_length is not None:
                kwargs["plate_length"] = float(plate_length)
            if "plate_width" in globals() and plate_width is not None:
                kwargs["plate_width"] = float(plate_width)
            if "plate_thickness" in globals() and plate_thickness is not None:
                kwargs["plate_thickness"] = float(plate_thickness)
            if "bottom_face_mode" in globals() and bottom_face_mode:
                kwargs["bottom_face_mode"] = str(bottom_face_mode)
            if "include_hierarchies" in globals() and include_hierarchies:
                kwargs["include_hierarchies"] = include_hierarchies
            if "target_support_nodes_only" in globals() and target_support_nodes_only is not None:
                kwargs["target_support_nodes_only"] = bool(target_support_nodes_only)
            if "support_z_tolerance" in globals() and support_z_tolerance is not None:
                kwargs["support_z_tolerance"] = float(support_z_tolerance)
            if "deduplicate_support_nodes" in globals() and deduplicate_support_nodes is not None:
                kwargs["deduplicate_support_nodes"] = bool(deduplicate_support_nodes)
            if "support_node_merge_tolerance" in globals() and support_node_merge_tolerance is not None:
                kwargs["support_node_merge_tolerance"] = float(support_node_merge_tolerance)
            if "target_cluster_index" in globals() and target_cluster_index is not None:
                kwargs["target_cluster_index"] = int(target_cluster_index)
            elif "target_member_index" in globals() and target_member_index is not None:
                # Backward compatibility only: use target_cluster_index (1..4) going forward.
                kwargs["target_cluster_index"] = int(target_member_index)
                print("[GH Wrapper] target_member_index is deprecated; use target_cluster_index (1..4).")
            if "geometry_kind" in globals() and geometry_kind:
                kwargs["geometry_kind"] = str(geometry_kind)
            if "baseplate_top_z" in globals() and baseplate_top_z is not None:
                kwargs["baseplate_top_z"] = float(baseplate_top_z)
            if "base_plate_brep" in globals() and base_plate_brep is not None:
                kwargs["base_plate_brep"] = base_plate_brep
            if "base_diameter" in globals() and base_diameter is not None:
                kwargs["base_diameter"] = float(base_diameter)
            if "min_hole_edge_spacing" in globals() and min_hole_edge_spacing is not None:
                kwargs["min_hole_edge_spacing"] = float(min_hole_edge_spacing)
            if "heel_fillet_radius" in globals() and heel_fillet_radius is not None:
                kwargs["heel_fillet_radius"] = float(heel_fillet_radius)
            if "timber_bottom_gap" in globals() and timber_bottom_gap is not None:
                kwargs["timber_bottom_gap"] = float(timber_bottom_gap)
            if "min_timber_gap" in globals() and min_timber_gap is not None:
                kwargs["min_timber_gap"] = float(min_timber_gap)
            if "webplate_thickness" in globals() and webplate_thickness is not None:
                kwargs["webplate_thickness"] = float(webplate_thickness)
            if "webplate_hole_diameter" in globals() and webplate_hole_diameter is not None:
                kwargs["webplate_hole_diameter"] = float(webplate_hole_diameter)
            if "webplate_hole_pitch" in globals() and webplate_hole_pitch is not None:
                kwargs["webplate_hole_pitch"] = float(webplate_hole_pitch)
            if "webplate_hole_transverse_spacing" in globals() and webplate_hole_transverse_spacing is not None:
                kwargs["webplate_hole_transverse_spacing"] = float(webplate_hole_transverse_spacing)
            row_input_name = None
            row_input_value = None
            if "webplate_hole_rows" in globals() and webplate_hole_rows is not None:
                row_input_name = "webplate_hole_rows"
                row_input_value = webplate_hole_rows
            elif "plate_hole_rows" in globals() and plate_hole_rows is not None:
                row_input_name = "plate_hole_rows"
                row_input_value = plate_hole_rows
            if row_input_name is not None:
                resolved_rows = _coerce_webplate_hole_rows(row_input_value)
                if resolved_rows is not None:
                    kwargs["webplate_hole_rows"] = resolved_rows
                    print(
                        "[GH Wrapper] hole row input {0}={1!r} -> rows={2}".format(
                            row_input_name,
                            row_input_value,
                            resolved_rows,
                        )
                    )
                    if row_input_name == "plate_hole_rows":
                        print("[GH Wrapper] plate_hole_rows is a supported alias; prefer webplate_hole_rows.")
            pattern_input_name = None
            pattern_input_value = None
            if "webplate_hole_pattern" in globals() and webplate_hole_pattern is not None:
                pattern_input_name = "webplate_hole_pattern"
                pattern_input_value = webplate_hole_pattern
            elif "plate_hole_pattern" in globals() and plate_hole_pattern is not None:
                pattern_input_name = "plate_hole_pattern"
                pattern_input_value = plate_hole_pattern
            elif (
                row_input_name is not None
                and _coerce_webplate_hole_pattern(row_input_value) == "staggered_double_row"
            ):
                pattern_input_name = row_input_name
                pattern_input_value = row_input_value
            if pattern_input_name is not None:
                resolved_pattern = _coerce_webplate_hole_pattern(pattern_input_value)
                if resolved_pattern is not None:
                    kwargs["webplate_hole_pattern"] = resolved_pattern
                    if resolved_pattern == "staggered_double_row":
                        kwargs["webplate_hole_rows"] = 2
                    print(
                        "[GH Wrapper] hole pattern input {0}={1!r} -> pattern={2}".format(
                            pattern_input_name,
                            pattern_input_value,
                            resolved_pattern,
                        )
                    )
            if "webplate_hole_stagger_offset" in globals() and webplate_hole_stagger_offset is not None:
                kwargs["webplate_hole_stagger_offset"] = float(webplate_hole_stagger_offset)

            pair_axis_shift_input_name = None
            pair_axis_shift_input_value = None
            for candidate_name in (
                "stiffener_pair_axis_shift",
                "stiffener_pair_shift",
                "stiffener_pair_translate",
            ):
                if candidate_name in globals() and globals().get(candidate_name) is not None:
                    pair_axis_shift_input_name = candidate_name
                    pair_axis_shift_input_value = globals().get(candidate_name)
                    break
            if pair_axis_shift_input_name is not None:
                kwargs["stiffener_pair_axis_shift"] = float(pair_axis_shift_input_value)
                print(
                    "[GH Wrapper] stiffener pair axis shift {0}={1!r}".format(
                        pair_axis_shift_input_name,
                        pair_axis_shift_input_value,
                    )
                )

            pair_from_input_name = None
            pair_from_input_value = None
            for candidate_name in (
                "stiffener_pair_from_point",
                "stiffener_point_1",
                "stiffener_point1",
            ):
                if candidate_name in globals() and globals().get(candidate_name) is not None:
                    pair_from_input_name = candidate_name
                    pair_from_input_value = globals().get(candidate_name)
                    break
            if pair_from_input_name is not None:
                kwargs["stiffener_pair_from_point"] = pair_from_input_value
                print("[GH Wrapper] stiffener pair from point input: {0}".format(pair_from_input_name))

            pair_to_input_name = None
            pair_to_input_value = None
            for candidate_name in (
                "stiffener_pair_to_point",
                "stiffener_point_2",
                "stiffener_point2",
            ):
                if candidate_name in globals() and globals().get(candidate_name) is not None:
                    pair_to_input_name = candidate_name
                    pair_to_input_value = globals().get(candidate_name)
                    break
            if pair_to_input_name is not None:
                kwargs["stiffener_pair_to_point"] = pair_to_input_value
                print("[GH Wrapper] stiffener pair to point input: {0}".format(pair_to_input_name))

            if "include_stiffeners" in globals() and include_stiffeners is not None:
                kwargs["include_stiffeners"] = bool(include_stiffeners)
            if "sizing_recommendations" in globals() and sizing_recommendations:
                kwargs["sizing_recommendations"] = _unwrap_payload(sizing_recommendations)
            elif "calc_payload" in globals() and calc_payload:
                kwargs["sizing_recommendations"] = _unwrap_payload(calc_payload)

            print("[GH Wrapper] kwargs:", kwargs)

            payload = helper.build_geometry_payload(**kwargs)
        members = payload.get("members", [])
        base_plate_records = payload.get("base_plates", [])
        base_plates = []
        footing_breps = payload.get("footing_breps", []) if isinstance(payload, dict) else []
        metadata = payload.get("metadata", {}) if isinstance(payload, dict) else {}
        handoff = payload.get("handoff", {}) if isinstance(payload, dict) else {}
        footing_debug_records = metadata.get("footing_debug", []) if isinstance(metadata, dict) else []
        footing_debug = [repr(item) for item in footing_debug_records]
        metadata_member_count = metadata.get("member_count") if isinstance(metadata, dict) else None
        metadata_geometry_kind = metadata.get("geometry_kind") if isinstance(metadata, dict) else None
        metadata_footing_handoff_count = metadata.get("footing_handoff_count") if isinstance(metadata, dict) else None
        print("[GH Wrapper] Extracted members: {0}".format(len(members)))
        print("[GH Wrapper] Extracted base_plates: {0}".format(len(base_plate_records)))
        if metadata_member_count is not None:
            print(
                "[GH Wrapper] metadata summary: member_count={0}, geometry_kind={1}, footing_handoff_count={2}".format(
                    metadata_member_count,
                    metadata_geometry_kind,
                    metadata_footing_handoff_count,
                )
            )
        if metadata.get("support_cluster_member_indices"):
            print(
                "[GH Wrapper] support cluster member indices: {0}".format(
                    metadata.get("support_cluster_member_indices")
                )
            )
        if footing_debug_records:
            first_debug = footing_debug_records[0] if isinstance(footing_debug_records[0], dict) else {}
            stiffener_debug = first_debug.get("stiffener_specs") if isinstance(first_debug, dict) else []
            if stiffener_debug:
                print(
                    "[GH Wrapper] stiffeners: count={0}, kinds={1}".format(
                        len(stiffener_debug),
                        [item.get("stiffener_kind") for item in stiffener_debug],
                    )
                )
                face_stiffener_shifts = [
                    {
                        "member": item.get("target_anchor_member_id"),
                        "face_depth": item.get("webplate_depth"),
                        "target_source": item.get("webplate_intersection_source"),
                        "collision_point": item.get("collision_point_input"),
                        "plane_projection": item.get("projected_collision_point"),
                        "edge_projection": item.get("edge_projected_collision_point"),
                        "edge_name": item.get("edge_projected_collision_name"),
                        "heel_face_start": item.get("heel_face_midline_start"),
                        "heel_face_end": item.get("heel_face_midline_end"),
                        "heel_face_target": item.get("heel_face_midpoint_at_timber_face"),
                        "heel_face_t": item.get("heel_face_intersection_param"),
                        "target": item.get("webplate_intersection_target"),
                        "from_midpoint": item.get("unsnapped_pair_shared_edge_midpoint"),
                        "pair_snap": item.get("pair_snap_vector"),
                        "side_span": item.get("side_mount_span"),
                        "side_offset": item.get("side_mount_center_offset"),
                        "heel_y": item.get("heel_side_alignment_y"),
                        "toe_y": item.get("toe_side_alignment_y"),
                        "center_shift": item.get("bottom_face_center_shift"),
                        "pair_axis_shift": item.get("pair_axis_shift"),
                        "pair_axis_shift_source": item.get("pair_axis_shift_source"),
                        "pair_axis_shift_vector": item.get("pair_axis_shift_vector"),
                    }
                    for item in stiffener_debug
                    if item.get("stiffener_kind") == "timber_bottom_face"
                ]
                if face_stiffener_shifts:
                    print(
                        "[GH Wrapper] timber-face stiffener edge alignment: {0}".format(
                            face_stiffener_shifts
                        )
                    )
        milling_metadata = handoff.get("milling", {}) if isinstance(handoff, dict) else {}
        if isinstance(milling_metadata, dict) and milling_metadata.get("bolt_hole_diameter") is not None:
            print(
                "[GH Wrapper] web plate holes: rows={0}, per_row={1}, total={2}, mode={3}, dia_mm={4}, gage_mm={5}, pitch_mm={6}, source={7}".format(
                    milling_metadata.get("plate_hole_rows"),
                    milling_metadata.get("plate_holes_per_row"),
                    milling_metadata.get("plate_total_hole_count"),
                    milling_metadata.get("plate_hole_row_mode"),
                    None if milling_metadata.get("bolt_hole_diameter") is None else 1000.0 * float(milling_metadata.get("bolt_hole_diameter")),
                    None if milling_metadata.get("gage_perp") is None else 1000.0 * float(milling_metadata.get("gage_perp")),
                    None if milling_metadata.get("pitch_parallel") is None else 1000.0 * float(milling_metadata.get("pitch_parallel")),
                    milling_metadata.get("bolt_hole_dimension_source"),
                )
            )
            if milling_metadata.get("plate_hole_center_counts"):
                print(
                    "[GH Wrapper] web plate hole center counts per plate: {0}".format(
                        milling_metadata.get("plate_hole_center_counts")
                    )
                )
            if milling_metadata.get("plate_hole_pattern_diagnostics"):
                print(
                    "[GH Wrapper] web plate hole pattern diagnostics: {0}".format(
                        [
                            {
                                "plate_index": item.get("plate_index"),
                                "expected": item.get("expected_count"),
                                "generated": item.get("generated_count"),
                                "inside": item.get("inside_plate_count"),
                                "status": item.get("status"),
                            }
                            for item in milling_metadata.get("plate_hole_pattern_diagnostics")
                        ]
                    )
                )
        geometry_metadata = handoff.get("geometry", {}) if isinstance(handoff, dict) else {}
        if isinstance(geometry_metadata, dict) and geometry_metadata.get("stiffener_specs"):
            print(
                "[GH Wrapper] stiffener targets: {0}".format(
                    [
                        {
                            "source": item.get("target_source"),
                            "member_id": item.get("target_anchor_member_id"),
                            "member_index": item.get("target_anchor_member_index"),
                            "azimuth_deg": item.get("azimuth_deg"),
                        }
                        for item in geometry_metadata.get("stiffener_specs")
                    ]
                )
            )
        if footing_debug_records:
            print("[GH Wrapper] footing debug: {0}".format(footing_debug_records))
        if "target_cluster_index" in kwargs:
            print(
                "[GH Wrapper] target_cluster_index={0}, mode={1}".format(
                    kwargs.get("target_cluster_index"),
                    metadata.get("target_member_index_mode"),
                )
            )
            try:
                available_indices = [int((m or {}).get("index")) for m in members if isinstance(m, dict) and (m or {}).get("index") is not None]
                print("[GH Wrapper] available member indices: {0}".format(available_indices))
            except Exception:
                pass
        
        preview_breps = []
        if footing_breps:
            footing_units = metadata.get("footing_output_units") or metadata.get("geometry_units") or "millimeters"
            payload_to_doc = _payload_to_doc_scale(footing_units)
            _scaled_breps = _scale_breps_copy(footing_breps, payload_to_doc)
            preview_breps = _coerce_geometry_list(_scaled_breps)
            if isinstance(payload, dict):
                payload["preview"] = {
                    "breps_doc_units": preview_breps,
                    "source_units": footing_units,
                    "document_scale_factor": payload_to_doc,
                }
            print(
                "[GH Wrapper] Built {0} footing preview breps ({1}->doc scale={2})".format(
                    len(preview_breps),
                    footing_units,
                    payload_to_doc,
                )
            )
            if len(preview_breps) != len(_scaled_breps):
                print("[GH Wrapper] Dropped {0} non-geometry footing items during coercion".format(
                    len(_scaled_breps) - len(preview_breps)
                ))
        elif metadata_geometry_kind == "footing":
            print(
                "[GH Wrapper] No footing_breps in payload. diagnostics: helper_rg_available={0}, helper_base_footing_run_callable={1}, member_count={2}, footing_handoff_count={3}".format(
                    bool(getattr(helper, "rg", None) is not None),
                    callable(getattr(helper, "base_footing_run", None)),
                    len(members),
                    metadata_footing_handoff_count,
                )
            )
        elif hasattr(helper, "BasePlateRecord") and base_plate_records:
            try:
                bp_records = [helper.BasePlateRecord(**bp) for bp in base_plate_records]
                preview_breps = _coerce_geometry_list(helper.build_preview_breps(bp_records))
                print("[GH Wrapper] Built {0} preview breps".format(len(preview_breps)))
            except Exception as bp_err:
                print("[GH Wrapper] Error building preview breps: {0}".format(bp_err))
                import traceback
                print(traceback.format_exc())

        # GH output "base_plates" is commonly wired to geometry params; emit breps
        # directly to avoid Goo->Geometry conversion failures on dict records.
        if preview_breps:
            base_plates = _coerce_geometry_list(preview_breps)
            if isinstance(payload, dict):
                payload["base_plate_records"] = base_plate_records
            print("[GH Wrapper] base_plates output mapped to preview breps: {0}".format(len(base_plates)))
        else:
            base_plates = []
        
        unit_hint = ""
        if members and base_plate_records:
            try:
                mw = float((members[0] or {}).get("width") or 0.0)
                pl = float((base_plate_records[0] or {}).get("length") or 0.0)
                if mw > 0.0 and pl / mw > 20.0:
                    unit_hint = " | WARNING: plate/member scale looks too large; check mm vs m"
            except Exception:
                pass
        out = "Loaded {0} members and built {1} base plate records; output {2} preview breps{3}".format(
            len(members),
            len(base_plate_records),
            len(preview_breps),
            unit_hint,
        )
        payload = _store_payload_reference("geometry", payload)
        print("[GH Wrapper] " + out)

except Exception:
    out = traceback.format_exc()
    payload = {}
    members = []
    base_plates = []
    preview_breps = []
    footing_debug = []
    print("[GH Wrapper] Exception caught:")
    print(out)
# ---------- end py3 ----------
preview = CustomPreview(Geometry=py3.preview_breps, Material=ColourSwatch(SwatchColor=RGB(192, 192, 192)))
panel = Panel(py3.out)

# ----
# POST-PROCESSING
number_slider_3 = Slider(0.0351, range=0..1)
annotations = Python3Script(payload=py3.payload, annotation_scale=number_slider_3)  # -> out, rh_geo_preview, code_check_labels, layout_package, messages; inputs annotation_scale: Double
# ---------- annotations: Python ----------
"""
Grasshopper Py3 wrapper: base_footing_annotation_component

GH Inputs expected (all optional — component still runs with no connections):
- package          (Item Access; opaque payload from gh_wrapper_calculations or gh_wrapper_ct_export)
- payload          (Item Access; alias for package)
- timber_brep      (manual Brep list; used when package is absent or timber_source="manual")
- plate_brep       (manual Brep list)
- bolt_points      (manual Point3d list)
- washer_recess_breps (manual Brep list)
- slot_cut_brep    (manual Brep list)
- timber_source    (str: "auto" | "package" | "manual"; default "auto")
- plate_source     (str: "auto" | "package" | "manual"; default "auto")
- bolt_source      (str: "auto" | "package" | "manual"; default "auto")
- washer_source    (str: "auto" | "package" | "manual"; default "auto")
- slot_source      (str: "auto" | "package" | "manual"; default "auto")
- metadata         (dict override; leave unconnected to read from package)
- show_top_dimensions    (bool; default True)
- show_front_dimensions  (bool; default True)
- show_section_dimensions (bool; default True)
- show_code_labels       (bool; default True)
- dim_offset       (float mm; default 25)
- text_height      (float mm; default 8)
- arrow_size       (float mm; default 3)
- view_scale       (float; default 1.0)
- annotation_scale (float; default 1.0; larger value = larger annotations)
- enabled          (bool; default True)

GH Outputs:
- out              (status string)
- rh_geo_preview   (all annotation geometry for Rhino preview)
- dim_lines
- extension_lines
- arrowheads
- text_labels
- leader_lines
- code_check_labels
- reports          (dict with full annotation report)
- layout_package   (single packaged payload for layout wrapper)
- debug_status     (diagnostic dict)
"""

import importlib.util
import os
import sys
import traceback

try:
    import scriptcontext as sc  # type: ignore
except Exception:
    sc = None

try:
    from Grasshopper.Kernel.Types import GH_ObjectWrapper  # type: ignore
except Exception:
    GH_ObjectWrapper = None

try:
    import Rhino  # type: ignore
except Exception:
    Rhino = None

ROOT = r"C:\Users\Juste\Documents\_GitHub\MAS-2526\10_llhil-t2-fabrication\design\structure_model\Base_Plates"
HELPER_PATH = os.path.join(ROOT, "py", "base_footing_annotation_component.py")
RUN_TAG = "ANNOTATION_WRAPPER_SYNC_2026_05_18"

print("[GH Annotation Wrapper] RUN_TAG:", RUN_TAG)
print("[GH Annotation Wrapper] HELPER_PATH:", HELPER_PATH)
print("[GH Annotation Wrapper] HELPER_EXISTS:", os.path.exists(HELPER_PATH))


# ---------------------------------------------------------------------------
# Fallback output assignments — survive any early-exit or truncated script run
# ---------------------------------------------------------------------------
out = "Annotation wrapper startup reached"
rh_geo_preview = []
dim_lines = []
extension_lines = []
arrowheads = []
text_labels = []
leader_lines = []
code_check_labels = []
reports = {}
layout_package = {}
debug_status = {
    "run_tag": RUN_TAG,
    "phase": "startup",
    "helper_path": HELPER_PATH,
    "helper_exists": bool(os.path.exists(HELPER_PATH)),
}


# ---------------------------------------------------------------------------
# Helpers
# ---------------------------------------------------------------------------

def _load_helper():
    module_name = "base_footing_annotation_component"
    print("[GH Annotation Wrapper] HELPER_LOAD_START")
    sys.modules.pop(module_name, None)
    spec = importlib.util.spec_from_file_location(module_name, HELPER_PATH)
    if spec is None or spec.loader is None:
        raise ImportError("Could not load {0}".format(HELPER_PATH))
    module = importlib.util.module_from_spec(spec)
    sys.modules[module_name] = module
    spec.loader.exec_module(module)
    print("[GH Annotation Wrapper] HELPER_LOADED: True")
    return module


def _to_python_data(value):
    if isinstance(value, dict):
        return {key: _to_python_data(item) for key, item in value.items()}
    try:
        keys = list(value.Keys)
    except Exception:
        keys = None
    if keys is not None:
        return {
            _to_python_data(key): _to_python_data(value[key])
            for key in keys
        }
    if isinstance(value, (list, tuple)):
        return [_to_python_data(item) for item in value]
    return value


def _unwrap_payload(value):
    """Normalise the common GH forms of a single dictionary payload."""
    normalized = value
    while True:
        wrapped_value = getattr(normalized, "Value", None)
        if wrapped_value is not None and wrapped_value is not normalized:
            normalized = wrapped_value
            continue
        branches = getattr(normalized, "Branches", None)
        if branches is not None:
            normalized = _to_python_data(branches)
            continue
        normalized = _to_python_data(normalized)
        if isinstance(normalized, str) and sc is not None and normalized in sc.sticky:
            normalized = sc.sticky[normalized]
            continue
        if isinstance(normalized, (list, tuple)) and len(normalized) == 1:
            normalized = normalized[0]
            continue
        return normalized


def _gh_input(name, default=None):
    """Read a GH input by name, returning default when absent or None."""
    value = globals().get(name, default)
    return default if value is None else value


def _coerce_float(value, default):
    try:
        return float(value)
    except Exception:
        return float(default)


def _mm_to_doc_scale():
    if Rhino is None:
        return 1.0
    try:
        doc = Rhino.RhinoDoc.ActiveDoc
        if doc is None:
            return 1.0
        return float(Rhino.RhinoMath.UnitScale(Rhino.UnitSystem.Millimeters, doc.ModelUnitSystem))
    except Exception:
        return 1.0


def _flatten_geo_list(value):
    """Accept a GH data-tree / list / single geometry item; return a flat list."""
    if value is None:
        return []
    branch_count = getattr(value, "BranchCount", None)
    branch_getter = getattr(value, "Branch", None)
    if isinstance(branch_count, int) and callable(branch_getter):
        items = []
        for i in range(branch_count):
            try:
                items.extend(list(branch_getter(i)))
            except Exception:
                pass
        return items
    try:
        return list(value)
    except TypeError:
        return [value]


def _is_geometry_like(value):
    if value is None:
        return False
    if isinstance(value, dict):
        return False
    return callable(getattr(value, "GetBoundingBox", None)) or callable(getattr(value, "ToBrep", None))


def _is_point_like(value):
    if value is None:
        return False
    if isinstance(value, dict):
        has_xyz = all(k in value for k in ("x", "y", "z")) or all(k in value for k in ("X", "Y", "Z"))
        return has_xyz
    if all(hasattr(value, key) for key in ("X", "Y", "Z")):
        return True
    try:
        items = list(value)
        return len(items) >= 3
    except Exception:
        return False


def _filter_values(values, validator):
    out = []
    for item in values or []:
        if validator(item):
            out.append(item)
    return out


def _first_connected_input(names):
    for name in names:
        if name in globals() and globals()[name] is not None:
            return name, globals()[name]
    return None, None


def _has_geometry_keys(data):
    if not isinstance(data, dict):
        return False
    geometry_keys = (
        "timber_brep",
        "timber_breps",
        "inspection_breps",
        "plate_brep",
        "plate_breps",
        "footing_breps",
        "base_plates",
        "preview_breps",
        "preview",
        "bolt_points",
        "hole_centers",
        "washer_recess_breps",
        "slot_cut_brep",
    )
    return any(key in data for key in geometry_keys)


def _iter_dicts_deep(value, _seen=None):
    if _seen is None:
        _seen = set()
    marker = id(value)
    if marker in _seen:
        return
    _seen.add(marker)
    if isinstance(value, dict):
        yield value
        for child in value.values():
            for nested in _iter_dicts_deep(child, _seen):
                yield nested
        return
    if isinstance(value, (list, tuple)):
        for item in value:
            for nested in _iter_dicts_deep(item, _seen):
                yield nested


def _pick_nested_list(payload_dict, candidate_keys, validator=None):
    if not isinstance(payload_dict, dict):
        return []
    for d in _iter_dicts_deep(payload_dict):
        for key in candidate_keys:
            raw = d.get(key)
            values = _flatten_geo_list(raw)
            values = [v for v in values if v is not None]
            if validator is not None:
                values = _filter_values(values, validator)
            if values:
                return values
    return []


def _metadata_from_payload(payload_dict):
    if not isinstance(payload_dict, dict):
        return None
    for d in _iter_dicts_deep(payload_dict):
        for key in ("annotation_metadata", "handoff", "metadata"):
            candidate = d.get(key)
            if isinstance(candidate, dict) and candidate:
                return candidate
    return None


def _payload_geometry_score(payload_dict):
    if not isinstance(payload_dict, dict):
        return 0
    score = 0
    key_sets = (
        (("timber_brep", "timber_breps", "inspection_breps", "timber"), _is_geometry_like),
        (("plate_brep", "plate_breps", "preview_breps", "breps_doc_units", "footing_breps", "base_plates"), _is_geometry_like),
        (("bolt_points", "hole_centers", "anchor_points", "bolt_hole_centers"), _is_point_like),
        (("washer_recess_brep", "washer_recess_breps", "washer_recesses"), _is_geometry_like),
        (("slot_cut_brep", "slot_cut_breps", "slot_brep", "slot_breps", "slot_cuts"), _is_geometry_like),
    )
    for keys, validator in key_sets:
        if _pick_nested_list(payload_dict, keys, validator=validator):
            score += 1
    if _metadata_from_payload(payload_dict):
        score += 1
    return score


def _resolve_best_package(candidate_names):
    best_name = None
    best_payload = None
    best_score = -1
    diagnostics = []
    for name in candidate_names:
        if name not in globals() or globals()[name] is None:
            diagnostics.append({"name": name, "state": "missing"})
            continue
        raw = globals()[name]
        unwrapped = _unwrap_payload(raw)
        payload = unwrapped
        used_nested = False
        if isinstance(payload, dict) and not _has_geometry_keys(payload):
            nested = payload.get("synced_geometry_payload")
            if isinstance(nested, dict):
                payload = nested
                used_nested = True
        score = _payload_geometry_score(payload)
        diagnostics.append(
            {
                "name": name,
                "state": "ok",
                "used_nested_synced": used_nested,
                "is_dict": isinstance(payload, dict),
                "score": score,
            }
        )
        if score > best_score:
            best_score = score
            best_name = name
            best_payload = payload
    return best_name, best_payload, diagnostics


# ---------------------------------------------------------------------------
# Initialized outputs (safe defaults shown in GH before the component runs)
# ---------------------------------------------------------------------------
out = "Annotation wrapper initialized"
rh_geo_preview = []
dim_lines = []
extension_lines = []
arrowheads = []
text_labels = []
leader_lines = []
code_check_labels = []
reports = {}
debug_status = {
    "run_tag": RUN_TAG,
    "phase": "initialized",
}

print("[GH Annotation Wrapper] OUTPUTS_INITIALIZED")


# ---------------------------------------------------------------------------
# Main execution
# ---------------------------------------------------------------------------
try:
    helper = _load_helper()

    if _gh_input("enabled", True) is False:
        out = "Annotation wrapper disabled."
        debug_status = {"run_tag": RUN_TAG, "phase": "disabled"}

    else:
        # --- resolve package input (accept common upstream names) ----------
        _package_source, _package, _package_diagnostics = _resolve_best_package(
            (
                "package",
                "payload",
                "synced_geometry_payload",
                "geometry_payload",
                "calc_payload",
                "calculation_payload",
                "calculations_payload",
            )
        )

        _timber_source_name, _timber_raw = _first_connected_input((
            "timber_brep",
            "inspection_breps",
            "timber_breps",
            "timber",
        ))
        _plate_source_name, _plate_raw = _first_connected_input((
            "plate_brep",
            "synced_preview_breps",
            "preview_breps",
            "footing_breps",
            "base_plates",
        ))
        _bolt_source_name, _bolt_raw = _first_connected_input(("bolt_points", "hole_centers"))
        _washer_source_name, _washer_raw = _first_connected_input(("washer_recess_breps", "washer_recess_brep"))
        _slot_source_name, _slot_raw = _first_connected_input(("slot_cut_brep", "slot_cut_breps", "slot_brep"))

        # If explicit GH inputs are not connected, recover geometry from nested
        # calculation/geometry payload dictionaries.
        if isinstance(_package, dict):
            if _timber_raw is None:
                _timber_raw = _pick_nested_list(
                    _package,
                    ("timber_brep", "timber_breps", "inspection_breps", "timber", "members"),
                    validator=_is_geometry_like,
                )
                if _timber_raw:
                    _timber_source_name = (_timber_source_name or "package") + ":nested"

            if _plate_raw is None:
                _plate_raw = _pick_nested_list(
                    _package,
                    (
                        "plate_brep",
                        "plate_breps",
                        "breps_doc_units",
                        "preview_breps",
                        "footing_breps",
                        "preview_breps",
                        "base_plates",
                    ),
                    validator=_is_geometry_like,
                )
                if _plate_raw:
                    _plate_source_name = (_plate_source_name or "package") + ":nested"

            if _bolt_raw is None:
                _bolt_raw = _pick_nested_list(
                    _package,
                    ("bolt_points", "hole_centers", "anchor_points", "bolt_hole_centers"),
                    validator=_is_point_like,
                )
                if _bolt_raw:
                    _bolt_source_name = (_bolt_source_name or "package") + ":nested"

            if _washer_raw is None:
                _washer_raw = _pick_nested_list(
                    _package,
                    ("washer_recess_brep", "washer_recess_breps", "washer_recesses"),
                    validator=_is_geometry_like,
                )
                if _washer_raw:
                    _washer_source_name = (_washer_source_name or "package") + ":nested"

            if _slot_raw is None:
                _slot_raw = _pick_nested_list(
                    _package,
                    ("slot_cut_brep", "slot_cut_breps", "slot_brep", "slot_breps", "slot_cuts"),
                    validator=_is_geometry_like,
                )
                if _slot_raw:
                    _slot_source_name = (_slot_source_name or "package") + ":nested"

        _timber_raw = _filter_values(_flatten_geo_list(_timber_raw), _is_geometry_like)
        _plate_raw = _filter_values(_flatten_geo_list(_plate_raw), _is_geometry_like)
        _bolt_raw = _filter_values(_flatten_geo_list(_bolt_raw), _is_point_like)
        _washer_raw = _filter_values(_flatten_geo_list(_washer_raw), _is_geometry_like)
        _slot_raw = _filter_values(_flatten_geo_list(_slot_raw), _is_geometry_like)

        _metadata_override = _gh_input("metadata")
        if _metadata_override is None and isinstance(_package, dict):
            _metadata_override = (
                _package.get("annotation_metadata")
                or _package.get("handoff")
                or _package.get("metadata")
            )
        if _metadata_override is None:
            _metadata_override = _metadata_from_payload(_package)

        _base_view_scale = max(_coerce_float(_gh_input("view_scale", 1.0), 1.0), 1e-9)
        _annotation_scale = max(_coerce_float(_gh_input("annotation_scale", 1.0), 1.0), 1e-9)
        # Helper interprets larger view_scale as smaller annotation graphics.
        # Keep slider semantics intuitive: larger annotation_scale => larger graphics.
        _effective_view_scale = _base_view_scale / _annotation_scale
        _mm_scale = _mm_to_doc_scale()
        _dim_offset = _coerce_float(_gh_input("dim_offset", 25.0), 25.0) * _mm_scale
        _text_height = _coerce_float(_gh_input("text_height", 8.0), 8.0) * _mm_scale
        _arrow_size = _coerce_float(_gh_input("arrow_size", 3.0), 3.0) * _mm_scale

        # --- call helper.run() with every optional input ------------------
        result = helper.run(
            package=_package,
            timber_brep=_flatten_geo_list(_timber_raw),
            plate_brep=_flatten_geo_list(_plate_raw),
            bolt_points=_flatten_geo_list(_bolt_raw),
            washer_recess_breps=_flatten_geo_list(_washer_raw),
            slot_cut_brep=_flatten_geo_list(_slot_raw),
            timber_source=_gh_input("timber_source", "auto"),
            plate_source=_gh_input("plate_source", "auto"),
            bolt_source=_gh_input("bolt_source", "auto"),
            washer_source=_gh_input("washer_source", "auto"),
            slot_source=_gh_input("slot_source", "auto"),
            metadata=_metadata_override,
            show_top_dimensions=_gh_input("show_top_dimensions", True),
            show_front_dimensions=_gh_input("show_front_dimensions", True),
            show_section_dimensions=_gh_input("show_section_dimensions", True),
            show_code_labels=_gh_input("show_code_labels", True),
            dim_offset=_dim_offset,
            text_height=_text_height,
            arrow_size=_arrow_size,
            view_scale=_effective_view_scale,
        )

        # Retry in explicit manual mode if the first pass yielded no geometry.
        if not (result.get("rh_geo_preview") or []):
            result = helper.run(
                package=None,
                timber_brep=_flatten_geo_list(_timber_raw),
                plate_brep=_flatten_geo_list(_plate_raw),
                bolt_points=_flatten_geo_list(_bolt_raw),
                washer_recess_breps=_flatten_geo_list(_washer_raw),
                slot_cut_brep=_flatten_geo_list(_slot_raw),
                timber_source="manual",
                plate_source="manual",
                bolt_source="manual",
                washer_source="manual",
                slot_source="manual",
                metadata=_metadata_override,
                show_top_dimensions=_gh_input("show_top_dimensions", True),
                show_front_dimensions=_gh_input("show_front_dimensions", True),
                show_section_dimensions=_gh_input("show_section_dimensions", True),
                show_code_labels=_gh_input("show_code_labels", True),
                dim_offset=_dim_offset,
                text_height=_text_height,
                arrow_size=_arrow_size,
                view_scale=_effective_view_scale,
            )

        # --- unpack outputs -----------------------------------------------
        rh_geo_preview = result.get("rh_geo_preview", [])
        dim_lines = result.get("dim_lines", [])
        extension_lines = result.get("extension_lines", [])
        arrowheads = result.get("arrowheads", [])
        text_labels = result.get("text_labels", [])
        leader_lines = result.get("leader_lines", [])
        code_check_labels = result.get("code_check_labels", [])
        reports = result.get("reports", {})

        _layout_payload = None
        if isinstance(_package, dict):
            _layout_payload = _package.get("layout_payload")
            if _layout_payload is None and isinstance(_package.get("reports"), dict):
                _layout_payload = _package["reports"].get("layout_payload")

        _combined_report = None
        if isinstance(_package, dict):
            _combined_report = _package.get("combined_report") or _package.get("report_text")
        if _combined_report is None and isinstance(reports, dict):
            _combined_report = reports.get("combined_report")

        layout_package = {
            "geometry_objects": list(rh_geo_preview or []),
            "annotation_objects": (
                list(dim_lines or [])
                + list(extension_lines or [])
                + list(arrowheads or [])
                + list(text_labels or [])
                + list(leader_lines or [])
                + list(code_check_labels or [])
            ),
            "metadata": _metadata_override if isinstance(_metadata_override, dict) else {},
            "combined_report": _combined_report,
            "layout_payload": _layout_payload if isinstance(_layout_payload, dict) else {},
            "reports": reports if isinstance(reports, dict) else {},
        }

        if isinstance(reports, dict):
            reports["layout_package"] = layout_package

        # Some component versions surface populated data under reports only.
        if isinstance(reports, dict):
            if not dim_lines:
                dim_lines = list(reports.get("dim_lines") or [])
            if not extension_lines:
                extension_lines = list(reports.get("extension_lines") or [])
            if not arrowheads:
                arrowheads = list(reports.get("arrowheads") or [])
            if not text_labels:
                text_labels = list(reports.get("text_labels") or [])
            if not leader_lines:
                leader_lines = list(reports.get("leader_lines") or [])

        _messages = result.get("messages", [])
        _source = result.get("source_report", {})
        out = "Annotation OK — geo: {0} items | {1}".format(
            len(rh_geo_preview),
            ", ".join("{0}={1}".format(k, v) for k, v in _source.items()
                      if k.endswith("_count") or k == "has_package"),
        )
        if _messages:
            out = "{0}\n{1}".format(out, "\n".join(str(m) for m in _messages))

        debug_status = {
            "run_tag": RUN_TAG,
            "phase": "completed",
            "package_source": _package_source,
            "package_candidates": _package_diagnostics,
            "timber_input": _timber_source_name,
            "plate_input": _plate_source_name,
            "bolt_input": _bolt_source_name,
            "washer_input": _washer_source_name,
            "slot_input": _slot_source_name,
            "timber_input_count": len(_flatten_geo_list(_timber_raw)),
            "plate_input_count": len(_flatten_geo_list(_plate_raw)),
            "bolt_input_count": len(_flatten_geo_list(_bolt_raw)),
            "washer_input_count": len(_flatten_geo_list(_washer_raw)),
            "slot_input_count": len(_flatten_geo_list(_slot_raw)),
            "mm_to_doc_scale": _mm_scale,
            "dim_offset_doc_units": _dim_offset,
            "text_height_doc_units": _text_height,
            "arrow_size_doc_units": _arrow_size,
            "base_view_scale": _base_view_scale,
            "annotation_scale": _annotation_scale,
            "effective_view_scale": _effective_view_scale,
            "geo_count": len(rh_geo_preview),
            "dim_line_count": len(dim_lines),
            "text_label_count": len(text_labels),
            "messages": _messages,
            "source_report": _source,
        }

        print("[GH Annotation Wrapper] DONE geo_count={0}".format(len(rh_geo_preview)))

except Exception:
    try:
        out = traceback.format_exc()
    except NameError:
        import traceback as _traceback
        out = _traceback.format_exc()
    print("[GH Annotation Wrapper] Exception caught:")
    print(out)
    rh_geo_preview = []
    dim_lines = []
    extension_lines = []
    arrowheads = []
    text_labels = []
    leader_lines = []
    code_check_labels = []
    reports = {"wrapper_error": out}
    layout_package = {}
    debug_status = {
        "run_tag": RUN_TAG,
        "phase": "error",
        "error": out,
    }
# ---------- end annotations ----------
panel_2 = Panel(annotations.out)
preview_2 = CustomPreview(Geometry=annotations.rh_geo_preview, Material=ColourSwatch(SwatchColor=RGB(0, 0, 255)))
layouts = Python3Script(layout_payload=annotations.layout_package, annotation_scale=Slider(0.0125, range=0..1))  # -> out, viewport_guides, title_block_curves, title_block_text, view_labels, report_text_block, print_ready_groups, debug_info; inputs annotation_scale: String
# ---------- layouts: Python ----------
"""
Grasshopper Python wrapper for the refactored base_footing_layout_component.

Single-source input contract:
- Connect ONE upstream payload to this wrapper via `package` or `payload`.
- Wrapper parses all fields internally (geometry, annotations, metadata, reports,
  and layout settings).

Recommended upstream source:
- `gh_wrapper_annotation` output `layout_package` (or `reports.layout_package`).
"""

import importlib.util
import logging
import os
import sys
from typing import Any, Dict, Iterable, List, Mapping, Sequence, Tuple, cast

try:
    import scriptcontext as sc  # type: ignore
except Exception:
    sc = None

if "package" not in globals():
    package = None
if "payload" not in globals():
    payload = None
if "geometry_objects" not in globals():
    geometry_objects = None
if "annotation_objects" not in globals():
    annotation_objects = None
if "metadata" not in globals():
    metadata = None
if "combined_report" not in globals():
    combined_report = None
if "layout_payload" not in globals():
    layout_payload = None
if "reports" not in globals():
    reports = None
if "annotation_scale" not in globals():
    annotation_scale = None

# Configure logging
logging.basicConfig(level=logging.DEBUG, format='%(asctime)s - %(levelname)s - %(message)s')

ROOT = r"C:\Users\Juste\Documents\_GitHub\MAS-2526\10_llhil-t2-fabrication\design\structure_model\Base_Plates"
HELPER_PATH = os.path.join(ROOT, "py", "base_footing_layout_component.py")


def _load_helper() -> Any:
    module_name = "base_footing_layout_component"
    sys.modules.pop(module_name, None)
    spec = importlib.util.spec_from_file_location(module_name, HELPER_PATH)
    if spec is None or spec.loader is None:
        raise ImportError("Could not load {0}".format(HELPER_PATH))
    module = importlib.util.module_from_spec(spec)
    sys.modules[module_name] = module
    spec.loader.exec_module(module)
    return module


def _pick_first(package: Dict[str, Any], keys: List[str], default: Any = None) -> Any:
    for key in keys:
        if key in package and package[key] is not None:
            return package[key]
    return default


def _to_python_data(value: Any) -> Any:
    if isinstance(value, dict):
        mapped = cast(Mapping[Any, Any], value)
        return {key: _to_python_data(mapped[key]) for key in mapped}

    keys = getattr(value, "Keys", None)
    if keys is not None:
        try:
            return {
                _to_python_data(key): _to_python_data(value[key])
                for key in list(keys)
            }
        except Exception:
            pass

    if isinstance(value, (list, tuple)):
        seq = cast(Iterable[Any], value)
        return [_to_python_data(item) for item in seq]

    if not isinstance(value, (str, bytes)):
        try:
            value.Count
            return [_to_python_data(item) for item in value]
        except Exception:
            pass

    return value


def _unwrap_payload(value: Any) -> Any:
    normalized: Any = value
    while True:
        obj = cast(object, normalized)
        wrapped_value = getattr(obj, "Value", None)
        if wrapped_value is not None and wrapped_value is not normalized:
            normalized = wrapped_value
            continue

        branches = getattr(obj, "Branches", None)
        if branches is not None:
            normalized = _to_python_data(branches)
            continue

        normalized = _to_python_data(normalized)

        sticky = getattr(sc, "sticky", None)
        if isinstance(normalized, str) and isinstance(sticky, dict) and normalized in sticky:
            sticky_map = cast(Mapping[str, Any], sticky)
            normalized = sticky_map[normalized]
            continue

        if isinstance(normalized, (list, tuple)):
            seq = cast(Sequence[Any], normalized)
            if len(seq) == 1:
                normalized = seq[0]
                continue

        return cast(Any, normalized)


def _resolve_source_payload(package_value: Any, payload_value: Any) -> Dict[str, Any]:
    candidates: List[Tuple[str, Any]] = [
        ("arg.package", package_value),
        ("arg.payload", payload_value),
        ("global.package", globals().get("package")),
        ("global.payload", globals().get("payload")),
    ]
    for name, value in candidates:
        if value is not None:
            return {
                "selected_source": name,
                "selected_value": value,
                "candidates": [
                    {"name": candidate_name, "has_value": candidate_value is not None}
                    for candidate_name, candidate_value in candidates
                ],
            }
    return {
        "selected_source": "none",
        "selected_value": None,
        "candidates": [
            {"name": candidate_name, "has_value": candidate_value is not None}
            for candidate_name, candidate_value in candidates
        ],
    }


def _as_list(value: Any) -> List[Any]:
    if value is None:
        return []
    if isinstance(value, list):
        return cast(List[Any], value)
    if isinstance(value, tuple):
        return list(cast(Iterable[Any], value))
    if isinstance(value, Iterable) and not isinstance(value, (str, bytes, dict)):
        return list(cast(Iterable[Any], value))
    return [value]


def _without_none(values: Any) -> List[Any]:
    return [item for item in _as_list(values) if item is not None]


def _as_dict(value: Any) -> Dict[str, Any]:
    if isinstance(value, dict):
        mapped = cast(Mapping[str, Any], value)
        return {str(key): mapped[key] for key in mapped}
    return {}


def _resolve_layout_inputs(package: Dict[str, Any]) -> Dict[str, Any]:
    if isinstance(package.get("layout_package"), dict):
        package = _as_dict(package.get("layout_package"))

    layout_payload = _as_dict(package.get("layout_payload"))
    reports = _as_dict(package.get("reports"))

    if not layout_payload and isinstance(reports.get("layout_payload"), dict):
        layout_payload = _as_dict(reports.get("layout_payload"))

    geometry_objects = _without_none(
        _pick_first(
            package,
            ["geometry_objects", "rh_geo_preview", "footing_breps", "preview_breps"],
            [],
        )
    )

    annotation_objects = _without_none(package.get("annotation_objects"))
    if not annotation_objects:
        annotation_objects = (
            _without_none(package.get("dim_lines"))
            + _without_none(package.get("extension_lines"))
            + _without_none(package.get("arrowheads"))
            + _without_none(package.get("text_labels"))
            + _without_none(package.get("leader_lines"))
            + _without_none(package.get("code_check_labels"))
        )
    if not annotation_objects:
        annotation_objects = (
            _without_none(reports.get("dim_lines"))
            + _without_none(reports.get("extension_lines"))
            + _without_none(reports.get("arrowheads"))
            + _without_none(reports.get("text_labels"))
            + _without_none(reports.get("leader_lines"))
            + _without_none(reports.get("code_check_labels"))
        )

    metadata = _pick_first(package, ["annotation_metadata", "handoff", "metadata"], {})
    metadata_dict = _as_dict(metadata)
    if not metadata_dict:
        metadata_dict = _as_dict(_pick_first(reports, ["metadata", "source_report"], {}))

    combined_report: Any = _pick_first(package, ["combined_report", "report_text"], reports.get("combined_report"))
    if combined_report is None:
        combined_report = _pick_first(reports, ["report_text", "messages"], None)
    if combined_report is None and isinstance(reports.get("source_report"), dict):
        combined_report = {
            "source_report": _as_dict(reports.get("source_report")),
            "messages": _as_list(reports.get("messages")),
        }

    return {
        "geometry_objects": geometry_objects,
        "annotation_objects": annotation_objects,
        "metadata": metadata_dict,
        "combined_report": combined_report,
        "create_named_views": bool(_pick_first(layout_payload, ["create_named_views"], True)),
        "create_layout_guides": bool(_pick_first(layout_payload, ["create_layout_guides"], True)),
        "sheet_size": _pick_first(layout_payload, ["sheet_size"], package.get("sheet_size", "A3")),
        "drawing_scale": _pick_first(layout_payload, ["drawing_scale"], package.get("drawing_scale", 20.0)),
        "annotation_scale": _pick_first(layout_payload, ["annotation_scale"], package.get("annotation_scale", 1.0)),
        "title_block_info": _pick_first(layout_payload, ["title_block_info"], package.get("title_block_info", {})),
        "project_name": _pick_first(layout_payload, ["project_name"], package.get("project_name", "")),
        "detail_name": _pick_first(layout_payload, ["detail_name"], package.get("detail_name", "")),
    }


def _build_resolved_inputs_from_args(
    geometry_objects: Any,
    annotation_objects: Any,
    metadata: Any,
    combined_report: Any,
    layout_payload: Any,
    reports: Any,
    annotation_scale: Any = None,
) -> Dict[str, Any]:
    """Build resolved_inputs directly from 6 named GH inputs."""
    lp = _as_dict(_unwrap_payload(layout_payload)) if layout_payload is not None else {}
    rp = _as_dict(_unwrap_payload(reports)) if reports is not None else {}

    geo = _without_none(_unwrap_payload(geometry_objects)) if geometry_objects is not None else []
    ann = _without_none(_unwrap_payload(annotation_objects)) if annotation_objects is not None else []
    if not ann:
        ann = (
            _without_none(rp.get("dim_lines"))
            + _without_none(rp.get("extension_lines"))
            + _without_none(rp.get("arrowheads"))
            + _without_none(rp.get("text_labels"))
            + _without_none(rp.get("leader_lines"))
            + _without_none(rp.get("code_check_labels"))
        )

    meta = _as_dict(_unwrap_payload(metadata)) if metadata is not None else {}
    if not meta:
        meta = _as_dict(_pick_first(rp, ["metadata", "source_report"], {}))

    rpt: Any = _unwrap_payload(combined_report) if combined_report is not None else rp.get("combined_report")
    if rpt is None:
        rpt = _pick_first(rp, ["report_text", "messages"], None)
    if rpt is None and isinstance(rp.get("source_report"), dict):
        rpt = {
            "source_report": _as_dict(rp.get("source_report")),
            "messages": _as_list(rp.get("messages")),
        }

    return {
        "geometry_objects": geo,
        "annotation_objects": ann,
        "metadata": meta,
        "combined_report": rpt,
        "create_named_views": bool(_pick_first(lp, ["create_named_views"], True)),
        "create_layout_guides": bool(_pick_first(lp, ["create_layout_guides"], True)),
        "sheet_size": _pick_first(lp, ["sheet_size"], "A3"),
        "drawing_scale": _pick_first(lp, ["drawing_scale"], 20.0),
        "annotation_scale": (
            annotation_scale
            if annotation_scale is not None
            else _pick_first(lp, ["annotation_scale"], 1.0)
        ),
        "title_block_info": _pick_first(lp, ["title_block_info"], {}),
        "project_name": _pick_first(lp, ["project_name"], ""),
        "detail_name": _pick_first(lp, ["detail_name"], ""),
    }


def script(
    package: Any = None,
    payload: Any = None,
    geometry_objects: Any = None,
    annotation_objects: Any = None,
    metadata: Any = None,
    combined_report: Any = None,
    layout_payload: Any = None,
    reports: Any = None,
    annotation_scale: Any = None,
) -> Dict[str, Any]:
    """
    Grasshopper Python entry point.

    Accepts either:
      - 6 named inputs: geometry_objects, annotation_objects, metadata,
        combined_report, layout_payload, reports  (direct wiring from annotation component)
      - OR a single dict payload via 'package' or 'payload'
    """
    # Detect which mode: explicit direct wiring vs single-payload.
    # A standalone annotation_scale input should not flip the wrapper out of
    # single-payload mode, otherwise package/payload gets ignored.
    direct_mode = any(v is not None for v in [
        geometry_objects, annotation_objects, metadata,
        combined_report, layout_payload, reports,
    ])

    if not os.path.exists(HELPER_PATH):
        return {"error": "Layout helper not found at: {0}".format(HELPER_PATH)}

    try:
        layout = _load_helper()
    except Exception as exc:
        return {"error": "Failed to load layout helper: {0}".format(exc)}

    if direct_mode:
        source_label = "direct_6_inputs"
        nested_layout_package_used = False
        resolved_inputs = _build_resolved_inputs_from_args(
            geometry_objects, annotation_objects, metadata,
            combined_report, layout_payload, reports, annotation_scale,
        )
    else:
        source_info = _resolve_source_payload(package, payload)
        source_value = source_info["selected_value"]
        source_label = source_info["selected_source"]
        if source_value is None:
            return {
                "error": "No input connected. Wire geometry_objects/annotation_objects/metadata/combined_report/layout_payload/reports, or connect a dict to package/payload.",
                "source_report": source_info,
            }
        unwrapped = _unwrap_payload(source_value)
        if not isinstance(unwrapped, dict):
            return {
                "error": "Single-payload input must be a dict. Got: {0}".format(type(unwrapped).__name__),
                "source_report": source_info,
            }
        payload_dict = cast(Dict[str, Any], unwrapped)
        nested_layout_package_used = False
        if isinstance(payload_dict.get("layout_package"), dict):
            payload_dict = _as_dict(payload_dict.get("layout_package"))
            nested_layout_package_used = True
        resolved_inputs = _resolve_layout_inputs(payload_dict)
        if annotation_scale is not None:
            resolved_inputs["annotation_scale"] = annotation_scale

    logging.debug("source=%s resolved_inputs keys=%s", source_label, list(resolved_inputs.keys()))

    try:
        result = layout.run(**resolved_inputs)
        # Collect pre-filter counts for diagnostics
        pre_filter_counts = {
            key: len(_as_list(result.get(key))) for key in
            ("viewport_guides", "title_block_curves", "title_block_text", "view_labels", "report_text_block")
        }
        for key in ("viewport_guides", "title_block_curves", "title_block_text", "view_labels", "report_text_block"):
            if key in result:
                result[key] = _without_none(result.get(key))
        # Probe: try creating one test rectangle to verify rg geometry works
        try:
            _test_rect = layout._rectangle(0.0, 0.0, 10.0, 10.0)
            _test_rect_type = type(_test_rect).__name__
            _test_rect_repr = str(_test_rect)[:120]
        except Exception as _te:
            _test_rect_type = "EXCEPTION"
            _test_rect_repr = str(_te)

        result["debug_info"] = {
            "rg_available": getattr(layout, "rg", "?") is not None,
            "create_layout_guides": resolved_inputs.get("create_layout_guides"),
            "sheet_size": resolved_inputs.get("sheet_size"),
            "drawing_scale": resolved_inputs.get("drawing_scale"),
            "annotation_scale": resolved_inputs.get("annotation_scale"),
            "source_mode": "direct_6_inputs" if direct_mode else "single_payload",
            "layout_payload_keys": list(_as_dict(
                _unwrap_payload(layout_payload) if direct_mode and layout_payload is not None else {}
            ).keys()),
            "test_rect_type": _test_rect_type,
            "test_rect_repr": _test_rect_repr,
            "pre_filter_counts": pre_filter_counts,
            "post_filter_counts": {
                key: len(_as_list(result.get(key))) for key in
                ("viewport_guides", "title_block_curves", "title_block_text", "view_labels", "report_text_block")
            },
            "first_viewport_guide": str(result.get("viewport_guides", [None])[0])[:120] if result.get("viewport_guides") else "EMPTY",
        }
        result["source_report"] = {
            "source_mode": "direct_6_inputs" if direct_mode else "single_payload",
            "selected_source": source_label,
            "nested_layout_package_used": False if direct_mode else nested_layout_package_used,
            "resolved_counts": {
                "geometry_objects": len(_as_list(resolved_inputs.get("geometry_objects"))),
                "annotation_objects": len(_as_list(resolved_inputs.get("annotation_objects"))),
            },
        }
        return result
    except Exception as e:
        logging.exception("Error while running layout component.")
        return {"error": str(e)}


def _assign_gh_outputs(result: Dict[str, Any]) -> None:
    """Map wrapper result dictionary to Grasshopper output variables."""
    global out
    global viewport_guides
    global title_block_curves
    global title_block_text
    global view_labels
    global report_text_block
    global print_ready_groups
    global debug_info
    global a
    global b
    global c
    global d
    global e
    global f
    global g
    global h

    error_text = result.get("error")
    if error_text:
        out = "Layout wrapper error: {0}".format(error_text)
        viewport_guides = []
        title_block_curves = []
        title_block_text = []
        view_labels = []
        report_text_block = []
        print_ready_groups = {}
        debug_info = cast(Dict[str, Any], {
            "error": error_text,
            "source_report": result.get("source_report"),
        })
    else:
        viewport_guides = _without_none(result.get("viewport_guides"))
        title_block_curves = _without_none(result.get("title_block_curves"))
        title_block_text = _without_none(result.get("title_block_text"))
        view_labels = _without_none(result.get("view_labels"))
        report_text_block = _without_none(result.get("report_text_block"))
        print_ready_groups = _as_dict(result.get("print_ready_groups"))

        source_report = _as_dict(result.get("source_report"))
        base_debug_info = _as_dict(result.get("debug_info"))
        debug_info = cast(Dict[str, Any], {
            "source_report": source_report,
            "layout_debug": base_debug_info,
            "counts": {
                "viewport_guides": len(viewport_guides),
                "title_block_curves": len(title_block_curves),
                "title_block_text": len(title_block_text),
                "view_labels": len(view_labels),
                "report_text_block": len(report_text_block),
            },
        })
        out = "Layout generated: guides={0}, labels={1}, report_lines={2}".format(
            len(viewport_guides),
            len(view_labels),
            len(report_text_block),
        )

    # Legacy aliases for components whose output names are still generic.
    a = out
    b = viewport_guides
    c = title_block_curves
    d = title_block_text
    e = view_labels
    f = report_text_block
    g = print_ready_groups
    h = debug_info


# Safe default outputs so GH never shows null due to missing assignment.
out = "Layout wrapper initialized"
viewport_guides = []
title_block_curves = []
title_block_text = []
view_labels = []
report_text_block = []
print_ready_groups = {}
debug_info: Dict[str, Any] = {
    "phase": "initialized",
}
a = out
b = viewport_guides
c = title_block_curves
d = title_block_text
e = view_labels
f = report_text_block
g = print_ready_groups
h: Any = debug_info


if "ghenv" in globals():
    _result = script(
        package=globals().get("package"),
        payload=globals().get("payload"),
        geometry_objects=globals().get("geometry_objects"),
        annotation_objects=globals().get("annotation_objects"),
        metadata=globals().get("metadata"),
        combined_report=globals().get("combined_report"),
        layout_payload=globals().get("layout_payload"),
        reports=globals().get("reports"),
        annotation_scale=globals().get("annotation_scale"),
    )
    _assign_gh_outputs(_result)
# ---------- end layouts ----------
panel_3 = Panel(layouts.print_ready_groups)
preview_3 = CustomPreview(Geometry=[layouts.title_block_text, layouts.view_labels], Material=ColourSwatch(SwatchColor=RGB(0, 0, 0)))
preview_4 = CustomPreview(Geometry=[layouts.viewport_guides, layouts.title_block_curves], Material=ColourSwatch(SwatchColor=RGB(183, 184, 192)))

# ----
# CODE CHECK
number_slider_4 = Slider(80, range=0..100)
falsestart_3 = LBFalseStartToggle(True)
bp_calculations = Python3Script(
    geometry_payload=py3.payload,
    min_allowable_clearance=number_slider_4,
    base_plate_min_thickness=Slider(0.015, range=0..1),
    bottom_face_mode=list,
    enabled=falsestart_3)  # -> out, report_text, sizing_recommendations, pass_fail_summary, debug_status, payload, synced_geometry_payload, r
# ---------- bp_calculations: Python ----------
import importlib.util
import os
import sys
import traceback

try:
    import Rhino.Geometry as rg  # type: ignore
except Exception:
    rg = None

try:
    import scriptcontext as sc  # type: ignore
except Exception:
    sc = None

try:
    from Grasshopper.Kernel.Types import GH_ObjectWrapper  # type: ignore
except Exception:
    GH_ObjectWrapper = None

ROOT = r"C:\Users\Juste\Documents\_GitHub\MAS-2526\10_llhil-t2-fabrication\design\structure_model\Base_Plates"
HELPER_PATH = os.path.join(ROOT, "py", "base_plate_calculations.py")
RUN_TAG = "BPC_WRAPPER_SYNC_2026_05_17_GH_OBJECT_PAYLOAD"

print("[GH Calc Wrapper] RUN_TAG:", RUN_TAG)
print("[GH Calc Wrapper] HELPER_PATH:", HELPER_PATH)
print("[GH Calc Wrapper] HELPER_EXISTS:", os.path.exists(HELPER_PATH))


def _load_helper():
    module_name = "base_plate_calculations"
    sys.modules.pop(module_name, None)
    spec = importlib.util.spec_from_file_location(module_name, HELPER_PATH)
    if spec is None or spec.loader is None:
        raise ImportError("Could not load {0}".format(HELPER_PATH))
    module = importlib.util.module_from_spec(spec)
    # Dataclasses resolve annotations through sys.modules during execution.
    sys.modules[module_name] = module
    spec.loader.exec_module(module)
    return module


def _to_python_data(value):
    if isinstance(value, dict):
        return {key: _to_python_data(item) for key, item in value.items()}
    try:
        keys = list(value.Keys)
    except Exception:
        keys = None
    if keys is not None:
        return {
            _to_python_data(key): _to_python_data(value[key])
            for key in keys
        }
    if isinstance(value, (list, tuple)):
        return [_to_python_data(item) for item in value]
    if not isinstance(value, (str, bytes)):
        try:
            value.Count
            return [_to_python_data(item) for item in value]
        except Exception:
            pass
    return value


def _unwrap_payload(value):
    """Normalize the common GH forms of a single dictionary payload."""
    normalized = value
    while True:
        wrapped_value = getattr(normalized, "Value", None)
        if wrapped_value is not None and wrapped_value is not normalized:
            normalized = wrapped_value
            continue
        branches = getattr(normalized, "Branches", None)
        if branches is not None:
            normalized = _to_python_data(branches)
            continue
        normalized = _to_python_data(normalized)
        if isinstance(normalized, str) and sc is not None and normalized in sc.sticky:
            normalized = sc.sticky[normalized]
            continue
        if isinstance(normalized, dict):
            return normalized
        if isinstance(normalized, (list, tuple)) and len(normalized) == 1:
            normalized = normalized[0]
            continue
        return normalized


def _payload_summary(value):
    if isinstance(value, dict):
        return "dict keys={0}".format(sorted(value.keys()))
    if isinstance(value, (list, tuple)):
        return "{0} len={1}".format(type(value).__name__, len(value))
    return type(value).__name__


def _component_key():
    try:
        return str(ghenv.Component.InstanceGuid)  # type: ignore[name-defined]
    except Exception:
        return "standalone"


def _store_payload_reference(kind, value):
    if GH_ObjectWrapper is not None:
        print("[GH Calc Wrapper] payload output mode=gh_object_wrapper kind={0}".format(kind))
        return GH_ObjectWrapper(value)
    if sc is None:
        return value
    token = "BPG_PAYLOAD::{0}::{1}".format(kind, _component_key())
    sc.sticky[token] = value
    print("[GH Calc Wrapper] payload output mode=reference_token kind={0}".format(kind))
    return token


def _build_synced_plate_preview_breps(payload_dict):
    if not isinstance(payload_dict, dict):
        return []

    # Prefer high-fidelity preview geometry passed through from geometry wrapper.
    preview_block = payload_dict.get("preview")
    if isinstance(preview_block, dict):
        preview_breps = preview_block.get("breps_doc_units")
        if isinstance(preview_breps, list):
            return [item for item in preview_breps if item is not None]

    footing_breps = payload_dict.get("footing_breps")
    if isinstance(footing_breps, list) and footing_breps:
        return [item for item in footing_breps if item is not None]

    # Fallback: reconstruct simplified boxes from synced base plate records.
    if rg is None:
        return []
    plates = payload_dict.get("base_plates", [])
    if not isinstance(plates, list):
        return []

    breps = []
    for plate in plates:
        if not isinstance(plate, dict):
            continue
        try:
            center = plate.get("center")
            x_axis = plate.get("x_axis")
            y_axis = plate.get("y_axis")
            length = float(plate.get("length", 0.0) or 0.0)
            width = float(plate.get("width", 0.0) or 0.0)
            thickness = float(plate.get("thickness", 0.0) or 0.0)
            if not center or not x_axis or not y_axis:
                continue
            if length <= 0.0 or width <= 0.0 or thickness <= 0.0:
                continue

            origin = rg.Point3d(float(center[0]), float(center[1]), float(center[2]))
            plane = rg.Plane(
                origin,
                rg.Vector3d(float(x_axis[0]), float(x_axis[1]), float(x_axis[2])),
                rg.Vector3d(float(y_axis[0]), float(y_axis[1]), float(y_axis[2])),
            )
            box = rg.Box(
                plane,
                rg.Interval(-0.5 * length, 0.5 * length),
                rg.Interval(-0.5 * width, 0.5 * width),
                rg.Interval(0.0, thickness),
            )
            if not box.IsValid:
                continue
            brep = box.ToBrep()
            if brep is None:
                continue
            breps.append(brep)
        except Exception:
            continue
    return breps


try:

    helper = _load_helper()

    if "enabled" in globals() and enabled is False:
        out = "Base plate calculations disabled."
        payload = {}
    else:
        geometry_payload_input = None
        geometry_payload_source = None
        for candidate_name in ("geometry_payload", "payload", "geometry"):
            if candidate_name in globals() and globals()[candidate_name]:
                geometry_payload_input = globals()[candidate_name]
                geometry_payload_source = candidate_name
                break
        if geometry_payload_input is None:
            raise ValueError("geometry_payload input is required")
        geometry_payload = _unwrap_payload(geometry_payload_input)
        print("[GH Calc Wrapper DEBUG] geometry_payload_source=", geometry_payload_source)
        print("[GH Calc Wrapper DEBUG] geometry_payload type=", type(geometry_payload))
        if isinstance(geometry_payload, dict):
            print("[GH Calc Wrapper DEBUG] geometry_payload keys=", list(geometry_payload.keys()))
        else:
            print("[GH Calc Wrapper DEBUG] geometry_payload value=", geometry_payload)
        if not isinstance(geometry_payload, dict):
            raise TypeError(
                "geometry payload from {0} did not normalize to a dict; got {1}. "
                "Keep geometry_payload on Item Access; List/Tree Access can explode the payload.".format(
                    geometry_payload_source,
                    _payload_summary(geometry_payload),
                )
            )

        geometry_metadata = geometry_payload.get("metadata", {}) if isinstance(geometry_payload, dict) else {}
        geometry_bottom_face_mode = (
            geometry_metadata.get("bottom_face_mode")
            if isinstance(geometry_metadata, dict)
            else None
        )
        kwargs = {
            "geometry_payload": geometry_payload,
            "bottom_face_mode": str(bottom_face_mode)
            if "bottom_face_mode" in globals() and bottom_face_mode
            else str(geometry_bottom_face_mode or "Perpendicular_to_grain"),
            "min_allowable_clearance": float(min_allowable_clearance) if "min_allowable_clearance" in globals() and min_allowable_clearance is not None else 80.0,
            "shift_step": float(shift_step) if "shift_step" in globals() and shift_step is not None else 10.0,
            "max_shift": float(max_shift) if "max_shift" in globals() and max_shift is not None else 400.0,
            "base_plate_min_thickness": float(base_plate_min_thickness) if "base_plate_min_thickness" in globals() and base_plate_min_thickness is not None else 10.0,
            "base_plate_max_thickness": float(base_plate_max_thickness) if "base_plate_max_thickness" in globals() and base_plate_max_thickness is not None else 60.0,
            "sync_plate_dimensions_from_engineering": bool(sync_plate_dimensions_from_engineering) if "sync_plate_dimensions_from_engineering" in globals() else True,
            "sync_iterations": int(sync_iterations) if "sync_iterations" in globals() and sync_iterations is not None else 1,
        }
        merged_engineering_overrides = {}
        if "engineering_overrides" in globals() and engineering_overrides:
            normalized_engineering_overrides = _to_python_data(engineering_overrides)
            if isinstance(normalized_engineering_overrides, dict):
                merged_engineering_overrides.update(normalized_engineering_overrides)
        for name in (
            "bolt_dia",
            "bolt_hole_dia",
            "hole_clearance",
            "project_min_bolt_hole_dia",
            "rows",
            "holes_per_row",
            "pitch_parallel",
            "gage_perp",
            "end_distance",
            "edge_distance",
            "run_aisc_steel_node_checks",
            "run_stress_concentration_check",
            "corner_radius",
            "corner_radius_mode",
            "stress_concentration_factor",
            "use_gusset_plates",
            "use_web_stiffeners",
            "weld_utilization_limit_for_gusset_warning",
            "plate_slenderness_limit",
            "min_corner_radius",
            "project_min_corner_radius",
            "preferred_corner_radius_factor",
            "unsupported_plate_width",
            "eccentricity_mm",
            "concentrated_force_kN",
            "wall_thickness_mm",
            "concentrated_force_per_wall_thickness_limit",
        ):
            if name in globals() and globals()[name] is not None:
                merged_engineering_overrides[name] = globals()[name]
        if merged_engineering_overrides:
            kwargs["engineering_overrides"] = merged_engineering_overrides

        payload = helper.run_validation(**kwargs)
        print("[GH Calc Wrapper DEBUG] payload type=", type(payload))
        if isinstance(payload, dict):
            print("[GH Calc Wrapper DEBUG] payload keys=", list(payload.keys()))
            print("[GH Calc Wrapper DEBUG] member_results count=", len(payload.get("member_results", [])))
        else:
            print("[GH Calc Wrapper DEBUG] payload value=", payload)
        out = "Validated {0} members".format(len(payload.get("member_results", [])))

    payload_data = payload
    report_text = payload_data.get("report_text", "") if payload_data else ""
    combined_report = payload_data.get("combined_report", "") if payload_data else ""
    pass_fail_summary = payload_data.get("pass_fail_summary", {}) if payload_data else {}
    utilization_values = payload_data.get("utilization_values", {}) if payload_data else {}
    sizing_recommendations = payload_data.get("engineering", {}).get("sizing_recommendations", {}) if payload_data else {}
    steel_node_report = payload_data.get("steel_node_report", "") if payload_data else ""
    steel_node_checks = payload_data.get("steel_node_checks", {}) if payload_data else {}
    steel_node_recommendations = payload_data.get("steel_node_recommendations", {}) if payload_data else {}
    corner_radius_recommendation = sizing_recommendations.get("corner_radius") if sizing_recommendations else None
    synced_geometry_payload = _store_payload_reference(
        "synced_geometry",
        payload_data.get("synced_geometry_payload", {}) if payload_data else {},
    )
    synced_preview_breps = _build_synced_plate_preview_breps(
        payload_data.get("synced_geometry_payload", {}) if payload_data else {}
    )
    synced_preview_payload = payload_data.get("synced_geometry_payload", {}) if payload_data else {}
    if isinstance(synced_preview_payload, dict) and isinstance(synced_preview_payload.get("preview"), dict) and isinstance((synced_preview_payload.get("preview") or {}).get("breps_doc_units"), list):
        synced_preview_source = "preview.breps_doc_units"
    elif isinstance(synced_preview_payload, dict) and isinstance(synced_preview_payload.get("footing_breps"), list) and synced_preview_payload.get("footing_breps"):
        synced_preview_source = "footing_breps"
    else:
        synced_preview_source = "base_plate_box_fallback"

    a = payload_data.get("a") if payload_data else None
    b = payload_data.get("b") if payload_data else None
    c = payload_data.get("c") if payload_data else None
    d = payload_data.get("d") if payload_data else None
    e = payload_data.get("e") if payload_data else None
    f = payload_data.get("f") if payload_data else None
    g = payload_data.get("g") if payload_data else None
    h = payload_data.get("h") if payload_data else None
    i = payload_data.get("i") if payload_data else None
    j = payload_data.get("j") if payload_data else None
    k = payload_data.get("k") if payload_data else None
    l = payload_data.get("l") if payload_data else None
    m = payload_data.get("m") if payload_data else None
    n = payload_data.get("n") if payload_data else None
    payload = _store_payload_reference("calculations", payload_data)
    debug_status = {
        "run_tag": RUN_TAG,
        "payload_type": type(payload_data).__name__,
        "member_result_count": len(payload_data.get("member_results", [])) if payload_data else 0,
        "adjusted_plate_count": len(payload_data.get("adjusted_base_plates", [])) if payload_data else 0,
        "synced_preview_brep_count": len(synced_preview_breps),
        "synced_preview_source": synced_preview_source,
        "has_report_text": bool(report_text),
        "has_combined_report": bool(combined_report),
        "b_timber_brep_is_none": b is None,
        "payload_transport": "gh_object_wrapper" if GH_ObjectWrapper is not None else ("sticky_token" if sc is not None else "direct_value"),
        "payload_output": payload,
        "synced_geometry_payload_output": synced_geometry_payload,
    }
    # Legacy / generic-output aliases for GH components that have not yet had
    # their output names refreshed after wrapper updates.
    o = debug_status
    p = out
    q = report_text
    r = synced_preview_breps

except Exception:
    out = traceback.format_exc()
    print("[GH Calc Wrapper] Exception caught:")
    print(out)
    payload = {}
    report_text = out
    combined_report = out
    pass_fail_summary = {"wrapper_error": True}
    utilization_values = {}
    sizing_recommendations = {}
    steel_node_report = out
    steel_node_checks = {"wrapper_error": True}
    steel_node_recommendations = {}
    corner_radius_recommendation = None
    synced_geometry_payload = {}
    synced_preview_breps = []
    debug_status = {
        "run_tag": RUN_TAG,
        "error": out,
    }
    a = report_text
    b = c = d = e = f = g = h = None
    i = utilization_values
    j = pass_fail_summary
    k = steel_node_report
    l = ""
    m = n = None
    o = debug_status
    p = out
    q = report_text
    r = synced_preview_breps
# ---------- end bp_calculations ----------
panel_4 = Panel(bp_calculations.debug_status)
panel_5 = Panel(bp_calculations.sizing_recommendations)
panel_7 = Panel(bp_calculations.pass_fail_summary)
panel_8 = Panel(bp_calculations.out)
preview_5 = CustomPreview(Geometry=bp_calculations.r, Material=ColourSwatch(SwatchColor=RGB(0, 0, 0)))

# ----
# COMPAS TIMBER
falsestart_4 = LBFalseStartToggle(True)
bp_ct_json = Python3Script(
    geometry_payload=bp_calculations.synced_geometry_payload,
    calc_payload=bp_calculations.payload,
    bottom_face_mode=list,
    enabled=falsestart_4)  # -> out, debug_status, inspection_breps, package, json_path; inputs bottom_face_mode: String
# ---------- bp_ct_json: Python ----------
"""
Grasshopper Py3 wrapper: ct_anchor_milling

GH Inputs expected:
- geometry_payload (optional when calc_payload.synced_geometry_payload is present; Item Access)
- calc_payload (Item Access)
- out_json_path
- bottom_face_mode
- process_only_passed
- enabled

GH Outputs:
- out
- package
- records
- timber_model_schema
- inspection_breps (final timber column breps with milling cuts)
- json_path
- debug_status
"""

import importlib.util
import os
import sys
import traceback
from pathlib import Path

try:
    import scriptcontext as sc  # type: ignore
except Exception:
    sc = None

try:
    import Rhino  # type: ignore
except Exception:
    Rhino = None

try:
    from Grasshopper.Kernel.Types import GH_ObjectWrapper  # type: ignore
except Exception:
    GH_ObjectWrapper = None

ROOT = r"C:\Users\Juste\Documents\_GitHub\MAS-2526\10_llhil-t2-fabrication\design\structure_model\Base_Plates"
HELPER_PATH = os.path.join(ROOT, "py", "ct_anchor_milling.py")
RUN_TAG = "CT_WRAPPER_SYNC_2026_05_18_COUNTERBORE_DIAG"

print("[GH CT Wrapper] RUN_TAG:", RUN_TAG)
print("[GH CT Wrapper] HELPER_PATH:", HELPER_PATH)
print("[GH CT Wrapper] HELPER_EXISTS:", os.path.exists(HELPER_PATH))

# Early fallback assignments: if a GH component is running a truncated copy of
# this script, outputs still show a diagnostic instead of staying <null>.
out = "CT wrapper startup reached"
package = {"phase": "startup"}
records = []
timber_model_schema = {}
inspection_breps = []
json_path = None
debug_status = {
    "run_tag": RUN_TAG,
    "phase": "startup_prints_completed",
    "helper_path": HELPER_PATH,
    "helper_exists": bool(os.path.exists(HELPER_PATH)),
}
a = out
b = package
c = records
d = timber_model_schema
e = inspection_breps
f = json_path
g = debug_status


def _load_helper():
    module_name = "ct_anchor_milling"
    print("[GH CT Wrapper] HELPER_LOAD_START")
    sys.modules.pop(module_name, None)
    spec = importlib.util.spec_from_file_location(module_name, HELPER_PATH)
    if spec is None or spec.loader is None:
        raise ImportError("Could not load {0}".format(HELPER_PATH))
    module = importlib.util.module_from_spec(spec)
    # Dataclasses/type annotations can resolve through sys.modules during exec.
    sys.modules[module_name] = module
    spec.loader.exec_module(module)
    print("[GH CT Wrapper] HELPER_LOADED: True")
    return module


def _to_python_data(value):
    if isinstance(value, dict):
        return {key: _to_python_data(item) for key, item in value.items()}
    try:
        keys = list(value.Keys)
    except Exception:
        keys = None
    if keys is not None:
        return {
            _to_python_data(key): _to_python_data(value[key])
            for key in keys
        }
    if isinstance(value, (list, tuple)):
        return [_to_python_data(item) for item in value]
    if not isinstance(value, (str, bytes)):
        try:
            value.Count
            return [_to_python_data(item) for item in value]
        except Exception:
            pass
    return value


def _unwrap_payload(value):
    """Normalize the common GH forms of a single dictionary payload."""
    normalized = value
    while True:
        wrapped_value = getattr(normalized, "Value", None)
        if wrapped_value is not None and wrapped_value is not normalized:
            normalized = wrapped_value
            continue
        branches = getattr(normalized, "Branches", None)
        if branches is not None:
            normalized = _to_python_data(branches)
            continue
        normalized = _to_python_data(normalized)
        if isinstance(normalized, str) and sc is not None and normalized in sc.sticky:
            normalized = sc.sticky[normalized]
            continue
        if isinstance(normalized, dict):
            return normalized
        if isinstance(normalized, (list, tuple)) and len(normalized) == 1:
            normalized = normalized[0]
            continue
        return normalized


def _payload_summary(value):
    if isinstance(value, dict):
        return "dict keys={0}".format(sorted(value.keys()))
    if isinstance(value, (list, tuple)):
        return "{0} len={1}".format(type(value).__name__, len(value))
    return type(value).__name__


def _component_key():
    try:
        return str(ghenv.Component.InstanceGuid)  # type: ignore[name-defined]
    except Exception:
        return "standalone"


def _store_payload_reference(kind, value):
    if GH_ObjectWrapper is not None:
        print("[GH CT Wrapper] payload output mode=gh_object_wrapper kind={0}".format(kind))
        return GH_ObjectWrapper(value)
    if sc is None:
        return value
    token = "BPG_PAYLOAD::{0}::{1}".format(kind, _component_key())
    sc.sticky[token] = value
    print("[GH CT Wrapper] payload output mode=reference_token kind={0}".format(kind))
    return token


def _coerce_geometry_list(items):
    """Return only Rhino geometry objects, converting to Brep when possible."""
    coerced = []
    for item in (items or []):
        if item is None:
            continue
        geom = item
        if Rhino is not None:
            try:
                if isinstance(geom, Rhino.Geometry.GeometryBase):
                    coerced.append(geom)
                    continue
            except Exception:
                pass
        try:
            duplicate = getattr(item, "Duplicate", None)
            if callable(duplicate):
                geom = duplicate()
        except Exception:
            geom = item
        if Rhino is not None:
            try:
                if isinstance(geom, Rhino.Geometry.GeometryBase):
                    coerced.append(geom)
                    continue
            except Exception:
                pass
        try:
            to_brep = getattr(item, "ToBrep", None)
            if callable(to_brep):
                try:
                    brep = to_brep(False)
                except TypeError:
                    brep = to_brep()
                if brep is not None:
                    coerced.append(brep)
                    continue
        except Exception:
            pass
    return coerced


print("[GH CT Wrapper] BODY_READY")


# Initialize outputs so GH never receives nulls from unassigned variables.
out = "CT wrapper initialized"
package = {}
records = []
timber_model_schema = {}
inspection_breps = []
json_path = None
debug_status = {
    "run_tag": RUN_TAG,
    "phase": "initialized",
}
a = out
b = package
c = records
d = timber_model_schema
e = inspection_breps
f = json_path
g = debug_status
print("[GH CT Wrapper] OUTPUTS_INITIALIZED")


try:
    helper = _load_helper()
    print("[GH CT Wrapper] HELPER_LOADED:", helper is not None)
    print(
        "[GH CT Wrapper] ENABLED_INPUT:",
        enabled if "enabled" in globals() else "<missing>",
    )

    if "enabled" in globals() and enabled is False:
        out = "CT export disabled."
        package = {}
        records = []
        timber_model_schema = {}
        inspection_breps = []
        json_path = None
        debug_status = {
            "run_tag": RUN_TAG,
            "phase": "disabled",
            "enabled_input": enabled if "enabled" in globals() else None,
        }
        a = out
        b = package
        c = records
        d = timber_model_schema
        e = inspection_breps
        f = json_path
        g = debug_status
    else:
        print("[GH CT Wrapper] ENTER_ACTIVE_BRANCH")
        calc_payload_input = None
        calc_payload_source = None
        for candidate_name in ("calc_payload", "calculations_payload", "calculation_payload", "payload"):
            if candidate_name in globals() and globals()[candidate_name]:
                calc_payload_input = globals()[candidate_name]
                calc_payload_source = candidate_name
                break
        if calc_payload_input is None:
            raise ValueError("calc_payload input is required")
        calc_payload = _unwrap_payload(calc_payload_input)
        print("[GH CT Wrapper DEBUG] calc_payload_source=", calc_payload_source)
        print("[GH CT Wrapper DEBUG] calc_payload_type=", type(calc_payload))
        if isinstance(calc_payload, dict):
            print("[GH CT Wrapper DEBUG] calc_payload_keys=", list(calc_payload.keys()))
        else:
            print("[GH CT Wrapper DEBUG] calc_payload_value=", calc_payload)
        if not isinstance(calc_payload, dict):
            raise TypeError(
                "calc payload from {0} did not normalize to a dict; got {1}. "
                "Keep calc_payload on Item Access; List/Tree Access can explode the payload.".format(
                    calc_payload_source,
                    _payload_summary(calc_payload),
                )
            )
        # Common GH wiring mistake: feeding debug_status instead of payload.
        if "run_tag" in calc_payload and "error" in calc_payload and len(calc_payload.keys()) <= 3:
            raise ValueError(
                "calc_payload appears to be debug_status, not calculations payload. "
                "Wire the 'payload' output of gh_wrapper_calculations to calc_payload input."
            )
        if not any(
            key in calc_payload
            for key in ("adjusted_base_plates", "member_results", "synced_geometry_payload")
        ):
            raise ValueError(
                "calc_payload missing required calculation keys. "
                "Expected one of: adjusted_base_plates, member_results, synced_geometry_payload. "
                "This usually means the wrong upstream output is connected."
            )
        print(
            "[GH CT Wrapper] calc payload source={0}; {1}".format(
                calc_payload_source,
                _payload_summary(calc_payload),
            )
        )

        geometry_payload_input = None
        geometry_payload_source = None
        for candidate_name in ("geometry_payload", "geometry"):
            if candidate_name in globals() and globals()[candidate_name]:
                geometry_payload_input = globals()[candidate_name]
                geometry_payload_source = candidate_name
                break
        geometry_payload = _unwrap_payload(geometry_payload_input) if geometry_payload_input is not None else {}
        maybe_synced = calc_payload.get("synced_geometry_payload")
        if geometry_payload and not isinstance(geometry_payload, dict):
            raise TypeError(
                "geometry payload from {0} did not normalize to a dict; got {1}. "
                "Keep geometry_payload on Item Access; List/Tree Access can explode the payload.".format(
                    geometry_payload_source,
                    _payload_summary(geometry_payload),
                )
            )
        if geometry_payload:
            print(
                "[GH CT Wrapper] geometry payload source={0}; {1}".format(
                    geometry_payload_source,
                    _payload_summary(geometry_payload),
                )
            )
        if not geometry_payload and not (isinstance(maybe_synced, dict) and maybe_synced):
            raise ValueError("geometry_payload input is required when calc_payload has no synced_geometry_payload")

        target_path = Path(str(out_json_path)) if "out_json_path" in globals() and out_json_path else (Path(ROOT) / "ct_anchor_milling_export.json")

        package = helper.export_ct_json(
            geometry_payload=geometry_payload,
            calc_payload=calc_payload,
            out_json_path=target_path,
            bottom_face_mode=str(bottom_face_mode) if "bottom_face_mode" in globals() and bottom_face_mode else None,
            process_only_passed=bool(process_only_passed) if "process_only_passed" in globals() else False,
        )
        records = package.get("records", [])
        timber_model_schema = package.get("timber_model_schema", {})
        inspection_breps_raw = helper.build_inspection_breps(records)
        inspection_breps = _coerce_geometry_list(inspection_breps_raw)
        print("[GH CT Wrapper] HELPER_HAS_RHINO_GEOMETRY:", bool(getattr(helper, "rg", None) is not None))
        print("[GH CT Wrapper] RECORD_COUNT:", len(records))
        print("[GH CT Wrapper] INSPECTION_BREP_COUNT:", len(inspection_breps))
        print("[GH CT Wrapper] INSPECTION_BREP_NULL_COUNT:", sum(1 for x in inspection_breps if x is None))
        if len(inspection_breps) != len(inspection_breps_raw):
            print(
                "[GH CT Wrapper] INSPECTION_BREP_COERCION: kept={0} dropped={1}".format(
                    len(inspection_breps),
                    len(inspection_breps_raw) - len(inspection_breps),
                )
            )
        inspection_cut_diagnostics = []
        try:
            helper.build_inspection_breps(
                records,
                diagnostics=inspection_cut_diagnostics,
            )
        except Exception as diagnostics_exc:
            inspection_cut_diagnostics = [
                {
                    "diagnostics_error": str(diagnostics_exc),
                }
            ]
        cut_diagnostic_lines = []
        for cut_diag in inspection_cut_diagnostics:
            if not isinstance(cut_diag, dict):
                continue
            cut_line = (
                "[GH CT Wrapper] CUT_DIAG member={0} attempts={1} successes={2} failures={3} "
                "solid_before_trim={4} plane_trimmed={5} capped={6} solid_after_trim={7} final_parts={8}".format(
                    cut_diag.get("member_id"),
                    cut_diag.get("cut_attempts"),
                    cut_diag.get("cut_successes"),
                    cut_diag.get("cut_failures"),
                    cut_diag.get("timber_solid_before_trim"),
                    cut_diag.get("plane_trimmed"),
                    cut_diag.get("plane_trim_cap_succeeded"),
                    cut_diag.get("timber_solid_after_trim"),
                    cut_diag.get("final_part_count"),
                )
            )
            cut_diagnostic_lines.append(cut_line)
            print(cut_line)
            slot_diag = cut_diag.get("slot_target_diagnostics")
            if isinstance(slot_diag, dict) and slot_diag:
                slot_line = (
                    "[GH CT Wrapper] SLOT_DIAG member={0} bbox_overlap={1} "
                    "bool_intersections={2} brep_brep_success={3} curves={4} "
                    "target_valid={5} target_solid={6} cutter_valid={7} cutter_solid={8} methods={9}"
                ).format(
                    cut_diag.get("member_id"),
                    slot_diag.get("bbox_overlap"),
                    slot_diag.get("boolean_intersection_count"),
                    slot_diag.get("brep_brep_success"),
                    slot_diag.get("brep_brep_curve_count"),
                    slot_diag.get("target_valid"),
                    slot_diag.get("target_solid"),
                    slot_diag.get("cutter_valid"),
                    slot_diag.get("cutter_solid"),
                    cut_diag.get("cut_methods"),
                )
                cut_diagnostic_lines.append(slot_line)
                print(slot_line)
        json_path = str(target_path)
        package_metadata = package.get("metadata", {}) if isinstance(package, dict) else {}
        reference_usage = package_metadata.get("reference_usage", {}) if isinstance(package_metadata, dict) else {}
        milling_feature_summary = package_metadata.get("milling_feature_summary", {}) if isinstance(package_metadata, dict) else {}
        if isinstance(milling_feature_summary, dict):
            print(
                "[GH CT Wrapper] COUNTERBORE_DIAG diameters={0} auto={1} factors={2} sources={3} matches_auto={4}".format(
                    milling_feature_summary.get("counterbore_diameters"),
                    milling_feature_summary.get("counterbore_auto_diameters"),
                    milling_feature_summary.get("counterbore_dia_factors"),
                    milling_feature_summary.get("counterbore_dia_sources"),
                    milling_feature_summary.get("counterbores_match_auto_proportion"),
                )
            )
        if isinstance(package_metadata, dict) and package_metadata.get("json_write_succeeded") is False:
            out = "Built {0} CT records; JSON write skipped: {1}".format(
                len(records),
                package_metadata.get("json_write_error"),
            )
        else:
            out = "Exported {0} CT records".format(len(records))
        if cut_diagnostic_lines:
            out = "{0}\n{1}".format(out, "\n".join(cut_diagnostic_lines))
        if len(records) == 0:
            out = (
                "Exported 0 CT records; "
                "calc_member_result_count={0}, calc_adjusted_plate_count={1}, "
                "has_synced_geometry_payload={2}, geometry_payload_provided={3}"
            ).format(
                len(calc_payload.get("member_results", [])) if isinstance(calc_payload.get("member_results"), list) else 0,
                len(calc_payload.get("adjusted_base_plates", [])) if isinstance(calc_payload.get("adjusted_base_plates"), list) else 0,
                bool(isinstance(calc_payload.get("synced_geometry_payload"), dict) and calc_payload.get("synced_geometry_payload")),
                bool(geometry_payload),
            )
        package = _store_payload_reference("ct_package", package)
        debug_status = {
            "run_tag": RUN_TAG,
            "record_count": len(records),
            "calc_member_result_count": len(calc_payload.get("member_results", [])) if isinstance(calc_payload.get("member_results"), list) else 0,
            "calc_adjusted_plate_count": len(calc_payload.get("adjusted_base_plates", [])) if isinstance(calc_payload.get("adjusted_base_plates"), list) else 0,
            "calc_has_synced_geometry_payload": bool(isinstance(calc_payload.get("synced_geometry_payload"), dict) and calc_payload.get("synced_geometry_payload")),
            "has_timber_model_schema": bool(timber_model_schema),
            "helper_has_rhino_geometry": bool(getattr(helper, "rg", None) is not None),
            "inspection_breps_python_type": type(inspection_breps).__name__,
            "inspection_brep_count": len(inspection_breps),
            "inspection_brep_null_count": sum(1 for x in inspection_breps if x is None),
            "inspection_cut_diagnostics": inspection_cut_diagnostics,
            "inspection_cut_diagnostic_lines": cut_diagnostic_lines,
            "reference_usage": reference_usage,
            "milling_feature_summary": milling_feature_summary,
            "cluster_expansion": {
                "expected_total": 16,
                "actual_total": len(records),
                "records_per_cluster": len(records) // max(len(calc_payload.get("adjusted_base_plates") or []), 1),
            },
            "payload_transport": "gh_object_wrapper" if GH_ObjectWrapper is not None else ("sticky_token" if sc is not None else "direct_value"),
            "package_output": package,
            "json_path": json_path,
        }
        # Legacy / generic-output aliases if this GH component has not yet had
        # its output names refreshed after wrapper updates.
        a = out
        b = package
        c = records
        d = timber_model_schema
        e = inspection_breps
        f = json_path
        g = debug_status

except Exception:
    try:
        out = traceback.format_exc()
    except NameError:
        import traceback as _traceback
        out = _traceback.format_exc()
    print("[GH CT Wrapper] Exception caught:")
    print(out)
    package = {"wrapper_error": out}
    records = [{"wrapper_error": out}]
    timber_model_schema = {"wrapper_error": True}
    inspection_breps = []
    json_path = None
    debug_status = {
        "run_tag": RUN_TAG,
        "error": out,
    }
    a = out
    b = package
    c = records
    d = timber_model_schema
    e = inspection_breps
    f = json_path
    g = debug_status
# ---------- end bp_ct_json ----------
panel_9 = Panel(bp_ct_json.json_path)
panel_10 = Panel(bp_ct_json.out)
previewmat = CustomPreviewMaterials(
    Geometry=bp_ct_json.inspection_breps,
    DiffuseColor=ColourSwatch(SwatchColor=RGB(0, 0, 0)),
    Transparency=Slider(0, range=0..1))
