# Grasshopper definition Json Export Script.gh (Grasshopper 1.0.8)

py3 = Python3Script(run=Button(), export_path="D:\_Studies\_DFAB\DFAB\_T2\_Final\lines.json")  # -> out, a
# ---------- py3: Python ----------
import json
import Rhino.Geometry as rg

if run:
    data = []
    
    for i, ln in enumerate(lines):
        # Handle both Line and LineCurve types
        if hasattr(ln, 'From'):
            start = ln.From
            end   = ln.To
        elif hasattr(ln, 'PointAtStart'):
            start = ln.PointAtStart
            end   = ln.PointAtEnd
        else:
            continue
        
        data.append({
            "index":  i,
            "start":  {"x": round(start.X, 4), "y": round(start.Y, 4), "z": round(start.Z, 4)},
            "end":    {"x": round(end.X, 4),   "y": round(end.Y, 4),   "z": round(end.Z, 4)},
            "length": round(start.DistanceTo(end), 4)
        })
    
    with open(export_path, "w") as f:
        json.dump({"lines": data, "count": len(data)}, f, indent=2)
    
    print(f"Exported {len(data)} lines → {export_path}")
    line_count = len(data)
# ---------- end py3 ----------
