# Grasshopper definition funicular_karamba_v7.ghx (Grasshopper 1.0.8)
# plug-ins: Karamba3D, CORE.Toolbox.Grasshopper, GrasshopperRfem6WsPlugin, MeshEdit Components, Weaverbird

# ---- group: IMPORT MODELS / RHINO_to_DLUBAL
list = ValueList({"C24 | SIA 265:2021", "GL24h | SIA 265:2021", "S235 | SIA 263:2013", "Schilliger | Schilliger"}, selected="GL24h | SIA 265:2021")  # disabled
toggle = BooleanToggle(True)  # disabled
panel = Panel("1")  # disabled
material = Material(MaterialNo=panel, MaterialName=list, UserDefinedMaterial=toggle, mode="Assemble")  # disabled

# ---- group: IMPORT MODELS / RHINO_to_DLUBAL / welche gehören zusammen
member_set = MemberSet(mode="Assemble")  # disabled

# ---- group: IMPORT MODELS / RHINO_to_DLUBAL / Gelenkbedingungen
member_hinge = MemberHinge(mode="Assemble")  # disabled
member_hinge_2 = MemberHinge(mode="Assemble")  # disabled

# ---- group: IMPORT MODELS / RHINO_to_DLUBAL / Plattenverbindungen Line Hinge
line_hinge = LineHinge(mode="Assemble")  # disabled

# ---- group: IMPORT MODELS
panel_2 = Panel("localhost:8082")  # disabled

# ---- group: EXPORT MODELS / DLUBAL_to_RHINO
panel_3 = Panel("260310 Loads etc")  # disabled
toggle_2 = BooleanToggle(True)  # disabled
toggle_3 = BooleanToggle(True)  # disabled
toggle_4 = BooleanToggle(True)  # disabled
toggle_5 = BooleanToggle(True)  # disabled
toggle_6 = BooleanToggle(False)  # disabled
toggle_7 = BooleanToggle(True)  # disabled
rfem_import = RFEM6ImportComponent(
    Run=toggle_6,
    Materials=toggle_4,
    CrossSections=toggle_5,
    NodalSupports=toggle_7,
    LoadObjects=toggle_3,
    NameOfModelInRFEM=panel_3,
    ReadLog=toggle_2)  # -> RFEMData, Log, SuccessfulImport; disabled
rfem_data = RFEMDataComponent(RFEMData=rfem_import.RFEMData)  # -> Materials, CrossSections, Thicknesses, Nodes, Lines, Members, MemberSets, Surfaces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; disabled
cross_section = CrossSection(CrossSection=rfem_data.CrossSections, mode="Extract")  # -> SectionNo, SectionName, MaterialNo, SectionRotationAngle, Comment, Area, ShearAreaY, ShearAreaZ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; disabled
nodal_support = NodalSupport(NodalSupport=rfem_data.NodalSupports, mode="Extract")  # -> GHNode, SupportNo, NodesNo, TranslationalSpringX, TranslationalSpringY, TranslationalSpringZ, RotationalRestraintX, RotationalRestraintY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; disabled
material_2 = Material(Material=rfem_data.Materials, mode="Extract")  # -> MaterialNo, MaterialName, UserDefinedMaterial, MaterialModel, Comment, DefinitionType, MaterialCharacteristics; disabled
member_load = MemberLoad(MemberLoad=rfem_data.MemberLoads, mode="Extract")  # -> MemberLoadNo, LoadCaseNo, MembersNo, LoadType, LoadDistribution, CoordinateSystem, LoadDirection, LoadMagnitudeP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; disabled
panel_4 = Panel(material_2.MaterialName)  # disabled
panel_5 = Panel(cross_section.SectionName)  # disabled
panel_6 = Panel(nodal_support.TranslationalSpringX)  # disabled

# ---- group: EXPORT MODELS / LINE MODEL EXPORT
json_exporter = Python3Script()  # -> out, ExportJson, MemberLines, AreaLoadMeshes, PointLoadPoints, BoundaryPoints, JointNodes; disabled
# ---------- json_exporter: Python ----------
# Minimal Input Cheat-Sheet (Exporter)
# - GH input names: model (or Model)
# - Function call: build_structure_export_json(model=...)
# - Minimal runnable input: {}
# - Minimal useful topology input:
#   {"nodes": [{"id": "N1", "x": 0, "y": 0, "z": 0}, {"id": "N2", "x": 1, "y": 0, "z": 0}],
#    "edges": [{"id": "E1", "start_node": "N1", "end_node": "N2"}]}
# - GH outputs: ExportJson, MemberLines, AreaLoadMeshes, LinearLoadLines, PointLoadPoints,
#   BoundaryPoints, JointNodes, out
from __future__ import annotations

import argparse
import json
from typing import Any, Dict, List, Optional


def _normalize_dict_list(value: Any) -> List[Dict[str, Any]]:
    if value is None:
        return []
    if isinstance(value, list):
        return [item for item in value if isinstance(item, dict)]
    if isinstance(value, dict):
        return [value]
    return []


def _pick_list(payload: Dict[str, Any], *keys: str) -> List[Dict[str, Any]]:
    for key in keys:
        items = _normalize_dict_list(payload.get(key))
        if items:
            return items
    return []


def _edge_or_node_guid(item: Dict[str, Any]) -> Optional[str]:
    attrs = item.get("attributes") if isinstance(item.get("attributes"), dict) else {}
    for key in (
        "guid",
        "rhino_guid",
        "proxy_guid",
        "point_guid",
        "pt_guid",
        "curve_guid",
        "line_guid",
        "area_guid",
        "mesh_guid",
    ):
        value = item.get(key)
        if value not in (None, ""):
            return str(value)
        attr_value = attrs.get(key)
        if attr_value not in (None, ""):
            return str(attr_value)
    return None


def _coerce_proxy_map(value: Any) -> Dict[str, str]:
    result: Dict[str, str] = {}
    if isinstance(value, dict):
        for key, map_value in value.items():
            if key in (None, "") or map_value in (None, ""):
                continue
            result[str(key)] = str(map_value)
        return result

    if isinstance(value, list):
        for item in value:
            if not isinstance(item, dict):
                continue
            guid = item.get("guid") or item.get("proxy_guid")
            target_id = item.get("id") or item.get("target_id")
            if guid in (None, "") or target_id in (None, ""):
                continue
            result[str(guid)] = str(target_id)
    return result


def _extract_input_proxy_maps(payload: Dict[str, Any]) -> Dict[str, Dict[str, str]]:
    proxies = {
        "pt": {},
        "curve": {},
        "area": {},
    }

    nested = payload.get("guid_proxies") if isinstance(payload.get("guid_proxies"), dict) else {}

    point_sources = [
        payload.get("pt_guid_proxies"),
        payload.get("pt_guid_proxy"),
        payload.get("point_guid_proxies"),
        payload.get("point_guid_proxy"),
        nested.get("pt"),
        nested.get("points"),
    ]
    curve_sources = [
        payload.get("curve_guid_proxies"),
        payload.get("curve_guid_proxy"),
        payload.get("line_guid_proxies"),
        payload.get("line_guid_proxy"),
        nested.get("curve"),
        nested.get("curves"),
        nested.get("lines"),
    ]
    area_sources = [
        payload.get("area_guid_proxies"),
        payload.get("area_guid_proxy"),
        payload.get("mesh_guid_proxies"),
        payload.get("mesh_guid_proxy"),
        nested.get("area"),
        nested.get("areas"),
        nested.get("meshes"),
    ]

    for source in point_sources:
        proxies["pt"].update(_coerce_proxy_map(source))
    for source in curve_sources:
        proxies["curve"].update(_coerce_proxy_map(source))
    for source in area_sources:
        proxies["area"].update(_coerce_proxy_map(source))

    return proxies


def _resolve_node_id(node: Dict[str, Any], index: int, prefix: str = "N") -> str:
    for key in ("id", "node_id", "identifier"):
        value = node.get(key)
        if value not in (None, ""):
            return str(value)
    return f"{prefix}{index + 1}"


def _resolve_edge_id(edge: Dict[str, Any], index: int, prefix: str = "E") -> str:
    for key in ("id", "edge_id", "line_id", "member_id", "identifier"):
        value = edge.get(key)
        if value not in (None, ""):
            return str(value)
    return f"{prefix}{index + 1}"


def _to_node_ref(value: Any, node_ids: List[str]) -> Optional[str]:
    if value is None:
        return None

    text = str(value)
    if text in node_ids:
        return text

    try:
        index = int(value)
    except (TypeError, ValueError):
        return None

    if 0 <= index < len(node_ids):
        return node_ids[index]
    if 1 <= index <= len(node_ids):
        return node_ids[index - 1]
    return None


def _edge_node_ids(edge: Dict[str, Any], node_ids: List[str]) -> Optional[tuple[str, str]]:
    attrs = edge.get("attributes") if isinstance(edge.get("attributes"), dict) else {}

    start = None
    end = None

    for key in ("start_node", "u", "from", "a"):
        start = _to_node_ref(edge.get(key), node_ids)
        if start is not None:
            break
    for key in ("end_node", "v", "to", "b"):
        end = _to_node_ref(edge.get(key), node_ids)
        if end is not None:
            break

    if start is None:
        start = _to_node_ref(attrs.get("start_node"), node_ids)
    if end is None:
        end = _to_node_ref(attrs.get("end_node"), node_ids)

    if start is None or end is None or start == end:
        return None

    return start, end


def build_structure_export_json(
    model: Dict[str, Any],
    *,
    schema: str = "structure_model_v1",
) -> Dict[str, Any]:
    """Build export JSON with nodes, edges, meshes and member breps from a Karamba model."""
    nodes_in = _pick_list(model, "nodes", "vertices", "points")
    edges_in = _pick_list(model, "edges", "lines", "members", "beams")
    meshes_in = _pick_list(model, "meshes", "areas", "shells", "faces")
    member_elements_in = _pick_list(model, "member_elements", "elements", "beam_elements")
    member_breps_in = _pick_list(model, "member_breps", "breps")
    sections_in = _pick_list(model, "cross_sections", "sections")
    input_proxies = _extract_input_proxy_maps(model)

    node_records: List[Dict[str, Any]] = []
    node_ids: List[str] = []
    point_guid_proxy: Dict[str, str] = dict(input_proxies["pt"])

    for index, node in enumerate(nodes_in):
        node_id = _resolve_node_id(node, index)
        node_ids.append(node_id)

        record = {
            "id": node_id,
            "x": float(node.get("x", 0.0)),
            "y": float(node.get("y", 0.0)),
            "z": float(node.get("z", 0.0)),
        }

        for key in ("support", "restraint", "attributes"):
            if key in node:
                record[key] = node[key]

        node_records.append(record)

        node_guid = _edge_or_node_guid(node)
        if node_guid is not None:
            point_guid_proxy[node_guid] = node_id

    section_by_edge: Dict[str, Any] = {}
    for entry in sections_in:
        edge_key = entry.get("edge_id") or entry.get("line_id") or entry.get("id")
        if edge_key is None:
            continue
        section_by_edge[str(edge_key)] = entry.get("section") or entry.get("name") or entry

    elements_by_edge: Dict[str, List[Dict[str, Any]]] = {}
    for element in member_elements_in:
        edge_key = element.get("edge_id") or element.get("line_id") or element.get("member_id")
        if edge_key is None:
            continue
        edge_id = str(edge_key)
        elements_by_edge.setdefault(edge_id, []).append(element)

    breps_by_edge: Dict[str, List[Dict[str, Any]]] = {}
    for brep in member_breps_in:
        edge_key = brep.get("edge_id") or brep.get("line_id") or brep.get("member_id")
        if edge_key is None:
            continue
        edge_id = str(edge_key)
        breps_by_edge.setdefault(edge_id, []).append(brep)

    edge_records: List[Dict[str, Any]] = []
    export_breps: List[Dict[str, Any]] = []
    curve_guid_proxy: Dict[str, str] = dict(input_proxies["curve"])

    for index, edge in enumerate(edges_in):
        edge_id = _resolve_edge_id(edge, index)
        node_pair = _edge_node_ids(edge, node_ids)
        if node_pair is None:
            continue

        start_node, end_node = node_pair
        edge_record: Dict[str, Any] = {
            "id": edge_id,
            "start_node": start_node,
            "end_node": end_node,
        }

        if edge_id in section_by_edge:
            edge_record["cross_section"] = section_by_edge[edge_id]
        elif "cross_section" in edge:
            edge_record["cross_section"] = edge["cross_section"]
        elif "cross_sections" in edge:
            edge_record["cross_section"] = edge["cross_sections"]

        members = elements_by_edge.get(edge_id, [])
        if members:
            edge_record["member_elements"] = members

        edge_records.append(edge_record)

        edge_guid = _edge_or_node_guid(edge)
        if edge_guid is not None:
            curve_guid_proxy[edge_guid] = edge_id

        for brep in breps_by_edge.get(edge_id, []):
            export_breps.append(
                {
                    "edge_id": edge_id,
                    "member_id": brep.get("member_id") or brep.get("id") or edge_id,
                    "brep": brep.get("brep") or brep.get("geometry") or brep,
                }
            )

    mesh_records: List[Dict[str, Any]] = []
    area_guid_proxy: Dict[str, str] = dict(input_proxies["area"])
    for index, mesh in enumerate(meshes_in):
        mesh_id = str(mesh.get("id") or mesh.get("mesh_id") or f"M{index + 1}")
        attrs = mesh.get("attributes") if isinstance(mesh.get("attributes"), dict) else {}
        preserved_attrs = {k: v for k, v in attrs.items() if k not in ("guid", "rhino_guid", "area_guid", "mesh_guid")}

        mesh_record: Dict[str, Any] = {
            "id": mesh_id,
            "attributes": preserved_attrs,
        }
        for key in ("vertices", "faces", "mesh", "geometry", "brep"):
            if key in mesh:
                mesh_record[key] = mesh[key]

        mesh_records.append(mesh_record)

        mesh_guid = _edge_or_node_guid(mesh)
        if mesh_guid is not None:
            area_guid_proxy[mesh_guid] = mesh_id

    member_line_ids = [edge["id"] for edge in edge_records]
    area_mesh_ids = [mesh["id"] for mesh in mesh_records]
    point_ids = [node["id"] for node in node_records]

    node_by_id: Dict[str, Dict[str, Any]] = {node["id"]: node for node in node_records}
    connected_edges_by_node: Dict[str, List[str]] = {}
    for edge in edge_records:
        start_node = str(edge["start_node"])
        end_node = str(edge["end_node"])
        connected_edges_by_node.setdefault(start_node, []).append(str(edge["id"]))
        connected_edges_by_node.setdefault(end_node, []).append(str(edge["id"]))

    joint_records: List[Dict[str, Any]] = []
    for node_id, connected_edges in sorted(connected_edges_by_node.items()):
        # A joint is a node where at least two member lines meet.
        unique_edges = sorted(set(connected_edges))
        if len(unique_edges) < 2:
            continue

        node = node_by_id.get(node_id, {})
        joint_records.append(
            {
                "id": f"J{len(joint_records) + 1}",
                "node_id": node_id,
                "x": node.get("x"),
                "y": node.get("y"),
                "z": node.get("z"),
                "connected_edges": unique_edges,
                "degree": len(unique_edges),
            }
        )

    return {
        "schema": schema,
        "nodes": node_records,
        "edges": edge_records,
        "meshes": mesh_records,
        "member_breps": export_breps,
        "joints": joint_records,
        "output_lists": {
            "member_lines": member_line_ids,
            "area_load_meshes": area_mesh_ids,
            "linear_load_lines": list(member_line_ids),
            "point_load_points": point_ids,
            "boundary_points": list(point_ids),
            "joint_nodes": [joint["node_id"] for joint in joint_records],
        },
        "guid_proxies": {
            "pt": dict(sorted(point_guid_proxy.items())),
            "curve": dict(sorted(curve_guid_proxy.items())),
            "area": dict(sorted(area_guid_proxy.items())),
        },
        "metadata": {
            "source": "karamba",
            "input_nodes": len(nodes_in),
            "input_edges": len(edges_in),
            "input_meshes": len(meshes_in),
            "output_nodes": len(node_records),
            "output_edges": len(edge_records),
            "output_meshes": len(mesh_records),
            "output_member_breps": len(export_breps),
            "output_joints": len(joint_records),
        },
    }


def as_output_lists(model: Dict[str, Any]) -> Dict[str, List[str]]:
    """Return GH-friendly validation lists from the normalized export payload."""
    payload = build_structure_export_json(model)
    lists = payload.get("output_lists", {})
    return {
        "MemberLines": list(lists.get("member_lines", [])),
        "AreaLoadMeshes": list(lists.get("area_load_meshes", [])),
        "LinearLoadLines": list(lists.get("linear_load_lines", [])),
        "PointLoadPoints": list(lists.get("point_load_points", [])),
        "BoundaryPoints": list(lists.get("boundary_points", [])),
        "JointNodes": list(lists.get("joint_nodes", [])),
    }


def _read_json(path: str) -> Dict[str, Any]:
    with open(path, "r", encoding="utf-8") as stream:
        data = json.load(stream)
    if not isinstance(data, dict):
        raise ValueError("Input JSON root must be an object.")
    return data


def _write_json(path: str, payload: Dict[str, Any]) -> None:
    with open(path, "w", encoding="utf-8") as stream:
        json.dump(payload, stream, indent=2)


def _build_parser() -> argparse.ArgumentParser:
    parser = argparse.ArgumentParser(description="Export Karamba model payload to structure JSON.")
    parser.add_argument("--input", required=True, help="Path to Karamba model JSON source file.")
    parser.add_argument("--output", required=True, help="Path to output structure model JSON file.")
    parser.add_argument("--schema", default="structure_model_v1", help="Schema name written into output JSON.")
    return parser


def main() -> None:
    parser = _build_parser()
    args = parser.parse_args()

    model = _read_json(args.input)
    payload = build_structure_export_json(model=model, schema=args.schema)
    _write_json(args.output, payload)


# GH Py3 auto-run block: input `model` (or `Model`) -> JSON payload + validation lists.
_g = globals()
if "model" in _g or "Model" in _g:
    _model_input = _g.get("model", _g.get("Model"))
    if isinstance(_model_input, dict):
        ExportJson = build_structure_export_json(model=_model_input)
        _lists = as_output_lists(_model_input)
        MemberLines = _lists["MemberLines"]
        AreaLoadMeshes = _lists["AreaLoadMeshes"]
        LinearLoadLines = _lists["LinearLoadLines"]
        PointLoadPoints = _lists["PointLoadPoints"]
        BoundaryPoints = _lists["BoundaryPoints"]
        JointNodes = _lists["JointNodes"]
        out = (
            "Exported nodes: {}, edges: {}, meshes: {}, member_breps: {}, joints: {}"
        ).format(
            len(ExportJson.get("nodes", [])),
            len(ExportJson.get("edges", [])),
            len(ExportJson.get("meshes", [])),
            len(ExportJson.get("member_breps", [])),
            len(ExportJson.get("joints", [])),
        )


if __name__ == "__main__":
    main()
# ---------- end json_exporter ----------

# ---- group: EXPORT MODELS / DLUBAL_to_RHINO
panel_7 = Panel("""ACTION_CATEGORY_PERMANENT_G
ACTION_CATEGORY_PERMANENT_G
ACTION_CATEGORY_SNOW_ICE_LOADS_QS
ACTION_CATEGORY_WIND_QW
ACTION_CATEGORY_WIND_QW
ACTION_CATEGORY_WIND_QW
ACTION_CATEGORY_WIND_QW""")  # disabled
panel_8 = Panel("""Ausbaulast
Schnee
Windsot 90°
Windsog 180°
Windsog 270°
Windsog 360°""")  # disabled
panel_9 = Panel("""1
1
1
1
1
1""")  # disabled
panel_10 = Panel("""2
3
4
5
6
7""")  # disabled
load_case = LoadCase(LoadCaseNo=panel_10, LoadCaseName=panel_8, StaticAnalysisSettings=panel_9, ActionCategory=panel_7, mode="Assemble")  # disabled

# ---- group: INPUT GEOMETRY
crv = Curve([<curve referenced from the Rhino model> x181])  # disabled
crv_2 = Curve([<curve referenced from the Rhino model> x17])  # disabled
crv_3 = Curve([<curve referenced from the Rhino model> x52])  # disabled
entwine = Entwine(Branch00=crv, Branch01=crv_2, Branch02=crv_3, FlattenInputs=True)  # disabled
pt = Point(Point(168.3500008, 52.91000076, 24.8))  # disabled
pt_2 = Point(Point(163.5400008, 48.10000076, 19.99))  # disabled
xz = XZPlane(Origin=pt)  # disabled
mirror = Mirror(Geometry=pt_2, Plane=xz)  # -> Geometry, Transform; disabled
yz = YZPlane(Origin=pt)  # disabled
mirror_2 = Mirror(Geometry=entwine, Plane=xz)  # -> Geometry, Transform; disabled
merge = Merge(Data1=entwine, Data2=mirror_2.Geometry)  # disabled
merge_2 = Merge(Data1=pt_2, Data2=mirror.Geometry)  # disabled
mirror_3 = Mirror(Geometry=merge, Plane=yz)  # -> Geometry, Transform; disabled
mirror_4 = Mirror(Geometry=merge_2, Plane=yz)  # -> Geometry, Transform; disabled
merge_3 = Merge(Data1=merge_2, Data2=mirror_4.Geometry)  # disabled
merge_4 = Merge(Data1=merge, Data2=mirror_3.Geometry)  # disabled
bang = ExplodeTree(Data=merge_4)  # -> Branch0, Branch1; disabled
crv_4 = Curve(merge_4)  # disabled
explode = Explode(Curve=crv_4, Recursive=True)  # -> flatten(Segments), Vertices; disabled
llinter = LineLineIntersectionKaramba3D(IntersectingLines=explode.Segments, LinesToIntersect=explode.Segments, LimitDistance_m=0.005)  # -> InterSecPoints, flatten(LineSubSegments); disabled
rdpoints = RemoveDuplicatePointsKaramba3D(Point=llinter.InterSecPoints, LimitDistance=0.005)  # -> OutPoint, Info, Indexes; disabled
pt_3 = Point(rdpoints.OutPoint)  # disabled
pdecon = Deconstruct(Point=pt_3)  # -> XComponent, YComponent, ZComponent; disabled
sort = SortList(Keys=pdecon.ZComponent, ValuesA=pt_3)  # -> Keys, ValuesA; disabled
crv_5 = Curve(bang.Branch1)  # disabled
item = ListItem(List=sort.Keys, Index=0, Wrap=True)  # -> Item1, Item; disabled
bbox = BoundingBox(Content=crv_5, Plane=PlaneXY(0, 0, 0), UnionBox=True)  # -> Box, Box_2; disabled
similar = Similarity(FirstNumber=item.Item1, SecondNumber=sort.Keys, Threshold=0.1)  # -> Similarity, AbsoluteDifference; disabled
srf = Surface(bbox.Box)  # disabled
cull = CullPattern(List=sort.ValuesA, CullPattern=similar.Similarity)  # disabled
srf_2 = Surface(srf)  # disabled
pt_4 = Point(cull)  # disabled
mesh = MeshBrep(
    Brep=srf_2,
    Settings={GridMaxCount=0, GridMinCount=16, JaggedSeams=False, MaxEdgeLength=0, MinEdgeLength=0.0001, MinTolerance=0, Refine=True, RefineAngle=0, RelativeTolerance=0.65, SimplePlanes=True, Tolerance=0})  # disabled
del = DelaunayMesh(Points=pt_4, Plane=PlaneXY(0, 0, 0))  # disabled
panel_11 = Panel("10000")  # disabled
quad = Quadrangulate(Mesh=del, Angle=0.03490658504, Ratio=0.875)  # -> Mesh, Count; disabled
rdlines = RemoveDuplicateLinesKaramba3D(Line=llinter.LineSubSegments, LimitDistance=0.005)  # -> OutLine, Info, Indexes; disabled
number_slider = Slider(1.2, range=0..10)  # disabled
number_slider_2 = Slider(0.9, range=0..1)  # disabled
number_slider_3 = Slider(100000, range=0..100000)  # disabled
line = Line(rdlines.OutLine)  # disabled
len = Length(Curve=line)  # disabled
pt_5 = Point(merge_3)  # disabled
pt_6 = Point([Point(163.5400008, 48.10000076, 16.1), Point(163.5400008, 57.72000076, 16.1), Point(173.1600008, 48.10000076, 20.1), Point(173.1600008, 57.72000076, 20.1)])  # disabled
toggle_8 = BooleanToggle(True)  # disabled
mc = MeshCorners(Mesh=quad.Mesh, Angle=2.35619449)  # disabled
mc_2 = MeshCorners(Mesh=mesh, Angle=2.35619449)  # disabled
number_slider_4 = Slider(1.2, range=0..10)  # disabled
points = PointList(Points=pt_5, Size=number_slider)  # disabled
multiplication = Multiplication(A=len, B=number_slider_2)  # disabled
pline = PolyLine(Vertices=mc, Closed=False)  # disabled
wbnaked = WeaverbirdsNakedBoundary(MeshClosedPolylines=mesh)
anchorxyz = AnchorXYZ(Point=pt_3, X=toggle_8, Y=toggle_8, Z=False, Strength=number_slider_3)  # disabled
length_line = LengthLine(Line=line, Length=multiplication, Strength=10)  # disabled
anchor = Anchor(Point=pt_5, Target=pt_6, Strength=10000)  # disabled
alongcrv = SortAlongCurve(Points=mc_2, Curve=pline)  # -> Points, Indices; disabled
points_2 = PointList(Points=mc, Size=number_slider_4)  # disabled
points_3 = PointList(Points=alongcrv.Points, Size=number_slider_4)  # disabled
splitatcorners = SplitAtCorners(Poly=wbnaked, Angle=1)  # -> Corners, Parts; disabled
number_slider_5 = Slider(1.2, range=0..10)  # disabled
onmesh = OnMesh(Points=pt_4, Mesh=mesh, Strength=panel_11)  # disabled
anchor_2 = Anchor(Point=mc, Target=alongcrv.Points, Strength=10000)  # disabled
midpt = CurveMiddle(Curve=splitatcorners.Parts)  # disabled
points_4 = PointList(Points=midpt, Size=number_slider_5)  # disabled
show = Show(G=pt_4)  # disabled
entwine_2 = Entwine(
    Branch00=length_line,
    Branch01=anchor,
    Branch02=anchor_2,
    Branch03=onmesh,
    Branch04=show,
    Branch05=anchorxyz,
    FlattenInputs=True)  # disabled
zombiesolver = ZombieSolver(GoalObjects=entwine_2, Threshold=1e-10, Tolerance=0.0001, MaxIterations=50000)  # -> I, V, O; disabled
pt_7 = Point(zombiesolver.V)  # disabled
pt_8 = Point(pt_6)  # disabled
unflatten = UnflattenTree(Tree=zombiesolver.O, Guide=entwine_2)  # disabled

# ---- group: TRANSFORM+GEOMETRY
panel_12 = Panel("""0
2""")  # disabled
item_2 = ListItem(List=splitatcorners.Parts, Index=panel_12, Wrap=True)  # disabled

# ----
panel_13 = Panel("C:\Users\Juste\Documents\_GitHub\MAS-2526\llhil-t2-fabrication\design\structure_model\data\Exchange Files\Files_In\_working\out_lines.json")
list_2 = ValueList({"members", "linear", "point_loads", "boundary", "joints", "areas", "all"}, selected="all")
crv_6 = Curve([<curve referenced from the Rhino model> x4])
srf_3 = Surface(<surface referenced from the Rhino model>)
pt_9 = Point([<point referenced from the Rhino model> x48])
pt_10 = Point([<point referenced from the Rhino model> x8])

# ---- group: INPUT LINE MODEL
json_importer = Python3Script(
    Model=panel_13,
    preview_geometry=Toggle(False),
    preview_kind=list_2,
    LineGuidProxies=crv_6,
    area_geometry=srf_3,
    point_load_guid_proxies=pt_9,
    boundary_guid_proxies=pt_10)  # -> out, ImportJson, MemberLines, AreaLoadMeshes, LinearLoadLines, PointLoadPoints, JointNodes, BoundaryPoints, PreviewGeometry; inputs LineGuidProxies: list of Curve, area_geometry: Surface, point_load_guid_proxies: list of Point3d, boundary_guid_proxies: list of Point3d
# ---------- json_importer: Python ----------
# Minimal Input Cheat-Sheet (Importer)
# - GH input names: model (or Model)
#   (can be a parsed JSON object/list OR a file path string to JSON)
# - Optional GH preview toggle:
#     preview_geometry (aliases: PreviewGeometry, BuildPreviewGeometry) -> default false
# - Optional GH area auto-mesh toggle (preview path):
#     auto_mesh_areas (aliases: AutoMeshAreas, AutoMeshAreaLoads) -> default true
# - Optional GH proxy / geometry inputs:
#     curve_guid_proxies      (alias: LineGuidProxies)      -> linear load line filtering
#     area_geometry           (aliases: AreaGeometry, AreaMeshes, AreaSurfaces) -> area meshes
#     point_load_guid_proxies (alias: PointLoadGuidProxies) -> filters PointLoadPoints (empty when not connected)
#     boundary_guid_proxies   (alias: BoundaryGuidProxies)  -> filters BoundaryPoints (empty when not connected)
# - preview_kind values and their GH input / output correspondence:
#     members     -> (no extra input)              -> MemberLines
#     linear      -> LineGuidProxies               -> LinearLoadLines
#     point_loads -> point_load_guid_proxies       -> PointLoadPoints
#     boundary    -> boundary_guid_proxies         -> BoundaryPoints
#     joints      -> (no extra input)              -> JointNodes
#     areas       -> area_geometry                 -> AreaLoadMeshes
#     all         -> all of the above              -> PreviewGeometry
#               ("all" shows: members + joints + areas; select specific kinds for
#                point_loads/boundary/linear to avoid redundant all-node point clouds)
# - Function call: import_line_model_json(payload=...,
#     curve_guid_proxies=..., point_load_guid_proxies=..., boundary_guid_proxies=...)
# - Minimal runnable input: {}
# - Minimal useful topology input:
#   {"lines": [{"start": [0, 0, 0], "end": [1, 0, 0]}]}
# - Also accepts COMPAS-style root arrays with entries like:
#   {"line": {"data": {"start": [...], "end": [...]}, "guid": "...", "name": "..."}, "type": "..."}
# - GH preferred outputs (compressed):
#   ImportJson, MemberLines, AreaLoadMeshes, LinearLoadLines,
#   PointLoadPoints, BoundaryPoints, JointNodes, out
# - Optional preview bridge output:
#   PreviewGeometry (enable with preview_geometry=true, set preview_kind)
# - Geometry record outputs (for downstream ID→geometry mapping):
#   Vertices (nodes), Edges (edges), Meshes (mesh records)
from __future__ import annotations

import argparse
import json
import sys
from pathlib import Path
from typing import Any, Dict, List, Optional, Tuple

try:
    import Rhino.Geometry as rg  # type: ignore
except Exception:  # pragma: no cover - Rhino is not available in CLI environments.
    rg = None


Point = Tuple[float, float, float]


def _as_point(value: Any) -> Optional[Point]:
    """Convert common point formats into a 3D tuple."""
    if value is None:
        return None

    if isinstance(value, dict):
        if all(axis in value for axis in ("x", "y", "z")):
            try:
                return (float(value["x"]), float(value["y"]), float(value["z"]))
            except (TypeError, ValueError):
                return None

        for key in ("point", "xyz", "coords", "position"):
            if key in value:
                return _as_point(value[key])

        return None

    if isinstance(value, (list, tuple)) and len(value) >= 3:
        try:
            return (float(value[0]), float(value[1]), float(value[2]))
        except (TypeError, ValueError):
            return None

    return None


def _first_point(*candidates: Any) -> Optional[Point]:
    for candidate in candidates:
        point = _as_point(candidate)
        if point is not None:
            return point
    return None


def _line_start_end(line: Dict[str, Any]) -> Tuple[Optional[Point], Optional[Point]]:
    attrs = line.get("attributes") if isinstance(line.get("attributes"), dict) else {}

    start = _first_point(
        line.get("start"),
        line.get("from"),
        line.get("u"),
        line.get("a"),
        line.get("start_point"),
        line.get("startPoint"),
        line.get("start_node"),
        attrs.get("start"),
        attrs.get("start_point"),
        attrs.get("start_node"),
    )

    end = _first_point(
        line.get("end"),
        line.get("to"),
        line.get("v"),
        line.get("b"),
        line.get("end_point"),
        line.get("endPoint"),
        line.get("end_node"),
        attrs.get("end"),
        attrs.get("end_point"),
        attrs.get("end_node"),
    )

    return start, end


def _normalize_item_list(value: Any) -> List[Dict[str, Any]]:
    if value is None:
        return []
    if isinstance(value, list):
        return [item for item in value if isinstance(item, dict)]
    if isinstance(value, dict):
        return [value]
    return []


def _normalize_compas_line_record(item: Dict[str, Any]) -> Dict[str, Any]:
    line = item.get("line") if isinstance(item.get("line"), dict) else {}
    data = line.get("data") if isinstance(line.get("data"), dict) else {}

    attributes: Dict[str, Any] = {}
    if item.get("type") is not None:
        attributes["type"] = item.get("type")
    if line.get("dtype") is not None:
        attributes["dtype"] = line.get("dtype")
    if line.get("name") is not None:
        attributes["source_name"] = line.get("name")

    normalized: Dict[str, Any] = {
        "start": data.get("start"),
        "end": data.get("end"),
        "attributes": attributes,
    }

    if line.get("guid") is not None:
        normalized["guid"] = line.get("guid")
    if line.get("name") is not None:
        normalized["id"] = str(line.get("name"))

    return normalized


def _load_payload_from_path(payload: Any) -> Any:
    # GH may pass path-like values that are not strict Python str instances.
    if payload is None:
        return payload

    if not isinstance(payload, (dict, list, tuple)):
        candidate = str(payload).strip()
        if (
            len(candidate) >= 2
            and ((candidate[0] == '"' and candidate[-1] == '"') or (candidate[0] == "'" and candidate[-1] == "'"))
        ):
            candidate = candidate[1:-1].strip()
        if candidate:
            # Allow direct JSON text passed from a panel.
            if candidate.startswith("{") or candidate.startswith("["):
                try:
                    return json.loads(candidate)
                except Exception:
                    pass

            path = Path(candidate)
            if path.is_file():
                with open(path, "r", encoding="utf-8") as stream:
                    return json.load(stream)
    return payload


def _normalize_input_payload(payload: Any) -> Dict[str, Any]:
    if isinstance(payload, list):
        lines: List[Dict[str, Any]] = []
        for item in payload:
            if not isinstance(item, dict):
                continue
            if isinstance(item.get("line"), dict):
                lines.append(_normalize_compas_line_record(item))
            else:
                lines.append(item)
        return {"lines": lines}

    if not isinstance(payload, dict):
        raise ValueError("Input JSON root must be an object or list.")

    normalized = dict(payload)
    for key in ("lines", "edges", "members", "segments"):
        items = normalized.get(key)
        if not isinstance(items, list):
            continue
        normalized[key] = [
            _normalize_compas_line_record(item) if isinstance(item, dict) and isinstance(item.get("line"), dict) else item
            for item in items
        ]
    return normalized


def _extract_vertices(payload: Dict[str, Any]) -> List[Dict[str, Any]]:
    for key in ("vertices", "nodes", "points"):
        if key in payload:
            return _normalize_item_list(payload.get(key))
    return []


def _extract_edges(payload: Dict[str, Any]) -> List[Dict[str, Any]]:
    for key in ("edges", "lines", "members", "segments"):
        if key in payload:
            return _normalize_item_list(payload.get(key))
    return []


def _extract_lines_only(payload: Dict[str, Any]) -> List[Dict[str, Any]]:
    for key in ("lines", "members", "edges", "segments"):
        items = _normalize_item_list(payload.get(key))
        if items:
            return items
    return []


def _extract_meshes(payload: Dict[str, Any]) -> List[Dict[str, Any]]:
    for key in ("meshes", "areas", "faces", "panels"):
        if key in payload:
            return _normalize_item_list(payload.get(key))
    return []


def _edge_or_node_guid(item: Dict[str, Any]) -> Optional[str]:
    attrs = item.get("attributes") if isinstance(item.get("attributes"), dict) else {}
    for key in (
        "guid",
        "rhino_guid",
        "proxy_guid",
        "point_guid",
        "pt_guid",
        "curve_guid",
        "line_guid",
        "area_guid",
        "mesh_guid",
    ):
        value = item.get(key)
        if value not in (None, ""):
            return str(value)
        attr_value = attrs.get(key)
        if attr_value not in (None, ""):
            return str(attr_value)
    return None


def _resolve_filtered_node_ids(
    value: Any, guid_map: Dict[str, str]
) -> Optional[List[str]]:
    """Resolve a GUID proxy input to a filtered list of node IDs.

    Returns None when no input is provided, so the caller can fall back to all
    node IDs. Supports:
    - list of GUID strings -> looked up in guid_map
    - dict {guid: node_id} -> node_id used directly (guid_map as fallback)
    - list of {guid, id} dicts -> id value used directly
    """
    if value is None:
        return None

    node_ids: List[str] = []

    if isinstance(value, dict):
        for guid, node_id in value.items():
            if guid in (None, ""):
                continue
            resolved = str(node_id) if node_id not in (None, "") else guid_map.get(str(guid))
            if resolved:
                node_ids.append(resolved)
        return node_ids if node_ids else None

    if isinstance(value, (list, tuple)):
        for item in value:
            if isinstance(item, str) and item:
                resolved = guid_map.get(item)
                if resolved:
                    node_ids.append(resolved)
            elif isinstance(item, dict):
                guid = item.get("guid") or item.get("proxy_guid")
                node_id = item.get("id") or item.get("target_id") or item.get("node_id")
                if node_id not in (None, ""):
                    node_ids.append(str(node_id))
                elif guid and str(guid) in guid_map:
                    node_ids.append(guid_map[str(guid)])
        return node_ids if node_ids else None

    return None


def _has_connected_filter_input(value: Any) -> bool:
    """Return True when a GH input is connected with a non-empty value."""
    if value is None:
        return False
    if isinstance(value, str):
        return value.strip() != ""
    if isinstance(value, (list, tuple)):
        return any(_has_connected_filter_input(item) for item in value)
    if isinstance(value, dict):
        return len(value) > 0
    return True


def _has_guid_like_filter_input(value: Any) -> bool:
    """Return True when input can be interpreted as GUID->ID filter data."""
    if value is None:
        return False
    if isinstance(value, str):
        return value.strip() != ""
    if isinstance(value, dict):
        return len(value) > 0
    if isinstance(value, (list, tuple)):
        for item in value:
            if isinstance(item, str) and item.strip() != "":
                return True
            if isinstance(item, dict) and len(item) > 0:
                return True
        return False
    return False


def _resolve_edge_ids_from_rhino_curves(
    value: Any,
    edge_records: List[Dict[str, Any]],
    nodes: List[Dict[str, Any]],
    *,
    tol: float = 1e-3,
) -> Optional[List[str]]:
    """Match Rhino Curve objects to edge IDs using distance-based endpoint matching.

    For each input curve, finds the nearest model node within *tol* distance for
    both endpoints, then looks up the edge connecting those two nodes.
    Returns None when value is None or contains no Rhino Curve instances.
    """
    if rg is None or value is None:
        return None

    items = list(value) if isinstance(value, (list, tuple)) else [value]
    curve_items: List[Any] = []
    for item in items:
        curve = _try_coerce_rhino_curve(item)
        if curve is not None:
            curve_items.append(curve)
    if not curve_items:
        return None

    # Flat list of (x, y, z, node_id) for nearest-neighbour search.
    node_coords: List[Tuple[float, float, float, str]] = []
    for node in nodes:
        xyz = _point_from_node_record(node)
        if xyz is not None:
            node_coords.append((xyz[0], xyz[1], xyz[2], str(node.get("id", ""))))

    if not node_coords:
        return None

    tol2 = tol * tol

    def _nearest_node_id(px: float, py: float, pz: float) -> Optional[str]:
        best_id: Optional[str] = None
        best_d2 = tol2
        for nx, ny, nz, nid in node_coords:
            d2 = (nx - px) ** 2 + (ny - py) ** 2 + (nz - pz) ** 2
            if d2 < best_d2:
                best_d2 = d2
                best_id = nid
        return best_id

    # Bidirectional lookup: (start_node_id, end_node_id) -> edge_id.
    edge_lookup: Dict[Tuple[str, str], str] = {}
    for edge in edge_records:
        sn = str(edge.get("start_node", ""))
        en = str(edge.get("end_node", ""))
        eid = str(edge.get("id", ""))
        if sn and en and eid:
            edge_lookup[(sn, en)] = eid
            edge_lookup[(en, sn)] = eid

    matched: List[str] = []
    seen: set = set()

    # First pass: exact node-to-node matching (fast path for simple line proxies).
    for crv in curve_items:
        ps = crv.PointAtStart
        pe = crv.PointAtEnd
        sn_id = _nearest_node_id(float(ps.X), float(ps.Y), float(ps.Z))
        en_id = _nearest_node_id(float(pe.X), float(pe.Y), float(pe.Z))
        if sn_id is None or en_id is None or sn_id == en_id:
            continue
        eid = edge_lookup.get((sn_id, en_id))
        if eid is not None and eid not in seen:
            matched.append(eid)
            seen.add(eid)

    # Second pass: perimeter/polycurve matching.
    # Include any edge whose start/end nodes lie on at least one input proxy curve.
    n_index = _node_index(nodes)
    for edge in edge_records:
        eid = str(edge.get("id", ""))
        if not eid or eid in seen:
            continue
        sn = n_index.get(str(edge.get("start_node", "")))
        en = n_index.get(str(edge.get("end_node", "")))
        if not sn or not en:
            continue
        a = _point_from_node_record(sn)
        b = _point_from_node_record(en)
        if a is None or b is None:
            continue

        pa = rg.Point3d(a[0], a[1], a[2])
        pb = rg.Point3d(b[0], b[1], b[2])
        for crv in curve_items:
            ok_a, ta = crv.ClosestPoint(pa)
            if not ok_a:
                continue
            qa = crv.PointAt(ta)
            if qa.DistanceTo(pa) > tol:
                continue

            ok_b, tb = crv.ClosestPoint(pb)
            if not ok_b:
                continue
            qb = crv.PointAt(tb)
            if qb.DistanceTo(pb) > tol:
                continue

            # Guard against both endpoints collapsing to the same curve parameter.
            if abs(float(tb) - float(ta)) <= 1e-9 and pa.DistanceTo(pb) > tol:
                continue

            matched.append(eid)
            seen.add(eid)
            break

    return matched if matched else None


def _resolve_node_ids_from_rhino_points(
    value: Any,
    nodes: List[Dict[str, Any]],
    *,
    tol: float = 1e-3,
) -> Optional[List[str]]:
    """Match Rhino Point3d objects to node IDs using distance-based nearest-neighbour search.

    Returns None when value is None or contains no Rhino Point3d instances.
    """
    if rg is None or value is None:
        return None

    items = list(value) if isinstance(value, (list, tuple)) else [value]
    point_items: List[Any] = []
    for item in items:
        if isinstance(item, rg.Point3d):
            point_items.append(item)
        elif isinstance(item, rg.Point):
            point_items.append(item.Location)
    if not point_items:
        return None

    node_coords: List[Tuple[float, float, float, str]] = []
    for node in nodes:
        xyz = _point_from_node_record(node)
        if xyz is not None:
            node_coords.append((xyz[0], xyz[1], xyz[2], str(node.get("id", ""))))

    if not node_coords:
        return None

    tol2 = tol * tol
    matched: List[str] = []
    seen: set = set()
    for pt in point_items:
        px, py, pz = float(pt.X), float(pt.Y), float(pt.Z)
        best_id: Optional[str] = None
        best_d2 = tol2
        for nx, ny, nz, nid in node_coords:
            d2 = (nx - px) ** 2 + (ny - py) ** 2 + (nz - pz) ** 2
            if d2 < best_d2:
                best_d2 = d2
                best_id = nid
        if best_id is not None and best_id not in seen:
            matched.append(best_id)
            seen.add(best_id)
    return matched if matched else None


def _build_linear_edges_from_curve_proxies(
    value: Any,
    nodes: List[Dict[str, Any]],
    edge_records: List[Dict[str, Any]],
    *,
    decimals: int = 6,
    tol: float = 1e-3,
) -> Optional[List[str]]:
    """Create/update linear edge records from proxy-curve segmentation.

    Returns None when no usable curve proxies are present.
    Returns [] when proxies are present but no segments can be resolved to nodes.
    """
    if rg is None or value is None:
        return None

    items = list(value) if isinstance(value, (list, tuple)) else [value]
    curve_items: List[Any] = []
    for item in items:
        curve = _try_coerce_rhino_curve(item)
        if curve is not None:
            curve_items.append(curve)
    if not curve_items:
        return None

    tol2 = tol * tol

    node_coords: List[Tuple[float, float, float, str]] = []
    for node in nodes:
        xyz = _point_from_node_record(node)
        nid = str(node.get("id", ""))
        if xyz is not None and nid:
            node_coords.append((xyz[0], xyz[1], xyz[2], nid))

    if not node_coords:
        return []

    def _nearest_node_id(px: float, py: float, pz: float) -> Optional[str]:
        best_id: Optional[str] = None
        best_d2 = tol2
        for nx, ny, nz, nid in node_coords:
            d2 = (nx - px) ** 2 + (ny - py) ** 2 + (nz - pz) ** 2
            if d2 < best_d2:
                best_d2 = d2
                best_id = nid
        return best_id

    pair_to_edge: Dict[Tuple[str, str], str] = {}
    existing_ids: set = set()
    for edge in edge_records:
        eid = str(edge.get("id", ""))
        sn = str(edge.get("start_node", ""))
        en = str(edge.get("end_node", ""))
        if not eid or not sn or not en:
            continue
        pair_to_edge[tuple(sorted((sn, en)))] = eid
        existing_ids.add(eid)

    def _new_edge_id() -> str:
        idx = 1
        while True:
            candidate = "LP{}".format(idx)
            if candidate not in existing_ids:
                existing_ids.add(candidate)
                return candidate
            idx += 1

    linear_ids: List[str] = []
    seen_linear: set = set()
    for crv in curve_items:
        for a, b in _segment_curve_by_neighbor_nodes(crv, nodes, decimals=decimals, snap_tol=tol):
            sn = _nearest_node_id(a[0], a[1], a[2])
            en = _nearest_node_id(b[0], b[1], b[2])
            if sn is None or en is None or sn == en:
                continue

            pair = tuple(sorted((sn, en)))
            eid = pair_to_edge.get(pair)
            if eid is None:
                eid = _new_edge_id()
                pair_to_edge[pair] = eid
                edge_records.append(
                    {
                        "id": eid,
                        "start_node": sn,
                        "end_node": en,
                        "attributes": {
                            "generated": "linear_proxy_segment",
                        },
                    }
                )

            if eid not in seen_linear:
                linear_ids.append(eid)
                seen_linear.add(eid)

    return linear_ids


def _coerce_proxy_map(value: Any) -> Dict[str, str]:
    result: Dict[str, str] = {}
    if isinstance(value, dict):
        for key, map_value in value.items():
            if key in (None, "") or map_value in (None, ""):
                continue
            result[str(key)] = str(map_value)
        return result

    if isinstance(value, list):
        for item in value:
            if not isinstance(item, dict):
                continue
            guid = item.get("guid") or item.get("proxy_guid")
            target_id = item.get("id") or item.get("target_id")
            if guid in (None, "") or target_id in (None, ""):
                continue
            result[str(guid)] = str(target_id)
    return result


def _to_bool(value: Any, default: bool = False) -> bool:
    if value is None:
        return default
    if isinstance(value, bool):
        return value
    if isinstance(value, (int, float)):
        return value != 0
    if isinstance(value, str):
        text = value.strip().lower()
        if text in ("1", "true", "yes", "y", "on"):
            return True
        if text in ("0", "false", "no", "n", "off", ""):
            return False
    return default


def _point_from_node_record(node: Dict[str, Any]) -> Optional[Point]:
    try:
        return (float(node.get("x", 0.0)), float(node.get("y", 0.0)), float(node.get("z", 0.0)))
    except (TypeError, ValueError):
        return None


def _points_are_close(a: Point, b: Point, tol: float) -> bool:
    return abs(a[0] - b[0]) <= tol and abs(a[1] - b[1]) <= tol and abs(a[2] - b[2]) <= tol


def _dedupe_sorted_scalars(values: List[float], tol: float) -> List[float]:
    if not values:
        return []

    ordered = sorted(float(value) for value in values)
    unique = [ordered[0]]
    for value in ordered[1:]:
        if abs(value - unique[-1]) > tol:
            unique.append(value)
    return unique


def _face_relation_is_exterior(relation: Any) -> bool:
    if relation is None:
        return True

    text = str(relation).lower()
    if "exterior" in text:
        return True
    if "interior" in text or "inside" in text or "boundary" in text:
        return False

    try:
        return int(relation) == 0
    except Exception:
        return False


def _closest_face_uv(face: Any, point: Any, *, tol: float) -> Optional[Tuple[float, float]]:
    try:
        closest = face.ClosestPoint(point)
    except Exception:
        return None

    if not isinstance(closest, tuple):
        return None

    ok = True
    if len(closest) >= 3 and isinstance(closest[0], bool):
        ok = bool(closest[0])
        if not ok:
            return None
        u = float(closest[1])
        v = float(closest[2])
    elif len(closest) >= 2:
        u = float(closest[0])
        v = float(closest[1])
    else:
        return None

    projected = face.PointAt(u, v)
    if projected.DistanceTo(point) > tol:
        return None
    if _face_relation_is_exterior(face.IsPointOnFace(u, v)):
        return None
    return (u, v)


def _collect_face_seed_parameters(face: Any, nodes: List[Dict[str, Any]], *, tol: float) -> List[Tuple[float, float]]:
    if rg is None:
        return []

    seeds: List[Tuple[float, float]] = []
    face_brep = None
    try:
        face_brep = face.DuplicateFace(False)
    except Exception:
        face_brep = None

    if face_brep is not None:
        for vertex in face_brep.Vertices:
            uv = _closest_face_uv(face, vertex.Location, tol=tol)
            if uv is not None:
                seeds.append(uv)

    for node in nodes:
        xyz = _point_from_node_record(node)
        if xyz is None:
            continue
        uv = _closest_face_uv(face, rg.Point3d(xyz[0], xyz[1], xyz[2]), tol=tol)
        if uv is not None:
            seeds.append(uv)

    return seeds


def _build_node_aware_mesh_for_face(face: Any, nodes: List[Dict[str, Any]], *, tol: float) -> Optional[Any]:
    if rg is None:
        return None

    seeds = _collect_face_seed_parameters(face, nodes, tol=tol)
    if not seeds:
        return None

    uv_tol = 1e-9
    u_values = _dedupe_sorted_scalars([u for u, _ in seeds], uv_tol)
    v_values = _dedupe_sorted_scalars([v for _, v in seeds], uv_tol)
    if len(u_values) < 2 or len(v_values) < 2:
        return None

    mesh = rg.Mesh()
    vertex_index_by_key: Dict[Tuple[float, float, float], int] = {}

    def _vertex_index(u: float, v: float) -> Optional[int]:
        if _face_relation_is_exterior(face.IsPointOnFace(u, v)):
            return None

        point = face.PointAt(u, v)
        key = (round(float(point.X), 9), round(float(point.Y), 9), round(float(point.Z), 9))
        existing = vertex_index_by_key.get(key)
        if existing is not None:
            return existing

        index = mesh.Vertices.Add(float(point.X), float(point.Y), float(point.Z))
        vertex_index_by_key[key] = index
        return index

    for ui in range(len(u_values) - 1):
        u0 = u_values[ui]
        u1 = u_values[ui + 1]
        if abs(u1 - u0) <= uv_tol:
            continue

        for vi in range(len(v_values) - 1):
            v0 = v_values[vi]
            v1 = v_values[vi + 1]
            if abs(v1 - v0) <= uv_tol:
                continue

            center_u = 0.5 * (u0 + u1)
            center_v = 0.5 * (v0 + v1)
            if _face_relation_is_exterior(face.IsPointOnFace(center_u, center_v)):
                continue

            indices: List[int] = []
            for corner_u, corner_v in ((u0, v0), (u1, v0), (u1, v1), (u0, v1)):
                index = _vertex_index(corner_u, corner_v)
                if index is None:
                    indices = []
                    break
                indices.append(index)

            if not indices:
                continue

            ordered_unique: List[int] = []
            for index in indices:
                if index not in ordered_unique:
                    ordered_unique.append(index)

            if len(ordered_unique) == 3:
                mesh.Faces.AddFace(ordered_unique[0], ordered_unique[1], ordered_unique[2])
            elif len(ordered_unique) == 4:
                mesh.Faces.AddFace(ordered_unique[0], ordered_unique[1], ordered_unique[2], ordered_unique[3])

    if mesh.Vertices.Count == 0 or mesh.Faces.Count == 0:
        return None

    mesh.Normals.ComputeNormals()
    mesh.Compact()
    return mesh


def _build_node_aware_meshes_from_brep(
    brep: Any,
    nodes: Optional[List[Dict[str, Any]]],
    *,
    tol: float,
) -> List[Any]:
    if rg is None or brep is None or not nodes:
        return []

    meshes: List[Any] = []
    for face in brep.Faces:
        mesh = _build_node_aware_mesh_for_face(face, nodes, tol=tol)
        if mesh is not None:
            meshes.append(mesh)
    return meshes


def _try_coerce_rhino_geometry(value: Any) -> Optional[Any]:
    if rg is None or value is None:
        return None

    # Direct RhinoCommon geometry object (GH object input path).
    if isinstance(value, (rg.Mesh, rg.Brep, rg.Surface)):
        return value

    # Optional: decode simple JSON geometry when available.
    if isinstance(value, dict):
        encoded = value.get("rhino") or value.get("rhino_json") or value.get("rhinoJson")
        if isinstance(encoded, str) and encoded:
            try:
                return rg.GeometryBase.FromJSON(encoded)
            except Exception:
                return None

    return None


def _try_coerce_rhino_curve(value: Any) -> Optional[Any]:
    if rg is None or value is None:
        return None

    # GH wrapper objects often expose underlying Rhino geometry via Value/ScriptVariable.
    wrapped = getattr(value, "Value", None)
    if wrapped is not None and wrapped is not value:
        coerced = _try_coerce_rhino_curve(wrapped)
        if coerced is not None:
            return coerced

    script_var = getattr(value, "ScriptVariable", None)
    if callable(script_var):
        try:
            sv = script_var()
        except Exception:
            sv = None
        if sv is not None and sv is not value:
            coerced = _try_coerce_rhino_curve(sv)
            if coerced is not None:
                return coerced

    if isinstance(value, rg.Curve):
        return value
    if isinstance(value, rg.Line):
        return rg.LineCurve(value)

    geo = _try_coerce_rhino_geometry(value)
    if geo is None:
        return None
    if isinstance(geo, rg.Curve):
        return geo
    if isinstance(geo, rg.Line):
        return rg.LineCurve(geo)
    return None


def _extract_curve_from_edge(raw_edge: Dict[str, Any]) -> Optional[Any]:
    attrs = raw_edge.get("attributes") if isinstance(raw_edge.get("attributes"), dict) else {}
    candidates = [
        raw_edge.get("curve"),
        raw_edge.get("line"),
        raw_edge.get("geometry"),
        raw_edge.get("rhino_curve"),
        attrs.get("curve"),
        attrs.get("line"),
        attrs.get("geometry"),
        attrs.get("rhino_curve"),
    ]

    for candidate in candidates:
        curve = _try_coerce_rhino_curve(candidate)
        if curve is not None:
            return curve
    return None


def _segment_curve_by_neighbor_nodes(
    curve: Any,
    nodes: List[Dict[str, Any]],
    *,
    decimals: int,
    snap_tol: Optional[float] = None,
) -> List[Tuple[Point, Point]]:
    if rg is None:
        return []

    dedup_tol = max(10.0 ** (-decimals), 1e-6)
    _snap_tol = snap_tol if snap_tol is not None else dedup_tol
    t0 = float(curve.Domain.T0)
    t1 = float(curve.Domain.T1)
    start = curve.PointAtStart
    end = curve.PointAtEnd

    candidates: List[Tuple[float, Point]] = [
        (t0, (float(start.X), float(start.Y), float(start.Z))),
        (t1, (float(end.X), float(end.Y), float(end.Z))),
    ]

    for node in nodes:
        xyz = _point_from_node_record(node)
        if xyz is None:
            continue

        test_pt = rg.Point3d(xyz[0], xyz[1], xyz[2])
        ok, t = curve.ClosestPoint(test_pt)
        if not ok:
            continue

        on_curve = curve.PointAt(t)
        if on_curve.DistanceTo(test_pt) <= _snap_tol:
            candidates.append((float(t), xyz))

    # Sort by curve parameter and remove near-duplicates.
    candidates.sort(key=lambda item: item[0])
    ordered: List[Point] = []
    last_t: Optional[float] = None
    for t, xyz in candidates:
        if last_t is not None and abs(t - last_t) <= dedup_tol:
            continue
        if ordered:
            prev = ordered[-1]
            if abs(prev[0] - xyz[0]) <= dedup_tol and abs(prev[1] - xyz[1]) <= dedup_tol and abs(prev[2] - xyz[2]) <= dedup_tol:
                last_t = t
                continue
        ordered.append(xyz)
        last_t = t

    segments: List[Tuple[Point, Point]] = []
    for idx in range(len(ordered) - 1):
        a = ordered[idx]
        b = ordered[idx + 1]
        if abs(a[0] - b[0]) <= dedup_tol and abs(a[1] - b[1]) <= dedup_tol and abs(a[2] - b[2]) <= dedup_tol:
            continue
        segments.append((a, b))
    return segments


def _meshes_from_area_payload(
    raw_area: Dict[str, Any],
    *,
    nodes: Optional[List[Dict[str, Any]]] = None,
    tol: float = 1e-3,
) -> List[Any]:
    if rg is None:
        return []

    sources = [
        raw_area.get("mesh"),
        raw_area.get("geometry"),
        raw_area.get("brep"),
        raw_area.get("surface"),
    ]

    out_meshes: List[Any] = []
    for source in sources:
        geo = _try_coerce_rhino_geometry(source)
        if geo is None:
            continue

        if isinstance(geo, rg.Mesh):
            out_meshes.append(geo)
            continue

        brep = None
        if isinstance(geo, rg.Brep):
            brep = geo
        elif isinstance(geo, rg.Surface):
            try:
                brep = geo.ToBrep()
            except Exception:
                brep = None

        if brep is None:
            continue

        seeded_meshes = _build_node_aware_meshes_from_brep(brep, nodes, tol=tol)
        if seeded_meshes:
            out_meshes.extend(seeded_meshes)
            continue

        try:
            parts = rg.Mesh.CreateFromBrep(brep, rg.MeshingParameters.FastRenderMesh)
        except Exception:
            parts = None

        if not parts:
            continue

        for part in parts:
            if part is not None and part.Vertices.Count > 0 and part.Faces.Count > 0:
                out_meshes.append(part)

    return out_meshes


def _mesh_record_to_rhino_meshes(
    raw_mesh: Dict[str, Any],
    *,
    auto_mesh_areas: bool,
    nodes: Optional[List[Dict[str, Any]]] = None,
) -> List[Any]:
    if rg is None:
        return []

    vertices = raw_mesh.get("vertices") if isinstance(raw_mesh.get("vertices"), list) else None
    faces = raw_mesh.get("faces") if isinstance(raw_mesh.get("faces"), list) else None
    if vertices and faces:
        rh_mesh = rg.Mesh()
        valid = True
        for vertex in vertices:
            pt = _as_point(vertex)
            if pt is None:
                valid = False
                break
            rh_mesh.Vertices.Add(pt[0], pt[1], pt[2])
        if not valid:
            return []

        for face in faces:
            if not isinstance(face, (list, tuple)):
                continue
            try:
                idx = [int(i) for i in face]
            except (TypeError, ValueError):
                continue
            if len(idx) == 3:
                rh_mesh.Faces.AddFace(idx[0], idx[1], idx[2])
            elif len(idx) >= 4:
                rh_mesh.Faces.AddFace(idx[0], idx[1], idx[2], idx[3])

        if rh_mesh.Vertices.Count > 0 and rh_mesh.Faces.Count > 0:
            rh_mesh.Normals.ComputeNormals()
            rh_mesh.Compact()
            return [rh_mesh]
        return []

    if auto_mesh_areas:
        return _meshes_from_area_payload(raw_mesh, nodes=nodes)
    return []


def _build_area_mesh_geometry(
    meshes: List[Dict[str, Any]],
    *,
    auto_mesh_areas: bool = True,
    nodes: Optional[List[Dict[str, Any]]] = None,
) -> List[Any]:
    mesh_geometry: List[Any] = []
    for mesh in meshes:
        mesh_geometry.extend(_mesh_record_to_rhino_meshes(mesh, auto_mesh_areas=auto_mesh_areas, nodes=nodes))
    return mesh_geometry


def _build_area_mesh_geometry_from_input(
    value: Any,
    *,
    auto_mesh_areas: bool = True,
    nodes: Optional[List[Dict[str, Any]]] = None,
) -> List[Any]:
    """Convert direct GH area geometry input into Rhino meshes."""
    if value is None:
        return []

    if isinstance(value, (list, tuple)):
        items = list(value)
    else:
        items = [value]

    mesh_records: List[Dict[str, Any]] = []
    for item in items:
        if item is None:
            continue

        if isinstance(item, dict):
            record: Dict[str, Any] = {}
            for key in ("vertices", "faces", "mesh", "geometry", "brep", "surface"):
                if key in item and item.get(key) is not None:
                    record[key] = item.get(key)
            if record:
                mesh_records.append(record)
            continue

        geo = _try_coerce_rhino_geometry(item)
        if geo is None:
            continue

        if rg is not None and isinstance(geo, rg.Mesh):
            mesh_records.append({"mesh": geo})
        elif rg is not None and isinstance(geo, rg.Brep):
            mesh_records.append({"brep": geo})
        elif rg is not None and isinstance(geo, rg.Surface):
            mesh_records.append({"surface": geo})

    return _build_area_mesh_geometry(mesh_records, auto_mesh_areas=auto_mesh_areas, nodes=nodes)


def _node_index(nodes: List[Dict[str, Any]]) -> Dict[str, Dict[str, Any]]:
    return {str(node.get("id")): node for node in nodes if node.get("id") not in (None, "")}


def _edge_index(edges: List[Dict[str, Any]]) -> Dict[str, Dict[str, Any]]:
    return {str(edge.get("id")): edge for edge in edges if edge.get("id") not in (None, "")}


def _point_geometry_from_node_ids(node_ids: List[str], nodes: List[Dict[str, Any]]) -> List[Any]:
    if rg is None:
        return []

    index = _node_index(nodes)
    out: List[Any] = []
    for node_id in node_ids:
        node = index.get(str(node_id))
        if not node:
            continue
        xyz = _point_from_node_record(node)
        if xyz is None:
            continue
        out.append(rg.Point3d(xyz[0], xyz[1], xyz[2]))
    return out


def _dedupe_node_ids_by_position(
    node_ids: List[str],
    nodes: List[Dict[str, Any]],
    *,
    tol: float = 1e-6,
) -> List[str]:
    """Return node IDs deduplicated by spatial position.

    This avoids creating overlapping supports/loads when multiple node IDs share
    the same coordinates.
    """
    if not node_ids:
        return []

    index = _node_index(nodes)
    unique_ids: List[str] = []
    unique_xyz: List[Point] = []

    for node_id in node_ids:
        node = index.get(str(node_id))
        if not node:
            continue
        xyz = _point_from_node_record(node)
        if xyz is None:
            continue

        duplicate = False
        for ux, uy, uz in unique_xyz:
            if abs(xyz[0] - ux) <= tol and abs(xyz[1] - uy) <= tol and abs(xyz[2] - uz) <= tol:
                duplicate = True
                break
        if duplicate:
            continue

        unique_ids.append(str(node_id))
        unique_xyz.append(xyz)

    return unique_ids


def _line_geometry_from_edge_ids(edge_ids: List[str], edges: List[Dict[str, Any]], nodes: List[Dict[str, Any]]) -> List[Any]:
    if rg is None:
        return []

    n_index = _node_index(nodes)
    e_index = _edge_index(edges)
    out: List[Any] = []

    for edge_id in edge_ids:
        edge = e_index.get(str(edge_id))
        if not edge:
            continue

        start_node = n_index.get(str(edge.get("start_node", "")))
        end_node = n_index.get(str(edge.get("end_node", "")))
        if not start_node or not end_node:
            continue

        a = _point_from_node_record(start_node)
        b = _point_from_node_record(end_node)
        if a is None or b is None:
            continue
        out.append(rg.LineCurve(rg.Point3d(a[0], a[1], a[2]), rg.Point3d(b[0], b[1], b[2])))

    return out


def _extract_input_proxy_maps(payload: Dict[str, Any]) -> Dict[str, Dict[str, str]]:
    proxies = {
        "pt": {},
        "curve": {},
        "area": {},
    }

    nested = payload.get("guid_proxies") if isinstance(payload.get("guid_proxies"), dict) else {}

    point_sources = [
        payload.get("pt_guid_proxies"),
        payload.get("pt_guid_proxy"),
        payload.get("point_guid_proxies"),
        payload.get("point_guid_proxy"),
        nested.get("pt"),
        nested.get("points"),
    ]
    curve_sources = [
        payload.get("curve_guid_proxies"),
        payload.get("curve_guid_proxy"),
        payload.get("line_guid_proxies"),
        payload.get("line_guid_proxy"),
        nested.get("curve"),
        nested.get("curves"),
        nested.get("lines"),
    ]
    area_sources = [
        payload.get("area_guid_proxies"),
        payload.get("area_guid_proxy"),
        payload.get("mesh_guid_proxies"),
        payload.get("mesh_guid_proxy"),
        nested.get("area"),
        nested.get("areas"),
        nested.get("meshes"),
    ]

    for source in point_sources:
        proxies["pt"].update(_coerce_proxy_map(source))
    for source in curve_sources:
        proxies["curve"].update(_coerce_proxy_map(source))
    for source in area_sources:
        proxies["area"].update(_coerce_proxy_map(source))

    return proxies


def import_line_model_json(
    payload: Any,
    *,
    decimals: int = 6,
    node_prefix: str = "N",
    edge_prefix: str = "E",
    mesh_prefix: str = "M",
    pt_guid_proxies: Any = None,
    curve_guid_proxies: Any = None,
    area_guid_proxies: Any = None,
    point_load_guid_proxies: Any = None,
    boundary_guid_proxies: Any = None,
) -> Dict[str, Any]:
    """Normalize line-model JSON into deduplicated vertices/edges and analysis target lists."""
    payload = _load_payload_from_path(payload)
    payload = _normalize_input_payload(payload)
    vertices = _extract_vertices(payload)
    edges = _extract_edges(payload)
    meshes = _extract_meshes(payload)
    input_proxies = _extract_input_proxy_maps(payload)
    # Explicit proxy inputs override/extend proxies embedded in the model payload.
    input_proxies["pt"].update(_coerce_proxy_map(pt_guid_proxies))
    input_proxies["curve"].update(_coerce_proxy_map(curve_guid_proxies))
    input_proxies["area"].update(_coerce_proxy_map(area_guid_proxies))

    # Fallback for models that only contain lines with embedded start/end node data.
    if not vertices and not edges:
        edges = _extract_lines_only(payload)

    node_by_key: Dict[Tuple[float, float, float], str] = {}
    node_records: List[Dict[str, Any]] = []
    point_guid_proxy: Dict[str, str] = dict(input_proxies["pt"])
    node_merge_tol = max(10.0 ** (-decimals), 1e-5)

    def ensure_node_id(point: Point) -> str:
        # First pass: tolerant weld to collapse near-coincident endpoints to a shared node ID.
        for node in node_records:
            xyz = _point_from_node_record(node)
            if xyz is not None and _points_are_close(point, xyz, node_merge_tol):
                return str(node["id"])

        # Second pass: exact rounded-key lookup for deterministic IDs.
        rounded = (round(point[0], decimals), round(point[1], decimals), round(point[2], decimals))
        existing = node_by_key.get(rounded)
        if existing is not None:
            return existing

        node_id = f"{node_prefix}{len(node_records) + 1}"
        node_by_key[rounded] = node_id
        node_records.append(
            {
                "id": node_id,
                "x": rounded[0],
                "y": rounded[1],
                "z": rounded[2],
            }
        )
        return node_id

    source_vertex_id_to_new: Dict[str, str] = {}
    for vertex in vertices:
        point = _first_point(vertex, vertex.get("point"), vertex.get("xyz"), vertex.get("coords"))
        if point is None:
            continue
        new_id = ensure_node_id(point)
        source_id = vertex.get("id")
        if source_id is not None:
            source_vertex_id_to_new[str(source_id)] = new_id
        vertex_guid = _edge_or_node_guid(vertex)
        if vertex_guid is not None:
            point_guid_proxy[vertex_guid] = new_id

    edge_records: List[Dict[str, Any]] = []
    segmented_edge_ids: List[str] = []
    seen_edge_pairs: Dict[Tuple[str, str], str] = {}
    curve_guid_proxy: Dict[str, str] = dict(input_proxies["curve"])

    for raw_edge in edges:
        attrs = raw_edge.get("attributes") if isinstance(raw_edge.get("attributes"), dict) else {}
        from_curve_segmentation = False

        start_id = None
        end_id = None

        for key in ("start_node_id", "start_node", "u", "from", "a"):
            value = raw_edge.get(key)
            if value is not None and str(value) in source_vertex_id_to_new:
                start_id = source_vertex_id_to_new[str(value)]
                break
        for key in ("end_node_id", "end_node", "v", "to", "b"):
            value = raw_edge.get(key)
            if value is not None and str(value) in source_vertex_id_to_new:
                end_id = source_vertex_id_to_new[str(value)]
                break

        segment_node_pairs: List[Tuple[str, str]] = []

        if start_id is not None and end_id is not None and start_id != end_id:
            segment_node_pairs.append((start_id, end_id))
        else:
            start_point, end_point = _line_start_end(raw_edge)

            if (start_point is None or end_point is None) and rg is not None:
                curve = _extract_curve_from_edge(raw_edge)
                if curve is not None:
                    curve_segments = _segment_curve_by_neighbor_nodes(curve, node_records, decimals=decimals)
                    if len(curve_segments) > 1:
                        from_curve_segmentation = True
                    for seg_start, seg_end in curve_segments:
                        seg_start_id = ensure_node_id(seg_start)
                        seg_end_id = ensure_node_id(seg_end)
                        if seg_start_id != seg_end_id:
                            segment_node_pairs.append((seg_start_id, seg_end_id))

            if not segment_node_pairs:
                if start_id is None and start_point is not None:
                    start_id = ensure_node_id(start_point)
                if end_id is None and end_point is not None:
                    end_id = ensure_node_id(end_point)
                if start_id is not None and end_id is not None and start_id != end_id:
                    segment_node_pairs.append((start_id, end_id))

        if not segment_node_pairs:
            continue

        preserved_attrs = {k: v for k, v in attrs.items() if k not in ("start", "end", "start_node", "end_node")}

        for seg_start_id, seg_end_id in segment_node_pairs:
            pair = tuple(sorted((seg_start_id, seg_end_id)))
            if pair in seen_edge_pairs:
                continue

            edge_id = f"{edge_prefix}{len(edge_records) + 1}"
            seen_edge_pairs[pair] = edge_id

            edge_record = {
                "id": edge_id,
                "start_node": seg_start_id,
                "end_node": seg_end_id,
                "attributes": preserved_attrs,
            }

            source_edge_id = raw_edge.get("id")
            if source_edge_id is not None:
                edge_record["source_id"] = source_edge_id

            if "cross_sections" in raw_edge:
                edge_record["cross_sections"] = raw_edge["cross_sections"]
            elif "cross_sections" in attrs:
                edge_record["cross_sections"] = attrs.get("cross_sections")

            edge_records.append(edge_record)
            if from_curve_segmentation:
                segmented_edge_ids.append(edge_id)

            edge_guid = _edge_or_node_guid(raw_edge)
            if edge_guid is not None:
                curve_guid_proxy[edge_guid] = edge_id

    node_by_id: Dict[str, Dict[str, Any]] = {node["id"]: node for node in node_records}
    connected_edges_by_node: Dict[str, List[str]] = {}
    for edge in edge_records:
        start_node = str(edge["start_node"])
        end_node = str(edge["end_node"])
        connected_edges_by_node.setdefault(start_node, []).append(str(edge["id"]))
        connected_edges_by_node.setdefault(end_node, []).append(str(edge["id"]))

    joint_records: List[Dict[str, Any]] = []
    for node_id, connected_edges in sorted(connected_edges_by_node.items()):
        # A joint is a node where at least two member lines meet.
        unique_edges = sorted(set(connected_edges))
        if len(unique_edges) < 2:
            continue

        node = node_by_id.get(node_id, {})
        joint_records.append(
            {
                "id": f"J{len(joint_records) + 1}",
                "node_id": node_id,
                "x": node.get("x"),
                "y": node.get("y"),
                "z": node.get("z"),
                "connected_edges": unique_edges,
                "degree": len(unique_edges),
            }
        )

    mesh_records: List[Dict[str, Any]] = []
    area_guid_proxy: Dict[str, str] = dict(input_proxies["area"])
    for raw_mesh in meshes:
        mesh_id = f"{mesh_prefix}{len(mesh_records) + 1}"
        attrs = raw_mesh.get("attributes") if isinstance(raw_mesh.get("attributes"), dict) else {}
        preserved_attrs = {k: v for k, v in attrs.items() if k not in ("guid", "rhino_guid", "area_guid", "mesh_guid")}

        mesh_record = {
            "id": mesh_id,
            "attributes": preserved_attrs,
        }

        for key in ("vertices", "faces", "mesh", "geometry", "brep", "surface"):
            if key in raw_mesh:
                mesh_record[key] = raw_mesh[key]

        source_mesh_id = raw_mesh.get("id")
        if source_mesh_id is not None:
            mesh_record["source_id"] = source_mesh_id

        mesh_records.append(mesh_record)

        mesh_guid = _edge_or_node_guid(raw_mesh)
        if mesh_guid is not None:
            area_guid_proxy[mesh_guid] = mesh_id

    member_line_ids = [edge["id"] for edge in edge_records]
    area_mesh_ids = [mesh["id"] for mesh in mesh_records]
    point_ids = [node["id"] for node in node_records]

    _curve_filter_connected = _has_guid_like_filter_input(curve_guid_proxies)
    _pl_filter_connected = _has_guid_like_filter_input(point_load_guid_proxies)
    _bp_filter_connected = _has_guid_like_filter_input(boundary_guid_proxies)

    # Resolve explicitly tagged GUID inputs to filtered node ID lists.
    # Point-load/boundary lists are opt-in and remain empty when no proxy input is provided.
    _pl_ids = _resolve_filtered_node_ids(point_load_guid_proxies, point_guid_proxy)
    _bp_ids = _resolve_filtered_node_ids(boundary_guid_proxies, point_guid_proxy)
    # Filter linear load lines by curve GUID proxies when provided; falls back to all member edges.
    _ll_ids = _resolve_filtered_node_ids(curve_guid_proxies, curve_guid_proxy)

    _linear_output_ids = _ll_ids if _curve_filter_connected else list(member_line_ids)
    if _curve_filter_connected and _linear_output_ids is None:
        _linear_output_ids = []

    _point_output_ids = _pl_ids if _pl_filter_connected else []
    if _pl_filter_connected and _point_output_ids is None:
        _point_output_ids = []
    _point_output_ids = _dedupe_node_ids_by_position(
        list(_point_output_ids), node_records, tol=node_merge_tol
    )

    _boundary_output_ids = _bp_ids if _bp_filter_connected else []
    if _bp_filter_connected and _boundary_output_ids is None:
        _boundary_output_ids = []

    # Boundary supports should be unique by position, not only by node ID.
    _boundary_output_ids = _dedupe_node_ids_by_position(
        list(_boundary_output_ids), node_records, tol=node_merge_tol
    )

    _joint_output_ids = _dedupe_node_ids_by_position(
        [joint["node_id"] for joint in joint_records], node_records, tol=node_merge_tol
    )

    return {
        "schema": "structure_model_v1",
        "nodes": node_records,
        "edges": edge_records,
        "meshes": mesh_records,
        "joints": joint_records,
        "output_lists": {
            "member_lines": member_line_ids,
            "area_load_meshes": area_mesh_ids,
            "linear_load_lines": list(_linear_output_ids),
            "segmented_linear_load_lines": list(segmented_edge_ids),
            "point_load_points": list(_point_output_ids),
            "boundary_points": list(_boundary_output_ids),
            "joint_nodes": list(_joint_output_ids),
        },
        "guid_proxies": {
            "pt": dict(sorted(point_guid_proxy.items())),
            "curve": dict(sorted(curve_guid_proxy.items())),
            "area": dict(sorted(area_guid_proxy.items())),
        },
        "metadata": {
            "input_nodes": len(vertices),
            "input_edges": len(edges),
            "input_meshes": len(meshes),
            "output_nodes": len(node_records),
            "output_edges": len(edge_records),
            "output_meshes": len(mesh_records),
            "output_joints": len(joint_records),
            "segmented_edge_count": len(segmented_edge_ids),
            "deduplicated_nodes": max(0, len(vertices) - len(node_records)),
            "deduplicated_edges": max(0, len(edges) - len(edge_records)),
        },
    }


def as_output_lists(model: Any) -> Dict[str, List[str]]:
    """Return GH-friendly validation lists from the normalized import payload."""
    payload = import_line_model_json(model)
    lists = payload.get("output_lists", {})
    return {
        "MemberLines": list(lists.get("member_lines", [])),
        "AreaLoadMeshes": list(lists.get("area_load_meshes", [])),
        "LinearLoadLines": list(lists.get("linear_load_lines", [])),
        "SegmentedLinearLoadLines": list(lists.get("segmented_linear_load_lines", [])),
        "PointLoadPoints": list(lists.get("point_load_points", [])),
        "BoundaryPoints": list(lists.get("boundary_points", [])),
        "JointNodes": list(lists.get("joint_nodes", [])),
    }


def _read_json(path: str) -> Any:
    with open(path, "r", encoding="utf-8") as stream:
        return json.load(stream)


def _write_json(path: str, payload: Dict[str, Any]) -> None:
    with open(path, "w", encoding="utf-8") as stream:
        json.dump(payload, stream, indent=2)


def _build_parser() -> argparse.ArgumentParser:
    parser = argparse.ArgumentParser(description="Normalize line model JSON into nodes/edges/meshes with IDs.")
    parser.add_argument("--input", required=True, help="Path to source JSON file.")
    parser.add_argument("--output", required=True, help="Path to normalized JSON output file.")
    parser.add_argument("--decimals", type=int, default=6, help="Rounding precision for vertex deduplication.")
    parser.add_argument("--node-prefix", default="N", help="Node ID prefix.")
    parser.add_argument("--edge-prefix", default="E", help="Edge ID prefix.")
    parser.add_argument("--mesh-prefix", default="M", help="Mesh ID prefix.")
    return parser


def main() -> None:
    parser = _build_parser()
    args = parser.parse_args()

    source = _read_json(args.input)
    normalized = import_line_model_json(
        source,
        decimals=args.decimals,
        node_prefix=args.node_prefix,
        edge_prefix=args.edge_prefix,
        mesh_prefix=args.mesh_prefix,
    )
    _write_json(args.output, normalized)


# GH Py3 auto-run block: input `model` (or `Model`) -> JSON payload + validation lists.
_g = globals()

# Preferred compact list outputs.
ImportJson = "{}"
MemberLines = []
AreaLoadMeshes = []
LinearLoadLines = []
PointLoadPoints = []
BoundaryPoints = []
JointNodes = []
out = "Waiting for Model input."

# Geometry record outputs (for downstream ID→geometry mapping).
Vertices = []
Edges = []
Meshes = []
PreviewGeometry = []


def _get_first_input(globals_dict: Dict[str, Any], names: List[str]) -> Any:
    for name in names:
        if name in globals_dict:
            return globals_dict.get(name)
    return None


if "model" in _g or "Model" in _g:
    _model_input = _get_first_input(_g, ["model", "Model"])
    if _model_input in (None, ""):
        out = "Model input is empty. Provide a JSON path or parsed JSON object/list."
    else:
        try:
            _curve_proxies = _get_first_input(_g, ["curve_guid_proxies", "CurveGuidProxies", "LineGuidProxies"])
            _pl_proxies = _get_first_input(_g, ["point_load_guid_proxies", "PointLoadGuidProxies"])
            _bp_proxies = _get_first_input(_g, ["boundary_guid_proxies", "BoundaryGuidProxies"])
            _preview_enabled = _to_bool(
                _get_first_input(_g, ["preview_geometry", "PreviewGeometry", "BuildPreviewGeometry"]),
                default=False,
            )
            _preview_kind_raw = _get_first_input(
                _g,
                ["preview_kind", "PreviewKind", "PreviewTarget", "PreviewSource"],
            )
            _preview_kind = str(_preview_kind_raw).strip().lower() if _preview_kind_raw not in (None, "") else "members"
            _auto_mesh_areas = _to_bool(
                _get_first_input(_g, ["auto_mesh_areas", "AutoMeshAreas", "AutoMeshAreaLoads"]),
                default=True,
            )
            _area_geometry_input = _get_first_input(_g, ["area_geometry", "AreaGeometry", "AreaMeshes", "AreaSurfaces"])

            _import_payload = import_line_model_json(
                _model_input,
                curve_guid_proxies=_curve_proxies,
                point_load_guid_proxies=_pl_proxies,
                boundary_guid_proxies=_bp_proxies,
            )
            _summary_payload = {
                "schema": _import_payload.get("schema", "structure_model_v1"),
                "metadata": dict(_import_payload.get("metadata", {})),
                "output_list_counts": {
                    "member_lines": len(_import_payload.get("output_lists", {}).get("member_lines", [])),
                    "area_load_meshes": len(_import_payload.get("output_lists", {}).get("area_load_meshes", [])),
                    "linear_load_lines": len(_import_payload.get("output_lists", {}).get("linear_load_lines", [])),
                    "point_load_points": len(_import_payload.get("output_lists", {}).get("point_load_points", [])),
                    "boundary_points": len(_import_payload.get("output_lists", {}).get("boundary_points", [])),
                    "joint_nodes": len(_import_payload.get("output_lists", {}).get("joint_nodes", [])),
                },
            }
            ImportJson = json.dumps(_summary_payload, separators=(",", ":"))

            # Compressed list-first outputs.
            _lists = _import_payload.get("output_lists", {})
            _member_line_ids = list(_lists.get("member_lines", []))
            AreaLoadMeshes = list(_lists.get("area_load_meshes", []))
            _segmented_linear_ids = list(_lists.get("segmented_linear_load_lines", []))
            _linear_line_ids = _segmented_linear_ids if _segmented_linear_ids else list(_lists.get("linear_load_lines", []))
            _point_node_ids = list(_lists.get("point_load_points", []))
            _boundary_node_ids = list(_lists.get("boundary_points", []))
            _joint_node_ids = list(_lists.get("joint_nodes", []))

            # Default outputs (CLI/no-Rhino fallback): ID lists.
            MemberLines = list(_member_line_ids)
            LinearLoadLines = list(_linear_line_ids)
            PointLoadPoints = list(_point_node_ids)
            BoundaryPoints = list(_boundary_node_ids)
            JointNodes = list(_joint_node_ids)

            # Raw geometry records for downstream ID→geometry mapping.
            _nodes = list(_import_payload.get("nodes", []))
            _edges = list(_import_payload.get("edges", []))
            _meshes = list(_import_payload.get("meshes", []))
            Vertices = _nodes
            Edges = _edges
            Meshes = _meshes
            PreviewGeometry = []

            # Ensure solver-facing point lists are unique per spatial location.
            _runtime_dedupe_tol = 1e-5
            _point_node_ids = _dedupe_node_ids_by_position(_point_node_ids, _nodes, tol=_runtime_dedupe_tol)
            _boundary_node_ids = _dedupe_node_ids_by_position(_boundary_node_ids, _nodes, tol=_runtime_dedupe_tol)
            _joint_node_ids = _dedupe_node_ids_by_position(_joint_node_ids, _nodes, tol=_runtime_dedupe_tol)

            # Keep fallback ID outputs synchronized with deduplicated IDs.
            PointLoadPoints = list(_point_node_ids)
            BoundaryPoints = list(_boundary_node_ids)
            JointNodes = list(_joint_node_ids)

            # Geometry-based proxy resolution: when GH curve proxies are connected,
            # generate perimeter linear edges by segmenting those curves against model nodes.
            if rg is not None:
                _generated_linear_ids = _build_linear_edges_from_curve_proxies(
                    _curve_proxies, _nodes, _edges, decimals=6
                )
                if _generated_linear_ids is not None:
                    _linear_line_ids = _generated_linear_ids
                elif _has_guid_like_filter_input(_curve_proxies):
                    # Connected GUID-like filter with no matches should not fall back to all members.
                    _linear_line_ids = []

                _rhino_pl = _resolve_node_ids_from_rhino_points(_pl_proxies, _nodes)
                if _rhino_pl is not None:
                    _point_node_ids = _rhino_pl
                _rhino_bp = _resolve_node_ids_from_rhino_points(_bp_proxies, _nodes)
                if _rhino_bp is not None:
                    _boundary_node_ids = _rhino_bp

                # Re-apply positional deduplication after Rhino-proxy overrides.
                _point_node_ids = _dedupe_node_ids_by_position(_point_node_ids, _nodes, tol=_runtime_dedupe_tol)
                _boundary_node_ids = _dedupe_node_ids_by_position(_boundary_node_ids, _nodes, tol=_runtime_dedupe_tol)
                _joint_node_ids = _dedupe_node_ids_by_position(_joint_node_ids, _nodes, tol=_runtime_dedupe_tol)

                # GH-facing outputs should be geometry for direct Karamba compatibility.
                MemberLines = _line_geometry_from_edge_ids(_member_line_ids, _edges, _nodes)
                LinearLoadLines = _line_geometry_from_edge_ids(_linear_line_ids, _edges, _nodes)
                PointLoadPoints = _point_geometry_from_node_ids(_point_node_ids, _nodes)
                BoundaryPoints = _point_geometry_from_node_ids(_boundary_node_ids, _nodes)
                JointNodes = _point_geometry_from_node_ids(_joint_node_ids, _nodes)

            # Publish potentially augmented edges (includes generated linear proxy segments).
            Edges = _edges

            # AreaLoadMeshes: actual Rhino Mesh objects built from JSON mesh records and/or
            # area_geometry input (surfaces/breps). Runs unconditionally so the output is usable
            # without enabling preview. Falls back to string IDs when rg is unavailable (CLI).
            if rg is not None:
                _area_geo_built = _build_area_mesh_geometry(
                    _meshes, auto_mesh_areas=_auto_mesh_areas, nodes=_nodes
                )
                _area_geo_built += _build_area_mesh_geometry_from_input(
                    _area_geometry_input, auto_mesh_areas=_auto_mesh_areas, nodes=_nodes
                )
                AreaLoadMeshes = _area_geo_built
            else:
                AreaLoadMeshes = list(_lists.get("area_load_meshes", []))

            # Optional single-stream preview geometry for Custom Preview.
            if _preview_enabled and rg is not None:
                _preview_items: List[Any] = []

                _kind = _preview_kind
                if _kind in ("member", "member_line", "member_lines"):
                    _kind = "members"
                elif _kind in ("area", "area_load", "area_loads"):
                    _kind = "areas"
                elif _kind in ("linear", "linear_load", "linear_loads", "linear_load_lines", "lines", "load_lines"):
                    _kind = "linear"
                elif _kind in ("point", "point_load", "point_loads", "point_load_points"):
                    _kind = "point_loads"
                elif _kind in ("boundary", "boundary_point", "boundary_points"):
                    _kind = "boundary"
                elif _kind in ("joint", "joint_node", "joint_nodes"):
                    _kind = "joints"
                elif _kind not in ("members", "areas", "linear", "point_loads", "boundary", "joints", "all"):
                    _kind = "members"

                if _kind in ("members", "all"):
                    _preview_items.extend(_line_geometry_from_edge_ids(_member_line_ids, _edges, _nodes))

                # "linear" is a filtered subset of members — shown on its own, not duplicated in "all".
                if _kind == "linear":
                    _preview_items.extend(_line_geometry_from_edge_ids(_linear_line_ids, _edges, _nodes))

                # point_loads / boundary are opt-in and remain empty unless their proxy input is connected.
                if _kind == "point_loads":
                    _preview_items.extend(_point_geometry_from_node_ids(_point_node_ids, _nodes))

                if _kind == "boundary":
                    _preview_items.extend(_point_geometry_from_node_ids(_boundary_node_ids, _nodes))

                if _kind in ("joints", "all"):
                    _preview_items.extend(_point_geometry_from_node_ids(_joint_node_ids, _nodes))

                if _kind in ("areas", "all"):
                    _preview_items.extend(AreaLoadMeshes)

                PreviewGeometry = _preview_items

            if _preview_enabled:
                out = (
                    "Imported -> members: {}, areas: {}, linear: {}, load pts: {}, boundary: {}, joints: {} | preview({}): {}"
                ).format(
                    len(MemberLines),
                    len(AreaLoadMeshes),
                    len(LinearLoadLines),
                    len(PointLoadPoints),
                    len(BoundaryPoints),
                    len(JointNodes),
                    _preview_kind,
                    len(PreviewGeometry),
                )
            else:
                out = (
                    "Imported -> members: {}, areas: {}, linear: {}, load pts: {}, boundary: {}, joints: {}"
                ).format(
                    len(MemberLines),
                    len(AreaLoadMeshes),
                    len(LinearLoadLines),
                    len(PointLoadPoints),
                    len(BoundaryPoints),
                    len(JointNodes),
                )
        except Exception as ex:
            ImportJson = json.dumps(
                {
                    "schema": "structure_model_v1",
                    "error": str(ex),
                    "model_input_type": type(_model_input).__name__ if "_model_input" in locals() else "unknown",
                },
                separators=(",", ":"),
            )
            AreaLoadMeshes = []
            LinearLoadLines = []
            PointLoadPoints = []
            BoundaryPoints = []
            JointNodes = []
            out = "Import failed: {}".format(ex)


if __name__ == "__main__" and any(arg.startswith("--input") for arg in sys.argv[1:]):
    main()
# ---------- end json_importer ----------
# ----
preview = CustomPreview(
    Geometry=json_importer.PreviewGeometry,
    Material={diffuse=RGB(221, 160, 221), emission=RGB(66, 48, 66), shine=0.5, specular=RGB(255, 255, 255), transparency=0})
panel_14 = Panel(json_importer.ImportJson)

# ---- group: MATERIAL PROPERTIES / CLT
matselect = MaterialSelectionKaramba3D(menu=[dropdown(1), dropdown(4), dropdown(11)])
crosec = CrossSectionKaramba3D(FamilyNameOfCrossSection="DefaultCroSec", Material=matselect, Height_cm=Slider(6, range=0..100), mode="Shell - Const")
surfelem = CreateSurfaceElementKaramba3D(Mesh=json_importer.AreaLoadMeshes, CrossSection=crosec, LimitDistance_m=0.005, Bending=True, mode="MeshToShell")  # -> Element, Points, Info

# ---- group: MATERIAL PROPERTIES / TIMBER
matselect_2 = MaterialSelectionKaramba3D(menu=[dropdown(1), dropdown(4), dropdown(11)])
number_slider_6 = Slider(14, range=0..100)
crosec_2 = CrossSectionKaramba3D(
    FamilyNameOfCrossSection="DefaultCroSec",
    Material=matselect_2,
    Height_cm=Slider(14, range=0..100),
    UpperFlangeWidth_cm=number_slider_6,
    LowerFlangeWidth_cm=number_slider_6,
    UpperFlangeThickness_cm=0.4,
    LowerFlangeThickness_cm=0.4,
    SidewallsThickness_cm=0.4,
    FilletRadius_cm=0.6,
    mode="Box")
lineelem = CreateLinearElementKaramba3D(
    Line=json_importer.MemberLines,
    CrossSection=crosec_2,
    LimitDistance_m=0.005,
    BucklingLengthY_m=-1,
    BucklingLengthZ_m=-1,
    BucklingLengthLT_m=-1,
    Bending=True,
    ToPolylineMaxAngle=0.25,
    ToPolylineTolerance=0.1,
    ToPolylineMaxEdgeLength=0.25,
    New=True,
    Remove=True,
    mode="LineToBeam",
    GuidGeneratorSeed=480624077)  # -> Element, Points, Info

# ----
merge_5 = Merge(Data1=surfelem.Element, Data2=lineelem.Element)  # -> flatten(Result)
element = ElementKaramba3D(merge_5)

# ---- group: JOINT & BOUNDARY CONDITIONS / JOINT CONDITION
number_slider_7 = Slider(2000, range=0..20000)
number_slider_8 = Slider(2000, range=0..20000)
vec = VectorXYZ(XComponent=number_slider_7, YComponent=number_slider_7, ZComponent=number_slider_7)  # -> Vector, Length
vec_2 = VectorXYZ(XComponent=number_slider_8, YComponent=number_slider_8, ZComponent=number_slider_8)  # -> Vector, Length
beam_joints = BeamJointsKaramba3D(
    BeamIdentifier=json_importer.MemberLines,
    CtKNMAtStartingNode=Vector(0, 0, 0),
    CrKNmRadAtStartingNode=vec.Vector,
    CtKNMAtEndNode=Vector(0, 0, 0),
    CrKNmRadAtEndNode=vec_2.Vector,
    menu=[buttons(off, off, off, on, on, on), buttons(off, off, off, on, on, on)])

# ---- group: JOINT & BOUNDARY CONDITIONS / BOUNDARY CONDITIONS
xy = XYPlane(Origin=Point(0, 0, 0))
supp = SupportKaramba3D(
    PosInd=json_importer.BoundaryPoints,
    PlaneOfReference=xy,
    Ct_kN_m=Vector(0, 0, 0),
    Cr_kNm_rad=Vector(0, 0, 0),
    menu=[buttons(on, on, on, on, on, on)])

# ----
# MEMBER SIZING/
# OPTIMIZATION
number_slider_9 = Slider(40, range=0..40)
number_slider_10 = Slider(20, range=0..100)
number_slider_11 = Slider(12, range=0..100)
number_slider_12 = Slider(16, range=0..100)
matselect_3 = MaterialSelectionKaramba3D(menu=[dropdown(1), dropdown(4), dropdown(11)])
series = Series(Start=number_slider_10, Step=Slider(4, range=0..10), Count=number_slider_9)
series_2 = Series(Start=number_slider_11, Step=Slider(4, range=0..10), Count=Slider(30, range=0..30))
series_3 = Series(Start=number_slider_12, Step=Slider(4, range=0..10), Count=Slider(30, range=0..30))
panel_15 = Panel(series)
panel_16 = Panel(series_3)
panel_17 = Panel(series_2)
crosec_3 = CrossSectionKaramba3D(
    FamilyNameOfCrossSection="DefaultCroSec",
    Material=matselect_3,
    Height_cm=series,
    UpperFlangeWidth_cm=number_slider_10,
    LowerFlangeWidth_cm=number_slider_10,
    mode="Trapezoid")
crosec_4 = CrossSectionKaramba3D(
    FamilyNameOfCrossSection="DefaultCroSec",
    Material=matselect_3,
    Height_cm=series_2,
    UpperFlangeWidth_cm=number_slider_11,
    LowerFlangeWidth_cm=number_slider_11,
    UpperFlangeThickness_cm=0.4,
    LowerFlangeThickness_cm=0.4,
    SidewallsThickness_cm=0.4,
    FilletRadius_cm=0.6,
    mode="Box")
crosec_5 = CrossSectionKaramba3D(
    FamilyNameOfCrossSection="DefaultCroSec",
    Material=matselect_3,
    Height_cm=series_3,
    UpperFlangeWidth_cm=number_slider_12,
    LowerFlangeWidth_cm=number_slider_12,
    UpperFlangeThickness_cm=0.4,
    LowerFlangeThickness_cm=0.4,
    SidewallsThickness_cm=0.4,
    FilletRadius_cm=0.6,
    mode="Box")
merge_6 = Merge(Data1=crosec_4, Data2=crosec_5, Data3=crosec_3)
crosec_6 = CrossSectionKaramba3D(merge_6)

list_3 = ValueList({"DL_T": -0.5, "DL_FD": -9, "LL": -1.5, "WL_X": -1.1, "WL_Y": -1.1, "SL": -1.1}, selected="DL_T")
list_4 = ValueList({"DL_T", "DL_FD", "LL", "WL_X", "WL_Y", "SL"}, selected="SL")
list_5 = ValueList({"DL_T", "DL_FD", "LL", "WL_X", "WL_Y", "SL"}, selected="DL_FD")
Z = UnitZ(Factor=list_3)
list_6 = ValueList({"DL_T", "DL_FD", "LL", "WL_X", "WL_Y", "SL"}, selected="LL")

# ---- group: KARAMBA_MODEL SET UP
number_slider_13 = Slider(2000, range=0..20000)  # disabled
number_slider_14 = Slider(2000, range=0..20000)  # disabled
vec_3 = VectorXYZ(XComponent=number_slider_13, YComponent=number_slider_13, ZComponent=number_slider_13)  # -> Vector, Length; disabled
vec_4 = VectorXYZ(XComponent=number_slider_14, YComponent=number_slider_14, ZComponent=number_slider_14)  # -> Vector, Length; disabled

# ---- group: LOADING CONDITIONS / LOAD CHECKS / LOAD COMBINATIONS / DEAD&LIVE LOAD FACTORS
dlf = Slider(1.35, range=0..10)
llf = Slider(1.5, range=0..10)
llf_rf = Slider(1.05, range=0..10)
clf = Slider(1.6, range=0..10)

# ---- group: LOADING CONDITIONS / LOAD CHECKS / LOAD COMBINATIONS / WIND LOAD FACTORS
wlf_0 = Slider(1.05, range=0..10)
wlf_1 = Slider(1.5, range=0..10)
wlf_2 = Slider(1, range=0..10)
wlf_3 = Slider(0.94, range=0..10)
wlf_4 = Slider(0.6, range=0..10)
wlf_5 = Slider(0.5, range=0..10)

# ---- group: LOADING CONDITIONS / LOAD CHECKS / LOAD COMBINATIONS / SNOW LOAD FACTORS
slf_1 = Slider(0.94, range=0..10)
slf_2 = Slider(1.5, range=0..10)
slf_3 = Slider(1, range=0..10)
slf_4 = Slider(0.75, range=0..10)

# ----
list_7 = ValueList({"ULSMode", "LLFDriven"}, selected="LLFDriven")

# ---- group: LOADING CONDITIONS / LOAD CHECKS / LOAD COMBINATIONS
load_combinations = Python3Script(
    mode=list_7,
    DLF=dlf,
    LLF=llf,
    LLF_rf=llf_rf,
    CLF=clf,
    WLF_0=wlf_0,
    WLF_1=wlf_1,
    WLF_2=wlf_2,
    WLF_3=wlf_3,
    WLF_4=wlf_4,
    WLF_5=wlf_5,
    SLF_1=slf_1,
    SLF_2=slf_2,
    SLF_3=slf_3,
    SLF_4=slf_4)  # -> out, ComboNames, ComboEquations; inputs mode: String
# ---------- load_combinations: Python ----------
from __future__ import annotations

from dataclasses import dataclass
from typing import Dict, Iterable, List, Tuple


TermMap = Dict[str, float]


@dataclass
class LoadFactors:
    # Dead + live factors
    DLF: float = 1.35
    LLF: float = 1.50
    LLF_rf: float = 1.05
    CLF: float = 1.60

    # Wind factors
    WLF_0: float = 1.05
    WLF_1: float = 1.50
    WLF_2: float = 1.00
    WLF_3: float = 0.94
    WLF_4: float = 0.60
    WLF_5: float = 0.50

    # Snow factors
    SLF_1: float = 0.94
    SLF_2: float = 1.50
    SLF_3: float = 1.00
    SLF_4: float = 0.75


@dataclass
class LoadDesignators:
    DL_T: str = "DL_T"
    DL_FD: str = "DL_FD"
    LL: str = "LL"
    WL_X: str = "WL_X"
    WL_Y: str = "WL_Y"
    SL: str = "SL"


def _to_string_list(value: object) -> List[str]:
    if value is None:
        return []

    if isinstance(value, str):
        text = value.replace("\r", "\n")
        for token in [",", ";", "\t"]:
            text = text.replace(token, "\n")
        return [part.strip() for part in text.split("\n") if part.strip()]

    if isinstance(value, Iterable):
        out: List[str] = []
        for item in value:
            if item is None:
                continue
            text = str(item).strip()
            if text:
                out.append(text)
        return out

    text = str(value).strip()
    return [text] if text else []


def _resolve_designators_from_loads(loads: object, base: LoadDesignators) -> LoadDesignators:
    """Allow GH list/dict load input to override default load-case designators.

    Supported formats:
    - Dict with keys: DL_T, DL_FD, LL, WL_X, WL_Y, SL
    - List in order: [DL_T, DL_FD, LL, WL_X, WL_Y, SL]
    - List with key-value tokens: ["DL_T=LC1", "WL_X=LC4", ...]
    """
    if loads is None:
        return base

    default_map = {
        "DL_T": base.DL_T,
        "DL_FD": base.DL_FD,
        "LL": base.LL,
        "WL_X": base.WL_X,
        "WL_Y": base.WL_Y,
        "SL": base.SL,
    }

    if isinstance(loads, dict):
        for key in default_map.keys():
            value = loads.get(key)
            if value is not None and str(value).strip():
                default_map[key] = str(value).strip()
        return LoadDesignators(**default_map)

    tokens = _to_string_list(loads)
    if not tokens:
        return base

    has_key_value = any("=" in token or ":" in token for token in tokens)
    if has_key_value:
        for token in tokens:
            if "=" in token:
                raw_key, raw_value = token.split("=", 1)
            elif ":" in token:
                raw_key, raw_value = token.split(":", 1)
            else:
                continue
            key = raw_key.strip().upper()
            value = raw_value.strip()
            if key in default_map and value:
                default_map[key] = value
        return LoadDesignators(**default_map)

    ordered_keys = ["DL_T", "DL_FD", "LL", "WL_X", "WL_Y", "SL"]
    for i, token in enumerate(tokens[: len(ordered_keys)]):
        if token:
            default_map[ordered_keys[i]] = token
    return LoadDesignators(**default_map)


def _merge_terms(*term_maps: TermMap) -> TermMap:
    merged: TermMap = {}
    for term_map in term_maps:
        for load_case, value in term_map.items():
            merged[load_case] = merged.get(load_case, 0.0) + float(value)
    return merged


def _normalize_mode(mode: object) -> str:
    if mode is None:
        return "exact_listed"

    if isinstance(mode, bool):
        return "llf_llrf_driven" if mode else "exact_listed"

    if isinstance(mode, (int, float)):
        return "llf_llrf_driven" if float(mode) != 0.0 else "exact_listed"

    text = str(mode).strip().strip('"\'').lower().replace("-", "_").replace(" ", "_")
    compact = text.replace("_", "")
    aliases = {
        "exact": "exact_listed",
        "listed": "exact_listed",
        "exact_listed": "exact_listed",
        "ulsmode": "exact_listed",
        "mode": "exact_listed",
        "false": "exact_listed",
        "0": "exact_listed",
        "off": "exact_listed",
        "llf": "llf_llrf_driven",
        "ll": "llf_llrf_driven",
        "ll_driven": "llf_llrf_driven",
        "ll_driven_mode": "llf_llrf_driven",
        "llf_driven": "llf_llrf_driven",
        "llf_llrf": "llf_llrf_driven",
        "llf_llrf_driven": "llf_llrf_driven",
        "true": "llf_llrf_driven",
        "1": "llf_llrf_driven",
        "on": "llf_llrf_driven",
        "llfdriven": "llf_llrf_driven",
        "use_llf_mode": "llf_llrf_driven",
        "usellfmode": "llf_llrf_driven",
    }
    if text in aliases:
        return aliases[text]
    if compact in aliases:
        return aliases[compact]

    # Fuzzy fallback for ad-hoc labels containing both keywords.
    if "llf" in compact and "driven" in compact:
        return "llf_llrf_driven"

    return "exact_listed"


def _resolve_mode_from_globals(globals_dict: Dict[str, object]) -> str:
    """Resolve mode from GH inputs, preferring any LLF-driven signal.

    This avoids a common GH wiring issue where one port still emits an
    exact-mode label (for example "ULSMode") while another emits
    "LLFDriven".
    """
    candidates = [
        "mode",
        "Mode",
        "ll_driven",
        "LLDriven",
        "llf_driven",
        "LLFDriven",
        "UseLLMode",
        "UseLLFMode",
        "ULSMode",
    ]

    normalized_values: List[str] = []
    for key in candidates:
        if key not in globals_dict:
            continue
        value = globals_dict.get(key)
        if value is None:
            continue
        normalized_values.append(_normalize_mode(value))

    # Any explicit LLF-driven signal wins.
    if any(mode_value == "llf_llrf_driven" for mode_value in normalized_values):
        return "llf_llrf_driven"

    # Otherwise use exact-listed as safe default.
    return "exact_listed"


def _format_expression(terms: TermMap) -> str:
    def lc_sort_key(item: Tuple[str, float]) -> int:
        name = item[0]
        digits = "".join(ch for ch in name if ch.isdigit())
        return int(digits) if digits else 10**9

    ordered = sorted(terms.items(), key=lc_sort_key)
    parts = [f"{coeff:.2f} * {load_case}" for load_case, coeff in ordered if abs(coeff) > 1e-12]
    return " + ".join(parts)


def generate_uls_combinations(
    factors: LoadFactors | None = None,
    designators: LoadDesignators | None = None,
    loads: object = None,
    combo_prefix: str = "ULS_C",
    mode: str = "exact_listed",
) -> List[Dict[str, object]]:
    """Generate load combinations named ULS_C1..ULS_C22.

    The generated pattern follows the shared ULS families with two wind directions.

    Args:
        factors: Numeric factors (defaults match your screenshot values).
        designators: Optional load designators for dead/live/wind/snow labels.
        loads: Optional load designator input (list/dict) from GH.
                combo_prefix: Prefix for the combination names, default "ULS_C".
                mode: Combination generation mode:
                        - "exact_listed": matches the fixed ULS_C1..ULS_C22 list exactly.
                        - "llf_llrf_driven": keeps the same list structure but uses LLF for
                            non-roof cases and LLF_rf for roof/snow-including cases.

    Returns:
        List of dicts with keys: name, terms, expression.
    """
    f = factors or LoadFactors()
    base_designators = designators or LoadDesignators()
    d = _resolve_designators_from_loads(loads, base_designators)
    selected_mode = _normalize_mode(mode)

    if selected_mode == "llf_llrf_driven":
        base_uls = {d.DL_T: f.DLF, d.DL_FD: f.DLF, d.LL: f.LLF}
        base_uls_rf = {d.DL_T: f.DLF, d.DL_FD: f.DLF, d.LL: f.LLF_rf}
        base_clf = {d.DL_T: f.CLF, d.DL_FD: f.CLF, d.LL: f.LLF}
        base_clf_rf = {d.DL_T: f.CLF, d.DL_FD: f.CLF, d.LL: f.LLF_rf}
    else:
        base_uls = {d.DL_T: f.DLF, d.DL_FD: f.DLF, d.LL: f.DLF}
        base_uls_rf = dict(base_uls)
        base_clf = {d.DL_T: f.CLF, d.DL_FD: f.CLF, d.LL: f.CLF}
        base_clf_rf = dict(base_clf)

    base_1 = {d.DL_T: 1.0, d.DL_FD: 1.0, d.LL: 1.0}

    combinations: List[TermMap] = [
        # ULS_C1 .. ULS_C8
        _merge_terms(base_uls),
        _merge_terms(base_uls, {d.WL_X: f.WLF_1}),
        _merge_terms(base_uls, {d.WL_Y: f.WLF_1}),
        _merge_terms(base_uls_rf, {d.WL_X: f.WLF_1, d.SL: f.SLF_1}),
        _merge_terms(base_uls_rf, {d.WL_Y: f.WLF_1, d.SL: f.SLF_1}),
        _merge_terms(base_uls_rf, {d.SL: f.SLF_2}),
        _merge_terms(base_uls_rf, {d.WL_X: f.WLF_4, d.SL: f.SLF_2}),
        _merge_terms(base_uls_rf, {d.WL_Y: f.WLF_4, d.SL: f.SLF_2}),
        # ULS_C9 .. ULS_C16
        _merge_terms(base_clf),
        _merge_terms(base_clf, {d.WL_X: f.WLF_2}),
        _merge_terms(base_clf, {d.WL_Y: f.WLF_2}),
        _merge_terms(base_clf_rf, {d.WL_X: f.WLF_2, d.SL: f.SLF_1}),
        _merge_terms(base_clf_rf, {d.WL_Y: f.WLF_2, d.SL: f.SLF_1}),
        _merge_terms(base_clf_rf, {d.SL: f.SLF_3}),
        _merge_terms(base_clf_rf, {d.WL_X: f.WLF_4, d.SL: f.SLF_3}),
        _merge_terms(base_clf_rf, {d.WL_Y: f.WLF_4, d.SL: f.SLF_3}),
        # ULS_C17 .. ULS_C22
        _merge_terms(base_clf),
        _merge_terms(base_clf, {d.WL_X: f.WLF_5}),
        _merge_terms(base_clf, {d.WL_Y: f.WLF_5}),
        _merge_terms(base_clf_rf, {d.SL: f.SLF_4}),
        _merge_terms(base_clf),
        _merge_terms(base_1),
    ]

    result: List[Dict[str, object]] = []
    for idx, terms in enumerate(combinations, start=1):
        result.append(
            {
                "name": f"{combo_prefix}{idx}",
                "terms": terms,
                "expression": _format_expression(terms),
            }
        )

    return result


def as_expression_list(
    factors: LoadFactors | None = None,
    designators: LoadDesignators | None = None,
    loads: object = None,
    combo_prefix: str = "ULS_C",
    mode: str = "exact_listed",
) -> List[str]:
    """Convenience output: ['ULS_C1 = ...', 'ULS_C2 = ...', ...]."""
    combos = generate_uls_combinations(
        factors=factors,
        designators=designators,
        loads=loads,
        combo_prefix=combo_prefix,
        mode=mode,
    )
    return [f"{combo['name']} = {combo['expression']}" for combo in combos]


def as_rfem_rows(
    factors: LoadFactors | None = None,
    designators: LoadDesignators | None = None,
    loads: object = None,
    combo_prefix: str = "ULS_C",
    mode: str = "exact_listed",
) -> List[List[str]]:
    """RFEM-friendly rows: [[name, expression], ...]."""
    combos = generate_uls_combinations(
        factors=factors,
        designators=designators,
        loads=loads,
        combo_prefix=combo_prefix,
        mode=mode,
    )
    return [[str(combo["name"]), str(combo["expression"])] for combo in combos]


def as_rfem_records(
    factors: LoadFactors | None = None,
    designators: LoadDesignators | None = None,
    loads: object = None,
    combo_prefix: str = "ULS_C",
    mode: str = "exact_listed",
) -> List[Dict[str, str]]:
    """RFEM-friendly records: [{"name": ..., "equation": ...}, ...]."""
    combos = generate_uls_combinations(
        factors=factors,
        designators=designators,
        loads=loads,
        combo_prefix=combo_prefix,
        mode=mode,
    )
    return [
        {
            "name": str(combo["name"]),
            "equation": str(combo["expression"]),
        }
        for combo in combos
    ]


def as_name_and_equation_lists(
    factors: LoadFactors | None = None,
    designators: LoadDesignators | None = None,
    loads: object = None,
    combo_prefix: str = "ULS_C",
    mode: str = "exact_listed",
) -> Tuple[List[str], List[str]]:
    """Return two parallel outputs: ComboNames and ComboEquations."""
    combos = generate_uls_combinations(
        factors=factors,
        designators=designators,
        loads=loads,
        combo_prefix=combo_prefix,
        mode=mode,
    )
    combo_names = [str(combo["name"]) for combo in combos]
    combo_equations = [str(combo["expression"]) for combo in combos]
    return combo_names, combo_equations


def factors_from_slider_inputs(
    DLF: float | None = 1.35,
    LLF: float | None = 1.50,
    LLF_rf: float | None = 1.05,
    CLF: float | None = 1.60,
    WLF_0: float | None = 1.05,
    WLF_1: float | None = 1.50,
    WLF_2: float | None = 1.00,
    WLF_3: float | None = 0.94,
    WLF_4: float | None = 0.60,
    WLF_5: float | None = 0.50,
    SLF_1: float | None = 0.94,
    SLF_2: float | None = 1.50,
    SLF_3: float | None = 1.00,
    SLF_4: float | None = 0.75,
) -> LoadFactors:
    """Build LoadFactors from GH slider values."""
    def _num(value: float | None, fallback: float) -> float:
        return fallback if value is None else float(value)

    return LoadFactors(
        DLF=_num(DLF, 1.35),
        LLF=_num(LLF, 1.50),
        LLF_rf=_num(LLF_rf, 1.05),
        CLF=_num(CLF, 1.60),
        WLF_0=_num(WLF_0, 1.05),
        WLF_1=_num(WLF_1, 1.50),
        WLF_2=_num(WLF_2, 1.00),
        WLF_3=_num(WLF_3, 0.94),
        WLF_4=_num(WLF_4, 0.60),
        WLF_5=_num(WLF_5, 0.50),
        SLF_1=_num(SLF_1, 0.94),
        SLF_2=_num(SLF_2, 1.50),
        SLF_3=_num(SLF_3, 1.00),
        SLF_4=_num(SLF_4, 0.75),
    )


def slider_inputs_to_name_and_equation_lists(
    DLF: float | None = 1.35,
    LLF: float | None = 1.50,
    LLF_rf: float | None = 1.05,
    CLF: float | None = 1.60,
    WLF_0: float | None = 1.05,
    WLF_1: float | None = 1.50,
    WLF_2: float | None = 1.00,
    WLF_3: float | None = 0.94,
    WLF_4: float | None = 0.60,
    WLF_5: float | None = 0.50,
    SLF_1: float | None = 0.94,
    SLF_2: float | None = 1.50,
    SLF_3: float | None = 1.00,
    SLF_4: float | None = 0.75,
    loads: object = None,
    designators: LoadDesignators | None = None,
    combo_prefix: str = "ULS_C",
    mode: str = "exact_listed",
) -> Tuple[List[str], List[str]]:
    """One-call GH adapter: slider inputs -> (ComboNames, ComboEquations)."""
    factors = factors_from_slider_inputs(
        DLF=DLF,
        LLF=LLF,
        LLF_rf=LLF_rf,
        CLF=CLF,
        WLF_0=WLF_0,
        WLF_1=WLF_1,
        WLF_2=WLF_2,
        WLF_3=WLF_3,
        WLF_4=WLF_4,
        WLF_5=WLF_5,
        SLF_1=SLF_1,
        SLF_2=SLF_2,
        SLF_3=SLF_3,
        SLF_4=SLF_4,
    )
    return as_name_and_equation_lists(
        factors=factors,
        designators=designators,
        loads=loads,
        combo_prefix=combo_prefix,
        mode=mode,
    )


# If this code is pasted directly into a GH Py3 component, compute outputs immediately.
try:
    _g = globals()
    ComboNames, ComboEquations = slider_inputs_to_name_and_equation_lists(
        DLF=_g.get("DLF"),
        LLF=_g.get("LLF"),
        LLF_rf=_g.get("LLF_rf"),
        CLF=_g.get("CLF"),
        WLF_0=_g.get("WLF_0"),
        WLF_1=_g.get("WLF_1"),
        WLF_2=_g.get("WLF_2"),
        WLF_3=_g.get("WLF_3"),
        WLF_4=_g.get("WLF_4"),
        WLF_5=_g.get("WLF_5"),
        SLF_1=_g.get("SLF_1"),
        SLF_2=_g.get("SLF_2"),
        SLF_3=_g.get("SLF_3"),
        SLF_4=_g.get("SLF_4"),
        loads=_g.get("Loads"),
        mode=_resolve_mode_from_globals(_g),
    )
except NameError:
    # Not running inside GH component inputs; keep module import-safe.
    pass


if __name__ == "__main__":
    for line in as_expression_list():
        print(line)
# ---------- end load_combinations ----------
panel_18 = Panel(load_combinations.ComboEquations)
load_combinations_2 = ValueList({"ULS_C1", "ULS_C2", "ULS_C3", "ULS_C4", "ULS_C5", "ULS_C6", "ULS_C7", "ULS_C8", "ULS_C9", "ULS_C10", "ULS_C11", "ULS_C12", "ULS_C13", "ULS_C14", "ULS_C15", "ULS_C16", "ULS_C17", "ULS_C18", "ULS_C19", "ULS_C20", "ULS_C21", "ULS_C22"}, selected="ULS_C2")

# ---- group: LOADING CONDITIONS / LOAD CHECKS / DESIGN SITUATIONS
design_situations = ValueList({"ULS_Fundamental_Combos", "SLS_Rare_Combos", "SLS_Frequent_Combos", "SLS_QP_Combos", "ULS_Accidental_Fire_Combos", "Optional: DSPrefix"}, selected="ULS_Fundamental_Combos")
design_situations_2 = Python3Script(
    ComboNames=load_combinations.ComboNames,
    ComboEquations=load_combinations.ComboEquations,
    DesignSituations=design_situations)  # -> out, DSIds, DSShortCodes, DSNames, DSCategories, DSIndexSpecs, DSComboNames, DSComboEquations
# ---------- design_situations_2: Python ----------
from __future__ import annotations

from dataclasses import dataclass
from typing import Dict, Iterable, List, Set


@dataclass
class DesignSituationSpec:
    order: int
    short_code: str
    name: str
    category: str
    index_spec: str


DEFAULT_DESIGN_SITUATIONS: List[DesignSituationSpec] = [
    DesignSituationSpec(order=1, short_code="2 F", name="ULS Type 2 - Fundamental", category="ULS", index_spec="1-8"),
    DesignSituationSpec(order=2, short_code="S R", name="SLS - Rare", category="SLS", index_spec="9-16"),
    DesignSituationSpec(order=3, short_code="S Fr", name="SLS - Frequent", category="SLS", index_spec="17-21"),
    DesignSituationSpec(order=4, short_code="S Qp", name="SLS - Quasi-permanent", category="SLS", index_spec="22"),
    DesignSituationSpec(order=5, short_code="2 AF", name="ULS Type 2 - Accidental - Fire - psi 2,1", category="ULS", index_spec=""),
]


def _to_combo_list(value: object) -> List[str]:
    """Normalize GH input (None, string, list) into a clean combo-name list."""
    if value is None:
        return []

    if isinstance(value, str):
        if not value.strip():
            return []
        text = value.replace("\r", "\n")
        for token in [",", ";", "\t"]:
            text = text.replace(token, "\n")
        return [part.strip() for part in text.split("\n") if part.strip()]

    if isinstance(value, Iterable):
        result: List[str] = []
        for item in value:
            if item is None:
                continue
            text = str(item).strip()
            if text:
                result.append(text)
        return result

    text = str(value).strip()
    return [text] if text else []


def _parse_index_spec(spec: str) -> Set[int]:
    """Parse 1-based index ranges like '1-8, 12, 15-16'."""
    text = (spec or "").strip()
    if not text:
        return set()

    result: Set[int] = set()
    for chunk in text.replace(";", ",").split(","):
        token = chunk.strip()
        if not token:
            continue
        if "-" in token:
            left, right = token.split("-", 1)
            try:
                start = int(left.strip())
                end = int(right.strip())
            except ValueError:
                continue
            if start <= 0 or end <= 0:
                continue
            if start <= end:
                result.update(range(start, end + 1))
            else:
                result.update(range(end, start + 1))
            continue

        try:
            idx = int(token)
        except ValueError:
            continue
        if idx > 0:
            result.add(idx)

    return result


def _select_combo_names(combo_names: List[str], index_spec: str) -> List[str]:
    indices = _parse_index_spec(index_spec)
    if not indices:
        return []
    return [name for i, name in enumerate(combo_names, start=1) if i in indices]


def _select_combo_equations(combo_equations: List[str], index_spec: str) -> List[str]:
    indices = _parse_index_spec(index_spec)
    if not indices:
        return []
    return [equation for i, equation in enumerate(combo_equations, start=1) if i in indices]


def _normalize_token(text: str) -> str:
    return "".join(ch.lower() for ch in text if ch.isalnum())


def _find_default_spec(token: str) -> DesignSituationSpec | None:
    t = _normalize_token(token)
    if not t:
        return None

    alias_by_order = {
        1: ["ULS_Fundamental_Combos"],
        2: ["SLS_Rare_Combos"],
        3: ["SLS_Frequent_Combos"],
        4: ["SLS_QP_Combos"],
        5: ["ULS_Accidental_Fire_Combos"],
    }

    for spec in DEFAULT_DESIGN_SITUATIONS:
        candidates = [
            f"ds{spec.order}",
            spec.short_code,
            spec.name,
            f"DS{spec.order} - {spec.name}",
            f"{spec.short_code} {spec.name}",
        ]
        candidates.extend(alias_by_order.get(spec.order, []))
        if any(_normalize_token(candidate) == t for candidate in candidates):
            return spec
    return None


def _resolve_design_situations(design_situations: object) -> List[DesignSituationSpec]:
    """Resolve value-list input into DS specs.

    Supported item formats:
    - "DS1" / "DS2" / ...
    - "DS1 - ULS Type 2 - Fundamental"
    - "2 F ULS Type 2 - Fundamental"
    - Custom pipe format: "DS6|X|Custom Name|ULS|1-3,7"
    """
    raw_items = _to_combo_list(design_situations)
    if not raw_items:
        return list(DEFAULT_DESIGN_SITUATIONS)

    resolved: List[DesignSituationSpec] = []
    for idx, item in enumerate(raw_items, start=1):
        text = item.strip()
        if not text:
            continue

        if "|" in text:
            parts = [p.strip() for p in text.split("|")]
            if len(parts) >= 5:
                order_token, short_code, name, category, index_spec = parts[:5]
                digits = "".join(ch for ch in order_token if ch.isdigit())
                order = int(digits) if digits else idx
                resolved.append(
                    DesignSituationSpec(
                        order=order,
                        short_code=short_code or "-",
                        name=name or f"Custom DS {order}",
                        category=(category or "ULS").upper(),
                        index_spec=index_spec,
                    )
                )
                continue

        default_spec = _find_default_spec(text)
        if default_spec is not None:
            resolved.append(default_spec)

    return resolved if resolved else list(DEFAULT_DESIGN_SITUATIONS)


def generate_design_situations(
    combo_names: object = None,
    combo_equations: object = None,
    design_situations: object = None,
    ds_prefix: str = "DS",
) -> List[Dict[str, object]]:
    """Build design situations from two inputs: ComboNames + DesignSituations."""
    combo_list = _to_combo_list(combo_names)
    combo_eq_list = _to_combo_list(combo_equations)
    specs = _resolve_design_situations(design_situations)

    records: List[Dict[str, object]] = []
    for spec in specs:
        combos = _select_combo_names(combo_list, spec.index_spec)
        equations = _select_combo_equations(combo_eq_list, spec.index_spec)
        records.append(
            {
                "id": f"{ds_prefix}{spec.order}",
                "short_code": spec.short_code,
                "name": spec.name,
                "category": spec.category,
                "index_spec": spec.index_spec,
                "combos": combos,
                "combo_equations": equations,
            }
        )
    return records


def as_rfem_records(
    combo_names: object = None,
    combo_equations: object = None,
    design_situations: object = None,
    ds_prefix: str = "DS",
) -> List[Dict[str, str]]:
    """RFEM-friendly DS records with joined combination names."""
    records = generate_design_situations(
        combo_names=combo_names,
        combo_equations=combo_equations,
        design_situations=design_situations,
        ds_prefix=ds_prefix,
    )

    out: List[Dict[str, str]] = []
    for row in records:
        combos = row["combos"]
        equations = row["combo_equations"]
        combo_text = "; ".join(str(x) for x in combos) if combos else ""
        equation_text = "; ".join(str(x) for x in equations) if equations else ""
        out.append(
            {
                "id": str(row["id"]),
                "short_code": str(row["short_code"]),
                "name": str(row["name"]),
                "category": str(row["category"]),
                "index_spec": str(row["index_spec"]),
                "combination_names": combo_text,
                "combination_equations": equation_text,
            }
        )
    return out


def as_output_lists(
    combo_names: object = None,
    combo_equations: object = None,
    design_situations: object = None,
    ds_prefix: str = "DS",
) -> Dict[str, List[str]]:
    """Parallel lists for GH outputs."""
    records = generate_design_situations(
        combo_names=combo_names,
        combo_equations=combo_equations,
        design_situations=design_situations,
        ds_prefix=ds_prefix,
    )

    ds_ids = [str(r["id"]) for r in records]
    ds_short_codes = [str(r["short_code"]) for r in records]
    ds_names = [str(r["name"]) for r in records]
    ds_categories = [str(r["category"]) for r in records]
    ds_index_specs = [str(r["index_spec"]) for r in records]
    ds_combo_lists = [list(r["combos"]) for r in records]
    ds_combo_eq_lists = [list(r["combo_equations"]) for r in records]

    return {
        "DSIds": ds_ids,
        "DSShortCodes": ds_short_codes,
        "DSNames": ds_names,
        "DSCategories": ds_categories,
        "DSIndexSpecs": ds_index_specs,
        "DSComboNames": ["; ".join(items) for items in ds_combo_lists],
        "DSComboEquations": ["; ".join(items) for items in ds_combo_eq_lists],
    }


# GH Py3 auto-run block: two input ports expected -> ComboNames + DesignSituations.
_g = globals()
if "ComboNames" in _g:
    _lists = as_output_lists(
        combo_names=_g.get("ComboNames"),
        combo_equations=_g.get("ComboEquations"),
        design_situations=_g.get("DesignSituations"),
        ds_prefix=str(_g.get("DSPrefix", "DS")),
    )
    DSIds = _lists["DSIds"]
    DSShortCodes = _lists["DSShortCodes"]
    DSNames = _lists["DSNames"]
    DSCategories = _lists["DSCategories"]
    DSIndexSpecs = _lists["DSIndexSpecs"]
    DSComboNames = _lists["DSComboNames"]
    DSComboEquations = _lists["DSComboEquations"]
    out = "Generated {} design situations".format(len(DSIds))


if __name__ == "__main__":
    sample = as_rfem_records(
        combo_names=[f"ULS_C{i}" for i in range(1, 23)],
        combo_equations=[f"1.35 * LC{i}" for i in range(1, 23)],
        design_situations=["DS1", "DS2", "DS3", "DS4", "DS5"],
    )
    for row in sample:
        print(row)
# ---------- end design_situations_2 ----------

# ----
# MEMBER SIZING/
# OPTIMIZATION
number_slider_15 = Slider(2, range=0..10)  # disabled
number_slider_16 = Slider(12, range=0..100)  # disabled
number_slider_17 = Slider(2, range=0..10)  # disabled
number_slider_18 = Slider(16, range=0..100)  # disabled
number_slider_19 = Slider(20, range=0..100)  # disabled
number_slider_20 = Slider(2, range=0..10)  # disabled
matselect_4 = MaterialSelectionKaramba3D(menu=[dropdown(1), dropdown(4), dropdown(11)])  # disabled
series_4 = Series(Start=number_slider_16, Step=number_slider_15, Count=10)  # disabled
series_5 = Series(Start=number_slider_18, Step=number_slider_17, Count=10)  # disabled
series_6 = Series(Start=number_slider_19, Step=number_slider_20, Count=10)  # disabled
panel_19 = Panel(series_4)  # disabled
panel_20 = Panel(series_5)  # disabled
panel_21 = Panel(series_6)  # disabled
crosec_7 = CrossSectionKaramba3D(
    FamilyNameOfCrossSection="DefaultCroSec",
    Material=matselect_4,
    Height_cm=series_4,
    UpperFlangeWidth_cm=number_slider_16,
    LowerFlangeWidth_cm=number_slider_16,
    mode="Trapezoid")  # disabled
crosec_8 = CrossSectionKaramba3D(
    FamilyNameOfCrossSection="DefaultCroSec",
    Material=matselect_4,
    Height_cm=series_5,
    UpperFlangeWidth_cm=number_slider_18,
    LowerFlangeWidth_cm=number_slider_18,
    mode="Trapezoid")  # disabled
merge_7 = Merge(Data1=crosec_7, Data2=crosec_8)  # disabled
crosec_9 = CrossSectionKaramba3D(merge_7)  # disabled

# ---- group: LOADING CONDITIONS / LOAD CHECKS / DESIGN LIMIT CHECKS
list_8 = ValueList({"CHK_DS1_01", "CHK_DS1_02", "CHK_DS1_03", "CHK_DS1_04", "CHK_DS1_05", "CHK_DS1_06", "CHK_DS2_01", "CHK_DS2_02", "CHK_DS2_03", "CHK_DS2_04", "CHK_DS2_05", "CHK_DS2_06", "CHK_DS3_01", "CHK_DS3_02", "CHK_DS3_03", "CHK_DS3_04", "CHK_DS3_05", "CHK_DS3_06", "CHK_DS4_01", "CHK_DS4_02", "CHK_DS4_03", "CHK_DS4_04", "CHK_DS4_05", "CHK_DS4_06", "CHK_DS5_01", "CHK_DS5_02"}, selected="CHK_DS1_01")
design_limit_checks = Python3Script(
    SelectedCheck=list_8,
    DSIds=design_situations_2.DSIds,
    DSCategories=design_situations_2.DSCategories,
    DSNames=design_situations_2.DSNames,
    DSComboEquations=design_situations_2.DSComboEquations,
    SelectedCheckToggle=Toggle(False))  # -> out, CheckIds, ParentDSIds, ParentDSNames, ParentDSCategories, Profiles, CheckCodes, CheckNames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
# ---------- design_limit_checks: Python ----------
from __future__ import annotations

from dataclasses import dataclass
from typing import Dict, Iterable, List


@dataclass(frozen=True)
class LimitCheckSpec:
    code: str
    name: str
    rfem_name: str
    group: str
    description: str


ULS_STANDARD_CHECKS: List[LimitCheckSpec] = [
    LimitCheckSpec("ULS_CRUSH", "Crushing / Compression Perpendicular-to-Grain", "Timber ULS - Compression Perpendicular to Grain", "Strength", "Bearing and localized compression verification."),
    LimitCheckSpec("ULS_BUCK_C", "Compression Buckling", "Timber ULS - Member Stability (Compression Buckling)", "Stability", "Column/member instability in compression."),
    LimitCheckSpec("ULS_BUCK_F", "Flexural Buckling", "Timber ULS - Member Stability (Flexural Buckling)", "Stability", "Out-of-plane member buckling under bending."),
    LimitCheckSpec("ULS_LTB", "Lateral-Torsional Buckling", "Timber ULS - Member Stability (Lateral Torsional Buckling)", "Stability", "Buckling check for bending members."),
    LimitCheckSpec("ULS_BEND_AX", "Combined Bending + Axial", "Timber ULS - Combined Stress Interaction", "Interaction", "Combined stress interaction verification."),
    LimitCheckSpec("ULS_SHEAR", "Shear Resistance", "Timber ULS - Shear", "Strength", "Shear stress and utilization check."),
]

SLS_STANDARD_CHECKS: List[LimitCheckSpec] = [
    LimitCheckSpec("SLS_DEF_INST", "Deflection (Instantaneous)", "Timber SLS - Deformation (Instantaneous)", "Serviceability", "Instantaneous deflection limit check."),
    LimitCheckSpec("SLS_DEF_FIN", "Deflection (Final)", "Timber SLS - Deformation (Final)", "Serviceability", "Final deflection including long-term effects."),
    LimitCheckSpec("SLS_SHRINK", "Timber Shrinkage", "Timber SLS - Shrinkage", "Serviceability", "Moisture-related shrinkage deformation check."),
    LimitCheckSpec("SLS_CREEP", "Creep", "Timber SLS - Creep", "Serviceability", "Long-term creep deformation amplification."),
    LimitCheckSpec("SLS_VIB", "Vibration Comfort", "Timber SLS - Vibrations", "Serviceability", "Basic vibration performance screening."),
    LimitCheckSpec("SLS_MOIST", "Moisture Movement", "Timber SLS - Moisture Movements", "Serviceability", "Moisture variation movement compatibility."),
]

FIRE_STANDARD_CHECKS: List[LimitCheckSpec] = [
    LimitCheckSpec("FIRE_CHAR", "Charring Depth / Residual Section", "Timber Fire - Charring / Residual Section", "Fire", "Section reduction due to charring."),
    LimitCheckSpec("FIRE_RES", "Fire Resistance Utilization", "Timber Fire - Resistance Verification", "Fire", "Capacity check under fire design actions."),
]


DEFAULT_DS_INDEX_SPECS: Dict[int, str] = {
    1: "1-8",
    2: "9-16",
    3: "17-21",
    4: "22",
    5: "",
}


def _to_list(value: object) -> List[str]:
    """Normalize GH input (None/string/list) into a cleaned list of strings."""
    if value is None:
        return []

    if isinstance(value, str):
        if not value.strip():
            return []
        text = value.replace("\r", "\n")
        for token in [",", ";", "\t"]:
            text = text.replace(token, "\n")
        return [part.strip() for part in text.split("\n") if part.strip()]

    if isinstance(value, Iterable):
        out: List[str] = []
        for item in value:
            if item is None:
                continue
            text = str(item).strip()
            if text:
                out.append(text)
        return out

    text = str(value).strip()
    return [text] if text else []


def _to_bool_list(value: object) -> List[bool]:
    if value is None:
        return []

    if isinstance(value, bool):
        return [value]

    if isinstance(value, str):
        tokens = _to_list(value)
    elif isinstance(value, Iterable):
        tokens = [str(item).strip() for item in value if item is not None]
    else:
        tokens = [str(value).strip()]

    true_tokens = {"1", "true", "yes", "on"}
    false_tokens = {"0", "false", "no", "off"}

    result: List[bool] = []
    for token in tokens:
        t = token.lower()
        if t in true_tokens:
            result.append(True)
        elif t in false_tokens:
            result.append(False)
        else:
            result.append(bool(token))
    return result


def _split_equation_bucket(value: str) -> List[str]:
    text = (value or "").replace("\r", "\n")
    for token in [";", "\t"]:
        text = text.replace(token, "\n")
    return [part.strip() for part in text.split("\n") if part.strip()]


def _parse_index_spec(spec: str) -> List[int]:
    text = (spec or "").strip()
    if not text:
        return []

    indices: List[int] = []
    for chunk in text.replace(";", ",").split(","):
        token = chunk.strip()
        if not token:
            continue
        if "-" in token:
            left, right = token.split("-", 1)
            try:
                start = int(left.strip())
                end = int(right.strip())
            except ValueError:
                continue
            if start <= 0 or end <= 0:
                continue
            if start <= end:
                indices.extend(range(start, end + 1))
            else:
                indices.extend(range(end, start + 1))
            continue
        try:
            idx = int(token)
        except ValueError:
            continue
        if idx > 0:
            indices.append(idx)
    return indices


def _parse_ds_order(ds_id: str) -> int | None:
    digits = "".join(ch for ch in str(ds_id) if ch.isdigit())
    if not digits:
        return None
    try:
        return int(digits)
    except ValueError:
        return None


def _rebuild_missing_ds_combo_equations(ds_ids: List[str]) -> List[str]:
    """Fallback for GH definitions that don't wire DSComboEquations.

    Reconstruct DS equation buckets from the canonical ULS_C1..ULS_C22 list.
    This keeps Karamba's load input populated even when only DS metadata is wired.
    """
    try:
        from design.structure_model.data.tools.uls_load_combination_generator import (
            as_name_and_equation_lists,
        )
    except Exception:
        try:
            from uls_load_combination_generator import as_name_and_equation_lists
        except Exception:
            return ["" for _ in ds_ids]

    try:
        _, combo_equations = as_name_and_equation_lists()
    except Exception:
        return ["" for _ in ds_ids]

    rebuilt: List[str] = []
    for ds_id in ds_ids:
        order = _parse_ds_order(ds_id)
        if order is None:
            rebuilt.append("")
            continue

        spec = DEFAULT_DS_INDEX_SPECS.get(order, "")
        idxs = _parse_index_spec(spec)
        if not idxs:
            rebuilt.append("")
            continue

        selected = [combo_equations[i - 1] for i in idxs if 0 < i <= len(combo_equations)]
        rebuilt.append("; ".join(selected) if selected else "")

    return rebuilt


def _norm(text: str) -> str:
    return "".join(ch.lower() for ch in text if ch.isalnum())


def _resolve_profile_name(category: str, profile_hint: str | None) -> str:
    """Resolve profile using DS category and optional value-list token."""
    c = _norm(category)
    p = _norm(profile_hint or "")

    if "fire" in p:
        return "FIRE_STANDARD"
    if "serviceability" in p or p.startswith("sls"):
        return "SLS_STANDARD"
    if "ultimate" in p or p.startswith("uls"):
        return "ULS_STANDARD"

    if c.startswith("sls"):
        return "SLS_STANDARD"
    if "fire" in c:
        return "FIRE_STANDARD"
    return "ULS_STANDARD"


def _checks_for_profile(profile_name: str) -> List[LimitCheckSpec]:
    if profile_name == "SLS_STANDARD":
        return SLS_STANDARD_CHECKS
    if profile_name == "FIRE_STANDARD":
        return FIRE_STANDARD_CHECKS
    return ULS_STANDARD_CHECKS


def generate_design_limit_checks(
    ds_ids: object = None,
    ds_categories: object = None,
    ds_names: object = None,
    ds_combo_equations: object = None,
    configuration_profiles: object = None,
    check_prefix: str = "CHK",
) -> List[Dict[str, str]]:
    """Expand design situations into timber design-limit checks.

    Inputs expected from GH:
    - ds_ids: list like ["DS1", "DS2", ...]
    - ds_categories: list like ["ULS", "SLS", ...]
    - ds_names: optional labels
    - configuration_profiles: optional value-list tokens per DS
      Example tokens:
      - "Ultimate Configurations - 1 - Standard"
      - "Serviceability Configurations - 1 - Standard"
      - "Fire Resistance Configurations - 1 - Standard"
    """
    ids = _to_list(ds_ids)
    categories = _to_list(ds_categories)
    names = _to_list(ds_names)
    combo_equations = _to_list(ds_combo_equations)
    profiles = _to_list(configuration_profiles)

    n = len(ids)
    if len(categories) < n:
        categories.extend(["ULS"] * (n - len(categories)))
    if len(names) < n:
        names.extend([""] * (n - len(names)))
    if len(combo_equations) < n:
        combo_equations.extend([""] * (n - len(combo_equations)))
    if len(profiles) < n:
        profiles.extend([""] * (n - len(profiles)))

    # Fallback path for GH definitions where DSComboEquations is not wired.
    if n > 0 and not any((eq or "").strip() for eq in combo_equations):
        combo_equations = _rebuild_missing_ds_combo_equations(ids)

    records: List[Dict[str, str]] = []
    for i in range(n):
        ds_id = ids[i]
        ds_category = categories[i]
        ds_name = names[i] if i < len(names) else ""
        ds_loads = combo_equations[i] if i < len(combo_equations) else ""
        profile_name = _resolve_profile_name(ds_category, profiles[i] if i < len(profiles) else "")
        checks = _checks_for_profile(profile_name)

        for check_idx, check in enumerate(checks, start=1):
            records.append(
                {
                    "check_id": f"{check_prefix}_{ds_id}_{check_idx:02d}",
                    "design_situation_id": ds_id,
                    "design_situation_name": ds_name,
                    "design_situation_category": ds_category,
                    "design_situation_loads": ds_loads,
                    "profile": profile_name,
                    "check_code": check.code,
                    "check_name": check.name,
                    "rfem_check_name": check.rfem_name,
                    "check_group": check.group,
                    "check_description": check.description,
                }
            )
    return records


def as_output_lists(
    ds_ids: object = None,
    ds_categories: object = None,
    ds_names: object = None,
    ds_combo_equations: object = None,
    configuration_profiles: object = None,
    active_check_ids: object = None,
    active_check_codes: object = None,
    active_toggles: object = None,
    selected_check: object = None,
    selected_check_toggle: object = None,
    check_prefix: str = "CHK",
) -> Dict[str, List[str]]:
    """Parallel GH outputs for design limit checks."""
    rows = generate_design_limit_checks(
        ds_ids=ds_ids,
        ds_categories=ds_categories,
        ds_names=ds_names,
        ds_combo_equations=ds_combo_equations,
        configuration_profiles=configuration_profiles,
        check_prefix=check_prefix,
    )

    selected = _to_list(selected_check)
    selected_toggle_flags = _to_bool_list(selected_check_toggle)
    selected_enabled = selected_toggle_flags[0] if selected_toggle_flags else True

    selected_ids = selected if selected_enabled else []
    active_ids = set(_to_list(active_check_ids) + selected_ids)
    active_codes = set(_to_list(active_check_codes))
    toggles = _to_bool_list(active_toggles)

    loads_out: List[str] = []
    for idx, row in enumerate(rows):
        is_selected = False

        if active_ids and row["check_id"] in active_ids:
            is_selected = True
        if active_codes and row["check_code"] in active_codes:
            is_selected = True
        if toggles and idx < len(toggles) and toggles[idx]:
            is_selected = True

        if not active_ids and not active_codes and not toggles and not selected_ids:
            # Default behavior when no toggle/selection is wired: pass all loads through.
            is_selected = True

        if is_selected:
            loads_out.extend(_split_equation_bucket(str(row.get("design_situation_loads", ""))))

    # Preserve order while removing duplicates.
    seen = set()
    loads_unique: List[str] = []
    for load in loads_out:
        if load in seen:
            continue
        seen.add(load)
        loads_unique.append(load)

    return {
        "CheckIds": [str(r["check_id"]) for r in rows],
        "ParentDSIds": [str(r["design_situation_id"]) for r in rows],
        "ParentDSNames": [str(r["design_situation_name"]) for r in rows],
        "ParentDSCategories": [str(r["design_situation_category"]) for r in rows],
        "ParentDSLoads": [str(r["design_situation_loads"]) for r in rows],
        "Profiles": [str(r["profile"]) for r in rows],
        "CheckCodes": [str(r["check_code"]) for r in rows],
        "CheckNames": [str(r["check_name"]) for r in rows],
        "RFEMCheckNames": [str(r["rfem_check_name"]) for r in rows],
        "CheckGroups": [str(r["check_group"]) for r in rows],
        "CheckDescriptions": [str(r["check_description"]) for r in rows],
        "Loads": loads_unique,
    }


def as_rfem_records(
    ds_ids: object = None,
    ds_categories: object = None,
    ds_names: object = None,
    ds_combo_equations: object = None,
    configuration_profiles: object = None,
    check_prefix: str = "CHK",
) -> List[Dict[str, str]]:
    """RFEM-friendly records for limit checks."""
    return generate_design_limit_checks(
        ds_ids=ds_ids,
        ds_categories=ds_categories,
        ds_names=ds_names,
        ds_combo_equations=ds_combo_equations,
        configuration_profiles=configuration_profiles,
        check_prefix=check_prefix,
    )


# GH Py3 auto-run block.
_g = globals()
if "DSIds" in _g:
    _lists = as_output_lists(
        ds_ids=_g.get("DSIds"),
        ds_categories=_g.get("DSCategories"),
        ds_names=_g.get("DSNames"),
        ds_combo_equations=_g.get("DSComboEquations"),
        configuration_profiles=_g.get("LimitCheckProfiles"),
        active_check_ids=_g.get("ActiveCheckIds"),
        active_check_codes=_g.get("ActiveCheckCodes"),
        active_toggles=_g.get("ActiveToggles"),
        selected_check=_g.get("SelectedCheck"),
        selected_check_toggle=_g.get("SelectedCheckToggle"),
        check_prefix=str(_g.get("CheckPrefix", "CHK")),
    )

    CheckIds = _lists["CheckIds"]
    ParentDSIds = _lists["ParentDSIds"]
    ParentDSNames = _lists["ParentDSNames"]
    ParentDSCategories = _lists["ParentDSCategories"]
    ParentDSLoads = _lists["ParentDSLoads"]
    Profiles = _lists["Profiles"]
    CheckCodes = _lists["CheckCodes"]
    CheckNames = _lists["CheckNames"]
    RFEMCheckNames = _lists["RFEMCheckNames"]
    CheckGroups = _lists["CheckGroups"]
    CheckDescriptions = _lists["CheckDescriptions"]
    Loads = _lists["Loads"]

    out = "Generated {} limit checks".format(len(CheckIds))


if __name__ == "__main__":
    sample = as_output_lists(
        ds_ids=["DS1", "DS2", "DS3", "DS4", "DS5"],
        ds_categories=["ULS", "SLS", "SLS", "SLS", "ULS_FIRE"],
        ds_names=[
            "ULS Type 2 - Fundamental",
            "SLS - Rare",
            "SLS - Frequent",
            "SLS - Quasi-permanent",
            "ULS Type 2 - Accidental - Fire",
        ],
        ds_combo_equations=[
            "1.35 * DL_T + 1.35 * DL_FD + 1.35 * LL",
            "1.60 * DL_T + 1.60 * DL_FD + 1.60 * LL",
            "1.60 * DL_T + 1.60 * DL_FD + 1.60 * LL + 0.94 * SL",
            "1.00 * DL_T + 1.00 * DL_FD + 1.00 * LL",
            "1.00 * DL_T + 1.00 * DL_FD + 1.00 * LL + FIRE",
        ],
        configuration_profiles=[
            "Ultimate Configurations - 1 - Standard",
            "Serviceability Configurations - 1 - Standard",
            "Serviceability Configurations - 1 - Standard",
            "Serviceability Configurations - 1 - Standard",
            "Fire Resistance Configurations - 1 - Standard",
        ],
    )
    print("checks:", len(sample["CheckIds"]))
# ---------- end design_limit_checks ----------

# ---- group: LM_to_RFEM6 / LOAD COMBINATIONS
list_9 = ValueList({"GEOMETRICALLY_LINEAR": 0, "LARGE_DEFORMATIONS": 1, "SECOND_ORDER_P_DELTA": 2}, selected="GEOMETRICALLY_LINEAR")
load_case_classification_component = LoadCaseClassificationComponent(ActionIndex=0, DesignIndex=0, StandardIndex=0, menu=[dropdown(0), dropdown(0), dropdown(0)])  # -> ActionCategory, DesignSituationType
static_analysis_settings = StaticAnalysisSettings(StaticAnalysisSettingNo="1", AnalysisType=list_9, ExceptionalHandling=Toggle(False), mode="Assemble")
load_case_2 = LoadCase(
    LoadCaseNo="1",
    LoadCaseName="Self Weigth",
    StaticAnalysisSettings=static_analysis_settings,
    ActionCategory=load_case_classification_component.ActionCategory,
    SelfWeightActive=Toggle(False),
    mode="Assemble")

# ---- group: LM_to_RFEM6 / APPLIED LOADS
list_10 = ValueList({"LOAD_DIRECTION_GLOBAL_X_OR_USER_DEFINED_U_PROJECTED": 0, "LOAD_DIRECTION_GLOBAL_X_OR_USER_DEFINED_U_TRUE": 1, "LOAD_DIRECTION_GLOBAL_Y_OR_USER_DEFINED_V_PROJECTED": 2, "LOAD_DIRECTION_GLOBAL_Y_OR_USER_DEFINED_V_TRUE": 3, "LOAD_DIRECTION_GLOBAL_Z_OR_USER_DEFINED_W_PROJECTED": 4, "LOAD_DIRECTION_GLOBAL_Z_OR_USER_DEFINED_W_TRUE": 5, "LOAD_DIRECTION_LOCAL_X": 6, "LOAD_DIRECTION_LOCAL_Y": 7, "LOAD_DIRECTION_LOCAL_Z": 8, "LOAD_DIRECTION_PRINCIPAL_U": 9, "LOAD_DIRECTION_PRINCIPAL_V": 10}, selected="LOAD_DIRECTION_LOCAL_Z")
py3 = Python3Script(attribute_name="Facade")  # -> value
# ---------- py3: Python ----------
import Rhino


def get_attribute(guid, attribute_name):
    """
    Verwendet in:
        auszüge/fassade.gh
    """
    rh_obj = Rhino.RhinoDoc.ActiveDoc.Objects.Find(guid)
    val = rh_obj.Attributes.GetUserString(attribute_name)
    return val if val else "N/A"


value = get_attribute(guid, attribute_name)

if value != "True":
    value = False
# ---------- end py3 ----------
list_11 = ValueList({"LOAD_DISTRIBUTION_CONCENTRATED_1": 0, "LOAD_DISTRIBUTION_CONCENTRATED_2": 1, "LOAD_DISTRIBUTION_CONCENTRATED_2x2": 2, "LOAD_DISTRIBUTION_CONCENTRATED_N": 3, "LOAD_DISTRIBUTION_CONCENTRATED_VARYING": 4, "LOAD_DISTRIBUTION_PARABOLIC": 5, "LOAD_DISTRIBUTION_TAPERED": 6, "LOAD_DISTRIBUTION_TRAPEZOIDAL": 7, "LOAD_DISTRIBUTION_UNIFORM": 8, "LOAD_DISTRIBUTION_UNIFORM_TOTAL": 9, "LOAD_DISTRIBUTION_VARYING": 10, "LOAD_DISTRIBUTION_VARYING_IN_Z": 11}, selected="LOAD_DISTRIBUTION_UNIFORM")
list_12 = ValueList({"E_TYPE_MASS": 0, "LOAD_TYPE_AXIAL_DISPLACEMENT": 1, "LOAD_TYPE_AXIAL_STRAIN": 2, "LOAD_TYPE_COATING_CONTOUR": 3, "LOAD_TYPE_COATING_POLYGON": 4, "LOAD_TYPE_DISPLACEMENT": 5, "LOAD_TYPE_END_PRESTRESS": 6, "LOAD_TYPE_FORCE": 7, "LOAD_TYPE_FORM_FINDING": 8, "LOAD_TYPE_INITIAL_PRESTRESS": 9, "LOAD_TYPE_MOMENT": 10, "LOAD_TYPE_PIPE_CONTENT_FULL": 11, "LOAD_TYPE_PIPE_CONTENT_PARTIAL": 12, "LOAD_TYPE_PIPE_INTERNAL_PRESSURE": 13, "LOAD_TYPE_PRECAMBER": 14, "LOAD_TYPE_PRESTRESS_TENDON": 15, "LOAD_TYPE_ROTARY_MOTION": 16, "LOAD_TYPE_ROTATION": 17, "LOAD_TYPE_TEMPERATURE": 18, "LOAD_TYPE_TEMPERATURE_CHANGE": 19}, selected="LOAD_TYPE_FORCE")
cull_2 = CullPattern(CullPattern=py3)
py3_2 = Python3Script(L=cull_2, S="1")  # -> No; inputs L: list, S: Int32
# ---------- py3_2: Python ----------
if not S:
    S = 1



No = list(range(S, len(L) + S))
# ---------- end py3_2 ----------
surface_load = SurfaceLoad(mode="Assemble")
member_load_2 = MemberLoad(
    MemberLoadNo=py3_2,
    LoadCaseNo="1",
    MembersNo=cull_2,
    LoadType=list_12,
    LoadDistribution=list_11,
    LoadDirection=list_10,
    mode="Assemble")
nodal_load = NodalLoad(mode="Assemble")

# ---- group: LINE MODEL
json_importer_2 = Python3Script()  # -> out, ImportJson, MemberLines, AreaLoadMeshes, LinearLoadLines, PointLoadPoints, BoundaryPoints; disabled
# ---------- json_importer_2: Python ----------
# Minimal Input Cheat-Sheet (Importer)
# - GH input names: model (or Model)
# - Optional GH proxy inputs:
#     pt_guid_proxies         (aliases: PtGuidProxies, PointGuidProxies)
#     curve_guid_proxies      (aliases: CurveGuidProxies, LineGuidProxies)
#     area_guid_proxies       (aliases: AreaGuidProxies, MeshGuidProxies)
#     point_load_guid_proxies (alias: PointLoadGuidProxies) -> filters PointLoadPoints
#     boundary_guid_proxies   (alias: BoundaryGuidProxies)  -> filters BoundaryPoints
# - Function call: import_line_model_json(payload=..., pt_guid_proxies=...,
#     curve_guid_proxies=..., area_guid_proxies=...,
#     point_load_guid_proxies=..., boundary_guid_proxies=...)
# - Minimal runnable input: {}
# - Minimal useful topology input:
#   {"lines": [{"start": [0, 0, 0], "end": [1, 0, 0]}]}
# - GH outputs: ImportJson, MemberLines, AreaLoadMeshes, LinearLoadLines, PointLoadPoints,
#   BoundaryPoints, JointNodes, out
from __future__ import annotations

import argparse
import json
from typing import Any, Dict, List, Optional, Tuple


Point = Tuple[float, float, float]


def _as_point(value: Any) -> Optional[Point]:
    """Convert common point formats into a 3D tuple."""
    if value is None:
        return None

    if isinstance(value, dict):
        if all(axis in value for axis in ("x", "y", "z")):
            try:
                return (float(value["x"]), float(value["y"]), float(value["z"]))
            except (TypeError, ValueError):
                return None

        for key in ("point", "xyz", "coords", "position"):
            if key in value:
                return _as_point(value[key])

        return None

    if isinstance(value, (list, tuple)) and len(value) >= 3:
        try:
            return (float(value[0]), float(value[1]), float(value[2]))
        except (TypeError, ValueError):
            return None

    return None


def _first_point(*candidates: Any) -> Optional[Point]:
    for candidate in candidates:
        point = _as_point(candidate)
        if point is not None:
            return point
    return None


def _line_start_end(line: Dict[str, Any]) -> Tuple[Optional[Point], Optional[Point]]:
    attrs = line.get("attributes") if isinstance(line.get("attributes"), dict) else {}

    start = _first_point(
        line.get("start"),
        line.get("from"),
        line.get("u"),
        line.get("a"),
        line.get("start_point"),
        line.get("startPoint"),
        line.get("start_node"),
        attrs.get("start"),
        attrs.get("start_point"),
        attrs.get("start_node"),
    )

    end = _first_point(
        line.get("end"),
        line.get("to"),
        line.get("v"),
        line.get("b"),
        line.get("end_point"),
        line.get("endPoint"),
        line.get("end_node"),
        attrs.get("end"),
        attrs.get("end_point"),
        attrs.get("end_node"),
    )

    return start, end


def _normalize_item_list(value: Any) -> List[Dict[str, Any]]:
    if value is None:
        return []
    if isinstance(value, list):
        return [item for item in value if isinstance(item, dict)]
    if isinstance(value, dict):
        return [value]
    return []


def _extract_vertices(payload: Dict[str, Any]) -> List[Dict[str, Any]]:
    for key in ("vertices", "nodes", "points"):
        if key in payload:
            return _normalize_item_list(payload.get(key))
    return []


def _extract_edges(payload: Dict[str, Any]) -> List[Dict[str, Any]]:
    for key in ("edges", "lines", "members", "segments"):
        if key in payload:
            return _normalize_item_list(payload.get(key))
    return []


def _extract_lines_only(payload: Dict[str, Any]) -> List[Dict[str, Any]]:
    for key in ("lines", "members", "edges", "segments"):
        items = _normalize_item_list(payload.get(key))
        if items:
            return items
    return []


def _extract_meshes(payload: Dict[str, Any]) -> List[Dict[str, Any]]:
    for key in ("meshes", "areas", "faces", "panels"):
        if key in payload:
            return _normalize_item_list(payload.get(key))
    return []


def _edge_or_node_guid(item: Dict[str, Any]) -> Optional[str]:
    attrs = item.get("attributes") if isinstance(item.get("attributes"), dict) else {}
    for key in (
        "guid",
        "rhino_guid",
        "proxy_guid",
        "point_guid",
        "pt_guid",
        "curve_guid",
        "line_guid",
        "area_guid",
        "mesh_guid",
    ):
        value = item.get(key)
        if value not in (None, ""):
            return str(value)
        attr_value = attrs.get(key)
        if attr_value not in (None, ""):
            return str(attr_value)
    return None


def _resolve_filtered_node_ids(
    value: Any, guid_map: Dict[str, str]
) -> Optional[List[str]]:
    """Resolve a GUID proxy input to a filtered list of node IDs.

    Returns None when no input is provided, so the caller can fall back to all
    node IDs. Supports:
    - list of GUID strings -> looked up in guid_map
    - dict {guid: node_id} -> node_id used directly (guid_map as fallback)
    - list of {guid, id} dicts -> id value used directly
    """
    if value is None:
        return None

    node_ids: List[str] = []

    if isinstance(value, dict):
        for guid, node_id in value.items():
            if guid in (None, ""):
                continue
            resolved = str(node_id) if node_id not in (None, "") else guid_map.get(str(guid))
            if resolved:
                node_ids.append(resolved)
        return node_ids if node_ids else None

    if isinstance(value, (list, tuple)):
        for item in value:
            if isinstance(item, str) and item:
                resolved = guid_map.get(item)
                if resolved:
                    node_ids.append(resolved)
            elif isinstance(item, dict):
                guid = item.get("guid") or item.get("proxy_guid")
                node_id = item.get("id") or item.get("target_id") or item.get("node_id")
                if node_id not in (None, ""):
                    node_ids.append(str(node_id))
                elif guid and str(guid) in guid_map:
                    node_ids.append(guid_map[str(guid)])
        return node_ids if node_ids else None

    return None


def _coerce_proxy_map(value: Any) -> Dict[str, str]:
    result: Dict[str, str] = {}
    if isinstance(value, dict):
        for key, map_value in value.items():
            if key in (None, "") or map_value in (None, ""):
                continue
            result[str(key)] = str(map_value)
        return result

    if isinstance(value, list):
        for item in value:
            if not isinstance(item, dict):
                continue
            guid = item.get("guid") or item.get("proxy_guid")
            target_id = item.get("id") or item.get("target_id")
            if guid in (None, "") or target_id in (None, ""):
                continue
            result[str(guid)] = str(target_id)
    return result


def _extract_input_proxy_maps(payload: Dict[str, Any]) -> Dict[str, Dict[str, str]]:
    proxies = {
        "pt": {},
        "curve": {},
        "area": {},
    }

    nested = payload.get("guid_proxies") if isinstance(payload.get("guid_proxies"), dict) else {}

    point_sources = [
        payload.get("pt_guid_proxies"),
        payload.get("pt_guid_proxy"),
        payload.get("point_guid_proxies"),
        payload.get("point_guid_proxy"),
        nested.get("pt"),
        nested.get("points"),
    ]
    curve_sources = [
        payload.get("curve_guid_proxies"),
        payload.get("curve_guid_proxy"),
        payload.get("line_guid_proxies"),
        payload.get("line_guid_proxy"),
        nested.get("curve"),
        nested.get("curves"),
        nested.get("lines"),
    ]
    area_sources = [
        payload.get("area_guid_proxies"),
        payload.get("area_guid_proxy"),
        payload.get("mesh_guid_proxies"),
        payload.get("mesh_guid_proxy"),
        nested.get("area"),
        nested.get("areas"),
        nested.get("meshes"),
    ]

    for source in point_sources:
        proxies["pt"].update(_coerce_proxy_map(source))
    for source in curve_sources:
        proxies["curve"].update(_coerce_proxy_map(source))
    for source in area_sources:
        proxies["area"].update(_coerce_proxy_map(source))

    return proxies


def import_line_model_json(
    payload: Dict[str, Any],
    *,
    decimals: int = 6,
    node_prefix: str = "N",
    edge_prefix: str = "E",
    mesh_prefix: str = "M",
    pt_guid_proxies: Any = None,
    curve_guid_proxies: Any = None,
    area_guid_proxies: Any = None,
    point_load_guid_proxies: Any = None,
    boundary_guid_proxies: Any = None,
) -> Dict[str, Any]:
    """Normalize line-model JSON into deduplicated vertices/edges and analysis target lists."""
    vertices = _extract_vertices(payload)
    edges = _extract_edges(payload)
    meshes = _extract_meshes(payload)
    input_proxies = _extract_input_proxy_maps(payload)
    # Explicit proxy inputs override/extend proxies embedded in the model payload.
    input_proxies["pt"].update(_coerce_proxy_map(pt_guid_proxies))
    input_proxies["curve"].update(_coerce_proxy_map(curve_guid_proxies))
    input_proxies["area"].update(_coerce_proxy_map(area_guid_proxies))

    # Fallback for models that only contain lines with embedded start/end node data.
    if not vertices and not edges:
        edges = _extract_lines_only(payload)

    node_by_key: Dict[Tuple[float, float, float], str] = {}
    node_records: List[Dict[str, Any]] = []
    point_guid_proxy: Dict[str, str] = dict(input_proxies["pt"])

    def ensure_node_id(point: Point) -> str:
        rounded = (round(point[0], decimals), round(point[1], decimals), round(point[2], decimals))
        existing = node_by_key.get(rounded)
        if existing is not None:
            return existing

        node_id = f"{node_prefix}{len(node_records) + 1}"
        node_by_key[rounded] = node_id
        node_records.append(
            {
                "id": node_id,
                "x": rounded[0],
                "y": rounded[1],
                "z": rounded[2],
            }
        )
        return node_id

    source_vertex_id_to_new: Dict[str, str] = {}
    for vertex in vertices:
        point = _first_point(vertex, vertex.get("point"), vertex.get("xyz"), vertex.get("coords"))
        if point is None:
            continue
        new_id = ensure_node_id(point)
        source_id = vertex.get("id")
        if source_id is not None:
            source_vertex_id_to_new[str(source_id)] = new_id
        vertex_guid = _edge_or_node_guid(vertex)
        if vertex_guid is not None:
            point_guid_proxy[vertex_guid] = new_id

    edge_records: List[Dict[str, Any]] = []
    seen_edge_pairs: Dict[Tuple[str, str], str] = {}
    curve_guid_proxy: Dict[str, str] = dict(input_proxies["curve"])

    for raw_edge in edges:
        attrs = raw_edge.get("attributes") if isinstance(raw_edge.get("attributes"), dict) else {}

        start_id = None
        end_id = None

        for key in ("start_node_id", "start_node", "u", "from", "a"):
            value = raw_edge.get(key)
            if value is not None and str(value) in source_vertex_id_to_new:
                start_id = source_vertex_id_to_new[str(value)]
                break
        for key in ("end_node_id", "end_node", "v", "to", "b"):
            value = raw_edge.get(key)
            if value is not None and str(value) in source_vertex_id_to_new:
                end_id = source_vertex_id_to_new[str(value)]
                break

        if start_id is None or end_id is None:
            start_point, end_point = _line_start_end(raw_edge)
            if start_id is None and start_point is not None:
                start_id = ensure_node_id(start_point)
            if end_id is None and end_point is not None:
                end_id = ensure_node_id(end_point)

        if start_id is None or end_id is None or start_id == end_id:
            continue

        pair = tuple(sorted((start_id, end_id)))
        if pair in seen_edge_pairs:
            continue

        edge_id = f"{edge_prefix}{len(edge_records) + 1}"
        seen_edge_pairs[pair] = edge_id

        preserved_attrs = {k: v for k, v in attrs.items() if k not in ("start", "end", "start_node", "end_node")}

        edge_record = {
            "id": edge_id,
            "start_node": start_id,
            "end_node": end_id,
            "attributes": preserved_attrs,
        }

        source_edge_id = raw_edge.get("id")
        if source_edge_id is not None:
            edge_record["source_id"] = source_edge_id

        if "cross_sections" in raw_edge:
            edge_record["cross_sections"] = raw_edge["cross_sections"]
        elif "cross_sections" in attrs:
            edge_record["cross_sections"] = attrs.get("cross_sections")

        edge_records.append(edge_record)

        edge_guid = _edge_or_node_guid(raw_edge)
        if edge_guid is not None:
            curve_guid_proxy[edge_guid] = edge_id

    node_by_id: Dict[str, Dict[str, Any]] = {node["id"]: node for node in node_records}
    connected_edges_by_node: Dict[str, List[str]] = {}
    for edge in edge_records:
        start_node = str(edge["start_node"])
        end_node = str(edge["end_node"])
        connected_edges_by_node.setdefault(start_node, []).append(str(edge["id"]))
        connected_edges_by_node.setdefault(end_node, []).append(str(edge["id"]))

    joint_records: List[Dict[str, Any]] = []
    for node_id, connected_edges in sorted(connected_edges_by_node.items()):
        # A joint is a node where at least two member lines meet.
        unique_edges = sorted(set(connected_edges))
        if len(unique_edges) < 2:
            continue

        node = node_by_id.get(node_id, {})
        joint_records.append(
            {
                "id": f"J{len(joint_records) + 1}",
                "node_id": node_id,
                "x": node.get("x"),
                "y": node.get("y"),
                "z": node.get("z"),
                "connected_edges": unique_edges,
                "degree": len(unique_edges),
            }
        )

    mesh_records: List[Dict[str, Any]] = []
    area_guid_proxy: Dict[str, str] = dict(input_proxies["area"])
    for raw_mesh in meshes:
        mesh_id = f"{mesh_prefix}{len(mesh_records) + 1}"
        attrs = raw_mesh.get("attributes") if isinstance(raw_mesh.get("attributes"), dict) else {}
        preserved_attrs = {k: v for k, v in attrs.items() if k not in ("guid", "rhino_guid", "area_guid", "mesh_guid")}

        mesh_record = {
            "id": mesh_id,
            "attributes": preserved_attrs,
        }

        for key in ("vertices", "faces", "mesh", "geometry", "brep"):
            if key in raw_mesh:
                mesh_record[key] = raw_mesh[key]

        source_mesh_id = raw_mesh.get("id")
        if source_mesh_id is not None:
            mesh_record["source_id"] = source_mesh_id

        mesh_records.append(mesh_record)

        mesh_guid = _edge_or_node_guid(raw_mesh)
        if mesh_guid is not None:
            area_guid_proxy[mesh_guid] = mesh_id

    member_line_ids = [edge["id"] for edge in edge_records]
    area_mesh_ids = [mesh["id"] for mesh in mesh_records]
    point_ids = [node["id"] for node in node_records]

    # Resolve explicitly tagged GUID inputs to filtered node ID lists.
    # Falls back to all node IDs when the proxy input is not provided.
    _pl_ids = _resolve_filtered_node_ids(point_load_guid_proxies, point_guid_proxy)
    _bp_ids = _resolve_filtered_node_ids(boundary_guid_proxies, point_guid_proxy)

    return {
        "schema": "structure_model_v1",
        "nodes": node_records,
        "edges": edge_records,
        "meshes": mesh_records,
        "joints": joint_records,
        "output_lists": {
            "member_lines": member_line_ids,
            "area_load_meshes": area_mesh_ids,
            "linear_load_lines": list(member_line_ids),
            "point_load_points": _pl_ids if _pl_ids is not None else point_ids,
            "boundary_points": _bp_ids if _bp_ids is not None else point_ids,
            "joint_nodes": [joint["node_id"] for joint in joint_records],
        },
        "guid_proxies": {
            "pt": dict(sorted(point_guid_proxy.items())),
            "curve": dict(sorted(curve_guid_proxy.items())),
            "area": dict(sorted(area_guid_proxy.items())),
        },
        "metadata": {
            "input_nodes": len(vertices),
            "input_edges": len(edges),
            "input_meshes": len(meshes),
            "output_nodes": len(node_records),
            "output_edges": len(edge_records),
            "output_meshes": len(mesh_records),
            "output_joints": len(joint_records),
            "deduplicated_nodes": max(0, len(vertices) - len(node_records)),
            "deduplicated_edges": max(0, len(edges) - len(edge_records)),
        },
    }


def as_output_lists(model: Dict[str, Any]) -> Dict[str, List[str]]:
    """Return GH-friendly validation lists from the normalized import payload."""
    payload = import_line_model_json(model)
    lists = payload.get("output_lists", {})
    return {
        "MemberLines": list(lists.get("member_lines", [])),
        "AreaLoadMeshes": list(lists.get("area_load_meshes", [])),
        "LinearLoadLines": list(lists.get("linear_load_lines", [])),
        "PointLoadPoints": list(lists.get("point_load_points", [])),
        "BoundaryPoints": list(lists.get("boundary_points", [])),
        "JointNodes": list(lists.get("joint_nodes", [])),
    }


def _read_json(path: str) -> Dict[str, Any]:
    with open(path, "r", encoding="utf-8") as stream:
        data = json.load(stream)
    if not isinstance(data, dict):
        raise ValueError("Input JSON root must be an object.")
    return data


def _write_json(path: str, payload: Dict[str, Any]) -> None:
    with open(path, "w", encoding="utf-8") as stream:
        json.dump(payload, stream, indent=2)


def _build_parser() -> argparse.ArgumentParser:
    parser = argparse.ArgumentParser(description="Normalize line model JSON into nodes/edges/meshes with IDs.")
    parser.add_argument("--input", required=True, help="Path to source JSON file.")
    parser.add_argument("--output", required=True, help="Path to normalized JSON output file.")
    parser.add_argument("--decimals", type=int, default=6, help="Rounding precision for vertex deduplication.")
    parser.add_argument("--node-prefix", default="N", help="Node ID prefix.")
    parser.add_argument("--edge-prefix", default="E", help="Edge ID prefix.")
    parser.add_argument("--mesh-prefix", default="M", help="Mesh ID prefix.")
    return parser


def main() -> None:
    parser = _build_parser()
    args = parser.parse_args()

    source = _read_json(args.input)
    normalized = import_line_model_json(
        source,
        decimals=args.decimals,
        node_prefix=args.node_prefix,
        edge_prefix=args.edge_prefix,
        mesh_prefix=args.mesh_prefix,
    )
    _write_json(args.output, normalized)


# GH Py3 auto-run block: input `model` (or `Model`) -> JSON payload + validation lists.
_g = globals()
if "model" in _g or "Model" in _g:
    _model_input = _g.get("model", _g.get("Model"))
    if isinstance(_model_input, dict):
        _pt_proxies = _g.get("pt_guid_proxies", _g.get("PtGuidProxies", _g.get("PointGuidProxies")))
        _curve_proxies = _g.get("curve_guid_proxies", _g.get("CurveGuidProxies", _g.get("LineGuidProxies")))
        _area_proxies = _g.get("area_guid_proxies", _g.get("AreaGuidProxies", _g.get("MeshGuidProxies")))
        _pl_proxies = _g.get("point_load_guid_proxies", _g.get("PointLoadGuidProxies"))
        _bp_proxies = _g.get("boundary_guid_proxies", _g.get("BoundaryGuidProxies"))

        ImportJson = import_line_model_json(
            _model_input,
            pt_guid_proxies=_pt_proxies,
            curve_guid_proxies=_curve_proxies,
            area_guid_proxies=_area_proxies,
            point_load_guid_proxies=_pl_proxies,
            boundary_guid_proxies=_bp_proxies,
        )
        _lists = ImportJson.get("output_lists", {})
        MemberLines = list(_lists.get("member_lines", []))
        AreaLoadMeshes = list(_lists.get("area_load_meshes", []))
        LinearLoadLines = list(_lists.get("linear_load_lines", []))
        PointLoadPoints = list(_lists.get("point_load_points", []))
        BoundaryPoints = list(_lists.get("boundary_points", []))
        JointNodes = list(_lists.get("joint_nodes", []))
        out = (
            "Imported nodes: {}, edges: {}, meshes: {}, joints: {}"
        ).format(
            len(ImportJson.get("nodes", [])),
            len(ImportJson.get("edges", [])),
            len(ImportJson.get("meshes", [])),
            len(ImportJson.get("joints", [])),
        )


if __name__ == "__main__":
    main()
# ---------- end json_importer_2 ----------

# ---- group: IMPORT MODELS / RHINO_to_DLUBAL
id = Guid([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])  # disabled
srf_4 = Surface([<surface referenced from the Rhino model> x4])  # disabled
panel_22 = Panel("1")  # disabled
py3_3 = Python3Script(L=srf_4, S=panel_22)  # -> No; inputs L: list, S: Int32; disabled; same code as py3_2
button = Button()  # disabled
py3_4 = Python3Script(reset=button)  # -> a; disabled
# ---------- py3_4: Python ----------
from compas_ghpython import unload_modules

unload_modules("gkr_hil_2024")
unload_modules("compas")

if reset:
    unload_modules("gkr_hil_2024")
    unload_modules("compas")
# ---------- end py3_4 ----------
panel_23 = Panel("""A
A
B
C
A
C""")  # disabled
panel_24 = Panel("1")  # disabled
list_13 = ValueList({"R_M1 0.08/0.12", "R_M1 0.1/0.16", "R_M1 0.16/0.16", "R_M1 0.16/0.2", "ROUND 0.02/H", "HEB 160 | DIN 1025-2:1995-11; ... | --", "R_M1 0.2/0.2"}, selected="HEB 160 | DIN 1025-2:1995-11; ... | --")  # disabled
panel_25 = Panel("""201
201
202
203
201
203""")  # disabled
cset = CreateSet(List=panel_23)  # -> Set, Map; disabled
panel_26 = Panel("0")  # disabled
panel_27 = Panel("inf")  # disabled
panel_28 = Panel("50000")  # disabled
surface = Surface(GHSurface=srf_4, SurfaceNo=py3_3, mode="Assemble")  # disabled
panel_29 = Panel("4 oder letztes")  # disabled
panel_30 = Panel("Facade")  # disabled
list_14 = ValueList({"LOAD_DIRECTION_GLOBAL_X_OR_USER_DEFINED_U_PROJECTED": 0, "LOAD_DIRECTION_GLOBAL_X_OR_USER_DEFINED_U_TRUE": 1, "LOAD_DIRECTION_GLOBAL_Y_OR_USER_DEFINED_V_PROJECTED": 2, "LOAD_DIRECTION_GLOBAL_Y_OR_USER_DEFINED_V_TRUE": 3, "LOAD_DIRECTION_GLOBAL_Z_OR_USER_DEFINED_W_PROJECTED": 4, "LOAD_DIRECTION_GLOBAL_Z_OR_USER_DEFINED_W_TRUE": 5, "LOAD_DIRECTION_LOCAL_X": 6, "LOAD_DIRECTION_LOCAL_Y": 7, "LOAD_DIRECTION_LOCAL_Z": 8, "LOAD_DIRECTION_PRINCIPAL_U": 9, "LOAD_DIRECTION_PRINCIPAL_V": 10}, selected="LOAD_DIRECTION_LOCAL_Z")  # disabled
py3_5 = Python3Script(guid=id, attribute_name=panel_30)  # -> value; disabled; same code as py3
list_15 = ValueList({"LOAD_DISTRIBUTION_CONCENTRATED_1": 0, "LOAD_DISTRIBUTION_CONCENTRATED_2": 1, "LOAD_DISTRIBUTION_CONCENTRATED_2x2": 2, "LOAD_DISTRIBUTION_CONCENTRATED_N": 3, "LOAD_DISTRIBUTION_CONCENTRATED_VARYING": 4, "LOAD_DISTRIBUTION_PARABOLIC": 5, "LOAD_DISTRIBUTION_TAPERED": 6, "LOAD_DISTRIBUTION_TRAPEZOIDAL": 7, "LOAD_DISTRIBUTION_UNIFORM": 8, "LOAD_DISTRIBUTION_UNIFORM_TOTAL": 9, "LOAD_DISTRIBUTION_VARYING": 10, "LOAD_DISTRIBUTION_VARYING_IN_Z": 11}, selected="LOAD_DISTRIBUTION_UNIFORM")  # disabled
list_16 = ValueList({"E_TYPE_MASS": 0, "LOAD_TYPE_AXIAL_DISPLACEMENT": 1, "LOAD_TYPE_AXIAL_STRAIN": 2, "LOAD_TYPE_COATING_CONTOUR": 3, "LOAD_TYPE_COATING_POLYGON": 4, "LOAD_TYPE_DISPLACEMENT": 5, "LOAD_TYPE_END_PRESTRESS": 6, "LOAD_TYPE_FORCE": 7, "LOAD_TYPE_FORM_FINDING": 8, "LOAD_TYPE_INITIAL_PRESTRESS": 9, "LOAD_TYPE_MOMENT": 10, "LOAD_TYPE_PIPE_CONTENT_FULL": 11, "LOAD_TYPE_PIPE_CONTENT_PARTIAL": 12, "LOAD_TYPE_PIPE_INTERNAL_PRESSURE": 13, "LOAD_TYPE_PRECAMBER": 14, "LOAD_TYPE_PRESTRESS_TENDON": 15, "LOAD_TYPE_ROTARY_MOTION": 16, "LOAD_TYPE_ROTATION": 17, "LOAD_TYPE_TEMPERATURE": 18, "LOAD_TYPE_TEMPERATURE_CHANGE": 19}, selected="LOAD_TYPE_FORCE")  # disabled
cull_3 = CullPattern(CullPattern=py3_5)  # disabled
panel_31 = Panel("1")  # disabled
design_situation = DesignSituation(mode="Assemble")  # disabled
panel_32 = Panel("1")  # disabled
py3_6 = Python3Script(L=cull_3, S=panel_31)  # -> No; inputs L: list, S: Int32; disabled; same code as py3_2
list_17 = ValueList({"GEOMETRICALLY_LINEAR": 0, "LARGE_DEFORMATIONS": 1, "SECOND_ORDER_P_DELTA": 2}, selected="GEOMETRICALLY_LINEAR")  # disabled
toggle_9 = BooleanToggle(False)  # disabled
load_case_classification_component_2 = LoadCaseClassificationComponent(ActionIndex=0, DesignIndex=0, StandardIndex=0, menu=[dropdown(0), dropdown(0), dropdown(0)])  # -> ActionCategory, DesignSituationType; disabled
panel_33 = Panel("1")  # disabled
surfaces = Data(surface)  # disabled
nodes = Data()  # disabled
static_analysis_settings_2 = StaticAnalysisSettings(StaticAnalysisSettingNo=panel_33, AnalysisType=list_17, ExceptionalHandling=toggle_9, mode="Assemble")  # disabled
button_2 = Button()  # disabled
list_18 = ValueList({"None": 0, "Microns": 1, "Millimeters": 2, "Centimeters": 3, "Meters": 4, "Kilometers": 5, "Microinches": 6, "Mils": 7, "Inches": 8, "Feet": 9, "Miles": 10, "CustomUnits": 11, "Angstroms": 12, "Nanometers": 13, "Decimeters": 14, "Dekameters": 15, "Hectometers": 16, "Megameters": 17, "Gigameters": 18, "Yards": 19, "PrinterPoints": 20, "PrinterPicas": 21, "NauticalMiles": 22, "AstronomicalUnits": 23, "LightYears": 24, "Parsecs": 25, "Unset": 26}, selected="Meters")  # disabled
überschreiben = BooleanToggle(True)  # disabled
toggle_10 = BooleanToggle(False)  # disabled
panel_34 = Panel("Self Weigth")  # disabled
panel_35 = Panel("1")  # disabled
toggle_11 = BooleanToggle(True)  # disabled
toggle_12 = BooleanToggle(True)  # disabled
toggle_13 = BooleanToggle(True)  # disabled
toggle_14 = BooleanToggle(False)  # disabled
load_case_3 = LoadCase(
    LoadCaseNo=panel_35,
    LoadCaseName=panel_34,
    StaticAnalysisSettings=static_analysis_settings_2,
    ActionCategory=load_case_classification_component_2.ActionCategory,
    SelfWeightActive=toggle_14,
    mode="Assemble")  # disabled
load_cases_materials = Data(flatten([load_case_3, material, static_analysis_settings_2]))  # disabled
panel_36 = Panel("dlubal from rhino")  # disabled

# ---- group: IMPORT MODELS / RHINO_to_DLUBAL / Linien in Grasshopper gespeichert
crv_7 = Curve(id)  # disabled

# ---- group: IMPORT MODELS / RHINO_to_DLUBAL / kürzeste Balken
len_2 = Length(Curve=crv_7)  # disabled
sort_2 = SortList(Keys=len_2, ValuesA=crv_7)  # -> Keys, ValuesA; disabled
expression = Expression(x=sort_2.Keys, Expression="x<0.1")  # disabled
dispatch = Dispatch(List=sort_2.ValuesA, DispatchPattern=expression)  # -> ListA, ListB; disabled
midpt_2 = CurveMiddle(Curve=dispatch.ListA)  # disabled
panel_37 = Panel("1")  # disabled
points_5 = PointList(Points=midpt_2, Size=panel_37)  # disabled

# ---- group: IMPORT MODELS / RHINO_to_DLUBAL
mcx = MultipleCurves(Curves=id)  # -> Points, IndexA, IndexB, ParamA, ParamB; disabled
cullpt = CullDuplicates(Points=mcx.Points, Tolerance=0.1, CullMode=3)  # -> Points, Indices, Valence; disabled
py3_7 = Python3Script(Pts=cullpt.Points)  # -> auflager; inputs Pts: list of Point3d; disabled
# ---------- py3_7: Python ----------
import Rhino
import Rhino.Geometry as rg

auflager = []

for pt in Pts:
    if pt.Z == 0:
        auflager.append(pt)
# ---------- end py3_7 ----------

# ---- group: IMPORT MODELS / RHINO_to_DLUBAL / Loads
nodal_load_2 = NodalLoad(mode="Assemble")  # disabled
surface_load_2 = SurfaceLoad(mode="Assemble")  # disabled
member_load_3 = MemberLoad(
    MemberLoadNo=py3_6,
    LoadCaseNo=panel_32,
    MembersNo=cull_3,
    LoadType=list_16,
    LoadDistribution=list_15,
    LoadDirection=list_14,
    mode="Assemble")  # disabled

# ---- group: IMPORT MODELS / RHINO_to_DLUBAL (continued)
crv_8 = Curve(crv_7)  # disabled
py3_8 = Python3Script(L=py3_7, S=panel_24)  # -> No; inputs L: list, S: Int32; disabled; same code as py3_2
item_3 = ListItem(List=crv_8, Index=panel_28, Wrap=True)  # disabled
member_loads = Data(member_load_3)  # disabled

# ---- group: IMPORT MODELS / RHINO_to_DLUBAL / Supports
nodal_support_2 = NodalSupport(
    GHNode=py3_7,
    SupportNo=py3_8,
    TranslationalSpringX=panel_26,
    TranslationalSpringY=panel_26,
    TranslationalSpringZ=panel_27,
    mode="Assemble")  # disabled

# ---- group: IMPORT MODELS / RHINO_to_DLUBAL
panel_38 = Panel("""201
202
203""")  # disabled
cross_section_2 = CrossSection(SectionNo=panel_38, SectionName=list_13, MaterialNo=material, mode="Assemble")  # disabled
panel_39 = Panel("50000")  # disabled
list_19 = ValueList({"SECTION_DISTRIBUTION_TYPE_CURVED": 0, "SECTION_DISTRIBUTION_TYPE_FISH_BEAM_LINEAR": 1, "SECTION_DISTRIBUTION_TYPE_FISH_BEAM_PARABOLIC": 2, "SECTION_DISTRIBUTION_TYPE_LINEAR": 3, "SECTION_DISTRIBUTION_TYPE_NONE": 4, "SECTION_DISTRIBUTION_TYPE_OFFSET_AT_BOTH_SIDES": 5, "SECTION_DISTRIBUTION_TYPE_OFFSET_AT_END_OF_MEMBER": 6, "SECTION_DISTRIBUTION_TYPE_OFFSET_AT_START_OF_MEMBER": 7, "SECTION_DISTRIBUTION_TYPE_PITCHED_CAMBERED_BEAM_WITH_CONSTANT_HEIGHT": 8, "SECTION_DISTRIBUTION_TYPE_PITCHED_CAMBERED_BEAM_WITH_VARIABLE_HEIGHT": 9, "SECTION_DISTRIBUTION_TYPE_SADDLE": 10, "SECTION_DISTRIBUTION_TYPE_TAPERED_AND_OFFSET_AT_BOTH_SIDES": 11, "SECTION_DISTRIBUTION_TYPE_TAPERED_AND_OFFSET_AT_END_OF_MEMBER": 12, "SECTION_DISTRIBUTION_TYPE_TAPERED_AND_OFFSET_AT_START_OF_MEMBER": 13, "SECTION_DISTRIBUTION_TYPE_TAPERED_AT_BOTH_SIDES": 14, "SECTION_DISTRIBUTION_TYPE_TAPERED_AT_END_OF_MEMBER": 15, "SECTION_DISTRIBUTION_TYPE_TAPERED_AT_START_OF_MEMBER": 16, "SECTION_DISTRIBUTION_TYPE_UNIFORM": 17}, selected="SECTION_DISTRIBUTION_TYPE_UNIFORM")  # disabled
long = LongestList(ListA=crv_8, ListB=cross_section_2, PaddingMode=2)  # -> ListA, ListB; disabled
list_20 = ValueList({"TYPE_ANCHOR": 0, "TYPE_BEAM": 1, "TYPE_BUCKLING": 2, "TYPE_CABLE": 3, "TYPE_CABLE_ON_PULLEYS": 4, "TYPE_COMPRESSION": 5, "TYPE_COUPLING_HINGE_HINGE": 6, "TYPE_COUPLING_HINGE_RIGID": 7, "TYPE_COUPLING_RIGID_HINGE": 8, "TYPE_COUPLING_RIGID_RIGID": 9, "TYPE_DAMPER": 10, "TYPE_DEEP_BEAM": 11, "TYPE_DEFINABLE_STIFFNESS": 12, "TYPE_DESIGN_STRIP": 13, "TYPE_JOIST": 14, "TYPE_LOAD_TRANSFER": 15, "TYPE_PILE": 16, "TYPE_RESULT_BEAM": 17, "TYPE_RESULT_LINE": 18, "TYPE_RIB": 19, "TYPE_RIGID": 20, "TYPE_SHEAR_WALL": 21, "TYPE_SPRING": 22, "TYPE_SURFACE_MODEL": 23, "TYPE_TENDON_CABLE": 24, "TYPE_TENDON_REBAR": 25, "TYPE_TENSION": 26, "TYPE_TRUSS": 27, "TYPE_TRUSS_ONLY_N": 28}, selected="TYPE_BEAM")  # disabled
member = Member(
    GHLine=long.ListA,
    SectionDistribution=list_19,
    SectionStart=long.ListB,
    MemberType=list_20,
    HingeStart=member_hinge,
    HingeEnd=member_hinge_2,
    mode="Assemble")  # disabled

members_cross_sections = Data(flatten([cross_section_2, member]))  # disabled
supports = Data(nodal_support_2)  # disabled
rfem_export = RFEM6ExportComponent(
    Run=toggle_10,
    Input=flatten([load_cases_materials, members_cross_sections, surfaces, supports, member_loads]),
    Units=list_18,
    FlipZAxis=toggle_13,
    UtilizeNodes=toggle_11,
    Overwrite=überschreiben,
    ReadLog=toggle_12,
    WsAddress=panel_2)  # -> RFEMData, Log, SuccessfulExport; disabled
panel_40 = Panel(rfem_export.SuccessfulExport)  # disabled
rec = DataRecorder(rfem_export.Log, DataLimit=-10, RecordData=True)  # disabled
panel_41 = Panel(rec)  # disabled

# ---- group: TRANSFORM+GEOMETRY
bang_2 = ExplodeTree(Data=unflatten)  # disabled
bang_3 = ExplodeTree(Data=unflatten)  # disabled

panel_42 = Panel("15")  # disabled
panel_43 = Panel("45")  # disabled
panel_44 = Panel("30")  # disabled
Z_2 = UnitZ(Factor=panel_42)  # disabled
Z_3 = UnitZ(Factor=panel_43)  # disabled
Z_4 = UnitZ(Factor=panel_44)  # disabled
move = Move(Geometry=bang_2, Motion=Z_3)  # -> Geometry, Transform; disabled
move_2 = Move(Geometry=bang_2, Motion=Z_4)  # -> Geometry, Transform; disabled
move_3 = Move(Geometry=bang_3, Motion=Z_2)  # -> Geometry, Transform; disabled
move_4 = Move(Geometry=pt_7, Motion=Z_2)  # -> Geometry, Transform; disabled
move_5 = Move(Geometry=pt_8, Motion=Z_2)  # -> Geometry, Transform; disabled
move_6 = Move(Geometry=item_2, Motion=Z_2)  # -> Geometry, Transform; disabled
pt_11 = Point(move_4.Geometry)  # disabled
line_2 = Line(move_3.Geometry)  # disabled
pt_12 = Point(move_5.Geometry)  # disabled
# ---- group: TRANSFORM+GEOMETRY / DUPLICATE MODEL_[30M]
number_slider_21 = Slider(0.048, range=0..1)  # disabled
number_slider_22 = Slider(0.242, range=0..1)  # disabled
line_3 = Line(move_2.Geometry)  # disabled
len_3 = Length(Curve=line_3)  # disabled
bnd = Bounds(Numbers=len_3)  # disabled
dom = ConstructDomain(DomainStart=number_slider_21, DomainEnd=number_slider_22)  # disabled
dedomain = DeconstructDomain(Domain=bnd)  # -> Start, End; disabled
number_slider_23 = Slider(0.067, range=0..1)  # disabled
midpt_3 = CurveMiddle(Curve=line_3)  # disabled
toggle_15 = BooleanToggle(True)  # disabled
remap = RemapNumbers(Value=len_3, Source=bnd, Target=dom)  # -> Mapped, Clipped; disabled
gradient = Gradient(
    LowerLimit=dedomain.End,
    UpperLimit=dedomain.Start,
    Parameter=len_3,
    stops=[0: RGB(234, 38, 0), 0.25: RGB(234, 126, 0), 0.5: RGB(254, 244, 84), 0.75: RGB(173, 203, 249), 1: RGB(75, 107, 169)])  # disabled
yz_2 = YZPlane(Origin=midpt_3)  # disabled
tag = TextTag3D(Location=yz_2, Text=len_3, Size=number_slider_23, Justification=7)  # disabled
line_prev = TTLineweightPreview(Geometry=line_3, StrokeColor=gradient, StrokeWeight=remap.Mapped, Absolute=toggle_15)  # disabled

# ---- group: COMPAS TIMBER OUTPUT / ORIGIN COMPAS TIMBER
number_slider_24 = Slider(0.2, range=0..1)  # disabled
number_slider_25 = Slider(0.16, range=0..1)  # disabled
line_4 = Line(bang_3)  # disabled
beam = CTBeam(centerline=line_4, width=number_slider_25, height=number_slider_24)  # -> Beam, Blank; inputs centerline: list, z_vector: list of Vector3d, width: list of Double, height: list of Double, category: list of String, updateRefObj: Boolean; disabled
#   port centerline: Referenced curve or line, Guid of curve or line in the active Rhino document.
#   port z_vector: Vector defining the orientation of the cross-section (corresponds to the height dimension). If None, a default will be taken.
#   port width: Width of the cross-section (usually the smaller dimension).
#   port height: Height of the cross-section (usually the larger dimension).
#   port category: Category of a beam.
#   port updateRefObj: (optional) If True, the attributes in the referenced object will be updated/overwritten with the new values given here.
#   port Beam: Beam object(s).
#   port Blank: Shape of the beam's blank.
# ---------- beam: Python ----------
# r: compas_timber>=1.0.2
"""Creates a Beam from a LineCurve."""

# flake8: noqa
import Grasshopper
import Rhino
import rhinoscriptsyntax as rs
import System
from compas.scene import Scene
from compas_rhino.conversions import line_to_compas
from compas_rhino.conversions import vector_to_compas

from compas_timber.elements import Beam as CTBeam
from compas_timber.ghpython.rhino_object_name_attributes import update_rhobj_attributes_name
from compas_timber.ghpython.ghcomponent_helpers import list_input_valid_cpython


class Beam_fromCurve(Grasshopper.Kernel.GH_ScriptInstance):
    def RunScript(self,
            centerline: System.Collections.Generic.List[object],
            z_vector: System.Collections.Generic.List[Rhino.Geometry.Vector3d],
            width: System.Collections.Generic.List[float],
            height: System.Collections.Generic.List[float],
            category: System.Collections.Generic.List[str],
            updateRefObj: bool):
        # minimum inputs required
        if not list_input_valid_cpython(ghenv, centerline, "Centerline"):
            return
        if not width:
            length = self._get_centerline_length(centerline)
            width = [length / 20]
        if not height:
            length = self._get_centerline_length(centerline)
            height = [length / 10]

        # reformat unset parameters for consistency
        if not z_vector:
            z_vector = [None]
        if not category:
            category = [None]

        beams = []
        blanks = []
        scene = Scene()

        if centerline and height and width:
            # check list lengths for consistency
            N = len(centerline)
            if len(z_vector) not in (0, 1, N):
                ghenv.Component.AddRuntimeMessage(
                    Grasshopper.Kernel.GH_RuntimeMessageLevel.Error, " In 'ZVector' I need either none, one or the same number of inputs as the Crv parameter."
                )
            if len(width) not in (1, N):
                ghenv.Component.AddRuntimeMessage(Grasshopper.Kernel.GH_RuntimeMessageLevel.Error, " In 'W' I need either one or the same number of inputs as the Crv parameter.")
            if len(height) not in (1, N):
                ghenv.Component.AddRuntimeMessage(Grasshopper.Kernel.GH_RuntimeMessageLevel.Error, " In 'H' I need either one or the same number of inputs as the Crv parameter.")
            if len(category) not in (0, 1, N):
                ghenv.Component.AddRuntimeMessage(
                    Grasshopper.Kernel.GH_RuntimeMessageLevel.Error, " In 'Category' I need either none, one or the same number of inputs as the Crv parameter."
                )

            # duplicate data if None or single value
            if len(z_vector) != N:
                z_vector = [z_vector[0] for _ in range(N)]
            if len(width) != N:
                width = [width[0] for _ in range(N)]
            if len(height) != N:
                height = [height[0] for _ in range(N)]
            if len(category) != N:
                category = [category[0] for _ in range(N)]

            for line, z, w, h, c in zip(centerline, z_vector, width, height, category):
                guid, geometry = self._get_guid_and_geometry(line)
                rhino_line = rs.coerceline(geometry)
                line = line_to_compas(rhino_line)

                z = vector_to_compas(z) if z else None
                beam = CTBeam.from_centerline(centerline=line, width=w, height=h, z_vector=z)
                beam.attributes["rhino_guid"] = str(guid) if guid else None
                beam.attributes["category"] = c
                if updateRefObj and guid:
                    update_rhobj_attributes_name(guid, "width", str(w))
                    update_rhobj_attributes_name(guid, "height", str(h))
                    update_rhobj_attributes_name(guid, "zvector", str(list(beam.frame.zaxis)))
                    update_rhobj_attributes_name(guid, "category", c)

                beams.append(beam)
                scene.add(beam.blank)

        blanks = scene.draw()

        return beams, blanks

    def _get_guid_and_geometry(self, line):
        # internalized curves and GH geometry will not have persistent GUIDs, referenced Rhino objects will
        # type hint on the input has to be 'ghdoc' for this to work
        guid = None
        geometry = line
        rhino_obj = Rhino.RhinoDoc.ActiveDoc.Objects.FindId(line)
        if rhino_obj:
            guid = line
            geometry = rhino_obj.Geometry
        return guid, geometry

    def _get_centerline_length(self, centerline):
        centerline_length = []
        for i in centerline:
            centerline_length.append(rs.CurveLength(i))
        if centerline_length:
            length_average = sum(centerline_length) / len(centerline_length)
        else:
            length_average = 1
        return length_average
# ---------- end beam ----------
toggle_16 = BooleanToggle(False)  # disabled
merge_8 = Merge(Data1=beam.Beam)  # disabled
model = CTModel(Elements=flatten(merge_8), CreateGeometry=toggle_16)  # -> Model, Geometry, DebugInfo; inputs Elements: list, Containers: list, JointRules: list, Features: list, MaxDistance: Double, CreateGeometry: Boolean; disabled
#   port Elements: Collection of Beams
#   port Containers: Container elements, such as walls, floors, roofs, etc.
#   port JointRules: Collection of joint rules.
#   port Features: Collection of feature definitions.
#   port MaxDistance: Max Distance Tolerance for topology detection.
#   port CreateGeometry: If True, Beam and joint geometry is created for visualization.
#   port Model: Model object.
#   port Geometry: Geometry of the beams and joints.
#   port DebugInfo: Debug information object in the case of feature or joining errors.
# ---------- model: Python ----------
# r: compas_timber>=1.0.2
"""Creates an Model"""

import Grasshopper
import Rhino
import System
from compas.scene import Scene
from compas.tolerance import TOL
from compas.tolerance import Tolerance

from compas_timber.design import DebugInfomation
from compas_timber.design import JointRuleSolver
from compas_timber.design import WallPopulator
from compas_timber.elements import Beam
from compas_timber.elements import Plate
from compas_timber.errors import FeatureApplicationError
from compas_timber.ghpython import error
from compas_timber.ghpython import warning
from compas_timber.model import TimberModel

# workaround for https://github.com/gramaziokohler/compas_timber/issues/280
TOL.absolute = 1e-6


class ModelComponent(Grasshopper.Kernel.GH_ScriptInstance):
    @property
    def component(self):
        return ghenv.Component  # type: ignore

    def RunScript(self,
            Elements: System.Collections.Generic.List[object],
            Containers: System.Collections.Generic.List[object],
            JointRules: System.Collections.Generic.List[object],
            Features: System.Collections.Generic.List[object],
            MaxDistance: float,
            CreateGeometry: bool):
        # this used to be default behavior in Rhino7.. I think..
        Elements = Elements or []
        Containers = Containers or []
        JointRules = JointRules or []
        Features = Features or []

        if not Elements:
            warning(self.component, "Input parameter Beams failed to collect data")
        if not JointRules:
            warning(self.component, "Input parameter JointRules failed to collect data")
        if not (Elements or Containers):  # shows beams even if no joints are found
            return
        if MaxDistance is None:
            MaxDistance = TOL.ABSOLUTE  # compared to calculted distance, so shouldn't be just 0.0

        tol = self.get_tol()
        Model = TimberModel(tolerance=tol)
        debug_info = DebugInfomation()

        ##### Adding elements #####
        self.add_elements_to_model(Model, Elements, Containers)

        ##### Wall populating #####
        handled_pairs, wall_joints = self.handle_populators(Model, Containers, MaxDistance)

        ##### Handle joinery #####
        # checks elements compatibility and generates Joints
        JointRules = [j for j in JointRules if j is not None]

        solver = JointRuleSolver(JointRules, max_distance=MaxDistance)
        joint_errors, _ = solver.apply_rules_to_model(Model)  # TODO: figure out best way to pass out unjoined_clusters

        for je in joint_errors:
            debug_info.add_joint_error(je)

        # applies extensions and features resulting from joints
        bje = Model.process_joinery()
        if bje:
            debug_info.add_joint_error(bje)

        ##### Handle user features #####
        if Features:
            feature_errors = self.handle_features(Features)
            debug_info.add_feature_error(feature_errors)

        ##### Visualization #####
        Geometry, errors = self.handle_geometry(Model, CreateGeometry)
        for geo_error in errors:
            debug_info.add_feature_error(geo_error)

        ##### Error Handling #####
        if debug_info.has_errors:
            warning(self.component, "Error found during joint creation. See DebugInfo output for details.")

        return Model, Geometry, debug_info

    def get_tol(self):
        units = Rhino.RhinoDoc.ActiveDoc.GetUnitSystemName(True, True, True, True)
        if units == "m":
            return Tolerance(unit="M", absolute=1e-6, relative=1e-6)
        elif units == "mm":
            return Tolerance(unit="MM", absolute=1e-3, relative=1e-3)
        else:
            error(self.component, f"Unsupported unit: {units}")
            return

    def add_elements_to_model(self, model, elements, containers):
        """Adds elements to the model and groups them by slab."""
        elements = [e for e in elements if e is not None]
        for element in elements:
            element.reset()
            model.add_element(element)

        containers = [c for c in containers if c is not None]

        for index, c_def in enumerate(containers):
            slab = c_def.slab
            model.add_group_element(slab, name=slab.name + str(index))

    def handle_populators(self, model, containers, max_distance):
        # Handle wall populators
        model.connect_adjacent_walls()
        config_sets = [c_def.config_set for c_def in containers]
        populators = []
        if any(config_sets):
            populators = WallPopulator.from_model(model, config_sets)

        handled_pairs = []
        wall_joints = []
        for populator, slab in zip(populators, list(model.slabs)):
            elements = populator.create_elements()
            model.add_elements(elements, parent=slab.name)
            joint_definitions = populator.create_joints(elements, max_distance)
            wall_joints.extend(joint_definitions)
            for j_def in joint_definitions:
                element_a, element_b = j_def.elements
                handled_pairs.append({element_a, element_b})

        return handled_pairs, wall_joints

    def handle_features(self, features):
        feature_errors = []
        features = [f for f in features if f is not None]
        for f_def in features:
            if not f_def.elements:
                warning(self.component, "Features defined in model must have elements defined. Features without elements will be ignored")
                continue

            for element in f_def.elements:
                try:
                    element.add_features(f_def.feature_from_element(element))
                except FeatureApplicationError as ex:
                    feature_errors.append(ex)
        return feature_errors

    def handle_geometry(self, Model, CreateGeometry):
        scene = Scene()
        errors = []
        for element in Model.elements():
            if CreateGeometry:
                scene.add(element.geometry)
                if getattr(element, "debug_info", False):
                    errors.append(element.debug_info)
            else:
                if isinstance(element, Beam):
                    scene.add(element.blank)
                elif isinstance(element, Plate):
                    scene.add(element.shape)
                else:
                    scene.add(element.geometry)
        return scene.draw(), errors
# ---------- end model ----------

# ---- group: KARAMBA_MODEL SET UP
# LOADING CONDITIONS
# * facade load?
# * snow, wind, etc. load?
pt_13 = Point(pt_11)  # disabled
item_4 = ListItem(List=move_6.Geometry, Index=0, Wrap=True)  # -> Item, Item1; disabled
pdecon_2 = Deconstruct(Point=pt_13)  # -> XComponent, YComponent, ZComponent; disabled
pt_14 = Point(move_4.Geometry)  # disabled
crv_cp = CurveClosestPoint(Point=pt_14, Curve=item_4.Item)  # -> Point, Parameter, Distance; disabled
sort_3 = SortList(Keys=pdecon_2.ZComponent, ValuesA=pt_13)  # -> reverse(Keys), reverse(ValuesA); disabled
pt_15 = Point(move_4.Geometry)  # disabled
crv_cp_2 = CurveClosestPoint(Point=pt_15, Curve=item_4.Item1)  # -> Point, Parameter, Distance; disabled
round = Round(Number=crv_cp.Distance)  # -> Nearest, Floor, Ceiling; disabled
item_5 = ListItem(List=sort_3.Keys, Index=0, Wrap=True)  # disabled
panel_45 = Panel("0")  # disabled
similar_2 = Similarity(FirstNumber=sort_3.Keys, SecondNumber=item_5, Threshold=0.1)  # -> Similarity, AbsoluteDifference; disabled
round_2 = Round(Number=crv_cp_2.Distance)  # -> Nearest, Floor, Ceiling; disabled
panel_46 = Panel("0")  # disabled
similar_3 = Similarity(FirstNumber=round.Nearest, SecondNumber=panel_45, Threshold=0.1)  # -> Similarity, AbsoluteDifference; disabled
cull_4 = CullPattern(List=sort_3.ValuesA, CullPattern=similar_2.Similarity)  # disabled
similar_4 = Similarity(FirstNumber=round_2.Nearest, SecondNumber=panel_46, Threshold=0.1)  # -> Similarity, AbsoluteDifference; disabled
cull_5 = CullPattern(List=pt_14, CullPattern=similar_3.Similarity)  # disabled
del_2 = DelaunayMesh(Points=cull_4, Plane=PlaneXY(0, 0, 0))  # disabled
cull_6 = CullPattern(List=pt_15, CullPattern=similar_4.Similarity)  # disabled
panel_47 = Panel("-1.1")  # disabled
quad_2 = Quadrangulate(Mesh=del_2, Angle=0.03490658504, Ratio=0.875)  # -> Mesh, Count; disabled
Z_5 = UnitZ(Factor=panel_47)  # disabled
panel_48 = Panel("-9")  # disabled
Z_6 = UnitZ(Factor=panel_48)  # disabled
pt_16 = Point([cull_5, cull_6])  # disabled
loads = LoadsKaramba3D(Vector=Vector(0, 0, -1), LCase="LC0", mode="Gravity")  # disabled
loads_2 = LoadsKaramba3D(ForceVector=Z_6, Local=False, PosInd=pt_16, LCase="LC0", mode="Point")  # disabled
loads_3 = LoadsKaramba3D(Vector=Z_5, Mesh=quad_2.Mesh, LCase="LC0", mode="MeshLoad -Const.", menu=[buttons(on, off, off), buttons(on, on)])  # disabled
merge_9 = Merge(Data1=loads, Data2=loads_2, Data3=loads_3)  # -> flatten(Result); disabled
load = LoadKaramba3D(merge_9)  # disabled

# BOUNDARY CONDITIONS
fsim = FindSimilarMember(Data=pt_12, Set=pt_11)  # -> Hit, Index; disabled
xy_2 = XYPlane(Origin=Point(0, 0, 0))  # disabled
pt_17 = Point(fsim.Hit)  # disabled
supp_2 = SupportKaramba3D(
    PosInd=pt_17,
    PlaneOfReference=xy_2,
    Ct_kN_m=Vector(0, 0, 0),
    Cr_kNm_rad=Vector(0, 0, 0),
    menu=[buttons(on, on, on, on, on, on)])  # disabled
item_6 = ListItem(List=pt_17, Index=0, Wrap=True)  # disabled

# TIMBER STRUTS
line_5 = Line(line_2)  # disabled
number_slider_26 = Slider(20, range=0..100)  # disabled
number_slider_27 = Slider(16, range=0..100)  # disabled
matselect_5 = MaterialSelectionKaramba3D(menu=[dropdown(1), dropdown(4), dropdown(11)])  # disabled
crosec_10 = CrossSectionKaramba3D(
    FamilyNameOfCrossSection="DefaultCroSec",
    Material=matselect_5,
    Height_cm=number_slider_26,
    UpperFlangeWidth_cm=number_slider_27,
    LowerFlangeWidth_cm=number_slider_27,
    mode="Trapezoid")  # disabled
panel_49 = Panel("XZ")  # disabled
lineelem_2 = CreateLinearElementKaramba3D(
    Line=line_5,
    Identifier=panel_49,
    CrossSection=crosec_10,
    LimitDistance_m=0.005,
    BucklingLengthY_m=-1,
    BucklingLengthZ_m=-1,
    BucklingLengthLT_m=-1,
    Bending=True,
    ToPolylineMaxAngle=0.25,
    ToPolylineTolerance=0.1,
    ToPolylineMaxEdgeLength=0.25,
    New=True,
    Remove=True,
    mode="LineToBeam",
    GuidGeneratorSeed=1272918615)  # -> Element, Points, Info; disabled

# CLT PANELS
crv_9 = Curve(bang.Branch1)  # disabled
move_7 = Move(Geometry=crv_9, Motion=Z_2)  # -> Geometry, Transform; disabled
explode_2 = Explode(Curve=move_7.Geometry, Recursive=True)  # -> flatten(Segments), Vertices; disabled
llinter_2 = LineLineIntersectionKaramba3D(IntersectingLines=explode_2.Segments, LinesToIntersect=explode_2.Segments, LimitDistance_m=0.005)  # -> InterSecPoints, flatten(LineSubSegments); disabled
rdpoints_2 = RemoveDuplicatePointsKaramba3D(Point=llinter_2.InterSecPoints, LimitDistance=0.005)  # -> OutPoint, Info, Indexes; disabled
del_3 = DelaunayMesh(Points=rdpoints_2.OutPoint, Plane=PlaneXY(0, 0, 0))  # disabled
quad_3 = Quadrangulate(Mesh=del_3, Angle=0.03490658504, Ratio=0.875)  # -> Mesh, Count; disabled
explode_3 = MeshExplode(Mesh=quad_3.Mesh, Interpolate=False)  # -> flatten(Faces)
number_slider_28 = Slider(6, range=0..100)  # disabled
matselect_6 = MaterialSelectionKaramba3D(menu=[dropdown(1), dropdown(4), dropdown(11)])  # disabled
crosec_11 = CrossSectionKaramba3D(FamilyNameOfCrossSection="DefaultCroSec", Material=matselect_6, Height_cm=number_slider_28, mode="Shell - Const")  # disabled
surfelem_2 = CreateSurfaceElementKaramba3D(Mesh=explode_3, Identifier=panel_49, CrossSection=crosec_11, LimitDistance_m=0.005, Bending=True, mode="MeshToShell")  # -> Element, Points, Info; disabled

# JOINTS & CONNECTIONS
beam_joints_2 = BeamJointsKaramba3D(
    BeamIdentifier=panel_49,
    CtKNMAtStartingNode=Vector(0, 0, 0),
    CrKNmRadAtStartingNode=vec_3.Vector,
    CtKNMAtEndNode=Vector(0, 0, 0),
    CrKNmRadAtEndNode=vec_4.Vector,
    menu=[buttons(off, off, off, on, on, on), buttons(off, off, off, on, on, on)])  # disabled

merge_10 = Merge(Data1=surfelem_2.Element, Data2=lineelem_2.Element)  # disabled
element_2 = ElementKaramba3D(merge_10)  # disabled

# ----
# RESULTS /
# STRUCTURAL BEHAVIOR
assemble = AssembleModelKaramba3D(Elem=element_2, Support=supp_2, Load=load, Joint=beam_joints_2, LimitDistance_m=0.005)  # -> Model, Info, Mass_kg, CentreOfGravity, LoadCaseNames; disabled
opticrosec = OptimizeCrossSectionKaramba3D(
    Model=assemble.Model,
    CrossSections=crosec_9,
    MaximumUtilization=1,
    MaximumDisplacement_cm=-1,
    MaximumVirtualWork_kNcm=0.01,
    NumberOfUtilizationIterations=5,
    NumberOfDisplacementIterations=5,
    NumberOfDisplacementIncrementsPerIteration=2,
    DisplacementTolerance=0.01,
    NumberOfSamplePoints=3,
    ElasticDesign=True,
    GammaM0=1,
    GammaM1=1.1,
    SwayFrame=True)  # -> OptimizedModel, Info, Mass_kg, MaximumDisplacement_cm, ElasticEnergyChange_kNm, MaximumUtilizationViewInsufficientCrossSections, MaximumDisplacementViewLimitCrossSections; disabled
analyse = AnalyseKaramba3D(Model=opticrosec.OptimizedModel)  # -> AnalysedModel, MaximumDisplacement_cm, ResultingForce_kN, ChangeOfElasticEnergy_kNm; disabled
modelview = ModelViewKaramba3D(Model=analyse.AnalysedModel)  # -> Model, DeformedMesh, DeformedAxes, DeformedModel, MaximumDeformation; disabled
beamview = BeamViewKaramba3D(Model=modelview.Model)  # -> Model, MeshesOfRenderedBeams, DeformedBeamAxes, LegendColours, LegendTags; disabled
shellview = ShellViewKaramba3D(Model=modelview.Model, IndexOfLayer=0)  # -> Model, MeshesOfRenderedShells, LegendColours, LegendTags; disabled
legend = LegendKaramba3D(
    Colors=beamview.LegendColours,
    Tags=beamview.LegendTags,
    Scale=0.8,
    Textsize=30,
    Legend_HasHeader=False,
    Legend_Justification=1,
    Legend_Position=2)  # disabled

# ---- group: COMPAS TIMBER OUTPUT / OUTPUT COMPAS TIMBER
disassemble = DisassembleModelKaramba3D(Model=modelview.Model)  # -> Model, Point, Beam, Shell, Support, Load, Line, Mesh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; disabled
disassemble_2 = DisassembleElementKaramba3D(Element=disassemble.Beam)  # -> Element, ElementIdentifier, AxisOfElement, CrossSection, Joint, Material, LocalCoordinateSystem, ElementIsActive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; disabled
disassemble_3 = DisassembleCrossSectionKaramba3D(CroSec=disassemble_2.CrossSection)  # -> CrossSection, FamilyNameOfCrossSection, TypeNameOfCrossSection, ElemIdentifiers, Colour, Material, LocalEccentricity_cm, flatten(Heights_cm)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; disabled
deplane = DeconstructPlane(Plane=disassemble_2.LocalCoordinateSystem)  # -> Origin, XAxis, YAxis, ZAxis; disabled
multiplication_2 = Multiplication(A=disassemble_3.Heights_cm, _001=0.01)  # disabled
multiplication_3 = Multiplication(A=disassemble_3.MaximumWidth_cm, _001=0.01)  # disabled
beam_2 = CTBeam(centerline=disassemble_2.AxisOfElement, z_vector=deplane.ZAxis, width=multiplication_3, height=multiplication_2)  # -> Beam, Blank; inputs centerline: list, z_vector: list of Vector3d, width: list of Double, height: list of Double, category: list of String, updateRefObj: Boolean; disabled; same code as beam
model_2 = CTModel(Elements=flatten(beam_2.Beam))  # -> Model, Geometry, DebugInfo; inputs Elements: list, Containers: list, JointRules: list, Features: list, MaxDistance: Double, CreateGeometry: Boolean; disabled; same code as model
cset_2 = CreateSet(List=flatten(disassemble_3.Heights_cm))  # -> Set, Map; disabled
cset_3 = CreateSet(List=flatten(disassemble_3.MaximumWidth_cm))  # -> Set, Map; disabled
item_7 = ListItem(List=beam_2.Beam, Index=0, Wrap=True)  # -> Item, Item1; disabled
panel_50 = Panel(cset_3.Set)  # disabled
panel_51 = Panel(cset_2.Set)  # disabled
panel_52 = Panel(disassemble_3.Heights_cm)  # disabled
panel_53 = Panel("""0.2
0.2
5""")  # disabled
panel_54 = Panel("""0.2
0.2
5""")  # disabled
button_3 = Button()  # disabled
button_4 = Button()  # disabled
button_5 = Button()  # disabled
bakewithboxmap = CTBakeWithBoxMap(model=model_2.Model, map_size=panel_54, bake=button_5)  # inputs map_size: list of Double, bake: Boolean; disabled
#   port model: Model object (optional).
#   port map_size: Scaling of the BoxMap in x,y,z directions (list of three positive values) (optional).
#   port bake: Set to True to Bake. Nothing happens if None or False.
# ---------- bakewithboxmap: Python ----------
# r: compas_timber>=1.0.2
# flake8: noqa
import math
import random

import Grasshopper
import System
import Rhino
import rhinoscriptsyntax as rs
from compas_rhino.conversions import frame_to_rhino
from compas_timber.ghpython import item_input_valid_cpython

from Rhino import Render
from Rhino.Geometry import Interval
from Rhino.Geometry import Plane


class BakeBoxMap(Grasshopper.Kernel.GH_ScriptInstance):
    def RunScript(self,
            model,
            map_size: System.Collections.Generic.List[float],
            bake: bool):
        if map_size and len(map_size) != 3:
            ghenv.Component.AddRuntimeMessage(
                Grasshopper.Kernel.GH_RuntimeMessageLevel.Error, "Input parameter MapSize requires exactly three float values (scale factors in x,y,z directions)"
            )
            return

        unit_system = Rhino.RhinoDoc.ActiveDoc.ModelUnitSystem

        if map_size:
            dimx, dimy, dimz = map_size
        else:
            # for the pine 251 material bitmap, rotated
            if unit_system == Rhino.UnitSystem.Meters:
                dimx = 0.2
                dimy = 0.2
                dimz = 1.0
            if unit_system == Rhino.UnitSystem.Centimeters:
                dimx = 20
                dimy = 20
                dimz = 100
            if unit_system == Rhino.UnitSystem.Millimeters:
                dimx = 200
                dimy = 200
                dimz = 1000

        if not item_input_valid_cpython(ghenv, model, "Model"):
            return

        if not bake:
            return

        try:
            frames = [frame_to_rhino(b.frame) for b in model.beams]
            breps = [beam.geometry.native_brep for beam in model.beams]

            if frames and breps:
                rs.EnableRedraw(False)

                for brep, frame in zip(breps, frames):
                    guid = Rhino.RhinoDoc.ActiveDoc.Objects.Add(brep)
                    boxmap = self.create_box_map(frame, dimx, dimy, dimz)
                    Rhino.RhinoDoc.ActiveDoc.Objects.ModifyTextureMapping(guid, 1, boxmap)
        finally:
            rs.EnableRedraw(True)

    @staticmethod
    def create_box_map(pln, sx, sy, sz):
        """
        pln: frame of beam box, where x=main axis, y=width, z=height
        sx,sy,sz: box map size in x,y,z direction
        """

        v = pln.YAxis
        w = pln.ZAxis
        pt = pln.Origin

        # random deviation
        a = math.pi * 0.5
        randangle = (random.random() - 0.5) * a
        v.Rotate(randangle, pln.XAxis)

        b = math.pi * 0.01
        randangle = (random.random() - 0.5) * b
        w.Rotate(randangle, pln.XAxis)

        randpos = sx * random.random()
        pt += pln.XAxis * randpos

        # create box mapping
        mappingPln = Plane(pt, w, v)
        dx = Interval(-sx * 0.5, sx * 0.5)
        dy = Interval(-sy * 0.5, sy * 0.5)
        dz = Interval(-sz * 0.5, sz * 0.5)

        BoxMap = Render.TextureMapping.CreateBoxMapping(mappingPln, dx, dy, dz, False)

        return BoxMap
# ---------- end bakewithboxmap ----------
bakewithboxmap_2 = CTBakeWithBoxMap(model=model_2.Model, map_size=panel_53, bake=button_4)  # inputs map_size: list of Double, bake: Boolean; disabled
#   port model: Model object (optional).
#   port map_size: Scaling of the BoxMap in x,y,z directions (list of three positive values) (optional).
#   port bake: Set to True to Bake. Nothing happens if None or False.
# ---------- bakewithboxmap_2: Python ----------
# r: compas_timber>=1.0.2
# flake8: noqa
import math
import random

import Grasshopper
import System
import Rhino
import rhinoscriptsyntax as rs
from compas_rhino.conversions import frame_to_rhino
from compas_timber.ghpython import item_input_valid_cpython

from Rhino import Render
from Rhino.Geometry import Interval
from Rhino.Geometry import Plane


class BakeBoxMap(Grasshopper.Kernel.GH_ScriptInstance):
    def RunScript(self,
            model,
            map_size: System.Collections.Generic.List[float],
            bake: bool):
        if map_size and len(map_size) != 3:
            ghenv.Component.AddRuntimeMessage(
                Grasshopper.Kernel.GH_RuntimeMessageLevel.Error, "Input parameter MapSize requires exactly three float values (scale factors in x,y,z directions)"
            )
            return

        unit_system = Rhino.RhinoDoc.ActiveDoc.ModelUnitSystem

        if map_size:
            dimx, dimy, dimz = map_size
        else:
            # for the pine 251 material bitmap, rotated
            if unit_system == Rhino.UnitSystem.Meters:
                dimx = 0.2
                dimy = 0.2
                dimz = 1.0
            if unit_system == Rhino.UnitSystem.Centimeters:
                dimx = 20
                dimy = 20
                dimz = 100
            if unit_system == Rhino.UnitSystem.Millimeters:
                dimx = 200
                dimy = 200
                dimz = 1000

        if not item_input_valid_cpython(ghenv, model, "Model"):
            return

        if not bake:
            return

        try:
            # frames = [frame_to_rhino(b.frame) for b in model.beams]
            # breps = [beam.geometry.native_brep for beam in model.beams]

            # if frames and breps:
            #     rs.EnableRedraw(False)

            #     for brep, frame in zip(breps, frames):
            #         guid = Rhino.RhinoDoc.ActiveDoc.Objects.Add(brep)
            #         boxmap = self.create_box_map(frame, dimx, dimy, dimz)
            #         Rhino.RhinoDoc.ActiveDoc.Objects.ModifyTextureMapping(guid, 1, boxmap)
            #
            from compas.datastructures import Mesh
            from compas_rhino.conversions import mesh_to_rhino
            import Rhino.Geometry as rg
            frames, meshes = [], []
            for beam in model.beams:
                frame = frame_to_rhino(beam.frame)
                frames.append(frame)
                mesh = Mesh()

                brep = beam.geometry
                ms = brep.to_meshes()
                for m in ms:
                    mesh.join(m)
                rh_mesh = mesh_to_rhino(mesh)
                rh_mesh.Vertices.CombineIdentical(True, True)
                meshes.append(rh_mesh)

            if frames and meshes:
                rs.EnableRedraw(False)

                for mesh, frame in zip(meshes, frames):
                    guid = Rhino.RhinoDoc.ActiveDoc.Objects.Add(mesh)
                    boxmap = self.create_box_map(frame, dimx, dimy, dimz)
                    Rhino.RhinoDoc.ActiveDoc.Objects.ModifyTextureMapping(guid, 1, boxmap)

                

        finally:
            rs.EnableRedraw(True)

    @staticmethod
    def create_box_map(pln, sx, sy, sz):
        """
        pln: frame of beam box, where x=main axis, y=width, z=height
        sx,sy,sz: box map size in x,y,z direction
        """

        v = pln.YAxis
        w = pln.ZAxis
        pt = pln.Origin

        # random deviation
        a = math.pi * 0.5
        randangle = (random.random() - 0.5) * a
        v.Rotate(randangle, pln.XAxis)

        b = math.pi * 0.01
        randangle = (random.random() - 0.5) * b
        w.Rotate(randangle, pln.XAxis)

        randpos = sx * random.random()
        pt += pln.XAxis * randpos

        # create box mapping
        mappingPln = Plane(pt, w, v)
        dx = Interval(-sx * 0.5, sx * 0.5)
        dy = Interval(-sy * 0.5, sy * 0.5)
        dz = Interval(-sz * 0.5, sz * 0.5)

        BoxMap = Render.TextureMapping.CreateBoxMapping(mappingPln, dx, dy, dz, False)

        return BoxMap
# ---------- end bakewithboxmap_2 ----------

# ---- group: TRANSFORM+GEOMETRY (continued)
multiplication_4 = Multiplication(A=disassemble_3.Heights_cm, B=disassemble_3.MaximumWidth_cm)  # disabled

# ---- group: TRANSFORM+GEOMETRY / DUPLICATE MODEL_[45M]
number_slider_29 = Slider(0.048, range=0..1)  # disabled
number_slider_30 = Slider(0.242, range=0..1)  # disabled
line_6 = Line(move.Geometry)  # disabled
bnd_2 = Bounds(Numbers=multiplication_4)  # disabled
dom_2 = ConstructDomain(DomainStart=number_slider_29, DomainEnd=number_slider_30)  # disabled
dedomain_2 = DeconstructDomain(Domain=bnd_2)  # -> Start, End; disabled
number_slider_31 = Slider(0.067, range=0..1)  # disabled
midpt_4 = CurveMiddle(Curve=line_6)  # disabled
toggle_17 = BooleanToggle(True)  # disabled
remap_2 = RemapNumbers(Value=multiplication_4, Source=bnd_2, Target=dom_2)  # -> Mapped, Clipped; disabled
gradient_2 = Gradient(
    LowerLimit=dedomain_2.End,
    UpperLimit=dedomain_2.Start,
    Parameter=multiplication_4,
    stops=[0: RGB(234, 38, 0), 0.25: RGB(234, 126, 0), 0.5: RGB(254, 244, 84), 0.75: RGB(173, 203, 249), 1: RGB(75, 107, 169)])  # disabled
yz_3 = YZPlane(Origin=midpt_4)  # disabled
tag_2 = TextTag3D(Location=yz_3, Text=multiplication_4, Size=number_slider_31, Justification=7)  # disabled
line_prev_2 = TTLineweightPreview(Geometry=line_6, StrokeColor=gradient_2, StrokeWeight=remap_2.Mapped, Absolute=toggle_17)  # disabled

# ---- group: COMPAS TIMBER OUTPUT / OUTPUT COMPAS TIMBER / Output: Mesh
bakewithboxmap_3 = CTBakeWithBoxMap(model=model_2.Model, map_size=panel_54, bake=button_3)  # inputs map_size: list of Double, bake: Boolean; disabled
#   port model: Model object (optional).
#   port map_size: Scaling of the BoxMap in x,y,z directions (list of three positive values) (optional).
#   port bake: Set to True to Bake. Nothing happens if None or False.
# ---------- bakewithboxmap_3: Python ----------
# r: compas_timber>=1.0.2
# flake8: noqa
import math
import random

import Grasshopper
import System
import Rhino
import rhinoscriptsyntax as rs
from compas_rhino.conversions import frame_to_rhino
from compas_timber.ghpython import item_input_valid_cpython

from Rhino import Render
from Rhino.Geometry import Interval
from Rhino.Geometry import Plane

from Rhino.Geometry import Box, Mesh
from compas_rhino.conversions import box_to_rhino

class BakeBoxMap(Grasshopper.Kernel.GH_ScriptInstance):
    def RunScript(self,
            model,
            map_size: System.Collections.Generic.List[float],
            bake: bool):
        if map_size and len(map_size) != 3:
            ghenv.Component.AddRuntimeMessage(
                Grasshopper.Kernel.GH_RuntimeMessageLevel.Error, "Input parameter MapSize requires exactly three float values (scale factors in x,y,z directions)"
            )
            return

        unit_system = Rhino.RhinoDoc.ActiveDoc.ModelUnitSystem

        if map_size:
            dimx, dimy, dimz = map_size
        else:
            # for the pine 251 material bitmap, rotated
            if unit_system == Rhino.UnitSystem.Meters:
                dimx = 0.2
                dimy = 0.2
                dimz = 1.0
            if unit_system == Rhino.UnitSystem.Centimeters:
                dimx = 20
                dimy = 20
                dimz = 100
            if unit_system == Rhino.UnitSystem.Millimeters:
                dimx = 200
                dimy = 200
                dimz = 1000

        if not item_input_valid_cpython(ghenv, model, "Model"):
            return

        if not bake:
            return

        try:
            frames, meshes = [], []
            for beam in model.beams:
                frame = frame_to_rhino(beam.frame)
                frames.append(frame)

                box = beam.shape
                box = box_to_rhino(box)
                mesh = Mesh.CreateFromBox(box, 1, 1, 1)
                meshes.append(mesh)

            if frames and meshes:
                rs.EnableRedraw(False)

                for mesh, frame in zip(meshes, frames):
                    guid = Rhino.RhinoDoc.ActiveDoc.Objects.Add(mesh)
                    boxmap = self.create_box_map(frame, dimx, dimy, dimz)
                    Rhino.RhinoDoc.ActiveDoc.Objects.ModifyTextureMapping(guid, 1, boxmap)
        finally:
            rs.EnableRedraw(True)

    @staticmethod
    def create_box_map(pln, sx, sy, sz):
        """
        pln: frame of beam box, where x=main axis, y=width, z=height
        sx,sy,sz: box map size in x,y,z direction
        """

        v = pln.YAxis
        w = pln.ZAxis
        pt = pln.Origin

        # random deviation
        a = math.pi * 0.5
        randangle = (random.random() - 0.5) * a
        v.Rotate(randangle, pln.XAxis)

        b = math.pi * 0.01
        randangle = (random.random() - 0.5) * b
        w.Rotate(randangle, pln.XAxis)

        randpos = sx * random.random()
        pt += pln.XAxis * randpos

        # create box mapping
        mappingPln = Plane(pt, w, v)
        dx = Interval(-sx * 0.5, sx * 0.5)
        dy = Interval(-sy * 0.5, sy * 0.5)
        dz = Interval(-sz * 0.5, sz * 0.5)

        BoxMap = Render.TextureMapping.CreateBoxMapping(mappingPln, dx, dy, dz, False)

        return BoxMap
# ---------- end bakewithboxmap_3 ----------

# ---- group: MASS/VOLUME QTY TAKE OFF
mesh_2 = Mesh(beamview.MeshesOfRenderedBeams)  # disabled
total_weight_kg = Panel(opticrosec.Mass_kg)  # disabled
volume = Volume(Geometry=mesh_2)  # -> Volume, Centroid; disabled
ma = MassAddition(Input=volume.Volume)  # -> Result, PartialResults; disabled
total_volume_cm = Panel(ma.PartialResults)  # disabled

# ---- group: MAX DEFLECTION [CM]
number_slider_32 = Slider(3, range=0..10)  # disabled
max_deflection_cm = Panel(analyse.MaximumDisplacement_cm)  # disabled
pt_18 = Point(Point(128.46, 47.8, 19.94))  # disabled
xz_2 = XZPlane(Origin=pt_18)  # disabled
tag_3 = TextTag3D(Location=xz_2, Text=max_deflection_cm, Size=number_slider_32, Justification=7)  # disabled

# ---- group: LOADING CONDITIONS
list_21 = ValueList({"DL_T": -0.5, "DL_FD": -9, "LL": -1.5, "WL_X": -1.1, "WL_Y": -1.1, "SL": -1.1}, selected="SL")
list_22 = ValueList({"DL_T": -0.5, "DL_FD": -9, "LL": -1.5, "WL_X": -1.1, "WL_Y": -1.1, "SL": -1.1}, selected="DL_FD")
list_23 = ValueList({"DL_T", "DL_FD", "LL", "WL_X", "WL_Y", "SL"}, selected="DL_T")
list_24 = ValueList({"DL_T": -0.5, "DL_FD": -9, "LL": -1.5, "WL_X": -1.1, "WL_Y": -1.1, "SL": -1.1}, selected="LL")

# ----
Z_7 = UnitZ(Factor=list_22)
Z_8 = UnitZ(Factor=list_21)

# ---- group: LOADING CONDITIONS / LINEAR LOADS (DEAD LOAD)
loads_4 = LoadsKaramba3D(ForceVector=Z_7, Local=False, PosInd=json_importer.PointLoadPoints, LCase=list_5, mode="Point")

# ---- group: LOADING CONDITIONS / ASYMETRIC LOADING (LIVE, WIND-X, WIND-Y SNOW)
loads_5 = LoadsKaramba3D(
    Vectors=Z_8,
    Mesh=json_importer.AreaLoadMeshes,
    LCase=list_4,
    mode="MeshLoad -Variable",
    menu=[buttons(on, off, off), buttons(on, on)])

# ---- group: LOADING CONDITIONS / SELF_WEIGHT (DEAD LOAD)
loads_6 = LoadsKaramba3D(Vector=Z, LCase=list_23, mode="Gravity")

# ----
Z_9 = UnitZ(Factor=list_24)

# ---- group: LOADING CONDITIONS / AREA LOADING (LIVE, WIND-X, WIND-Y SNOW)
loads_7 = LoadsKaramba3D(
    Vector=Z_9,
    Mesh=json_importer.AreaLoadMeshes,
    LCase=list_6,
    mode="MeshLoad -Const.",
    menu=[buttons(on, off, off), buttons(on, on)])

# ---- group: LOADING CONDITIONS (continued)
merge_11 = Merge(Data1=loads_6, Data2=loads_4, Data3=loads_7, Data4=loads_5)  # -> flatten(Result)
load_2 = LoadKaramba3D(merge_11)

# ----
# RESULTS /
# STRUCTURAL BEHAVIOR
assemble_2 = AssembleModelKaramba3D(Elem=element, Support=supp, Load=load_2, Joint=beam_joints, LimitDistance_m=0.005)  # -> Model, Info, Mass_kg, CentreOfGravity, LoadCaseNames
opticrosec_2 = OptimizeCrossSectionKaramba3D(
    Model=assemble_2.Model,
    CrossSections=crosec_6,
    MaximumUtilization=1,
    MaximumDisplacement_cm=-1,
    MaximumVirtualWork_kNcm=0.01,
    NumberOfUtilizationIterations=5,
    NumberOfDisplacementIterations=5,
    NumberOfDisplacementIncrementsPerIteration=2,
    DisplacementTolerance=0.01,
    NumberOfSamplePoints=3,
    ElasticDesign=True,
    GammaM0=1,
    GammaM1=1.1,
    SwayFrame=True)  # -> OptimizedModel, Info, Mass_kg, MaximumDisplacement_cm, ElasticEnergyChange_kNm, MaximumUtilizationViewInsufficientCrossSections, MaximumDisplacementViewLimitCrossSections
analyse_2 = AnalyseKaramba3D(Model=opticrosec_2.OptimizedModel)  # -> AnalysedModel, MaximumDisplacement_cm, ResultingForce_kN, ChangeOfElasticEnergy_kNm
modelview_2 = ModelViewKaramba3D(Model=analyse_2.AnalysedModel)  # -> Model, DeformedMesh, DeformedAxes, DeformedModel, MaximumDeformation
beamview_2 = BeamViewKaramba3D(Model=modelview_2.Model)  # -> Model, MeshesOfRenderedBeams, DeformedBeamAxes, LegendColours, LegendTags
mesh_3 = Mesh(beamview_2.MeshesOfRenderedBeams)
total_weight_kg_2 = Panel(opticrosec_2.Mass_kg)
volume_2 = Volume(Geometry=mesh_3)  # -> Volume, Centroid
legend_2 = LegendKaramba3D(
    Colors=beamview_2.LegendColours,
    Tags=beamview_2.LegendTags,
    Scale=0.8,
    Textsize=30,
    Legend_HasHeader=False,
    Legend_Justification=1,
    Legend_Position=2)
ma_2 = MassAddition(Input=volume_2.Volume)  # -> Result, PartialResults
total_volume_cm_2 = Panel(ma_2.PartialResults)
shellview_2 = ShellViewKaramba3D(Model=modelview_2.Model, IndexOfLayer=0)  # -> Model, MeshesOfRenderedShells, LegendColours, LegendTags
pt_19 = Point(Point(99.91606605, 82.08842956, 0))
max_deflection_cm_2 = Panel(analyse_2.MaximumDisplacement_cm)
xz_3 = XZPlane(Origin=pt_19)
tag_4 = TextTag3D(Location=xz_3, Text=max_deflection_cm_2, Size=Slider(2.5, range=0..10), Justification=7)

legend_3 = LegendKaramba3D(
    Colors=shellview_2.LegendColours,
    Tags=shellview_2.LegendTags,
    Scale=0.8,
    Textsize=30,
    Legend_HasHeader=False,
    Legend_Justification=1,
    Legend_Position=2)

# ---- group: OUTPUT LINE MODEL
json_exporter_2 = Python3Script(Model=modelview_2.Model)  # -> out, ExportJson, MemberLines, AreaLoadMeshes, PointLoadPoints, BoundaryPoints, JointNodes, GHLineCurves, GHNodes, GHSurfaces
# ---------- json_exporter_2: Python ----------
# Minimal Input Cheat-Sheet (Exporter)
# - GH input names: model (or Model)
# - Function call: build_structure_export_json(model=...)
# - Minimal runnable input: {}
# - Minimal useful topology input:
#   {"nodes": [{"id": "N1", "x": 0, "y": 0, "z": 0}, {"id": "N2", "x": 1, "y": 0, "z": 0}],
#    "edges": [{"id": "E1", "start_node": "N1", "end_node": "N2"}]}
# - GH outputs: ExportJson, MemberLines, AreaLoadMeshes, LinearLoadLines, PointLoadPoints,
#   BoundaryPoints, JointNodes, GHLineCurves, GHNodes, GHSurfaces, out
from __future__ import annotations

import argparse
import json
from typing import Any, Dict, List, Optional, Tuple

try:
    import Rhino.Geometry as rg  # type: ignore
except Exception:  # pragma: no cover - Rhino is not available in CLI environments.
    rg = None


Point = Tuple[float, float, float]


def _normalize_dict_list(value: Any) -> List[Dict[str, Any]]:
    if value is None:
        return []
    if isinstance(value, list):
        return [item for item in value if isinstance(item, dict)]
    if isinstance(value, dict):
        return [value]
    return []


def _pick_list(payload: Dict[str, Any], *keys: str) -> List[Dict[str, Any]]:
    for key in keys:
        items = _normalize_dict_list(payload.get(key))
        if items:
            return items
    return []


def _as_point(value: Any) -> Optional[Point]:
    if value is None:
        return None

    if isinstance(value, dict):
        if all(axis in value for axis in ("x", "y", "z")):
            try:
                return (float(value["x"]), float(value["y"]), float(value["z"]))
            except (TypeError, ValueError):
                return None

        for key in ("point", "xyz", "coords", "position"):
            if key in value:
                return _as_point(value[key])

        return None

    if isinstance(value, (list, tuple)) and len(value) >= 3:
        try:
            return (float(value[0]), float(value[1]), float(value[2]))
        except (TypeError, ValueError):
            return None

    return None


def _first_point(*candidates: Any) -> Optional[Point]:
    for candidate in candidates:
        point = _as_point(candidate)
        if point is not None:
            return point
    return None


def _node_point(node: Dict[str, Any]) -> Optional[Point]:
    attrs = node.get("attributes") if isinstance(node.get("attributes"), dict) else {}
    return _first_point(node, node.get("point"), attrs.get("point"), attrs.get("xyz"))


def _line_start_end(edge: Dict[str, Any], node_by_id: Dict[str, Dict[str, Any]]) -> Tuple[Optional[Point], Optional[Point]]:
    attrs = edge.get("attributes") if isinstance(edge.get("attributes"), dict) else {}
    start_id = edge.get("start_node") or edge.get("u") or edge.get("from") or attrs.get("start_node")
    end_id = edge.get("end_node") or edge.get("v") or edge.get("to") or attrs.get("end_node")

    start_node = node_by_id.get(str(start_id)) if start_id not in (None, "") else None
    end_node = node_by_id.get(str(end_id)) if end_id not in (None, "") else None
    return _node_point(start_node or {}), _node_point(end_node or {})


def _point_to_output(point: Point) -> Any:
    if rg is None:
        return point
    return rg.Point3d(point[0], point[1], point[2])


def _edge_to_output_curve(edge: Dict[str, Any], node_by_id: Dict[str, Dict[str, Any]]) -> Optional[Any]:
    start, end = _line_start_end(edge, node_by_id)
    if start is None or end is None:
        return None
    if rg is None:
        return {"start": start, "end": end}
    return rg.LineCurve(_point_to_output(start), _point_to_output(end))


def _mesh_geometry_candidates(mesh: Dict[str, Any]) -> List[Any]:
    return [
        mesh.get("mesh"),
        mesh.get("geometry"),
        mesh.get("brep"),
        mesh.get("surface"),
    ]


def _mesh_to_output_geometry(mesh: Dict[str, Any]) -> Optional[Any]:
    vertices = mesh.get("vertices") if isinstance(mesh.get("vertices"), list) else None
    faces = mesh.get("faces") if isinstance(mesh.get("faces"), list) else None

    if rg is not None:
        for candidate in _mesh_geometry_candidates(mesh):
            if candidate is None:
                continue
            if isinstance(candidate, (rg.Mesh, rg.Brep, rg.Surface)):
                return candidate
            if hasattr(candidate, "ToBrep"):
                try:
                    return candidate.ToBrep()
                except Exception:
                    pass

        if vertices and faces:
            rh_mesh = rg.Mesh()
            for vertex in vertices:
                point = _as_point(vertex)
                if point is None:
                    continue
                rh_mesh.Vertices.Add(point[0], point[1], point[2])

            for face in faces:
                if not isinstance(face, (list, tuple)):
                    continue
                indices = [int(value) for value in face[:4]]
                if len(indices) == 3:
                    rh_mesh.Faces.AddFace(indices[0], indices[1], indices[2])
                elif len(indices) == 4:
                    rh_mesh.Faces.AddFace(indices[0], indices[1], indices[2], indices[3])

            if rh_mesh.Vertices.Count > 0 and rh_mesh.Faces.Count > 0:
                rh_mesh.Normals.ComputeNormals()
                rh_mesh.Compact()
                return rh_mesh

    for candidate in _mesh_geometry_candidates(mesh):
        if candidate is not None:
            return candidate

    if vertices and faces:
        return {"vertices": vertices, "faces": faces}

    return None


def _edge_or_node_guid(item: Dict[str, Any]) -> Optional[str]:
    attrs = item.get("attributes") if isinstance(item.get("attributes"), dict) else {}
    for key in (
        "guid",
        "rhino_guid",
        "proxy_guid",
        "point_guid",
        "pt_guid",
        "curve_guid",
        "line_guid",
        "area_guid",
        "mesh_guid",
    ):
        value = item.get(key)
        if value not in (None, ""):
            return str(value)
        attr_value = attrs.get(key)
        if attr_value not in (None, ""):
            return str(attr_value)
    return None


def _coerce_proxy_map(value: Any) -> Dict[str, str]:
    result: Dict[str, str] = {}
    if isinstance(value, dict):
        for key, map_value in value.items():
            if key in (None, "") or map_value in (None, ""):
                continue
            result[str(key)] = str(map_value)
        return result

    if isinstance(value, list):
        for item in value:
            if not isinstance(item, dict):
                continue
            guid = item.get("guid") or item.get("proxy_guid")
            target_id = item.get("id") or item.get("target_id")
            if guid in (None, "") or target_id in (None, ""):
                continue
            result[str(guid)] = str(target_id)
    return result


def _extract_input_proxy_maps(payload: Dict[str, Any]) -> Dict[str, Dict[str, str]]:
    proxies = {
        "pt": {},
        "curve": {},
        "area": {},
    }

    nested = payload.get("guid_proxies") if isinstance(payload.get("guid_proxies"), dict) else {}

    point_sources = [
        payload.get("pt_guid_proxies"),
        payload.get("pt_guid_proxy"),
        payload.get("point_guid_proxies"),
        payload.get("point_guid_proxy"),
        nested.get("pt"),
        nested.get("points"),
    ]
    curve_sources = [
        payload.get("curve_guid_proxies"),
        payload.get("curve_guid_proxy"),
        payload.get("line_guid_proxies"),
        payload.get("line_guid_proxy"),
        nested.get("curve"),
        nested.get("curves"),
        nested.get("lines"),
    ]
    area_sources = [
        payload.get("area_guid_proxies"),
        payload.get("area_guid_proxy"),
        payload.get("mesh_guid_proxies"),
        payload.get("mesh_guid_proxy"),
        nested.get("area"),
        nested.get("areas"),
        nested.get("meshes"),
    ]

    for source in point_sources:
        proxies["pt"].update(_coerce_proxy_map(source))
    for source in curve_sources:
        proxies["curve"].update(_coerce_proxy_map(source))
    for source in area_sources:
        proxies["area"].update(_coerce_proxy_map(source))

    return proxies


def _resolve_node_id(node: Dict[str, Any], index: int, prefix: str = "N") -> str:
    for key in ("id", "node_id", "identifier"):
        value = node.get(key)
        if value not in (None, ""):
            return str(value)
    return f"{prefix}{index + 1}"


def _resolve_edge_id(edge: Dict[str, Any], index: int, prefix: str = "E") -> str:
    for key in ("id", "edge_id", "line_id", "member_id", "identifier"):
        value = edge.get(key)
        if value not in (None, ""):
            return str(value)
    return f"{prefix}{index + 1}"


def _to_node_ref(value: Any, node_ids: List[str]) -> Optional[str]:
    if value is None:
        return None

    text = str(value)
    if text in node_ids:
        return text

    try:
        index = int(value)
    except (TypeError, ValueError):
        return None

    if 0 <= index < len(node_ids):
        return node_ids[index]
    if 1 <= index <= len(node_ids):
        return node_ids[index - 1]
    return None


def _edge_node_ids(edge: Dict[str, Any], node_ids: List[str]) -> Optional[tuple[str, str]]:
    attrs = edge.get("attributes") if isinstance(edge.get("attributes"), dict) else {}

    start = None
    end = None

    for key in ("start_node", "u", "from", "a"):
        start = _to_node_ref(edge.get(key), node_ids)
        if start is not None:
            break
    for key in ("end_node", "v", "to", "b"):
        end = _to_node_ref(edge.get(key), node_ids)
        if end is not None:
            break

    if start is None:
        start = _to_node_ref(attrs.get("start_node"), node_ids)
    if end is None:
        end = _to_node_ref(attrs.get("end_node"), node_ids)

    if start is None or end is None or start == end:
        return None

    return start, end


def build_structure_export_json(
    model: Dict[str, Any],
    *,
    schema: str = "structure_model_v1",
) -> Dict[str, Any]:
    """Build export JSON with nodes, edges, meshes and member breps from a Karamba model."""
    nodes_in = _pick_list(model, "nodes", "vertices", "points")
    edges_in = _pick_list(model, "edges", "lines", "members", "beams")
    meshes_in = _pick_list(model, "meshes", "areas", "shells", "faces")
    member_elements_in = _pick_list(model, "member_elements", "elements", "beam_elements")
    member_breps_in = _pick_list(model, "member_breps", "breps")
    sections_in = _pick_list(model, "cross_sections", "sections")
    input_proxies = _extract_input_proxy_maps(model)

    node_records: List[Dict[str, Any]] = []
    node_ids: List[str] = []
    point_guid_proxy: Dict[str, str] = dict(input_proxies["pt"])

    for index, node in enumerate(nodes_in):
        node_id = _resolve_node_id(node, index)
        node_ids.append(node_id)

        record = {
            "id": node_id,
            "x": float(node.get("x", 0.0)),
            "y": float(node.get("y", 0.0)),
            "z": float(node.get("z", 0.0)),
        }

        for key in ("support", "restraint", "attributes"):
            if key in node:
                record[key] = node[key]

        node_records.append(record)

        node_guid = _edge_or_node_guid(node)
        if node_guid is not None:
            point_guid_proxy[node_guid] = node_id

    section_by_edge: Dict[str, Any] = {}
    for entry in sections_in:
        edge_key = entry.get("edge_id") or entry.get("line_id") or entry.get("id")
        if edge_key is None:
            continue
        section_by_edge[str(edge_key)] = entry.get("section") or entry.get("name") or entry

    elements_by_edge: Dict[str, List[Dict[str, Any]]] = {}
    for element in member_elements_in:
        edge_key = element.get("edge_id") or element.get("line_id") or element.get("member_id")
        if edge_key is None:
            continue
        edge_id = str(edge_key)
        elements_by_edge.setdefault(edge_id, []).append(element)

    breps_by_edge: Dict[str, List[Dict[str, Any]]] = {}
    for brep in member_breps_in:
        edge_key = brep.get("edge_id") or brep.get("line_id") or brep.get("member_id")
        if edge_key is None:
            continue
        edge_id = str(edge_key)
        breps_by_edge.setdefault(edge_id, []).append(brep)

    edge_records: List[Dict[str, Any]] = []
    export_breps: List[Dict[str, Any]] = []
    curve_guid_proxy: Dict[str, str] = dict(input_proxies["curve"])

    for index, edge in enumerate(edges_in):
        edge_id = _resolve_edge_id(edge, index)
        node_pair = _edge_node_ids(edge, node_ids)
        if node_pair is None:
            continue

        start_node, end_node = node_pair
        edge_record: Dict[str, Any] = {
            "id": edge_id,
            "start_node": start_node,
            "end_node": end_node,
        }

        if edge_id in section_by_edge:
            edge_record["cross_section"] = section_by_edge[edge_id]
        elif "cross_section" in edge:
            edge_record["cross_section"] = edge["cross_section"]
        elif "cross_sections" in edge:
            edge_record["cross_section"] = edge["cross_sections"]

        members = elements_by_edge.get(edge_id, [])
        if members:
            edge_record["member_elements"] = members

        edge_records.append(edge_record)

        edge_guid = _edge_or_node_guid(edge)
        if edge_guid is not None:
            curve_guid_proxy[edge_guid] = edge_id

        for brep in breps_by_edge.get(edge_id, []):
            export_breps.append(
                {
                    "edge_id": edge_id,
                    "member_id": brep.get("member_id") or brep.get("id") or edge_id,
                    "brep": brep.get("brep") or brep.get("geometry") or brep,
                }
            )

    mesh_records: List[Dict[str, Any]] = []
    area_guid_proxy: Dict[str, str] = dict(input_proxies["area"])
    for index, mesh in enumerate(meshes_in):
        mesh_id = str(mesh.get("id") or mesh.get("mesh_id") or f"M{index + 1}")
        attrs = mesh.get("attributes") if isinstance(mesh.get("attributes"), dict) else {}
        preserved_attrs = {k: v for k, v in attrs.items() if k not in ("guid", "rhino_guid", "area_guid", "mesh_guid")}

        mesh_record: Dict[str, Any] = {
            "id": mesh_id,
            "attributes": preserved_attrs,
        }
        for key in ("vertices", "faces", "mesh", "geometry", "brep"):
            if key in mesh:
                mesh_record[key] = mesh[key]

        mesh_records.append(mesh_record)

        mesh_guid = _edge_or_node_guid(mesh)
        if mesh_guid is not None:
            area_guid_proxy[mesh_guid] = mesh_id

    member_line_ids = [edge["id"] for edge in edge_records]
    area_mesh_ids = [mesh["id"] for mesh in mesh_records]
    point_ids = [node["id"] for node in node_records]

    node_by_id: Dict[str, Dict[str, Any]] = {node["id"]: node for node in node_records}
    connected_edges_by_node: Dict[str, List[str]] = {}
    for edge in edge_records:
        start_node = str(edge["start_node"])
        end_node = str(edge["end_node"])
        connected_edges_by_node.setdefault(start_node, []).append(str(edge["id"]))
        connected_edges_by_node.setdefault(end_node, []).append(str(edge["id"]))

    joint_records: List[Dict[str, Any]] = []
    for node_id, connected_edges in sorted(connected_edges_by_node.items()):
        # A joint is a node where at least two member lines meet.
        unique_edges = sorted(set(connected_edges))
        if len(unique_edges) < 2:
            continue

        node = node_by_id.get(node_id, {})
        joint_records.append(
            {
                "id": f"J{len(joint_records) + 1}",
                "node_id": node_id,
                "x": node.get("x"),
                "y": node.get("y"),
                "z": node.get("z"),
                "connected_edges": unique_edges,
                "degree": len(unique_edges),
            }
        )

    return {
        "schema": schema,
        "nodes": node_records,
        "edges": edge_records,
        "meshes": mesh_records,
        "member_breps": export_breps,
        "joints": joint_records,
        "output_lists": {
            "member_lines": member_line_ids,
            "area_load_meshes": area_mesh_ids,
            "linear_load_lines": list(member_line_ids),
            "point_load_points": point_ids,
            "boundary_points": list(point_ids),
            "joint_nodes": [joint["node_id"] for joint in joint_records],
        },
        "guid_proxies": {
            "pt": dict(sorted(point_guid_proxy.items())),
            "curve": dict(sorted(curve_guid_proxy.items())),
            "area": dict(sorted(area_guid_proxy.items())),
        },
        "metadata": {
            "source": "karamba",
            "input_nodes": len(nodes_in),
            "input_edges": len(edges_in),
            "input_meshes": len(meshes_in),
            "output_nodes": len(node_records),
            "output_edges": len(edge_records),
            "output_meshes": len(mesh_records),
            "output_member_breps": len(export_breps),
            "output_joints": len(joint_records),
        },
    }


def as_output_lists(model: Dict[str, Any]) -> Dict[str, List[Any]]:
    """Return GH-friendly validation and preview geometry lists from the export payload."""
    payload = build_structure_export_json(model)
    lists = payload.get("output_lists", {})
    nodes = _pick_list(payload, "nodes")
    edges = _pick_list(payload, "edges")
    meshes = _pick_list(payload, "meshes")
    node_by_id: Dict[str, Dict[str, Any]] = {str(node.get("id")): node for node in nodes if node.get("id") not in (None, "")}
    boundary_point_ids = [str(node_id) for node_id in list(lists.get("boundary_points", []))]

    gh_nodes: List[Any] = []
    for node_id in boundary_point_ids:
        node = node_by_id.get(node_id)
        if not isinstance(node, dict):
            continue
        point = _node_point(node)
        if point is not None:
            gh_nodes.append(_point_to_output(point))

    gh_line_curves: List[Any] = []
    for edge in edges:
        curve = _edge_to_output_curve(edge, node_by_id)
        if curve is not None:
            gh_line_curves.append(curve)

    gh_surfaces: List[Any] = []
    for mesh in meshes:
        geometry = _mesh_to_output_geometry(mesh)
        if geometry is not None:
            gh_surfaces.append(geometry)

    return {
        "MemberLines": list(lists.get("member_lines", [])),
        "AreaLoadMeshes": list(lists.get("area_load_meshes", [])),
        "LinearLoadLines": list(lists.get("linear_load_lines", [])),
        "PointLoadPoints": list(lists.get("point_load_points", [])),
        "BoundaryPoints": list(lists.get("boundary_points", [])),
        "JointNodes": list(lists.get("joint_nodes", [])),
        "GHLineCurves": gh_line_curves,
        "GHNodes": gh_nodes,
        "GHSurfaces": gh_surfaces,
    }


def _read_json(path: str) -> Dict[str, Any]:
    with open(path, "r", encoding="utf-8") as stream:
        data = json.load(stream)
    if not isinstance(data, dict):
        raise ValueError("Input JSON root must be an object.")
    return data


def _write_json(path: str, payload: Dict[str, Any]) -> None:
    with open(path, "w", encoding="utf-8") as stream:
        json.dump(payload, stream, indent=2)


def _build_parser() -> argparse.ArgumentParser:
    parser = argparse.ArgumentParser(description="Export Karamba model payload to structure JSON.")
    parser.add_argument("--input", required=True, help="Path to Karamba model JSON source file.")
    parser.add_argument("--output", required=True, help="Path to output structure model JSON file.")
    parser.add_argument("--schema", default="structure_model_v1", help="Schema name written into output JSON.")
    return parser


def main() -> None:
    parser = _build_parser()
    args = parser.parse_args()

    model = _read_json(args.input)
    payload = build_structure_export_json(model=model, schema=args.schema)
    _write_json(args.output, payload)


# GH Py3 auto-run block: input `model` (or `Model`) -> JSON payload + validation lists.
_g = globals()
if "model" in _g or "Model" in _g:
    _model_input = _g.get("model", _g.get("Model"))
    if isinstance(_model_input, dict):
        ExportJson = build_structure_export_json(model=_model_input)
        _lists = as_output_lists(_model_input)
        MemberLines = _lists["MemberLines"]
        AreaLoadMeshes = _lists["AreaLoadMeshes"]
        LinearLoadLines = _lists["LinearLoadLines"]
        PointLoadPoints = _lists["PointLoadPoints"]
        BoundaryPoints = _lists["BoundaryPoints"]
        JointNodes = _lists["JointNodes"]
        GHLineCurves = _lists["GHLineCurves"]
        GHNodes = _lists["GHNodes"]
        GHSurfaces = _lists["GHSurfaces"]
        out = (
            "Exported nodes: {}, edges: {}, meshes: {}, member_breps: {}, joints: {}, gh_lines: {}, gh_nodes: {}, gh_surfaces: {}"
        ).format(
            len(ExportJson.get("nodes", [])),
            len(ExportJson.get("edges", [])),
            len(ExportJson.get("meshes", [])),
            len(ExportJson.get("member_breps", [])),
            len(ExportJson.get("joints", [])),
            len(GHLineCurves),
            len(GHNodes),
            len(GHSurfaces),
        )


if __name__ == "__main__" and "model" not in globals() and "Model" not in globals():
    main()
# ---------- end json_exporter_2 ----------

# ---- group: LM_to_RFEM6 / MATERIAL AND CROSS-SECTION
list_25 = ValueList({"C24 | SIA 265:2021", "GL24h | SIA 265:2021", "S235 | SIA 263:2013", "Schilliger | Schilliger"}, selected="GL24h | SIA 265:2021")
list_26 = ValueList({"R_M1 0.08/0.12", "R_M1 0.1/0.16", "R_M1 0.16/0.16", "R_M1 0.16/0.2", "ROUND 0.02/H", "HEB 160 | DIN 1025-2:1995-11; ... | --", "R_M1 0.2/0.2"}, selected="HEB 160 | DIN 1025-2:1995-11; ... | --")
panel_55 = Panel("1")
material_3 = Material(MaterialName=list_25, UserDefinedMaterial=Toggle(True), mode="Assemble")
panel_56 = Panel("""201
202
203""")
cross_section_3 = CrossSection(SectionName=list_26, MaterialNo=material_3, mode="Assemble")
long_2 = LongestList(ListA=json_exporter_2.GHLineCurves, ListB=cross_section_3, PaddingMode=2)  # -> ListA, ListB

# ---- group: LM_to_RFEM6 / GEOMETRY INPUT
list_27 = ValueList({"SECTION_DISTRIBUTION_TYPE_CURVED": 0, "SECTION_DISTRIBUTION_TYPE_FISH_BEAM_LINEAR": 1, "SECTION_DISTRIBUTION_TYPE_FISH_BEAM_PARABOLIC": 2, "SECTION_DISTRIBUTION_TYPE_LINEAR": 3, "SECTION_DISTRIBUTION_TYPE_NONE": 4, "SECTION_DISTRIBUTION_TYPE_OFFSET_AT_BOTH_SIDES": 5, "SECTION_DISTRIBUTION_TYPE_OFFSET_AT_END_OF_MEMBER": 6, "SECTION_DISTRIBUTION_TYPE_OFFSET_AT_START_OF_MEMBER": 7, "SECTION_DISTRIBUTION_TYPE_PITCHED_CAMBERED_BEAM_WITH_CONSTANT_HEIGHT": 8, "SECTION_DISTRIBUTION_TYPE_PITCHED_CAMBERED_BEAM_WITH_VARIABLE_HEIGHT": 9, "SECTION_DISTRIBUTION_TYPE_SADDLE": 10, "SECTION_DISTRIBUTION_TYPE_TAPERED_AND_OFFSET_AT_BOTH_SIDES": 11, "SECTION_DISTRIBUTION_TYPE_TAPERED_AND_OFFSET_AT_END_OF_MEMBER": 12, "SECTION_DISTRIBUTION_TYPE_TAPERED_AND_OFFSET_AT_START_OF_MEMBER": 13, "SECTION_DISTRIBUTION_TYPE_TAPERED_AT_BOTH_SIDES": 14, "SECTION_DISTRIBUTION_TYPE_TAPERED_AT_END_OF_MEMBER": 15, "SECTION_DISTRIBUTION_TYPE_TAPERED_AT_START_OF_MEMBER": 16, "SECTION_DISTRIBUTION_TYPE_UNIFORM": 17}, selected="SECTION_DISTRIBUTION_TYPE_UNIFORM")
list_28 = ValueList({"TYPE_ANCHOR": 0, "TYPE_BEAM": 1, "TYPE_BUCKLING": 2, "TYPE_CABLE": 3, "TYPE_CABLE_ON_PULLEYS": 4, "TYPE_COMPRESSION": 5, "TYPE_COUPLING_HINGE_HINGE": 6, "TYPE_COUPLING_HINGE_RIGID": 7, "TYPE_COUPLING_RIGID_HINGE": 8, "TYPE_COUPLING_RIGID_RIGID": 9, "TYPE_DAMPER": 10, "TYPE_DEEP_BEAM": 11, "TYPE_DEFINABLE_STIFFNESS": 12, "TYPE_DESIGN_STRIP": 13, "TYPE_JOIST": 14, "TYPE_LOAD_TRANSFER": 15, "TYPE_PILE": 16, "TYPE_RESULT_BEAM": 17, "TYPE_RESULT_LINE": 18, "TYPE_RIB": 19, "TYPE_RIGID": 20, "TYPE_SHEAR_WALL": 21, "TYPE_SPRING": 22, "TYPE_SURFACE_MODEL": 23, "TYPE_TENDON_CABLE": 24, "TYPE_TENDON_REBAR": 25, "TYPE_TENSION": 26, "TYPE_TRUSS": 27, "TYPE_TRUSS_ONLY_N": 28}, selected="TYPE_BEAM")
nodal_support_3 = NodalSupport(
    GHNode=json_exporter_2.GHNodes,
    TranslationalSpringX="0",
    TranslationalSpringY="0",
    TranslationalSpringZ="inf",
    mode="Assemble")
surface_2 = Surface(GHSurface=json_exporter_2.GHSurfaces, mode="Assemble")
member_hinge_3 = MemberHinge(mode="Assemble")
member_hinge_4 = MemberHinge(mode="Assemble")
member_2 = Member(
    GHLine=long_2.ListA,
    SectionDistribution=list_27,
    SectionEnd=long_2.ListA,
    MemberType=list_28,
    HingeStart=member_hinge_3,
    HingeEnd=member_hinge_4,
    mode="Assemble")

# ---- group: LM_to_RFEM6 / EXPORT
load_cases_materials_2 = Data(flatten([material_3, load_case_2, static_analysis_settings]))
members_cross_sections_2 = Data(flatten([member_2, cross_section_3]))
surfaces_2 = Data(surface_2)
supports_2 = Data(nodal_support_3)
member_loads_2 = Data(member_load_2)
button_6 = Button()
list_29 = ValueList({"None": 0, "Microns": 1, "Millimeters": 2, "Centimeters": 3, "Meters": 4, "Kilometers": 5, "Microinches": 6, "Mils": 7, "Inches": 8, "Feet": 9, "Miles": 10, "CustomUnits": 11, "Angstroms": 12, "Nanometers": 13, "Decimeters": 14, "Dekameters": 15, "Hectometers": 16, "Megameters": 17, "Gigameters": 18, "Yards": 19, "PrinterPoints": 20, "PrinterPicas": 21, "NauticalMiles": 22, "AstronomicalUnits": 23, "LightYears": 24, "Parsecs": 25, "Unset": 26}, selected="Meters")
überschreiben_2 = BooleanToggle(True)
rfem_export_2 = RFEM6ExportComponent(
    Run=Toggle(False),
    Input=flatten([load_cases_materials_2, members_cross_sections_2, surfaces_2, supports_2, member_loads_2]),
    Units=list_29,
    FlipZAxis=Toggle(True),
    UtilizeNodes=Toggle(True),
    Overwrite=überschreiben_2,
    ReadLog=Toggle(True),
    WsAddress="localhost:8082")  # -> RFEMData, Log, SuccessfulExport
panel_57 = Panel(rfem_export_2.SuccessfulExport)
rec_2 = DataRecorder(rfem_export_2.Log, DataLimit=-10, RecordData=True)
panel_58 = Panel(rec_2)
