# Grasshopper definition 0528_timber_model.ghx (Grasshopper 1.0.8)
# plug-ins: Human

py3 = Python3Script()  # -> out, graph, a; disabled
# ---------- py3: Python ----------
from compas.data import json_load
import os, sys, importlib

gh_dir = os.path.dirname(ghenv.Component.OnPingDocument().FilePath)
gh_par = os.path.dirname(gh_dir)

line_path = os.path.join(gh_par, 'line_model')
json_path = os.path.join(
    gh_par, 'line_model', 'data', '260520_v1_line_model.json'
)

if line_path not in sys.path:
    sys.path.insert(0, line_path)

import nodegraph
importlib.reload(nodegraph)
from nodegraph import NodeGraph


line_model = json_load(json_path)

print (type(line_model))
from compas.geometry import Line
from copy import deepcopy
graph = deepcopy(line_model)

a = []
for edge in graph.edges():
    if graph.edge_attribute(edge, 'hierarchy') == 'shoe':
        if graph.edge_attribute(edge, 'direction_id') == 'A':
            ln = graph.edge_attribute(edge, 'shifted_line')
            offset = (0, 0, 1e-6)

            new_ln = Line(ln.start + offset, ln.end + offset)
            graph.edge_attribute(edge, 'shifted_line', new_ln)
            a.append(new_ln)
# ---------- end py3 ----------
draw = COMPASDraw(cg=py3.a)  # -> rg; disabled
#   port cg: The COMPAS geometry or datastructure to be drawn.
#   port rg: The Rhino geometry object.
# ---------- draw: Python ----------
# r: compas>=2.14.1
"""
Draws COMPAS geometry in Grasshopper.
"""

from typing import Any

import Grasshopper

from compas.scene import SceneObject


class CompasToRhinoGeometry(Grasshopper.Kernel.GH_ScriptInstance):
    def RunScript(self, cg):
        if not cg:
            return None

        return SceneObject(item=cg).draw()
# ---------- end draw ----------

number_slider = Slider(3, range=0..6)  # disabled
py3_2 = Python3Script(graph=py3.graph)  # -> out, models; disabled
# ---------- py3_2: Python ----------
import os, sys, importlib

gh_dir = os.path.dirname(ghenv.Component.OnPingDocument().FilePath)

parent = os.path.dirname(gh_dir)              # go up one level
src_dir = os.path.join(parent, "src")         # go into src folder
if src_dir not in sys.path:
    sys.path.insert(0, src_dir)

print (gh_dir)
print (parent)
print (src_dir)


#######---------Imports------------##########
import timber_config
importlib.reload(timber_config)

import timber_model
importlib.reload(timber_model)
from timber_model import graph_to_timber_models


########----------Main Code-----------_###########
models = graph_to_timber_models(graph, align_shoe=False)

print (list(m.attributes['group'] for m in models))


models.sort(key=lambda m: m.attributes['group'])

print (list(m.attributes['group'] for m in models))
# ---------- end py3_2 ----------
list = ValueList({"Zero": 0, "One": 1, "Two": 2, "Three": 2² - 1}, selected=["Zero", "One", "Two", "Three"])  # disabled
number_slider_2 = Slider(0, range=0..6)  # disabled
item = ListItem(List=py3_2.models, Index=list, Wrap=True)  # disabled
number_slider_3 = Slider(0, range=0..30)  # disabled
py3_3 = Python3Script(models=item)  # -> out, line_tree, frame_tree, locations, texts, tri_locations, geos, frames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; inputs lines: list of Line, models: list; disabled
# ---------- py3_3: Python ----------
from compas_rhino.conversions import line_to_compas
from compas.geometry import Vector, angle_vectors

from compas_timber.elements import Beam
from compas_timber.model import TimberModel
from compas_timber.connections import (
    KBirdsmouthJoint, LMiterJoint,
    TStepJoint, TButtJoint, TLapJoint,
    XLapJoint
)
from compas_timber.connections import JointTopology

from compas_timber.analyzers import TripletAnalyzer

from compas.tolerance import Tolerance

from Grasshopper import DataTree
from Grasshopper.Kernel.Data import GH_Path

from copy import deepcopy

models = deepcopy(models)


def is_planar_t_joint(candidate, tol=1e-3):
    """
    Check if a T joint candidate is planar.
    """
    if candidate.topology != JointTopology.TOPO_T:
        raise ValueError("Candidate must be of T topology")

    def _is_coplanar(points):
        # Remove duplicates
        pts = []
        for p in points:
            if not pts or (p - pts[-1]).length > tol:
                pts.append(p)

        if len(pts) < 4:
            return True

        # Find first non-colinear triple
        p0 = pts[0]
        n = None
        for i in range(1, len(pts) - 1):
            v1 = pts[i] - p0
            for j in range(i + 1, len(pts)):
                v2 = pts[j] - p0
                n = v1.cross(v2)
                if n.length > tol:
                    break
            if n and n.length > tol:
                break

        # All points colinear → treat as planar
        if not n or n.length <= tol:
            return True

        # Check remaining points
        for p in pts:
            v = p - p0
            if abs(n.dot(v)) > tol:
                return False

        return True

    ca, cb = candidate.elements
    pts = [*ca.centerline, *cb.centerline]

    # 1. Check coplanarity
    if not _is_coplanar(pts):
        return False

    # 2. Check cross-section alignment (y-axis)
    ya = ca.frame.yaxis.unitized()
    yb = cb.frame.yaxis.unitized()

    return abs(ya.dot(yb)) >= 1 - tol

def _is_planar(element_a, element_b):
    """Check if two beams are planar.

    Parameters
    ----------
    element_a : :class:`compas_timber.elements.Beam`
        The first beam.
    element_b : :class:`compas_timber.elements.Beam`
        The second beam.

    Returns
    -------
    bool
        ``True`` if the beams are planar, ``False`` otherwise.

    """
    # Get frame from each beam
    frame_a = element_a.frame
    frame_b = element_b.frame

    # Match orientation of the frames
    frame_a.xaxis = Vector(0, 0, 1)
    frame_b.xaxis = Vector(0, 0, 1)

    # Calculate the angle between the two vectors
    angle = angle_vectors(frame_a.normal, frame_b.normal, deg=True)

    # If the angle is close to 0 or 180 degrees, the beams are planar
    return abs(angle) < 1e-6 or abs(angle - 180) < 1e-6

####
"""
TOPO_UNKNOWN = 0
TOPO_I = 1
TOPO_L = 2
TOPO_T = 3
TOPO_X = 4
TOPO_Y = 5
TOPO_K = 6
"""
from compas.geometry import Plane, Frame

def _get_average_miter_plane(reordered_elements, flip=False):
    _, a, b = reordered_elements
    ori = a.centerline.start
    dir_a = a.centerline.direction
    dir_b = b.centerline.direction

    cross = dir_a.cross(dir_b)

    y = dir_a + dir_b
    if flip:
        return Plane.from_frame(Frame(ori, cross, -y))
    return Plane.from_frame(Frame(ori, cross, y))

def _k_birdsmouth_solver(model, mill_depth, miter_type=None, miter_flag=False):
    """
    Handle K birdsmouth joints with three beams.

    Parameters
    ----------
    model : TimberModel
        The timber model after calling connect.adjacent_beams. 
    mill_depth : float
        The depth of the mill cut for the birdsmouth joint.
    miter_type : str, optional
        "VERTICAL" for a global Z aligned miter plane.
        "AVERAGE" for a miter plane based on the average of the two beam directions.
        If None, miter plane will generate within compas_timber definition, see k_birdsmouth.py.
    miter_flag : bool, optional
        Flip miter plane direction if generating weird cuts.
    
    Returns
    -------
    None
    """
    max_offset = max(candidate.distance for candidate in model.joint_candidates)

    # handle non-pair joints (in this case a 3-way connection using TripletAnalyzer)
    analyzer = TripletAnalyzer(model, max_offset/2)
    clusters = analyzer.find()

    for cluster in clusters:
        if cluster.topology == JointTopology.TOPO_K:
            # keep track of the amount of elements per type
            counts = Counter(e.attributes["hierarchy"] for e in cluster.elements)
            if counts["secondary"] == 2 and counts["tertiary"] == 1: #skip this joint
                continue

            # define the order of the elements to be passed to the joint
            order = {"main_primary": 0, "primary": 1, "secondary": 2, "tertiary": 3}
            if counts["main_primary"] == 2 and counts["primary"] == 1:
                order = {"primary": 0, "main_primary": 1, "secondary": 2, "tertiary": 3} #override the order just for this condition
            reordered_elements = sorted(cluster.elements, key=lambda e: order.get(e.attributes["hierarchy"], float('inf')))

            if len(reordered_elements) != 3:
                raise ValueError(f"Something went wrong with the analyzer. There should be always 3 elements, got: {len(reordered_elements)}")

            # promote cluster
            if miter_type == 'VERTICAL':
                miter_pln = _get_vertical_miter_plane(reordered_elements, flip=miter_flag)
            elif miter_type == 'AVERAGE':
                miter_pln = _get_average_miter_plane(reordered_elements, flip=miter_flag)
            else:
                miter_pln = None

            kwargs = {"mill_depth": mill_depth, "miter_plane": miter_pln}
            KBirdsmouthJoint.promote_cluster(model, cluster, reordered_elements=reordered_elements, **kwargs)
    return

######------Init------############
line_tree = DataTree[object]()
frame_tree = DataTree[object]()
locations = []
texts = []
geos = []

tri_locations = DataTree[object]()

dist = 0.055

########--------K Birdsmouth test------##########
# for model in models:
#     g = model.attributes['group']

#     for beam in model.beams:
#         beam.reset_computed_properties()

#     model.connect_adjacent_beams(max_distance=dist)
    
#     for can in model.joint_candidates:
#         locations.append(can.location)

#     analyzer = TripletAnalyzer(model, dist)
#     clusters = analyzer.find()

#     for i, c in enumerate(clusters):
#         path = GH_Path(g, i)

#         tri_locations.Add(c.location, path)
        
#         for beam in c.elements:
#             line_tree.Add(beam.centerline, path)

#         order = {"main_primary": 0, "primary": 1, "secondary": 2, "tertiary": 3}
#         reordered_elements = sorted(c.elements, key=lambda e: order.get(e.attributes["hierarchy"], float('inf')))
#         print (f'A{i}', list(e.attributes["hierarchy"] for e in c.elements))
#         print (f'B{i}', list(e.attributes["hierarchy"] for e in reordered_elements))

#         mill_depth = 0.01
#         miter_pln = _get_average_miter_plane(reordered_elements, flip=False)
#         # miter_pln = None
#         kwargs = {"mill_depth": mill_depth, "miter_plane": miter_pln}
#         KBirdsmouthJoint.promote_cluster(model, c, reordered_elements=reordered_elements, **kwargs)
    


    # # model.process_joinery()

    # for beam in model.beams:
    #     geos.append(beam.geometry)

#####-------T Miter test------##########
# pln_tree = DataTree[object]()
# for model in models:
#     g = model.attributes['group']

#     for beam in model.beams:
#         beam.reset_computed_properties()

#     model.connect_adjacent_beams(max_distance=dist)

#     for i, can in enumerate(model.joint_candidates):
#         path = GH_Path(g, i)
#         topo = JointTopology.get_name(can.topology)

#         ca, cb = can.elements
#         if all([ca.attributes['has_middle_joint'], cb.attributes['has_middle_joint']]):
#             if topo == "TOPO_L":
#                 continue
#             tlj = TLapJoint.create(model, ca, cb)
#             print (tlj.ref_side_index_a, tlj.ref_side_index_b)

#             line_tree.Add(ca.centerline, path)
#             line_tree.Add(cb.centerline, path)
    
#     model.process_joinery()
    
#     for i, can in enumerate(model.joint_candidates):
#         path = GH_Path(g, i)
#         topo = JointTopology.get_name(can.topology)

#         ca, cb = can.elements
#         if all([ca.attributes['has_middle_joint'], cb.attributes['has_middle_joint']]):
#             if topo == "TOPO_L":
#                 continue
#             geos.append(ca.geometry)
            
#             # print (len(ca.ref_sides))
#             pln_tree.AddRange(ca.ref_sides[:4], path)


aa = DataTree[object]()
bb = DataTree[object]()

for model in models:
    g = model.attributes['group']
    model.connect_adjacent_beams(max_distance=dist)
    
    for i, can in enumerate(model.joint_candidates):
        path = GH_Path(g, i)

        a, b = can.elements
        if all([a.attributes['hierarchy'] == 'shoe', b.attributes['hierarchy'] == 'shoe']):
            if a.attributes['cyclic_sign'] == +1:
                flip = False
            else:
                flip = True
            if a.attributes['direction_id'] == 'A':
                XLapJoint.create(model, a, b)

            elif a.attributes['direction_id'] == 'B':
                XLapJoint.create(model, b, a)


    model.process_joinery()

    for i, can in enumerate(model.joint_candidates):
        path = GH_Path(g, i)

        a, b = can.elements
        if all([a.attributes['hierarchy'] == 'shoe', b.attributes['hierarchy'] == 'shoe']):
            # if a.attributes['direction_id'] == 'A':
            #     aa.Add(a.geometry, path)
            #     bb.Add(b.geometry, path)
            # else:
            #     aa.Add(b.geometry, path)
            #     bb.Add(a.geometry, path)
            pass
    
    for beam in model.beams:
        if beam.attributes['hierarchy'] == 'shoe':
            if beam.attributes['direction_id'] == 'A':
                aa.Add(beam.geometry)
            elif beam.attributes['direction_id'] == 'B':
                bb.Add(beam.geometry)
# ---------- end py3_3 ----------
tstat = TreeStatistics(Tree=py3_3.pln_tree)  # -> Paths, Length, Count; disabled
item_2 = ListItem(List=tstat.Paths, Index=number_slider, Wrap=True)  # disabled
branch = TreeBranch(Tree=py3_3.pln_tree, Path=item_2, MaintainPaths=True)  # disabled
draw_2 = COMPASDraw(cg=branch)  # -> rg; disabled; same code as draw
draw_3 = COMPASDraw(cg=branch)  # -> rg; disabled; same code as draw
tstat_2 = TreeStatistics(Tree=draw_2)  # -> Paths, Length, Count; disabled
item_3 = ListItem(List=tstat_2.Paths, Index=number_slider_2, Wrap=True)  # disabled
number_slider_4 = Slider(0.29, range=0..1)  # disabled
branch_2 = TreeBranch(Tree=draw_2, Path=item_3, MaintainPaths=True)  # disabled
draw_4 = COMPASDraw(cg=py3_3.geos)  # -> rg; disabled; same code as draw
swatch = ColourSwatch(SwatchColor=RGBA(0, 0, 0, 131))  # disabled
draw_5 = COMPASDraw(cg=py3_3.line_tree)  # -> rg; disabled; same code as draw
tstat_3 = TreeStatistics(Tree=draw_5)  # -> Paths, Length, Count; disabled
item_4 = ListItem(List=tstat_3.Paths, Index=number_slider_3, Wrap=True)  # disabled
draw_6 = COMPASDraw(cg=py3_3.locations)  # -> rg; disabled; same code as draw
draw_7 = COMPASDraw(cg=py3_3.tri_locations)  # -> rg; disabled; same code as draw
preview = CustomPreview(Geometry=draw_4, Material=swatch)  # disabled
midpt = CurveMiddle(Curve=draw_5)  # disabled
points = PointList(Points=midpt, Size=number_slider_4)  # disabled
trim = TrimTree(Tree=draw_7, Depth=1)  # disabled
branch_3 = TreeBranch(Tree=draw_5, Path=item_4, MaintainPaths=True)  # disabled
swatch_2 = ColourSwatch(SwatchColor=RGB(255, 0, 0))  # disabled
draw_8 = COMPASDraw(cg=py3_3.aa)  # -> rg; disabled; same code as draw
draw_9 = COMPASDraw(cg=py3_3.bb)  # -> rg; disabled; same code as draw
preview_2 = CustomPreview(Geometry=draw_9, Material=swatch_2)  # disabled
preview_3 = CustomPreview(
    Geometry=draw_8,
    Material={diffuse=RGB(228, 178, 227), emission=RGB(68, 53, 68), shine=0.5, specular=RGB(255, 254, 255), transparency=0})  # disabled

py3_4 = Python3Script()  # -> out, line_model
# ---------- py3_4: Python ----------
from compas.data import json_load
import os, sys, importlib

gh_dir = os.path.dirname(ghenv.Component.OnPingDocument().FilePath)
gh_par = os.path.dirname(gh_dir)

line_path = os.path.join(gh_par, 'line_model')
json_path = os.path.join(
    gh_par, 'line_model', 'data', '260527_v4_line_model.json'
)

if line_path not in sys.path:
    sys.path.insert(0, line_path)

import nodegraph
importlib.reload(nodegraph)
from nodegraph import NodeGraph


line_model = json_load(json_path)

print (type(line_model))
# ---------- end py3_4 ----------

# ----
# Construct Timber Models
py3_5 = Python3Script(graph=py3_4.line_model)  # -> out, models; same code as py3_2

crv = Curve([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])

# ----
# Apply Joints
list_2 = ValueList({"Zero": 0, "One": 1, "Two": 2, "Three": 2² - 1}, selected="Zero")
item_5 = ListItem(List=py3_5.models, Index=list_2, Wrap=True)
py3_6 = Python3Script(models=item_5)  # -> out, models; inputs models: list
# ---------- py3_6: Python ----------
import os, sys, importlib

gh_dir = os.path.dirname(ghenv.Component.OnPingDocument().FilePath)

parent = os.path.dirname(gh_dir)              # go up one level
src_dir = os.path.join(parent, "src")         # go into src folder
if src_dir not in sys.path:
    sys.path.insert(0, src_dir)

import timber_config
importlib.reload(timber_config)

import timber_model
importlib.reload(timber_model)
from timber_model import apply_joints

from copy import deepcopy

models = deepcopy(models)


#
for model in models:
    apply_joints(
        model,
        max_distance=0.065,
        k_miter_type="AVERAGE",
        k_miter_flag=False,
        x_lap_flip=False,
        debug=True
    )
# ---------- end py3_6 ----------

panel = Panel(py3_6.out)
panel_2 = Panel(py3_6.models)

# ----
# Process joinery
toggle = BooleanToggle(True)
py3_7 = Python3Script(models=py3_6.models, process=toggle)  # -> out, models; inputs models: list, process: Boolean
# ---------- py3_7: Python ----------
import os, sys, importlib

gh_dir = os.path.dirname(ghenv.Component.OnPingDocument().FilePath)

parent = os.path.dirname(gh_dir)              # go up one level
src_dir = os.path.join(parent, "src")         # go into src folder
if src_dir not in sys.path:
    sys.path.insert(0, src_dir)

print (gh_dir)
print (parent)
print (src_dir)

import timber_config
importlib.reload(timber_config)

import timber_model
importlib.reload(timber_model)
from timber_model import apply_processings

from copy import deepcopy

models = deepcopy(models)


#
if process:
    for model in models:
        apply_processings(model)
# ---------- end py3_7 ----------

py3_8 = Python3Script(models=py3_7.models)  # -> out, locations, txts, vectors, port, geos, graft(vecs), struts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; inputs models: list
# ---------- py3_8: Python ----------
import os, sys, importlib

gh_dir = os.path.dirname(ghenv.Component.OnPingDocument().FilePath)

parent = os.path.dirname(gh_dir)              # go up one level
src_dir = os.path.join(parent, "src")         # go into src folder
if src_dir not in sys.path:
    sys.path.insert(0, src_dir)

import screw_planning
importlib.reload(screw_planning)
from screw_planning import apply_screws_2, ScrewSolver

import joint_wrappers
importlib.reload(joint_wrappers)
from joint_wrappers import TMSJ

import screw_spec
importlib.reload(screw_spec)
from screw_spec import ScrewSpecification

from copy import deepcopy

from Grasshopper import DataTree
from Grasshopper.Kernel.Data import GH_Path

from compas_timber.connections import TMultiStepJoint
from compas_rhino.conversions import frame_to_rhino
from compas.geometry import angle_vectors, Point
import math

# models = deepcopy(models)
JOINT_MAP = {
    TMultiStepJoint : TMSJ,

}
def _average_points(points):
    x = sum(p.x for p in points) / len(points)
    y = sum(p.y for p in points) / len(points)
    z = sum(p.z for p in points) / len(points)
    return Point(x, y, z)

locations = DataTree[object]()
txts = DataTree[object]()

geos = DataTree[object]()
struts = DataTree[object]()
lines = DataTree[object]()
volumes = DataTree[object]()
pts = DataTree[object]()
cylinders = DataTree[object]()

vectors = DataTree[object]()
orient = "perp_tread"
for model in models:
    g = model.attributes['group']
    
    solver = ScrewSolver(model)
    for j, joint in enumerate(model.joints):
        if joint.name != "TMultiStepJoint":
            continue

        # Wrap the joint with the corresponding class in JOINT_MAP if it exists
        joint_class = joint.__class__
        if joint_class in JOINT_MAP:
            joint = JOINT_MAP[joint_class](joint)

        path = GH_Path(g, j)
        
        txts.Add(round(joint.acute_angle), path)
        # txts.Add(joint.step_shape, path)

        for ele in joint.elements:
            geos.Add(ele.geometry, path)

        polyline = joint.get_strut_boundary(data_type="polyline")
        locations.Add(_average_points(polyline[:-1]), path)

        entry_type = solver.determine_entry_type(joint)
        if entry_type == "crossed":
            pts_grid = solver.populate_crossed_entry_points(joint, "cross_section")
            pts.AddRange(pts_grid, path)
            strut = joint.get_strut_boundary(data_type="polyline")
            struts.Add(strut, path)
            polys = joint.find_screw_boundaries("cross_section", data_type="polylines")
            volumes.AddRange(polys, path)
            lns = solver.populate_crossed_screw_lines(joint, "cross_section")
            lines.AddRange(lns, path)
            cyls = solver.create_screw_cylinders(joint, "cross_section")
            cylinders.AddRange(cyls, path)

            # solver.add_drilling_features(joint, "cross_section")
            continue
        
        
        strut = joint.get_strut_boundary(data_type="polyline")
        polys = joint.find_screw_boundaries(orient, data_type="polylines")
        pts_grid = solver.populate_aligned_entry_points(joint, orient)
        lns = solver.populate_aligned_screw_lines(joint, orient)
        cyls = solver.create_screw_cylinders(joint, orient)
        # solver.add_drilling_features([joint], orient)

        struts.Add(strut, path)
        volumes.AddRange(polys, path)
        pts.AddRange(pts_grid, path)
        lines.AddRange(lns, path)
        cylinders.AddRange(cyls, path)
    
    # model.process_joinery()
    # for beam in model.beams:
    #     geos.Add(beam.geometry)
# ---------- end py3_8 ----------
draw_10 = COMPASDraw(cg=py3_8.geos)  # -> rg; same code as draw
preview_4 = CustomPreview(Geometry=draw_10, Material=ColourSwatch(SwatchColor=RGBA(38, 56, 36, 0)))
draw_11 = COMPASDraw(cg=py3_8.cylinders)  # -> rg; same code as draw
draw_12 = COMPASDraw(cg=py3_8.pts)  # -> rg; same code as draw
draw_13 = COMPASDraw(cg=py3_8.struts)  # -> rg; same code as draw
disc = Discontinuity(Curve=draw_13, Level=1)  # -> Points, Parameters
draw_14 = COMPASDraw(cg=py3_8.volumes)  # -> rg; same code as draw
draw_15 = COMPASDraw(cg=py3_8.lines)  # -> rg; same code as draw
py3_9 = Python3Script(models=py3_7.models, lines=crv)  # -> out, a; inputs models: list, lines: list of Line
# ---------- py3_9: Python ----------
from compas_timber.fabrication import Drilling
from compas_rhino.conversions import line_to_compas
lines = [line_to_compas(ln) for ln in lines]


for model in models:

    for i, joint in enumerate(model.joints):
        if i != 21:
            continue
        
        for ln in lines:
            drl = Drilling(
                depth_limited=True
            ).from_line_and_element(ln, joint.main_beam, 0.005)

            joint.main_beam.add_feature(drl)
        
    model.process_joinery()
    
    for i, joint in enumerate(model.joints):
        if i == 21:
            a = joint.main_beam.geometry
# ---------- end py3_9 ----------
item_6 = ListItem(List=disc.Points, Index=0, Wrap=True)
py3_10 = Python3Script(models=py3_7.models)  # -> out, locations, txts; inputs models: list
# ---------- py3_10: Python ----------
from compas_timber.fabrication import Drilling
from compas_rhino.conversions import line_to_compas


locations = []
txts = []
for model in models:
    for beam in model.beams:
        txts.append(beam.name)
        locations.append(beam.centerline.midpoint)
# ---------- end py3_10 ----------
draw_16 = COMPASDraw(cg=py3_9.a)  # -> rg; same code as draw
panel_3 = Panel(py3_8.out)
draw_17 = COMPASDraw(cg=py3_10.locations)  # -> rg; same code as draw
tag = TextTag(Location=draw_17, Text=py3_10.txts)

# ----
# Preview
number_slider_5 = Slider(130, range=0..255)
python_3_script = Python3Script(models=py3_7.models, alpha=number_slider_5)  # -> out, geos, colors, cut_planes, models; inputs models: list, alpha: Int32
# ---------- python_3_script: Python ----------
import rhinoscriptsyntax as rs
import scriptcontext as sc
import Rhino.Display as rd
import System.Drawing as sd

from compas.scene import Scene
from compas.geometry import Line, Point
from copy import deepcopy


COLORS = {
    "primary":      sd.Color.FromArgb(alpha, 220,  50,  50),
    "main_primary": sd.Color.FromArgb(alpha, 150,  80, 220),
    "secondary":    sd.Color.FromArgb(alpha,  50, 150, 220),
    "tertiary":     sd.Color.FromArgb(alpha,  80, 200, 100),
    "shoe":         sd.Color.FromArgb(alpha,  20, 150, 100),
    "plate":        sd.Color.FromArgb(alpha, 100, 100, 100)
}


geos = []
colors = []
cut_planes = []

for model in models:
    for plate in model.plates:
        pass
        # geos.append(plate.geometry)
        # colors.append(COLORS['plate'])

    for beam in model.beams:
        # if beam.attributes['hierarchy'] != 'shoe':
            # continue
        hie = beam.attributes.get('hierarchy')

        geos.append(beam.geometry)
        colors.append(COLORS[hie])

    cut_planes.append(model.attributes['cut_plane'])
# ---------- end python_3_script ----------
compas_draw = COMPASDraw(cg=python_3_script.geos)  # -> rg; same code as draw
compas_draw_2 = COMPASDraw(cg=python_3_script.cut_planes)  # -> rg; same code as draw
preview_5 = CustomPreview(Geometry=compas_draw, Material=python_3_script.colors)
wires = BrepWireframe(Brep=compas_draw, Density=-1)
previewlw = CustomPreviewLineweights(Geometry=wires, Shader=ColourSwatch(SwatchColor=RGB(255, 255, 255)), Absolute=False)

number_slider_6 = Slider(0.604, range=0..1)  # disabled
py3_11 = Python3Script(models=py3_7.models)  # -> out, locations, txts, port, butts, cuts, steps, notchs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; inputs models: list; disabled
# ---------- py3_11: Python ----------
from Grasshopper import DataTree
from Grasshopper.Kernel.Data import GH_Path

from compas_rhino.conversions import frame_to_rhino


locations = DataTree[object]()
txts = DataTree[object]()

butts = DataTree[object]()
cuts = DataTree[object]()
steps = DataTree[object]()
notchs = DataTree[object]()
bases = DataTree[object]()

geos = DataTree[object]()

a = DataTree[object]()
b = DataTree[object]()
c = DataTree[object]()
refs_m = DataTree[object]()
refs_c = DataTree[object]()

for model in models:
    g = model.attributes['group']
    for j, joint in enumerate(model.joints):
        if joint.name != "TMultiStepJoint":
            continue
        print (joint)
        path = GH_Path(g, j)
        locations.Add(joint.location, path)
        # txts.Add(len(joint.features), path)
        txts.Add(joint.step_shape, path)
        
        butt_pln = joint._get_butt_plane()
        cut_plns = joint._get_cut_planes()
        step_plns = joint._get_step_planes()
        notch_plns = joint._get_notch_planes()

        butts.Add(butt_pln, path)
        cuts.AddRange(cut_plns, path)
        steps.AddRange(step_plns, path)
        notchs.AddRange(notch_plns, path)
        bases.AddRange(joint._compute_base_planes(), path)

        for ele in joint.elements:
            geos.Add(ele.geometry, path)

        for frame in joint.main_beam.ref_sides:
            a.Add(frame_to_rhino(frame), path)
        for frame in joint.cross_beam.ref_sides:
            b.Add(frame_to_rhino(frame), path)

        # print (j, joint._main_beam_ref_side_index, joint._cross_beam_ref_side_index)
        c.Add(frame_to_rhino(joint.main_beam.front_side(joint.main_beam_ref_side_index)), path)
        refs_m.Add(joint.main_beam_ref_side_index, path)
        refs_c.Add(joint.cross_beam_ref_side_index, path)
# ---------- end py3_11 ----------
number_slider_7 = Slider(13, range=0..40)  # disabled
draw_18 = COMPASDraw(cg=py3_11.locations)  # -> rg; disabled; same code as draw
tstat_4 = TreeStatistics(Tree=draw_18)  # -> Paths, Length, Count; disabled
number_slider_8 = Slider(0, range=0..1)  # disabled
item_7 = ListItem(List=tstat_4.Paths, Index=number_slider_7, Wrap=True)  # disabled
branch_4 = TreeBranch(Tree=py3_11.b, Path=item_7, MaintainPaths=True)  # disabled
branch_5 = TreeBranch(Tree=py3_11.refs_c, Path=item_7, MaintainPaths=True)  # disabled
branch_6 = TreeBranch(Tree=py3_11.c, Path=item_7, MaintainPaths=True)  # disabled
branch_7 = TreeBranch(Tree=py3_11.refs_m, Path=item_7, MaintainPaths=True)  # disabled
branch_8 = TreeBranch(Tree=py3_11.a, Path=item_7, MaintainPaths=True)  # disabled
item_8 = ListItem(List=branch_4, Index=branch_5, Wrap=True)  # disabled
item_9 = ListItem(List=branch_8, Index=branch_7, Wrap=True)  # disabled
cluster = Cluster(P=branch_6, num=number_slider_6)  # disabled
cluster_2 = Cluster(P=item_9, num=number_slider_6)  # disabled
cluster_3 = Cluster(P=item_8, num=number_slider_6)  # disabled
branch_9 = TreeBranch(Tree=py3_11.geos, Path=item_7, MaintainPaths=True)  # disabled
branch_10 = TreeBranch(Tree=py3_11.butts, Path=item_7, MaintainPaths=True)  # disabled
branch_11 = TreeBranch(Tree=py3_11.cuts, Path=item_7, MaintainPaths=True)  # disabled
branch_12 = TreeBranch(Tree=py3_11.steps, Path=item_7, MaintainPaths=True)  # disabled
branch_13 = TreeBranch(Tree=py3_11.notchs, Path=item_7, MaintainPaths=True)  # disabled
branch_14 = TreeBranch(Tree=py3_11.bases, Path=item_7, MaintainPaths=True)  # disabled
draw_19 = COMPASDraw(cg=branch_9)  # -> rg; disabled; same code as draw
swatch_3 = ColourSwatch(SwatchColor=RGB(189, 88, 0))  # disabled
draw_20 = COMPASDraw(cg=branch_10)  # -> rg; disabled; same code as draw
draw_21 = COMPASDraw(cg=branch_11)  # -> rg; disabled; same code as draw
draw_22 = COMPASDraw(cg=branch_12)  # -> rg; disabled; same code as draw
draw_23 = COMPASDraw(cg=branch_13)  # -> rg; disabled; same code as draw
draw_24 = COMPASDraw(cg=branch_14)  # -> rg; disabled; same code as draw
swatch_4 = ColourSwatch(SwatchColor=RGB(84, 84, 84))  # disabled
item_10 = ListItem(List=draw_19, Index=0, Wrap=True)  # -> Item, Item1; disabled
branch_15 = TreeBranch(Tree=draw_18, Path=item_7, MaintainPaths=True)  # disabled
branch_16 = TreeBranch(Tree=py3_11.txts, Path=item_7, MaintainPaths=True)  # disabled
number_slider_9 = Slider(0.123, range=0..1)  # disabled
preview_6 = CustomPreview(Geometry=item_10.Item, Material=swatch_3)  # disabled
preview_7 = CustomPreview(Geometry=item_10.Item1, Material=swatch_4)  # disabled
tag_2 = TextTag3D(Location=branch_15, Text=branch_16, Size=number_slider_9, Justification=7)  # disabled
branch_17 = TreeBranch(Tree=simplify(draw_24), Path=number_slider_8, MaintainPaths=True)  # disabled
preview_8 = CustomPreview(
    Geometry=branch_17,
    Material={diffuse=RGB(221, 160, 221), emission=RGB(66, 48, 66), shine=0.5, specular=RGB(255, 255, 255), transparency=0})  # disabled

# ----
# Write to json
number_slider_10 = Slider(1, range=1..10)
py3_12 = Python3Script(models=py3_7.models, version=number_slider_10, save=Button())  # inputs models: list, version: Int32
# ---------- py3_12: Python ----------
import os, sys, importlib
from datetime import date

from compas.data import json_dump

gh_dir = os.path.dirname(ghenv.Component.OnPingDocument().FilePath)
gh_par = os.path.dirname(gh_dir)
file_path = os.path.join(gh_par, "timber_design", "data")

today = date.today().strftime("%y%m%d")
print(today)



if save:
    serializable = []
    for m in models:
        serializable.append({
            "attributes": dict(m.attributes),
            "model": m
        })
        
    output_path = os.path.join(file_path, f"{today}_v{version}_timber_models.json")
    dump = json_dump(serializable, output_path, pretty=False)
    print(f"Model written to {output_path}")


# serializable = []
# for m in models:
#     serializable.append({
#         "attributes": dict(m.attributes),
#         "model": m
#     })
# print (serializable)
# ---------- end py3_12 ----------

# ==== cluster Cluster
P = ClusterInput()
num = ClusterInput()
deplane = DeconstructPlane(Plane=P)  # -> Origin, XAxis, YAxis, ZAxis
num_2 = Number(num)
entwine = Entwine(Branch00=deplane.XAxis, Branch01=deplane.YAxis, Branch02=deplane.ZAxis, FlattenInputs=True)
multiplication = Multiplication(A=entwine, B=num_2)
merge = Merge(
    Data1=ColourSwatch(SwatchColor=RGB(255, 0, 0)),
    Data2=ColourSwatch(SwatchColor=RGB(0, 255, 0)),
    Data3=ColourSwatch(SwatchColor=RGB(0, 0, 255)))  # -> graft(Result)
vdisex = VectorDisplayEx(Point=deplane.Origin, Vector=multiplication, Colour=merge, Width=2)
