# Grasshopper definition 0529_timber_model.ghx (Grasshopper 1.0.8)
# plug-ins: Human

pt = ConstructPoint(XCoordinate=0, YCoordinate=0, ZCoordinate=0)  # disabled
crv = Curve(<curve referenced from the Rhino model>)  # disabled
crv_2 = Curve(<curve referenced from the Rhino model>)  # disabled
crv_3 = Curve(<curve referenced from the Rhino model>)  # disabled
number_slider = Slider(0, range=0..23)  # disabled
unit = UnitVector(Vector=crv_3)  # disabled
unit_2 = UnitVector(Vector=crv)  # disabled
line = LineSDL(Start=pt, Direction=unit_2, Length=1)  # disabled
unit_3 = UnitVector(Vector=crv_2)  # disabled
line_2 = LineSDL(Start=pt, Direction=unit_3, Length=1)  # disabled
project = Project(Geometry=line, Plane=PlaneXY(0, 0, 0))  # -> Geometry, Transform; disabled
project_2 = Project(Geometry=line_2, Plane=PlaneXY(0, 0, 0))  # -> Geometry, Transform; disabled
angle = Angle(VectorA=unit_2, VectorB=unit_3)  # -> Angle, Reflex; disabled
deg = Degrees(Radians=angle.Angle)  # disabled
angle_2 = Angle(VectorA=project.Geometry, VectorB=project_2.Geometry)  # -> Angle, Reflex; disabled
deg_2 = Degrees(Radians=angle_2.Angle)  # disabled
panel = Panel(deg)  # disabled
panel_2 = Panel(deg_2)  # disabled
swatch = ColourSwatch(SwatchColor=RGB(189, 88, 0))  # disabled
swatch_2 = ColourSwatch(SwatchColor=RGB(84, 84, 84))  # disabled
py3 = Python3Script()  # -> out, line_model
# ---------- py3: Python ----------
from compas.data import json_load
import os, sys, importlib

gh_dir = os.path.dirname(ghenv.Component.OnPingDocument().FilePath)
gh_par = os.path.dirname(gh_dir)

line_path = os.path.join(gh_par, 'line_model')
json_path = os.path.join(
    gh_par, 'line_model', 'data', '260527_v4_line_model.json'
)

if line_path not in sys.path:
    sys.path.insert(0, line_path)

import nodegraph
importlib.reload(nodegraph)
from nodegraph import NodeGraph


line_model = json_load(json_path)

print (type(line_model))
# ---------- end py3 ----------

# ----
# Construct Timber Models
py3_2 = Python3Script(graph=py3.line_model)  # -> out, models
# ---------- py3_2: Python ----------
import os, sys, importlib

gh_dir = os.path.dirname(ghenv.Component.OnPingDocument().FilePath)

parent = os.path.dirname(gh_dir)              # go up one level
src_dir = os.path.join(parent, "src")         # go into src folder
if src_dir not in sys.path:
    sys.path.insert(0, src_dir)

print (gh_dir)
print (parent)
print (src_dir)


#######---------Imports------------##########
import timber_config
importlib.reload(timber_config)

import timber_model
importlib.reload(timber_model)
from timber_model import graph_to_timber_models


########----------Main Code-----------_###########
models = graph_to_timber_models(graph, align_shoe=False)

print (list(m.attributes['group'] for m in models))


models.sort(key=lambda m: m.attributes['group'])

print (list(m.attributes['group'] for m in models))
# ---------- end py3_2 ----------

# ----
# Apply Joints
list = ValueList({"Zero": 0, "One": 1, "Two": 2, "Three": 2² - 1}, selected="Zero")
item = ListItem(List=py3_2.models, Index=list, Wrap=True)
py3_3 = Python3Script(models=item)  # -> out, models; inputs models: list
# ---------- py3_3: Python ----------
import os, sys, importlib

gh_dir = os.path.dirname(ghenv.Component.OnPingDocument().FilePath)

parent = os.path.dirname(gh_dir)              # go up one level
src_dir = os.path.join(parent, "src")         # go into src folder
if src_dir not in sys.path:
    sys.path.insert(0, src_dir)

import timber_config
importlib.reload(timber_config)

import timber_model
importlib.reload(timber_model)
from timber_model import apply_joints

from copy import deepcopy

models = deepcopy(models)


#
for model in models:
    apply_joints(
        model,
        max_distance=0.065,
        k_miter_type="AVERAGE",
        k_miter_flag=False,
        x_lap_flip=False,
        debug=True
    )
# ---------- end py3_3 ----------

panel_3 = Panel(py3_3.out)
panel_4 = Panel(py3_3.models)

# ----
# Process joinery
toggle = BooleanToggle(True)
py3_4 = Python3Script(models=py3_3.models, process=toggle)  # -> out, models; inputs models: list, process: Boolean
# ---------- py3_4: Python ----------
import os, sys, importlib

gh_dir = os.path.dirname(ghenv.Component.OnPingDocument().FilePath)

parent = os.path.dirname(gh_dir)              # go up one level
src_dir = os.path.join(parent, "src")         # go into src folder
if src_dir not in sys.path:
    sys.path.insert(0, src_dir)

print (gh_dir)
print (parent)
print (src_dir)

import timber_config
importlib.reload(timber_config)

import timber_model
importlib.reload(timber_model)
from timber_model import apply_processings

from copy import deepcopy

models = deepcopy(models)


#
if process:
    for model in models:
        apply_processings(model)
# ---------- end py3_4 ----------

py3_5 = Python3Script(models=py3_4.models)  # -> out, locations, txts, centerlines, geos, entry_point_tree, screw_line_tree, entry_faces, exit_faces, strut_faces; inputs models: list; disabled
# ---------- py3_5: Python ----------
import os, sys, importlib
gh_dir = os.path.dirname(ghenv.Component.OnPingDocument().FilePath)

parent = os.path.dirname(gh_dir)
src_dir = os.path.join(parent, "src")
if src_dir not in sys.path:
    sys.path.insert(0, src_dir)

import screw_planning
import screw_spec
import joint_wrappers

importlib.reload(screw_planning)
importlib.reload(screw_spec)
importlib.reload(joint_wrappers)

from screw_planning import apply_screws, ScrewSolver
from screw_spec import ScrewSpecification
from joint_wrappers import TMSJ

from compas_timber.connections import KBirdsmouthJoint, XLapJoint, LMiterJoint
from Grasshopper import DataTree
from Grasshopper.Kernel.Data import GH_Path

# from copy import deepcopy
# models = deepcopy(models)

locations = DataTree[object]()
txts = DataTree[object]()
centerlines = DataTree[object]()

entry_point_tree = DataTree[object]()
screw_line_tree = DataTree[object]()
entry_faces = DataTree[object]()
exit_faces = DataTree[object]()
strut_faces = DataTree[object]()

geos = DataTree[object]()

orientation_aligned = "biscector"
orientation_crossed = "along_cross"
for model in models:
    g = model.attributes["group"]
    solver = ScrewSolver(model, spec_model="WT-plus-6.5")

    joints_to_process = []
    for joint in model.joints:
        if joint.__class__ not in (KBirdsmouthJoint,):
            continue
        
        kbmj = ScrewSolver.JOINT_MAP[KBirdsmouthJoint]
        sub_joint_0 = kbmj(joint, main_id=0)
        sub_joint_1 = kbmj(joint, main_id=1)
        joints_to_process.extend([sub_joint_0, sub_joint_1])
    
    for i, joint in enumerate(joints_to_process):
        path = GH_Path(g, i)

        geos.AddRange([joint.main_beam.geometry, joint.cross_beam.geometry], path)
     
        if solver.determine_entry_type(joint) == "aligned":
            orientation = orientation_aligned
            entry_points = solver


        elif solver.determine_entry_type(joint) == "crossed":
            orientation = orientation_crossed

        # locations.Add(joint.main_beam.centerline.midpoint, path)
        # txts.Add(joint.acute_angle, path)
        centerlines.AddRange([joint.main_beam.centerline, joint.cross_beam.centerline], path)


for model in models:
    g = model.attributes["group"]
    solver = ScrewSolver(model, spec_model="WT-plus-6.5")
    for joint in model.joints:
        if joint.__class__ not in (KBirdsmouthJoint,):
            continue

        locations.Add(joint.location, path)
        txts.Add(solver.is_joint_planar(joint))
# ---------- end py3_5 ----------
data = Data(py3_5.geos)  # disabled
tstat = TreeStatistics(Tree=data)  # -> Paths, Length, Count; disabled
item_2 = ListItem(List=tstat.Paths, Index=number_slider, Wrap=True)  # disabled
branch = TreeBranch(Tree=data, Path=item_2, MaintainPaths=True)  # disabled
draw = COMPASDraw(cg=py3_5.locations)  # -> rg; disabled
#   port cg: The COMPAS geometry or datastructure to be drawn.
#   port rg: The Rhino geometry object.
# ---------- draw: Python ----------
# r: compas>=2.14.1
"""
Draws COMPAS geometry in Grasshopper.
"""

from typing import Any

import Grasshopper

from compas.scene import SceneObject


class CompasToRhinoGeometry(Grasshopper.Kernel.GH_ScriptInstance):
    def RunScript(self, cg):
        if not cg:
            return None

        return SceneObject(item=cg).draw()
# ---------- end draw ----------
draw_2 = COMPASDraw(cg=py3_5.centerlines)  # -> rg; disabled; same code as draw
draw_3 = COMPASDraw(cg=branch)  # -> rg; disabled; same code as draw
tag = TextTag(Location=draw, Text=py3_5.txts)  # disabled
item_3 = ListItem(List=draw_3, Index=0, Wrap=True)  # -> Item, Item1; disabled
preview = CustomPreview(Geometry=item_3.Item, Material=swatch)  # disabled
preview_2 = CustomPreview(Geometry=item_3.Item1, Material=swatch_2)  # disabled
py3_6 = Python3Script(models=py3_4.models)  # -> out, locations, txts, geos, entry_point_tree, screw_line_tree, entry_faces, exit_faces, interfaces; inputs models: list
# ---------- py3_6: Python ----------
import os, sys, importlib
gh_dir = os.path.dirname(ghenv.Component.OnPingDocument().FilePath)

parent = os.path.dirname(gh_dir)
src_dir = os.path.join(parent, "src")
if src_dir not in sys.path:
    sys.path.insert(0, src_dir)

import screw_planning_2
import screw_spec_2
import joint_wrappers_2

importlib.reload(screw_planning_2)
importlib.reload(screw_spec_2)
importlib.reload(joint_wrappers_2)

from screw_planning_2 import apply_screws
from screw_spec_2 import ScrewSpecification
from joint_wrappers_2 import TMSJ

from Grasshopper import DataTree
from Grasshopper.Kernel.Data import GH_Path

# from copy import deepcopy
# models = deepcopy(models)

entry_point_tree = DataTree[object]()
screw_line_tree = DataTree[object]()
entry_faces = DataTree[object]()
exit_faces = DataTree[object]()
interfaces = DataTree[object]()

geos = DataTree[object]()

for model in models:
    g = model.attributes["group"]
        
    results = apply_screws(
        model,
        spec_model="WT-plus-6.5",
        screw_map=None,
        orientation_aligned="bisector",
        orientation_crossed="along_cross",
        drill_target="main",
        depth_limited=True,
        with_data=True
    )
    
    for i, (key, result) in enumerate(results.items()):
        path = GH_Path(g, i)

        entry_points = result["entry_points"]
        screw_lines = result["screw_lines"]
        entry_face = result["entry_face"]
        exit_face = result["exit_face"]
        interface = result["interface"]

        entry_point_tree.AddRange(entry_points, path)
        screw_line_tree.AddRange(screw_lines, path)
        entry_faces.Add(entry_face, path)
        exit_faces.Add(exit_face, path)
        interfaces.Add(interface, path)

    # model.process_joinery()
    # for beam in model.beams:
        # geos.Add(beam.geometry)
# ---------- end py3_6 ----------
lng = ListLength(List=flatten(py3_6.entry_point_tree))
lng_2 = ListLength(List=flatten(py3_6.screw_line_tree))
panel_5 = Panel(lng)
panel_6 = Panel(lng_2)

py3_7 = Python3Script(models=py3_4.models)  # -> out, locations, txts, geos; inputs models: list
# ---------- py3_7: Python ----------
from compas_timber.fabrication import Drilling
from compas_rhino.conversions import line_to_compas


locations = []
txts = []
geos = []
for model in models:
    for beam in model.beams:
        txts.append(beam.name)
        locations.append(beam.centerline.midpoint)
        geos.append(beam.geometry)
# ---------- end py3_7 ----------
draw_4 = COMPASDraw(cg=py3_7.locations)  # -> rg; same code as draw
draw_5 = COMPASDraw(cg=py3_7.geos)  # -> rg; same code as draw
swatch_3 = ColourSwatch(SwatchColor=RGB(186, 118, 0))
tag_2 = TextTag(Location=draw_4, Text=py3_7.txts)
preview_3 = CustomPreview(Geometry=draw_5, Material=ColourSwatch(SwatchColor=RGBA(38, 56, 36, 0)))

draw_6 = COMPASDraw(cg=py3_6.entry_faces)  # -> rg; same code as draw
draw_7 = COMPASDraw(cg=py3_6.exit_faces)  # -> rg; same code as draw
draw_8 = COMPASDraw(cg=py3_6.interfaces)  # -> rg; same code as draw
disc = Discontinuity(Curve=draw_8, Level=1)  # -> Points, Parameters
draw_9 = COMPASDraw(cg=py3_6.geos)  # -> rg; same code as draw
draw_10 = COMPASDraw(cg=py3_6.entry_point_tree)  # -> rg; same code as draw
draw_11 = COMPASDraw(cg=py3_6.screw_line_tree)  # -> rg; same code as draw
points = PointList(Points=disc.Points, Size=Slider(0.021, range=0..0.1))
panel_7 = Panel(draw_10)

# ----
# Preview
number_slider_2 = Slider(94, range=0..255)
python_3_script = Python3Script(models=py3_4.models, alpha=number_slider_2)  # -> out, geos, colors, cut_planes, models; inputs models: list, alpha: Int32
# ---------- python_3_script: Python ----------
import rhinoscriptsyntax as rs
import scriptcontext as sc
import Rhino.Display as rd
import System.Drawing as sd

from compas.scene import Scene
from compas.geometry import Line, Point
from copy import deepcopy


COLORS = {
    "primary":      sd.Color.FromArgb(alpha, 220,  50,  50),
    "main_primary": sd.Color.FromArgb(alpha, 150,  80, 220),
    "secondary":    sd.Color.FromArgb(alpha,  50, 150, 220),
    "tertiary":     sd.Color.FromArgb(alpha,  80, 200, 100),
    "shoe":         sd.Color.FromArgb(alpha,  20, 150, 100),
    "plate":        sd.Color.FromArgb(alpha, 100, 100, 100)
}


geos = []
colors = []
cut_planes = []

for model in models:
    for plate in model.plates:
        pass
        # geos.append(plate.geometry)
        # colors.append(COLORS['plate'])

    for beam in model.beams:
        # if beam.attributes['hierarchy'] != 'shoe':
            # continue
        hie = beam.attributes.get('hierarchy')

        geos.append(beam.geometry)
        colors.append(COLORS[hie])

    cut_planes.append(model.attributes['cut_plane'])
# ---------- end python_3_script ----------
compas_draw = COMPASDraw(cg=python_3_script.geos)  # -> rg; same code as draw
compas_draw_2 = COMPASDraw(cg=python_3_script.cut_planes)  # -> rg; same code as draw
preview_4 = CustomPreview(Geometry=compas_draw, Material=python_3_script.colors)
wires = BrepWireframe(Brep=compas_draw, Density=-1)
previewlw = CustomPreviewLineweights(Geometry=wires, Shader=ColourSwatch(SwatchColor=RGB(255, 255, 255)), Absolute=False)

number_slider_3 = Slider(0.604, range=0..1)  # disabled
py3_8 = Python3Script(models=py3_4.models)  # -> out, locations, txts, port, butts, cuts, steps, notchs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; inputs models: list; disabled
# ---------- py3_8: Python ----------
from Grasshopper import DataTree
from Grasshopper.Kernel.Data import GH_Path

from compas_rhino.conversions import frame_to_rhino


locations = DataTree[object]()
txts = DataTree[object]()

butts = DataTree[object]()
cuts = DataTree[object]()
steps = DataTree[object]()
notchs = DataTree[object]()
bases = DataTree[object]()

geos = DataTree[object]()

a = DataTree[object]()
b = DataTree[object]()
c = DataTree[object]()
refs_m = DataTree[object]()
refs_c = DataTree[object]()

for model in models:
    g = model.attributes['group']
    for j, joint in enumerate(model.joints):
        if joint.name != "TMultiStepJoint":
            continue
        print (joint)
        path = GH_Path(g, j)
        locations.Add(joint.location, path)
        # txts.Add(len(joint.features), path)
        txts.Add(joint.step_shape, path)
        
        butt_pln = joint._get_butt_plane()
        cut_plns = joint._get_cut_planes()
        step_plns = joint._get_step_planes()
        notch_plns = joint._get_notch_planes()

        butts.Add(butt_pln, path)
        cuts.AddRange(cut_plns, path)
        steps.AddRange(step_plns, path)
        notchs.AddRange(notch_plns, path)
        bases.AddRange(joint._compute_base_planes(), path)

        for ele in joint.elements:
            geos.Add(ele.geometry, path)

        for frame in joint.main_beam.ref_sides:
            a.Add(frame_to_rhino(frame), path)
        for frame in joint.cross_beam.ref_sides:
            b.Add(frame_to_rhino(frame), path)

        # print (j, joint._main_beam_ref_side_index, joint._cross_beam_ref_side_index)
        c.Add(frame_to_rhino(joint.main_beam.front_side(joint.main_beam_ref_side_index)), path)
        refs_m.Add(joint.main_beam_ref_side_index, path)
        refs_c.Add(joint.cross_beam_ref_side_index, path)
# ---------- end py3_8 ----------
number_slider_4 = Slider(8, range=0..40)  # disabled
draw_12 = COMPASDraw(cg=py3_8.locations)  # -> rg; disabled; same code as draw
tstat_2 = TreeStatistics(Tree=draw_12)  # -> Paths, Length, Count; disabled
number_slider_5 = Slider(0, range=0..1)  # disabled
item_4 = ListItem(List=tstat_2.Paths, Index=number_slider_4, Wrap=True)  # disabled
branch_2 = TreeBranch(Tree=py3_8.b, Path=item_4, MaintainPaths=True)  # disabled
branch_3 = TreeBranch(Tree=py3_8.refs_c, Path=item_4, MaintainPaths=True)  # disabled
branch_4 = TreeBranch(Tree=py3_8.c, Path=item_4, MaintainPaths=True)  # disabled
branch_5 = TreeBranch(Tree=py3_8.refs_m, Path=item_4, MaintainPaths=True)  # disabled
branch_6 = TreeBranch(Tree=py3_8.a, Path=item_4, MaintainPaths=True)  # disabled
item_5 = ListItem(List=branch_2, Index=branch_3, Wrap=True)  # disabled
item_6 = ListItem(List=branch_6, Index=branch_5, Wrap=True)  # disabled
cluster = Cluster(P=branch_4, num=number_slider_3)  # disabled
cluster_2 = Cluster(P=item_6, num=number_slider_3)  # disabled
cluster_3 = Cluster(P=item_5, num=number_slider_3)  # disabled
branch_7 = TreeBranch(Tree=py3_8.geos, Path=item_4, MaintainPaths=True)  # disabled
branch_8 = TreeBranch(Tree=py3_8.butts, Path=item_4, MaintainPaths=True)  # disabled
branch_9 = TreeBranch(Tree=py3_8.cuts, Path=item_4, MaintainPaths=True)  # disabled
branch_10 = TreeBranch(Tree=py3_8.steps, Path=item_4, MaintainPaths=True)  # disabled
branch_11 = TreeBranch(Tree=py3_8.notchs, Path=item_4, MaintainPaths=True)  # disabled
branch_12 = TreeBranch(Tree=py3_8.bases, Path=item_4, MaintainPaths=True)  # disabled
draw_13 = COMPASDraw(cg=branch_7)  # -> rg; disabled; same code as draw
swatch_4 = ColourSwatch(SwatchColor=RGB(189, 88, 0))  # disabled
draw_14 = COMPASDraw(cg=branch_8)  # -> rg; disabled; same code as draw
draw_15 = COMPASDraw(cg=branch_9)  # -> rg; disabled; same code as draw
draw_16 = COMPASDraw(cg=branch_10)  # -> rg; disabled; same code as draw
draw_17 = COMPASDraw(cg=branch_11)  # -> rg; disabled; same code as draw
draw_18 = COMPASDraw(cg=branch_12)  # -> rg; disabled; same code as draw
swatch_5 = ColourSwatch(SwatchColor=RGB(84, 84, 84))  # disabled
item_7 = ListItem(List=draw_13, Index=0, Wrap=True)  # -> Item, Item1; disabled
branch_13 = TreeBranch(Tree=draw_12, Path=item_4, MaintainPaths=True)  # disabled
branch_14 = TreeBranch(Tree=py3_8.txts, Path=item_4, MaintainPaths=True)  # disabled
number_slider_6 = Slider(0.123, range=0..1)  # disabled
preview_5 = CustomPreview(Geometry=item_7.Item, Material=swatch_4)  # disabled
preview_6 = CustomPreview(Geometry=item_7.Item1, Material=swatch_5)  # disabled
tag_3 = TextTag3D(Location=branch_13, Text=branch_14, Size=number_slider_6, Justification=7)  # disabled
branch_15 = TreeBranch(Tree=simplify(draw_18), Path=number_slider_5, MaintainPaths=True)  # disabled
preview_7 = CustomPreview(
    Geometry=branch_15,
    Material={diffuse=RGB(221, 160, 221), emission=RGB(66, 48, 66), shine=0.5, specular=RGB(255, 255, 255), transparency=0})  # disabled

# ----
# Write to json
number_slider_7 = Slider(1, range=1..10)
py3_9 = Python3Script(models=py3_4.models, version=number_slider_7, save=Button())  # inputs models: list, version: Int32
# ---------- py3_9: Python ----------
import os, sys, importlib
from datetime import date

from compas.data import json_dump

gh_dir = os.path.dirname(ghenv.Component.OnPingDocument().FilePath)
gh_par = os.path.dirname(gh_dir)
file_path = os.path.join(gh_par, "timber_design", "data")

today = date.today().strftime("%y%m%d")
print(today)



if save:
    serializable = []
    for m in models:
        serializable.append({
            "attributes": dict(m.attributes),
            "model": m
        })
        
    output_path = os.path.join(file_path, f"{today}_v{version}_timber_models.json")
    dump = json_dump(serializable, output_path, pretty=False)
    print(f"Model written to {output_path}")


# serializable = []
# for m in models:
#     serializable.append({
#         "attributes": dict(m.attributes),
#         "model": m
#     })
# print (serializable)
# ---------- end py3_9 ----------

# ==== cluster Cluster
P = ClusterInput()
num = ClusterInput()
deplane = DeconstructPlane(Plane=P)  # -> Origin, XAxis, YAxis, ZAxis
num_2 = Number(num)
entwine = Entwine(Branch00=deplane.XAxis, Branch01=deplane.YAxis, Branch02=deplane.ZAxis, FlattenInputs=True)
multiplication = Multiplication(A=entwine, B=num_2)
merge = Merge(
    Data1=ColourSwatch(SwatchColor=RGB(255, 0, 0)),
    Data2=ColourSwatch(SwatchColor=RGB(0, 255, 0)),
    Data3=ColourSwatch(SwatchColor=RGB(0, 0, 255)))  # -> graft(Result)
vdisex = VectorDisplayEx(Point=deplane.Origin, Vector=multiplication, Colour=merge, Width=2)
