# Grasshopper definition 0614_screw_planning.gh (Grasshopper 1.0.8)
# plug-ins: Heteroptera, Human

# ----
# Load json file
toggle = BooleanToggle(True)
py3 = Python3Script(load=toggle)  # -> out, timber_models, maps; inputs load: Boolean
# ---------- py3: Python ----------
from compas.data import json_load, json_dumps
import os, sys, importlib

from copy import deepcopy



gh_dir = os.path.dirname(ghenv.Component.OnPingDocument().FilePath)
gh_par = os.path.dirname(gh_dir)

file_path = os.path.join(gh_par,"timber_design", "data", "260605_v2_timber_models.json")
other_file_path = os.path.join(gh_par,"structure_model", "data", "joint_to_screwmap.json")
# print(file_path)

if load:
    results = json_load(file_path)
    results = deepcopy(results)

    for data in results:
        model = data['model']
        attrs = data['attributes']
        # print (model.attributes.keys())

        model.attributes = attrs
        # print (model.attributes.keys())

    timber_models = [data['model'] for data in results]
    maps = json_load(other_file_path)
    print (len(maps))
    maps = json_dumps({str(k): v for k, v in maps.items()})
    # maps = [json_dumps({str(k): v for k, v in m.items()}) for m in maps]
    print (maps)
    map_list = []
    for model in timber_models:
        g = model.attributes["group"]
# ---------- end py3 ----------

python_3_script = Python3Script(models=py3.timber_models, mapped=py3.maps)  # -> out, pts, labels, log, lines; inputs models: list, mapped: String
# ---------- python_3_script: Python ----------
import clr
clr.AddReference("RhinoCommon")
import Rhino.Geometry as rg

from compas.data import json_loads

pts    = []
lines  = []
labels = []
log    = []

total     = 0
unmatched = 0

mapped = json_loads(mapped)

for model in models:
    g = model.attributes["group"]

    for joint in model.joints:
        loc   = joint.location
        pt    = rg.Point3d(loc.x, loc.y, loc.z)
        key   = str(getattr(joint, "key", joint.guid))
        count = mapped.get(str(joint.guid), -1)

        pts.append(pt)
        labels.append(count)

        if count == -1:
            unmatched += 1
        total += 1

    [lines.append(b.centerline) for b in model.beams]

log.append("OK — {} joints, {} unmatched.".format(total, unmatched))
# ---------- end python_3_script ----------
compas_draw = COMPASDraw(cg=python_3_script.lines)  # -> rg
#   port cg: The COMPAS geometry or datastructure to be drawn.
#   port rg: The Rhino geometry object.
# ---------- compas_draw: Python ----------
# r: compas>=2.14.1
"""
Draws COMPAS geometry in Grasshopper.
"""

from typing import Any

import Grasshopper

from compas.scene import SceneObject


class CompasToRhinoGeometry(Grasshopper.Kernel.GH_ScriptInstance):
    def RunScript(self, cg):
        if not cg:
            return None

        return SceneObject(item=cg).draw()
# ---------- end compas_draw ----------
dot_display = DotDisplay(Point=python_3_script.pts, Colour=ColourSwatch(SwatchColor=RGB(255, 255, 255)), Size=Slider(0.1, range=0..1))
text_tag = TextTag(Location=python_3_script.pts, Text=python_3_script.labels)

# ----
# Process joinery
list = ValueList({"Zero": 0, "One": 1, "Two": 2, "Three": 2² - 1}, selected="Zero")
item = ListItem(List=py3.timber_models, Index=list, Wrap=True)
py3_2 = Python3Script(models=item, process=Toggle(True))  # -> out, models; inputs models: list, process: Boolean
# ---------- py3_2: Python ----------
import os, sys, importlib

gh_dir = os.path.dirname(ghenv.Component.OnPingDocument().FilePath)

parent = os.path.dirname(gh_dir)              # go up one level
src_dir = os.path.join(parent, "src")         # go into src folder
if src_dir not in sys.path:
    sys.path.insert(0, src_dir)

print (gh_dir)
print (parent)
print (src_dir)

import timber_config
importlib.reload(timber_config)

import timber_model
importlib.reload(timber_model)
from timber_model import apply_processings

from copy import deepcopy

models = deepcopy(models)


#
if process:
    for model in models:
        apply_processings(model)
# ---------- end py3_2 ----------

py3_3 = Python3Script(models=py3_2.models)  # -> out, locations, txts, geos; inputs models: list
# ---------- py3_3: Python ----------
from compas_timber.fabrication import Drilling
from compas_rhino.conversions import line_to_compas


locations = []
txts = []
geos = []
for model in models:
    for beam in model.beams:
        txts.append(beam.name)
        locations.append(beam.centerline.midpoint)
        geos.append(beam.geometry)
# ---------- end py3_3 ----------
draw = COMPASDraw(cg=py3_3.locations)  # -> rg; same code as compas_draw
swatch = ColourSwatch(SwatchColor=RGB(186, 118, 0))
draw_2 = COMPASDraw(cg=py3_3.geos)  # -> rg; same code as compas_draw
tag = TextTag(Location=draw, Text=py3_3.txts)
preview = CustomPreview(Geometry=draw_2, Material=ColourSwatch(SwatchColor=RGBA(38, 56, 36, 0)))

py3_4 = Python3Script(models=py3_2.models, mapped=py3.maps, name="M0L0_31")  # -> out, locations, txts, port, geos, selected_geo, entry_point_tree, screw_line_tree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; inputs models: list, mapped: String, name: String
# ---------- py3_4: Python ----------
import os, sys, importlib
gh_dir = os.path.dirname(ghenv.Component.OnPingDocument().FilePath)

parent = os.path.dirname(gh_dir)
src_dir = os.path.join(parent, "src")
if src_dir not in sys.path:
    sys.path.insert(0, src_dir)

import screw
import screw_planning_5
import screw_spec_2
import joint_wrappers_3

importlib.reload(screw)
importlib.reload(screw_planning_5)
importlib.reload(screw_spec_2)
importlib.reload(joint_wrappers_3)

from screw_planning_5 import apply_screws
from screw_spec_2 import ScrewSpecification
from joint_wrappers_3 import TMSJ

from Grasshopper import DataTree
from Grasshopper.Kernel.Data import GH_Path
from compas.data import json_loads

# from copy import deepcopy
# models = deepcopy(models)

locations = []
txts = DataTree[object]() # rejection reasons

entry_point_tree = DataTree[object]()
screw_line_tree = DataTree[object]()
screw_length_tree = DataTree[object]()
entry_faces = DataTree[object]()
exit_faces = DataTree[object]()
interfaces = DataTree[object]()
beam_name = DataTree[object]()


rejected_points = DataTree[object]()
geos = DataTree[object]()

selected_geo = []

mapped = json_loads(mapped)

for model in models:
    g = model.attributes["group"]
    results = apply_screws(
        model,
        spec_model="WT-plus-6.5",
        screw_map=mapped,
        screw_angle=40,
        add_features=False,
        drill_target="main",
        depth_limited=False,
        with_data=True,
        debug=True
    )

    for i, (key, result) in enumerate(results["joint_data"].items()):
        path = GH_Path(g, i)

        screws = result["screws"]

        entry_points = [s.entry for s in screws]
        screw_lines = [s.line for s in screws]
        screw_lengths = [s.length for s in screws]

        entry_face = result["entry_face"]
        exit_face = result["exit_face"]
        interface = result["interface"]

        entry_point_tree.AddRange(entry_points, path)
        screw_line_tree.AddRange(screw_lines, path)
        screw_length_tree.AddRange(screw_lengths, path)        
        entry_faces.Add(entry_face, path)
        exit_faces.Add(exit_face, path)
        interfaces.Add(interface, path)

        for screw in screws:
            if screw.reject_reason:
                rejected_points.Add(screw.entry, path)
                txts.Add(screw.reject_reason.name, path)
                print (screw.reject_reason.name)
    for j, beam in enumerate(model.beams):
        beam_path = GH_Path(g, j)
        beam_name.Add(beam.name, beam_path)
        geos.Add(beam.geometry, beam_path)

        if name and beam.name and str(name) == str(beam.name):
            selected_geo.append(beam.geometry)

    # Debug for screw capacity
    warnings = results["capacity_warnings"]
    for item in warnings:
        print (item)
        location = item['joint'].location
        locations.append(location)
# ---------- end py3_4 ----------
draw_3 = COMPASDraw(cg=py3_4.rejected_points)  # -> rg; same code as compas_draw
text_tag_2 = TextTag(Location=draw_3, Text=py3_4.txts)
dots = DotDisplay(Point=draw_3, Colour=RGB(255, 144, 0), Size=0.03)
panel = Panel(py3_4.out)
draw_4 = COMPASDraw(cg=py3_4.locations)  # -> rg; same code as compas_draw
draw_5 = COMPASDraw(cg=py3_4.geos)  # -> rg; same code as compas_draw
draw_6 = COMPASDraw(cg=py3_4.entry_point_tree)  # -> rg; same code as compas_draw
draw_7 = COMPASDraw(cg=py3_4.screw_line_tree)  # -> rg; same code as compas_draw
draw_8 = COMPASDraw(cg=py3_4.exit_faces)  # -> rg; same code as compas_draw
draw_9 = COMPASDraw(cg=py3_4.entry_faces)  # -> rg; same code as compas_draw
disc = Discontinuity(Curve=draw_9, Level=1)  # -> Points, Parameters
sph = Sphere(Base=draw_4, Radius=0.1)
draw_10 = COMPASDraw(cg=py3_4.interfaces)  # -> rg; same code as compas_draw
points = PointList(Points=disc.Points, Size=Slider(0.021, range=0..0.1))

# ----
# Preview
number_slider = Slider(94, range=0..255)
python_3_script_2 = Python3Script(models=py3_2.models, alpha=number_slider)  # -> out, geos, colors, cut_planes, models; inputs models: list, alpha: Int32
# ---------- python_3_script_2: Python ----------
import rhinoscriptsyntax as rs
import scriptcontext as sc
import Rhino.Display as rd
import System.Drawing as sd

from compas.scene import Scene
from compas.geometry import Line, Point
from copy import deepcopy


COLORS = {
    "primary":      sd.Color.FromArgb(alpha, 220,  50,  50),
    "main_primary": sd.Color.FromArgb(alpha, 150,  80, 220),
    "secondary":    sd.Color.FromArgb(alpha,  50, 150, 220),
    "tertiary":     sd.Color.FromArgb(alpha,  80, 200, 100),
    "shoe":         sd.Color.FromArgb(alpha,  20, 150, 100),
    "plate":        sd.Color.FromArgb(alpha, 100, 100, 100)
}


geos = []
colors = []
cut_planes = []

for model in models:
    for plate in model.plates:
        pass
        # geos.append(plate.geometry)
        # colors.append(COLORS['plate'])

    for beam in model.beams:
        # if beam.attributes['hierarchy'] != 'shoe':
            # continue
        hie = beam.attributes.get('hierarchy')

        geos.append(beam.geometry)
        colors.append(COLORS[hie])

    cut_planes.append(model.attributes['cut_plane'])
# ---------- end python_3_script_2 ----------
compas_draw_2 = COMPASDraw(cg=python_3_script_2.geos)  # -> rg; same code as compas_draw
compas_draw_3 = COMPASDraw(cg=python_3_script_2.cut_planes)  # -> rg; same code as compas_draw
preview_2 = CustomPreview(Geometry=compas_draw_2, Material=python_3_script_2.colors)
wires = BrepWireframe(Brep=compas_draw_2, Density=-1)
previewlw = CustomPreviewLineweights(Geometry=wires, Shader=ColourSwatch(SwatchColor=RGB(255, 255, 255)), Absolute=False)

lng = ListLength(List=flatten(draw_6))
lng_2 = ListLength(List=flatten(draw_7))
panel_2 = Panel(py3_4.entry_faces)
panel_3 = Panel(lng)
panel_4 = Panel(lng_2)
draw_11 = COMPASDraw(cg=py3_4.selected_geo)  # -> rg; same code as compas_draw
center = Center(Geometry=draw_5)  # -> Center, Dimension
end = EndPoints(Curve=draw_7)  # -> Start, End
text_tag_3 = TextTag(Location=end.End, Text=py3_4.screw_length_tree)
preview_3 = CustomPreview(Geometry=draw_11, Material=ColourSwatch(SwatchColor=RGB(255, 255, 255)))
text_tag_4 = TextTag(Location=center.Center, Text=py3_4.beam_name, Colour=ColourSwatch(SwatchColor=RGB(0, 0, 0)))

# ----
# Write to json
number_slider_2 = Slider(1, range=1..10)
py3_5 = Python3Script(models=py3_2.models, version=number_slider_2, save=Button())  # inputs models: list, version: Int32
# ---------- py3_5: Python ----------
import os, sys, importlib
from datetime import date

from compas.data import json_dump

gh_dir = os.path.dirname(ghenv.Component.OnPingDocument().FilePath)
gh_par = os.path.dirname(gh_dir)
file_path = os.path.join(gh_par, "timber_design", "data")

today = date.today().strftime("%y%m%d")
print(today)



if save:
    serializable = []
    for m in models:
        serializable.append({
            "attributes": dict(m.attributes),
            "model": m
        })
        
    output_path = os.path.join(file_path, f"{today}_v{version}_timber_models.json")
    dump = json_dump(serializable, output_path, pretty=False)
    print(f"Model written to {output_path}")


# serializable = []
# for m in models:
#     serializable.append({
#         "attributes": dict(m.attributes),
#         "model": m
#     })
# print (serializable)
# ---------- end py3_5 ----------

number_slider_3 = Slider(0.604, range=0..1)  # disabled
py3_6 = Python3Script(models=py3_2.models)  # -> out, locations, txts, port, butts, cuts, steps, notchs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; inputs models: list; disabled
# ---------- py3_6: Python ----------
from Grasshopper import DataTree
from Grasshopper.Kernel.Data import GH_Path

from compas_rhino.conversions import frame_to_rhino


locations = DataTree[object]()
txts = DataTree[object]()

butts = DataTree[object]()
cuts = DataTree[object]()
steps = DataTree[object]()
notchs = DataTree[object]()
bases = DataTree[object]()

geos = DataTree[object]()

a = DataTree[object]()
b = DataTree[object]()
c = DataTree[object]()
refs_m = DataTree[object]()
refs_c = DataTree[object]()

for model in models:
    g = model.attributes['group']
    for j, joint in enumerate(model.joints):
        if joint.name != "TMultiStepJoint":
            continue
        print (joint)
        path = GH_Path(g, j)
        locations.Add(joint.location, path)
        # txts.Add(len(joint.features), path)
        txts.Add(joint.step_shape, path)
        
        butt_pln = joint._get_butt_plane()
        cut_plns = joint._get_cut_planes()
        step_plns = joint._get_step_planes()
        notch_plns = joint._get_notch_planes()

        butts.Add(butt_pln, path)
        cuts.AddRange(cut_plns, path)
        steps.AddRange(step_plns, path)
        notchs.AddRange(notch_plns, path)
        bases.AddRange(joint._compute_base_planes(), path)

        for ele in joint.elements:
            geos.Add(ele.geometry, path)

        for frame in joint.main_beam.ref_sides:
            a.Add(frame_to_rhino(frame), path)
        for frame in joint.cross_beam.ref_sides:
            b.Add(frame_to_rhino(frame), path)

        # print (j, joint._main_beam_ref_side_index, joint._cross_beam_ref_side_index)
        c.Add(frame_to_rhino(joint.main_beam.front_side(joint.main_beam_ref_side_index)), path)
        refs_m.Add(joint.main_beam_ref_side_index, path)
        refs_c.Add(joint.cross_beam_ref_side_index, path)
# ---------- end py3_6 ----------
number_slider_4 = Slider(8, range=0..40)  # disabled
draw_12 = COMPASDraw(cg=py3_6.locations)  # -> rg; disabled; same code as compas_draw
tstat = TreeStatistics(Tree=draw_12)  # -> Paths, Length, Count; disabled
number_slider_5 = Slider(0, range=0..1)  # disabled
item_2 = ListItem(List=tstat.Paths, Index=number_slider_4, Wrap=True)  # disabled
branch = TreeBranch(Tree=py3_6.b, Path=item_2, MaintainPaths=True)  # disabled
branch_2 = TreeBranch(Tree=py3_6.refs_c, Path=item_2, MaintainPaths=True)  # disabled
branch_3 = TreeBranch(Tree=py3_6.c, Path=item_2, MaintainPaths=True)  # disabled
branch_4 = TreeBranch(Tree=py3_6.refs_m, Path=item_2, MaintainPaths=True)  # disabled
branch_5 = TreeBranch(Tree=py3_6.a, Path=item_2, MaintainPaths=True)  # disabled
item_3 = ListItem(List=branch, Index=branch_2, Wrap=True)  # disabled
item_4 = ListItem(List=branch_5, Index=branch_4, Wrap=True)  # disabled
cluster = Cluster(P=branch_3, num=number_slider_3)  # disabled
cluster_2 = Cluster(P=item_4, num=number_slider_3)  # disabled
cluster_3 = Cluster(P=item_3, num=number_slider_3)  # disabled
branch_6 = TreeBranch(Tree=py3_6.geos, Path=item_2, MaintainPaths=True)  # disabled
branch_7 = TreeBranch(Tree=py3_6.butts, Path=item_2, MaintainPaths=True)  # disabled
branch_8 = TreeBranch(Tree=py3_6.cuts, Path=item_2, MaintainPaths=True)  # disabled
branch_9 = TreeBranch(Tree=py3_6.steps, Path=item_2, MaintainPaths=True)  # disabled
branch_10 = TreeBranch(Tree=py3_6.notchs, Path=item_2, MaintainPaths=True)  # disabled
branch_11 = TreeBranch(Tree=py3_6.bases, Path=item_2, MaintainPaths=True)  # disabled
draw_13 = COMPASDraw(cg=branch_6)  # -> rg; disabled; same code as compas_draw
swatch_2 = ColourSwatch(SwatchColor=RGB(189, 88, 0))  # disabled
draw_14 = COMPASDraw(cg=branch_7)  # -> rg; disabled; same code as compas_draw
draw_15 = COMPASDraw(cg=branch_8)  # -> rg; disabled; same code as compas_draw
draw_16 = COMPASDraw(cg=branch_9)  # -> rg; disabled; same code as compas_draw
draw_17 = COMPASDraw(cg=branch_10)  # -> rg; disabled; same code as compas_draw
draw_18 = COMPASDraw(cg=branch_11)  # -> rg; disabled; same code as compas_draw
swatch_3 = ColourSwatch(SwatchColor=RGB(84, 84, 84))  # disabled
item_5 = ListItem(List=draw_13, Index=0, Wrap=True)  # -> Item, Item1; disabled
branch_12 = TreeBranch(Tree=draw_12, Path=item_2, MaintainPaths=True)  # disabled
branch_13 = TreeBranch(Tree=py3_6.txts, Path=item_2, MaintainPaths=True)  # disabled
number_slider_6 = Slider(0.123, range=0..1)  # disabled
preview_4 = CustomPreview(Geometry=item_5.Item, Material=swatch_2)  # disabled
preview_5 = CustomPreview(Geometry=item_5.Item1, Material=swatch_3)  # disabled
tag_2 = TextTag3D(Location=branch_12, Text=branch_13, Size=number_slider_6, Justification=7)  # disabled
branch_14 = TreeBranch(Tree=simplify(draw_18), Path=number_slider_5, MaintainPaths=True)  # disabled
preview_6 = CustomPreview(
    Geometry=branch_14,
    Material={diffuse=RGB(221, 160, 221), emission=RGB(66, 48, 66), shine=0.5, specular=RGB(255, 255, 255), transparency=0})  # disabled

# ==== cluster Cluster
P = ClusterInput()
num = ClusterInput()
deplane = DeconstructPlane(Plane=P)  # -> Origin, XAxis, YAxis, ZAxis
num_2 = Number(num)
entwine = Entwine(Branch00=deplane.XAxis, Branch01=deplane.YAxis, Branch02=deplane.ZAxis, FlattenInputs=True)
multiplication = Multiplication(A=entwine, B=num_2)
merge = Merge(
    Data1=ColourSwatch(SwatchColor=RGB(255, 0, 0)),
    Data2=ColourSwatch(SwatchColor=RGB(0, 255, 0)),
    Data3=ColourSwatch(SwatchColor=RGB(0, 0, 255)))  # -> graft(Result)
vdisex = VectorDisplayEx(Point=deplane.Origin, Vector=multiplication, Colour=merge, Width=2)
