# Grasshopper definition 102_Joinery_Solver.ghx (Grasshopper 1.0.8)
# plug-ins: Human

# ---- group: Import line_model
python_3_script = Python3Script()  # -> out, json_path, lines, types
# ---------- python_3_script: Python ----------
import os
from compas.data import json_load

gh_dir = os.path.dirname(ghenv.Component.OnPingDocument().FilePath)
design_folder = os.path.dirname(gh_dir)
json_path = os.path.join(design_folder, "line_model", "data", "out_lines.json")
print (json_path)

lines_data = json_load(json_path)

lines = [item["line"] for item in lines_data]
types = [item["type"] for item in lines_data]
# ---------- end python_3_script ----------

# ----
panel = Panel(python_3_script.json_path)

reload = Script(enabled=Toggle(True))
# ---------- reload: Python ----------
# r: compas>=2.9, compas_timber>=0.14
# venv: ca-fs25

from compas_rhino.devtools import DevTools
if enabled:
    DevTools.enable_reloader()
else:
    DevTools.disable_reloader()
# ---------- end reload ----------

panel_2 = Panel(python_3_script.lines)
compas_draw = COMPASDraw(cg=python_3_script.lines)  # -> rg
#   port cg: The COMPAS geometry or datastructure to be drawn.
#   port rg: The Rhino geometry object.
# ---------- compas_draw: Python ----------
# r: compas>=2.14.1
"""
Draws COMPAS geometry in Grasshopper.
"""

from typing import Any

import Grasshopper

from compas.scene import SceneObject


class CompasToRhinoGeometry(Grasshopper.Kernel.GH_ScriptInstance):
    def RunScript(self, cg):
        if not cg:
            return None

        return SceneObject(item=cg).draw()
# ---------- end compas_draw ----------
panel_3 = Panel(python_3_script.types)

# ---- group: Valency_Filter
python_3_script_2 = Python3Script(lines=compas_draw)  # -> out, all_lines, types; inputs lines: list of Line
# ---------- python_3_script_2: Python ----------
from compas_rhino.conversions import line_to_compas

lines = [line_to_compas(line) for line in lines]

all_lines = []
for i, ln in enumerate(lines):
    ln.name = str(i)
    all_lines.append(ln)
# ---------- end python_3_script_2 ----------

# ----
compas_draw_2 = COMPASDraw(cg=python_3_script_2.all_lines)  # -> rg; same code as compas_draw
crv = Curve(compas_draw_2)

# ---- group: RFUnit_Lines
curve = Curve([<curve referenced from the Rhino model> x4])

curve_2 = Curve([<curve referenced from the Rhino model> x3])

curve_3 = Curve([<curve referenced from the Rhino model> x3])

curve_4 = Curve([<curve referenced from the Rhino model> x3])

curve_5 = Curve([<curve referenced from the Rhino model> x4])

curve_6 = Curve([<curve referenced from the Rhino model> x3])

curve_7 = Curve([<curve referenced from the Rhino model> x3])

curve_8 = Curve([<curve referenced from the Rhino model> x3])

# ----
curve_9 = Curve([<curve referenced from the Rhino model> x34])
cluster = Cluster(curve=curve)  # -> i, point_3
cluster_2 = Cluster(curve=curve_2)  # -> i, point_3
cluster_3 = Cluster(curve=curve_3)  # -> i, point_3
cluster_4 = Cluster(curve=curve_4)  # -> i, point_3
cluster_5 = Cluster(curve=curve_5)  # -> i, point_3
cluster_6 = Cluster(curve=curve_6)  # -> i, point_3
cluster_7 = Cluster(curve=curve_7)  # -> i, point_3
cluster_8 = Cluster(curve=curve_8)  # -> i, point_3

# ---- group: Initialize RFUnit
rfunit = Python3Script(
    pivot=cluster.i,
    points=cluster.point_3,
    start_eccentricity=Slider(0.144, range=-0.5..0.5),
    end_eccentricity=Slider(0, range=-0.5..0.5),
    overlap=Slider(0, range=0..0.5))  # -> rfunit, shape_edges, segment_lines; inputs pivot: Point3d, points: list of Point3d
# ---------- rfunit: Python ----------
# r: compas>=2.9, compas_timber>=0.14
# venv: mas-personal

from compas_rhino import DevTools
DevTools.ensure_path()

from RF_Joint_Expansion import BoundaryPolygon
from RF_Joint_Expansion import RFUnit
from compas.geometry import Polygon
from compas.geometry import Point
from compas_rhino.conversions import point_to_compas

#arbitrary extension to find line intersections
extension = 7

#input parmameters 
p1 = point_to_compas(pivot)
pts = [point_to_compas(p) for p in points]

#Create Boundary Polygon
boundpoly = BoundaryPolygon(p1, pts, extension)
a = boundpoly.polygon_points
b = boundpoly.polygon_edges
c = boundpoly.shape

#Create RFUnit instance
rfunit = RFUnit(boundpoly, start_eccentricity, end_eccentricity, overlap)
rfunit.generate_segments()
rfunit.adjust_segments()

# a = rfunit.

#Output edges and segments lines
shape_edges = rfunit.edges
segment_lines = [segment.line for segment in rfunit.segments]
# ---------- end rfunit ----------

rfunit_2 = Python3Script(
    pivot=cluster_2.i,
    points=cluster_2.point_3,
    start_eccentricity=Slider(0, range=-0.5..0.5),
    end_eccentricity=Slider(0, range=-0.5..0.5),
    overlap=Slider(0, range=0..0.5))  # -> rfunit, shape_edges, segment_lines; inputs pivot: Point3d, points: list of Point3d
# ---------- rfunit_2: Python ----------
# r: compas>=2.9, compas_timber>=0.14
# venv: mas-personal

from compas_rhino import DevTools
DevTools.ensure_path()

from RF_Joint_Expansion import BoundaryPolygon
from RF_Joint_Expansion import RFUnit
from compas.geometry import Polygon
from compas.geometry import Point
from compas_rhino.conversions import point_to_compas

#arbitrary extension to find line intersections
extension = 100
 
#input parmameters 
p1 = point_to_compas(pivot)
pts = [point_to_compas(p) for p in points]

#Create Boundary Polygon
boundpoly = BoundaryPolygon(p1, pts, extension)

#Create RFUnit instance
rfunit = RFUnit(boundpoly, start_eccentricity, end_eccentricity, overlap)
rfunit.generate_segments()
rfunit.adjust_segments()

#Output edges and segments lines
shape_edges = rfunit.edges
segment_lines = [segment.line for segment in rfunit.segments]
# ---------- end rfunit_2 ----------

rfunit_3 = Python3Script(
    pivot=cluster_3.i,
    points=cluster_3.point_3,
    start_eccentricity=Slider(-0.3, range=-0.5..0.5),
    end_eccentricity=Slider(0, range=-0.5..0.5),
    overlap=Slider(0, range=0..0.5))  # -> rfunit, shape_edges, segment_lines; inputs pivot: Point3d, points: list of Point3d; same code as rfunit_2

rfunit_4 = Python3Script(
    pivot=cluster_4.i,
    points=cluster_4.point_3,
    start_eccentricity=Slider(-0.275, range=-0.5..0.5),
    end_eccentricity=Slider(0, range=-0.5..0.5),
    overlap=Slider(0, range=0..0.5))  # -> rfunit, shape_edges, segment_lines; inputs pivot: Point3d, points: list of Point3d; same code as rfunit_2

rfunit_5 = Python3Script(
    pivot=cluster_5.i,
    points=cluster_5.point_3,
    start_eccentricity=Slider(0.144, range=-0.5..0.5),
    end_eccentricity=Slider(0, range=-0.5..0.5),
    overlap=Slider(0, range=0..0.5))  # -> rfunit, shape_edges, segment_lines; inputs pivot: Point3d, points: list of Point3d; same code as rfunit

rfunit_6 = Python3Script(
    pivot=cluster_6.i,
    points=cluster_6.point_3,
    start_eccentricity=Slider(-0.279, range=-0.5..0.5),
    end_eccentricity=Slider(0, range=-0.5..0.5),
    overlap=Slider(0, range=0..0.5))  # -> rfunit, shape_edges, segment_lines; inputs pivot: Point3d, points: list of Point3d; same code as rfunit

rfunit_7 = Python3Script(
    pivot=cluster_7.i,
    points=cluster_7.point_3,
    start_eccentricity=Slider(-0.274, range=-0.5..0.5),
    end_eccentricity=Slider(0, range=-0.5..0.5),
    overlap=Slider(0, range=0..0.5))  # -> rfunit, shape_edges, segment_lines; inputs pivot: Point3d, points: list of Point3d; same code as rfunit

rfunit_8 = Python3Script(
    pivot=cluster_8.i,
    points=cluster_8.point_3,
    start_eccentricity=Slider(-0.279, range=-0.5..0.5),
    end_eccentricity=Slider(0, range=-0.5..0.5),
    overlap=Slider(0, range=0..0.5))  # -> rfunit, shape_edges, segment_lines; inputs pivot: Point3d, points: list of Point3d; same code as rfunit

# ----
# RF Units
number_slider = Slider(3, range=3..20)
ct_beam = CTBeam(centerline=curve_9, width=Slider(0.12, range=0..1), height=Slider(0.24, range=0..1))  # -> Beam, Blank; inputs centerline: list, z_vector: list of Vector3d, width: list of Double, height: list of Double, category: list of String, updateRefObj: Boolean
#   port centerline: Referenced curve or line, Guid of curve or line in the active Rhino document.
#   port z_vector: Vector defining the orientation of the cross-section (corresponds to the height dimension). If None, a default will be taken.
#   port width: Width of the cross-section (usually the smaller dimension).
#   port height: Height of the cross-section (usually the larger dimension).
#   port category: Category of a beam.
#   port updateRefObj: (optional) If True, the attributes in the referenced object will be updated/overwritten with the new values given here.
#   port Beam: Beam object(s).
#   port Blank: Shape of the beam's blank.
# ---------- ct_beam: Python ----------
# r: compas_timber==1.0.5
"""Creates a Beam from a LineCurve."""

# flake8: noqa
import Grasshopper
import Rhino
import rhinoscriptsyntax as rs
import System
from compas.scene import Scene
from compas_rhino.conversions import line_to_compas
from compas_rhino.conversions import vector_to_compas

from compas_timber.elements import Beam as CTBeam
from compas_timber.ghpython.rhino_object_name_attributes import update_rhobj_attributes_name
from compas_timber.ghpython.ghcomponent_helpers import list_input_valid_cpython


class Beam_fromCurve(Grasshopper.Kernel.GH_ScriptInstance):
    def RunScript(self,
            centerline: System.Collections.Generic.List[object],
            z_vector: System.Collections.Generic.List[Rhino.Geometry.Vector3d],
            width: System.Collections.Generic.List[float],
            height: System.Collections.Generic.List[float],
            category: System.Collections.Generic.List[str],
            updateRefObj: bool):
        # minimum inputs required
        if not list_input_valid_cpython(ghenv, centerline, "Centerline"):
            return
        if not width:
            length = self._get_centerline_length(centerline)
            width = [length / 20]
        if not height:
            length = self._get_centerline_length(centerline)
            height = [length / 10]

        # reformat unset parameters for consistency
        if not z_vector:
            z_vector = [None]
        if not category:
            category = [None]

        beams = []
        blanks = []
        scene = Scene()

        if centerline and height and width:
            # check list lengths for consistency
            N = len(centerline)
            if len(z_vector) not in (0, 1, N):
                ghenv.Component.AddRuntimeMessage(
                    Grasshopper.Kernel.GH_RuntimeMessageLevel.Error, " In 'ZVector' I need either none, one or the same number of inputs as the Crv parameter."
                )
            if len(width) not in (1, N):
                ghenv.Component.AddRuntimeMessage(Grasshopper.Kernel.GH_RuntimeMessageLevel.Error, " In 'W' I need either one or the same number of inputs as the Crv parameter.")
            if len(height) not in (1, N):
                ghenv.Component.AddRuntimeMessage(Grasshopper.Kernel.GH_RuntimeMessageLevel.Error, " In 'H' I need either one or the same number of inputs as the Crv parameter.")
            if len(category) not in (0, 1, N):
                ghenv.Component.AddRuntimeMessage(
                    Grasshopper.Kernel.GH_RuntimeMessageLevel.Error, " In 'Category' I need either none, one or the same number of inputs as the Crv parameter."
                )

            # duplicate data if None or single value
            if len(z_vector) != N:
                z_vector = [z_vector[0] for _ in range(N)]
            if len(width) != N:
                width = [width[0] for _ in range(N)]
            if len(height) != N:
                height = [height[0] for _ in range(N)]
            if len(category) != N:
                category = [category[0] for _ in range(N)]

            for line, z, w, h, c in zip(centerline, z_vector, width, height, category):
                guid, geometry = self._get_guid_and_geometry(line)
                rhino_line = rs.coerceline(geometry)
                line = line_to_compas(rhino_line)

                z = vector_to_compas(z) if z else None
                beam = CTBeam.from_centerline(centerline=line, width=w, height=h, z_vector=z)
                beam.attributes["rhino_guid"] = str(guid) if guid else None
                beam.attributes["category"] = c
                if updateRefObj and guid:
                    update_rhobj_attributes_name(guid, "width", str(w))
                    update_rhobj_attributes_name(guid, "height", str(h))
                    update_rhobj_attributes_name(guid, "zvector", str(list(beam.frame.zaxis)))
                    update_rhobj_attributes_name(guid, "category", c)

                beams.append(beam)
                scene.add(beam.blank)

        blanks = scene.draw()

        return beams, blanks

    def _get_guid_and_geometry(self, line):
        # internalized curves and GH geometry will not have persistent GUIDs, referenced Rhino objects will
        # type hint on the input has to be 'ghdoc' for this to work
        guid = None
        geometry = line
        rhino_obj = Rhino.RhinoDoc.ActiveDoc.Objects.FindId(line)
        if rhino_obj:
            guid = line
            geometry = rhino_obj.Geometry
        return guid, geometry

    def _get_centerline_length(self, centerline):
        centerline_length = []
        for i in centerline:
            centerline_length.append(rs.CurveLength(i))
        if centerline_length:
            length_average = sum(centerline_length) / len(centerline_length)
        else:
            length_average = 1
        return length_average
# ---------- end ct_beam ----------
data = Data(rfunit.rfunit)
compas_draw_3 = COMPASDraw(cg=rfunit.shape_edges)  # -> rg
#   port cg: The COMPAS geometry or datastructure to be drawn.
#   port rg: The Rhino geometry object.
# ---------- compas_draw_3: Python ----------
# r: compas>=2.8.1
"""
Draws COMPAS geometry in Grasshopper.
"""

from typing import Any

import Grasshopper

from compas.scene import SceneObject


class CompasToRhinoGeometry(Grasshopper.Kernel.GH_ScriptInstance):
    def RunScript(self, cg):
        if not cg:
            return None

        return SceneObject(item=cg).draw()
# ---------- end compas_draw_3 ----------
compas_draw_4 = COMPASDraw(cg=rfunit.segment_lines)  # -> rg; same code as compas_draw_3
data_2 = Data(rfunit_2.rfunit)
compas_draw_5 = COMPASDraw(cg=rfunit_2.shape_edges)  # -> rg; same code as compas_draw_3
compas_draw_6 = COMPASDraw(cg=rfunit_2.segment_lines)  # -> rg; same code as compas_draw_3
data_3 = Data(rfunit_3.rfunit)
compas_draw_7 = COMPASDraw(cg=rfunit_3.shape_edges)  # -> rg; same code as compas_draw_3
compas_draw_8 = COMPASDraw(cg=rfunit_3.segment_lines)  # -> rg; same code as compas_draw_3
data_4 = Data(rfunit_4.rfunit)
compas_draw_9 = COMPASDraw(cg=rfunit_4.shape_edges)  # -> rg; same code as compas_draw_3
compas_draw_10 = COMPASDraw(cg=rfunit_4.segment_lines)  # -> rg; same code as compas_draw_3
data_5 = Data(rfunit_5.rfunit)
compas_draw_11 = COMPASDraw(cg=rfunit_5.shape_edges)  # -> rg; same code as compas_draw_3
compas_draw_12 = COMPASDraw(cg=rfunit_5.segment_lines)  # -> rg; same code as compas_draw_3
data_6 = Data(rfunit_6.rfunit)
compas_draw_13 = COMPASDraw(cg=rfunit_6.shape_edges)  # -> rg; same code as compas_draw_3
compas_draw_14 = COMPASDraw(cg=rfunit_6.segment_lines)  # -> rg; same code as compas_draw_3
data_7 = Data(rfunit_7.rfunit)
compas_draw_15 = COMPASDraw(cg=rfunit_7.shape_edges)  # -> rg; same code as compas_draw_3
compas_draw_16 = COMPASDraw(cg=rfunit_7.segment_lines)  # -> rg; same code as compas_draw_3
data_8 = Data(rfunit_8.rfunit)
compas_draw_17 = COMPASDraw(cg=rfunit_8.shape_edges)  # -> rg; same code as compas_draw_3
compas_draw_18 = COMPASDraw(cg=rfunit_8.segment_lines)  # -> rg; same code as compas_draw_3
rf_unit = Python3Script(
    sides=number_slider,
    edge_length=Slider(0.65, range=0.1..3),
    start_eccentricity=Slider(0.096, range=-0.5..0.5),
    end_eccentricity=Slider(0.11, range=-0.5..0.5),
    overlap=Slider(0.26, range=0..0.5))  # -> rfunit, segment_lines, shape_edges; inputs sides: Int32
# ---------- rf_unit: Python ----------
# r: compas>=2.9, compas_timber>=0.14
# venv: ca-fs25

from compas_rhino import DevTools
DevTools.ensure_path()

import math

from compas.geometry import Polygon
from a03_lift_solution import RFUnit

radius = edge_length / (2 * math.sin(math.pi / sides))
shape = Polygon.from_sides_and_radius_xy(sides, radius)

# 8.2 Create the RFUnit instance
rfunit = RFUnit(shape, start_eccentricity, end_eccentricity, overlap)
rfunit.generate_segments()
rfunit.adjust_segments()

# 8.3 Output the edges and segment lines. You can visualize with the COMPAS Draw component right after
shape_edges = rfunit.edges
segment_lines = [segment.line for segment in rfunit.segments]
# ---------- end rf_unit ----------
rf_unit_2 = Python3Script(
    sides=Slider(6, range=3..20),
    edge_length=Slider(0.7, range=0.1..3),
    start_eccentricity=Slider(0.34, range=-0.5..0.5),
    end_eccentricity=Slider(0, range=-0.5..0.5),
    overlap=Slider(0.11, range=0..0.5))  # -> rfunit, segment_lines, shape_edges; inputs sides: Int32; same code as rf_unit
curve_middle = CurveMiddle(Curve=compas_draw_12)
point_list = PointList(Points=curve_middle, Size=Slider(0.1, range=0..1))
ct_beam_2 = CTBeam(
    centerline=[compas_draw_6, compas_draw_8, compas_draw_10, compas_draw_12],
    width=Slider(0.12, range=0..1),
    height=Slider(0.24, range=0..1))  # -> Beam, Blank; inputs centerline: list, z_vector: list of Vector3d, width: list of Double, height: list of Double, category: list of String, updateRefObj: Boolean; same code as ct_beam
custom_preview_lineweights = CustomPreviewLineweights(
    Geometry=compas_draw_4,
    Shader=ColourSwatch(SwatchColor=RGB(0, 0, 255)),
    Thickness=Slider(10, range=0..100),
    Absolute=False)
compas_draw_19 = COMPASDraw(cg=rf_unit.segment_lines)  # -> rg; same code as compas_draw_3
compas_draw_20 = COMPASDraw(cg=rf_unit.shape_edges)  # -> rg; same code as compas_draw_3
compas_draw_21 = COMPASDraw(cg=rf_unit_2.segment_lines)  # -> rg; same code as compas_draw_3
compas_draw_22 = COMPASDraw(cg=rf_unit_2.shape_edges)  # -> rg; same code as compas_draw_3
custom_preview_lineweights_2 = CustomPreviewLineweights(
    Geometry=compas_draw_14,
    Shader=ColourSwatch(SwatchColor=RGB(0, 255, 0)),
    Thickness=Slider(10, range=0..100),
    Absolute=False)
custom_preview_lineweights_3 = CustomPreviewLineweights(
    Geometry=compas_draw_16,
    Shader=ColourSwatch(SwatchColor=RGB(0, 0, 255)),
    Thickness=Slider(25, range=0..100),
    Absolute=False)
custom_preview_lineweights_4 = CustomPreviewLineweights(
    Geometry=compas_draw_18,
    Shader=ColourSwatch(SwatchColor=RGB(0, 255, 0)),
    Thickness=Slider(36, range=0..100),
    Absolute=False)
merge = Merge(Data1=data_2, Data2=data_3, Data3=data_4, Data4=data_5)

# ---- group: 3.6
rule = Script(
    unit1=rf_unit.rfunit,
    unit2=rf_unit_2.rfunit,
    edge1=Slider(0, range=0..6),
    edge2=Slider(0, range=0..6),
    mirror=Toggle(False))  # -> rule, geo; inputs edge1: Int32, edge2: Int32
# ---------- rule: Python ----------
# r: compas>=2.9, compas_timber>=0.14
# venv: ca-fs25

from compas_rhino import DevTools
DevTools.ensure_path()

from a03_lift_solution import RFGrammarRule


rule = RFGrammarRule(unit1, unit2, edge1, edge2, mirror)
new_unit = rule.apply_rule(edge1, edge2, mirror)

geo = []
shape_edges = unit1.edges + new_unit.edges
segment_lines = [segment.line for segment in unit1.segments]
segment_lines += [segment.line for segment in new_unit.segments]
geo = shape_edges + segment_lines
# ---------- end rule ----------
compas_draw_23 = COMPASDraw(cg=rule.geo)  # -> rg; same code as compas_draw_3

# ----
custom_preview_lineweights_5 = CustomPreviewLineweights(
    Geometry=[compas_draw_6, compas_draw_8, compas_draw_10],
    Shader=ColourSwatch(SwatchColor=RGB(255, 0, 254)),
    Thickness=Slider(10, range=0..100),
    Absolute=False)
custom_preview_lineweights_6 = CustomPreviewLineweights(
    Geometry=compas_draw_12,
    Shader=ColourSwatch(SwatchColor=RGB(255, 0, 0)),
    Thickness=Slider(10, range=0..100),
    Absolute=False)
rfcluster = Script(Units=merge, show_text=Toggle(True))  # -> Cluster, geo
# ---------- rfcluster: Python ----------
# r: compas>=2.9, compas_timber>=0.14
# venv: ca-fs25

from compas_rhino import DevTools
DevTools.ensure_path()

from compas_rhino.conversions import line_to_rhino_curve, point_to_rhino
from RF_Joint_Expansion import RFCluster

import random
import Rhino.Geometry as rg

# vertex_config = eval(vertex_config)

"""Needs a different initialisation parameter for RFTessellation"""

# tessellation = RFTessellation(vertex_configuration=vertex_config)
# tessellation.apply_rules_cycle(rules)

cluster = RFCluster()

geo = []

for unit in cluster.units:
    geo.extend(map(line_to_rhino_curve, unit.edges))
    geo.extend([line_to_rhino_curve(segment.line)  for segment in unit.segments])

    if show_text:
        dot = rg.TextDot(f"Unit={unit.key}", point_to_rhino(unit.centroid))
        geo.append(dot)

        for e, cp in enumerate(unit.connection_points):
            dot = rg.TextDot(f"E={unit.key}/{e}", point_to_rhino(cp.point - cp.vector/100.))
            geo.append(dot)
# ---------- end rfcluster ----------
geometry = Geometry(rfcluster.geo)
panel_4 = Panel(rfcluster.Cluster)

# ---- group: Single Cycle
value_list = ValueList({"(3, 3, 3, 3, 3, 3)", "(4, 4, 4, 4)", "(3, 6, 3, 6)", "(6, 6, 6)"}, selected="(3, 6, 3, 6)")
# RF Tessellation
data_9 = Data(rule.rule)
tessellate_single_cycle = Script(rules=data_9, vertex_config=value_list, show_text=Toggle(False))  # -> tessellation, geo; inputs rules: list
# ---------- tessellate_single_cycle: Python ----------
# r: compas>=2.9, compas_timber>=0.14
# venv: ca-fs25

from compas_rhino import DevTools
DevTools.ensure_path()

from compas_rhino.conversions import line_to_rhino_curve, point_to_rhino
from a03_lift_solution import RFTessellation

import random
import Rhino.Geometry as rg

vertex_config = eval(vertex_config)

tessellation = RFTessellation(vertex_configuration=vertex_config)
tessellation.apply_rules_cycle(rules)

geo = []

for unit in tessellation.units:
    geo.extend(map(line_to_rhino_curve, unit.edges))
    geo.extend([line_to_rhino_curve(segment.line)  for segment in unit.segments])

    if show_text:
        dot = rg.TextDot(f"Unit={unit.key}", point_to_rhino(unit.centroid))
        geo.append(dot)

        for e, cp in enumerate(unit.connection_points):
            dot = rg.TextDot(f"E={unit.key}/{e}", point_to_rhino(cp.point - cp.vector/100.))
            geo.append(dot)
# ---------- end tessellate_single_cycle ----------

# ---- group: Export line_model
python_3_script_3 = Python3Script(all_lines=python_3_script_2.all_lines, save=Button())  # -> json_path; inputs all_lines: list
# ---------- python_3_script_3: Python ----------
import os
from compas.data import json_dump

gh_dir = os.path.dirname(ghenv.Component.OnPingDocument().FilePath)
data_folder = os.path.join(gh_dir, "data")
json_path = os.path.join(data_folder, "out_lines.json")

# Build data with attributes
data = []
for i, line in enumerate(all_lines):
    data.append({
        "line": line,
        "type": line.name
    })

if save:
    with open(json_path, 'w') as path:
        json_dump(data, path, pretty=True)
# ---------- end python_3_script_3 ----------

# ----
python_3_script_4 = Python3Script(run=Toggle(False), angle_deg=Slider(8, range=0..100))  # -> out, tree_out, color_out
# ---------- python_3_script_4: Python ----------
"""
Rotate By Group - GHPython CPython Rhino 8
==========================================
Reads all grouped objects from the active Rhino doc,
rotates each group around its bounding box center by angle_deg,
outputs geometry and per-group colors as DataTrees.

INPUTS
    run       : bool
    angle_deg : float  (default 2.0)

OUTPUTS
    tree_out  : DataTree<GeometryBase>
    color_out : DataTree<Color>
"""

import Rhino
import Rhino.Geometry as rg
import Grasshopper as gh
import System.Drawing as sd
import random
import math

try:
    if not run:
        tree_out  = gh.DataTree[object]()
        color_out = gh.DataTree[object]()
    else:
        _angle = angle_deg if angle_deg is not None else 2.0
        angle_rad = math.radians(_angle)

        # --- Gather geometry by group id ---
        group_dict = {}  # group_id -> [GeometryBase, ...]

        settings = Rhino.DocObjects.ObjectEnumeratorSettings()
        settings.NormalObjects = True
        rh_objs = Rhino.RhinoDoc.ActiveDoc.Objects.GetObjectList(settings)

        for obj in rh_objs:
            ids = obj.Attributes.GetGroupList()
            if ids and len(ids) > 0:
                gid = ids[0]
                if gid not in group_dict:
                    group_dict[gid] = []
                group_dict[gid].append(obj.Geometry.Duplicate())

        # --- Build output trees ---
        geom_tree  = gh.DataTree[object]()
        color_tree = gh.DataTree[object]()

        rnd = random.Random(42)

        for path_idx, (gid, members) in enumerate(group_dict.items()):
            path = gh.Kernel.Data.GH_Path(path_idx)

            # One random color per group
            r = rnd.randint(50, 255)
            g = rnd.randint(50, 255)
            b = rnd.randint(50, 255)
            color_tree.Add(sd.Color.FromArgb(r, g, b), path)

            # Bounding box center
            bbox = rg.BoundingBox.Empty
            for geo in members:
                bbox.Union(geo.GetBoundingBox(True))
            center = bbox.Center

            # Rotate around Z through center
            xform = rg.Transform.Rotation(angle_rad, rg.Vector3d.ZAxis, center)

            for geo in members:
                geo.Transform(xform)
                geom_tree.Add(geo, path)

        tree_out  = geom_tree
        color_out = color_tree

except Exception as e:
    import traceback
    tree_out  = gh.DataTree[object]()
    color_out = gh.DataTree[object]()
    print("ERROR: " + str(e))
    print(traceback.format_exc())
# ---------- end python_3_script_4 ----------
panel_5 = Panel(python_3_script_3)
panel_6 = Panel(tessellate_single_cycle.tessellation)

collinearity = Script(tessellation=tessellate_single_cycle.tessellation, angular_tolerance=Slider(4.1, range=0..20), collinear=Toggle(True))  # -> tessellation, geo
# ---------- collinearity: Python ----------
# r: compas>=2.9, compas_timber>=0.14
# venv: ca-fs25

from compas_rhino import DevTools
DevTools.ensure_path()

from compas_rhino.conversions import line_to_rhino_curve, point_to_rhino

import random
import Rhino.Geometry as rg

#cluster = cluster.copy()

tessellation = tessellation.copy()

if collinear:
    tessellation.create_rods_from_shared_segments(angular_tolerance)
else:
    tessellation.create_rods_from_single_segments()


# if collinear:
#     cluster.create_rods_from_shared_segments(angular_tolerance)
# else:
#     tessellation.create_rods_from_single_segments()


geo = []

for rod in tessellation.rods:
    geo.append(line_to_rhino_curve(rod.line))

#for rod in cluster.rods:
    # geo.append(line_to_rhino_curve(rod.line))
# ---------- end collinearity ----------

geometry_2 = Geometry(tessellate_single_cycle.geo)
curve_10 = Curve(reparameterize(python_3_script_4.tree_out))

# ----
# Colinearity Check
number_slider_2 = Slider(4.1, range=0..20)
collinearity_2 = Script(tessellation=tessellate_single_cycle.tessellation, angular_tolerance=number_slider_2, collinear=Toggle(True))  # -> tessellation, geo
# ---------- collinearity_2: Python ----------
# r: compas>=2.9, compas_timber>=0.14
# venv: ca-fs25

from compas_rhino import DevTools
DevTools.ensure_path()

from compas_rhino.conversions import line_to_rhino_curve, point_to_rhino

import random
import Rhino.Geometry as rg


tessellation = tessellation.copy()

if collinear:
    tessellation.create_rods_from_shared_segments(angular_tolerance)
else:
    tessellation.create_rods_from_single_segments()

geo = []

for rod in tessellation.rods:
    geo.append(line_to_rhino_curve(rod.line))
# ---------- end collinearity_2 ----------

python_3_script_5 = Python3Script(group_lines=curve_10, outer_frac=Slider(0.18, range=0..1), debug=Toggle(True))  # -> out, extremity_pts, group_normals, node_pts, resolved_lines; inputs group_lines: tree of Line
# ---------- python_3_script_5: Python ----------
"""
Group Node Resolver - GHPython CPython Rhino 8

INPUTS
    group_lines : DataTree<Line>
    outer_frac  : float  (default 0.5)
    tol         : float  (default 0.01)
    debug       : bool

OUTPUTS
    resolved_lines : DataTree<Line>
    node_pts       : List<Point3d>
    extremity_pts  : DataTree<Point3d>
"""

import Rhino.Geometry as rg
import Grasshopper as gh
import numpy as np
from scipy.spatial import cKDTree

try:
    _tol        = tol        if tol        is not None else 0.01
    _outer_frac = outer_frac if outer_frac is not None else 0.5
    _debug      = debug      if debug      is not None else False

    # Unwrap
    all_lines = []
    for branch in group_lines.Branches:
        lns = []
        for item in branch:
            ln = item.Value if hasattr(item, "Value") else item
            if ln is not None: lns.append(ln)
        all_lines.append(lns)

    # KDTree on midpoints - one entry per line
    mid_gids   = []
    mid_lines  = []
    mid_coords = []
    for gid, lns in enumerate(all_lines):
        for ln in lns:
            mid_gids.append(gid)
            mid_lines.append(ln)
            mid_coords.append([(ln.From.X+ln.To.X)*0.5,
                                (ln.From.Y+ln.To.Y)*0.5,
                                (ln.From.Z+ln.To.Z)*0.5])
    kd = cKDTree(np.array(mid_coords))

    def filter_by_dist(pts, ref_pt, max_dist):
        return [p for p in pts if ref_pt.DistanceTo(p) <= max_dist]

    def group_plane(lns):
        a, b = lns[0].From, lns[0].To
        c = rg.Point3d(a.X, a.Y, 0.0)
        if a.DistanceTo(c) < _tol:
            c = rg.Point3d((a.X+b.X)/2, (a.Y+b.Y)/2, 0.0)
        return rg.Plane(a, b, c)

    def intersect(plane, ln):
        rc, t = rg.Intersect.Intersection.LinePlane(ln, plane)
        if rc and 0.0 <= t <= 1.0:
            return ln.PointAt(t)
        return None

    # Node pool
    all_nodes = {}
    def add_node(pt):
        for ep in all_nodes.values():
            if ep.DistanceTo(pt) < _tol*3: return ep
        k = (round(pt.X/_tol)*_tol, round(pt.Y/_tol)*_tol, round(pt.Z/_tol)*_tol)
        all_nodes[k] = pt
        return pt

    resolved_tree = gh.DataTree[object]()
    ext_tree      = gh.DataTree[object]()
    normals_tree  = gh.DataTree[object]()

    for gid, lns in enumerate(all_lines):
        if not lns: continue

        # Weighted centroid: all From+To with duplicates
        all_ep = [ln.From for ln in lns] + [ln.To for ln in lns]
        cx = sum(p.X for p in all_ep) / len(all_ep)
        cy = sum(p.Y for p in all_ep) / len(all_ep)
        cz = sum(p.Z for p in all_ep) / len(all_ep)
        cen = rg.Point3d(cx, cy, cz)

        upts  = list({(round(p.X/_tol), round(p.Y/_tol), round(p.Z/_tol)): p
                      for ln in lns for p in (ln.From, ln.To)}.values())

        # XY-only distance from centroid
        def xy_dist(p):
            return ((p.X-cx)**2 + (p.Y-cy)**2)**0.5

        max_r  = max(xy_dist(p) for p in upts)
        thresh = max_r * _outer_frac

        path       = gh.Kernel.Data.GH_Path(gid)
        used_nodes = []

        single_line_group = (len(lns) == 1)
        plane = group_plane(lns)

        # Compute one normal for the whole group using 3-point method
        # Use first line's From, To, and a second point from another line if available
        grp_normal = plane.Normal
        grp_normal.Unitize()
        ln_len_avg = sum(l.From.DistanceTo(l.To) for l in lns) / len(lns)
        max_snap = max(0.8, ln_len_avg * 0.3)

        def get_node(query_pt, ln_mid_pt):
            # find nearest neighbour group and intersect plane with it
            _, idxs = kd.query([[query_pt.X, query_pt.Y, query_pt.Z]],
                                k=min(100, len(mid_gids)))
            ngid = None
            for idx in idxs[0]:
                if mid_gids[idx] != gid:
                    ngid = mid_gids[idx]; break
            if ngid is None: return None, None
            ipts = [p for p in (intersect(plane, nln) for nln in all_lines[ngid])
                    if p is not None]
            ipts = filter_by_dist(ipts, query_pt, max_snap)
            if not ipts: return None, ngid
            ipts.sort(key=lambda p: ln_mid_pt.DistanceTo(p))
            node = ipts[0]
            for cp in ipts:
                if not any(cp.DistanceTo(u) < _tol*5 for u in used_nodes):
                    node = cp; break
            used_nodes.append(node)
            return add_node(node), ngid

        for li, ln in enumerate(lns):
            from_r = xy_dist(ln.From)
            to_r   = xy_dist(ln.To)
            ln_mid = rg.Point3d((ln.From.X+ln.To.X)*0.5,
                                 (ln.From.Y+ln.To.Y)*0.5,
                                 (ln.From.Z+ln.To.Z)*0.5)

            if single_line_group:
                # Both ends are free - resolve each independently
                p0, ng0 = get_node(ln.From, ln_mid)
                p1, ng1 = get_node(ln.To,   ln_mid)
                ext_tree.Add(ln.From, gh.Kernel.Data.GH_Path(gid, li*2))
                ext_tree.Add(ln.To,   gh.Kernel.Data.GH_Path(gid, li*2+1))
                p0 = p0 if p0 else ln.From
                p1 = p1 if p1 else ln.To
                if p0.DistanceTo(p1) > _tol:
                    res_ln = rg.Line(p0, p1)
                    resolved_tree.Add(res_ln, path)
                    normals_tree.Add(grp_normal, path)

                if _debug:
                    print("G{} L{} SINGLE from->G{} {:.2f},{:.2f},{:.2f}  to->G{} {:.2f},{:.2f},{:.2f}".format(
                        gid, li,
                        ng0, p0.X, p0.Y, p0.Z,
                        ng1, p1.X, p1.Y, p1.Z))
                continue

            # Normal: one outer, one inner
            if from_r >= to_r:
                outer_pt, inner_pt = ln.From, ln.To
            else:
                outer_pt, inner_pt = ln.To, ln.From

            ext_tree.Add(outer_pt, gh.Kernel.Data.GH_Path(gid, li))
            node_pt, ngid = get_node(outer_pt, ln_mid)
            if node_pt is None:
                # No neighbour found - keep original line as-is
                res_ln = rg.Line(ln.From, ln.To)
                resolved_tree.Add(res_ln, path)
                normals_tree.Add(grp_normal, path)

                continue

            if inner_pt.DistanceTo(node_pt) > _tol:
                res_ln = rg.Line(inner_pt, node_pt)
                resolved_tree.Add(res_ln, path)
                normals_tree.Add(grp_normal, path)

            if _debug:
                print("G{} L{} outer={:.2f},{:.2f},{:.2f} inner={:.2f},{:.2f},{:.2f} -> G{} node={:.2f},{:.2f},{:.2f}".format(
                    gid, li,
                    outer_pt.X, outer_pt.Y, outer_pt.Z,
                    inner_pt.X, inner_pt.Y, inner_pt.Z,
                    ngid,
                    node_pt.X, node_pt.Y, node_pt.Z))

    resolved_lines = resolved_tree
    extremity_pts  = ext_tree
    node_pts       = list(all_nodes.values())
    group_normals  = normals_tree

except Exception as e:
    import traceback
    resolved_lines = gh.DataTree[object]()
    extremity_pts  = gh.DataTree[object]()
    node_pts       = []
    group_normals  = gh.DataTree[object]()
    print("ERROR: " + str(e))
    print(traceback.format_exc())
# ---------- end python_3_script_5 ----------
point = Point(python_3_script_5.node_pts)
point_2 = Point(python_3_script_5.extremity_pts)
curve_11 = Curve(flatten(python_3_script_5.resolved_lines))
ct_beam_3 = CTBeam(
    centerline=curve_11,
    z_vector=flatten(python_3_script_5.group_normals),
    width=Slider(0.16, range=0..1),
    height=Slider(0.24, range=0..1))  # -> Beam, Blank; inputs centerline: list, z_vector: list of Vector3d, width: list of Double, height: list of Double, category: list of String, updateRefObj: Boolean; same code as ct_beam
unflatten_tree = UnflattenTree(Tree=ct_beam_3.Blank, Guide=python_3_script_5.resolved_lines)
custom_preview_lineweights_7 = CustomPreviewLineweights(
    Geometry=python_3_script_5.resolved_lines,
    Shader=python_3_script_4.color_out,
    Thickness=Slider(4, range=0..100),
    Absolute=False)

# ==== cluster Cluster
curve = ClusterInput()

end_points = EndPoints(Curve=curve)  # -> Start, End
point = Point([end_points.Start, end_points.End])
bounding_box = BoundingBox(Content=point, Plane=PlaneXY(0, 0, 0), UnionBox=True)  # -> Box, Box_2
area = Area(Geometry=bounding_box.Box)  # -> Area, Centroid
list_length = ListLength(List=point)
distance = Distance(PointA=area.Centroid, PointB=point)
division = Division(A=list_length, B=Slider(2, range=0..10))
sort_list = SortList(Keys=distance, ValuesValuesA=point)  # -> Keys, ValuesValuesA
split_list = SplitList(List=sort_list.ValuesValuesA, Index=division)  # -> ListA, ListB
list_item = ListItem(List=split_list.ListA, Index=0, Wrap=True)
point_2 = Point(split_list.ListB)

point_3 = ClusterOutput(point_2)
i = ClusterOutput(list_item)
