# Grasshopper definition 0511_timber_model.ghx (Grasshopper 1.0.8)
# plug-ins: Heteroptera, Pufferfish, Human

python_3_script = Python3Script()  # -> out, line_model
# ---------- python_3_script: Python ----------
from compas.data import json_load

import os, sys, importlib

gh_dir = os.path.dirname(ghenv.Component.OnPingDocument().FilePath)
gh_par = os.path.dirname(gh_dir)
file_path = os.path.join(gh_par, "line_model","data", "0806_shifted_lines.json")
print(file_path)

line_model = json_load(file_path)
# ---------- end python_3_script ----------
button = Button()  # disabled
py3 = Python3Script(unload=button)  # disabled
# ---------- py3: Python ----------
from compas_rhino import unload_modules
import compas_timber

if unload:
    unload_modules("compas_timber")
# ---------- end py3 ----------
crv = Curve(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)  # disabled
crv_2 = Curve([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])  # disabled
panel = Panel("0.1")  # disabled
panel_2 = Panel("0.12")  # disabled
panel_3 = Panel("0.1")  # disabled
panel_4 = Panel("0.12")  # disabled
panel_5 = Panel("pass")  # disabled
panel_6 = Panel("fix")  # disabled
crv_3 = Curve([<curve referenced from the Rhino model> x3])  # disabled
number_slider = Slider(0.06, range=0..0.1)  # disabled
crv_4 = Curve([<curve referenced from the Rhino model> x2])  # disabled
number_slider_2 = Slider(0.12, range=0..1)  # disabled
merge = Merge(Data1=panel_5, Data2=panel_6)  # disabled
beam = CTBeam(centerline=crv_2, width=panel_3, height=panel_4, category=panel_6)  # -> Beam, Blank; inputs centerline: list, z_vector: list of Vector3d, width: list of Double, height: list of Double, category: list of String, updateRefObj: Boolean; disabled
#   port centerline: Referenced curve or line, Guid of curve or line in the active Rhino document.
#   port z_vector: Vector defining the orientation of the cross-section (corresponds to the height dimension). If None, a default will be taken.
#   port width: Width of the cross-section (usually the smaller dimension).
#   port height: Height of the cross-section (usually the larger dimension).
#   port category: Category of a beam.
#   port updateRefObj: (optional) If True, the attributes in the referenced object will be updated/overwritten with the new values given here.
#   port Beam: Beam object(s).
#   port Blank: Shape of the beam's blank.
# ---------- beam: Python ----------
# env: C:\Users\kapso\OneDrive\Documents\GitHub\timber_design\src
# r: compas_timber>=0.16.2
"""Creates a Beam from a LineCurve."""

# flake8: noqa
import Grasshopper
import Rhino
import rhinoscriptsyntax as rs
import System
from compas.scene import Scene
from compas_rhino.conversions import line_to_compas
from compas_rhino.conversions import vector_to_compas

from compas_timber.elements import Beam as CTBeam
from timber_design.ghpython.ghcomponent_helpers import list_input_valid_cpython


class Beam_fromCurve(Grasshopper.Kernel.GH_ScriptInstance):
    def RunScript(self,
            centerline: System.Collections.Generic.List[object],
            z_vector: System.Collections.Generic.List[Rhino.Geometry.Vector3d],
            width: System.Collections.Generic.List[float],
            height: System.Collections.Generic.List[float],
            category: System.Collections.Generic.List[str],
            updateRefObj: bool):
        # minimum inputs required
        if not list_input_valid_cpython(ghenv, centerline, "Centerline"):
            return
        if not width:
            length = self._get_centerline_length(centerline)
            width = [length / 20]
        if not height:
            length = self._get_centerline_length(centerline)
            height = [length / 10]

        # reformat unset parameters for consistency
        if not z_vector:
            z_vector = [None]
        if not category:
            category = [None]

        beams = []
        blanks = []
        scene = Scene()

        if centerline and height and width:
            # check list lengths for consistency
            N = len(centerline)
            if len(z_vector) not in (0, 1, N):
                ghenv.Component.AddRuntimeMessage(
                    Grasshopper.Kernel.GH_RuntimeMessageLevel.Error, " In 'ZVector' I need either none, one or the same number of inputs as the Crv parameter."
                )
            if len(width) not in (1, N):
                ghenv.Component.AddRuntimeMessage(Grasshopper.Kernel.GH_RuntimeMessageLevel.Error, " In 'W' I need either one or the same number of inputs as the Crv parameter.")
            if len(height) not in (1, N):
                ghenv.Component.AddRuntimeMessage(Grasshopper.Kernel.GH_RuntimeMessageLevel.Error, " In 'H' I need either one or the same number of inputs as the Crv parameter.")
            if len(category) not in (0, 1, N):
                ghenv.Component.AddRuntimeMessage(
                    Grasshopper.Kernel.GH_RuntimeMessageLevel.Error, " In 'Category' I need either none, one or the same number of inputs as the Crv parameter."
                )

            # duplicate data if None or single value
            if len(z_vector) != N:
                z_vector = [z_vector[0] for _ in range(N)]
            if len(width) != N:
                width = [width[0] for _ in range(N)]
            if len(height) != N:
                height = [height[0] for _ in range(N)]
            if len(category) != N:
                category = [category[0] for _ in range(N)]

            for line, z, w, h, c in zip(centerline, z_vector, width, height, category):
                guid, geometry = self._get_guid_and_geometry(line)
                rhino_line = rs.coerceline(geometry)
                line = line_to_compas(rhino_line)

                z = vector_to_compas(z) if z else None
                beam = CTBeam.from_centerline(centerline=line, width=w, height=h, z_vector=z)
                beam.attributes["rhino_guid"] = str(guid) if guid else None
                beam.attributes["category"] = c


                beams.append(beam)
                scene.add(beam.blank)

        blanks = scene.draw()

        return beams, blanks

    def _get_guid_and_geometry(self, line):
        # internalized curves and GH geometry will not have persistent GUIDs, referenced Rhino objects will
        # type hint on the input has to be 'ghdoc' for this to work
        guid = None
        geometry = line
        rhino_obj = Rhino.RhinoDoc.ActiveDoc.Objects.FindId(line)
        if rhino_obj:
            guid = line
            geometry = rhino_obj.Geometry
        return guid, geometry

    def _get_centerline_length(self, centerline):
        centerline_length = []
        for i in centerline:
            centerline_length.append(rs.CurveLength(i))
        if centerline_length:
            length_average = sum(centerline_length) / len(centerline_length)
        else:
            length_average = 1
        return length_average
# ---------- end beam ----------
shift = ShiftList(List=crv_3, Shift=1, Wrap=True)  # disabled
beam_2 = CTBeam(centerline=crv, width=panel, height=panel_2)  # -> Beam, Blank; inputs centerline: list, z_vector: list of Vector3d, width: list of Double, height: list of Double, category: list of String, updateRefObj: Boolean; disabled; same code as beam
end = EndPoints(Curve=crv_4)  # -> Start, End; disabled
end_2 = EndPoints(Curve=crv_3)  # -> Start, End; disabled
vec = Vector(unitize(shift))  # disabled
number_slider_3 = Slider(0, range=0..1)  # disabled
angle = Angle(VectorA=crv_3, VectorB=shift)  # -> Angle, Reflex; disabled
toggle = BooleanToggle(False)  # disabled
bnd = Bounds(Numbers=angle.Angle)  # disabled
py3_2 = Python3Script(x=beam_2.Beam, y=beam.Beam, i=number_slider_3, reorder=toggle)  # -> out, a, planes, cutting_planes, model; inputs y: list, i: Int32; disabled
# ---------- py3_2: Python ----------
from compas_timber.connections import KBirdsmouthJoint
from compas_timber.model import TimberModel
from compas_timber.fabrication import DoubleCut
from compas.tolerance import Tolerance
from compas.scene import Scene
from compas_rhino.conversions import plane_to_rhino, frame_to_rhino

scene = Scene()

model = TimberModel(Tolerance(unit="M"))
model.add_element(x)
model.add_elements(y)

for beam in model.beams:
    beam.remove_features()
# kbj=KBirdsmouthJoint.create(model, x, *y, mill_depth=0.02)
kbj=KBirdsmouthJoint(x, *y, mill_depth=0.02)
cutting_planes = kbj._get_cutting_planes()
dc = DoubleCut.from_planes_and_beam(cutting_planes[i], model.beams[i+1])
model.beams[i+1].add_feature(dc)

# model.process_joinery()

for beam in model.beams:
    if beam.attributes["category"] == "fix":
        for feature in beam.features:
            if feature.PROCESSING_NAME == "DoubleCut":
                planes = [plane_to_rhino(f) for f in feature.planes_from_params_and_beam(beam)]
            scene.add(beam.geometry)

cutting_planes = [frame_to_rhino(p) for p in cutting_planes[1]]
a = scene.draw()
# ---------- end py3_2 ----------
number_slider_4 = Slider(0.02, range=0.01..0.1)  # disabled
remap = RemapNumbers(Value=angle.Angle, Source=bnd, Target=Domain(0, 1))  # -> Mapped, Clipped; disabled
button_2 = Button()  # disabled
panel_7 = Panel("0.06")  # disabled
multiplication = Multiplication(A=panel_7, B=2)  # disabled
addition = Addition(A=multiplication, B=number_slider_4)  # disabled
Z = UnitZ(Factor=addition)  # disabled
move = Move(Geometry=end.Start, Motion=Z)  # -> Geometry, Transform; disabled
ln = Line(StartPoint=move.Geometry, EndPoint=end.End)  # disabled
path = FilePath("C:\Users\kapso\OneDrive\Desktop\BTLx\dc")  # disabled
addition_2 = Addition(A=remap.Mapped, B=1)  # disabled
path_2 = FilePath("C:\Users\kapso\OneDrive\Desktop\BTLx\dc_reorder.btlx")  # disabled
pln = Plane(py3_2.cutting_planes)  # disabled
addition_3 = Addition(A=panel_7, B=number_slider_4)  # disabled
brep = Brep(py3_2.a)  # disabled
writebtlx = CTWriteBTLx(model=py3_2.model, path=path, write=button_2)  # -> BTLx; inputs write: Boolean; disabled
#   port model: Model object.
#   port path: Filepath for new BTLx.
#   port write: Write to file.
#   port BTLx: Pretty BTLx string
# ---------- writebtlx: Python ----------
"""Writes a BTLx file for machining of model parts."""
# env: C:\Users\kapso\OneDrive\Documents\GitHub\timber_design\src
# r: compas_timber>=0.16.2
# flake8: noqa
import Grasshopper
import Rhino

from compas_timber.fabrication import BTLxWriter
from timber_design.ghpython.ghcomponent_helpers import item_input_valid_cpython


class WriteBTLx(Grasshopper.Kernel.GH_ScriptInstance):
    def RunScript(self, model, path, write: bool):
        if not item_input_valid_cpython(ghenv, model, "Model"):
            return

        btlx = BTLxWriter(file_name=str(Rhino.RhinoDoc.ActiveDoc.Name))

        if write:
            if not item_input_valid_cpython(ghenv, path, "Path"):
                return
            XML = btlx.write(model, path)
        else:
            XML = btlx.model_to_xml(model)

        return XML
# ---------- end writebtlx ----------
multiplication_2 = Multiplication(A=addition_2, B=addition_3)  # disabled
multiplication_3 = Multiplication(A=vec, B=multiplication_2)  # disabled
move_2 = Move(Geometry=end_2.Start, Motion=multiplication_3)  # -> Geometry, Transform; disabled
ln_2 = Line(StartPoint=move_2.Geometry, EndPoint=end_2.End)  # disabled
shift_2 = ShiftList(List=ln_2, Shift=1, Wrap=True)  # disabled
pln_2 = Plane(py3_2.planes)  # disabled
pl_origin = PlaneOrigin(Base=py3_2.cutting_planes, Origin=py3_2.planes)  # disabled
end_3 = EndPoints(Curve=shift_2)  # -> Start, End; disabled
number_slider_5 = Slider(4, range=0..10)  # disabled
pl = ConstructPlane(Origin=end_3.Start, XAxis=shift_2, YAxis=Vector(0, 1, 0))  # disabled
end_4 = EndPoints(Curve=ln_2)  # -> Start, End; disabled
item = ListItem(List=pl_origin, Index=0, Wrap=True)  # disabled
projecta = ProjectAlong(Geometry=end_4.Start, Plane=pl, Direction=ln_2)  # -> Geometry, Transform; disabled
number_slider_6 = Slider(0.02, range=0..0.1)  # disabled
ln_3 = Line(StartPoint=projecta.Geometry, EndPoint=end_4.End)  # disabled
item_2 = ListItem(List=ln_3, Index=0, Wrap=True)  # -> Item, Item1; disabled
crvprox = CurveProximity(CurveA=item_2.Item1, CurveB=ln)  # -> PointA, PointB, Distance; disabled
extremes = MinMax(Number=crvprox.Distance)  # -> Minimum, Maximum; disabled
roundd = RoundToDecimalPlace(NumberX=extremes.Maximum, DecimalPlace=number_slider_5, RoundType=2)  # -> Rounded, Difference; disabled
number_slider_7 = Slider(0.015, range=0..0.1)  # disabled
number_slider_8 = Slider(0.12, range=0..1)  # disabled
number_slider_9 = Slider(0.1, range=0..0.1)  # disabled
panel_8 = Panel("primary")  # disabled
timber_model = Python3Script()  # -> out, a, b, c, d, e, processed_models, base_model; inputs boxes: list, clt_plates: list of Polyline; disabled
# ---------- timber_model: Python ----------
from compas.scene import Scene
from compas_rhino.conversions import line_to_compas, polyline_to_compas, plane_to_compas
from compas.tolerance import Tolerance, TOL

from compas_timber.model import TimberModel
from compas_timber.elements import Beam, Plate
from compas_timber.analyzers import TripletAnalyzer

from compas_timber.connections import JointTopology
from compas_timber.connections import TMultiStepJoint
from compas_timber.connections import TStepJoint
from compas_timber.connections import LMiterJoint
from compas_timber.connections import TBirdsmouthJoint
from compas_timber.connections import XLapJoint
from compas_timber.connections import KBirdsmouthJoint

from compas_timber.fabrication import JackRafterCut

from compas.geometry import Frame, Vector, Point, angle_vectors, centroid_points, Line, intersection_segment_plane

#initialise scene object
scene = Scene()

# #initialise base compas timber model
# base_model = TimberModel(Tolerance(unit="MM", absolute="0.001"))

# ============================================================
# Helper: make polygon point order consistent with world Z+
# ============================================================
def oriented_polyline_to_world_z_plus(compas_poly):
    pts = list(compas_poly.points)

    if len(pts) < 3:
        return compas_poly, Vector(0, 0, 1)

    # remove duplicate last point if closed
    if pts[0] == pts[-1]:
        pts = pts[:-1]

    if len(pts) < 3:
        return compas_poly, Vector(0, 0, 1)

    p0 = pts[0]
    p1 = pts[1]
    p2 = pts[2]

    frame = Frame.from_points(p0, p1, p2)
    local_z = frame.zaxis
    world_z = Vector(0, 0, 1)

    # if normal points downward, reverse point order
    if local_z.dot(world_z) < 0:
        pts.reverse()

        # close it again if original was closed
        pts.append(pts[0])

        compas_poly = type(compas_poly)(pts)

        p0 = compas_poly.points[0]
        p1 = compas_poly.points[1]
        p2 = compas_poly.points[2]

        frame = Frame.from_points(p0, p1, p2)
        local_z = frame.zaxis

    return compas_poly, local_z

# ============================================================
# Create CLT Plates
# ============================================================

plates = []
models = []

# for c in clt_plates:
#     compas_poly = polyline_to_compas(c)
#     if compas_poly is None:
#         continue
#     center = centroid_points(compas_poly.points)    
#     for b in boxes:
#         model = TimberModel(Tolerance(unit="MM", absolute="0.001"))
#         if b.contains_point(center):
#             compas_poly, local_z = oriented_polyline_to_world_z_plus(compas_poly)

#             plate = Plate.from_outline_thickness(
#                 compas_poly,
#                 thickness=0.1,
#                 vector=local_z
#             )

#             plates.append(plate)
#             model.add_element(plate)
#             base_model.add_element(plate)
#             models.append(model)

# ============================================================
# Input Beams
# ============================================================

beams = []
cutting_frames = []
for plane in footing_plane:
    cutting_frames.append(plane)

#convert rhino curves into compas lines
"""to be replaced with graph input"""

from copy import deepcopy

ng = deepcopy(line_graph)

for edge in ng.edges():
    h = ng.edge_attribute(edge,"hierarchy") #primary, secondary, tertiary
    l = ng.edge_attribute(edge,"level") #0,1,2... top to bottom 
    g = ng.edge_attribute(edge, "group") #quadrant 0,1,2,3 clockwise

    """set width and height based on attributes"""

    if h == "primary" and l != 0:
        ln_width = 0.100
        ln_height = 0.160
    elif h == "primary" or h == "secondary":
        ln_width = 0.100
        ln_height = 0.120
    elif h == "tertiary":
        ln_width = 0.100
        ln_height = 0.120

    ln = ng.edge_attribute(edge, "shifted_line")
    
    if ln is None:
        continue
    
    # for b, m in zip (boxes, models):
    #     if b.contains_point(ln.start) or b.contains_point(ln.end):
    #         ln.name = h
    #         beam = Beam.from_centerline(ln,width=ln_width, height=ln_height)
    #         beam.name = ln.name
    #         beams.append(beam)
    #         m.add_element(beam)
    #         base_model.add_element(beam)
    #         break



#temporary add shoe
for shoe in shoes:
    shoe_line = line_to_compas(shoe)
    for b, m in zip (boxes, models):
        if b.contains_point(shoe_line.start) or b.contains_point(shoe_line.end):
            beam = Beam.from_centerline(shoe_line, width=0.1, height=0.1)
            beam.name = "shoe"
            beams.append(beam)
            m.add_element(beam)
            base_model.add_element(beam)

# ============================================================
# Process Jointery
# ============================================================

#planarity check
def is_planar(element_a, element_b):
    frames_a = []
    frames_b = []
    planarity_check = []
    frame_a = element_a.frame
    frame_a.xaxis = Vector(0,0,1)
    frames_a.append(frame_a)

    frame_b = element_b.frame
    frame_b.xaxis = Vector(0, 0, 1)

    planarity = angle_vectors(frame_a.normal, frame_b.normal, deg = True)
    planarity_check.append(planarity)

    is_planar = bool
    if planarity < 0.2 or planarity > 178.2:
        is_planar = True
    else:
        is_planar = False
    return(is_planar)

distances = []

#reset beams and features
for model in models:
    for beam in model.beams:
        beam.remove_features()

    #compute line network
    base_model.connect_adjacent_beams(max_distance)
    model.connect_adjacent_beams(max_distance)

    for c in model.joint_candidates:
        distances.append(c.distance)

    # #handle non-pair joints (in this case a 3-way connection using TripletAnalyzer)
    # analyzer = TripletAnalyzer(model, max(distances)/2)
    # clusters = analyzer.find()

    # for cluster in clusters:
    #     if cluster.topology == JointTopology.TOPO_K:
    #         reordered_elements = [e for e in cluster.elements if h == "primary"]
    #         print (len(reordered_elements))
    #         reordered_elements += [e for e in cluster.elements if e not in reordered_elements]
    #         kbj = KBirdsmouthJoint.promote_cluster(model, cluster[0], reordered_elements=reordered_elements, mill_depth=.040)

    #debugging tools
    candidates_a = []
    candidates_b = []
    frames_a = []
    frames_b = []
    planarity_check = []

    #set joint conditions
    for candidate in model.joint_candidates:
        if candidate.is_promoted == False:
            #check for mid_point = above certain z_height
            a_is_shoe = bool
            b_is_shoe = bool
            ceiling_height = 3.9

            height_a = candidate.element_a.centerline.midpoint.z
            if height_a > ceiling_height:
                a_is_shoe = True
            else:
                a_is_shoe = False
                
            height_b = candidate.element_b.centerline.midpoint.z
            if height_b > ceiling_height:
                b_is_shoe = True
            else:
                b_is_shoe = False

            #joints based on topology, planarity and z height
            if candidate.topology == JointTopology.TOPO_T and is_planar(candidate.element_a, candidate.element_b) == True:
                if b_is_shoe == True:
                    t_step_joint = TMultiStepJoint.create(model, candidate.element_a, candidate.element_b, step_count=2)
                
                else:
                    if angle_vectors(candidate.element_a.centerline.direction, candidate.element_b.centerline.direction, deg=True) < 50:
                        step_shape = "heel"
                    else:
                        step_shape = "step"
                    
                    print (candidate.element_a.centerline.name)
                    t_step_joint = TMultiStepJoint.create(model, candidate.element_a, candidate.element_b, step_shape=step_shape, step_depth=.02, riser_angle=90)
            
            elif candidate.topology == JointTopology.TOPO_T and is_planar(candidate.element_a, candidate.element_b) == False:
                t_bm_joint = TBirdsmouthJoint.create(model, candidate.element_a, candidate.element_b)
                # t_np_step_joint = TMultiStepJoint.create(model, candidate.element_a, candidate.element_b, do_refine_cut=True, step_depth = 0.02, riser_angle=90)
            elif candidate.topology==JointTopology.TOPO_L:
                mp = Frame.worldYZ
                # miter_plane = ??
                l_miter_joint = LMiterJoint.create(model, candidate.element_a, candidate.element_b, cutoff = False)

            elif candidate.topology == JointTopology.TOPO_X:
                x_lap_joint = XLapJoint.create(model, candidate.element_a, candidate.element_b)

            else:
                continue
    
    # #add features to beams
    # for beam in model.beams:
    #     if beam.name == "primary":
    #         for plane in cutting_frames:
    #             intersection = intersection_segment_plane(b.centerline, plane, tol=None)
    #             if intersection is not None:
    #                 jackrafter = JackRafterCut.from_plane_and_beam(plane, b, ref_side_indes =3)
    #         # jackrafter = JackRafterCut.from_plane_and_beam(plane_cut, b, ref_side_indes =5)
    #             b.add_feature(jackrafter)


    # drill_line = line_to_compas(drill_line)
    # for i, beam in enumerate(model.beams):
    #     if i == 0:
    #         drill_feature = Drilling.from_line_and_element(drill_line, beam, diameter=10)
    #         beam.add_features(drill_feature)
    #         scene.add(beam.geometry)

    #process joints in compas timber model
    model.process_joinery()

processed_models = []

for m in models:
    processed_models.append(m)

    #visualise geometries
    for beam in (m.beams):
        scene.add(beam.geometry)
    
    for plate in (m.plates):
        scene.add(plate.geometry)
    print ("ADDED")

a = scene.draw()
# ---------- end timber_model ----------
panel_9 = Panel(timber_model.base_model)  # disabled
panel_10 = Panel(timber_model.processed_models)  # disabled
multiplication_4 = Multiplication(A=panel_7, B=2)  # disabled
beam_3 = CTBeam(centerline=ln, width=number_slider_9, height=multiplication_4)  # -> Beam, Blank; inputs centerline: list, z_vector: list of Vector3d, width: list of Double, height: list of Double, category: list of String, updateRefObj: Boolean; disabled; same code as beam
dispatch = Dispatch(List=beam_3.Beam, DispatchPattern=[True, False])  # -> ListA, ListB; disabled
jointsbycategory = CTCategoryJointsRules(main_beam_category=panel_8, cross_beam_category=panel_8, step_depth=number_slider_7)  # -> TMultiStepJoint; inputs main_beam_category: String, cross_beam_category: String; disabled
#   port main_beam_category: Beam A category.
#   port cross_beam_category: Beam B category.
#   port TMultiStepJoint: A joint rule.
# ---------- jointsbycategory: Python ----------
# env: C:\Users\kapso\OneDrive\Documents\GitHub\timber_design\src
# r: compas_timber>=0.16.2
"""Defines which Joint type will be applied in the Automatic Joints component for connecting Beams with the given Category attributes. This overrides Topological Joint rules and is overriden by Direct joint rules"""

# flake8: noqa
import inspect
from collections import OrderedDict

import Grasshopper
from System.Windows.Forms import ToolStripMenuItem
from System.Windows.Forms import ToolStripSeparator


from timber_design.workflow import CategoryRule
from timber_design.ghpython import get_createable_joints
from timber_design.ghpython import item_input_valid_cpython
from timber_design.ghpython import manage_cpython_dynamic_params
from timber_design.ghpython import rename_cpython_gh_output
from timber_design.ghpython import warning
from timber_design.ghpython import message


class CategoryJointRule(Grasshopper.Kernel.GH_ScriptInstance):
    def __init__(self):
        super(CategoryJointRule, self).__init__()
        self.topo_bools = OrderedDict([("Unknown", False), ("I", False), ("L", False), ("T", False), ("X", False)])

        self.classes = {}
        for cls in get_createable_joints():
            self.classes[cls.__name__] = cls

        if ghenv.Component.Params.Output[0].NickName == "Rule":
            self.joint_type = None
        else:
            parsed_output = ghenv.Component.Params.Output[0].NickName.split("_")
            self.joint_type = self.classes.get(parsed_output[0])
            for key in parsed_output[1:]:
                self.topo_bools[key] = True

    @property
    def component(self):
        return ghenv.Component  # type: ignore

    def RunScript(self, *args):
        if not self.joint_type:
            warning(self.component, "Select joint type from context menu (right click)")
            return None
        else:
            message(self.component, self.joint_type.__name__)
            cat_a, cat_b = args[:2]
            kwargs = {}
            for i, val in enumerate(args[2:]):
                if val is not None:
                    kwargs[self.arg_names()[i + 2]] = val
            if not item_input_valid_cpython(ghenv, cat_a, self.arg_names()[0]) or not item_input_valid_cpython(ghenv, cat_b, self.arg_names()[1]):
                return

            topos = []
            for i, bool in enumerate(self.topo_bools.values()):
                if bool:
                    topos.append(i)

            return CategoryRule(self.joint_type, cat_a, cat_b, topos, **kwargs)

    def arg_names(self):
        names = inspect.getargspec(self.joint_type.__init__)[0][1:]
        for i in range(2):
            names[i] += "_category"
        return [name for name in names if (name != "key") and (name != "frame")] + ["max_distance"]

    def AppendAdditionalMenuItems(self, menu):
        for name in self.classes.keys():
            item = menu.Items.Add(name, None, self.on_item_click)
            if self.joint_type and name == self.joint_type.__name__:
                item.Checked = True

        menu.Items.Add(ToolStripSeparator())
        topo_menu = ToolStripMenuItem("Apply to Topology")
        menu.Items.Add(topo_menu)
        for name, bool in self.topo_bools.items():
            item = ToolStripMenuItem(name, None, self.on_topo_click)
            item.Checked = bool
            topo_menu.DropDownItems.Add(item)

    def output_name(self):
        name = self.joint_type.__name__
        for key, bool in self.topo_bools.items():
            if bool:
                name += "_{}".format(key)
        return name

    def on_topo_click(self, sender, event_info):
        self.topo_bools[str(sender)] = not self.topo_bools[str(sender)]
        rename_cpython_gh_output(self.output_name(), 0, ghenv)
        ghenv.Component.ExpireSolution(True)

    def on_item_click(self, sender, event_info):
        self.joint_type = self.classes[str(sender)]
        rename_cpython_gh_output(self.output_name(), 0, ghenv)
        manage_cpython_dynamic_params(self.arg_names(), ghenv, rename_count=2, permanent_param_count=0)
        ghenv.Component.ExpireSolution(True)
# ---------- end jointsbycategory ----------
beam_4 = CTBeam(centerline=ln_3, width=number_slider_9, height=multiplication_4, category=panel_8)  # -> Beam, Blank; inputs centerline: list, z_vector: list of Vector3d, width: list of Double, height: list of Double, category: list of String, updateRefObj: Boolean; disabled; same code as beam
item_3 = ListItem(List=beam_4.Beam, Index=0, Wrap=True)  # -> Item, Item1; disabled
merge_2 = Merge(Data1=flatten(item_3.Item1), Data2=flatten(beam_3.Beam))  # disabled
directjoints = CTDirectJointRules(
    cross_beam=item_3.Item1,
    main_beam_a=dispatch.ListA,
    main_beam_b=dispatch.ListB,
    mill_depth=number_slider_6,
    max_distance=roundd.Rounded)  # -> KBirdsmouthJoint; disabled
#   port KBirdsmouthJoint: Direct Joint Rule.
# ---------- directjoints: Python ----------
# env: C:\Users\kapso\OneDrive\Documents\GitHub\timber_design\src
# r: compas_timber>=0.16.2
"""Generates a direct joint between two elements. This overrides other joint rules."""

import inspect

import Grasshopper  # type: ignore

from compas_timber.connections import PlateJoint
from timber_design.workflow import DirectRule
from timber_design.ghpython import get_createable_joints
from timber_design.ghpython import item_input_valid_cpython
from timber_design.ghpython import manage_cpython_dynamic_params
from timber_design.ghpython import rename_cpython_gh_output
from timber_design.ghpython import warning


class DirectJointRule(Grasshopper.Kernel.GH_ScriptInstance):
    def __init__(self):
        super(DirectJointRule, self).__init__()
        self.classes = {}
        for cls in get_createable_joints():
            if cls.MAX_ELEMENT_COUNT == 2 and not issubclass(cls, PlateJoint):
                self.classes[cls.__name__] = cls

        self.joint_type = self.classes.get(self.component.Params.Output[0].NickName, None)

    @property
    def component(self):
        return ghenv.Component  # type: ignore  # noqa: F821

    def RunScript(self, *args):
        if not self.joint_type:
            self.component.Message = "Select joint type from context menu (right click)"
            warning(self.component, "Select joint type from context menu (right click)")
            return None

        self.component.Message = self.joint_type.__name__
        beam_a = args[0]
        beam_b = args[1]
        if not item_input_valid_cpython(ghenv, beam_a, self.arg_names()[0]) or not item_input_valid_cpython(ghenv, beam_b, self.arg_names()[1]):
            return

        kwargs = {}
        for i, val in enumerate(args[2:]):
            if val is not None:
                kwargs[self.arg_names()[i + 2]] = val

        Rules = DirectRule(self.joint_type, [beam_a, beam_b], **kwargs)
        return Rules

    def arg_names(self):
        return inspect.getargspec(self.joint_type.__init__)[0][1:] + ["max_distance"]

    def AppendAdditionalMenuItems(self, menu):
        for name in self.classes.keys():
            item = menu.Items.Add(name, None, self.on_item_click)
            if self.joint_type and name == self.joint_type.__name__:
                item.Checked = True

    def on_item_click(self, sender, event_info):
        self.joint_type = self.classes[str(sender)]
        rename_cpython_gh_output(self.joint_type.__name__, 0, ghenv)
        manage_cpython_dynamic_params(self.arg_names(), ghenv, rename_count=2, permanent_param_count=0)
        self.component.ExpireSolution(True)
# ---------- end directjoints ----------
md_slider = MDSlider(SliderMode=0, slider_value=Point(0.5, 0.5, 0.5), x_domain=Domain(0, 1), y_domain=Domain(0, 1), z_domain=Domain(0, 1))  # disabled
compas_draw = COMPASDraw(cg=timber_model.b)  # -> rg; disabled
#   port cg: The COMPAS geometry or datastructure to be drawn.
#   port rg: The Rhino geometry object.
# ---------- compas_draw: Python ----------
# r: compas>=2.14.1
"""
Draws COMPAS geometry in Grasshopper.
"""

from typing import Any

import Grasshopper

from compas.scene import SceneObject


class CompasToRhinoGeometry(Grasshopper.Kernel.GH_ScriptInstance):
    def RunScript(self, cg):
        if not cg:
            return None

        return SceneObject(item=cg).draw()
# ---------- end compas_draw ----------
compas_draw_2 = COMPASDraw(cg=timber_model.d)  # -> rg; disabled; same code as compas_draw
file_path = FilePath("C:\Users\kapso\OneDrive\Documents\GitHub\llhil-t2-fabrication\design\timber_design\data\0508_timber_model")
compas_draw_3 = COMPASDraw(cg=timber_model.c)  # -> rg; disabled; same code as compas_draw
compas_draw_4 = COMPASDraw(cg=timber_model.e)  # -> rg; disabled; same code as compas_draw
crv_5 = Curve([<curve referenced from the Rhino model> x2])  # disabled
file_path_2 = FilePath("C:\Users\frido\OneDrive\Dokumente\ETH_MAS_Architecture_Digital_Fabrication\Visual_Studio_Code\GitHub_personal\MAS_26_copy\10_T2_Timber\10_05_BTLx\")  # disabled
surface = Surface(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)  # disabled
curve = Curve([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])  # disabled
curve_2 = Curve([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])  # disabled
curve_3 = Curve([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])  # disabled
curve_4 = Curve([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])  # disabled
surface_2 = Surface(reparameterize(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))  # disabled
toggle_2 = BooleanToggle(False)  # disabled
dispatch_2 = Dispatch(List=crv_5, DispatchPattern=[True, False])  # -> ListA, ListB; disabled
evaluate_surface = EvaluateSurface(Surface=surface_2, Point=md_slider)  # -> Point, Normal, UDirection, VDirection, Frame; disabled
number_slider_10 = Slider(0, range=0..100)  # disabled
crvprox_2 = CurveProximity(CurveA=dispatch_2.ListB, CurveB=dispatch_2.ListA)  # -> PointA, PointB, Distance; disabled
geometry = Geometry(timber_model.a)  # disabled
file_path_3 = FilePath("/Users/minghip/Desktop/timber_model_0.json")
model = CTModel(
    Elements=flatten([beam_4.Beam, beam_3.Beam]),
    JointRules=flatten(jointsbycategory),
    MaxDistance=roundd.Rounded,
    CreateGeometry=toggle_2)  # -> Model, Geometry, DebugInfo; inputs Elements: list, Containers: list, JointRules: list, Features: list, MaxDistance: Double, CreateGeometry: Boolean; disabled
#   port Elements: Collection of Beams
#   port Containers: Container elements, such as walls, floors, roofs, etc.
#   port JointRules: Collection of joint rules.
#   port Features: Collection of feature definitions.
#   port MaxDistance: Max Distance Tolerance for topology detection.
#   port CreateGeometry: If True, Beam and joint geometry is created for visualization.
#   port Model: Model object.
#   port Geometry: Geometry of the beams and joints.
#   port DebugInfo: Debug information object in the case of feature or joining errors.
# ---------- model: Python ----------
# env: C:\Users\kapso\OneDrive\Documents\GitHub\timber_design\src
# r: compas_timber>=0.16.2
"""Creates an Model"""

import Grasshopper
import Rhino
import System
from compas.scene import Scene
from compas.tolerance import TOL
from compas.tolerance import Tolerance

from timber_design.workflow import DebugInfomation
from timber_design.workflow import JointRuleSolver
# from timber_design.workflow import WallPopulator - breaks the GH Component
from compas_timber.elements import Beam
from compas_timber.elements import Plate
from compas_timber.errors import FeatureApplicationError
from timber_design.ghpython import error
from timber_design.ghpython import warning
from compas_timber.model import TimberModel

# workaround for https://github.com/gramaziokohler/compas_timber/issues/280
TOL.absolute = 1e-6


class ModelComponent(Grasshopper.Kernel.GH_ScriptInstance):
    @property
    def component(self):
        return ghenv.Component  # type: ignore

    def RunScript(self,
            Elements: System.Collections.Generic.List[object],
            Containers: System.Collections.Generic.List[object],
            JointRules: System.Collections.Generic.List[object],
            Features: System.Collections.Generic.List[object],
            MaxDistance: float,
            CreateGeometry: bool):
        # this used to be default behavior in Rhino7.. I think..
        Elements = Elements or []
        Containers = Containers or []
        JointRules = JointRules or []
        Features = Features or []

        if not Elements:
            warning(self.component, "Input parameter Beams failed to collect data")
        if not JointRules:
            warning(self.component, "Input parameter JointRules failed to collect data")
        if not (Elements or Containers):  # shows beams even if no joints are found
            return
        if MaxDistance is None:
            MaxDistance = TOL.ABSOLUTE  # compared to calculted distance, so shouldn't be just 0.0

        tol = self.get_tol()
        Model = TimberModel(tolerance=tol)
        debug_info = DebugInfomation()

        ##### Adding elements #####
        self.add_elements_to_model(Model, Elements, Containers)

        ##### Handle joinery #####
        # checks elements compatibility and generates Joints
        JointRules = [j for j in JointRules if j is not None]

        if JointRules:
            solver = JointRuleSolver(JointRules, max_distance=MaxDistance)
            joint_errors, _ = solver.apply_rules_to_model(Model)  # TODO: figure out best way to pass out unjoined_clusters

            for je in joint_errors:
                debug_info.add_joint_error(je)

        # applies extensions and features resulting from joints
        # bje = Model.process_joinery()
        # if bje:
        #     debug_info.add_joint_error(bje)

        ##### Handle user features #####
        if Features:
            feature_errors = self.handle_features(Features)
            debug_info.add_feature_error(feature_errors)

        ##### Visualization #####
        Geometry, errors = self.handle_geometry(Model, CreateGeometry)
        for geo_error in errors:
            debug_info.add_feature_error(geo_error)

        ##### Error Handling #####
        if debug_info.has_errors:
            warning(self.component, "Error found during joint creation. See DebugInfo output for details.")

        return Model, Geometry, debug_info

    def get_tol(self):
        units = Rhino.RhinoDoc.ActiveDoc.GetUnitSystemName(True, True, True, True)
        if units == "m":
            return Tolerance(unit="M", absolute=1e-6, relative=1e-6)
        elif units == "mm":
            return Tolerance(unit="MM", absolute=1e-3, relative=1e-3)
        else:
            error(self.component, f"Unsupported unit: {units}")
            return

    def add_elements_to_model(self, model, elements, containers):
        """Adds elements to the model and groups them by slab."""
        elements = [e for e in elements if e is not None]
        for element in elements:
            element.reset()
            model.add_element(element)

        containers = [c for c in containers if c is not None]

        for index, c_def in enumerate(containers):
            slab = c_def.slab
            model.add_group_element(slab, name=slab.name + str(index))

    def handle_populators(self, model, containers, max_distance):
        # Handle wall populators
        model.connect_adjacent_walls()
        config_sets = [c_def.config_set for c_def in containers]
        populators = []
        if any(config_sets):
            populators = WallPopulator.from_model(model, config_sets)

        handled_pairs = []
        wall_joints = []
        for populator, slab in zip(populators, list(model.slabs)):
            elements = populator.create_elements()
            model.add_elements(elements, parent=slab.name)
            joint_definitions = populator.create_joints(elements, max_distance)
            wall_joints.extend(joint_definitions)
            for j_def in joint_definitions:
                element_a, element_b = j_def.elements
                handled_pairs.append({element_a, element_b})

        return handled_pairs, wall_joints

    def handle_features(self, features):
        feature_errors = []
        features = [f for f in features if f is not None]
        for f_def in features:
            if not f_def.elements:
                warning(self.component, "Features defined in model must have elements defined. Features without elements will be ignored")
                continue

            for element in f_def.elements:
                try:
                    element.add_features(f_def.feature_from_element(element))
                except FeatureApplicationError as ex:
                    feature_errors.append(ex)
        return feature_errors

    def handle_geometry(self, Model, CreateGeometry):
        scene = Scene()
        errors = []
        for element in Model.elements():
            if CreateGeometry:
                scene.add(element.geometry)
                if getattr(element, "debug_info", False):
                    errors.append(element.debug_info)
            else:
                if isinstance(element, Beam):
                    scene.add(element.blank)
                elif isinstance(element, Plate):
                    scene.add(element.shape)
                else:
                    scene.add(element.geometry)
        return scene.draw(), errors
# ---------- end model ----------
python_3_script_2 = Python3Script(
    brep=surface,
    shoe=curve,
    leaf=curve_2,
    recipro=curve_3,
    low_sup=curve_4,
    path=file_path_2,
    b_plane=evaluate_surface.Frame)  # -> out, a, model, z_vectors, c, b, frames; inputs brep: list of Surface, shoe: list of Curve, leaf: list of Curve, recipro: list of Curve, low_sup: list of Curve, b_plane: Plane; disabled
# ---------- python_3_script_2: Python ----------
from compas.scene import Scene
from compas.tolerance import Tolerance, TOL

from compas_timber.model import TimberModel
from compas_timber.elements import Beam

from compas_timber.connections import JointTopology, TMultiStepJoint, TStepJoint,LMiterJoint, TBirdsmouthJoint, XLapJoint

from compas_timber.fabrication import StepShapeType, JackRafterCut

from compas_rhino.conversions import curve_to_compas_line, surface_to_compas, plane_to_compas_frame, plane_to_compas

from compas.geometry import Frame, Plane, Vector, Point, angle_vectors, Line, intersection_segment_plane

from compas_timber.fabrication import BTLxWriter

""" check if planar function """
def is_planar(element_a, element_b):
    frames_a = []
    frames_b = []
    planarity_check = []
    frame_a = element_a.frame
    frame_a.xaxis = Vector(0,0,1)
    frames_a.append(frame_a)

    frame_b = element_b.frame
    frame_b.xaxis = Vector(0, 0, 1)

    planarity = angle_vectors(frame_a.normal, frame_b.normal, deg = True)
    planarity_check.append(planarity)

    is_planar = bool
    if planarity < 0.2 or planarity > 178.2:
        is_planar = True
    else:
        is_planar = False
    return(is_planar)

""" orient Lines, so start is on bottom"""
def orient_lines(centerline):
    if centerline.start.z > centerline.end.z:
        return Line(centerline.end, centerline.start)
    return centerline

""" get brep normalZz_vector """
z_vectors = []
for srf in brep:
    compas_srf = surface_to_compas(srf)          # returns a NurbsSurface or similar
    frame = compas_srf.frame_at(0.5, 0.5) 
    z_vector = frame.normal       # get frame at surface midpoint
    z_vectors.append(z_vector)

#initialise Scene object
scene = Scene()


#initialise compas timber model
model = TimberModel(Tolerance(unit="MM"), absolute = "100")

# beam list
beams = []

#shoes
shoes = [curve_to_compas_line(c) for c in shoe]

for l in shoes:
    beam = Beam.from_centerline(l, width = 120, height = 200, z_vector = z_vectors[0])
    beam.attributes["category"] = "shoe"
    beams.append(beam)
    model.add_element(beam)

leaves = [curve_to_compas_line(c) for c in leaf]
for l in leaves:
    beam = Beam.from_centerline(l, width = 120, height = 240)
    beam.attributes["category"] = "leaf"
    beams.append(beam)
    model.add_element(beam)

reciprocal = [curve_to_compas_line(c) for c in recipro]
for r in reciprocal:
    beam = Beam.from_centerline(r, width = 120, height = 200)
    beam.attributes["category"] = "reciprocal"
    beams.append(beam)
    model.add_element(beam)

birdmiter = [curve_to_compas_line(c) for c in low_sup]
for b in birdmiter:
    beam = Beam.from_centerline(b, width =80, height = 200)
    beam.attributes["category"] = "miterbirdsmouth"
    beams.append(beam)
    model.add_element(beam)

# print categories
for beam in model.beams:
    print(beam.attributes["category"])



model.connect_adjacent_beams(max_distance=100)
for candidate in model.joint_candidates:
    # dictionary = beam.attributes.get["category"]
    beam_a, beam_b = candidate.elements

        # sorting by Z for shoe-step-topology
    a_is_shoe = bool
    b_is_shoe = bool
    ceiling_height = 2640

    a_oriented = orient_lines(candidate.element_a.centerline) # set shoe-direction
    height_a = candidate.location.z
    # height_a = candidate.element_a.centerline.midpoint.z
    print("a", height_a)
    if height_a > ceiling_height:
        a_is_shoe = True
    else:
        a_is_shoe = False

    b_oriented = orient_lines(candidate.element_b.centerline)
    height_b = b_oriented.end.z
    print("b", height_b)
    if height_b > ceiling_height:
        b_is_shoe = True
    else:
        b_is_shoe = False

    if beam_a.attributes["category"] == "leaf" and beam_b.attributes["category"] == "shoe":
        heel_step = TStepJoint.create(model, beam_a, beam_b, step_shape="double", step_depth=40, heel_depth=60)
        # heel_step = TMultiStepJoint.create(model, beam_a, beam_b, step_shape = StepShapeType.HEEL, step_count = 2)
        # print("hello")
    elif candidate.topology == JointTopology.TOPO_X:
        lap_joint = XLapJoint.create(model, beam_a, beam_b)
    
    elif beam_a.attributes["category"] == "miterbirdsmouth" and beam_b.attributes["category"] == "reciprocal":
        birdsmouth = TBirdsmouthJoint.create(model, beam_a, beam_b)
    
    elif candidate.topology == JointTopology.TOPO_L:
        miter = LMiterJoint.create(model, candidate.element_a, candidate.element_b) #candidate.element_a as well as beam_a works!
    
    elif candidate.topology == JointTopology.TOPO_T and is_planar(candidate.element_a, candidate.element_b) == True:
        if a_is_shoe == True:
            heel = TMultiStepJoint.create(model, beam_a, beam_b, step_count = 2, step_shape = StepShapeType.HEEL)
        # elif b_is_shoe == True:
            # heelstep = heel = TMultiStepJoint.create(model, beam_a, beam_b, step_count = 2, step_shape = StepShapeType.HEEL)
        # if a_is_shoe == False:
        #     teeth = TMultiStepJoint.create(model, beam_a, beam_b, step_count = 5) #step_depth = 15
        #     print("hello")
        # elif b_is_shoe == False:
        #     teethstep = TMultiStepJoint.create(model, beam_a, beam_b, step_count = 5)
        else:
            multistep = TMultiStepJoint.create(model, beam_a, beam_b, step_count = 5)
    


#from_plane_and_beam(cls, plane, beam, ref_side_index=3, **kwargs):
frames = []
for b in beams:
    plane_cut = plane_to_compas(b_plane)
    frames.append(plane_cut)
    intersection = intersection_segment_plane(b.centerline, plane_cut, tol=None)
    if intersection is not None:
        jackrafter = JackRafterCut.from_plane_and_beam(plane_cut, b, ref_side_indes =3)
    # print(frame)
    # jackrafter = JackRafterCut.from_plane_and_beam(plane_cut, b, ref_side_indes =5)
        b.add_feature(jackrafter)


# drill_line = line_to_compas(drill_line)
# for i, beam in enumerate(model.beams):
#     if i == 0:
#         drill_feature = Drilling.from_line_and_element(drill_line, beam, diameter=10)
#         beam.add_features(drill_feature)
#         scene.add(beam.geometry)


model.process_joinery()

#visualise geometries
for beam in model.beams:
    scene.add(beam.geometry)

writer = BTLxWriter()
btlx = writer.write(model, file_path=path)

a = scene.draw()
# ---------- end python_3_script_2 ----------
python_3_script_3 = Python3Script(y=file_path_3)  # -> out, a; inputs y: String
# ---------- python_3_script_3: Python ----------
from compas.data import json_load
from compas_timber.model import TimberModel

timber_model = json_load(y)
timber_model.process_joinery()
a = timber_model
# ---------- end python_3_script_3 ----------
panel_11 = Panel("0")  # disabled
joiningerrors = CTShowJoiningErrors(debug_info=model.DebugInfo, i=number_slider_10)  # -> Info, Geometry; disabled
#   port debug_info: DebugInformation object containing joining errors.
#   port i: Index of the joining error to show. This index wraps around the number of errors.
#   port Info: Information about the joining error.
#   port Geometry: Geometry of the beam blanks related to the selected joining error.
# ---------- joiningerrors: Python ----------
"""Shows information useful for debugging errors that occurred while attempting to join beams."""
# env: C:\Users\kapso\OneDrive\Documents\GitHub\timber_design\src
# r: compas_timber>=0.16.2
# flake8: noqa
import Grasshopper

from compas.scene import SceneObject
from timber_design.ghpython.ghcomponent_helpers import item_input_valid_cpython


class ShowJoiningErrors(Grasshopper.Kernel.GH_ScriptInstance):
    def RunScript(self, debug_info, i):
        if not item_input_valid_cpython(ghenv, i, "i"):
            i = 0
        if not item_input_valid_cpython(ghenv, debug_info, "DebugInfo"):
            return
        if not debug_info.joint_errors:
            ghenv.Component.AddRuntimeMessage(Grasshopper.Kernel.GH_RuntimeMessageLevel.Warning, "No joining errors found in input parameter 'DebugInfo'")
            return
        joining_errors = debug_info.joint_errors
        i = int(i) % len(joining_errors)
        error = joining_errors[i]

        geometries = [beam.blank for beam in error.beams]
        geometries.extend(error.debug_geometries)
        geo_objs = [SceneObject(item=geo) for geo in geometries]
        output = []
        for obj in geo_objs:
            output.extend(obj.draw())

        return error.debug_info, output
# ---------- end joiningerrors ----------
list_item = ListItem(List=timber_model.processed_models, Index=panel_11, Wrap=True)  # disabled
panel_12 = Panel(python_3_script_3.a)
panel_13 = Panel(list_item)  # disabled
number_slider_11 = Slider(0, range=0..3)  # disabled
draw = COMPASDraw(cg=python_3_script_2.frames)  # -> rg; disabled; same code as compas_draw
draw_2 = COMPASDraw(cg=python_3_script_2.z_vectors)  # -> rg; disabled; same code as compas_draw
button_3 = Button()  # disabled
py3_3 = Python3Script(model=model.Model, max_distance=roundd.Rounded)  # -> out, a; disabled
# ---------- py3_3: Python ----------
from compas_timber.analyzers import TripletAnalyzer
from compas_timber.connections import JointTopology
from compas_timber.connections import KBirdsmouthJoint
from compas.scene import Scene

scene = Scene()
for beam in model.beams:
    beam.features = []
#handle non-pair joints (in this case a 3-way connection using TripletAnalyzer)
analyzer = TripletAnalyzer(model, max_distance)
clusters = analyzer.find()

for cluster in clusters:
    if cluster.topology == JointTopology.TOPO_K:
        # check the type of the cluster
        reordered_elements = []
        # if not skip:
        reordered_elements = [e for e in cluster.elements if e.attributes["category"] == "primary"]
        reordered_elements += [e for e in cluster.elements if e not in reordered_elements]
        kbj = KBirdsmouthJoint.promote_cluster(model, cluster, reordered_elements=reordered_elements, mill_depth=0.02)
model.process_joinery()

for beam in model.beams:
    scene.add(beam.geometry)

a = scene.draw()
# ---------- end py3_3 ----------
file_path_4 = FilePath("/Users/minghip/Desktop/")  # disabled

# ---- group: json_dump of n modules
python_3_script_4 = Python3Script(x=list_item, save=button_3, file_path=file_path_4)  # -> out, a; inputs x: list; disabled
# ---------- python_3_script_4: Python ----------
import os
from compas.data import json_dump

if save:
    for i, m in enumerate(x):
        """Serialize models to .JSON"""
        output_path = os.path.join(file_path, f"timber_model_{i}.json")
        m.to_json(output_path, pretty=True)
        print(f"Model written to {output_path}")
# ---------- end python_3_script_4 ----------

# ---- group: visualize modules based on index
python_3_script_5 = Python3Script(x=list_item, y=number_slider_11)  # -> out, a; inputs x: list, y: Int32; disabled
# ---------- python_3_script_5: Python ----------
from compas.scene import Scene
from compas_rhino.conversions import line_to_compas
from compas.tolerance import Tolerance, TOL

from compas_timber.model import TimberModel
from compas_timber.elements import Beam, Plate

from compas_timber.connections import JointTopology
from compas_timber.connections import TMultiStepJoint
from compas_timber.connections import TStepJoint
from compas_timber.connections import LMiterJoint
from compas_timber.connections import TBirdsmouthJoint
from compas_timber.connections import XLapJoint

from compas_rhino.conversions import line_to_compas, polyline_to_compas

from compas.geometry import Frame, Vector, Point, angle_vectors, centroid_points

from statistics import mean


scene = Scene()
# for m in x:
# model = x[y]
for beam in (x[y].beams):
    if not beam.attributes["neighbour"]:
        scene.add(beam.geometry)

for plate in (x[y].plates):
    scene.add(plate.geometry)
a = scene.draw()
# ---------- end python_3_script_5 ----------

# ---- group: visualize neighbour beams based on module index
python_3_script_6 = Python3Script(x=list_item, y=number_slider_11)  # -> out, a; inputs x: list, y: Int32; disabled
# ---------- python_3_script_6: Python ----------
from compas.scene import Scene
from compas_rhino.conversions import line_to_compas
from compas.tolerance import Tolerance, TOL

from compas_timber.model import TimberModel
from compas_timber.elements import Beam, Plate

from compas_timber.connections import JointTopology
from compas_timber.connections import TMultiStepJoint
from compas_timber.connections import TStepJoint
from compas_timber.connections import LMiterJoint
from compas_timber.connections import TBirdsmouthJoint
from compas_timber.connections import XLapJoint

from compas_rhino.conversions import line_to_compas, polyline_to_compas

from compas.geometry import Frame, Vector, Point, angle_vectors, centroid_points

from statistics import mean


scene = Scene()
# for m in x:
# model = x[y]
for beam in (x[y].beams):
    if beam.attributes["neighbour"]:
        scene.add(beam.geometry)
a = scene.draw()
# ---------- end python_3_script_6 ----------

# ----
# lines for compas_timber from graph
python_3_script_7 = Python3Script(graph=python_3_script.line_model)  # -> out, main_primary, primary, secondary, tertiary, shoes, all, models
# ---------- python_3_script_7: Python ----------
from compas.geometry import Line, Point
from copy import deepcopy

from compas_timber.model import TimberModel
from compas_timber.elements import Beam
from compas_timber.elements import Plate
from compas.tolerance import Tolerance
from compas.scene import Scene

ng = deepcopy(graph)

#quick checking
primary_shifted = []
main_primary_shifted = []
secondary_shifted = []
tertiary_shifted = []

models = []
scene = Scene()
groups = [ng.edge_attribute(e,"group") for e in ng.edges()]
print(type(ng))
# support_nodes = ng.get_support_nodes()
# for s in support_nodes:
#     cut_plane = ng.node_attribute(s, "cut_plane")
#     print (cut_plane)
#     print (ng.node_attribute(s, "group"))
shoes = []
for e in ng.edges():
    ln = ng.edge_attribute(e, "shifted_line")
    h = ng.edge_attribute(e, "hierarchy")
    if h == "shoe":
        # print("there is a shoe")
        shoes.append(ln)
        """assign groups by division?"""
        pass

for i in range(4):
    model = TimberModel(Tolerance(unit="M", absolute=0.001))
    beams = []

    for e in ng.edges():

        h = ng.edge_attribute(e, "hierarchy")      # classification
        l = ng.edge_attribute(e, "level")          # level
        g = ng.edge_attribute(e, "group")
        w = ng.edge_attribute(e, "")

        if i == g:
            ln = ng.edge_attribute(e, "shifted_line")  # shifted geometry
            if ln is None:
                continue
            scene.add(ln)
            #assign beam cross-sections
            ln.name = h
            ln_width = 0.100
            ln_height = float

            # if h == "plate":
            #     plate = Plate.from_outline_thickness()

            if h == "primary":
                primary_shifted.append(ln)
            elif h == "main_primary":
                main_primary_shifted.append(ln)
            elif h == "secondary":
                secondary_shifted.append(ln)
            elif h == "tertiary":
                tertiary_shifted.append(ln)
            elif h == "shoe":
                shoes.append(ln)

            beam = Beam.from_centerline(
            centerline = ln, 
            width = 0.10, 
            height = ng.edge_attribute(e, "height")
            )

            #assign attributes to beams
            beam.attributes["category"] = ln.name
            beam.attributes["edge"] = e
            beam.attributes["group"] = g
            beam.attributes["level"] = l

            print (beam.attributes)
            beams.append(beam)
        
    for b in beams:
        model.add_element(b)
    
    models.append(model)

main_primary = main_primary_shifted
primary = primary_shifted
secondary = secondary_shifted
tertiary =  tertiary_shifted

all_ = scene.draw()
# ---------- end python_3_script_7 ----------
draw_3 = COMPASDraw(cg=python_3_script_7.main_primary)  # -> rg; same code as compas_draw
draw_4 = COMPASDraw(cg=python_3_script_7.primary)  # -> rg; same code as compas_draw
draw_5 = COMPASDraw(cg=python_3_script_7.secondary)  # -> rg; same code as compas_draw
merge_3 = Merge(
    Data1=ColourSwatch(SwatchColor=RGB(255, 0, 0)),
    Data2=ColourSwatch(SwatchColor=RGB(149, 0, 255)),
    Data3=ColourSwatch(SwatchColor=RGB(0, 183, 255)),
    Data4=ColourSwatch(SwatchColor=RGB(41, 189, 0)),
    Data5=ColourSwatch(SwatchColor=RGB(255, 119, 0)))
merge_4 = Merge(Data1="main_primary", Data2="primary", Data3="secondary", Data4="tertiary", Data5="shoes")

panel_14 = Panel(python_3_script_7.models)
draw_6 = COMPASDraw(cg=python_3_script_7.tertiary)  # -> rg; same code as compas_draw
draw_7 = COMPASDraw(cg=python_3_script_7.shoes)  # -> rg; same code as compas_draw

entwine = Entwine(Branch00=draw_3, Branch01=draw_4, Branch02=draw_5, Branch03=draw_6, Branch04=draw_7, FlattenInputs=True)
midpt = CurveMiddle(Curve=entwine)
tag = TextTag(Location=midpt, Text=graft(merge_4), Colour=graft(merge_3))

previewlw = CustomPreviewLineweights(Geometry=entwine, Shader=graft(merge_3), Thickness="2", Absolute=False)
item_4 = ListItem(List=python_3_script_7.models, Index=0, Wrap=True)
timber_model_2 = Python3Script(models=item_4)  # -> out, timber_models; inputs models: list
# ---------- timber_model_2: Python ----------
import os, sys, importlib

gh_dir = os.path.dirname(ghenv.Component.OnPingDocument().FilePath)
if gh_dir not in sys.path:
    sys.path.insert(0, gh_dir)

import timber_helpers
importlib.reload(timber_helpers)

from collections import Counter

from timber_helpers import is_planar, orient_polyline_to_world_z

from compas.scene import Scene
from compas_rhino.conversions import line_to_compas, polyline_to_compas, plane_to_compas
from compas.tolerance import Tolerance, TOL

from compas_timber.model import TimberModel
from compas_timber.elements import Beam, Plate
from compas_timber.analyzers import TripletAnalyzer

from compas_timber.connections import JointTopology
from compas_timber.connections import TMultiStepJoint
from compas_timber.connections import TStepJoint
from compas_timber.connections import LMiterJoint
from compas_timber.connections import TBirdsmouthJoint
from compas_timber.connections import XLapJoint
from compas_timber.connections import KBirdsmouthJoint
from compas_timber.fabrication import JackRafterCut

from compas.geometry import Frame, Vector, Point, angle_vectors, centroid_points, Line, intersection_segment_plane

#initialise scene object
scene = Scene()

# ============================================================
# Process Jointery
# ============================================================

distances = []
max_distance = 0.055
timber_models = []
#reset beams and features
for model in models:
    #copy the model
    model = model.copy()
    for beam in model.beams:
        beam.reset_computed_properties()

    #create pair-wise joint candidates
    model.connect_adjacent_beams(max_distance)

    #find the max distance of the offseted centerlines
    max_offset = max(candidate.distance for candidate in model.joint_candidates)

    #handle non-pair joints (in this case a 3-way connection using TripletAnalyzer)
    analyzer = TripletAnalyzer(model, max_offset/2)
    clusters = analyzer.find()

    for cluster in clusters:
        if cluster.topology == JointTopology.TOPO_K:
            #keep track of the amount of elements per type
            counts = Counter(e.attributes["category"] for e in cluster.elements)
            if counts["secondary"] == 2 and counts["tertiary"] == 1: #skip this joint
                continue

            #define the order of the elements to be passed to the joint
            order = {"main_primary": 0, "primary": 1, "secondary": 2}
            if counts["main_primary"] == 2 and counts["primary"] == 1:
                order = {"primary": 0, "main_primary": 1, "secondary": 2} #override the order just for this condition
            reordered_elements =  sorted(cluster.elements, key=lambda e: order.get(e.attributes["category"], 99))
            
            if len(reordered_elements) != 3:
                raise ValueError(f"Something went wrong with the analyzer. There should be always 3 elements, got: {len(reordered_elements)}")
            
            #promote cluster
            kbj = KBirdsmouthJoint.promote_cluster(model, cluster, reordered_elements=reordered_elements, mill_depth=0.01)

    #set joint conditions
    for candidate in model.joint_candidates:
        if candidate.is_promoted == False:
            #check for mid_point = above certain z_height
            b_is_shoe = bool

            ceiling_height = 3.9
            height_b = candidate.element_b.centerline.midpoint.z

            if height_b > ceiling_height:
                b_is_shoe = True
            else:
                b_is_shoe = False

            #joints based on topology
            if candidate.topology == JointTopology.TOPO_T:
                if is_planar(candidate.element_a, candidate.element_b):
                    if angle_vectors(candidate.element_a.centerline.direction, candidate.element_b.centerline.direction, deg=True) < 50:
                        step_shape = "heel"
                    else:
                        step_shape = "step"
                    t_step_joint = TMultiStepJoint.create(model, candidate.element_a, candidate.element_b, step_shape=step_shape, step_depth=0.02, riser_angle=90)
                # else:
                #     t_bm_joint = TBirdsmouthJoint.create(model, candidate.element_a, candidate.element_b)
                # t_np_step_joint = TMultiStepJoint.create(model, candidate.element_a, candidate.element_b, do_refine_cut=True, step_depth = 0.015, riser_angle=90)
            # elif candidate.topology==JointTopology.TOPO_L:
            #     mp = Frame.worldYZ
            #     l_miter_joint = LMiterJoint.create(model, candidate.element_a, candidate.element_b, cutoff = False)

            elif candidate.topology == JointTopology.TOPO_X:
                x_lap_joint = XLapJoint.create(model, candidate.element_a, candidate.element_b)

            else:
                continue
    timber_models.append(model)
    # #add features to beams
    # for beam in model.beams:
    #     if beam.name == "primary":
    #         for plane in cutting_frames:
    #             intersection = intersection_segment_plane(b.centerline, plane, tol=None)
    #             if intersection is not None:
    #                 jackrafter = JackRafterCut.from_plane_and_beam(plane, b, ref_side_indes =3)
    #         # jackrafter = JackRafterCut.from_plane_and_beam(plane_cut, b, ref_side_indes =5)
    #             b.add_feature(jackrafter)


    # drill_line = line_to_compas(drill_line)
    # for i, beam in enumerate(model.beams):
    #     if i == 0:
    #         drill_feature = Drilling.from_line_and_element(drill_line, beam, diameter=10)
    #         beam.add_features(drill_feature)
    #         scene.add(beam.geometry)
# ---------- end timber_model_2 ----------
panel_15 = Panel(timber_model_2.timber_models)
py3_4 = Python3Script(model=timber_model_2.timber_models, process=Toggle(True), vizualize=Toggle(True))  # -> out, model, geo, debug_info; inputs process: Boolean, vizualize: Boolean
# ---------- py3_4: Python ----------
from timber_design.workflow import DebugInfomation
from compas.scene import Scene

scene = Scene()
debug_info = DebugInfomation()

if process:
    for beam in model.beams:
        beam.reset_computed_properties()

    bje = model.process_joinery()
    if bje:
        debug_info.add_joint_error(bje)

if vizualize:
    for beam in model.beams:
        scene.add(beam.geometry)
        if beam.debug_info:
            for error in beam.debug_info:
                debug_info.add_feature_error(error)

geo = scene.draw()
# ---------- end py3_4 ----------
panel_16 = Panel(py3_4.out)
showjointtypes = CTShowJointTypes(model=timber_model_2.timber_models)
#   port model: Model object.
# ---------- showjointtypes: Python ----------
"""Shows the names of the defined Joints."""
# env: C:\Users\kapso\OneDrive\Documents\GitHub\timber_design\src
# r: compas_timber>=0.16.2
# flake8: noqa
import Grasshopper
import System
from compas_rhino.conversions import point_to_rhino

from compas_timber.utils import intersection_line_line_param
from timber_design.ghpython.ghcomponent_helpers import item_input_valid_cpython


class ShowJointTypes(Grasshopper.Kernel.GH_ScriptInstance):
    def RunScript(self, model):
        self.pt = []
        self.txt = []

        if not item_input_valid_cpython(ghenv, model, "model"):
            return

        for joint in model.joints:
            line_a, line_b = joint.elements[0].centerline, joint.elements[1].centerline
            [p1, _], [p2, _] = intersection_line_line_param(line_a, line_b, float("inf"), False, 1e-3)
            p1 = point_to_rhino(p1)
            p2 = point_to_rhino(p2)

            self.pt.append((p2 + p1) / 2)
            self.txt.append(joint.__class__.__name__)

    def DrawViewportWires(self, arg):
        if ghenv.Component.Locked:
            return
        col = System.Drawing.Color.FromArgb(255, 0, 0, 0)
        # https://developer.rhino3d.com/api/RhinoCommon/html/M_Rhino_Display_DisplayPipeline_Draw2dText_5.htm
        for p, t in zip(self.pt, self.txt):
            arg.Display.Draw2dText(t, col, p, True, 12, "Verdana")
# ---------- end showjointtypes ----------
featureerrors = CTShowFeatureErrors(debug_info=py3_4.debug_info, i=Slider(0, range=0..100))  # -> Info, Geometry
#   port debug_info: DebugInformation object containing feature errors.
#   port i: Index of the feature error to show. This index wraps around the number of errors.
#   port Info: Information about the selected feature error.
#   port Geometry: Geometry related to the selected feature error.
# ---------- featureerrors: Python ----------
"""Shows information useful for debugging feature application errors."""
# env: C:\Users\kapso\OneDrive\Documents\GitHub\timber_design\src
# r: compas_timber>=0.16.2
# flake8: noqa
import Grasshopper

from compas.scene import SceneObject
from timber_design.ghpython.ghcomponent_helpers import item_input_valid_cpython


class ShowFeatureErrors(Grasshopper.Kernel.GH_ScriptInstance):
    def RunScript(self, debug_info, i):
        if not item_input_valid_cpython(ghenv, i, "i"):
            i = 0
        if not item_input_valid_cpython(ghenv, debug_info, "DebugInfo"):
            return
        if not debug_info.feature_errors:
            ghenv.Component.AddRuntimeMessage(Grasshopper.Kernel.GH_RuntimeMessageLevel.Warning, "No feature errors found in input parameter 'DebugInfo'")
            return
        feature_errors = debug_info.feature_errors
        i = int(i) % len(feature_errors)
        error = feature_errors[i]

        geometries = [error.feature_geometry, error.element_geometry]
        geometries = flatten(geometries)
        geo_objs = [SceneObject(item=geo) for geo in geometries]
        output = []
        for obj in geo_objs:
            output.extend(obj.draw())

        return error.message, output


def flatten(lst):
    if not lst:
        return lst
    if isinstance(lst[0], list):
        return flatten(lst[0]) + flatten(lst[1:])
    return lst[:1] + flatten(lst[1:])
# ---------- end featureerrors ----------
geometry_2 = Geometry(py3_4.geo)
preview = CustomPreview(Geometry=geometry_2, Material=ColourSwatch(SwatchColor=RGBA(156, 115, 115, 147)))
python_3_script_8 = Python3Script(models=py3_4.model, save=Button(), file_path=file_path)  # -> out, a; inputs models: list
# ---------- python_3_script_8: Python ----------
import os
from compas.data import json_dump

if save:
    json_dump(models, file_path, pretty=True)
    # for i, m in enumerate(models):
    #     """Serialize models to .JSON"""
    #     output_path = os.path.join(file_path, f"timber_model_{i}.json")
    #     m.to_json(output_path, pretty=True)
    #     print(f"Model written to {output_path}")
# ---------- end python_3_script_8 ----------
panel_17 = Panel(python_3_script_8.out)

# ---- group: BTLX
writebtlx_2 = CTWriteBTLx(model=py3_4.model, write=Button())  # -> BTLx; inputs write: Boolean
#   port model: Model object.
#   port write: Write to file.
#   port BTLx: Pretty BTLx string
# ---------- writebtlx_2: Python ----------
"""Writes a BTLx file for machining of model parts."""
# env: C:\Users\Juste\Documents\_GitHub\timber_design\src
# r: compas_timber>=0.16.2
# flake8: noqa
import Grasshopper
import Rhino

from compas_timber.fabrication import BTLxWriter
from timber_design.ghpython.ghcomponent_helpers import item_input_valid_cpython

import os, sys, importlib

gh_dir = os.path.dirname(ghenv.Component.OnPingDocument().FilePath)
# move up a folder from line_model -> design -> llhil-t2-fabrication
root_dir = os.path.dirname(os.path.dirname(gh_dir))
path = os.path.join(root_dir, "fabrication", "BTLx_Files", "0511-btlx")
print(path)

class WriteBTLx(Grasshopper.Kernel.GH_ScriptInstance):
    def RunScript(self, model, write: bool):
        if not item_input_valid_cpython(ghenv, model, "Model"):
            return

        btlx = BTLxWriter(file_name=str(Rhino.RhinoDoc.ActiveDoc.Name))

        if write:
            if not item_input_valid_cpython(ghenv, path, "Path"):
                return
            XML = btlx.write(model, path)
        else:
            XML = btlx.model_to_xml(model)

        return XML
# ---------- end writebtlx_2 ----------
