# Grasshopper definition 0513_timber_model.ghx (Grasshopper 1.0.8)
# plug-ins: Human

panel = Panel("""0
2
4
5""")
crv = Curve([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])

panel_2 = Panel("""0
3""")  # disabled
panel_3 = Panel("0.03")  # disabled
panel_4 = Panel("0.13")  # disabled
item = ListItem(List=crv, Index=panel_2, Wrap=True)  # disabled
py3 = Python3Script(lines=item, dist=panel_3)  # -> out, line_tree, frame_tree, simplify(graft(locations)), simplify(graft(texts)), geos, frames; inputs lines: list of Line, dist: Double; disabled
# ---------- py3: Python ----------
from compas_rhino.conversions import line_to_compas
from compas.geometry import Vector, angle_vectors

from compas_timber.elements import Beam
from compas_timber.model import TimberModel
from compas_timber.connections import (
    KBirdsmouthJoint, LMiterJoint,
    TStepJoint, TButtJoint
)
from compas_timber.connections import JointTopology

from compas_timber.analyzers import TripletAnalyzer

from compas.tolerance import Tolerance

from Grasshopper import DataTree
from Grasshopper.Kernel.Data import GH_Path

def is_planar_t_joint(candidate, tol=1e-3):
    """
    Check if a T joint candidate is planar.
    """
    if candidate.topology != JointTopology.TOPO_T:
        raise ValueError("Candidate must be of T topology")

    def _is_coplanar(points):
        # Remove duplicates
        pts = []
        for p in points:
            if not pts or (p - pts[-1]).length > tol:
                pts.append(p)

        if len(pts) < 4:
            return True

        # Find first non-colinear triple
        p0 = pts[0]
        n = None
        for i in range(1, len(pts) - 1):
            v1 = pts[i] - p0
            for j in range(i + 1, len(pts)):
                v2 = pts[j] - p0
                n = v1.cross(v2)
                if n.length > tol:
                    break
            if n and n.length > tol:
                break

        # All points colinear → treat as planar
        if not n or n.length <= tol:
            return True

        # Check remaining points
        for p in pts:
            v = p - p0
            if abs(n.dot(v)) > tol:
                return False

        return True

    ca, cb = candidate.elements
    pts = [*ca.centerline, *cb.centerline]

    # 1. Check coplanarity
    if not _is_coplanar(pts):
        return False

    # 2. Check cross-section alignment (y-axis)
    ya = ca.frame.yaxis.unitized()
    yb = cb.frame.yaxis.unitized()

    return abs(ya.dot(yb)) >= 1 - tol

def _is_planar(element_a, element_b):
    """Check if two beams are planar.

    Parameters
    ----------
    element_a : :class:`compas_timber.elements.Beam`
        The first beam.
    element_b : :class:`compas_timber.elements.Beam`
        The second beam.

    Returns
    -------
    bool
        ``True`` if the beams are planar, ``False`` otherwise.

    """
    # Get frame from each beam
    frame_a = element_a.frame
    frame_b = element_b.frame

    # Match orientation of the frames
    frame_a.xaxis = Vector(0, 0, 1)
    frame_b.xaxis = Vector(0, 0, 1)

    # Calculate the angle between the two vectors
    angle = angle_vectors(frame_a.normal, frame_b.normal, deg=True)

    # If the angle is close to 0 or 180 degrees, the beams are planar
    return abs(angle) < 1e-6 or abs(angle - 180) < 1e-6

####
lines = [line_to_compas(ln) for ln in lines]

model = TimberModel(Tolerance(unit="M", absolute=0.001))

frames = []
for ln in lines:
    beam = Beam.from_centerline(ln, 0.10, 0.12)

    model.add_element(beam)
    frames.append(beam.frame)
model.connect_adjacent_beams(max_distance=dist)

"""
TOPO_UNKNOWN = 0
TOPO_I = 1
TOPO_L = 2
TOPO_T = 3
TOPO_X = 4
TOPO_Y = 5
TOPO_K = 6
"""
line_tree = DataTree[object]()
frame_tree = DataTree[object]()
locations = []
texts = []

for i, can in enumerate(model.joint_candidates):
    path = GH_Path(i)
    
    topo = JointTopology.get_name(can.topology)

    dist = round(can.distance, 3)
    print (dist, topo)

    ca, cb = can.element_a, can.element_b

    # print (is_planar_t_joint(can))

    if topo == "TOPO_L":
        LMiterJoint.create(model, ca, cb)

    if topo == "TOPO_T":
        if _is_planar(ca, cb):
            TStepJoint.create(model, ca, cb)
        else:
            TButtJoint.create(model, ca, cb)


    locations.append(can.location)
    texts.append(f"{topo}, {dist}")

    lns = [ca.centerline, cb.centerline]
    line_tree.AddRange(lns, path)

model.process_joinery()

geos = []
for beam in model.beams:
    geos.append(beam.geometry)

print(model)
# ---------- end py3 ----------
number_slider = Slider(0.08, range=0..0.1)  # disabled
draw = COMPASDraw(cg=py3.geos)  # -> rg; disabled
#   port cg: The COMPAS geometry or datastructure to be drawn.
#   port rg: The Rhino geometry object.
# ---------- draw: Python ----------
# r: compas>=2.14.1
"""
Draws COMPAS geometry in Grasshopper.
"""

from typing import Any

import Grasshopper

from compas.scene import SceneObject


class CompasToRhinoGeometry(Grasshopper.Kernel.GH_ScriptInstance):
    def RunScript(self, cg):
        if not cg:
            return None

        return SceneObject(item=cg).draw()
# ---------- end draw ----------
draw_2 = COMPASDraw(cg=py3.locations)  # -> rg; disabled; same code as draw
tag = TextTag3D(Location=draw_2, Text=py3.texts, Size=number_slider, Justification=7)  # disabled

py3_2 = Python3Script()  # -> out, line_model
# ---------- py3_2: Python ----------
from compas.data import json_load
import os, sys, importlib

gh_dir = os.path.dirname(ghenv.Component.OnPingDocument().FilePath)
gh_par = os.path.dirname(gh_dir)

line_path = os.path.join(gh_par, 'line_model')
json_path = os.path.join(
    gh_par, 'line_model', 'data', '260518_v3_line_model.json'
)

if line_path not in sys.path:
    sys.path.insert(0, line_path)

import nodegraph
importlib.reload(nodegraph)
from nodegraph import NodeGraph


line_model = json_load(json_path)

print (type(line_model))
# ---------- end py3_2 ----------
py3_3 = Python3Script(graph=py3_2.line_model)  # -> out, a
# ---------- py3_3: Python ----------
from Grasshopper import DataTree
from Grasshopper.Kernel.Data import GH_Path

groups = {}
for edge in graph.edges():
    g = graph.get_edge_attribute(edge, 'group')
    groups.setdefault(g, []).append(edge)


a = DataTree[object]()

for g, edges in groups.items():
    path = GH_Path(g)
    for e in edges:
        # print (e)
        ln = graph.get_edge_attribute(e, 'shifted_line', else_value=graph.edge_line(e))
        a.Add(ln, path)
# ---------- end py3_3 ----------
py3_4 = Python3Script(graph=py3_2.line_model)  # -> out, test_lines
# ---------- py3_4: Python ----------
import os, sys, importlib

gh_dir = os.path.dirname(ghenv.Component.OnPingDocument().FilePath)

parent = os.path.dirname(gh_dir)              # go up one level
src_dir = os.path.join(parent, "src")         # go into src folder
if src_dir not in sys.path:
    sys.path.insert(0, src_dir)

print (gh_dir)
print (parent)
print (src_dir)


#######---------Imports------------##########
objs = [(0, 2), (1, 4)]
print (objs[1])
########----------Main Code-----------_###########

test_lines = []

edges = graph.edges_where({"group": 1})

for e in edges:
    ln = graph.get_edge_attribute(e, "shifted_line", else_value=graph.edge_line(e))
    test_lines.append(ln)
# ---------- end py3_4 ----------
draw_3 = COMPASDraw(cg=py3_3.a)  # -> rg; same code as draw
draw_4 = COMPASDraw(cg=py3_4.test_lines)  # -> rg; same code as draw
midpt = CurveMiddle(Curve=draw_3)
item_2 = ListItem(List=crv, Index=panel, Wrap=True)
number_slider_2 = Slider(0.12, range=0..1)
points = PointList(Points=midpt, Size=number_slider_2)
py3_5 = Python3Script(lines=crv)  # -> out, line_tree, frame_tree, simplify(graft(locations)), simplify(graft(texts)), geos, frames; inputs lines: list of Line
# ---------- py3_5: Python ----------
from compas_rhino.conversions import line_to_compas
from compas.geometry import Vector, angle_vectors

from compas_timber.elements import Beam
from compas_timber.model import TimberModel
from compas_timber.connections import (
    KBirdsmouthJoint, LMiterJoint,
    TStepJoint, TButtJoint
)
from compas_timber.connections import JointTopology

from compas_timber.analyzers import TripletAnalyzer

from compas.tolerance import Tolerance

from Grasshopper import DataTree
from Grasshopper.Kernel.Data import GH_Path

def is_planar_t_joint(candidate, tol=1e-3):
    """
    Check if a T joint candidate is planar.
    """
    if candidate.topology != JointTopology.TOPO_T:
        raise ValueError("Candidate must be of T topology")

    def _is_coplanar(points):
        # Remove duplicates
        pts = []
        for p in points:
            if not pts or (p - pts[-1]).length > tol:
                pts.append(p)

        if len(pts) < 4:
            return True

        # Find first non-colinear triple
        p0 = pts[0]
        n = None
        for i in range(1, len(pts) - 1):
            v1 = pts[i] - p0
            for j in range(i + 1, len(pts)):
                v2 = pts[j] - p0
                n = v1.cross(v2)
                if n.length > tol:
                    break
            if n and n.length > tol:
                break

        # All points colinear → treat as planar
        if not n or n.length <= tol:
            return True

        # Check remaining points
        for p in pts:
            v = p - p0
            if abs(n.dot(v)) > tol:
                return False

        return True

    ca, cb = candidate.elements
    pts = [*ca.centerline, *cb.centerline]

    # 1. Check coplanarity
    if not _is_coplanar(pts):
        return False

    # 2. Check cross-section alignment (y-axis)
    ya = ca.frame.yaxis.unitized()
    yb = cb.frame.yaxis.unitized()

    return abs(ya.dot(yb)) >= 1 - tol

def _is_planar(element_a, element_b):
    """Check if two beams are planar.

    Parameters
    ----------
    element_a : :class:`compas_timber.elements.Beam`
        The first beam.
    element_b : :class:`compas_timber.elements.Beam`
        The second beam.

    Returns
    -------
    bool
        ``True`` if the beams are planar, ``False`` otherwise.

    """
    # Get frame from each beam
    frame_a = element_a.frame
    frame_b = element_b.frame

    # Match orientation of the frames
    frame_a.xaxis = Vector(0, 0, 1)
    frame_b.xaxis = Vector(0, 0, 1)

    # Calculate the angle between the two vectors
    angle = angle_vectors(frame_a.normal, frame_b.normal, deg=True)

    # If the angle is close to 0 or 180 degrees, the beams are planar
    return abs(angle) < 1e-6 or abs(angle - 180) < 1e-6

####
lines = [line_to_compas(ln) for ln in lines]

model = TimberModel(Tolerance(unit="M", absolute=0.001))

frames = []
for ln in lines:
    beam = Beam.from_centerline(ln, 0.10, 0.12)

    model.add_element(beam)
    frames.append(beam.frame)
model.connect_adjacent_beams(max_distance=0.055)

"""
TOPO_UNKNOWN = 0
TOPO_I = 1
TOPO_L = 2
TOPO_T = 3
TOPO_X = 4
TOPO_Y = 5
TOPO_K = 6
"""
line_tree = DataTree[object]()
frame_tree = DataTree[object]()
locations = []
texts = []

analyzer = TripletAnalyzer(model, 0.1)
clusters = analyzer.find()
print (clusters)
for cluster in clusters:
    print (cluster.location)


for i, can in enumerate(model.joint_candidates):
    path = GH_Path(i)
    
    topo = JointTopology.get_name(can.topology)

    dist = round(can.distance, 3)
    print (dist, topo)

    ca, cb = can.element_a, can.element_b

    # print (is_planar_t_joint(can))

    if topo == "TOPO_L":
        LMiterJoint.create(model, ca, cb)

    if topo == "TOPO_T":
        if _is_planar(ca, cb):
            TStepJoint.create(model, ca, cb)
        else:
            TButtJoint.create(model, ca, cb)


    locations.append(can.location)
    texts.append(f"{topo}, {dist}")

    lns = [ca.centerline, cb.centerline]
    line_tree.AddRange(lns, path)

model.process_joinery()

geos = []
for beam in model.beams:
    geos.append(beam.geometry)

print(model)
# ---------- end py3_5 ----------
number_slider_3 = Slider(7, range=0..10)

# ----
# Construct Timber Models
py3_6 = Python3Script(graph=py3_2.line_model)  # -> out, models
# ---------- py3_6: Python ----------
import os, sys, importlib

gh_dir = os.path.dirname(ghenv.Component.OnPingDocument().FilePath)

parent = os.path.dirname(gh_dir)              # go up one level
src_dir = os.path.join(parent, "src")         # go into src folder
if src_dir not in sys.path:
    sys.path.insert(0, src_dir)

print (gh_dir)
print (parent)
print (src_dir)


#######---------Imports------------##########
import timber_config
importlib.reload(timber_config)

import timber_model
importlib.reload(timber_model)
from timber_model import graph_to_timber_models


########----------Main Code-----------_###########
models = graph_to_timber_models(graph, align_shoe=False)

print (list(m.attributes['group'] for m in models))


models.sort(key=lambda m: m.attributes['group'])

print (list(m.attributes['group'] for m in models))
# ---------- end py3_6 ----------

py3_7 = Python3Script(models=py3_6.models)  # -> out, models, lns, pts; inputs models: list
# ---------- py3_7: Python ----------
import os, sys, importlib

gh_dir = os.path.dirname(ghenv.Component.OnPingDocument().FilePath)

parent = os.path.dirname(gh_dir)              # go up one level
src_dir = os.path.join(parent, "src")         # go into src folder
if src_dir not in sys.path:
    sys.path.insert(0, src_dir)


import timber_config
importlib.reload(timber_config)

import timber_model
importlib.reload(timber_model)
from timber_model import apply_joints

from copy import deepcopy

models = deepcopy(models)


from Grasshopper import DataTree
from Grasshopper.Kernel.Data import GH_Path
pts = DataTree[object]()
lns = DataTree[object]()

#
for model in models:
    g = model.attributes['group']
    path = GH_Path(g)

    for beam in model.beams:
        ln = beam.centerline
        pt = ln.midpoint
        lns.Add(ln, path)
        pts.Add(pt, path)
# ---------- end py3_7 ----------
draw_5 = COMPASDraw(cg=py3_7.pts)  # -> rg; same code as draw
draw_6 = COMPASDraw(cg=py3_7.lns)  # -> rg; same code as draw
draw_7 = COMPASDraw(cg=py3_5.frames)  # -> rg; same code as draw
draw_8 = COMPASDraw(cg=py3_5.line_tree)  # -> rg; same code as draw
points_2 = PointList(Points=draw_5, Size=number_slider_2)
draw_9 = COMPASDraw(cg=py3_5.locations)  # -> rg; same code as draw
draw_10 = COMPASDraw(cg=py3_5.geos)  # -> rg; same code as draw
panel_5 = Panel(py3_5.texts)
branch = TreeBranch(Tree=draw_9, Path=number_slider_3, MaintainPaths=True)
branch_2 = TreeBranch(Tree=draw_8, Path=number_slider_3, MaintainPaths=True)
midpt_2 = CurveMiddle(Curve=branch_2)
branch_3 = TreeBranch(Tree=py3_5.texts, Path=number_slider_3, MaintainPaths=True)
item_3 = ListItem(List=draw_7, Index=Slider(3, range=0..3), Wrap=True)

# ----
# Apply Joints
list = ValueList({"Zero": 0, "One": 1, "Two": 2, "Three": 2² - 1}, selected=["Zero", "One", "Two", "Three"])
item_4 = ListItem(List=py3_6.models, Index=list, Wrap=True)
py3_8 = Python3Script(models=item_4)  # -> out, models; inputs models: list
# ---------- py3_8: Python ----------
import os, sys, importlib

gh_dir = os.path.dirname(ghenv.Component.OnPingDocument().FilePath)

parent = os.path.dirname(gh_dir)              # go up one level
src_dir = os.path.join(parent, "src")         # go into src folder
if src_dir not in sys.path:
    sys.path.insert(0, src_dir)


import timber_config
importlib.reload(timber_config)

import timber_model
importlib.reload(timber_model)
from timber_model import apply_joints

from copy import deepcopy

models = deepcopy(models)


#
for model in models:
    apply_joints(
        model,
        max_distance=0.055,
        k_miter_type="AVERAGE",
        k_miter_flag=False,
        debug=True
    )
# ---------- end py3_8 ----------

item_5 = ListItem(List=item_4, Index=0, Wrap=True)  # -> Item1, Item
py3_9 = Python3Script(models=item_5.Item)  # -> out, line_tree, frame_tree, locations, texts, tri_locations, geos, frames; inputs lines: list of Line, models: list
# ---------- py3_9: Python ----------
from compas_rhino.conversions import line_to_compas
from compas.geometry import Vector, angle_vectors

from compas_timber.elements import Beam
from compas_timber.model import TimberModel
from compas_timber.connections import (
    KBirdsmouthJoint, LMiterJoint,
    TStepJoint, TButtJoint
)
from compas_timber.connections import JointTopology

from compas_timber.analyzers import TripletAnalyzer

from compas.tolerance import Tolerance

from Grasshopper import DataTree
from Grasshopper.Kernel.Data import GH_Path

from copy import deepcopy

models = deepcopy(models)


def is_planar_t_joint(candidate, tol=1e-3):
    """
    Check if a T joint candidate is planar.
    """
    if candidate.topology != JointTopology.TOPO_T:
        raise ValueError("Candidate must be of T topology")

    def _is_coplanar(points):
        # Remove duplicates
        pts = []
        for p in points:
            if not pts or (p - pts[-1]).length > tol:
                pts.append(p)

        if len(pts) < 4:
            return True

        # Find first non-colinear triple
        p0 = pts[0]
        n = None
        for i in range(1, len(pts) - 1):
            v1 = pts[i] - p0
            for j in range(i + 1, len(pts)):
                v2 = pts[j] - p0
                n = v1.cross(v2)
                if n.length > tol:
                    break
            if n and n.length > tol:
                break

        # All points colinear → treat as planar
        if not n or n.length <= tol:
            return True

        # Check remaining points
        for p in pts:
            v = p - p0
            if abs(n.dot(v)) > tol:
                return False

        return True

    ca, cb = candidate.elements
    pts = [*ca.centerline, *cb.centerline]

    # 1. Check coplanarity
    if not _is_coplanar(pts):
        return False

    # 2. Check cross-section alignment (y-axis)
    ya = ca.frame.yaxis.unitized()
    yb = cb.frame.yaxis.unitized()

    return abs(ya.dot(yb)) >= 1 - tol

def _is_planar(element_a, element_b):
    """Check if two beams are planar.

    Parameters
    ----------
    element_a : :class:`compas_timber.elements.Beam`
        The first beam.
    element_b : :class:`compas_timber.elements.Beam`
        The second beam.

    Returns
    -------
    bool
        ``True`` if the beams are planar, ``False`` otherwise.

    """
    # Get frame from each beam
    frame_a = element_a.frame
    frame_b = element_b.frame

    # Match orientation of the frames
    frame_a.xaxis = Vector(0, 0, 1)
    frame_b.xaxis = Vector(0, 0, 1)

    # Calculate the angle between the two vectors
    angle = angle_vectors(frame_a.normal, frame_b.normal, deg=True)

    # If the angle is close to 0 or 180 degrees, the beams are planar
    return abs(angle) < 1e-6 or abs(angle - 180) < 1e-6

####
"""
TOPO_UNKNOWN = 0
TOPO_I = 1
TOPO_L = 2
TOPO_T = 3
TOPO_X = 4
TOPO_Y = 5
TOPO_K = 6
"""
from compas.geometry import Plane, Frame

def _get_average_miter_plane(reordered_elements, flip=False):
    _, a, b = reordered_elements
    ori = a.centerline.start
    dir_a = a.centerline.direction
    dir_b = b.centerline.direction

    cross = dir_a.cross(dir_b)

    y = dir_a + dir_b
    if flip:
        return Plane.from_frame(Frame(ori, cross, -y))
    return Plane.from_frame(Frame(ori, cross, y))

def _k_birdsmouth_solver(model, mill_depth, miter_type=None, miter_flag=False):
    """
    Handle K birdsmouth joints with three beams.

    Parameters
    ----------
    model : TimberModel
        The timber model after calling connect.adjacent_beams. 
    mill_depth : float
        The depth of the mill cut for the birdsmouth joint.
    miter_type : str, optional
        "VERTICAL" for a global Z aligned miter plane.
        "AVERAGE" for a miter plane based on the average of the two beam directions.
        If None, miter plane will generate within compas_timber definition, see k_birdsmouth.py.
    miter_flag : bool, optional
        Flip miter plane direction if generating weird cuts.
    
    Returns
    -------
    None
    """
    max_offset = max(candidate.distance for candidate in model.joint_candidates)

    # handle non-pair joints (in this case a 3-way connection using TripletAnalyzer)
    analyzer = TripletAnalyzer(model, max_offset/2)
    clusters = analyzer.find()

    for cluster in clusters:
        if cluster.topology == JointTopology.TOPO_K:
            # keep track of the amount of elements per type
            counts = Counter(e.attributes["hierarchy"] for e in cluster.elements)
            if counts["secondary"] == 2 and counts["tertiary"] == 1: #skip this joint
                continue

            # define the order of the elements to be passed to the joint
            order = {"main_primary": 0, "primary": 1, "secondary": 2, "tertiary": 3}
            if counts["main_primary"] == 2 and counts["primary"] == 1:
                order = {"primary": 0, "main_primary": 1, "secondary": 2, "tertiary": 3} #override the order just for this condition
            reordered_elements = sorted(cluster.elements, key=lambda e: order.get(e.attributes["hierarchy"], float('inf')))

            if len(reordered_elements) != 3:
                raise ValueError(f"Something went wrong with the analyzer. There should be always 3 elements, got: {len(reordered_elements)}")

            # promote cluster
            if miter_type == 'VERTICAL':
                miter_pln = _get_vertical_miter_plane(reordered_elements, flip=miter_flag)
            elif miter_type == 'AVERAGE':
                miter_pln = _get_average_miter_plane(reordered_elements, flip=miter_flag)
            else:
                miter_pln = None

            kwargs = {"mill_depth": mill_depth, "miter_plane": miter_pln}
            KBirdsmouthJoint.promote_cluster(model, cluster, reordered_elements=reordered_elements, **kwargs)
    return


line_tree = DataTree[object]()
frame_tree = DataTree[object]()
locations = []
texts = []
geos = []

tri_locations = []

dist = 0.055

for model in models:
    for beam in model.beams:
        beam.reset_computed_properties()

    model.connect_adjacent_beams(max_distance=dist)
    
    for can in model.joint_candidates:
        locations.append(can.location)

    analyzer = TripletAnalyzer(model, dist/2)
    clusters = analyzer.find()

    for i, c in enumerate(clusters):
        path = GH_Path(i)

        tri_locations.append(c.location)
        
        for beam in c.elements:
            line_tree.Add(beam.centerline, path)

        order = {"main_primary": 0, "primary": 1, "secondary": 2, "tertiary": 3}
        reordered_elements = sorted(c.elements, key=lambda e: order.get(e.attributes["hierarchy"], float('inf')))
        print (f'A{i}', list(e.attributes["hierarchy"] for e in c.elements))
        print (f'B{i}', list(e.attributes["hierarchy"] for e in reordered_elements))

        mill_depth = 0.01
        miter_pln = _get_average_miter_plane(reordered_elements, flip=False)
        # miter_pln = None
        kwargs = {"mill_depth": mill_depth, "miter_plane": miter_pln}
        KBirdsmouthJoint.promote_cluster(model, c, reordered_elements=reordered_elements, **kwargs)
    


    model.process_joinery()

    for beam in model.beams:
        geos.append(beam.geometry)
# ---------- end py3_9 ----------
draw_11 = COMPASDraw(cg=py3_9.geos)  # -> rg; same code as draw
draw_12 = COMPASDraw(cg=py3_9.line_tree)  # -> rg; same code as draw
draw_13 = COMPASDraw(cg=py3_9.locations)  # -> rg; same code as draw
draw_14 = COMPASDraw(cg=py3_9.tri_locations)  # -> rg; same code as draw
preview = CustomPreview(Geometry=draw_11, Material=ColourSwatch(SwatchColor=RGBA(0, 0, 0, 131)))
points_3 = PointList(Points=draw_14, Size=Slider(0.04, range=0..1))
branch_4 = TreeBranch(Tree=draw_12, Path=Slider(4, range=0..30), MaintainPaths=True)
panel_6 = Panel(py3_8.out)
panel_7 = Panel(py3_8.models)
points_4 = PointList(Points=midpt_2, Size=Slider(0.07, range=0..1))
tag_2 = TextTag3D(Location=branch, Text=branch_3, Size=Slider(0.08, range=0..0.1), Justification=7)
py3_10 = Python3Script(models=py3_8.models)  # -> out, models, centroids, pts, txts; inputs models: list
# ---------- py3_10: Python ----------
import os, sys, importlib

gh_dir = os.path.dirname(ghenv.Component.OnPingDocument().FilePath)

parent = os.path.dirname(gh_dir)              # go up one level
src_dir = os.path.join(parent, "src")         # go into src folder
if src_dir not in sys.path:
    sys.path.insert(0, src_dir)


import timber_config
importlib.reload(timber_config)

import timber_model
importlib.reload(timber_model)
from timber_model import apply_joints

from Grasshopper import DataTree
from Grasshopper.Kernel.Data import GH_Path

from copy import deepcopy

models = deepcopy(models)


#
centroids = [m.center_of_mass for m in models]

pts = DataTree[object]()
txts = DataTree[object]()

for m in models:
    g = m.attributes['group']
    path = GH_Path(g)

    joints = m.joints
    locations = [j.location for j in joints]
    pts.AddRange(locations, path)
# ---------- end py3_10 ----------
branch_5 = TreeBranch(Tree=py3_10.pts, Path=Slider(1, range=0..1), MaintainPaths=True)
branch_6 = TreeBranch(Tree=py3_10.pts, Path=Slider(0, range=0..100), MaintainPaths=True)
number_slider_4 = Slider(0.001, range=0..0.001)
draw_15 = COMPASDraw(cg=branch_5)  # -> rg; same code as draw
draw_16 = COMPASDraw(cg=branch_6)  # -> rg; same code as draw
cullpt = CullDuplicates(Points=draw_15, Tolerance=number_slider_4, CullMode=2)  # -> Points, Indices, Valence
cullpt_2 = CullDuplicates(Points=draw_16, Tolerance=number_slider_4, CullMode=2)  # -> Points, Indices, Valence
draw_17 = COMPASDraw(cg=py3_10.centroids)  # -> rg; same code as draw
sort_pt = SortPoints(Points=cullpt_2.Points)  # -> Points, Indices
number_slider_5 = Slider(0.02, range=0..0.1)

# ----
# Process joinery
toggle = BooleanToggle(False)
py3_11 = Python3Script(models=py3_8.models, process=toggle)  # -> out, models; inputs models: list, process: Boolean
# ---------- py3_11: Python ----------
import os, sys, importlib

gh_dir = os.path.dirname(ghenv.Component.OnPingDocument().FilePath)

parent = os.path.dirname(gh_dir)              # go up one level
src_dir = os.path.join(parent, "src")         # go into src folder
if src_dir not in sys.path:
    sys.path.insert(0, src_dir)

print (gh_dir)
print (parent)
print (src_dir)

import timber_config
importlib.reload(timber_config)

import timber_model
importlib.reload(timber_model)
from timber_model import apply_processings

from copy import deepcopy

models = deepcopy(models)


#
if process:
    for model in models:
        apply_processings(model)
# ---------- end py3_11 ----------

points_5 = PointList(Points=draw_17, Size=Slider(1, range=0..1))
py3_12 = Python3Script(models=py3_8.models)  # -> out, models; inputs models: list; disabled
# ---------- py3_12: Python ----------
import os, sys, importlib

gh_dir = os.path.dirname(ghenv.Component.OnPingDocument().FilePath)

parent = os.path.dirname(gh_dir)              # go up one level
src_dir = os.path.join(parent, "src")         # go into src folder
if src_dir not in sys.path:
    sys.path.insert(0, src_dir)


import timber_config
importlib.reload(timber_config)

import timber_model
importlib.reload(timber_model)
from timber_model import apply_joints

from copy import deepcopy

models = deepcopy(models)


#
for model in models:
    # print (model)
    # print (model.attributes)
    pass
from compas.data import json_load


# timber_model = json_load(file_path)
results = json_load(os.path.join(parent, "timber_design", "data", f"260515_v1_timber_models.json"))

for data in results:
    model = data['model']
    attrs = data['attributes']
    print (model.attributes)

    model.attributes = attrs
    # print (model.attributes)
# ---------- end py3_12 ----------

# ----
# Preview
number_slider_6 = Slider(255, range=0..255)
python_3_script = Python3Script(models=py3_11.models, alpha=number_slider_6)  # -> out, geos, colors, cut_planes, models; inputs models: list, alpha: Int32
# ---------- python_3_script: Python ----------
import rhinoscriptsyntax as rs
import scriptcontext as sc
import Rhino.Display as rd
import System.Drawing as sd

from compas.scene import Scene
from compas.geometry import Line, Point
from copy import deepcopy


COLORS = {
    "primary":      sd.Color.FromArgb(alpha, 220,  50,  50),
    "main_primary": sd.Color.FromArgb(alpha, 150,  80, 220),
    "secondary":    sd.Color.FromArgb(alpha,  50, 150, 220),
    "tertiary":     sd.Color.FromArgb(alpha,  80, 200, 100),
    "shoe":         sd.Color.FromArgb(alpha,  20, 150, 100),
    "plate":        sd.Color.FromArgb(alpha, 100, 100, 100)
}


geos = []
colors = []
cut_planes = []

for model in models:
    for plate in model.plates:
        geos.append(plate.geometry)
        colors.append(COLORS['plate'])

    for beam in model.beams:
        hie = beam.attributes.get('hierarchy')

        geos.append(beam.geometry)
        colors.append(COLORS[hie])

    cut_planes.append(model.attributes['cut_plane'])
# ---------- end python_3_script ----------
compas_draw = COMPASDraw(cg=python_3_script.geos)  # -> rg; same code as draw
compas_draw_2 = COMPASDraw(cg=python_3_script.cut_planes)  # -> rg; same code as draw
preview_2 = CustomPreview(Geometry=compas_draw, Material=python_3_script.colors)
wires = BrepWireframe(Brep=compas_draw, Density=-1)
previewlw = CustomPreviewLineweights(Geometry=wires, Shader=ColourSwatch(SwatchColor=RGB(255, 255, 255)), Absolute=False)

item_6 = ListItem(List=draw_17, Index=[Slider(0, range=0..1), Slider(1, range=0..1)], Wrap=True)
dots = DotDisplay(Point=cullpt.Points, Colour=graft(ColourSwatch(SwatchColor=RGB(0, 0, 0))), Size=number_slider_5)
avr = Average(Input=item_6)
yz = YZPlane(Origin=avr)
mirror = Mirror(Geometry=cullpt_2.Points, Plane=yz)  # -> Geometry, Transform
dots_2 = DotDisplay(Point=mirror.Geometry, Colour=graft(ColourSwatch(SwatchColor=RGB(255, 254, 255))), Size=number_slider_5)

py3_13 = Python3Script(models=py3_11.models)  # -> out, models, geo_tree, rh_pln_tree, flipped_geo_tree; inputs models: list
# ---------- py3_13: Python ----------
import os, sys, importlib

gh_dir = os.path.dirname(ghenv.Component.OnPingDocument().FilePath)

parent = os.path.dirname(gh_dir)              # go up one level
src_dir = os.path.join(parent, "src")         # go into src folder
if src_dir not in sys.path:
    sys.path.insert(0, src_dir)

print (gh_dir)
print (parent)
print (src_dir)

import timber_config
importlib.reload(timber_config)

import timber_model
importlib.reload(timber_model)
from timber_model import apply_joints


from Grasshopper import DataTree
from Grasshopper.Kernel.Data import GH_Path
from compas_rhino.conversions import frame_to_rhino_plane

from compas.geometry import Transformation, Frame

#
geo_tree = DataTree[object]()
rh_pln_tree = DataTree[object]()
flipped_geo_tree = DataTree[object]()

# Robot station location
to_frame = Frame.worldXY()

for model in models:
    g = model.attributes['group']
    path = GH_Path(g)
    
    # Get ONE clt plate for each module
    plate = model.attributes['clt_plate']

    # Get special frame for nesting
    from_frame = plate.attributes['negative_frame']
    O = Transformation.from_frame_to_frame(from_frame, to_frame)
    
    rh_pln_tree.Add(frame_to_rhino_plane(from_frame), path)

    geo = plate.geometry
    geo_tree.Add(geo, path)

    flipped_geo_tree.Add(geo.transformed(O), path)

    for beam in model.beams:
        geo = beam.geometry
        geo_tree.Add(geo, path)

        flipped_geo_tree.Add(geo.transformed(O), path)
# ---------- end py3_13 ----------
draw_18 = COMPASDraw(cg=py3_13.geo_tree)  # -> rg; same code as draw
draw_19 = COMPASDraw(cg=py3_13.flipped_geo_tree)  # -> rg; same code as draw
pln = Plane(py3_13.rh_pln_tree)
orient = Orient(Geometry=draw_18, Source=py3_13.rh_pln_tree, Target=PlaneXY(0, 0, 0))  # -> Geometry, Transform
geo = Geometry(draw_19)
geo_2 = Geometry(orient.Geometry)

# ----
# Write to json
number_slider_7 = Slider(2, range=1..10)
py3_14 = Python3Script(models=py3_11.models, version=number_slider_7, save=Button())  # inputs models: list, version: Int32
# ---------- py3_14: Python ----------
import os, sys, importlib
from datetime import date

from compas.data import json_dump

gh_dir = os.path.dirname(ghenv.Component.OnPingDocument().FilePath)
gh_par = os.path.dirname(gh_dir)
file_path = os.path.join(gh_par, "timber_design", "data")

today = date.today().strftime("%y%m%d")
print(today)



if save:
    serializable = []
    for m in models:
        serializable.append({
            "attributes": dict(m.attributes),
            "model": m
        })
        
    output_path = os.path.join(file_path, f"{today}_v{version}_timber_models.json")
    dump = json_dump(serializable, output_path, pretty=False)
    print(f"Model written to {output_path}")


# serializable = []
# for m in models:
#     serializable.append({
#         "attributes": dict(m.attributes),
#         "model": m
#     })
# print (serializable)
# ---------- end py3_14 ----------

branch_7 = TreeBranch(Tree=draw_18, Path=Slider(0, range=0..100), MaintainPaths=True)
branch_8 = TreeBranch(Tree=draw_18, Path=Slider(1, range=0..1), MaintainPaths=True)
preview_3 = CustomPreview(
    Geometry=branch_8,
    Material={diffuse=RGB(228, 178, 227), emission=RGB(68, 53, 68), shine=0.5, specular=RGB(255, 254, 255), transparency=0})
mirror_2 = Mirror(Geometry=branch_7, Plane=yz)  # -> Geometry, Transform
preview_4 = CustomPreview(Geometry=mirror_2.Geometry, Material=ColourSwatch(SwatchColor=RGB(173, 107, 0)))
