# Grasshopper definition 0528_timber_model.ghx (Grasshopper 1.0.8)
# plug-ins: Human

py3 = Python3Script()  # -> out, line_model
# ---------- py3: Python ----------
from compas.data import json_load
import os, sys, importlib

gh_dir = os.path.dirname(ghenv.Component.OnPingDocument().FilePath)
gh_par = os.path.dirname(gh_dir)

line_path = os.path.join(gh_par, 'line_model')
json_path = os.path.join(
    gh_par, 'line_model', 'data', '260527_v4_line_model.json'
)

if line_path not in sys.path:
    sys.path.insert(0, line_path)

import nodegraph
importlib.reload(nodegraph)
from nodegraph import NodeGraph


line_model = json_load(json_path)

print (type(line_model))
# ---------- end py3 ----------

# ----
# Construct Timber Models
py3_2 = Python3Script(graph=py3.line_model)  # -> out, models
# ---------- py3_2: Python ----------
import os, sys, importlib

gh_dir = os.path.dirname(ghenv.Component.OnPingDocument().FilePath)

parent = os.path.dirname(gh_dir)              # go up one level
src_dir = os.path.join(parent, "src")         # go into src folder
if src_dir not in sys.path:
    sys.path.insert(0, src_dir)

print (gh_dir)
print (parent)
print (src_dir)


#######---------Imports------------##########
import timber_config
importlib.reload(timber_config)

import timber_model
importlib.reload(timber_model)
from timber_model import graph_to_timber_models


########----------Main Code-----------_###########
models = graph_to_timber_models(graph, align_shoe=False)

print (list(m.attributes['group'] for m in models))


models.sort(key=lambda m: m.attributes['group'])

print (list(m.attributes['group'] for m in models))
# ---------- end py3_2 ----------

swatch = ColourSwatch(SwatchColor=RGBA(38, 56, 36, 0))

# ----
# Apply Joints
list = ValueList({"Zero": 0, "One": 1, "Two": 2, "Three": 2² - 1}, selected="Zero")
item = ListItem(List=py3_2.models, Index=list, Wrap=True)
py3_3 = Python3Script(models=item)  # -> out, models; inputs models: list
# ---------- py3_3: Python ----------
import os, sys, importlib

gh_dir = os.path.dirname(ghenv.Component.OnPingDocument().FilePath)

parent = os.path.dirname(gh_dir)              # go up one level
src_dir = os.path.join(parent, "src")         # go into src folder
if src_dir not in sys.path:
    sys.path.insert(0, src_dir)

import timber_config
importlib.reload(timber_config)

import timber_model
importlib.reload(timber_model)
from timber_model import apply_joints

from copy import deepcopy

models = deepcopy(models)


#
for model in models:
    apply_joints(
        model,
        max_distance=0.065,
        k_miter_type="AVERAGE",
        k_miter_flag=False,
        x_lap_flip=False,
        debug=True
    )
# ---------- end py3_3 ----------

panel = Panel(py3_3.out)
panel_2 = Panel(py3_3.models)

# ----
# Process joinery
toggle = BooleanToggle(True)
py3_4 = Python3Script(models=py3_3.models, process=toggle)  # -> out, models; inputs models: list, process: Boolean
# ---------- py3_4: Python ----------
import os, sys, importlib

gh_dir = os.path.dirname(ghenv.Component.OnPingDocument().FilePath)

parent = os.path.dirname(gh_dir)              # go up one level
src_dir = os.path.join(parent, "src")         # go into src folder
if src_dir not in sys.path:
    sys.path.insert(0, src_dir)

print (gh_dir)
print (parent)
print (src_dir)

import timber_config
importlib.reload(timber_config)

import timber_model
importlib.reload(timber_model)
from timber_model import apply_processings

from copy import deepcopy

models = deepcopy(models)


#
if process:
    for model in models:
        apply_processings(model)
# ---------- end py3_4 ----------

py3_5 = Python3Script(models=py3_4.models)  # -> out, locations, txts, geos, entry_point_tree, screw_line_tree, entry_faces, exit_faces, strut_faces; inputs models: list
# ---------- py3_5: Python ----------
import os, sys, importlib
gh_dir = os.path.dirname(ghenv.Component.OnPingDocument().FilePath)

parent = os.path.dirname(gh_dir)
src_dir = os.path.join(parent, "src")
if src_dir not in sys.path:
    sys.path.insert(0, src_dir)

import screw_planning
import screw_spec
import joint_wrappers

importlib.reload(screw_planning)
importlib.reload(screw_spec)
importlib.reload(joint_wrappers)

from screw_planning import apply_screws
from screw_spec import ScrewSpecification
from joint_wrappers import TMSJ

from Grasshopper import DataTree
from Grasshopper.Kernel.Data import GH_Path

# from copy import deepcopy
# models = deepcopy(models)

entry_point_tree = DataTree[object]()
screw_line_tree = DataTree[object]()
entry_faces = DataTree[object]()
exit_faces = DataTree[object]()
strut_faces = DataTree[object]()

geos = DataTree[object]()

for model in models:
    g = model.attributes["group"]

    results = apply_screws(
        model,
        spec_model="WT-plus-6.5",
        orientation_aligned="perp_tread",
        orientation_crossed="cross_section",
        drill_target="main",
        depth_limited=True,
        with_data=True
    )
    
    for i, (key, result) in enumerate(results.items()):
        path = GH_Path(g, i)

        entry_points = result["entry_points"]
        screw_lines = result["screw_lines"]
        entry_face = result["entry_face"]
        exit_face = result["exit_face"]
        strut_face = result["strut_face"]

        entry_point_tree.AddRange(entry_points, path)
        screw_line_tree.AddRange(screw_lines, path)
        entry_faces.Add(entry_face, path)
        exit_faces.Add(exit_face, path)
        strut_faces.Add(strut_face, path)

    model.process_joinery()
    for beam in model.beams:
        geos.Add(beam.geometry)
# ---------- end py3_5 ----------
draw = COMPASDraw(cg=py3_5.entry_faces)  # -> rg
#   port cg: The COMPAS geometry or datastructure to be drawn.
#   port rg: The Rhino geometry object.
# ---------- draw: Python ----------
# r: compas>=2.14.1
"""
Draws COMPAS geometry in Grasshopper.
"""

from typing import Any

import Grasshopper

from compas.scene import SceneObject


class CompasToRhinoGeometry(Grasshopper.Kernel.GH_ScriptInstance):
    def RunScript(self, cg):
        if not cg:
            return None

        return SceneObject(item=cg).draw()
# ---------- end draw ----------
draw_2 = COMPASDraw(cg=py3_5.exit_faces)  # -> rg; same code as draw
draw_3 = COMPASDraw(cg=py3_5.strut_faces)  # -> rg; same code as draw
draw_4 = COMPASDraw(cg=py3_5.geos)  # -> rg; same code as draw
preview = CustomPreview(Geometry=draw_4, Material=ColourSwatch(SwatchColor=RGB(186, 118, 0)))
draw_5 = COMPASDraw(cg=py3_5.entry_point_tree)  # -> rg; same code as draw
draw_6 = COMPASDraw(cg=py3_5.screw_line_tree)  # -> rg; same code as draw
py3_6 = Python3Script(models=py3_4.models)  # -> out, locations, txts; inputs models: list
# ---------- py3_6: Python ----------
from compas_timber.fabrication import Drilling
from compas_rhino.conversions import line_to_compas


locations = []
txts = []
for model in models:
    for beam in model.beams:
        txts.append(beam.name)
        locations.append(beam.centerline.midpoint)
# ---------- end py3_6 ----------
panel_3 = Panel(draw_4)
draw_7 = COMPASDraw(cg=py3_6.locations)  # -> rg; same code as draw
tag = TextTag(Location=draw_7, Text=py3_6.txts)

# ----
# Preview
number_slider = Slider(94, range=0..255)
python_3_script = Python3Script(models=py3_4.models, alpha=number_slider)  # -> out, geos, colors, cut_planes, models; inputs models: list, alpha: Int32
# ---------- python_3_script: Python ----------
import rhinoscriptsyntax as rs
import scriptcontext as sc
import Rhino.Display as rd
import System.Drawing as sd

from compas.scene import Scene
from compas.geometry import Line, Point
from copy import deepcopy


COLORS = {
    "primary":      sd.Color.FromArgb(alpha, 220,  50,  50),
    "main_primary": sd.Color.FromArgb(alpha, 150,  80, 220),
    "secondary":    sd.Color.FromArgb(alpha,  50, 150, 220),
    "tertiary":     sd.Color.FromArgb(alpha,  80, 200, 100),
    "shoe":         sd.Color.FromArgb(alpha,  20, 150, 100),
    "plate":        sd.Color.FromArgb(alpha, 100, 100, 100)
}


geos = []
colors = []
cut_planes = []

for model in models:
    for plate in model.plates:
        pass
        # geos.append(plate.geometry)
        # colors.append(COLORS['plate'])

    for beam in model.beams:
        # if beam.attributes['hierarchy'] != 'shoe':
            # continue
        hie = beam.attributes.get('hierarchy')

        geos.append(beam.geometry)
        colors.append(COLORS[hie])

    cut_planes.append(model.attributes['cut_plane'])
# ---------- end python_3_script ----------
compas_draw = COMPASDraw(cg=python_3_script.geos)  # -> rg; same code as draw
compas_draw_2 = COMPASDraw(cg=python_3_script.cut_planes)  # -> rg; same code as draw
preview_2 = CustomPreview(Geometry=compas_draw, Material=python_3_script.colors)
wires = BrepWireframe(Brep=compas_draw, Density=-1)
previewlw = CustomPreviewLineweights(Geometry=wires, Shader=ColourSwatch(SwatchColor=RGB(255, 255, 255)), Absolute=False)

number_slider_2 = Slider(0.604, range=0..1)
py3_7 = Python3Script(models=py3_4.models)  # -> out, locations, txts, port, butts, cuts, steps, notchs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; inputs models: list
# ---------- py3_7: Python ----------
from Grasshopper import DataTree
from Grasshopper.Kernel.Data import GH_Path

from compas_rhino.conversions import frame_to_rhino


locations = DataTree[object]()
txts = DataTree[object]()

butts = DataTree[object]()
cuts = DataTree[object]()
steps = DataTree[object]()
notchs = DataTree[object]()
bases = DataTree[object]()

geos = DataTree[object]()

a = DataTree[object]()
b = DataTree[object]()
c = DataTree[object]()
refs_m = DataTree[object]()
refs_c = DataTree[object]()

for model in models:
    g = model.attributes['group']
    for j, joint in enumerate(model.joints):
        if joint.name != "TMultiStepJoint":
            continue
        print (joint)
        path = GH_Path(g, j)
        locations.Add(joint.location, path)
        # txts.Add(len(joint.features), path)
        txts.Add(joint.step_shape, path)
        
        butt_pln = joint._get_butt_plane()
        cut_plns = joint._get_cut_planes()
        step_plns = joint._get_step_planes()
        notch_plns = joint._get_notch_planes()

        butts.Add(butt_pln, path)
        cuts.AddRange(cut_plns, path)
        steps.AddRange(step_plns, path)
        notchs.AddRange(notch_plns, path)
        bases.AddRange(joint._compute_base_planes(), path)

        for ele in joint.elements:
            geos.Add(ele.geometry, path)

        for frame in joint.main_beam.ref_sides:
            a.Add(frame_to_rhino(frame), path)
        for frame in joint.cross_beam.ref_sides:
            b.Add(frame_to_rhino(frame), path)

        # print (j, joint._main_beam_ref_side_index, joint._cross_beam_ref_side_index)
        c.Add(frame_to_rhino(joint.main_beam.front_side(joint.main_beam_ref_side_index)), path)
        refs_m.Add(joint.main_beam_ref_side_index, path)
        refs_c.Add(joint.cross_beam_ref_side_index, path)
# ---------- end py3_7 ----------
draw_8 = COMPASDraw(cg=py3_7.locations)  # -> rg; same code as draw
tstat = TreeStatistics(Tree=draw_8)  # -> Paths, Length, Count
item_2 = ListItem(List=tstat.Paths, Index=Slider(8, range=0..40), Wrap=True)
branch = TreeBranch(Tree=py3_7.b, Path=item_2, MaintainPaths=True)
branch_2 = TreeBranch(Tree=py3_7.refs_c, Path=item_2, MaintainPaths=True)
branch_3 = TreeBranch(Tree=py3_7.c, Path=item_2, MaintainPaths=True)
branch_4 = TreeBranch(Tree=py3_7.refs_m, Path=item_2, MaintainPaths=True)
branch_5 = TreeBranch(Tree=py3_7.a, Path=item_2, MaintainPaths=True)
item_3 = ListItem(List=branch, Index=branch_2, Wrap=True)
item_4 = ListItem(List=branch_5, Index=branch_4, Wrap=True)
cluster = Cluster(P=branch_3, num=number_slider_2)
cluster_2 = Cluster(P=item_4, num=number_slider_2)
cluster_3 = Cluster(P=item_3, num=number_slider_2)
branch_6 = TreeBranch(Tree=py3_7.geos, Path=item_2, MaintainPaths=True)
branch_7 = TreeBranch(Tree=py3_7.butts, Path=item_2, MaintainPaths=True)
branch_8 = TreeBranch(Tree=py3_7.cuts, Path=item_2, MaintainPaths=True)
branch_9 = TreeBranch(Tree=py3_7.steps, Path=item_2, MaintainPaths=True)
branch_10 = TreeBranch(Tree=py3_7.notchs, Path=item_2, MaintainPaths=True)
branch_11 = TreeBranch(Tree=py3_7.bases, Path=item_2, MaintainPaths=True)
draw_9 = COMPASDraw(cg=branch_6)  # -> rg; same code as draw
draw_10 = COMPASDraw(cg=branch_7)  # -> rg; same code as draw
draw_11 = COMPASDraw(cg=branch_8)  # -> rg; same code as draw
draw_12 = COMPASDraw(cg=branch_9)  # -> rg; same code as draw
draw_13 = COMPASDraw(cg=branch_10)  # -> rg; same code as draw
draw_14 = COMPASDraw(cg=branch_11)  # -> rg; same code as draw
item_5 = ListItem(List=draw_9, Index=0, Wrap=True)  # -> Item, Item1
branch_12 = TreeBranch(Tree=draw_8, Path=item_2, MaintainPaths=True)
branch_13 = TreeBranch(Tree=py3_7.txts, Path=item_2, MaintainPaths=True)
preview_3 = CustomPreview(Geometry=item_5.Item, Material=ColourSwatch(SwatchColor=RGB(189, 88, 0)))
preview_4 = CustomPreview(Geometry=item_5.Item1, Material=ColourSwatch(SwatchColor=RGB(84, 84, 84)))
tag_2 = TextTag3D(Location=branch_12, Text=branch_13, Size=Slider(0.123, range=0..1), Justification=7)
branch_14 = TreeBranch(Tree=simplify(draw_14), Path=Slider(0, range=0..1), MaintainPaths=True)
preview_5 = CustomPreview(
    Geometry=branch_14,
    Material={diffuse=RGB(221, 160, 221), emission=RGB(66, 48, 66), shine=0.5, specular=RGB(255, 255, 255), transparency=0})

# ----
# Write to json
number_slider_3 = Slider(1, range=1..10)
py3_8 = Python3Script(models=py3_4.models, version=number_slider_3, save=Button())  # inputs models: list, version: Int32
# ---------- py3_8: Python ----------
import os, sys, importlib
from datetime import date

from compas.data import json_dump

gh_dir = os.path.dirname(ghenv.Component.OnPingDocument().FilePath)
gh_par = os.path.dirname(gh_dir)
file_path = os.path.join(gh_par, "timber_design", "data")

today = date.today().strftime("%y%m%d")
print(today)



if save:
    serializable = []
    for m in models:
        serializable.append({
            "attributes": dict(m.attributes),
            "model": m
        })
        
    output_path = os.path.join(file_path, f"{today}_v{version}_timber_models.json")
    dump = json_dump(serializable, output_path, pretty=False)
    print(f"Model written to {output_path}")


# serializable = []
# for m in models:
#     serializable.append({
#         "attributes": dict(m.attributes),
#         "model": m
#     })
# print (serializable)
# ---------- end py3_8 ----------

# ==== cluster Cluster
P = ClusterInput()
num = ClusterInput()
deplane = DeconstructPlane(Plane=P)  # -> Origin, XAxis, YAxis, ZAxis
num_2 = Number(num)
entwine = Entwine(Branch00=deplane.XAxis, Branch01=deplane.YAxis, Branch02=deplane.ZAxis, FlattenInputs=True)
multiplication = Multiplication(A=entwine, B=num_2)
merge = Merge(
    Data1=ColourSwatch(SwatchColor=RGB(255, 0, 0)),
    Data2=ColourSwatch(SwatchColor=RGB(0, 255, 0)),
    Data3=ColourSwatch(SwatchColor=RGB(0, 0, 255)))  # -> graft(Result)
vdisex = VectorDisplayEx(Point=deplane.Origin, Vector=multiplication, Colour=merge, Width=2)
