# Grasshopper definition import_line_model.ghx (Grasshopper 1.0.8)

py3 = Python3Script()  # -> out, line_model
# ---------- py3: Python ----------
from compas.data import json_load

import os, sys, importlib

gh_dir = os.path.dirname(ghenv.Component.OnPingDocument().FilePath)
gh_par = os.path.dirname(gh_dir)
file_path = os.path.join(gh_par, "line_model","data", "shifted_lines.json")
print(file_path)

line_model = json_load(file_path)
# ---------- end py3 ----------
data = Data([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])

# ----
# lines for compas_timber from graph
py3_2 = Python3Script(graph=py3.line_model)  # -> out, a, b, c, d
# ---------- py3_2: Python ----------
from compas.geometry import Line, Point
from copy import deepcopy

ng = deepcopy(graph)

primary_shifted = []
secondary_shifted = []
tertiary_shifted = []

for e in ng.edges():
    h = ng.edge_attribute(e, "hierarchy")      # classification
    ln = ng.edge_attribute(e, "shifted_line")  # shifted geometry
    if ln is None:
        continue

    if h == "primary":
        primary_shifted.append(ln)
    elif h == "main_primary":
        primary_shifted.append(ln)
    elif h == "secondary":
        secondary_shifted.append(ln)
    elif h == "tertiary":
        tertiary_shifted.append(ln)

a = primary_shifted
b = secondary_shifted
c = tertiary_shifted
# ---------- end py3_2 ----------
draw = COMPASDraw(cg=py3_2.b)  # -> rg
#   port cg: The COMPAS geometry or datastructure to be drawn.
#   port rg: The Rhino geometry object.
# ---------- draw: Python ----------
# r: compas>=2.14.1
"""
Draws COMPAS geometry in Grasshopper.
"""

from typing import Any

import Grasshopper

from compas.scene import SceneObject


class CompasToRhinoGeometry(Grasshopper.Kernel.GH_ScriptInstance):
    def RunScript(self, cg):
        if not cg:
            return None

        return SceneObject(item=cg).draw()
# ---------- end draw ----------
draw_2 = COMPASDraw(cg=py3_2.a)  # -> rg; same code as draw
draw_3 = COMPASDraw(cg=py3_2.c)  # -> rg; same code as draw

draw_4 = COMPASDraw(cg=py3_2.d)  # -> rg; same code as draw
line = Line([Line((1.611417203, -0.9114564587, 4), (2.188582797, 0.5314575268, 4)), Line((2.188582797, -0.9114564587, 4), (1.611417203, 0.5314575268, 4)), Line((2.411417203, -0.9114564587, 4), (2.988582797, 0.5314575268, 4)), Line((2.988582797, -0.9114564587, 4), (2.411417203, 0.5314575268, 4)), Line((3.211417203, -0.9114564587, 4), (3.788582797, 0.5314575268, 4)), Line((3.788582797, -0.9114564587, 4), (3.211417203, 0.5314575268, 4))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])
py3_3 = Python3Script(lines=line)  # -> out, compas_lines; inputs lines: list of Line
# ---------- py3_3: Python ----------
from compas_rhino.conversions import line_to_compas

compas_lines = []
for l in lines:
    compas_lines.append(line_to_compas(l))
# ---------- end py3_3 ----------
multiplication = Multiplication(B=Slider(1, range=0..1000))
number_slider = Slider(0, range=0..3)
path = FilePath("/Users/minghip/Desktop/")

relay = Relay()
deconstruct_brep = DeconstructBrep(Brep=data)  # -> Faces, Edges, Vertices
join_curves = JoinCurves(Curves=deconstruct_brep.Edges, Preserve=False)  # -> flatten(Curves)
curve = Curve(join_curves)
offset = OffsetCurve(Curve=curve, Distance=Slider(0, range=0..1), Corners=1)
unit_z = UnitZ(Factor="0.05")

# ---- group: boxes
python_3_script = Python3Script(x=flatten(curve), y=flatten(offset))  # -> out, boxes, x_sorted, y_sorted, c_pts; inputs x: list of Curve, y: list of Curve
# ---------- python_3_script: Python ----------
from compas.geometry import bounding_box, Box
from compas_rhino.conversions import curve_to_compas_polyline

def curve_xy_key(curve):
    c = curve_to_compas_polyline(curve)
    pts = c.points
    bb = bounding_box(pts)

    # center of bounding box
    cx = (bb[0][0] + bb[6][0]) * 0.5
    cy = (bb[0][1] + bb[6][1]) * 0.5

    # return (cx, cy)
    return (round(cy, 3), cx)

# sort first
x_sorted = sorted(x, key=curve_xy_key)
y_sorted = sorted(y, key=curve_xy_key)

boxes = []
for curve in y_sorted:
    c = curve_to_compas_polyline(curve)
    points = c.points
    a = Box.from_bounding_box(bounding_box(points))
    a.zsize = 20.0
    boxes.append(a)

c_pts = [b.frame.point for b in boxes]
print(boxes)
# ---------- end python_3_script ----------

# ----
move = Move(Geometry=python_3_script.x_sorted, Motion=unit_z)  # -> Geometry, Transform
draw_5 = COMPASDraw(cg=python_3_script.c_pts)  # -> rg; same code as draw
point_list = PointList(Points=draw_5, Size=Slider(1, range=0..10))

timber_model = Python3Script(
    shoes=line,
    line_graph=py3.line_model,
    boxes=python_3_script.boxes,
    clt_plates=move.Geometry,
    max_distance=multiplication)  # -> out, a, b, c, d, e, processed_models, base_model; inputs shoes: list of Line, boxes: list, clt_plates: list of Polyline, max_distance: Double
# ---------- timber_model: Python ----------
from compas.scene import Scene
from compas_rhino.conversions import line_to_compas, polyline_to_compas, plane_to_compas
from compas.tolerance import Tolerance, TOL

from compas_timber.model import TimberModel
from compas_timber.elements import Beam, Plate
from compas_timber.analyzers import TripletAnalyzer

from compas_timber.connections import JointTopology
from compas_timber.connections import TMultiStepJoint
from compas_timber.connections import TStepJoint
from compas_timber.connections import LMiterJoint
from compas_timber.connections import TBirdsmouthJoint
from compas_timber.connections import XLapJoint
from compas_timber.connections import KBirdsmouthJoint

from compas_timber.fabrication import JackRafterCut

from compas.geometry import Frame, Vector, Point, angle_vectors, centroid_points, Line, intersection_segment_plane

#initialise scene object
scene = Scene()

# #initialise base compas timber model
# base_model = TimberModel(Tolerance(unit="MM", absolute="0.001"))

# ============================================================
# Helper: make polygon point order consistent with world Z+
# ============================================================
def oriented_polyline_to_world_z_plus(compas_poly):
    pts = list(compas_poly.points)

    if len(pts) < 3:
        return compas_poly, Vector(0, 0, 1)

    # remove duplicate last point if closed
    if pts[0] == pts[-1]:
        pts = pts[:-1]

    if len(pts) < 3:
        return compas_poly, Vector(0, 0, 1)

    p0 = pts[0]
    p1 = pts[1]
    p2 = pts[2]

    frame = Frame.from_points(p0, p1, p2)
    local_z = frame.zaxis
    world_z = Vector(0, 0, 1)

    # if normal points downward, reverse point order
    if local_z.dot(world_z) < 0:
        pts.reverse()

        # close it again if original was closed
        pts.append(pts[0])

        compas_poly = type(compas_poly)(pts)

        p0 = compas_poly.points[0]
        p1 = compas_poly.points[1]
        p2 = compas_poly.points[2]

        frame = Frame.from_points(p0, p1, p2)
        local_z = frame.zaxis

    return compas_poly, local_z

# ============================================================
# Create CLT Plates
# ============================================================

plates = []
models = []

# for c in clt_plates:
#     compas_poly = polyline_to_compas(c)
#     if compas_poly is None:
#         continue
#     center = centroid_points(compas_poly.points)    
#     for b in boxes:
#         model = TimberModel(Tolerance(unit="MM", absolute="0.001"))
#         if b.contains_point(center):
#             compas_poly, local_z = oriented_polyline_to_world_z_plus(compas_poly)

#             plate = Plate.from_outline_thickness(
#                 compas_poly,
#                 thickness=0.1,
#                 vector=local_z
#             )

#             plates.append(plate)
#             model.add_element(plate)
#             base_model.add_element(plate)
#             models.append(model)

# ============================================================
# Input Beams
# ============================================================

beams = []
cutting_frames = []
for plane in footing_plane:
    cutting_frames.append(plane)

#convert rhino curves into compas lines
"""to be replaced with graph input"""

from copy import deepcopy

ng = deepcopy(line_graph)

for edge in ng.edges():
    h = ng.edge_attribute(edge,"hierarchy") #primary, secondary, tertiary
    l = ng.edge_attribute(edge,"level") #0,1,2... top to bottom 
    g = ng.edge_attribute(edge, "group") #quadrant 0,1,2,3 clockwise

    """set width and height based on attributes"""

    if h == "primary" and l != 0:
        ln_width = 0.100
        ln_height = 0.160
    elif h == "primary" or h == "secondary":
        ln_width = 0.100
        ln_height = 0.120
    elif h == "tertiary":
        ln_width = 0.100
        ln_height = 0.120

    ln = ng.edge_attribute(edge, "shifted_line")
    
    if ln is None:
        continue
    
    # for b, m in zip (boxes, models):
    #     if b.contains_point(ln.start) or b.contains_point(ln.end):
    #         ln.name = h
    #         beam = Beam.from_centerline(ln,width=ln_width, height=ln_height)
    #         beam.name = ln.name
    #         beams.append(beam)
    #         m.add_element(beam)
    #         base_model.add_element(beam)
    #         break



#temporary add shoe
for shoe in shoes:
    shoe_line = line_to_compas(shoe)
    for b, m in zip (boxes, models):
        if b.contains_point(shoe_line.start) or b.contains_point(shoe_line.end):
            beam = Beam.from_centerline(shoe_line, width=0.1, height=0.1)
            beam.name = "shoe"
            beams.append(beam)
            m.add_element(beam)
            base_model.add_element(beam)

# ============================================================
# Process Jointery
# ============================================================

#planarity check
def is_planar(element_a, element_b):
    frames_a = []
    frames_b = []
    planarity_check = []
    frame_a = element_a.frame
    frame_a.xaxis = Vector(0,0,1)
    frames_a.append(frame_a)

    frame_b = element_b.frame
    frame_b.xaxis = Vector(0, 0, 1)

    planarity = angle_vectors(frame_a.normal, frame_b.normal, deg = True)
    planarity_check.append(planarity)

    is_planar = bool
    if planarity < 0.2 or planarity > 178.2:
        is_planar = True
    else:
        is_planar = False
    return(is_planar)

distances = []

#reset beams and features
for model in models:
    for beam in model.beams:
        beam.remove_features()

    #compute line network
    base_model.connect_adjacent_beams(max_distance)
    model.connect_adjacent_beams(max_distance)

    for c in model.joint_candidates:
        distances.append(c.distance)

    # #handle non-pair joints (in this case a 3-way connection using TripletAnalyzer)
    # analyzer = TripletAnalyzer(model, max(distances)/2)
    # clusters = analyzer.find()

    # for cluster in clusters:
    #     if cluster.topology == JointTopology.TOPO_K:
    #         reordered_elements = [e for e in cluster.elements if h == "primary"]
    #         print (len(reordered_elements))
    #         reordered_elements += [e for e in cluster.elements if e not in reordered_elements]
    #         kbj = KBirdsmouthJoint.promote_cluster(model, cluster[0], reordered_elements=reordered_elements, mill_depth=.040)

    #debugging tools
    candidates_a = []
    candidates_b = []
    frames_a = []
    frames_b = []
    planarity_check = []

    #set joint conditions
    for candidate in model.joint_candidates:
        if candidate.is_promoted == False:
            #check for mid_point = above certain z_height
            a_is_shoe = bool
            b_is_shoe = bool
            ceiling_height = 3.9

            height_a = candidate.element_a.centerline.midpoint.z
            if height_a > ceiling_height:
                a_is_shoe = True
            else:
                a_is_shoe = False
                
            height_b = candidate.element_b.centerline.midpoint.z
            if height_b > ceiling_height:
                b_is_shoe = True
            else:
                b_is_shoe = False

            #joints based on topology, planarity and z height
            if candidate.topology == JointTopology.TOPO_T and is_planar(candidate.element_a, candidate.element_b) == True:
                if b_is_shoe == True:
                    t_step_joint = TMultiStepJoint.create(model, candidate.element_a, candidate.element_b, step_count=2)
                
                else:
                    if angle_vectors(candidate.element_a.centerline.direction, candidate.element_b.centerline.direction, deg=True) < 50:
                        step_shape = "heel"
                    else:
                        step_shape = "step"
                    
                    print (candidate.element_a.centerline.name)
                    t_step_joint = TMultiStepJoint.create(model, candidate.element_a, candidate.element_b, step_shape=step_shape, step_depth=.02, riser_angle=90)
            
            elif candidate.topology == JointTopology.TOPO_T and is_planar(candidate.element_a, candidate.element_b) == False:
                t_bm_joint = TBirdsmouthJoint.create(model, candidate.element_a, candidate.element_b)
                # t_np_step_joint = TMultiStepJoint.create(model, candidate.element_a, candidate.element_b, do_refine_cut=True, step_depth = 0.02, riser_angle=90)
            elif candidate.topology==JointTopology.TOPO_L:
                mp = Frame.worldYZ
                # miter_plane = ??
                l_miter_joint = LMiterJoint.create(model, candidate.element_a, candidate.element_b, cutoff = False)

            elif candidate.topology == JointTopology.TOPO_X:
                x_lap_joint = XLapJoint.create(model, candidate.element_a, candidate.element_b)

            else:
                continue
    
    # #add features to beams
    # for beam in model.beams:
    #     if beam.name == "primary":
    #         for plane in cutting_frames:
    #             intersection = intersection_segment_plane(b.centerline, plane, tol=None)
    #             if intersection is not None:
    #                 jackrafter = JackRafterCut.from_plane_and_beam(plane, b, ref_side_indes =3)
    #         # jackrafter = JackRafterCut.from_plane_and_beam(plane_cut, b, ref_side_indes =5)
    #             b.add_feature(jackrafter)


    # drill_line = line_to_compas(drill_line)
    # for i, beam in enumerate(model.beams):
    #     if i == 0:
    #         drill_feature = Drilling.from_line_and_element(drill_line, beam, diameter=10)
    #         beam.add_features(drill_feature)
    #         scene.add(beam.geometry)

    #process joints in compas timber model
    model.process_joinery()

processed_models = []

for m in models:
    processed_models.append(m)

    #visualise geometries
    for beam in (m.beams):
        scene.add(beam.geometry)
    
    for plate in (m.plates):
        scene.add(plate.geometry)
    print ("ADDED")

a = scene.draw()
# ---------- end timber_model ----------
panel = Panel(timber_model.base_model)
panel_2 = Panel(timber_model.processed_models)
compas_draw = COMPASDraw(cg=timber_model.b)  # -> rg; same code as draw
compas_draw_2 = COMPASDraw(cg=timber_model.d)  # -> rg; same code as draw
compas_draw_3 = COMPASDraw(cg=timber_model.c)  # -> rg; same code as draw
compas_draw_4 = COMPASDraw(cg=timber_model.e)  # -> rg; same code as draw
list_item = ListItem(List=timber_model.processed_models, Index=0, Wrap=True)
geometry = Geometry(timber_model.a)
displayjointnames = Python3Script(model=list_item)
# ---------- displayjointnames: Python ----------
import Grasshopper
import System

from compas_rhino.conversions import point_to_rhino

from compas_timber.utils import intersection_line_line_param

class ShowJointTypes(Grasshopper.Kernel.GH_ScriptInstance):
    def RunScript(self, model):
        self.pt = []
        self.txt = []

        for joint in model.joints:
            line_a, line_b = joint.elements[0].centerline, joint.elements[1].centerline
            [p1, _], [p2, _] = intersection_line_line_param(line_a, line_b, float("inf"), False, 1e-3)
            p1 = point_to_rhino(p1)
            p2 = point_to_rhino(p2)
            
            self.pt.append((p2 + p1)/2)
            self.txt.append(joint.__class__.__name__)
    
    def DrawViewportWires(self, arg):
        if ghenv.Component.Locked:
            return
        col = System.Drawing.Color.FromArgb(255, 0, 0, 0)
        # https://developer.rhino3d.com/api/RhinoCommon/html/M_Rhino_Display_DisplayPipeline_Draw2dText_5.htm
        for p, t in zip(self.pt, self.txt):
            arg.Display.Draw2dText(t, col, p, True, 25, "Verdana")
# ---------- end displayjointnames ----------
item = ListItem(List=timber_model.processed_models, Index="0", Wrap=True)
panel_3 = Panel(item)

# ---- group: json_dump of n modules
py3_4 = Python3Script(x=item, save=Button(), file_path=path)  # -> out, a; inputs x: list
# ---------- py3_4: Python ----------
import os
from compas.data import json_dump

if save:
    for i, m in enumerate(x):
        """Serialize models to .JSON"""
        output_path = os.path.join(file_path, f"timber_model_{i}.json")
        m.to_json(output_path, pretty=True)
        print(f"Model written to {output_path}")
# ---------- end py3_4 ----------

# ---- group: visualize modules based on index
py3_5 = Python3Script(x=item, y=number_slider)  # -> out, a; inputs x: list, y: Int32
# ---------- py3_5: Python ----------
from compas.scene import Scene
from compas_rhino.conversions import line_to_compas
from compas.tolerance import Tolerance, TOL

from compas_timber.model import TimberModel
from compas_timber.elements import Beam, Plate

from compas_timber.connections import JointTopology
from compas_timber.connections import TMultiStepJoint
from compas_timber.connections import TStepJoint
from compas_timber.connections import LMiterJoint
from compas_timber.connections import TBirdsmouthJoint
from compas_timber.connections import XLapJoint

from compas_rhino.conversions import line_to_compas, polyline_to_compas

from compas.geometry import Frame, Vector, Point, angle_vectors, centroid_points

from statistics import mean


scene = Scene()
# for m in x:
# model = x[y]
for beam in (x[y].beams):
    if not beam.attributes["neighbour"]:
        scene.add(beam.geometry)

for plate in (x[y].plates):
    scene.add(plate.geometry)
a = scene.draw()
# ---------- end py3_5 ----------

# ---- group: visualize neighbour beams based on module index
py3_6 = Python3Script(x=item, y=number_slider)  # -> out, a; inputs x: list, y: Int32
# ---------- py3_6: Python ----------
from compas.scene import Scene
from compas_rhino.conversions import line_to_compas
from compas.tolerance import Tolerance, TOL

from compas_timber.model import TimberModel
from compas_timber.elements import Beam, Plate

from compas_timber.connections import JointTopology
from compas_timber.connections import TMultiStepJoint
from compas_timber.connections import TStepJoint
from compas_timber.connections import LMiterJoint
from compas_timber.connections import TBirdsmouthJoint
from compas_timber.connections import XLapJoint

from compas_rhino.conversions import line_to_compas, polyline_to_compas

from compas.geometry import Frame, Vector, Point, angle_vectors, centroid_points

from statistics import mean


scene = Scene()
# for m in x:
# model = x[y]
for beam in (x[y].beams):
    if beam.attributes["neighbour"]:
        scene.add(beam.geometry)
a = scene.draw()
# ---------- end py3_6 ----------
