# Grasshopper definition middle_prototype_tm.ghx (Grasshopper 1.0.8)

py3 = Python3Script()  # -> out, line_model
# ---------- py3: Python ----------
from compas.data import json_load
import os, sys, importlib

gh_dir = os.path.dirname(ghenv.Component.OnPingDocument().FilePath)
gh_par = os.path.dirname(gh_dir)

line_path = os.path.join(gh_par, 'line_model')
json_path = os.path.join(
    gh_par, 'line_model', 'data', '260519_v1_line_model.json'
)

if line_path not in sys.path:
    sys.path.insert(0, line_path)

import nodegraph
importlib.reload(nodegraph)
from nodegraph import NodeGraph


line_model = json_load(json_path)

print (type(line_model))
# ---------- end py3 ----------
py3_2 = Python3Script(graph=py3.line_model)  # -> out, models
# ---------- py3_2: Python ----------
import os, sys, importlib

gh_dir = os.path.dirname(ghenv.Component.OnPingDocument().FilePath)

parent = os.path.dirname(gh_dir)              # go up one level
src_dir = os.path.join(parent, "src")         # go into src folder
if src_dir not in sys.path:
    sys.path.insert(0, src_dir)

print (gh_dir)
print (parent)
print (src_dir)


#######---------Imports------------##########
import timber_config
importlib.reload(timber_config)

import timber_model
importlib.reload(timber_model)
from timber_model import graph_to_timber_models


########----------Main Code-----------_###########
models = graph_to_timber_models(graph, align_shoe=False)

print (list(m.attributes['group'] for m in models))


models.sort(key=lambda m: m.attributes['group'])

print (list(m.attributes['group'] for m in models))
# ---------- end py3_2 ----------
list_item = ListItem(List=py3_2.models, Index=0, Wrap=True)
python_3_script = Python3Script(x=list_item)  # -> out, a
# ---------- python_3_script: Python ----------
from compas_timber.elements import Beam
from compas_timber.model import TimberModel
from compas_rhino.conversions import plane_to_rhino

a = []

# for beam in x.beams:
#     if beam.attributes["has_middle_joint"]:
#         a.append(beam.centerline)

# a = x.attributes.get('clt_plate').geometry
a = plane_to_rhino(x.attributes.get("cut_plane"))
# ---------- end python_3_script ----------
compas_draw = COMPASDraw(cg=python_3_script.a)  # -> rg
#   port cg: The COMPAS geometry or datastructure to be drawn.
#   port rg: The Rhino geometry object.
# ---------- compas_draw: Python ----------
# r: compas>=2.14.1
"""
Draws COMPAS geometry in Grasshopper.
"""

from typing import Any

import Grasshopper

from compas.scene import SceneObject


class CompasToRhinoGeometry(Grasshopper.Kernel.GH_ScriptInstance):
    def RunScript(self, cg):
        if not cg:
            return None

        return SceneObject(item=cg).draw()
# ---------- end compas_draw ----------
panel = Panel("""0.06
0.08""")
unit_z = UnitZ(Factor=Slider(1.7, range=0..10))
panel_2 = Panel("""0
1""")
panel_3 = Panel("""0,0
0,1
0,2
0,3""")
file_path = FilePath("/Users/minghip/Desktop/")

# ---- group: Middle Node Prototype
curve = Curve([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])
curve_2 = Curve(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)
curve_3 = Curve([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])
curve_4 = Curve([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])
plane = Plane(Plane(origin=(0.15, 1.86, 0.23), x=(-1, 0, 0), y=(0, 1, 0)))

# ----
move = Move(Geometry=plane, Motion=unit_z)  # -> Geometry, Transform

# ---- group: Middle Node Prototype (continued)
python_3_script_2 = Python3Script(stock=panel, shoe=curve_4, primary_0=curve, primary_1=curve_3, clt_plate=curve_2, cut_plane=move.Geometry)  # -> out, timber_model, clt_plate; inputs stock: list of Double, shoe: list of Line, primary_0: list of Line, primary_1: list of Line, clt_plate: Polyline, cut_plane: Plane
# ---------- python_3_script_2: Python ----------
from compas_timber.model import TimberModel
from compas_timber.elements import Beam, Plate
from compas_timber.utils import get_polyline_normal_vector
from compas.tolerance import Tolerance
from compas_rhino.conversions import line_to_compas, plane_to_compas, polyline_to_compas
from compas.geometry import Polyline, Translation, Vector
# --------------------------------------
# Dimensions
# --------------------------------------

stock_1_width = stock[0]
stock_1_height = stock[1]

if len(stock) > 2:
    stock_2_width = stock[2]
    stock_2_height = stock[3]

# --------------------------------------
# Helpers
# --------------------------------------

def create_add_beams(model, lines, w, h, hierarchy, is_mid=True, reached = False, level=0):
    beams = []
    for line in lines:
        centerline = line_to_compas(line)
        beam = Beam.from_centerline(centerline, w, h)
        beam.name = hierarchy
        beam.attributes = {
            'hierarchy': hierarchy,
            'has_middle_joint': is_mid,
            'reached': reached,
            'level': level,
        }
        beams.append(beam)
    model.add_elements(beams)

def orientate_plane_negative(plane):
    if plane.normal.z > 0:
        plane.normal = -plane.normal
    return plane

# --------------------------------------
# Build Model
# --------------------------------------

timber_model = TimberModel(Tolerance(unit="M", absolute= 0.01))

#beams
create_add_beams(timber_model, shoe, stock_1_width, stock_1_height, "shoe", is_mid = True, reached = False, level = 0)
create_add_beams(timber_model, primary_0, stock_1_width, stock_1_height, "primary", is_mid = True, reached = False, level = 0)
create_add_beams(timber_model, primary_1, stock_1_width, stock_1_height, "primary", is_mid = True, reached = True, level = 1)

#plate
clt_polyline = polyline_to_compas(clt_plate)
clt_polyline.transform(Translation.from_vector(Vector(0,0,0.01)))
vector = get_polyline_normal_vector(clt_polyline)
if vector.z < 0:
    vector = -vector
plate = Plate.from_outline_thickness(clt_polyline, 0.1, vector)
timber_model.add_element(plate)
timber_model.attributes['clt_plate'] = plate

clt_plate = plate.geometry

#plane
c_plane = plane_to_compas(cut_plane)
c_plane = orientate_plane_negative(c_plane)
timber_model.attributes['cut_plane'] = c_plane
timber_model = timber_model
# ---------- end python_3_script_2 ----------

# ----
panel_4 = Panel(python_3_script_2.timber_model)
compas_draw_2 = COMPASDraw(cg=python_3_script_2.clt_plate)  # -> rg; same code as compas_draw
py3_3 = Python3Script(models=python_3_script_2.timber_model)  # -> out, models, planes, beams; inputs models: list
# ---------- py3_3: Python ----------
import os, sys, importlib

gh_dir = os.path.dirname(ghenv.Component.OnPingDocument().FilePath)

parent = os.path.dirname(gh_dir)              # go up one level
src_dir = os.path.join(parent, "src")         # go into src folder
if src_dir not in sys.path:
    sys.path.insert(0, src_dir)

import timber_config
importlib.reload(timber_config)

import timber_model
importlib.reload(timber_model)
from timber_model import apply_joints,apply_joints_middle_prototype

from copy import deepcopy

models = deepcopy(models)

for model in models:
    a, planes, debug = apply_joints_middle_prototype(model)

# beams = [b.geometry for b in beams]
print (debug)
# ---------- end py3_3 ----------
panel_5 = Panel(py3_3.models)
compas_draw_3 = COMPASDraw(cg=py3_3.beams)  # -> rg; same code as compas_draw
compas_draw_4 = COMPASDraw(cg=py3_3.planes)  # -> rg; same code as compas_draw
tree_branch = TreeBranch(Tree=compas_draw_4, Path=panel_3, MaintainPaths=True)
py3_4 = Python3Script(models=py3_3.models, process=Toggle(True))  # -> out, models, debug; inputs models: list, process: Boolean
# ---------- py3_4: Python ----------
import os, sys, importlib

gh_dir = os.path.dirname(ghenv.Component.OnPingDocument().FilePath)

parent = os.path.dirname(gh_dir)              # go up one level
src_dir = os.path.join(parent, "src")         # go into src folder
if src_dir not in sys.path:
    sys.path.insert(0, src_dir)

import timber_config
importlib.reload(timber_config)

import timber_model
importlib.reload(timber_model)
from timber_model import apply_processings,apply_processings_middle_prototype

from copy import deepcopy

models = deepcopy(models)

if process:
    for model in models:
        model.process_joinery()
        model, debug = apply_processings_middle_prototype(model)

print (debug)
# ---------- end py3_4 ----------
list_item_2 = ListItem(List=compas_draw_3, Index=panel_2, Wrap=True)

# ----
# Preview
python_3_script_3 = Python3Script(models=py3_4.models)  # -> out, geos, colors, cut_planes, models; inputs models: list
# ---------- python_3_script_3: Python ----------
import rhinoscriptsyntax as rs
import scriptcontext as sc
import Rhino.Display as rd
import System.Drawing as sd

from compas.scene import Scene
from compas.geometry import Line, Point
from copy import deepcopy


COLORS = {
    "primary":      sd.Color.FromArgb(100, 220,  50,  50),
    "main_primary": sd.Color.FromArgb(100, 150,  80, 220),
    "secondary":    sd.Color.FromArgb(100,  50, 150, 220),
    "tertiary":     sd.Color.FromArgb(100,  80, 200, 100),
    "shoe":         sd.Color.FromArgb(25,  20, 150, 100),
    "plate":        sd.Color.FromArgb(100,  100, 100, 100)
}


geos = []
colors = []
cut_planes = []

for model in models:
    # for plate in model.plates:
    #     geos.append(plate.geometry)
    #     colors.append(COLORS['plate'])

    for beam in model.beams:
        # if beam.attributes['hierarchy'] != 'shoe':
            hie = beam.attributes.get('hierarchy')

            geos.append(beam.geometry)
            colors.append(COLORS[hie])

    cut_planes.append(model.attributes['cut_plane'])
# ---------- end python_3_script_3 ----------
compas_draw_5 = COMPASDraw(cg=python_3_script_3.geos)  # -> rg; same code as compas_draw
compas_draw_6 = COMPASDraw(cg=python_3_script_3.cut_planes)  # -> rg; same code as compas_draw
preview = CustomPreview(Geometry=compas_draw_5, Material=python_3_script_3.colors)

py3_5 = Python3Script(models=py3_4.models, save=Button(), set_file_path=file_path)  # inputs models: list
# ---------- py3_5: Python ----------
import os, sys, importlib
from compas.data import json_dump
from compas_timber.fabrication import BTLxWriter

writer = BTLxWriter()

gh_dir = os.path.dirname(ghenv.Component.OnPingDocument().FilePath)
gh_par = os.path.dirname(gh_dir)
file_path = os.path.join(gh_par, "timber_design","data")

if set_file_path:
    file_path = set_file_path

if save:
    for i, model in enumerate(models):
        """Serialize models to .JSON"""
        output_path_json = os.path.join(file_path, f"1805_timber_model_{i}.json")
        output_path_btlx = os.path.join(file_path, f"1805_timber_model_{i}.btlx")
        writer.write(model, file_path=output_path_btlx)
        model.to_json(output_path_json, pretty=True)
# ---------- end py3_5 ----------
