# Grasshopper definition import_line_model.ghx (Grasshopper 1.0.8)

py3 = Python3Script()  # -> out, line_model
# ---------- py3: Python ----------
from compas.data import json_load

import os, sys, importlib

gh_dir = os.path.dirname(ghenv.Component.OnPingDocument().FilePath)
gh_par = os.path.dirname(gh_dir)
file_path = os.path.join(gh_par, "line_model","data", "shifted_lines.json")
print(file_path)

line_model = json_load(file_path)
# ---------- end py3 ----------
py3_2 = Python3Script(export=Button())  # -> out, a; inputs export: Boolean
# ---------- py3_2: Python ----------
from compas.data import json_dump

import os, sys, importlib

gh_dir = os.path.dirname(ghenv.Component.OnPingDocument().FilePath)
if gh_dir not in sys.path:
    sys.path.insert(0, gh_dir)

file_path = os.path.join(gh_dir, "data", "shifted_lines.json")
print(file_path)
if export:
    json_dump(graph, file_path, pretty = True)
# ---------- end py3_2 ----------

# ----
# lines for compas_timber from graph
py3_3 = Python3Script(graph=py3.line_model)  # -> out, a, b, c, d
# ---------- py3_3: Python ----------
from compas.geometry import Line, Point
from copy import deepcopy

ng = deepcopy(graph)

primary_shifted = []
main_primary_shifted = []
secondary_shifted = []
tertiary_shifted = []

for e in ng.edges():
    h = ng.edge_attribute(e, "hierarchy")      # classification
    ln = ng.edge_attribute(e, "shifted_line")  # shifted geometry
    if ln is None:
        continue

    if h == "primary":
        primary_shifted.append(ln)
    elif h == "primary":
        main_primary_shifted.append(ln)
    elif h == "secondary":
        secondary_shifted.append(ln)
    elif h == "tertiary":
        tertiary_shifted.append(ln)

a = primary_shifted
b = secondary_shifted
c = tertiary_shifted
# ---------- end py3_3 ----------
draw = COMPASDraw(cg=py3_3.b)  # -> rg
#   port cg: The COMPAS geometry or datastructure to be drawn.
#   port rg: The Rhino geometry object.
# ---------- draw: Python ----------
# r: compas>=2.14.1
"""
Draws COMPAS geometry in Grasshopper.
"""

from typing import Any

import Grasshopper

from compas.scene import SceneObject


class CompasToRhinoGeometry(Grasshopper.Kernel.GH_ScriptInstance):
    def RunScript(self, cg):
        if not cg:
            return None

        return SceneObject(item=cg).draw()
# ---------- end draw ----------
draw_2 = COMPASDraw(cg=py3_3.a)  # -> rg; same code as draw
draw_3 = COMPASDraw(cg=py3_3.c)  # -> rg; same code as draw

draw_4 = COMPASDraw(cg=py3_3.d)  # -> rg; same code as draw
