# Grasshopper definition middle_prototype_tm.ghx (Grasshopper 1.0.8)
# plug-ins: Human

py3 = Python3Script()  # -> out, line_model
# ---------- py3: Python ----------
from compas.data import json_load

import os, sys, importlib

gh_dir = os.path.dirname(ghenv.Component.OnPingDocument().FilePath)
gh_par = os.path.dirname(gh_dir)
file_path = os.path.join(gh_par, "line_model", "data", "260513_v6_shifted_lines.json")

print(file_path)

line_model = json_load(file_path)
# ---------- end py3 ----------
panel = Panel("""0.06
0.08""")
unit_z = UnitZ(Factor=Slider(0.2, range=0..1))

# ----
# Construct Timber Models
py3_2 = Python3Script(graph=py3.line_model)  # -> out, models
# ---------- py3_2: Python ----------
import os, sys, importlib

gh_dir = os.path.dirname(ghenv.Component.OnPingDocument().FilePath)

parent = os.path.dirname(gh_dir)              # go up one level
src_dir = os.path.join(parent, "src")         # go into src folder
if src_dir not in sys.path:
    sys.path.insert(0, src_dir)

print (gh_dir)
print (parent)
print (src_dir)


#######---------Imports------------##########
import timber_config
importlib.reload(timber_config)

import timber_model
importlib.reload(timber_model)
from timber_model import graph_to_timber_models


########----------Main Code-----------_###########
models = graph_to_timber_models(graph, align_shoe=False)

print (list(m.attributes['group'] for m in models))


models.sort(key=lambda m: m.attributes['group'])

print (list(m.attributes['group'] for m in models))
# ---------- end py3_2 ----------

# ----
# Apply Joints
list = ValueList({"Zero": 0, "One": 1, "Two": 2, "Three": 2² - 1}, selected=["Zero", "One", "Two", "Three"])
item = ListItem(List=py3_2.models, Index=list, Wrap=True)
py3_3 = Python3Script(models=item)  # -> out, models; inputs models: list
# ---------- py3_3: Python ----------
import os, sys, importlib

gh_dir = os.path.dirname(ghenv.Component.OnPingDocument().FilePath)

parent = os.path.dirname(gh_dir)              # go up one level
src_dir = os.path.join(parent, "src")         # go into src folder
if src_dir not in sys.path:
    sys.path.insert(0, src_dir)


import timber_config
importlib.reload(timber_config)

import timber_model
importlib.reload(timber_model)
from timber_model import apply_joints

from copy import deepcopy

models = deepcopy(models)


#
for model in models:
    apply_joints(model, debug=True)
# ---------- end py3_3 ----------

panel_2 = Panel(py3_3.out)

# ----
# Process joinery
toggle = BooleanToggle(False)
py3_4 = Python3Script(models=py3_3.models, process=toggle)  # -> out, models; inputs models: list, process: Boolean
# ---------- py3_4: Python ----------
import os, sys, importlib

gh_dir = os.path.dirname(ghenv.Component.OnPingDocument().FilePath)

parent = os.path.dirname(gh_dir)              # go up one level
src_dir = os.path.join(parent, "src")         # go into src folder
if src_dir not in sys.path:
    sys.path.insert(0, src_dir)

print (gh_dir)
print (parent)
print (src_dir)

import timber_config
importlib.reload(timber_config)

import timber_model
importlib.reload(timber_model)
from timber_model import apply_processings

from copy import deepcopy

models = deepcopy(models)


#
if process:
    for model in models:
        apply_processings(model)
# ---------- end py3_4 ----------

py3_5 = Python3Script(models=py3_3.models)  # -> out, models; inputs models: list
# ---------- py3_5: Python ----------
import os, sys, importlib

gh_dir = os.path.dirname(ghenv.Component.OnPingDocument().FilePath)

parent = os.path.dirname(gh_dir)              # go up one level
src_dir = os.path.join(parent, "src")         # go into src folder
if src_dir not in sys.path:
    sys.path.insert(0, src_dir)


import timber_config
importlib.reload(timber_config)

import timber_model
importlib.reload(timber_model)
from timber_model import apply_joints

from copy import deepcopy

models = deepcopy(models)


#
for model in models:
    # print (model)
    # print (model.attributes)
    pass
from compas.data import json_load


# timber_model = json_load(file_path)
results = json_load(os.path.join(parent, "timber_design", "data", f"260515_v1_timber_models.json"))

for data in results:
    model = data['model']
    attrs = data['attributes']
    print (model.attributes)

    model.attributes = attrs
    # print (model.attributes)
# ---------- end py3_5 ----------
file_path = FilePath("/Users/minghip/Desktop/")

# ----
# Preview
number_slider = Slider(154, range=0..255)
python_3_script = Python3Script(models=py3_4.models, alpha=number_slider)  # -> out, geos, colors, cut_planes, models; inputs models: list, alpha: Int32
# ---------- python_3_script: Python ----------
import rhinoscriptsyntax as rs
import scriptcontext as sc
import Rhino.Display as rd
import System.Drawing as sd

from compas.scene import Scene
from compas.geometry import Line, Point
from copy import deepcopy


COLORS = {
    "primary":      sd.Color.FromArgb(alpha, 220,  50,  50),
    "main_primary": sd.Color.FromArgb(alpha, 150,  80, 220),
    "secondary":    sd.Color.FromArgb(alpha,  50, 150, 220),
    "tertiary":     sd.Color.FromArgb(alpha,  80, 200, 100),
    "shoe":         sd.Color.FromArgb(alpha,  20, 150, 100),
    "plate":        sd.Color.FromArgb(alpha, 100, 100, 100)
}


geos = []
colors = []
cut_planes = []

for model in models:
    for plate in model.plates:
        geos.append(plate.geometry)
        colors.append(COLORS['plate'])

    for beam in model.beams:
        hie = beam.attributes.get('hierarchy')

        geos.append(beam.geometry)
        colors.append(COLORS[hie])

    cut_planes.append(model.attributes['cut_plane'])
# ---------- end python_3_script ----------
compas_draw = COMPASDraw(cg=python_3_script.geos)  # -> rg
#   port cg: The COMPAS geometry or datastructure to be drawn.
#   port rg: The Rhino geometry object.
# ---------- compas_draw: Python ----------
# r: compas>=2.14.1
"""
Draws COMPAS geometry in Grasshopper.
"""

from typing import Any

import Grasshopper

from compas.scene import SceneObject


class CompasToRhinoGeometry(Grasshopper.Kernel.GH_ScriptInstance):
    def RunScript(self, cg):
        if not cg:
            return None

        return SceneObject(item=cg).draw()
# ---------- end compas_draw ----------
compas_draw_2 = COMPASDraw(cg=python_3_script.cut_planes)  # -> rg; same code as compas_draw
preview = CustomPreview(Geometry=compas_draw, Material=python_3_script.colors)
wires = BrepWireframe(Brep=compas_draw, Density=-1)
previewlw = CustomPreviewLineweights(Geometry=wires, Shader=ColourSwatch(SwatchColor=RGB(255, 255, 255)), Absolute=False)

py3_6 = Python3Script(models=py3_4.models)  # -> out, models, geo_tree, rh_pln_tree, flipped_geo_tree; inputs models: list; disabled
# ---------- py3_6: Python ----------
import os, sys, importlib

gh_dir = os.path.dirname(ghenv.Component.OnPingDocument().FilePath)

parent = os.path.dirname(gh_dir)              # go up one level
src_dir = os.path.join(parent, "src")         # go into src folder
if src_dir not in sys.path:
    sys.path.insert(0, src_dir)

print (gh_dir)
print (parent)
print (src_dir)

import timber_config
importlib.reload(timber_config)

import timber_model
importlib.reload(timber_model)
from timber_model import apply_joints


from Grasshopper import DataTree
from Grasshopper.Kernel.Data import GH_Path
from compas_rhino.conversions import frame_to_rhino_plane

from compas.geometry import Transformation, Frame

#
geo_tree = DataTree[object]()
rh_pln_tree = DataTree[object]()
flipped_geo_tree = DataTree[object]()

# Robot station location
to_frame = Frame.worldXY()

for model in models:
    g = model.attributes['group']
    path = GH_Path(g)
    
    # Get ONE clt plate for each module
    plate = model.attributes['clt_plate']

    # Get special frame for nesting
    from_frame = plate.attributes['negative_frame']
    O = Transformation.from_frame_to_frame(from_frame, to_frame)
    
    rh_pln_tree.Add(frame_to_rhino_plane(from_frame), path)

    geo = plate.geometry
    geo_tree.Add(geo, path)

    flipped_geo_tree.Add(geo.transformed(O), path)

    for beam in model.beams:
        geo = beam.geometry
        geo_tree.Add(geo, path)

        flipped_geo_tree.Add(geo.transformed(O), path)
# ---------- end py3_6 ----------
draw = COMPASDraw(cg=py3_6.geo_tree)  # -> rg; disabled; same code as compas_draw
draw_2 = COMPASDraw(cg=py3_6.flipped_geo_tree)  # -> rg; disabled; same code as compas_draw
pln = Plane(py3_6.rh_pln_tree)  # disabled
orient = Orient(Geometry=draw, Source=py3_6.rh_pln_tree, Target=PlaneXY(0, 0, 0))  # -> Geometry, Transform; disabled
geo = Geometry(draw_2)  # disabled
geo_2 = Geometry(orient.Geometry)  # disabled

py3_7 = Python3Script(models=py3_4.models, version=Slider(1, range=1..10), save=Button())  # inputs models: list, version: Int32
# ---------- py3_7: Python ----------
import os, sys, importlib
from datetime import date

from compas.data import json_dump

gh_dir = os.path.dirname(ghenv.Component.OnPingDocument().FilePath)
gh_par = os.path.dirname(gh_dir)
file_path = os.path.join(gh_par, "timber_design", "data")

today = date.today().strftime("%y%m%d")
print(today)



if save:
    serializable = []
    for m in models:
        serializable.append({
            "attributes": dict(m.attributes),
            "model": m
        })
        
    output_path = os.path.join(file_path, f"{today}_v{version}_timber_models.json")
    dump = json_dump(serializable, output_path, pretty=True)
    print(f"Model written to {output_path}")


# serializable = []
# for m in models:
#     serializable.append({
#         "attributes": dict(m.attributes),
#         "model": m
#     })
# print (serializable)
# ---------- end py3_7 ----------

# ---- group: Middle Node Prototype
curve = Curve([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])
curve_2 = Curve(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)
plane = Plane(Plane(origin=(2.799809662, 1.809560759, 1.7118025), x=(0, 1, 0), y=(1, 0, 0)))
curve_3 = Curve([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])
curve_4 = Curve([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])

# ----
move = Move(Geometry=plane, Motion=unit_z)  # -> Geometry, Transform

# ---- group: Middle Node Prototype (continued)
python_3_script_2 = Python3Script(stock=panel, shoe=curve_3, primary_0=curve, primary_1=curve_4, clt_plate=curve_2, cut_plane=move.Geometry)  # -> out, timber_model; inputs stock: list of Double, shoe: list of Line, primary_0: list of Line, primary_1: list of Line, clt_plate: Polyline, cut_plane: Plane
# ---------- python_3_script_2: Python ----------
from compas_timber.model import TimberModel
from compas_timber.elements import Beam, Plate
from compas_timber.utils import get_polyline_normal_vector
from compas.tolerance import Tolerance
from compas_rhino.conversions import line_to_compas, plane_to_compas, polyline_to_compas
from compas.geometry import Polyline, Translation, Vector
# --------------------------------------
# Dimensions
# --------------------------------------

stock_1_width = stock[0]
stock_1_height = stock[1]

if len(stock) > 2:
    stock_2_width = stock[2]
    stock_2_height = stock[3]

# --------------------------------------
# Helpers
# --------------------------------------

def create_add_beams(model, lines, w, h, hierarchy, is_mid=True, reached = False, level=0):
    beams = []
    for line in lines:
        centerline = line_to_compas(line)
        beam = Beam.from_centerline(centerline, w, h)
        beam.name = hierarchy
        beam.attributes = {
            'hierarchy': hierarchy,
            'has_middle_joint': is_mid,
            'reached': reached,
            'level': level,
        }
        beams.append(beam)
    model.add_elements(beams)

def orientate_plane_negative(plane):
    if plane.normal.z > 0:
        plane.normal = -plane.normal
    return plane

# --------------------------------------
# Build Model
# --------------------------------------

timber_model = TimberModel(Tolerance(unit="M", absolute= 0.01))

#beams
create_add_beams(timber_model, shoe, stock_1_width, stock_1_height, "shoe", is_mid = False, reached = False, level = 0)
create_add_beams(timber_model, primary_0, stock_1_width, stock_1_height, "primary", is_mid = True, reached = False, level = 0)
create_add_beams(timber_model, primary_1, stock_1_width, stock_1_height, "primary", is_mid = True, reached = True, level = 1)

#plate
clt_polyline = polyline_to_compas(clt_plate)
clt_polyline.transform(Translation.from_vector(Vector(0,0,0.03)))
vector = get_polyline_normal_vector(clt_polyline)
if vector.z < 0:
    vector = -vector
plate = Plate.from_outline_thickness(clt_polyline, 0.1, vector)
timber_model.add_element(plate)
timber_model.attributes['clt_plate'] = plate

#plane
c_plane = plane_to_compas(cut_plane)
c_plane = orientate_plane_negative(c_plane)
timber_model.attributes['cut_plane'] = c_plane
timber_model = timber_model
# ---------- end python_3_script_2 ----------

# ----
panel_3 = Panel(python_3_script_2.timber_model)
py3_8 = Python3Script(models=python_3_script_2.timber_model)  # -> out, models; inputs models: list
# ---------- py3_8: Python ----------
import os, sys, importlib

gh_dir = os.path.dirname(ghenv.Component.OnPingDocument().FilePath)

parent = os.path.dirname(gh_dir)              # go up one level
src_dir = os.path.join(parent, "src")         # go into src folder
if src_dir not in sys.path:
    sys.path.insert(0, src_dir)

import timber_config
importlib.reload(timber_config)

import timber_model
importlib.reload(timber_model)
from timber_model import apply_joints

from copy import deepcopy

models = deepcopy(models)


#
for model in models:
    apply_joints(model)
# ---------- end py3_8 ----------
py3_9 = Python3Script(models=py3_8.models, process=Toggle(True))  # -> out, models, debug; inputs models: list, process: Boolean
# ---------- py3_9: Python ----------
import os, sys, importlib

gh_dir = os.path.dirname(ghenv.Component.OnPingDocument().FilePath)

parent = os.path.dirname(gh_dir)              # go up one level
src_dir = os.path.join(parent, "src")         # go into src folder
if src_dir not in sys.path:
    sys.path.insert(0, src_dir)

import timber_config
importlib.reload(timber_config)

import timber_model
importlib.reload(timber_model)
from timber_model import apply_processings,apply_processings_middle_prototype

from copy import deepcopy

models = deepcopy(models)


#
if process:
    for model in models:
        model.process_joinery()
        model = apply_processings_middle_prototype(model)
# ---------- end py3_9 ----------

# ----
# Preview
python_3_script_3 = Python3Script(models=py3_9.models)  # -> out, geos, colors, cut_planes, models; inputs models: list
# ---------- python_3_script_3: Python ----------
import rhinoscriptsyntax as rs
import scriptcontext as sc
import Rhino.Display as rd
import System.Drawing as sd

from compas.scene import Scene
from compas.geometry import Line, Point
from copy import deepcopy


COLORS = {
    "primary":      sd.Color.FromArgb(100, 220,  50,  50),
    "main_primary": sd.Color.FromArgb(100, 150,  80, 220),
    "secondary":    sd.Color.FromArgb(100,  50, 150, 220),
    "tertiary":     sd.Color.FromArgb(100,  80, 200, 100),
    "shoe":         sd.Color.FromArgb(100,  20, 150, 100),
    "plate":        sd.Color.FromArgb(100,  100, 100, 100)
}


geos = []
colors = []
cut_planes = []

for model in models:
    # for plate in model.plates:
    #     geos.append(plate.geometry)
    #     colors.append(COLORS['plate'])

    for beam in model.beams:
        hie = beam.attributes.get('hierarchy')

        geos.append(beam.geometry)
        colors.append(COLORS[hie])

    cut_planes.append(model.attributes['cut_plane'])
# ---------- end python_3_script_3 ----------
compas_draw_3 = COMPASDraw(cg=python_3_script_3.geos)  # -> rg; same code as compas_draw
compas_draw_4 = COMPASDraw(cg=python_3_script_3.cut_planes)  # -> rg; same code as compas_draw
preview_2 = CustomPreview(Geometry=compas_draw_3, Material=python_3_script_3.colors)

py3_10 = Python3Script(models=py3_9.models, save=Button(), set_file_path=file_path)  # inputs models: list
# ---------- py3_10: Python ----------
import os, sys, importlib
from compas.data import json_dump
from compas_timber.fabrication import BTLxWriter

writer = BTLxWriter()

gh_dir = os.path.dirname(ghenv.Component.OnPingDocument().FilePath)
gh_par = os.path.dirname(gh_dir)
file_path = os.path.join(gh_par, "timber_design","data")

if set_file_path:
    file_path = set_file_path

if save:
    for i, model in enumerate(models):
        """Serialize models to .JSON"""
        output_path_json = os.path.join(file_path, f"1605_timber_model_{i}.json")
        output_path_btlx = os.path.join(file_path, f"1605_timber_model_{i}.btlx")
        writer.write(model, file_path=output_path_btlx)
        model.to_json(output_path_json, pretty=True)
# ---------- end py3_10 ----------
