# Grasshopper definition preview_joints.ghx (Grasshopper 1.0.8)

panel = Panel("""T2_2026
Consoles / Gripper Positioner""")

# ----
# Load json file
toggle = BooleanToggle(True)
py3 = Python3Script(load=toggle)  # -> out, timber_models, maps; inputs load: Boolean
# ---------- py3: Python ----------
from compas.data import json_load, json_dumps
import os, sys, importlib

from copy import deepcopy



gh_dir = os.path.dirname(ghenv.Component.OnPingDocument().FilePath)
gh_par = os.path.dirname(gh_dir)

file_path = os.path.join(gh_par,"timber_design", "data", "260529_v1_timber_models.json")
other_file_path = os.path.join(gh_par,"structure_model", "data", "joint_to_screwmap.json")
# print(file_path)

if load:
    results = json_load(file_path)
    results = deepcopy(results)

    for data in results:
        model = data['model']
        attrs = data['attributes']
        # print (model.attributes.keys())

        model.attributes = attrs
        # print (model.attributes.keys())

    timber_models = [data['model'] for data in results]
    maps = json_load(other_file_path)
    maps = json_dumps({str(k): v for k, v in maps.items()})
    # maps = [json_dumps({str(k): v for k, v in m.items()}) for m in maps]
# ---------- end py3 ----------

py3_2 = Python3Script(unload=Button())  # -> out; inputs unload: Boolean
# ---------- py3_2: Python ----------
from compas_rhino import unload_modules
import compas_timber

if unload:
    unload_modules('compas_timber')
    print("Module Unloaded")
# ---------- end py3_2 ----------
check = Python3Script()  # -> out, a
# ---------- check: Python ----------
import compas
import compas_timber

# venv: t2e
print(compas.__version__)
print(compas_timber.__version__)
print(compas_timber.__file__)
# ---------- end check ----------
panel_2 = Panel(check.out)
python_3_script = Python3Script(models=py3.timber_models, mapped=py3.maps)  # -> out, pts, labels, log, lines; inputs models: list, mapped: String
# ---------- python_3_script: Python ----------
import clr
clr.AddReference("RhinoCommon")
import Rhino.Geometry as rg

from compas.data import json_loads

pts    = []
lines  = []
labels = []
log    = []

total     = 0
unmatched = 0

mapped = json_loads(mapped)

for model in models:
    for joint in model.joints:
        loc   = joint.location
        pt    = rg.Point3d(loc.x, loc.y, loc.z)
        key   = str(getattr(joint, "key", joint.guid))
        count = mapped.get(str(joint.guid), -1)

        pts.append(pt)
        labels.append(count)

        if count == -1:
            unmatched += 1
        total += 1

    [lines.append(b.centerline) for b in model.beams]

log.append("OK — {} joints, {} unmatched.".format(total, unmatched))
# ---------- end python_3_script ----------
compas_draw = COMPASDraw(cg=python_3_script.lines)  # -> rg
#   port cg: The COMPAS geometry or datastructure to be drawn.
#   port rg: The Rhino geometry object.
# ---------- compas_draw: Python ----------
# r: compas>=2.14.1
"""
Draws COMPAS geometry in Grasshopper.
"""

from typing import Any

import Grasshopper

from compas.scene import SceneObject


class CompasToRhinoGeometry(Grasshopper.Kernel.GH_ScriptInstance):
    def RunScript(self, cg):
        if not cg:
            return None

        return SceneObject(item=cg).draw()
# ---------- end compas_draw ----------
text_tag = TextTag(Location=python_3_script.pts, Text=python_3_script.labels)
dot_display = DotDisplay(Point=python_3_script.pts, Colour=ColourSwatch(SwatchColor=RGB(255, 255, 255)), Size=Slider(0.1, range=0..1))
