# Grasshopper definition timber_model.ghx (Grasshopper 1.0.8)

number_slider = Slider(200, range=0..1000)
number_slider_2 = Slider(120, range=0..1000)
crv = Curve([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])
split = SplitList(List=crv, Index="3")  # -> ListA, ListB

# ---- group: compas_timber
python_3_script = Python3Script()  # -> out, a, b, c, d, e
# ---------- python_3_script: Python ----------
from compas.scene import Scene
from compas_rhino.conversions import line_to_compas
from compas.tolerance import Tolerance, TOL

from compas_timber.model import TimberModel
from compas_timber.elements import Beam

from compas_timber.connections import JointTopology
from compas_timber.connections import TMultiStepJoint
from compas_timber.connections import TStepJoint
from compas_timber.connections import LMiterJoint
from compas_timber.connections import LLapJoint
from compas_timber.connections import TBirdsmouthJoint
from compas_timber.connections import XLapJoint

from compas.geometry import Frame, Vector, Point, angle_vectors, Line
from copy import deepcopy

ng = deepcopy(line_graph)

for e in ng.edges():
    h = ng.edge_attribute(e, "hierarchy")
    ln = ng.edge_attribute(e, "shifted_lines")
    print (ng.edge_attributes(e))

# #initialise scene object
# scene = Scene()

# #initialise compas timber model
# model = TimberModel(Tolerance(unit="MM", absolute="0.001"))

# #beam list
# beams = []

# #convert rhino curves into compas lines
# "primary lines"
# p_1 = [line_to_compas(c) for c in p_1]
# p_2 = [line_to_compas(c) for c in p_2]
# p_3 = [line_to_compas(c) for c in p_3]
# p_4 = [line_to_compas(c) for c in p_4]
# p_5 = [line_to_compas(c) for c in p_5]

# # "secondary lines"
# s_1 = [line_to_compas(c) for c in s_1]
# s_2 = [line_to_compas(c) for c in s_2]

# # "tertiary (shoe) lines"
# t_1 = [line_to_compas(c) for c in t_1]

# #assign beam names and width
# # "primary lines"
# for l in p_1:
#     l.name = "primary_1"
#     beam = Beam.from_centerline(l, width=.120, height=.180)
#     beam.name = "primary"
#     beams.append(beam)
#     model.add_element(beam)

# for l in p_2:
#     l.name = "primary_2"
#     beam = Beam.from_centerline(l, width=.140, height=.180)
#     beam.name = "primary"
#     beams.append(beam)
#     model.add_element(beam)

# for l in p_3:
#     l.name = "primary_3"
#     beam = Beam.from_centerline(l, width=.140, height=.200)
#     beam.name = "primary"
#     beams.append(beam)
#     model.add_element(beam)

# for l in p_4:
#     l.name = "primary_4"
#     beam = Beam.from_centerline(l, width=.140, height=.240)
#     beam.name = "primary"
#     beams.append(beam)
#     model.add_element(beam)

# for l in p_5:
#     l.name = "primary_5"
#     beam = Beam.from_centerline(l, width=.08, height=.20)
#     beam.name = "primary"
#     beams.append(beam)
#     model.add_element(beam)

# # "Secondary lines"
# for l in s_1:
#     l.name = "secondary_1"
#     beam = Beam.from_centerline(l, width=.120, height=.160)
#     beam.name = "secondary"
#     beams.append(beam)
#     model.add_element(beam)

# for l in s_2:
#     l.name = "secondary_2"
#     beam = Beam.from_centerline(l, width=.120, height=.180)
#     beam.name = "secondary"
#     beams.append(beam)
#     model.add_element(beam)

# # "tertiary lines"
# for l in t_1:
#     l.name = "tertiary"
#     beam = Beam.from_centerline(l, width=.120, height=.160)
#     beam.name = "tertiary"
#     beams.append(beam)
#     model.add_element(beam)

# #reset beams and features
# for beam in model.beams:
#     beam.remove_features()

# #compute line network
# model.connect_adjacent_beams()

# #debugging tools
# candidates_a = []
# candidates_b = []
# frames_a = []
# frames_b = []
# planarity_check = []

# #set joint conditions
# for candidate in model.joint_candidates:
#     #check for frames
#     frame_a = candidate.element_a.frame
#     frame_a.xaxis = Vector(0,0,1)
#     frames_a.append (frame_a)

#     frame_b = candidate.element_b.frame
#     frame_b.xaxis = Vector(0,0,1)
#     frames_b.append (frame_b)

#     #visualise candidates for debug
#     candidates_a.append(Beam.from_centerline(candidate.element_a.centerline, width = .1, height = .1))
#     candidates_b.append(Beam.from_centerline(candidate.element_b.centerline, width = .1, height = .1))

#     #planarity check between candidate a and candidate b
#     planarity = (angle_vectors(frame_a.normal, frame_b.normal, deg=True))
#     planarity_check.append(planarity)
    
#     is_planar = bool
#     if planarity < 0.2 or planarity > 179.8:
#         is_planar = True
#     else:
#         is_planar = False
#     print (is_planar)

#     #check for mid_point = above certain z_height
#     a_is_shoe = bool
#     b_is_shoe = bool
#     ceiling_height = 24.07

#     height_a = candidate.element_a.centerline.midpoint.z
#     if height_a > ceiling_height:
#         a_is_shoe = True
#     else:
#         a_is_shoe = False
        
#     height_b = candidate.element_b.centerline.midpoint.z
#     if height_b > ceiling_height:
#         b_is_shoe = True
#     else:
#         b_is_shoe = False

#     #joints based on topology, planarity and z height
#     if candidate.topology == JointTopology.TOPO_T and is_planar == True:
#         if b_is_shoe == True:
#             heel_step = TStepJoint.create(model, candidate.element_a, candidate.element_b, step_shape="double", step_depth=.040, heel_depth=.060)
    
#         else:
#             if angle_vectors(candidate.element_a.centerline.direction, candidate.element_b.centerline.direction, deg=True) < 50:
#                 step_shape = "heel"
#             else:
#                 step_shape = "step"
            
#             print (candidate.element_a.centerline.name)
#             t_step_joint = TMultiStepJoint.create(model, candidate.element_a, candidate.element_b, step_shape=step_shape, step_depth=.02, riser_angle=90)
    
#     elif candidate.topology == JointTopology.TOPO_T and is_planar == False:
#         t_bm_joint = TBirdsmouthJoint.create(model, candidate.element_a, candidate.element_b)
#         # t_np_step_joint = TMultiStepJoint.create(model, candidate.element_a, candidate.element_b, do_refine_cut=True, step_depth = 0.02, riser_angle=90)
#     elif candidate.topology==JointTopology.TOPO_L:
#         mp = Frame.worldYZ
#         # miter_plane = ??
#         # l_miter_joint = LMiterJoint.create(model, candidate.element_a, candidate.element_b, cutoff = False)
#         l_lap_joint = LLapJoint.create(model, candidate.element_a, candidate.element_b)

#     # elif candidate.topology == JointTopology.TOPO_X:
#     #     x_lap_joint = XLapJoint.create(model, candidate.element_a, candidate.element_b)

#     else:
#         print ("some joints were not created!")
#         continue

# #process joints in compas timber model
# model.process_joinery()

# #visualise geometries
# for beam in (model.beams):
#     scene.add(beam.geometry)



# a = scene.draw()
# # b = frames_a[0]
# # c = candidates_a[0].geometry
# # d = frames_b[0]
# # e = candidates_b[0].geometry

# # print (planarity_check[1])
# ---------- end python_3_script ----------

# ----
crv_2 = Curve([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])
compas_draw = COMPASDraw(cg=python_3_script.b)  # -> rg
#   port cg: The COMPAS geometry or datastructure to be drawn.
#   port rg: The Rhino geometry object.
# ---------- compas_draw: Python ----------
# r: compas>=2.14.1
"""
Draws COMPAS geometry in Grasshopper.
"""

from typing import Any

import Grasshopper

from compas.scene import SceneObject


class CompasToRhinoGeometry(Grasshopper.Kernel.GH_ScriptInstance):
    def RunScript(self, cg):
        if not cg:
            return None

        return SceneObject(item=cg).draw()
# ---------- end compas_draw ----------
compas_draw_2 = COMPASDraw(cg=python_3_script.d)  # -> rg; same code as compas_draw
compas_draw_3 = COMPASDraw(cg=python_3_script.c)  # -> rg; same code as compas_draw
compas_draw_4 = COMPASDraw(cg=python_3_script.e)  # -> rg; same code as compas_draw
ctbeam = Python3Script(centerline=split.ListA, width=number_slider_2, height=number_slider, category="reciprocal")  # -> out, Beam, Blank; inputs centerline: list, width: list of Double, height: list of Double, category: list of String
# ---------- ctbeam: Python ----------
import Grasshopper
import Rhino

import rhinoscriptsyntax as rs
import System

from compas.scene import Scene
from compas_rhino.conversions import line_to_compas, vector_to_compas

from compas_timber.elements import Beam as CTBeam

class Beam_fromCurve(Grasshopper.Kernel.GH_ScriptInstance):
    def RunScript(self,
            centerline: list[object],
            width: list[float],
            height: list[float],
            category: list[str]):

        if not width:
            length = self._get_centerline_length(centerline)
            width = [length / 20]
        if not height:
            length = self._get_centerline_length(centerline)
            height = [length / 10]

        # reformat unset parameters for consistency
        if not category:
            category = [None]
        
        beams = []
        blanks = []
        scene = Scene()

        if centerline and height and width:
            N = len(centerline)
            if len(width) not in (1,N):
                print ("In 'W' I need either one or the same number of inputs as the Crv parameter.")
            if len(height) not in (1,N):
                print ("In 'H' I need either one or the same number of inputs as the Crv parameter.")
            if len(category) not in (0,1,N):
                print (" In 'Category' I need either none, one or the same number of inputs as the Crv parameter.")
            
            if len(width) != N:
                width = [width[0] for _ in range (N)]
            if len(height) != N:
                height = [height[0] for _ in range(N)]
            if len(category) != N:
                category = [category[0] for _ in range(N)]
            
            for line, w, h, c in zip (centerline, width, height, category):
                guid, geometry = self._get_guid_and_geometry(line)
                rhino_line = rs.coerceline(geometry)
                line = line_to_compas(rhino_line)

                beam = CTBeam.from_centerline(centerline=line, width = w, height = h)
                beam.attributes["category"] = c

                beams.append(beam)
                scene.add(beam.blank)
        
        blanks = scene.draw()

        return beams, blanks
                
    def _get_guid_and_geometry(self, line):
        # internalized curves and GH geometry will not have persistent GUIDs, referenced Rhino objects will
        # type hint on the input has to be 'ghdoc' for this to work
        guid = None
        geometry = line
        rhino_obj = Rhino.RhinoDoc.ActiveDoc.Objects.FindId(line)
        if rhino_obj:
            guid = line
            geometry = rhino_obj.Geometry
        return guid, geometry
    
    def _get_centerline_length(self, centerline):
        centerline_length = []
        for i in centerline:
            centerline_length.append(rs.CurveLength(i))
        if centerline_length:
            length_average = sum(centerline_length) / len(centerline_length)
        else:
            length_average = 1
        return length_average
# ---------- end ctbeam ----------
py3 = Python3Script(unload=Button())
# ---------- py3: Python ----------
from compas_rhino import unload_modules
import compas_timber

if unload:
    unload_modules("compas_timber")
# ---------- end py3 ----------
ctbeam_2 = Python3Script(centerline=split.ListB, width=number_slider_2, height=number_slider, category="reciprocal_b")  # -> out, Beam, Blank; inputs centerline: list, width: list of Double, height: list of Double, category: list of String; same code as ctbeam
ctbeam_3 = Python3Script(centerline=crv_2, width=Slider(80, range=0..1000), height=Slider(200, range=0..1000), category="birdsmouth")  # -> out, Beam, Blank; inputs centerline: list, width: list of Double, height: list of Double, category: list of String; same code as ctbeam
geometry = Geometry(python_3_script.a)
md_slider = MDSlider(SliderMode=0, slider_value=Point(0.5, 0.5, 0.5), x_domain=Domain(0, 1), y_domain=Domain(0, 1), z_domain=Domain(0, 1))
srf = Surface(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)
crv_3 = Curve([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])
crv_4 = Curve([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])
crv_5 = Curve([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])
crv_6 = Curve([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])
path = FilePath("C:\Users\frido\OneDrive\Dokumente\ETH_MAS_Architecture_Digital_Fabrication\Visual_Studio_Code\GitHub_personal\MAS_26_copy\10_T2_Timber\10_05_BTLx\")
srf_2 = Surface(reparameterize(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))

# ---- group: secondary
curve = Curve([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])
curve_2 = Curve([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])

# ----
crvprox = CurveProximity(CurveA=crv_2, CurveB=split.ListB)  # -> PointA, PointB, Distance
evalsrf = EvaluateSurface(Surface=srf_2, Point=md_slider)  # -> Point, Normal, UDirection, VDirection, Frame
# set file location -> click on existing file == new name
panel = Panel(path)
srf_3 = Surface(<surface referenced from the Rhino model>)
crv_7 = Curve([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])
crv_8 = Curve([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])
crv_9 = Curve([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])
crv_10 = Curve([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])
crv_11 = Curve([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])
curve_3 = Curve([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])

# ---- group: primary
curve_4 = Curve([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])
curve_5 = Curve([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])
curve_6 = Curve([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])
curve_7 = Curve([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])

# ----
sort = SortList(Keys=crvprox.Distance, ValuesA=crvprox.Distance)  # -> Keys, ValuesA
py3_2 = Python3Script(brep=srf, shoe=crv_3, leaf=crv_4, recipro=crv_5, low_sup=crv_6, path=path, b_plane=evalsrf.Frame)  # -> out, a, model, z_vectors, c, b, frames; inputs brep: list of Surface, shoe: list of Curve, leaf: list of Curve, recipro: list of Curve, low_sup: list of Curve, b_plane: Plane
# ---------- py3_2: Python ----------
from compas.scene import Scene
from compas.tolerance import Tolerance, TOL

from compas_timber.model import TimberModel
from compas_timber.elements import Beam

from compas_timber.connections import JointTopology, TMultiStepJoint, TStepJoint,LMiterJoint, TBirdsmouthJoint, XLapJoint

from compas_timber.fabrication import StepShapeType, JackRafterCut

from compas_rhino.conversions import curve_to_compas_line, surface_to_compas, plane_to_compas_frame, plane_to_compas

from compas.geometry import Frame, Plane, Vector, Point, angle_vectors, Line, intersection_segment_plane

from compas_timber.fabrication import BTLxWriter

""" check if planar function """
def is_planar(element_a, element_b):
    frames_a = []
    frames_b = []
    planarity_check = []
    frame_a = element_a.frame
    frame_a.xaxis = Vector(0,0,1)
    frames_a.append(frame_a)

    frame_b = element_b.frame
    frame_b.xaxis = Vector(0, 0, 1)

    planarity = angle_vectors(frame_a.normal, frame_b.normal, deg = True)
    planarity_check.append(planarity)

    is_planar = bool
    if planarity < 0.2 or planarity > 178.2:
        is_planar = True
    else:
        is_planar = False
    return(is_planar)

""" orient Lines, so start is on bottom"""
def orient_lines(centerline):
    if centerline.start.z > centerline.end.z:
        return Line(centerline.end, centerline.start)
    return centerline

""" get brep normalZz_vector """
z_vectors = []
for srf in brep:
    compas_srf = surface_to_compas(srf)          # returns a NurbsSurface or similar
    frame = compas_srf.frame_at(0.5, 0.5) 
    z_vector = frame.normal       # get frame at surface midpoint
    z_vectors.append(z_vector)

#initialise Scene object
scene = Scene()


#initialise compas timber model
model = TimberModel(Tolerance(unit="MM"), absolute = "100")

# beam list
beams = []

#shoes
shoes = [curve_to_compas_line(c) for c in shoe]

for l in shoes:
    beam = Beam.from_centerline(l, width = 120, height = 200, z_vector = z_vectors[0])
    beam.attributes["category"] = "shoe"
    beams.append(beam)
    model.add_element(beam)

leaves = [curve_to_compas_line(c) for c in leaf]
for l in leaves:
    beam = Beam.from_centerline(l, width = 120, height = 240)
    beam.attributes["category"] = "leaf"
    beams.append(beam)
    model.add_element(beam)

reciprocal = [curve_to_compas_line(c) for c in recipro]
for r in reciprocal:
    beam = Beam.from_centerline(r, width = 120, height = 200)
    beam.attributes["category"] = "reciprocal"
    beams.append(beam)
    model.add_element(beam)

birdmiter = [curve_to_compas_line(c) for c in low_sup]
for b in birdmiter:
    beam = Beam.from_centerline(b, width =80, height = 200)
    beam.attributes["category"] = "miterbirdsmouth"
    beams.append(beam)
    model.add_element(beam)

# print categories
for beam in model.beams:
    print(beam.attributes["category"])



model.connect_adjacent_beams(max_distance=100)
for candidate in model.joint_candidates:
    # dictionary = beam.attributes.get["category"]
    beam_a, beam_b = candidate.elements

        # sorting by Z for shoe-step-topology
    a_is_shoe = bool
    b_is_shoe = bool
    ceiling_height = 2640

    a_oriented = orient_lines(candidate.element_a.centerline) # set shoe-direction
    height_a = candidate.location.z
    # height_a = candidate.element_a.centerline.midpoint.z
    print("a", height_a)
    if height_a > ceiling_height:
        a_is_shoe = True
    else:
        a_is_shoe = False

    b_oriented = orient_lines(candidate.element_b.centerline)
    height_b = b_oriented.end.z
    print("b", height_b)
    if height_b > ceiling_height:
        b_is_shoe = True
    else:
        b_is_shoe = False

    if beam_a.attributes["category"] == "leaf" and beam_b.attributes["category"] == "shoe":
        heel_step = TStepJoint.create(model, beam_a, beam_b, step_shape="double", step_depth=40, heel_depth=60)
        # heel_step = TMultiStepJoint.create(model, beam_a, beam_b, step_shape = StepShapeType.HEEL, step_count = 2)
        # print("hello")
    elif candidate.topology == JointTopology.TOPO_X:
        lap_joint = XLapJoint.create(model, beam_a, beam_b)
    
    elif beam_a.attributes["category"] == "miterbirdsmouth" and beam_b.attributes["category"] == "reciprocal":
        birdsmouth = TBirdsmouthJoint.create(model, beam_a, beam_b)
    
    elif candidate.topology == JointTopology.TOPO_L:
        miter = LMiterJoint.create(model, candidate.element_a, candidate.element_b) #candidate.element_a as well as beam_a works!
    
    elif candidate.topology == JointTopology.TOPO_T and is_planar(candidate.element_a, candidate.element_b) == True:
        if a_is_shoe == True:
            heel = TMultiStepJoint.create(model, beam_a, beam_b, step_count = 2, step_shape = StepShapeType.HEEL)
        # elif b_is_shoe == True:
            # heelstep = heel = TMultiStepJoint.create(model, beam_a, beam_b, step_count = 2, step_shape = StepShapeType.HEEL)
        # if a_is_shoe == False:
        #     teeth = TMultiStepJoint.create(model, beam_a, beam_b, step_count = 5) #step_depth = 15
        #     print("hello")
        # elif b_is_shoe == False:
        #     teethstep = TMultiStepJoint.create(model, beam_a, beam_b, step_count = 5)
        else:
            multistep = TMultiStepJoint.create(model, beam_a, beam_b, step_count = 5)
    


#from_plane_and_beam(cls, plane, beam, ref_side_index=3, **kwargs):
frames = []
for b in beams:
    plane_cut = plane_to_compas(b_plane)
    frames.append(plane_cut)
    intersection = intersection_segment_plane(b.centerline, plane_cut, tol=None)
    if intersection is not None:
        jackrafter = JackRafterCut.from_plane_and_beam(plane_cut, b, ref_side_indes =3)
    # print(frame)
    # jackrafter = JackRafterCut.from_plane_and_beam(plane_cut, b, ref_side_indes =5)
        b.add_feature(jackrafter)


# drill_line = line_to_compas(drill_line)
# for i, beam in enumerate(model.beams):
#     if i == 0:
#         drill_feature = Drilling.from_line_and_element(drill_line, beam, diameter=10)
#         beam.add_features(drill_feature)
#         scene.add(beam.geometry)


model.process_joinery()

#visualise geometries
for beam in model.beams:
    scene.add(beam.geometry)

writer = BTLxWriter()
btlx = writer.write(model, file_path=path)

a = scene.draw()
# ---------- end py3_2 ----------

# ---- group: shoe
curve_8 = Curve([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])

# ----
srf_4 = Surface(evalsrf.Frame)
item = ListItem(List=reverse(sort.ValuesA), Index=0, Wrap=True)
py3_3 = Python3Script(brep=srf_3, shoe=crv_7, leaf=crv_11, recipro=crv_9, low_sup=crv_10)  # -> out, a, model, z_vectors, c; inputs brep: list of Surface, shoe: list of Curve, leaf: list of Curve, recipro: list of Curve, low_sup: list of Curve
# ---------- py3_3: Python ----------
from compas.scene import Scene
from compas.tolerance import Tolerance, TOL

from compas_timber.model import TimberModel
from compas_timber.elements import Beam

from compas_timber.connections import JointTopology, TMultiStepJoint, TStepJoint,LMiterJoint, TBirdsmouthJoint, XLapJoint

from compas_timber.fabrication import StepShapeType
from compas_rhino.conversions import curve_to_compas_line, surface_to_compas

from compas.geometry import Frame, Plane, Vector, Point, angle_vectors

""" check if planar function """
def is_planar(element_a, element_b):
    frames_a = []
    frames_b = []
    planarity_check = []
    frame_a = element_a.frame
    frame_a.xaxis = Vector(0,0,1)
    frames_a.append(frame_a)

    frame_b = element_b.frame
    frame_b.xaxis = Vector(0, 0, 1)

    planarity = angle_vectors(frame_a.normal, frame_b.normal, deg = True)
    planarity_check.append(planarity)

    is_planar = bool
    if planarity < 0.2 or planarity > 178.2:
        is_planar = True
    else:
        is_planar = False
    return(is_planar)

""" get brep normalZz_vector """
z_vectors = []
for srf in brep:
    compas_srf = surface_to_compas(srf)          # returns a NurbsSurface or similar
    frame = compas_srf.frame_at(0.5, 0.5) 
    z_vector = frame.normal       # get frame at surface midpoint
    z_vectors.append(z_vector)

#initialise Scene object
scene = Scene()

#initialise compas timber model
model = TimberModel(Tolerance(unit="MM", absolute = "10"))

# beam list
beams = []

#shoes
shoes = [curve_to_compas_line(c) for c in shoe]

for l in shoes:
    beam = Beam.from_centerline(l, width = 120, height = 160, z_vector = z_vectors[0])
    beam.attributes["category"] = "shoe"
    beams.append(beam)
    model.add_element(beam)

leaves = [curve_to_compas_line(c) for c in leaf]
for l in leaves:
    beam = Beam.from_centerline(l, width = 120, height = 160)
    beam.attributes["category"] = "leaf"
    beams.append(beam)
    model.add_element(beam)

reciprocal = [curve_to_compas_line(c) for c in recipro]
for r in reciprocal:
    beam = Beam.from_centerline(r, width = 120, height = 180)
    beam.attributes["category"] = "reciprocal"
    beams.append(beam)
    model.add_element(beam)

birdmiter = [curve_to_compas_line(c) for c in low_sup]
for b in birdmiter:
    beam = Beam.from_centerline(b, width =100, height = 220)
    beam.attributes["category"] = "miterbirdsmouth"
    beams.append(beam)
    model.add_element(beam)

# print categories
for beam in model.beams:
    print(beam.attributes["category"])

model.connect_adjacent_beams(max_distance=100)

for candidate in model.joint_candidates:
    # dictionary = beam.attributes.get["category"]
    beam_a, beam_b = candidate.elements

    if beam_a.attributes["category"] == "leaf" and beam_b.attributes["category"] == "shoe":
        heel_step = TStepJoint.create(model, candidate.element_a, candidate.element_b, step_shape="double", step_depth=40, heel_depth=60)
        # heel_step = TMultiStepJoint.create(model, beam_a, beam_b, step_shape = StepShapeType.HEEL, step_count = 2)
        # print("hello")
    elif candidate.topology == JointTopology.TOPO_X:
        lap_joint = XLapJoint.create(model, beam_a, beam_b)
    
    elif candidate.topology == JointTopology.TOPO_L:
        miter = LMiterJoint.create(model, candidate.element_a, candidate.element_b) #candidate.element_a as well as beam_a works!
    elif candidate.topology == JointTopology.TOPO_T and is_planar(candidate.element_a, candidate.element_b) == True:
        teeth = TMultiStepJoint.create(model, beam_a, beam_b,step_count = 6, step_depth = 40)
        
    elif beam_a.attributes["category"] == "miterbirdsmouth" and beam_b.attributes["category"] == "reciprocal":
        birdsmouth = TBirdsmouthJoint.create(model, beam_a, beam_b)
    print("hello")

model.process_joinery()

#visualise geometries
for beam in model.beams:
    scene.add(beam.geometry)

a = scene.draw()
# ---------- end py3_3 ----------

# ---- group: compas_timber
python_3_script_2 = Python3Script(p_5=curve_3, p_1=curve_6, p_2=curve_4, p_3=curve_7, p_4=curve_5, s_1=curve_2, s_2=curve, t_1=curve_8)  # -> out, a, b, c, d, e; inputs p_5: list of Line, p_1: list of Line, p_2: list of Line, p_3: list of Line, p_4: list of Line, s_1: list of Line, s_2: list of Line, t_1: list of Line; disabled
# ---------- python_3_script_2: Python ----------
from compas.scene import Scene
from compas_rhino.conversions import line_to_compas
from compas.tolerance import Tolerance, TOL

from compas_timber.model import TimberModel
from compas_timber.elements import Beam

from compas_timber.connections import JointTopology
from compas_timber.connections import TMultiStepJoint
from compas_timber.connections import TStepJoint
from compas_timber.connections import LMiterJoint
from compas_timber.connections import LLapJoint
from compas_timber.connections import TBirdsmouthJoint
from compas_timber.connections import XLapJoint

from compas.geometry import Frame, Vector, Point, angle_vectors

#initialise scene object
scene = Scene()

#initialise compas timber model
model = TimberModel(Tolerance(unit="MM", absolute="0.001"))

#beam list
beams = []

#convert rhino curves into compas lines
"primary lines"
p_1 = [line_to_compas(c) for c in p_1]
p_2 = [line_to_compas(c) for c in p_2]
p_3 = [line_to_compas(c) for c in p_3]
p_4 = [line_to_compas(c) for c in p_4]
p_5 = [line_to_compas(c) for c in p_5]

# "secondary lines"
s_1 = [line_to_compas(c) for c in s_1]
s_2 = [line_to_compas(c) for c in s_2]

# "tertiary (shoe) lines"
t_1 = [line_to_compas(c) for c in t_1]

#assign beam names and width
# "primary lines"
for l in p_1:
    l.name = "primary_1"
    beam = Beam.from_centerline(l, width=.120, height=.180)
    beam.name = "primary"
    beams.append(beam)
    model.add_element(beam)

for l in p_2:
    l.name = "primary_2"
    beam = Beam.from_centerline(l, width=.140, height=.180)
    beam.name = "primary"
    beams.append(beam)
    model.add_element(beam)

for l in p_3:
    l.name = "primary_3"
    beam = Beam.from_centerline(l, width=.140, height=.200)
    beam.name = "primary"
    beams.append(beam)
    model.add_element(beam)

for l in p_4:
    l.name = "primary_4"
    beam = Beam.from_centerline(l, width=.140, height=.240)
    beam.name = "primary"
    beams.append(beam)
    model.add_element(beam)

for l in p_5:
    l.name = "primary_5"
    beam = Beam.from_centerline(l, width=.08, height=.20)
    beam.name = "primary"
    beams.append(beam)
    model.add_element(beam)

# "Secondary lines"
for l in s_1:
    l.name = "secondary_1"
    beam = Beam.from_centerline(l, width=.120, height=.160)
    beam.name = "secondary"
    beams.append(beam)
    model.add_element(beam)

for l in s_2:
    l.name = "secondary_2"
    beam = Beam.from_centerline(l, width=.120, height=.180)
    beam.name = "secondary"
    beams.append(beam)
    model.add_element(beam)

# "tertiary lines"
for l in t_1:
    l.name = "tertiary"
    beam = Beam.from_centerline(l, width=.120, height=.160)
    beam.name = "tertiary"
    beams.append(beam)
    model.add_element(beam)

#reset beams and features
for beam in model.beams:
    beam.remove_features()

#compute line network
model.connect_adjacent_beams()

#debugging tools
candidates_a = []
candidates_b = []
frames_a = []
frames_b = []
planarity_check = []

#set joint conditions
for candidate in model.joint_candidates:
    #check for frames
    frame_a = candidate.element_a.frame
    frame_a.xaxis = Vector(0,0,1)
    frames_a.append (frame_a)

    frame_b = candidate.element_b.frame
    frame_b.xaxis = Vector(0,0,1)
    frames_b.append (frame_b)

    #visualise candidates for debug
    candidates_a.append(Beam.from_centerline(candidate.element_a.centerline, width = .1, height = .1))
    candidates_b.append(Beam.from_centerline(candidate.element_b.centerline, width = .1, height = .1))

    #planarity check between candidate a and candidate b
    planarity = (angle_vectors(frame_a.normal, frame_b.normal, deg=True))
    planarity_check.append(planarity)
    
    is_planar = bool
    if planarity < 0.2 or planarity > 179.8:
        is_planar = True
    else:
        is_planar = False
    print (is_planar)

    #check for mid_point = above certain z_height
    a_is_shoe = bool
    b_is_shoe = bool
    ceiling_height = 24.07

    height_a = candidate.element_a.centerline.midpoint.z
    if height_a > ceiling_height:
        a_is_shoe = True
    else:
        a_is_shoe = False
        
    height_b = candidate.element_b.centerline.midpoint.z
    if height_b > ceiling_height:
        b_is_shoe = True
    else:
        b_is_shoe = False

    #joints based on topology, planarity and z height
    if candidate.topology == JointTopology.TOPO_T and is_planar == True:
        if b_is_shoe == True:
            heel_step = TStepJoint.create(model, candidate.element_a, candidate.element_b, step_shape="double", step_depth=.040, heel_depth=.060)
    
        else:
            if angle_vectors(candidate.element_a.centerline.direction, candidate.element_b.centerline.direction, deg=True) < 50:
                step_shape = "heel"
            else:
                step_shape = "step"
            
            print (candidate.element_a.centerline.name)
            t_step_joint = TMultiStepJoint.create(model, candidate.element_a, candidate.element_b, step_shape=step_shape, step_depth=.02, riser_angle=90)
    
    elif candidate.topology == JointTopology.TOPO_T and is_planar == False:
        t_bm_joint = TBirdsmouthJoint.create(model, candidate.element_a, candidate.element_b)
        # t_np_step_joint = TMultiStepJoint.create(model, candidate.element_a, candidate.element_b, do_refine_cut=True, step_depth = 0.02, riser_angle=90)
    elif candidate.topology==JointTopology.TOPO_L:
        mp = Frame.worldYZ
        # miter_plane = ??
        # l_miter_joint = LMiterJoint.create(model, candidate.element_a, candidate.element_b, cutoff = False)
        l_lap_joint = LLapJoint.create(model, candidate.element_a, candidate.element_b)

    # elif candidate.topology == JointTopology.TOPO_X:
    #     x_lap_joint = XLapJoint.create(model, candidate.element_a, candidate.element_b)

    else:
        print ("some joints were not created!")
        continue

#process joints in compas timber model
model.process_joinery()

#visualise geometries
for beam in (model.beams):
    scene.add(beam.geometry)



a = scene.draw()
# b = frames_a[0]
# c = candidates_a[0].geometry
# d = frames_b[0]
# e = candidates_b[0].geometry

# print (planarity_check[1])
# ---------- end python_3_script_2 ----------

# ----
panel_2 = Panel(python_3_script_2.out)  # disabled
int = Integer(item)
draw = COMPASDraw(cg=py3_2.frames)  # -> rg; same code as compas_draw
draw_2 = COMPASDraw(cg=py3_2.z_vectors)  # -> rg; same code as compas_draw
py3_4 = Python3Script(rest_beams=ctbeam.Beam, cross_beam=ctbeam_2.Beam, main_beams=ctbeam_3.Beam, max_distance=int)  # -> out, a, model; inputs rest_beams: list, main_beams: list, max_distance: Double
# ---------- py3_4: Python ----------
from compas_timber.analyzers import TripletAnalyzer

from compas_timber.connections import JointTopology
from compas_timber.connections import KBirdsmouthJoint
from compas_timber.connections import TMultiStepJoint

from compas_timber.model import TimberModel
from compas.tolerance import Tolerance
from compas.scene import Scene

scene = Scene()
model = TimberModel(unit = "MM", tolerance = Tolerance(unit="MM"))

elements = [cross_beam] + main_beams + rest_beams
for element in elements:
    element.remove_features()
model.add_elements(elements)

for m in model.elements():
    print (m.attributes)

# run first solver for creating pairs
model.connect_adjacent_beams(max_distance)

# #handle non-pair joints (in this case a 3-way connection using TripletAnalyzer)
analyzer = TripletAnalyzer(model, max_distance/2)
clusters = analyzer.find()

for cluster in clusters:
    # promote cluster that matches the topology
    if cluster.topology == JointTopology.TOPO_K:
        # make sure the cross_beam is always first in the new list
        reordered_elements = [e for e in cluster.elements if e.attributes["category"] == "reciprocal_b"]
        # then add the rest of them in a random order
        reordered_elements += [e for e in cluster.elements if e not in reordered_elements]
        kbj = KBirdsmouthJoint.promote_cluster(model, clusters[0], reordered_elements=reordered_elements, mill_depth=40)

#handle pair-wise joint connections
for candidate in model.joint_candidates:
    if candidate.is_promoted == False: # skip the joints that make up the clusters and have been already promoted
        if candidate.topology == JointTopology.TOPO_T:
            tmsj = TMultiStepJoint.promote_joint_candidate(model, candidate, step_depth=25)

model.process_joinery()

for beam in model.beams:
    scene.add(beam.geometry)
a = scene.draw()
# ---------- end py3_4 ----------
compas_draw_5 = COMPASDraw(cg=python_3_script_2.b)  # -> rg; disabled; same code as compas_draw
compas_draw_6 = COMPASDraw(cg=python_3_script_2.d)  # -> rg; disabled; same code as compas_draw
draw_3 = COMPASDraw(cg=py3_3.z_vectors)  # -> rg; same code as compas_draw
py3_5 = Python3Script(brep=srf_3)  # -> out, normals, a; inputs brep: list of Surface
# ---------- py3_5: Python ----------
from compas_rhino.conversions import surface_to_compas
from compas.geometry import Plane, Frame

normals = []

for srf in brep:
    compas_srf = surface_to_compas(srf)          # returns a NurbsSurface or similar
    frame = compas_srf.frame_at(0.5, 0.5)        # get frame at surface midpoint
    plane = Plane.from_frame(frame)               # convert frame to plane
    normal = plane.normal
    normals.append(normal)
    print(normal)
# ---------- end py3_5 ----------
compas_draw_7 = COMPASDraw(cg=python_3_script_2.c)  # -> rg; disabled; same code as compas_draw
compas_draw_8 = COMPASDraw(cg=python_3_script_2.e)  # -> rg; disabled; same code as compas_draw
geometry_2 = Geometry(python_3_script_2.a)  # disabled
path_2 = FilePath("/Users/minghip/Desktop/")
panel_3 = Panel(py3_5.normals)
displayjointnames = Python3Script(model=py3_4.model)
# ---------- displayjointnames: Python ----------
import Grasshopper
import System

from compas_rhino.conversions import point_to_rhino

from compas_timber.utils import intersection_line_line_param

class ShowJointTypes(Grasshopper.Kernel.GH_ScriptInstance):
    def RunScript(self, model):
        self.pt = []
        self.txt = []

        for joint in model.joints:
            line_a, line_b = joint.elements[0].centerline, joint.elements[1].centerline
            [p1, _], [p2, _] = intersection_line_line_param(line_a, line_b, float("inf"), False, 1e-3)
            p1 = point_to_rhino(p1)
            p2 = point_to_rhino(p2)
            
            self.pt.append((p2 + p1)/2)
            self.txt.append(joint.__class__.__name__)
    
    def DrawViewportWires(self, arg):
        if ghenv.Component.Locked:
            return
        col = System.Drawing.Color.FromArgb(255, 0, 0, 0)
        # https://developer.rhino3d.com/api/RhinoCommon/html/M_Rhino_Display_DisplayPipeline_Draw2dText_5.htm
        for p, t in zip(self.pt, self.txt):
            arg.Display.Draw2dText(t, col, p, True, 25, "Verdana")
# ---------- end displayjointnames ----------
btlx = Python3Script(model=py3_4.model, file_path=path_2, write=Button())  # -> BTLx
# ---------- btlx: Python ----------
import os
import Grasshopper
import Rhino

from compas_timber.fabrication import BTLxWriter

class WriteBTLx(Grasshopper.Kernel.GH_ScriptInstance):
    def RunScript(self, model, file_path, write):

        output_path = os.path.join(file_path,f"timber_model.btlx")
        btlx = BTLxWriter(output_path)

        if write:
            XML = btlx.write(model, output_path)
        else:
            XML = btlx.model_to_xml(model)
        return XML
# ---------- end btlx ----------
panel_4 = Panel(btlx)
panel_5 = Panel("""0
1
4
5""")
number_slider_3 = Slider(3, range=0..3)
path_3 = FilePath("/Users/minghip/Documents/Github/llhil-t2-fabrication/fabrication/data/timber_models/")

relay = Relay()
deconstruct_brep = DeconstructBrep(Brep=relay)  # -> Faces, Edges, Vertices
join_curves = JoinCurves(Curves=deconstruct_brep.Edges, Preserve=False)  # -> flatten(Curves)
curve_9 = Curve(join_curves)
offset = OffsetCurve(Curve=curve_9, Distance=Slider(0, range=0..1), Corners=1)
unit_z = UnitZ(Factor="0.08")

# ---- group: boxes
python_3_script_3 = Python3Script(x=flatten(curve_9), y=flatten(offset))  # -> out, boxes, x_sorted, y_sorted, c_pts; inputs x: list of Curve, y: list of Curve
# ---------- python_3_script_3: Python ----------
from compas.geometry import bounding_box, Box
from compas_rhino.conversions import curve_to_compas_polyline

def curve_xy_key(curve):
    c = curve_to_compas_polyline(curve)
    pts = c.points
    bb = bounding_box(pts)

    # center of bounding box
    cx = (bb[0][0] + bb[6][0]) * 0.5
    cy = (bb[0][1] + bb[6][1]) * 0.5

    # return (cx, cy)
    return (round(cy, 3), cx)

# sort first
x_sorted = sorted(x, key=curve_xy_key)
y_sorted = sorted(y, key=curve_xy_key)

boxes = []
for curve in y_sorted:
    c = curve_to_compas_polyline(curve)
    points = c.points
    a = Box.from_bounding_box(bounding_box(points))
    a.zsize = 20.0
    boxes.append(a)

c_pts = [b.frame.point for b in boxes]
print(boxes)
# ---------- end python_3_script_3 ----------

# ----
move = Move(Geometry=python_3_script_3.x_sorted, Motion=unit_z)  # -> Geometry, Transform
draw_4 = COMPASDraw(cg=python_3_script_3.c_pts)  # -> rg; same code as compas_draw
point_list = PointList(Points=draw_4, Size=Slider(1, range=0..10))

timber_model = Python3Script(boxes=python_3_script_3.boxes, clt_plates=move.Geometry)  # -> out, a, b, c, d, e, processed_models, base_model; inputs boxes: list, clt_plates: list of Polyline
# ---------- timber_model: Python ----------
from compas.scene import Scene
from compas_rhino.conversions import line_to_compas, polyline_to_compas
from compas.tolerance import Tolerance, TOL

from compas_timber.model import TimberModel
from compas_timber.elements import Beam, Plate

from compas_timber.connections import JointTopology
from compas_timber.connections import TMultiStepJoint
from compas_timber.connections import TStepJoint
from compas_timber.connections import LMiterJoint
from compas_timber.connections import TBirdsmouthJoint
from compas_timber.connections import XLapJoint
from compas_timber.connections import LLapJoint

from compas.geometry import Frame, Vector, Point, angle_vectors, centroid_points, Line

#initialise scene object
scene = Scene()

#initialise base compas timber model
base_model = TimberModel(Tolerance(unit="MM", absolute="0.001"))

# ============================================================
# Helper: make polygon point order consistent with world Z+
# ============================================================
def oriented_polyline_to_world_z_plus(compas_poly):
    pts = list(compas_poly.points)

    if len(pts) < 3:
        return compas_poly, Vector(0, 0, 1)

    # remove duplicate last point if closed
    if pts[0] == pts[-1]:
        pts = pts[:-1]

    if len(pts) < 3:
        return compas_poly, Vector(0, 0, 1)

    p0 = pts[0]
    p1 = pts[1]
    p2 = pts[2]

    frame = Frame.from_points(p0, p1, p2)
    local_z = frame.zaxis
    world_z = Vector(0, 0, 1)

    # if normal points downward, reverse point order
    if local_z.dot(world_z) < 0:
        pts.reverse()

        # close it again if original was closed
        pts.append(pts[0])

        compas_poly = type(compas_poly)(pts)

        p0 = compas_poly.points[0]
        p1 = compas_poly.points[1]
        p2 = compas_poly.points[2]

        frame = Frame.from_points(p0, p1, p2)
        local_z = frame.zaxis

    return compas_poly, local_z

# ============================================================
# Create CLT Plates
# ============================================================

plates = []
models = []

for c in clt_plates:
    compas_poly = polyline_to_compas(c)
    if compas_poly is None:
        continue
    center = centroid_points(compas_poly.points)    
    for b in boxes:
        model = TimberModel(Tolerance(unit="MM", absolute="0.001"))
        if b.contains_point(center):
            compas_poly, local_z = oriented_polyline_to_world_z_plus(compas_poly)

            plate = Plate.from_outline_thickness(
                compas_poly,
                thickness=0.12,
                vector=local_z
            )

            plates.append(plate)
            model.add_element(plate)
            base_model.add_element(plate)
            models.append(model)

# ============================================================
# Input Beams
# ============================================================

beams = []

#convert rhino curves into compas lines
"""to be replaced with graph input"""

from copy import deepcopy

ng = deepcopy(line_graph)

for edge in ng.edges():
    h = ng.edge_attribute(edge,"hierarchy")

    """set width and height based on attributes"""

    if h == "primary":
        ln_width = 0.100
        ln_height = 0.200
    elif h == "secondary":
        ln_width = 0.100
        ln_height = 0.160
    elif h == "tertiary":
        ln_width = 0.100
        ln_height = 0.120

    ln = ng.edge_attribute(edge, "shifted_lines")
    
    if ln is None:
        continue
    
    for b, m in zip (boxes, models):
        if b.contains_point(ln.start) or b.contains_point(ln.end):
            ln.name = h
            beam = Beam.from_centerline(ln,width=ln_width, height=ln_height)
            beam.name = ln.name
            beams.append(beam)
            m.add_element(beam)
            base_model.add_element(beam)

# ============================================================
# Process Jointery
# ============================================================

#planarity check
def is_planar(element_a, element_b):
    frames_a = []
    frames_b = []
    planarity_check = []
    frame_a = element_a.frame
    frame_a.xaxis = Vector(0,0,1)
    frames_a.append(frame_a)

    frame_b = element_b.frame
    frame_b.xaxis = Vector(0, 0, 1)

    planarity = angle_vectors(frame_a.normal, frame_b.normal, deg = True)
    planarity_check.append(planarity)

    is_planar = bool
    if planarity < 0.2 or planarity > 178.2:
        is_planar = True
    else:
        is_planar = False
    return(is_planar)

#reset beams and features
for model in models:
    for beam in model.beams:
        beam.remove_features()

    #compute line network
    base_model.connect_adjacent_beams()
    model.connect_adjacent_beams()

    #debugging tools
    candidates_a = []
    candidates_b = []
    frames_a = []
    frames_b = []
    planarity_check = []

    #set joint conditions
    for candidate in model.joint_candidates:
        # #check for frames
        # frame_a = candidate.element_a.frame
        # frame_a.xaxis = Vector(0,0,1)
        # frames_a.append (frame_a)

        # frame_b = candidate.element_b.frame
        # frame_b.xaxis = Vector(0,0,1)
        # frames_b.append (frame_b)

        # #visualise candidates for debug
        # candidates_a.append(Beam.from_centerline(candidate.element_a.centerline, width = .1, height = .1))
        # candidates_b.append(Beam.from_centerline(candidate.element_b.centerline, width = .1, height = .1))

        # #planarity check between candidate a and candidate b
        # planarity = (angle_vectors(frame_a.normal, frame_b.normal, deg=True))
        # planarity_check.append(planarity)
        
        # is_planar = bool
        # if planarity < 0.2 or planarity > 179.8:
        #     is_planar = True
        # else:
        #     is_planar = False
        # print (is_planar)

        #check for mid_point = above certain z_height
        a_is_shoe = bool
        b_is_shoe = bool
        ceiling_height = 24.48

        height_a = candidate.element_a.centerline.midpoint.z
        if height_a > ceiling_height:
            a_is_shoe = True
        else:
            a_is_shoe = False
            
        height_b = candidate.element_b.centerline.midpoint.z
        if height_b > ceiling_height:
            b_is_shoe = True
        else:
            b_is_shoe = False

        #joints based on topology, planarity and z height
        if candidate.topology == JointTopology.TOPO_T and is_planar(candidate.element_a, candidate.element_b) == True:
            if b_is_shoe == True:
                t_step_joint = TMultiStepJoint.create(model, candidate.element_a, candidate.element_b, step_count=2)
            
            else:
                if angle_vectors(candidate.element_a.centerline.direction, candidate.element_b.centerline.direction, deg=True) < 50:
                    step_shape = "heel"
                else:
                    step_shape = "step"
                
                print (candidate.element_a.centerline.name)
                t_step_joint = TMultiStepJoint.create(model, candidate.element_a, candidate.element_b, step_shape=step_shape, step_depth=.02, riser_angle=90)
        
        elif candidate.topology == JointTopology.TOPO_T and is_planar(candidate.element_a, candidate.element_b) == False:
            t_bm_joint = TBirdsmouthJoint.create(model, candidate.element_a, candidate.element_b)
            # t_np_step_joint = TMultiStepJoint.create(model, candidate.element_a, candidate.element_b, do_refine_cut=True, step_depth = 0.02, riser_angle=90)
        elif candidate.topology==JointTopology.TOPO_L:
            mp = Frame.worldYZ
            # miter_plane = ??
            l_miter_joint = LMiterJoint.create(model, candidate.element_a, candidate.element_b, cutoff = False)

        elif candidate.topology == JointTopology.TOPO_X:
            x_lap_joint = XLapJoint.create(model, candidate.element_a, candidate.element_b)

        else:
            continue

    #process joints in compas timber model
    model.process_joinery()

processed_models = []

for m in models:
    processed_models.append(m)

    #visualise geometries
    for beam in (m.beams):
        scene.add(beam.geometry)
    
    for plate in (m.plates):
        scene.add(plate.geometry)
    print ("ADDED")

a = scene.draw()
# ---------- end timber_model ----------
panel_6 = Panel(timber_model.processed_models)
panel_7 = Panel(timber_model.base_model)
compas_draw_9 = COMPASDraw(cg=timber_model.b)  # -> rg; same code as compas_draw
compas_draw_10 = COMPASDraw(cg=timber_model.d)  # -> rg; same code as compas_draw
compas_draw_11 = COMPASDraw(cg=timber_model.c)  # -> rg; same code as compas_draw
compas_draw_12 = COMPASDraw(cg=timber_model.e)  # -> rg; same code as compas_draw
geometry_3 = Geometry(timber_model.a)
item_2 = ListItem(List=timber_model.processed_models, Index=panel_5, Wrap=True)
panel_8 = Panel(item_2)

# ---- group: json_dump of n modules
py3_6 = Python3Script(x=item_2, save=Button(), file_path=path_3)  # -> out, a; inputs x: list
# ---------- py3_6: Python ----------
import os
from compas.data import json_dump

if save:
    for i, m in enumerate(x):
        """Serialize models to .JSON"""
        output_path = os.path.join(file_path, f"timber_model_{i}.json")
        m.to_json(output_path, pretty=True)
        print(f"Model written to {output_path}")
# ---------- end py3_6 ----------

# ---- group: visualize modules based on index
py3_7 = Python3Script(x=item_2, y=number_slider_3)  # -> out, a; inputs x: list, y: Int32
# ---------- py3_7: Python ----------
from compas.scene import Scene
from compas_rhino.conversions import line_to_compas
from compas.tolerance import Tolerance, TOL

from compas_timber.model import TimberModel
from compas_timber.elements import Beam, Plate

from compas_timber.connections import JointTopology
from compas_timber.connections import TMultiStepJoint
from compas_timber.connections import TStepJoint
from compas_timber.connections import LMiterJoint
from compas_timber.connections import TBirdsmouthJoint
from compas_timber.connections import XLapJoint

from compas_rhino.conversions import line_to_compas, polyline_to_compas

from compas.geometry import Frame, Vector, Point, angle_vectors, centroid_points

from statistics import mean


scene = Scene()
# for m in x:
# model = x[y]
for beam in (x[y].beams):
    if not beam.attributes["neighbour"]:
        scene.add(beam.geometry)

for plate in (x[y].plates):
    scene.add(plate.geometry)
a = scene.draw()
# ---------- end py3_7 ----------

# ---- group: visualize neighbour beams based on module index
py3_8 = Python3Script(x=item_2, y=number_slider_3)  # -> out, a; inputs x: list, y: Int32
# ---------- py3_8: Python ----------
from compas.scene import Scene
from compas_rhino.conversions import line_to_compas
from compas.tolerance import Tolerance, TOL

from compas_timber.model import TimberModel
from compas_timber.elements import Beam, Plate

from compas_timber.connections import JointTopology
from compas_timber.connections import TMultiStepJoint
from compas_timber.connections import TStepJoint
from compas_timber.connections import LMiterJoint
from compas_timber.connections import TBirdsmouthJoint
from compas_timber.connections import XLapJoint

from compas_rhino.conversions import line_to_compas, polyline_to_compas

from compas.geometry import Frame, Vector, Point, angle_vectors, centroid_points

from statistics import mean


scene = Scene()
# for m in x:
# model = x[y]
for beam in (x[y].beams):
    if beam.attributes["neighbour"]:
        scene.add(beam.geometry)
a = scene.draw()
# ---------- end py3_8 ----------
