# Grasshopper definition T2_PositionerViewer_Clean_05.gh (Grasshopper 1.0.8)
# plug-ins: Increment

# ---- group: JSON
path = FilePath("C:\Users\user\github\MAS-2526\10_Timber Rooftop\llhil-t2-fabrication\design\timber_design\data\260525_v1_timber_model0.json")

path_2 = FilePath("C:\Users\user\github\MAS-2526\10_Timber Rooftop\llhil-t2-fabrication\design\modularization\data\260526_v2_timber_models.json")

path_3 = FilePath("C:\Users\user\github\MAS-2526\10_Timber Rooftop\llhil-t2-fabrication\design\timber_design\data\260525_v1_timber_model0.json")  # disabled

# ----
number_slider = Slider(0, range=0..100)  # disabled
panel = Panel(path_2)
list = ValueList({"Medium": 0, "Large": 1, "Custom": 2}, selected="Medium")
side_index = Slider(0, range=0..3)
gripper_separation = Slider(1.3, range=0..10)
panel_2 = Panel("""T2_2026
Consoles / Gripper Positioner""")
panel_3 = Panel(path_3)  # disabled
list_2 = ValueList({"Medium": 0, "Large": 1, "Custom": 2}, selected="Medium")  # disabled
side_index_2 = Slider(0, range=0..3)  # disabled
gripper_separation_2 = Slider(1.3, range=0..10)  # disabled
model = Python3Script(x=path_2, t=list, gs=gripper_separation, si=side_index, mod=Slider(0, range=0..100))  # -> model, geo; inputs t: Int32, gs: Double, mod: Int32
# ---------- model: Python ----------
from compas.data import json_load, json_dumps
from compas.scene import Scene
from compas_timber.planning import set_gripper_positions

data = json_load(x)

models = []
for item in data:
    model_dict = item.get("model ") or item.get("model")
    models.append(model_dict)

for i, model in enumerate(models):
    if i == mod:

        model.process_joinery()

# add gripper drilling / tool max. = 2.0
# if t == 0:
set_gripper_positions(model, side_index = si)
# elif t == 2 and gs <= 2.0:
    # set_gripper_positions(model, gripper_separation = gs, side_index = si)
# else:
    # set_gripper_positions(model, gripper_separation = 2.0, side_index = si)    

scene = Scene()

for beam in model.beams:
    scene.add(beam.geometry)

model = model
geo = scene.draw()
# ---------- end model ----------
py3 = Python3Script(unload=Button())  # -> out; inputs unload: Boolean
# ---------- py3: Python ----------
from compas_rhino import unload_modules
import compas_timber

if unload:
    unload_modules('compas_timber')
    print("Module Unloaded")
# ---------- end py3 ----------
model_2 = Python3Script(x=path_3, t=list_2, gs=gripper_separation_2, si=side_index_2, mod=number_slider)  # -> model, geo; inputs t: Int32, gs: Double, mod: Int32; disabled; same code as model
check = Python3Script()  # -> out, a
# ---------- check: Python ----------
import compas
import compas_timber

print(compas.__version__)
print(compas_timber.__version__)
print(compas_timber.__file__)
# ---------- end check ----------
nest_spacing = Slider(0.032, range=0..0.1)
nest_spacing_2 = Slider(0.032, range=0..0.1)  # disabled
geo = Geometry(model.geo)
geo_2 = Geometry(model_2.geo)  # disabled
panel_4 = Panel(check.out)
individual = BooleanToggle(True)
individual_2 = BooleanToggle(True)  # disabled
json = Button()
btlx = Button()
increment = Increment(BeginningNumber=0, StepSize=1, currentValue=1, increment=1, oldStart=0)  # -> Output, Item
json_2 = Button()  # disabled
btlx_2 = Button()  # disabled
increment_2 = Increment(BeginningNumber=0, StepSize=1, currentValue=0, increment=1, oldStart=0)  # -> Output, Item; disabled
number_slider_2 = Slider(0, range=-2..2.001)  # disabled
positioner = Python3Script(model=model.model, index=increment.Output, spacing=nest_spacing, individual=individual, path=path_2, write=json)  # -> out, nesting_result, summary, geometry, blank, consoles_positions, gripper_positions; inputs index: Int32, exclude: list of Int32, path: String, write: Boolean
# ---------- positioner: Python ----------
# env: C:\Users\kapso\OneDrive\Documents\GitHub\compas_timber\src
from compas.data import json_dumps, json_loads
from compas_timber.planning import BeamStock
from compas_timber.planning import BeamNester
from compas_timber.planning import set_gripper_positions
from compas_timber.fabrication import Lap
from compas.data import json_dump
from compas.scene import Scene
from compas.geometry import Transformation, Frame, Vector, Translation
from ghpythonlib.treehelpers import list_to_tree
from compas_rhino.conversions import polyhedron_to_rhino
import os

debug_scene = Scene()
geo_scene = Scene()
blank_scene = Scene()
gripper_positions = []

# stock_catalog = [
#     BeamStock(5, (0.12,0.12)),
# ]

def get_cross_sections_from_model(model):
    cross_sections = []

    for beam in model.beams:
        section = tuple(sorted((beam.width, beam.height)))

        if section not in cross_sections:
            cross_sections.append(section)

    return cross_sections


stock_catalog = [
    BeamStock(5.0, section)
    for section in get_cross_sections_from_model(model)
]

if individual:
    spacing = 100
else:
    spacing = spacing

nester = BeamNester(model, stock_catalog, spacing, per_group=True)
nesting_result = nester.nest(fast=False, consoles=True, optimize=True, exclude_groups=exclude)
# total_material_volume = nesting_result.total_material_volume
stock_report = nesting_result.total_stock_pieces
print(stock_report)
# summary = nesting_result.summary
# for stock_type, dimensions_dict in stock_report.items():
#     print(f"{stock_type}:")
#     for dimensions, count in dimensions_dict.items():
#         print(f"  {dimensions} -> {count} piece(s)")

summary_lines = []

for stock_i, stock in enumerate(nesting_result.stocks):

    summary_lines.append("BeamStock_{}:".format(stock_i))
    summary_lines.append(
        "Dimensions(mm): {:.0f}x{:.0f}x{:.0f}".format(
            stock.cross_section[0] * 1000,
            stock.cross_section[1] * 1000,
            stock.length * 1000
        )
    )

    beam_keys = []
    beam_levels = []
    beam_lengths = []

    for guid, data in stock.element_data.items():

        element = model.element_by_guid(str(guid))

        key = data.get("key")
        length = data.get("length")
        level = element.attributes.get("level", "No level")

        beam_keys.append(key)
        beam_lengths.append(round(length * 1000, 1))
        beam_levels.append(level)

    summary_lines.append("BeamKeys: {}".format(beam_keys))
    summary_lines.append("BeamLevels: {}".format(beam_levels))
    summary_lines.append("BeamLengths(mm): {}".format(beam_lengths))
    summary_lines.append("Waste(mm): {:.1f}".format(stock.length * 1000 - sum(beam_lengths)))
    summary_lines.append("Spacing(mm): {:.1f}".format(float(stock.spacing) * 1000))
    summary_lines.append("Groups: {}".format(list(stock.groups)))
    summary_lines.append("--------")

summary = "\n".join(summary_lines)

debug_volumes = []
for i, stock in enumerate(nesting_result.stocks):
    if i == index:
        consoles_positions = stock.consoles_positions

        for guid, data in stock.element_data.items():

            element = model.element_by_guid(str(guid))

            key = data.get("key")
            frame = data.get("frame")

            att = element.attributes
            level = att.get("level", "No level")

            if element.attributes["gripper_position"] != None:
                gripper_local = float(element.attributes["gripper_position"])
            else:
                gripper_local = None
            blank_ext = element._resolve_blank_extensions()
            value = blank_ext[0]

            frame = Frame(frame.point + (value, 0, 0), Vector.Xaxis(), -Vector.Zaxis())
            offset_transformation = Translation.from_vector(Vector.Zaxis() * element.height / 2.0)

            cnc_transformation = (
                Transformation.from_frame(frame)
                * offset_transformation
            )

            geo = element.elementgeometry.transformed(cnc_transformation)
            geo_scene.add(geo)

            local_blank = element.blank.transformed(element.transformation_to_local())
            local_blank.transform(Transformation.from_frame(frame))
            local_blank.translate(Vector.Yaxis() * element.height / 2.0)
            blank_scene.add(local_blank)

            if gripper_local:
                if blank_ext:
                    gripper_positions.append(frame.point.x + gripper_local - value)
                else:
                    gripper_positions.append(frame.point.x + gripper_local)
            else:
                gripper_positions.append("Assembly by hand")

            print(blank_ext)

def get_file_name(file_path):
    file_path_components = file_path.split('/')
    file_name_and_extension = file_path_components[-1].rsplit('.', 1)
    return file_name_and_extension[0]

if write:
    dir_path = get_file_name(path)
    json_dump(model, fp=dir_path+"_fabrication.json", pretty=True)

geometry = geo_scene.draw()
blank = blank_scene.draw()
debug_volumes = list_to_tree(debug_volumes)
# ---------- end positioner ----------
writebtlx = CTWriteBTLx(model=model.model, path=path_2, nesting_result=positioner.nesting_result, write=btlx)  # -> BTLx; inputs write: Boolean
#   port model: Model object.
#   port path: Filepath for new BTLx.
#   port write: Write to file.
#   port BTLx: Pretty BTLx string
# ---------- writebtlx: Python ----------
from compas_timber.fabrication import BTLxWriter
from compas.tolerance import TOL

model.tolerance.unit = "M"

def get_file_name(file_path):
    file_path_components = file_path.split('/')
    file_name_and_extension = file_path_components[-1].rsplit('.', 1)
    return file_name_and_extension[0]


dir_path = get_file_name(path)
writer = BTLxWriter(project_name="T2_fabrication")

if write:
    XML = writer.write(model, dir_path+"_fabrication.btlx", nesting_result=nesting_result)
# ---------- end writebtlx ----------
positioner_2 = Python3Script(
    model=model_2.model,
    index=increment_2.Output,
    spacing=nest_spacing_2,
    individual=individual_2,
    path=path_3,
    write=json_2)  # -> out, nesting_result, summary, geometry, blank, consoles_positions, gripper_positions; inputs index: Int32, exclude: list of Int32, path: String, write: Boolean; disabled
# ---------- positioner_2: Python ----------
# env: C:\Users\kapso\OneDrive\Documents\GitHub\compas_timber\src
from compas.data import json_dumps, json_loads
from compas_timber.planning import BeamStock
from compas_timber.planning import BeamNester
from compas_timber.planning import set_gripper_positions
from compas_timber.fabrication import Lap
from compas.data import json_dump
from compas.scene import Scene
from compas.geometry import Transformation, Frame, Vector, Translation
from ghpythonlib.treehelpers import list_to_tree
from compas_rhino.conversions import polyhedron_to_rhino
import os

debug_scene = Scene()
geo_scene = Scene()
blank_scene = Scene()
gripper_positions = []

# stock_catalog = [
#     BeamStock(5, (0.12,0.12)),
# ]

def get_cross_sections_from_model(model):
    cross_sections = []

    for beam in model.beams:
        section = tuple(sorted((beam.width, beam.height)))

        if section not in cross_sections:
            cross_sections.append(section)

    return cross_sections


stock_catalog = [
    BeamStock(5.0, section)
    for section in get_cross_sections_from_model(model)
]

if individual:
    spacing = 100
else:
    spacing = spacing

nester = BeamNester(model, stock_catalog, spacing, per_group=True)
nesting_result = nester.nest(fast=False, consoles=True, optimize=True, exclude_groups=exclude)
# total_material_volume = nesting_result.total_material_volume
stock_report = nesting_result.total_stock_pieces
print(stock_report)
summary = nesting_result.summary
for stock_type, dimensions_dict in stock_report.items():
    print(f"{stock_type}:")
    for dimensions, count in dimensions_dict.items():
        print(f"  {dimensions} -> {count} piece(s)")

debug_volumes = []
for i, stock in enumerate(nesting_result.stocks):
    if i == index:
        consoles_positions = stock.consoles_positions

        for guid, data in stock.element_data.items():

            element = model.element_by_guid(str(guid))
            key = data.get("key")
            frame = data.get("frame")
            att = element.attributes
            if element.attributes["gripper_position"] != None:
                gripper_local = float(element.attributes["gripper_position"])
            else:
                gripper_local = None
            blank_ext = element._resolve_blank_extensions()
            value = blank_ext[0]

            frame = Frame(frame.point + (value, 0, 0), Vector.Xaxis(), -Vector.Zaxis())
            offset_transformation = Translation.from_vector(Vector.Zaxis() * element.height / 2.0)

            cnc_transformation = (
                Transformation.from_frame(frame)
                * offset_transformation
            )

            geo = element.elementgeometry.transformed(cnc_transformation)
            geo_scene.add(geo)

            local_blank = element.blank.transformed(element.transformation_to_local())
            local_blank.transform(Transformation.from_frame(frame))
            local_blank.translate(Vector.Yaxis() * element.height / 2.0)
            blank_scene.add(local_blank)

            if gripper_local:
                if blank_ext:
                    gripper_positions.append(frame.point.x + gripper_local - value)
                else:
                    gripper_positions.append(frame.point.x + gripper_local)
            else:
                gripper_positions.append("Assembly by hand")

            print(blank_ext)

def get_file_name(file_path):
    file_path_components = file_path.split('/')
    file_name_and_extension = file_path_components[-1].rsplit('.', 1)
    return file_name_and_extension[0]

if write:
    dir_path = get_file_name(path)
    json_dump(model, fp=dir_path+"_fabrication.json", pretty=True)

geometry = geo_scene.draw()
blank = blank_scene.draw()
debug_volumes = list_to_tree(debug_volumes)
# ---------- end positioner_2 ----------
writebtlx_2 = CTWriteBTLx(model=model_2.model, path=path_3, nesting_result=positioner_2.nesting_result, write=btlx_2)  # -> BTLx; inputs write: Boolean; disabled; same code as writebtlx
addition = Addition(A=positioner.gripper_positions, B=Slider(0, range=-2..2.001))
addition_2 = Addition(A=positioner_2.gripper_positions, B=number_slider_2)  # disabled
consoles_positions = Panel(positioner.consoles_positions)
gripper_positions = Panel(addition)
consoles_positions_2 = Panel(positioner_2.consoles_positions)  # disabled
gripper_positions_2 = Panel(addition_2)  # disabled
gripper = Gripper(G=list, F=graft(addition), A=gripper_separation)
beam = Beam(G=positioner.geometry, geo=positioner.blank, A=side_index)
consoles = Consoles(F=positioner.consoles_positions)
gripper_2 = Gripper(G=list_2, F=graft(addition_2), A=gripper_separation_2)  # disabled
beam_2 = Beam(G=positioner_2.geometry, geo=positioner_2.blank, A=side_index_2)  # disabled
consoles_2 = Consoles(F=positioner_2.consoles_positions)  # disabled
summary = Panel(positioner.summary)
summary_2 = Panel(positioner_2.summary)  # disabled

# ==== cluster Consoles
xz = XZPlane(Origin=Point(0, 0, 0))
pt = ConstructPoint(XCoordinate=0, YCoordinate=0, ZCoordinate=0)
pt_2 = ConstructPoint(
    XCoordinate=Slider(120, range=0..1000),
    YCoordinate=Slider(2500, range=0..10000),
    ZCoordinate=expr("-x", Slider(140, range=0..1000)))
division = Division(A=pt_2, B=1000)
box = Box2Pt(PointA=pt, PointB=division, Plane=PlaneXY(0, 0, 0))
division_2 = Division(A=Slider(70, range=0..100), B=1000)
F = ClusterInput()
Z = UnitZ(Factor=expr("-x", division_2))
X = UnitX(Factor=F)
lng = ListLength(List=X)
series = Series(Start=Slider(0.3, range=0..1), Step=Slider(0.2, range=0..1), Count=lng)
move = Move(Geometry=box, Motion=Z)  # -> Geometry, Transform
move_2 = Move(Geometry=move.Geometry, Motion=X)  # -> Geometry, Transform
geo = Geometry(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)
aligndim = AlignedDimension(Plane=xz, PointA=pt, PointB=X, Offset=expr("-x", series), Text="{0:0.00}", Size=Slider(0.1, range=0..0.1))
preview = CustomPreview(Geometry=[move_2.Geometry, geo], Material=ColourSwatch(SwatchColor=RGBA(0, 0, 0, 119)))

# ==== cluster Beam
X = UnitX(Factor=1)
A = ClusterInput()
subtraction = Subtraction(A=A, B=3)
geo = ClusterInput()
neg = Negative(Value=subtraction)
multiplication = Multiplication(A=90, B=neg)
geo_2 = Geometry(geo)
area = Area(Geometry=geo_2)  # -> Area, Centroid
line = LineSDL(Start=area.Centroid, Direction=X, Length=1)
rot3d = Rotate3D(Geometry=geo_2, Angle=degrees(multiplication), Center=area.Centroid, Axis=line)  # -> Geometry, Transform
debox = DeconstructBox(Box=rot3d.Geometry)  # -> Plane, X, Y, Z
division = Division(A="70", B=1000)
Z = UnitZ(Factor=division)
dedomain = DeconstructDomain(Domain=debox.Z)  # -> Start, End
move = Move(Geometry=rot3d.Geometry, Motion=Z)  # -> Geometry, Transform
subtraction_2 = Subtraction(A=dedomain.End, B=dedomain.Start)
division_2 = Division(A="280", B=1000)
merge = Merge(Data1=graft(rot3d.Geometry), Data2=graft(move.Geometry))
equalst = EqualityWithinTolerance(FirstNumber=subtraction_2, SecondNumber=division_2, Tolerance=0.001)  # -> Equality, Inequality
panel = Panel(equalst.Equality)
graft = GraftTree(Tree=equalst.Equality, IncludeEmptyLists=True, IncludeNullItems=True)
item = ListItem(List=merge, Index=graft, Wrap=True)
edges = BrepEdges(Brep=item)  # -> Naked, Interior, NonManifold
previewlw = CustomPreviewLineweights(Geometry=edges.Interior, Shader=ColourSwatch(SwatchColor=RGB(255, 71, 71)), Absolute=False)
division_3 = Division(A="70", B=1000)
Z_2 = UnitZ(Factor=division_3)
G = ClusterInput()
transform = Transform(Geometry=G, Transform=rot3d.Transform)
move_2 = Move(Geometry=transform, Motion=Z_2)  # -> Geometry, Transform
merge_2 = Merge(Data1=graft(transform), Data2=graft(move_2.Geometry))
item_2 = ListItem(List=merge_2, Index=graft, Wrap=True)
edges_2 = BrepEdges(Brep=item_2)  # -> Naked, Interior, NonManifold
preview = CustomPreview(Geometry=item_2, Material=ColourSwatch(SwatchColor=RGBA(255, 171, 97, 119)))
previewlw_2 = CustomPreviewLineweights(Geometry=edges_2.Interior, Shader=ColourSwatch(SwatchColor=RGB(0, 0, 0)), Absolute=False)

# ==== cluster Gripper
medium = Geometry([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])
G = ClusterInput()
long = Geometry([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])
filter = StreamFilter(Gate=G, Stream0=medium, Stream1=long, Stream2=long)
A = ClusterInput()
F = ClusterInput()
division = Division(A=Slider(60, range=0..100), B=1000)
division_2 = Division(A=Slider(225, range=0..1000), B=1000)
Z = UnitZ(Factor=division_2)
X = UnitX(Factor=F)
move = Move(Geometry=filter, Motion=Z)  # -> Geometry, Transform
number_slider = Slider(2, range=0..10)
move_2 = Move(Geometry=move.Geometry, Motion=X)  # -> Geometry, Transform
Y = UnitY(Factor=division)
smaller = SmallerThan(FirstNumber=A, SecondNumber=number_slider)  # -> SmallerThan, OrEqualTo
panel = Panel("""33
34
35
36
45
46
47""")
panel_2 = Panel("""25
26
27
28
29
30""")
panel_3 = Panel("""81
82
83
84
85
86""")
move_3 = Move(Geometry=move_2.Geometry, Motion=Y)  # -> Geometry, Transform
filter_2 = StreamFilter(Gate=smaller.OrEqualTo, Stream0=number_slider, Stream1=A)
subtraction = Subtraction(A=number_slider, B=filter_2)
item = ListItem(List=move_3.Geometry, Index=panel_2, Wrap=True)
item_2 = ListItem(List=move_3.Geometry, Index=panel_3, Wrap=True)
item_3 = ListItem(List=move_3.Geometry, Index=36, Wrap=True)
item_4 = ListItem(List=move_3.Geometry, Index=panel, Wrap=True)
cull_i = CullIndex(List=move_3.Geometry, Indices=[panel_3, panel_2, panel], Wrap=True)
division_3 = Division(A=subtraction, B=2)
explode = ExplodeObject(Object=item_3, Recursive=False)
multiplication = Multiplication(A=A, B=Slider(0.5, range=0..1))
X_2 = UnitX(Factor=division_3)
move_4 = Move(Geometry=item_2, Motion=expr("-x", X_2))  # -> Geometry, Transform
move_5 = Move(Geometry=item, Motion=X_2)  # -> Geometry, Transform
area = Area(Geometry=explode)  # -> Area, Centroid
scale_nu = ScaleNU(Geometry=item_3, Plane=area.Centroid, ScaleX=multiplication, ScaleY=1, ScaleZ=1)  # -> Geometry, Transform
filter_3 = StreamFilter(
    Gate=G,
    Stream0=move_3.Geometry,
    Stream1=move_3.Geometry,
    Stream2=[cull_i, move_4.Geometry, move_5.Geometry, scale_nu.Geometry])
preview = CustomPreview(Geometry=filter_3, Material=ColourSwatch(SwatchColor=RGBA(0, 0, 0, 119)))
