# Grasshopper definition export_hops.ghx (Grasshopper 1.0.8)
# plug-ins: Human, Increment

py3 = Python3Script(unload=Button())  # inputs unload: Boolean
# ---------- py3: Python ----------
from compas_rhino import unload_modules

import easyhops
if unload:
    unload_modules("easyhops")
# ---------- end py3 ----------

list = ValueList({"main_primary", "primary", "secondary", "tertiary", "shoe"}, selected="shoe")
hops = Button()
btlx = Button()
flip = BooleanToggle(False)
increment = Increment(BeginningNumber=0, StepSize=1, currentValue=13, increment=1, oldStart=0)  # -> Output, Item
path = FilePath("C:\Users\kapso\GitHub\llhil-t2-fabrication\design\timber_design\data\260618_v1_timber_models.json")
panel = Panel(path)
list_2 = ValueList({"zero": 0, "1", "2", "3", "4"}, selected="1")
flip_2 = BooleanToggle(True)
py3_2 = Python3Script(filepath=path, level=list_2, index=increment.Output, flip=flip, write=btlx, export=hops)  # -> out, model, geometry, processing_report, hops_report, btlx_errors; inputs filepath: String, hierarchy: String, level: Int32, index: Int32, flip: Boolean, export: Boolean, names: list
# ---------- py3_2: Python ----------
# venv: t2_living_lab
# r: compas_timber @ git+https://github.com/MAS-dfab/compas_timber.git@t2-2526

import os, sys, importlib
import copy
import math
from compas.scene import Scene
from compas_timber.model import TimberModel
from compas_timber.fabrication import BTLxWriter
from compas_rhino.conversions import plane_to_rhino

from compas.geometry import angle_vectors

gh_dir = os.path.dirname(ghenv.Component.OnPingDocument().FilePath)

repo_root = os.path.dirname(os.path.dirname(gh_dir))
cnc_dir = os.path.join(repo_root, "fabrication", "cnc")
# if hierarchy:
#     name = str(hierarchy)
# elif level:
#     name = "level_" + str(level)
name = "level_"+ str(level)
btlx_dir = cnc_dir + "\\BTLx\\" + name
hops_dir =cnc_dir + "\\HOPS\\" + name

if cnc_dir not in sys.path:
    sys.path.insert(0, cnc_dir)

import hops_exporter as he
importlib.reload(he)

scene = Scene()

model = he.load_model(filepath)
# for beam in model.beams:
#     for f in beam.features:
#         if f.PROCESSING_NAME == "Drilling":
#             if f.depth*1000 == 0:
#                 f.depth_limited = False
#             #     beam.remove_features(f)
#             #     print("removed_one!")
#             # else:
#             #     print(f.depth*1000)
#     beam.reset_computed_properties()
            
export_dir = os.path.join(os.path.dirname(filepath), "hops")
beam = he.resolve_beam(model, index, hierarchy, level, names=names)

if beam:
    he.override_features(beam, flip)
    if beam.attributes.get("hierarchy") != "shoe":
        geometry = he.visualize_geometry(beam)
        processing_report = he.get_processing_report(beam)
    else: 
        processing_report = "it's a shoe"
btlx_errors = []
if write:
    new_model = TimberModel()
    for beam in model.beams:
        # if hierarchy:
        #     if beam.attributes.get("hierarchy") == hierarchy:
        #         new_model.add_element(beam)
        # if level:
        if beam.attributes.get("level") == level:
            new_model.add_element(beam)
    writer = BTLxWriter()
    xml = writer.write(new_model, file_path=btlx_dir)
    btlx_errors.append(writer.errors)
print(hops_dir)
hops_report = []
if export:
    HOPSJob = he.export_hop(beam, hops_dir)
    hops_report.append(HOPSJob)
# ---------- end py3_2 ----------
panel_2 = Panel(py3_2.hops_report)
# M0L1_69 has an issue with the ref_side of the DoubleCut!!
# M0L0_49/09 has an issue with the ref_side of the DoubleCut!!
panel_3 = Panel(py3_2.processing_report)
panel_4 = Panel(py3_2.out)
py3_3 = Python3Script(unload=Button())  # -> out
# ---------- py3_3: Python ----------
from compas_rhino import unload_modules
import compas_timber

if unload:
    unload_modules("compas_timber")
    print("Succesfully unloaded CT!")
# ---------- end py3_3 ----------
panel_5 = Panel(py3_3)
toggle = BooleanToggle(False)  # disabled
cluster = Cluster(data=py3_2.geometry)  # -> A, B
py3_4 = Python3Script(model=py3_2.model, viz=toggle)  # -> a, b; disabled
# ---------- py3_4: Python ----------
from compas.scene import Scene
from compas_rhino.conversions import line_to_compas
scene = Scene()
debug_scene = Scene()

if viz:
    for beam in model.beams:
        # if beam == i:
        #     beam.add_features(Drilling.from_line_and_element(line_to_compas(line), beam))
        # if name is not None:
        #     if beam.name == name:
        scene.add(beam.geometry)
        if beam.debug_info:
            for fae in beam.debug_info:
                if isinstance(fae.feature_geometry, list):
                    debug_scene.add(fae.feature_geometry[0])
                else:
                    debug_scene.add(fae.feature_geometry)
    a = scene.draw()
    b = debug_scene.draw()
# ---------- end py3_4 ----------
py3_5 = Python3Script()  # -> out, a
# ---------- py3_5: Python ----------
print((0 - 3) % 4)
# ---------- end py3_5 ----------
edges = BrepEdges(Brep=py3_4.a)  # -> Naked, Interior, NonManifold; disabled
swatch = ColourSwatch(SwatchColor=RGBA(158, 150, 108, 184))  # disabled
preview = CustomPreview(Geometry=py3_4.a, Material=swatch)  # disabled
preview_2 = CustomPreview(Geometry=cluster.B, Material=ColourSwatch(SwatchColor=RGBA(158, 150, 108, 184)))
previewlw = CustomPreviewLineweights(Geometry=edges.Interior, Shader=ColourSwatch(SwatchColor=RGBA(0, 0, 0, 184)), Absolute=False)  # disabled
previewlw_2 = CustomPreviewLineweights(Geometry=cluster.A, Shader=ColourSwatch(SwatchColor=RGBA(255, 0, 0, 184)), Absolute=False)

# ==== cluster Cluster
data = ClusterInput()
data_2 = Data(data)
brep = Brep(data_2)
null = NullItem(Item=brep)  # -> NullFlags, InvalidFlags, Description
dispatch = Dispatch(List=data_2, DispatchPattern=null.NullFlags)  # -> ListA, ListB
A = ClusterOutput(dispatch.ListA)
B = ClusterOutput(dispatch.ListB)
