# Grasshopper definition trajectory_test.ghx (Grasshopper 1.0.8)
# plug-ins: Pufferfish, ghgl

py3 = Python3Script()  # -> out, f
# ---------- py3: Python ----------
import compas
from compas.geometry import Frame, Point, Vector
from compas_rhino.conversions import frame_to_rhino_plane

f = Frame(Point(10,10,1), Vector.Yaxis(), Vector.Xaxis())
f = frame_to_rhino_plane(f)
# ---------- end py3 ----------
compas_fab_ros_connect = COMPASFABROSConnect(connect=Toggle(True))  # -> ros_client, is_connected; inputs ip: String, port: Int32, connect: Boolean
#   port ip: The ip address ROS. Defaults to 127.0.0.1.
#   port port: The port of ROS. Defaults to 9090.
#   port connect: If True, connects to ROS. If False, disconnects from ROS. Defaults to False.
#   port ros_client: The ROS client.
#   port is_connected: True if connection established.
# ---------- compas_fab_ros_connect: Python ----------
# r: compas_fab>=1.0.2
"""
Connect or disconnect to ROS.

COMPAS FAB v1.0.2
"""

import Grasshopper
from compas_ghpython import create_id
from scriptcontext import sticky as st

from compas_fab.backends import RosClient


class ROSConnect(Grasshopper.Kernel.GH_ScriptInstance):
    def RunScript(self, ip: str, port: int, connect: bool):
        ros_client = None

        ip = ip or "127.0.0.1"
        port = port or 9090

        key = create_id(ghenv.Component, "ros_client")  # noqa: F821
        ros_client = st.get(key, None)

        if ros_client:
            st[key].close()
        if connect:
            st[key] = RosClient(ip, port)
            st[key].run(5)

        ros_client = st.get(key, None)
        is_connected = ros_client.is_connected if ros_client else False
        return (ros_client, is_connected)
# ---------- end compas_fab_ros_connect ----------

# ---- group: SAFE
pln = Plane(Plane(origin=(11.2172932, 6.937054386, 2.742677148), x=(0, -1, 0), y=(1, 0, 0)))
pflip = FlipPlane(Plane=pln, ReverseX=False, ReverseY=False, SwapAxes=True)

# ---- group: PICKUP
pln_2 = Plane(Plane(origin=(8.694522113, 4.563865698, 1.198251008), x=(0.9999675249, 0, -0.00805910755), y=(0, -1, 0)))

# ----
load = Button()

# ---- group: START CONFIG
py3_2 = Python3Script(x="Grasshopper.Kernel.Types.GH_ObjectWrapper")  # -> out, config
# ---------- py3_2: Python ----------
import compas_fab
from compas_robots import Configuration
import math

config = Configuration(
    [10.0, -7.0, -4.0, -1.5707963267948966, -0.9599310885968813, 0.9599310885968813, 3.141592653589793, 1.5707963267948966, -1.5707963267948966, -12.0, -4.5, 0.0, 1.5707963267948966, 0.0, 0.0, 0.0, 0.0, 30.0, 0.0, -2.96, 0.0, 0.0, 0.0, 0.0, 0.0, 0.0, -7.412, -2.96, 0.0, 0.0, 0.0, 0.0, 0.0, 0.0],
    [2, 2, 2, 0, 0, 0, 0, 0, 0, 2, 2, 0, 0, 0, 0, 0, 0, 2, 2, 2, 0, 0, 0, 0, 0, 0, 2, 2, 0, 0, 0, 0, 0, 0],
    ['bridge1_joint_EA_X', 'robot11_joint_EA_Y', 'robot11_joint_EA_Z', 'robot11_joint_1', 'robot11_joint_2', 'robot11_joint_3', 'robot11_joint_4', 'robot11_joint_5', 'robot11_joint_6', 'robot12_joint_EA_Y', 'robot12_joint_EA_Z', 'robot12_joint_1', 'robot12_joint_2', 'robot12_joint_3', 'robot12_joint_4', 'robot12_joint_5', 'robot12_joint_6', 'bridge2_joint_EA_X', 'robot21_joint_EA_Y', 'robot21_joint_EA_Z', 'robot21_joint_1', 'robot21_joint_2', 'robot21_joint_3', 'robot21_joint_4', 'robot21_joint_5', 'robot21_joint_6', 'robot22_joint_EA_Y', 'robot22_joint_EA_Z', 'robot22_joint_1', 'robot22_joint_2', 'robot22_joint_3', 'robot22_joint_4', 'robot22_joint_5', 'robot22_joint_6']
)

config["robot12_joint_EA_Y"] = config["robot11_joint_EA_Y"]
config["robot12_joint_EA_Z"] = config["robot11_joint_EA_Z"]
config["robot12_joint_1"] = config["robot11_joint_1"]
config["robot12_joint_2"] = config["robot11_joint_2"]
config["robot12_joint_3"] = config["robot11_joint_3"]
config["robot12_joint_4"] = config["robot11_joint_4"]
config["robot12_joint_5"] = config["robot11_joint_5"]
config["robot12_joint_6"] = config["robot11_joint_6"]

config["robot11_joint_EA_Y"] = -1.1
config["robot11_joint_EA_Z"] = -4.9
config["robot11_joint_1"] = math.radians(180)
config["robot11_joint_2"] = math.radians(90)
config["robot11_joint_3"] = math.radians(-35)
config["robot11_joint_4"] = math.radians(180)
config["robot11_joint_5"] = math.radians(90)
config["robot11_joint_6"] = math.radians(-0)
# ---------- end py3_2 ----------

# ----
geo = Geometry([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])

# ---- group: ROBOT
compas_fab_ros_robot = COMPASFABROSRobot(ros_client=compas_fab_ros_connect.ros_client, load=load)  # -> robot; inputs load: Boolean
#   port ros_client: The ROS client.
#   port load: If True, loads the robot from ROS. Defaults to False.
# ---------- compas_fab_ros_robot: Python ----------
# r: compas_fab>=1.0.2
"""
Load robot directly from ROS.

COMPAS FAB v1.0.2
"""

import Grasshopper
from compas_ghpython import create_id
from scriptcontext import sticky as st

from compas.scene import SceneObject


class ROSRobot(Grasshopper.Kernel.GH_ScriptInstance):
    def RunScript(self, ros_client, load: bool):
        key = create_id(ghenv.Component, "robot")  # noqa: F821

        if ros_client and ros_client.is_connected and load:
            # Load URDF from ROS
            st[key] = ros_client.load_robot(load_geometry=True, precision=12)
            st[key].scene_object = SceneObject(item=st[key].model)

        robot = st.get(key, None)
        if robot:  # client sometimes need to be restarted, without needing to reload geometry
            robot.client = ros_client
        return robot
# ---------- end compas_fab_ros_robot ----------

# ----
pln_3 = Plane(Plane(origin=(7.884683624, 6.821619432, 0.897381093), x=(-0.9424448827, 0, -0.3343615454), y=(0, 1, 0)))
mesh = Mesh(<mesh referenced from the Rhino model>)
mesh_2 = Mesh(geo)
merge = Merge(Data1=py3_2.config, Data2=pln_2, Data3=pln_3)  # -> graft(Result)
py3_3 = Python3Script()  # -> out, p1, f1, f2, fs, box; disabled
# ---------- py3_3: Python ----------
from compas.geometry import Frame, Point, Vector, Box
from compas.data import json_load

p1 = Point(x=11.607, y=0.566, z=0.989)

f1 = Frame(point=Point(x=9.565, y=8.180, z=0.793), xaxis=Vector(x=0.999, y=-0.041, z=-0.005), yaxis=Vector(x=-0.041, y=-0.999, z=0.007))
f2 = Frame(point=Point(x=9.563, y=8.130, z=0.793), xaxis=Vector(x=0.999, y=-0.041, z=-0.005), yaxis=Vector(x=-0.041, y=-0.999, z=0.007))
box = Box(xsize=2.2872280199818054, ysize=0.1400000000000009, zsize=0.14000000000004312, frame=Frame(point=Point(x=2073.6828650090974, y=870.4613768393101, z=70.00286865232223), xaxis=Vector(x=-1.0, y=0.0, z=-4.997226323222658e-17), yaxis=Vector(x=4.334402908831805e-38, y=-1.0, z=-8.673617379884038e-22)))


fs = [Frame(point=Point(x=10.808803441903999, y=1.1904816678352994, z=1.0181644824476035), xaxis=Vector(x=-0.9999999856494718, y=-1.30089909105231e-05, z=0.00016891365376310157), yaxis=Vector(x=-0.00016889828686147352, y=-0.0011723309009553974, z=-0.9999992985565678)), Frame(point=Point(x=12.060284423944585, y=1.1904979483402531, z=1.0179530902192784), xaxis=Vector(x=-0.9999999856494718, y=-1.30089909105231e-05, z=0.00016891365376310154), yaxis=Vector(x=-0.0001688982868614735, y=-0.0011723309009553974, z=-0.9999992985565678))]
# ---------- end py3_3 ----------
data = Data("robot12_eaXYZ")
item = ListItem(List=mesh_2, Index=0, Wrap=True)
compas_draw = COMPASDraw(cg=py3_3.box)  # -> rg; disabled
#   port cg: The COMPAS geometry or datastructure to be drawn.
#   port rg: The Rhino geometry object.
# ---------- compas_draw: Python ----------
# r: compas>=2.14.1
"""
Draws COMPAS geometry in Grasshopper.
"""

from typing import Any

import Grasshopper

from compas.scene import SceneObject


class CompasToRhinoGeometry(Grasshopper.Kernel.GH_ScriptInstance):
    def RunScript(self, cg):
        if not cg:
            return None

        return SceneObject(item=cg).draw()
# ---------- end compas_draw ----------
compas_draw_2 = COMPASDraw(cg=py3_3.p1)  # -> rg; disabled; same code as compas_draw
compas_draw_3 = COMPASDraw(cg=py3_3.f2)  # -> rg; disabled; same code as compas_draw
compas_draw_4 = COMPASDraw(cg=py3_3.f1)  # -> rg; disabled; same code as compas_draw
compas_draw_5 = COMPASDraw(cg=py3_3.fs)  # -> rg; disabled; same code as compas_draw
merge_2 = Merge(Data1=pln_2, Data2=pln_3, Data3=pflip)
toggle = BooleanToggle(True)
pt = Point(Point(12.02529412, 9.893405135, 3.517071723))
toggle_2 = BooleanToggle(False)
item_2 = ListItem(List=compas_draw_4, Index=0, Wrap=True)  # -> Item, Item1, Item2, Item3; disabled
number_slider = Slider(0, range=0..10)  # disabled
pt_2 = ConstructPoint(XCoordinate=0, YCoordinate=0, ZCoordinate="0.157")
line = Line(item_2.Item1)  # disabled
pl = ConstructPlane(Origin=pt_2, XAxis=Vector(1, 0, 0), YAxis=Vector(0, 1, 0))
pt_3 = Point(item_2.Item)  # disabled
mesh_3 = Mesh(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)
mesh_4 = Mesh(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)
item_3 = ListItem(List=flatten(line), Index=number_slider, Wrap=invert(True))  # disabled
item_4 = ListItem(List=flatten(pt_3), Index=number_slider, Wrap=invert(True))  # disabled
number_slider_2 = Slider(110, range=0..300)
number_slider_3 = Slider(67, range=0..80)
compas_fab_attached_tool = COMPASFABAttachedTool(
    robot=compas_fab_ros_robot,
    visual_mesh=mesh_3,
    collision_mesh=mesh_4,
    tcf_plane=pl,
    group="robot12_eaXYZ",
    connected_to="robot12_tool0")  # -> robot; inputs visual_mesh: Mesh, collision_mesh: Mesh
#   port visual_mesh: A visual mesh for the tool.
#   port collision_mesh: A collision mesh for the tool.
#   port tcf_plane: The frame of the tool in tool0 frame.
#   port group: The planning group to which the tool should be attached.
#   port connected_to: The link to which the tool should be connected to.
# ---------- compas_fab_attached_tool: Python ----------
# r: compas_fab>=1.0.2
"""
Attach a tool to the robot.

COMPAS FAB v1.0.2
"""

import Grasshopper
import Rhino
from compas.geometry import Frame
from compas_rhino.conversions import mesh_to_compas
from compas_rhino.conversions import plane_to_compas_frame

from compas_fab.robots import Tool


class AttachToolComponent(Grasshopper.Kernel.GH_ScriptInstance):
    def RunScript(self,
            robot,
            visual_mesh: Rhino.Geometry.Mesh,
            collision_mesh: Rhino.Geometry.Mesh,
            tcf_plane,
            group,
            connected_to):
        if robot and robot.client and robot.client.is_connected and visual_mesh:
            if not collision_mesh:
                collision_mesh = visual_mesh

            c_visual_mesh = mesh_to_compas(visual_mesh)
            c_collision_mesh = mesh_to_compas(collision_mesh)

            if not tcf_plane:
                frame = Frame.worldXY()
            else:
                frame = plane_to_compas_frame(tcf_plane)
            tool = Tool(c_visual_mesh, frame, c_collision_mesh, connected_to=connected_to)

            robot.attach_tool(tool, group)
            print("attached_tool", tool.name, group)

        return robot
# ---------- end compas_fab_attached_tool ----------
data_2 = Data(compas_fab_attached_tool)
constraints_from_plane = COMPASFABConstraintsFromPlane(robot=data_2, plane=pln_2, group=data)  # -> constraints; inputs group: String, tolerance_position: Double, tolerance_xaxis: Double, tolerance_yaxis: Double, tolerance_zaxis: Double
#   port plane: The plane or frame from which we create position and orientation constraints.
#   port group: The planning group for which we specify the constraint. Defaults to the robot's main planning group.
#   port tolerance_position: The allowed tolerance to the frame's position (defined in the robot's units). Defaults to 0.001
#   port tolerance_xaxis: The allowed tolerance of the frame's X-axis in degrees.
#   port tolerance_yaxis: The allowed tolerance of the frame's Y-axis in degrees.
#   port tolerance_zaxis: The allowed tolerance of the frame's Z-axis in degrees.
#   port constraints: A list containing a position and an orientation constraint.
# ---------- constraints_from_plane: Python ----------
# r: compas_fab>=1.0.2
"""
Create a position and an orientation constraint from a plane calculated for the group's end-effector link.

COMPAS FAB v1.0.2
"""

import math

import Grasshopper
import System
from compas_rhino.conversions import plane_to_compas_frame


class ConstraintsFromPlane(Grasshopper.Kernel.GH_ScriptInstance):
    def RunScript(self,
            robot,
            plane,
            group: str,
            tolerance_position: float,
            tolerance_xaxis: float,
            tolerance_yaxis: float,
            tolerance_zaxis: float):
        goal_constraints = None
        if robot and plane:
            tolerance_position = tolerance_position or 0.001
            tolerance_xaxis = tolerance_xaxis or 1.0
            tolerance_yaxis = tolerance_yaxis or 1.0
            tolerance_zaxis = tolerance_zaxis or 1.0

            frame = plane_to_compas_frame(plane)
            tolerances_axes = [
                math.radians(tolerance_xaxis),
                math.radians(tolerance_yaxis),
                math.radians(tolerance_zaxis),
            ]
            goal_constraints = robot.constraints_from_frame(frame, tolerance_position, tolerances_axes, group)

        return goal_constraints
# ---------- end constraints_from_plane ----------
constraints_from_plane_2 = COMPASFABConstraintsFromPlane(robot=data_2, plane=pflip, group=data)  # -> constraints; inputs group: String, tolerance_position: Double, tolerance_xaxis: Double, tolerance_yaxis: Double, tolerance_zaxis: Double; same code as constraints_from_plane
constraints_from_plane_3 = COMPASFABConstraintsFromPlane(robot=data_2, plane=pflip, group=data)  # -> constraints; inputs group: String, tolerance_position: Double, tolerance_xaxis: Double, tolerance_yaxis: Double, tolerance_zaxis: Double; same code as constraints_from_plane
scene = COMPASFABPlanningScene(robot=compas_fab_attached_tool)  # -> scene
#   port scene: A planning scene.
# ---------- scene: Python ----------
# r: compas_fab>=1.0.2
"""
Create a planning scene.

COMPAS FAB v1.0.2
"""

import Grasshopper
from compas_ghpython import create_id
from scriptcontext import sticky as st

from compas_fab.robots import PlanningScene


class PlanningSceneComponent(Grasshopper.Kernel.GH_ScriptInstance):
    def RunScript(self, robot):
        key = create_id(ghenv.Component, "planning_scene")  # noqa: F821
        if robot:
            st[key] = PlanningScene(robot)
        return st.get(key, None)
# ---------- end scene ----------
plan_motion = COMPASFABPlanMotion(
    robot=compas_fab_attached_tool,
    goal_constraints=constraints_from_plane,
    start_configuration=py3_2.config,
    group="robot12_eaXYZ",
    compute=Button())  # -> trajectory; inputs goal_constraints: list, group: String, attached_collision_meshes: list, path_constraints: list, planner_id: String, compute: Boolean
#   port goal_constraints: The goal to be achieved, defined in a set of constraints. Constraints can be very specific, for example defining value domains for each joint, such that the goal configuration is included, or defining a volume in space, to which a specific robot link (e.g. the end-effector) is required to move to.
#   port start_configuration: The robot's full configuration, i.e. values for all configurable joints of the entire robot, at the starting position. Defaults to the all-zero configuration.
#   port group: The planning group used for calculation. Defaults to the robot's main planning group.
#   port attached_collision_meshes: A list of attached collision meshes to be included for planning.
#   port path_constraints: Optional constraints that can be imposed along the solution path. Note that path calculation won't work if the start_configuration violates these constraints. Defaults to None.
#   port planner_id: The name of the algorithm used for path planning. Defaults to 'RRTConnect'
#   port compute: If True, calculates a trajectory.
#   port trajectory: The calculated trajectory.
# ---------- plan_motion: Python ----------
# r: compas_fab>=1.0.2
"""
Calculate a motion path.

COMPAS FAB v1.0.2
"""

import Grasshopper
import System
from compas_ghpython import create_id
from scriptcontext import sticky as st


class PlanMotion(Grasshopper.Kernel.GH_ScriptInstance):
    def RunScript(self,
            robot,
            goal_constraints: System.Collections.Generic.List[object],
            start_configuration,
            group: str,
            attached_collision_meshes: System.Collections.Generic.List[object],
            path_constraints: System.Collections.Generic.List[object],
            planner_id: str,
            compute: bool):
        key = create_id(ghenv.Component, "trajectory")  # noqa: F821

        path_constraints = list(path_constraints) if path_constraints else None
        attached_collision_meshes = list(attached_collision_meshes) if attached_collision_meshes else None
        planner_id = str(planner_id) if planner_id else "RRTConnect"

        if (
            robot
            and robot.client
            and robot.client.is_connected
            and start_configuration
            and goal_constraints
            and compute
        ):
            st[key] = robot.plan_motion(
                goal_constraints,
                start_configuration=start_configuration,
                group=group,
                options=dict(
                    attached_collision_meshes=attached_collision_meshes,
                    path_constraints=path_constraints,
                    planner_id=planner_id,
                ),
            )

        trajectory = st.get(key, None)
        return trajectory
# ---------- end plan_motion ----------
compas_fab_trajectory_visualize = COMPASFABTrajectoryVisualize(robot=compas_fab_attached_tool, group="robot12_eaXYZ", trajectory=plan_motion)  # -> start_configuration, configurations, fraction, time, planes, P, V, A; inputs group: String
#   port group: The planning group for which this trajectory was planned.
#   port trajectory: The calculated trajectory.
#   port start_configuration: The start configuration of the trajectory.
#   port configurations: The full configurations along the trajectory.
#   port fraction: Indicates the fraction of requested trajectory that was calculated, e.g. 1 means the full trajectory was found.
#   port time: The time which is needed to execute that trajectory at full speed.
#   port planes: The planes of the robot's end-effector.
#   port P: The positions along the trajectory
#   port V: The velocities along the trajectory
#   port A: The accelerations along the trajectory
# ---------- compas_fab_trajectory_visualize: Python ----------
# r: compas_fab>=1.0.2
"""
Visualizes a trajectory.

COMPAS FAB v1.0.2
"""

import Grasshopper
from compas_ghpython.drawing import draw_frame
from compas_ghpython.sets import list_to_ghtree


class TrajectoryVisualize(Grasshopper.Kernel.GH_ScriptInstance):
    def RunScript(self, robot, group: str, trajectory):
        start_configuration = None
        configurations = []
        fraction = 0.0
        time = 0.0

        planes = []
        positions = []
        velocities = []
        accelerations = []

        if robot and trajectory:
            group = group or robot.main_group_name

            for c in trajectory.points:
                configurations.append(
                    robot.merge_group_with_full_configuration(c, trajectory.start_configuration, group)
                )
                frame = robot.forward_kinematics(c, group, options=dict(solver="model"))
                planes.append(draw_frame(frame))
                positions.append(c.positions)
                velocities.append(c.velocities)
                accelerations.append(c.accelerations)

            start_configuration = trajectory.start_configuration
            fraction = trajectory.fraction
            time = trajectory.time_from_start

        P = list_to_ghtree(list(zip(*positions)))
        V = list_to_ghtree(list(zip(*velocities)))
        A = list_to_ghtree(list(zip(*accelerations)))

        # return outputs if you have them; here I try it for you:
        return (start_configuration, configurations, fraction, time, planes, P, V, A)
# ---------- end compas_fab_trajectory_visualize ----------
item_5 = ListItem(List=compas_fab_trajectory_visualize.configurations, Index=0, Wrap=True)  # -> Item1, Item
number_slider_4 = Slider(502, range=0..1600)
number_slider_5 = Slider(2505, range=0..3000)
compas_fab_zero_config = COMPASFABZeroConfig(robot=compas_fab_attached_tool)  # -> config; inputs group: String
#   port group: If assigned, it will return the zero configuration for the given group, otherwise a full zero configuration.
#   port config: The zero configuration.
# ---------- compas_fab_zero_config: Python ----------
# r: compas_fab>=1.0.2
"""
Get a zero configuration for a robot.

COMPAS FAB v1.0.2
"""

import Grasshopper


class ConfigZero(Grasshopper.Kernel.GH_ScriptInstance):
    def RunScript(self, robot, group: str):
        if robot:
            return robot.zero_configuration(group)

        return None
# ---------- end compas_fab_zero_config ----------
number_slider_6 = Slider(8000, range=0..10000)
panel = Panel(compas_fab_zero_config)
jagged = SettingsSpeed()
python_3_script = Python3Script()  # -> out, frames, frames1, traj0, traj1, config, frm, traj_frames, trajs; disabled
# ---------- python_3_script: Python ----------
from compas.geometry import Frame, Point, Vector
from compas_rhino.conversions import frame_to_rhino
from compas_fab.robots import JointTrajectoryPoint, Duration
from compas.data import json_load


frames = [
    Frame(point=Point(x=15261.663, y=7508.276, z=400.282), xaxis=Vector(x=-1.000, y=0.000, z=0.000), yaxis=Vector(x=-0.000, y=-0.707, z=-0.707)), 
    Frame(point=Point(x=11316.769, y=8216.430, z=734.278), xaxis=Vector(x=1.000, y=0.006, z=-0.003), yaxis=Vector(x=-0.006, y=1.000, z=-0.003)),
    Frame(point=Point(x=15216.144, y=3156.750, z=978.362), xaxis=Vector(x=-1.000, y=-0.002, z=-0.001), yaxis=Vector(x=0.002, y=-1.000, z=-0.002))
    ]

frames1 = [Frame(point=Point(x=13989.635619185665, y=3154.176983538369, z=1187.1354013799598), xaxis=Vector(x=-0.999997500009375, y=-0.0019999950000186926, z=-0.000999997500009375), yaxis=Vector(x=0.0009959935260451934, y=0.002001986987090738, z=-0.999997500019375)), Frame(point=Point(x=13989.635619185665, y=3154.176983538369, z=4187.13540137996), xaxis=Vector(x=-0.999997500009375, y=-0.0019999950000186926, z=-0.000999997500009375), yaxis=Vector(x=0.0009959935260451934, y=0.002001986987090738, z=-0.999997500019375)), Frame(point=Point(x=12328.657198074916, y=8720.959898027291, z=3789.7385815777275), xaxis=Vector(x=-0.42887848101752335, y=0.9033610317161286, z=-0.0014473758577941403), yaxis=Vector(x=0.9033572698530501, y=0.42887030542165655, z=-0.00398799839252229)), Frame(point=Point(x=12328.657198074916, y=8720.959898027291, z=939.7385815777276), xaxis=Vector(x=-0.42887848101752335, y=0.9033610317161286, z=-0.0014473758577941403), yaxis=Vector(x=0.9033572698530501, y=0.42887030542165655, z=-0.00398799839252229)), Frame(point=Point(x=12328.657198074916, y=8720.959898027291, z=789.7385815777276), xaxis=Vector(x=-0.42887848101752335, y=0.9033610317161286, z=-0.00144737585779414), yaxis=Vector(x=0.9033572698530501, y=0.42887030542165655, z=-0.00398799839252229))]

frames = [frame_to_rhino(f) for f in frames]
frames1 = [frame_to_rhino(f) for f in frames1]


print(len([0, 21.201999999999998, 0, -7.412, -2.96, 0, 0, 0, 0, 0, 0, -2.96, 0, 0, 0, 0, 0, 0, 0, -7.412, -2.96, 0, 0, 0, 0, 0, 0, -2.96, 0, 0, 0, 0, 0, 0]))


l1 = ['bridge1_joint_EA_X', 'bridge2_joint_EA_X', 'robot11_joint_EA_Y', 'robot12_joint_EA_Y', 'robot11_joint_EA_Z', 'robot11_joint_1', 'robot11_joint_2', 'robot11_joint_3', 'robot11_joint_4', 'robot11_joint_5', 'robot11_joint_6', 'robot12_joint_EA_Z', 'robot12_joint_1', 'robot12_joint_2', 'robot12_joint_3', 'robot12_joint_4', 'robot12_joint_5', 'robot12_joint_6', 'robot21_joint_EA_Y', 'robot22_joint_EA_Y', 'robot21_joint_EA_Z', 'robot21_joint_1', 'robot21_joint_2', 'robot21_joint_3', 'robot21_joint_4', 'robot21_joint_5', 'robot21_joint_6', 'robot22_joint_EA_Z', 'robot22_joint_1', 'robot22_joint_2', 'robot22_joint_3', 'robot22_joint_4', 'robot22_joint_5', 'robot22_joint_6']
l2 =['bridge1_joint_EA_X', 'bridge2_joint_EA_X', 'robot11_joint_EA_Y', 'robot12_joint_EA_Y', 'robot11_joint_EA_Z', 'robot11_joint_1', 'robot11_joint_2', 'robot11_joint_3', 'robot11_joint_4', 'robot11_joint_5', 'robot11_joint_6', 'robot12_joint_EA_Z', 'robot12_joint_1', 'robot12_joint_2', 'robot12_joint_3', 'robot12_joint_4', 'robot12_joint_5', 'robot12_joint_6', 'robot21_joint_EA_Y', 'robot22_joint_EA_Y', 'robot21_joint_EA_Z', 'robot21_joint_1', 'robot21_joint_2', 'robot21_joint_3', 'robot21_joint_4', 'robot21_joint_5', 'robot21_joint_6', 'robot22_joint_EA_Z', 'robot22_joint_1', 'robot22_joint_2', 'robot22_joint_3', 'robot22_joint_4', 'robot22_joint_5', 'robot22_joint_6']
l3 =['bridge1_joint_EA_X', 'bridge2_joint_EA_X', 'robot11_joint_EA_Y', 'robot12_joint_EA_Y', 'robot11_joint_EA_Z', 'robot11_joint_1', 'robot11_joint_2', 'robot11_joint_3', 'robot11_joint_4', 'robot11_joint_5', 'robot11_joint_6', 'robot12_joint_EA_Z', 'robot12_joint_1', 'robot12_joint_2', 'robot12_joint_3', 'robot12_joint_4', 'robot12_joint_5', 'robot12_joint_6', 'robot21_joint_EA_Y', 'robot22_joint_EA_Y', 'robot21_joint_EA_Z', 'robot21_joint_1', 'robot21_joint_2', 'robot21_joint_3', 'robot21_joint_4', 'robot21_joint_5', 'robot21_joint_6', 'robot22_joint_EA_Z', 'robot22_joint_1', 'robot22_joint_2', 'robot22_joint_3', 'robot22_joint_4', 'robot22_joint_5', 'robot22_joint_6']
if l1==l2==l3:
    print(True)

# traj0 = json_load("C:\\Users\\paulj\\Downloads\\traj_test.json")
# config = json_load("C:\\Users\\paulj\\Downloads\\config_test.json"), 
# traj1 = json_load("C:\\Users\\paulj\\Downloads\\traj_test1.json")


frm = Frame(point=Point(x=1.580, y=0.000, z=1.195), xaxis=Vector(x=0.000, y=-0.000, z=1.000), yaxis=Vector(x=-0.000, y=-1.000, z=-0.000))

traj_frames = json_load("C:\\Users\\paulj\\Downloads\\traj_frames.json")
traj_frames = [frame_to_rhino(f) for f in traj_frames]
trajs = json_load("C:\\Users\\paulj\\Downloads\\merged_traj_test.json")
# trajs = json_load("C:\\Users\\paulj\\Downloads\\plate_0_trajs.json")
# ---------- end python_3_script ----------
plane = Plane(python_3_script.traj_frames)  # disabled
number_slider_7 = Slider(0.09, range=0..1)  # disabled
point = Point(plane)  # disabled
trajectory_visualize = COMPASFABTrajectoryVisualize(robot=compas_fab_attached_tool, group="robot12_eaXYZ", trajectory=python_3_script.trajs)  # -> start_configuration, configurations, fraction, time, planes, P, V, A; inputs group: String; disabled; same code as compas_fab_trajectory_visualize
polyline = PolyLine(Vertices=point, Closed=False)  # disabled
point_list = PointList(Points=point, Size=number_slider_7)  # disabled
Z = UnitZ(Factor=1)
panel_2 = Panel(trajectory_visualize.start_configuration)  # disabled
python_3_script_2 = Python3Script()  # -> out, cf, tf, config; disabled
# ---------- python_3_script_2: Python ----------
from compas.geometry import Frame, Vector, Point
from compas_robots import Configuration

tf = Frame(point=Point(x=10.609, y=1.006, z=3.500), xaxis=Vector(x=-1.000, y=-0.000, z=0.000), yaxis=Vector(x=-0.000, y=1.000, z=-0.001))
cf = Frame(point=Point(x=10.649, y=5.361, z=0.426), xaxis=Vector(x=-1.000, y=0.000, z=0.000), yaxis=Vector(x=0.000, y=0.707, z=0.707))

config = Configuration((10.617, 30.000, -1.004, -12.000, -3.451, 0.249, -1.168, 0.433, 3.140, 0.835, -0.248, -4.500, 0.000, 1.571, 0.000, 0.000, 0.000, 0.000, 0.000, -7.412, -2.960, 0.000, 0.000, 0.000, 0.000, 0.000, 0.000, -2.960, 0.000, 0.000, 0.000, 0.000, 0.000, 0.000), (2, 2, 2, 2, 2, 0, 0, 0, 0, 0, 0, 2, 0, 0, 0, 0, 0, 0, 2, 2, 2, 0, 0, 0, 0, 0, 0, 2, 0, 0, 0, 0, 0, 0), ('bridge1_joint_EA_X', 'bridge2_joint_EA_X', 'robot11_joint_EA_Y', 'robot12_joint_EA_Y', 'robot11_joint_EA_Z', 'robot11_joint_1', 'robot11_joint_2', 'robot11_joint_3', 'robot11_joint_4', 'robot11_joint_5', 'robot11_joint_6', 'robot12_joint_EA_Z', 'robot12_joint_1', 'robot12_joint_2', 'robot12_joint_3', 'robot12_joint_4', 'robot12_joint_5', 'robot12_joint_6', 'robot21_joint_EA_Y', 'robot22_joint_EA_Y', 'robot21_joint_EA_Z', 'robot21_joint_1', 'robot21_joint_2', 'robot21_joint_3', 'robot21_joint_4', 'robot21_joint_5', 'robot21_joint_6', 'robot22_joint_EA_Z', 'robot22_joint_1', 'robot22_joint_2', 'robot22_joint_3', 'robot22_joint_4', 'robot22_joint_5', 'robot22_joint_6'))
# ---------- end python_3_script_2 ----------
compas_draw_6 = COMPASDraw(cg=python_3_script_2.cf)  # -> rg; disabled; same code as compas_draw
compas_draw_7 = COMPASDraw(cg=python_3_script_2.tf)  # -> rg; disabled; same code as compas_draw

# ----
# module double height tall
knob = ControlKnob(Decimals=0, Limit=True, Maximum=40, Minimum=0, Range=40, Value=37)
panel_3 = Panel("""28
24
10
23
26
27
22
25
6
7
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""")
geo_2 = Geometry([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])

scale = Scale(Geometry=geo_2, Center=Point(0, 0, 0), Factor=Slider(0.001, range=0..0.001))  # -> Geometry, Transform
area = Area(Geometry=scale.Geometry)  # -> Area, Centroid
item_6 = ListItem(List=area.Centroid, Index=0, Wrap=True)
vec2pt = Vector2Pt(PointA=item_6, PointB=pt, Unitize=False)  # -> Vector, Length
rotate = Rotate(Geometry=scale.Geometry, Angle=1.570796327, Plane=item_6)  # -> Geometry, Transform
move = Move(Geometry=rotate.Geometry, Motion=vec2pt.Vector)  # -> Geometry, Transform
area_2 = Area(Geometry=move.Geometry)  # -> Area, Centroid

python_3_script_3 = Python3Script(geo=move.Geometry, order=panel_3, step=knob)  # -> out, shown_geo; inputs geo: list of GeometryBase, step: Int32
# ---------- python_3_script_3: Python ----------
# Inputs:
# geo   : geometry list
# order : panel or list
# step  : integer slider

sorted_geo = []
shown_geo = []
clean_order = []

# -----------------------------------
# convert order into a proper list
# -----------------------------------
if isinstance(order, str):
    raw_items = order.splitlines()
else:
    try:
        raw_items = list(order)
    except:
        raw_items = [order]

# -----------------------------------
# clean and convert to integers
# -----------------------------------
for item in raw_items:
    s = str(item).strip()
    if not s:
        continue
    try:
        clean_order.append(int(s))
    except:
        pass

# -----------------------------------
# sort geometry by custom order
# this uses 0-based indexing
# -----------------------------------
for idx in clean_order:
    if 0 <= idx < len(geo):
        sorted_geo.append(geo[idx])

# -----------------------------------
# cumulative reveal with slider
# -----------------------------------
step = max(0, min(step, len(sorted_geo)))
shown_geo = sorted_geo[:step]

# Outputs:
# A = clean_order
# B = sorted_geo
# C = shown_geo
# ---------- end python_3_script_3 ----------
point_list_2 = PointList(Points=area_2.Centroid, Size="0.2")
lng = ListLength(List=python_3_script_3.shown_geo)
custom_preview = CustomPreview(
    Geometry=python_3_script_3.shown_geo,
    Material={diffuse=RGB(221, 160, 221), emission=RGB(66, 48, 66), shine=0.5, specular=RGB(255, 255, 255), transparency=0})
x_minus_one = XMinusOne(NumberX=lng)
split = SplitList(List=python_3_script_3.shown_geo, Index=x_minus_one)  # -> ListA, ListB
geo_3 = Geometry(split.ListB)

geo_4 = Geometry(split.ListA)
mesh_5 = MeshBrep(Brep=geo_4, Settings=jagged)
merge_3 = Merge(Data1=mesh_2, Data2=mesh_5)  # -> flatten(Result)
cm = COMPASFABCollisionMesh(scene=scene, mesh=merge_3, identifier="col_mesh", append=toggle)  # -> ok; inputs mesh: Mesh, identifier: String, add: Boolean, append: Boolean, remove: Boolean
#   port scene: The planning scene.
#   port mesh: A collision mesh.
#   port identifier: The identifier of the collision mesh.
#   port add: If True, adds the collision mesh to the planning scene.
#   port append: If True, appends the collision mesh to the planning scene.
#   port remove: If True, removes the collision mesh from the planning scene.
#   port ok: True if the operation was successfully performed.
# ---------- cm: Python ----------
# r: compas_fab>=1.0.2
"""
Add or remove a collision mesh from the planning scene.

COMPAS FAB v1.0.2
"""

import Grasshopper
import Rhino
from compas_rhino.conversions import mesh_to_compas

from compas_fab.ghpython.components import error
from compas_fab.ghpython.components import message
from compas_fab.robots import CollisionMesh


class CollisionMeshComponent(Grasshopper.Kernel.GH_ScriptInstance):
    @property
    def component(self):
        return ghenv.Component

    def RunScript(self,
            scene,
            mesh: Rhino.Geometry.Mesh,
            identifier: str,
            add: bool,
            append: bool,
            remove: bool):
        ok = False
        message(self.component, "")

        if (add and append) or (append and remove) or (add and remove):
            error(self.component, "Use only one operation at a time\n(add, append or remove)")
            return

        if scene and mesh and identifier:
            compas_mesh = mesh_to_compas(mesh)
            collision_mesh = CollisionMesh(compas_mesh, identifier)
            if add:
                scene.add_collision_mesh(collision_mesh)
                message(self.component, "Added")
                ok = True
            if append:
                scene.append_collision_mesh(collision_mesh)
                message(self.component, "Appended")
                ok = True
            if remove:
                scene.remove_collision_mesh(identifier)
                message(self.component, "Removed")
                ok = True
        return ok
# ---------- end cm ----------
debrep = DeconstructBrep(Brep=geo_3)  # -> Faces, Edges, Vertices
mesh_6 = Mesh(geo_3)
area_3 = Area(Geometry=debrep.Faces)  # -> Area, Centroid
sort = SortList(Keys=area_3.Area, ValuesA=debrep.Faces)  # -> Keys, ValuesA
rev = ReverseList(List=sort.ValuesA)
split_2 = SplitList(List=rev, Index=Slider(4, range=0..10))  # -> ListA, ListB
evalsrf = EvaluateSurface(Surface=reparameterize(split_2.ListA), Point="0.5, 0.5")  # -> Point, Normal, UDirection, VDirection, Frame
pt_4 = Point(evalsrf.Point)
angle = Angle(VectorA=evalsrf.Normal, VectorB=Z)  # -> Angle, Reflex
sort_2 = SortList(Keys=angle.Angle, ValuesA=evalsrf.Frame)  # -> Keys, ValuesA

# ---- group: PLACE
item_7 = ListItem(List=sort_2.ValuesA, Index=0, Wrap=True)

# ----
deplane = DeconstructPlane(Plane=item_7)  # -> Origin, XAxis, YAxis, ZAxis
pflip_2 = FlipPlane(Plane=item_7, ReverseX=False, ReverseY=False, SwapAxes=True)
constraints_from_plane_4 = COMPASFABConstraintsFromPlane(robot=data_2, plane=pflip_2, group=data)  # -> constraints; inputs group: String, tolerance_position: Double, tolerance_xaxis: Double, tolerance_yaxis: Double, tolerance_zaxis: Double; same code as constraints_from_plane
orient = Orient(Geometry=mesh_6, Source=pflip_2, Target=PlaneXY(0, 0, 0))  # -> Geometry, Transform
geo_5 = Geometry(orient.Geometry)
acm = COMPASFABAttachedCollisionMesh(scene=scene, mesh=geo_5, identifier="current_beam", link_name="robot12_tool0", add=toggle)  # -> attached_collision_mesh; inputs mesh: Mesh, identifier: String, link_name: String, touch_links: list of String, add: Boolean, remove: Boolean
#   port scene: The planning scene.
#   port mesh: A collision mesh.
#   port identifier: The identifier of the collision mesh.
#   port link_name: The robot's link name to attach the mesh to.
#   port touch_links: Names of links that the robot is allowed to touch.
#   port add: If True, adds the collision mesh to the planning scene.
#   port remove: If True, removes the collision mesh from the planning scene.
#   port attached_collision_mesh: A collision mesh that is attached to a robot's link.
# ---------- acm: Python ----------
# r: compas_fab>=1.0.2
"""
Add an attached collision mesh to the robot.

COMPAS FAB v1.0.2
"""

import Grasshopper
import Rhino
import System
from compas_rhino.conversions import mesh_to_compas

from compas_fab.robots import AttachedCollisionMesh
from compas_fab.robots import CollisionMesh


class AttachedCollisionMeshComponent(Grasshopper.Kernel.GH_ScriptInstance):
    def RunScript(self,
            scene,
            mesh: Rhino.Geometry.Mesh,
            identifier: str,
            link_name: str,
            touch_links: System.Collections.Generic.List[str],
            add: bool,
            remove: bool):
        attached_collision_mesh = None
        if scene and mesh and identifier and link_name:
            compas_mesh = mesh_to_compas(mesh)
            collision_mesh = CollisionMesh(compas_mesh, identifier)
            attached_collision_mesh = AttachedCollisionMesh(collision_mesh, link_name, touch_links)
            if add:
                scene.add_attached_collision_mesh(attached_collision_mesh)
            if remove:
                scene.remove_attached_collision_mesh(identifier)
                scene.remove_collision_mesh(identifier)
        return attached_collision_mesh
# ---------- end acm ----------
plan_motion_2 = COMPASFABPlanMotion(
    robot=compas_fab_attached_tool,
    goal_constraints=constraints_from_plane_3,
    start_configuration=item_5.Item1,
    group="robot12_eaXYZ",
    attached_collision_meshes=acm,
    compute=Button())  # -> trajectory; inputs goal_constraints: list, group: String, attached_collision_meshes: list, path_constraints: list, planner_id: String, compute: Boolean; same code as plan_motion
compas_fab_trajectory_visualize_2 = COMPASFABTrajectoryVisualize(robot=compas_fab_attached_tool, group="robot12_eaXYZ", trajectory=plan_motion_2)  # -> start_configuration, configurations, fraction, time, planes, P, V, A; inputs group: String; same code as compas_fab_trajectory_visualize
item_8 = ListItem(List=compas_fab_trajectory_visualize_2.configurations, Index=0, Wrap=True)  # -> Item1, Item
amp = Amplitude(Vector=deplane.ZAxis, Amplitude=Slider(0.3, range=0..1))

# ---- group: APPROACH
move_2 = Move(Geometry=pflip_2, Motion=amp)  # -> Geometry, Transform

# ----
merge_4 = Merge(
    Data1=flatten(pln_2),
    Data2=flatten(pflip),
    Data3=flatten(move_2.Geometry),
    Data4=flatten(pflip_2),
    Data5=flatten(move_2.Geometry),
    Data6=flatten(pflip))  # -> flatten(Result)
pln_4 = Plane(move_2.Geometry)
pln_5 = Plane(move_2.Geometry)
constraints_from_plane_5 = COMPASFABConstraintsFromPlane(robot=data_2, plane=pln_4, group=data)  # -> constraints; inputs group: String, tolerance_position: Double, tolerance_xaxis: Double, tolerance_yaxis: Double, tolerance_zaxis: Double; same code as constraints_from_plane
constraints_from_plane_6 = COMPASFABConstraintsFromPlane(robot=data_2, plane=pln_5, group=data)  # -> constraints; inputs group: String, tolerance_position: Double, tolerance_xaxis: Double, tolerance_yaxis: Double, tolerance_zaxis: Double; same code as constraints_from_plane
item_9 = ListItem(List=merge_4, Index=Slider(5, range=0..6), Wrap=True)
plan_cartesian_motion = COMPASFABPlanCartesianMotion(
    robot=compas_fab_attached_tool,
    planes=merge_4,
    start_configuration=py3_2.config,
    group="robot12_eaXYZ",
    max_step=Slider(0.1, range=0..0.1),
    compute=Button())  # -> trajectory; inputs planes: list, group: String, attached_collision_meshes: list, path_constraints: list, max_step: Double, compute: Boolean
#   port planes: The planes or frames through which the path is defined.
#   port start_configuration: The robot's full configuration, i.e. values for all configurable joints of the entire robot, at the starting position. Defaults to the all-zero configuration.
#   port group: The planning group used for calculation. Defaults to the robot's main planning group.
#   port attached_collision_meshes: A list of attached collision meshes to be included for planning.
#   port path_constraints: Optional constraints that can be imposed along the solution path. Note that path calculation won't work if the start_configuration violates these constraints. Defaults to None.
#   port max_step: The approximate distance between the calculated points. (Defined in the robot's units.) Defaults to 0.01.
#   port compute: If True, calculates a trajectory.
#   port trajectory: The calculated trajectory.
# ---------- plan_cartesian_motion: Python ----------
# r: compas_fab>=1.0.2
"""
Calculate a cartesian motion path (linear in tool space).

COMPAS FAB v1.0.2
"""

import Grasshopper
import System
from compas_ghpython import create_id
from compas_rhino.conversions import plane_to_compas_frame
from scriptcontext import sticky as st


class PlanCartesianMotion(Grasshopper.Kernel.GH_ScriptInstance):
    def RunScript(self,
            robot,
            planes: System.Collections.Generic.List[object],
            start_configuration,
            group: str,
            attached_collision_meshes: System.Collections.Generic.List[object],
            path_constraints: System.Collections.Generic.List[object],
            max_step: float,
            compute: bool):
        key = create_id(ghenv.Component, "trajectory")  # noqa: F821

        max_step = float(max_step) if max_step else 0.01
        path_constraints = list(path_constraints) if path_constraints else None
        attached_collision_meshes = list(attached_collision_meshes) if attached_collision_meshes else None

        if robot and robot.client and robot.client.is_connected and start_configuration and planes and compute:
            frames = [plane_to_compas_frame(plane) for plane in planes]
            st[key] = robot.plan_cartesian_motion(
                frames,
                start_configuration=start_configuration,
                group=group,
                options=dict(
                    max_step=max_step,
                    path_constraints=path_constraints,
                    attached_collision_meshes=attached_collision_meshes,
                ),
            )

        trajectory = st.get(key, None)
        return trajectory
# ---------- end plan_cartesian_motion ----------
plan_motion_3 = COMPASFABPlanMotion(
    robot=compas_fab_attached_tool,
    goal_constraints=constraints_from_plane_6,
    start_configuration=item_8.Item1,
    group="robot12_eaXYZ",
    attached_collision_meshes=acm,
    compute=Button())  # -> trajectory; inputs goal_constraints: list, group: String, attached_collision_meshes: list, path_constraints: list, planner_id: String, compute: Boolean; same code as plan_motion
compas_fab_trajectory_visualize_3 = COMPASFABTrajectoryVisualize(robot=compas_fab_attached_tool, group="robot12_eaXYZ", trajectory=plan_cartesian_motion)  # -> start_configuration, configurations, fraction, time, planes, P, V, A; inputs group: String; same code as compas_fab_trajectory_visualize
compas_fab_trajectory_visualize_4 = COMPASFABTrajectoryVisualize(robot=compas_fab_attached_tool, group="robot12_eaXYZ", trajectory=plan_motion_3)  # -> start_configuration, configurations, fraction, time, planes, P, V, A; inputs group: String; same code as compas_fab_trajectory_visualize
item_10 = ListItem(List=compas_fab_trajectory_visualize_4.configurations, Index=0, Wrap=True)  # -> Item1, Item
plan_motion_4 = COMPASFABPlanMotion(
    robot=compas_fab_attached_tool,
    goal_constraints=constraints_from_plane_4,
    start_configuration=item_10.Item1,
    group="robot12_eaXYZ",
    compute=Button())  # -> trajectory; inputs goal_constraints: list, group: String, attached_collision_meshes: list, path_constraints: list, planner_id: String, compute: Boolean; same code as plan_motion
compas_fab_trajectory_visualize_5 = COMPASFABTrajectoryVisualize(robot=compas_fab_attached_tool, group="robot12_eaXYZ", trajectory=plan_motion_4)  # -> start_configuration, configurations, fraction, time, planes, P, V, A; inputs group: String; same code as compas_fab_trajectory_visualize
item_11 = ListItem(List=compas_fab_trajectory_visualize_5.configurations, Index=0, Wrap=True)  # -> Item1, Item
plan_motion_5 = COMPASFABPlanMotion(
    robot=compas_fab_attached_tool,
    goal_constraints=constraints_from_plane_5,
    start_configuration=item_11.Item1,
    group="robot12_eaXYZ",
    compute=Button())  # -> trajectory; inputs goal_constraints: list, group: String, attached_collision_meshes: list, path_constraints: list, planner_id: String, compute: Boolean; same code as plan_motion
compas_fab_trajectory_visualize_6 = COMPASFABTrajectoryVisualize(robot=compas_fab_attached_tool, group="robot12_eaXYZ", trajectory=plan_motion_5)  # -> start_configuration, configurations, fraction, time, planes, P, V, A; inputs group: String; same code as compas_fab_trajectory_visualize
item_12 = ListItem(List=compas_fab_trajectory_visualize_6.configurations, Index=0, Wrap=True)  # -> Item1, Item
plan_motion_6 = COMPASFABPlanMotion(
    robot=compas_fab_attached_tool,
    goal_constraints=constraints_from_plane_2,
    start_configuration=item_12.Item1,
    group="robot12_eaXYZ",
    compute=Button())  # -> trajectory; inputs goal_constraints: list, group: String, attached_collision_meshes: list, path_constraints: list, planner_id: String, compute: Boolean; same code as plan_motion
compas_fab_trajectory_visualize_7 = COMPASFABTrajectoryVisualize(robot=compas_fab_attached_tool, group="robot12_eaXYZ", trajectory=plan_motion_6)  # -> start_configuration, configurations, fraction, time, planes, P, V, A; inputs group: String; same code as compas_fab_trajectory_visualize
merge_5 = Merge(
    Data1=plan_motion,
    Data2=plan_motion_2,
    Data3=plan_motion_3,
    Data4=plan_motion_4,
    Data5=plan_motion_5,
    Data6=plan_motion_6)  # -> flatten(Result)
py3_4 = Python3Script(x=merge_5)  # -> out, combined_trajs; inputs x: list, y: list
# ---------- py3_4: Python ----------
from compas_fab.robots import JointTrajectory
from compas_fab.robots.time_ import Duration

def combine_trajectories(trajectories: list[JointTrajectory]) -> JointTrajectory:
    """
    Combines a list of sequential trajectories into one.

    This function correctly recalculates the time_from_start
    for each point and handles potential None values in planning_time
    and fraction.
    """
    if not trajectories:
        return JointTrajectory()

    # Use metadata from the first trajectory
    first_traj = trajectories[0]
    print("ATTRIBUTES OF FIRST TRAJECTORY:")
    print(first_traj.attributes)
    combined_points = []
    combined_joint_names = first_traj.joint_names
    combined_start_config = first_traj.start_configuration

    total_planning_time = 0.0
    time_offset = Duration(0, 0)  # This will accumulate the time
    all_fractions_complete = True

    for traj in trajectories:
        if not traj.points:
            continue

        if traj.joint_names != combined_joint_names:
            raise ValueError("Cannot combine trajectories with different joint_names.")

        # Get the duration of this trajectory segment
        segment_duration = traj.points[-1].time_from_start

        for point in traj.points:
            # Create a copy to avoid modifying the original trajectory
            new_point = point.copy()

            # Manually add components since Duration does not support '+'
            new_secs = time_offset.secs + new_point.time_from_start.secs
            new_nsecs = time_offset.nsecs + new_point.time_from_start.nsecs

            # Create a new Duration object; its __init__ will normalize the values
            new_point.time_from_start = Duration(new_secs, new_nsecs)

            combined_points.append(new_point)

        # Update the time_offset manually
        new_offset_secs = time_offset.secs + segment_duration.secs
        new_offset_nsecs = time_offset.nsecs + segment_duration.nsecs
        time_offset = Duration(new_offset_secs, new_offset_nsecs)

        # --- THIS IS THE FIX for planning_time ---
        # Accumulate planning time, checking if it is None
        if traj.planning_time is not None:
            total_planning_time += traj.planning_time
        # --- END FIX ---

        # --- THIS IS THE FIX for fraction ---
        # Check if any trajectory was incomplete or has an unknown fraction
        if traj.fraction is None or traj.fraction < 1.0:
            all_fractions_complete = False
        # --- END FIX ---

    # Create the new, combined trajectory
    combined_trajectory = JointTrajectory(
        trajectory_points=combined_points, joint_names=combined_joint_names, start_configuration=combined_start_config, attributes=first_traj.attributes.copy()
    )

    combined_trajectory.planning_time = total_planning_time

    # If all fractions were 1.0, the combined fraction is 1.0
    # Otherwise, it's None (as we can't sum/average them)
    combined_trajectory.fraction = 1.0 if all_fractions_complete else None

    return combined_trajectory


combined_trajs = combine_trajectories(x)
# ---------- end py3_4 ----------
dam = DataDam(DataA=py3_4.combined_trajs, BufferDelay=10000000, BufferMode=0)
compas_fab_trajectory_visualize_8 = COMPASFABTrajectoryVisualize(robot=compas_fab_attached_tool, group="robot12_eaXYZ", trajectory=dam)  # -> start_configuration, configurations, fraction, time, planes, P, V, A; inputs group: String; same code as compas_fab_trajectory_visualize
compas_fab_forward_kinematics = COMPASFABForwardKinematics(robot=compas_fab_attached_tool, config=compas_fab_trajectory_visualize_8.configurations, group="robot12_eaXYZ")  # -> frame; inputs group: String, link: String, use_only_model: Boolean
#   port config: The configuration to calculate the forward kinematics for.
#   port group: The planning group used for calculation. Defaults to the robot's main planning group.
#   port link: The link name to calculate forward kinematics for. Defaults to the robot's end effector.
#   port use_only_model: If True, use only the robot model instead of the connected backend to calculate FK.
#   port frame: The resulting frame.
# ---------- compas_fab_forward_kinematics: Python ----------
# r: compas_fab>=1.0.2
"""
Calculate the robot's forward kinematic for a given configuration.

COMPAS FAB v1.0.2
"""

import Grasshopper


class ForwardKinematics(Grasshopper.Kernel.GH_ScriptInstance):
    def RunScript(self, robot, config, group: str, link: str, use_only_model: bool):
        frame = None
        if robot and config:
            options = {}
            if link:
                options["link"] = link
            if use_only_model:
                options["solver"] = "model"
            frame = robot.forward_kinematics(config, group, options=options)
        return frame
# ---------- end compas_fab_forward_kinematics ----------
list_item = ListItem(List=compas_fab_trajectory_visualize_8.configurations, Index=number_slider_2, Wrap=invert(True))
compas_draw_8 = COMPASDraw(cg=compas_fab_forward_kinematics)  # -> rg; same code as compas_draw
list_item_2 = ListItem(List=compas_draw_8, Index=0, Wrap=True)  # -> flatten(Item)
compas_fab_robot_visualize = COMPASFABRobotVisualize(
    robot=compas_fab_attached_tool,
    group="robot12_eaXYZ",
    configuration=list_item,
    show_visual=Toggle(True),
    show_end_effector_frame=Toggle(False))  # -> out, visual, collision, collision_meshes, attached_meshes, frames, base_frame, ee_frame; inputs group: String, show_visual: Boolean, show_collision: Boolean, show_frames: Boolean, show_base_frame: Boolean, show_end_effector_frame: Boolean, show_cm: Boolean, show_acm: Boolean
#   port group: The planning group used for end-effector and base visualization.
#   port configuration: The robot's full configuration.
#   port show_visual: Whether or not to show the robot's visual meshes.
#   port show_collision: Whether or not to show the robot's collision meshes.
#   port show_frames: Whether or not to show the robot's joint frames.
#   port show_base_frame: Whether or not to show the robot's base frame.
#   port show_end_effector_frame: Whether or not to show the robot's end-effector frame.
#   port show_cm: Whether or not to show the collision meshes (if any).
#   port show_acm: Whether or not to show the attached collision meshes (if any).
#   port visual: Rhino meshes of the robot's visual geometry (if any).
#   port collision: Rhino meshes of the robot's collision geometry (if any).
#   port collision_meshes: Rhino meshes of the scene's collision meshes (if any).
#   port attached_meshes: Rhino meshes of the scene's attached collision meshes (if any).
#   port frames: The robot's joint frames as Rhino planes (if any).
#   port base_frame: The robot's base frame as a Rhino plane (if any).
#   port ee_frame: The robot's end-effector frame as a Rhino plane (if any).
# ---------- compas_fab_robot_visualize: Python ----------
# r: compas_fab>=1.0.2
"""
Visualizes the robot.

COMPAS FAB v1.0.2
"""

import time

import Grasshopper
from compas_ghpython import create_id
from compas_rhino.conversions import frame_to_rhino_plane
from scriptcontext import sticky as st

from compas.geometry import Frame
from compas.geometry import Transformation
from compas.scene import SceneObject
from compas_fab.backends import BackendFeatureNotSupportedError
from compas_fab.robots import PlanningScene


class RobotVisualize(Grasshopper.Kernel.GH_ScriptInstance):
    def RunScript(self,
            robot,
            group: str,
            configuration,
            show_visual: bool,
            show_collision: bool,
            show_frames: bool,
            show_base_frame: bool,
            show_end_effector_frame: bool,
            show_cm: bool,
            show_acm: bool):
        visual = None
        collision = None
        collision_meshes = None
        attached_meshes = None
        frames = None
        base_frame = None
        ee_frame = None

        import compas_fab
        print(compas_fab.__version__)
        if robot:
            show_visual = True if show_visual is None else show_visual
            show_cm = True if show_cm is None else show_cm
            show_acm = True if show_acm is None else show_acm
            configuration = configuration or robot.zero_configuration()

            robot.update(configuration, visual=show_visual, collision=show_collision)
            compas_frames = robot.transformed_frames(configuration, group)

            if show_visual:
                visual = robot.scene_object.draw_visual()

            if show_collision:
                collision = robot.scene_object.draw_collision()

            if show_base_frame:
                base_compas_frame = compas_frames[0]
                base_frame = frame_to_rhino_plane(base_compas_frame)

            if show_end_effector_frame:
                options = dict(solver="model")
                if robot.attached_tool:
                    print("attached_tool", robot.attached_tool)
                    options["link"] = robot.attached_tool.connected_to

                ee_compas_frame = robot.forward_kinematics(configuration, group, options=options)
                ee_frame = frame_to_rhino_plane(ee_compas_frame)

            if show_frames:
                frames = []
                for compas_frame in compas_frames[1:]:
                    frame = frame_to_rhino_plane(compas_frame)
                    frames.append(frame)

            cached_scene_key = create_id(ghenv.Component, "cached_scene")  # noqa: F821

            if show_cm or show_acm:
                cached_scene = st.get(cached_scene_key)
                if not cached_scene:
                    cached_scene = {"time": 0}

                # expire cache if the component has not been executed in the last 2 seconds
                # this allows to slide through a list of configurations
                # without triggering refreshes of the scene in the middle of it
                if time.time() - cached_scene["time"] > 2:
                    update_scene = True
                else:
                    update_scene = False
                update_scene = True

                if update_scene:
                    scene = PlanningScene(robot)
                    try:
                        scene = robot.client.get_planning_scene()
                        print("type(scene)", type(scene))
                    except BackendFeatureNotSupportedError:
                        print(
                            "The selected backend does not support collision meshes. If you need collision mesh support, use a different backend."
                        )
                        scene = None
                        show_cm = False
                        show_acm = False

                if update_scene and show_cm:
                    collision_meshes = []

                    for co in scene.world.collision_objects:
                        header = co.header
                        frame_id = header.frame_id
                        cms = co.to_collision_meshes()

                        for cm in cms:
                            if cm.frame != Frame.worldXY():
                                t = Transformation.from_frame(cm.frame)
                                mesh = cm.mesh.transformed(t)
                            else:
                                mesh = cm.mesh

                            collision_meshes.extend(SceneObject(item=mesh).draw())

                        cached_scene["cm"] = collision_meshes

                collision_meshes = cached_scene.get("cm", [])

                if update_scene and show_acm:
                    attached_meshes = []

                    for aco in scene.robot_state.attached_collision_objects:
                        print("aco", aco.to_attached_collision_meshes())
                        for acm in aco.to_attached_collision_meshes():
                            frame_id = aco.object["header"]["frame_id"]
                            print("acm", acm.touch_links)
                            frame = robot.forward_kinematics(configuration, group=group, options=dict(link=frame_id))
                            t = Transformation.from_frame(frame)

                            # Local CM frame
                            if acm.collision_mesh.frame and acm.collision_mesh.frame != Frame.worldXY():
                                t = t * Transformation.from_frame(acm.collision_mesh.frame)

                            mesh = acm.collision_mesh.mesh.transformed(t)

                            attached_meshes.extend(SceneObject(item=mesh).draw())

                    cached_scene["acm"] = attached_meshes

                attached_meshes = cached_scene.get("acm", [])

                cached_scene["time"] = time.time()
                st[cached_scene_key] = cached_scene

        return (
            visual,
            collision,
            collision_meshes,
            attached_meshes,
            frames,
            base_frame,
            ee_frame,
        )
# ---------- end compas_fab_robot_visualize ----------
point_2 = Point(list_item_2)
polyline_2 = PolyLine(Vertices=point_2, Closed=False)  # -> reparameterize(Polyline)
curve_closest_point = CurveClosestPoint(Point=point_2, Curve=polyline_2)  # -> Point, Parameter, Distance
point_on_curve = PointOnCurve(polyline_2, parameter=0)
split_list = SplitList(List=point_2, Index=number_slider_2)  # -> ListA, ListB
list_item_3 = ListItem(List=compas_fab_robot_visualize.visual, Index=0, Wrap=True)
mesh_7 = Mesh(compas_fab_robot_visualize.attached_meshes)
gradient = Gradient(
    LowerLimit=0,
    UpperLimit=1,
    Parameter=curve_closest_point.Parameter,
    stops=[0: RGB(243, 57, 0), 0: RGB(173, 188, 234), 0.1: RGB(236, 27, 60), 0.2: RGB(210, 0, 118), 0.254: RGB(103, 0, 120), 0.366: RGB(39, 72, 161), 0.5: RGB(1, 192, 229), 0.6: RGB(18, 178, 90), 0.7: RGB(79, 186, 8), 0.8: RGB(220, 237, 32), 0.9: RGB(247, 159, 20), 1: RGB(243, 57, 0)])
gl_shader = GLShader(
    Vertex=split_list.ListA,
    Vcolor=gradient,
    DepthTestingEnabled=True,
    DepthWritingEnabled=True,
    DrawMode=3,
    FragmentShader="""#version 330

in vec4 vertex_color;
out vec4 final_color;

void main()
{
  final_color = vertex_color;
}""",
    GLShader=(0, 2, 0),
    PreviewSortOrder=5,
    VertexShader="""#version 330

layout(location = 0) in vec3 vertex;
layout(location = 1) in vec4 vcolor;
uniform mat4 _worldToClip;
out vec4 vertex_color;

void main() 
{
  vertex_color = vcolor;
  gl_Position = _worldToClip * vec4(vertex,1);
}""",
    glLineWidth=3,
    glPointSize=8)  # -> Color, Depth
